# Grasshopper definition bridge.gh (Grasshopper 1.0.8)
# Copyright: GNU Lesser General Public License Version 3
# Copyright: GNU Lesser General Public License v3.0 or later
# plug-ins: RhinoCodePluginGH, semio

save_representation = BooleanToggle(False)
icon_export = BooleanToggle(False)
validate = BooleanToggle(False)
save = BooleanToggle(False)
sep = Separator()  # -> S; same code as sep
dir = Directory()  # -> D
# ---------- dir: C# ----------
#region Usings
using System;
using System.Linq;
using System.Collections;
using System.Collections.Generic;
using System.Drawing;
using System.IO;

using Rhino;
using Rhino.Geometry;

using Grasshopper;
using Grasshopper.Kernel;
using Grasshopper.Kernel.Data;
using Grasshopper.Kernel.Types;
#endregion

public class Script_Instance : GH_ScriptInstance
{
    private void RunScript(ref object D)
    {
        D = Path.GetDirectoryName(this.GrasshopperDocument.FilePath);
    }
}
# ---------- end dir ----------
# ^                                    ^
#    |                                     |
# <-- Constants    Preview -->
# Parameters    External    Local -->
# <-- Meta               |
#      |                       v
#      v
par = ParentDirectory(D=dir)  # -> P; inputs D: String
# ---------- par: C# ----------
#region Usings
using System;
using System.Linq;
using System.Collections;
using System.Collections.Generic;
using System.Drawing;
using System.IO;

using Rhino;
using Rhino.Geometry;

using Grasshopper;
using Grasshopper.Kernel;
using Grasshopper.Kernel.Data;
using Grasshopper.Kernel.Types;
#endregion

public class Script_Instance : GH_ScriptInstance
{
    private void RunScript(string D, ref object P)
    {
        P = new DirectoryInfo(D).Parent;
    }
}
# ---------- end par ----------
and = GateAnd(A=save, B=icon_export)
and_2 = GateAnd(A=save, B=save_representation)
variant = GetString("", AtLeast=0, AtMost=1, TreeAccess=False)
expression = Expression(x=Slider(260, range=0..1000), Expression="x/100")
expression_2 = Expression(x=Slider(40, range=0..100), Expression="x/100")
expression_3 = Expression(x=Slider(250, range=0..1000), Expression="x/100")
length_m = Number(expression)
panel = Panel("Parallel")  # disabled
width_m = Number(length_m)
east_length_m = Number(length_m)
gap_m = Number(expression_2)
height_m = Number(expression_3)
west_length_m = Number(length_m)
m2d_rhino = Make2DRhinoView(Name=panel, Clip=True)  # disabled
number_slider = Slider(876, range=0..1000)  # disabled
view_rectangle = ViewRectangle(view=m2d_rhino)  # disabled
number_slider_2 = Slider(125, range=0..1000)
genes = GenePool(Decimals=0, Maximum=100, Minimum=0, Value=80)
number_slider_3 = Slider(20, range=0..100)
previewplane = PreviewPlane(plane=view_rectangle, axis_length=number_slider)  # disabled

addition = Addition(A=west_length_m, B=gap_m)
addition_2 = Addition(A=west_length_m, B=east_length_m, C=gap_m)
neg = Negative(Value=width_m)
dom = ConstructDomain(DomainStart=addition, DomainEnd=addition_2)
box = DomainBox(Base=PlaneXY(0, 0, 0), X=addition_2, Y=neg, Z=height_m)
box_2 = DomainBox(Base=PlaneXY(0, 0, 0), X=dom, Y=neg, Z=height_m)
volumeright = Box(box_2)
volumemain = Box(box)

# ----
# 2023-2025 Ueli Saluz
# 2025 Elduane Lumpine
# 2025 Christian Hödtke
# Permission is hereby granted, free of charge, to any person obtaining a copy
# of this Grasshopper file and associated documentation files (the "Document"),
# to deal in the Document without restriction, including without limitation the
# rights to use, copy, modify, merge, publish, distribute, sublicense, and/or sell
# copies of the Document, and to permit persons to whom the Document is
# furnished to do so.
# 
# Individual clusters used inside this document might be licensed under
# different terms. This is indicated through a similar copyright notice group
# inside the cluster and otherwise in the license field of the cluster. If you
# have any question please reach out to us: license@semio-tech.com
# 
# THE DOCUMENT IS PROVIDED "AS IS", WITHOUT WARRANTY OF ANY
# KIND, EXPRESS OR IMPLIED, INCLUDING BUT NOT LIMITED TO THE
# WARRANTIES OF MERCHANTABILITY, FITNESS FOR A PARTICULAR
# PURPOSE AND NONINFRINGEMENT. IN NO EVENT SHALL THE
# AUTHORS OR COPYRIGHT HOLDERS BE LIABLE FOR ANY CLAIM,
# DAMAGES OR OTHER LIABILITY, WHETHER IN AN ACTION OF
# CONTRACT, TORT OR OTHERWISE, ARISING FROM, OUT OF OR IN
# CONNECTION WITH THE DOCUMENT OR THE USE OR OTHER
# DEALINGS IN THE DOCUMENT.
expression_4 = Expression(x=number_slider_3, Expression="x/100")
expression_5 = Expression(x=Slider(1, range=0..100), Expression="x/100")
expression_6 = Expression(x=number_slider_2, Expression="x/100")
expression_7 = Expression(x=genes, Expression="x/100")
parapet_height_m = Number(expression_6)
platform_height_m = Number(expression_4)
parapet_segments_height_m = Number(expression_7)
flooring_height_m = Number(expression_5)
number_slider_4 = Slider(8, range=0..100)
number_slider_5 = Slider(10, range=0..100)
number_slider_6 = Slider(6, range=0..100)
expression_8 = Expression(x=number_slider_5, Expression="x/100")
expression_9 = Expression(x=number_slider_4, Expression="x/100")
expression_10 = Expression(x=number_slider_6, Expression="x/100")
frame_primary_diameter_m = Number(expression_8)

neg_2 = Negative(Value=width_m)
addition_3 = Addition(A=west_length_m, B=gap_m)
addition_4 = Addition(A=neg_2, B=frame_primary_diameter_m)
neg_3 = Negative(Value=frame_primary_diameter_m)
dom_2 = ConstructDomain(DomainStart=west_length_m, DomainEnd=addition_3)
dom_3 = ConstructDomain(DomainStart=neg_3, DomainEnd=addition_4)
rectangle = Rectangle(Plane=PlaneXY(0, 0, 0), XSize=dom_2, YSize=dom_3, Radius=0)  # -> Rectangle, Length
srf = Surface(rectangle.Rectangle)

frame_secondary_diameter_m = Number(expression_9)
frame_tertiary_diameter_m = Number(expression_10)
expression_11 = Expression(x=Slider(250, range=0..1000), Expression="x/100")
expression_12 = Expression(x=Slider(125, range=0..1000), Expression="x/100")
west_addition = Boolean(Toggle(True))
east_addition = Boolean(Toggle(False))
addition_length_m = Number(expression_11)
addition_width_m = Number(expression_12)

cluster = Cluster(
    length=east_length_m,
    width=width_m,
    height=height_m,
    parapetheight=parapet_height_m,
    parapetsegmentsheight=parapet_segments_height_m,
    addition=east_addition,
    additionlength=addition_length_m,
    additionwidth=addition_width_m,
    rodprimarydiameter=frame_primary_diameter_m,
    rodsecondarydiameter=frame_secondary_diameter_m,
    rodtertiarydiameter=frame_tertiary_diameter_m)  # -> ground_2, railinglines_to_mirror_2, railinglines_2, volume_2, volumeside_2, base_2, rods_2, mainframe_2, filledsurface_2
cluster_2 = Cluster(
    length=west_length_m,
    width=width_m,
    height=height_m,
    parapetheight=parapet_height_m,
    parapetsegmentsheight=parapet_segments_height_m,
    addition=west_addition,
    additionlength=addition_length_m,
    additionwidth=addition_width_m,
    rodprimarydiameter=frame_primary_diameter_m,
    rodsecondarydiameter=frame_secondary_diameter_m,
    rodtertiarydiameter=frame_tertiary_diameter_m)  # -> ground_2, railinglines_to_mirror_2, railinglines_2, volume_2, volumeside_2, base_2, rods_2, mainframe_2, filledsurface_2
area = Area(Geometry=cluster.volume_2)  # -> Area, Centroid
neg_4 = Negative(Value=platform_height_m)
sunion = SolidUnion(Breps=cluster.rods_2)
yz = YZPlane(Origin=area.Centroid)
Z = UnitZ(Factor=neg_4)
X = UnitX(Factor=addition_3)
extr = Extrude(Base=cluster_2.base_2, Direction=Z)
mirror = Mirror(Geometry=sunion, Plane=yz)  # -> Geometry, Transform
move = Move(Geometry=mirror.Geometry, Motion=X)  # -> Geometry, Transform
merge = Merge(Data1=mirror.Transform, Data2=move.Transform)
comp = Compound(Transforms=merge)
baseleft = Brep(extr)
transform = Transform(Geometry=cluster.volume_2, Transform=comp)
transform_2 = Transform(Geometry=cluster.volumeside_2, Transform=comp)
merge_2 = Merge(Data1=cluster_2.rods_2, Data2=baseleft)
transform_3 = Transform(Geometry=cluster.ground_2, Transform=comp)
transform_4 = Transform(Geometry=cluster.base_2, Transform=comp)
transform_5 = Transform(Geometry=cluster.filledsurface_2, Transform=comp)
merge_3 = Merge(Data1=cluster_2.filledsurface_2, Data2=transform_5)
transform_6 = Transform(Geometry=cluster.mainframe_2, Transform=comp)
merge_4 = Merge(Data1=cluster_2.mainframe_2, Data2=transform_6)
merge_5 = Merge(Data1=cluster_2.rods_2, Data2=move.Geometry)
sunion_2 = SolidUnion(Breps=merge_2)
extr_2 = Extrude(Base=transform_4, Direction=Z)
rodsmain = Brep(merge_4)
surface = Brep(merge_3)
merge_6 = Merge(Data1=cluster_2.ground_2, Data2=srf, Data3=transform_3)
rods = Brep(merge_5)
baseright = Brep(extr_2)
join = BrepJoin(Breps=merge_6)  # -> Breps, Closed
merge_7 = Merge(Data1=baseleft, Data2=baseright)
merge_8 = Merge(Data1=move.Geometry, Data2=baseright)
fmerge = MergeFaces(Brep=join.Breps)  # -> Breps, Before, After
Z_2 = UnitZ(Factor=flooring_height_m)
base = Brep(merge_7)
sunion_3 = SolidUnion(Breps=merge_8)
extr_3 = Extrude(Base=fmerge.Breps, Direction=Z_2)
merge_9 = Merge(Data1=sunion_2, Data2=sunion_3)
metalplate = Brep(extr_3)
merge_10 = Merge(Data1=extr_3, Data2=merge_9)
model1to200 = Brep(merge_10)

concat = Concatenate(FragmentA=par, FragmentB=sep)
concat_2 = Concatenate(FragmentA=par, FragmentB=sep)
panel_2 = Panel("rods")
metalplate_2 = Brep(metalplate)
metalplate_3 = Brep(fmerge.Breps)
rodsmain_2 = Brep(rodsmain)
rods_2 = Brep(rods)
base_2 = Brep(base)
surface_2 = Brep(surface)
merge_11 = Merge(Data1=base_2, Data2=metalplate_2, Data3=rods_2)

surface_3 = Brep(surface)
geo = PreviewGeometry(geo=merge_11, sc=1)

# ----
# Outputs   ->
#                 |
#                 v
base_3 = Brep(merge_7)
area_2 = Area(Geometry=cluster.volume_2)  # -> Area, Centroid
yz_2 = YZPlane(Origin=area_2.Centroid)
explode = ExplodeObject(Object=base_3, Recursive=False)  # -> flatten(Objects)
move_2 = Move(Geometry=fmerge.Breps, Motion=Z_2)  # -> Geometry, Transform
merge_12 = Merge(Data1=base_3, Data2=move_2.Geometry)
wires = BrepWireframe(Brep=merge_12, Density=-1)  # -> flatten(Wireframe)
X_2 = UnitX(Factor=addition_3)
mirror_2 = Mirror(Geometry=cluster.railinglines_to_mirror_2, Plane=yz_2)  # -> Geometry, Transform
panel_3 = Panel("""6
12""")
cull_i = CullIndex(List=explode, Indices=panel_3, Wrap=True)
move_3 = Move(Geometry=mirror_2.Geometry, Motion=X_2)  # -> Geometry, Transform
merge_13 = Merge(Data1=cull_i, Data2=move_2.Geometry)  # -> flatten(Result)
merge_14 = Merge(Data1=wires, Data2=cluster_2.railinglines_2, Data3=move_3.Geometry)
lines = Data(merge_14)
merge_15 = Merge(Data1=merge_13, Data2=lines)

rec = Rectangle({Plane=Plane(origin=(-1970.889691, 1937.419247, 1956.598842), x=(0.7071067812, 0.7071067812, 0), y=(0.4082482905, -0.4082482905, 0.8164965809)), Size=Domain2(u=-46.34617503..46.34617503, v=-24.69844367..24.69844367)})
m2d_parallel = Make2DParallelView(Projection=rec)
make2d = Make2D(Geometry=model1to200, View=m2d_parallel, TangentEdges="T", TangentSeams=False, AutoComputeMake2D=True)  # -> VisibleCurves, VisibleIndex, VisibleType, HiddenCurves, HiddenIndex, HiddenType
trim = TrimTree(Tree=make2d.VisibleCurves, Depth=1)
bridge = Geometry(trim)

merge_16 = Merge(Data1=cluster_2.volume_2, Data2=transform)
bbox = BoundingBox(Content=merge_16, Plane=PlaneXY(0, 0, 0), UnionBox=True)  # -> Box, Box_2
merge_17 = Merge(Data1=bbox.Box, Data2=cluster_2.volumeside_2, Data3=transform_2)
sunion_4 = SolidUnion(Breps=merge_17)
jagged = SettingsSpeed()
mesh = MeshBrep(Brep=sunion_4, Settings=jagged)
collider = Mesh(mesh)

concat_3 = Concatenate(FragmentC="icon")
concat_4 = Concatenate(FragmentC="icons", FragmentD=sep)
expression_13 = Expression(x="bridge", y=bridge, Expression="x")
concat_5 = Concatenate(FragmentA=concat_4)
concat_6 = Concatenate(FragmentA=par, FragmentB=sep, FragmentC=concat_5)
blc = ExportBlock(path=concat_6, name=concat_3, url=concat_5, geo=bridge, layer_name=expression_13, export=and)  # -> block_definition_3, path_4, exported_2

panel_4 = Panel("""platform east
platform west""")
expression_14 = Expression(x=width_m, Expression="x/2")
panel_5 = Panel("""door tambour west
door tambour east""")
neg_5 = Negative(Value=expression_14)
X_3 = UnitX(Factor=east_length_m)
pt = ConstructPoint(XCoordinate=0, YCoordinate=0, ZCoordinate=0)
Y = UnitY(Factor=neg_5)
addition_5 = Addition(A=X, B=X_3)
move_4 = Move(Geometry=pt, Motion=Y)  # -> Geometry, Transform
X_4 = UnitX(Factor=1)
panel_6 = Panel("""0.25
0.75""")
rev = Reverse(Vector=X_4)
move_5 = Move(Geometry=move_4.Geometry, Motion=addition_5)  # -> Geometry, Transform
merge_18 = Merge(Data1=move_5.Geometry, Data2=move_4.Geometry)
merge_19 = Merge(Data1=X_4, Data2=rev)
panel_7 = Panel("""east
west""")
concat_7 = Concatenate(FragmentA="The middle of the ", FragmentC=panel_7, FragmentB=" side of the plattform.")
panel_8 = Panel("""e
w""")
por = ModelPort(
    Validate=validate,
    Id=graft(panel_8),
    Description=graft(concat_7),
    Family=graft(panel_4),
    CompatibleFamilies=graft(panel_5),
    Point=graft(merge_18),
    Direction=graft(merge_19),
    T=graft(panel_6),
    Qualities=graft(panel_7))  # -> Port, Valid, Id, Description, Mandatory, Family, CompatibleFamilies, Point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
trim_2 = TrimTree(Tree=por.Port, Depth=1)

prv = PreviewPort(po=trim_2)
maintenance_expenses_month_eff_m² = Number(Slider(5, range=0..10))
construction_cost_eff_m² = Number(Slider(4500, range=0..10000))
construction_global_warming_potential_kg = Number(Slider(400, range=0..2000))  # "Construction Global Warming Potential [kgCO2e/eff. m²]"

# ----
# https://identifier.buildingsmart.org/uri/etim/etim/9.0/prop/EF016979
maintenance_expenses_month_eff_m²_2 = Number(maintenance_expenses_month_eff_m²)
construction_global_warming_potential_kg_2 = Number(construction_global_warming_potential_kg)  # "Construction Global Warming Potential [kgCO2e/eff. m²]"
area_3 = Area(Geometry=cluster_2.ground_2)  # -> Area, Centroid
construction_cost_eff_m²_2 = Number(construction_cost_eff_m²)
area_4 = Area(Geometry=cluster.ground_2)  # -> Area, Centroid
addition_6 = Addition(A=area_3.Area, B=area_4.Area)
multiplication = Multiplication(A=addition_6, B=maintenance_expenses_month_eff_m²_2)
expression_15 = Expression(x=multiplication, Expression="x*12")
multiplication_2 = Multiplication(A=addition_6, B=construction_global_warming_potential_kg_2)
multiplication_3 = Multiplication(A=addition_6, B=construction_cost_eff_m²_2)
round = Round(Number=expression_15)  # -> Nearest, Floor, Ceiling
round_2 = Round(Number=multiplication_2)  # -> Nearest, Floor, Ceiling
addition_7 = Addition(A=west_length_m, B=east_length_m, C=gap_m)
round_3 = Round(Number=multiplication_3)  # -> Nearest, Floor, Ceiling
merge_20 = Merge(
    Data1=addition_7,
    Data2=length_m,
    Data3=east_length_m,
    Data4=gap_m,
    Data5=width_m,
    Data6=height_m,
    Data7=number_slider_3,
    Data8=number_slider_5,
    Data9=number_slider_4,
    Data10=number_slider_6,
    Data11=number_slider_2,
    Data12=round_3.Nearest,
    Data13=round.Nearest,
    Data14=round_2.Nearest)
panel_9 = Panel("""length
platform west length
platform east length
gap
width
height
base height
primary rod diameter
secondary rod diameter
tertiary rod diameter
parapet height
construction cost
maintenance expenses
construction global warming potential""")
panel_10 = Panel(merge_20)
panel_11 = Panel("""m
m
m
m
m
m
m
m
m
m
m
€
€/a
kgCO2e""")
qal = ModelQuality(Validate=validate, Name=panel_9, Value=panel_10, Unit=panel_11)  # -> Quality, Valid, Name, Value, Unit

rods_3 = Brep(rods)
area_5 = Area(Geometry=cluster.volume_2)  # -> Area, Centroid
panel_12 = Panel("""0
1
2""")
cull_i_2 = CullIndex(List=cluster.rods_2, Indices=panel_12, Wrap=True)  # -> flatten(List)
cull_i_3 = CullIndex(List=rods_3, Indices=[panel_12, "18"], Wrap=True)  # -> flatten(List)
item = ListItem(List=rods_3, Index=panel_12, Wrap=True)
X_5 = UnitX(Factor=addition_3)
merge_21 = Merge(Data1=cull_i_2, Data2=item)
yz_3 = YZPlane(Origin=area_5.Centroid)
group = NamedGroup(Geometry=base_2, Name="base")  # -> Group, Geometry, Name
group_2 = NamedGroup(Geometry=metalplate_3, Name="metal plate")  # -> Group, Geometry, Name
group_3 = NamedGroup(Geometry=rodsmain_2, Name="RodsMain")  # -> Group, Geometry, Name
group_4 = NamedGroup(Geometry=surface_3, Name="railing")  # -> Group, Geometry, Name
mirror_3 = Mirror(Geometry=merge_21, Plane=yz_3)  # -> Geometry, Transform
panel_13 = Panel("""0
1
2
3
4
5""")
merge_22 = Merge(Data1=group.Group, Data2=group_2.Group, Data3=group_3.Group, Data4=group_4.Group)
move_6 = Move(Geometry=mirror_3.Geometry, Motion=X_5)  # -> Geometry, Transform
item_2 = ListItem(List=move_6.Geometry, Index=panel_13, Wrap=True)
baseleft_2 = Brep(extr)
baseright_2 = Brep(extr_2)
group_5 = NamedGroup(Geometry=merge_22)  # -> Group, Geometry, Name
merge_23 = Merge(Data1=item_2, Data2=cull_i_3)
merge_24 = Merge(Data1=item, Data2=move_6.Geometry)
metalplate_4 = Brep(extr_3)
merge_25 = Merge(Data1=baseleft_2, Data2=baseright_2)
group_6 = NamedGroup(Geometry=merge_25, Name="base")  # -> Group, Geometry, Name
group_7 = NamedGroup(Geometry=metalplate_4, Name="metal plate")  # -> Group, Geometry, Name
group_8 = NamedGroup()  # -> Group, Geometry, Name
group_9 = NamedGroup(Geometry=merge_24, Name="RodsMain")  # -> Group, Geometry, Name
group_10 = NamedGroup(Geometry=merge_23)  # -> Group, Geometry, Name
group_11 = NamedGroup()  # -> Group, Geometry, Name
merge_26 = Merge(
    Data1=group_6.Group,
    Data2=group_7.Group,
    Data3=group_8.Group,
    Data4=group_9.Group,
    Data5=group_10.Group,
    Data6=group_11.Group)
panel_14 = Panel("A bridge with two segments an addition on the west along the main path.")
aut = ModelAuthor(Name="Ueli Saluz", Email="ueli@semio-tech.org")  # -> Author, Valid, Name, Email, Attributes
rep = ModelRepresentation(Tags="1to200")  # -> Representation, Valid, Url, Description, Tags, Attributes
group_12 = NamedGroup(Geometry=fmerge.Breps, Name="shades")  # -> Group, Geometry, Name
group_13 = NamedGroup(Geometry=merge_26)  # -> Group, Geometry, Name
path = FilePath(dir)
name = Data("Bridge")
data = Data(variant)
collider_2 = Mesh(collider)
ql = Quality(qal.Quality)
energy_representation = Data(group_12.Group)
typ = OppinionatedType(
    path=path,
    na=name,
    description=panel_14,
    variant=data,
    de=group_5.Group,
    paper=merge_15,
    collider=collider_2,
    volume=group_5.Group,
    group=group_13.Group,
    rp=rep.Representation,
    po=por.Port,
    authors=aut.Author,
    qualities=ql,
    ex=and_2)  # -> ty_2, ba_2

panel_15 = Panel("A bridge with two segments an addition on the west along the main path.")
aut_2 = ModelAuthor(Name="Ueli Saluz", Email="ueli@semio-tech.org")  # -> Author, Valid, Name, Email, Attributes
typ_2 = ModelType(
    Validate=validate,
    Name="Bridge",
    Description=panel_15,
    Icon="🌉",
    Image="images/bridge.png",
    Variant=variant,
    Unit="m",
    Ports=trim_2,
    Authors=aut_2.Author,
    Qualities=qal.Quality)  # -> Type, Valid, Name, Description, Icon, Image, Variant, Stock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
typ_3 = PutType(Type=typ_2.Type, Uri=par, Run=save)

typ_4 = SerializeType(Type=typ_2.Type)
txt = EncodeText(Text=typ_4, Mode=0)
type = Text(txt)
context_bake = ContextBake(Geometry=type)

# ==== cluster Cluster
length = ClusterInput()
width = ClusterInput()
height = ClusterInput()
parapetheight = ClusterInput()
parapetsegmentsheight = ClusterInput()
additionlength = ClusterInput()
additionwidth = ClusterInput()
rodprimarydiameter = ClusterInput()
rodsecondarydiameter = ClusterInput()
rodtertiarydiameter = ClusterInput()
addition = ClusterInput()
width_2 = Number(width)
parapetheight_2 = Number(parapetheight)
additionwidth_2 = Number(additionwidth)
rodprimarydiameter_2 = Number(rodprimarydiameter)
length_2 = Number(length)
height_2 = Number(height)
parapetsegmentsheight_2 = Number(parapetsegmentsheight)
addition_2 = Boolean(addition)
additionlength_2 = Number(additionlength)
rodsecondarydiameter_2 = Number(rodsecondarydiameter)
rodtertiarydiameter_2 = Number(rodtertiarydiameter)
neg = Negative(Value=width_2)
addition_3 = Addition(A=width_2, B=additionlength_2)
expression = Expression(x=rodprimarydiameter_2, Expression="x/2")
expression_2 = Expression(x=rodprimarydiameter_2, Expression="x*Sqrt(2)")
expression_3 = Expression(x=rodsecondarydiameter_2, Expression="x/2")
neg_2 = Negative(Value=rodprimarydiameter_2)
neg_3 = Negative(Value=addition_3)
neg_4 = Negative(Value=expression)
subtraction = Subtraction(A=additionwidth_2, B=expression_3)
addition_4 = Addition(A=neg_3, B=expression_3)
addition_5 = Addition(A=expression, B=length_2)
subtraction_2 = Subtraction(A=height_2, B=expression_2)
addition_6 = Addition(A=neg, B=expression)
addition_7 = Addition(A=neg, B=expression)
expression_4 = Expression(x=addition_5, y=expression, Expression="x-2*y")

dom = ConstructDomain(DomainStart=neg_4, DomainEnd=addition_6)
dom_2 = ConstructDomain(DomainStart=expression, DomainEnd=expression_4)
dom_3 = ConstructDomain(DomainStart=neg, DomainEnd=neg_3)
dom_4 = ConstructDomain(DomainStart=expression, DomainEnd=subtraction)
dom_5 = ConstructDomain(DomainStart=addition_7, DomainEnd=addition_4)
box = DomainBox(Base=PlaneXY(0, 0, 0), X=length_2, Y=neg, Z=height_2)
box_2 = DomainBox(Base=PlaneXY(0, 0, 0), X=dom_2, Y=dom, Z=subtraction_2)
box_3 = DomainBox(Base=PlaneXY(0, 0, 0), X=additionwidth_2, Y=dom_3, Z=height_2)
box_4 = DomainBox(Base=PlaneXY(0, 0, 0), X=dom_4, Y=dom_5, Z=subtraction_2)
volumesideinner = Box(box_4)
volumeinner = Box(box_2)
volumeside = Box(box_3)
volume = Box(box)

# ----
# Dimensions aren't exact!
domprop = DomainProperties(I=dom_5, In=True)  # -> L, M, T0, T1; inputs I: tree, In: tree of Boolean
# ---------- domprop: Python ----------
#Component Information
#--------------------------------------------------------------------------------------------
if ghenv.Component.RunCount<2:
    #General
    #--------------------------------------------------------------------------------------------
    __author__ = "Ueli Saluz"
    __version__ = "2021.11.22"
    
    ghenv.Component.Name = "DomainProperties"
    ghenv.Component.NickName = "DomProp"
    ghenv.Component.Description = "Returns some properties of a domain"
    ghenv.Component.Message = "VER 1.0"
    ghenv.Component.Category = "Maths"
    ghenv.Component.SubCategory = "Domain"
    
     #Inputs
    #--------------------------------------------------------------------------------------------
    inputIndex=0
    
    ghenv.Component.Params.Input[inputIndex].Name = "Domain"
    ghenv.Component.Params.Input[inputIndex].NickName = "I"
    ghenv.Component.Params.Input[inputIndex].Description = "Domain to evaluate"
    ghenv.Component.Params.Input[inputIndex].Optional = False
    inputIndex+=1
    
    ghenv.Component.Params.Input[inputIndex].Name = "MakeIncreasing"
    ghenv.Component.Params.Input[inputIndex].NickName = "In"
    ghenv.Component.Params.Input[inputIndex].Description = "Makes sure that the domain is increasing. If not it gets swapped."
    ghenv.Component.Params.Input[inputIndex].Optional = False
    inputIndex+=1
    
    #Outputs
    #--------------------------------------------------------------------------------------------
    outputIndex=0
    
    ghenv.Component.Params.Output[outputIndex].Name = "Length"
    ghenv.Component.Params.Output[outputIndex].NickName = "L"
    ghenv.Component.Params.Output[outputIndex].Description = "Length of the domain"
    outputIndex+=1
    
    ghenv.Component.Params.Output[outputIndex].Name = "Mid"
    ghenv.Component.Params.Output[outputIndex].NickName = "M"
    ghenv.Component.Params.Output[outputIndex].Description = "Middle of the of the domain"
    outputIndex+=1
    
    ghenv.Component.Params.Output[outputIndex].Name = "DomainStartParameter"
    ghenv.Component.Params.Output[outputIndex].NickName = "T0"
    ghenv.Component.Params.Output[outputIndex].Description = "Start parameter. Doens't have to be smaller than the end parameter."
    outputIndex+=1
    
    ghenv.Component.Params.Output[outputIndex].Name = "DomainEndParameter"
    ghenv.Component.Params.Output[outputIndex].NickName = "T1"
    ghenv.Component.Params.Output[outputIndex].Description = "End parameter. Doens't have to be bigger than the start parameter."
    outputIndex+=1
    


#Imports
#--------------------------------------------------------------------------------------------
from System import Object
from Grasshopper import DataTree

#Solver - Run with trees to enhance performance drastically
#--------------------------------------------------------------------------------------------
if __name__ == "__main__":
    
    #Initialize trees
    #--------------------------------------------------------------------------------------------
    LengthTree = DataTree[Object]()
    MidTree = DataTree[Object]()
    DomainStartParameterTree = DataTree[Object]()
    DomainEndParameterTree = DataTree[Object]()
    LengthTree = DataTree[Object]()
    
    #Data matching
    #--------------------------------------------------------------------------------------------
    for path in I.Paths:
        domainBranch = I.Branch(path)
        for i,domain in enumerate(domainBranch):
            if In==True:
                domain.MakeIncreasing()
            LengthTree.Add(domain.Length, path)
            MidTree.Add(domain.Mid, path)
            DomainStartParameterTree.Add(domain.T0, path)
            DomainEndParameterTree.Add(domain.T1, path)
    
     #Assign trees to output
    #--------------------------------------------------------------------------------------------
    L = LengthTree
    M = MidTree
    T0 = DomainStartParameterTree
    T1 = DomainEndParameterTree
# ---------- end domprop ----------
panel = Panel(domprop.L)
volumeinner_2 = Box(box_2)
volume_2 = ClusterOutput(volume)
volumeside_2 = ClusterOutput(volumeside)

debrep = DeconstructBrep(Brep=volumeside)  # -> Faces, Edges, Vertices
debrep_2 = DeconstructBrep(Brep=volume)  # -> Faces, Edges, Vertices
trim = TrimTree(Tree=debrep.Faces, Depth=1)
trim_2 = TrimTree(Tree=debrep_2.Faces, Depth=1)
trim_3 = TrimTree(Tree=debrep_2.Vertices, Depth=1)
item = ListItem(List=trim, Index=0, Wrap=True)  # -> Item2, Item1, Item
item_2 = ListItem(List=trim_2, Index=0, Wrap=True)  # -> Item2, Item1, Item
item_3 = ListItem(List=trim_3, Index=0, Wrap=True)
merge = Merge(Data1=item_2.Item2, Data2=item.Item2)
join = BrepJoin(Breps=merge)  # -> Breps, Closed
fmerge = MergeFaces(Brep=join.Breps)  # -> Breps, Before, After
filter = StreamFilter(Gate=addition_2, Stream0=item_2.Item2, Stream1=fmerge.Breps)
base = Brep(filter)

neg_5 = Negative(Value=expression)
neg_6 = Negative(Value=expression)
X = UnitX(Factor=rodprimarydiameter_2)
Y = UnitY(Factor=rodprimarydiameter_2)
base_2 = ClusterOutput(base)
rodcaptype = Integer(Slider(1, range=0..2))

rodmainprimarydiameter = Number(rodprimarydiameter_2)
area = Area(Geometry=volumeinner_2)  # -> Area, Centroid
debrep_3 = DeconstructBrep(Brep=volumeinner_2)  # -> Faces, Edges, Vertices
trim_4 = TrimTree(Tree=debrep_3.Vertices, Depth=1)
trim_5 = TrimTree(Tree=debrep_3.Edges, Depth=1)
item_4 = ListItem(List=trim_4, Index=0, Wrap=True)  # -> Item1, Item, Item1_2, Item2, Item3, Item4
item_5 = ListItem(List=trim_5, Index=0, Wrap=True)  # -> Item4, Item3, Item2, Item1, Item
ln = Line(StartPoint=item_4.Item1, EndPoint=item_4.Item2)
ln_2 = Line(StartPoint=item_4.Item4, EndPoint=item_4.Item1_2)
merge_2 = Merge(Data1=item_5.Item1, Data2=ln)
merge_3 = Merge(Data1=item_5.Item4, Data2=ln_2)
join_2 = JoinCurves(Curves=merge_2, Preserve=False)
join_3 = JoinCurves(Curves=merge_3, Preserve=False)
trim_6 = TrimTree(Tree=join_2, Depth=1)
trim_7 = TrimTree(Tree=join_3, Depth=1)
expression_5 = Expression(x=rodmainprimarydiameter, Expression="x/2")
merge_4 = Merge(Data1=trim_6, Data2=trim_7)
pipe = Pipe(Curve=merge_4, Radius=expression_5, Caps=rodcaptype)
trim_8 = TrimTree(Tree=pipe, Depth=1)
mainframe = Brep(trim_8)

intermediateposts = Integer(Slider(1, range=0..10))
expression_6 = Expression(x=intermediateposts, Expression="x+1")
Z = UnitZ(Factor=parapetheight_2)
Z_2 = UnitZ(Factor=parapetsegmentsheight_2)
expression_7 = Expression(x=rodtertiarydiameter_2, Expression="x/2")
expression_8 = Expression(x=rodsecondarydiameter_2, Expression="x/2")
expression_9 = Expression(x=rodtertiarydiameter_2, Expression="x/2")
mainframe_2 = ClusterOutput(mainframe)

debrep_4 = DeconstructBrep(Brep=volumesideinner)  # -> Faces, Edges, Vertices
debrep_5 = DeconstructBrep(Brep=volumeinner)  # -> Faces, Edges, Vertices
trim_9 = TrimTree(Tree=debrep_4.Faces, Depth=1)
trim_10 = TrimTree(Tree=debrep_4.Vertices, Depth=1)
trim_11 = TrimTree(Tree=debrep_5.Faces, Depth=1)
trim_12 = TrimTree(Tree=debrep_5.Vertices, Depth=1)
trim_13 = TrimTree(Tree=debrep_5.Edges, Depth=1)
item_6 = ListItem(List=trim_9, Index=0, Wrap=True)  # -> Item2, Item1, Item
item_7 = ListItem(List=trim_10, Index=0, Wrap=True)  # -> Item, Item1, Item2
item_8 = ListItem(List=trim_11, Index=0, Wrap=True)  # -> Item2, Item1, Item
item_9 = ListItem(List=trim_13, Index=0, Wrap=True)  # -> Item, Item1, Item2, Item3, Item4, Item5, Item6, Item7
item_10 = ListItem(List=trim_12, Index=0, Wrap=True)  # -> Item, Item1, Item2
basesideinner = Surface(item_6.Item2)
baseinner = Surface(item_8.Item2)
merge_5 = Merge(Data1=baseinner, Data2=basesideinner)
join_4 = BrepJoin(Breps=merge_5)  # -> Breps, Closed
fmerge_2 = MergeFaces(Brep=join_4.Breps)  # -> Breps, Before, After

offset = OffsetCurve(Curve=basesideinner, Distance=neg_5, Corners=1)
offset_2 = OffsetCurve(Curve=baseinner, Distance=neg_6, Corners=1)
trim_14 = TrimTree(Tree=offset_2, Depth=1)
trim_15 = TrimTree(Tree=offset, Depth=1)
explode = Explode(Curve=trim_14, Recursive=True)  # -> Segments, Vertices
explode_2 = Explode(Curve=trim_15, Recursive=True)  # -> Segments, Vertices
trim_16 = TrimTree(Tree=explode.Vertices, Depth=1)
trim_17 = TrimTree(Tree=explode_2.Vertices, Depth=1)
item_11 = ListItem(List=trim_16, Index=0, Wrap=True)  # -> Item3, Item2, Item1, Item, Item1_2
item_12 = ListItem(List=trim_17, Index=0, Wrap=True)  # -> Item, Item1, Item2, Item3
filter_2 = StreamFilter(Gate=addition_2, Stream0=item_8.Item2, Stream1=fmerge_2.Breps)
move = Move(Geometry=item_12.Item3, Motion=Y)  # -> Geometry, Transform
move_2 = Move(Geometry=item_11.Item3, Motion=X)  # -> Geometry, Transform
move_3 = Move(Geometry=item_11.Item2, Motion=X)  # -> Geometry, Transform

baseleft = Brep(filter_2)

merge_6 = Merge(Data1=item_11.Item, Data2=item_11.Item1_2, Data3=move_2.Geometry, Data4=move_3.Geometry, Data5=item_11.Item)
merge_7 = Merge(
    Data1=item_11.Item,
    Data2=item_12.Item1,
    Data3=item_12.Item2,
    Data4=move.Geometry,
    Data5=move_2.Geometry,
    Data6=move_3.Geometry,
    Data7=item_11.Item)
explode_3 = Explode(Curve=baseleft, Recursive=True)  # -> Segments, Vertices
pline = PolyLine(Vertices=merge_7, Closed=False)
pline_2 = PolyLine(Vertices=merge_6, Closed=False)
reprmcrv = ReparametrizeCurve(C=item_9.Item2)  # -> RC, I, IL; inputs C: tree, T0: tree, T1: tree
# ---------- reprmcrv: Python ----------
#Component Information
#--------------------------------------------------------------------------------------------
if ghenv.Component.RunCount<2:
    #General
    #--------------------------------------------------------------------------------------------
    __author__ = "Ueli Saluz"
    __version__ = "2021.11.15"
    #--------------------------------------------------------------------------------------------
    ghenv.Component.Name = "ReparametrizeCurve"
    ghenv.Component.NickName = "RePrmCrv"
    ghenv.Component.Description = "Reparametrize the domain of a curve to the interval from 0 to the length of the curve."
    ghenv.Component.Message = "VER 1.0"
    
    ghenv.Component.Category = "Curve"
    ghenv.Component.SubCategory = "Util"
    
    #Inputs
    #--------------------------------------------------------------------------------------------
    inputIndex=0
    
    ghenv.Component.Params.Input[inputIndex].Name = "Curve"
    ghenv.Component.Params.Input[inputIndex].NickName = "C"
    ghenv.Component.Params.Input[inputIndex].Description = "Curve to reparametrize domain to interval [0,length]"
    ghenv.Component.Params.Input[inputIndex].Optional = True
    inputIndex+=1
    
    ghenv.Component.Params.Input[inputIndex].Name = "DomainStart"
    ghenv.Component.Params.Input[inputIndex].NickName = "T0"
    ghenv.Component.Params.Input[inputIndex].Description = "Starting value of domain that will be used to reparametrized. Default is 0."
    ghenv.Component.Params.Input[inputIndex].Optional = True
    inputIndex+=1
    
    ghenv.Component.Params.Input[inputIndex].Name = "DomainEnd"
    ghenv.Component.Params.Input[inputIndex].NickName = "T1"
    ghenv.Component.Params.Input[inputIndex].Description = "End value of domain that will be used to reparametrized. Default is length."
    ghenv.Component.Params.Input[inputIndex].Optional = True
    inputIndex+=1
    
    #Outputs
    #--------------------------------------------------------------------------------------------
    outputIndex=0
    
    ghenv.Component.Params.Output[outputIndex].Name = "ReparametrizedCurve"
    ghenv.Component.Params.Output[outputIndex].NickName = "RC"
    ghenv.Component.Params.Output[outputIndex].Description = "Reparametrized curve"
    outputIndex+=1
    
    ghenv.Component.Params.Output[outputIndex].Name = "Domain"
    ghenv.Component.Params.Output[outputIndex].NickName = "I"
    ghenv.Component.Params.Output[outputIndex].Description = "Domain of the reparametrized curve"
    outputIndex+=1
    
    ghenv.Component.Params.Output[outputIndex].Name = "DomainLength"
    ghenv.Component.Params.Output[outputIndex].NickName = "IL"
    ghenv.Component.Params.Output[outputIndex].Description = "Length of the domain of the reparametrized curve"
    outputIndex+=1


#Imports
#--------------------------------------------------------------------------------------------
from Rhino.Geometry import Interval, Curve
from System import Object
from Grasshopper import DataTree


#The Component function - Buisness logic only (e.g. working without trees)
#--------------------------------------------------------------------------------------------
"""Reparametrize the domain of a curve to the interval from 0 to the length of the curve.
    Inputs:
        crv: curve to reparametrize domain to interval [0,length]
        t0: Starting value of domain that will be used to reparametrized. Default is 0.
        t1: End value of domain that will be used to reparametrized. Default is length.
    Output:
        rc: Reparametrized curve"""
def reparametrizeCurve (crv,t0=None,t1=None):
    if(t0 is None):
        t0=0
    if(t1 is None):
        t1=crv.GetLength()
    crv.Domain = Interval(t0,t1)
    return crv

#Solver - Run with trees to enhance performance drastically
#--------------------------------------------------------------------------------------------
if __name__ == "__main__":
    
    #Initialize trees
    #--------------------------------------------------------------------------------------------
    ReparametrizedCurveTree = DataTree[Object]()
    DomainTree = DataTree[Object]()
    DomainLengthTree = DataTree[Object]()
    
    #Data matching
    #--------------------------------------------------------------------------------------------
    for path in C.Paths:
        curveBranch = C.Branch(path)
        for i,curve in enumerate(curveBranch):
            reparametrizedCurve = reparametrizeCurve(curve)
            ReparametrizedCurveTree.Add(reparametrizedCurve,path)
            DomainTree.Add(reparametrizedCurve.Domain,path)
            DomainLengthTree.Add(reparametrizedCurve.Domain.Length, path)
            
    #Assign trees to output
    #--------------------------------------------------------------------------------------------
    RC=ReparametrizedCurveTree
    I=DomainTree
    IL=DomainLengthTree
# ---------- end reprmcrv ----------
trim_18 = TrimTree(Tree=explode_3.Segments, Depth=1)
item_13 = ListItem(List=trim_18, Index=0, Wrap=True)  # -> Item1, Item, Item1_2, Item2
ext = ExtendCurve(Curve=reprmcrv.RC, Type="1", Start=neg_2, End="0")
filter_3 = StreamFilter(Gate=addition_2, Stream0=pline_2, Stream1=pline)
divide = DivideCurve(Curve=item_13.Item1_2, Count=expression_6, Kinks=False)  # -> Points, Tangents, Parameters
crv_cp = CurveClosestPoint(Point=item_10.Item, Curve=item_13.Item1)  # -> Point, Parameter, Distance

reprmcrv_2 = ReparametrizeCurve(C=item_9.Item)  # -> RC, I, IL; inputs C: tree, T0: tree, T1: tree; same code as reprmcrv
ext_2 = ExtendCurve(Curve=reprmcrv_2.RC, Type="1", Start="0", End=neg_2)
divide_2 = DivideCurve(Curve=ext_2, Count=expression_6, Kinks=False)  # -> Points, Tangents, Parameters
trim_19 = TrimTree(Tree=divide_2.Points, Depth=1)
lito3p = ListInto3Parts(ListToSlice=trim_19, StartIndex="1", EndIndex=-1)  # -> FilteredList, ItemsBefore, ItemsAfter; inputs ListToSlice: tree, StartIndex: tree of Int32, EndIndex: tree of Int32
# ---------- lito3p: Python ----------
if ghenv.Component.RunCount<2:
    __author__ = "Ueli Saluz"
    __version__ = "2020.05.28"
    
    ghenv.Component.Name = "ListInto3Parts"
    ghenv.Component.NickName = "LiTo3P"
    ghenv.Component.Description = "Slice list into 3 parts. All lists are sliced with the same indices. End index = 0 = length(list)."
    ghenv.Component.Message = "VER 1.6"

from System import Object
from Grasshopper import DataTree

def filterList(listToFilter,startIndex,endIndex):
    # Return: FilteredList, Before, After
    if (((startIndex == 0) or (startIndex is None)) and ((endIndex == 0) or (endIndex is None))) or (endIndex <= startIndex and endIndex > 0):
        return (listToFilter,None,None)
    elif (startIndex == 0) or (startIndex is None):
        return (listToFilter[:endIndex],None,listToFilter[endIndex:])
    elif (endIndex == 0) or (endIndex is None):
        print 1
        return (listToFilter[:startIndex],listToFilter[startIndex:],None)
    else:
        return (listToFilter[startIndex:endIndex],listToFilter[:startIndex],listToFilter[endIndex:])

if __name__ == "__main__":
    FilteredList = DataTree[Object]()
    ItemsBefore = DataTree[Object]()
    ItemsAfter = DataTree[Object]()
    
    for path in ListToSlice.Paths:
        listBranch = ListToSlice.Branch(path)
        pyList = list(listBranch)   #Convert .Net List to Python
        try: #terrible way of writing code but if I set the list to list access the performance decreases massivly due to many calls
            startIndex = StartIndex.Branch(path)
            startIndex = startIndex[0]
        except Exception:
            try:
                startIndex = StartIndex.Branch(0)
                startIndex = startIndex[0]
            except Exception:
                startIndex = 0
        try:
            endIndex = EndIndex.Branch(path)
            endIndex = endIndex[0]
        except Exception:
            try:
                endIndex = EndIndex.Branch(0)
                endIndex = endIndex[0]
            except Exception:
                endIndex = len(pyList)
        filtList=filterList(pyList,startIndex,endIndex)
        if filtList[0]:
            FilteredList.AddRange(filtList[0],path)
        if filtList[1]:
            ItemsBefore.AddRange(filtList[1],path)
        if filtList[2]:
            ItemsAfter.AddRange(filtList[2],path)
# ---------- end lito3p ----------
end = EndPoints(Curve=item_9.Item)  # -> Start, End
line = LineSDL(Start=lito3p.FilteredList, Direction=Z, Length=parapetheight_2)
line_2 = LineSDL(Start=end.End, Direction=Z, Length=parapetheight_2)
move_4 = Move(Geometry=item_9.Item, Motion=Z)  # -> Geometry, Transform
merge_8 = Merge(Data1=move_4.Geometry, Data2=line_2)
join_5 = JoinCurves(Curves=merge_8, Preserve=False)
move_5 = Move(Geometry=item_9.Item, Motion=Z_2)  # -> Geometry, Transform
trim_20 = TrimTree(Tree=join_5, Depth=1)
pipe_2 = Pipe(Curve=trim_20, Radius=expression_8, Caps=rodcaptype)
pipe_3 = Pipe(Curve=line, Radius=expression_7, Caps=rodcaptype)
pipe_4 = Pipe(Curve=move_5.Geometry, Radius=expression_9, Caps=rodcaptype)
trim_21 = TrimTree(Tree=pipe_2, Depth=1)
trim_22 = TrimTree(Tree=pipe_3, Depth=1)
trim_23 = TrimTree(Tree=pipe_4, Depth=1)
railsecondarysupplement = Brep(trim_23)
railsecondaryposts = Brep(trim_22)
primaryrail = Brep(trim_21)
merge_9 = Merge(Data1=primaryrail, Data2=railsecondaryposts, Data3=railsecondarysupplement)

ground = Curve(filter_3)
divide_3 = DivideCurve(Curve=ext, Count=expression_6, Kinks=False)  # -> Points, Tangents, Parameters
trim_24 = TrimTree(Tree=divide.Points, Depth=1)
shatter = Shatter(Curve=item_13.Item1, Parameters=crv_cp.Parameter)
ground_2 = ClusterOutput(ground)
trim_25 = TrimTree(Tree=divide_3.Points, Depth=1)
lito3p_2 = ListInto3Parts(ListToSlice=trim_24, StartIndex="1", EndIndex="-1")  # -> FilteredList, ItemsBefore, ItemsAfter; inputs ListToSlice: tree, StartIndex: tree of Int32, EndIndex: tree of Int32; same code as lito3p
trim_26 = TrimTree(Tree=shatter, Depth=1)
lito3p_3 = ListInto3Parts(ListToSlice=trim_25, StartIndex="1", EndIndex="-1")  # -> FilteredList, ItemsBefore, ItemsAfter; inputs ListToSlice: tree, StartIndex: tree of Int32, EndIndex: tree of Int32; same code as lito3p
item_14 = ListItem(List=trim_26, Index=0, Wrap=True)  # -> Item, Item1
divide_4 = DivideCurve(Curve=item_14.Item1, Count=expression_6, Kinks=False)  # -> Points, Tangents, Parameters
trim_27 = TrimTree(Tree=divide_4.Points, Depth=1)
lito3p_4 = ListInto3Parts(ListToSlice=trim_27, StartIndex="1", EndIndex="-1")  # -> FilteredList, ItemsBefore, ItemsAfter; inputs ListToSlice: tree, StartIndex: tree of Int32, EndIndex: tree of Int32; same code as lito3p
merge_10 = Merge(
    Data1=lito3p_4.FilteredList,
    Data2=item_7.Item,
    Data3=item_7.Item1,
    Data4=lito3p_2.FilteredList,
    Data5=item_7.Item2,
    Data6=item_4.Item1_2)
merge_11 = Merge(Data1=item_14.Item1, Data2=item_13.Item, Data3=item_13.Item1_2, Data4=item_13.Item2)
line_3 = LineSDL(Start=merge_10, Direction=Z, Length=parapetheight_2)
join_6 = JoinCurves(Curves=merge_11, Preserve=False)
extr = Extrude(Base=reprmcrv.RC, Direction=Z)
move_6 = Move(Geometry=reprmcrv.RC, Motion=Z)  # -> Geometry, Transform
line_4 = LineSDL(Start=item_10.Item2, Direction=Z, Length=parapetheight_2)
merge_12 = Merge(Data1=item_14.Item1, Data2=item_13.Item1_2)
lito3p_5 = ListInto3Parts(ListToSlice=line_3, EndIndex="-1")  # -> FilteredList, ItemsBefore, ItemsAfter; inputs ListToSlice: tree, StartIndex: tree of Int32, EndIndex: tree of Int32; same code as lito3p
trim_28 = TrimTree(Tree=join_6, Depth=1)
secondaryrailsurface = Brep(extr)
merge_13 = Merge(Data1=move_6.Geometry, Data2=line_4)
line_5 = LineSDL(Start=lito3p_3.FilteredList, Direction=Z, Length=parapetheight_2)
join_7 = JoinCurves(Curves=merge_12, Preserve=False)
move_7 = Move(Geometry=trim_28, Motion=Z)  # -> Geometry, Transform
extr_2 = Extrude(Base=trim_28, Direction=Z)
join_8 = JoinCurves(Curves=merge_13, Preserve=False)
trim_29 = TrimTree(Tree=join_7, Depth=1)
move_8 = Move(Geometry=trim_28, Motion=Z_2)  # -> Geometry, Transform
primaryrailsurface = Brep(extr_2)
merge_14 = Merge(Data1=move_7.Geometry, Data2=lito3p_5.ItemsAfter)
merge_15 = Merge(Data1=baseleft, Data2=secondaryrailsurface)
trim_30 = TrimTree(Tree=join_8, Depth=1)
move_9 = Move(Geometry=reprmcrv.RC, Motion=Z_2)  # -> Geometry, Transform
extr_3 = Extrude(Base=trim_29, Direction=Z)
join_9 = JoinCurves(Curves=merge_14, Preserve=False)
pipe_5 = Pipe(Curve=move_8.Geometry, Radius=expression_9, Caps=rodcaptype)
pipe_6 = Pipe(Curve=line_5, Radius=expression_7, Caps=rodcaptype)
pipe_7 = Pipe(Curve=trim_30, Radius=expression_8, Caps=rodcaptype)
pipe_8 = Pipe(Curve=move_9.Geometry, Radius=expression_9, Caps=rodcaptype)
pipe_9 = Pipe(Curve=item_9.Item7, Radius=expression_5, Caps=rodcaptype)
merge_16 = Merge(Data1=extr_3, Data2=base)
merge_17 = Merge(Data1=primaryrailsurface, Data2=base, Data3=secondaryrailsurface)
trim_31 = TrimTree(Tree=join_9, Depth=1)
trim_32 = TrimTree(Tree=pipe_5, Depth=1)
trim_33 = TrimTree(Tree=pipe_6, Depth=1)
trim_34 = TrimTree(Tree=pipe_7, Depth=1)
trim_35 = TrimTree(Tree=pipe_9, Depth=1)
trim_36 = TrimTree(Tree=pipe_8, Depth=1)
filter_4 = StreamFilter(Gate=addition_2, Stream0=merge_16, Stream1=merge_17)
pipe_10 = Pipe(Curve=trim_31, Radius=expression_8, Caps=rodcaptype)
pipe_11 = Pipe(Curve=lito3p_5.FilteredList, Radius=expression_7, Caps=rodcaptype)
pipe_12 = Pipe(Curve=lito3p_5.FilteredList, Radius=expression_9, Caps=rodcaptype)
railsecondarysupplement_2 = Brep(trim_32)
secondaryrail = Brep(trim_34)
railsecondaryposts_2 = Brep(trim_33)
railsecondarysupplement_3 = Brep(trim_36)
secondarybar = Brep(trim_35)
trim_37 = TrimTree(Tree=pipe_10, Depth=1)
trim_38 = TrimTree(Tree=pipe_11, Depth=1)
join_10 = BrepJoin(Breps=filter_4)  # -> Breps, Closed
trim_39 = TrimTree(Tree=pipe_12, Depth=1)
filledsurface = Brep(join_10.Breps)
primaryrail_2 = Brep(trim_37)
railsecondary = Brep(trim_38)
railsecondaryposts_3 = Brep(trim_39)
merge_18 = Merge(Data1=secondaryrail, Data2=railsecondaryposts_2, Data3=railsecondarysupplement_3)
merge_19 = Merge(Data1=secondarybar, Data2=mainframe)
merge_20 = Merge(Data1=primaryrail_2, Data2=railsecondary, Data3=railsecondaryposts_3, Data4=railsecondarysupplement_2)
filter_5 = StreamFilter(Gate=addition_2, Stream0=merge_9, Stream1=merge_20)
merge_21 = Merge(
    Data1=trim_31,
    Data2=move_8.Geometry,
    Data3=lito3p_5.FilteredList,
    Data4=item_9.Item7,
    Data5=trim_30,
    Data6=line_5,
    Data7=move_9.Geometry,
    Data8=merge_4)
merge_22 = Merge(Data1=merge_19, Data2=merge_18, Data3=filter_5)
merge_23 = Merge(
    Data1=trim_20,
    Data2=move_5.Geometry,
    Data3=line,
    Data4=merge_4,
    Data5=item_9.Item7,
    Data6=trim_30,
    Data7=line_5,
    Data8=move_9.Geometry)
rods = Brep(merge_22)
railinglines_to_mirror = Data(merge_23)
railinglines = Data(merge_21)
rods_2 = ClusterOutput(rods)
filledsurface_2 = ClusterOutput(filledsurface)
railinglines_2 = ClusterOutput(railinglines)
railinglines_to_mirror_2 = ClusterOutput(railinglines_to_mirror)

# ==== cluster PreviewPlane: Preview a plane with axis colors and naming.
axis_length = ClusterInput()
plane = ClusterInput()
axis_length_2 = Number(axis_length)
plane_2 = Plane(plane)
deplane = DeconstructPlane(Plane=plane_2)  # -> Origin, XAxis, YAxis, ZAxis
line = LineSDL(Start=deplane.Origin, Direction=deplane.YAxis, Length=axis_length_2)
line_2 = LineSDL(Start=deplane.Origin, Direction=deplane.XAxis, Length=axis_length_2)
line_3 = LineSDL(Start=deplane.Origin, Direction=deplane.ZAxis, Length=axis_length_2)
swatch = ColourSwatch(SwatchColor=RGB(235, 52, 79))
swatch_2 = ColourSwatch(SwatchColor=RGB(0, 166, 157))
swatch_3 = ColourSwatch(SwatchColor=RGB(240, 117, 24))
end = EndPoints(Curve=line_2)  # -> Start, End
end_2 = EndPoints(Curve=line)  # -> Start, End
end_3 = EndPoints(Curve=line_3)  # -> Start, End
tag = TextTag(Location=end.End, Text="X", Colour=swatch)
tag_2 = TextTag(Location=end_2.End, Text="Y", Colour=swatch_2)
tag_3 = TextTag(Location=end_3.End, Text="Z", Colour=swatch_3)
preview = CustomPreview(Geometry=line_2, Material=swatch)
preview_2 = CustomPreview(Geometry=line, Material=swatch_2)
preview_3 = CustomPreview(Geometry=line_3, Material=swatch_3)

# ==== cluster ViewRectangle
view = ClusterInput()
view_2 = Data(view)
nickname = NAME(view=view_2)  # -> c, x, y, z, h, w
# ---------- nickname: Python ----------
uselss, c, x, y, z = view.GetCameraFrame()
h = view.FrustumHeight
w = view.FrustumWidth
# ---------- end nickname ----------
rev = Reverse(Vector=nickname.x)
rev_2 = Reverse(Vector=nickname.y)
pl = ConstructPlane(Origin=nickname.c, XAxis=rev, YAxis=nickname.y)
_2d = _2D(x=nickname.w)
_2d_2 = _2D(x=nickname.h)
rectangle = Rectangle(Plane=pl, XSize=_2d, YSize=_2d_2, Radius=0)  # -> Rectangle, Length
rec = Rectangle(rectangle.Rectangle)
rec_2 = ClusterOutput(rec)

# ==== cluster ExportBlock: Export geometry with layer names to a file.
path = ClusterInput()
name = ClusterInput()
url = ClusterInput()
geo = ClusterInput()
layer_name = ClusterInput()
export = ClusterInput()
path_2 = FilePath(path)
name_2 = Text(name)
url_2 = Text(url)
geo_2 = Geometry(geo)
layer_name_2 = Text(layer_name)
export_2 = Boolean(export)
layer = ModelLayer(Name=layer_name_2)  # -> Layer, Name, Hidden, Locked, DisplayColour, Material, Linetype
object = ModelObject(Geometry=geo_2, Layer=layer.Layer)  # -> Object, Geometry, Name, Layer, Visibility, Display, Drafting, Render
block_definition = ModelBlockDefinition(Objects=object.Object, Name=name_2, URL=url_2)  # -> BlockDefinition, Objects, Units, Name, Notes, URL, URLDescription
export_definition = ExportModelBlockDefinition(BlockDefinition=block_definition.BlockDefinition, FilePath=path_2, Overwrite="T", Export=export_2)  # -> BlockDefinition, FilePath, Exported
block_definition_2 = ModelBlockDefinition(export_definition.BlockDefinition)
path_3 = FilePath(export_definition.FilePath)
exported = Boolean(export_definition.Exported)
path_4 = ClusterOutput(path_3)
exported_2 = ClusterOutput(exported)
block_definition_3 = ClusterOutput(block_definition_2)

# ==== cluster PreviewPort: Preview a port by showing the point and direction and if exists: id, family and compatible families.
po = ClusterInput()
sc = ClusterInput()
sc_2 = Number(sc)
po_2 = Port(po)
por = ModelPort(Port=po_2)  # -> Port, Valid, Id, Description, Mandatory, Family, CompatibleFamilies, Point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
swatch = ColourSwatch(SwatchColor=RGB(235, 52, 79))
swatch_2 = ColourSwatch(SwatchColor=RGB(250, 149, 0))
amp = Amplitude(Vector=por.Direction, Amplitude=sc_2)
lng = ListLength(List=por.CompatibleFamilies)
expression = Expression(x=por.Family, Expression="x=\"\"")
cull = CullPattern(List=por.Point, CullPattern=expression)
expression_2 = Expression(x=lng, Expression="x=0")
join = TextJoin(Text=por.CompatibleFamilies, Join=",")
merge = Merge(Data1=":")
trim = TrimTree(Tree=join, Depth=1)
trim_2 = TrimTree(Tree=expression_2, Depth=1)
item = ListItem(List=merge, Index=expression, Wrap=invert(True))
log = Logarithm(Value=sc_2)
concat = Concatenate(FragmentA="[", FragmentB=trim, FragmentC="]")
expression_3 = Expression(y=trim_2, Expression="x")
merge_2 = Merge(Data1=graft(concat), Data2=graft(expression_3))
item_2 = ListItem(List=merge_2, Index=graft(expression), Wrap=invert(True))
multiplication = Multiplication(A=log, B=Slider(2, range=0..10))
trim_3 = TrimTree(Tree=item_2, Depth=1)
concat_2 = Concatenate(FragmentA=por.Id, FragmentB=item, FragmentC=por.Family, FragmentD=trim_3)
preview = CustomPreview(Geometry=cull, Material=swatch)
tag = TextTag(Location=por.Point, Text=concat_2, Colour=swatch)
vdisex = VectorDisplayEx(Point=por.Point, Vector=amp, Colour=ColourSwatch(SwatchColor=RGB(0, 166, 157)), Width=multiplication)

# ==== cluster PreviewGeometry: Preview geometry by ungrouping everything, showing light surfaces and dark edges.
sc = ClusterInput()
geo = ClusterInput()
geo_2 = Geometry(flatten(geo))
sc_2 = Number(sc)
expression = Expression(x=sc_2, Expression="x+1")
swatch = ColourSwatch(SwatchColor=RGB(0, 0, 0))
swatch_2 = ColourSwatch(SwatchColor=RGB(255, 255, 255))
ungroup = Ungroup(Group=geo_2)
ungroup_2 = Ungroup(Group=ungroup)
ungroup_3 = Ungroup(Group=ungroup_2)
ungroup_4 = Ungroup(Group=ungroup_3)
log = Logarithm(Value=expression)
clean = CleanTree(RemoveNulls=True, RemoveInvalid=True, RemoveEmpty=invert(False), Tree=ungroup_4)  # -> flatten(Tree)
multiplication = Multiplication(A=log, B=Slider(0.05, range=0..1))
linetype = ModelLinetype(Name="semio", Width=multiplication)  # -> ModelLinetype, Name, Segments, CapStyle, JoinStyle, Width, WidthUnits, TaperWidths, TaperPositions
dispatch = CSharpScript(D=clean)  # -> P, C, B, M, R
# ---------- dispatch: C# ----------
// Grasshopper Script Instance
#region Usings
using System;
using System.Linq;
using System.Collections;
using System.Collections.Generic;
using System.Drawing;

using Rhino;
using Rhino.Geometry;

using Grasshopper;
using Grasshopper.Kernel;
using Grasshopper.Kernel.Data;
using Grasshopper.Kernel.Types;
#endregion

public class Script_Instance : GH_ScriptInstance
{
    #region Notes
    /* 
      Members:
        RhinoDoc RhinoDocument
        GH_Document GrasshopperDocument
        IGH_Component Component
        int Iteration

      Methods (Virtual & overridable):
        Print(string text)
        Print(string format, params object[] args)
        Reflect(object obj)
        Reflect(object obj, string method_name)
    */
    #endregion

    private void RunScript(
	object D,
	ref object P,
	ref object C,
	ref object B,
	ref object M,
	ref object R)
    {
        if (D is Curve) C = D; // Curve
        else if (
            D is Rhino.Geometry.Point ||
            D is PointCloud
            )
            P = D; // Point
        else if ( D is Mesh) M = D; // Mesh
        else if (
            D is Surface ||
            D is Extrusion ||
            D is SubD ||
            D is Brep
            )
            B = D; // Brep
        else R = D; // Rest
            
    }
}
# ---------- end dispatch ----------
clean_2 = CleanTree(RemoveNulls=True, RemoveInvalid=True, RemoveEmpty=False, Tree=dispatch.M)
clean_3 = CleanTree(RemoveNulls=True, RemoveInvalid=True, RemoveEmpty=False, Tree=dispatch.R)
clean_4 = CleanTree(RemoveNulls=True, RemoveInvalid=True, RemoveEmpty=False, Tree=dispatch.B)
clean_5 = CleanTree(RemoveNulls=True, RemoveInvalid=True, RemoveEmpty=False, Tree=dispatch.P)
clean_6 = CleanTree(RemoveNulls=True, RemoveInvalid=True, RemoveEmpty=False, Tree=dispatch.C)
debrep = DeconstructBrep(Brep=clean_4)  # -> Faces, Edges, Vertices
preview = CustomPreview(Geometry=flatten(clean_5), Material=swatch)
preview_2 = CustomPreview(Geometry=flatten(debrep.Faces), Material=swatch_2)
preview_3 = CustomPreview(Geometry=flatten(clean_2), Material=swatch_2)
preview_4 = CustomPreview(Geometry=flatten(clean_3), Material=swatch)
curve_preview = CustomCurvePreview(Curve=clean_6, Linetype=linetype.ModelLinetype, Colour=swatch)
curve_preview_2 = CustomCurvePreview(Curve=debrep.Edges, Linetype=linetype.ModelLinetype, Colour=swatch)

# ==== cluster OppinionatedType: Construct a type following the oppinionated conventions of semio. All representations are saved under representations folder where each representation is saved once natively (.3dm) and once exported (.glb). Further a collider representation is required. All names and file names are standardized.
emoji = Panel("")
name = Panel("Default")
abbreviation = Panel("Dft?")
nn = Panel("De")
prm = ModelParam(Na=name, NN=nn, Dc="The optional default representation geometry group.", Op=Toggle(True), Ru=Toggle(True))  # -> Param, Name, NickName, Description, Optional, Success; inputs Pr: tree, Op: Boolean, Ru: Boolean
# ---------- prm: Python ----------
#Component Information
#--------------------------------------------------------------------------------------------
if ghenv.Component.RunCount<2:
    #General
    #--------------------------------------------------------------------------------------------
    __author__ = "Ueli Saluz"
    __version__ = "2025.06.18"
    
    ghenv.Component.Name = "Model Param"
    ghenv.Component.NickName = "~Prm"
    ghenv.Component.Description = "Deconstruct or modify a param."
    ghenv.Component.Message = "VER 1.0"
    ghenv.Component.Category = "semio"
    ghenv.Component.SubCategory = "Scripting"
    
     #Inputs
    #--------------------------------------------------------------------------------------------
    inputIndex=0
    
    ghenv.Component.Params.Input[inputIndex].Name = "Param"
    ghenv.Component.Params.Input[inputIndex].NickName = "Pr"
    ghenv.Component.Params.Input[inputIndex].Description = "Connect the param to desconstruct or modify here with one wire."
    ghenv.Component.Params.Input[inputIndex].Optional = False
    inputIndex+=1

    ghenv.Component.Params.Input[inputIndex].Name = "Name"
    ghenv.Component.Params.Input[inputIndex].NickName = "Na"
    ghenv.Component.Params.Input[inputIndex].Description = "Name of the param."
    ghenv.Component.Params.Input[inputIndex].Optional = False
    inputIndex+=1
    
    ghenv.Component.Params.Input[inputIndex].Name = "NickName"
    ghenv.Component.Params.Input[inputIndex].NickName = "NN"
    ghenv.Component.Params.Input[inputIndex].Description = "Nickname of the param."
    ghenv.Component.Params.Input[inputIndex].Optional = False
    inputIndex+=1
    
    ghenv.Component.Params.Input[inputIndex].Name = "Description"
    ghenv.Component.Params.Input[inputIndex].NickName = "Dc"
    ghenv.Component.Params.Input[inputIndex].Description = "Description of the param."
    ghenv.Component.Params.Input[inputIndex].Optional = True
    inputIndex+=1
    
    ghenv.Component.Params.Input[inputIndex].Name = "Optional"
    ghenv.Component.Params.Input[inputIndex].NickName = "Op"
    ghenv.Component.Params.Input[inputIndex].Description = "Wheather the param is optional."
    ghenv.Component.Params.Input[inputIndex].Optional = True
    inputIndex+=1
    
    ghenv.Component.Params.Input[inputIndex].Name = "Run"
    ghenv.Component.Params.Input[inputIndex].NickName = "Ru"
    ghenv.Component.Params.Input[inputIndex].Description = "Modify the param."
    ghenv.Component.Params.Input[inputIndex].Optional = True
    inputIndex+=1
    
    #Outputs
    #--------------------------------------------------------------------------------------------
    outputIndex=0
    
    ghenv.Component.Params.Output[outputIndex].Name = "Param"
    ghenv.Component.Params.Output[outputIndex].NickName = "Param"
    ghenv.Component.Params.Output[outputIndex].Description = "The desconstruct or modified param"
    ghenv.Component.Params.Output[outputIndex].Optional = False
    outputIndex+=1
    
    ghenv.Component.Params.Output[outputIndex].Name = "Name"
    ghenv.Component.Params.Output[outputIndex].NickName = "Name"
    ghenv.Component.Params.Output[outputIndex].Description = "Name of the param."
    ghenv.Component.Params.Output[outputIndex].Optional = False
    outputIndex+=1
    
    ghenv.Component.Params.Output[outputIndex].Name = "NickName"
    ghenv.Component.Params.Output[outputIndex].NickName = "NickName"
    ghenv.Component.Params.Output[outputIndex].Description = "Nickname of the param."
    ghenv.Component.Params.Output[outputIndex].Optional = False
    outputIndex+=1
    
    ghenv.Component.Params.Output[outputIndex].Name = "Description"
    ghenv.Component.Params.Output[outputIndex].NickName = "Description"
    ghenv.Component.Params.Output[outputIndex].Description = "Description of the param."
    ghenv.Component.Params.Output[outputIndex].Optional = True
    outputIndex+=1
    
    ghenv.Component.Params.Output[outputIndex].Name = "Optional"
    ghenv.Component.Params.Output[outputIndex].NickName = "Optional"
    ghenv.Component.Params.Output[outputIndex].Description = "Wheather the param is optional."
    ghenv.Component.Params.Output[outputIndex].Optional = True
    outputIndex+=1
    
    ghenv.Component.Params.Output[outputIndex].Name = "Success"
    ghenv.Component.Params.Output[outputIndex].NickName = "Success"
    ghenv.Component.Params.Output[outputIndex].Description = "Wheather the operation was successful."
    ghenv.Component.Params.Output[outputIndex].Optional = False
    outputIndex+=1

input = ghenv.Component.Params.Input[0]
param = input.Sources[0]
if Ru:
    if Na:
        param.Name = Na
    if NN:
        param.NickName = NN
    if Dc:
        param.Description = Dc
    if Op:
        param.Optional = Op
    Success = True
else:
    Success = False
Param = param
Name = param.Name
NickName = param.NickName
Description = param.Description
Optional = param.Optional
# ---------- end prm ----------
concat = Concatenate(FragmentA="\"", FragmentB=prm.Description, FragmentC="\"")
merge = Merge(Data1=emoji, Data2=prm.NickName, Data3=abbreviation, Data4=prm.Name, Data5=concat)
join = TextJoin(Text=merge, Join=",")
de = ClusterInput()
paper = ClusterInput()
panel = Panel(join)
path = ClusterInput()
na = ClusterInput()
description = ClusterInput()
variant = ClusterInput()
rp = ClusterInput()
collider = ClusterInput()
volume = ClusterInput()
ex = ClusterInput()
group = ClusterInput()
po = ClusterInput()
authors = ClusterInput()
qualities = ClusterInput()
sep = Separator()  # -> S; same code as sep
path_2 = FilePath(path)
na_2 = Name(na)
description_2 = Description(description)
variant_2 = Variant(variant)
de_2 = Default(de)
rp_2 = Representation(rp)
volume_2 = Volume(volume)
group_2 = Group(group)
paper_2 = Paper(paper)
collider_2 = Collider(collider)
authors_2 = Authors(authors)
qualities_2 = Qualities(qualities)
po_2 = Port(po)
ex_2 = Export(ex)
merge_2 = Merge(Data1=de_2, Data2=paper_2, Data3=collider_2, Data4=volume_2)
rep = ModelRepresentation(Representation=rp_2)  # -> Representation, Valid, Url, Description, Tags, Qualities
rep_2 = ReplaceText(Text=variant_2, Find="/", Replace="slash", RecursiveReplace=False)
txt = NormalizeText(Text=na_2)  # -> Strict, Title, Underscore, Kebab, Pascal
split = SplitList(List=rep.Tags, Index="1")  # -> ListA, ListB
rep_3 = ReplaceText(Text=rep_2, Find="\", Replace="backslash", RecursiveReplace=False)
panel_2 = Panel(rp_2)
txt_2 = NormalizeText(Text=rep_3)  # -> Strict, Title, Underscore, Kebab, Pascal
join_2 = TextJoin(Text=split.ListB, Join="_")
panel_3 = Panel("""default
paper
collider
volume""")
concat_2 = Concatenate(FragmentA=txt.Kebab, FragmentD="_", FragmentB=txt_2.Kebab)
concat_3 = Concatenate(FragmentA="images", FragmentB=sep, FragmentC=concat_2, FragmentD=".png")
concat_4 = Concatenate(FragmentA="icons", FragmentB=sep, FragmentC=concat_2, FragmentD=".svg")
concat_5 = Concatenate(FragmentA=concat_2, FragmentB=".glb")
concat_6 = Concatenate(FragmentA=concat_2, FragmentD="_", FragmentB=join_2)
concat_7 = Concatenate(FragmentA="representations", FragmentB=sep, FragmentC=concat_2, FragmentD=".glb")
concat_8 = Concatenate(FragmentA="representations", FragmentB=sep, FragmentC=concat_2, FragmentD=".3dm")
concat_9 = Concatenate(FragmentA=concat_6, FragmentB=".glb")
concat_10 = Concatenate(FragmentA=concat_6, FragmentB=".3dm")
concat_11 = Concatenate(FragmentD=concat_2, FragmentC="_", FragmentA=panel_3, FragmentB=".3dm")
concat_12 = Concatenate(FragmentA=concat_2, FragmentC="_", FragmentB=panel_3, FragmentD=".glb")
concat_13 = Concatenate(FragmentA="representations", FragmentB=sep, FragmentC=concat_10)
concat_14 = Concatenate(FragmentA="representations", FragmentB=sep, FragmentC=concat_9)
concat_15 = Concatenate(FragmentA="representations", FragmentB=sep, FragmentC=concat_11)
concat_16 = Concatenate(FragmentA="representations", FragmentB=sep, FragmentC=concat_12)
panel_4 = Panel(concat_13)
rep_4 = ModelRepresentation(Url=concat_13, Tags=split.ListB)  # -> Representation, Valid, Url, Description, Tags, Qualities
rep_5 = ModelRepresentation(Url=graft(concat_16), Tags=graft(panel_3))  # -> Representation, Valid, Url, Description, Tags, Qualities
rep_6 = ModelRepresentation(Url=concat_14, Tags=split.ListB)  # -> Representation, Valid, Url, Description, Tags, Qualities
rep_7 = ModelRepresentation(Url=graft(concat_15), Tags=graft(panel_3))  # -> Representation, Valid, Url, Description, Tags, Qualities
rep_8 = ModelRepresentation(Url=concat_7)  # -> Representation, Valid, Url, Description, Tags, Qualities
rep_9 = ModelRepresentation(Url=concat_8)  # -> Representation, Valid, Url, Description, Tags, Qualities
trim = TrimTree(Tree=rep_4.Representation, Depth=1)
trim_2 = TrimTree(Tree=rep_6.Representation, Depth=1)
trim_3 = TrimTree(Tree=rep_7.Representation, Depth=1)
trim_4 = TrimTree(Tree=rep_5.Representation, Depth=1)
merge_3 = Merge(Data1=rep_8.Representation, Data2=rep_9.Representation, Data3=trim, Data4=trim_2, Data5=trim_4, Data6=trim_3)
concat_17 = Concatenate(FragmentA=path_2, FragmentB=sep, FragmentC=concat_16)
concat_18 = Concatenate(FragmentA=path_2, FragmentB=sep, FragmentC=concat_14)
concat_collider_glb = Concatenate(FragmentA=path_2, FragmentB=sep, FragmentC=concat_16)
cluster = Cluster_2(gr=merge_2)  # -> geo_2, txt_2
typ = ModelType(
    Name=txt.Title,
    Description=description_2,
    Icon=concat_4,
    Image=concat_3,
    Variant=variant_2,
    Representations=merge_3,
    Ports=po_2,
    Authors=authors_2,
    Qualities=qualities_2)  # -> Type, Valid, Name, Description, Icon, Image, Variant, Stock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
geo = ExportGeometry(F=concat_collider_glb, G=collider_2, R=ex_2)  # -> S; inputs G: tree of GeometryBase, R: Boolean
# ---------- geo: C# ----------
// Grasshopper Script Instance
#region Usings
using System;
using System.Linq;
using System.Collections;
using System.Collections.Generic;
using System.Drawing;
using System.IO;

using Rhino;
using Rhino.Geometry;

using Grasshopper;
using Grasshopper.Kernel;
using Grasshopper.Kernel.Data;
using Grasshopper.Kernel.Types;
#endregion

public class Script_Instance : GH_ScriptInstance
{
    #region Notes
    /* 
      Members:
        RhinoDoc RhinoDocument
        GH_Document GrasshopperDocument
        IGH_Component Component
        int Iteration

      Methods (Virtual & overridable):
        Print(string text)
        Print(string format, params object[] args)
        Reflect(object obj)
        Reflect(object obj, string method_name)
    */
    #endregion

    private void RunScript(object F, DataTree<GeometryBase> G, bool R, ref object S)
    {
        // inspired from https://github.com/jhorikawa/GrasshopperProgrammingTutorials/blob/master/0015%20Export%20Geometry%20with%20Grasshopper%20C%23/Export%20Geometry%20with%20Grasshopper%20C%23.gh
        if(R){
            var guids = new List<Guid>();

            for(int i = 0; i < G.BranchCount; i++){
                for(int n = 0; n < G.Branches[i].Count; n++){
                var geom = G.Branches[i][n];
                var guid = Rhino.RhinoDoc.ActiveDoc.Objects.Add(geom);
                guids.Add(guid);
                }
            }

            Rhino.RhinoDoc.ActiveDoc.Objects.Select(guids);

            string cmd = "_-Export " + "\"" + F + "\"" + " _Enter _Enter";

            Rhino.RhinoApp.RunScript(cmd, false);

            Rhino.RhinoDoc.ActiveDoc.Objects.Delete(guids, true);
            S = true;
        }
    }
}
# ---------- end geo ----------
concat_3dm = Concatenate(FragmentA=path_2, FragmentB=sep, FragmentC=concat_13)
geo_2 = ExportGeometry(F=concat_18, G=collider_2, R=ex_2)  # -> S; inputs G: tree of GeometryBase, R: Boolean; same code as geo
geo_3 = ExportGeometry(F=concat_17, G=cluster.geo_2, R=ex_2)  # -> S; inputs G: tree of GeometryBase, R: Boolean; same code as geo
geo_4 = ExportGeometry()  # -> S; inputs G: tree of GeometryBase, R: Boolean; same code as geo
ty = Type(typ.Type)
ba = Text(concat_2)
ty_2 = ClusterOutput(ty)
ba_2 = ClusterOutput(ba)
blc = ExportBlock_3(export=ex_2, ob=group_2)  # -> block_definition_3, path_4, exported_2
blc_2 = ExportBlock_2(path=path_2, gr=group_2, ty=typ.Type, rp=rp_2, export=ex_2)  # -> block_definition_3, path_4, exported_2
blc_3 = ExportBlock_2(path=path_2, export=ex_2)  # -> block_definition_3, path_4, exported_2
geo_5 = ExportGeometry(F=concat_3dm, G=group_2, R=ex_2)  # -> S; inputs G: tree of GeometryBase, R: Boolean; same code as geo

# ==== cluster _2D
x = ClusterInput()
expression = Expression(x=x, Expression="x/2")
neg = Negative(Value=expression)
dom = ConstructDomain(DomainStart=neg, DomainEnd=expression)
I = ClusterOutput(dom)

# ==== cluster ExportBlock_2: Export geometry with layer names to a file.
gr = ClusterInput()
ty = ClusterInput()
export = ClusterInput()
rp = ClusterInput()
path = ClusterInput()
path_2 = FilePath(path)
ty_2 = Type(ty)
rp_2 = Representation(rp)
export_2 = Boolean(export)
cluster = Cluster_2(gr=gr)  # -> geo_2, txt_2
layer = ModelLayer(Name=cluster.txt_2)  # -> Layer, Name, Hidden, Locked, DisplayColour, Material, Linetype
object = ModelObject(Geometry=cluster.geo_2, Layer=layer.Layer)  # -> Object, Geometry, Name, Layer, Visibility, Display, Drafting, Render
typ = ModelType(Type=ty_2)  # -> Type, Valid, Name, Description, Icon, Image, Variant, Stock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
rep = ModelRepresentation(Representation=rp_2)  # -> Representation, Valid, Url, Description, Tags, Qualities
trim = TrimTree(Tree=object.Object, Depth="5")
concat = Concatenate(FragmentA=typ.Type, FragmentC=":", FragmentB=rep.Representation)
block_definition = ModelBlockDefinition(Objects=trim, Name=concat, Notes=typ.Description)  # -> BlockDefinition, Objects, Units, Name, Notes, URL, URLDescription
export_definition = ExportModelBlockDefinition(BlockDefinition=block_definition.BlockDefinition, FilePath=path_2, Overwrite="T", Export=export_2)  # -> BlockDefinition, FilePath, Exported
block_definition_2 = ModelBlockDefinition(export_definition.BlockDefinition)
path_3 = FilePath(export_definition.FilePath)
exported = Boolean(export_definition.Exported)

# ---- group: Export single files. WIP
sep = Separator()  # -> S
# ---------- sep: C# ----------
#region Usings
using System;
using System.Linq;
using System.Collections;
using System.Collections.Generic;
using System.Drawing;
using System.IO;

using Rhino;
using Rhino.Geometry;

using Grasshopper;
using Grasshopper.Kernel;
using Grasshopper.Kernel.Data;
using Grasshopper.Kernel.Types;
#endregion

public class Script_Instance : GH_ScriptInstance
{
    private void RunScript(ref object S)
    {
        S = Path.DirectorySeparatorChar;
    }
}
# ---------- end sep ----------
rep_2 = ReplaceText(Text=rep.Url, Find="/", Replace=sep, RecursiveReplace=False)
item = ListItem(List=rep.Tags, Index=0, Wrap=True)
concat_2 = Concatenate(FragmentA=path_2, FragmentB=sep, FragmentC=rep_2)
mime = Mime({".glb": "model/gltf-binary", ".gltf": "model/gltf+json", ".stl": "model/stl", ".obj": "model/obj", ".blend": "model/x-blender", ".3dm": "model/vnd.3dm", ".ifc": "model/x-ifc", ".dwg": "model/acad", ".dxf": "model/dxf", ".rvt": "model/vnd.revit"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}, selected=".3dm")
trim_2 = TrimTree(Tree=item, Depth=1)
expression = Expression(x=trim_2, y=mime, Expression="x=y")
# WIP
dispatch = Dispatch(List=concat_2, DispatchPattern=expression)  # -> ListA, ListB
dispatch_2 = Dispatch(List=concat_2, DispatchPattern=expression)  # -> ListA, ListB

# ----
exported_2 = ClusterOutput(exported)
path_4 = ClusterOutput(path_3)
block_definition_3 = ClusterOutput(block_definition_2)

# ==== cluster ExportBlock_3: Export geometry with layer names to a file.
ob = ClusterInput()
G = ClusterInput()
dc = ClusterInput()
path = ClusterInput()
name = ClusterInput()
url = ClusterInput()
layer_n = ClusterInput()
export = ClusterInput()
ob_2 = ModelObject(ob)
group = Group(Geometry=G)
path_2 = FilePath(path)
name_2 = Text(name)
url_2 = Text(url)
export_2 = Boolean(export)
layer_n_2 = Name(layer_n)
dc_2 = DisplayColour(dc)
object = ModelObject(Object=group)  # -> Object, Geometry, Name, Layer, Visibility, Display, Drafting, Render
layer = ModelLayer(Name=layer_n_2, DisplayColour=dc_2)  # -> Layer, Name, Hidden, Locked, DisplayColour, Material, Linetype, PrintColour, PrintWidth
object_2 = ModelObject(group)
group_2 = NamedGroup(Geometry=group)  # -> Group, Geometry, Name
object_3 = ModelObject(Geometry=object_2, Layer=layer.Layer)  # -> Object, Geometry, Name, Layer, Visibility, Display, Drafting, Render
object_4 = ModelObject(Object=object_2)  # -> Object, Geometry, Name, Layer, Visibility, Display, Drafting, Render
block_definition = ModelBlockDefinition(Objects=object_3.Object, Name=name_2, URL=url_2)  # -> BlockDefinition, Objects, Units, Name, Notes, URL, URLDescription
panel = Panel(object_4.Layer)
export_definition = ExportModelBlockDefinition(BlockDefinition=block_definition.BlockDefinition, FilePath=path_2, Overwrite="T", Export=export_2)  # -> BlockDefinition, FilePath, Exported
block_definition_2 = ModelBlockDefinition(export_definition.BlockDefinition)
path_3 = FilePath(export_definition.FilePath)
exported = Boolean(export_definition.Exported)
path_4 = ClusterOutput(path_3)
exported_2 = ClusterOutput(exported)
block_definition_3 = ClusterOutput(block_definition_2)

# ==== cluster Cluster_2
gr = ClusterInput()
gr_2 = Group(gr)
group = NamedGroup(Group=gr_2)  # -> Group, Geometry, Name
group_2 = NamedGroup(Group=group.Geometry)  # -> Group, Geometry, Name
expression = Expression(x=graft(group.Name), y=group_2.Name, Expression="x")
group_3 = NamedGroup(Group=group_2.Geometry)  # -> Group, Geometry, Name
expression_2 = Expression(x=graft(expression), y=group_3.Name, Expression="x")
expression_3 = Expression(x=graft(group_2.Name), y=group_3.Name, Expression="x")
group_4 = NamedGroup(Group=group_3.Geometry)  # -> Group, Geometry, Name
expression_4 = Expression(x=graft(expression_2), y=group_4.Name, Expression="x")
expression_5 = Expression(x=graft(expression_3), y=group_4.Name, Expression="x")
expression_6 = Expression(x=graft(group_3.Name), y=group_4.Name, Expression="x")
group_5 = NamedGroup(Group=group_4.Geometry)  # -> Group, Geometry, Name
expression_7 = Expression(x=graft(expression_4), y=group_5.Name, Expression="x")
expression_8 = Expression(x=graft(expression_5), y=group_5.Name, Expression="x")
expression_9 = Expression(x=graft(expression_6), y=group_5.Name, Expression="x")
expression_10 = Expression(x=graft(group_4.Name), y=group_5.Name, Expression="x")
group_6 = NamedGroup(Group=group_5.Geometry)  # -> Group, Geometry, Name
expression_11 = Expression(x=graft(expression_7), y=group_6.Name, Expression="x")
expression_12 = Expression(x=graft(expression_9), y=group_6.Name, Expression="x")
expression_13 = Expression(x=graft(expression_8), y=group_6.Name, Expression="x")
expression_14 = Expression(x=graft(expression_10), y=group_6.Name, Expression="x")
expression_15 = Expression(x=graft(group_5.Name), y=group_6.Name, Expression="x")
merge = Merge(
    Data1=expression_11,
    Data2=expression_13,
    Data3=expression_12,
    Data4=expression_14,
    Data5=expression_15,
    Data6=group_6.Name)
join = TextJoin(Text=merge, Join="::")
geo = Geometry(group_6.Geometry)
txt = Text(join)
geo_2 = ClusterOutput(geo)
txt_2 = ClusterOutput(txt)
