# Grasshopper definition cylindric-tambour.gh (Grasshopper 1.0.8)
# Copyright: GNU Lesser General Public License Version 3
# Copyright: GNU Lesser General Public License v3.0 or later
# plug-ins: RhinoCodePluginGH, semio

number_slider = Slider(0, range=0..3)
save_representation = BooleanToggle(False)
icon_export = BooleanToggle(False)
panel = Panel("""First Storey
Last Storey
Single Storey""")
validate = BooleanToggle(False)
save = BooleanToggle(False)
loop_slider = PythonScript(
    SliderToModify=number_slider,
    Min="0",
    Max="3",
    stepSize="1",
    Delay=Slider(0, range=0..1),
    Run=Toggle(False),
    Reset=Button())  # inputs Run: Boolean, Reset: Boolean
# ---------- loop_slider: Python ----------
import time

def updateSliderInput(inputName,min,max,value,decimalPlace=2):
    for input in ghenv.Component.Params.Input:
        for source in input.Sources:
            if input.Name == str(inputName):
                source.Slider.DecimalPlaces = decimalPlace
                source.Slider.Minimum = min
                source.Slider.Maximum = max
                source.Slider.Value = value
                source.ExpireSolution(True)

def countDecimal(number):
    string= str(number)
    return string[::-1].find('.')

if Run == True:
    if SliderToModify < Max:
        time.sleep(Delay)
        updateSliderInput("SliderToModify",Min,Max,SliderToModify+stepSize,countDecimal(stepSize))
if Reset == True:
    updateSliderInput("SliderToModify",Min,Max,Min)
# ---------- end loop_slider ----------
sep = Separator()  # -> S; same code as sep
dir = Directory()  # -> D
# ---------- dir: C# ----------
#region Usings
using System;
using System.Linq;
using System.Collections;
using System.Collections.Generic;
using System.Drawing;
using System.IO;

using Rhino;
using Rhino.Geometry;

using Grasshopper;
using Grasshopper.Kernel;
using Grasshopper.Kernel.Data;
using Grasshopper.Kernel.Types;
#endregion

public class Script_Instance : GH_ScriptInstance
{
    private void RunScript(ref object D)
    {
        D = Path.GetDirectoryName(this.GrasshopperDocument.FilePath);
    }
}
# ---------- end dir ----------
and = GateAnd(A=save, B=save_representation)
and_2 = GateAnd(A=save, B=icon_export)

panel_2 = Panel("""west
east
west
east
west
east
west
east""")
panel_3 = Panel("""east
west
east
west
east
west
east
west""")
concat = Concatenate(FragmentC="door tambour ", FragmentD=panel_2)
concat_2 = Concatenate(FragmentC="door capsule ", FragmentD=panel_3)
concat_3 = Concatenate(FragmentA="platform ", FragmentB=panel_2)
merge = Merge(Data1=graft(concat_2), Data2=graft(concat_3))

# ----
# ^                                    ^
#    |                                     |
# <-- Constants    Preview -->
# Parameters    External    Local -->
# <-- Meta               |
#      |                       v
#      v
par = ParentDirectory(D=dir)  # -> P; inputs D: String
# ---------- par: C# ----------
#region Usings
using System;
using System.Linq;
using System.Collections;
using System.Collections.Generic;
using System.Drawing;
using System.IO;

using Rhino;
using Rhino.Geometry;

using Grasshopper;
using Grasshopper.Kernel;
using Grasshopper.Kernel.Data;
using Grasshopper.Kernel.Types;
#endregion

public class Script_Instance : GH_ScriptInstance
{
    private void RunScript(string D, ref object P)
    {
        P = new DirectoryInfo(D).Parent;
    }
}
# ---------- end par ----------
item = ListItem(List=panel, Index=number_slider, Wrap=True)
panel_4 = Panel(item)
variant = GetString(item, AtLeast=0, AtMost=1, TreeAccess=False)
itemindex = ItemIndex(L=panel, I=variant)  # -> i; inputs L: list
# ---------- itemindex: Python ----------
#Component Information
#--------------------------------------------------------------------------------------------
if ghenv.Component.RunCount<2:
    #General
    #--------------------------------------------------------------------------------------------
    __author__ = "Ueli Saluz"
    __version__ = "2022.11.18"
    
    ghenv.Component.Name = "ItemIndex"
    ghenv.Component.NickName = "ItemIndex"
    ghenv.Component.Description = "A better IdemIndex"
    ghenv.Component.Message = "VER 1.0"
    ghenv.Component.Category = "Set"
    ghenv.Component.SubCategory = "List"
    
     #Inputs
    #--------------------------------------------------------------------------------------------
    inputIndex=0
    
    ghenv.Component.Params.Input[inputIndex].Name = "List"
    ghenv.Component.Params.Input[inputIndex].NickName = "L"
    ghenv.Component.Params.Input[inputIndex].Description = "Input1 is..."
    ghenv.Component.Params.Input[inputIndex].Optional = False
    inputIndex+=1
    
    ghenv.Component.Params.Input[inputIndex].Name = "Item"
    ghenv.Component.Params.Input[inputIndex].NickName = "I"
    ghenv.Component.Params.Input[inputIndex].Description = "Input2 is..."
    ghenv.Component.Params.Input[inputIndex].Optional = False
    inputIndex+=1
    
    #Outputs
    #--------------------------------------------------------------------------------------------
    outputIndex=0
    
    ghenv.Component.Params.Output[outputIndex].Name = "Index"
    ghenv.Component.Params.Output[outputIndex].NickName = "i"
    ghenv.Component.Params.Output[outputIndex].Description = "Output1 is..."
    outputIndex+=1

i = L.index(I)
# ---------- end itemindex ----------

merge_2 = Merge()
rec = Rectangle({Plane=Plane(origin=(853.3612491, 852.5312947, 866.3069427), x=(0.7071067812, -0.7071067812, 0), y=(-0.4082482905, -0.4082482905, 0.8164965809)), Size=Domain2(u=-52.32632723..52.32632723, v=-27.88533994..27.88533994)})
m2d_parallel = Make2DParallelView(Projection=rec)
make2d = Make2D(Geometry=merge_2, View=m2d_parallel, TangentEdges="T", TangentSeams=False, AutoComputeMake2D=True)  # -> VisibleCurves, VisibleIndex, VisibleType, HiddenCurves, HiddenIndex, HiddenType
trim = TrimTree(Tree=make2d.VisibleCurves, Depth=1)
trim_2 = TrimTree(Tree=make2d.HiddenCurves, Depth=1)

panel_5 = Panel("""F
T
F
T""")
panel_6 = Panel("""F
F
T
T""")
zoom = Button()
panel_7 = Panel("""_first-storey
_last-storey
_single-storey""")
item_2 = ListItem(List=panel_5, Index=itemindex, Wrap=True)
item_3 = ListItem(List=panel_6, Index=itemindex, Wrap=True)
item_4 = ListItem(List=panel, Index=itemindex, Wrap=True)

expression = Expression(x="visible", y=trim, Expression="x")
expression_2 = Expression(x="hidden", y=trim, Expression="x")
concat_4 = Concatenate(FragmentC="icon")
concat_5 = Concatenate(FragmentC="icons", FragmentD=sep)
concat_6 = Concatenate(FragmentA=concat_5)
merge_3 = Merge(Data1=trim, Data2=trim_2)
merge_4 = Merge(Data1=expression, Data2=expression_2)
concat_7 = Concatenate(FragmentA=par, FragmentB=sep, FragmentC=concat_6)
blc = ExportBlock(path=concat_7, name=concat_4, url=concat_6, geo=merge_3, layer_name=merge_4, export=and_2)  # -> block_definition_3, path_4, exported_2

expression_3 = Expression(x=Slider(20, range=0..100), Expression="x/100")
# 2023-2025 Ueli Saluz
# 2025 Elduane Lumpine
# 2025 Christian Hödtke
# Permission is hereby granted, free of charge, to any person obtaining a copy
# of this Grasshopper file and associated documentation files (the "Document"),
# to deal in the Document without restriction, including without limitation the
# rights to use, copy, modify, merge, publish, distribute, sublicense, and/or sell
# copies of the Document, and to permit persons to whom the Document is
# furnished to do so.
# 
# Individual clusters used inside this document might be licensed under
# different terms. This is indicated through a similar copyright notice group
# inside the cluster and otherwise in the license field of the cluster. If you
# have any question please reach out to us: license@semio-tech.com
# 
# THE DOCUMENT IS PROVIDED "AS IS", WITHOUT WARRANTY OF ANY
# KIND, EXPRESS OR IMPLIED, INCLUDING BUT NOT LIMITED TO THE
# WARRANTIES OF MERCHANTABILITY, FITNESS FOR A PARTICULAR
# PURPOSE AND NONINFRINGEMENT. IN NO EVENT SHALL THE
# AUTHORS OR COPYRIGHT HOLDERS BE LIABLE FOR ANY CLAIM,
# DAMAGES OR OTHER LIABILITY, WHETHER IN AN ACTION OF
# CONTRACT, TORT OR OTHERWISE, ARISING FROM, OUT OF OR IN
# CONNECTION WITH THE DOCUMENT OR THE USE OR OTHER
# DEALINGS IN THE DOCUMENT.
expression_4 = Expression(x=Slider(650, range=0..1000), Expression="x/100")
expression_5 = Expression(x=Slider(275, range=0..1000), Expression="x/100")
list = ValueList({"North": "north", "East": "east", "South": "south", "West": "west"}, selected="North")
slab_thickness_m = Number(expression_3)
width_m = Number(expression_4)
floor_height_m = Number(expression_5)
include_top = Boolean(item_3)
int = Integer(include_top)
platform = Text(list)
include_bottom = Boolean(item_2)
int_2 = Integer(include_bottom)
concat_8 = Concatenate(FragmentA=int, FragmentB=int_2)
b2d = BinaryToDecimal(Binary=concat_8)  # -> Decimal
# ---------- b2d: Python ----------
if ghenv.Component.RunCount<2:
    __author__ = "Ueli Saluz"
    __version__ = "2021.11.14"
    
    ghenv.Component.Name = "BinaryToDecimal"
    ghenv.Component.NickName = "B2D"
    ghenv.Component.Description = "Converts a number in binary representation to a number in decimal representation."
    ghenv.Component.Message = "VER 1.0"
    
    ghenv.Component.Params.Input[0].NickName = "Binary"
    
    ghenv.Component.Params.Input[0].Description = "Binary representation of a number."
    
    ghenv.Component.Params.Output[0].NickName = "Decimal"
    
    ghenv.Component.Params.Output[0].Description = "Converted decimal representation of the same number."

if __name__ == "__main__":
    Decimal = int(Binary,2)
# ---------- end b2d ----------
item_5 = ListItem(List=panel, Index=b2d, Wrap=True)
item_6 = ListItem(List=panel_7, Index=b2d, Wrap=True)

aut = ModelAuthor(Name="Ueli Saluz", Email="ueli@semio-tech.org")  # -> Author, Valid, Name, Email, Attributes

concat_9 = Concatenate(FragmentA="images/", FragmentC=".svg")

concat_10 = Concatenate(FragmentA="icons/", FragmentC=".svg")

expression_6 = Expression(x=Slider(30, range=0..100), Expression="x/100")
expression_7 = Expression(x=Slider(80, range=0..200), Expression="x/100")
expression_8 = Expression(x=Slider(200, range=0..1000), Expression="x/100")
expression_9 = Expression(x=Slider(175, range=0..1000), Expression="x/100")
wall_thickness_m = Number(expression_6)
door_width_m = Number(expression_7)
door_height_m = Number(expression_8)
door_offset_m = Number(expression_9)
panel_8 = Panel("Parallel")  # disabled
m2d_rhino = Make2DRhinoView(Name=panel_8, Clip=True)  # disabled
number_slider_2 = Slider(876, range=0..1000)  # disabled
view_rectangle = ViewRectangle(view=m2d_rhino)  # disabled
construction_area_factor = Number(Slider(0.2, range=0..1))
maintenance_expenses_month_eff_m² = Number(Slider(3.5, range=0..10))
construction_cost_eff_m² = Number(Slider(10500, range=0..15000))
previewplane = PreviewPlane(plane=view_rectangle, axis_length=number_slider_2)  # disabled
cooling_energy_demand_kwh_m²a = Number(Slider(5, range=0..200))
heating_energy_demand_kwh_m²a = Number(Slider(15, range=0..200))
technical_equipment_energy_demand_kwh_m² = Number(Slider(20, range=0..200))  # "Technical Equipment Energy Demand[kWh/m²a]"
construction_global_warming_potential_kg = Number(Slider(1600, range=0..2000))  # "Construction Global Warming Potential [kgCO2e/eff. m²]"
_2d = _2D(x=door_width_m)
Z = UnitZ(Factor=1)
rev = Reverse(Vector=Z)

number_slider_3 = Slider(0.05, range=0..1)
series = Series(Start=0, Step="0.25", Count="4")
trim_3 = TrimTree(Tree=series, Depth=1)
addition = Addition(A=trim_3, B=number_slider_3)
subtraction = Subtraction(A=trim_3, B=number_slider_3)
merge_5 = Merge(Data1=graft(subtraction), Data2=graft(addition))
trim_4 = TrimTree(Tree=merge_5, Depth=1)
shift = ShiftList(List=trim_4, Shift="2", Wrap=True)
trim_5 = TrimTree(Tree=shift, Depth=1)

# ----
# https://identifier.buildingsmart.org/uri/buildingsmart/ifc/4.3/prop/Diameter
# https://identifier.buildingsmart.org/uri/buildingsmart/ifc/4.3/class/IfcBuildingStorey
# https://identifier.buildingsmart.org/uri/buildingsmart/ifc/4.3/prop/GrossHeight
# 
# 
# 
# 
# https://identifier.buildingsmart.org/uri/buildingsmart/ifc/4.3/prop/NetFloorArea
# 
# https://identifier.buildingsmart.org/uri/buildingsmart/ifc/4.3/prop/EnergyConsumption
# https://identifier.buildingsmart.org/uri/buildingsmart/ifc/4.3/prop/EnergyConsumption
# https://identifier.buildingsmart.org/uri/buildingsmart/ifc/4.3/prop/EnergyConsumption
# 
# https://identifier.buildingsmart.org/uri/etim/etim/9.0/prop/EF016979
maintenance_expenses_month_m² = Number(maintenance_expenses_month_eff_m²)
# Outputs   ->
#                 |
#                 v
construction_global_warming_potential_kg_2 = Number(construction_global_warming_potential_kg)  # "Construction Global Warming Potential [kgCO2e/eff. m²]"
technical_equipment_energy_demand_kwh_m²_2 = Number(technical_equipment_energy_demand_kwh_m²)  # "Technical Equipment Energy Demand[kWh/m²a]"
construction_area_factor_2 = Number(construction_area_factor)
heating_energy_demand_kwh_m²a_2 = Number(heating_energy_demand_kwh_m²a)
cooling_energy_demand_kwh_m²a_2 = Number(cooling_energy_demand_kwh_m²a)
construction_cost_eff_m²_2 = Number(construction_cost_eff_m²)
expression_10 = Expression(x=construction_area_factor_2, Expression="1-x")
multiplication = Multiplication(B=construction_global_warming_potential_kg_2)
round = Round(Number=multiplication)  # -> Nearest, Floor, Ceiling
panel_9 = Panel("""diameter
storeys
floor height
platform
door width
door height
door offset
effective floor area
construction cost
heating energy demand
cooling energy demand
technical equipment energy demand
maintenance expenses
construction global warming potential""")
panel_10 = Panel("""m

m

m
m
m
m²
€
kWh/a
kWh/a
kWh/a
€/a
kgCO2e""")

series_2 = Series(Start="1", Step=1, Count="2")
dup = DuplicateData(Data="0", Number="4", Order=True)
trim_6 = TrimTree(Tree=series_2, Depth=1)  # -> graft(Tree)
trim_7 = TrimTree(Tree=dup, Depth=1)
dup_2 = DuplicateData(Data=trim_6, Number="2", Order=True)  # -> flatten(Data)
merge_6 = Merge(Data1=trim_7, Data2=dup_2)

expression_11 = Expression(x=floor_height_m, Expression="x/3")
expression_12 = Expression(x=width_m, Expression="x/2")
expression_13 = Expression(x=floor_height_m, Expression="x*(2/3)")
_2d_2 = _2D(x=width_m)
addition_2 = Addition(A=floor_height_m, B=expression_11)
addition_3 = Addition(A=addition_2, B=expression_11)
neg = Negative(Value=expression_12)
dom = ConstructDomain(DomainStart=expression_11, DomainEnd=expression_13)
dom_2 = ConstructDomain(DomainStart=addition_2, DomainEnd=addition_3)
box = DomainBox(Base=PlaneXY(0, 0, 0), X=_2d_2, Y=expression_12, Z=expression_11)
box_2 = DomainBox(Base=PlaneXY(0, 0, 0), X=neg, Y=expression_12, Z=dom)
box_3 = DomainBox(Base=PlaneXY(0, 0, 0), X=expression_12, Y=expression_12, Z=dom_2)
nand = GateNand(A=include_bottom, B=include_top)

expression_14 = Expression(x=width_m, Expression="x/2")
panel_11 = Panel("""north
east
south
west""")
itemindex_2 = ItemIndex(L=panel_11, I=platform)  # -> i; inputs L: list; same code as itemindex
cir = Circle(Plane=PlaneXY(0, 0, 0), Radius=expression_14)
addition_4 = Addition(A=floor_height_m, B=expression_13)
valueor0 = ValueOr0(value=itemindex_2)
coreheight = Number(addition_4)
dom_3 = ConstructDomain(DomainStart=0, DomainEnd=coreheight)
_2d_3 = _2D(x=width_m)
box_4 = DomainBox(Base=PlaneXY(0, 0, 0), X=_2d_3, Y=_2d_3, Z=dom_3)
cyl = Cylinder(Base=PlaneXY(0, 0, 0), Radius=expression_14, Length=coreheight)
cap = CapHoles(Brep=cyl)
debrep = DeconstructBrep(Brep=box_4)  # -> Faces, Edges, Vertices
trim_8 = TrimTree(Tree=debrep.Faces, Depth=1)
item_7 = ListItem(List=trim_8, Index=0, Wrap=True)  # -> Item, Item1, Item2, Item3, Item4
base = Surface(item_7.Item4)
explode = Explode(Curve=base, Recursive=True)  # -> Segments, Vertices
trim_9 = TrimTree(Tree=explode.Segments, Depth=1)
join = JoinCurves(Curves=explode.Segments, Preserve=False)
expression_15 = Expression(x=width_m, Expression="x/2")
expression_16 = Expression(x=door_width_m, Expression="x/2")
trim_10 = TrimTree(Tree=join, Depth=1)
curvepoint = PointOnCurve(trim_9, parameter=0.5)
subtraction_2 = Subtraction(A=expression_15, B=expression_16, C=door_offset_m, D=wall_thickness_m)
crv_cp = CurveClosestPoint(Point=curvepoint, Curve=trim_9)  # -> Point, Parameter, Distance
addition_5 = Addition(A=crv_cp.Parameter, B=subtraction_2)
subtraction_3 = Subtraction(A=crv_cp.Parameter, B=subtraction_2)
eval = EvaluateCurve(Curve=trim_9, Parameter=addition_5)  # -> Point, Tangent, Angle
eval_2 = EvaluateCurve(Curve=trim_9, Parameter=subtraction_3)  # -> Point, Tangent, Angle
shift_2 = ShiftList(List=eval_2.Point, Shift=1, Wrap=True)
trim_11 = TrimTree(Tree=shift_2, Depth=1)
merge_7 = Merge(Data1=graft(eval.Point), Data2=graft(trim_11))

expression_17 = Expression(x=floor_height_m, Expression="x/3")
expression_18 = Expression(x="1", Expression="x+1")
lng = ListLength(List=trim_9)
dup_3 = DuplicateData(Data=expression_17, Number=lng, Order=True)
int_3 = Integer(expression_18)
trim_12 = TrimTree(Tree=dup_3, Depth=1)
expression_19 = Expression(x=int_3, Expression="(x-1)*4")
replace = ReplaceItems(List=trim_12, Item="0", Indices="1", Wrap=False)
repeat = RepeatData(Data=replace, Length=expression_19)
trim_13 = TrimTree(Tree=repeat, Depth=1)
ma = MassAddition(Input=trim_13)  # -> Result, PartialResults
flip = FlipMatrix(Data=ma.PartialResults)
doorheights = Number(flip)
Z_2 = UnitZ(Factor=doorheights)
trim_14 = TrimTree(Tree=Z_2, Depth=1)
cset = CreateSet(List=trim_14)  # -> Set, graft(Map)
path = ConstructPath(Indices=cset.Map)
trim_15 = TrimTree(Tree=path, Depth=1)

l2o = List2Object(L=merge_7)  # -> O; inputs L: tree
# ---------- l2o: Python ----------
#Component Information
#--------------------------------------------------------------------------------------------
if ghenv.Component.RunCount<2:
    #General
    #--------------------------------------------------------------------------------------------
    __author__ = "Ueli Saluz"
    __version__ = "2022.04.24"
    
    ghenv.Component.Name = "List2Object"
    ghenv.Component.NickName = "L2O"
    ghenv.Component.Description = "Wraps a list of objects into a list object."
    ghenv.Component.Message = "VER 1.0"
    ghenv.Component.Category = "Sets"
    ghenv.Component.SubCategory = "Tree"
    
     #Inputs
    #--------------------------------------------------------------------------------------------
    inputIndex=0
    
    ghenv.Component.Params.Input[inputIndex].Name = "List"
    ghenv.Component.Params.Input[inputIndex].NickName = "L"
    ghenv.Component.Params.Input[inputIndex].Description = "Tree with lists to wrap."
    ghenv.Component.Params.Input[inputIndex].Optional = False
    inputIndex+=1
    

    #Outputs
    #--------------------------------------------------------------------------------------------
    outputIndex=0
    
    ghenv.Component.Params.Output[outputIndex].Name =  "ListObject" 
    ghenv.Component.Params.Output[outputIndex].NickName = "O"
    ghenv.Component.Params.Output[outputIndex].Description = "Python list object as single item."
    outputIndex+=1


#Imports
#--------------------------------------------------------------------------------------------
from System import Object
from Grasshopper import DataTree

#Solver - Run with trees to enhance performance drastically
#--------------------------------------------------------------------------------------------
if __name__ == "__main__":
    
    #Initialize trees
    #--------------------------------------------------------------------------------------------
    TreeToWrap = DataTree[Object]()
    
    #Data matching
    #--------------------------------------------------------------------------------------------
    for path in L.Paths:
        listBranch = L.Branch(path)
        TreeToWrap.Add(listBranch,path)
    
     #Assign trees to output
    #--------------------------------------------------------------------------------------------
    O = TreeToWrap
# ---------- end l2o ----------
trim_16 = TrimTree(Tree=l2o, Depth=1)
repeat_2 = RepeatData(Data=trim_16, Length=expression_19)
trim_17 = TrimTree(Tree=repeat_2, Depth=1)
o2l = Object2List(O=trim_17)  # -> L; inputs O: tree
# ---------- o2l: Python ----------
#Component Information
#--------------------------------------------------------------------------------------------
if ghenv.Component.RunCount<2:
    #General
    #--------------------------------------------------------------------------------------------
    __author__ = "Ueli Saluz"
    __version__ = "2022.04.24"
    
    ghenv.Component.Name = "Object2List"
    ghenv.Component.NickName = "O2L"
    ghenv.Component.Description = "Unwraps a list of objects into a list object."
    ghenv.Component.Message = "VER 1.0"
    ghenv.Component.Category = "Sets"
    ghenv.Component.SubCategory = "Tree"
    
     #Inputs
    #--------------------------------------------------------------------------------------------
    inputIndex=0
    
    ghenv.Component.Params.Input[inputIndex].Name = "ListObject"
    ghenv.Component.Params.Input[inputIndex].NickName = "O"
    ghenv.Component.Params.Input[inputIndex].Description = "A python list object that will be unwrapped into a Grasshopper list."
    ghenv.Component.Params.Input[inputIndex].Optional = False
    inputIndex+=1
    

    #Outputs
    #--------------------------------------------------------------------------------------------
    outputIndex=0
    
    ghenv.Component.Params.Output[outputIndex].Name =  "List"
    ghenv.Component.Params.Output[outputIndex].NickName = "L"
    ghenv.Component.Params.Output[outputIndex].Description = "The unwrapped list."
    outputIndex+=1


#Imports
#--------------------------------------------------------------------------------------------
from System import Object
from Grasshopper import DataTree

#Solver - Run with trees to enhance performance drastically
#--------------------------------------------------------------------------------------------
if __name__ == "__main__":
    
    #Initialize trees
    #--------------------------------------------------------------------------------------------
    OriginalTree = DataTree[Object]()
    
    #Data matching
    #--------------------------------------------------------------------------------------------
    for path in O.Paths:
        listBranch = O.Branch(path)
        for i,listItem in enumerate(listBranch):
            OriginalTree.AddRange(list(listItem),path.AppendElement(i))
    
     #Assign trees to output
    #--------------------------------------------------------------------------------------------
    L = OriginalTree
# ---------- end o2l ----------
match = MatchTree(Tree=Z_2, Guide=o2l)
move = Move(Geometry=o2l, Motion=match)  # -> Geometry, Transform
crv_cp_2 = CurveClosestPoint(Point=move.Geometry, Curve=trim_10)  # -> Point, Parameter, Distance
eval_3 = EvaluateCurve(Curve=trim_10, Parameter=crv_cp_2.Parameter)  # -> Point, Tangent, Angle
rev_2 = Reverse(Vector=eval_3.Tangent)
line = LineSDL(Start=eval_3.Point, Direction=Vector(0, 0, 1), Length=1)
vrot = Rotate(Vector=rev_2, Axis=line, Angle=degrees("90"))
expression_20 = Expression(x=valueor0, Expression="-((x+2)*90)%360")
pl = ConstructPlane(Origin=eval_3.Point, XAxis=rev_2, YAxis=vrot)
move_2 = Move(Geometry=pl, Motion=Z_2)  # -> Geometry, Transform
rotate = Rotate(Geometry=move_2.Geometry, Angle=degrees(expression_20), Plane=PlaneXY(0, 0, 0))  # -> Geometry, Transform
neg_2 = Negative(Value=expression_17)
relblbrch = RelabelBranches(TreeToMatch=rotate.Geometry, ListOfPaths=trim_15)  # -> RelabeledTree; inputs TreeToMatch: tree, ListOfPaths: list
# ---------- relblbrch: Python ----------
if ghenv.Component.RunCount<2:
    __author__ = "Your name"
    __version__ = "2000.00.00"
    
    ghenv.Component.Name = "RelabelBranches"
    ghenv.Component.NickName = "ReLblBrch"
    ghenv.Component.Description = "Relabel all the paths of the branches with a list of new paths. The amount of branches must match with the size of the list of pahts"
    ghenv.Component.Message = "VER 1.0"
    
    ghenv.Component.Params.Input[0].NickName = "TreeToMatch"
    ghenv.Component.Params.Input[1].NickName = "ListOfPaths"
    
    ghenv.Component.Params.Input[0].Description = "Tree that should be relabeled."
    ghenv.Component.Params.Input[1].Description = "List of paths to use for new branch paths."
    
    ghenv.Component.Params.Output[0].NickName = "RelabeledTree"
    ghenv.Component.Params.Output[0].Description = "Relabeled tree where all the paths of the branches have been replaced with new paths."

from System import Object
from Grasshopper import DataTree

def relabelBranchesWithLstOfPths (tree, paths):
    newTree = DataTree[Object]()
    for i,path in enumerate(tree.Paths):
        items = tree.Branch(path)
        for data in items:
            newTree.Add(data,paths[i])
    return newTree

if __name__ == "__main__":
    RelabeledTree = relabelBranchesWithLstOfPths(TreeToMatch,ListOfPaths)
# ---------- end relblbrch ----------
addition_6 = Addition(A=neg_2, B=slab_thickness_m)
Z_3 = UnitZ(Factor=addition_6)
move_3 = Move(Geometry=relblbrch, Motion=Z_3)  # -> Geometry, Transform
entranceplanes = Plane(move_3.Geometry)

series_3 = Series(Start=0, Step=1, Count="4")
series_4 = Series(Start=0, Step=1, Count="2")
trim_18 = TrimTree(Tree=series_3, Depth=1)
trim_19 = TrimTree(Tree=series_4, Depth=1)
lng_2 = ListLength(List=flatten(entranceplanes))
merge_8 = Merge(Data1=trim_18, Data2=trim_19, Data3=trim_19)
repeat_3 = RepeatData(Data=merge_8, Length=lng_2)
trim_20 = TrimTree(Tree=repeat_3, Depth=1)
concat_11 = Concatenate(FragmentA="d", FragmentC=trim_20)
qal = ModelQuality(Validate=validate, Name="door", Value=trim_20)  # -> Quality, Valid, Name, Value, Unit

dom_4 = ConstructDomain(DomainStart=floor_height_m, DomainEnd=coreheight)
box_5 = DomainBox(Base=PlaneXY(0, 0, 0), X=_2d_2, Y=neg, Z=dom_4)
rotate_2 = Rotate(Geometry=box, Angle=degrees(expression_20), Plane=PlaneXY(0, 0, 0))  # -> Geometry, Transform
rotate_3 = Rotate(Geometry=box_2, Angle=degrees(expression_20), Plane=PlaneXY(0, 0, 0))  # -> Geometry, Transform
rotate_4 = Rotate(Geometry=box_3, Angle=degrees(expression_20), Plane=PlaneXY(0, 0, 0))  # -> Geometry, Transform
rotate_5 = Rotate(Geometry=box_5, Angle=degrees(expression_20), Plane=PlaneXY(0, 0, 0))  # -> Geometry, Transform
merge_9 = Merge(Data1=rotate_2.Geometry, Data2=rotate_3.Geometry)
merge_10 = Merge(Data1=rotate_4.Geometry, Data2=rotate_5.Geometry)
sunion = SolidUnion(Breps=merge_9)
sunion_2 = SolidUnion(Breps=merge_10)
filter = StreamFilter(Gate=include_top, Stream0=sunion_2)
filter_2 = StreamFilter(Gate=include_bottom, Stream0=sunion)
merge_11 = Merge(Data1=filter_2, Data2=filter)
area = Area(Geometry=merge_11)  # -> Area, Centroid
scale = Scale(Geometry=merge_11, Center=area.Centroid, Factor="1.1")  # -> Geometry, Transform
sdiff = SolidDifference(BrepsA=cap, BrepsB=merge_11)
sdiff_2 = SolidDifference(BrepsA=cap, BrepsB=scale.Geometry)
filter_3 = StreamFilter(Gate=nand, Stream0=cap, Stream1=sdiff)
filter_4 = StreamFilter(Gate=nand, Stream0=cap, Stream1=sdiff_2)

area_2 = Area(Geometry=cir)  # -> Area, Centroid
multiplication_2 = Multiplication(A=area_2.Area, B="1")
multiplication_3 = Multiplication(A=multiplication_2, B=expression_10)
multiplication_4 = Multiplication(A=multiplication_3, B=maintenance_expenses_month_m²)
expression_21 = Expression(x=multiplication_4, Expression="x*12")
round_2 = Round(Number=expression_21)  # -> Nearest, Floor, Ceiling
multiplication_5 = Multiplication(A=heating_energy_demand_kwh_m²a_2, B=multiplication_3)
multiplication_6 = Multiplication(A=cooling_energy_demand_kwh_m²a_2, B=multiplication_3)
multiplication_7 = Multiplication(A=multiplication_3, B=construction_cost_eff_m²_2)
multiplication_8 = Multiplication(A=technical_equipment_energy_demand_kwh_m²_2, B=multiplication_3)
roundmult = RoundToMultiple(N=multiplication_3, M="0.01")  # -> R; inputs N: tree, M: tree
# ---------- roundmult: Python ----------
#Component Information
#--------------------------------------------------------------------------------------------
if ghenv.Component.RunCount<2:
    #General
    #--------------------------------------------------------------------------------------------
    __author__ = "YOUR NAME"
    __version__ = "2000.00.00"
    
    ghenv.Component.Name = "Round to Multiple"
    ghenv.Component.NickName = "RoundMult"
    ghenv.Component.Description = "Rounds a number to the nearest specified multiple."
    ghenv.Component.Message = "VER 1.0"
    ghenv.Component.Category = "Math"
    ghenv.Component.SubCategory = "Arithmetic"
    
     #Inputs
    #--------------------------------------------------------------------------------------------
    inputIndex=0
    
    ghenv.Component.Params.Input[inputIndex].Name = "Number"
    ghenv.Component.Params.Input[inputIndex].NickName = "N"
    ghenv.Component.Params.Input[inputIndex].Description = "Number to round."
    ghenv.Component.Params.Input[inputIndex].Optional = False
    inputIndex+=1
    
    ghenv.Component.Params.Input[inputIndex].Name = "Multiple"
    ghenv.Component.Params.Input[inputIndex].NickName = "M"
    ghenv.Component.Params.Input[inputIndex].Description = "Multiple to round to."
    ghenv.Component.Params.Input[inputIndex].Optional = False
    inputIndex+=1
    
    #Outputs
    #--------------------------------------------------------------------------------------------
    outputIndex=0
    
    ghenv.Component.Params.Output[outputIndex].Name = "Rounded"
    ghenv.Component.Params.Output[outputIndex].NickName = "R"
    ghenv.Component.Params.Output[outputIndex].Description = "Number rounded to the nearest specified multiple."
    outputIndex+=1


#Imports
#--------------------------------------------------------------------------------------------
from System import Object
from Grasshopper import DataTree
import math


#The Component function - Business logic only (e.g. working without trees)
#--------------------------------------------------------------------------------------------
"""Function that this component is computing.
    Inputs:
        number: The number to round.
        multiple: The multiple to round to.
    Output:
        rounded: The number rounded to the nearest specified multiple."""
def RoundToMultiple(number, multiple):
    rounded = math.ceil(number / multiple) * multiple
    return rounded

#Solver - Run with trees to enhance performance drastically
#--------------------------------------------------------------------------------------------
if __name__ == "__main__":
    
    #Initialize trees
    #--------------------------------------------------------------------------------------------
    RoundedTree = DataTree[Object]()
    
    #Data matching
    #--------------------------------------------------------------------------------------------
    for path in N.Paths:
        numberBranch = N.Branch(path)
        for i, number in enumerate(numberBranch):
            multiple = M.Branch(path)[i]
            rounded = RoundToMultiple(number, multiple)
            RoundedTree.Add(rounded, path)
    
     #Assign trees to output
    #--------------------------------------------------------------------------------------------
    R = RoundedTree
# ---------- end roundmult ----------
round_3 = Round(Number=multiplication_7)  # -> Nearest, Floor, Ceiling
round_4 = Round(Number=multiplication_5)  # -> Nearest, Floor, Ceiling
round_5 = Round(Number=multiplication_6)  # -> Nearest, Floor, Ceiling
round_6 = Round(Number=multiplication_8)  # -> Nearest, Floor, Ceiling
merge_12 = Merge(
    Data1=width_m,
    Data2="1",
    Data3=floor_height_m,
    Data4=platform,
    Data5=door_width_m,
    Data6=door_height_m,
    Data7=door_offset_m,
    Data8=roundmult,
    Data9=round_3.Nearest,
    Data10=round_4.Nearest,
    Data11=round_5.Nearest,
    Data12=round_6.Nearest,
    Data13=round_2.Nearest,
    Data14=round.Floor)
panel_12 = Panel(merge_12)
qal_2 = ModelQuality(Validate=validate, Name=panel_9, Value=panel_12, Unit=panel_10)  # -> Quality, Valid, Name, Value, Unit

dup_4 = DuplicateData(Data=merge_6, Number="1", Order=True)
trim_21 = TrimTree(Tree=dup_4, Depth=1)
concat_12 = Concatenate(FragmentA="sl", FragmentC=trim_21)
qal_3 = ModelQuality(Validate=validate, Name="split level", Value=trim_21)  # -> Quality, Valid, Name, Value, Unit

equals = Equality(FirstNumber=trim_21, SecondNumber="0")  # -> Equality, Inequality
panel_13 = Panel("""main
side""")
item_8 = ListItem(List=panel_13, Index=equals.Equality, Wrap=True)
qal_4 = ModelQuality(Validate=validate, Name="platform", Value=item_8)  # -> Quality, Valid, Name, Value, Unit

graft = GraftTree(Tree=pl, IncludeEmptyLists=True, IncludeNullItems=True)

subtraction_4 = Subtraction(A=coreheight, B=expression_11)
pt = ConstructPoint(XCoordinate=0, YCoordinate=0, ZCoordinate=expression_11)
pt_2 = ConstructPoint(XCoordinate=0, YCoordinate=0, ZCoordinate=0)
pt_3 = ConstructPoint(XCoordinate=0, YCoordinate=0, ZCoordinate=subtraction_4)
pt_4 = ConstructPoint(XCoordinate=0, YCoordinate=0, ZCoordinate=coreheight)
filter_5 = StreamFilter(Gate=include_bottom, Stream0=pt, Stream1=pt_2)
filter_6 = StreamFilter(Gate=include_top, Stream0=pt_3, Stream1=pt_4)
Z_4 = UnitZ(Factor=1)
rev_3 = Reverse(Vector=Z_4)

tstat = TreeStatistics(Tree=graft)  # -> Paths, Length, Count
expression_22 = Expression(x=valueor0, Expression="-((x+2)*90)%360")

panel_14 = Panel(" storey core with an elevator in the center, the main platform on the ")
panel_15 = Panel(""", and on the other corners sides platforms with two doors. There is a stair between 
every platform. Hence the doors are spiraling around.""")
concat_13 = Concatenate(FragmentH="An efficient ", FragmentG="1", FragmentA=panel_14, FragmentB=platform, FragmentC=panel_15)

panel_16 = Panel("""tambour circular bottom
tambour circular bottom
roof circular top
roof circular top""")
panel_17 = Panel("""tambour circular top
tambour circular top
roof circular bottom
roof circular bottom""")
item_9 = ListItem(List=panel_17, Index=itemindex, Wrap=True)
item_10 = ListItem(List=panel_16, Index=itemindex, Wrap=True)
por = ModelPort(
    Validate=validate,
    Id="t",
    Description="The top system center of the elevator.",
    Family=item_9,
    CompatibleFamilies=item_10,
    Point=filter_6,
    Direction=Z_4,
    T="0",
    Qualities="top")  # -> Port, Valid, Id, Description, Mandatory, Family, CompatibleFamilies, Point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

panel_18 = Panel("""tambour circular bottom
core circular top
tambour circular bottom
core circular top""")
panel_19 = Panel("""tambour circular top
core circular bottom
tambour circular top
core circular bottom""")
panel_20 = Panel("bottom")
qal_5 = ModelQuality(Name="wasp rotation", Value="180")  # -> Quality, Valid, Name, Value, Unit
item_11 = ListItem(List=panel_19, Index=itemindex, Wrap=True)
item_12 = ListItem(List=panel_18, Index=itemindex, Wrap=True)
merge_13 = Merge(Data2=qal_5.Quality)
por_2 = ModelPort(
    Validate=validate,
    Id="b",
    Description="The bottom system center of the elevator.",
    Family=item_12,
    CompatibleFamilies=item_11,
    Point=filter_5,
    Direction=rev_3,
    T="0.5",
    Qualities=merge_13)  # -> Port, Valid, Id, Description, Mandatory, Family, CompatibleFamilies, Point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

volume = Data(filter_3)

jagged = SettingsSpeed()
mesh = MeshBrep(Brep=filter_4, Settings=jagged)
collider = Mesh(mesh)

graft_2 = GraftTree(Tree=pl, IncludeEmptyLists=True, IncludeNullItems=True)
graft_3 = GraftTree(Tree=pl, IncludeEmptyLists=True, IncludeNullItems=True)
tstat_2 = TreeStatistics(Tree=graft_2)  # -> Paths, Length, Count
tstat_3 = TreeStatistics(Tree=graft_3)  # -> Paths, Length, Count

cir_2 = Circle(Plane=PlaneXY(0, 0, 0), Radius=expression_14)
crv_cp_3 = CurveClosestPoint(Point=merge_7, Curve=cir_2)  # -> Point, Parameter, Distance
eval_4 = EvaluateCurve(Curve=cir_2, Parameter=crv_cp_3.Parameter)  # -> Point, Tangent, Angle
Z_5 = UnitZ(Factor=1)
rev_4 = Reverse(Vector=eval_4.Tangent)
xprod = CrossProduct(VectorA=eval_4.Tangent, VectorB=Z_5, Unitize=False)  # -> Vector, Length
pl_2 = ConstructPlane(Origin=eval_4.Point, XAxis=rev_4, YAxis=xprod.Vector)

l2o_2 = List2Object(L=pl_2)  # -> O; inputs L: tree; same code as l2o
trim_22 = TrimTree(Tree=l2o_2, Depth=1)
repeat_4 = RepeatData(Data=trim_22, Length=expression_19)
trim_23 = TrimTree(Tree=repeat_4, Depth=1)
o2l_2 = Object2List(O=trim_23)  # -> graft(L); inputs O: tree; same code as o2l
relblbrch_2 = RelabelBranches(TreeToMatch=o2l_2, ListOfPaths=tstat.Paths)  # -> RelabeledTree; inputs TreeToMatch: tree, ListOfPaths: list; same code as relblbrch
trim_24 = TrimTree(Tree=relblbrch_2, Depth=1)
deplane = DeconstructPlane(Plane=pl_2)  # -> Origin, XAxis, YAxis, ZAxis
pl_3 = ConstructPlane(Origin=deplane.Origin, XAxis=deplane.XAxis, YAxis=deplane.ZAxis)
rectangle = Rectangle(Plane=pl_3, XSize=_2d, YSize=door_height_m, Radius=0)  # -> Rectangle, Length
l2o_3 = List2Object(L=rectangle.Rectangle)  # -> O; inputs L: tree; same code as l2o
trim_25 = TrimTree(Tree=l2o_3, Depth=1)
repeat_5 = RepeatData(Data=trim_25, Length=expression_19)
trim_26 = TrimTree(Tree=repeat_5, Depth=1)
o2l_3 = Object2List(O=trim_26)  # -> graft(L); inputs O: tree; same code as o2l
relblbrch_3 = RelabelBranches(TreeToMatch=o2l_3, ListOfPaths=tstat_2.Paths)  # -> RelabeledTree; inputs TreeToMatch: tree, ListOfPaths: list; same code as relblbrch
trim_27 = TrimTree(Tree=relblbrch_3, Depth=1)
explode_2 = Explode(Curve=rectangle.Rectangle, Recursive=True)  # -> Segments, Vertices
item_13 = ListItem(List=explode_2.Vertices, Index=0, Wrap=True)  # -> Item, Item1
trim_28 = TrimTree(Tree=item_13.Item1, Depth=1)
trim_29 = TrimTree(Tree=item_13.Item, Depth=1)
crv_cp_4 = CurveClosestPoint(Point=trim_29, Curve=cir_2)  # -> Point, Parameter, Distance
crv_cp_5 = CurveClosestPoint(Point=trim_28, Curve=cir_2)  # -> Point, Parameter, Distance
ln = Line(StartPoint=crv_cp_4.Point, EndPoint=crv_cp_5.Point)
eval_5 = EvaluateCurve(Curve=reparameterize(ln), Parameter="0.5")  # -> Point, Tangent, Angle
xprod_2 = CrossProduct(VectorA=eval_5.Tangent, VectorB=rev, Unitize=False)  # -> Vector, Length
pl_4 = ConstructPlane(Origin=eval_5.Point, XAxis=eval_5.Tangent, YAxis=xprod_2.Vector)
deplane_2 = DeconstructPlane(Plane=pl_4)  # -> Origin, XAxis, YAxis, ZAxis
len = Length(Curve=ln)
item_14 = ListItem(List=flatten(len), Index=0, Wrap=True)
pl_5 = ConstructPlane(Origin=deplane_2.Origin, XAxis=deplane_2.XAxis, YAxis=deplane_2.ZAxis)
_2d_4 = _2D(x=len)
panel_21 = Panel(item_14)
rectangle_2 = Rectangle(Plane=pl_5, XSize=_2d_4, YSize=door_height_m, Radius=0)  # -> Rectangle, Length
rulesrf = RuledSurface(CurveA=rectangle.Rectangle, CurveB=rectangle_2.Rectangle)
cap_2 = CapHoles(Brep=rulesrf)
l2o_4 = List2Object(L=cap_2)  # -> O; inputs L: tree; same code as l2o
trim_30 = TrimTree(Tree=l2o_4, Depth=1)
repeat_6 = RepeatData(Data=trim_30, Length=expression_19)
trim_31 = TrimTree(Tree=repeat_6, Depth=1)
o2l_4 = Object2List(O=trim_31)  # -> graft(L); inputs O: tree; same code as o2l
relblbrch_4 = RelabelBranches(TreeToMatch=o2l_4, ListOfPaths=tstat_3.Paths)  # -> RelabeledTree; inputs TreeToMatch: tree, ListOfPaths: list; same code as relblbrch
trim_32 = TrimTree(Tree=relblbrch_4, Depth=1)

panel_22 = Panel("""east
north
north
west
west
south
south
east""")
expression_23 = Expression(x=valueor0, Expression="(-x)*2")
shift_3 = ShiftList(List=panel_22, Shift=expression_23, Wrap=True)

shift_4 = ShiftList(List=trim_5, Shift=expression_23, Wrap=True)
trim_33 = TrimTree(Tree=shift_4, Depth=1)

l2o_5 = List2Object(L=merge_7)  # -> O; inputs L: tree; same code as l2o
trim_34 = TrimTree(Tree=l2o_5, Depth=1)
repeat_7 = RepeatData(Data=trim_34, Length=expression_19)
trim_35 = TrimTree(Tree=repeat_7, Depth=1)
o2l_5 = Object2List(O=trim_35)  # -> L; inputs O: tree; same code as o2l
match_2 = MatchTree(Tree=Z_2, Guide=o2l_5)
move_4 = Move(Geometry=o2l_5, Motion=match_2)  # -> Geometry, Transform
crv_cp_6 = CurveClosestPoint(Point=move_4.Geometry, Curve=trim_10)  # -> Point, Parameter, Distance
eval_6 = EvaluateCurve(Curve=trim_10, Parameter=crv_cp_6.Parameter)  # -> Point, Tangent, Angle
rev_5 = Reverse(Vector=eval_6.Tangent)
line_2 = LineSDL(Start=eval_6.Point, Direction=Vector(0, 0, 1), Length=1)
vrot_2 = Rotate(Vector=rev_5, Axis=line_2, Angle=degrees("90"))
neg_3 = Negative(Value=expression_17)
pl_6 = ConstructPlane(Origin=eval_6.Point, XAxis=rev_5, YAxis=vrot_2)
addition_7 = Addition(A=neg_3, B=slab_thickness_m)
move_5 = Move(Geometry=trim_24, Motion=Z_2)  # -> Geometry, Transform
Z_6 = UnitZ(Factor=addition_7)

rotate_6 = Rotate(Geometry=move_5.Geometry, Angle=degrees(expression_22), Plane=PlaneXY(0, 0, 0))  # -> Geometry, Transform

move_6 = Move(Geometry=rotate_6.Geometry, Motion=Z_6)  # -> Geometry, Transform
relblbrch_5 = RelabelBranches(TreeToMatch=move_6.Geometry, ListOfPaths=trim_15)  # -> RelabeledTree; inputs TreeToMatch: tree, ListOfPaths: list; same code as relblbrch
entranceplanes_2 = Plane(relblbrch_5)

pl2pl = MoveObjectPlaneToPlane(G=trim_27, S=trim_24, T=move_6.Geometry)  # -> TG, T; inputs S: Plane, T: Plane
# ---------- pl2pl: Python ----------
#Component Information
#--------------------------------------------------------------------------------------------
if ghenv.Component.RunCount<2:
    #General
    #--------------------------------------------------------------------------------------------
    __author__ = "Ueli Saluz"
    __version__ = "2023.02.12"
    
    ghenv.Component.Name = "MoveObjectPlaneToPlane"
    ghenv.Component.NickName = "Pl2Pl"
    ghenv.Component.Description = "Moves abitrary geometry from a source plane to a target plane."
    ghenv.Component.Message = "VER 1.2"
    ghenv.Component.Category = "Transform"
    ghenv.Component.SubCategory = "Euclidean"
    
     #Inputs
    #--------------------------------------------------------------------------------------------
    inputIndex=0
    
    ghenv.Component.Params.Input[inputIndex].Name = "Geometry"
    ghenv.Component.Params.Input[inputIndex].NickName = "G"
    ghenv.Component.Params.Input[inputIndex].Description = "Geometry to move."
    ghenv.Component.Params.Input[inputIndex].Optional = False
    inputIndex+=1
    
    ghenv.Component.Params.Input[inputIndex].Name = "SourcePlane"
    ghenv.Component.Params.Input[inputIndex].NickName = "S"
    ghenv.Component.Params.Input[inputIndex].Description = "Source plane of object."
    ghenv.Component.Params.Input[inputIndex].Optional = False
    inputIndex+=1
    
    ghenv.Component.Params.Input[inputIndex].Name = "TargetPlane"
    ghenv.Component.Params.Input[inputIndex].NickName = "T"
    ghenv.Component.Params.Input[inputIndex].Description = "Target plane of object."
    ghenv.Component.Params.Input[inputIndex].Optional = False
    inputIndex+=1
    
    #Outputs
    #--------------------------------------------------------------------------------------------
    outputIndex=0
    
    ghenv.Component.Params.Output[outputIndex].Name = "TranslatedGeometry"
    ghenv.Component.Params.Output[outputIndex].NickName = "TG"
    ghenv.Component.Params.Output[outputIndex].Description = "Translated geometry in target plane."
    outputIndex+=1
    
    ghenv.Component.Params.Output[outputIndex].Name = "Trasnform"
    ghenv.Component.Params.Output[outputIndex].NickName = "T"
    ghenv.Component.Params.Output[outputIndex].Description = "Transform describing translation form source to target plane."
    outputIndex+=1


#Imports
#--------------------------------------------------------------------------------------------
import Rhino.Geometry.Transform as trsf

def MvObjPlnToPln (geo,plnObj,plnDest):
    transform = trsf.PlaneToPlane(plnObj,plnDest)
    geo.Transform(transform)
    return (geo,transform)

TG, T = MvObjPlnToPln(G,S,T)
# ---------- end pl2pl ----------
transform = Transform(Geometry=trim_32, Transform=pl2pl.T)
doors1to200 = Brep(flatten(transform))

trim_36 = TrimTree(Tree=doors1to200, Depth=1)
merge_14 = Merge(Data1=cap, Data2=trim_36)
volume1to200 = Brep(merge_14)

doors1to500 = Rectangle(flatten(pl2pl.TG))

door_tree = Data(doors1to500)
lng_3 = ListLength(List=flatten(door_tree))
repeat_8 = RepeatData(Data=flatten(shift_3), Length=lng_3)
tstat_4 = TreeStatistics(Tree=door_tree)  # -> Paths, Length, Count
trim_37 = TrimTree(Tree=repeat_8, Depth=1)
partition = PartitionList(List=trim_37, Size=tstat_4.Length)
match_3 = MatchTree(Tree=partition, Guide=door_tree)  # -> flatten(Tree)
qal_6 = ModelQuality(Validate=validate, Name="facade", Value=match_3)  # -> Quality, Valid, Name, Value, Unit

panel_23 = Panel("""first
second
third
fourth""")
item_15 = ListItem(List=panel_23, Index=trim_20, Wrap=True)
concat_14 = Concatenate(
    FragmentG="The ",
    FragmentF=item_15,
    FragmentA=" door of the ",
    FragmentB=item_8,
    FragmentC=" plattform in the ",
    FragmentD=match_3,
    FragmentE=" facade.")

panel_24 = Panel("""0.2
0.05
0.95
0.8
0.7
0.55
0.45
0.3""")
entranceplanes_3 = Plane(flatten(entranceplanes_2))
concat_15 = Concatenate(FragmentC=concat_12, FragmentD="_", FragmentE=concat_11)
merge_15 = Merge(Data1=graft(qal_3.Quality), Data2=graft(qal.Quality), Data3=graft(qal_6.Quality), Data4=graft(qal_4.Quality))
por_3 = ModelPort(
    Port=graft(entranceplanes_3),
    Validate=validate,
    Id=graft(concat_15),
    Description=graft(concat_14),
    Family=graft(concat),
    CompatibleFamilies=merge,
    T=graft(panel_24))  # -> Port, Valid, Id, Description, Mandatory, Family, CompatibleFamilies, Point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
trim_38 = TrimTree(Tree=por_3.Port, Depth=1)

merge_16 = Merge(Data1=por_2.Port, Data2=por.Port, Data3=trim_38)
prv = PreviewPort(po=merge_16)

typ = ModelType(
    Validate=validate,
    Name="Cylindric Tambour",
    Description=concat_13,
    Icon=concat_10,
    Image=concat_9,
    Variant=variant,
    Unit="m",
    Ports=merge_16,
    Authors=aut.Author,
    Qualities=qal_2.Quality)  # -> Type, Valid, Name, Description, Icon, Image, Variant, Stock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
typ_2 = PutType(Type=typ.Type, Uri=par, Run=save)

typ_3 = SerializeType(Type=typ.Type)
type = Text(typ_3)
context_bake = ContextBake(Geometry=type)

edges = BrepEdges(Brep=cyl)  # -> Naked, Interior, NonManifold
data = Data(flatten(len))
item_16 = ListItem(List=edges.Naked, Index=0, Wrap=True)
Z_7 = UnitZ(Factor=coreheight)
item_17 = ListItem(List=data, Index=0, Wrap=True)
group = NamedGroup()  # -> Group, Geometry, Name
len_2 = Length(Curve=item_16)
multiplication_9 = Multiplication(A=item_17, B="2")
division = Division(A=len_2, B=multiplication_9)
round_7 = Round(Number=division)  # -> Nearest, Floor, Ceiling
volume_2 = Data(volume)
group_2 = NamedGroup(Geometry=volume_2, Name="floors")  # -> Group, Geometry, Name
divide = DivideCurve(Curve=item_16, Count=round_7.Floor, Kinks=False)  # -> Points, Tangents, Parameters
shift_5 = ShiftList(List=divide.Points, Shift=1, Wrap=True)
ln_2 = Line(StartPoint=divide.Points, EndPoint=shift_5)
boundary = BoundarySurfaces(Edges=ln_2)
extr = Extrude(Base=ln_2, Direction=Z_7)
move_7 = Move(Geometry=boundary, Motion=Z_7)  # -> Geometry, Transform
merge_17 = Merge(Data1=boundary, Data2=move_7.Geometry, Data3=extr)
join_2 = BrepJoin(Breps=merge_17)  # -> Breps, Closed
group_3 = NamedGroup(Geometry=doors1to200, Name="door")  # -> Group, Geometry, Name
group_4 = NamedGroup(Geometry=doors1to500, Name="door")  # -> Group, Geometry, Name
group_5 = NamedGroup(Geometry=volume_2, Name="Volume")  # -> Group, Geometry, Name
group_6 = NamedGroup(Geometry=volume_2, Name="Volume")  # -> Group, Geometry, Name
facen = FaceNormals(Mesh=flatten(pl_5))  # -> Centers, simplify(Normals)
merge_18 = Merge(Data1=group_4.Group, Data2=group_5.Group)
neg_4 = Negative(Value=facen.Normals)
merge_19 = Merge(Data1=group_3.Group, Data2=group_6.Group)
graft_4 = GraftTree(Tree=doors1to500, IncludeEmptyLists=True, IncludeNullItems=True)
sdiff_3 = SolidDifference(BrepsA=join_2.Breps, BrepsB=merge_11)  # -> flatten(Result)
merge_20 = Merge(Data1=facen.Normals, Data2=neg_4)
null = NullItem(Item=sdiff_3)  # -> NullFlags, InvalidFlags, Description
wires = BrepWireframe(Brep=volume_2, Density=-1)  # -> flatten(Wireframe)
group_7 = NamedGroup(Geometry=merge_18)  # -> Group, Geometry, Name
group_8 = NamedGroup(Geometry=merge_19)  # -> Group, Geometry, Name
extr_2 = Extrude(Base=graft_4, Direction=merge_20)
join_3 = BrepJoin(Breps=extr_2)  # -> Breps, Closed
filter_7 = StreamFilter(Gate=null.NullFlags, Stream0=sdiff_3, Stream1=join_2.Breps)
merge_21 = Merge(Data1=volume_2, Data2=wires, Data3=doors1to500)
data_2 = Data(concat_13)
data_3 = Data(variant)
rep = ModelRepresentation(Tags="1 to 200")  # -> Representation, Valid, Url, Description, Tags, Attributes
collider_2 = Mesh(collider)
au = Author(aut.Author)
ql = Quality(qal_2.Quality)
po = Port(merge_16)
cap_3 = CapHoles(Brep=join_3.Breps)  # -> flatten(Brep)
bbx = BrepBrep(BrepA=cap_3, BrepB=join_2.Breps)  # -> flatten(Curves), Points
typ_4 = OppinionatedType(
    path=dir,
    description=data_2,
    variant=data_3,
    de=group_7.Group,
    paper=merge_21,
    collider=collider_2,
    volume=group_7.Group,
    group=group_8.Group,
    rp=rep.Representation,
    po=po,
    authors=au,
    qualities=ql,
    ex=and)  # -> ty_2, ba_2
doors = Data(bbx.Curves)
srf = Surface(doors)
group_9 = NamedGroup(Geometry=srf, Name="door")  # -> Group, Geometry, Name

geo = PreviewGeometry(geo=group_8.Group, sc=1)
bbox = BoundingBox(Content=flatten(group_8.Group), Plane=PlaneXY(0, 0, 0), UnionBox=True)  # -> Box, Box_2
zoom2bb = ZoomToBoundingBox(N=["Top", "Front", "Right", "Perspective", "Parallel"], BB=bbox.Box, S=0, R=zoom)  # -> F, SBB; inputs BB: Box, R: Boolean
# ---------- zoom2bb: Python ----------
#Component Information
#--------------------------------------------------------------------------------------------
if ghenv.Component.RunCount<2:
    #General
    #--------------------------------------------------------------------------------------------
    __author__ = "Ueli Saluz"
    __version__ = "2022.05.21"
    
    ghenv.Component.Name = "ZoomToBoundingBox"
    ghenv.Component.NickName = "Zoom2BB"
    ghenv.Component.Description = "Zoom the view of a Rhino viewport to a bounding box."
    ghenv.Component.Message = "VER 1.1"
    ghenv.Component.Category = "Display"
    ghenv.Component.SubCategory = "Camera"
    
     #Inputs
    #--------------------------------------------------------------------------------------------
    inputIndex=0
    
    ghenv.Component.Params.Input[inputIndex].Name = "Name"
    ghenv.Component.Params.Input[inputIndex].NickName = "N"
    ghenv.Component.Params.Input[inputIndex].Description = "Name of the viewport"
    ghenv.Component.Params.Input[inputIndex].Optional = False
    inputIndex+=1
    
    ghenv.Component.Params.Input[inputIndex].Name = "BoundingBox"
    ghenv.Component.Params.Input[inputIndex].NickName = "BB"
    ghenv.Component.Params.Input[inputIndex].Description = ""
    ghenv.Component.Params.Input[inputIndex].Optional = False
    inputIndex+=1
    
    ghenv.Component.Params.Input[inputIndex].Name = "ScaleFactor"
    ghenv.Component.Params.Input[inputIndex].NickName = "S"
    ghenv.Component.Params.Input[inputIndex].Description = "A factor for the extension of the bounding box." \
    +"0 means 0 extension, a positive number makes the bounding box larger a negative smaller. The amount is proportional to the length."
    ghenv.Component.Params.Input[inputIndex].Optional = False
    inputIndex+=1
   
    
    ghenv.Component.Params.Input[inputIndex].Name = "Run"
    ghenv.Component.Params.Input[inputIndex].NickName = "R"
    ghenv.Component.Params.Input[inputIndex].Description = "Zoom to the given bounding box."
    ghenv.Component.Params.Input[inputIndex].Optional = False
    inputIndex+=1
    
    #Outputs
    #--------------------------------------------------------------------------------------------
    outputIndex=0
    
    ghenv.Component.Params.Output[outputIndex].Name = "Finished"
    ghenv.Component.Params.Output[outputIndex].NickName = "F"
    ghenv.Component.Params.Output[outputIndex].Description = "Sends True when finished. Just to trigger other depending components."
    outputIndex+=1
    
    ghenv.Component.Params.Output[outputIndex].Name = "ScaledBoundingBox"
    ghenv.Component.Params.Output[outputIndex].NickName = "SBB"
    ghenv.Component.Params.Output[outputIndex].Description = "The scaled bounding box."
    outputIndex+=1


#Imports
#--------------------------------------------------------------------------------------------
from Rhino import RhinoDoc
from Rhino.Geometry import Box

#Solver - Run with trees to enhance performance drastically
#--------------------------------------------------------------------------------------------
if __name__ == "__main__":
    try:
        vp = RhinoDoc.ActiveDoc.Views.Find(N, False).ActiveViewport
        if R:
            box = BB
            bb = BB.BoundingBox
            bb.Inflate(S*box.X.Length,S*box.Y.Length,S*box.Z.Length)
            vp.ZoomBoundingBox(bb)
            SBB = bb
        F = True
    except:
        pass
# ---------- end zoom2bb ----------
sort_surfaces = SortSurfaces(B=filter_7)  # -> base_2, roof_2, walls_2

group_10 = NamedGroup(Geometry=sort_surfaces.base_2, Name="Base")  # -> flatten(Group), Geometry, Name
group_11 = NamedGroup(Geometry=sort_surfaces.walls_2, Name="walls")  # -> flatten(Group), Geometry, Name
group_12 = NamedGroup(Geometry=sort_surfaces.roof_2, Name="roof")  # -> flatten(Group), Geometry, Name
merge_22 = Merge(
    Data1=group_2.Group,
    Data2=group_10.Group,
    Data3=group_11.Group,
    Data4=group.Group,
    Data5=group_9.Group,
    Data7=group_12.Group)
group_13 = NamedGroup(Geometry=merge_22)  # -> Group, Geometry, Name
energy_representation = Data(group_13.Group)

# ==== cluster _2D
x = ClusterInput()
expression = Expression(x=x, Expression="x/2")
neg = Negative(Value=expression)
dom = ConstructDomain(DomainStart=neg, DomainEnd=expression)
I = ClusterOutput(dom)

# ==== cluster ValueOr0
value = ClusterInput()
value_2 = Number(value)
null = NullItem(Item=value_2)  # -> NullFlags, InvalidFlags, Description
filter = StreamFilter(Gate=null.NullFlags, Stream0=value_2, Stream1="0")
valueor0 = Number(filter)
valueor0_2 = ClusterOutput(valueor0)

# ==== cluster PreviewPlane: Preview a plane with axis colors and naming.
axis_length = ClusterInput()
plane = ClusterInput()
axis_length_2 = Number(axis_length)
plane_2 = Plane(plane)
deplane = DeconstructPlane(Plane=plane_2)  # -> Origin, XAxis, YAxis, ZAxis
line = LineSDL(Start=deplane.Origin, Direction=deplane.YAxis, Length=axis_length_2)
line_2 = LineSDL(Start=deplane.Origin, Direction=deplane.XAxis, Length=axis_length_2)
line_3 = LineSDL(Start=deplane.Origin, Direction=deplane.ZAxis, Length=axis_length_2)
swatch = ColourSwatch(SwatchColor=RGB(235, 52, 79))
swatch_2 = ColourSwatch(SwatchColor=RGB(0, 166, 157))
swatch_3 = ColourSwatch(SwatchColor=RGB(240, 117, 24))
end = EndPoints(Curve=line_2)  # -> Start, End
end_2 = EndPoints(Curve=line)  # -> Start, End
end_3 = EndPoints(Curve=line_3)  # -> Start, End
tag = TextTag(Location=end.End, Text="X", Colour=swatch)
tag_2 = TextTag(Location=end_2.End, Text="Y", Colour=swatch_2)
tag_3 = TextTag(Location=end_3.End, Text="Z", Colour=swatch_3)
preview = CustomPreview(Geometry=line_2, Material=swatch)
preview_2 = CustomPreview(Geometry=line, Material=swatch_2)
preview_3 = CustomPreview(Geometry=line_3, Material=swatch_3)

# ==== cluster ViewRectangle
view = ClusterInput()
view_2 = Data(view)
nickname = NAME(view=view_2)  # -> c, x, y, z, h, w
# ---------- nickname: Python ----------
uselss, c, x, y, z = view.GetCameraFrame()
h = view.FrustumHeight
w = view.FrustumWidth
# ---------- end nickname ----------
rev = Reverse(Vector=nickname.x)
rev_2 = Reverse(Vector=nickname.y)
pl = ConstructPlane(Origin=nickname.c, XAxis=rev, YAxis=nickname.y)
_2d = _2D(x=nickname.w)
_2d_2 = _2D(x=nickname.h)
rectangle = Rectangle(Plane=pl, XSize=_2d, YSize=_2d_2, Radius=0)  # -> Rectangle, Length
rec = Rectangle(rectangle.Rectangle)
rec_2 = ClusterOutput(rec)

# ==== cluster ExportBlock: Export geometry with layer names to a file.
path = ClusterInput()
name = ClusterInput()
url = ClusterInput()
geo = ClusterInput()
layer_name = ClusterInput()
export = ClusterInput()
path_2 = FilePath(path)
name_2 = Text(name)
url_2 = Text(url)
geo_2 = Geometry(geo)
layer_name_2 = Text(layer_name)
export_2 = Boolean(export)
layer = ModelLayer(Name=layer_name_2)  # -> Layer, Name, Hidden, Locked, DisplayColour, Material, Linetype
object = ModelObject(Geometry=geo_2, Layer=layer.Layer)  # -> Object, Geometry, Name, Layer, Visibility, Display, Drafting, Render
block_definition = ModelBlockDefinition(Objects=object.Object, Name=name_2, URL=url_2)  # -> BlockDefinition, Objects, Units, Name, Notes, URL, URLDescription
export_definition = ExportModelBlockDefinition(BlockDefinition=block_definition.BlockDefinition, FilePath=path_2, Overwrite="T", Export=export_2)  # -> BlockDefinition, FilePath, Exported
block_definition_2 = ModelBlockDefinition(export_definition.BlockDefinition)
path_3 = FilePath(export_definition.FilePath)
exported = Boolean(export_definition.Exported)
path_4 = ClusterOutput(path_3)
exported_2 = ClusterOutput(exported)
block_definition_3 = ClusterOutput(block_definition_2)

# ==== cluster PreviewPort: Preview a port by showing the point and direction and if exists: id, family and compatible families.
po = ClusterInput()
sc = ClusterInput()
sc_2 = Number(sc)
po_2 = Port(po)
por = ModelPort(Port=po_2)  # -> Port, Valid, Id, Description, Mandatory, Family, CompatibleFamilies, Point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
swatch = ColourSwatch(SwatchColor=RGB(235, 52, 79))
swatch_2 = ColourSwatch(SwatchColor=RGB(250, 149, 0))
amp = Amplitude(Vector=por.Direction, Amplitude=sc_2)
lng = ListLength(List=por.CompatibleFamilies)
expression = Expression(x=por.Family, Expression="x=\"\"")
cull = CullPattern(List=por.Point, CullPattern=expression)
expression_2 = Expression(x=lng, Expression="x=0")
join = TextJoin(Text=por.CompatibleFamilies, Join=",")
merge = Merge(Data1=":")
trim = TrimTree(Tree=join, Depth=1)
trim_2 = TrimTree(Tree=expression_2, Depth=1)
item = ListItem(List=merge, Index=expression, Wrap=invert(True))
log = Logarithm(Value=sc_2)
concat = Concatenate(FragmentA="[", FragmentB=trim, FragmentC="]")
expression_3 = Expression(y=trim_2, Expression="x")
merge_2 = Merge(Data1=graft(concat), Data2=graft(expression_3))
item_2 = ListItem(List=merge_2, Index=graft(expression), Wrap=invert(True))
multiplication = Multiplication(A=log, B=Slider(2, range=0..10))
trim_3 = TrimTree(Tree=item_2, Depth=1)
concat_2 = Concatenate(FragmentA=por.Id, FragmentB=item, FragmentC=por.Family, FragmentD=trim_3)
preview = CustomPreview(Geometry=cull, Material=swatch)
tag = TextTag(Location=por.Point, Text=concat_2, Colour=swatch)
vdisex = VectorDisplayEx(Point=por.Point, Vector=amp, Colour=ColourSwatch(SwatchColor=RGB(0, 166, 157)), Width=multiplication)

# ==== cluster PreviewGeometry: Preview geometry by ungrouping everything, showing light surfaces and dark edges.
sc = ClusterInput()
geo = ClusterInput()
geo_2 = Geometry(flatten(geo))
sc_2 = Number(sc)
expression = Expression(x=sc_2, Expression="x+1")
swatch = ColourSwatch(SwatchColor=RGB(0, 0, 0))
swatch_2 = ColourSwatch(SwatchColor=RGB(255, 255, 255))
ungroup = Ungroup(Group=geo_2)
ungroup_2 = Ungroup(Group=ungroup)
ungroup_3 = Ungroup(Group=ungroup_2)
ungroup_4 = Ungroup(Group=ungroup_3)
log = Logarithm(Value=expression)
clean = CleanTree(RemoveNulls=True, RemoveInvalid=True, RemoveEmpty=invert(False), Tree=ungroup_4)  # -> flatten(Tree)
multiplication = Multiplication(A=log, B=Slider(0.05, range=0..1))
linetype = ModelLinetype(Name="semio", Width=multiplication)  # -> ModelLinetype, Name, Segments, CapStyle, JoinStyle, Width, WidthUnits, TaperWidths, TaperPositions
dispatch = CSharpScript(D=clean)  # -> P, C, B, M, R
# ---------- dispatch: C# ----------
// Grasshopper Script Instance
#region Usings
using System;
using System.Linq;
using System.Collections;
using System.Collections.Generic;
using System.Drawing;

using Rhino;
using Rhino.Geometry;

using Grasshopper;
using Grasshopper.Kernel;
using Grasshopper.Kernel.Data;
using Grasshopper.Kernel.Types;
#endregion

public class Script_Instance : GH_ScriptInstance
{
    #region Notes
    /* 
      Members:
        RhinoDoc RhinoDocument
        GH_Document GrasshopperDocument
        IGH_Component Component
        int Iteration

      Methods (Virtual & overridable):
        Print(string text)
        Print(string format, params object[] args)
        Reflect(object obj)
        Reflect(object obj, string method_name)
    */
    #endregion

    private void RunScript(
	object D,
	ref object P,
	ref object C,
	ref object B,
	ref object M,
	ref object R)
    {
        if (D is Curve) C = D; // Curve
        else if (
            D is Rhino.Geometry.Point ||
            D is PointCloud
            )
            P = D; // Point
        else if ( D is Mesh) M = D; // Mesh
        else if (
            D is Surface ||
            D is Extrusion ||
            D is SubD ||
            D is Brep
            )
            B = D; // Brep
        else R = D; // Rest
            
    }
}
# ---------- end dispatch ----------
clean_2 = CleanTree(RemoveNulls=True, RemoveInvalid=True, RemoveEmpty=False, Tree=dispatch.M)
clean_3 = CleanTree(RemoveNulls=True, RemoveInvalid=True, RemoveEmpty=False, Tree=dispatch.R)
clean_4 = CleanTree(RemoveNulls=True, RemoveInvalid=True, RemoveEmpty=False, Tree=dispatch.B)
clean_5 = CleanTree(RemoveNulls=True, RemoveInvalid=True, RemoveEmpty=False, Tree=dispatch.P)
clean_6 = CleanTree(RemoveNulls=True, RemoveInvalid=True, RemoveEmpty=False, Tree=dispatch.C)
debrep = DeconstructBrep(Brep=clean_4)  # -> Faces, Edges, Vertices
preview = CustomPreview(Geometry=flatten(clean_5), Material=swatch)
preview_2 = CustomPreview(Geometry=flatten(debrep.Faces), Material=swatch_2)
preview_3 = CustomPreview(Geometry=flatten(clean_2), Material=swatch_2)
preview_4 = CustomPreview(Geometry=flatten(clean_3), Material=swatch)
curve_preview = CustomCurvePreview(Curve=clean_6, Linetype=linetype.ModelLinetype, Colour=swatch)
curve_preview_2 = CustomCurvePreview(Curve=debrep.Edges, Linetype=linetype.ModelLinetype, Colour=swatch)

# ==== cluster OppinionatedType: Construct a type following the oppinionated conventions of semio. All representations are saved under representations folder where each representation is saved once natively (.3dm) and once exported (.glb). Further a collider representation is required. All names and file names are standardized.
emoji = Panel("")
name = Panel("Default")
abbreviation = Panel("Dft?")
nn = Panel("De")
prm = ModelParam(Na=name, NN=nn, Dc="The optional default representation geometry group.", Op=Toggle(True), Ru=Toggle(True))  # -> Param, Name, NickName, Description, Optional, Success; inputs Pr: tree, Op: Boolean, Ru: Boolean
# ---------- prm: Python ----------
#Component Information
#--------------------------------------------------------------------------------------------
if ghenv.Component.RunCount<2:
    #General
    #--------------------------------------------------------------------------------------------
    __author__ = "Ueli Saluz"
    __version__ = "2025.06.18"
    
    ghenv.Component.Name = "Model Param"
    ghenv.Component.NickName = "~Prm"
    ghenv.Component.Description = "Deconstruct or modify a param."
    ghenv.Component.Message = "VER 1.0"
    ghenv.Component.Category = "semio"
    ghenv.Component.SubCategory = "Scripting"
    
     #Inputs
    #--------------------------------------------------------------------------------------------
    inputIndex=0
    
    ghenv.Component.Params.Input[inputIndex].Name = "Param"
    ghenv.Component.Params.Input[inputIndex].NickName = "Pr"
    ghenv.Component.Params.Input[inputIndex].Description = "Connect the param to desconstruct or modify here with one wire."
    ghenv.Component.Params.Input[inputIndex].Optional = False
    inputIndex+=1

    ghenv.Component.Params.Input[inputIndex].Name = "Name"
    ghenv.Component.Params.Input[inputIndex].NickName = "Na"
    ghenv.Component.Params.Input[inputIndex].Description = "Name of the param."
    ghenv.Component.Params.Input[inputIndex].Optional = False
    inputIndex+=1
    
    ghenv.Component.Params.Input[inputIndex].Name = "NickName"
    ghenv.Component.Params.Input[inputIndex].NickName = "NN"
    ghenv.Component.Params.Input[inputIndex].Description = "Nickname of the param."
    ghenv.Component.Params.Input[inputIndex].Optional = False
    inputIndex+=1
    
    ghenv.Component.Params.Input[inputIndex].Name = "Description"
    ghenv.Component.Params.Input[inputIndex].NickName = "Dc"
    ghenv.Component.Params.Input[inputIndex].Description = "Description of the param."
    ghenv.Component.Params.Input[inputIndex].Optional = True
    inputIndex+=1
    
    ghenv.Component.Params.Input[inputIndex].Name = "Optional"
    ghenv.Component.Params.Input[inputIndex].NickName = "Op"
    ghenv.Component.Params.Input[inputIndex].Description = "Wheather the param is optional."
    ghenv.Component.Params.Input[inputIndex].Optional = True
    inputIndex+=1
    
    ghenv.Component.Params.Input[inputIndex].Name = "Run"
    ghenv.Component.Params.Input[inputIndex].NickName = "Ru"
    ghenv.Component.Params.Input[inputIndex].Description = "Modify the param."
    ghenv.Component.Params.Input[inputIndex].Optional = True
    inputIndex+=1
    
    #Outputs
    #--------------------------------------------------------------------------------------------
    outputIndex=0
    
    ghenv.Component.Params.Output[outputIndex].Name = "Param"
    ghenv.Component.Params.Output[outputIndex].NickName = "Param"
    ghenv.Component.Params.Output[outputIndex].Description = "The desconstruct or modified param"
    ghenv.Component.Params.Output[outputIndex].Optional = False
    outputIndex+=1
    
    ghenv.Component.Params.Output[outputIndex].Name = "Name"
    ghenv.Component.Params.Output[outputIndex].NickName = "Name"
    ghenv.Component.Params.Output[outputIndex].Description = "Name of the param."
    ghenv.Component.Params.Output[outputIndex].Optional = False
    outputIndex+=1
    
    ghenv.Component.Params.Output[outputIndex].Name = "NickName"
    ghenv.Component.Params.Output[outputIndex].NickName = "NickName"
    ghenv.Component.Params.Output[outputIndex].Description = "Nickname of the param."
    ghenv.Component.Params.Output[outputIndex].Optional = False
    outputIndex+=1
    
    ghenv.Component.Params.Output[outputIndex].Name = "Description"
    ghenv.Component.Params.Output[outputIndex].NickName = "Description"
    ghenv.Component.Params.Output[outputIndex].Description = "Description of the param."
    ghenv.Component.Params.Output[outputIndex].Optional = True
    outputIndex+=1
    
    ghenv.Component.Params.Output[outputIndex].Name = "Optional"
    ghenv.Component.Params.Output[outputIndex].NickName = "Optional"
    ghenv.Component.Params.Output[outputIndex].Description = "Wheather the param is optional."
    ghenv.Component.Params.Output[outputIndex].Optional = True
    outputIndex+=1
    
    ghenv.Component.Params.Output[outputIndex].Name = "Success"
    ghenv.Component.Params.Output[outputIndex].NickName = "Success"
    ghenv.Component.Params.Output[outputIndex].Description = "Wheather the operation was successful."
    ghenv.Component.Params.Output[outputIndex].Optional = False
    outputIndex+=1

input = ghenv.Component.Params.Input[0]
param = input.Sources[0]
if Ru:
    if Na:
        param.Name = Na
    if NN:
        param.NickName = NN
    if Dc:
        param.Description = Dc
    if Op:
        param.Optional = Op
    Success = True
else:
    Success = False
Param = param
Name = param.Name
NickName = param.NickName
Description = param.Description
Optional = param.Optional
# ---------- end prm ----------
concat = Concatenate(FragmentA="\"", FragmentB=prm.Description, FragmentC="\"")
merge = Merge(Data1=emoji, Data2=prm.NickName, Data3=abbreviation, Data4=prm.Name, Data5=concat)
join = TextJoin(Text=merge, Join=",")
de = ClusterInput()
paper = ClusterInput()
panel = Panel(join)
path = ClusterInput()
na = ClusterInput()
description = ClusterInput()
variant = ClusterInput()
rp = ClusterInput()
collider = ClusterInput()
volume = ClusterInput()
ex = ClusterInput()
group = ClusterInput()
po = ClusterInput()
authors = ClusterInput()
qualities = ClusterInput()
sep = Separator()  # -> S; same code as sep
path_2 = FilePath(path)
na_2 = Name(na)
description_2 = Description(description)
variant_2 = Variant(variant)
de_2 = Default(de)
rp_2 = Representation(rp)
volume_2 = Volume(volume)
group_2 = Group(group)
paper_2 = Paper(paper)
collider_2 = Collider(collider)
authors_2 = Authors(authors)
qualities_2 = Qualities(qualities)
po_2 = Port(po)
ex_2 = Export(ex)
merge_2 = Merge(Data1=de_2, Data2=paper_2, Data3=collider_2, Data4=volume_2)
rep = ModelRepresentation(Representation=rp_2)  # -> Representation, Valid, Url, Description, Tags, Qualities
rep_2 = ReplaceText(Text=variant_2, Find="/", Replace="slash", RecursiveReplace=False)
txt = NormalizeText(Text=na_2)  # -> Strict, Title, Underscore, Kebab, Pascal
split = SplitList(List=rep.Tags, Index="1")  # -> ListA, ListB
rep_3 = ReplaceText(Text=rep_2, Find="\", Replace="backslash", RecursiveReplace=False)
panel_2 = Panel(rp_2)
txt_2 = NormalizeText(Text=rep_3)  # -> Strict, Title, Underscore, Kebab, Pascal
join_2 = TextJoin(Text=split.ListB, Join="_")
panel_3 = Panel("""default
paper
collider
volume""")
concat_2 = Concatenate(FragmentA=txt.Kebab, FragmentD="_", FragmentB=txt_2.Kebab)
concat_3 = Concatenate(FragmentA="images", FragmentB=sep, FragmentC=concat_2, FragmentD=".png")
concat_4 = Concatenate(FragmentA="icons", FragmentB=sep, FragmentC=concat_2, FragmentD=".svg")
concat_5 = Concatenate(FragmentA=concat_2, FragmentB=".glb")
concat_6 = Concatenate(FragmentA=concat_2, FragmentD="_", FragmentB=join_2)
concat_7 = Concatenate(FragmentA="representations", FragmentB=sep, FragmentC=concat_2, FragmentD=".glb")
concat_8 = Concatenate(FragmentA="representations", FragmentB=sep, FragmentC=concat_2, FragmentD=".3dm")
concat_9 = Concatenate(FragmentA=concat_6, FragmentB=".glb")
concat_10 = Concatenate(FragmentA=concat_6, FragmentB=".3dm")
concat_11 = Concatenate(FragmentD=concat_2, FragmentC="_", FragmentA=panel_3, FragmentB=".3dm")
concat_12 = Concatenate(FragmentA=concat_2, FragmentC="_", FragmentB=panel_3, FragmentD=".glb")
concat_13 = Concatenate(FragmentA="representations", FragmentB=sep, FragmentC=concat_10)
concat_14 = Concatenate(FragmentA="representations", FragmentB=sep, FragmentC=concat_9)
concat_15 = Concatenate(FragmentA="representations", FragmentB=sep, FragmentC=concat_11)
concat_16 = Concatenate(FragmentA="representations", FragmentB=sep, FragmentC=concat_12)
panel_4 = Panel(concat_13)
rep_4 = ModelRepresentation(Url=concat_13, Tags=split.ListB)  # -> Representation, Valid, Url, Description, Tags, Qualities
rep_5 = ModelRepresentation(Url=graft(concat_16), Tags=graft(panel_3))  # -> Representation, Valid, Url, Description, Tags, Qualities
rep_6 = ModelRepresentation(Url=concat_14, Tags=split.ListB)  # -> Representation, Valid, Url, Description, Tags, Qualities
rep_7 = ModelRepresentation(Url=graft(concat_15), Tags=graft(panel_3))  # -> Representation, Valid, Url, Description, Tags, Qualities
rep_8 = ModelRepresentation(Url=concat_7)  # -> Representation, Valid, Url, Description, Tags, Qualities
rep_9 = ModelRepresentation(Url=concat_8)  # -> Representation, Valid, Url, Description, Tags, Qualities
trim = TrimTree(Tree=rep_4.Representation, Depth=1)
trim_2 = TrimTree(Tree=rep_6.Representation, Depth=1)
trim_3 = TrimTree(Tree=rep_7.Representation, Depth=1)
trim_4 = TrimTree(Tree=rep_5.Representation, Depth=1)
merge_3 = Merge(Data1=rep_8.Representation, Data2=rep_9.Representation, Data3=trim, Data4=trim_2, Data5=trim_4, Data6=trim_3)
concat_17 = Concatenate(FragmentA=path_2, FragmentB=sep, FragmentC=concat_16)
concat_18 = Concatenate(FragmentA=path_2, FragmentB=sep, FragmentC=concat_14)
concat_collider_glb = Concatenate(FragmentA=path_2, FragmentB=sep, FragmentC=concat_16)
cluster = Cluster(gr=merge_2)  # -> geo_2, txt_2
typ = ModelType(
    Name=txt.Title,
    Description=description_2,
    Icon=concat_4,
    Image=concat_3,
    Variant=variant_2,
    Representations=merge_3,
    Ports=po_2,
    Authors=authors_2,
    Qualities=qualities_2)  # -> Type, Valid, Name, Description, Icon, Image, Variant, Stock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
geo = ExportGeometry(F=concat_collider_glb, G=collider_2, R=ex_2)  # -> S; inputs G: tree of GeometryBase, R: Boolean
# ---------- geo: C# ----------
// Grasshopper Script Instance
#region Usings
using System;
using System.Linq;
using System.Collections;
using System.Collections.Generic;
using System.Drawing;
using System.IO;

using Rhino;
using Rhino.Geometry;

using Grasshopper;
using Grasshopper.Kernel;
using Grasshopper.Kernel.Data;
using Grasshopper.Kernel.Types;
#endregion

public class Script_Instance : GH_ScriptInstance
{
    #region Notes
    /* 
      Members:
        RhinoDoc RhinoDocument
        GH_Document GrasshopperDocument
        IGH_Component Component
        int Iteration

      Methods (Virtual & overridable):
        Print(string text)
        Print(string format, params object[] args)
        Reflect(object obj)
        Reflect(object obj, string method_name)
    */
    #endregion

    private void RunScript(object F, DataTree<GeometryBase> G, bool R, ref object S)
    {
        // inspired from https://github.com/jhorikawa/GrasshopperProgrammingTutorials/blob/master/0015%20Export%20Geometry%20with%20Grasshopper%20C%23/Export%20Geometry%20with%20Grasshopper%20C%23.gh
        if(R){
            var guids = new List<Guid>();

            for(int i = 0; i < G.BranchCount; i++){
                for(int n = 0; n < G.Branches[i].Count; n++){
                var geom = G.Branches[i][n];
                var guid = Rhino.RhinoDoc.ActiveDoc.Objects.Add(geom);
                guids.Add(guid);
                }
            }

            Rhino.RhinoDoc.ActiveDoc.Objects.Select(guids);

            string cmd = "_-Export " + "\"" + F + "\"" + " _Enter _Enter";

            Rhino.RhinoApp.RunScript(cmd, false);

            Rhino.RhinoDoc.ActiveDoc.Objects.Delete(guids, true);
            S = true;
        }
    }
}
# ---------- end geo ----------
concat_3dm = Concatenate(FragmentA=path_2, FragmentB=sep, FragmentC=concat_13)
geo_2 = ExportGeometry(F=concat_18, G=collider_2, R=ex_2)  # -> S; inputs G: tree of GeometryBase, R: Boolean; same code as geo
geo_3 = ExportGeometry(F=concat_17, G=cluster.geo_2, R=ex_2)  # -> S; inputs G: tree of GeometryBase, R: Boolean; same code as geo
geo_4 = ExportGeometry()  # -> S; inputs G: tree of GeometryBase, R: Boolean; same code as geo
ty = Type(typ.Type)
ba = Text(concat_2)
ty_2 = ClusterOutput(ty)
ba_2 = ClusterOutput(ba)
blc = ExportBlock_3(export=ex_2, ob=group_2)  # -> block_definition_3, path_4, exported_2
blc_2 = ExportBlock_2(path=path_2, gr=group_2, ty=typ.Type, rp=rp_2, export=ex_2)  # -> block_definition_3, path_4, exported_2
blc_3 = ExportBlock_2(path=path_2, export=ex_2)  # -> block_definition_3, path_4, exported_2
geo_5 = ExportGeometry(F=concat_3dm, G=group_2, R=ex_2)  # -> S; inputs G: tree of GeometryBase, R: Boolean; same code as geo

# ==== cluster SortSurfaces
B = ClusterInput()
debrep = DeconstructBrep(Brep=B)  # -> flatten(Faces), Edges, Vertices
facen = FaceNormals(Mesh=debrep.Faces)  # -> simplify(Centers), simplify(Normals)
item = ListItem(List=facen.Normals, Index=0, Wrap=True)  # -> flatten(Item)
devec = DeconstructVector(Vector=item)  # -> XComponent, YComponent, ZComponent
smaller = SmallerThan(FirstNumber=devec.ZComponent, SecondNumber="0.01")  # -> SmallerThan, OrEqualTo
smaller_2 = SmallerThan(FirstNumber=devec.ZComponent, SecondNumber="-0.01")  # -> SmallerThan, OrEqualTo
larger = LargerThan(FirstNumber=devec.ZComponent, SecondNumber="0.01")  # -> LargerThan, OrEqualTo
larger_2 = LargerThan(FirstNumber=devec.ZComponent, SecondNumber="-0.01")  # -> LargerThan, OrEqualTo
and = GateAnd(A=smaller.SmallerThan, B=smaller_2.SmallerThan)
and_2 = GateAnd(A=smaller.SmallerThan, B=larger_2.LargerThan)
cull = CullPattern(List=debrep.Faces, CullPattern=and)
cull_2 = CullPattern(List=debrep.Faces, CullPattern=larger.LargerThan)
cull_3 = CullPattern(List=debrep.Faces, CullPattern=and_2)
base = Surface(cull)
base_2 = ClusterOutput(base)
roof = Surface(cull_2)
roof_2 = ClusterOutput(roof)
walls = Surface(cull_3)
walls_2 = ClusterOutput(walls)

# ==== cluster ExportBlock_2: Export geometry with layer names to a file.
gr = ClusterInput()
ty = ClusterInput()
export = ClusterInput()
rp = ClusterInput()
path = ClusterInput()
path_2 = FilePath(path)
ty_2 = Type(ty)
rp_2 = Representation(rp)
export_2 = Boolean(export)
cluster = Cluster(gr=gr)  # -> geo_2, txt_2
layer = ModelLayer(Name=cluster.txt_2)  # -> Layer, Name, Hidden, Locked, DisplayColour, Material, Linetype
object = ModelObject(Geometry=cluster.geo_2, Layer=layer.Layer)  # -> Object, Geometry, Name, Layer, Visibility, Display, Drafting, Render
typ = ModelType(Type=ty_2)  # -> Type, Valid, Name, Description, Icon, Image, Variant, Stock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
rep = ModelRepresentation(Representation=rp_2)  # -> Representation, Valid, Url, Description, Tags, Qualities
trim = TrimTree(Tree=object.Object, Depth="5")
concat = Concatenate(FragmentA=typ.Type, FragmentC=":", FragmentB=rep.Representation)
block_definition = ModelBlockDefinition(Objects=trim, Name=concat, Notes=typ.Description)  # -> BlockDefinition, Objects, Units, Name, Notes, URL, URLDescription
export_definition = ExportModelBlockDefinition(BlockDefinition=block_definition.BlockDefinition, FilePath=path_2, Overwrite="T", Export=export_2)  # -> BlockDefinition, FilePath, Exported
block_definition_2 = ModelBlockDefinition(export_definition.BlockDefinition)
path_3 = FilePath(export_definition.FilePath)
exported = Boolean(export_definition.Exported)

# ---- group: Export single files. WIP
sep = Separator()  # -> S
# ---------- sep: C# ----------
#region Usings
using System;
using System.Linq;
using System.Collections;
using System.Collections.Generic;
using System.Drawing;
using System.IO;

using Rhino;
using Rhino.Geometry;

using Grasshopper;
using Grasshopper.Kernel;
using Grasshopper.Kernel.Data;
using Grasshopper.Kernel.Types;
#endregion

public class Script_Instance : GH_ScriptInstance
{
    private void RunScript(ref object S)
    {
        S = Path.DirectorySeparatorChar;
    }
}
# ---------- end sep ----------
rep_2 = ReplaceText(Text=rep.Url, Find="/", Replace=sep, RecursiveReplace=False)
item = ListItem(List=rep.Tags, Index=0, Wrap=True)
concat_2 = Concatenate(FragmentA=path_2, FragmentB=sep, FragmentC=rep_2)
mime = Mime({".glb": "model/gltf-binary", ".gltf": "model/gltf+json", ".stl": "model/stl", ".obj": "model/obj", ".blend": "model/x-blender", ".3dm": "model/vnd.3dm", ".ifc": "model/x-ifc", ".dwg": "model/acad", ".dxf": "model/dxf", ".rvt": "model/vnd.revit"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}, selected=".3dm")
trim_2 = TrimTree(Tree=item, Depth=1)
expression = Expression(x=trim_2, y=mime, Expression="x=y")
# WIP
dispatch = Dispatch(List=concat_2, DispatchPattern=expression)  # -> ListA, ListB
dispatch_2 = Dispatch(List=concat_2, DispatchPattern=expression)  # -> ListA, ListB

# ----
exported_2 = ClusterOutput(exported)
path_4 = ClusterOutput(path_3)
block_definition_3 = ClusterOutput(block_definition_2)

# ==== cluster ExportBlock_3: Export geometry with layer names to a file.
ob = ClusterInput()
G = ClusterInput()
dc = ClusterInput()
path = ClusterInput()
name = ClusterInput()
url = ClusterInput()
layer_n = ClusterInput()
export = ClusterInput()
ob_2 = ModelObject(ob)
group = Group(Geometry=G)
path_2 = FilePath(path)
name_2 = Text(name)
url_2 = Text(url)
export_2 = Boolean(export)
layer_n_2 = Name(layer_n)
dc_2 = DisplayColour(dc)
object = ModelObject(Object=group)  # -> Object, Geometry, Name, Layer, Visibility, Display, Drafting, Render
layer = ModelLayer(Name=layer_n_2, DisplayColour=dc_2)  # -> Layer, Name, Hidden, Locked, DisplayColour, Material, Linetype, PrintColour, PrintWidth
object_2 = ModelObject(group)
group_2 = NamedGroup(Geometry=group)  # -> Group, Geometry, Name
object_3 = ModelObject(Geometry=object_2, Layer=layer.Layer)  # -> Object, Geometry, Name, Layer, Visibility, Display, Drafting, Render
object_4 = ModelObject(Object=object_2)  # -> Object, Geometry, Name, Layer, Visibility, Display, Drafting, Render
block_definition = ModelBlockDefinition(Objects=object_3.Object, Name=name_2, URL=url_2)  # -> BlockDefinition, Objects, Units, Name, Notes, URL, URLDescription
panel = Panel(object_4.Layer)
export_definition = ExportModelBlockDefinition(BlockDefinition=block_definition.BlockDefinition, FilePath=path_2, Overwrite="T", Export=export_2)  # -> BlockDefinition, FilePath, Exported
block_definition_2 = ModelBlockDefinition(export_definition.BlockDefinition)
path_3 = FilePath(export_definition.FilePath)
exported = Boolean(export_definition.Exported)
path_4 = ClusterOutput(path_3)
exported_2 = ClusterOutput(exported)
block_definition_3 = ClusterOutput(block_definition_2)

# ==== cluster Cluster
gr = ClusterInput()
gr_2 = Group(gr)
group = NamedGroup(Group=gr_2)  # -> Group, Geometry, Name
group_2 = NamedGroup(Group=group.Geometry)  # -> Group, Geometry, Name
expression = Expression(x=graft(group.Name), y=group_2.Name, Expression="x")
group_3 = NamedGroup(Group=group_2.Geometry)  # -> Group, Geometry, Name
expression_2 = Expression(x=graft(expression), y=group_3.Name, Expression="x")
expression_3 = Expression(x=graft(group_2.Name), y=group_3.Name, Expression="x")
group_4 = NamedGroup(Group=group_3.Geometry)  # -> Group, Geometry, Name
expression_4 = Expression(x=graft(expression_2), y=group_4.Name, Expression="x")
expression_5 = Expression(x=graft(expression_3), y=group_4.Name, Expression="x")
expression_6 = Expression(x=graft(group_3.Name), y=group_4.Name, Expression="x")
group_5 = NamedGroup(Group=group_4.Geometry)  # -> Group, Geometry, Name
expression_7 = Expression(x=graft(expression_4), y=group_5.Name, Expression="x")
expression_8 = Expression(x=graft(expression_5), y=group_5.Name, Expression="x")
expression_9 = Expression(x=graft(expression_6), y=group_5.Name, Expression="x")
expression_10 = Expression(x=graft(group_4.Name), y=group_5.Name, Expression="x")
group_6 = NamedGroup(Group=group_5.Geometry)  # -> Group, Geometry, Name
expression_11 = Expression(x=graft(expression_7), y=group_6.Name, Expression="x")
expression_12 = Expression(x=graft(expression_9), y=group_6.Name, Expression="x")
expression_13 = Expression(x=graft(expression_8), y=group_6.Name, Expression="x")
expression_14 = Expression(x=graft(expression_10), y=group_6.Name, Expression="x")
expression_15 = Expression(x=graft(group_5.Name), y=group_6.Name, Expression="x")
merge = Merge(
    Data1=expression_11,
    Data2=expression_13,
    Data3=expression_12,
    Data4=expression_14,
    Data5=expression_15,
    Data6=group_6.Name)
join = TextJoin(Text=merge, Join="::")
geo = Geometry(group_6.Geometry)
txt = Text(join)
geo_2 = ClusterOutput(geo)
txt_2 = ClusterOutput(txt)
