# Grasshopper definition trapezoid-capsule.gh (Grasshopper 1.0.8)
# Copyright: GNU Lesser General Public License Version 3
# Copyright: GNU Lesser General Public License v3.0 or later
# plug-ins: RhinoCodePluginGH, semio

save_representation = BooleanToggle(False)
variant = Slider(0, range=0..7)
icon_export = BooleanToggle(False)
validate = BooleanToggle(False)
save = BooleanToggle(False)
panel = Panel("""\
/
q
p
J
L
s
z""")
dir = Directory()  # -> D
# ---------- dir: C# ----------
#region Usings
using System;
using System.Linq;
using System.Collections;
using System.Collections.Generic;
using System.Drawing;
using System.IO;

using Rhino;
using Rhino.Geometry;

using Grasshopper;
using Grasshopper.Kernel;
using Grasshopper.Kernel.Data;
using Grasshopper.Kernel.Types;
#endregion

public class Script_Instance : GH_ScriptInstance
{
    private void RunScript(ref object D)
    {
        D = Path.GetDirectoryName(this.GrasshopperDocument.FilePath);
    }
}
# ---------- end dir ----------
sep = Separator()  # -> S; same code as sep
and = GateAnd(A=save, B=save_representation)
and_2 = GateAnd(A=save, B=icon_export)
loop_slider = PythonScript(SliderToModify=variant, Min="0", Max="7", stepSize="1", Delay=Slider(0, range=0..1), Run=Toggle(False), Reset=Button())  # inputs Run: Boolean, Reset: Boolean
# ---------- loop_slider: Python ----------
import time

def updateSliderInput(inputName,min,max,value,decimalPlace=2):
    for input in ghenv.Component.Params.Input:
        for source in input.Sources:
            if input.Name == str(inputName):
                source.Slider.DecimalPlaces = decimalPlace
                source.Slider.Minimum = min
                source.Slider.Maximum = max
                source.Slider.Value = value
                source.ExpireSolution(True)

def countDecimal(number):
    string= str(number)
    return string[::-1].find('.')

if Run == True:
    if SliderToModify < Max:
        time.sleep(Delay)
        updateSliderInput("SliderToModify",Min,Max,SliderToModify+stepSize,countDecimal(stepSize))
if Reset == True:
    updateSliderInput("SliderToModify",Min,Max,Min)
# ---------- end loop_slider ----------
# ^                                    ^
#    |                                     |
# <-- Constants    Preview -->
# Parameters    External    Local -->
# <-- Meta               |
#      |                       v
#      v
par = ParentDirectory(D=dir)  # -> P; inputs D: String
# ---------- par: C# ----------
#region Usings
using System;
using System.Linq;
using System.Collections;
using System.Collections.Generic;
using System.Drawing;
using System.IO;

using Rhino;
using Rhino.Geometry;

using Grasshopper;
using Grasshopper.Kernel;
using Grasshopper.Kernel.Data;
using Grasshopper.Kernel.Types;
#endregion

public class Script_Instance : GH_ScriptInstance
{
    private void RunScript(string D, ref object P)
    {
        P = new DirectoryInfo(D).Parent;
    }
}
# ---------- end par ----------
item = ListItem(List=panel, Index=variant, Wrap=True)
panel_2 = Panel(item)
number_slider = Slider(3.25, range=0..10)  # disabled
number_slider_2 = Slider(7, range=0..10)  # disabled
variant_2 = GetString(item, AtLeast=0, AtMost=1, TreeAccess=False)
expression = Expression(x=number_slider, Expression="x/4")  # disabled
itemindex = ItemIndex(L=panel, I=variant_2)  # -> i; inputs L: list
# ---------- itemindex: Python ----------
#Component Information
#--------------------------------------------------------------------------------------------
if ghenv.Component.RunCount<2:
    #General
    #--------------------------------------------------------------------------------------------
    __author__ = "Ueli Saluz"
    __version__ = "2022.11.18"
    
    ghenv.Component.Name = "ItemIndex"
    ghenv.Component.NickName = "ItemIndex"
    ghenv.Component.Description = "A better IdemIndex"
    ghenv.Component.Message = "VER 1.0"
    ghenv.Component.Category = "Set"
    ghenv.Component.SubCategory = "List"
    
     #Inputs
    #--------------------------------------------------------------------------------------------
    inputIndex=0
    
    ghenv.Component.Params.Input[inputIndex].Name = "List"
    ghenv.Component.Params.Input[inputIndex].NickName = "L"
    ghenv.Component.Params.Input[inputIndex].Description = "Input1 is..."
    ghenv.Component.Params.Input[inputIndex].Optional = False
    inputIndex+=1
    
    ghenv.Component.Params.Input[inputIndex].Name = "Item"
    ghenv.Component.Params.Input[inputIndex].NickName = "I"
    ghenv.Component.Params.Input[inputIndex].Description = "Input2 is..."
    ghenv.Component.Params.Input[inputIndex].Optional = False
    inputIndex+=1
    
    #Outputs
    #--------------------------------------------------------------------------------------------
    outputIndex=0
    
    ghenv.Component.Params.Output[outputIndex].Name = "Index"
    ghenv.Component.Params.Output[outputIndex].NickName = "i"
    ghenv.Component.Params.Output[outputIndex].Description = "Output1 is..."
    outputIndex+=1

i = L.index(I)
# ---------- end itemindex ----------
panel_3 = Panel("""backslash
slash
q
p
J
L
s
z""")
series = Series(Start=number_slider, Step=expression, Count=number_slider_2)  # disabled
zoom = Button()
crv = Curve(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)  # disabled
crv_2 = Curve(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)  # disabled
trim = TrimTree(Tree=series, Depth=1)  # disabled
crv_3 = Curve(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)  # disabled
crv_4 = Curve(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)  # disabled
item_2 = ListItem(List=panel_3, Index=itemindex, Wrap=True)
len = Length(Curve=crv_2)  # disabled
len_2 = Length(Curve=crv)  # disabled
len_3 = Length(Curve=crv_4)  # disabled
len_4 = Length(Curve=crv_3)  # disabled
cir = Circle(Plane=PlaneXY(0, 0, 0), Radius=trim)  # disabled
panel_4 = Panel("8")  # disabled
merge = Merge(Data1="front", Data2="front", Data3="side", Data4="side", Data5="front", Data6="front", Data7="side", Data8="side")
merge_2 = Merge(Data1="F", Data2="T", Data3="F", Data4="T", Data5="F", Data6="T", Data7="F", Data8="T")
panel_5 = Panel("16")  # disabled
merge_3 = Merge(Data1="back", Data2="back", Data3="back", Data4="back", Data5="side", Data6="side", Data7="side", Data8="side")
division = Division(A=len_3, B=len)  # disabled
divide = DivideCurve(Curve=cir, Count=panel_4, Kinks=False)  # -> Points, Tangents, Parameters; disabled
divide_2 = DivideCurve(Curve=cir, Count=panel_5, Kinks=False)  # -> Points, Tangents, Parameters; disabled
list = ValueList({"Back": "back", "Side": "side"}, selected="Back")
item_3 = ListItem(List=merge_3, Index=itemindex, Wrap=True)
toggle = BooleanToggle(False)
item_4 = ListItem(List=merge_2, Index=itemindex, Wrap=True)
list_2 = ValueList({"Front", "Side"}, selected="Front")
item_5 = ListItem(List=merge, Index=itemindex, Wrap=True)
expression_2 = Expression(x=Slider(210, range=0..1000), Expression="x/100")
panel_6 = Panel(division)  # disabled
expression_3 = Expression(x=Slider(250, range=0..1000), Expression="x/100")
shatter = Shatter(Curve=graft(cir), Parameters=divide.Parameters)  # disabled
shatter_2 = Shatter(Curve=graft(cir), Parameters=divide_2.Parameters)  # disabled
entrance = Text(item_3)
view = Text(item_5)
mirror = Boolean(item_4)
trim_2 = TrimTree(Tree=shatter, Depth=1)  # disabled
# 2023-2025 Ueli Saluz
# 2025 Elduane Lumpine
# 2025 Christian Hödtke
# Permission is hereby granted, free of charge, to any person obtaining a copy
# of this Grasshopper file and associated documentation files (the "Document"),
# to deal in the Document without restriction, including without limitation the
# rights to use, copy, modify, merge, publish, distribute, sublicense, and/or sell
# copies of the Document, and to permit persons to whom the Document is
# furnished to do so.
# 
# Individual clusters used inside this document might be licensed under
# different terms. This is indicated through a similar copyright notice group
# inside the cluster and otherwise in the license field of the cluster. If you
# have any question please reach out to us: license@semio-tech.com
# 
# THE DOCUMENT IS PROVIDED "AS IS", WITHOUT WARRANTY OF ANY
# KIND, EXPRESS OR IMPLIED, INCLUDING BUT NOT LIMITED TO THE
# WARRANTIES OF MERCHANTABILITY, FITNESS FOR A PARTICULAR
# PURPOSE AND NONINFRINGEMENT. IN NO EVENT SHALL THE
# AUTHORS OR COPYRIGHT HOLDERS BE LIABLE FOR ANY CLAIM,
# DAMAGES OR OTHER LIABILITY, WHETHER IN AN ACTION OF
# CONTRACT, TORT OR OTHERWISE, ARISING FROM, OUT OF OR IN
# CONNECTION WITH THE DOCUMENT OR THE USE OR OTHER
# DEALINGS IN THE DOCUMENT.
trim_3 = TrimTree(Tree=shatter_2, Depth=1)  # disabled
entrance_width = Number(expression_2)
height_m = Number(expression_3)

expression_4 = Expression(x=entrance_width, Expression="x/2")
neg = Negative(Value=expression_4)
X = UnitX(Factor=neg)
X_2 = UnitX(Factor=expression_4)
ln = Line(StartPoint=X, EndPoint=X_2)
multiplication = Multiplication(A=entrance_width, B="0.099456")
midpt = CurveMiddle(Curve=ln)
Y = UnitY(Factor=multiplication)
move = Move(Geometry=midpt, Motion=Y)  # -> Geometry, Transform
arc = Arc3Pt(PointA=X, PointB=move.Geometry, PointC=X_2)  # -> Arc, Plane, Radius
expression_5 = Expression(x=arc.Radius, Expression="x+2*x*0.75")
expression_6 = Expression(x=arc.Radius, Expression="x+x*0.75")
darc = DeconstructArc(Arc=arc.Arc)  # -> BasePlane, Radius, Angle
arc_2 = Arc(Plane=darc.BasePlane, Radius=expression_6, Angle=darc.Angle)  # -> Arc, Length
arc_3 = Arc(Plane=darc.BasePlane, Radius=expression_5, Angle=darc.Angle)  # -> Arc, Length
end = EndPoints(Curve=arc.Arc)  # -> Start, End
end_2 = EndPoints(Curve=arc_2.Arc)  # -> Start, End
end_3 = EndPoints(Curve=arc_3.Arc)  # -> Start, End
merge_4 = Merge(Data1=end.Start, Data2=end_2.Start, Data3=end_3.End, Data4=end_2.End, Data5=end.End)
merge_5 = Merge(Data1=end.Start, Data2=end_2.Start, Data3=end_3.Start, Data4=end_3.End, Data5=end_2.End, Data6=end.End)
merge_6 = Merge(Data1=end.Start, Data2=end_2.Start, Data3=end_3.Start, Data4=end_2.End, Data5=end.End)
pline = PolyLine(Vertices=merge_4, Closed=invert(False))
pline_2 = PolyLine(Vertices=merge_6, Closed=invert(False))
pline_3 = PolyLine(Vertices=merge_5, Closed=invert(False))

expression_7 = Expression(x=Slider(20, range=0..100), Expression="x/100")

filter = StreamFilter(Gate=mirror, Stream1=" It is mirrored compared to the normal one.")
concat = Concatenate(
    FragmentA="An apartment capsule of the variant ",
    FragmentG=variant_2,
    FragmentH=" with a balcony for one person. It has the entrance on the",
    FragmentB=entrance,
    FragmentC=" and has the view to the ",
    FragmentD=view,
    FragmentF=".",
    FragmentE=filter)

shellthickness_m = Number(expression_7)
fillet_radius_m = Number(shellthickness_m)

aut = ModelAuthor(Name="Ueli Saluz", Email="ueli@semio-tech.org")  # -> Author, Valid, Name, Email, Attributes

panel_7 = Panel("Parallel")  # disabled
m2d_rhino = Make2DRhinoView(Name=panel_7, Clip=True)  # disabled
number_slider_3 = Slider(876, range=0..1000)  # disabled
expression_8 = Expression(x=Slider(10, range=3..10), Expression="x/100")

concat_2 = Concatenate(FragmentA="icons/", FragmentC=".svg")

concat_3 = Concatenate(FragmentA="images/", FragmentC=".png")

view_rectangle = ViewRectangle(view=m2d_rhino)  # disabled
window_frame_m = Number(expression_8)
previewplane = PreviewPlane(plane=view_rectangle, axis_length=number_slider_3)  # disabled

filter_2 = StreamFilter(
    Gate=itemindex,
    Stream0=pline,
    Stream1=pline_2,
    Stream2=pline,
    Stream3=pline_2,
    Stream4=pline_2,
    Stream5=pline,
    Stream6=pline_2,
    Stream7=pline)
Z = UnitZ(Factor=height_m)
shell = Curve(filter_2)
extr = Extrude(Base=shell, Direction=Z)
cap = CapHoles(Brep=extr)
shell_1to500 = Geometry(cap)
debrep = DeconstructBrep(Brep=shell_1to500)  # -> Faces, Edges, Vertices
trim_4 = TrimTree(Tree=debrep.Edges, Depth=1)
lng = ListLength(List=trim_4)
series_2 = Series(Start=0, Step=1, Count=lng)
trim_5 = TrimTree(Tree=series_2, Depth=1)
filedge = FilletEdge(Shape=shell_1to500, Blend=0, Metric=0, Edges=trim_5, Radii=fillet_radius_m)
shell_1to200 = Geometry(filedge)

ln_2 = Line(StartPoint=end_2.Start, EndPoint=end_3.End)
ln_3 = Line(StartPoint=end_2.End, EndPoint=end_3.Start)
ln_4 = Line(StartPoint=end_2.Start, EndPoint=end_3.Start)
ln_5 = Line(StartPoint=end_2.End, EndPoint=end_3.End)
llx = LineLine(Line1=ln_2, Line2=ln_3)  # -> ParamA, ParamB, PointA, PointB
crv_cp = CurveClosestPoint(Point=end.End, Curve=ln_2)  # -> Point, Parameter, Distance
shatter_3 = Shatter(Curve=ln_2, Parameters=llx.ParamA)
shatter_4 = Shatter(Curve=ln_3, Parameters=llx.ParamB)
trim_6 = TrimTree(Tree=shatter_3, Depth=1)
trim_7 = TrimTree(Tree=shatter_4, Depth=1)
item_6 = ListItem(List=trim_6, Index=0, Wrap=True)  # -> Item, Item1
item_7 = ListItem(List=trim_7, Index=0, Wrap=True)  # -> Item, Item1
flip = FlipCurve(Curve=item_7.Item)  # -> Curve, Flag
flip_2 = FlipCurve(Curve=item_7.Item1)  # -> Curve, Flag
flip_3 = FlipCurve(Curve=item_6.Item)  # -> Curve, Flag
filter_3 = StreamFilter(
    Gate=itemindex,
    Stream0=item_6.Item1,
    Stream1=item_7.Item1,
    Stream2=flip_3.Curve,
    Stream3=flip.Curve,
    Stream4=ln_4,
    Stream5=ln_5,
    Stream6=item_7.Item1,
    Stream7=item_6.Item1)
neg_2 = Negative(Value=window_frame_m)
window = Curve(filter_3)
subcrv = SubCurve(BaseCurve=reparameterize(window), Domain="0.8")
move_2 = Move(Geometry=subcrv, Motion=Z)  # -> Geometry, Transform
rulesrf = RuledSurface(CurveA=move_2.Geometry, CurveB=subcrv)
neg_3 = Negative(Value=shellthickness_m)
offset = OffsetCurve(Curve=rulesrf, Distance=neg_3, Corners=1)
trim_8 = TrimTree(Tree=offset, Depth=1)
window_1to500 = Surface(trim_8)
offset_2 = OffsetCurve(Curve=window_1to500, Distance=neg_2, Corners=1)
trim_9 = TrimTree(Tree=offset_2, Depth=1)
simplify = SimplifyCurve(Curve=trim_9)  # -> Curve, Simplified
merge_7 = Merge(Data1=window_1to500, Data2=simplify.Curve)
loft = Loft(Curves=merge_7, Options={Adjust=False, Closed=False, LoftEnds=0, LoftSimp=0, LoftType=0, Rebuild=10, Refit=0.01})
item_8 = ListItem(List=simplify.Curve, Index=0, Wrap=True)  # -> Item, Item1
window_frame_1to200 = Brep(loft)
window_1to200 = Surface(item_8.Item1)

panel_8 = Panel(crv_cp.Distance)
expression_9 = Expression(x=Slider(80, range=0..100), Expression="x/100")
expression_10 = Expression(x=Slider(200, range=0..1000), Expression="x/100")
door_width_m = Number(expression_9)
door_height_m = Number(expression_10)
door_angle = Number(Slider(-8.5, range=-10..10))
door_t = Number(Slider(0.3, range=0..1))
flip_4 = FlipCurve(Curve=item_6.Item1)  # -> Curve, Flag

jagged = SettingsSpeed()
mesh = MeshBrep(Brep=shell_1to500, Settings=jagged)
collider = Mesh(mesh)

construction_area_factor = Number(Slider(0.2, range=0..1))
construction_cost_eff_m² = Number(Slider(9500, range=0..20000))
income_month_eff_m² = Number(Slider(125, range=0..200))
maintenance_expenses_month_eff_m² = Number(Slider(10, range=0..30))

expression_11 = Expression(x=door_t, Expression="1-x")
eval = EvaluateLength(Curve=ln, Length=door_t, Normalized=True)  # -> Point, Tangent, Parameter
eval_2 = EvaluateLength(Curve=ln, Length=expression_11, Normalized=True)  # -> Point, Tangent, Parameter
filter_4 = StreamFilter(
    Gate=itemindex,
    Stream0=eval_2.Point,
    Stream1=eval.Point,
    Stream2=eval_2.Point,
    Stream3=eval.Point,
    Stream4=eval_2.Point,
    Stream5=eval.Point,
    Stream6=eval_2.Point,
    Stream7=eval.Point)
Z_2 = UnitZ(Factor=1)
pl = ConstructPlane(Origin=filter_4, XAxis=Vector(1, 0, 0), YAxis=Z_2)
_2d = _2D(x=door_width_m)
rectangle = Rectangle(Plane=pl, XSize=_2d, YSize=door_height_m, Radius=0)  # -> Rectangle, Length
Z_3 = UnitZ(Factor=shellthickness_m)
move_3 = Move(Geometry=rectangle.Rectangle, Motion=Z_3)  # -> Geometry, Transform
door = Surface(move_3.Geometry)

neg_4 = Negative(Value=door_angle)
panel_9 = Panel("""east
west""")
panel_10 = Panel("""east
west""")
filter_5 = StreamFilter(
    Gate=itemindex,
    Stream0=door_angle,
    Stream1=neg_4,
    Stream2=door_angle,
    Stream3=neg_4,
    Stream4=door_angle,
    Stream5=neg_4,
    Stream6=door_angle,
    Stream7=neg_4)
item_9 = ListItem(List=panel_9, Index=0, Wrap=True)
item_10 = ListItem(List=panel_10, Index=0, Wrap=True)
panel_11 = Panel("The middle of the main entrance door of the upper entrance floor.")
Y_2 = UnitY(Factor=1)
rev = Reverse(Vector=Y_2)
Z_4 = UnitZ(Factor=1)
concat_4 = Concatenate(FragmentA="door capsule", FragmentC=" ", FragmentB=item_9)
concat_5 = Concatenate(FragmentA="door tambour", FragmentC=" ", FragmentB=item_10)
vrot = Rotate(Vector=rev, Axis=Z_4, Angle=degrees(filter_5))
por = ModelPort(
    Validate=validate,
    Description=panel_11,
    Family=concat_4,
    CompatibleFamilies=concat_5,
    Point=filter_4,
    Direction=vrot,
    Qualities="entrance")  # -> Port, Valid, Id, Description, Mandatory, Family, CompatibleFamilies, Point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

prv = PreviewPort(po=por.Port)
heating_energy_demand_kwh_m²a = Number(Slider(45, range=0..200))
cooling_energy_demand_kwh_m²a = Number(Slider(30, range=0..200))
technical_equipment_energy_demand_kwh_m² = Number(Slider(30, range=0..200))  # "Technical Equipment Energy Demand[kWh/m²a]"
construction_global_warming_potential_kg = Number(Slider(1000, range=0..2000))  # "Construction Global Warming Potential [kgCO2e/eff. m²]"

# ----
# https://search.bsdd.buildingsmart.org/uri/buildingsmart/ifc/4.3/prop/Height
# https://identifier.buildingsmart.org/uri/buildingsmart/ifc/4.3/prop/NetFloorArea
# 
# https://identifier.buildingsmart.org/uri/buildingsmart/ifc/4.3/prop/EnergyConsumption
# https://identifier.buildingsmart.org/uri/buildingsmart/ifc/4.3/prop/EnergyConsumption
# https://identifier.buildingsmart.org/uri/buildingsmart/ifc/4.3/prop/EnergyConsumption
# 
# 
# https://identifier.buildingsmart.org/uri/etim/etim/9.0/prop/EF016979
maintenance_expenses_month_eff_m²_2 = Number(maintenance_expenses_month_eff_m²)
# Outputs   ->
#                 |
#                 v
construction_global_warming_potential_kg_2 = Number(construction_global_warming_potential_kg)  # "Construction Global Warming Potential [kgCO2e/eff. m²]"
construction_area_factor_2 = Number(construction_area_factor)
technical_equipment_energy_demand_kwh_m²_2 = Number(technical_equipment_energy_demand_kwh_m²)  # "Technical Equipment Energy Demand[kWh/m²a]"
income_month_eff_m²_2 = Number(income_month_eff_m²)
heating_energy_demand_kwh_m²a_2 = Number(heating_energy_demand_kwh_m²a)
cooling_energy_demand_kwh_m²a_2 = Number(cooling_energy_demand_kwh_m²a)
construction_cost_eff_m²_2 = Number(construction_cost_eff_m²)
expression_12 = Expression(x=construction_area_factor_2, Expression="1-x")
area = Area(Geometry=shell)  # -> Area, Centroid
multiplication_2 = Multiplication(A=area.Area, B=expression_12)
multiplication_3 = Multiplication(A=multiplication_2, B=income_month_eff_m²_2)
multiplication_4 = Multiplication(A=multiplication_2, B=maintenance_expenses_month_eff_m²_2)
expression_13 = Expression(x=multiplication_3, Expression="x*12")
expression_14 = Expression(x=multiplication_4, Expression="x*12")
multiplication_5 = Multiplication(A=multiplication_2, B=construction_global_warming_potential_kg_2)
multiplication_6 = Multiplication(A=heating_energy_demand_kwh_m²a_2, B=multiplication_2)
multiplication_7 = Multiplication(A=cooling_energy_demand_kwh_m²a_2, B=multiplication_2)
multiplication_8 = Multiplication(A=multiplication_2, B=construction_cost_eff_m²_2)
multiplication_9 = Multiplication(A=technical_equipment_energy_demand_kwh_m²_2, B=multiplication_2)
roundmult = RoundToMultiple(N=multiplication_2, M="0.01")  # -> R; inputs N: tree, M: tree
# ---------- roundmult: Python ----------
#Component Information
#--------------------------------------------------------------------------------------------
if ghenv.Component.RunCount<2:
    #General
    #--------------------------------------------------------------------------------------------
    __author__ = "YOUR NAME"
    __version__ = "2000.00.00"
    
    ghenv.Component.Name = "Round to Multiple"
    ghenv.Component.NickName = "RoundMult"
    ghenv.Component.Description = "Rounds a number to the nearest specified multiple."
    ghenv.Component.Message = "VER 1.0"
    ghenv.Component.Category = "Math"
    ghenv.Component.SubCategory = "Arithmetic"
    
     #Inputs
    #--------------------------------------------------------------------------------------------
    inputIndex=0
    
    ghenv.Component.Params.Input[inputIndex].Name = "Number"
    ghenv.Component.Params.Input[inputIndex].NickName = "N"
    ghenv.Component.Params.Input[inputIndex].Description = "Number to round."
    ghenv.Component.Params.Input[inputIndex].Optional = False
    inputIndex+=1
    
    ghenv.Component.Params.Input[inputIndex].Name = "Multiple"
    ghenv.Component.Params.Input[inputIndex].NickName = "M"
    ghenv.Component.Params.Input[inputIndex].Description = "Multiple to round to."
    ghenv.Component.Params.Input[inputIndex].Optional = False
    inputIndex+=1
    
    #Outputs
    #--------------------------------------------------------------------------------------------
    outputIndex=0
    
    ghenv.Component.Params.Output[outputIndex].Name = "Rounded"
    ghenv.Component.Params.Output[outputIndex].NickName = "R"
    ghenv.Component.Params.Output[outputIndex].Description = "Number rounded to the nearest specified multiple."
    outputIndex+=1


#Imports
#--------------------------------------------------------------------------------------------
from System import Object
from Grasshopper import DataTree
import math


#The Component function - Business logic only (e.g. working without trees)
#--------------------------------------------------------------------------------------------
"""Function that this component is computing.
    Inputs:
        number: The number to round.
        multiple: The multiple to round to.
    Output:
        rounded: The number rounded to the nearest specified multiple."""
def RoundToMultiple(number, multiple):
    rounded = math.ceil(number / multiple) * multiple
    return rounded

#Solver - Run with trees to enhance performance drastically
#--------------------------------------------------------------------------------------------
if __name__ == "__main__":
    
    #Initialize trees
    #--------------------------------------------------------------------------------------------
    RoundedTree = DataTree[Object]()
    
    #Data matching
    #--------------------------------------------------------------------------------------------
    for path in N.Paths:
        numberBranch = N.Branch(path)
        for i, number in enumerate(numberBranch):
            multiple = M.Branch(path)[i]
            rounded = RoundToMultiple(number, multiple)
            RoundedTree.Add(rounded, path)
    
     #Assign trees to output
    #--------------------------------------------------------------------------------------------
    R = RoundedTree
# ---------- end roundmult ----------
round = Round(Number=multiplication_8)  # -> Nearest, Floor, Ceiling
roundmult_2 = RoundToMultiple(N=multiplication_5, M="0.01")  # -> R; inputs N: tree, M: tree; same code as roundmult
round_2 = Round(Number=multiplication_6)  # -> Nearest, Floor, Ceiling
round_3 = Round(Number=multiplication_7)  # -> Nearest, Floor, Ceiling
round_4 = Round(Number=multiplication_9)  # -> Nearest, Floor, Ceiling
round_5 = Round(Number=expression_13)  # -> Nearest, Floor, Ceiling
round_6 = Round(Number=expression_14)  # -> Nearest, Floor, Ceiling
merge_8 = Merge(
    Data1=entrance,
    Data2=view,
    Data3=height_m,
    Data4=roundmult,
    Data5=round.Nearest,
    Data6=round_2.Nearest,
    Data7=round_3.Nearest,
    Data8=round_4.Nearest,
    Data9=round_5.Nearest,
    Data10=round_6.Nearest,
    Data11=roundmult_2)
panel_12 = Panel("""entrance
view
heigth
effective floor area
construction cost
heating energy demand
cooling energy demand
technical equipment energy demand
income
maintenance expenses
construction global warming potential""")
panel_13 = Panel(merge_8)
panel_14 = Panel("""m
m²
€
kWh/a
kWh/a
kWh/a
€/a
€/a
kgCO2e""")
qal = ModelQuality(Validate=validate, Name=panel_12, Value=panel_13, Unit=panel_14)  # -> Quality, Valid, Name, Value, Unit
filter_6 = StreamFilter(Gate=mirror, Stream1="mirrored")
merge_9 = Merge(Data1=qal.Quality, Data2=filter_6)

typ = ModelType(
    Name="Trapezoid Capsule",
    Description=concat,
    Icon=concat_2,
    Image=concat_3,
    Variant=variant_2,
    Unit="m",
    Ports=por.Port,
    Authors=aut.Author,
    Qualities=merge_9)  # -> Type, Valid, Name, Description, Icon, Image, Variant, Stock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
typ_2 = PutType(Type=typ.Type, Uri=par, Run=save)

typ_3 = SerializeType(Type=typ.Type)
txt = EncodeText(Text=typ_3, Mode=0)
type = Text(txt)
context_bake = ContextBake(Geometry=type)

number_slider_4 = Slider(0.2, range=0..1)
sort_surfaces = SortSurfaces(B=shell_1to500)  # -> base_2, roof_2, walls_2
door_2 = Surface(door)
window_1to500_2 = Brep(window_1to500)
window_frame_1to200_2 = Brep(window_frame_1to200)
window_1to200_2 = Surface(window_1to200)
shell_1to200_2 = Geometry(shell_1to200)
neg_5 = Negative(Value=number_slider_4)
giving_a_thickness = GivingAThickness(
    D=neg_5,
    A=shell_1to200_2,
    O=shell_1to200_2,
    B_5=door_2,
    B_4=door_2,
    M_2=door_2,
    B=window_1to200_2,
    A_2=number_slider_4,
    M=window_1to200_2,
    B_3=window_1to200_2,
    B_2=window_frame_1to200_2)  # -> G, G_2, E
group = NamedGroup(Geometry=shell_1to500, Name="floors")  # -> Group, Geometry, Name
group_2 = NamedGroup(Geometry=sort_surfaces.base_2, Name="Base")  # -> Group, Geometry, Name
group_3 = NamedGroup(Geometry=sort_surfaces.walls_2, Name="walls")  # -> Group, Geometry, Name
group_4 = NamedGroup(Geometry=window_1to500_2, Name="window")  # -> Group, Geometry, Name
group_5 = NamedGroup(Geometry=door_2, Name="door")  # -> Group, Geometry, Name
group_6 = NamedGroup(Geometry=sort_surfaces.roof_2, Name="roof")  # -> Group, Geometry, Name
group_7 = NamedGroup(Geometry=window_1to500_2, Name="window")  # -> Group, Geometry, Name
group_8 = NamedGroup(Geometry=door_2, Name="door")  # -> Group, Geometry, Name
group_9 = NamedGroup(Geometry=shell_1to500, Name="shell")  # -> Group, Geometry, Name
group_10 = NamedGroup(Geometry=giving_a_thickness.G, Name="door")  # -> Group, Geometry, Name
group_11 = NamedGroup(Geometry=shell_1to200_2, Name="shell")  # -> Group, Geometry, Name
group_12 = NamedGroup(Geometry=giving_a_thickness.G_2, Name="window")  # -> Group, Geometry, Name
group_13 = NamedGroup(Geometry=giving_a_thickness.E, Name="window::frame")  # -> Group, Geometry, Name
merge_10 = Merge(
    Data1=group.Group,
    Data2=group_2.Group,
    Data3=group_3.Group,
    Data4=group_4.Group,
    Data5=group_5.Group,
    Data7=group_6.Group)
merge_11 = Merge(Data1=shell_1to500, Data2=door_2, Data3=window_1to500_2)
merge_12 = Merge(Data1=group_8.Group, Data2=group_9.Group, Data3=group_7.Group)
merge_13 = Merge(Data1=group_10.Group, Data2=group_11.Group, Data3=group_12.Group, Data4=group_13.Group)  # -> flatten(Result)
group_14 = NamedGroup(Geometry=merge_10)  # -> Group, Geometry, Name
wires = BrepWireframe(Brep=merge_11, Density=-1)  # -> flatten(Wireframe)
group_15 = NamedGroup(Geometry=merge_12)  # -> Group, Geometry, Name
group_16 = NamedGroup(Geometry=merge_13)  # -> Group, Geometry, Name
merge_14 = Merge(Data1=shell_1to500, Data2=wires)
data = Data(concat)
data_2 = Data(variant_2)
rep = ModelRepresentation(Tags="1 to 200")  # -> Representation, Valid, Url, Description, Tags, Attributes
collider_2 = Mesh(collider)
po = Port(por.Port)
au = Author(aut.Author)
ql = Quality(qal.Quality)
energy_representation = Data(group_14.Group)
typ_4 = OppinionatedType(
    path=dir,
    na="Trapezoid Capsule",
    description=data,
    variant=data_2,
    de=group_15.Group,
    paper=merge_14,
    collider=collider_2,
    volume=group_15.Group,
    group=group_16.Group,
    rp=rep.Representation,
    po=po,
    authors=au,
    qualities=ql)  # -> ty_2, ba_2

mrg_a = MergeSeperatlyAppend(z=shell_1to200, u=door, x=window_1to200, y=window_frame_1to200)  # -> Mrgd; inputs z: tree, u: tree, x: tree, y: tree
# ---------- mrg_a: Python ----------
if ghenv.Component.RunCount<2:
    __author__ = "Ueli Saluz"
    __version__ = "2020.05.28"
    
    ghenv.Component.Name = "MergeSeperatly(Append)"
    ghenv.Component.NickName = "Mrg(A)"
    ghenv.Component.Description = "Merge inputs seperatly on a new path. Append index of input parameter for distincting."
    ghenv.Component.Message = "VER 1.0"

from System import Object
from Grasshopper import DataTree
from Grasshopper.Kernel import GH_ParamAccess as Access

if __name__ == "__main__":
    Mrgd = DataTree[Object]()
    access = Access()
    
    for input in ghenv.Component.Params.Input:  #set all Inputaccess to Tree Access
        input.Access = access.tree
    
    for i,input in enumerate(ghenv.Component.Params.Input):
        for j,source in enumerate(input.Sources):
            for path in source.VolatileData.Paths:
                Mrgd.AddRange(source.VolatileData[path],path.AppendElement(i))
# ---------- end mrg_a ----------
geometry_1to200 = Geometry(flatten(mrg_a))

rec = Rectangle({Plane=Plane(origin=(15.60693884, 14.69292436, 15.6245417), x=(0.7071067812, -0.7071067812, 0), y=(-0.4082482905, -0.4082482905, 0.8164965809)), Size=Domain2(u=-24.40970167..24.40970167, v=-18.06498235..18.06498235)})
m2d_parallel = Make2DParallelView(Projection=rec)
make2d = Make2D(Geometry=flatten(geometry_1to200), View=m2d_parallel, TangentEdges="T", TangentSeams=False, AutoComputeMake2D=True)  # -> VisibleCurves, VisibleIndex, VisibleType, HiddenCurves, HiddenIndex, HiddenType
trim_10 = TrimTree(Tree=make2d.VisibleCurves, Depth=1)
trim_11 = TrimTree(Tree=make2d.HiddenCurves, Depth=1)
hidden = Curve(trim_11)
visible = Curve(trim_10)

bbox = BoundingBox(Content=flatten(geometry_1to200), Plane=PlaneXY(0, 0, 0), UnionBox=True)  # -> Box, Box_2
geo = PreviewGeometry(geo=geometry_1to200, sc=1)
zoom2bb = ZoomToBoundingBox(N=["Top", "Front", "Right", "Perspective", "Parallel"], BB=bbox.Box, S=0, R=zoom)  # -> F, SBB; inputs BB: Box, R: Boolean
# ---------- zoom2bb: Python ----------
#Component Information
#--------------------------------------------------------------------------------------------
if ghenv.Component.RunCount<2:
    #General
    #--------------------------------------------------------------------------------------------
    __author__ = "Ueli Saluz"
    __version__ = "2022.05.21"
    
    ghenv.Component.Name = "ZoomToBoundingBox"
    ghenv.Component.NickName = "Zoom2BB"
    ghenv.Component.Description = "Zoom the view of a Rhino viewport to a bounding box."
    ghenv.Component.Message = "VER 1.1"
    ghenv.Component.Category = "Display"
    ghenv.Component.SubCategory = "Camera"
    
     #Inputs
    #--------------------------------------------------------------------------------------------
    inputIndex=0
    
    ghenv.Component.Params.Input[inputIndex].Name = "Name"
    ghenv.Component.Params.Input[inputIndex].NickName = "N"
    ghenv.Component.Params.Input[inputIndex].Description = "Name of the viewport"
    ghenv.Component.Params.Input[inputIndex].Optional = False
    inputIndex+=1
    
    ghenv.Component.Params.Input[inputIndex].Name = "BoundingBox"
    ghenv.Component.Params.Input[inputIndex].NickName = "BB"
    ghenv.Component.Params.Input[inputIndex].Description = ""
    ghenv.Component.Params.Input[inputIndex].Optional = False
    inputIndex+=1
    
    ghenv.Component.Params.Input[inputIndex].Name = "ScaleFactor"
    ghenv.Component.Params.Input[inputIndex].NickName = "S"
    ghenv.Component.Params.Input[inputIndex].Description = "A factor for the extension of the bounding box." \
    +"0 means 0 extension, a positive number makes the bounding box larger a negative smaller. The amount is proportional to the length."
    ghenv.Component.Params.Input[inputIndex].Optional = False
    inputIndex+=1
   
    
    ghenv.Component.Params.Input[inputIndex].Name = "Run"
    ghenv.Component.Params.Input[inputIndex].NickName = "R"
    ghenv.Component.Params.Input[inputIndex].Description = "Zoom to the given bounding box."
    ghenv.Component.Params.Input[inputIndex].Optional = False
    inputIndex+=1
    
    #Outputs
    #--------------------------------------------------------------------------------------------
    outputIndex=0
    
    ghenv.Component.Params.Output[outputIndex].Name = "Finished"
    ghenv.Component.Params.Output[outputIndex].NickName = "F"
    ghenv.Component.Params.Output[outputIndex].Description = "Sends True when finished. Just to trigger other depending components."
    outputIndex+=1
    
    ghenv.Component.Params.Output[outputIndex].Name = "ScaledBoundingBox"
    ghenv.Component.Params.Output[outputIndex].NickName = "SBB"
    ghenv.Component.Params.Output[outputIndex].Description = "The scaled bounding box."
    outputIndex+=1


#Imports
#--------------------------------------------------------------------------------------------
from Rhino import RhinoDoc
from Rhino.Geometry import Box

#Solver - Run with trees to enhance performance drastically
#--------------------------------------------------------------------------------------------
if __name__ == "__main__":
    try:
        vp = RhinoDoc.ActiveDoc.Views.Find(N, False).ActiveViewport
        if R:
            box = BB
            bb = BB.BoundingBox
            bb.Inflate(S*box.X.Length,S*box.Y.Length,S*box.Z.Length)
            vp.ZoomBoundingBox(bb)
            SBB = bb
        F = True
    except:
        pass
# ---------- end zoom2bb ----------

expression_15 = Expression(x="visible", y=visible, Expression="x")
expression_16 = Expression(x="hidden", y=hidden, Expression="x")
merge_15 = Merge(Data1=visible, Data2=hidden)
merge_16 = Merge(Data1=expression_15, Data2=expression_16)
concat_6 = Concatenate(FragmentC="icon")
concat_7 = Concatenate(FragmentC="icons", FragmentD=sep)
concat_8 = Concatenate(FragmentA=concat_7)
concat_9 = Concatenate(FragmentA=par, FragmentB=sep, FragmentC=concat_8)
blc = ExportBlock(path=concat_9, name=concat_6, url=concat_8, geo=merge_15, layer_name=merge_16, export=and_2)  # -> block_definition_3, path_4, exported_2

# ==== cluster PreviewPlane: Preview a plane with axis colors and naming.
axis_length = ClusterInput()
plane = ClusterInput()
axis_length_2 = Number(axis_length)
plane_2 = Plane(plane)
deplane = DeconstructPlane(Plane=plane_2)  # -> Origin, XAxis, YAxis, ZAxis
line = LineSDL(Start=deplane.Origin, Direction=deplane.YAxis, Length=axis_length_2)
line_2 = LineSDL(Start=deplane.Origin, Direction=deplane.XAxis, Length=axis_length_2)
line_3 = LineSDL(Start=deplane.Origin, Direction=deplane.ZAxis, Length=axis_length_2)
swatch = ColourSwatch(SwatchColor=RGB(235, 52, 79))
swatch_2 = ColourSwatch(SwatchColor=RGB(0, 166, 157))
swatch_3 = ColourSwatch(SwatchColor=RGB(240, 117, 24))
end = EndPoints(Curve=line_2)  # -> Start, End
end_2 = EndPoints(Curve=line)  # -> Start, End
end_3 = EndPoints(Curve=line_3)  # -> Start, End
tag = TextTag(Location=end.End, Text="X", Colour=swatch)
tag_2 = TextTag(Location=end_2.End, Text="Y", Colour=swatch_2)
tag_3 = TextTag(Location=end_3.End, Text="Z", Colour=swatch_3)
preview = CustomPreview(Geometry=line_2, Material=swatch)
preview_2 = CustomPreview(Geometry=line, Material=swatch_2)
preview_3 = CustomPreview(Geometry=line_3, Material=swatch_3)

# ==== cluster ViewRectangle
view = ClusterInput()
view_2 = Data(view)
nickname = NAME(view=view_2)  # -> c, x, y, z, h, w
# ---------- nickname: Python ----------
uselss, c, x, y, z = view.GetCameraFrame()
h = view.FrustumHeight
w = view.FrustumWidth
# ---------- end nickname ----------
rev = Reverse(Vector=nickname.x)
rev_2 = Reverse(Vector=nickname.y)
pl = ConstructPlane(Origin=nickname.c, XAxis=rev, YAxis=nickname.y)
_2d = _2D(x=nickname.w)
_2d_2 = _2D(x=nickname.h)
rectangle = Rectangle(Plane=pl, XSize=_2d, YSize=_2d_2, Radius=0)  # -> Rectangle, Length
rec = Rectangle(rectangle.Rectangle)
rec_2 = ClusterOutput(rec)

# ==== cluster ExportBlock: Export geometry with layer names to a file.
path = ClusterInput()
name = ClusterInput()
url = ClusterInput()
geo = ClusterInput()
layer_name = ClusterInput()
export = ClusterInput()
path_2 = FilePath(path)
name_2 = Text(name)
url_2 = Text(url)
geo_2 = Geometry(geo)
layer_name_2 = Text(layer_name)
export_2 = Boolean(export)
layer = ModelLayer(Name=layer_name_2)  # -> Layer, Name, Hidden, Locked, DisplayColour, Material, Linetype
object = ModelObject(Geometry=geo_2, Layer=layer.Layer)  # -> Object, Geometry, Name, Layer, Visibility, Display, Drafting, Render
block_definition = ModelBlockDefinition(Objects=object.Object, Name=name_2, URL=url_2)  # -> BlockDefinition, Objects, Units, Name, Notes, URL, URLDescription
export_definition = ExportModelBlockDefinition(BlockDefinition=block_definition.BlockDefinition, FilePath=path_2, Overwrite="T", Export=export_2)  # -> BlockDefinition, FilePath, Exported
block_definition_2 = ModelBlockDefinition(export_definition.BlockDefinition)
path_3 = FilePath(export_definition.FilePath)
exported = Boolean(export_definition.Exported)
path_4 = ClusterOutput(path_3)
exported_2 = ClusterOutput(exported)
block_definition_3 = ClusterOutput(block_definition_2)

# ==== cluster PreviewPort: Preview a port by showing the point and direction and if exists: id, family and compatible families.
po = ClusterInput()
sc = ClusterInput()
sc_2 = Number(sc)
po_2 = Port(po)
por = ModelPort(Port=po_2)  # -> Port, Valid, Id, Description, Mandatory, Family, CompatibleFamilies, Point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
swatch = ColourSwatch(SwatchColor=RGB(235, 52, 79))
swatch_2 = ColourSwatch(SwatchColor=RGB(250, 149, 0))
amp = Amplitude(Vector=por.Direction, Amplitude=sc_2)
lng = ListLength(List=por.CompatibleFamilies)
expression = Expression(x=por.Family, Expression="x=\"\"")
cull = CullPattern(List=por.Point, CullPattern=expression)
expression_2 = Expression(x=lng, Expression="x=0")
join = TextJoin(Text=por.CompatibleFamilies, Join=",")
merge = Merge(Data1=":")
trim = TrimTree(Tree=join, Depth=1)
trim_2 = TrimTree(Tree=expression_2, Depth=1)
item = ListItem(List=merge, Index=expression, Wrap=invert(True))
log = Logarithm(Value=sc_2)
concat = Concatenate(FragmentA="[", FragmentB=trim, FragmentC="]")
expression_3 = Expression(y=trim_2, Expression="x")
merge_2 = Merge(Data1=graft(concat), Data2=graft(expression_3))
item_2 = ListItem(List=merge_2, Index=graft(expression), Wrap=invert(True))
multiplication = Multiplication(A=log, B=Slider(2, range=0..10))
trim_3 = TrimTree(Tree=item_2, Depth=1)
concat_2 = Concatenate(FragmentA=por.Id, FragmentB=item, FragmentC=por.Family, FragmentD=trim_3)
preview = CustomPreview(Geometry=cull, Material=swatch)
tag = TextTag(Location=por.Point, Text=concat_2, Colour=swatch)
vdisex = VectorDisplayEx(Point=por.Point, Vector=amp, Colour=ColourSwatch(SwatchColor=RGB(0, 166, 157)), Width=multiplication)

# ==== cluster PreviewGeometry: Preview geometry by ungrouping everything, showing light surfaces and dark edges.
sc = ClusterInput()
geo = ClusterInput()
geo_2 = Geometry(flatten(geo))
sc_2 = Number(sc)
expression = Expression(x=sc_2, Expression="x+1")
swatch = ColourSwatch(SwatchColor=RGB(0, 0, 0))
swatch_2 = ColourSwatch(SwatchColor=RGB(255, 255, 255))
ungroup = Ungroup(Group=geo_2)
ungroup_2 = Ungroup(Group=ungroup)
ungroup_3 = Ungroup(Group=ungroup_2)
ungroup_4 = Ungroup(Group=ungroup_3)
log = Logarithm(Value=expression)
clean = CleanTree(RemoveNulls=True, RemoveInvalid=True, RemoveEmpty=invert(False), Tree=ungroup_4)  # -> flatten(Tree)
multiplication = Multiplication(A=log, B=Slider(0.05, range=0..1))
linetype = ModelLinetype(Name="semio", Width=multiplication)  # -> ModelLinetype, Name, Segments, CapStyle, JoinStyle, Width, WidthUnits, TaperWidths, TaperPositions
dispatch = CSharpScript(D=clean)  # -> P, C, B, M, R
# ---------- dispatch: C# ----------
// Grasshopper Script Instance
#region Usings
using System;
using System.Linq;
using System.Collections;
using System.Collections.Generic;
using System.Drawing;

using Rhino;
using Rhino.Geometry;

using Grasshopper;
using Grasshopper.Kernel;
using Grasshopper.Kernel.Data;
using Grasshopper.Kernel.Types;
#endregion

public class Script_Instance : GH_ScriptInstance
{
    #region Notes
    /* 
      Members:
        RhinoDoc RhinoDocument
        GH_Document GrasshopperDocument
        IGH_Component Component
        int Iteration

      Methods (Virtual & overridable):
        Print(string text)
        Print(string format, params object[] args)
        Reflect(object obj)
        Reflect(object obj, string method_name)
    */
    #endregion

    private void RunScript(
	object D,
	ref object P,
	ref object C,
	ref object B,
	ref object M,
	ref object R)
    {
        if (D is Curve) C = D; // Curve
        else if (
            D is Rhino.Geometry.Point ||
            D is PointCloud
            )
            P = D; // Point
        else if ( D is Mesh) M = D; // Mesh
        else if (
            D is Surface ||
            D is Extrusion ||
            D is SubD ||
            D is Brep
            )
            B = D; // Brep
        else R = D; // Rest
            
    }
}
# ---------- end dispatch ----------
clean_2 = CleanTree(RemoveNulls=True, RemoveInvalid=True, RemoveEmpty=False, Tree=dispatch.M)
clean_3 = CleanTree(RemoveNulls=True, RemoveInvalid=True, RemoveEmpty=False, Tree=dispatch.R)
clean_4 = CleanTree(RemoveNulls=True, RemoveInvalid=True, RemoveEmpty=False, Tree=dispatch.B)
clean_5 = CleanTree(RemoveNulls=True, RemoveInvalid=True, RemoveEmpty=False, Tree=dispatch.P)
clean_6 = CleanTree(RemoveNulls=True, RemoveInvalid=True, RemoveEmpty=False, Tree=dispatch.C)
debrep = DeconstructBrep(Brep=clean_4)  # -> Faces, Edges, Vertices
preview = CustomPreview(Geometry=flatten(clean_5), Material=swatch)
preview_2 = CustomPreview(Geometry=flatten(debrep.Faces), Material=swatch_2)
preview_3 = CustomPreview(Geometry=flatten(clean_2), Material=swatch_2)
preview_4 = CustomPreview(Geometry=flatten(clean_3), Material=swatch)
curve_preview = CustomCurvePreview(Curve=clean_6, Linetype=linetype.ModelLinetype, Colour=swatch)
curve_preview_2 = CustomCurvePreview(Curve=debrep.Edges, Linetype=linetype.ModelLinetype, Colour=swatch)

# ==== cluster OppinionatedType: Construct a type following the oppinionated conventions of semio. All representations are saved under representations folder where each representation is saved once natively (.3dm) and once exported (.glb). Further a collider representation is required. All names and file names are standardized.
emoji = Panel("")
name = Panel("Default")
abbreviation = Panel("Dft?")
nn = Panel("De")
prm = ModelParam(Na=name, NN=nn, Dc="The optional default representation geometry group.", Op=Toggle(True), Ru=Toggle(True))  # -> Param, Name, NickName, Description, Optional, Success; inputs Pr: tree, Op: Boolean, Ru: Boolean
# ---------- prm: Python ----------
#Component Information
#--------------------------------------------------------------------------------------------
if ghenv.Component.RunCount<2:
    #General
    #--------------------------------------------------------------------------------------------
    __author__ = "Ueli Saluz"
    __version__ = "2025.06.18"
    
    ghenv.Component.Name = "Model Param"
    ghenv.Component.NickName = "~Prm"
    ghenv.Component.Description = "Deconstruct or modify a param."
    ghenv.Component.Message = "VER 1.0"
    ghenv.Component.Category = "semio"
    ghenv.Component.SubCategory = "Scripting"
    
     #Inputs
    #--------------------------------------------------------------------------------------------
    inputIndex=0
    
    ghenv.Component.Params.Input[inputIndex].Name = "Param"
    ghenv.Component.Params.Input[inputIndex].NickName = "Pr"
    ghenv.Component.Params.Input[inputIndex].Description = "Connect the param to desconstruct or modify here with one wire."
    ghenv.Component.Params.Input[inputIndex].Optional = False
    inputIndex+=1

    ghenv.Component.Params.Input[inputIndex].Name = "Name"
    ghenv.Component.Params.Input[inputIndex].NickName = "Na"
    ghenv.Component.Params.Input[inputIndex].Description = "Name of the param."
    ghenv.Component.Params.Input[inputIndex].Optional = False
    inputIndex+=1
    
    ghenv.Component.Params.Input[inputIndex].Name = "NickName"
    ghenv.Component.Params.Input[inputIndex].NickName = "NN"
    ghenv.Component.Params.Input[inputIndex].Description = "Nickname of the param."
    ghenv.Component.Params.Input[inputIndex].Optional = False
    inputIndex+=1
    
    ghenv.Component.Params.Input[inputIndex].Name = "Description"
    ghenv.Component.Params.Input[inputIndex].NickName = "Dc"
    ghenv.Component.Params.Input[inputIndex].Description = "Description of the param."
    ghenv.Component.Params.Input[inputIndex].Optional = True
    inputIndex+=1
    
    ghenv.Component.Params.Input[inputIndex].Name = "Optional"
    ghenv.Component.Params.Input[inputIndex].NickName = "Op"
    ghenv.Component.Params.Input[inputIndex].Description = "Wheather the param is optional."
    ghenv.Component.Params.Input[inputIndex].Optional = True
    inputIndex+=1
    
    ghenv.Component.Params.Input[inputIndex].Name = "Run"
    ghenv.Component.Params.Input[inputIndex].NickName = "Ru"
    ghenv.Component.Params.Input[inputIndex].Description = "Modify the param."
    ghenv.Component.Params.Input[inputIndex].Optional = True
    inputIndex+=1
    
    #Outputs
    #--------------------------------------------------------------------------------------------
    outputIndex=0
    
    ghenv.Component.Params.Output[outputIndex].Name = "Param"
    ghenv.Component.Params.Output[outputIndex].NickName = "Param"
    ghenv.Component.Params.Output[outputIndex].Description = "The desconstruct or modified param"
    ghenv.Component.Params.Output[outputIndex].Optional = False
    outputIndex+=1
    
    ghenv.Component.Params.Output[outputIndex].Name = "Name"
    ghenv.Component.Params.Output[outputIndex].NickName = "Name"
    ghenv.Component.Params.Output[outputIndex].Description = "Name of the param."
    ghenv.Component.Params.Output[outputIndex].Optional = False
    outputIndex+=1
    
    ghenv.Component.Params.Output[outputIndex].Name = "NickName"
    ghenv.Component.Params.Output[outputIndex].NickName = "NickName"
    ghenv.Component.Params.Output[outputIndex].Description = "Nickname of the param."
    ghenv.Component.Params.Output[outputIndex].Optional = False
    outputIndex+=1
    
    ghenv.Component.Params.Output[outputIndex].Name = "Description"
    ghenv.Component.Params.Output[outputIndex].NickName = "Description"
    ghenv.Component.Params.Output[outputIndex].Description = "Description of the param."
    ghenv.Component.Params.Output[outputIndex].Optional = True
    outputIndex+=1
    
    ghenv.Component.Params.Output[outputIndex].Name = "Optional"
    ghenv.Component.Params.Output[outputIndex].NickName = "Optional"
    ghenv.Component.Params.Output[outputIndex].Description = "Wheather the param is optional."
    ghenv.Component.Params.Output[outputIndex].Optional = True
    outputIndex+=1
    
    ghenv.Component.Params.Output[outputIndex].Name = "Success"
    ghenv.Component.Params.Output[outputIndex].NickName = "Success"
    ghenv.Component.Params.Output[outputIndex].Description = "Wheather the operation was successful."
    ghenv.Component.Params.Output[outputIndex].Optional = False
    outputIndex+=1

input = ghenv.Component.Params.Input[0]
param = input.Sources[0]
if Ru:
    if Na:
        param.Name = Na
    if NN:
        param.NickName = NN
    if Dc:
        param.Description = Dc
    if Op:
        param.Optional = Op
    Success = True
else:
    Success = False
Param = param
Name = param.Name
NickName = param.NickName
Description = param.Description
Optional = param.Optional
# ---------- end prm ----------
concat = Concatenate(FragmentA="\"", FragmentB=prm.Description, FragmentC="\"")
merge = Merge(Data1=emoji, Data2=prm.NickName, Data3=abbreviation, Data4=prm.Name, Data5=concat)
join = TextJoin(Text=merge, Join=",")
de = ClusterInput()
paper = ClusterInput()
panel = Panel(join)
path = ClusterInput()
na = ClusterInput()
description = ClusterInput()
variant = ClusterInput()
rp = ClusterInput()
collider = ClusterInput()
volume = ClusterInput()
ex = ClusterInput()
group = ClusterInput()
po = ClusterInput()
authors = ClusterInput()
qualities = ClusterInput()
sep = Separator()  # -> S; same code as sep
path_2 = FilePath(path)
na_2 = Name(na)
description_2 = Description(description)
variant_2 = Variant(variant)
de_2 = Default(de)
rp_2 = Representation(rp)
volume_2 = Volume(volume)
group_2 = Group(group)
paper_2 = Paper(paper)
collider_2 = Collider(collider)
authors_2 = Authors(authors)
qualities_2 = Qualities(qualities)
po_2 = Port(po)
ex_2 = Export(ex)
merge_2 = Merge(Data1=de_2, Data2=paper_2, Data3=collider_2, Data4=volume_2)
rep = ModelRepresentation(Representation=rp_2)  # -> Representation, Valid, Url, Description, Tags, Qualities
rep_2 = ReplaceText(Text=variant_2, Find="/", Replace="slash", RecursiveReplace=False)
txt = NormalizeText(Text=na_2)  # -> Strict, Title, Underscore, Kebab, Pascal
split = SplitList(List=rep.Tags, Index="1")  # -> ListA, ListB
rep_3 = ReplaceText(Text=rep_2, Find="\", Replace="backslash", RecursiveReplace=False)
panel_2 = Panel(rp_2)
txt_2 = NormalizeText(Text=rep_3)  # -> Strict, Title, Underscore, Kebab, Pascal
join_2 = TextJoin(Text=split.ListB, Join="_")
panel_3 = Panel("""default
paper
collider
volume""")
concat_2 = Concatenate(FragmentA=txt.Kebab, FragmentD="_", FragmentB=txt_2.Kebab)
concat_3 = Concatenate(FragmentA="images", FragmentB=sep, FragmentC=concat_2, FragmentD=".png")
concat_4 = Concatenate(FragmentA="icons", FragmentB=sep, FragmentC=concat_2, FragmentD=".svg")
concat_5 = Concatenate(FragmentA=concat_2, FragmentB=".glb")
concat_6 = Concatenate(FragmentA=concat_2, FragmentD="_", FragmentB=join_2)
concat_7 = Concatenate(FragmentA="representations", FragmentB=sep, FragmentC=concat_2, FragmentD=".glb")
concat_8 = Concatenate(FragmentA="representations", FragmentB=sep, FragmentC=concat_2, FragmentD=".3dm")
concat_9 = Concatenate(FragmentA=concat_6, FragmentB=".glb")
concat_10 = Concatenate(FragmentA=concat_6, FragmentB=".3dm")
concat_11 = Concatenate(FragmentD=concat_2, FragmentC="_", FragmentA=panel_3, FragmentB=".3dm")
concat_12 = Concatenate(FragmentA=concat_2, FragmentC="_", FragmentB=panel_3, FragmentD=".glb")
concat_13 = Concatenate(FragmentA="representations", FragmentB=sep, FragmentC=concat_10)
concat_14 = Concatenate(FragmentA="representations", FragmentB=sep, FragmentC=concat_9)
concat_15 = Concatenate(FragmentA="representations", FragmentB=sep, FragmentC=concat_11)
concat_16 = Concatenate(FragmentA="representations", FragmentB=sep, FragmentC=concat_12)
panel_4 = Panel(concat_13)
rep_4 = ModelRepresentation(Url=concat_13, Tags=split.ListB)  # -> Representation, Valid, Url, Description, Tags, Qualities
rep_5 = ModelRepresentation(Url=graft(concat_16), Tags=graft(panel_3))  # -> Representation, Valid, Url, Description, Tags, Qualities
rep_6 = ModelRepresentation(Url=concat_14, Tags=split.ListB)  # -> Representation, Valid, Url, Description, Tags, Qualities
rep_7 = ModelRepresentation(Url=graft(concat_15), Tags=graft(panel_3))  # -> Representation, Valid, Url, Description, Tags, Qualities
rep_8 = ModelRepresentation(Url=concat_7)  # -> Representation, Valid, Url, Description, Tags, Qualities
rep_9 = ModelRepresentation(Url=concat_8)  # -> Representation, Valid, Url, Description, Tags, Qualities
trim = TrimTree(Tree=rep_4.Representation, Depth=1)
trim_2 = TrimTree(Tree=rep_6.Representation, Depth=1)
trim_3 = TrimTree(Tree=rep_7.Representation, Depth=1)
trim_4 = TrimTree(Tree=rep_5.Representation, Depth=1)
merge_3 = Merge(Data1=rep_8.Representation, Data2=rep_9.Representation, Data3=trim, Data4=trim_2, Data5=trim_4, Data6=trim_3)
concat_17 = Concatenate(FragmentA=path_2, FragmentB=sep, FragmentC=concat_16)
concat_18 = Concatenate(FragmentA=path_2, FragmentB=sep, FragmentC=concat_14)
concat_collider_glb = Concatenate(FragmentA=path_2, FragmentB=sep, FragmentC=concat_16)
cluster = Cluster(gr=merge_2)  # -> geo_2, txt_2
typ = ModelType(
    Name=txt.Title,
    Description=description_2,
    Icon=concat_4,
    Image=concat_3,
    Variant=variant_2,
    Representations=merge_3,
    Ports=po_2,
    Authors=authors_2,
    Qualities=qualities_2)  # -> Type, Valid, Name, Description, Icon, Image, Variant, Stock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
geo = ExportGeometry(F=concat_collider_glb, G=collider_2, R=ex_2)  # -> S; inputs G: tree of GeometryBase, R: Boolean
# ---------- geo: C# ----------
// Grasshopper Script Instance
#region Usings
using System;
using System.Linq;
using System.Collections;
using System.Collections.Generic;
using System.Drawing;
using System.IO;

using Rhino;
using Rhino.Geometry;

using Grasshopper;
using Grasshopper.Kernel;
using Grasshopper.Kernel.Data;
using Grasshopper.Kernel.Types;
#endregion

public class Script_Instance : GH_ScriptInstance
{
    #region Notes
    /* 
      Members:
        RhinoDoc RhinoDocument
        GH_Document GrasshopperDocument
        IGH_Component Component
        int Iteration

      Methods (Virtual & overridable):
        Print(string text)
        Print(string format, params object[] args)
        Reflect(object obj)
        Reflect(object obj, string method_name)
    */
    #endregion

    private void RunScript(object F, DataTree<GeometryBase> G, bool R, ref object S)
    {
        // inspired from https://github.com/jhorikawa/GrasshopperProgrammingTutorials/blob/master/0015%20Export%20Geometry%20with%20Grasshopper%20C%23/Export%20Geometry%20with%20Grasshopper%20C%23.gh
        if(R){
            var guids = new List<Guid>();

            for(int i = 0; i < G.BranchCount; i++){
                for(int n = 0; n < G.Branches[i].Count; n++){
                var geom = G.Branches[i][n];
                var guid = Rhino.RhinoDoc.ActiveDoc.Objects.Add(geom);
                guids.Add(guid);
                }
            }

            Rhino.RhinoDoc.ActiveDoc.Objects.Select(guids);

            string cmd = "_-Export " + "\"" + F + "\"" + " _Enter _Enter";

            Rhino.RhinoApp.RunScript(cmd, false);

            Rhino.RhinoDoc.ActiveDoc.Objects.Delete(guids, true);
            S = true;
        }
    }
}
# ---------- end geo ----------
concat_3dm = Concatenate(FragmentA=path_2, FragmentB=sep, FragmentC=concat_13)
geo_2 = ExportGeometry(F=concat_18, G=collider_2, R=ex_2)  # -> S; inputs G: tree of GeometryBase, R: Boolean; same code as geo
geo_3 = ExportGeometry(F=concat_17, G=cluster.geo_2, R=ex_2)  # -> S; inputs G: tree of GeometryBase, R: Boolean; same code as geo
geo_4 = ExportGeometry()  # -> S; inputs G: tree of GeometryBase, R: Boolean; same code as geo
ty = Type(typ.Type)
ba = Text(concat_2)
ty_2 = ClusterOutput(ty)
ba_2 = ClusterOutput(ba)
blc = ExportBlock_3(export=ex_2, ob=group_2)  # -> block_definition_3, path_4, exported_2
blc_2 = ExportBlock_2(path=path_2, gr=group_2, ty=typ.Type, rp=rp_2, export=ex_2)  # -> block_definition_3, path_4, exported_2
blc_3 = ExportBlock_2(path=path_2, export=ex_2)  # -> block_definition_3, path_4, exported_2
geo_5 = ExportGeometry(F=concat_3dm, G=group_2, R=ex_2)  # -> S; inputs G: tree of GeometryBase, R: Boolean; same code as geo

# ==== cluster SortSurfaces
B = ClusterInput()
debrep = DeconstructBrep(Brep=B)  # -> flatten(Faces), Edges, Vertices
facen = FaceNormals(Mesh=debrep.Faces)  # -> simplify(Centers), simplify(Normals)
item = ListItem(List=facen.Normals, Index=0, Wrap=True)  # -> flatten(Item)
devec = DeconstructVector(Vector=item)  # -> XComponent, YComponent, ZComponent
smaller = SmallerThan(FirstNumber=devec.ZComponent, SecondNumber="0.01")  # -> SmallerThan, OrEqualTo
smaller_2 = SmallerThan(FirstNumber=devec.ZComponent, SecondNumber="-0.01")  # -> SmallerThan, OrEqualTo
larger = LargerThan(FirstNumber=devec.ZComponent, SecondNumber="0.01")  # -> LargerThan, OrEqualTo
larger_2 = LargerThan(FirstNumber=devec.ZComponent, SecondNumber="-0.01")  # -> LargerThan, OrEqualTo
and = GateAnd(A=smaller.SmallerThan, B=smaller_2.SmallerThan)
and_2 = GateAnd(A=smaller.SmallerThan, B=larger_2.LargerThan)
cull = CullPattern(List=debrep.Faces, CullPattern=and)
cull_2 = CullPattern(List=debrep.Faces, CullPattern=larger.LargerThan)
cull_3 = CullPattern(List=debrep.Faces, CullPattern=and_2)
base = Surface(cull)
roof = Surface(cull_2)
walls = Surface(cull_3)
base_2 = ClusterOutput(base)
roof_2 = ClusterOutput(roof)
walls_2 = ClusterOutput(walls)

# ==== cluster GivingAThickness
D = ClusterInput()
O = ClusterInput()
A = ClusterInput()
B = ClusterInput()
B_2 = ClusterInput()
M = ClusterInput()
B_3 = ClusterInput()
A_2 = ClusterInput()
B_4 = ClusterInput()
M_2 = ClusterInput()
B_5 = ClusterInput()
facen = FaceNormals(Mesh=M)  # -> Centers, Normals
facen_2 = FaceNormals(Mesh=M_2)  # -> Centers, Normals
explode = ExplodeObject(Object=O, Recursive=False)
neg = Negative(Value=facen.Normals)
neg_2 = Negative(Value=facen_2.Normals)
offset = OffsetSurface(Surface=explode, Distance=D, Retrim=True)
amp = Amplitude(Vector=neg, Amplitude="0.2")
amp_2 = Amplitude(Vector=neg_2, Amplitude="0.05")
amp_3 = Amplitude(Vector=neg, Amplitude=A_2)
amp_4 = Amplitude(Vector=neg_2, Amplitude="0.2")
amp_5 = Amplitude(Vector=neg, Amplitude="0.05")
join = BrepJoin(Breps=offset)  # -> Breps, Closed
extr = Extrude(Base=B_5, Direction=amp_2)
extr_2 = Extrude(Base=B_4, Direction=amp_4)
extr_3 = Extrude(Base=B, Direction=amp_5)
extr_4 = Extrude(Base=B_3, Direction=amp)
extr_5 = Extrude(Base=B_2, Direction=amp)
E = ClusterOutput(extr_5)
move = Move(Geometry=extr, Motion=amp_2)  # -> Geometry, Transform
G = ClusterOutput(move.Geometry)
move_2 = Move(Geometry=extr_3, Motion=amp_5)  # -> Geometry, Transform
G_2 = ClusterOutput(move_2.Geometry)
merge = Merge(Data1=join.Breps, Data2=extr_2, Data3=extr_5, Data4=extr_4)
join_2 = BrepJoin(Breps=merge)  # -> Breps, Closed
sdiff = SolidDifference(BrepsA=A, BrepsB=join_2.Breps)

# ==== cluster _2D
x = ClusterInput()
expression = Expression(x=x, Expression="x/2")
neg = Negative(Value=expression)
dom = ConstructDomain(DomainStart=neg, DomainEnd=expression)
I = ClusterOutput(dom)

# ==== cluster ExportBlock_2: Export geometry with layer names to a file.
gr = ClusterInput()
ty = ClusterInput()
export = ClusterInput()
rp = ClusterInput()
path = ClusterInput()
path_2 = FilePath(path)
ty_2 = Type(ty)
rp_2 = Representation(rp)
export_2 = Boolean(export)
cluster = Cluster(gr=gr)  # -> geo_2, txt_2
layer = ModelLayer(Name=cluster.txt_2)  # -> Layer, Name, Hidden, Locked, DisplayColour, Material, Linetype
object = ModelObject(Geometry=cluster.geo_2, Layer=layer.Layer)  # -> Object, Geometry, Name, Layer, Visibility, Display, Drafting, Render
typ = ModelType(Type=ty_2)  # -> Type, Valid, Name, Description, Icon, Image, Variant, Stock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
rep = ModelRepresentation(Representation=rp_2)  # -> Representation, Valid, Url, Description, Tags, Qualities
trim = TrimTree(Tree=object.Object, Depth="5")
concat = Concatenate(FragmentA=typ.Type, FragmentC=":", FragmentB=rep.Representation)
block_definition = ModelBlockDefinition(Objects=trim, Name=concat, Notes=typ.Description)  # -> BlockDefinition, Objects, Units, Name, Notes, URL, URLDescription
export_definition = ExportModelBlockDefinition(BlockDefinition=block_definition.BlockDefinition, FilePath=path_2, Overwrite="T", Export=export_2)  # -> BlockDefinition, FilePath, Exported
block_definition_2 = ModelBlockDefinition(export_definition.BlockDefinition)
path_3 = FilePath(export_definition.FilePath)
exported = Boolean(export_definition.Exported)

# ---- group: Export single files. WIP
sep = Separator()  # -> S
# ---------- sep: C# ----------
#region Usings
using System;
using System.Linq;
using System.Collections;
using System.Collections.Generic;
using System.Drawing;
using System.IO;

using Rhino;
using Rhino.Geometry;

using Grasshopper;
using Grasshopper.Kernel;
using Grasshopper.Kernel.Data;
using Grasshopper.Kernel.Types;
#endregion

public class Script_Instance : GH_ScriptInstance
{
    private void RunScript(ref object S)
    {
        S = Path.DirectorySeparatorChar;
    }
}
# ---------- end sep ----------
rep_2 = ReplaceText(Text=rep.Url, Find="/", Replace=sep, RecursiveReplace=False)
item = ListItem(List=rep.Tags, Index=0, Wrap=True)
concat_2 = Concatenate(FragmentA=path_2, FragmentB=sep, FragmentC=rep_2)
mime = Mime({".glb": "model/gltf-binary", ".gltf": "model/gltf+json", ".stl": "model/stl", ".obj": "model/obj", ".blend": "model/x-blender", ".3dm": "model/vnd.3dm", ".ifc": "model/x-ifc", ".dwg": "model/acad", ".dxf": "model/dxf", ".rvt": "model/vnd.revit"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}, selected=".3dm")
trim_2 = TrimTree(Tree=item, Depth=1)
expression = Expression(x=trim_2, y=mime, Expression="x=y")
# WIP
dispatch = Dispatch(List=concat_2, DispatchPattern=expression)  # -> ListA, ListB
dispatch_2 = Dispatch(List=concat_2, DispatchPattern=expression)  # -> ListA, ListB

# ----
exported_2 = ClusterOutput(exported)
path_4 = ClusterOutput(path_3)
block_definition_3 = ClusterOutput(block_definition_2)

# ==== cluster ExportBlock_3: Export geometry with layer names to a file.
ob = ClusterInput()
G = ClusterInput()
dc = ClusterInput()
path = ClusterInput()
name = ClusterInput()
url = ClusterInput()
layer_n = ClusterInput()
export = ClusterInput()
ob_2 = ModelObject(ob)
group = Group(Geometry=G)
path_2 = FilePath(path)
name_2 = Text(name)
url_2 = Text(url)
export_2 = Boolean(export)
layer_n_2 = Name(layer_n)
dc_2 = DisplayColour(dc)
object = ModelObject(Object=group)  # -> Object, Geometry, Name, Layer, Visibility, Display, Drafting, Render
layer = ModelLayer(Name=layer_n_2, DisplayColour=dc_2)  # -> Layer, Name, Hidden, Locked, DisplayColour, Material, Linetype, PrintColour, PrintWidth
object_2 = ModelObject(group)
group_2 = NamedGroup(Geometry=group)  # -> Group, Geometry, Name
object_3 = ModelObject(Geometry=object_2, Layer=layer.Layer)  # -> Object, Geometry, Name, Layer, Visibility, Display, Drafting, Render
object_4 = ModelObject(Object=object_2)  # -> Object, Geometry, Name, Layer, Visibility, Display, Drafting, Render
block_definition = ModelBlockDefinition(Objects=object_3.Object, Name=name_2, URL=url_2)  # -> BlockDefinition, Objects, Units, Name, Notes, URL, URLDescription
panel = Panel(object_4.Layer)
export_definition = ExportModelBlockDefinition(BlockDefinition=block_definition.BlockDefinition, FilePath=path_2, Overwrite="T", Export=export_2)  # -> BlockDefinition, FilePath, Exported
block_definition_2 = ModelBlockDefinition(export_definition.BlockDefinition)
path_3 = FilePath(export_definition.FilePath)
exported = Boolean(export_definition.Exported)
path_4 = ClusterOutput(path_3)
exported_2 = ClusterOutput(exported)
block_definition_3 = ClusterOutput(block_definition_2)

# ==== cluster Cluster
gr = ClusterInput()
gr_2 = Group(gr)
group = NamedGroup(Group=gr_2)  # -> Group, Geometry, Name
group_2 = NamedGroup(Group=group.Geometry)  # -> Group, Geometry, Name
expression = Expression(x=graft(group.Name), y=group_2.Name, Expression="x")
group_3 = NamedGroup(Group=group_2.Geometry)  # -> Group, Geometry, Name
expression_2 = Expression(x=graft(expression), y=group_3.Name, Expression="x")
expression_3 = Expression(x=graft(group_2.Name), y=group_3.Name, Expression="x")
group_4 = NamedGroup(Group=group_3.Geometry)  # -> Group, Geometry, Name
expression_4 = Expression(x=graft(expression_2), y=group_4.Name, Expression="x")
expression_5 = Expression(x=graft(expression_3), y=group_4.Name, Expression="x")
expression_6 = Expression(x=graft(group_3.Name), y=group_4.Name, Expression="x")
group_5 = NamedGroup(Group=group_4.Geometry)  # -> Group, Geometry, Name
expression_7 = Expression(x=graft(expression_4), y=group_5.Name, Expression="x")
expression_8 = Expression(x=graft(expression_5), y=group_5.Name, Expression="x")
expression_9 = Expression(x=graft(expression_6), y=group_5.Name, Expression="x")
expression_10 = Expression(x=graft(group_4.Name), y=group_5.Name, Expression="x")
group_6 = NamedGroup(Group=group_5.Geometry)  # -> Group, Geometry, Name
expression_11 = Expression(x=graft(expression_7), y=group_6.Name, Expression="x")
expression_12 = Expression(x=graft(expression_9), y=group_6.Name, Expression="x")
expression_13 = Expression(x=graft(expression_8), y=group_6.Name, Expression="x")
expression_14 = Expression(x=graft(expression_10), y=group_6.Name, Expression="x")
expression_15 = Expression(x=graft(group_5.Name), y=group_6.Name, Expression="x")
merge = Merge(
    Data1=expression_11,
    Data2=expression_13,
    Data3=expression_12,
    Data4=expression_14,
    Data5=expression_15,
    Data6=group_6.Name)
join = TextJoin(Text=merge, Join="::")
geo = Geometry(group_6.Geometry)
txt = Text(join)
geo_2 = ClusterOutput(geo)
txt_2 = ClusterOutput(txt)
