# Grasshopper definition oppionated-type.gh (Grasshopper 1.0.8)
# Copyright: GNU Lesser General Public License Version 3
# Copyright: GNU Lesser General Public License v3.0 or later
# plug-ins: RhinoCodePluginGH, semio

ob = Data(Tree({0;0;0}: [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], {0;0;1}: [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], {0;0;2}: [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], {0;0;3}: [], {0;0;4}: [], {0;0;5}: [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]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))
bang = ExplodeTree(Data=ob)  # -> Branch0, Branch1, flatten(Branch2)
split = SplitList(List=bang.Branch0, Index="120")  # -> flatten(ListA), ListB
item = ListItem(List=bang.Branch0, Index=0, Wrap=True)
split_2 = SplitList(List=split.ListB, Index=Slider(109, range=0..1000))  # -> flatten(ListA), flatten(ListB)
group = NamedGroup(Geometry=split.ListA, Name="Layer 1")  # -> Group, Geometry, Name
group_2 = NamedGroup(Geometry=split_2.ListB, Name="Sublayer 3")  # -> Group, Geometry, Name
group_3 = NamedGroup(Geometry=split_2.ListA, Name="Sublayer 2")  # -> Group, Geometry, Name
panel = Panel("! _-Layer New")
merge = Merge(Data1=group_3.Group, Data2=group_2.Group)
group_4 = NamedGroup(Geometry=merge, Name="Layer 2")  # -> Group, Geometry, Name
merge_2 = Merge(Data1=group.Group, Data2=group_4.Group)
dir = Directory()  # -> D
# ---------- dir: C# ----------
#region Usings
using System;
using System.Linq;
using System.Collections;
using System.Collections.Generic;
using System.Drawing;
using System.IO;

using Rhino;
using Rhino.Geometry;

using Grasshopper;
using Grasshopper.Kernel;
using Grasshopper.Kernel.Data;
using Grasshopper.Kernel.Types;
#endregion

public class Script_Instance : GH_ScriptInstance
{
    private void RunScript(ref object D)
    {
        D = Path.GetDirectoryName(this.GrasshopperDocument.FilePath);
    }
}
# ---------- end dir ----------
sep = Separator()  # -> S; same code as sep
par = ParentDirectory(D=dir)  # -> P; inputs D: String
# ---------- par: C# ----------
#region Usings
using System;
using System.Linq;
using System.Collections;
using System.Collections.Generic;
using System.Drawing;
using System.IO;

using Rhino;
using Rhino.Geometry;

using Grasshopper;
using Grasshopper.Kernel;
using Grasshopper.Kernel.Data;
using Grasshopper.Kernel.Types;
#endregion

public class Script_Instance : GH_ScriptInstance
{
    private void RunScript(string D, ref object P)
    {
        P = new DirectoryInfo(D).Parent;
    }
}
# ---------- end par ----------
par_2 = ParentDirectory(D=par)  # -> P; inputs D: String; same code as par
ty = Type([null x45])
panel_2 = Panel("""First storey
last door
r23.5-1
\
/""")
concat = Concatenate(FragmentA=par_2, FragmentB=sep, FragmentC="examples")
aut = ModelAuthor()  # -> Author, Valid, Name, Email
panel_3 = Panel("""floor plan
1to200""")
panel_4 = Panel("""floor plan
1to500""")
concat_2 = Concatenate(FragmentA=concat, FragmentB=sep, FragmentC="metabolism")
item_2 = ListItem(List=panel_2, Index=0, Wrap=True)  # -> Item, Item1, Item2, Item3, Item4, Item5, Item6
entwine = Entwine(Branch00=panel_4, Branch01=panel_3, FlattenInputs=True)
qal = ModelQuality()  # -> Quality, Valid, Name, Value, Unit, Definition
panel_5 = Panel(concat_2)
rep = ModelRepresentation(Url="placeholder.3dm", Tags=entwine)  # -> flatten(Representation), Valid, Url, Description, Tags, Qualities
por = ModelPort()  # -> Port, Valid, Id, Description, Mandatory, Family, CompatibleFamilies, Point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
box = CenterBox(Base=PlaneXY(0, 0, 0), X=1, Y=1, Z=1)
merge_3 = Merge(Data1=box, Data2=box)
panel_6 = Panel(rep.Representation)
typ = OppinionatedType(
    path=concat_2,
    na="capsule",
    description="some capsule",
    variant=item_2.Item4,
    de=box,
    paper=box,
    collider=box,
    volume=box,
    group=merge_3,
    rp=rep.Representation,
    po=por.Port,
    authors=aut.Author,
    qualities=qal.Quality,
    ex=Toggle(False))  # -> ty_2, ba_2
save_representation = BooleanToggle(False)
panel_7 = Panel("""\
/
q
p
J
L
s
z""")
variant = Slider(0, range=0..7)
icon_export = BooleanToggle(False)
panel_8 = Panel([typ.ty_2, typ.ba_2])
validate = BooleanToggle(False)
save = BooleanToggle(False)
dir_2 = Directory()  # -> D; same code as dir
sep_2 = Separator()  # -> S; same code as sep
and = GateAnd(A=save, B=icon_export)
and_2 = GateAnd(A=save, B=save_representation)
loop_slider = PythonScript(SliderToModify=variant, Min="0", Max="7", stepSize="1", Delay=Slider(0, range=0..1), Run=Toggle(False), Reset=Button())  # inputs Run: Boolean, Reset: Boolean
# ---------- loop_slider: Python ----------
import time

def updateSliderInput(inputName,min,max,value,decimalPlace=2):
    for input in ghenv.Component.Params.Input:
        for source in input.Sources:
            if input.Name == str(inputName):
                source.Slider.DecimalPlaces = decimalPlace
                source.Slider.Minimum = min
                source.Slider.Maximum = max
                source.Slider.Value = value
                source.ExpireSolution(True)

def countDecimal(number):
    string= str(number)
    return string[::-1].find('.')

if Run == True:
    if SliderToModify < Max:
        time.sleep(Delay)
        updateSliderInput("SliderToModify",Min,Max,SliderToModify+stepSize,countDecimal(stepSize))
if Reset == True:
    updateSliderInput("SliderToModify",Min,Max,Min)
# ---------- end loop_slider ----------
par_3 = ParentDirectory(D=dir_2)  # -> P; inputs D: String; same code as par
item_3 = ListItem(List=panel_7, Index=variant, Wrap=True)
variant_2 = GetString(item_3, AtLeast=0, AtMost=1, TreeAccess=False)
panel_9 = Panel("""backslash
slash
q
p
J
L
s
z""")
itemindex = ItemIndex(L=panel_7, I=variant_2)  # -> i; inputs L: list
# ---------- itemindex: Python ----------
#Component Information
#--------------------------------------------------------------------------------------------
if ghenv.Component.RunCount<2:
    #General
    #--------------------------------------------------------------------------------------------
    __author__ = "Ueli Saluz"
    __version__ = "2022.11.18"
    
    ghenv.Component.Name = "ItemIndex"
    ghenv.Component.NickName = "ItemIndex"
    ghenv.Component.Description = "A better IdemIndex"
    ghenv.Component.Message = "VER 1.0"
    ghenv.Component.Category = "Set"
    ghenv.Component.SubCategory = "List"
    
     #Inputs
    #--------------------------------------------------------------------------------------------
    inputIndex=0
    
    ghenv.Component.Params.Input[inputIndex].Name = "List"
    ghenv.Component.Params.Input[inputIndex].NickName = "L"
    ghenv.Component.Params.Input[inputIndex].Description = "Input1 is..."
    ghenv.Component.Params.Input[inputIndex].Optional = False
    inputIndex+=1
    
    ghenv.Component.Params.Input[inputIndex].Name = "Item"
    ghenv.Component.Params.Input[inputIndex].NickName = "I"
    ghenv.Component.Params.Input[inputIndex].Description = "Input2 is..."
    ghenv.Component.Params.Input[inputIndex].Optional = False
    inputIndex+=1
    
    #Outputs
    #--------------------------------------------------------------------------------------------
    outputIndex=0
    
    ghenv.Component.Params.Output[outputIndex].Name = "Index"
    ghenv.Component.Params.Output[outputIndex].NickName = "i"
    ghenv.Component.Params.Output[outputIndex].Description = "Output1 is..."
    outputIndex+=1

i = L.index(I)
# ---------- end itemindex ----------
zoom = Button()
item_4 = ListItem(List=panel_9, Index=itemindex, Wrap=True)
merge_4 = Merge(Data1="F", Data2="T", Data3="F", Data4="T", Data5="F", Data6="T", Data7="F", Data8="T")
merge_5 = Merge(Data1="front", Data2="front", Data3="side", Data4="side", Data5="front", Data6="front", Data7="side", Data8="side")
merge_6 = Merge(Data1="back", Data2="back", Data3="back", Data4="back", Data5="side", Data6="side", Data7="side", Data8="side")
toggle = BooleanToggle(False)
item_5 = ListItem(List=merge_6, Index=itemindex, Wrap=True)
item_6 = ListItem(List=merge_4, Index=itemindex, Wrap=True)
list = ValueList({"Front", "Side"}, selected="Front")
item_7 = ListItem(List=merge_5, Index=itemindex, Wrap=True)
list_2 = ValueList({"Back": "back", "Side": "side"}, selected="Back")
expression = Expression(x=Slider(420, range=0..1000), Expression="x/100")
expression_2 = Expression(x=Slider(260, range=0..1000), Expression="x/100")
expression_3 = Expression(x=Slider(250, range=0..1000), Expression="x/100")
entrance = Text(item_5)
view = Text(item_7)
mirror = Boolean(item_6)

panel_10 = Panel("An apartment capsule for one person. It has the entrance on the ")
filter = StreamFilter(Gate=mirror, Stream1=" It is mirrored compared to the normal one.")
concat_3 = Concatenate(
    FragmentA=panel_10,
    FragmentB=entrance,
    FragmentC=" and has the view to the ",
    FragmentD=view,
    FragmentF=".",
    FragmentE=filter)

length_m = Number(expression)
height_m = Number(expression_3)
width_m = Number(expression_2)
panel_11 = Panel("""round
rectangular""")
panel_12 = Panel("""front
side""")
panel_13 = Panel("""back
side""")
_2d = _2D(x=length_m)
_2d_2 = _2D(x=width_m)
mirrored = Boolean(mirror)
itemindex_2 = ItemIndex(L=panel_13, I=entrance)  # -> i; inputs L: list; same code as itemindex
itemindex_3 = ItemIndex(L=panel_12, I=view)  # -> i; inputs L: list; same code as itemindex
rectangle = Rectangle(Plane=PlaneXY(0, 0, 0), XSize=_2d, YSize=_2d_2, Radius=0)  # -> Rectangle, Length
valueor0 = ValueOr0(value=itemindex_2)
valueor0_2 = ValueOr0(value=itemindex_3)

aut_2 = ModelAuthor(Name="Ueli Saluz", Email="ueli@semio-tech.org")  # -> Author, Valid, Name, Email

expression_4 = Expression(x=Slider(20, range=0..100), Expression="x/100")
expression_5 = Expression(x=Slider(25, range=0..100), Expression="x/100")
entrance_2 = Integer(valueor0)
entrance_3 = Integer(entrance_2)
multiplication = Multiplication(A=entrance_3, B="4")
view_2 = Integer(valueor0_2)
view_3 = Integer(view_2)
multiplication_2 = Multiplication(A=view_3, B="2")
addition = Addition(A=multiplication, B=multiplication_2, C=mirrored)
variant_3 = Integer(addition)

panel_14 = Panel("""6f52c1e6b1
45ab357369
e6c366306e
f16baa9eba
9442aab847
29526c7d12
b3a9105a14
ff37b776dd
b7243eed93
5004160f7d
b8c26ca1c9
a6e1f7d736
0da1e26dff
a3b1c730a1
c696cc23a3
532cc5697c""")
dup = DuplicateData(Data="2", Number="8", Order=True)
concat_4 = Concatenate(FragmentA="https://app.speckle.systems/projects/e7de1a2f8f/models/", FragmentB=panel_14)
trim = TrimTree(Tree=dup, Depth=1)
partition = PartitionList(List=concat_4, Size=trim)
tstat = TreeStatistics(Tree=partition)  # -> Paths, Length, Count
item_8 = ListItem(List=flatten(tstat.Paths), Index=variant_3, Wrap=True)
branch = TreeBranch(Tree=partition, Path=item_8, MaintainPaths=True)
item_9 = ListItem(List=flatten(branch), Index=0, Wrap=True)  # -> Item, Item1

concat_5 = Concatenate(FragmentC="capsule", FragmentD="_", FragmentA=item_4)
mime = ValueList({".stl": "model/stl", ".obj": "model/obj", ".glb": "model/gltf-binary", ".gltf": "model/gltf+json", ".3dm": "model/vnd.3dm", ".speckle": "model/vnd.speckle+json", ".png": "image/png", ".jpg": "image/jpeg", ".jpeg": "image/jpeg", ".svg": "image/svg+xml", ".pdf": "application/pdf", ".zip": "application/zip", ".json": "application/json", ".csv": "text/csv", ".txt": "text/plain"}, selected=".speckle")
concat_6 = Concatenate(FragmentA=concat_5, FragmentB="_", FragmentE="1to200", FragmentG="_", FragmentF="volume")
concat_7 = Concatenate(FragmentA=concat_5, FragmentB="_", FragmentE="1to500", FragmentG="_", FragmentF="volume")
concat_8 = Concatenate(FragmentC="representations", FragmentD=sep_2, FragmentA=concat_6)
concat_9 = Concatenate(FragmentC="representations", FragmentD=sep_2, FragmentA=concat_5)
concat_10 = Concatenate(FragmentC="representations", FragmentD=sep_2, FragmentA=concat_7)
concat_11 = Concatenate(FragmentA=concat_8, FragmentB=".3dm")
concat_12 = Concatenate(FragmentA=concat_9, FragmentB=".glb")
concat_13 = Concatenate(FragmentA=concat_10, FragmentB=".3dm")
rep_2 = ModelRepresentation(Validate=validate, Url=concat_13, Lod="1to500", Tags="volume")  # -> Representation, Valid, Url, Mime, Lod, Tags
rep_3 = ModelRepresentation(Validate=validate, Url=concat_12)  # -> Representation, Valid, Url, Mime, Lod, Tags
rep_4 = ModelRepresentation(Validate=validate, Url=concat_11, Lod="1to200", Tags="volume")  # -> Representation, Valid, Url, Mime, Lod, Tags
trim_2 = TrimTree(Tree=rep_4.Tags, Depth=1)
trim_3 = TrimTree(Tree=rep_2.Tags, Depth=1)
rep_5 = ModelRepresentation(Validate=validate, Url=item_9.Item1, Mime=mime, Lod=rep_4.Lod, Tags=trim_2)  # -> Representation, Valid, Url, Mime, Lod, Tags
rep_6 = ModelRepresentation(Validate=validate, Url=item_9.Item, Mime=mime, Lod=rep_2.Lod, Tags=trim_3)  # -> Representation, Valid, Url, Mime, Lod, Tags
merge_7 = Merge(
    Data1=rep_3.Representation,
    Data4=rep_2.Representation,
    Data5=rep_6.Representation,
    Data6=rep_4.Representation,
    Data7=rep_5.Representation)

panel_15 = Panel([concat_12, concat_13, item_9.Item, concat_11, item_9.Item1])
panel_16 = Panel(item_9.Item)
panel_17 = Panel(merge_7)

concat_14 = Concatenate(FragmentA="images/", FragmentB=concat_5, FragmentC=".png")

fillet_radius_m = Number(expression_5)
shellthickness_m = Number(expression_4)
subtraction = Subtraction(A=height_m, B=shellthickness_m)
neg = Negative(Value=shellthickness_m)
dom = ConstructDomain(DomainStart=neg, DomainEnd=subtraction)
box_2 = DomainBox(Base=PlaneXY(0, 0, 0), X=_2d_2, Y=_2d, Z=dom)
volume1to500 = Box(box_2)
debrep = DeconstructBrep(Brep=volume1to500)  # -> Faces, Edges, Vertices
bool = Boolean(invert(mirror))
trim_4 = TrimTree(Tree=debrep.Edges, Depth=1)
trim_5 = TrimTree(Tree=debrep.Faces, Depth=1)
filter_2 = StreamFilter(Gate=entrance_2, Stream0=mirror, Stream1=bool)
item_10 = ListItem(List=trim_5, Index=0, Wrap=True)  # -> Item, Item1, Item2, Item3, Item4, Item5
list_3 = ValueList({"Round": "round", "Rectangular": "rectangular"}, selected="Round")
mirror_2 = Boolean(filter_2)
mirrored_2 = Boolean(mirror_2)
addition_2 = Addition(A=multiplication, B=multiplication_2, C=mirrored_2)
oldvariant = Integer(addition_2)

lng = ListLength(List=debrep.Edges)
series = Series(Start=0, Step=1, Count=lng)
trim_6 = TrimTree(Tree=series, Depth=1)
filedge = FilletEdge(Shape=volume1to500, Blend=0, Metric=0, Edges=trim_6, Radii=fillet_radius_m)
trim_7 = TrimTree(Tree=filedge, Depth=1)

expression_6 = Expression(x=Slider(30, range=0..100), Expression="x/100")
expression_7 = Expression(x=Slider(65, range=0..100), Expression="x/100")
window_shape = Text(list_3)
itemindex_4 = ItemIndex(L=panel_11, I=window_shape)  # -> i; inputs L: list; same code as itemindex
valueor0_3 = ValueOr0(value=itemindex_4)
windowshape = Integer(valueor0_3)
window_circle_radius_m = Number(expression_7)
window_offset_wall_m = Number(expression_6)
panel_18 = Panel(concat_4)
expression_8 = Expression(x=Slider(80, range=0..100), Expression="x/100")
expression_9 = Expression(x=Slider(200, range=0..1000), Expression="x/100")
expression_10 = Expression(x=Slider(25, range=0..100), Expression="x/100")
panel_19 = Panel("Parallel")  # disabled
door_width_m = Number(expression_8)
door_offset_wall_m = Number(expression_10)
door_height_m = Number(expression_9)

item_11 = ListItem(List=trim_4, Index=0, Wrap=True)  # -> Item, Item1, Item2, Item3
flip = FlipCurve(Curve=item_11.Item)  # -> Curve, Flag
filter_3 = StreamFilter(Gate=mirror_2, Stream0=flip.Curve, Stream1=item_11.Item)
filter_4 = StreamFilter(Gate=mirror_2, Stream0=item_10.Item1, Stream1=item_10.Item3)
filter_5 = StreamFilter(Gate=entrance_2, Stream0=filter_3, Stream1=item_11.Item1)
filter_6 = StreamFilter(Gate=entrance_2, Stream0=item_10.Item, Stream1=filter_4)
addition_3 = Addition(A=door_offset_wall_m, B=shellthickness_m)
eval = EvaluateLength(Curve=filter_5, Length=addition_3, Normalized=False)  # -> Point, Tangent, Parameter
srf_cp = SurfaceClosestPoint(Point=eval.Point, Surface=filter_6)  # -> Point, UVPoint, Distance
evalsrf = EvaluateSurface(Surface=filter_6, Point=srf_cp.UVPoint)  # -> Point, Normal, UDirection, VDirection, Frame
neg_2 = Negative(Value=door_width_m)
filter_7 = StreamFilter(Gate=entrance_2, Stream0=neg_2, Stream1=door_width_m)
filter_8 = StreamFilter(Gate=mirror_2, Stream0=filter_7, Stream1=door_width_m)
and_3 = GateAnd(A=entrance_2, B=mirror_2)
filter_9 = StreamFilter(Gate=and_3, Stream0=filter_8, Stream1=neg_2)
rectangle_2 = Rectangle(Plane=evalsrf.Frame, XSize=filter_9, YSize=door_height_m, Radius=0)  # -> Rectangle, Length
Z = UnitZ(Factor=shellthickness_m)
move = Move(Geometry=rectangle_2.Rectangle, Motion=Z)  # -> Geometry, Transform
door = Rectangle(move.Geometry)

flip_2 = FlipCurve(Curve=item_11.Item1)  # -> Curve, Flag
expression_11 = Expression(x=height_m, Expression="x/2")
filter_10 = StreamFilter(Gate=mirror_2, Stream0=item_11.Item3, Stream1=flip_2.Curve)
addition_4 = Addition(A=window_circle_radius_m, B=window_offset_wall_m, C=shellthickness_m)
Z_2 = UnitZ(Factor=expression_11)
filter_11 = StreamFilter(Gate=mirror_2, Stream0=item_10.Item3, Stream1=item_10.Item1)
eval_2 = EvaluateLength(Curve=filter_10, Length=addition_4, Normalized=False)  # -> Point, Tangent, Parameter
evalsrf_2 = EvaluateSurface(Surface=reparameterize(filter_11), Point="0.5,0.5")  # -> Point, Normal, UDirection, VDirection, Frame
move_2 = Move(Geometry=eval_2.Point, Motion=Z_2)  # -> Geometry, Transform
evalsrf_3 = EvaluateSurface(Surface=reparameterize(item_10.Item2), Point="0.5,0.5")  # -> Point, Normal, UDirection, VDirection, Frame
pl_origin = PlaneOrigin(Base=evalsrf_2.Frame, Origin=move_2.Geometry)
expression_12 = Expression(x=window_circle_radius_m, Expression="x*2")
filter_12 = StreamFilter(Gate=view_2, Stream0=evalsrf_3.Frame, Stream1=pl_origin)
_2d_3 = _2D(x=expression_12)
rectangle_3 = Rectangle(Plane=filter_12, XSize=_2d_3, YSize=_2d_3, Radius=0)  # -> Rectangle, Length
cir = Circle(Plane=filter_12, Radius=window_circle_radius_m)
filter_13 = StreamFilter(Gate=windowshape, Stream0=cir, Stream1=rectangle_3.Rectangle)
windowplane = Plane(filter_12)
window = Geometry(filter_13)

windowplane_2 = Plane(windowplane)
deplane = DeconstructPlane(Plane=windowplane_2)  # -> Origin, XAxis, YAxis, ZAxis
expression_13 = Expression(x=shellthickness_m, Expression="x/3")
neg_3 = Negative(Value=deplane.ZAxis)
amp = Amplitude(Vector=neg_3, Amplitude=expression_13)
extr = Extrude(Base=window, Direction=amp)
cap = CapHoles(Brep=extr)

m2d_rhino = Make2DRhinoView(Name=panel_19, Clip=True)  # disabled
number_slider = Slider(876, range=0..1000)  # disabled

srf = Surface(item_10.Item)
srf_2 = Surface(item_10.Item1)
srf_3 = Surface(item_10.Item3)
srf_4 = Surface(item_10.Item2)
srf_5 = Surface(item_10.Item4)
srf_6 = Surface(item_10.Item5)
mirrored_3 = Boolean(mirror_2)
mirrored_4 = Boolean(mirror_2)
filter_14 = StreamFilter(Gate=mirrored_3, Stream0=srf_2, Stream1=srf_3)
filter_15 = StreamFilter(Gate=mirrored_4, Stream0=srf_3, Stream1=srf_2)
merge_8 = Merge(Data1=srf_2, Data2=srf_3)
merge_9 = Merge(Data1=srf_2, Data2=srf)
merge_10 = Merge(Data1=srf, Data2=srf_4)
merge_11 = Merge(Data1=srf_2, Data2=srf_4)
merge_12 = Merge(Data1=srf_3, Data2=srf_4)
merge_13 = Merge(Data1=srf, Data2=srf_3)
entrance_4 = Integer(entrance_2)
window_2 = Integer(view_2)
filter_16 = StreamFilter(Gate=entrance_4, Stream0=srf, Stream1=filter_14)
filter_17 = StreamFilter(Gate=window_2, Stream0=srf_4, Stream1=filter_15)
filter_18 = StreamFilter(
    Gate=oldvariant,
    Stream0=merge_8,
    Stream1=merge_8,
    Stream2=merge_11,
    Stream3=merge_12,
    Stream4=merge_13,
    Stream5=merge_9,
    Stream6=merge_10,
    Stream7=merge_10)

view_rectangle = ViewRectangle(view=m2d_rhino)  # disabled
previewplane = PreviewPlane(plane=view_rectangle, axis_length=number_slider)  # disabled
construction_area_factor = Number(Slider(0.2, range=0..1))
construction_cost_eff_m² = Number(Slider(9500, range=0..20000))
income_month_eff_m² = Number(Slider(125, range=0..200))
maintenance_expenses_month_eff_m² = Number(Slider(10, range=0..30))

door_2 = Rectangle(door)
explode = Explode(Curve=door, Recursive=True)  # -> Segments, Vertices
trim_8 = TrimTree(Tree=explode.Segments, Depth=1)
item_12 = ListItem(List=trim_8, Index=0, Wrap=True)  # -> Item, Item1, Item2, Item3
eval_3 = EvaluateCurve(Curve=reparameterize(item_12.Item), Parameter="0.5")  # -> Point, Tangent, Angle
rev = Reverse(Vector=eval_3.Tangent)
Z_3 = UnitZ(Factor=1)
xprod = CrossProduct(VectorA=eval_3.Tangent, VectorB=Z_3, Unitize=False)  # -> Vector, Length
xprod_2 = CrossProduct(VectorA=rev, VectorB=Z_3, Unitize=False)  # -> Vector, Length
pl = ConstructPlane(Origin=eval_3.Point, XAxis=eval_3.Tangent, YAxis=xprod_2.Vector)
doorentranceplane = Plane(pl)

panel_20 = Panel("The middle of the main entrance door of the upper entrance floor.")
por_2 = ModelPort(Validate=validate, Description=panel_20, Point=eval_3.Point, Direction=xprod.Vector, Locators="entrance")  # -> Port, Valid, Id, Description, Point, Direction, Locators, Direction_2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

prv = PreviewPort(po=por_2.Port)

doorentranceplane_2 = Plane(doorentranceplane)
deplane_2 = DeconstructPlane(Plane=doorentranceplane_2)  # -> Origin, XAxis, YAxis, ZAxis
amp_2 = Amplitude(Vector=deplane_2.YAxis, Amplitude=shellthickness_m)
extr_2 = Extrude(Base=door, Direction=amp_2)
cap_2 = CapHoles(Brep=extr_2)

merge_14 = Merge(Data1=cap_2, Data2=cap)
sdiff = SolidDifference(BrepsA=trim_7, BrepsB=merge_14)

rec = Rectangle({Plane=Plane(origin=(15.60693884, 14.69292436, 15.6245417), x=(0.7071067812, -0.7071067812, 0), y=(-0.4082482905, -0.4082482905, 0.8164965809)), Size=Domain2(u=-24.40970167..24.40970167, v=-18.06498235..18.06498235)})
m2d_parallel = Make2DParallelView(Projection=rec)
make2d = Make2D(Geometry=cap_2, View=m2d_parallel, TangentEdges=False, TangentSeams=False, AutoComputeMake2D=True)  # -> VisibleCurves, VisibleIndex, VisibleType, HiddenCurves, HiddenIndex, HiddenType
make2d_2 = Make2D(Geometry=cap, View=m2d_parallel, TangentEdges=False, TangentSeams=False, AutoComputeMake2D=True)  # -> VisibleCurves, VisibleIndex, VisibleType, HiddenCurves, HiddenIndex, HiddenType
make2d_3 = Make2D(Geometry=trim_7, View=m2d_parallel, TangentEdges="T", TangentSeams=False, AutoComputeMake2D=True)  # -> VisibleCurves, VisibleIndex, VisibleType, HiddenCurves, HiddenIndex, HiddenType
trim_9 = TrimTree(Tree=make2d_3.VisibleCurves, Depth=1)
trim_10 = TrimTree(Tree=make2d.VisibleCurves, Depth=1)
merge_15 = Merge(Data1=make2d_2.VisibleCurves, Data2=make2d_2.HiddenCurves)
trim_11 = TrimTree(Tree=merge_15, Depth=1)
shell = Geometry(trim_9)
door_3 = Geometry(trim_10)
window_3 = Geometry(trim_11)

volume1to200 = Brep(sdiff)
bbox = BoundingBox(Content=flatten(volume1to200), Plane=PlaneXY(0, 0, 0), UnionBox=True)  # -> Box, Box_2
zoom2bb = ZoomToBoundingBox(N=["Top", "Front", "Right", "Perspective", "Parallel"], BB=bbox.Box, S=0, R=zoom)  # -> F, SBB; inputs BB: Box, R: Boolean
# ---------- zoom2bb: Python ----------
#Component Information
#--------------------------------------------------------------------------------------------
if ghenv.Component.RunCount<2:
    #General
    #--------------------------------------------------------------------------------------------
    __author__ = "Ueli Saluz"
    __version__ = "2022.05.21"
    
    ghenv.Component.Name = "ZoomToBoundingBox"
    ghenv.Component.NickName = "Zoom2BB"
    ghenv.Component.Description = "Zoom the view of a Rhino viewport to a bounding box."
    ghenv.Component.Message = "VER 1.1"
    ghenv.Component.Category = "Display"
    ghenv.Component.SubCategory = "Camera"
    
     #Inputs
    #--------------------------------------------------------------------------------------------
    inputIndex=0
    
    ghenv.Component.Params.Input[inputIndex].Name = "Name"
    ghenv.Component.Params.Input[inputIndex].NickName = "N"
    ghenv.Component.Params.Input[inputIndex].Description = "Name of the viewport"
    ghenv.Component.Params.Input[inputIndex].Optional = False
    inputIndex+=1
    
    ghenv.Component.Params.Input[inputIndex].Name = "BoundingBox"
    ghenv.Component.Params.Input[inputIndex].NickName = "BB"
    ghenv.Component.Params.Input[inputIndex].Description = ""
    ghenv.Component.Params.Input[inputIndex].Optional = False
    inputIndex+=1
    
    ghenv.Component.Params.Input[inputIndex].Name = "ScaleFactor"
    ghenv.Component.Params.Input[inputIndex].NickName = "S"
    ghenv.Component.Params.Input[inputIndex].Description = "A factor for the extension of the bounding box." \
    +"0 means 0 extension, a positive number makes the bounding box larger a negative smaller. The amount is proportional to the length."
    ghenv.Component.Params.Input[inputIndex].Optional = False
    inputIndex+=1
   
    
    ghenv.Component.Params.Input[inputIndex].Name = "Run"
    ghenv.Component.Params.Input[inputIndex].NickName = "R"
    ghenv.Component.Params.Input[inputIndex].Description = "Zoom to the given bounding box."
    ghenv.Component.Params.Input[inputIndex].Optional = False
    inputIndex+=1
    
    #Outputs
    #--------------------------------------------------------------------------------------------
    outputIndex=0
    
    ghenv.Component.Params.Output[outputIndex].Name = "Finished"
    ghenv.Component.Params.Output[outputIndex].NickName = "F"
    ghenv.Component.Params.Output[outputIndex].Description = "Sends True when finished. Just to trigger other depending components."
    outputIndex+=1
    
    ghenv.Component.Params.Output[outputIndex].Name = "ScaledBoundingBox"
    ghenv.Component.Params.Output[outputIndex].NickName = "SBB"
    ghenv.Component.Params.Output[outputIndex].Description = "The scaled bounding box."
    outputIndex+=1


#Imports
#--------------------------------------------------------------------------------------------
from Rhino import RhinoDoc
from Rhino.Geometry import Box

#Solver - Run with trees to enhance performance drastically
#--------------------------------------------------------------------------------------------
if __name__ == "__main__":
    try:
        vp = RhinoDoc.ActiveDoc.Views.Find(N, False).ActiveViewport
        if R:
            box = BB
            bb = BB.BoundingBox
            bb.Inflate(S*box.X.Length,S*box.Y.Length,S*box.Z.Length)
            vp.ZoomBoundingBox(bb)
            SBB = bb
        F = True
    except:
        pass
# ---------- end zoom2bb ----------
merge_16 = Merge(Data1=door, Data2=window)
merge_17 = Merge(Data1=filter_16, Data2=filter_17)
sdiff_2 = SolidDifference(BrepsA=merge_17, BrepsB=merge_16)
merge_18 = Merge(Data1=srf_5, Data2=filter_18, Data3=sdiff_2, Data4=srf_6)
shell_2 = Surface(merge_18)
heating_energy_demand_kwh_m²a = Number(Slider(45, range=0..200))
cooling_energy_demand_kwh_m²a = Number(Slider(30, range=0..200))
technical_equipment_energy_demand_kwh_m² = Number(Slider(30, range=0..200))  # "Technical Equipment Energy Demand[kWh/m²a]"
construction_global_warming_potential_kg = Number(Slider(1000, range=0..2000))  # "Construction Global Warming Potential [kgCO2e/eff. m²]"

maintenance_expenses_month_eff_m²_2 = Number(maintenance_expenses_month_eff_m²)
construction_global_warming_potential_kg_2 = Number(construction_global_warming_potential_kg)  # "Construction Global Warming Potential [kgCO2e/eff. m²]"
construction_area_factor_2 = Number(construction_area_factor)
technical_equipment_energy_demand_kwh_m²_2 = Number(technical_equipment_energy_demand_kwh_m²)  # "Technical Equipment Energy Demand[kWh/m²a]"
income_month_eff_m²_2 = Number(income_month_eff_m²)
heating_energy_demand_kwh_m²a_2 = Number(heating_energy_demand_kwh_m²a)
cooling_energy_demand_kwh_m²a_2 = Number(cooling_energy_demand_kwh_m²a)
construction_cost_eff_m²_2 = Number(construction_cost_eff_m²)
expression_14 = Expression(x=construction_area_factor_2, Expression="1-x")
area = Area(Geometry=rectangle.Rectangle)  # -> Area, Centroid
multiplication_3 = Multiplication(A=area.Area, B=expression_14)
multiplication_4 = Multiplication(A=multiplication_3, B=income_month_eff_m²_2)
multiplication_5 = Multiplication(A=multiplication_3, B=maintenance_expenses_month_eff_m²_2)
expression_15 = Expression(x=multiplication_4, Expression="x*12")
expression_16 = Expression(x=multiplication_5, Expression="x*12")
multiplication_6 = Multiplication(A=multiplication_3, B=construction_global_warming_potential_kg_2)
multiplication_7 = Multiplication(A=heating_energy_demand_kwh_m²a_2, B=multiplication_3)
multiplication_8 = Multiplication(A=cooling_energy_demand_kwh_m²a_2, B=multiplication_3)
multiplication_9 = Multiplication(A=multiplication_3, B=construction_cost_eff_m²_2)
multiplication_10 = Multiplication(A=technical_equipment_energy_demand_kwh_m²_2, B=multiplication_3)
roundmult = RoundToMultiple(N=multiplication_3, M="0.01")  # -> R; inputs N: tree, M: tree
# ---------- roundmult: Python ----------
#Component Information
#--------------------------------------------------------------------------------------------
if ghenv.Component.RunCount<2:
    #General
    #--------------------------------------------------------------------------------------------
    __author__ = "YOUR NAME"
    __version__ = "2000.00.00"
    
    ghenv.Component.Name = "Round to Multiple"
    ghenv.Component.NickName = "RoundMult"
    ghenv.Component.Description = "Rounds a number to the nearest specified multiple."
    ghenv.Component.Message = "VER 1.0"
    ghenv.Component.Category = "Math"
    ghenv.Component.SubCategory = "Arithmetic"
    
     #Inputs
    #--------------------------------------------------------------------------------------------
    inputIndex=0
    
    ghenv.Component.Params.Input[inputIndex].Name = "Number"
    ghenv.Component.Params.Input[inputIndex].NickName = "N"
    ghenv.Component.Params.Input[inputIndex].Description = "Number to round."
    ghenv.Component.Params.Input[inputIndex].Optional = False
    inputIndex+=1
    
    ghenv.Component.Params.Input[inputIndex].Name = "Multiple"
    ghenv.Component.Params.Input[inputIndex].NickName = "M"
    ghenv.Component.Params.Input[inputIndex].Description = "Multiple to round to."
    ghenv.Component.Params.Input[inputIndex].Optional = False
    inputIndex+=1
    
    #Outputs
    #--------------------------------------------------------------------------------------------
    outputIndex=0
    
    ghenv.Component.Params.Output[outputIndex].Name = "Rounded"
    ghenv.Component.Params.Output[outputIndex].NickName = "R"
    ghenv.Component.Params.Output[outputIndex].Description = "Number rounded to the nearest specified multiple."
    outputIndex+=1


#Imports
#--------------------------------------------------------------------------------------------
from System import Object
from Grasshopper import DataTree
import math


#The Component function - Business logic only (e.g. working without trees)
#--------------------------------------------------------------------------------------------
"""Function that this component is computing.
    Inputs:
        number: The number to round.
        multiple: The multiple to round to.
    Output:
        rounded: The number rounded to the nearest specified multiple."""
def RoundToMultiple(number, multiple):
    rounded = math.ceil(number / multiple) * multiple
    return rounded

#Solver - Run with trees to enhance performance drastically
#--------------------------------------------------------------------------------------------
if __name__ == "__main__":
    
    #Initialize trees
    #--------------------------------------------------------------------------------------------
    RoundedTree = DataTree[Object]()
    
    #Data matching
    #--------------------------------------------------------------------------------------------
    for path in N.Paths:
        numberBranch = N.Branch(path)
        for i, number in enumerate(numberBranch):
            multiple = M.Branch(path)[i]
            rounded = RoundToMultiple(number, multiple)
            RoundedTree.Add(rounded, path)
    
     #Assign trees to output
    #--------------------------------------------------------------------------------------------
    R = RoundedTree
# ---------- end roundmult ----------
round = Round(Number=multiplication_9)  # -> Nearest, Floor, Ceiling
roundmult_2 = RoundToMultiple(N=multiplication_6, M="0.01")  # -> R; inputs N: tree, M: tree; same code as roundmult
round_2 = Round(Number=multiplication_7)  # -> Nearest, Floor, Ceiling
round_3 = Round(Number=multiplication_8)  # -> Nearest, Floor, Ceiling
round_4 = Round(Number=multiplication_10)  # -> Nearest, Floor, Ceiling
round_5 = Round(Number=expression_15)  # -> Nearest, Floor, Ceiling
round_6 = Round(Number=expression_16)  # -> Nearest, Floor, Ceiling
merge_19 = Merge(
    Data1=entrance,
    Data2=view,
    Data3=length_m,
    Data4=width_m,
    Data5=height_m,
    Data6=window_shape,
    Data7=roundmult,
    Data8=round.Nearest,
    Data9=round_2.Nearest,
    Data10=round_3.Nearest,
    Data11=round_4.Nearest,
    Data12=round_5.Nearest,
    Data13=round_6.Nearest,
    Data14=roundmult_2)
panel_21 = Panel("""https://search.bsdd.buildingsmart.org/uri/buildingsmart/ifc/4.3/prop/Length
https://search.bsdd.buildingsmart.org/uri/buildingsmart/ifc/4.3/prop/Width
https://search.bsdd.buildingsmart.org/uri/buildingsmart/ifc/4.3/prop/Height

https://identifier.buildingsmart.org/uri/buildingsmart/ifc/4.3/prop/NetFloorArea

https://identifier.buildingsmart.org/uri/buildingsmart/ifc/4.3/prop/EnergyConsumption
https://identifier.buildingsmart.org/uri/buildingsmart/ifc/4.3/prop/EnergyConsumption
https://identifier.buildingsmart.org/uri/buildingsmart/ifc/4.3/prop/EnergyConsumption


https://identifier.buildingsmart.org/uri/etim/etim/9.0/prop/EF016979 """)
panel_22 = Panel("""entrance
view
length
width
heigth
window shape
effective floor area
construction cost
heating energy demand
cooling energy demand
technical equipment energy demand
income
maintenance expenses
construction global warming potential""")
panel_23 = Panel(merge_19)
panel_24 = Panel("""m
m
m

m²
€
kWh/a
kWh/a
kWh/a
€/a
€/a
kgCO2e""")
qal_2 = ModelQuality(Validate=validate, Name=panel_22, Value=panel_23, Unit=panel_24, Definition=panel_21)  # -> Quality, Valid, Name, Value, Unit, Definition
# Outputs   ->
#                 |
#                 v
panel_25 = Panel("mirrored")
filter_19 = StreamFilter(Gate=mirror, Stream1=panel_25)
merge_20 = Merge(Data1=qal_2.Quality, Data2=filter_19)

concat_15 = Concatenate(FragmentA="icons/", FragmentB=concat_5, FragmentC=".svg")
typ_2 = ModelType(
    Validate=validate,
    Name="Capsule",
    Description=concat_3,
    Icon=concat_15,
    Image=concat_14,
    Variant=variant_2,
    Unit="m",
    Representations=merge_7,
    Ports=por_2.Port,
    Qualities=merge_20,
    Authors=aut_2.Author)  # -> Type, Valid, Name, Description, Icon, Image, Variant, Unit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
typ_3 = PutType(Type=typ_2.Type, Uri=par_3, Run=save)

volume1to200_2 = Brep(volume1to200)
concat_16 = Concatenate(FragmentA=par_3, FragmentB=sep_2, FragmentC=concat_13)
shell_3 = Surface(shell_2)
door_4 = Surface(door)
window_4 = Surface(window)
expression_17 = Expression(x="shell", y=shell_3, Expression="x")
concat_17 = Concatenate(FragmentA=par_3, FragmentB=sep_2, FragmentC=concat_11)
merge_21 = Merge(Data1=shell_3, Data2=window_4, Data3=door_4)
merge_22 = Merge(Data1=expression_17, Data2="window", Data3="door")
blc = ExportBlock_3(path=concat_16, name=concat_7, url=concat_13, geo=merge_21, layer_name=merge_22, export=and_2)  # -> block_definition_3, path_4, exported_2
blc_2 = ExportBlock_3(path=concat_17, name=concat_6, url=concat_11, geo=volume1to200_2, layer_name="volume", export=and_2)  # -> block_definition_3, path_4, exported_2

geo = GeometryPreview(geo=volume1to200_2)
typ_4 = SerializeType(Type=typ_2.Type)
txt = EncodeText(Text=typ_4, Mode=0)

expression_18 = Expression(x="shell", y=shell, Expression="x")
expression_19 = Expression(x="window", y=window_3, Expression="x")
expression_20 = Expression(x="door", y=door_3, Expression="x")
merge_23 = Merge(Data1=expression_18, Data2=expression_20, Data3=expression_19)
merge_24 = Merge(Data1=shell, Data2=door_3, Data3=window_3)
concat_18 = Concatenate(FragmentA=concat_5, FragmentB="_", FragmentC="icon")
concat_19 = Concatenate(FragmentC="icons", FragmentD=sep_2, FragmentA=concat_5)
concat_20 = Concatenate(FragmentA=concat_19, FragmentB=".3dm")
concat_21 = Concatenate(FragmentA=par_3, FragmentB=sep_2, FragmentC=concat_20)
blc_3 = ExportBlock_3(path=concat_21, name=concat_18, url=concat_20, geo=merge_24, layer_name=merge_23, export=and)  # -> block_definition_3, path_4, exported_2

type = Text(txt)
context_bake = ContextBake(Geometry=type)
sep_3 = Separator()  # -> S; same code as sep
dir_3 = Directory()  # -> D; same code as dir
# ^                                    ^
#    |                                     |
# <-- Constants    Preview -->
# Parameters    External    Local -->
# <-- Meta               |
#      |                       v
#      v
par_4 = ParentDirectory(D=dir_3)  # -> P; inputs D: String; same code as par

# ---- group: Speckle Representationlinks
panel_26 = Panel("""6f52c1e6b1
45ab357369
e6c366306e
f16baa9eba
9442aab847
29526c7d12
b3a9105a14
ff37b776dd
b7243eed93
5004160f7d
b8c26ca1c9
a6e1f7d736
0da1e26dff
a3b1c730a1
c696cc23a3
532cc5697c""")
dup_2 = DuplicateData(Data="2", Number="8", Order=True)
concat_22 = Concatenate(FragmentA="https://app.speckle.systems/projects/e7de1a2f8f/models/", FragmentB=panel_26)
trim_12 = TrimTree(Tree=dup_2, Depth=1)
partition_2 = PartitionList(List=concat_22, Size=trim_12)
tstat_2 = TreeStatistics(Tree=partition_2)  # -> Paths, Length, Count
item_13 = ListItem(List=flatten(tstat_2.Paths), Index=0, Wrap=True)
branch_2 = TreeBranch(Tree=partition_2, Path=item_13, MaintainPaths=True)
item_14 = ListItem(List=flatten(branch_2), Index=0, Wrap=True)  # -> Item, Item1

# ----
zoom_2 = Button()
bbox_2 = BoundingBox(Plane=PlaneXY(0, 0, 0), UnionBox=True)  # -> Box, Box_2
zoom2bb_2 = ZoomToBoundingBox(N=["Top", "Front", "Right", "Perspective", "Parallel"], BB=bbox_2.Box, S=0, R=zoom_2)  # -> F, SBB; inputs BB: Box, R: Boolean; same code as zoom2bb

# ---- group: Variant
save_representation_2 = BooleanToggle(False)
variant_4 = Slider(2, range=0..7)
panel_27 = Panel("""\
/
q
p
J
L
s
z""")
icon_export_2 = BooleanToggle(False)
validate_2 = BooleanToggle(False)
save_2 = BooleanToggle(False)
and_4 = GateAnd(A=save_2, B=icon_export_2)
and_5 = GateAnd(A=save_2, B=save_representation_2)
loop_slider_2 = PythonScript(SliderToModify=variant_4, Min="0", Max="7", stepSize="1", Delay=Slider(0, range=0..1), Run=Toggle(False), Reset=Button())  # inputs Run: Boolean, Reset: Boolean; same code as loop_slider
item_15 = ListItem(List=panel_27, Index=variant_4, Wrap=True)
panel_28 = Panel(item_15)
variant_5 = GetString(item_15, AtLeast=0, AtMost=1, TreeAccess=False)

# ---- group: Representations
panel_29 = Panel("_")
panel_30 = Panel(".3dm")
concat_23 = Concatenate(FragmentC="capsule", FragmentD=panel_29)
concat_24 = Concatenate(FragmentA=concat_23, FragmentB=panel_29, FragmentE="collider")
concat_25 = Concatenate(FragmentA=concat_23, FragmentB=panel_29, FragmentE="1to200")
concat_26 = Concatenate(FragmentA=concat_23, FragmentB=panel_29, FragmentE="1to500")
concat_27 = Concatenate(FragmentC="representations", FragmentD=sep_3, FragmentA=concat_23)
concat_28 = Concatenate(FragmentC="representations", FragmentD=sep_3, FragmentA=concat_26)
concat_29 = Concatenate(FragmentC="representations", FragmentD=sep_3, FragmentA=concat_25)
concat_30 = Concatenate(FragmentC="representations", FragmentD=sep_3, FragmentA=concat_24)
concat_31 = Concatenate(FragmentA=concat_27, FragmentB=".glb")
concat_32 = Concatenate(FragmentA=concat_28, FragmentB=panel_30)
concat_33 = Concatenate(FragmentA=concat_29, FragmentB=panel_30)
concat_34 = Concatenate(FragmentA=concat_30, FragmentB=panel_30)
concat_35 = Concatenate(FragmentA=concat_30, FragmentB=".glb")
rep_7 = ModelRepresentation(Validate=validate_2, Url=concat_31)  # -> Representation, Valid, Url, Description, Mime, Tags
rep_8 = ModelRepresentation(Validate=validate_2, Url=concat_33, Tags="1to200")  # -> Representation, Valid, Url, Description, Mime, Tags
rep_9 = ModelRepresentation(Validate=validate_2, Url=concat_32, Tags="1to500")  # -> Representation, Valid, Url, Description, Mime, Tags
rep_10 = ModelRepresentation(Validate=validate_2, Url=concat_35, Tags="collider")  # -> Representation, Valid, Url, Description, Mime, Tags
trim_13 = TrimTree(Tree=rep_8.Tags, Depth=1)
trim_14 = TrimTree(Tree=rep_9.Tags, Depth=1)
mime_2 = ValueList({".stl": "model/stl", ".obj": "model/obj", ".glb": "model/gltf-binary", ".gltf": "model/gltf+json", ".3dm": "model/vnd.3dm", ".speckle": "model/vnd.speckle+json", ".png": "image/png", ".jpg": "image/jpeg", ".jpeg": "image/jpeg", ".svg": "image/svg+xml", ".pdf": "application/pdf", ".zip": "application/zip", ".json": "application/json", ".csv": "text/csv", ".txt": "text/plain"}, selected=".speckle")
rep_11 = ModelRepresentation(Validate=validate_2, Url=item_14.Item1, Mime=mime_2, Tags=trim_13)  # -> Representation, Valid, Url, Description, Mime, Tags
rep_12 = ModelRepresentation(Validate=validate_2, Url=item_14.Item, Mime=mime_2, Tags=trim_14)  # -> Representation, Valid, Url, Description, Mime, Tags
merge_25 = Merge(
    Data1=rep_7.Representation,
    Data2=rep_9.Representation,
    Data3=rep_8.Representation,
    Data4=rep_12.Representation,
    Data5=rep_11.Representation,
    Data6=rep_10.Representation)

# ---- group: Qals
maintenance_expenses_month_eff_m²_3 = Number()
construction_global_warming_potential_kg_3 = Number()  # "Construction Global Warming Potential [kgCO2e/eff. m²]"
construction_area_factor_3 = Number()
technical_equipment_energy_demand_kwh_m²_3 = Number()  # "Technical Equipment Energy Demand[kWh/m²a]"
income_month_eff_m²_3 = Number()
heating_energy_demand_kwh_m²a_3 = Number()
cooling_energy_demand_kwh_m²a_3 = Number()
construction_cost_eff_m²_3 = Number()
expression_21 = Expression(x=construction_area_factor_3, Expression="1-x")
area_2 = Area()  # -> Area, Centroid
multiplication_11 = Multiplication(A=area_2.Area, B=expression_21)
multiplication_12 = Multiplication(A=multiplication_11, B=income_month_eff_m²_3)
multiplication_13 = Multiplication(A=multiplication_11, B=maintenance_expenses_month_eff_m²_3)
expression_22 = Expression(x=multiplication_12, Expression="x*12")
expression_23 = Expression(x=multiplication_13, Expression="x*12")
multiplication_14 = Multiplication(A=multiplication_11, B=construction_global_warming_potential_kg_3)
multiplication_15 = Multiplication(A=heating_energy_demand_kwh_m²a_3, B=multiplication_11)
multiplication_16 = Multiplication(A=cooling_energy_demand_kwh_m²a_3, B=multiplication_11)
multiplication_17 = Multiplication(A=multiplication_11, B=construction_cost_eff_m²_3)
multiplication_18 = Multiplication(A=technical_equipment_energy_demand_kwh_m²_3, B=multiplication_11)
# Outputs   ->
#                 |
#                 v
panel_31 = Panel("0.01")
roundmult_3 = RoundToMultiple(N=multiplication_11, M="0.01")  # -> R; inputs N: tree, M: tree; same code as roundmult
round_7 = Round(Number=multiplication_17)  # -> Nearest, Floor, Ceiling
roundmult_4 = RoundToMultiple(N=multiplication_14, M=panel_31)  # -> R; inputs N: tree, M: tree; same code as roundmult
round_8 = Round(Number=multiplication_15)  # -> Nearest, Floor, Ceiling
round_9 = Round(Number=multiplication_16)  # -> Nearest, Floor, Ceiling
round_10 = Round(Number=multiplication_18)  # -> Nearest, Floor, Ceiling
round_11 = Round(Number=expression_22)  # -> Nearest, Floor, Ceiling
round_12 = Round(Number=expression_23)  # -> Nearest, Floor, Ceiling
merge_26 = Merge(
    Data7=roundmult_3,
    Data8=round_7.Nearest,
    Data9=round_8.Nearest,
    Data10=round_9.Nearest,
    Data11=round_10.Nearest,
    Data12=round_11.Nearest,
    Data13=round_12.Nearest,
    Data14=roundmult_4)
panel_32 = Panel("""https://search.bsdd.buildingsmart.org/uri/buildingsmart/ifc/4.3/prop/Length
https://search.bsdd.buildingsmart.org/uri/buildingsmart/ifc/4.3/prop/Width
https://search.bsdd.buildingsmart.org/uri/buildingsmart/ifc/4.3/prop/Height

https://identifier.buildingsmart.org/uri/buildingsmart/ifc/4.3/prop/NetFloorArea

https://identifier.buildingsmart.org/uri/buildingsmart/ifc/4.3/prop/EnergyConsumption
https://identifier.buildingsmart.org/uri/buildingsmart/ifc/4.3/prop/EnergyConsumption
https://identifier.buildingsmart.org/uri/buildingsmart/ifc/4.3/prop/EnergyConsumption


https://identifier.buildingsmart.org/uri/etim/etim/9.0/prop/EF016979 """)
panel_33 = Panel("""entrance
view
length
width
heigth
window shape
effective floor area
construction cost
heating energy demand
cooling energy demand
technical equipment energy demand
income
maintenance expenses
construction global warming potential""")
panel_34 = Panel(merge_26)
panel_35 = Panel("""m
m
m

m²
€
kWh/a
kWh/a
kWh/a
€/a
€/a
kgCO2e""")
qal_3 = ModelQuality(Validate=validate_2, Name=panel_33, Value=panel_34, Unit=panel_35, Definition=panel_32)  # -> Quality, Valid, Name, Value, Unit, Definition
filter_20 = StreamFilter(Gate=0, Stream1="mirrored")
merge_27 = Merge(Data1=qal_3.Quality, Data2=filter_20)

# ---- group: ~Por
panel_36 = Panel("The middle of the main entrance door of the upper entrance floor.")
panel_37 = Panel("entrance")

# ---- group: ~Typ
aut_3 = ModelAuthor(Name="Ueli Saluz", Email="ueli@semio-tech.org")  # -> Author, Valid, Name, Email

concat_36 = Concatenate(FragmentA="images/", FragmentB=concat_23, FragmentC=".png")

# ----
rec_2 = Rectangle({Plane=Plane(origin=(15.60693884, 14.69292436, 15.6245417), x=(0.7071067812, -0.7071067812, 0), y=(-0.4082482905, -0.4082482905, 0.8164965809)), Size=Domain2(u=-24.40970167..24.40970167, v=-18.06498235..18.06498235)})
m2d_parallel_2 = Make2DParallelView(Projection=rec_2)
make2d_4 = Make2D(View=m2d_parallel_2, TangentEdges=False, TangentSeams=False, AutoComputeMake2D=True)  # -> VisibleCurves, VisibleIndex, VisibleType, HiddenCurves, HiddenIndex, HiddenType
make2d_5 = Make2D(View=m2d_parallel_2, TangentEdges=False, TangentSeams=False, AutoComputeMake2D=True)  # -> VisibleCurves, VisibleIndex, VisibleType, HiddenCurves, HiddenIndex, HiddenType
make2d_6 = Make2D(View=m2d_parallel_2, TangentEdges="T", TangentSeams=False, AutoComputeMake2D=True)  # -> VisibleCurves, VisibleIndex, VisibleType, HiddenCurves, HiddenIndex, HiddenType
trim_15 = TrimTree(Tree=make2d_6.VisibleCurves, Depth=1)
trim_16 = TrimTree(Tree=make2d_4.VisibleCurves, Depth=1)
merge_28 = Merge(Data1=make2d_5.VisibleCurves, Data2=make2d_5.HiddenCurves)
trim_17 = TrimTree(Tree=merge_28, Depth=1)
shell_4 = Geometry(trim_15)
door_5 = Geometry(trim_16)
window_5 = Geometry(trim_17)

panel_38 = Panel("Parallel")  # disabled
m2d_rhino_2 = Make2DRhinoView(Name=panel_38, Clip=True)  # disabled
number_slider_2 = Slider(876, range=0..1000)  # disabled

jagged = SettingsSpeed()
mesh = MeshBrep(Settings=jagged)
collider = Mesh(mesh)

move_3 = Move(Motion=Vector(0, 0, 10))  # -> Geometry, Transform
view_rectangle_2 = ViewRectangle(view=m2d_rhino_2)  # disabled
door_6 = Rectangle(move_3.Geometry)
previewplane_2 = PreviewPlane(plane=view_rectangle_2, axis_length=number_slider_2)  # disabled

door_7 = Rectangle(door_6)
explode_2 = Explode(Curve=door_6, Recursive=True)  # -> Segments, Vertices
trim_18 = TrimTree(Tree=explode_2.Segments, Depth=1)
item_16 = ListItem(List=trim_18, Index=0, Wrap=True)  # -> Item, Item1, Item2, Item3
eval_4 = EvaluateCurve(Curve=reparameterize(item_16.Item), Parameter="0.5")  # -> Point, Tangent, Angle
rev_2 = Reverse(Vector=eval_4.Tangent)
Z_4 = UnitZ(Factor=1)
xprod_3 = CrossProduct(VectorA=eval_4.Tangent, VectorB=Z_4, Unitize=False)  # -> Vector, Length
xprod_4 = CrossProduct(VectorA=rev_2, VectorB=Z_4, Unitize=False)  # -> Vector, Length
pl_2 = ConstructPlane(Origin=eval_4.Point, XAxis=eval_4.Tangent, YAxis=xprod_4.Vector)
doorentranceplane_3 = Plane(pl_2)

# ---- group: ~Por
panel_39 = Panel("""east
west""")
panel_40 = Panel("""west
east""")
panel_41 = Panel("An apartment capsule for one person. It has the entrance on the ")
item_17 = ListItem(List=panel_39, Index=0, Wrap=True)
item_18 = ListItem(List=panel_40, Index=0, Wrap=True)
concat_37 = Concatenate(FragmentA="door capsule", FragmentC=" ", FragmentB=item_17)
concat_38 = Concatenate(FragmentA="door tambour", FragmentC=" ", FragmentB=item_18)
filter_21 = StreamFilter(Gate=0, Stream1=" It is mirrored compared to the normal one.")
por_3 = ModelPort(
    Validate=validate_2,
    Description=panel_36,
    Family=concat_37,
    CompatibleFamilies=concat_38,
    Point=eval_4.Point,
    Direction=xprod_3.Vector,
    Qualities=panel_37)  # -> Port, Valid, Id, Description, Family, CompatibleFamilies, Point, Direction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
concat_39 = Concatenate(FragmentA=panel_41, FragmentC=" and has the view to the ", FragmentF=".", FragmentE=filter_21)

# ----
prv_2 = PreviewPort(po=por_3.Port)

# ---- group: ~Typ
concat_40 = Concatenate(FragmentA="icons/", FragmentB=concat_23, FragmentC=".svg")
typ_5 = ModelType(
    Validate=validate_2,
    Name="Capsule",
    Description=concat_39,
    Icon=concat_40,
    Image=concat_36,
    Variant=variant_5,
    Unit="m",
    Representations=merge_25,
    Ports=por_3.Port,
    Authors=aut_3.Author,
    Qualities=merge_27)  # -> Type, Valid, Name, Description, Icon, Image, Variant, Unit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
typ_6 = PutType(Type=typ_5.Type, Uri=par_4, Run=save_2)

# ----
typ_7 = SerializeType(Type=typ_5.Type)
txt_2 = EncodeText(Text=typ_7, Mode=0)
type_2 = Text(txt_2)
context_bake_2 = ContextBake(Geometry=type_2)
merge_29 = Merge(Data1=door_6)
merge_30 = Merge()
sdiff_3 = SolidDifference(BrepsA=merge_30, BrepsB=merge_29)
merge_31 = Merge(Data3=sdiff_3)
shell_5 = Surface(merge_31)

volume1to200_3 = Brep()
shell_6 = Surface(shell_5)
panel_42 = Panel("volume")
door_8 = Surface(door_6)
window_6 = Surface()
merge_32 = Merge(Data1=shell_6, Data2=window_6, Data3=door_8)
expression_24 = Expression(x="shell", y=shell_6, Expression="x")
merge_33 = Merge(Data1=expression_24, Data2="window", Data3="door")
concat_41 = Concatenate(FragmentA=par_4, FragmentB=sep_3, FragmentC=concat_32)
concat_42 = Concatenate(FragmentA=par_4, FragmentB=sep_3, FragmentC=concat_33)
concat_43 = Concatenate(FragmentA=par_4, FragmentB=sep_3, FragmentC=concat_34)
geo_2 = ExportGeometry(G=collider, R=and_5)  # -> S; inputs G: tree of GeometryBase, R: Boolean; same code as geo

geo_3 = PreviewGeometry(geo=volume1to200_3)

expression_25 = Expression(x="shell", y=shell_4, Expression="x")
expression_26 = Expression(x="window", y=window_5, Expression="x")
expression_27 = Expression(x="door", y=door_5, Expression="x")
merge_34 = Merge(Data1=expression_25, Data2=expression_27, Data3=expression_26)
merge_35 = Merge(Data1=shell_4, Data2=door_5, Data3=window_5)
concat_44 = Concatenate(FragmentA=concat_23, FragmentB=panel_29, FragmentC="icon")
concat_45 = Concatenate(FragmentC="icons", FragmentD=sep_3, FragmentA=concat_23)
concat_46 = Concatenate(FragmentA=concat_45, FragmentB=panel_30)
concat_47 = Concatenate(FragmentA=par_4, FragmentB=sep_3, FragmentC=concat_46)
blc_4 = ExportBlock_3(path=concat_47, name=concat_44, url=concat_46, geo=merge_35, layer_name=merge_34, export=and_4)  # -> block_definition_3, path_4, exported_2

# ==== cluster OppinionatedType: Construct a type following the oppinionated conventions of semio. All representations are saved under representations folder where each representation is saved once natively (.3dm) and once exported (.glb). Further a collider representation is required. All names and file names are standardized.
emoji = Panel("")
name = Panel("Default")
abbreviation = Panel("Dft?")
nn = Panel("De")
prm = ModelParam(Na=name, NN=nn, Dc="The optional default representation geometry group.", Op=Toggle(True), Ru=Toggle(True))  # -> Param, Name, NickName, Description, Optional, Success; inputs Pr: tree, Op: Boolean, Ru: Boolean
# ---------- prm: Python ----------
#Component Information
#--------------------------------------------------------------------------------------------
if ghenv.Component.RunCount<2:
    #General
    #--------------------------------------------------------------------------------------------
    __author__ = "Ueli Saluz"
    __version__ = "2025.06.18"
    
    ghenv.Component.Name = "Model Param"
    ghenv.Component.NickName = "~Prm"
    ghenv.Component.Description = "Deconstruct or modify a param."
    ghenv.Component.Message = "VER 1.0"
    ghenv.Component.Category = "semio"
    ghenv.Component.SubCategory = "Scripting"
    
     #Inputs
    #--------------------------------------------------------------------------------------------
    inputIndex=0
    
    ghenv.Component.Params.Input[inputIndex].Name = "Param"
    ghenv.Component.Params.Input[inputIndex].NickName = "Pr"
    ghenv.Component.Params.Input[inputIndex].Description = "Connect the param to desconstruct or modify here with one wire."
    ghenv.Component.Params.Input[inputIndex].Optional = False
    inputIndex+=1

    ghenv.Component.Params.Input[inputIndex].Name = "Name"
    ghenv.Component.Params.Input[inputIndex].NickName = "Na"
    ghenv.Component.Params.Input[inputIndex].Description = "Name of the param."
    ghenv.Component.Params.Input[inputIndex].Optional = False
    inputIndex+=1
    
    ghenv.Component.Params.Input[inputIndex].Name = "NickName"
    ghenv.Component.Params.Input[inputIndex].NickName = "NN"
    ghenv.Component.Params.Input[inputIndex].Description = "Nickname of the param."
    ghenv.Component.Params.Input[inputIndex].Optional = False
    inputIndex+=1
    
    ghenv.Component.Params.Input[inputIndex].Name = "Description"
    ghenv.Component.Params.Input[inputIndex].NickName = "Dc"
    ghenv.Component.Params.Input[inputIndex].Description = "Description of the param."
    ghenv.Component.Params.Input[inputIndex].Optional = True
    inputIndex+=1
    
    ghenv.Component.Params.Input[inputIndex].Name = "Optional"
    ghenv.Component.Params.Input[inputIndex].NickName = "Op"
    ghenv.Component.Params.Input[inputIndex].Description = "Wheather the param is optional."
    ghenv.Component.Params.Input[inputIndex].Optional = True
    inputIndex+=1
    
    ghenv.Component.Params.Input[inputIndex].Name = "Run"
    ghenv.Component.Params.Input[inputIndex].NickName = "Ru"
    ghenv.Component.Params.Input[inputIndex].Description = "Modify the param."
    ghenv.Component.Params.Input[inputIndex].Optional = True
    inputIndex+=1
    
    #Outputs
    #--------------------------------------------------------------------------------------------
    outputIndex=0
    
    ghenv.Component.Params.Output[outputIndex].Name = "Param"
    ghenv.Component.Params.Output[outputIndex].NickName = "Param"
    ghenv.Component.Params.Output[outputIndex].Description = "The desconstruct or modified param"
    ghenv.Component.Params.Output[outputIndex].Optional = False
    outputIndex+=1
    
    ghenv.Component.Params.Output[outputIndex].Name = "Name"
    ghenv.Component.Params.Output[outputIndex].NickName = "Name"
    ghenv.Component.Params.Output[outputIndex].Description = "Name of the param."
    ghenv.Component.Params.Output[outputIndex].Optional = False
    outputIndex+=1
    
    ghenv.Component.Params.Output[outputIndex].Name = "NickName"
    ghenv.Component.Params.Output[outputIndex].NickName = "NickName"
    ghenv.Component.Params.Output[outputIndex].Description = "Nickname of the param."
    ghenv.Component.Params.Output[outputIndex].Optional = False
    outputIndex+=1
    
    ghenv.Component.Params.Output[outputIndex].Name = "Description"
    ghenv.Component.Params.Output[outputIndex].NickName = "Description"
    ghenv.Component.Params.Output[outputIndex].Description = "Description of the param."
    ghenv.Component.Params.Output[outputIndex].Optional = True
    outputIndex+=1
    
    ghenv.Component.Params.Output[outputIndex].Name = "Optional"
    ghenv.Component.Params.Output[outputIndex].NickName = "Optional"
    ghenv.Component.Params.Output[outputIndex].Description = "Wheather the param is optional."
    ghenv.Component.Params.Output[outputIndex].Optional = True
    outputIndex+=1
    
    ghenv.Component.Params.Output[outputIndex].Name = "Success"
    ghenv.Component.Params.Output[outputIndex].NickName = "Success"
    ghenv.Component.Params.Output[outputIndex].Description = "Wheather the operation was successful."
    ghenv.Component.Params.Output[outputIndex].Optional = False
    outputIndex+=1

input = ghenv.Component.Params.Input[0]
param = input.Sources[0]
if Ru:
    if Na:
        param.Name = Na
    if NN:
        param.NickName = NN
    if Dc:
        param.Description = Dc
    if Op:
        param.Optional = Op
    Success = True
else:
    Success = False
Param = param
Name = param.Name
NickName = param.NickName
Description = param.Description
Optional = param.Optional
# ---------- end prm ----------
concat = Concatenate(FragmentA="\"", FragmentB=prm.Description, FragmentC="\"")
merge = Merge(Data1=emoji, Data2=prm.NickName, Data3=abbreviation, Data4=prm.Name, Data5=concat)
join = TextJoin(Text=merge, Join=",")
de = ClusterInput()
paper = ClusterInput()
panel = Panel(join)
path = ClusterInput()
na = ClusterInput()
description = ClusterInput()
variant = ClusterInput()
rp = ClusterInput()
collider = ClusterInput()
volume = ClusterInput()
ex = ClusterInput()
group = ClusterInput()
po = ClusterInput()
authors = ClusterInput()
qualities = ClusterInput()
sep = Separator()  # -> S; same code as sep
path_2 = FilePath(path)
na_2 = Name(na)
description_2 = Description(description)
variant_2 = Variant(variant)
de_2 = Default(de)
rp_2 = Representation(rp)
volume_2 = Volume(volume)
group_2 = Group(group)
paper_2 = Paper(paper)
collider_2 = Collider(collider)
authors_2 = Authors(authors)
qualities_2 = Qualities(qualities)
po_2 = Port(po)
ex_2 = Export(ex)
merge_2 = Merge(Data1=de_2, Data2=paper_2, Data3=collider_2, Data4=volume_2)
rep = ModelRepresentation(Representation=rp_2)  # -> Representation, Valid, Url, Description, Tags, Qualities
rep_2 = ReplaceText(Text=variant_2, Find="/", Replace="slash", RecursiveReplace=False)
txt = NormalizeText(Text=na_2)  # -> Strict, Title, Underscore, Kebab, Pascal
split = SplitList(List=rep.Tags, Index="1")  # -> ListA, ListB
rep_3 = ReplaceText(Text=rep_2, Find="\", Replace="backslash", RecursiveReplace=False)
panel_2 = Panel(rp_2)
txt_2 = NormalizeText(Text=rep_3)  # -> Strict, Title, Underscore, Kebab, Pascal
join_2 = TextJoin(Text=split.ListB, Join="_")
panel_3 = Panel("""default
paper
collider
volume""")
concat_2 = Concatenate(FragmentA=txt.Kebab, FragmentD="_", FragmentB=txt_2.Kebab)
concat_3 = Concatenate(FragmentA="images", FragmentB=sep, FragmentC=concat_2, FragmentD=".png")
concat_4 = Concatenate(FragmentA="icons", FragmentB=sep, FragmentC=concat_2, FragmentD=".svg")
concat_5 = Concatenate(FragmentA=concat_2, FragmentB=".glb")
concat_6 = Concatenate(FragmentA=concat_2, FragmentD="_", FragmentB=join_2)
concat_7 = Concatenate(FragmentA="representations", FragmentB=sep, FragmentC=concat_2, FragmentD=".glb")
concat_8 = Concatenate(FragmentA="representations", FragmentB=sep, FragmentC=concat_2, FragmentD=".3dm")
concat_9 = Concatenate(FragmentA=concat_6, FragmentB=".glb")
concat_10 = Concatenate(FragmentA=concat_6, FragmentB=".3dm")
concat_11 = Concatenate(FragmentD=concat_2, FragmentC="_", FragmentA=panel_3, FragmentB=".3dm")
concat_12 = Concatenate(FragmentA=concat_2, FragmentC="_", FragmentB=panel_3, FragmentD=".glb")
concat_13 = Concatenate(FragmentA="representations", FragmentB=sep, FragmentC=concat_10)
concat_14 = Concatenate(FragmentA="representations", FragmentB=sep, FragmentC=concat_9)
concat_15 = Concatenate(FragmentA="representations", FragmentB=sep, FragmentC=concat_11)
concat_16 = Concatenate(FragmentA="representations", FragmentB=sep, FragmentC=concat_12)
panel_4 = Panel(concat_13)
rep_4 = ModelRepresentation(Url=concat_13, Tags=split.ListB)  # -> Representation, Valid, Url, Description, Tags, Qualities
rep_5 = ModelRepresentation(Url=graft(concat_16), Tags=graft(panel_3))  # -> Representation, Valid, Url, Description, Tags, Qualities
rep_6 = ModelRepresentation(Url=concat_14, Tags=split.ListB)  # -> Representation, Valid, Url, Description, Tags, Qualities
rep_7 = ModelRepresentation(Url=graft(concat_15), Tags=graft(panel_3))  # -> Representation, Valid, Url, Description, Tags, Qualities
rep_8 = ModelRepresentation(Url=concat_7)  # -> Representation, Valid, Url, Description, Tags, Qualities
rep_9 = ModelRepresentation(Url=concat_8)  # -> Representation, Valid, Url, Description, Tags, Qualities
trim = TrimTree(Tree=rep_4.Representation, Depth=1)
trim_2 = TrimTree(Tree=rep_6.Representation, Depth=1)
trim_3 = TrimTree(Tree=rep_7.Representation, Depth=1)
trim_4 = TrimTree(Tree=rep_5.Representation, Depth=1)
merge_3 = Merge(Data1=rep_8.Representation, Data2=rep_9.Representation, Data3=trim, Data4=trim_2, Data5=trim_4, Data6=trim_3)
concat_17 = Concatenate(FragmentA=path_2, FragmentB=sep, FragmentC=concat_16)
concat_18 = Concatenate(FragmentA=path_2, FragmentB=sep, FragmentC=concat_14)
concat_collider_glb = Concatenate(FragmentA=path_2, FragmentB=sep, FragmentC=concat_16)
cluster = Cluster(gr=merge_2)  # -> geo_2, txt_2
typ = ModelType(
    Name=txt.Title,
    Description=description_2,
    Icon=concat_4,
    Image=concat_3,
    Variant=variant_2,
    Representations=merge_3,
    Ports=po_2,
    Authors=authors_2,
    Qualities=qualities_2)  # -> Type, Valid, Name, Description, Icon, Image, Variant, Stock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
geo = ExportGeometry(F=concat_collider_glb, G=collider_2, R=ex_2)  # -> S; inputs G: tree of GeometryBase, R: Boolean
# ---------- geo: C# ----------
// Grasshopper Script Instance
#region Usings
using System;
using System.Linq;
using System.Collections;
using System.Collections.Generic;
using System.Drawing;
using System.IO;

using Rhino;
using Rhino.Geometry;

using Grasshopper;
using Grasshopper.Kernel;
using Grasshopper.Kernel.Data;
using Grasshopper.Kernel.Types;
#endregion

public class Script_Instance : GH_ScriptInstance
{
    #region Notes
    /* 
      Members:
        RhinoDoc RhinoDocument
        GH_Document GrasshopperDocument
        IGH_Component Component
        int Iteration

      Methods (Virtual & overridable):
        Print(string text)
        Print(string format, params object[] args)
        Reflect(object obj)
        Reflect(object obj, string method_name)
    */
    #endregion

    private void RunScript(object F, DataTree<GeometryBase> G, bool R, ref object S)
    {
        // inspired from https://github.com/jhorikawa/GrasshopperProgrammingTutorials/blob/master/0015%20Export%20Geometry%20with%20Grasshopper%20C%23/Export%20Geometry%20with%20Grasshopper%20C%23.gh
        if(R){
            var guids = new List<Guid>();

            for(int i = 0; i < G.BranchCount; i++){
                for(int n = 0; n < G.Branches[i].Count; n++){
                var geom = G.Branches[i][n];
                var guid = Rhino.RhinoDoc.ActiveDoc.Objects.Add(geom);
                guids.Add(guid);
                }
            }

            Rhino.RhinoDoc.ActiveDoc.Objects.Select(guids);

            string cmd = "_-Export " + "\"" + F + "\"" + " _Enter _Enter";

            Rhino.RhinoApp.RunScript(cmd, false);

            Rhino.RhinoDoc.ActiveDoc.Objects.Delete(guids, true);
            S = true;
        }
    }
}
# ---------- end geo ----------
concat_3dm = Concatenate(FragmentA=path_2, FragmentB=sep, FragmentC=concat_13)
geo_2 = ExportGeometry(F=concat_18, G=collider_2, R=ex_2)  # -> S; inputs G: tree of GeometryBase, R: Boolean; same code as geo
geo_3 = ExportGeometry(F=concat_17, G=cluster.geo_2, R=ex_2)  # -> S; inputs G: tree of GeometryBase, R: Boolean; same code as geo
geo_4 = ExportGeometry()  # -> S; inputs G: tree of GeometryBase, R: Boolean; same code as geo
ty = Type(typ.Type)
ba = Text(concat_2)
ty_2 = ClusterOutput(ty)
ba_2 = ClusterOutput(ba)
blc = ExportBlock_2(export=ex_2, ob=group_2)  # -> block_definition_3, path_4, exported_2
blc_2 = ExportBlock(path=path_2, gr=group_2, ty=typ.Type, rp=rp_2, export=ex_2)  # -> block_definition_3, path_4, exported_2
blc_3 = ExportBlock(path=path_2, export=ex_2)  # -> block_definition_3, path_4, exported_2
geo_5 = ExportGeometry(F=concat_3dm, G=group_2, R=ex_2)  # -> S; inputs G: tree of GeometryBase, R: Boolean; same code as geo

# ==== cluster PreviewPlane: Preview a plane with axis colors and naming.
axis_length = ClusterInput()
plane = ClusterInput()
axis_length_2 = Number(axis_length)
plane_2 = Plane(plane)
deplane = DeconstructPlane(Plane=plane_2)  # -> Origin, XAxis, YAxis, ZAxis
line = LineSDL(Start=deplane.Origin, Direction=deplane.YAxis, Length=axis_length_2)
line_2 = LineSDL(Start=deplane.Origin, Direction=deplane.XAxis, Length=axis_length_2)
line_3 = LineSDL(Start=deplane.Origin, Direction=deplane.ZAxis, Length=axis_length_2)
swatch = ColourSwatch(SwatchColor=RGB(235, 52, 79))
swatch_2 = ColourSwatch(SwatchColor=RGB(0, 166, 157))
swatch_3 = ColourSwatch(SwatchColor=RGB(240, 117, 24))
end = EndPoints(Curve=line_2)  # -> Start, End
end_2 = EndPoints(Curve=line)  # -> Start, End
end_3 = EndPoints(Curve=line_3)  # -> Start, End
tag = TextTag(Location=end.End, Text="X", Colour=swatch)
tag_2 = TextTag(Location=end_2.End, Text="Y", Colour=swatch_2)
tag_3 = TextTag(Location=end_3.End, Text="Z", Colour=swatch_3)
preview = CustomPreview(Geometry=line_2, Material=swatch)
preview_2 = CustomPreview(Geometry=line, Material=swatch_2)
preview_3 = CustomPreview(Geometry=line_3, Material=swatch_3)

# ==== cluster ViewRectangle
view = ClusterInput()
view_2 = Data(view)
nickname = NAME(view=view_2)  # -> c, x, y, z, h, w
# ---------- nickname: Python ----------
uselss, c, x, y, z = view.GetCameraFrame()
h = view.FrustumHeight
w = view.FrustumWidth
# ---------- end nickname ----------
rev = Reverse(Vector=nickname.x)
rev_2 = Reverse(Vector=nickname.y)
pl = ConstructPlane(Origin=nickname.c, XAxis=rev, YAxis=nickname.y)
_2d = _2D(x=nickname.w)
_2d_2 = _2D(x=nickname.h)
rectangle = Rectangle(Plane=pl, XSize=_2d, YSize=_2d_2, Radius=0)  # -> Rectangle, Length
rec = Rectangle(rectangle.Rectangle)
rec_2 = ClusterOutput(rec)

# ==== cluster ExportBlock_3: Export geometry with layer names to a file.
path = ClusterInput()
name = ClusterInput()
url = ClusterInput()
geo = ClusterInput()
layer_name = ClusterInput()
export = ClusterInput()
path_2 = FilePath(path)
name_2 = Text(name)
url_2 = Text(url)
geo_2 = Geometry(geo)
layer_name_2 = Text(layer_name)
export_2 = Boolean(export)
layer = ModelLayer(Name=layer_name_2)  # -> Layer, Name, Hidden, Locked, DisplayColour, Material, Linetype
object = ModelObject(Geometry=geo_2, Layer=layer.Layer)  # -> Object, Geometry, Name, Layer, Visibility, Display, Drafting, Render
block_definition = ModelBlockDefinition(Objects=object.Object, Name=name_2, URL=url_2)  # -> BlockDefinition, Objects, Units, Name, Notes, URL, URLDescription
export_definition = ExportModelBlockDefinition(BlockDefinition=block_definition.BlockDefinition, FilePath=path_2, Overwrite="T", Export=export_2)  # -> BlockDefinition, FilePath, Exported
block_definition_2 = ModelBlockDefinition(export_definition.BlockDefinition)
path_3 = FilePath(export_definition.FilePath)
exported = Boolean(export_definition.Exported)
path_4 = ClusterOutput(path_3)
exported_2 = ClusterOutput(exported)
block_definition_3 = ClusterOutput(block_definition_2)

# ==== cluster PreviewGeometry: semio styled preview of geometry.
geo = ClusterInput()
swatch = ColourSwatch(SwatchColor=RGB(255, 255, 255))
swatch_2 = ColourSwatch(SwatchColor=RGB(0, 0, 0))
geo_2 = Geometry(flatten(geo))
dispatch = CSharpScript(D=geo_2)  # -> P, C, B, M, R
# ---------- dispatch: C# ----------
// Grasshopper Script Instance
#region Usings
using System;
using System.Linq;
using System.Collections;
using System.Collections.Generic;
using System.Drawing;

using Rhino;
using Rhino.Geometry;

using Grasshopper;
using Grasshopper.Kernel;
using Grasshopper.Kernel.Data;
using Grasshopper.Kernel.Types;
#endregion

public class Script_Instance : GH_ScriptInstance
{
    #region Notes
    /* 
      Members:
        RhinoDoc RhinoDocument
        GH_Document GrasshopperDocument
        IGH_Component Component
        int Iteration

      Methods (Virtual & overridable):
        Print(string text)
        Print(string format, params object[] args)
        Reflect(object obj)
        Reflect(object obj, string method_name)
    */
    #endregion

    private void RunScript(
	object D,
	ref object P,
	ref object C,
	ref object B,
	ref object M,
	ref object R)
    {
        if (D is Curve) C = D; // Curve
        else if (
            D is Rhino.Geometry.Point ||
            D is PointCloud
            )
            P = D; // Point
        else if ( D is Mesh) M = D; // Mesh
        else if (
            D is Surface ||
            D is Extrusion ||
            D is SubD ||
            D is Brep
            )
            B = D; // Brep
        else R = D; // Rest
            
    }
}
# ---------- end dispatch ----------
clean = CleanTree(RemoveNulls=True, RemoveInvalid=True, RemoveEmpty=False, Tree=dispatch.P)
clean_2 = CleanTree(RemoveNulls=True, RemoveInvalid=True, RemoveEmpty=False, Tree=dispatch.C)
clean_3 = CleanTree(RemoveNulls=True, RemoveInvalid=True, RemoveEmpty=False, Tree=dispatch.B)
clean_4 = CleanTree(RemoveNulls=True, RemoveInvalid=True, RemoveEmpty=False, Tree=dispatch.M)
clean_5 = CleanTree(RemoveNulls=True, RemoveInvalid=True, RemoveEmpty=False, Tree=dispatch.R)
debrep = DeconstructBrep(Brep=clean_3)  # -> Faces, Edges, Vertices
preview = CustomPreview(Geometry=flatten(clean_5), Material=swatch_2)
preview_2 = CustomPreview(Geometry=flatten(clean), Material=swatch_2)
preview_3 = CustomPreview(Geometry=flatten(clean_2), Material=swatch_2)
preview_4 = CustomPreview(Geometry=flatten(debrep.Faces), Material=swatch)
preview_5 = CustomPreview(Geometry=flatten(debrep.Edges), Material=swatch_2)
preview_6 = CustomPreview(Geometry=flatten(clean_4), Material=swatch)

# ==== cluster PreviewPort: semio styled preview of ports.
po = ClusterInput()
po_2 = Port(po)
por = ModelPort(Port=po_2)  # -> Port, Valid, Id, Description, Family, CompatibleFamilies, Point, Direction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
vdisex = VectorDisplayEx(Point=por.Point, Vector=por.Direction, Colour=ColourSwatch(SwatchColor=RGB(0, 166, 157)), Width=2)
preview = CustomPreview(Geometry=por.Point, Material=ColourSwatch(SwatchColor=RGB(235, 52, 79)))
tag = TextTag(Location=por.Point, Text=por.Id, Colour=ColourSwatch(SwatchColor=RGB(250, 149, 0)))

# ==== cluster ValueOr0
value = ClusterInput()
value_2 = Number(value)
null = NullItem(Item=value_2)  # -> NullFlags, InvalidFlags, Description
filter = StreamFilter(Gate=null.NullFlags, Stream0=value_2, Stream1="0")
valueor0 = Number(filter)
valueor0_2 = ClusterOutput(valueor0)

# ==== cluster GeometryPreview: semio styled preview of geometry.
geo = ClusterInput()
geo_2 = Geometry(flatten(geo))
debrep = DeconstructBrep(Brep=geo_2)  # -> Faces, Edges, Vertices
preview = CustomPreview(Geometry=flatten(debrep.Edges), Material=ColourSwatch(SwatchColor=RGB(0, 0, 0)))
preview_2 = CustomPreview(Geometry=flatten(debrep.Faces), Material=ColourSwatch(SwatchColor=RGB(255, 255, 255)))

# ==== cluster ExportBlock: Export geometry with layer names to a file.
gr = ClusterInput()
ty = ClusterInput()
export = ClusterInput()
rp = ClusterInput()
path = ClusterInput()
path_2 = FilePath(path)
ty_2 = Type(ty)
rp_2 = Representation(rp)
export_2 = Boolean(export)
cluster = Cluster(gr=gr)  # -> geo_2, txt_2
layer = ModelLayer(Name=cluster.txt_2)  # -> Layer, Name, Hidden, Locked, DisplayColour, Material, Linetype
object = ModelObject(Geometry=cluster.geo_2, Layer=layer.Layer)  # -> Object, Geometry, Name, Layer, Visibility, Display, Drafting, Render
typ = ModelType(Type=ty_2)  # -> Type, Valid, Name, Description, Icon, Image, Variant, Stock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
rep = ModelRepresentation(Representation=rp_2)  # -> Representation, Valid, Url, Description, Tags, Qualities
trim = TrimTree(Tree=object.Object, Depth="5")
concat = Concatenate(FragmentA=typ.Type, FragmentC=":", FragmentB=rep.Representation)
block_definition = ModelBlockDefinition(Objects=trim, Name=concat, Notes=typ.Description)  # -> BlockDefinition, Objects, Units, Name, Notes, URL, URLDescription
export_definition = ExportModelBlockDefinition(BlockDefinition=block_definition.BlockDefinition, FilePath=path_2, Overwrite="T", Export=export_2)  # -> BlockDefinition, FilePath, Exported
block_definition_2 = ModelBlockDefinition(export_definition.BlockDefinition)
path_3 = FilePath(export_definition.FilePath)
exported = Boolean(export_definition.Exported)

# ---- group: Export single files. WIP
sep = Separator()  # -> S
# ---------- sep: C# ----------
#region Usings
using System;
using System.Linq;
using System.Collections;
using System.Collections.Generic;
using System.Drawing;
using System.IO;

using Rhino;
using Rhino.Geometry;

using Grasshopper;
using Grasshopper.Kernel;
using Grasshopper.Kernel.Data;
using Grasshopper.Kernel.Types;
#endregion

public class Script_Instance : GH_ScriptInstance
{
    private void RunScript(ref object S)
    {
        S = Path.DirectorySeparatorChar;
    }
}
# ---------- end sep ----------
rep_2 = ReplaceText(Text=rep.Url, Find="/", Replace=sep, RecursiveReplace=False)
item = ListItem(List=rep.Tags, Index=0, Wrap=True)
concat_2 = Concatenate(FragmentA=path_2, FragmentB=sep, FragmentC=rep_2)
mime = Mime({".glb": "model/gltf-binary", ".gltf": "model/gltf+json", ".stl": "model/stl", ".obj": "model/obj", ".blend": "model/x-blender", ".3dm": "model/vnd.3dm", ".ifc": "model/x-ifc", ".dwg": "model/acad", ".dxf": "model/dxf", ".rvt": "model/vnd.revit"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}, selected=".3dm")
trim_2 = TrimTree(Tree=item, Depth=1)
expression = Expression(x=trim_2, y=mime, Expression="x=y")
# WIP
dispatch = Dispatch(List=concat_2, DispatchPattern=expression)  # -> ListA, ListB
dispatch_2 = Dispatch(List=concat_2, DispatchPattern=expression)  # -> ListA, ListB

# ----
exported_2 = ClusterOutput(exported)
path_4 = ClusterOutput(path_3)
block_definition_3 = ClusterOutput(block_definition_2)

# ==== cluster ExportBlock_2: Export geometry with layer names to a file.
ob = ClusterInput()
G = ClusterInput()
dc = ClusterInput()
path = ClusterInput()
name = ClusterInput()
url = ClusterInput()
layer_n = ClusterInput()
export = ClusterInput()
ob_2 = ModelObject(ob)
group = Group(Geometry=G)
path_2 = FilePath(path)
name_2 = Text(name)
url_2 = Text(url)
export_2 = Boolean(export)
layer_n_2 = Name(layer_n)
dc_2 = DisplayColour(dc)
object = ModelObject(Object=group)  # -> Object, Geometry, Name, Layer, Visibility, Display, Drafting, Render
layer = ModelLayer(Name=layer_n_2, DisplayColour=dc_2)  # -> Layer, Name, Hidden, Locked, DisplayColour, Material, Linetype, PrintColour, PrintWidth
object_2 = ModelObject(group)
group_2 = NamedGroup(Geometry=group)  # -> Group, Geometry, Name
object_3 = ModelObject(Geometry=object_2, Layer=layer.Layer)  # -> Object, Geometry, Name, Layer, Visibility, Display, Drafting, Render
object_4 = ModelObject(Object=object_2)  # -> Object, Geometry, Name, Layer, Visibility, Display, Drafting, Render
block_definition = ModelBlockDefinition(Objects=object_3.Object, Name=name_2, URL=url_2)  # -> BlockDefinition, Objects, Units, Name, Notes, URL, URLDescription
panel = Panel(object_4.Layer)
export_definition = ExportModelBlockDefinition(BlockDefinition=block_definition.BlockDefinition, FilePath=path_2, Overwrite="T", Export=export_2)  # -> BlockDefinition, FilePath, Exported
block_definition_2 = ModelBlockDefinition(export_definition.BlockDefinition)
path_3 = FilePath(export_definition.FilePath)
exported = Boolean(export_definition.Exported)
path_4 = ClusterOutput(path_3)
exported_2 = ClusterOutput(exported)
block_definition_3 = ClusterOutput(block_definition_2)

# ==== cluster _2D
x = ClusterInput()
expression = Expression(x=x, Expression="x/2")
neg = Negative(Value=expression)
dom = ConstructDomain(DomainStart=neg, DomainEnd=expression)
I = ClusterOutput(dom)

# ==== cluster Cluster
gr = ClusterInput()
gr_2 = Group(gr)
group = NamedGroup(Group=gr_2)  # -> Group, Geometry, Name
group_2 = NamedGroup(Group=group.Geometry)  # -> Group, Geometry, Name
expression = Expression(x=graft(group.Name), y=group_2.Name, Expression="x")
group_3 = NamedGroup(Group=group_2.Geometry)  # -> Group, Geometry, Name
expression_2 = Expression(x=graft(expression), y=group_3.Name, Expression="x")
expression_3 = Expression(x=graft(group_2.Name), y=group_3.Name, Expression="x")
group_4 = NamedGroup(Group=group_3.Geometry)  # -> Group, Geometry, Name
expression_4 = Expression(x=graft(expression_2), y=group_4.Name, Expression="x")
expression_5 = Expression(x=graft(expression_3), y=group_4.Name, Expression="x")
expression_6 = Expression(x=graft(group_3.Name), y=group_4.Name, Expression="x")
group_5 = NamedGroup(Group=group_4.Geometry)  # -> Group, Geometry, Name
expression_7 = Expression(x=graft(expression_4), y=group_5.Name, Expression="x")
expression_8 = Expression(x=graft(expression_5), y=group_5.Name, Expression="x")
expression_9 = Expression(x=graft(expression_6), y=group_5.Name, Expression="x")
expression_10 = Expression(x=graft(group_4.Name), y=group_5.Name, Expression="x")
group_6 = NamedGroup(Group=group_5.Geometry)  # -> Group, Geometry, Name
expression_11 = Expression(x=graft(expression_7), y=group_6.Name, Expression="x")
expression_12 = Expression(x=graft(expression_9), y=group_6.Name, Expression="x")
expression_13 = Expression(x=graft(expression_8), y=group_6.Name, Expression="x")
expression_14 = Expression(x=graft(expression_10), y=group_6.Name, Expression="x")
expression_15 = Expression(x=graft(group_5.Name), y=group_6.Name, Expression="x")
merge = Merge(
    Data1=expression_11,
    Data2=expression_13,
    Data3=expression_12,
    Data4=expression_14,
    Data5=expression_15,
    Data6=group_6.Name)
join = TextJoin(Text=merge, Join="::")
geo = Geometry(group_6.Geometry)
txt = Text(join)
geo_2 = ClusterOutput(geo)
txt_2 = ClusterOutput(txt)
