# Grasshopper definition semio.gh (Grasshopper 1.0.7)
# plug-ins: Pufferfish, Human, MetaHopper

logo_serif_width = Slider(1, range=0..1)
logogram_serif_width = Slider(0.5, range=0..1)
number_slider = Slider(4, range=0..10)
number_slider_2 = Slider(0.125, range=0..1)
number_slider_3 = Slider(0.05, range=0..1)
logo_wire = BooleanToggle(True)
logogram_wire = BooleanToggle(False)
logo_serif = BooleanToggle(False)
logogram_serif = BooleanToggle(False)
logo_color = BooleanToggle(True)
invert = BooleanToggle(False)
move = BooleanToggle(False)
round_corners = BooleanToggle(False)
swatch = ColourSwatch(SwatchColor=RGB(255, 255, 255))
swatch_2 = ColourSwatch(SwatchColor=RGB(235, 52, 79))
swatch_3 = ColourSwatch(SwatchColor=RGB(0, 0, 0))
swatch_4 = ColourSwatch(SwatchColor=RGB(0, 166, 157))
swatch_5 = ColourSwatch(SwatchColor=RGB(240, 117, 24))
file = ReadFile(File="C:\Git\semio\resources\logo\src\logoraw.svg", PerLineParse=True)
S = Curve([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])
filter = StreamFilter(Gate=invert, Stream0=swatch_3, Stream1=swatch)
filter_2 = StreamFilter(Gate=invert, Stream0=swatch, Stream1=swatch_3)
I = Curve(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)
E = Curve([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])
S_2 = Curve([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])
adjustsvg = AdjustSVG(svg_path=file, width=Slider(18, range=0..100), bywidth=invert(False))  # -> svg_path_4, svg_path_cm_2, coordinates_2
L = Curve([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])
I_2 = Curve(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)
E_2 = Curve([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])
O = Curve([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])
E_3 = Curve([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])
S_3 = Curve([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])
I_3 = Curve(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)
M = Curve([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])
fillet = Fillet(Curve=I_2, Radius=number_slider_2)
fillet_2 = Fillet(Curve=E_2, Radius=number_slider_2)
fillet_3 = Fillet(Curve=L, Radius=number_slider_2)
middle = Curve([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])
short = Curve([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])
long = Curve([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])
S_4 = Curve([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])
E_4 = Curve([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])
M_2 = Curve([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])
I_4 = Curve(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)
O_2 = Curve([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])
filter_3 = StreamFilter(Gate=round_corners, Stream0=I_2, Stream1=fillet)
filter_4 = StreamFilter(Gate=round_corners, Stream0=E_2, Stream1=fillet_2)
filter_5 = StreamFilter(Gate=round_corners, Stream0=L, Stream1=fillet_3)
item = ListItem(List=adjustsvg.coordinates_2, Index=0, Wrap=True)  # -> Item, Item1
panel = Panel(adjustsvg.svg_path_4)
fillet_4 = Fillet(Curve=E_4, Radius=number_slider_3)
fillet_5 = Fillet(Curve=M_2, Radius=number_slider_3)
fillet_6 = Fillet(Curve=S_4, Radius=number_slider_3)
merge = Merge(Data1=filter_5, Data2=filter_3, Data3=filter_4)
fillet_7 = Fillet(Curve=I_4, Radius=number_slider_3)
fillet_8 = Fillet(Curve=O_2, Radius=number_slider_3)
bnd = Bounds(Numbers=flatten(item.Item))
bnd_2 = Bounds(Numbers=flatten(item.Item1))
logo_closed = Curve([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])
logo = Curve([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])
filter_6 = StreamFilter(Gate=round_corners, Stream0=E_4, Stream1=fillet_4)
filter_7 = StreamFilter(Gate=round_corners, Stream0=M_2, Stream1=fillet_5)
filter_8 = StreamFilter(Gate=round_corners, Stream0=S_4, Stream1=fillet_6)
filter_9 = StreamFilter(Gate=round_corners, Stream0=I_4, Stream1=fillet_7)
filter_10 = StreamFilter(Gate=round_corners, Stream0=O_2, Stream1=fillet_8)
panel_2 = Panel(bnd)
T = Vector(Vector(-19.4997978, -9.500080588, 0))
middle_2 = Curve(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)
short_2 = Curve([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])
long_2 = Curve(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)
panel_3 = Panel(bnd_2)
logo_2 = Curve(merge)
move_2 = Move(Geometry=logo_2, Motion=T)  # -> Geometry, Transform
move_3 = Move(Geometry=short_2, Motion=T)  # -> Geometry, Transform
move_4 = Move(Geometry=middle_2, Motion=T)  # -> Geometry, Transform
move_5 = Move(Geometry=long_2, Motion=T)  # -> Geometry, Transform
merge_2 = Merge(Data1=filter_8, Data2=filter_6, Data3=filter_7, Data4=filter_9, Data5=filter_10)
filter_11 = StreamFilter(Gate=move, Stream0=middle_2, Stream1=move_4.Geometry)
filter_12 = StreamFilter(Gate=move, Stream0=logo_2, Stream1=move_2.Geometry)
filter_13 = StreamFilter(Gate=move, Stream0=short_2, Stream1=move_3.Geometry)
filter_14 = StreamFilter(Gate=move, Stream0=long_2, Stream1=move_5.Geometry)
merge_3 = Merge(Data1=merge_2, Data2=filter_12, Data3=filter_13, Data4=filter_11, Data5=filter_14)
srf = Surface(merge_2)
srf_2 = Surface(filter_12)
previewlw = CustomPreviewLineweights(Geometry=merge_2, Shader=filter, Thickness=number_slider, Absolute=False)  # disabled
preview = CustomPreview(Geometry=srf, Material=filter)
preview_2 = CustomPreview(Geometry=srf_2, Material=filter)  # disabled
previewlw_2 = CustomPreviewLineweights(Geometry=filter_12, Shader=filter, Thickness=number_slider, Absolute=False)
onoff = EnableDisableObject(Enabled=logo_wire, AllObjects_Object=previewlw_2)
onoff_2 = EnableDisableObject(Enabled=logo_color, AllObjects_Object=[preview_9, preview_11, preview_10])
onoff_3 = EnableDisableObject(Enabled=logogram_wire, AllObjects_Object=previewlw)
onoff_4 = EnableDisableObject(Enabled=logogram_serif, AllObjects_Object=[preview_8, preview_4, preview_6])
offcrv = OffsetCurve(Curve=filter_13, Distance=logo_serif_width, Plane=PlaneXY(0, 0, 0), BothSides=True, Kinks=0, CapType=1)
offcrv_2 = OffsetCurve(Curve=filter_11, Distance=logo_serif_width, Plane=PlaneXY(0, 0, 0), BothSides=True, Kinks=0, CapType=1)
offcrv_3 = OffsetCurve(Curve=short, Distance=logogram_serif_width, Plane=PlaneXY(0, 0, 0), BothSides=True, Kinks=0, CapType=1)
offcrv_4 = OffsetCurve(Curve=middle, Distance=logogram_serif_width, Plane=PlaneXY(0, 0, 0), BothSides=True, Kinks=0, CapType=1)
offcrv_5 = OffsetCurve(Curve=filter_14, Distance=logo_serif_width, Plane=PlaneXY(0, 0, 0), BothSides=True, Kinks=0, CapType=1)
offcrv_6 = OffsetCurve(Curve=long, Distance=logogram_serif_width, Plane=PlaneXY(0, 0, 0), BothSides=True, Kinks=0, CapType=1)
onoff_5 = EnableDisableObject(Enabled=logo_serif, AllObjects_Object=[preview_7, preview_3, preview_5])
onoff_6 = EnableDisableObject(Enabled=invert(logo_wire), AllObjects_Object=preview_2)
onoff_7 = EnableDisableObject(Enabled=invert(logogram_wire), AllObjects_Object=preview)
srf_3 = Surface(offcrv)
srf_4 = Surface(offcrv_5)
srf_5 = Surface(offcrv_3)
srf_6 = Surface(offcrv_6)
srf_7 = Surface(offcrv_2)
srf_8 = Surface(offcrv_4)
preview_3 = CustomPreview(Geometry=srf_4, Material=swatch_2)  # disabled
preview_4 = CustomPreview(Geometry=srf_6, Material=swatch_2)  # disabled
preview_5 = CustomPreview(Geometry=srf_7, Material=swatch_5)  # disabled
preview_6 = CustomPreview(Geometry=srf_8, Material=swatch_5)  # disabled
preview_7 = CustomPreview(Geometry=srf_3, Material=swatch_4)  # disabled
preview_8 = CustomPreview(Geometry=srf_5, Material=swatch_4)  # disabled
move_6 = Move(Geometry=filter_3, Motion=T)  # -> Geometry, Transform
move_7 = Move(Geometry=filter_4, Motion=T)  # -> Geometry, Transform
move_8 = Move(Geometry=filter_5, Motion=T)  # -> Geometry, Transform
merge_4 = Merge(Data1=srf_5, Data2=srf_8, Data3=srf_6)
merge_5 = Merge(Data1=srf_3, Data2=srf_7, Data3=srf_4)
filter_15 = StreamFilter(Gate=move, Stream0=filter_3, Stream1=move_6.Geometry)
filter_16 = StreamFilter(Gate=move, Stream0=filter_4, Stream1=move_7.Geometry)
filter_17 = StreamFilter(Gate=move, Stream0=filter_5, Stream1=move_8.Geometry)
onoff_8 = EnableDisableObject(Enabled=invert(invert), AllObjects_Object=previewlw_2)
merge_6 = Merge(Data1=merge_5, Data2=merge_4)
onoff_9 = EnableDisableObject(Enabled=invert, AllObjects_Object=preview_12)
srf_9 = Surface(filter_15)
srf_10 = Surface(filter_17)
srf_11 = Surface(filter_16)
merge_7 = Merge(Data1=merge_3, Data2=merge_6)  # -> flatten(Result)
preview_9 = CustomPreview(Geometry=srf_10, Material=swatch_2)
preview_10 = CustomPreview(Geometry=srf_9, Material=swatch_5)
preview_11 = CustomPreview(Geometry=srf_11, Material=swatch_4)
brec = BoundingRectangle(Geometry=merge_7, Plane=PlaneXY(0, 0, 0), Axis=0, Slide=0, Union=True)  # -> Bounding, DimensionX, DimensionY
drec = DeconstuctRectangle(Rectangle=brec.Bounding)  # -> BasePlane, XInterval, YInterval
offset = OffsetCurve(Curve=brec.Bounding, Distance=Slider(2, range=0..10), Plane=PlaneXY(0, 0, 0), Corners=1)
domprop = DomainProperties(I=drec.YInterval, In=True)  # -> L, M, T0, T1; inputs I: tree, In: tree of Boolean; same code as domprop
srf_12 = Surface(offset)
preview_12 = CustomPreview(Geometry=srf_12, Material=filter_2)  # disabled

# ==== cluster AdjustSVG
svg_path = ClusterInput()
height = ClusterInput()
width = ClusterInput()
bywidth = ClusterInput()
svg_path_2 = Text(svg_path)
height_2 = Number(height)
bywidth_2 = Boolean(bywidth)
width_2 = Number(width)
desvgpath = DeSVGPath(svg_path=svg_path_2)  # -> coordinates_2, isdecimalpattern_2, commands_2, zpaths_2, nonzpaths_2

# ---- group: Centimeter to Points
number_slider = Slider(28.34, range=0..100)
multiplication = Multiplication(A=height_2, B=number_slider)

# ----
item = ListItem(List=desvgpath.coordinates_2, Index=0, Wrap=True)  # -> Item, Item1
bnd = Bounds(Numbers=flatten(item.Item1))
bnd_2 = Bounds(Numbers=flatten(item.Item))
multiplication_2 = Multiplication(A=width_2, B=number_slider)
domprop = DomainProperties(I=bnd, In=True)  # -> L, M, T0, T1; inputs I: tree, In: tree of Boolean
# ---------- domprop: Python ----------
#Component Information
#--------------------------------------------------------------------------------------------
if ghenv.Component.RunCount<2:
    #General
    #--------------------------------------------------------------------------------------------
    __author__ = "Ueli Saluz"
    __version__ = "2021.11.22"
    
    ghenv.Component.Name = "DomainProperties"
    ghenv.Component.NickName = "DomProp"
    ghenv.Component.Description = "Returns some properties of a domain"
    ghenv.Component.Message = "VER 1.0"
    ghenv.Component.Category = "Maths"
    ghenv.Component.SubCategory = "Domain"
    
     #Inputs
    #--------------------------------------------------------------------------------------------
    inputIndex=0
    
    ghenv.Component.Params.Input[inputIndex].Name = "Domain"
    ghenv.Component.Params.Input[inputIndex].NickName = "I"
    ghenv.Component.Params.Input[inputIndex].Description = "Domain to evaluate"
    ghenv.Component.Params.Input[inputIndex].Optional = False
    inputIndex+=1
    
    ghenv.Component.Params.Input[inputIndex].Name = "MakeIncreasing"
    ghenv.Component.Params.Input[inputIndex].NickName = "In"
    ghenv.Component.Params.Input[inputIndex].Description = "Makes sure that the domain is increasing. If not it gets swapped."
    ghenv.Component.Params.Input[inputIndex].Optional = False
    inputIndex+=1
    
    #Outputs
    #--------------------------------------------------------------------------------------------
    outputIndex=0
    
    ghenv.Component.Params.Output[outputIndex].Name = "Length"
    ghenv.Component.Params.Output[outputIndex].NickName = "L"
    ghenv.Component.Params.Output[outputIndex].Description = "Length of the domain"
    outputIndex+=1
    
    ghenv.Component.Params.Output[outputIndex].Name = "Mid"
    ghenv.Component.Params.Output[outputIndex].NickName = "M"
    ghenv.Component.Params.Output[outputIndex].Description = "Middle of the of the domain"
    outputIndex+=1
    
    ghenv.Component.Params.Output[outputIndex].Name = "DomainStartParameter"
    ghenv.Component.Params.Output[outputIndex].NickName = "T0"
    ghenv.Component.Params.Output[outputIndex].Description = "Start parameter. Doens't have to be smaller than the end parameter."
    outputIndex+=1
    
    ghenv.Component.Params.Output[outputIndex].Name = "DomainEndParameter"
    ghenv.Component.Params.Output[outputIndex].NickName = "T1"
    ghenv.Component.Params.Output[outputIndex].Description = "End parameter. Doens't have to be bigger than the start parameter."
    outputIndex+=1
    


#Imports
#--------------------------------------------------------------------------------------------
from System import Object
from Grasshopper import DataTree

#Solver - Run with trees to enhance performance drastically
#--------------------------------------------------------------------------------------------
if __name__ == "__main__":
    
    #Initialize trees
    #--------------------------------------------------------------------------------------------
    LengthTree = DataTree[Object]()
    MidTree = DataTree[Object]()
    DomainStartParameterTree = DataTree[Object]()
    DomainEndParameterTree = DataTree[Object]()
    LengthTree = DataTree[Object]()
    
    #Data matching
    #--------------------------------------------------------------------------------------------
    for path in I.Paths:
        domainBranch = I.Branch(path)
        for i,domain in enumerate(domainBranch):
            if In==True:
                domain.MakeIncreasing()
            LengthTree.Add(domain.Length, path)
            MidTree.Add(domain.Mid, path)
            DomainStartParameterTree.Add(domain.T0, path)
            DomainEndParameterTree.Add(domain.T1, path)
    
     #Assign trees to output
    #--------------------------------------------------------------------------------------------
    L = LengthTree
    M = MidTree
    T0 = DomainStartParameterTree
    T1 = DomainEndParameterTree
# ---------- end domprop ----------
domprop_2 = DomainProperties(I=bnd_2, In=True)  # -> L, M, T0, T1; inputs I: tree, In: tree of Boolean; same code as domprop
subtraction = Subtraction(A=item.Item1, B=domprop.T0)
subtraction_2 = Subtraction(A=item.Item, B=domprop_2.T0)
division = Division(A=multiplication, B=domprop.L)
division_2 = Division(A=multiplication_2, B=domprop_2.L)
merge = Merge(Data1=subtraction_2, Data2=subtraction)
panel = Panel(merge)
filter = StreamFilter(Gate=bywidth_2, Stream0=division, Stream1=division_2)
multiplication_3 = Multiplication(A=merge, B=filter)
division_3 = Division(A=multiplication_3, B=number_slider)
roundd = RoundToDecimalPlace(NumberX=multiplication_3, DecimalPlace="2", RoundType=0)  # -> Rounded, Difference
roundd_2 = RoundToDecimalPlace(NumberX=division_3, DecimalPlace="2", RoundType=0)  # -> Rounded, Difference
svgpath = SVGPath(
    coordinates=roundd.Rounded,
    isdecimalpattern=desvgpath.isdecimalpattern_2,
    commands=desvgpath.commands_2,
    zpaths=desvgpath.zpaths_2,
    nonzpaths=desvgpath.nonzpaths_2)
svgpath_2 = SVGPath(
    coordinates=roundd_2.Rounded,
    isdecimalpattern=desvgpath.isdecimalpattern_2,
    commands=desvgpath.commands_2,
    zpaths=desvgpath.zpaths_2,
    nonzpaths=desvgpath.nonzpaths_2)
coordinates = Number(roundd.Rounded)
svg_path_cm = Text(svgpath_2)
svg_path_3 = Text(svgpath)
svg_path_4 = ClusterOutput(svg_path_3)
coordinates_2 = ClusterOutput(coordinates)
svg_path_cm_2 = ClusterOutput(svg_path_cm)

# ==== cluster SVGPath
coordinates = ClusterInput()
isdecimalpattern = ClusterInput()
commands = ClusterInput()
zpaths = ClusterInput()
nonzpaths = ClusterInput()
isdecimalpattern_2 = Boolean(isdecimalpattern)
coordinates_2 = Number(coordinates)
commands_2 = Text(commands)
nonzpaths_2 = DataPath(nonzpaths)
zpaths_2 = DataPath(zpaths)
join = TextJoin(Text=coordinates_2, Join=",")
dispatch = Dispatch(List=join, DispatchPattern=isdecimalpattern_2)  # -> ListA, ListB
clean = CleanTree(RemoveNulls=True, RemoveInvalid=True, RemoveEmpty=True, Tree=dispatch.ListB)
concat = Concatenate(FragmentA=commands_2, FragmentB=clean)
merge = Merge(Data1=dispatch.ListA, Data2=concat)
trim = TrimTree(Tree=merge, Depth=1)
branch = TreeBranch(Tree=trim, Path=nonzpaths_2, MaintainPaths=True)
branch_2 = TreeBranch(Tree=trim, Path=zpaths_2, MaintainPaths=True)
item = ListItem(List=branch_2, Index=0, Wrap=True)
mtchanc = MatchAncestor(AT="z", CT=item)  # -> MAT; inputs AT: tree, CT: tree
# ---------- mtchanc: Python ----------
if ghenv.Component.RunCount<2:
    __author__ = "Ueli Saluz"
    __version__ = "2022.04.25"
    
    ghenv.Component.Name = "Match Ancestor"
    ghenv.Component.NickName = "MtchAnc"
    ghenv.Component.Description = "Duplicates all elements of an ancestor tree to match the amount of elements in the child tree."
    ghenv.Component.Message = "VER 1.1"
    
    ghenv.Component.Params.Input[0].Name = "AncestorTree"
    ghenv.Component.Params.Input[0].NickName = "AT"
    ghenv.Component.Params.Input[0].Description = "Ancestor tree that data will the duplicated until it matches the child tree"
    ghenv.Component.Params.Input[0].Optional = False
    
    ghenv.Component.Params.Input[1].Name = "ChildTree"
    ghenv.Component.Params.Input[1].NickName = "CT"
    ghenv.Component.Params.Input[1].Description = "Child tree that branches will the guide to duplicat the data of the ancestor tree"
    ghenv.Component.Params.Input[0].Optional = False
    
    ghenv.Component.Params.Output[0].Name = "MatchedAncestorTree"
    ghenv.Component.Params.Output[0].NickName = "MAT"
    ghenv.Component.Params.Output[0].Description = "Matched ancestor tree with the amount of items and the branch paths of the child tree"

from System import Object
from Grasshopper import DataTree

"""Returns a new tree with the ancestor data being duplicated along all child branches which where child paths of that ancestor.
    Inputs:
        ancestorTree: Ancestor tree that data will the duplicated until it matches the child tree
        childTree: Child tree that branches will the guide to duplicat the data of the ancestor tree
    Output:
        matchedAncestorTree: Matched ancestor tree with the amount of items and the branch paths of the child tree"""
def MatchAncestorTreeToChildTree (ancestorTree, childTree):
    
    matchedAncestorTree = DataTree[Object]()
    dummy = 0
    for i,pathAncestor in enumerate(ancestorTree.Paths):
        branch = ancestorTree.Branch(pathAncestor)
        if len(branch)!=1:
            raise Exception("Ancestor must be grafted and containing one item per branch")
        #The item to be duplicated
        item = branch[0]
        for j,pathChild in enumerate(childTree.Paths):
            #Returns a tuple and not like in the documentation described a bool with a pointer to the int to store the generations
            checkAncestor = pathChild.IsAncestor(pathAncestor,dummy)
            if(checkAncestor[0]):
                matchedAncestorTree.AddRange([item]*childTree.Branch(pathChild).Count,pathChild)
    return matchedAncestorTree

if __name__ == "__main__":
    MAT = MatchAncestorTreeToChildTree (AT,CT)
# ---------- end mtchanc ----------
merge_2 = Merge(Data1=branch_2, Data2=mtchanc)
merge_3 = Merge(Data1=merge_2, Data2=branch)
join_2 = TextJoin(Text=merge_3, Join=" ")
trim_2 = TrimTree(Tree=join_2, Depth=1)
svg_path = Text(trim_2)
svg_path_2 = ClusterOutput(svg_path)

# ==== cluster DeSVGPath
svg_path = ClusterInput()
svg_path_2 = Text(svg_path)
tmatch = MatchText(Text=svg_path_2, RegEx="z", Case=True)
split = TextSplit(Text=svg_path_2, Separators=" ")
tstat = TreeStatistics(Tree=split)  # -> flatten(Paths), flatten(Length), Count
dispatch = Dispatch(List=tstat.Paths, DispatchPattern=flatten(tmatch))  # -> ListA, ListB
branch = TreeBranch(Tree=split, Path=dispatch.ListB, MaintainPaths=True)
branch_2 = TreeBranch(Tree=split, Path=dispatch.ListA, MaintainPaths=True)
lito3p = ListInto3Parts(ListToSlice=branch_2, StartIndex=0, EndIndex="-1")  # -> FilteredList, ItemsBefore, ItemsAfter; inputs ListToSlice: tree, StartIndex: tree of Int32, EndIndex: tree of Int32
# ---------- lito3p: Python ----------
if ghenv.Component.RunCount<2:
    __author__ = "Ueli Saluz"
    __version__ = "2020.05.28"
    
    ghenv.Component.Name = "ListInto3Parts"
    ghenv.Component.NickName = "LiTo3P"
    ghenv.Component.Description = "Slice list into 3 parts. All lists are sliced with the same indices. End index = 0 = length(list)."
    ghenv.Component.Message = "VER 1.6"

from System import Object
from Grasshopper import DataTree

def filterList(listToFilter,startIndex,endIndex):
    # Return: FilteredList, Before, After
    if (((startIndex == 0) or (startIndex is None)) and ((endIndex == 0) or (endIndex is None))) or (endIndex <= startIndex and endIndex > 0):
        return (listToFilter,None,None)
    elif (startIndex == 0) or (startIndex is None):
        return (listToFilter[:endIndex],None,listToFilter[endIndex:])
    elif (endIndex == 0) or (endIndex is None):
        print 1
        return (listToFilter[:startIndex],listToFilter[startIndex:],None)
    else:
        return (listToFilter[startIndex:endIndex],listToFilter[:startIndex],listToFilter[endIndex:])

if __name__ == "__main__":
    FilteredList = DataTree[Object]()
    ItemsBefore = DataTree[Object]()
    ItemsAfter = DataTree[Object]()
    
    for path in ListToSlice.Paths:
        listBranch = ListToSlice.Branch(path)
        pyList = list(listBranch)   #Convert .Net List to Python
        try: #terrible way of writing code but if I set the list to list access the performance decreases massivly due to many calls
            startIndex = StartIndex.Branch(path)
            startIndex = startIndex[0]
        except Exception:
            try:
                startIndex = StartIndex.Branch(0)
                startIndex = startIndex[0]
            except Exception:
                startIndex = 0
        try:
            endIndex = EndIndex.Branch(path)
            endIndex = endIndex[0]
        except Exception:
            try:
                endIndex = EndIndex.Branch(0)
                endIndex = endIndex[0]
            except Exception:
                endIndex = len(pyList)
        filtList=filterList(pyList,startIndex,endIndex)
        if filtList[0]:
            FilteredList.AddRange(filtList[0],path)
        if filtList[1]:
            ItemsBefore.AddRange(filtList[1],path)
        if filtList[2]:
            ItemsAfter.AddRange(filtList[2],path)
# ---------- end lito3p ----------
merge = Merge(Data1=lito3p.FilteredList, Data2=branch)  # -> graft(Result)
tmatch_2 = MatchText(Text=merge, RegEx="^\d", Case=True)
dispatch_2 = Dispatch(List=merge, DispatchPattern=tmatch_2)  # -> ListA, ListB
chars = Characters(Text=dispatch_2.ListB)  # -> Result, Unicode
trim = TrimTree(Tree=chars.Result, Depth=1)
lito3p_2 = ListInto3Parts(ListToSlice=trim, StartIndex="1")  # -> FilteredList, ItemsBefore, ItemsAfter; inputs ListToSlice: tree, StartIndex: tree of Int32, EndIndex: tree of Int32; same code as lito3p
join = TextJoin(Text=lito3p_2.FilteredList)
merge_2 = Merge(Data1=dispatch_2.ListA, Data2=join)
split_2 = TextSplit(Text=merge_2, Separators=",")
trim_2 = TrimTree(Tree=split_2, Depth=1)
isdecimalpattern = Boolean(tmatch_2)
commands = Text(lito3p_2.ItemsBefore)
zpaths = DataPath(dispatch.ListA)
nonzpaths = DataPath(dispatch.ListB)
coordinates = Number(trim_2)
zpaths_2 = ClusterOutput(zpaths)
nonzpaths_2 = ClusterOutput(nonzpaths)
commands_2 = ClusterOutput(commands)
coordinates_2 = ClusterOutput(coordinates)
isdecimalpattern_2 = ClusterOutput(isdecimalpattern)
