# Grasshopper definition tests.gh (Grasshopper 1.0.8)
# Copyright: GNU Lesser General Public License Version 3
# plug-ins: RhinoCodePluginGH, semio

validate = BooleanToggle(True)
list = ValueList({"Full": 0, "Towers": 1, "First Tower": 2, "Second Tower": 3, "Chain": 4, "Module": 5, "Y": 6, "Self": 7}, selected="Full")

spt = ModelScreenPoint(Validate=validate)  # -> ScreenPoint, Valid, X, Y

# ----
# Point missing
# Direction missing
por = ModelPort(Validate=validate)  # -> Port, Valid, Id, Point, Direction, Locators

# ----
# Url missing
rep = ModelRepresentation(Validate=validate)  # -> Representation, Valid, Url, Mime, Lod, Tags

# ----
# Group missing
loc = ModelLocator(Validate=validate)  # -> Locator, Valid, Group, Subgroup

number_slider = Slider(3, range=0..10)
custom_plane = BooleanToggle(False)
pt = ConstructPoint(XCoordinate=Slider(5, range=-10..10), YCoordinate=Slider(-7, range=-10..10), ZCoordinate=Slider(8, range=-10..10))
pt_2 = ConstructPoint(
    XCoordinate=Slider(-0.4, range=-10..10),
    YCoordinate=Slider(-4.5, range=-10..10),
    ZCoordinate=Slider(-1.1, range=-10..10))
pt_3 = ConstructPoint(XCoordinate=Slider(3.2, range=-10..10), YCoordinate=Slider(-4.1, range=-10..10), ZCoordinate=Slider(-2.2, range=-10..10))

# ----
# Constructors
# Name missing
qal = ModelQuality(Validate=validate)  # -> Quality, Valid, Name, Value, Unit, Definition

filter = StreamFilter(Gate=list)

# ----
# Connected equal Connecting
con = ModelConnection(Validate=validate)  # -> Connection, Valid, ConnectedPieceId, ConnectedPieceTypePortId, ConnectingPieceId, ConnectingPieceTypePortId, Rotation, Tilt, Gap, Shift

toggle = BooleanToggle(False)
dn = Design([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])
dn_2 = Design("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")
dn_3 = Design("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")

# ----
# Type Name missing
pce = ModelPiece(Validate=validate)  # -> Piece, Valid, Id, TypeName, TypeVariant, Plane, ScreenPoint

pl_3pt = Plane3Pt(PointA=pt, PointB=pt_2, PointC=pt_3)
xy = XYPlane(Origin=Point(0, 0, 0))
filter_2 = StreamFilter(Gate=custom_plane, Stream0=xy, Stream1=pl_3pt)
item = ListItem(List=dn_2, Index=number_slider, Wrap=True)

# ----
# Name missing
typ = ModelType(Validate=validate)  # -> Type, Valid, Name, Description, Icon, Variant, Unit, Representations, Ports, Qualities

curdir = CurrentDirectory()  # -> D, P, PP, S
# ---------- curdir: C# ----------
#region Usings
using System;
using System.Linq;
using System.Collections;
using System.Collections.Generic;
using System.Drawing;
using System.IO;

using Rhino;
using Rhino.Geometry;

using Grasshopper;
using Grasshopper.Kernel;
using Grasshopper.Kernel.Data;
using Grasshopper.Kernel.Types;
#endregion

public class Script_Instance : GH_ScriptInstance
{
    private void RunScript(ref object D, ref object P, ref object PP, ref object S)
    {
        D = Path.GetDirectoryName(this.GrasshopperDocument.FilePath);
        var p = new DirectoryInfo(this.GrasshopperDocument.FilePath).Parent.Parent;
        P = p.ToString();
        PP = p.Parent.ToString();
        S = Path.DirectorySeparatorChar;
    }
}
# ---------- end curdir ----------

# ----
# Name missing
dsn = ModelDesign(Validate=validate)  # -> Design, Valid, Name, Description, Icon, Variant, Unit, Pieces, Connections, Qualities

curdir_2 = CurrentDirectory()  # -> D, P, PP, S; same code as curdir

energy_global_warming_potential_kgco2e_k = ValueList({"Natural Gas": 0.201, "Heating Oil": 0.216, "Electricity Non-Renewable": 0.5, "Electricity Renewable": 0}, selected="Natural Gas")  # "Energy Global Warming Potential [kgCO2e/kWh]"
energy_global_warming_potential_kgco2e_k_2 = ValueList({"Natural Gas": 0.201, "Heating Oil": 0.216, "Electricity Non-Renewable": 0.5, "Electricity Renewable": 0}, selected="Electricity Non-Renewable")  # "Energy Global Warming Potential [kgCO2e/kWh]"
energy_price_kwh = ValueList({"Natural Gas": 0.095, "Heating Oil": 0.10, "Electricity Non-Renewable": 0.25, "Electrictiy Renewable": 0.35}, selected="Natural Gas")
energy_price_kwh_2 = ValueList({"Natural Gas": 0.095, "Heating Oil": 0.10, "Electricity Non-Renewable": 0.25, "Electrictiy Renewable": 0.35}, selected="Electricity Non-Renewable")
number_slider_2 = Slider(0.9, range=0.5..4)
number_slider_3 = Slider(0.9, range=0.5..4)

trim = TrimTree(Depth=1)

# ----
# Name missing
kit = ModelKit(Validate=validate)  # -> Kit, Valid, Name, Description, Icon, Version, Remote, Homepage, Types, Designs

concat = Concatenate(FragmentA=curdir.D, FragmentD=curdir.S, FragmentB="local")
concat_2 = Concatenate(FragmentA=curdir_2.PP, FragmentD=curdir_2.S, FragmentB="examples", FragmentC=curdir_2.S, FragmentE="metabolism")
nordsn = NormalizeDesign_2(dn=dn_2)
concat_3 = Concatenate(FragmentA=concat, FragmentC=curdir.S, FragmentE="kit")
kit_2 = LoadKit(Uri=concat_3, Run=Toggle(True))  # -> Kit, Success, LocalDirectory
dsn_2 = PutDesign(Design=dn_2, Uri=concat_3, Run=Toggle(True))
kit_3 = ModelKit(Kit=kit_2.Kit)  # -> Kit, Valid, Name, Description, Icon, Remote, Homepage, Types, Designs, Designs_2
trim_2 = TrimTree(Tree=kit_3.Designs, Depth=1)
nordsn_2 = NormalizeDesign_2(dn=trim_2)
# Change parameters
panel = Panel("/")

genes = GenePool(Decimals=0, Maximum=8, Minimum=0, Value=[8, 8, 8, 8, 8, 8, 8, 8, 8, 8, 8])
genes_2 = GenePool(Decimals=0, Maximum=8, Minimum=0, Value=[6, 0, 0, 6, 0, 3, 6, 6, 0])
genes_3 = GenePool(Decimals=0, Maximum=8, Minimum=0, Value=[6, 6, 6, 6, 6, 6, 6, 7, 7])
genes_4 = GenePool(Decimals=0, Maximum=8, Minimum=0, Value=[6, 0, 0, 0, 6, 6, 0, 6, 0, 6, 3])

dsn_3 = SerializeDesign(Design=nordsn)
dsn_4 = SerializeDesign(Design=nordsn_2)
panel_2 = Panel("NameToooooooooooooooooLoooooooooooooooooooooonggggggggggggggggggg")
panel_3 = Panel("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")
panel_4 = Panel("IdToooooooooooooooooooooooooooooooooooooooLooooooooooooooooooooooooooooooooooooooooooooooooooongggggggggggggggggggggggggggggggggg")
expression = Expression(x=dsn_3, y=dsn_4, Expression="x=y")
panel_5 = Panel(expression)
panel_6 = Panel("SecondName")

# ----
# In=Out (Serialization must be the same)
toggle_2 = BooleanToggle(True)
kit_4 = DeleteKit(Url=concat_3, Run=toggle_2)
kt = Kit("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")
expression_2 = Expression(x=toggle_2, y=kit_4, Expression="x")
kit_5 = SerializeKit(Kit=kt)
kit_6 = CreateKit(Kit=kt, Uri=concat_3, Run=expression_2)
expression_3 = Expression(x=toggle_2, y=kit_6, Expression="x")
kit_7 = LoadKit(Uri=concat_3, Run=expression_3)  # -> Success, Kit, LocalDirectory
kit_8 = SerializeKit(Kit=kit_7.Kit)
expression_4 = Expression(x=kit_5, y=kit_8, Expression="x=y")
must_be_true = Panel(expression_4)

txt = EncodeText(Text=concat_3)
item_2 = ListItem(List=dsn_3, Index=number_slider, Wrap=True)
item_3 = ListItem(List=dsn_4, Index=number_slider, Wrap=True)
panel_7 = Panel(txt)

# ----
# Id too long
pt_4 = ConstructPoint(XCoordinate=0, YCoordinate=0, ZCoordinate=0)
X = UnitX(Factor=1)
por_2 = ModelPort(Validate=validate, Id=panel_4, Point=pt_4, Direction=X)  # -> Port, Valid, Id, Point, Direction, Locators

futuristic = BooleanToggle(False)
xy_2 = XYPlane(Origin=Point(0, 0, 0))
list_2 = ValueList({"1to500", "1to200"}, selected="1to500")

tambour_tilt = Slider(-2.186, range=-360..360)
tambour_gap = Slider(7.525, range=-10..10)
tambour_shift = Slider(0.487, range=-10..10)
capsule_rotation = Slider(-1.252, range=-360..360)
capsule_tilt = Slider(3.069, range=-360..360)
capsule_shift = Slider(4.689, range=-10..10)
tambour_rotation = Slider(14.853, range=-360..360)
capsule_gap = Slider(2.622, range=-10..10)
capital_rotation = Slider(2.964, range=-360..360)
capital_tilt = Slider(-2.478, range=-360..360)
capital_gap = Slider(6.98, range=-10..10)
capital_shift = Slider(0.274, range=-10..10)
shaft_rotation = Slider(9.948, range=-360..360)
shaft_tilt = Slider(4.793, range=-360..360)
shaft_gap = Slider(5.216, range=-10..10)
shaft_shift = Slider(5.147, range=-10..10)

capsule_rotation_2 = Slider(0, range=-360..360)
tambour_rotation_2 = Slider(0, range=-360..360)
tambour_tilt_2 = Slider(0, range=-360..360)
tambour_gap_2 = Slider(0, range=-10..10)
tambour_shift_2 = Slider(0, range=-10..10)
capsule_tilt_2 = Slider(0, range=-360..360)
capsule_gap_2 = Slider(0, range=-10..10)
capsule_shift_2 = Slider(0, range=-10..10)
capital_tilt_2 = Slider(0, range=-360..360)
capital_gap_2 = Slider(0, range=-10..10)
shaft_tilt_2 = Slider(0, range=-360..360)
shaft_gap_2 = Slider(0, range=-10..10)
shaft_shift_2 = Slider(0, range=-10..10)
capital_rotation_2 = Slider(0, range=-360..360)
capital_shift_2 = Slider(0, range=-10..10)
shaft_rotation_2 = Slider(0, range=-360..360)

# ----
# Url too long
rep_2 = ModelRepresentation(Validate=validate, Url="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")  # -> Representation, Valid, Url, Mime, Lod, Tags

# ----
# Lod too long
rep_3 = ModelRepresentation(Validate=validate, Url="https://url", Mime="https://url", Lod=panel_2)  # -> Representation, Valid, Url, Mime, Lod, Tags

pln = Plane(Plane(origin=(70, 80, -20), x=(0.243952672, 0.9683632361, -0.05253319695), y=(-0.9613751256, 0.234362177, -0.1443337724)))

# ----
# Description too long
typ_2 = ModelType(Validate=validate, Name="Name", Description=panel_3)  # -> Type, Valid, Name, Description, Icon, Variant, Unit, Representations, Ports, Qualities

# ----
# Props
# Tag too long
rep_4 = ModelRepresentation(Validate=validate, Url="https://url", Mime="https://url", Tags=panel_2)  # -> Representation, Valid, Url, Mime, Lod, Tags

# ----
# Id too long
pce_2 = ModelPiece(Validate=validate, Id=panel_4, TypeName="Name")  # -> Piece, Valid, Id, TypeName, TypeVariant, Plane, ScreenPoint

cnvunt = ConvertUnit(Value=1, FromUnit="cm", ToUnit="m")

# ----
# Description too long
dsn_5 = ModelDesign(Validate=validate, Name="Name", Description=panel_3)  # -> Design, Valid, Name, Description, Icon, Variant, Unit, Pieces, Connections, Qualities

# ----
# Mime too long
rep_5 = ModelRepresentation(Validate=validate, Url="https://url", Mime=panel_4)  # -> Representation, Valid, Url, Mime, Lod, Tags

panel_8 = Panel("12")  # disabled

# ----
# Description too long
kit_9 = ModelKit(Validate=validate, Name="Name", Description=panel_3)  # -> Kit, Valid, Name, Description, Icon, Version, Remote, Homepage, Types, Designs

# ----
# Connected equal Connecting
con_2 = ModelConnection(Validate=validate, ConnectedPieceId="0", ConnectingPieceId="0")  # -> Connection, Valid, ConnectedPieceId, ConnectedPieceTypePortId, ConnectingPieceId, ConnectingPieceTypePortId, Rotation, Tilt, Gap, Shift

# ----
# Piece not part
con_3 = ModelConnection(ConnectedPieceId="0", ConnectingPieceId="1")  # -> Connection, Valid, ConnectedPieceId, ConnectedPieceTypePortId, ConnectingPieceId, ConnectingPieceTypePortId, Rotation, Tilt, Gap, Shift
dsn_6 = ModelDesign(Validate=validate, Name="Name", Connections=con_3.Connection)  # -> Design, Valid, Name, Description, Icon, Variant, Unit, Pieces, Connections, Qualities

relay = Relay()
fltdsn = FlattenDesign(Design=relay)
concat_4 = Concatenate(FragmentA=concat, FragmentC=curdir.S, FragmentE="after.json")
kit_10 = SerializeKit()
dsn_7 = SerializeDesign(Design=fltdsn)
typ_3 = SerializeType()
concat_5 = Concatenate(FragmentA=concat, FragmentC=curdir.S, FragmentE="before.json")
xy_3 = XYPlane(Origin=Point(-41.49243504, 23.95616042, 0))
relay_2 = Relay()
xy_4 = XYPlane(Origin=Point(-3.798026312, 18.24230209, 0))
kit_11 = CreateKit(Kit=relay_2, Uri=concat_3, Run=Toggle(False))
kit_12 = DeleteKit(Url=concat_3, Run=Toggle(False))
kit_13 = LoadKit(Url=concat_3, Run=Toggle(False))  # -> Kit, Success, LocalDirectory
py3 = Python3Script(path=concat_5, content=item_2, run=toggle)  # -> out; inputs path: String, content: String
# ---------- py3: Python ----------
if run:
    with open(path, 'w', encoding='utf-8') as f:
        f.write(content)
# ---------- end py3 ----------
py3_2 = Python3Script(path=concat_4, content=item_3, run=toggle)  # -> out; inputs path: String, content: String; same code as py3
typ_4 = PutType(Uri=concat_3, Run=Toggle(False))
typ_5 = RemoveType(Uri=concat_3, Run=Toggle(False))
dsn_8 = PutDesign(Uri=concat_3, Run=Toggle(False))
file = ReadFile(File=concat_5, PerLineParse=False)  # disabled
dsn_9 = RemoveDesign(Uri=concat_3, Run=Toggle(False))
pce_3 = ModelPiece(Id="b3", TypeName="Base", Plane=xy_3)  # -> Piece, Valid, Id, TypeName, TypeVariant, Plane, ScreenPoint
pce_4 = ModelPiece(Id="t_b3", TypeName="Tambour", Plane=xy_3)  # -> Piece, Valid, Id, TypeName, TypeVariant, Plane, ScreenPoint
pce_5 = ModelPiece(Id="t_z2", TypeName="Tambour")  # -> Piece, Valid, Id, TypeName, TypeVariant, Plane, ScreenPoint
pce_6 = ModelPiece(Id="z2", TypeName="Base", Plane=xy_4)  # -> Piece, Valid, Id, TypeName, TypeVariant, Plane, ScreenPoint
con_4 = ModelConnection(ConnectedPieceId=pce_3.Id, ConnectedPieceTypePortId="c1", ConnectingPieceId=pce_4.Id, ConnectingPieceTypePortId="b")  # -> Connection, Valid, ConnectedPieceId, ConnectedPieceTypePortId, ConnectingPieceId, ConnectingPieceTypePortId, Rotation, Tilt, Gap, Shift
con_5 = ModelConnection(ConnectedPieceId=pce_6.Id, ConnectedPieceTypePortId="c1", ConnectingPieceId=pce_5.Id, ConnectingPieceTypePortId="b")  # -> Connection, Valid, ConnectedPieceId, ConnectedPieceTypePortId, ConnectingPieceId, ConnectingPieceTypePortId, Rotation, Tilt, Gap, Shift

# ----
# Create, delete or load the kit
panel_9 = Panel("https://github.com/usalu/semio")
ty = Type([null x29])
dn_4 = Design([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])
concat_6 = Concatenate(FragmentD=panel_9, FragmentA="/releases/download/", FragmentB="r24.12-2", FragmentC="/examples.zip")
concat_7 = Concatenate(FragmentA=panel_9, FragmentB="/tree/", FragmentC="r24.12-2", FragmentD="/examples/metabolism")
kit_14 = ModelKit(
    Name="Metabolism",
    Description="Everything for metabolistic architecture.",
    Version="r24.12-2",
    Remote=concat_6,
    Homepage=concat_7,
    Types=ty)  # -> Kit, Valid, Name, Description, Icon, Version, Remote, Homepage, Types, Designs
delete_kit = BooleanToggle(False)
create_kit = BooleanToggle(False)
load_kit = BooleanToggle(True)
validate_2 = BooleanToggle(False)
kit_15 = DeleteKit(Uri=concat_3, Run=delete_kit)
kit_16 = CreateKit(Kit=kit_14.Kit, Uri=concat_3, Run=create_kit)

kit_17 = CreateKit(Kit=kit_14.Kit, Uri=concat_3, Run=Toggle(True))
kit_18 = LoadKit(Uri=concat_3, Run=load_kit)  # -> Success, Kit, LocalDirectory

kit_19 = ModelKit(Kit=kit_18.Kit)  # -> Kit, Valid, Name, Description, Icon, Version, Remote, Homepage, Types, Designs
trim_3 = TrimTree(Tree=kit_19.Types, Depth=1)

shwdsn = ShowDesign_2(dn=graft(dn_4), ty=trim_3, mm="model/vnd.3dm", lod=list_2, tags="volume")  # -> id_2, ur_2, pln_2

# ----
# Normalization not affecting semantics
item_4 = ListItem(List=dn_4, Index=0, Wrap=True)
nordsn_3 = NormalizeDesign(dn=item_4)
shwdsn_2 = ShowDesign_2(dn=nordsn_3, ty=trim_3, mm="model/vnd.3dm", lod=list_2, tags="volume")  # -> id_2, ur_2, pln_2
shwdsn_3 = ShowDesign_2(dn=item_4, ty=trim_3, mm="model/vnd.3dm", lod=list_2, tags="volume")  # -> id_2, ur_2, pln_2
tsort = SortText(Keys=shwdsn_2.id_2, Values=shwdsn_2.pln_2, Culture=127)  # -> Keys, Values
tsort_2 = SortText(Keys=shwdsn_3.id_2, Values=shwdsn_3.pln_2, Culture=127)  # -> Keys, Values
expression_5 = Expression(x=tsort_2.Values, y=tsort.Values, Expression="x=y")
mm = MassMultiplication(Input=expression_5)  # -> Result, PartialResults
bool = Boolean(mm.Result)
must_be_true_2 = Panel(bool)

tsort_3 = SortText(Keys=shwdsn.id_2, Values=shwdsn.pln_2, Culture=127)  # -> Keys, Values
base_with_twin_capsule_towers_with_capit = BaseWithTwinCapsuleTowersWithCapital(
    ty=trim_3,
    variant="Flying Baroque",
    futuristic=invert(futuristic),
    lod=list_2,
    tags="volume",
    capsule_corner_ne=genes_2,
    capsule_corner_se=genes_3,
    capsule_corner_sw=genes,
    capsule_corner_nw=genes_4,
    shaft_rotation=shaft_rotation,
    shaft_tilt=shaft_tilt,
    shaft_gap=shaft_gap,
    shaft_shift=shaft_shift,
    tambour_rotation=tambour_rotation,
    tambour_tilt=tambour_tilt,
    tambour_gap=tambour_gap,
    tambour_shift=tambour_shift,
    capsule_rotation=capsule_rotation,
    capsule_tilt=capsule_tilt,
    capsule_gap=capsule_gap,
    capsule_shift=capsule_shift,
    capital_rotation=capital_rotation,
    capital_tilt=capital_tilt,
    capital_gap=capital_gap,
    capital_shift=capital_shift,
    base_plane=pln,
    heating_energy_price_kwh=energy_price_kwh,
    heating_efficiency_factor=number_slider_2,
    heating_global_warming_potential_kgco2e=energy_global_warming_potential_kgco2e_k,
    cooling_energy_price_kwh=energy_price_kwh_2,
    cooling_efficiency_factor=number_slider_3,
    cooling_global_warming_potential_kgco2e=energy_global_warming_potential_kgco2e_k_2,
    electrictiy_energy_price_cent_kwh=energy_price_kwh_2,
    electrictiy_global_warming_potential_kgc=energy_global_warming_potential_kgco2e_k_2)  # -> dn, ur, pln, effective_floor_area_m²_2, specific_operational_global_warming_pote_2, construction_cost_mio_2, return_a_2, construction_global_warming_potential_tc_2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; "Base with Twin Capsule Towers with Capital"; disabled
base_with_twin_capsule_towers_with_capit_2 = BaseWithTwinCapsuleTowersWithCapital(
    ty=trim_3,
    futuristic=futuristic,
    lod=list_2,
    tags="volume",
    capsule_corner_ne=genes_2,
    capsule_corner_se=genes_3,
    capsule_corner_sw=genes,
    capsule_corner_nw=genes_4,
    shaft_rotation=shaft_rotation_2,
    shaft_tilt=shaft_tilt_2,
    shaft_gap=shaft_gap_2,
    shaft_shift=shaft_shift_2,
    tambour_rotation=tambour_rotation_2,
    tambour_tilt=tambour_tilt_2,
    tambour_gap=tambour_gap_2,
    tambour_shift=tambour_shift_2,
    capsule_rotation=capsule_rotation_2,
    capsule_tilt=capsule_tilt_2,
    capsule_gap=capsule_gap_2,
    capsule_shift=capsule_shift_2,
    capital_rotation=capital_rotation_2,
    capital_tilt=capital_tilt_2,
    capital_gap=capital_gap_2,
    capital_shift=capital_shift_2,
    base_plane=filter_2,
    heating_energy_price_kwh=energy_price_kwh,
    heating_efficiency_factor=number_slider_2,
    heating_global_warming_potential_kgco2e=energy_global_warming_potential_kgco2e_k,
    cooling_energy_price_kwh=energy_price_kwh_2,
    cooling_efficiency_factor=number_slider_3,
    cooling_global_warming_potential_kgco2e=energy_global_warming_potential_kgco2e_k_2,
    electrictiy_energy_price_cent_kwh=energy_price_kwh_2,
    electrictiy_global_warming_potential_kgc=energy_global_warming_potential_kgco2e_k_2)  # -> dn, ur, pln, effective_floor_area_m²_2, specific_operational_global_warming_pote_2, construction_cost_mio_2, return_a_2, construction_global_warming_potential_tc_2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; "Base with Twin Capsule Towers with Capital"; disabled

# ----
# Save the designs
merge = Merge(Data1=base_with_twin_capsule_towers_with_capit_2.dn, Data2=base_with_twin_capsule_towers_with_capit.dn)
save = BooleanToggle(False)
dsn_10 = PutDesign(Design=merge, Run=save)

return_a = Panel(base_with_twin_capsule_towers_with_capit_2.return_a_2)
operational_cost_mio_a = Panel(base_with_twin_capsule_towers_with_capit_2.operational_cost_mio_a_2)
maintenance_expenses_mio_a = Panel(base_with_twin_capsule_towers_with_capit_2.maintenance_expenses_mio_a_2)
# Evaluate metrics
effective_floor_area_m² = Panel(base_with_twin_capsule_towers_with_capit_2.effective_floor_area_m²_2)
construction_cost_mio = Panel(base_with_twin_capsule_towers_with_capit_2.construction_cost_mio_2)
income_mio_a = Panel(base_with_twin_capsule_towers_with_capit_2.income_mio_a_2)
operational_energy_cost_a = Panel(base_with_twin_capsule_towers_with_capit_2.operational_energy_cost_a_2)
operational_global_warming_potential_tco = Panel(base_with_twin_capsule_towers_with_capit_2.operational_global_warming_potential_tco_2)  # "Operational Global Warming Potential [tCO2e/a]"
technical_equipment_energy_demand_mwh_a = Panel(base_with_twin_capsule_towers_with_capit_2.technical_equipment_energy_demand_mwh_a_2)
specific_operational_global_warming_pote = Panel(base_with_twin_capsule_towers_with_capit_2.specific_operational_global_warming_pote_2)  # "Specific Operational Global Warming Potential [kgCO2e/m²a]"
construction_global_warming_potential_tc = Panel(base_with_twin_capsule_towers_with_capit_2.construction_global_warming_potential_tc_2)  # "Construction Global Warming Potential [tCO2e]"
specific_energy_demand_kwh_m²a = Panel(base_with_twin_capsule_towers_with_capit_2.specific_energy_demand_kwh_m²a_2)
heating_energy_demand_mwh_a = Panel(base_with_twin_capsule_towers_with_capit_2.heating_energy_demand_mwh_a_2)
cooling_energy_demand_mwh_a = Panel(base_with_twin_capsule_towers_with_capit_2.cooling_energy_demand_mwh_a_2)

# ----
# Interpolate
inpdsn = Interpolate_2(
    S=base_with_twin_capsule_towers_with_capit_2.dn,
    T=base_with_twin_capsule_towers_with_capit.dn,
    t=Slider(0.33, range=0..1))  # -> dn_s_u_t_2, dn_s_t_2, dn_t_s_2
shwdsn_4 = ShowDesign_2(dn=inpdsn.dn_s_u_t_2, ty=trim_3, mm="model/vnd.3dm", lod=list_2, tags="volume")  # -> id_2, ur_2, pln_2

effective_floor_area_m²_2 = Panel(base_with_twin_capsule_towers_with_capit.effective_floor_area_m²_2)
construction_cost_mio_2 = Panel(base_with_twin_capsule_towers_with_capit.construction_cost_mio_2)
return_a_2 = Panel(base_with_twin_capsule_towers_with_capit.return_a_2)
income_mio_a_2 = Panel(base_with_twin_capsule_towers_with_capit.income_mio_a_2)
operational_cost_mio_a_2 = Panel(base_with_twin_capsule_towers_with_capit.operational_cost_mio_a_2)
operational_energy_cost_a_2 = Panel(base_with_twin_capsule_towers_with_capit.operational_energy_cost_a_2)
maintenance_expenses_mio_a_2 = Panel(base_with_twin_capsule_towers_with_capit.maintenance_expenses_mio_a_2)
construction_global_warming_potential_tc_2 = Panel(base_with_twin_capsule_towers_with_capit.construction_global_warming_potential_tc_2)  # "Construction Global Warming Potential [tCO2e]"
operational_global_warming_potential_tco_2 = Panel(base_with_twin_capsule_towers_with_capit.operational_global_warming_potential_tco_2)  # "Operational Global Warming Potential [tCO2e/a]"
heating_energy_demand_mwh_a_2 = Panel(base_with_twin_capsule_towers_with_capit.heating_energy_demand_mwh_a_2)
cooling_energy_demand_mwh_a_2 = Panel(base_with_twin_capsule_towers_with_capit.cooling_energy_demand_mwh_a_2)
technical_equipment_energy_demand_mwh_a_2 = Panel(base_with_twin_capsule_towers_with_capit.technical_equipment_energy_demand_mwh_a_2)
specific_operational_global_warming_pote_2 = Panel(base_with_twin_capsule_towers_with_capit.specific_operational_global_warming_pote_2)  # "Specific Operational Global Warming Potential [kgCO2e/m²a]"
specific_energy_demand_kwh_m²a_2 = Panel(base_with_twin_capsule_towers_with_capit.specific_energy_demand_kwh_m²a_2)

inpdsn_2 = Interpolate_2(
    S=base_with_twin_capsule_towers_with_capit_2.dn,
    T=base_with_twin_capsule_towers_with_capit.dn,
    t=Slider(0.66, range=0..1))  # -> dn_s_u_t_2, dn_s_t_2, dn_t_s_2
shwdsn_5 = ShowDesign_2(dn=inpdsn_2.dn_s_u_t_2, ty=trim_3, mm="model/vnd.3dm", lod=list_2, tags="volume")  # -> id_2, ur_2, pln_2

nordsn_4 = NormalizeDesign_2(dn=dn_4)
dsn_11 = SerializeDesign(Design=nordsn_4)
mrg_a = MergeSeperatlyAppend(
    x=base_with_twin_capsule_towers_with_capit_2.dn,
    y=base_with_twin_capsule_towers_with_capit.dn,
    z=inpdsn.dn_s_u_t_2,
    u=inpdsn.dn_s_u_t_2)  # -> Mrgd; inputs x: tree, y: tree, z: tree, u: tree
# ---------- mrg_a: Python ----------
if ghenv.Component.RunCount<2:
    __author__ = "Ueli Saluz"
    __version__ = "2020.05.28"
    
    ghenv.Component.Name = "MergeSeperatly(Append)"
    ghenv.Component.NickName = "Mrg(A)"
    ghenv.Component.Description = "Merge inputs seperatly on a new path. Append index of input parameter for distincting."
    ghenv.Component.Message = "VER 1.0"

from System import Object
from Grasshopper import DataTree
from Grasshopper.Kernel import GH_ParamAccess as Access

if __name__ == "__main__":
    Mrgd = DataTree[Object]()
    access = Access()
    
    for input in ghenv.Component.Params.Input:  #set all Inputaccess to Tree Access
        input.Access = access.tree
    
    for i,input in enumerate(ghenv.Component.Params.Input):
        for j,source in enumerate(input.Sources):
            for path in source.VolatileData.Paths:
                Mrgd.AddRange(source.VolatileData[path],path.AppendElement(i))
# ---------- end mrg_a ----------
item_5 = ListItem(List=dsn_11, Index=0, Wrap=True)  # -> Item1, Item
shwdsn_6 = ShowDesign_2(dn=mrg_a, ty=trim_3, mm="model/vnd.3dm", lod=list_2, tags="volume")  # -> id_2, ur_2, pln_2
rep_6 = ReplaceText(Text=shwdsn_6.ur_2, Find=panel, Replace=curdir_2.S, RecursiveReplace=False)

rep_7 = ReplaceText(Text=shwdsn_4.ur_2, Find=panel, Replace=curdir_2.S, RecursiveReplace=False)
concat_8 = Concatenate(FragmentA=concat_2, FragmentB=curdir_2.S, FragmentC=rep_7)
load_geometry = Geo(path=concat_8, pln=shwdsn_4.pln_2)
semio_preview = SemioPrv(geo=flatten(load_geometry))

rep_8 = ReplaceText(Text=shwdsn_5.ur_2, Find=panel, Replace=curdir_2.S, RecursiveReplace=False)
concat_9 = Concatenate(FragmentA=concat_2, FragmentB=curdir_2.S, FragmentC=rep_8)
load_geometry_2 = Geo(path=concat_9, pln=shwdsn_5.pln_2)
semio_preview_2 = SemioPrv(geo=flatten(load_geometry_2))

rep_9 = ReplaceText(Text=base_with_twin_capsule_towers_with_capit.ur, Find=panel, Replace=curdir_2.S, RecursiveReplace=False)
concat_10 = Concatenate(FragmentA=concat_2, FragmentB=curdir_2.S, FragmentC=rep_9)
load_geometry_3 = Geo(path=concat_10, pln=base_with_twin_capsule_towers_with_capit.pln)
semio_preview_3 = SemioPrv(geo=flatten(load_geometry_3))

rep_10 = ReplaceText(Text=base_with_twin_capsule_towers_with_capit_2.ur, Find=panel, Replace=curdir_2.S, RecursiveReplace=False)
# Filter& load
concat_11 = Concatenate(FragmentA=concat_2, FragmentB=curdir_2.S, FragmentC=rep_10)
load_geometry_4 = Geo(path=concat_11, pln=base_with_twin_capsule_towers_with_capit_2.pln)
semio_preview_4 = SemioPrv(geo=flatten(load_geometry_4))

merge_2 = Merge(Data1=load_geometry_4, Data2=load_geometry, Data3=load_geometry_2, Data4=load_geometry_3)
zoom = Button()
bbox = BoundingBox(Content=flatten(merge_2), Plane=PlaneXY(0, 0, 0), UnionBox=True)  # -> Box, Box_2
zoom2bb = ZoomToBoundingBox(N=["Top", "Front", "Right", "Perspective", "Parallel"], BB=bbox.Box, S=0, R=zoom)  # -> F, SBB; inputs BB: Box, R: Boolean
# ---------- zoom2bb: Python ----------
#Component Information
#--------------------------------------------------------------------------------------------
if ghenv.Component.RunCount<2:
    #General
    #--------------------------------------------------------------------------------------------
    __author__ = "Ueli Saluz"
    __version__ = "2022.05.21"
    
    ghenv.Component.Name = "ZoomToBoundingBox"
    ghenv.Component.NickName = "Zoom2BB"
    ghenv.Component.Description = "Zoom the view of a Rhino viewport to a bounding box."
    ghenv.Component.Message = "VER 1.0"
    ghenv.Component.Category = "Display"
    ghenv.Component.SubCategory = "Camera"
    
     #Inputs
    #--------------------------------------------------------------------------------------------
    inputIndex=0
    
    ghenv.Component.Params.Input[inputIndex].Name = "Name"
    ghenv.Component.Params.Input[inputIndex].NickName = "N"
    ghenv.Component.Params.Input[inputIndex].Description = "Name of the viewport"
    ghenv.Component.Params.Input[inputIndex].Optional = False
    inputIndex+=1
    
    ghenv.Component.Params.Input[inputIndex].Name = "BoundingBox"
    ghenv.Component.Params.Input[inputIndex].NickName = "BB"
    ghenv.Component.Params.Input[inputIndex].Description = ""
    ghenv.Component.Params.Input[inputIndex].Optional = False
    inputIndex+=1
    
    ghenv.Component.Params.Input[inputIndex].Name = "ScaleFactor"
    ghenv.Component.Params.Input[inputIndex].NickName = "S"
    ghenv.Component.Params.Input[inputIndex].Description = "A factor for the extension of the bounding box." \
    +"0 means 0 extension, a positive number makes the bounding box larger a negative smaller. The amount is proportional to the length."
    ghenv.Component.Params.Input[inputIndex].Optional = False
    inputIndex+=1
   
    
    ghenv.Component.Params.Input[inputIndex].Name = "Run"
    ghenv.Component.Params.Input[inputIndex].NickName = "R"
    ghenv.Component.Params.Input[inputIndex].Description = "Zoom to the given bounding box."
    ghenv.Component.Params.Input[inputIndex].Optional = False
    inputIndex+=1
    
    #Outputs
    #--------------------------------------------------------------------------------------------
    outputIndex=0
    
    ghenv.Component.Params.Output[outputIndex].Name = "Finished"
    ghenv.Component.Params.Output[outputIndex].NickName = "F"
    ghenv.Component.Params.Output[outputIndex].Description = "Sends True when finished. Just to trigger other depending components."
    outputIndex+=1
    
    ghenv.Component.Params.Output[outputIndex].Name = "ScaledBoundingBox"
    ghenv.Component.Params.Output[outputIndex].NickName = "SBB"
    ghenv.Component.Params.Output[outputIndex].Description = "The scaled bounding box."
    outputIndex+=1


#Imports
#--------------------------------------------------------------------------------------------
from Rhino import RhinoDoc
from Rhino.Geometry import Box

#Solver - Run with trees to enhance performance drastically
#--------------------------------------------------------------------------------------------
if __name__ == "__main__":
    try:
        vp = RhinoDoc.ActiveDoc.Views.Find(N, False).ActiveViewport
        if R:
            box = BB
            bb = BB.BoundingBox
            bb.Inflate(S*box.X.Length,S*box.Y.Length,S*box.Z.Length)
            vp.ZoomBoundingBox(bb)
            SBB = bb
        F = True
    except:
        pass
# ---------- end zoom2bb ----------

concat_12 = Concatenate(FragmentA=concat_2, FragmentB=curdir_2.S, FragmentC=rep_6)

zoom_2 = Button()
# Zoom
bbox_2 = BoundingBox(Content=flatten(load_geometry_4), Plane=PlaneXY(0, 0, 0), UnionBox=True)  # -> Box, Box_2
zoom2bb_2 = ZoomToBoundingBox(N=["Top", "Front", "Right", "Perspective", "Parallel"], BB=bbox_2.Box, S=0, R=zoom_2)  # -> F, SBB; inputs BB: Box, R: Boolean; same code as zoom2bb

zoom_3 = Button()
bbox_3 = BoundingBox(Content=flatten(load_geometry_3), Plane=PlaneXY(0, 0, 0), UnionBox=True)  # -> Box, Box_2
zoom2bb_3 = ZoomToBoundingBox(N=["Top", "Front", "Right", "Perspective", "Parallel"], BB=bbox_3.Box, S=0, R=zoom_3)  # -> F, SBB; inputs BB: Box, R: Boolean; same code as zoom2bb

load_geometry_5 = Geo(path=concat_12, pln=shwdsn_6.pln_2)
semio_preview_5 = SemioPrv(geo=flatten(load_geometry_5))
shwdsn_7 = ShowDesign_2(dn=graft(nordsn_4), ty=trim_3, mm="model/vnd.3dm", lod=list_2, tags="volume")  # -> id_2, ur_2, pln_2
kt_2 = Kit(kit_18.Kit)
tsort_4 = SortText(Keys=shwdsn_7.id_2, Values=shwdsn_7.pln_2, Culture=127)  # -> Keys, Values
dsn_12 = ModelDesign(Design=base_with_twin_capsule_towers_with_capit.dn)  # -> Design, Valid, Name, Description, Icon, Variant, Unit, Pieces, Connections, Qualities
dsn_13 = ModelDesign(Design=base_with_twin_capsule_towers_with_capit_2.dn)  # -> Design, Valid, Name, Description, Icon, Variant, Unit, Pieces, Connections, Qualities
trim_4 = TrimTree(Tree=dsn_12.Pieces, Depth=1)
trim_5 = TrimTree(Tree=dsn_12.Connections, Depth=1)
trim_6 = TrimTree(Tree=dsn_13.Pieces, Depth=1)
trim_7 = TrimTree(Tree=dsn_13.Connections, Depth=1)
merge_3 = Merge(Data1=trim_4, Data2=pce_3.Piece, Data3=pce_4.Piece)
merge_4 = Merge(Data1=trim_6, Data2=pce_6.Piece, Data3=pce_5.Piece)
rev = ReverseList(List=trim_7)
rev_2 = ReverseList(List=merge_3)
rev_3 = ReverseList(List=merge_4)
merge_5 = Merge(Data1=trim_5, Data2=con_4.Connection)
merge_6 = Merge(Data1=rev, Data2=con_5.Connection)
dsn_14 = ModelDesign(Design=dsn_12.Design, Pieces=rev_2, Connections=merge_5)  # -> Design, Valid, Name, Description, Icon, Variant, Unit, Pieces, Connections, Qualities
dsn_15 = ModelDesign(Design=dsn_13.Design, Pieces=rev_3, Connections=merge_6)  # -> Design, Valid, Name, Description, Icon, Variant, Unit, Pieces, Connections, Qualities
inpdsn_3 = Interpolate(S=dsn_15.Design, T=dsn_14.Design, t=Slider(0.5, range=0..1))  # -> dn_s_u_t_2, dn_s_t_2, dn_t_s_2

# ----
# Overwrite (Serialization must be the same)
kt_3 = Kit("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")
toggle_3 = BooleanToggle(True)
kit_20 = ModelKit(Kit=kit_18.Kit)  # -> Kit, Valid, Name, Description, Icon, Remote, Homepage, Types, Designs, Designs_2
kit_21 = DeleteKit(Url=concat_3, Run=toggle_3)
expression_6 = Expression(x=toggle_3, y=kit_21, Expression="x")
trim_8 = TrimTree(Tree=kit_20.Types, Depth=1)
trim_9 = TrimTree(Tree=kit_20.Designs, Depth=1)
kit_22 = CreateKit(Kit=kt_3, Uri=concat_3, Run=expression_6)
expression_7 = Expression(x=toggle_3, y=kit_22, Expression="x")
kit_23 = LoadKit(Url=concat_3, Run=expression_7)  # -> Kit, Success, LocalDirectory
expression_8 = Expression(x=toggle_3, y=kit_23.Kit, Expression="x")
typ_6 = PutType(Type=trim_8, Uri=concat_3, Run=expression_8)
item_6 = ListItem(List=typ_6, Index=0, Wrap=True)
expression_9 = Expression(x=toggle_3, y=item_6, Expression="x")
dsn_16 = PutDesign(Design=trim_9, Uri=concat_3, Run=expression_9)
item_7 = ListItem(List=dsn_16, Index=0, Wrap=True)
expression_10 = Expression(x=toggle_3, y=item_7, Expression="x")
kit_24 = LoadKit(Url=concat_3, Run=expression_10)  # -> Kit, Success, LocalDirectory

item_8 = ListItem(List=trim_8, Index=panel_8, Wrap=True)  # disabled
typ_7 = PutType(Type=item_8, Uri=concat_3, Run=expression_8)  # disabled
kit_25 = ModelKit(Kit=kit_24.Success)  # -> Kit, Valid, Name, Description, Icon, Remote, Homepage, Types, Designs, Designs_2
trim_10 = TrimTree(Tree=kit_25.Types, Depth=1)
trim_11 = TrimTree(Tree=kit_25.Designs, Depth=1)
typ_8 = SerializeType(Type=trim_8)  # disabled
typ_9 = SerializeType(Type=trim_10)  # disabled
kt_4 = Kit(kit_23.Success)
kt_5 = Kit(kit_24.Success)
expression_11 = Expression(x=typ_8, y=typ_9, Expression="x=y")  # disabled
nordsn_5 = NormalizeDesign_2(dn=trim_11)
kit_26 = ModelKit(Kit=kt_4)  # -> Kit, Valid, Name, Description, Icon, Remote, Homepage, Types, Designs, Designs_2
kit_27 = ModelKit(Kit=kt_5)  # -> Kit, Valid, Name, Description, Icon, Remote, Homepage, Types, Designs, Designs_2
must_be_true_3 = Panel(expression_11)  # disabled
dsn_17 = SerializeDesign(Design=nordsn_5)
trim_12 = TrimTree(Tree=kit_26.Designs_2, Depth=1)
trim_13 = TrimTree(Tree=kit_27.Designs_2, Depth=1)
typ_10 = ModelType(Type=trim_10)  # -> Type, Valid, Name, Description, Icon, Variant, Unit, Representations, Ports, Qualities
expression_12 = Expression(x=dsn_11, y=dsn_17, Expression="x=y")
nordsn_6 = NormalizeDesign_2(dn=trim_13)
nordsn_7 = NormalizeDesign_2(dn=trim_12)
item_9 = ListItem(List=dsn_17, Index=0, Wrap=True)  # -> Item1, Item
por_3 = ModelPort(Port=typ_10.Ports)  # -> Port, Valid, Id, Point, Direction, Locators
kit_28 = ModelKit(Kit=kit_26.Kit, Designs_2=nordsn_7)  # -> Kit, Valid, Name, Description, Icon, Remote, Homepage, Types, Designs, Designs_2
kit_29 = ModelKit(Kit=kit_27.Kit, Designs_2=nordsn_6)  # -> Kit, Valid, Name, Description, Icon, Remote, Homepage, Types, Designs, Designs_2
loc_2 = ModelLocator(Locator=por_3.Locators)  # -> Locator, Valid, Group, Subgroup
kt_6 = Kit(kit_28.Kit)
kt_7 = Kit(kit_29.Kit)

kit_30 = SerializeKit(Kit=kt_6)
kit_31 = SerializeKit(Kit=kt_7)
expression_13 = Expression(x=kit_30, y=kit_31, Expression="x=y")
must_be_true_4 = Panel(expression_13)

shwdsn_8 = ShowDesign_2(dn=graft(nordsn_5), ty=trim_3, mm="model/vnd.3dm", lod=list_2, tags="volume")  # -> id_2, ur_2, pln_2
tsort_5 = SortText(Keys=shwdsn_8.id_2, Values=shwdsn_8.pln_2, Culture=127)  # -> Keys, Values
expression_14 = Expression(x=tsort_5.Values, y=tsort_4.Values, Expression="x=y")
mm_2 = MassMultiplication(Input=expression_14)  # -> Result, PartialResults
bool_2 = Boolean(mm_2.Result)
must_be_true_5 = Panel(bool_2)

# ==== cluster Interpolate: Interpolate between a source design and a target design. The target will act as a blueprint. The result is an interpolated union design and two unmodified but filtered difference design.
T = ClusterInput()
S = ClusterInput()
t = ClusterInput()
T_2 = Design(T)
S_2 = Design(S)
t_2 = Number(t)
nordsn = NormalizeDesign(dn=S_2)
nordsn_2 = NormalizeDesign(dn=T_2)
dsn = ModelDesign(Design=nordsn)  # -> Design, Valid, Name, Description, Icon, Variant, Unit, Pieces, Connections, Qualities
dsn_2 = ModelDesign(Design=nordsn_2)  # -> Design, Valid, Name, Description, Icon, Variant, Unit, Pieces, Connections, Qualities
trim = TrimTree(Tree=dsn_2.Connections, Depth=1)
trim_2 = TrimTree(Tree=dsn.Pieces, Depth=1)
trim_3 = TrimTree(Tree=dsn.Connections, Depth=1)
trim_4 = TrimTree(Tree=dsn_2.Pieces, Depth=1)
pce = ModelPiece(Piece=trim_4)  # -> Piece, Valid, Id, TypeName, TypeVariant, Plane, ScreenPoint
pce_2 = ModelPiece(Piece=trim_2)  # -> Piece, Valid, Id, TypeName, TypeVariant, Plane, ScreenPoint
con = ModelConnection(Connection=trim)  # -> Connection, Valid, ConnectedPieceId, ConnectedPieceTypePortId, ConnectingPieceId, ConnectingPieceTypePortId, Rotation, Tilt, Gap, Shift
con_2 = ModelConnection(Connection=trim_3)  # -> Connection, Valid, ConnectedPieceId, ConnectedPieceTypePortId, ConnectingPieceId, ConnectingPieceTypePortId, Rotation, Tilt, Gap, Shift
intersection = SetIntersection(SetA=pce_2.Id, SetB=pce.Id)
difference = SetDifference(SetA=pce.Id, SetB=pce_2.Id)
difference_2 = SetDifference(SetA=pce_2.Id, SetB=pce.Id)
selcon = SelectConnection(co=trim, cdpc=graft(con_2.ConnectedPieceId), cgpc=graft(con_2.ConnectingPieceId))
selcon_2 = SelectConnection(co=trim_3, cdpc=graft(con.ConnectedPieceId), cgpc=graft(con.ConnectingPieceId))
selpce = SelectPiece(pc=pce.Piece, id=graft(intersection))
selpce_2 = SelectPiece(pc=pce.Piece, id=graft(difference))
selpce_3 = SelectPiece(pc=pce_2.Piece, id=graft(difference_2))
selpce_4 = SelectPiece(pc=pce_2.Piece, id=graft(intersection))
trim_5 = TrimTree(Tree=selcon, Depth=1)
trim_6 = TrimTree(Tree=selcon_2, Depth=1)
expression = Expression(x=t_2, Expression="1-x")
trim_7 = TrimTree(Tree=selpce_2, Depth=1)
trim_8 = TrimTree(Tree=selpce, Depth=1)
trim_9 = TrimTree(Tree=selpce_4, Depth=1)
trim_10 = TrimTree(Tree=selpce_3, Depth=1)
con_3 = ModelConnection(Connection=trim_5)  # -> Connection, Valid, ConnectedPieceId, ConnectedPieceTypePortId, ConnectingPieceId, ConnectingPieceTypePortId, Rotation, Tilt, Gap, Shift
con_4 = ModelConnection(Connection=trim_6)  # -> Connection, Valid, ConnectedPieceId, ConnectedPieceTypePortId, ConnectingPieceId, ConnectingPieceTypePortId, Rotation, Tilt, Gap, Shift
pce_3 = ModelPiece(Piece=trim_8)  # -> Piece, Valid, Id, TypeName, TypeVariant, Plane, ScreenPoint
pce_4 = ModelPiece(Piece=trim_9)  # -> Piece, Valid, Id, TypeName, TypeVariant, Plane, ScreenPoint
merge = Merge(Data1=t_2, Data2=expression)
merge_2 = Merge(Data1=graft(con_4.Gap), Data2=graft(con_3.Gap))
merge_3 = Merge(Data1=graft(con_4.Shift), Data2=graft(con_3.Shift))
merge_4 = Merge(Data1=graft(con_4.Tilt), Data2=graft(con_3.Tilt))
merge_5 = Merge(Data1=graft(con_4.Rotation), Data2=graft(con_3.Rotation))
tstat = TreeStatistics(Tree=selcon_2)  # -> Paths, Length, Count
tstat_2 = TreeStatistics(Tree=selcon)  # -> Paths, Length, Count
merge_6 = Merge(Data1=graft(pce_4.Plane), Data2=graft(pce_3.Plane))
trim_11 = TrimTree(Tree=tstat_2.Length, Depth=1)
trim_12 = TrimTree(Tree=tstat.Length, Depth=1)
interp = InterpolateData(Data=merge_5, Parameter=t_2, Interpolation=2)
interp_2 = InterpolateData(Data=merge_2, Parameter=t_2, Interpolation=2)
interp_3 = InterpolateData(Data=merge_3, Parameter=t_2, Interpolation=2)
interp_4 = InterpolateData(Data=merge_4, Parameter=t_2, Interpolation=2)
avgpl = AveragePlane(Pl=merge_6, M=merge)  # -> AvPl; inputs Pl: list of Plane, M: list of Double
# ---------- avgpl: C# usings ----------
using System.Linq;
# ---------- avgpl: C# ----------
    //Author: Ueli Saluz
    //Last modified: 29.05.2020
    //Contact: usaluz@outlook.de

    if (Component.RunCount < 2)
    {
      Component.Name = "AveragePlane";
      Component.NickName = "AvgPl";
      Component.Description = "Get the average plane from a set of planes. Provide multiplier to weight some planes more.";

      Component.Params.Input[0].Name = "Planes";
      Component.Params.Input[0].Description = "Planes to take average from.";
      Component.Params.Input[1].Name = "weights";
      Component.Params.Input[1].Description = "weights act like weights towards a plane.";

      Component.Params.Output[0].Name = "AveragePlane";
      Component.Params.Output[0].Description = "Resulting average plane.";

      Component.Message = "VER 1.0";
    }
    AvPl = GetAveragePlane(Pl.ToArray(), M.ToArray());
# ---------- avgpl: C# additional code ----------
  /// <summary>
  /// Gets the average plane from a set of of planes. Each plane can have a weight.
  /// </summary>
  /// <param name="planes"></param>
  /// <param name="weights"></param>
  /// <returns>Average plane under consideration of weights</returns>
  public Plane GetAveragePlane(Plane[] planes, double[] weights)
  {
    //If there are less weights than planes then the weight of 1 is assumed.
    if (weights.Length < planes.Length)
      weights = weights.Concat(Enumerable.Repeat(1d, planes.Length - weights.Length)).ToArray();
    //If there are more weights than planes then the last ones will be ignored.
    else if (weights.Length > planes.Length)
      weights = weights.Take(planes.Length).ToArray();

    if (weights.Sum() == 0)
      weights = Enumerable.Repeat(1d, planes.Length).ToArray();

    var sum = weights.Sum();
    weights = weights.Select(x => x / sum).ToArray();

    var origins = planes.Select(x => x.Origin).ToArray();
    var xAxes = planes.Select(x => x.XAxis).ToArray();
    var yAxes = planes.Select(x => x.YAxis).ToArray();

    for (int i = 0; i < planes.Length; i++)
    {
      origins[i].Transform(new Transform(weights[i]));
      xAxes[i].Transform(new Transform(weights[i]));
      yAxes[i].Transform(new Transform(weights[i]));
    }

    return new Plane(origins.Aggregate((a,b) => a + b), xAxes.Aggregate((a,b) => a + b), yAxes.Aggregate((a,b) => a + b));
  }
# ---------- end avgpl ----------
trim_13 = TrimTree(Tree=interp_3, Depth=1)
equals = Equality(FirstNumber=trim_12, SecondNumber="0")  # -> Equality, Inequality
trim_14 = TrimTree(Tree=interp, Depth=1)
trim_15 = TrimTree(Tree=interp_4, Depth=1)
equals_2 = Equality(FirstNumber=trim_11, SecondNumber="0")  # -> Equality, Inequality
trim_16 = TrimTree(Tree=interp_2, Depth=1)
c_script = CSharpScript(x=avgpl)  # -> a; inputs x: Plane
# ---------- c_script: C# ----------
// Grasshopper Script Instance
#region Usings
using System;
using System.Linq;
using System.Collections;
using System.Collections.Generic;
using System.Drawing;

using Rhino;
using Rhino.Geometry;

using Grasshopper;
using Grasshopper.Kernel;
using Grasshopper.Kernel.Data;
using Grasshopper.Kernel.Types;
#endregion

public class Script_Instance : GH_ScriptInstance
{
    #region Notes
    /* 
      Members:
        RhinoDoc RhinoDocument
        GH_Document GrasshopperDocument
        IGH_Component Component
        int Iteration

      Methods (Virtual & overridable):
        Print(string text)
        Print(string format, params object[] args)
        Reflect(object obj)
        Reflect(object obj, string method_name)
    */
    #endregion

    private void RunScript(Plane x, ref object a)
    {
        a = x.IsValid ? x : null;
    }
}
# ---------- end c_script ----------
con_5 = ModelConnection(Connection=con_3.Connection, Rotation=trim_14, Tilt=trim_15, Gap=trim_16, Shift=trim_13)  # -> Connection, Valid, ConnectedPieceId, ConnectedPieceTypePortId, ConnectingPieceId, ConnectingPieceTypePortId, Rotation, Tilt, Gap, Shift
cull = CullPattern(List=trim_3, CullPattern=equals_2.Equality)
cull_2 = CullPattern(List=trim, CullPattern=equals.Equality)
trim_17 = TrimTree(Tree=c_script, Depth=1)
pce_5 = ModelPiece(Piece=pce_3.Piece, Plane=trim_17)  # -> Piece, Valid, Id, TypeName, TypeVariant, Plane, ScreenPoint
co_s_u_t = Connection(con_5.Connection)
co_s_t = Connection(cull)
co_t_s = Connection(cull_2)
pc_s_u_t = Piece(pce_5.Piece)
pc_s_t = Piece(trim_10)
pc_t_s = Piece(trim_7)
dsn_3 = ModelDesign(Design=nordsn_2, Pieces=pc_s_u_t, Connections=co_s_u_t)  # -> Design, Valid, Name, Description, Icon, Variant, Unit, Pieces, Connections, Qualities
dsn_4 = ModelDesign(Design=nordsn, Pieces=pc_s_t, Connections=co_s_t)  # -> Design, Valid, Name, Description, Icon, Variant, Unit, Pieces, Connections, Qualities
dsn_5 = ModelDesign(Design=nordsn_2, Pieces=pc_t_s, Connections=co_t_s)  # -> Design, Valid, Name, Description, Icon, Variant, Unit, Pieces, Connections, Qualities
dn_s_t = Design(dsn_4.Design)
dn_s_u_t = Design(dsn_3.Design)
dn_t_s = Design(dsn_5.Design)
dn_s_t_2 = ClusterOutput(dn_s_t)
dn_s_u_t_2 = ClusterOutput(dn_s_u_t)
dn_t_s_2 = ClusterOutput(dn_t_s)

# ==== cluster Geo
path = ClusterInput()
pln = ClusterInput()
path_2 = FilePath(path)

pln_2 = Plane(graft(pln))
cset = CreateSet(List=path_2)  # -> Set, Map
panel = Panel("*")
_3dm = Import3DM(File=graft(cset.Set), Layer="*", Name="*")
lng = ListLength(List=cset.Set)
expression = Expression(x=lng, Expression="x>1")
trim = TrimTree(Tree=_3dm, Depth=1)
filter = StreamFilter(Gate=expression, Stream0=_3dm, Stream1=trim)
tstat = TreeStatistics(Tree=filter)  # -> Paths, Length, Count
item = ListItem(List=tstat.Paths, Index=cset.Map, Wrap=True)
branch = TreeBranch(Tree=filter, Path=item, MaintainPaths=False)
match = MatchTree(Tree=branch, Guide=pln_2)
mtchanc = MatchAncestor(AT=pln_2, CT=graft(match))  # -> MAT; inputs AT: tree, CT: tree
# ---------- mtchanc: Python ----------
if ghenv.Component.RunCount<2:
    __author__ = "Ueli Saluz"
    __version__ = "2022.04.25"
    
    ghenv.Component.Name = "Match Ancestor"
    ghenv.Component.NickName = "MtchAnc"
    ghenv.Component.Description = "Duplicates all elements of an ancestor tree to match the amount of elements in the child tree."
    ghenv.Component.Message = "VER 1.1"
    
    ghenv.Component.Params.Input[0].Name = "AncestorTree"
    ghenv.Component.Params.Input[0].NickName = "AT"
    ghenv.Component.Params.Input[0].Description = "Ancestor tree that data will the duplicated until it matches the child tree"
    ghenv.Component.Params.Input[0].Optional = False
    
    ghenv.Component.Params.Input[1].Name = "ChildTree"
    ghenv.Component.Params.Input[1].NickName = "CT"
    ghenv.Component.Params.Input[1].Description = "Child tree that branches will the guide to duplicat the data of the ancestor tree"
    ghenv.Component.Params.Input[0].Optional = False
    
    ghenv.Component.Params.Output[0].Name = "MatchedAncestorTree"
    ghenv.Component.Params.Output[0].NickName = "MAT"
    ghenv.Component.Params.Output[0].Description = "Matched ancestor tree with the amount of items and the branch paths of the child tree"

from System import Object
from Grasshopper import DataTree

"""Returns a new tree with the ancestor data being duplicated along all child branches which where child paths of that ancestor.
    Inputs:
        ancestorTree: Ancestor tree that data will the duplicated until it matches the child tree
        childTree: Child tree that branches will the guide to duplicat the data of the ancestor tree
    Output:
        matchedAncestorTree: Matched ancestor tree with the amount of items and the branch paths of the child tree"""
def MatchAncestorTreeToChildTree (ancestorTree, childTree):
    
    matchedAncestorTree = DataTree[Object]()
    dummy = 0
    for i,pathAncestor in enumerate(ancestorTree.Paths):
        branch = ancestorTree.Branch(pathAncestor)
        if len(branch)!=1:
            raise Exception("Ancestor must be grafted and containing one item per branch")
        #The item to be duplicated
        item = branch[0]
        for j,pathChild in enumerate(childTree.Paths):
            #Returns a tuple and not like in the documentation described a bool with a pointer to the int to store the generations
            checkAncestor = pathChild.IsAncestor(pathAncestor,dummy)
            if(checkAncestor[0]):
                matchedAncestorTree.AddRange([item]*childTree.Branch(pathChild).Count,pathChild)
    return matchedAncestorTree

if __name__ == "__main__":
    MAT = MatchAncestorTreeToChildTree (AT,CT)
# ---------- end mtchanc ----------
trim_2 = TrimTree(Tree=mtchanc, Depth=1)
pl2pl = MoveObjectPlaneToPlane(G=match, S=PlaneXY(0, 0, 0), T=trim_2)  # -> TG, T; inputs S: Plane, T: Plane
# ---------- pl2pl: Python ----------
#Component Information
#--------------------------------------------------------------------------------------------
if ghenv.Component.RunCount<2:
    #General
    #--------------------------------------------------------------------------------------------
    __author__ = "Ueli Saluz"
    __version__ = "2023.02.12"
    
    ghenv.Component.Name = "MoveObjectPlaneToPlane"
    ghenv.Component.NickName = "Pl2Pl"
    ghenv.Component.Description = "Moves abitrary geometry from a source plane to a target plane."
    ghenv.Component.Message = "VER 1.2"
    ghenv.Component.Category = "Transform"
    ghenv.Component.SubCategory = "Euclidean"
    
     #Inputs
    #--------------------------------------------------------------------------------------------
    inputIndex=0
    
    ghenv.Component.Params.Input[inputIndex].Name = "Geometry"
    ghenv.Component.Params.Input[inputIndex].NickName = "G"
    ghenv.Component.Params.Input[inputIndex].Description = "Geometry to move."
    ghenv.Component.Params.Input[inputIndex].Optional = False
    inputIndex+=1
    
    ghenv.Component.Params.Input[inputIndex].Name = "SourcePlane"
    ghenv.Component.Params.Input[inputIndex].NickName = "S"
    ghenv.Component.Params.Input[inputIndex].Description = "Source plane of object."
    ghenv.Component.Params.Input[inputIndex].Optional = False
    inputIndex+=1
    
    ghenv.Component.Params.Input[inputIndex].Name = "TargetPlane"
    ghenv.Component.Params.Input[inputIndex].NickName = "T"
    ghenv.Component.Params.Input[inputIndex].Description = "Target plane of object."
    ghenv.Component.Params.Input[inputIndex].Optional = False
    inputIndex+=1
    
    #Outputs
    #--------------------------------------------------------------------------------------------
    outputIndex=0
    
    ghenv.Component.Params.Output[outputIndex].Name = "TranslatedGeometry"
    ghenv.Component.Params.Output[outputIndex].NickName = "TG"
    ghenv.Component.Params.Output[outputIndex].Description = "Translated geometry in target plane."
    outputIndex+=1
    
    ghenv.Component.Params.Output[outputIndex].Name = "Trasnform"
    ghenv.Component.Params.Output[outputIndex].NickName = "T"
    ghenv.Component.Params.Output[outputIndex].Description = "Transform describing translation form source to target plane."
    outputIndex+=1


#Imports
#--------------------------------------------------------------------------------------------
import Rhino.Geometry.Transform as trsf

def MvObjPlnToPln (geo,plnObj,plnDest):
    transform = trsf.PlaneToPlane(plnObj,plnDest)
    geo.Transform(transform)
    return (geo,transform)

TG, T = MvObjPlnToPln(G,S,T)
# ---------- end pl2pl ----------
geo = Geometry(pl2pl.TG)

geo_2 = ClusterOutput(geo)

# ==== cluster SemioPrv: semio styled preview of geometry.
geo = ClusterInput()
geo_2 = Geometry(flatten(geo))
debrep = DeconstructBrep(Brep=geo_2)  # -> Faces, Edges, Vertices
curve_preview = CustomCurvePreview(Curve=flatten(debrep.Edges), Colour=ColourSwatch(SwatchColor=RGB(0, 0, 0)))
preview = CustomPreview(Geometry=flatten(geo_2), Material=ColourSwatch(SwatchColor=RGB(255, 255, 255)))

# ==== cluster BaseWithTwinCapsuleTowersWithCapital
ty = ClusterInput()

variant = ClusterInput()
futuristic = ClusterInput()
lod = ClusterInput()
tags = ClusterInput()
variant_2 = Text(variant)
futuristic_2 = Boolean(futuristic)
lod_2 = Text(lod)
tags_2 = Text(tags)

shaft_rotation = ClusterInput()
shaft_tilt = ClusterInput()
shaft_gap = ClusterInput()
shaft_shift = ClusterInput()
tambour_rotation = ClusterInput()
tambour_tilt = ClusterInput()
tambour_gap = ClusterInput()
tambour_shift = ClusterInput()
capsule_rotation = ClusterInput()
capsule_tilt = ClusterInput()
capsule_gap = ClusterInput()
capsule_shift = ClusterInput()
capital_rotation = ClusterInput()
capital_tilt = ClusterInput()
capital_gap = ClusterInput()
capital_shift = ClusterInput()
base_plane = ClusterInput()
shaft_tilt_2 = Number(shaft_tilt)
capsule_rotation_2 = Number(capsule_rotation)
capsule_shift_2 = Number(capsule_shift)
capital_rotation_2 = Number(capital_rotation)
capital_gap_2 = Number(capital_gap)
capital_shift_2 = Number(capital_shift)
shaft_rotation_2 = Number(shaft_rotation)
shaft_gap_2 = Number(shaft_gap)
shaft_shift_2 = Number(shaft_shift)
tambour_rotation_2 = Number(tambour_rotation)
tambour_tilt_2 = Number(tambour_tilt)
tambour_gap_2 = Number(tambour_gap)
tambour_shift_2 = Number(tambour_shift)
capsule_tilt_2 = Number(capsule_tilt)
capsule_gap_2 = Number(capsule_gap)
capital_tilt_2 = Number(capital_tilt)
base_plane_2 = Plane(base_plane)

electrictiy_global_warming_potential_kgc = ClusterInput()  # "Electrictiy Global Warming Potential [kgCO2e/kWh]"
heating_energy_price_kwh = ClusterInput()
heating_efficiency_factor = ClusterInput()
cooling_efficiency_factor = ClusterInput()
cooling_global_warming_potential_kgco2e = ClusterInput()  # "Cooling Global Warming Potential [kgCO2e/kWh]"
heating_global_warming_potential_kgco2e = ClusterInput()  # "Heating Global Warming Potential [kgCO2e/kWh]"
cooling_energy_price_kwh = ClusterInput()
electrictiy_energy_price_cent_kwh = ClusterInput()
heating_efficiency_factor_2 = Number(heating_efficiency_factor)
electrictiy_global_warming_potential_kgc_2 = Number(electrictiy_global_warming_potential_kgc)  # "Electrictiy Global Warming Potential [kgCO2e/kWh]"
heating_energy_price_kwh_2 = Number(heating_energy_price_kwh)
heating_global_warming_potential_kgco2e_2 = Number(heating_global_warming_potential_kgco2e)  # "Heating Global Warming Potential [kgCO2e/kWh]"
cooling_energy_price_kwh_2 = Number(cooling_energy_price_kwh)
cooling_efficiency_factor_2 = Number(cooling_efficiency_factor)
cooling_global_warming_potential_kgco2e_2 = Number(cooling_global_warming_potential_kgco2e)  # "Cooling Global Warming Potential [kgCO2e/kWh]"
electrictiy_energy_price_cent_kwh_2 = Number(electrictiy_energy_price_cent_kwh)

capsule_corner_ne = ClusterInput()
capsule_corner_se = ClusterInput()
capsule_corner_sw = ClusterInput()
capsule_corner_nw = ClusterInput()
capsule_corner_nw_2 = Integer(capsule_corner_nw)
capsule_corner_ne_2 = Integer(capsule_corner_ne)
capsule_corner_se_2 = Integer(capsule_corner_se)
capsule_corner_sw_2 = Integer(capsule_corner_sw)

ty_2 = Type(ty)

lng = ListLength(List=capsule_corner_sw_2)
lng_2 = ListLength(List=capsule_corner_ne_2)
dup = DuplicateData(Data="0", Number=lng_2, Order=True)
dup_2 = DuplicateData(Data="6", Number=lng_2, Order=True)
dup_3 = DuplicateData(Data="0", Number=lng, Order=True)
dup_4 = DuplicateData(Data="6", Number=lng, Order=True)
trim = TrimTree(Tree=dup, Depth=1)
trim_2 = TrimTree(Tree=dup_2, Depth=1)
trim_3 = TrimTree(Tree=dup_3, Depth=1)
trim_4 = TrimTree(Tree=dup_4, Depth=1)

# ----
# Model the initial design
panel = Panel("Capital")
neg = Negative(Value="-90")
neg_2 = Negative(Value="-9")
concat = Concatenate(FragmentA="c", FragmentC="1")
concat_2 = Concatenate(FragmentA="c", FragmentC="0")
addition = Addition(A="-90", B=neg_2)
addition_2 = Addition(A="-90", B=neg_2)
filter = StreamFilter(Gate=0, Stream0="-90", Stream1=addition)
filter_2 = StreamFilter(Gate=0, Stream0="-90", Stream1=addition_2)
neg_3 = Negative(Value=filter)
bridge_tilt = Slider(0, range=-360..360)
bridge_gap = Slider(0, range=-10..10)
bridge_rotation = Slider(0, range=-360..360)
bridge_shift = Slider(-0.8, range=-10..10)
genes = GenePool(Decimals=0, Maximum=10, Minimum=0, Value=[3, 6, 9])

concat_3 = Concatenate(FragmentA="b", FragmentB="_", FragmentC=concat_2)
tower = Tower(
    shaftpieceid=concat_3,
    capsulepatternnorthwest=trim_2,
    capsulepatternsoutheast=capsule_corner_ne_2,
    capsulepatternsouthwest=capsule_corner_se_2,
    capsulepatternnortheast=trim,
    capsulerotation=capsule_rotation_2,
    capsuletilt=capsule_tilt_2,
    capsulegap=capsule_gap_2,
    capsuleshift=capsule_shift_2,
    tambourrotation=tambour_rotation_2,
    tambourtilt=tambour_tilt_2,
    tambourgap=tambour_gap_2,
    tambourshift=tambour_shift_2)  # -> pc_2, co_2, tambour_co_2, tambour_pc_2, first_tambour_id_2, last_tambour_id_2, capsule_pc_2, caspule_co_2

concat_4 = Concatenate(FragmentA="b", FragmentB="_", FragmentC=concat)
tower_2 = Tower(
    shaftpieceid=concat_4,
    capsulepatternnorthwest=trim_4,
    capsulepatternsoutheast=capsule_corner_sw_2,
    capsulepatternsouthwest=capsule_corner_nw_2,
    capsulepatternnortheast=trim_3,
    capsulerotation=capsule_rotation_2,
    capsuletilt=capsule_tilt_2,
    capsulegap=capsule_gap_2,
    capsuleshift=capsule_shift_2,
    tambourrotation=tambour_rotation_2,
    tambourtilt=tambour_tilt_2,
    tambourgap=tambour_gap_2,
    tambourshift=tambour_shift_2)  # -> pc_2, co_2, tambour_co_2, tambour_pc_2, first_tambour_id_2, last_tambour_id_2, capsule_pc_2, caspule_co_2

concat_5 = Concatenate(FragmentD="ci", FragmentC="_", FragmentB=tower_2.last_tambour_id_2)
concat_6 = Concatenate(FragmentD="ci", FragmentC="_", FragmentB=tower.last_tambour_id_2)
merge = Merge(Data1=tower.pc_2, Data2=tower_2.pc_2)
merge_2 = Merge(Data1=tower.co_2, Data2=tower_2.co_2)

pce = ModelPiece(Id=concat_5, TypeName=panel)  # -> Piece, Valid, Id, TypeName, TypeVariant, Plane, ScreenPoint
pce_2 = ModelPiece(Id=concat_6, TypeName=panel)  # -> Piece, Valid, Id, TypeName, TypeVariant, Plane, ScreenPoint
pce_3 = ModelPiece(Id="b", TypeName="Base", Plane=base_plane_2)  # -> Piece, Valid, Id, TypeName, TypeVariant, Plane, ScreenPoint
addition_3 = Addition(A="-90", B=capital_rotation_2)
addition_4 = Addition(A=neg_3, B=capital_rotation_2)
addition_5 = Addition(A=neg, B=shaft_rotation_2)
addition_6 = Addition(A=shaft_rotation_2, B=filter_2)
con = ModelConnection(
    ConnectedPieceId=pce_3.Id,
    ConnectedPieceTypePortId=concat_2,
    ConnectingPieceId=tower.first_tambour_id_2,
    ConnectingPieceTypePortId="b",
    Rotation=addition_6,
    Tilt=shaft_tilt_2,
    Gap=shaft_gap_2,
    Shift=shaft_shift_2)  # -> Connection, Valid, ConnectedPieceId, ConnectedPieceTypePortId, ConnectingPieceId, ConnectingPieceTypePortId, Rotation, Tilt, Gap, Shift
con_2 = ModelConnection(
    ConnectedPieceId=pce_3.Id,
    ConnectedPieceTypePortId=concat,
    ConnectingPieceId=tower_2.first_tambour_id_2,
    ConnectingPieceTypePortId="b",
    Rotation=addition_5,
    Tilt=shaft_tilt_2,
    Gap=shaft_gap_2,
    Shift=shaft_shift_2)  # -> Connection, Valid, ConnectedPieceId, ConnectedPieceTypePortId, ConnectingPieceId, ConnectingPieceTypePortId, Rotation, Tilt, Gap, Shift
con_3 = ModelConnection(
    ConnectedPieceId=tower.last_tambour_id_2,
    ConnectedPieceTypePortId="t",
    ConnectingPieceId=pce_2.Id,
    Rotation=addition_4,
    Tilt=capital_tilt_2,
    Gap=capital_gap_2,
    Shift=capital_shift_2)  # -> Connection, Valid, ConnectedPieceId, ConnectedPieceTypePortId, ConnectingPieceId, ConnectingPieceTypePortId, Rotation, Tilt, Gap, Shift
con_4 = ModelConnection(
    ConnectedPieceId=tower_2.last_tambour_id_2,
    ConnectedPieceTypePortId="t",
    ConnectingPieceId=pce.Id,
    Rotation=addition_3,
    Tilt=capital_tilt_2,
    Gap=capital_gap_2,
    Shift=capital_shift_2)  # -> Connection, Valid, ConnectedPieceId, ConnectedPieceTypePortId, ConnectingPieceId, ConnectingPieceTypePortId, Rotation, Tilt, Gap, Shift

merge_3 = Merge(Data1=pce_3.Piece, Data2=pce_2.Piece, Data3=pce.Piece)
merge_4 = Merge(Data1=con.Connection, Data2=con_2.Connection, Data3=con_3.Connection, Data4=con_4.Connection)
merge_5 = Merge(Data1=merge_4, Data2=merge_2)
merge_6 = Merge(Data1=merge_3, Data2=merge)
dsn = ModelDesign(
    Name="Nakagin Capsule Tower",
    Description="The former Nakagin Capsule Tower from Tokyio.",
    Icon="🫀",
    Variant=variant_2,
    Pieces=merge_6,
    Connections=merge_5)  # -> Design, Valid, Name, Description, Icon, Variant, Unit, Pieces, Connections, Qualities
addbridges = AddBridges(
    dn=dsn.Design,
    levels=genes,
    bridge_rotation=bridge_rotation,
    bridge_tilt=bridge_tilt,
    bridge_gap=bridge_gap,
    bridge_shift=bridge_shift)

# ----
# Change the design later
panel_2 = Panel("Base")
vartyp = VaryTypes(dn=addbridges, na=panel_2, new_vn="Blob")
rpltyp = ReplaceType(dn=vartyp, old_na="Capsule", new_na="Ellipsoid Capsule")
rpltyp_2 = ReplaceType(dn=rpltyp, old_na="Tambour", new_na="Cylindric Tambour")
rpltyp_3 = ReplaceType(dn=rpltyp_2, old_na="Capital", new_na="Cylindric Capital")
concat_7 = Concatenate(FragmentA="Futuristic ", FragmentB="Nakagin Capsule Tower")
dsn_2 = ModelDesign(Design=rpltyp_3, Name=concat_7)  # -> Design, Valid, Name, Description, Icon, Variant, Unit, Pieces, Connections, Qualities
filter_3 = StreamFilter(Gate=futuristic_2, Stream0=addbridges, Stream1=dsn_2.Design)
shwdsn = ShowDesign(dn=filter_3, ty=ty_2, mm="model/vnd.3dm", lod=lod_2, tags=tags_2)  # -> ur_2, pln_2

# ----
# Do some calculations based on metadata
performance_assessment = PerformanceAssessment(
    dn=filter_3,
    ty=ty_2,
    heating_energy_price_cent_kwh=heating_energy_price_kwh_2,
    heating_efficiency_factor=heating_efficiency_factor_2,
    heating_global_warming_potential_kgco2e=heating_global_warming_potential_kgco2e_2,
    cooling_energy_price_cent_kwh=cooling_energy_price_kwh_2,
    cooling_efficiency_factor=cooling_efficiency_factor_2,
    cooling_global_warming_potential_kgco2e=cooling_global_warming_potential_kgco2e_2,
    electrictiy_energy_price_cent_kwh=electrictiy_energy_price_cent_kwh_2,
    electrictiy_global_warming_potential_kgc=electrictiy_global_warming_potential_kgc_2)  # -> dn_4, effective_floor_area_m²_2, specific_operational_global_warming_pote_2, construction_cost_2, return_a_2, construction_global_warming_potential_kg_2, operational_cost_a_2, operational_global_warming_potential_kgc_2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
expression = Expression(x=performance_assessment.construction_cost_2, Expression="x/1000000")
expression_2 = Expression(x=performance_assessment.operational_cost_a_2, Expression="x/1000000")
expression_3 = Expression(x=performance_assessment.maintenance_expenses_a_2, Expression="x/1000000")
expression_4 = Expression(x=performance_assessment.income_2, Expression="x/1000000")
expression_5 = Expression(x=performance_assessment.return_a_2, Expression="x/1000000")
expression_6 = Expression(x=performance_assessment.operational_energy_cost_a_2, Expression="x/1000000")
expression_7 = Expression(x=performance_assessment.construction_global_warming_potential_kg_2, Expression="x/1000")
expression_8 = Expression(x=performance_assessment.operational_global_warming_potential_kgc_2, Expression="x/1000")
expression_9 = Expression(x=performance_assessment.heating_energy_demand_kwh_a_2, Expression="x/1000")
expression_10 = Expression(x=performance_assessment.cooling_energy_demand_kwh_a_2, Expression="x/1000")
expression_11 = Expression(x=performance_assessment.technical_equipment_energy_demand_kwh_a_2, Expression="x/1000")
roundmult = RoundToMultiple(N=expression_4, M="0.05")  # -> R; inputs N: tree, M: tree
# ---------- roundmult: Python ----------
#Component Information
#--------------------------------------------------------------------------------------------
if ghenv.Component.RunCount<2:
    #General
    #--------------------------------------------------------------------------------------------
    __author__ = "YOUR NAME"
    __version__ = "2000.00.00"
    
    ghenv.Component.Name = "Round to Multiple"
    ghenv.Component.NickName = "RoundMult"
    ghenv.Component.Description = "Rounds a number to the nearest specified multiple."
    ghenv.Component.Message = "VER 1.0"
    ghenv.Component.Category = "Math"
    ghenv.Component.SubCategory = "Arithmetic"
    
     #Inputs
    #--------------------------------------------------------------------------------------------
    inputIndex=0
    
    ghenv.Component.Params.Input[inputIndex].Name = "Number"
    ghenv.Component.Params.Input[inputIndex].NickName = "N"
    ghenv.Component.Params.Input[inputIndex].Description = "Number to round."
    ghenv.Component.Params.Input[inputIndex].Optional = False
    inputIndex+=1
    
    ghenv.Component.Params.Input[inputIndex].Name = "Multiple"
    ghenv.Component.Params.Input[inputIndex].NickName = "M"
    ghenv.Component.Params.Input[inputIndex].Description = "Multiple to round to."
    ghenv.Component.Params.Input[inputIndex].Optional = False
    inputIndex+=1
    
    #Outputs
    #--------------------------------------------------------------------------------------------
    outputIndex=0
    
    ghenv.Component.Params.Output[outputIndex].Name = "Rounded"
    ghenv.Component.Params.Output[outputIndex].NickName = "R"
    ghenv.Component.Params.Output[outputIndex].Description = "Number rounded to the nearest specified multiple."
    outputIndex+=1


#Imports
#--------------------------------------------------------------------------------------------
from System import Object
from Grasshopper import DataTree
import math


#The Component function - Business logic only (e.g. working without trees)
#--------------------------------------------------------------------------------------------
"""Function that this component is computing.
    Inputs:
        number: The number to round.
        multiple: The multiple to round to.
    Output:
        rounded: The number rounded to the nearest specified multiple."""
def RoundToMultiple(number, multiple):
    rounded = math.ceil(number / multiple) * multiple
    return rounded

#Solver - Run with trees to enhance performance drastically
#--------------------------------------------------------------------------------------------
if __name__ == "__main__":
    
    #Initialize trees
    #--------------------------------------------------------------------------------------------
    RoundedTree = DataTree[Object]()
    
    #Data matching
    #--------------------------------------------------------------------------------------------
    for path in N.Paths:
        numberBranch = N.Branch(path)
        for i, number in enumerate(numberBranch):
            multiple = M.Branch(path)[i]
            rounded = RoundToMultiple(number, multiple)
            RoundedTree.Add(rounded, path)
    
     #Assign trees to output
    #--------------------------------------------------------------------------------------------
    R = RoundedTree
# ---------- end roundmult ----------
roundmult_2 = RoundToMultiple(N=expression_3, M="0.05")  # -> R; inputs N: tree, M: tree; same code as roundmult
roundmult_3 = RoundToMultiple(N=performance_assessment.specific_energy_demand_kwh_m²a_2, M="2.5")  # -> R; inputs N: tree, M: tree; same code as roundmult
roundmult_4 = RoundToMultiple(N=expression_6, M="0.05")  # -> R; inputs N: tree, M: tree; same code as roundmult
roundmult_5 = RoundToMultiple(N=expression_9, M=1)  # -> R; inputs N: tree, M: tree; same code as roundmult
roundmult_6 = RoundToMultiple(N=expression_10, M=1)  # -> R; inputs N: tree, M: tree; same code as roundmult
roundmult_7 = RoundToMultiple(N=expression_11, M=1)  # -> R; inputs N: tree, M: tree; same code as roundmult
roundmult_8 = RoundToMultiple(N=performance_assessment.effective_floor_area_m²_2, M="25")  # -> R; inputs N: tree, M: tree; same code as roundmult
roundmult_9 = RoundToMultiple(N=performance_assessment.specific_operational_global_warming_pote_2, M=1)  # -> R; inputs N: tree, M: tree; same code as roundmult
roundmult_10 = RoundToMultiple(N=expression, M="0.05")  # -> R; inputs N: tree, M: tree; same code as roundmult
roundmult_11 = RoundToMultiple(N=expression_5, M="0.05")  # -> R; inputs N: tree, M: tree; same code as roundmult
roundmult_12 = RoundToMultiple(N=expression_7, M="25")  # -> R; inputs N: tree, M: tree; same code as roundmult
roundmult_13 = RoundToMultiple(N=expression_2, M="0.05")  # -> R; inputs N: tree, M: tree; same code as roundmult
roundmult_14 = RoundToMultiple(N=expression_8, M="5")  # -> R; inputs N: tree, M: tree; same code as roundmult
effective_floor_area_m² = Number(roundmult_8)
operational_cost_mio_a = Number(roundmult_13)
specific_operational_global_warming_pote = Number(roundmult_9)  # "Specific Operational Global Warming Potential [kgCO2e/m²a]"
construction_cost_mio = Number(roundmult_10)
return_a = Number(roundmult_11)
construction_global_warming_potential_tc = Number(roundmult_12)  # "Construction Global Warming Potential [tCO2e]"
operational_global_warming_potential_tco = Number(roundmult_14)  # "Operational Global Warming Potential [tCO2e/a]"
income_mio_a = Number(roundmult)
maintenance_expenses_mio_a = Number(roundmult_2)
specific_energy_demand_kwh_m²a = Number(roundmult_3)
operational_energy_cost_a = Number(roundmult_4)
heating_energy_demand_mwh_a = Number(roundmult_5)
cooling_energy_demand_mwh_a = Number(roundmult_6)
technical_equipment_energy_demand_mwh_a = Number(roundmult_7)

dn = ClusterOutput(performance_assessment.dn_4)
ur = ClusterOutput(shwdsn.ur_2)
effective_floor_area_m²_2 = ClusterOutput(effective_floor_area_m²)
specific_operational_global_warming_pote_2 = ClusterOutput(specific_operational_global_warming_pote)  # "Specific Operational Global Warming Potential [kgCO2e/m²a]"
construction_cost_mio_2 = ClusterOutput(construction_cost_mio)
return_a_2 = ClusterOutput(return_a)
construction_global_warming_potential_tc_2 = ClusterOutput(construction_global_warming_potential_tc)  # "Construction Global Warming Potential [tCO2e]"
operational_cost_mio_a_2 = ClusterOutput(operational_cost_mio_a)
operational_global_warming_potential_tco_2 = ClusterOutput(operational_global_warming_potential_tco)  # "Operational Global Warming Potential [tCO2e/a]"
income_mio_a_2 = ClusterOutput(income_mio_a)
maintenance_expenses_mio_a_2 = ClusterOutput(maintenance_expenses_mio_a)
specific_energy_demand_kwh_m²a_2 = ClusterOutput(specific_energy_demand_kwh_m²a)
operational_energy_cost_a_2 = ClusterOutput(operational_energy_cost_a)
heating_energy_demand_mwh_a_2 = ClusterOutput(heating_energy_demand_mwh_a)
cooling_energy_demand_mwh_a_2 = ClusterOutput(cooling_energy_demand_mwh_a)
technical_equipment_energy_demand_mwh_a_2 = ClusterOutput(technical_equipment_energy_demand_mwh_a)
pln = ClusterOutput(shwdsn.pln_2)

# ==== cluster Interpolate_2: Interpolate between a source design and a target design. The target will act as a blueprint. The result is an interpolated union design and two unmodified but filtered difference design.
T = ClusterInput()
S = ClusterInput()
t = ClusterInput()
T_2 = Design(T)
S_2 = Design(S)
t_2 = Number(t)
nordsn = NormalizeDesign(dn=S_2)
nordsn_2 = NormalizeDesign(dn=T_2)
dsn = ModelDesign(Design=nordsn)  # -> Design, Valid, Name, Description, Icon, Variant, Unit, Pieces, Connections, Qualities
dsn_2 = ModelDesign(Design=nordsn_2)  # -> Design, Valid, Name, Description, Icon, Variant, Unit, Pieces, Connections, Qualities
trim = TrimTree(Tree=dsn_2.Connections, Depth=1)
trim_2 = TrimTree(Tree=dsn.Pieces, Depth=1)
trim_3 = TrimTree(Tree=dsn.Connections, Depth=1)
trim_4 = TrimTree(Tree=dsn_2.Pieces, Depth=1)
pce = ModelPiece(Piece=trim_4)  # -> Piece, Valid, Id, TypeName, TypeVariant, Plane, ScreenPoint
pce_2 = ModelPiece(Piece=trim_2)  # -> Piece, Valid, Id, TypeName, TypeVariant, Plane, ScreenPoint
con = ModelConnection(Connection=trim)  # -> Connection, Valid, ConnectedPieceId, ConnectedPieceTypePortId, ConnectingPieceId, ConnectingPieceTypePortId, Rotation, Tilt, Gap, Shift
con_2 = ModelConnection(Connection=trim_3)  # -> Connection, Valid, ConnectedPieceId, ConnectedPieceTypePortId, ConnectingPieceId, ConnectingPieceTypePortId, Rotation, Tilt, Gap, Shift
intersection = SetIntersection(SetA=pce_2.Id, SetB=pce.Id)
difference = SetDifference(SetA=pce.Id, SetB=pce_2.Id)
difference_2 = SetDifference(SetA=pce_2.Id, SetB=pce.Id)
selcon = SelectConnection(co=trim, cdpc=graft(con_2.ConnectedPieceId), cgpc=graft(con_2.ConnectingPieceId))
selcon_2 = SelectConnection(co=trim_3, cdpc=graft(con.ConnectedPieceId), cgpc=graft(con.ConnectingPieceId))
selpce = SelectPiece(pc=pce.Piece, id=graft(intersection))
selpce_2 = SelectPiece(pc=pce.Piece, id=graft(difference))
selpce_3 = SelectPiece(pc=pce_2.Piece, id=graft(difference_2))
selpce_4 = SelectPiece(pc=pce_2.Piece, id=graft(intersection))
trim_5 = TrimTree(Tree=selcon, Depth=1)
trim_6 = TrimTree(Tree=selcon_2, Depth=1)
expression = Expression(x=t_2, Expression="1-x")
trim_7 = TrimTree(Tree=selpce_2, Depth=1)
trim_8 = TrimTree(Tree=selpce, Depth=1)
trim_9 = TrimTree(Tree=selpce_4, Depth=1)
trim_10 = TrimTree(Tree=selpce_3, Depth=1)
con_3 = ModelConnection(Connection=trim_5)  # -> Connection, Valid, ConnectedPieceId, ConnectedPieceTypePortId, ConnectingPieceId, ConnectingPieceTypePortId, Rotation, Tilt, Gap, Shift
con_4 = ModelConnection(Connection=trim_6)  # -> Connection, Valid, ConnectedPieceId, ConnectedPieceTypePortId, ConnectingPieceId, ConnectingPieceTypePortId, Rotation, Tilt, Gap, Shift
pce_3 = ModelPiece(Piece=trim_8)  # -> Piece, Valid, Id, TypeName, TypeVariant, Plane, ScreenPoint
pce_4 = ModelPiece(Piece=trim_9)  # -> Piece, Valid, Id, TypeName, TypeVariant, Plane, ScreenPoint
merge = Merge(Data1=expression, Data2=t_2)
expression_2 = Expression(x=con_4.Rotation, y=con_3.Rotation, Expression="If(Abs(x-y)≤180,y,-(360-y))")
expression_3 = Expression(x=con_4.Tilt, y=con_3.Tilt, Expression="If(Abs(x-y)≤180,y,-(360-y))")
merge_2 = Merge(Data1=graft(pce_4.Plane), Data2=graft(pce_3.Plane))
avgpl = AveragePlane(Pl=merge_2, M=merge)  # -> AvPl; inputs Pl: list of Plane, M: list of Double; same code as avgpl
expression_4 = Expression(x=t_2, Expression="x≥0.5")
c_script = CSharpScript(x=avgpl)  # -> a; inputs x: Plane; same code as c_script
filter = StreamFilter(Gate=expression_4, Stream0=pce_4.Piece, Stream1=pce_3.Piece)
trim_11 = TrimTree(Tree=c_script, Depth=1)
merge_3 = Merge(Data1=graft(con_4.Gap), Data2=graft(con_3.Gap))
merge_4 = Merge(Data1=graft(con_4.Shift), Data2=graft(con_3.Shift))
merge_5 = Merge(Data1=graft(con_4.Tilt), Data2=graft(expression_3))
merge_6 = Merge(Data1=graft(con_4.Rotation), Data2=graft(expression_2))
tstat = TreeStatistics(Tree=selcon_2)  # -> Paths, Length, Count
tstat_2 = TreeStatistics(Tree=selcon)  # -> Paths, Length, Count
pce_5 = ModelPiece(Piece=filter, Plane=trim_11)  # -> Piece, Valid, Id, TypeName, TypeVariant, Plane, ScreenPoint
trim_12 = TrimTree(Tree=tstat_2.Length, Depth=1)
trim_13 = TrimTree(Tree=tstat.Length, Depth=1)
interp = InterpolateData(Data=merge_6, Parameter=t_2, Interpolation=2)
interp_2 = InterpolateData(Data=merge_3, Parameter=t_2, Interpolation=2)
interp_3 = InterpolateData(Data=merge_4, Parameter=t_2, Interpolation=2)
interp_4 = InterpolateData(Data=merge_5, Parameter=t_2, Interpolation=2)
filter_2 = StreamFilter(Gate=expression_4, Stream0=con_4.Connection, Stream1=con_3.Connection)
pc_s_u_t = Piece(pce_5.Piece)
filter_3 = StreamFilter(Gate=expression_4, Stream0=T_2, Stream1=S_2)
trim_14 = TrimTree(Tree=interp_3, Depth=1)
equals = Equality(FirstNumber=trim_13, SecondNumber="0")  # -> Equality, Inequality
pc_s_t = Piece(trim_10)
trim_15 = TrimTree(Tree=interp, Depth=1)
trim_16 = TrimTree(Tree=interp_4, Depth=1)
equals_2 = Equality(FirstNumber=trim_12, SecondNumber="0")  # -> Equality, Inequality
pc_t_s = Piece(trim_7)
trim_17 = TrimTree(Tree=interp_2, Depth=1)
con_5 = ModelConnection(Connection=filter_2, Rotation=trim_15, Tilt=trim_16, Gap=trim_17, Shift=trim_14)  # -> Connection, Valid, ConnectedPieceId, ConnectedPieceTypePortId, ConnectingPieceId, ConnectingPieceTypePortId, Rotation, Tilt, Gap, Shift
cull = CullPattern(List=trim_3, CullPattern=equals_2.Equality)
cull_2 = CullPattern(List=trim, CullPattern=equals.Equality)
co_s_u_t = Connection(con_5.Connection)
co_s_t = Connection(cull)
co_t_s = Connection(cull_2)
dsn_3 = ModelDesign(Design=filter_3, Pieces=pc_s_u_t, Connections=co_s_u_t)  # -> Design, Valid, Name, Description, Icon, Variant, Unit, Pieces, Connections, Qualities
dsn_4 = ModelDesign(Design=nordsn, Pieces=pc_s_t, Connections=co_s_t)  # -> Design, Valid, Name, Description, Icon, Variant, Unit, Pieces, Connections, Qualities
dsn_5 = ModelDesign(Design=nordsn_2, Pieces=pc_t_s, Connections=co_t_s)  # -> Design, Valid, Name, Description, Icon, Variant, Unit, Pieces, Connections, Qualities
dn_s_u_t = Design(dsn_3.Design)
dn_s_t = Design(dsn_4.Design)
dn_t_s = Design(dsn_5.Design)
dn_s_t_2 = ClusterOutput(dn_s_t)
dn_s_u_t_2 = ClusterOutput(dn_s_u_t)
dn_t_s_2 = ClusterOutput(dn_t_s)

# ==== cluster ShowDesign_2: Show a design by flattening it and selecting only representations with the same mime, lod and tags.
ty = ClusterInput()
dn = ClusterInput()
mm = ClusterInput()
lod = ClusterInput()
tags = ClusterInput()
ty_2 = Type(ty)
mm_2 = Mime(mm)
tags_2 = Tags(tags)
dn_2 = Design(dn)
lod_2 = Lod(lod)
fltdsn = FlattenDesign(Design=dn_2, Type=ty_2)
typ = ModelType(Type=ty_2)  # -> Type, Valid, Name, Description, Icon, Variant, Unit, Representations, Ports, Qualities
dsn = ModelDesign(Design=fltdsn)  # -> Design, Valid, Name, Description, Icon, Variant, Unit, Pieces, Connections, Qualities
tstat = TreeStatistics(Tree=typ.Representations)  # -> Paths, Length, Count
trim = TrimTree(Tree=dsn.Pieces, Depth=1)
pce = ModelPiece(Piece=trim)  # -> Piece, Valid, Id, TypeName, TypeVariant, Plane, ScreenPoint
lng = ListLength(List=ty_2)
expression = Expression(x=graft(pce.TypeName), y=typ.Name, Expression="x=y")
expression_2 = Expression(x=graft(pce.TypeVariant), y=typ.Variant, Expression="x=y")
series = Series(Start=0, Step=1, Count=lng)
and = GateAnd(A=expression, B=expression_2)
trim_2 = TrimTree(Tree=series, Depth=1)
cull = CullPattern(List=ty_2, CullPattern=and)
txt = Text(cull)
txt_2 = Text(ty_2)
expression_3 = Expression(x=txt, y=txt_2, Expression="x=y")
cull_2 = CullPattern(List=trim_2, CullPattern=expression_3)
trim_3 = TrimTree(Tree=cull_2, Depth=1)
item = ListItem(List=tstat.Paths, Index=trim_3, Wrap=True)
branch = TreeBranch(Tree=typ.Representations, Path=item, MaintainPaths=False)
mrg_p = MergeSeperatlyPrepend(x=branch)  # -> Mrgd; inputs x: tree; same code as mrg_p
rep = ModelRepresentation(Representation=mrg_p)  # -> Representation, Valid, Url, Mime, Lod, Tags
expression_4 = Expression(x=rep.Mime, y=mm_2, Expression="x=y")
cull_3 = CullPattern(List=rep.Representation, CullPattern=expression_4)
rep_2 = ModelRepresentation(Representation=cull_3)  # -> Representation, Valid, Url, Mime, Lod, Tags
expression_5 = Expression(x=rep_2.Lod, y=lod_2, Expression="x=y")
cull_4 = CullPattern(List=rep_2.Representation, CullPattern=expression_5)
trim_4 = TrimTree(Tree=cull_4, Depth=1)
rep_3 = ModelRepresentation(Representation=trim_4)  # -> Representation, Valid, Url, Mime, Lod, Tags
ur = Url(rep_3.Url)
id = Id(pce.Id)
pln = Plane(pce.Plane)
ur_2 = ClusterOutput(ur)
pln_2 = ClusterOutput(pln)
id_2 = ClusterOutput(id)

# ==== cluster NormalizeDesign_2: Normalize a design to a standard way. It does not change the design, only the way that it is structured. This includes reodering pieces and connections. In the future, this will optionally convert units automatically.
dn = ClusterInput()
dn_2 = Design(dn)
dsn = ModelDesign(Design=dn_2)  # -> Design, Valid, Name, Description, Icon, Variant, Unit, Pieces, Connections, Qualities
trim = TrimTree(Tree=dsn.Pieces, Depth=1)
trim_2 = TrimTree(Tree=dsn.Connections, Depth=1)
con = ModelConnection(Connection=trim_2)  # -> Connection, Valid, ConnectedPieceId, ConnectedPieceTypePortId, ConnectingPieceId, ConnectingPieceTypePortId, Rotation, Tilt, Gap, Shift
merge = Merge(Data1=graft(con.ConnectedPieceId), Data2=graft(con.ConnectingPieceId))
tsort = SortText(Keys=merge, Culture=127)  # -> Keys, Values
trim_3 = TrimTree(Tree=tsort.Keys, Depth=1)
expression = Expression(x=merge, y=trim_3, Expression="x=y")
item = ListItem(List=expression, Index=0, Wrap=True)
trim_4 = TrimTree(Tree=item, Depth=1)
dispatch = Dispatch(List=con.Connection, DispatchPattern=trim_4)  # -> ListA, ListB
con_2 = ModelConnection(Connection=dispatch.ListB)  # -> Connection, Valid, ConnectedPieceId, ConnectedPieceTypePortId, ConnectingPieceId, ConnectingPieceTypePortId, Rotation, Tilt, Gap, Shift
con_3 = ModelConnection(
    Connection=dispatch.ListB,
    ConnectedPieceId=con_2.ConnectingPieceId,
    ConnectedPieceTypePortId=con_2.ConnectingPieceTypePortId,
    ConnectingPieceId=con_2.ConnectedPieceId,
    ConnectingPieceTypePortId=con_2.ConnectedPieceTypePortId)  # -> Connection, Valid, ConnectedPieceId, ConnectedPieceTypePortId, ConnectingPieceId, ConnectingPieceTypePortId, Rotation, Tilt, Gap, Shift
merge_2 = Merge(Data1=dispatch.ListA, Data2=con_3.Connection)
con_4 = ModelConnection(Connection=merge_2)  # -> Connection, Valid, ConnectedPieceId, ConnectedPieceTypePortId, ConnectingPieceId, ConnectingPieceTypePortId, Rotation, Tilt, Gap, Shift
concat = Concatenate(FragmentA=con_4.ConnectedPieceId, FragmentC=" -- ", FragmentB=con_4.ConnectingPieceId)
pce = ModelPiece(Piece=trim)  # -> Piece, Valid, Id, TypeName, TypeVariant, Plane, ScreenPoint
tsort_2 = SortText(Keys=concat, Values=con_4.Connection, Culture=127)  # -> Keys, Values
tsort_3 = SortText(Keys=pce.Id, Values=pce.Piece, Culture=127)  # -> Keys, Values
trim_5 = TrimTree(Tree=tsort_2.Values, Depth=1)
trim_6 = TrimTree(Tree=tsort_3.Values, Depth=1)
dsn_2 = ModelDesign(Design=dsn.Design, Pieces=trim_6, Connections=trim_5)  # -> Design, Valid, Name, Description, Icon, Variant, Unit, Pieces, Connections, Qualities
dn_3 = Design(dsn_2.Design)
dn_4 = ClusterOutput(dn_3)

# ==== cluster SelectPiece: Select a piece with the id.
pc = ClusterInput()
id = ClusterInput()
pc_2 = Piece(pc)
id_2 = Id(id)
pce = ModelPiece(Piece=pc_2)  # -> Piece, Valid, Id, TypeName, TypeVariant, Plane, ScreenPoint
expression = Expression(x=pce.Id, y=id_2, Expression="x=y")
cull = CullPattern(List=pce.Piece, CullPattern=expression)
pc_3 = Piece(cull)
pc_4 = ClusterOutput(pc_3)

# ==== cluster SelectConnection: Select a connection with the connected id and the connected id. The connections are symetric, so if the conected is the connecting and vice versa it will still selct them.
co = ClusterInput()
cdpc = ClusterInput()
cgpc = ClusterInput()
co_2 = Connection(co)
cdpc_2 = ConnectedPieceId(cdpc)
cgpc_2 = ConnectingPieceId(cgpc)
con = ModelConnection(Connection=co_2)  # -> Connection, Valid, ConnectedPieceId, ConnectedPieceTypePortId, ConnectingPieceId, ConnectingPieceTypePortId, Rotation, Tilt, Gap, Shift
expression = Expression(x=con.ConnectedPieceId, y=cdpc_2, Expression="x=y")
expression_2 = Expression(x=con.ConnectedPieceId, y=cgpc_2, Expression="x=y")
expression_3 = Expression(x=con.ConnectingPieceId, y=cgpc_2, Expression="x=y")
expression_4 = Expression(x=con.ConnectingPieceId, y=cdpc_2, Expression="x=y")
and = GateAnd(A=expression, B=expression_3)
and_2 = GateAnd(A=expression_2, B=expression_4)
or = GateOr(A=and, B=and_2)
cull = CullPattern(List=con.Connection, CullPattern=or)
co_3 = Connection(cull)
co_4 = ClusterOutput(co_3)

# ==== cluster NormalizeDesign: Normalize a design to a standard way. It does not change the design, only the way that it is structured. This includes reodering pieces and connections. In the future, this will optionally convert units automatically.
dn = ClusterInput()
dn_2 = Design(dn)
dsn = ModelDesign(Design=dn_2)  # -> Design, Valid, Name, Description, Icon, Variant, Unit, Pieces, Connections, Qualities
trim = TrimTree(Tree=dsn.Pieces, Depth=1)
trim_2 = TrimTree(Tree=dsn.Connections, Depth=1)
con = ModelConnection(Connection=trim_2)  # -> Connection, Valid, ConnectedPieceId, ConnectedPieceTypePortId, ConnectingPieceId, ConnectingPieceTypePortId, Rotation, Tilt, Gap, Shift
merge = Merge(Data1=graft(con.ConnectedPieceId), Data2=graft(con.ConnectingPieceId))
tsort = SortText(Keys=merge, Culture=127)  # -> Keys, Values
trim_3 = TrimTree(Tree=tsort.Keys, Depth=1)
expression = Expression(x=merge, y=trim_3, Expression="x=y")
item = ListItem(List=expression, Index=0, Wrap=True)
trim_4 = TrimTree(Tree=item, Depth=1)
dispatch = Dispatch(List=con.Connection, DispatchPattern=trim_4)  # -> ListA, ListB
con_2 = ModelConnection(Connection=dispatch.ListB)  # -> Connection, Valid, ConnectedPieceId, ConnectedPieceTypePortId, ConnectingPieceId, ConnectingPieceTypePortId, Rotation, Tilt, Gap, Shift
con_3 = ModelConnection(
    Connection=dispatch.ListB,
    ConnectedPieceId=con_2.ConnectingPieceId,
    ConnectedPieceTypePortId=con_2.ConnectingPieceTypePortId,
    ConnectingPieceId=con_2.ConnectedPieceId,
    ConnectingPieceTypePortId=con_2.ConnectedPieceTypePortId)  # -> Connection, Valid, ConnectedPieceId, ConnectedPieceTypePortId, ConnectingPieceId, ConnectingPieceTypePortId, Rotation, Tilt, Gap, Shift
merge_2 = Merge(Data1=dispatch.ListA, Data2=con_3.Connection)
con_4 = ModelConnection(Connection=merge_2)  # -> Connection, Valid, ConnectedPieceId, ConnectedPieceTypePortId, ConnectingPieceId, ConnectingPieceTypePortId, Rotation, Tilt, Gap, Shift
concat = Concatenate(FragmentA=con_4.ConnectedPieceId, FragmentB=con_4.ConnectingPieceId)
pce = ModelPiece(Piece=trim)  # -> Piece, Valid, Id, TypeName, TypeVariant, Plane, ScreenPoint
tsort_2 = SortText(Keys=concat, Values=con_4.Connection, Culture=127)  # -> Keys, Values
tsort_3 = SortText(Keys=pce.Id, Values=pce.Piece, Culture=127)  # -> Keys, Values
trim_5 = TrimTree(Tree=tsort_2.Values, Depth=1)
trim_6 = TrimTree(Tree=tsort_3.Values, Depth=1)
dsn_2 = ModelDesign(Design=dsn.Design, Pieces=trim_6, Connections=trim_5)  # -> Design, Valid, Name, Description, Icon, Variant, Unit, Pieces, Connections, Qualities
dn_3 = Design(dsn_2.Design)
dn_4 = ClusterOutput(dn_3)

# ==== cluster Tower
floor = Panel("f")
shaftpieceid = ClusterInput()
capsulepatternnorthwest = ClusterInput()
capsulepatternsoutheast = ClusterInput()
capsulepatternsouthwest = ClusterInput()
capsulepatternnortheast = ClusterInput()
capsulerotation = ClusterInput()
capsuletilt = ClusterInput()
capsulegap = ClusterInput()
capsuleshift = ClusterInput()
tambourrotation = ClusterInput()
tambourtilt = ClusterInput()
tambourgap = ClusterInput()
tambourshift = ClusterInput()
panel = Panel("""0
0
1
0
1
0
2
3
3""")
panel_2 = Panel("""2
3
3
0
0
1
0
0
1""")
merge = Merge(Data1="\", Data2="p", Data3="L", Data4="z")
merge_2 = Merge(Data1="/", Data2="q", Data3="J", Data4="s")
split_level = Panel("sl")
door = Panel("d")
shaftpieceid_2 = Text(shaftpieceid)
capsulepatternnorthwest_2 = Integer(capsulepatternnorthwest)
item = ListItem(List=panel, Index=capsulepatternnorthwest_2, Wrap=True)
item_2 = ListItem(List=panel_2, Index=capsulepatternnorthwest_2, Wrap=True)
item_3 = ListItem(List=merge, Index=item, Wrap=True)
item_4 = ListItem(List=merge_2, Index=item_2, Wrap=True)
lng = ListLength(List=capsulepatternnorthwest_2)
capsulepatternsoutheast_2 = Integer(capsulepatternsoutheast)
item_5 = ListItem(List=panel_2, Index=capsulepatternsoutheast_2, Wrap=True)
item_6 = ListItem(List=panel, Index=capsulepatternsoutheast_2, Wrap=True)
item_7 = ListItem(List=merge, Index=item_6, Wrap=True)
item_8 = ListItem(List=merge_2, Index=item_5, Wrap=True)
capsulepatternsouthwest_2 = Integer(capsulepatternsouthwest)
item_9 = ListItem(List=panel, Index=capsulepatternsouthwest_2, Wrap=True)
item_10 = ListItem(List=panel_2, Index=capsulepatternsouthwest_2, Wrap=True)
item_11 = ListItem(List=merge, Index=item_9, Wrap=True)
item_12 = ListItem(List=merge_2, Index=item_10, Wrap=True)
capsulepatternnortheast_2 = Integer(capsulepatternnortheast)
item_13 = ListItem(List=panel, Index=capsulepatternnortheast_2, Wrap=True)
item_14 = ListItem(List=panel_2, Index=capsulepatternnortheast_2, Wrap=True)
item_15 = ListItem(List=merge_2, Index=item_14, Wrap=True)
item_16 = ListItem(List=merge, Index=item_13, Wrap=True)
capsulerotation_2 = Number(capsulerotation)
tambourrotation_2 = Number(tambourrotation)
tambourtilt_2 = Number(tambourtilt)
capsuletilt_2 = Number(capsuletilt)
capsulegap_2 = Number(capsulegap)
capsuleshift_2 = Number(capsuleshift)
tambourgap_2 = Number(tambourgap)
tambourshift_2 = Number(tambourshift)
bottom = Panel("b")
capsulevariantsouthright = Text(item_12)
number_of_floors = Integer(lng)
capsulevariantwestright = Text(item_4)
capsulevariantnorthleft = Text(item_3)
capsulevariantwestleft = Text(item_11)
capsulevariantsouthleft = Text(item_7)
capsulevariantnorthright = Text(item_15)
capsulevarianteastright = Text(item_8)
capsulevarianteastleft = Text(item_16)
neg = Negative(Value=capsuleshift_2)
top = Panel("t")

series = Series(Start=0, Step=1, Count=number_of_floors)
trim = TrimTree(Tree=series, Depth=1)
concat = Concatenate(FragmentA=floor, FragmentB=trim)
concat_2 = Concatenate(FragmentD="t", FragmentE="_", FragmentA=concat, FragmentF="_", FragmentG=shaftpieceid_2)
lito3p = ListInto3Parts(ListToSlice=concat_2, StartIndex="1", EndIndex="-1")  # -> FilteredList, ItemsBefore, ItemsAfter; inputs ListToSlice: tree, StartIndex: tree of Int32, EndIndex: tree of Int32
# ---------- lito3p: Python ----------
if ghenv.Component.RunCount<2:
    __author__ = "Ueli Saluz"
    __version__ = "2020.05.28"
    
    ghenv.Component.Name = "ListInto3Parts"
    ghenv.Component.NickName = "LiTo3P"
    ghenv.Component.Description = "Slice list into 3 parts. All lists are sliced with the same indices. End index = 0 = length(list)."
    ghenv.Component.Message = "VER 1.6"

from System import Object
from Grasshopper import DataTree

def filterList(listToFilter,startIndex,endIndex):
    # Return: FilteredList, Before, After
    if (((startIndex == 0) or (startIndex is None)) and ((endIndex == 0) or (endIndex is None))) or (endIndex <= startIndex and endIndex > 0):
        return (listToFilter,None,None)
    elif (startIndex == 0) or (startIndex is None):
        return (listToFilter[:endIndex],None,listToFilter[endIndex:])
    elif (endIndex == 0) or (endIndex is None):
        print 1
        return (listToFilter[:startIndex],listToFilter[startIndex:],None)
    else:
        return (listToFilter[startIndex:endIndex],listToFilter[:startIndex],listToFilter[endIndex:])

if __name__ == "__main__":
    FilteredList = DataTree[Object]()
    ItemsBefore = DataTree[Object]()
    ItemsAfter = DataTree[Object]()
    
    for path in ListToSlice.Paths:
        listBranch = ListToSlice.Branch(path)
        pyList = list(listBranch)   #Convert .Net List to Python
        try: #terrible way of writing code but if I set the list to list access the performance decreases massivly due to many calls
            startIndex = StartIndex.Branch(path)
            startIndex = startIndex[0]
        except Exception:
            try:
                startIndex = StartIndex.Branch(0)
                startIndex = startIndex[0]
            except Exception:
                startIndex = 0
        try:
            endIndex = EndIndex.Branch(path)
            endIndex = endIndex[0]
        except Exception:
            try:
                endIndex = EndIndex.Branch(0)
                endIndex = endIndex[0]
            except Exception:
                endIndex = len(pyList)
        filtList=filterList(pyList,startIndex,endIndex)
        if filtList[0]:
            FilteredList.AddRange(filtList[0],path)
        if filtList[1]:
            ItemsBefore.AddRange(filtList[1],path)
        if filtList[2]:
            ItemsAfter.AddRange(filtList[2],path)
# ---------- end lito3p ----------
pce = ModelPiece(Id=lito3p.FilteredList, TypeName="Tambour")  # -> Piece, Valid, Id, TypeName, TypeVariant, Plane, ScreenPoint
pce_2 = ModelPiece(Id=lito3p.ItemsBefore, TypeName="Tambour", TypeVariant="First Storey")  # -> Piece, Valid, Id, TypeName, TypeVariant, Plane, ScreenPoint
pce_3 = ModelPiece(Id=lito3p.ItemsAfter, TypeName="Tambour", TypeVariant="Last Storey")  # -> Piece, Valid, Id, TypeName, TypeVariant, Plane, ScreenPoint
expression = Expression(x=number_of_floors, Expression="x=1")
merge_3 = Merge(Data1=pce_2.Piece, Data2=pce.Piece, Data3=pce_3.Piece)
pce_4 = ModelPiece(Id=concat_2, TypeName="Tambour")  # -> Piece, Valid, Id, TypeName, TypeVariant, Plane, ScreenPoint
filter = StreamFilter(Gate=expression, Stream0=merge_3, Stream1=pce_4.Piece)
pce_5 = ModelPiece(Piece=filter, TypeName="Tambour")  # -> Piece, Valid, Id, TypeName, TypeVariant, Plane, ScreenPoint
tambour_pc = Piece(pce_5.Piece)

concat_3 = Concatenate(FragmentA=split_level, FragmentB="0")
concat_4 = Concatenate(FragmentA=door, FragmentB="0")
concat_5 = Concatenate(FragmentA=concat_3, FragmentC="_", FragmentB=concat_4)
concat_6 = Concatenate(FragmentF="cs", FragmentA="_", FragmentD=concat_5, FragmentB="_", FragmentC=concat_2)
pce_6 = ModelPiece(Id=concat_6, TypeName="Capsule", TypeVariant=capsulevarianteastleft)  # -> Piece, Valid, Id, TypeName, TypeVariant, Plane, ScreenPoint
con = ModelConnection(
    ConnectedPieceId=pce_5.Id,
    ConnectedPieceTypePortId=concat_5,
    ConnectingPieceId=pce_6.Id,
    Rotation=capsulerotation_2,
    Tilt=capsuletilt_2,
    Gap=capsulegap_2,
    Shift=neg)  # -> Connection, Valid, ConnectedPieceId, ConnectedPieceTypePortId, ConnectingPieceId, ConnectingPieceTypePortId, Rotation, Tilt, Gap, Shift

concat_7 = Concatenate(FragmentA=door, FragmentB="1")
concat_8 = Concatenate(FragmentA=split_level, FragmentB="0")
concat_9 = Concatenate(FragmentA=concat_8, FragmentC="_", FragmentB=concat_7)
concat_10 = Concatenate(FragmentF="cs", FragmentA="_", FragmentD=concat_9, FragmentB="_", FragmentC=concat_2)
pce_7 = ModelPiece(Id=concat_10, TypeName="Capsule", TypeVariant=capsulevariantnorthright)  # -> Piece, Valid, Id, TypeName, TypeVariant, Plane, ScreenPoint
con_2 = ModelConnection(
    ConnectedPieceId=pce_5.Id,
    ConnectedPieceTypePortId=concat_9,
    ConnectingPieceId=pce_7.Id,
    Rotation=capsulerotation_2,
    Tilt=capsuletilt_2,
    Gap=capsulegap_2,
    Shift=capsuleshift_2)  # -> Connection, Valid, ConnectedPieceId, ConnectedPieceTypePortId, ConnectingPieceId, ConnectingPieceTypePortId, Rotation, Tilt, Gap, Shift

concat_11 = Concatenate(FragmentA=split_level, FragmentB="0")
concat_12 = Concatenate(FragmentA=door, FragmentB="2")
concat_13 = Concatenate(FragmentA=concat_11, FragmentC="_", FragmentB=concat_12)
concat_14 = Concatenate(FragmentF="cs", FragmentA="_", FragmentD=concat_13, FragmentB="_", FragmentC=concat_2)
pce_8 = ModelPiece(Id=concat_14, TypeName="Capsule", TypeVariant=capsulevariantnorthleft)  # -> Piece, Valid, Id, TypeName, TypeVariant, Plane, ScreenPoint
con_3 = ModelConnection(
    ConnectedPieceId=pce_5.Id,
    ConnectedPieceTypePortId=concat_13,
    ConnectingPieceId=pce_8.Id,
    Rotation=capsulerotation_2,
    Tilt=capsuletilt_2,
    Gap=capsulegap_2,
    Shift=neg)  # -> Connection, Valid, ConnectedPieceId, ConnectedPieceTypePortId, ConnectingPieceId, ConnectingPieceTypePortId, Rotation, Tilt, Gap, Shift

concat_15 = Concatenate(FragmentA=door, FragmentB="3")
concat_16 = Concatenate(FragmentA=split_level, FragmentB="0")
concat_17 = Concatenate(FragmentA=concat_16, FragmentC="_", FragmentB=concat_15)
concat_18 = Concatenate(FragmentF="cs", FragmentA="_", FragmentD=concat_17, FragmentB="_", FragmentC=concat_2)
pce_9 = ModelPiece(Id=concat_18, TypeName="Capsule", TypeVariant=capsulevariantwestright)  # -> Piece, Valid, Id, TypeName, TypeVariant, Plane, ScreenPoint
con_4 = ModelConnection(
    ConnectedPieceId=pce_5.Id,
    ConnectedPieceTypePortId=concat_17,
    ConnectingPieceId=pce_9.Id,
    Rotation=capsulerotation_2,
    Tilt=capsuletilt_2,
    Gap=capsulegap_2,
    Shift=capsuleshift_2)  # -> Connection, Valid, ConnectedPieceId, ConnectedPieceTypePortId, ConnectingPieceId, ConnectingPieceTypePortId, Rotation, Tilt, Gap, Shift

concat_19 = Concatenate(FragmentA=split_level, FragmentB="1")
concat_20 = Concatenate(FragmentA=door, FragmentB="0")
concat_21 = Concatenate(FragmentA=concat_19, FragmentC="_", FragmentB=concat_20)
concat_22 = Concatenate(FragmentF="cs", FragmentA="_", FragmentD=concat_21, FragmentB="_", FragmentC=concat_2)
pce_10 = ModelPiece(Id=concat_22, TypeName="Capsule", TypeVariant=capsulevariantwestleft)  # -> Piece, Valid, Id, TypeName, TypeVariant, Plane, ScreenPoint
con_5 = ModelConnection(
    ConnectedPieceId=pce_5.Id,
    ConnectedPieceTypePortId=concat_21,
    ConnectingPieceId=pce_10.Id,
    Rotation=capsulerotation_2,
    Tilt=capsuletilt_2,
    Gap=capsulegap_2,
    Shift=neg)  # -> Connection, Valid, ConnectedPieceId, ConnectedPieceTypePortId, ConnectingPieceId, ConnectingPieceTypePortId, Rotation, Tilt, Gap, Shift

concat_23 = Concatenate(FragmentA=door, FragmentB="1")
concat_24 = Concatenate(FragmentA=split_level, FragmentB="1")
concat_25 = Concatenate(FragmentA=concat_24, FragmentC="_", FragmentB=concat_23)
concat_26 = Concatenate(FragmentF="cs", FragmentA="_", FragmentD=concat_25, FragmentB="_", FragmentC=concat_2)
pce_11 = ModelPiece(Id=concat_26, TypeName="Capsule", TypeVariant=capsulevariantsouthright)  # -> Piece, Valid, Id, TypeName, TypeVariant, Plane, ScreenPoint
con_6 = ModelConnection(
    ConnectedPieceId=pce_5.Id,
    ConnectedPieceTypePortId=concat_25,
    ConnectingPieceId=pce_11.Id,
    Rotation=capsulerotation_2,
    Tilt=capsuletilt_2,
    Gap=capsulegap_2,
    Shift=capsuleshift_2)  # -> Connection, Valid, ConnectedPieceId, ConnectedPieceTypePortId, ConnectingPieceId, ConnectingPieceTypePortId, Rotation, Tilt, Gap, Shift

tambour_pc_2 = ClusterOutput(tambour_pc)

shift = ShiftList(List=pce_5.Id, Shift="-1", Wrap="F")
shift_2 = ShiftList(List=pce_5.Id, Shift=1, Wrap="F")
trim_2 = TrimTree(Tree=shift_2, Depth=1)
trim_3 = TrimTree(Tree=shift, Depth=1)
con_7 = ModelConnection(
    ConnectedPieceId=trim_3,
    ConnectedPieceTypePortId=top,
    ConnectingPieceId=trim_2,
    ConnectingPieceTypePortId=bottom,
    Rotation=tambourrotation_2,
    Tilt=tambourtilt_2,
    Gap=tambourgap_2,
    Shift=tambourshift_2)  # -> Connection, Valid, ConnectedPieceId, ConnectedPieceTypePortId, ConnectingPieceId, ConnectingPieceTypePortId, Rotation, Tilt, Gap, Shift
filter_2 = StreamFilter(Gate=expression, Stream0=con_7.Connection)
tambour_co = Connection(filter_2)

tambour_co_2 = ClusterOutput(tambour_co)

concat_27 = Concatenate(FragmentA=split_level, FragmentB="2")
concat_28 = Concatenate(FragmentA=door, FragmentB="0")
concat_29 = Concatenate(FragmentA=concat_27, FragmentC="_", FragmentB=concat_28)
concat_30 = Concatenate(FragmentF="cs", FragmentA="_", FragmentD=concat_29, FragmentB="_", FragmentC=concat_2)
pce_12 = ModelPiece(Id=concat_30, TypeName="Capsule", TypeVariant=capsulevariantsouthleft)  # -> Piece, Valid, Id, TypeName, TypeVariant, Plane, ScreenPoint
con_8 = ModelConnection(
    ConnectedPieceId=pce_5.Id,
    ConnectedPieceTypePortId=concat_29,
    ConnectingPieceId=pce_12.Id,
    Rotation=capsulerotation_2,
    Tilt=capsuletilt_2,
    Gap=capsulegap_2,
    Shift=neg)  # -> Connection, Valid, ConnectedPieceId, ConnectedPieceTypePortId, ConnectingPieceId, ConnectingPieceTypePortId, Rotation, Tilt, Gap, Shift

concat_31 = Concatenate(FragmentA=split_level, FragmentB="2")
concat_32 = Concatenate(FragmentA=door, FragmentB="1")
concat_33 = Concatenate(FragmentA=concat_31, FragmentC="_", FragmentB=concat_32)
concat_34 = Concatenate(FragmentF="cs", FragmentA="_", FragmentD=concat_33, FragmentB="_", FragmentC=concat_2)
pce_13 = ModelPiece(Id=concat_34, TypeName="Capsule", TypeVariant=capsulevarianteastright)  # -> Piece, Valid, Id, TypeName, TypeVariant, Plane, ScreenPoint
con_9 = ModelConnection(
    ConnectedPieceId=pce_5.Id,
    ConnectedPieceTypePortId=concat_33,
    ConnectingPieceId=pce_13.Id,
    Rotation=capsulerotation_2,
    Tilt=capsuletilt_2,
    Gap=capsulegap_2,
    Shift=capsuleshift_2)  # -> Connection, Valid, ConnectedPieceId, ConnectedPieceTypePortId, ConnectingPieceId, ConnectingPieceTypePortId, Rotation, Tilt, Gap, Shift

merge_4 = Merge(
    Data1=pce_6.Piece,
    Data2=pce_7.Piece,
    Data3=pce_8.Piece,
    Data4=pce_9.Piece,
    Data5=pce_10.Piece,
    Data6=pce_11.Piece,
    Data7=pce_12.Piece,
    Data8=pce_13.Piece)
merge_5 = Merge(
    Data1=con.Connection,
    Data2=con_2.Connection,
    Data3=con_3.Connection,
    Data4=con_4.Connection,
    Data5=con_5.Connection,
    Data6=con_6.Connection,
    Data7=con_8.Connection,
    Data8=con_9.Connection)
capsule_pc = Piece(merge_4)
caspule_co = Connection(merge_5)
merge_6 = Merge(Data1=tambour_co, Data2=caspule_co)
merge_7 = Merge(Data1=tambour_pc, Data2=capsule_pc)
co = Connection(merge_6)
pc = Piece(merge_7)
capsule_pc_2 = ClusterOutput(capsule_pc)
caspule_co_2 = ClusterOutput(caspule_co)
pc_2 = ClusterOutput(pc)
co_2 = ClusterOutput(co)
item_17 = ListItem(List=tambour_pc, Index=0, Wrap=True)  # -> Item1, Item
pce_14 = ModelPiece(Piece=item_17.Item)  # -> Piece, Valid, Id, TypeName, TypeVariant, Plane, ScreenPoint
pce_15 = ModelPiece(Piece=item_17.Item1)  # -> Piece, Valid, Id, TypeName, TypeVariant, Plane, ScreenPoint
first_tambour_id = Text(pce_14.Id)
first_tambour_id_2 = ClusterOutput(first_tambour_id)
last_tambour_id = Text(pce_15.Id)
last_tambour_id_2 = ClusterOutput(last_tambour_id)

# ==== cluster ShowDesign: Show a design by flattening it and selecting only representations with the same mime, lod and tags.
ty = ClusterInput()
dn = ClusterInput()
mm = ClusterInput()
lod = ClusterInput()
tags = ClusterInput()
ty_2 = Type(ty)
mm_2 = Mime(mm)
tags_2 = Tags(tags)
dn_2 = Design(dn)
lod_2 = Lod(lod)
fltdsn = FlattenDesign(Design=dn_2, Type=ty_2)
typ = ModelType(Type=ty_2)  # -> Type, Valid, Name, Description, Icon, Variant, Unit, Representations, Ports, Qualities
dsn = ModelDesign(Design=fltdsn)  # -> Design, Valid, Name, Description, Icon, Variant, Unit, Pieces, Connections, Qualities
tstat = TreeStatistics(Tree=typ.Representations)  # -> Paths, Length, Count
trim = TrimTree(Tree=dsn.Pieces, Depth=1)
pce = ModelPiece(Piece=trim)  # -> Piece, Valid, Id, TypeName, TypeVariant, Plane, ScreenPoint
lng = ListLength(List=ty_2)
expression = Expression(x=graft(pce.TypeName), y=typ.Name, Expression="x=y")
expression_2 = Expression(x=graft(pce.TypeVariant), y=typ.Variant, Expression="x=y")
series = Series(Start=0, Step=1, Count=lng)
and = GateAnd(A=expression, B=expression_2)
trim_2 = TrimTree(Tree=series, Depth=1)
cull = CullPattern(List=ty_2, CullPattern=and)
txt = Text(cull)
txt_2 = Text(ty_2)
expression_3 = Expression(x=txt, y=txt_2, Expression="x=y")
cull_2 = CullPattern(List=trim_2, CullPattern=expression_3)
trim_3 = TrimTree(Tree=cull_2, Depth=1)
item = ListItem(List=tstat.Paths, Index=trim_3, Wrap=True)
branch = TreeBranch(Tree=typ.Representations, Path=item, MaintainPaths=False)
mrg_p = MergeSeperatlyPrepend(x=branch)  # -> Mrgd; inputs x: tree
# ---------- mrg_p: Python ----------
if ghenv.Component.RunCount<2:
    __author__ = "Ueli Saluz"
    __version__ = "2020.05.28"
    
    ghenv.Component.Name = "MergeSeperatly(Prepend)"
    ghenv.Component.NickName = "Mrg(P)"
    ghenv.Component.Description = "Merge inputs seperatly on a new path. Prepend index of input parameter for distincting."
    ghenv.Component.Message = "VER 1.0"

from System import Object
from Grasshopper import DataTree
from Grasshopper.Kernel import GH_ParamAccess as Access

if __name__ == "__main__":
    Mrgd = DataTree[Object]()
    access = Access()
    
    for input in ghenv.Component.Params.Input:  #set all Inputaccess to Tree Access
        input.Access = access.tree
    
    for i,input in enumerate(ghenv.Component.Params.Input):
        for j,source in enumerate(input.Sources):
            for path in source.VolatileData.Paths:
                Mrgd.AddRange(source.VolatileData[path],path.PrependElement(i))
# ---------- end mrg_p ----------
rep = ModelRepresentation(Representation=mrg_p)  # -> Representation, Valid, Url, Mime, Lod, Tags
expression_4 = Expression(x=rep.Mime, y=mm_2, Expression="x=y")
cull_3 = CullPattern(List=rep.Representation, CullPattern=expression_4)
rep_2 = ModelRepresentation(Representation=cull_3)  # -> Representation, Valid, Url, Mime, Lod, Tags
expression_5 = Expression(x=rep_2.Lod, y=lod_2, Expression="x=y")
cull_4 = CullPattern(List=rep_2.Representation, CullPattern=expression_5)
trim_4 = TrimTree(Tree=cull_4, Depth=1)
rep_3 = ModelRepresentation(Representation=trim_4)  # -> Representation, Valid, Url, Mime, Lod, Tags
ur = Url(rep_3.Url)
pln = Plane(pce.Plane)
ur_2 = ClusterOutput(ur)
pln_2 = ClusterOutput(pln)

# ==== cluster AddBridges
dn = ClusterInput()
levels = ClusterInput()
bridge_rotation = ClusterInput()
bridge_tilt = ClusterInput()
bridge_gap = ClusterInput()
bridge_shift = ClusterInput()
dn_2 = Design(dn)
levels_2 = Integer(levels)
bridge_rotation_2 = Number(bridge_rotation)
bridge_tilt_2 = Number(bridge_tilt)
bridge_gap_2 = Number(bridge_gap)
bridge_shift_2 = Number(bridge_shift)
expression = Expression(x=levels_2, Expression="x-1")
concat = Concatenate(
    FragmentA="cs_",
    FragmentD="sl",
    FragmentH="0",
    FragmentI="_d",
    FragmentJ="1",
    FragmentB="_t_f",
    FragmentC=expression,
    FragmentE="_b_c",
    FragmentF="1")
concat_2 = Concatenate(
    FragmentA="cs_",
    FragmentD="sl",
    FragmentH="0",
    FragmentI="_d",
    FragmentJ="2",
    FragmentB="_t_f",
    FragmentC=expression,
    FragmentE="_b_c",
    FragmentF="0")
merge = Merge(Data1=concat_2, Data2=concat)
rmvpces = RemovePieces(dn=dn_2, ids=merge)  # -> dn_4, pc_2, co_2
dsn = ModelDesign(Design=rmvpces.dn_4)  # -> Design, Valid, Name, Description, Icon, Variant, Unit, Pieces, Connections, Qualities
lng = ListLength(List=levels_2)
split = SplitList(List=rmvpces.pc_2, Index=lng)  # -> ListA, ListB
split_2 = SplitList(List=rmvpces.co_2, Index=lng)  # -> ListA, ListB
trim = TrimTree(Tree=dsn.Pieces, Depth=1)
trim_2 = TrimTree(Tree=dsn.Connections, Depth=1)
concat_3 = Concatenate(
    FragmentA="br_",
    FragmentD="sl",
    FragmentH="0",
    FragmentI="_d",
    FragmentJ="2",
    FragmentB="_t_f",
    FragmentC=expression,
    FragmentE="_b_c",
    FragmentF="0")
trim_3 = TrimTree(Tree=split.ListA, Depth=1)
trim_4 = TrimTree(Tree=split_2.ListA, Depth=1)
pce = ModelPiece(Piece=trim_3, Id=concat_3, TypeName="Bridge")  # -> Piece, Valid, Id, TypeName, TypeVariant, Plane, ScreenPoint
con = ModelConnection(
    Connection=trim_4,
    ConnectingPieceId=pce.Id,
    ConnectingPieceTypePortId="e",
    Rotation=bridge_rotation_2,
    Tilt=bridge_tilt_2,
    Offset=bridge_gap_2,
    Shift=bridge_shift_2)  # -> Connection, Valid, ConnectedPieceId, ConnectedPieceTypePortId, ConnectingPieceId, ConnectingPieceTypePortId, Rotation, Tilt, Offset, Shift
merge_2 = Merge(Data1=trim_2, Data2=con.Connection)
merge_3 = Merge(Data1=trim, Data2=pce.Piece)
dsn_2 = ModelDesign(Design=dsn.Design, Pieces=merge_3, Connections=merge_2)  # -> Design, Valid, Name, Description, Icon, Variant, Unit, Pieces, Connections, Qualities
dn_3 = Design(dsn_2.Design)
dn_4 = ClusterOutput(dn_3)

# ==== cluster PerformanceAssessment
dn = ClusterInput()
ty = ClusterInput()
heating_energy_price_cent_kwh = ClusterInput()
heating_efficiency_factor = ClusterInput()
heating_global_warming_potential_kgco2e = ClusterInput()  # "Heating Global Warming Potential [kgCO2e/kWh]"
cooling_energy_price_cent_kwh = ClusterInput()
cooling_efficiency_factor = ClusterInput()
cooling_global_warming_potential_kgco2e = ClusterInput()  # "Cooling Global Warming Potential [kgCO2e/kWh]"
electrictiy_energy_price_cent_kwh = ClusterInput()
electrictiy_global_warming_potential_kgc = ClusterInput()  # "Electrictiy Global Warming Potential [kgCO2e/kWh]"
dn_2 = Design(dn)
heating_energy_price_cent_kwh_2 = Number(heating_energy_price_cent_kwh)
heating_efficiency_factor_2 = Number(heating_efficiency_factor)
heating_global_warming_potential_kgco2e_2 = Number(heating_global_warming_potential_kgco2e)  # "Heating Global Warming Potential [kgCO2e/kWh]"
cooling_energy_price_cent_kwh_2 = Number(cooling_energy_price_cent_kwh)
cooling_efficiency_factor_2 = Number(cooling_efficiency_factor)
cooling_global_warming_potential_kgco2e_2 = Number(cooling_global_warming_potential_kgco2e)  # "Cooling Global Warming Potential [kgCO2e/kWh]"
electrictiy_energy_price_cent_kwh_2 = Number(electrictiy_energy_price_cent_kwh)
electrictiy_global_warming_potential_kgc_2 = Number(electrictiy_global_warming_potential_kgc)  # "Electrictiy Global Warming Potential [kgCO2e/kWh]"
ty_2 = Type(ty)
sumqal = SumQualities(dn=dn_2, ty=ty_2, na="cooling energy demand")  # -> num_2, ql_2
sumqal_2 = SumQualities(dn=dn_2, ty=ty_2, na="technical equipment energy demand")  # -> num_2, ql_2
sumqal_3 = SumQualities(dn=dn_2, ty=ty_2, na="maintenance expenses")  # -> num_2, ql_2
sumqal_4 = SumQualities(dn=dn_2, ty=ty_2, na="heating energy demand")  # -> num_2, ql_2
sumqal_5 = SumQualities(dn=dn_2, ty=ty_2, na="income")  # -> num_2, ql_2
sumqal_6 = SumQualities(dn=dn_2, ty=ty_2, na="effective floor area")  # -> num_2, ql_2
sumqal_7 = SumQualities(dn=dn_2, ty=ty_2, na="construction cost")  # -> num_2, ql_2
expression = Expression(x=sumqal_4.num_2, y=heating_efficiency_factor_2, Expression="x*(1/y)")
expression_2 = Expression(x=sumqal.num_2, y=cooling_efficiency_factor_2, Expression="x*(1/y)")
addition = Addition(A=expression, B=expression_2, C=sumqal_2.num_2)
multiplication = Multiplication(A=heating_energy_price_cent_kwh_2, B=expression)
multiplication_2 = Multiplication(A=heating_global_warming_potential_kgco2e_2, B=expression)
multiplication_3 = Multiplication(A=cooling_energy_price_cent_kwh_2, B=expression_2)
multiplication_4 = Multiplication(A=cooling_global_warming_potential_kgco2e_2, B=expression_2)
multiplication_5 = Multiplication(A=sumqal_2.num_2, B=electrictiy_energy_price_cent_kwh_2)
multiplication_6 = Multiplication(A=electrictiy_global_warming_potential_kgc_2, B=electrictiy_global_warming_potential_kgc_2)
sumqal_8 = SumQualities(dn=dn_2, ty=ty_2, na="construction global warming potential")  # -> num_2, ql_2
division = Division(A=addition, B=sumqal_6.num_2)
addition_2 = Addition(A=multiplication, B=multiplication_3, C=multiplication_5)
addition_3 = Addition(A=multiplication_2, B=multiplication_4, C=multiplication_6)
division_2 = Division(A=addition_3, B=sumqal_6.num_2)
addition_4 = Addition(A=sumqal_3.num_2, B=addition_2)
subtraction = Subtraction(A=sumqal_5.num_2, B=addition_4)
panel = Panel("""https://identifier.buildingsmart.org/uri/buildingsmart/ifc/4.3/prop/NetFloorArea
https://identifier.buildingsmart.org/uri/etim/etim/9.0/prop/EF016979
construction cost
return
https://identifier.buildingsmart.org/uri/etim/etim/9.0/prop/EF016979
operational cost
https://identifier.buildingsmart.org/uri/etim/etim/9.0/prop/EF016979
income
maintenance expenses
https://identifier.buildingsmart.org/uri/buildingsmart/ifc/4.3/prop/EnergyConsumption
operational energy cost
https://identifier.buildingsmart.org/uri/buildingsmart/ifc/4.3/prop/EnergyConsumption
https://identifier.buildingsmart.org/uri/buildingsmart/ifc/4.3/prop/EnergyConsumption
https://identifier.buildingsmart.org/uri/buildingsmart/ifc/4.3/prop/EnergyConsumption""")
panel_2 = Panel("""effective floor area
specific operational global warming potential
construction cost
return
construction global warming potential
operational cost
operational global warming potential
income
maintenance expenses
specific energy demand
operational energy cost
heating energy demand
cooling energy demand
technical equipment energy demand""")
effective_floor_area_m² = Number(sumqal_6.num_2)
specific_operational_global_warming_pote = Number(division_2)  # "Specific Operational Global Warming Potential [kgCO2e/m²a]"
construction_cost = Number(sumqal_7.num_2)
return_a = Number(subtraction)
operational_cost_a = Number(addition_4)
maintenance_expenses_a = Number(sumqal_3.num_2)
specific_energy_demand_kwh_m²a = Number(division)
operational_energy_cost_a = Number(addition_2)
cooling_energy_demand_kwh_a = Number(sumqal.num_2)
construction_global_warming_potential_kg = Number(sumqal_8.num_2)  # "Construction Global Warming Potential [kgCO2e]"
operational_global_warming_potential_kgc = Number(addition_3)  # "Operational Global Warming Potential [kgCO2e/a]"
income = Number(sumqal_5.num_2)
heating_energy_demand_kwh_a = Number(sumqal_4.num_2)
technical_equipment_energy_demand_kwh_a = Number(sumqal_2.num_2)
merge = Merge(
    Data1=effective_floor_area_m²,
    Data2=specific_operational_global_warming_pote,
    Data3=construction_cost,
    Data4=return_a,
    Data5=construction_global_warming_potential_kg,
    Data6=operational_cost_a,
    Data7=operational_global_warming_potential_kgc,
    Data8=income,
    Data9=maintenance_expenses_a,
    Data10=specific_energy_demand_kwh_m²a,
    Data11=operational_energy_cost_a,
    Data12=heating_energy_demand_kwh_a,
    Data13=cooling_energy_demand_kwh_a,
    Data14=technical_equipment_energy_demand_kwh_a)
panel_3 = Panel("""m²
kgCO2e/m²a
€
€/a
kgCO2e
€/a
kgCO2e/a
€
€/a
kWh/m²a
€/a
kWh/a
kWh/a
kWh/a""")
dsn = ModelDesign(Design=dn_2)  # -> Design, Valid, Name, Description, Icon, Variant, Unit, Pieces, Connections, Qualities
trim = TrimTree(Tree=dsn.Qualities, Depth=1)
qal = ModelQuality(Name=panel_2, Value=merge, Unit=panel_3, Definition=panel)  # -> Quality, Valid, Name, Value, Unit, Definition
merge_2 = Merge(Data1=trim, Data2=qal.Quality)
dsn_2 = ModelDesign(Design=dsn.Design, Qualities=merge_2)  # -> Design, Valid, Name, Description, Icon, Variant, Unit, Pieces, Connections, Qualities
dn_3 = Design(dsn_2.Design)
effective_floor_area_m²_2 = ClusterOutput(effective_floor_area_m²)
specific_operational_global_warming_pote_2 = ClusterOutput(specific_operational_global_warming_pote)  # "Specific Operational Global Warming Potential [kgCO2e/m²a]"
construction_cost_2 = ClusterOutput(construction_cost)
return_a_2 = ClusterOutput(return_a)
construction_global_warming_potential_kg_2 = ClusterOutput(construction_global_warming_potential_kg)  # "Construction Global Warming Potential [kgCO2e]"
operational_cost_a_2 = ClusterOutput(operational_cost_a)
operational_global_warming_potential_kgc_2 = ClusterOutput(operational_global_warming_potential_kgc)  # "Operational Global Warming Potential [kgCO2e/a]"
income_2 = ClusterOutput(income)
maintenance_expenses_a_2 = ClusterOutput(maintenance_expenses_a)
specific_energy_demand_kwh_m²a_2 = ClusterOutput(specific_energy_demand_kwh_m²a)
operational_energy_cost_a_2 = ClusterOutput(operational_energy_cost_a)
heating_energy_demand_kwh_a_2 = ClusterOutput(heating_energy_demand_kwh_a)
cooling_energy_demand_kwh_a_2 = ClusterOutput(cooling_energy_demand_kwh_a)
technical_equipment_energy_demand_kwh_a_2 = ClusterOutput(technical_equipment_energy_demand_kwh_a)
dn_4 = ClusterOutput(dn_3)

# ==== cluster ReplaceType: Replace a type (name) in a design. All variants stay the same and must exist in the new type.
new_na = ClusterInput()
dn = ClusterInput()
old_na = ClusterInput()
new_na_2 = Text(new_na)
dn_2 = Design(dn)
old_na_2 = Text(old_na)
dsn = ModelDesign(Design=dn_2)  # -> Design, Valid, Name, Description, Icon, Variant, Unit, Pieces, Connections, Qualities
trim = TrimTree(Tree=dsn.Pieces, Depth=1)
lng = ListLength(List=trim)
pce = ModelPiece(Piece=trim)  # -> Piece, Valid, Id, TypeName, TypeVariant, Plane, ScreenPoint
series = Series(Start=0, Step=1, Count=lng)
trim_2 = TrimTree(Tree=series, Depth=1)
expression = Expression(x=pce.TypeName, y=old_na_2, Expression="x=y")
dispatch = Dispatch(List=pce.Piece, DispatchPattern=expression)  # -> ListA, ListB
dispatch_2 = Dispatch(List=trim_2, DispatchPattern=expression)  # -> ListA, ListB
pce_2 = ModelPiece(Piece=dispatch.ListA, TypeName=new_na_2)  # -> Piece, Valid, Id, TypeName, TypeVariant, Plane, ScreenPoint
replace = ReplaceItems(List=trim, Item=pce_2.Piece, Indices=dispatch_2.ListA, Wrap=False)
trim_3 = TrimTree(Tree=replace, Depth=1)
dsn_2 = ModelDesign(Design=dsn.Design, Pieces=trim_3)  # -> Design, Valid, Name, Description, Icon, Variant, Unit, Pieces, Connections, Qualities
dn_3 = Design(dsn_2.Design)
dn_4 = ClusterOutput(dn_3)

# ==== cluster VaryTypes: Change a variant (name) from one type to another variant of the same type for all pieces of a design.
dn = ClusterInput()
na = ClusterInput()
old_vn = ClusterInput()
new_vn = ClusterInput()
dn_2 = Design(dn)
na_2 = TypeName(na)
old_vn_2 = TypeVariant(old_vn)
new_vn_2 = TypeVariant(new_vn)
dsn = ModelDesign(Design=dn_2)  # -> Design, Valid, Name, Description, Icon, Variant, Unit, Pieces, Connections, Qualities
trim = TrimTree(Tree=dsn.Pieces, Depth=1)
pce = ModelPiece(Piece=trim)  # -> Piece, Valid, Id, TypeName, TypeVariant, Plane, ScreenPoint
lng = ListLength(List=trim)
series = Series(Start=0, Step=1, Count=lng)
expression = Expression(x=pce.TypeVariant, y=old_vn_2, Expression="x=y")
expression_2 = Expression(x=pce.TypeName, y=na_2, Expression="x=y")
trim_2 = TrimTree(Tree=series, Depth=1)
and = GateAnd(A=expression_2, B=expression)
dispatch = Dispatch(List=trim_2, DispatchPattern=and)  # -> ListA, ListB
dispatch_2 = Dispatch(List=pce.Piece, DispatchPattern=and)  # -> ListA, ListB
pce_2 = ModelPiece(Piece=dispatch_2.ListA, TypeVariant=new_vn_2)  # -> Piece, Valid, Id, TypeName, TypeVariant, Plane, ScreenPoint
replace = ReplaceItems(List=trim, Item=pce_2.Piece, Indices=dispatch.ListA, Wrap=False)
trim_3 = TrimTree(Tree=replace, Depth=1)
dsn_2 = ModelDesign(Design=dsn.Design, Pieces=trim_3)  # -> Design, Valid, Name, Description, Icon, Variant, Unit, Pieces, Connections, Qualities
dn_3 = Design(dsn_2.Design)
dn_4 = ClusterOutput(dn_3)

# ==== cluster RemovePieces: Remove all pieces (and all associated connections) from a design.
dn = ClusterInput()
ids = ClusterInput()
dn_2 = Design(dn)
ids_2 = Text(ids)
dsn = ModelDesign(Design=dn_2)  # -> Design, Valid, Name, Description, Icon, Variant, Unit, Pieces, Connections, Qualities

trim = TrimTree(Tree=dsn.Connections, Depth=1)
con = ModelConnection(Connection=trim)  # -> Connection, Valid, ConnectedPieceId, ConnectedPieceTypePortId, ConnectingPieceId, ConnectingPieceTypePortId, Rotation, Tilt, Offset, Shift
expression = Expression(x=graft(con.ConnectingPieceId), y=ids_2, Expression="x=y")
expression_2 = Expression(x=graft(con.ConnectedPieceId), y=ids_2, Expression="x=y")
ma = MassAddition(Input=expression)  # -> Result, PartialResults
ma_2 = MassAddition(Input=expression_2)  # -> Result, PartialResults
or = GateOr(A=ma_2.Result, B=ma.Result)
trim_2 = TrimTree(Tree=or, Depth=1)
dispatch = Dispatch(List=trim, DispatchPattern=trim_2)  # -> ListA, ListB

trim_3 = TrimTree(Tree=dsn.Pieces, Depth=1)
pce = ModelPiece(Piece=trim_3)  # -> Piece, Valid, Id, TypeName, TypeVariant, Plane, ScreenPoint
expression_3 = Expression(x=graft(pce.Id), y=ids_2, Expression="x=y")
ma_3 = MassAddition(Input=expression_3)  # -> Result, PartialResults
trim_4 = TrimTree(Tree=ma_3.Result, Depth=1)
dispatch_2 = Dispatch(List=trim_3, DispatchPattern=trim_4)  # -> ListA, ListB

dsn_2 = ModelDesign(Design=dsn.Design, Pieces=dispatch_2.ListB, Connections=dispatch.ListB)  # -> Design, Valid, Name, Description, Icon, Variant, Unit, Pieces, Connections, Qualities
dn_3 = Design(dsn_2.Design)
pc = Piece(dispatch_2.ListA)
co = Connection(dispatch.ListA)
dn_4 = ClusterOutput(dn_3)
pc_2 = ClusterOutput(pc)
co_2 = ClusterOutput(co)

# ==== cluster SumQualities: Sum up the qualities of a type for each piece with this type in a design.
dn = ClusterInput()
ty = ClusterInput()
na = ClusterInput()
ty_2 = Type(ty)
dn_2 = Design(dn)
na_2 = Name(na)
typ = ModelType(Type=ty_2)  # -> Type, Valid, Name, Description, Icon, Variant, Unit, Representations, Ports, Qualities
dsn = ModelDesign(Design=dn_2)  # -> Design, Valid, Name, Description, Icon, Variant, Unit, Pieces, Connections, Qualities
lng = ListLength(List=ty_2)
series = Series(Start=0, Step=1, Count=lng)
trim = TrimTree(Tree=dsn.Pieces, Depth=1)
qal = ModelQuality(Quality=typ.Qualities)  # -> Quality, Valid, Name, Value, Unit, Definition
trim_2 = TrimTree(Tree=series, Depth=1)
pce = ModelPiece(Piece=trim)  # -> Piece, Valid, Id, TypeName, TypeVariant, Plane, ScreenPoint
expression = Expression(x=na_2, y=qal.Name, Expression="x=y")
expression_2 = Expression(x=graft(pce.TypeVariant), y=typ.Variant, Expression="x=y")
expression_3 = Expression(x=graft(pce.TypeName), y=typ.Name, Expression="x=y")
cull = CullPattern(List=typ.Qualities, CullPattern=expression)
qal_2 = ModelQuality(Quality=cull)  # -> Quality, Valid, Name, flatten(Value), Unit, Definition
and = GateAnd(A=expression_3, B=expression_2)
cull_2 = CullPattern(List=ty_2, CullPattern=and)
txt = Text(ty_2)
txt_2 = Text(cull_2)
expression_4 = Expression(x=txt_2, y=txt, Expression="x=y")
ql = Quality(qal_2.Quality)
cull_3 = CullPattern(List=trim_2, CullPattern=expression_4)
ql_2 = ClusterOutput(ql)
trim_3 = TrimTree(Tree=cull_3, Depth=1)
item = ListItem(List=qal_2.Value, Index=trim_3, Wrap=True)
clean = CleanTree(RemoveNulls=True, RemoveInvalid=True, RemoveEmpty=False, Tree=item)
ma = MassAddition(Input=clean)  # -> Result, PartialResults
num = Number(ma.Result)
num_2 = ClusterOutput(num)
