# Grasshopper definition bouleenewtoncapsule.gh (Grasshopper 1.0.7)
# plug-ins: Semio, MetaHopper, LunchBox

# Parameters:
number_slider = Slider(420, range=0..1000)
# Outputs ->
number_slider_2 = Slider(0.5, range=0..1)
list = ValueList({"Round", "Rectangular"}, selected="Round")
list_2 = ValueList({"Front", "Side"}, selected="Side")
list_3 = ValueList({"Back", "Side"}, selected="Back")
pt = ConstructPoint(XCoordinate=0, YCoordinate=0, ZCoordinate=Slider(300, range=0..1000))
pt_2 = ConstructPoint(
    XCoordinate=Slider(84, range=-1000..1000),
    YCoordinate=Slider(51, range=-1000..1000),
    ZCoordinate=Slider(125, range=-1000..1000))
panel = Panel("Bottom")
panel_2 = Panel("Door")
panel_3 = Panel(" ")
panel_4 = Panel("Top")
debug = BooleanToggle(True)
windowshape = GetString(list, AtLeast=0, AtMost=1, TreeAccess=False)
mirror = GetBoolean(Toggle(False), AtLeast=0, AtMost=1, FalseValue="False", TreeAccess=False, TrueValue="True")
# External
#      |
#      v
length = GetNumber(number_slider, AtLeast=1, AtMost=1, Maximum=1.797693135e+308, Minimum=-1.797693135e+308, TreeAccess=False)
width = GetNumber(Slider(270, range=0..1000), AtLeast=1, AtMost=1, Maximum=1.797693135e+308, Minimum=-1.797693135e+308, TreeAccess=False)
subtraction = Subtraction(A=length, B=width)
expression = Expression(x=subtraction, Expression="x/2")
height = GetNumber(Slider(250, range=0..1000), AtLeast=1, AtMost=1, Maximum=1.797693135e+308, Minimum=-1.797693135e+308, TreeAccess=False)
entrance = GetString(list_3, AtLeast=0, AtMost=1, TreeAccess=False)
window = GetString(list_2, AtLeast=0, AtMost=1, TreeAccess=False)
shellthickness = GetNumber(Slider(20, range=0..100), AtLeast=0, AtMost=1, Maximum=1.797693135e+308, Minimum=-1.797693135e+308, TreeAccess=False)
sightprotection = GetBoolean(Toggle(False), AtLeast=0, AtMost=1, FalseValue="False", TreeAccess=False, TrueValue="True")
connection_ports = GetString("Side", AtLeast=0, AtMost=1, TreeAccess=False)
connection_point = GetPoint(AtLeast=0, AtMost=1, Realtime=True, TreeAccess=False)
connection_bias_gap = GetNumber(Slider(5, range=0..100), AtLeast=0, AtMost=1, Maximum=1.797693135e+308, Minimum=-1.797693135e+308, TreeAccess=False)
connection_bias_corner = GetBoolean(Toggle(False), AtLeast=0, AtMost=1, FalseValue="False", TreeAccess=False, TrueValue="True")
connection_bias_centroid = GetBoolean(Toggle(True), AtLeast=0, AtMost=1, FalseValue="False", TreeAccess=False, TrueValue="True")
connection_bias_u = GetNumber(Slider(0.5, range=0..1), AtLeast=1, AtMost=1, Maximum=1.797693135e+308, Minimum=-1.797693135e+308, TreeAccess=False)
connection_bias_v = GetNumber(number_slider_2, AtLeast=1, AtMost=1, Maximum=1.797693135e+308, Minimum=-1.797693135e+308, TreeAccess=False)
neg = Negative(Value=expression)
Y = UnitY(Factor=neg)
swatch = ColourSwatch(SwatchColor=RGB(191, 216, 255))
swatch_2 = ColourSwatch(SwatchColor=RGB(0, 0, 0))
hideshow = HideShowObjectPreview(Visible=debug, AllObjects_Object=[door, window_3, capsule, pt_4])
hideshow_2 = HideShowObjectPreview(Visible=invert(debug), AllObjects_Object=[geo_3, connection_point_2])
swatch_3 = ColourSwatch(SwatchColor=RGB(75, 85, 100))
swatch_4 = ColourSwatch(SwatchColor=RGB(37, 42, 50))
panel_5 = Panel("""Front
Side""")
panel_6 = Panel("""Back
Side""")
panel_7 = Panel("""Round
Rectangular""")
subtraction_2 = Subtraction(A=height, B=shellthickness)
neg_2 = Negative(Value=shellthickness)
# Local ->
_2d = _2D(x=length)
_2d_2 = _2D(x=width)
pt_3 = ConstructPoint(XCoordinate=connection_bias_u, YCoordinate=connection_bias_v, ZCoordinate=0)
dom = ConstructDomain(DomainStart=neg_2, DomainEnd=subtraction_2)
# Use quadratic box, to enable stacking despite different entrances
box = DomainBox(Base=PlaneXY(0, 0, 0), X=_2d_2, Y=_2d_2, Z=dom)
move = Move(Geometry=box, Motion=Y)  # -> Geometry, Transform
itemindex = ItemIndex(L=panel_6, I=entrance)  # -> i; inputs L: list
# ---------- itemindex: Python ----------
#Component Information
#--------------------------------------------------------------------------------------------
if ghenv.Component.RunCount<2:
    #General
    #--------------------------------------------------------------------------------------------
    __author__ = "Ueli Saluz"
    __version__ = "2022.11.18"
    
    ghenv.Component.Name = "ItemIndex"
    ghenv.Component.NickName = "ItemIndex"
    ghenv.Component.Description = "A better IdemIndex"
    ghenv.Component.Message = "VER 1.0"
    ghenv.Component.Category = "Set"
    ghenv.Component.SubCategory = "List"
    
     #Inputs
    #--------------------------------------------------------------------------------------------
    inputIndex=0
    
    ghenv.Component.Params.Input[inputIndex].Name = "List"
    ghenv.Component.Params.Input[inputIndex].NickName = "L"
    ghenv.Component.Params.Input[inputIndex].Description = "Input1 is..."
    ghenv.Component.Params.Input[inputIndex].Optional = False
    inputIndex+=1
    
    ghenv.Component.Params.Input[inputIndex].Name = "Item"
    ghenv.Component.Params.Input[inputIndex].NickName = "I"
    ghenv.Component.Params.Input[inputIndex].Description = "Input2 is..."
    ghenv.Component.Params.Input[inputIndex].Optional = False
    inputIndex+=1
    
    #Outputs
    #--------------------------------------------------------------------------------------------
    outputIndex=0
    
    ghenv.Component.Params.Output[outputIndex].Name = "Index"
    ghenv.Component.Params.Output[outputIndex].NickName = "i"
    ghenv.Component.Params.Output[outputIndex].Description = "Output1 is..."
    outputIndex+=1

i = L.index(I)
# ---------- end itemindex ----------
itemindex_2 = ItemIndex(L=panel_5, I=window)  # -> i; inputs L: list; same code as itemindex
swatch_5 = ColourSwatch(SwatchColor=RGB(0, 166, 157))
swatch_6 = ColourSwatch(SwatchColor=RGB(240, 117, 24))
swatch_7 = ColourSwatch(SwatchColor=RGB(235, 52, 79))
itemindex_3 = ItemIndex(L=panel_7, I=windowshape)  # -> i; inputs L: list; same code as itemindex
offsetbox = ExtendBox(box=move.Geometry, length=connection_bias_gap)
contains = Contains(L=connection_ports, I="Door")  # -> R; inputs L: list, I: list
# ---------- contains: Python ----------
#Component Information
#--------------------------------------------------------------------------------------------
if ghenv.Component.RunCount<2:
    #General
    #--------------------------------------------------------------------------------------------
    __author__ = "Ueli Saluz"
    __version__ = "2023.02.04"
    
    ghenv.Component.Name = "Contains"
    ghenv.Component.NickName = "Contains"
    ghenv.Component.Description = "True if list contains one of the items."
    ghenv.Component.Message = "VER 1.0"
    ghenv.Component.Category = "Set"
    ghenv.Component.SubCategory = "List"
    
     #Inputs
    #--------------------------------------------------------------------------------------------
    inputIndex=0
    
    ghenv.Component.Params.Input[inputIndex].Name = "List"
    ghenv.Component.Params.Input[inputIndex].NickName = "L"
    ghenv.Component.Params.Input[inputIndex].Description = ""
    ghenv.Component.Params.Input[inputIndex].Optional = False
    inputIndex+=1
    
    ghenv.Component.Params.Input[inputIndex].Name = "Items"
    ghenv.Component.Params.Input[inputIndex].NickName = "I"
    ghenv.Component.Params.Input[inputIndex].Description = ""
    ghenv.Component.Params.Input[inputIndex].Optional = False
    inputIndex+=1
    
    #Outputs
    #--------------------------------------------------------------------------------------------
    outputIndex=0
    
    ghenv.Component.Params.Output[outputIndex].Name = "Contains"
    ghenv.Component.Params.Output[outputIndex].NickName = "R"
    ghenv.Component.Params.Output[outputIndex].Description = ""
    outputIndex+=1

R = False
for i in I:
    if i in L:
        R = True
# ---------- end contains ----------
contains_2 = Contains(L=connection_ports, I="Side")  # -> R; inputs L: list, I: list; same code as contains
box_2 = DomainBox(Base=PlaneXY(0, 0, 0), X=_2d_2, Y=_2d, Z=dom)
contains_3 = Contains(L=connection_ports, I="Bottom")  # -> R; inputs L: list, I: list; same code as contains
contains_4 = Contains(L=connection_ports, I="Top")  # -> R; inputs L: list, I: list; same code as contains
valueor0 = ValueOr0(value=itemindex)
valueor0_2 = ValueOr0(value=itemindex_2)
valueor0_3 = ValueOr0(value=itemindex_3)
number_slider_3 = Slider(55, range=0..100)
valueor0_4 = ValueOr0(value=contains)
capsule = Box(box_2)
valueor0_5 = ValueOr0(value=contains_3)
valueor0_6 = ValueOr0(value=contains_2)
valueor0_7 = ValueOr0(value=contains_4)
debrep = DeconstructBrep(Brep=capsule)  # -> Faces, Edges, Vertices
entrance_2 = Integer(valueor0)
window_2 = Integer(valueor0_2)
area = Area(Geometry=move.Geometry)  # -> Area, Centroid
debrep_2 = DeconstructBrep(Brep=offsetbox)  # -> Faces, Edges, Vertices
windowshape_2 = Integer(valueor0_3)
trim = TrimTree(Tree=debrep.Edges, Depth=1)
trim_2 = TrimTree(Tree=debrep.Faces, Depth=1)
trim_3 = TrimTree(Tree=debrep_2.Faces, Depth=1)
neg_3 = Negative(Value=area.Centroid)
windowcircleradius = Number(Slider(65, range=0..100))
window_offset_wall = Number(Slider(30, range=0..100))
item = ListItem(List=trim_2, Index=0, Wrap=True)  # -> Item, Item1, Item2, Item3, Item4, Item5
item_2 = ListItem(List=trim, Index=0, Wrap=True)  # -> Item, Item1, Item2, Item3
move_2 = Move(Geometry=trim_3, Motion=neg_3)  # -> Geometry, Transform
rev = Reverse(Vector=neg_3)
item_3 = ListItem(List=trim_3, Index=0, Wrap=True)  # -> Item, Item1, Item2, Item3, Item4, Item5
flip = FlipCurve(Curve=item_2.Item)  # -> Curve, Flag
flip_2 = FlipCurve(Curve=item_2.Item1)  # -> Curve, Flag
expression_2 = Expression(x=height, Expression="x/2")
mirror_2 = Boolean(mirror)
evalsrf = EvaluateSurface(Surface=reparameterize(item.Item2), Point="0.5,0.5")  # -> Point, Normal, UDirection, VDirection, Frame
filter = StreamFilter(Gate=mirror, Stream0=flip.Curve, Stream1=item_2.Item)
evalsrf_2 = EvaluateSurface(Surface=reparameterize(move_2.Geometry), Point=pt_3)  # -> Point, Normal, UDirection, VDirection, Frame
filter_2 = StreamFilter(Gate=mirror, Stream0=item.Item1, Stream1=item.Item3)
filter_3 = StreamFilter(Gate=mirror_2, Stream0=item_3.Item1, Stream1=item_3.Item3)
filter_4 = StreamFilter(Gate=mirror, Stream0=item_2.Item3, Stream1=flip_2.Curve)
filter_5 = StreamFilter(Gate=mirror_2, Stream0=item_3.Item2, Stream1=item_3.Item)
addition = Addition(A=windowcircleradius, B=window_offset_wall, C=shellthickness)
Z = UnitZ(Factor=expression_2)
entrance_3 = Boolean(entrance_2)
filter_6 = StreamFilter(Gate=mirror, Stream0=item.Item3, Stream1=item.Item1)
filter_7 = StreamFilter(Gate=entrance_2, Stream0=item.Item, Stream1=filter_2)
filter_8 = StreamFilter(Gate=entrance_2, Stream0=filter, Stream1=item_2.Item1)
eval = EvaluateLength(Curve=filter_4, Length=addition, Normalized=False)  # -> Point, Tangent, Parameter
cp = ClosestPoint(Point=connection_point, Cloud=evalsrf_2.Point)  # -> ClosestPoint, CPIndex, Distance
cp_2 = ClosestPoint(Point=connection_point, Cloud=debrep_2.Vertices)  # -> ClosestPoint, CPIndex, Distance
filter_9 = StreamFilter(Gate=entrance_3, Stream0=filter_3, Stream1=filter_5)
move_3 = Move(Geometry=eval.Point, Motion=Z)  # -> Geometry, Transform
filter_10 = StreamFilter(Gate=connection_bias_corner, Stream0=cp.ClosestPoint, Stream1=cp_2.ClosestPoint)
evalsrf_3 = EvaluateSurface(Surface=reparameterize(filter_6), Point=pt_3)  # -> Point, Normal, UDirection, VDirection, Frame
door_offset_wall = Number(Slider(20, range=0..100))
addition_2 = Addition(A=door_offset_wall, B=shellthickness)
eval_2 = EvaluateLength(Curve=filter_8, Length=addition_2, Normalized=False)  # -> Point, Tangent, Parameter
door_width = Number(Slider(80, range=0..100))
door_height = Number(Slider(200, range=0..1000))
srf_cp = SurfaceClosestPoint(Point=eval_2.Point, Surface=filter_7)  # -> Point, UVPoint, Distance
evalsrf_4 = EvaluateSurface(Surface=reparameterize(item_3.Item4), Point=pt_3)  # -> Point, Normal, UDirection, VDirection, Frame
evalsrf_5 = EvaluateSurface(Surface=reparameterize(filter_9), Point=pt_3)  # -> Point, Normal, UDirection, VDirection, Frame
evalsrf_6 = EvaluateSurface(Surface=reparameterize(item_3.Item5), Point=pt_3)  # -> Point, Normal, UDirection, VDirection, Frame
move_4 = Move(Geometry=filter_10, Motion=rev)  # -> Geometry, Transform
evalsrf_7 = EvaluateSurface(Surface=filter_7, Point=srf_cp.UVPoint)  # -> Point, Normal, UDirection, VDirection, Frame
neg_4 = Negative(Value=door_width)
pl_origin = PlaneOrigin(Base=evalsrf_3.Frame, Origin=move_3.Geometry)
filter_11 = StreamFilter(Gate=entrance_2, Stream0=neg_4, Stream1=door_width)
expression_3 = Expression(x=windowcircleradius, Expression="x*2")
filter_12 = StreamFilter(Gate=valueor0_6, Stream0=move_4.Geometry, Stream1=evalsrf_5.Point)
filter_13 = StreamFilter(Gate=window_2, Stream0=evalsrf.Frame, Stream1=pl_origin)
filter_14 = StreamFilter(Gate=mirror, Stream0=filter_11, Stream1=door_width)
and = GateAnd(A=entrance_2, B=mirror)
_2d_3 = _2D(x=expression_3)
filter_15 = StreamFilter(Gate=valueor0_5, Stream0=filter_12, Stream1=evalsrf_4.Point)
box_subd = BoxSubD(box=capsule)
cir = Circle(Plane=filter_13, Radius=windowcircleradius)
filter_16 = StreamFilter(Gate=and, Stream0=filter_14, Stream1=neg_4)
rectangle = Rectangle(Plane=filter_13, XSize=_2d_3, YSize=_2d_3, Radius=0)  # -> Rectangle, Length
deplane = DeconstructPlane(Plane=filter_13)  # -> Origin, XAxis, YAxis, ZAxis
filter_17 = StreamFilter(Gate=valueor0_7, Stream0=filter_15, Stream1=evalsrf_6.Point)
filter_18 = StreamFilter(Gate=windowshape_2, Stream0=cir, Stream1=rectangle.Rectangle)
rev_2 = Reverse(Vector=deplane.ZAxis)
rectangle_2 = Rectangle(Plane=evalsrf_7.Frame, XSize=filter_16, YSize=door_height, Radius=0)  # -> Rectangle, Length
Z_2 = UnitZ(Factor=shellthickness)
brep = Brep(box_subd)
window_3 = Surface(filter_18)
move_5 = Move(Geometry=rectangle_2.Rectangle, Motion=Z_2)  # -> Geometry, Transform
project = Project(Curve=window_3, Brep=brep, Direction=rev_2)
trim_4 = TrimTree(Tree=project, Depth=1)
door = Rectangle(move_5.Geometry)
explode = Explode(Curve=door, Recursive=True)  # -> Segments, Vertices
item_4 = ListItem(List=trim_4, Index=0, Wrap=True)  # -> Item, Item1
xy = XYPlane(Origin=Point(0, 0, 0))
item_5 = ListItem(List=explode.Segments, Index=0, Wrap=True)  # -> Item, Item1, Item2, Item3
filter_19 = StreamFilter(Gate=mirror, Stream0=item_4.Item1, Stream1=item_4.Item)
eval_3 = EvaluateCurve(Curve=reparameterize(item_5.Item), Parameter="0.5")  # -> Point, Tangent, Angle
filter_20 = StreamFilter(Gate=entrance_2, Stream0=item_4.Item1, Stream1=filter_19)
not = GateNot(A=window_2)
vrot = Rotate()
rev_3 = Reverse(Vector=eval_3.Tangent)
Z_3 = UnitZ(Factor=1)
filter_21 = StreamFilter(Gate=window_2, Stream0=filter_20, Stream1=filter_19)
and_2 = GateAnd(A=entrance_2, B=not, C=mirror)
xprod = CrossProduct(VectorA=rev_3, VectorB=Z_3, Unitize=False)  # -> Vector, Length
filter_22 = StreamFilter(Gate=and_2, Stream0=filter_21, Stream1=item_4.Item1)
pl = ConstructPlane(Origin=eval_3.Point, XAxis=eval_3.Tangent, YAxis=xprod.Vector)
patch = PatchSurface(EdgeCurves=filter_22, U=2, V=2, Tolerance=0.001)
doorentranceplane = Plane(pl)
filter_23 = StreamFilter(Gate=valueor0_4, Stream0=filter_17, Stream1=doorentranceplane)
null = NullItem(Item=filter_23)  # -> NullFlags, InvalidFlags, Description
filter_24 = StreamFilter(Gate=null.NullFlags, Stream0=filter_23, Stream1=evalsrf_6.Point)
pt_4 = Point(filter_24)
pl2pl = MoveObjectPlaneToPlane(G=pt_4, S=doorentranceplane, T=xy)  # -> TG; inputs S: Plane, T: Plane
# ---------- pl2pl: Python ----------
#Component Information
#--------------------------------------------------------------------------------------------
if ghenv.Component.RunCount<2:
    #General
    #--------------------------------------------------------------------------------------------
    __author__ = "Ueli Saluz"
    __version__ = "2022.12.10"
    
    ghenv.Component.Name = "MoveObjectPlaneToPlane"
    ghenv.Component.NickName = "Pl2Pl"
    ghenv.Component.Description = "Moves abitrary geometry from a source plane to a target plane."
    ghenv.Component.Message = "VER 1.1"
    ghenv.Component.Category = "Transform"
    ghenv.Component.SubCategory = "Euclidean"
    
     #Inputs
    #--------------------------------------------------------------------------------------------
    inputIndex=0
    
    ghenv.Component.Params.Input[inputIndex].Name = "Geometry"
    ghenv.Component.Params.Input[inputIndex].NickName = "G"
    ghenv.Component.Params.Input[inputIndex].Description = "Geometry to move."
    ghenv.Component.Params.Input[inputIndex].Optional = False
    inputIndex+=1
    
    ghenv.Component.Params.Input[inputIndex].Name = "SourcePlane"
    ghenv.Component.Params.Input[inputIndex].NickName = "S"
    ghenv.Component.Params.Input[inputIndex].Description = "Source plane of object."
    ghenv.Component.Params.Input[inputIndex].Optional = False
    inputIndex+=1
    
    ghenv.Component.Params.Input[inputIndex].Name = "TargetPlane"
    ghenv.Component.Params.Input[inputIndex].NickName = "T"
    ghenv.Component.Params.Input[inputIndex].Description = "Target plane of object."
    ghenv.Component.Params.Input[inputIndex].Optional = False
    inputIndex+=1
    
    #Outputs
    #--------------------------------------------------------------------------------------------
    outputIndex=0
    
    ghenv.Component.Params.Output[outputIndex].Name = "TranslatedGeometry"
    ghenv.Component.Params.Output[outputIndex].NickName = "TG"
    ghenv.Component.Params.Output[outputIndex].Description = "Translated geometry in target plane."
    outputIndex+=1


#Imports
#--------------------------------------------------------------------------------------------
import Rhino.Geometry.Transform as trsf

def MvObjPlnToPln (geo,plnObj,plnDest):
    geo.Transform(trsf.PlaneToPlane(plnObj,plnDest))
    return geo

TG = MvObjPlnToPln(G,S,T)
# ---------- end pl2pl ----------
connection_point_2 = Point(pl2pl)
panel_8 = Panel(connection_point_2)
context_bake = ContextBake(CONNECTIONPOINT=connection_point_2)
evalsrf_8 = EvaluateSurface(Surface=reparameterize(patch), Point="0.5,0.5")  # -> Point, Normal, UDirection, VDirection, Frame
xy_2 = XYPlane(Origin=Point(0, 0, 0))
sec = BrepPlane(Brep=brep, Plane=evalsrf_8.Frame)  # -> Curves, Points
filter_25 = StreamFilter(Gate=entrance_2, Stream0=length, Stream1=width)
trim_5 = TrimTree(Tree=sec.Curves, Depth=1)
expression_4 = Expression(x=filter_25, Expression="x/2")
deplane_2 = DeconstructPlane(Plane=evalsrf_7.Frame)  # -> Origin, XAxis, YAxis, ZAxis
rev_4 = Reverse(Vector=deplane_2.ZAxis)
boundary = BoundarySurfaces(Edges=trim_5)
amp = Amplitude(Vector=rev_4, Amplitude=expression_4)
split = SplitBrep(Brep=brep, Cutter=boundary)
extr = Extrude(Base=door, Direction=amp)
trim_6 = TrimTree(Tree=split, Depth=1)
item_6 = ListItem(List=trim_6, Index=0, Wrap=True)  # -> Item, Item1
capsule_2 = Brep(item_6.Item)
entrance_4 = Box(extr)
window_4 = Surface(item_6.Item1)
window_5 = Surface(window_4)
pl2pl_2 = MoveObjectPlaneToPlane(G=window_5, S=doorentranceplane, T=xy_2)  # -> TG; inputs S: Plane, T: Plane; same code as pl2pl
pl2pl_3 = MoveObjectPlaneToPlane(G=window_5, S=doorentranceplane, T=xy_2)  # -> TG; inputs S: Plane, T: Plane; same code as pl2pl
geo = Geometry(pl2pl_3)
geo_2 = Geometry(pl2pl_2)
serialize = Serialize(Input=geo)
serialize_2 = Serialize(Input=geo_2)
representation = ConstructRepresentation(Body=serialize_2, Concepts="Door")
representation_2 = ConstructRepresentation(Body=serialize, Concepts="Window")
capsule_3 = Brep(item_6.Item)
sdiff = SolidDifference(BrepsA=entrance_4, BrepsB=capsule_3)
door_2 = Brep(sdiff)
entrance_5 = Brep(door_2)
merge = Merge(Data1=capsule_2, Data2=window_5, Data3=entrance_5)
sunion = SolidUnion(Breps=merge)
pl2pl_4 = MoveObjectPlaneToPlane(G=sunion, S=doorentranceplane, T=xy_2)  # -> TG; inputs S: Plane, T: Plane; same code as pl2pl
geo_3 = Geometry(pl2pl_4)
serialize_3 = Serialize(Input=geo_3)
representation_3 = ConstructRepresentation(Body=serialize_3, Concepts="Detailed")
serialize_4 = Serialize(Input=geo_3)
representation_4 = ConstructRepresentation(Body=serialize_4, Concepts="All")
merge_2 = Merge(Data1=representation_4, Data2=representation, Data3=representation_2)
compress = Compress(Input=merge_2)
representations = Text(compress)
context_print = ContextPrint(REPRESENTATIONS=representations)

# ==== cluster _2D
x = ClusterInput()
expression = Expression(x=x, Expression="x/2")
neg = Negative(Value=expression)
dom = ConstructDomain(DomainStart=neg, DomainEnd=expression)
I = ClusterOutput(dom)

# ==== cluster ValueOr0
value = ClusterInput()
value_2 = Number(value)
null = NullItem(Item=value_2)  # -> NullFlags, InvalidFlags, Description
filter = StreamFilter(Gate=null.NullFlags, Stream0=value_2, Stream1="0")
valueor0 = Number(filter)
valueor0_2 = ClusterOutput(valueor0)

# ==== cluster ExtendBox: Extend (or trim) a box by a certain length in a certain dimension
length = ClusterInput()
box = ClusterInput()
length_2 = Number(length)
box_2 = Box(box)
debox = DeconstructBox(Box=box_2)  # -> Plane, X, Y, Z
cluster = D(I=debox.X, length=length_2)
cluster_2 = D(I=debox.Y, length=length_2)
cluster_3 = D(I=debox.Z, length=length_2)
box_3 = DomainBox(Base=debox.Plane, X=cluster, Y=cluster_2, Z=cluster_3)
adjust_box = Box(box_3)
adjust_box_2 = ClusterOutput(adjust_box)

# ==== cluster BoxSubD
box = ClusterInput()
box_2 = Box(box)
mesh = MeshBrep(
    Brep=box_2,
    Settings={GridMaxCount=0, GridMinCount=16, JaggedSeams=False, MaxEdgeLength=0, MinEdgeLength=0.0001, MinTolerance=0, Refine=True, RefineAngle=0, RelativeTolerance=0.65, SimplePlanes=True, Tolerance=0})
subdmesh = SubDFromMesh(Mesh=mesh, Creases=1, Corners=1, Interpolate=Toggle(False))
bbox = BoundingBox(Content=subdmesh, Plane=PlaneXY(0, 0, 0))  # -> Box, Box_2
trim = TrimTree(Tree=bbox.Box, Depth=1)
boxmap = BoxMapping(Geometry=subdmesh, Source=trim, Target=box_2)  # -> Geometry, Transform
subd = SubD(boxmap.Geometry)
subd_2 = ClusterOutput(subd)

# ==== cluster D
length = ClusterInput()
I = ClusterInput()
length_2 = Number(length)
domprop = DomainProperties(I=I, In=True)  # -> L, M, T0, T1; inputs I: tree, In: tree of Boolean
# ---------- domprop: Python ----------
#Component Information
#--------------------------------------------------------------------------------------------
if ghenv.Component.RunCount<2:
    #General
    #--------------------------------------------------------------------------------------------
    __author__ = "Ueli Saluz"
    __version__ = "2021.11.22"
    
    ghenv.Component.Name = "DomainProperties"
    ghenv.Component.NickName = "DomProp"
    ghenv.Component.Description = "Returns some properties of a domain"
    ghenv.Component.Message = "VER 1.0"
    ghenv.Component.Category = "Maths"
    ghenv.Component.SubCategory = "Domain"
    
     #Inputs
    #--------------------------------------------------------------------------------------------
    inputIndex=0
    
    ghenv.Component.Params.Input[inputIndex].Name = "Domain"
    ghenv.Component.Params.Input[inputIndex].NickName = "I"
    ghenv.Component.Params.Input[inputIndex].Description = "Domain to evaluate"
    ghenv.Component.Params.Input[inputIndex].Optional = False
    inputIndex+=1
    
    ghenv.Component.Params.Input[inputIndex].Name = "MakeIncreasing"
    ghenv.Component.Params.Input[inputIndex].NickName = "In"
    ghenv.Component.Params.Input[inputIndex].Description = "Makes sure that the domain is increasing. If not it gets swapped."
    ghenv.Component.Params.Input[inputIndex].Optional = False
    inputIndex+=1
    
    #Outputs
    #--------------------------------------------------------------------------------------------
    outputIndex=0
    
    ghenv.Component.Params.Output[outputIndex].Name = "Length"
    ghenv.Component.Params.Output[outputIndex].NickName = "L"
    ghenv.Component.Params.Output[outputIndex].Description = "Length of the domain"
    outputIndex+=1
    
    ghenv.Component.Params.Output[outputIndex].Name = "Mid"
    ghenv.Component.Params.Output[outputIndex].NickName = "M"
    ghenv.Component.Params.Output[outputIndex].Description = "Middle of the of the domain"
    outputIndex+=1
    
    ghenv.Component.Params.Output[outputIndex].Name = "DomainStartParameter"
    ghenv.Component.Params.Output[outputIndex].NickName = "T0"
    ghenv.Component.Params.Output[outputIndex].Description = "Start parameter. Doens't have to be smaller than the end parameter."
    outputIndex+=1
    
    ghenv.Component.Params.Output[outputIndex].Name = "DomainEndParameter"
    ghenv.Component.Params.Output[outputIndex].NickName = "T1"
    ghenv.Component.Params.Output[outputIndex].Description = "End parameter. Doens't have to be bigger than the start parameter."
    outputIndex+=1
    


#Imports
#--------------------------------------------------------------------------------------------
from System import Object
from Grasshopper import DataTree

#Solver - Run with trees to enhance performance drastically
#--------------------------------------------------------------------------------------------
if __name__ == "__main__":
    
    #Initialize trees
    #--------------------------------------------------------------------------------------------
    LengthTree = DataTree[Object]()
    MidTree = DataTree[Object]()
    DomainStartParameterTree = DataTree[Object]()
    DomainEndParameterTree = DataTree[Object]()
    LengthTree = DataTree[Object]()
    
    #Data matching
    #--------------------------------------------------------------------------------------------
    for path in I.Paths:
        domainBranch = I.Branch(path)
        for i,domain in enumerate(domainBranch):
            if In==True:
                domain.MakeIncreasing()
            LengthTree.Add(domain.Length, path)
            MidTree.Add(domain.Mid, path)
            DomainStartParameterTree.Add(domain.T0, path)
            DomainEndParameterTree.Add(domain.T1, path)
    
     #Assign trees to output
    #--------------------------------------------------------------------------------------------
    L = LengthTree
    M = MidTree
    T0 = DomainStartParameterTree
    T1 = DomainEndParameterTree
# ---------- end domprop ----------
subtraction = Subtraction(A=domprop.T0, B=length_2)
addition = Addition(A=domprop.T1, B=length_2)
dom = ConstructDomain(DomainStart=subtraction, DomainEnd=addition)
I_2 = ClusterOutput(dom)
