# Grasshopper definition homogeneouscapsuletower.gh (Grasshopper 1.0.7)
# plug-ins: Semio, Human, LunchBox, MetaHopper, Pufferfish

panel = Panel("C:\Git\Studium\PhD\semio\examples\capsuletower")
number_slider = Slider(9, range=1..20)
number_slider_2 = Slider(11, range=1..20)
toggle = BooleanToggle(False)
toggle_2 = BooleanToggle(True)
toggle_3 = BooleanToggle(True)
toggle_4 = BooleanToggle(False)
merge = Merge(
    Data1=toggle_2,
    Data2=toggle,
    Data3=toggle,
    Data4=toggle,
    Data5=toggle_2,
    Data6=toggle_2,
    Data7=toggle,
    Data8=toggle_2,
    Data9=toggle,
    Data10=toggle_2)
repeat = RepeatData(Data=Toggle(False), Length=number_slider)
repeat_2 = RepeatData(Data=Toggle(False), Length=number_slider_2)
concat = Concatenate(FragmentA=panel, FragmentB="\", FragmentC="base.gh")

# ---- group: base
sobject = ConstructSobject(Plan=concat)
link = ConstructLink(Ports="Primary")
link_2 = ConstructLink(Ports="Secondary")
connectable = ConstructConnectable(Sobject=sobject, Link=link)
connectable_2 = ConstructConnectable(Sobject=sobject, Link=link_2)

# ----
concat_2 = Concatenate(FragmentA=panel, FragmentB="\", FragmentC="shaft.gh")
concat_3 = Concatenate(FragmentA=panel, FragmentB="\", FragmentC="capital.gh")

# ---- group: primary shaft captial
xy = XYPlane(Origin=Point(0, 0, 0))
prot = RotatePlane(Plane=xy, Angle=degrees("-90"))
plan = ConstructPlan(Uri=concat_3)  # -> Plan, Hash
sobject_2 = ConstructSobject(Pose=prot, Plan=plan.Plan)

# ----
concat_4 = Concatenate(FragmentA=panel, FragmentB="\", FragmentC="capsule.gh")
merge_2 = Merge(
    Data1=toggle_4,
    Data2=toggle_3,
    Data3=toggle_3,
    Data4=toggle_4,
    Data5=toggle_3,
    Data6=toggle_4,
    Data7=toggle_4,
    Data8=toggle_4,
    Data9=toggle_3)
trim = TrimTree(Tree=repeat, Depth=1)
invbool = InvertBoolean(Boolean=merge)  # -> Inverted, Number
sobject_3 = ConstructSobject(Pose=prot, Plan=plan.Plan)
trim_2 = TrimTree(Tree=repeat_2, Depth=1)
invbool_2 = InvertBoolean(Boolean=trim_2)  # -> Inverted, Number
invbool_3 = InvertBoolean(Boolean=trim)  # -> Inverted, Number
merge_3 = Merge(Data1=merge, Data2=toggle)
merge_4 = Merge(Data1=invbool.Inverted, Data2=toggle)
invbool_4 = InvertBoolean(Boolean=merge_2)  # -> Inverted, Number
list = ValueList({"Front", "Right", "Bottom", "Left"}, selected="Bottom")
list_2 = ValueList({"Front", "Right", "Bottom", "Left"}, selected="Bottom")
merge_5 = Merge(Data1=sobject_2, Data2=sobject_3)
concat_5 = Concatenate(FragmentA=panel, FragmentB="\", FragmentC="bouleenewtoncapsule.gh")
capsuletower = CapsuleTower(
    numberoffloors=number_slider_2,
    bridge=list,
    entrancepatternnorth1=merge_3,
    entrancepatternfront2=trim_2,
    entrancepatterneast1=invbool_2.Inverted,
    entrancepatterneast2=invbool_2.Inverted,
    entrancepatternsouth1=trim_2,
    entrancepatternsouth2=trim_2,
    entrancepatternwest1=invbool_2.Inverted,
    entrancepatternwest2=merge_4,
    windowpatternnorth1=trim_2,
    windowpatternfront2=trim_2,
    windowpatterneast1=trim_2,
    windowpatterneast2=trim_2,
    windowpatternsouth1=trim_2,
    windowpatternsouth2=invbool_2.Inverted,
    windowpatternwest1=invbool_2.Inverted,
    windowpatternwest2=trim_2)  # -> so_2, C_2
capsuletower_2 = CapsuleTower(
    numberoffloors=number_slider,
    bridge=list_2,
    entrancepatternnorth1=trim,
    entrancepatternfront2=merge_2,
    entrancepatterneast1=invbool_4.Inverted,
    entrancepatterneast2=trim,
    entrancepatternsouth1=invbool_3.Inverted,
    entrancepatternsouth2=trim,
    entrancepatternwest1=invbool_3.Inverted,
    entrancepatternwest2=invbool_3.Inverted,
    windowpatternnorth1=trim,
    windowpatternfront2=trim,
    windowpatterneast1=trim,
    windowpatterneast2=trim,
    windowpatternsouth1=trim,
    windowpatternsouth2=trim,
    windowpatternwest1=invbool_3.Inverted,
    windowpatternwest2=trim)  # -> so_2, C_2
draw = BooleanToggle(True)
item = ListItem(List=capsuletower.so_2, Index=0, Wrap=True)
item_2 = ListItem(List=capsuletower_2.so_2, Index=0, Wrap=True)
link_3 = ConstructLink(Ports="Top")
link_4 = ConstructLink(Ports="Bottom")
onoff = EnableDisableObject(Enabled=draw, AllObjects_Object=[make2d, make2d_2, make2d_4, make2d_5, make2d_3])
run = Boolean(Toggle(True))
server = Text("http://localhost:2999")
connectable_3 = ConstructConnectable(Sobject=item, Link=link_3)
connectable_4 = ConstructConnectable(Sobject=item, Link=link_4)
connectable_5 = ConstructConnectable(Sobject=item_2, Link=link_4)
connectable_6 = ConstructConnectable(Sobject=item_2, Link=link_3)
connection = ConstructConnection(Connecting=connectable_4, Connected=connectable)
connection_2 = ConstructConnection(Connecting=sobject_2, Connected=connectable_3)
connection_3 = ConstructConnection(Connecting=sobject_3, Connected=connectable_6)
connection_4 = ConstructConnection(Connecting=connectable_5, Connected=connectable_2)
merge_6 = Merge(Data1=connection, Data2=connection_4)
merge_7 = Merge(Data1=connection_2, Data2=connection_3)
merge_8 = Merge(Data1=sobject, Data2=capsuletower.so_2, Data3=capsuletower_2.so_2, Data4=merge_5)
merge_9 = Merge(Data1=merge_6, Data2=capsuletower.C_2, Data3=capsuletower_2.C_2, Data4=merge_7)
layout = ConstructLayout(Sobjects=merge_8, Connections=merge_9, Assembly=sobject)
layout_design = LayoutDesign(Url=server, Layout=layout, Run=run)
D = Design(layout_design)
design = ShowDesign(Design=layout_design, Concepts="All")
design_2 = ShowDesign(Design=layout_design, Concepts="Simple")
D_2 = Design(null)
dedesign = DeconstructDesign(Design=D_2)  # -> Prototypes, Elements
trim_3 = TrimTree(Tree=dedesign.Prototypes, Depth=1)
trim_4 = TrimTree(Tree=dedesign.Elements, Depth=1)
viewer = ParamViewer(dedesign.Elements)
deprototype = DeconstructPrototype(Prototype=trim_3)  # -> PlanHash, Representations, Description
deelement = DeconstructElement(Element=trim_4)  # -> SobjectId, PlanHash, Pose
tstat = TreeStatistics(Tree=deprototype.Representations)  # -> Paths, Length, Count
hash = NAME(x=deprototype.PlanHash)  # -> h
# ---------- hash: Python ----------
#Component Information
#--------------------------------------------------------------------------------------------
if ghenv.Component.RunCount<2:
    #General
    #--------------------------------------------------------------------------------------------
    __author__ = "YOUR NAME"
    __version__ = "2000.00.00"
h = hash(x)
# ---------- end hash ----------
hash_2 = NAME(x=deelement.PlanHash)  # -> h; same code as hash
sort = SortList(Keys=hash, ValuesA=tstat.Paths)  # -> Keys, ValuesA
sort_2 = SortList(Keys=hash_2, ValuesA=deelement.Pose)  # -> Keys, ValuesA
branch = TreeBranch(Tree=deprototype.Representations, Path=sort.ValuesA, MaintainPaths=False)
branch_2 = TreeBranch(MaintainPaths=True)
item_3 = ListItem(List=branch, Index=0, Wrap="False")  # -> Item, Item1
imrepresentation = ImportRepresentation(Representation=item_3.Item1)
clean = CleanTree(RemoveNulls=True, RemoveInvalid=True, RemoveEmpty=True, Tree=imrepresentation)
vec = VectorXYZ(XComponent=Slider(1, range=-10..10), YComponent=Slider(1, range=-10..10), ZComponent=Slider(-1, range=-10..10))  # -> Vector, Length
imrepresentation_2 = ImportRepresentation(Representation=item_3.Item)
pln = Plane(graft(sort_2.ValuesA))
swatch = ColourSwatch(SwatchColor=RGB(191, 216, 255))
swatch_2 = ColourSwatch(SwatchColor=RGB(0, 0, 0))
swatch_3 = ColourSwatch(SwatchColor=RGB(75, 85, 100))
swatch_4 = ColourSwatch(SwatchColor=RGB(37, 42, 50))
trim_5 = TrimTree(Tree=clean, Depth=1)
trim_6 = TrimTree(Tree=imrepresentation_2, Depth=1)
genes = GenePool(Decimals=0, Maximum=10, Minimum=0, Value=[8, 8])
genes_2 = GenePool(Decimals=0, Maximum=10, Minimum=0, Value=[8, 8])
number_slider_3 = Slider(1, range=0..1)
number_slider_4 = Slider(1000, range=0..10000)
swatch_5 = ColourSwatch(SwatchColor=RGB(240, 117, 24))
swatch_6 = ColourSwatch(SwatchColor=RGB(235, 52, 79))
swatch_7 = ColourSwatch(SwatchColor=RGB(0, 166, 157))
tstat_2 = TreeStatistics(Tree=trim_5)  # -> Paths, Length, Count
pl2pl = MoveObjectPlaneToPlane(G=trim_6, S=PlaneXY(0, 0, 0), T=pln)  # -> TG, T; inputs S: Plane, T: Plane
# ---------- pl2pl: Python ----------
#Component Information
#--------------------------------------------------------------------------------------------
if ghenv.Component.RunCount<2:
    #General
    #--------------------------------------------------------------------------------------------
    __author__ = "Ueli Saluz"
    __version__ = "2023.02.12"
    
    ghenv.Component.Name = "MoveObjectPlaneToPlane"
    ghenv.Component.NickName = "Pl2Pl"
    ghenv.Component.Description = "Moves abitrary geometry from a source plane to a target plane."
    ghenv.Component.Message = "VER 1.2"
    ghenv.Component.Category = "Transform"
    ghenv.Component.SubCategory = "Euclidean"
    
     #Inputs
    #--------------------------------------------------------------------------------------------
    inputIndex=0
    
    ghenv.Component.Params.Input[inputIndex].Name = "Geometry"
    ghenv.Component.Params.Input[inputIndex].NickName = "G"
    ghenv.Component.Params.Input[inputIndex].Description = "Geometry to move."
    ghenv.Component.Params.Input[inputIndex].Optional = False
    inputIndex+=1
    
    ghenv.Component.Params.Input[inputIndex].Name = "SourcePlane"
    ghenv.Component.Params.Input[inputIndex].NickName = "S"
    ghenv.Component.Params.Input[inputIndex].Description = "Source plane of object."
    ghenv.Component.Params.Input[inputIndex].Optional = False
    inputIndex+=1
    
    ghenv.Component.Params.Input[inputIndex].Name = "TargetPlane"
    ghenv.Component.Params.Input[inputIndex].NickName = "T"
    ghenv.Component.Params.Input[inputIndex].Description = "Target plane of object."
    ghenv.Component.Params.Input[inputIndex].Optional = False
    inputIndex+=1
    
    #Outputs
    #--------------------------------------------------------------------------------------------
    outputIndex=0
    
    ghenv.Component.Params.Output[outputIndex].Name = "TranslatedGeometry"
    ghenv.Component.Params.Output[outputIndex].NickName = "TG"
    ghenv.Component.Params.Output[outputIndex].Description = "Translated geometry in target plane."
    outputIndex+=1
    
    ghenv.Component.Params.Output[outputIndex].Name = "Trasnform"
    ghenv.Component.Params.Output[outputIndex].NickName = "T"
    ghenv.Component.Params.Output[outputIndex].Description = "Transform describing translation form source to target plane."
    outputIndex+=1


#Imports
#--------------------------------------------------------------------------------------------
import Rhino.Geometry.Transform as trsf

def MvObjPlnToPln (geo,plnObj,plnDest):
    transform = trsf.PlaneToPlane(plnObj,plnDest)
    geo.Transform(transform)
    return (geo,transform)

TG, T = MvObjPlnToPln(G,S,T)
# ---------- end pl2pl ----------
branch_3 = TreeBranch(Tree=pln, Path=tstat_2.Paths, MaintainPaths=True)
geo = Geometry(pl2pl.TG)
button = Button(ExpressionNormal="True", ExpressionPressed="False")
number_slider_5 = Slider(1, range=0..1)
bbox = BoundingBox(Content=flatten(pl2pl.TG), Plane=PlaneXY(0, 0, 0), UnionBox=True)  # -> Box, Box_2
button_2 = Button(ExpressionNormal="True", ExpressionPressed="False")
pl2pl_2 = MoveObjectPlaneToPlane(G=trim_5, S=PlaneXY(0, 0, 0), T=branch_3)  # -> TG, T; inputs S: Plane, T: Plane; same code as pl2pl
tstat_3 = TreeStatistics(Tree=geo)  # -> Paths, Length, Count
pt = ConstructPoint(
    XCoordinate=Slider(2000, range=0..10000),
    YCoordinate=Slider(-3000, range=-10000..-3000),
    ZCoordinate=Slider(2000, range=0..10000))
normallinethickness = Number(Slider(6, range=0..10))
explosionlinepattern = Number(genes)
hiddenlinethickness = Number(Slider(3, range=0..10))
saveviewports = Boolean(Button())
transparency = Number(Slider(0.2, range=0..1))
vec_2 = VectorXYZ(XComponent=Slider(4, range=-10..10), YComponent=Slider(-4, range=-10..10), ZComponent=Slider(-1, range=-10..10))  # -> Vector, Length
Z = UnitZ(Factor=1)
hiddenlinepattern = Number(genes_2)
normallinecolor = Colour(swatch_2)
scalefactor = Number(Slider(5, range=0..10))
item_4 = ListItem(List=flatten(geo), Index=Slider(37, range=0..100), Wrap=True)
trim_7 = TrimTree(Tree=geo, Depth=1)
dam = DataDam(DataA=bbox.Box, BufferDelay=10000000, BufferMode=0)
rhinovp = RhinoViewport(N="Diagram", P="0", WD=Domain2(u=0..1000, v=0..1000), T="False", A=button)  # -> F; inputs P: Int32, T: Boolean, A: Boolean
#   port P: 0 = None 1 = Top 2 = Bottom 3 = Left 4 = Right 5 = Front 6 = Back 7 = Perspective 8 = TwoPointPerspective
# ---------- rhinovp: Python ----------
#Component Information
#--------------------------------------------------------------------------------------------
if ghenv.Component.RunCount<2:
    #General
    #--------------------------------------------------------------------------------------------
    __author__ = "Ueli Saluz"
    __version__ = "2023.04.05"
    
    ghenv.Component.Name = "RhinoViewport"
    ghenv.Component.NickName = "RhinoVP"
    ghenv.Component.Description = "Launches or closes a Rhino viewport."
    ghenv.Component.Message = "VER 1.3"
    ghenv.Component.Category = "Display"
    ghenv.Component.SubCategory = "Camera"
    
     #Inputs
    #--------------------------------------------------------------------------------------------
    inputIndex=0
    
    ghenv.Component.Params.Input[inputIndex].Name = "Name"
    ghenv.Component.Params.Input[inputIndex].NickName = "N"
    ghenv.Component.Params.Input[inputIndex].Description = "Name of the viewport"
    ghenv.Component.Params.Input[inputIndex].Optional = False
    inputIndex+=1
    
    ghenv.Component.Params.Input[inputIndex].Name = "ViewportProjection"
    ghenv.Component.Params.Input[inputIndex].NickName = "P"
    ghenv.Component.Params.Input[inputIndex].Description = "0  = None \n1 = Top \n2 = Bottom \n3 = Left \n4 = Right \n5 = Front\n6 = Back\n7 = Perspective\n8 = TwoPointPerspective"
    ghenv.Component.Params.Input[inputIndex].Optional = False
    inputIndex+=1
    
    ghenv.Component.Params.Input[inputIndex].Name = "WindowDomain"
    ghenv.Component.Params.Input[inputIndex].NickName = "WD"
    ghenv.Component.Params.Input[inputIndex].Description = "The domain of the window. The U domain corresponds to X and the V domain to Y."
    ghenv.Component.Params.Input[inputIndex].Optional = False
    inputIndex+=1
    
    ghenv.Component.Params.Input[inputIndex].Name = "TitleVisible"
    ghenv.Component.Params.Input[inputIndex].NickName = "T"
    ghenv.Component.Params.Input[inputIndex].Description = "True if Rhino view title should be visible."
    ghenv.Component.Params.Input[inputIndex].Optional = True
    inputIndex+=1
    
    ghenv.Component.Params.Input[inputIndex].Name = "WallPaperPath"
    ghenv.Component.Params.Input[inputIndex].NickName = "WP"
    ghenv.Component.Params.Input[inputIndex].Description = "The domain of the window. The U domain corresponds to X and the V domain to Y."
    ghenv.Component.Params.Input[inputIndex].Optional = True
    inputIndex+=1
    
    ghenv.Component.Params.Input[inputIndex].Name = "ScaleFactor"
    ghenv.Component.Params.Input[inputIndex].NickName = "S"
    ghenv.Component.Params.Input[inputIndex].Description = "A scale factor that is applied on the window domains."
    ghenv.Component.Params.Input[inputIndex].Optional = True
    inputIndex+=1
    
    ghenv.Component.Params.Input[inputIndex].Name = "Active"
    ghenv.Component.Params.Input[inputIndex].NickName = "A"
    ghenv.Component.Params.Input[inputIndex].Description = "Activate or deactivate the window."
    ghenv.Component.Params.Input[inputIndex].Optional = False
    inputIndex+=1
    
    #Outputs
    #--------------------------------------------------------------------------------------------
    outputIndex=0
    
    ghenv.Component.Params.Output[outputIndex].Name = "Finished"
    ghenv.Component.Params.Output[outputIndex].NickName = "F"
    ghenv.Component.Params.Output[outputIndex].Description = "Sends True when finished. Just to trigger other depending components."
    outputIndex+=1


#Imports
#--------------------------------------------------------------------------------------------
from System import Object, Enum
from Grasshopper import DataTree
import System as sy
import Rhino as rc
import scriptcontext as sc
import clr
import System.Windows.Forms.Control

#Solver - Run with trees to enhance performance drastically
#--------------------------------------------------------------------------------------------
if __name__ == "__main__":
    
    vp = rc.RhinoDoc.ActiveDoc.Views.Find(N, False)
    if A:
        scaleFacor = 1 if S is None else S
        if vp:
            vp.Close()
        
        #The width is 16 pixel and height is 39 too little. Additionally the windows start 8 pixel shifted to the left. Why? I don't know.
        windowRectangle = sy.Drawing.Rectangle(WD.U0*scaleFacor-8,WD.V0*scaleFacor,WD.U.Length*scaleFacor+16,WD.V.Length*scaleFacor+39)
        newView = rc.RhinoDoc.ActiveDoc.Views.Add(N,Enum.ToObject(rc.Display.DefinedViewportProjection, P),windowRectangle,True)
        #newView seems to not set the name properly
        newView.MainViewport.Name = N
        if T==False:
            newView.TitleVisible = False
        viewport = newView.ActiveViewport
        if WP is not None:
            viewport.SetWallpaper(WP,False)
        
        viewport.ConstructionAxesVisible = False
        viewport.ConstructionGridVisible = False
        viewport.WorldAxesVisible = False
        
    else:
        if vp:
            vp.Close()
    F = True
# ---------- end rhinovp ----------
setview = SetView(N="Diagram", P="0", L=pt, D=vec_2.Vector, Up=Z, R=button_2)  # -> F; inputs P: Int32, L: Point3d, D: Vector3d, Up: Vector3d, R: Boolean
#   port P: 0 = Parallel view 1 = Perspective view
# ---------- setview: Python ----------
#Component Information
#--------------------------------------------------------------------------------------------
if ghenv.Component.RunCount<2:
    #General
    #--------------------------------------------------------------------------------------------
    __author__ = "Ueli Saluz"
    __version__ = "2022.05.22"
    
    ghenv.Component.Name = "SetView"
    ghenv.Component.NickName = "SetView"
    ghenv.Component.Description = "Set a camera view and projection."
    ghenv.Component.Message = "VER 1.1"
    ghenv.Component.Category = "Display"
    ghenv.Component.SubCategory = "Camera"
    
     #Inputs
    #--------------------------------------------------------------------------------------------
    inputIndex=0
    
    ghenv.Component.Params.Input[inputIndex].Name = "Name"
    ghenv.Component.Params.Input[inputIndex].NickName = "N"
    ghenv.Component.Params.Input[inputIndex].Description = "Name of the viewport"
    ghenv.Component.Params.Input[inputIndex].Optional = True
    inputIndex+=1
    
    ghenv.Component.Params.Input[inputIndex].Name = "Projection"
    ghenv.Component.Params.Input[inputIndex].NickName = "P"
    ghenv.Component.Params.Input[inputIndex].Description = "0 = Parallel view\n"+\
                                                           "1 = Perspective view"
    ghenv.Component.Params.Input[inputIndex].Optional = True
    inputIndex+=1
    
    
    ghenv.Component.Params.Input[inputIndex].Name = "CameraLocation"
    ghenv.Component.Params.Input[inputIndex].NickName = "L"
    ghenv.Component.Params.Input[inputIndex].Description = "Location of the camera."
    ghenv.Component.Params.Input[inputIndex].Optional = True
    inputIndex+=1
    
    ghenv.Component.Params.Input[inputIndex].Name = "CameraDirection"
    ghenv.Component.Params.Input[inputIndex].NickName = "D"
    ghenv.Component.Params.Input[inputIndex].Description = "Direction of the camera."
    ghenv.Component.Params.Input[inputIndex].Optional = True
    inputIndex+=1
    
    ghenv.Component.Params.Input[inputIndex].Name = "CameraUp"
    ghenv.Component.Params.Input[inputIndex].NickName = "Up"
    ghenv.Component.Params.Input[inputIndex].Description = "Up vector of the camera."
    ghenv.Component.Params.Input[inputIndex].Optional = True
    inputIndex+=1
    
    ghenv.Component.Params.Input[inputIndex].Name = "LensLength"
    ghenv.Component.Params.Input[inputIndex].NickName = "LL"
    ghenv.Component.Params.Input[inputIndex].Description = "Lens length of the camera. Only relevant if projection is perspective."
    ghenv.Component.Params.Input[inputIndex].Optional = True
    inputIndex+=1
    
    ghenv.Component.Params.Input[inputIndex].Name = "Run"
    ghenv.Component.Params.Input[inputIndex].NickName = "R"
    ghenv.Component.Params.Input[inputIndex].Description = "Zoom to the given bounding box."
    ghenv.Component.Params.Input[inputIndex].Optional = False
    inputIndex+=1
    
    #Outputs
    #--------------------------------------------------------------------------------------------
    outputIndex=0
    
    ghenv.Component.Params.Output[outputIndex].Name = "Finished"
    ghenv.Component.Params.Output[outputIndex].NickName = "F"
    ghenv.Component.Params.Output[outputIndex].Description = "Sends True when finished. Just to trigger other depending components."
    outputIndex+=1
    


#Imports
#--------------------------------------------------------------------------------------------
from Rhino import RhinoDoc
from Rhino.Geometry import Box

#Solver - Run with trees to enhance performance drastically
#--------------------------------------------------------------------------------------------
if __name__ == "__main__":
    
    if R:
        if N is not None:
            view = RhinoDoc.ActiveDoc.Views.Find(N, False)
        else:
            view = RhinoDoc.ActiveDoc.Views.ActiveView
        vp = view.ActiveViewport
        if P is not None:
            if (P==0):
                vp.ChangeToParallelProjection(True)
            else:
                vp.ChangeToPerspectiveProjection(True,LL)
        if L is not None:
            vp.SetCameraLocation(L,False)
        if D is not None:
            vp.SetCameraDirection(D,False)
        if Up is not None:
            vp.CameraUp = Up
    F = True
# ---------- end setview ----------
item_5 = ListItem(List=trim_7, Index=number_slider_5, Wrap=True)
wires = BrepWireframe(Brep=geo, Density=-1)
capex = CapHolesEx(Brep=item_5)  # -> Brep, Caps, Solid
zoom2bb = ZoomToBoundingBox(N="Diagram", BB=bbox.Box, S=0, R=setview)  # -> F, SBB; inputs BB: Box, R: Boolean
# ---------- zoom2bb: Python ----------
#Component Information
#--------------------------------------------------------------------------------------------
if ghenv.Component.RunCount<2:
    #General
    #--------------------------------------------------------------------------------------------
    __author__ = "Ueli Saluz"
    __version__ = "2022.05.21"
    
    ghenv.Component.Name = "ZoomToBoundingBox"
    ghenv.Component.NickName = "Zoom2BB"
    ghenv.Component.Description = "Zoom the view of a Rhino viewport to a bounding box."
    ghenv.Component.Message = "VER 1.0"
    ghenv.Component.Category = "Display"
    ghenv.Component.SubCategory = "Camera"
    
     #Inputs
    #--------------------------------------------------------------------------------------------
    inputIndex=0
    
    ghenv.Component.Params.Input[inputIndex].Name = "Name"
    ghenv.Component.Params.Input[inputIndex].NickName = "N"
    ghenv.Component.Params.Input[inputIndex].Description = "Name of the viewport"
    ghenv.Component.Params.Input[inputIndex].Optional = False
    inputIndex+=1
    
    ghenv.Component.Params.Input[inputIndex].Name = "BoundingBox"
    ghenv.Component.Params.Input[inputIndex].NickName = "BB"
    ghenv.Component.Params.Input[inputIndex].Description = ""
    ghenv.Component.Params.Input[inputIndex].Optional = False
    inputIndex+=1
    
    ghenv.Component.Params.Input[inputIndex].Name = "ScaleFactor"
    ghenv.Component.Params.Input[inputIndex].NickName = "S"
    ghenv.Component.Params.Input[inputIndex].Description = "A factor for the extension of the bounding box." \
    +"0 means 0 extension, a positive number makes the bounding box larger a negative smaller. The amount is proportional to the length."
    ghenv.Component.Params.Input[inputIndex].Optional = False
    inputIndex+=1
   
    
    ghenv.Component.Params.Input[inputIndex].Name = "Run"
    ghenv.Component.Params.Input[inputIndex].NickName = "R"
    ghenv.Component.Params.Input[inputIndex].Description = "Zoom to the given bounding box."
    ghenv.Component.Params.Input[inputIndex].Optional = False
    inputIndex+=1
    
    #Outputs
    #--------------------------------------------------------------------------------------------
    outputIndex=0
    
    ghenv.Component.Params.Output[outputIndex].Name = "Finished"
    ghenv.Component.Params.Output[outputIndex].NickName = "F"
    ghenv.Component.Params.Output[outputIndex].Description = "Sends True when finished. Just to trigger other depending components."
    outputIndex+=1
    
    ghenv.Component.Params.Output[outputIndex].Name = "ScaledBoundingBox"
    ghenv.Component.Params.Output[outputIndex].NickName = "SBB"
    ghenv.Component.Params.Output[outputIndex].Description = "The scaled bounding box."
    outputIndex+=1


#Imports
#--------------------------------------------------------------------------------------------
from Rhino import RhinoDoc
from Rhino.Geometry import Box

#Solver - Run with trees to enhance performance drastically
#--------------------------------------------------------------------------------------------
if __name__ == "__main__":
    
    vp = RhinoDoc.ActiveDoc.Views.Find(N, False).ActiveViewport
    if R:
        box = BB
        bb = BB.BoundingBox
        bb.Inflate(S*box.X.Length,S*box.Y.Length,S*box.Z.Length)
        vp.ZoomBoundingBox(bb)
        SBB = bb
    F = True
# ---------- end zoom2bb ----------

lng = ListLength(List=deelement.SobjectId)
expression = Expression(x=lng, Expression="x-1")
series = Series(Start=0, Step=1, Count=expression)
dup = DuplicateData(Data=swatch_2, Number=expression, Order=True)
trim_8 = TrimTree(Tree=series, Depth=1)
trim_9 = TrimTree(Tree=dup, Depth=1)
concat_6 = Concatenate(FragmentA="capsule", FragmentB=trim_8)
merge_10 = Merge(Data1="shaft", Data2=concat_6)
merge_11 = Merge(Data1=swatch_2, Data2=swatch_6)
layer = CreateLayers(CreateToggle=Button(), LayerNames=merge_10, LayerColors=merge_11)

panel_2 = Panel("C:\Git\Studium\PhD\semio\examples\capsuletower\axonometry.png")
cleanlayer = BooleanToggle(False)
replace = ReplaceItems(List=trim_7, Item=capex.Brep, Indices=number_slider_5, Wrap=False)
trim_10 = TrimTree(Tree=wires, Depth=1)
merge_12 = Merge(Data1=geo, Data2=trim_10)
number_slider_6 = Slider(5000, range=0..10000)
toggle_5 = BooleanToggle(True)  # disabled
number_slider_7 = Slider(1, range=-10..10)
toggle_6 = BooleanToggle(True)
number_slider_8 = Slider(1, range=-10..10)
toggle_7 = BooleanToggle(True)
m2d_rhino = Make2DRhinoView(Name="Diagram", Clip=True)
onoff_2 = EnableDisableObject(Enabled=cleanlayer, AllObjects_Object=[layers, layertable, toggle_8, trim_12, toggle_5, difference])
trim_11 = TrimTree(Tree=merge_12, Depth=1)
sunion = SolidUnion()
layertable = LayerTable(Update=toggle_5, AutoUpdate=False)  # -> Layers, FullLayerPaths, LayerColors, Linetypes, MaterialNames, Visible, PrintWidth, PrintColor; disabled
make2d = Make2D(Geometry=trim_11, View=m2d_rhino, TangentEdges=toggle_6, TangentSeams=toggle_6, AutoComputeMake2D=True)  # -> VisibleCurves, VisibleIndex, VisibleType, HiddenCurves, HiddenIndex, HiddenType
make2d_2 = Make2D(Geometry=sunion, View=m2d_rhino, TangentEdges=toggle_6, TangentSeams=toggle_6, AutoComputeMake2D=True)  # -> VisibleCurves, VisibleIndex, VisibleType, HiddenCurves, HiddenIndex, HiddenType
make2d_3 = Make2D(Geometry=pl2pl_2.TG, View=m2d_rhino, TangentEdges=toggle_6, TangentSeams=toggle_6, AutoComputeMake2D=True)  # -> VisibleCurves, VisibleIndex, VisibleType, HiddenCurves, HiddenIndex, HiddenType
panel_3 = Panel("Silhouette")
panel_4 = Panel("Silhouette, Boundary")
panel_5 = Panel("axonometry.png")
pt_2 = ConstructPoint(XCoordinate=number_slider_6, YCoordinate=number_slider_6, ZCoordinate=0)
panel_6 = Panel("Silhouette, Crease")
panel_7 = Panel("Crease")
trim_12 = TrimTree(Tree=layertable.Layers, Depth=1)  # disabled
panel_8 = Panel("Wire")
trim_13 = TrimTree(Tree=make2d_2.HiddenCurves, Depth=1)
vec_3 = VectorXYZ(XComponent=0, YComponent=0, ZComponent=Slider(-1, range=-10..10))  # -> Vector, Length
Z_2 = UnitZ(Factor=1)
trim_14 = TrimTree(Tree=make2d_2.VisibleType, Depth=1)
trim_15 = TrimTree(Tree=make2d_2.VisibleCurves, Depth=1)
trim_16 = TrimTree(Tree=make2d.HiddenCurves, Depth=1)
trim_17 = TrimTree(Tree=make2d.VisibleCurves, Depth=1)
trim_18 = TrimTree(Tree=make2d.VisibleType, Depth=1)
trim_19 = TrimTree(Tree=make2d_3.HiddenCurves, Depth=1)
trim_20 = TrimTree(Tree=make2d_3.VisibleCurves, Depth=1)
toggle_8 = BooleanToggle(True)  # disabled
difference = SetDifference(SetA=trim_12, SetB=merge_10)  # disabled
move = Move(Geometry=trim_16, Motion=pt_2)  # -> Geometry, Transform
move_2 = Move(Geometry=trim_13, Motion=pt_2)  # -> Geometry, Transform
move_3 = Move(Geometry=trim_17, Motion=pt_2)  # -> Geometry, Transform
saveview = SaveViewportToFile(Run=saveviewports, ViewportName="Drawing", Render=False, FilePath=panel_2, ScaleFactor=scalefactor)
setview_2 = SetView(N="Drawing", P="0", L=pt_2, D=vec_3.Vector, Up=Z_2, R=button_2)  # -> F; inputs P: Int32, L: Point3d, D: Vector3d, Up: Vector3d, R: Boolean; same code as setview
tmatch = MatchText(Text=trim_14, RegEx="Boundary", Case=True)
rhinovp_2 = RhinoViewport(N="Drawing", P="0", WD=Domain2(u=0..1000, v=0..1000), T="False", A=button)  # -> F; inputs P: Int32, T: Boolean, A: Boolean; same code as rhinovp
move_4 = Move(Geometry=trim_15, Motion=pt_2)  # -> Geometry, Transform
move_5 = Move(Geometry=trim_19, Motion=pt_2)  # -> Geometry, Transform
move_6 = Move(Geometry=trim_20, Motion=pt_2)  # -> Geometry, Transform
union = BooleanToggle(False)
layers = CreateModifyLayers(LayerName=difference, DeleteLayer=toggle_8, enableFullPath=False)  # -> LayerNames, LayerFullPath; disabled
dispatch = Dispatch(List=move_4.Geometry, DispatchPattern=tmatch)  # -> ListA, ListB
merge_13 = Merge(Data1=move_3.Geometry, Data2=move.Geometry)
filter = StreamFilter(Gate=union, Stream0=move_3.Geometry, Stream1=move_4.Geometry)
merge_14 = Merge(Data1=move_2.Geometry)
convexhull = ConvexHull(C=move_3.Geometry)
bbox_2 = BoundingBox(Content=flatten(merge_13), Plane=PlaneXY(0, 0, 0), UnionBox=True)  # -> Box, Box_2
drawinghidden = Curve(merge_14)
drawingvisible = Curve(filter)
bang = ExplodeTree(Data=pl2pl.TG)  # -> Branch0, Branch1, Branch2, Branch3, Branch4, Branch5, Branch6
bang_2 = ExplodeTree(Data=convexhull)  # -> Branch0, Branch1, Branch2, Branch3, Branch4, Branch5, Branch6
trim_21 = TrimTree(Depth=1)
zoom2bb_2 = ZoomToBoundingBox(N="Drawing", BB=bbox_2.Box, S=0, R=setview_2)  # -> F, SBB; inputs BB: Box, R: Boolean; same code as zoom2bb
expression_2 = Expression(x=number_slider_4, Expression="x/2")
layers_2 = CreateModifyLayers(LayerName="Default:LineType", DeleteLayer=False, enableFullPath=True)  # -> LayerNames, LayerFullPath
merge_15 = Merge(Data1=bang.Branch1, Data2=bang.Branch2, Data3=bang.Branch3)
merge_16 = Merge(Data1=bang.Branch4, Data2=bang.Branch5, Data3=bang.Branch6)
dash = DashPattern(Curve=trim_21, Pattern=hiddenlinepattern)  # -> Dashes, Gaps
dash_2 = DashPattern(Curve=drawinghidden, Pattern=hiddenlinepattern)  # -> Dashes, Gaps
merge_17 = Merge(Data1=bang_2.Branch2, Data2=bang_2.Branch3, Data3=bang_2.Branch5, Data4=bang_2.Branch6)
merge_18 = Merge(Data1=bang_2.Branch1, Data2=bang_2.Branch4)
panel_9 = Panel(trim_14)
pt_3 = ConstructPoint(XCoordinate=Slider(0.5, range=0..1), YCoordinate=0, ZCoordinate=0)
merge_19 = Merge(Data1=merge_15, Data2=merge_16)
explosionaxonometry = ExplosionAxonometry(
    eastcapsules=merge_16,
    southcapsules=merge_15,
    mainexplosiondistance=number_slider_4,
    secondaryexplosiondistance=Slider(800, range=0..1000))  # -> capsules_2, explosionslines_2, explosiontransform_2
previewlw = CustomPreviewLineweights(Geometry=dash.Dashes, Shader=normallinecolor, Thickness=hiddenlinethickness, Absolute=False)
previewlw_2 = CustomPreviewLineweights(Geometry=drawingvisible, Shader=normallinecolor, Thickness=normallinethickness, Absolute=False)
previewlw_3 = CustomPreviewLineweights(Geometry=dash_2.Dashes, Shader=normallinecolor, Thickness=hiddenlinethickness, Absolute=False)
previewmat = CustomPreviewMaterials(Geometry=bang_2.Branch0, DiffuseColor=swatch_5, Transparency=transparency)
previewmat_2 = CustomPreviewMaterials(Geometry=merge_18, DiffuseColor=swatch_5, Transparency=transparency)
previewmat_3 = CustomPreviewMaterials(Geometry=merge_17, DiffuseColor=swatch_6, Transparency=transparency)
multiplication = Multiplication(A=pt_2, B="2")
evalsrf = EvaluateSurface(Surface=reparameterize(pl2pl_2.TG), Point=pt_3)  # -> Point, Normal, UDirection, VDirection, Frame
area = Area(Geometry=merge_19)  # -> Area, Centroid
trim_22 = TrimTree(Tree=dash_2.Dashes, Depth=1)
trim_23 = TrimTree(Tree=dash.Dashes, Depth=1)
subtraction = Subtraction(A=evalsrf.Point, B=area.Centroid)
merge_20 = Merge(Data1=drawingvisible, Data2=trim_22, Data3=trim_23)
move_7 = Move(Geometry=explosionaxonometry.explosionslines_2, Motion=subtraction)  # -> Geometry, Transform
button_3 = Button()
createatts = CreateAttributes(LayerName="Default", Color=swatch_2, enableFullPath=False)
createatts_2 = CreateAttributes(LayerName="Default", enableFullPath=False)
number_slider_9 = Slider(1, range=-10..10)
number_slider_10 = Slider(1, range=-10..10)
merge_21 = Merge(Data1=bang.Branch0, Data2=explosionaxonometry.capsules_2)
bake = BakeGeometry(Bake=button_3, Geometry=merge_20, Attributes=createatts, DeleteOldBakes=False, PreserveTrees=False)
bake_2 = BakeGeometry(Bake=button_3, Attributes=createatts_2, DeleteOldBakes=False, PreserveTrees=False)
toggle_9 = BooleanToggle(True)
vec_4 = VectorXYZ(XComponent=0, YComponent=0, ZComponent=Slider(-1, range=-10..10))  # -> Vector, Length
Z_3 = UnitZ(Factor=1)
make2d_4 = Make2D(Geometry=merge_21, View=m2d_rhino, TangentEdges=toggle_9, TangentSeams=toggle_9, AutoComputeMake2D=True)  # -> VisibleCurves, VisibleIndex, VisibleType, HiddenCurves, HiddenIndex, HiddenType
make2d_5 = Make2D(Geometry=move_7.Geometry, View=m2d_rhino, TangentEdges=toggle_9, TangentSeams=toggle_9, AutoComputeMake2D=True)  # -> VisibleCurves, VisibleIndex, VisibleType, HiddenCurves, HiddenIndex, HiddenType
rhinovp_3 = RhinoViewport(N="Axonometrie", P="0", WD=Domain2(u=0..1000, v=0..1000), T="False", A=button)  # -> F; inputs P: Int32, T: Boolean, A: Boolean; same code as rhinovp
saveview_2 = SaveViewportToFile(
    Run=saveviewports,
    ViewportName="Axonometrie",
    Render=False,
    FilePath="explosionaxononmetry.png",
    ScaleFactor=scalefactor)
setview_3 = SetView(N="Axonometrie", P="0", L=pt_2, D=vec_4.Vector, Up=Z_3, R=button_2)  # -> F; inputs P: Int32, L: Point3d, D: Vector3d, Up: Vector3d, R: Boolean; same code as setview
trim_24 = TrimTree(Tree=make2d_4.HiddenCurves, Depth=1)
trim_25 = TrimTree(Tree=make2d_4.VisibleCurves, Depth=1)
trim_26 = TrimTree(Tree=make2d_5.VisibleCurves, Depth=1)
crv = Curve([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])
crv_2 = Curve([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])
crv_3 = Curve([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])
move_8 = Move(Geometry=trim_25, Motion=multiplication)  # -> Geometry, Transform
convexhull_2 = ConvexHull(C=move_8.Geometry)
bang_3 = ExplodeTree(Data=convexhull_2)  # -> Branch0, Branch1, Branch2, Branch3, Branch4, Branch5, Branch6
move_9 = Move(Geometry=trim_24, Motion=multiplication)  # -> Geometry, Transform
move_10 = Move(Geometry=trim_26, Motion=multiplication)  # -> Geometry, Transform
explosionlines = Curve(move_10.Geometry)
dash_3 = DashPattern(Curve=explosionlines, Pattern=hiddenlinepattern)  # -> Dashes, Gaps
merge_22 = Merge(Data1=bang_3.Branch2, Data2=bang_3.Branch3, Data3=bang_3.Branch5, Data4=bang_3.Branch6)
merge_23 = Merge(Data1=bang_3.Branch1, Data2=bang_3.Branch4)
bbox_3 = BoundingBox(Content=flatten(move_8.Geometry), Plane=PlaneXY(0, 0, 0), UnionBox=True)  # -> Box, Box_2
merge_24 = Merge(Data1=move_8.Geometry)
drawingvisible_2 = Curve(merge_24)
merge_25 = Merge(Data2=move_9.Geometry)
drawinghidden_2 = Curve(merge_25)
dash_4 = DashPattern(Curve=drawinghidden_2, Pattern=hiddenlinepattern)  # -> Dashes, Gaps
previewmat_4 = CustomPreviewMaterials(Geometry=merge_22, DiffuseColor=swatch_6, Transparency=transparency)
previewmat_5 = CustomPreviewMaterials(Geometry=bang_3.Branch0, DiffuseColor=swatch_5, Transparency=transparency)
previewmat_6 = CustomPreviewMaterials(Geometry=merge_23, DiffuseColor=swatch_5, Transparency=transparency)
previewlw_4 = CustomPreviewLineweights(Geometry=dash_3.Dashes, Shader=normallinecolor, Thickness=hiddenlinethickness, Absolute=False)
previewlw_5 = CustomPreviewLineweights(Geometry=drawingvisible_2, Shader=normallinecolor, Thickness=normallinethickness, Absolute=False)
previewlw_6 = CustomPreviewLineweights(Geometry=dash_4.Dashes, Shader=normallinecolor, Thickness=hiddenlinethickness, Absolute=False)
zoom2bb_3 = ZoomToBoundingBox(N="Axonometrie", BB=bbox_3.Box, S=0, R=setview_3)  # -> F, SBB; inputs BB: Box, R: Boolean; same code as zoom2bb

# ==== cluster ConvexHull
C = ClusterInput()
explode = Explode(Curve=C, Recursive=True)  # -> Segments, Vertices
trim = TrimTree(Tree=explode.Vertices, Depth=1)
hull = ConvexHull(Points=trim, Plane=PlaneXY(0, 0, 0))  # -> Hull, HullZ, Indices
crv = Curve(hull.Hull)
srf = Surface(crv)
srf_2 = ClusterOutput(srf)

# ==== cluster ExplosionAxonometry
mainexplosiondistance = ClusterInput()
secondaryexplosiondistance = ClusterInput()
southcapsules = ClusterInput()
northcapsules = ClusterInput()
westcapsules = ClusterInput()
eastcapsules = ClusterInput()
mainexplosiondistance_2 = Number(mainexplosiondistance)
northcapsules_2 = Geometry(northcapsules)
southcapsules_2 = Geometry(southcapsules)
westcapsules_2 = Geometry(westcapsules)
eastcapsules_2 = Geometry(eastcapsules)
secondaryexplosiondistance_2 = Number(secondaryexplosiondistance)
neg = Negative(Value=mainexplosiondistance_2)
neg_2 = Negative(Value=secondaryexplosiondistance_2)
Y = UnitY(Factor=neg)
Z = UnitZ(Factor=secondaryexplosiondistance_2)
X = UnitX(Factor=mainexplosiondistance_2)
Z_2 = UnitZ(Factor=neg_2)
cluster = Cluster(geo=northcapsules_2, T_3=Y, T_2=Z_2, T=Z)  # -> geo_4, pt_2, transform_2
cluster_2 = Cluster(geo=southcapsules_2, T_3=Y, T_2=Z_2, T=Z)  # -> geo_4, pt_2, transform_2
cluster_3 = Cluster(geo=eastcapsules_2, T_3=X, T_2=Z_2, T=Z)  # -> geo_4, pt_2, transform_2
cluster_4 = Cluster(geo=southcapsules_2, T_3=Y, T_2=Z_2, T=Z)  # -> geo_4, pt_2, transform_2
merge = Merge(Data1=cluster_2.pt_2, Data2=cluster_3.pt_2)
merge_2 = Merge(Data1=cluster_2.transform_2, Data2=cluster_3.transform_2)
merge_3 = Merge(Data1=cluster_2.geo_4, Data2=cluster_3.geo_4)
pline = PolyLine(Vertices=merge, Closed=False)
explosiontransform = Transform(merge_2)
capsules = Geometry(merge_3)
explosionslines = Curve(pline)
explosiontransform_2 = ClusterOutput(explosiontransform)
capsules_2 = ClusterOutput(capsules)
explosionslines_2 = ClusterOutput(explosionslines)

# ==== cluster CapsuleTower
panel = Panel("C:\Git\Studium\PhD\semio\examples\capsuletower")
entrancepatternsouth1 = ClusterInput()
entrancepatternsouth2 = ClusterInput()
entrancepatternnorth1 = ClusterInput()
entrancepatterneast2 = ClusterInput()
entrancepatternwest1 = ClusterInput()
entrancepatternwest2 = ClusterInput()
entrancepatternfront2 = ClusterInput()
entrancepatterneast1 = ClusterInput()
windowpatternnorth1 = ClusterInput()
windowpatternsouth1 = ClusterInput()
windowpatternsouth2 = ClusterInput()
windowpatternfront2 = ClusterInput()
windowpatternwest1 = ClusterInput()
windowpatterneast2 = ClusterInput()
windowpatterneast1 = ClusterInput()
windowpatternwest2 = ClusterInput()
list = ValueList({"Round", "Rectangular"}, selected="Round")
entrancepatternnorth1_2 = Integer(entrancepatternnorth1)
entrancepatterneast2_2 = Integer(entrancepatterneast2)
entrancepatterneast1_2 = Integer(entrancepatterneast1)
entrancepatternsouth2_2 = Integer(entrancepatternsouth2)
entrancepatternfront2_2 = Integer(entrancepatternfront2)
entrancepatternsouth1_2 = Integer(entrancepatternsouth1)
entrancepatternwest1_2 = Integer(entrancepatternwest1)
entrancepatternwest2_2 = Integer(entrancepatternwest2)
windowpatternnorth1_2 = Integer(windowpatternnorth1)
windowpatterneast2_2 = Integer(windowpatterneast2)
windowpatterneast1_2 = Integer(windowpatterneast1)
windowpatternsouth2_2 = Integer(windowpatternsouth2)
windowpatternfront2_2 = Integer(windowpatternfront2)
windowpatternwest1_2 = Integer(windowpatternwest1)
windowpatternsouth1_2 = Integer(windowpatternsouth1)
windowpatternwest2_2 = Integer(windowpatternwest2)
list_2 = ValueList({"Back", "Side"}, selected="Back")
concat = Concatenate(FragmentA=panel, FragmentB="\", FragmentC="base.gh")
concat_2 = Concatenate(FragmentA=panel, FragmentB="\", FragmentC="shaft.gh")
concat_3 = Concatenate(FragmentA=panel, FragmentB="\", FragmentC="capital.gh")
concat_4 = Concatenate(FragmentA=panel, FragmentB="\", FragmentC="capsule.gh")
parameter = ConstructParameter(Name="Entrance", Value=list_2)
panel_2 = Panel("""Back
Side""")
parameter_2 = ConstructParameter(Name="WindowShape", Value=list)
parameter_3 = ConstructParameter(Name="Length", Value=Slider(400, range=0..1000))
panel_3 = Panel("""Back
Side""")
list_3 = ValueList({"Front", "Side"}, selected="Front")
list_4 = ValueList({"Back", "Side"}, selected="Side")
parameter_4 = ConstructParameter(Name="Length", Value=Slider(420, range=0..1000))
parameter_5 = ConstructParameter(Name="Mirror", Value=Toggle(True))
item = ListItem(List=panel_2, Index=entrancepatternnorth1_2, Wrap=True)  # -> graft(Item)
item_2 = ListItem(List=panel_2, Index=entrancepatternfront2_2, Wrap=True)  # -> graft(Item)
item_3 = ListItem(List=panel_2, Index=entrancepatterneast1_2, Wrap=True)  # -> graft(Item)
item_4 = ListItem(List=panel_2, Index=entrancepatterneast2_2, Wrap=True)  # -> graft(Item)
item_5 = ListItem(List=panel_2, Index=entrancepatternsouth1_2, Wrap=True)  # -> graft(Item)
item_6 = ListItem(List=panel_2, Index=entrancepatternsouth2_2, Wrap=True)  # -> graft(Item)
item_7 = ListItem(List=panel_2, Index=entrancepatternwest1_2, Wrap=True)  # -> graft(Item)
item_8 = ListItem(List=panel_2, Index=entrancepatternwest2_2, Wrap=True)  # -> graft(Item)
parameter_6 = ConstructParameter(Name="Width", Value=Slider(270, range=0..1000))
item_9 = ListItem(List=panel_3, Index=windowpatternnorth1_2, Wrap=True)  # -> graft(Item)
item_10 = ListItem(List=panel_3, Index=windowpatternfront2_2, Wrap=True)  # -> graft(Item)
item_11 = ListItem(List=panel_3, Index=windowpatterneast1_2, Wrap=True)  # -> graft(Item)
item_12 = ListItem(List=panel_3, Index=windowpatterneast2_2, Wrap=True)  # -> graft(Item)
parameter_7 = ConstructParameter(Name="Height", Value=Slider(275, range=0..1000))
item_13 = ListItem(List=panel_3, Index=windowpatternsouth1_2, Wrap=True)  # -> graft(Item)
item_14 = ListItem(List=panel_3, Index=windowpatternsouth2_2, Wrap=True)  # -> graft(Item)
item_15 = ListItem(List=panel_3, Index=windowpatternwest1_2, Wrap=True)  # -> graft(Item)
item_16 = ListItem(List=panel_3, Index=windowpatternwest2_2, Wrap=True)  # -> graft(Item)
parameter_8 = ConstructParameter(Name="Entrance", Value=list_4)
parameter_9 = ConstructParameter(Name="Window", Value=list_3)
merge = Merge(Data2=parameter_2, Data3=parameter_3)
parameter_10 = ConstructParameter(Name="Entrance", Value=item)
parameter_11 = ConstructParameter(Name="Entrance", Value=item_2)
parameter_12 = ConstructParameter(Name="Entrance", Value=item_3)
parameter_13 = ConstructParameter(Name="Entrance", Value=item_4)
parameter_14 = ConstructParameter(Name="Entrance", Value=item_5)
parameter_15 = ConstructParameter(Name="Entrance", Value=item_6)
parameter_16 = ConstructParameter(Name="Entrance", Value=item_7)
parameter_17 = ConstructParameter(Name="Entrance", Value=item_8)
parameter_18 = ConstructParameter(Name="Window", Value=item_9)
parameter_19 = ConstructParameter(Name="Window", Value=item_10)
parameter_20 = ConstructParameter(Name="Window", Value=item_11)
parameter_21 = ConstructParameter(Name="Window", Value=item_12)
parameter_22 = ConstructParameter(Name="Window", Value=item_13)
parameter_23 = ConstructParameter(Name="Window", Value=item_14)
parameter_24 = ConstructParameter(Name="Window", Value=item_15)
parameter_25 = ConstructParameter(Name="Window", Value=item_16)
list_5 = ValueList({"Front", "Right", "Bottom", "Left"}, selected="Bottom")
commonmirror = Parameter([parameter_5, merge])
common = Parameter(merge)
numberoffloors = ClusterInput()
bridge = ClusterInput()
xy = XYPlane(Origin=Point(0, 0, 0))
numberoffloors_2 = Integer(numberoffloors)
dup = DuplicateData(Data=graft(common), Number=numberoffloors_2, Order=True)
dup_2 = DuplicateData(Data=graft(commonmirror), Number=numberoffloors_2, Order=True)
bridge_2 = Text(bridge)
trim = TrimTree(Tree=dup, Depth=1)
trim_2 = TrimTree(Tree=dup_2, Depth=1)
flip = FlipMatrix(Data=trim)
flip_2 = FlipMatrix(Data=trim_2)
series = Series(Start=0, Step=1, Count=numberoffloors_2)
link = ConstructLink(Ports="Door")
merge_2 = Merge(Data1=flip)
merge_3 = Merge(Data1=flip_2)
trim_3 = TrimTree(Tree=series, Depth=1)
parameter_26 = ConstructParameter(Name="Floor", Value=trim_3)  # -> graft(Parameter)
parameter_27 = ConstructParameter(Name="SplitLevel", Value="1")
parameter_28 = ConstructParameter(Name="SplitLevel", Value="2")
parameter_29 = ConstructParameter(Name="SplitLevel", Value="1")
parameter_30 = ConstructParameter(Name="Door", Value="1")
parameter_31 = ConstructParameter(Name="Door", Value="2")
parameter_32 = ConstructParameter(Name="Door", Value="3")
parameter_33 = ConstructParameter(Name="Floors", Value=numberoffloors_2)
parameter_34 = ConstructParameter(Name="FloorHeight", Value=Slider(275, range=0..1000))
parameter_35 = ConstructParameter(Name="Width", Value=Slider(550, range=0..1000))
parameter_36 = ConstructParameter(Name="SecondDoor", Value="1")
parameter_37 = ConstructParameter(Name="Bridge", Value=bridge_2)
prot = RotatePlane(Plane=xy, Angle=degrees("180"))
prot_2 = RotatePlane(Plane=xy, Angle=degrees("-90"))
prot_3 = RotatePlane(Plane=xy, Angle=degrees("90"))
expression = Expression(x=parameter_29, y=parameter_26, Expression="x")
expression_2 = Expression(x=parameter_30, y=parameter_26, Expression="x")
expression_3 = Expression(x=parameter_28, y=parameter_26, Expression="x")
expression_4 = Expression(x=parameter_27, y=parameter_26, Expression="x")
expression_5 = Expression(x=parameter_31, y=parameter_26, Expression="x")
expression_6 = Expression(x=parameter_32, y=parameter_26, Expression="x")
merge_4 = Merge(Data1=merge_3, Data2=parameter_10, Data3=parameter_18)
merge_5 = Merge(Data1=merge_3, Data2=parameter_14, Data3=parameter_22)
merge_6 = Merge(Data1=merge_2, Data2=parameter_11, Data3=parameter_19)
merge_7 = Merge(Data1=merge_3, Data2=parameter_16, Data3=parameter_24)
plan = ConstructPlan(Uri=concat_2, Parameters=[parameter_35, parameter_37, parameter_33, parameter_34, parameter_36])  # -> Plan, Hash
merge_8 = Merge(Data1=merge_2, Data2=parameter_13, Data3=parameter_21)
merge_9 = Merge(Data1=merge_3, Data2=parameter_12, Data3=parameter_20)
merge_10 = Merge(Data1=merge_2, Data2=parameter_17, Data3=parameter_25)
merge_11 = Merge(Data1=merge_2, Data2=parameter_15, Data3=parameter_23)
link_2 = ConstructLink(Bias=[parameter_26, expression_3])
link_3 = ConstructLink(Bias=[parameter_26, expression_4, expression_2])
link_4 = ConstructLink(Bias=[parameter_26, expression_5])
link_5 = ConstructLink(Bias=[parameter_26, expression])
plan_2 = ConstructPlan(Uri=concat_4, Parameters=merge_4)  # -> Plan, Hash
sobject = ConstructSobject(Plan=plan.Plan)
link_6 = ConstructLink(Bias=[parameter_26, expression_5, expression_2])
link_7 = ConstructLink(Bias=[parameter_26, expression_6])
plan_3 = ConstructPlan(Uri=concat_4, Parameters=merge_6)  # -> Plan, Hash
link_8 = ConstructLink(Bias=parameter_26)
plan_4 = ConstructPlan(Uri=concat_4, Parameters=merge_11)  # -> Plan, Hash
plan_5 = ConstructPlan(Uri=concat_4, Parameters=merge_10)  # -> Plan, Hash
plan_6 = ConstructPlan(Uri=concat_4, Parameters=merge_9)  # -> Plan, Hash
plan_7 = ConstructPlan(Uri=concat_4, Parameters=merge_8)  # -> Plan, Hash
plan_8 = ConstructPlan(Uri=concat_4, Parameters=merge_5)  # -> Plan, Hash
link_9 = ConstructLink(Bias=[parameter_26, expression_2, expression_3])
plan_9 = ConstructPlan(Uri=concat_4, Parameters=merge_7)  # -> Plan, Hash
connectable = ConstructConnectable(Sobject=sobject, Link=link_2)
sobject_2 = ConstructSobject(Plan=plan_2.Plan)
connectable_2 = ConstructConnectable(Sobject=sobject, Link=link_3)
sobject_3 = ConstructSobject(Plan=plan_3.Plan)
connectable_3 = ConstructConnectable(Sobject=sobject, Link=link_4)
connectable_4 = ConstructConnectable(Sobject=sobject, Link=link_5)
run = Boolean(Toggle(False))
sobject_4 = ConstructSobject(Pose=prot_2, Plan=plan_6.Plan)
sobject_5 = ConstructSobject(Pose=prot_2, Plan=plan_7.Plan)
sobject_6 = ConstructSobject(Pose=prot, Plan=plan_8.Plan)
connectable_5 = ConstructConnectable(Sobject=sobject, Link=link_6)
connectable_6 = ConstructConnectable(Sobject=sobject, Link=link_7)
server = Text("http://localhost:2999")
sobject_7 = ConstructSobject(Pose=prot_3, Plan=plan_5.Plan)
sobject_8 = ConstructSobject(Pose=prot, Plan=plan_4.Plan)
connectable_7 = ConstructConnectable(Sobject=sobject, Link=link_8)
sobject_9 = ConstructSobject(Pose=prot_3, Plan=plan_9.Plan)
connectable_8 = ConstructConnectable(Sobject=sobject, Link=link_9)
connectable_9 = ConstructConnectable(Sobject=sobject_2, Link=link)
connectable_10 = ConstructConnectable(Sobject=sobject_3, Link=link)
connection = ConstructConnection(Connecting=connectable_9, Connected=connectable)
connection_2 = ConstructConnection(Connecting=connectable_10, Connected=connectable_2)
connectable_11 = ConstructConnectable(Sobject=sobject_5, Link=link)
connectable_12 = ConstructConnectable(Sobject=sobject_4, Link=link)
connectable_13 = ConstructConnectable(Sobject=sobject_6, Link=link)
connection_3 = ConstructConnection(Connecting=connectable_13, Connected=connectable_3)
connection_4 = ConstructConnection(Connecting=connectable_12, Connected=connectable_4)
connectable_14 = ConstructConnectable(Sobject=sobject_8, Link=link)
connectable_15 = ConstructConnectable(Sobject=sobject_7, Link=link)
connection_5 = ConstructConnection(Connecting=connectable_14, Connected=connectable_5)
connection_6 = ConstructConnection(Connecting=connectable_11, Connected=connectable_6)
connectable_16 = ConstructConnectable(Sobject=sobject_9, Link=link)
connection_7 = ConstructConnection(Connecting=connectable_16, Connected=connectable_7)
connection_8 = ConstructConnection(Connecting=connectable_15, Connected=connectable_8)
trim_4 = TrimTree(Tree=sobject_2, Depth=1)
trim_5 = TrimTree(Tree=sobject_4, Depth=1)
trim_6 = TrimTree(Tree=sobject_3, Depth=1)
trim_7 = TrimTree(Tree=sobject_6, Depth=1)
trim_8 = TrimTree(Tree=sobject_9, Depth=1)
trim_9 = TrimTree(Tree=sobject_7, Depth=1)
trim_10 = TrimTree(Tree=sobject_8, Depth=1)
trim_11 = TrimTree(Tree=sobject_5, Depth=1)
trim_12 = TrimTree(Tree=connection, Depth=1)
trim_13 = TrimTree(Tree=connection_3, Depth=1)
trim_14 = TrimTree(Tree=connection_4, Depth=1)
trim_15 = TrimTree(Tree=connection_2, Depth=1)
trim_16 = TrimTree(Tree=connection_5, Depth=1)
trim_17 = TrimTree(Tree=connection_6, Depth=1)
trim_18 = TrimTree(Tree=connection_7, Depth=1)
trim_19 = TrimTree(Tree=connection_8, Depth=1)
merge_12 = Merge(Data1=trim_4, Data2=trim_5, Data3=trim_7, Data4=trim_8)
merge_13 = Merge(Data1=trim_6, Data2=trim_9, Data3=trim_10, Data4=trim_11)
merge_14 = Merge(Data1=trim_12, Data2=trim_18, Data4=trim_13, Data5=trim_14)
merge_15 = Merge(Data1=trim_15, Data2=trim_19, Data3=trim_16, Data4=trim_17)
merge_16 = Merge(Data1=merge_12, Data2=merge_13)
fjs = FormatJsonString(JSONString=link_5)
merge_17 = Merge(Data1=merge_14, Data2=merge_15)
merge_18 = Merge(Data1=sobject, Data2=merge_16)
merge_19 = Merge(Data1=merge_17)
panel_4 = Panel(fjs)
C = Connection(merge_19)
so = Sobject(merge_18)
layout = ConstructLayout(Sobjects=merge_18, Connections=merge_19, Assembly=sobject)
C_2 = ClusterOutput(C)
so_2 = ClusterOutput(so)
layout_design = LayoutDesign(Url=server, Layout=layout, Run=run)
design = ShowDesign(Design=layout_design, Concepts="All")
design_2 = ShowDesign(Design=layout_design, Concepts="Doors")
dedesign = DeconstructDesign(Design=layout_design)  # -> Prototypes, Elements

# ==== cluster Cluster
geo = ClusterInput()
T = ClusterInput()
T_2 = ClusterInput()
T_3 = ClusterInput()
geo_2 = Geometry(geo)

area = Area(Geometry=geo_2)  # -> Area, Centroid
move = Move(Geometry=geo_2, Motion=T_3)  # -> Geometry, Transform
trim = TrimTree(Tree=move.Geometry, Depth=1)
item = ListItem(List=trim, Index=0, Wrap=True)  # -> Item, Item1, Item2
move_2 = Move(Geometry=item.Item, Motion=T_2)  # -> Geometry, Transform
move_3 = Move(Geometry=item.Item2, Motion=T)  # -> Geometry, Transform
merge = Merge(Data1=move_2.Geometry, Data2=item.Item1, Data3=move_3.Geometry)
match = MatchTree(Tree=graft(merge), Guide=geo_2)
geo_3 = Geometry(match)
geo_4 = ClusterOutput(geo_3)

tstat = TreeStatistics(Tree=geo_2)  # -> Paths, Length, Count
item_2 = ListItem(List=tstat.Paths, Index=0, Wrap=True)  # -> Item, Item1, Item2
merge_2 = Merge(Data1=move_2.Transform, Data2=move_3.Transform)  # -> graft(Result)
merge_3 = Merge(Data1=item_2.Item, Data3=item_2.Item2)
relblbrch = RelabelBranches(TreeToMatch=merge_2, ListOfPaths=merge_3)  # -> RelabeledTree; inputs TreeToMatch: tree, ListOfPaths: list
# ---------- relblbrch: Python ----------
if ghenv.Component.RunCount<2:
    __author__ = "Your name"
    __version__ = "2000.00.00"
    
    ghenv.Component.Name = "RelabelBranches"
    ghenv.Component.NickName = "ReLblBrch"
    ghenv.Component.Description = "Relabel all the paths of the branches with a list of new paths. The amount of branches must match with the size of the list of pahts"
    ghenv.Component.Message = "VER 1.0"
    
    ghenv.Component.Params.Input[0].NickName = "TreeToMatch"
    ghenv.Component.Params.Input[1].NickName = "ListOfPaths"
    
    ghenv.Component.Params.Input[0].Description = "Tree that should be relabeled."
    ghenv.Component.Params.Input[1].Description = "List of paths to use for new branch paths."
    
    ghenv.Component.Params.Output[0].NickName = "RelabeledTree"
    ghenv.Component.Params.Output[0].Description = "Relabeled tree where all the paths of the branches have been replaced with new paths."

from System import Object
from Grasshopper import DataTree

def relabelBranchesWithLstOfPths (tree, paths):
    newTree = DataTree[Object]()
    for i,path in enumerate(tree.Paths):
        items = tree.Branch(path)
        for data in items:
            newTree.Add(data,paths[i])
    return newTree

if __name__ == "__main__":
    RelabeledTree = relabelBranchesWithLstOfPths(TreeToMatch,ListOfPaths)
# ---------- end relblbrch ----------
merge_4 = Merge(Data1=item_2.Item, Data3=item_2.Item2)
merge_5 = Merge(Data1=move.Transform, Data2=relblbrch)
transform = Transform(merge_5)
transform_2 = ClusterOutput(transform)

transform_3 = Transform(Geometry=area.Centroid, Transform=move.Transform)
trim_2 = TrimTree(Tree=transform_3, Depth=1)
item_3 = ListItem(List=trim_2, Index=0, Wrap=True)  # -> Item, Item1, Item2
transform_4 = Transform(Geometry=item_3.Item, Transform=move_2.Transform)
transform_5 = Transform(Geometry=item_3.Item2, Transform=move_3.Transform)
merge_6 = Merge(Data1=transform_4, Data3=transform_5)  # -> graft(Result)

relblbrch_2 = RelabelBranches(TreeToMatch=merge_6, ListOfPaths=merge_4)  # -> RelabeledTree; inputs TreeToMatch: tree, ListOfPaths: list; same code as relblbrch

merge_7 = Merge(Data1=area.Centroid, Data2=transform_3, Data3=relblbrch_2)
pt = Point(merge_7)
pt_2 = ClusterOutput(pt)
