# Grasshopper definition nakagincapsuletower.gh (Grasshopper 1.0.7)
# plug-ins: semio, LunchBox, Human, MetaHopper, Pufferfish, gh_sofistik, Swiftlet, Pancake

panel = Panel("C:\git\semio\examples\capsuletower")
pcghfilepath = DefinitionPath(LastSaveLocalization="neutral,N")  # -> Directory, Name, DirectorySeparator
genes = GenePool(Decimals=0, Maximum=20, Minimum=0, Value=[2, 5, 8])
number_slider = Slider(9, range=1..20)
number_slider_2 = Slider(11, range=1..20)
toggle = BooleanToggle(False)
toggle_2 = BooleanToggle(True)
number_slider_3 = Slider(9, range=1..20)
number_slider_4 = Slider(11, range=1..20)
toggle_3 = BooleanToggle(True)
toggle_4 = BooleanToggle(False)
merge = Merge(
    Data1=toggle_2,
    Data2=toggle,
    Data3=toggle,
    Data4=toggle,
    Data5=toggle_2,
    Data6=toggle_2,
    Data7=toggle,
    Data8=toggle_2,
    Data9=toggle,
    Data10=toggle_2)
repeat = RepeatData(Data=Toggle(False), Length=number_slider)
repeat_2 = RepeatData(Data=Toggle(False), Length=number_slider_2)
repeat_3 = RepeatData(Data=Toggle(False), Length=number_slider_3)
repeat_4 = RepeatData(Data=Toggle(False), Length=number_slider_4)
concat = Concatenate(FragmentA=pcghfilepath.Directory, FragmentB="\", FragmentC="base.gh")

# ---- group: base
sobject = ConstructSobject(Plan=concat)
link = ConstructLink(Ports="Primary")
link_2 = ConstructLink(Ports="Secondary")
connectable = ConstructConnectable(Sobject=sobject, Link=link)
connectable_2 = ConstructConnectable(Sobject=sobject, Link=link_2)

sobject_2 = ConstructSobject(Plan=concat)
link_3 = ConstructLink(Ports="Primary")
link_4 = ConstructLink(Ports="Secondary")
connectable_3 = ConstructConnectable(Sobject=sobject_2, Link=link_3)
connectable_4 = ConstructConnectable(Sobject=sobject_2, Link=link_4)

# ----
concat_2 = Concatenate(FragmentA=pcghfilepath.Directory, FragmentB="\", FragmentC="shaft.gh")
concat_3 = Concatenate(FragmentA=pcghfilepath.Directory, FragmentB="\", FragmentC="capital.gh")

# ---- group: primary shaft captial
xy = XYPlane(Origin=Point(0, 0, 0))
prot = RotatePlane(Plane=xy, Angle=degrees("-90"))
plan = ConstructPlan(Uri=concat_3)  # -> Plan, Hash
sobject_3 = ConstructSobject(Pose=prot, Plan=plan.Plan)

xy_2 = XYPlane(Origin=Point(0, 0, 0))
prot_2 = RotatePlane(Plane=xy_2, Angle=degrees("-90"))
plan_2 = ConstructPlan(Uri=concat_3)  # -> Plan, Hash
sobject_4 = ConstructSobject(Pose=prot_2, Plan=plan_2.Plan)

# ----
concat_4 = Concatenate(FragmentA=pcghfilepath.Directory, FragmentB="\", FragmentC="capsule.gh")
concat_5 = Concatenate(FragmentA=pcghfilepath.Directory, FragmentB="\", FragmentC="bridge.gh")
merge_2 = Merge(
    Data1=toggle_4,
    Data2=toggle_3,
    Data3=toggle_3,
    Data4=toggle_4,
    Data5=toggle_3,
    Data6=toggle_4,
    Data7=toggle_4,
    Data8=toggle_4,
    Data9=toggle_3)
invbool = InvertBoolean(Boolean=merge)  # -> Inverted, Number
trim = TrimTree(Tree=repeat, Depth=1)
sobject_5 = ConstructSobject(Pose=prot, Plan=plan.Plan)
trim_2 = TrimTree(Tree=repeat_2, Depth=1)
trim_3 = TrimTree(Tree=repeat_3, Depth=1)
sobject_6 = ConstructSobject(Pose=prot_2, Plan=plan_2.Plan)
trim_4 = TrimTree(Tree=repeat_4, Depth=1)
invbool_2 = InvertBoolean(Boolean=trim_2)  # -> Inverted, Number
invbool_3 = InvertBoolean(Boolean=trim)  # -> Inverted, Number
merge_3 = Merge(
    Data1=toggle_4,
    Data2=toggle_4,
    Data3=toggle_4,
    Data4=toggle_4,
    Data5=toggle_4,
    Data6=toggle_4,
    Data7=toggle_4,
    Data8=toggle_3,
    Data9=toggle_3)
merge_4 = Merge(Data1=merge, Data2=toggle)
merge_5 = Merge(Data1=invbool.Inverted, Data2=toggle)
invbool_4 = InvertBoolean(Boolean=merge_2)  # -> Inverted, Number
list = ValueList({"Front", "Right", "Bottom", "Left"}, selected="Bottom")
list_2 = ValueList({"Front", "Right", "Bottom", "Left"}, selected="Bottom")
list_3 = ValueList({"Front", "Right", "Bottom", "Left"}, selected="Bottom")
list_4 = ValueList({"Front", "Right", "Bottom", "Left"}, selected="Bottom")
merge_6 = Merge(Data1=sobject_3, Data2=sobject_5)
merge_7 = Merge(Data1=sobject_4, Data2=sobject_6)
concat_6 = Concatenate(FragmentA=pcghfilepath.Directory, FragmentB="\", FragmentC="bouleenewtoncapsule.gh")
capsuletower = CapsuleTower(
    shafturi=concat_2,
    capsuleuri=concat_4,
    bridgeuri=concat_5,
    numberoffloors=number_slider_2,
    bridge=list,
    bridgelevels=genes,
    largetower=Toggle(True),
    entrancepatternnorth1=merge_4,
    entrancepatternfront2=trim_2,
    entrancepatterneast1=invbool_2.Inverted,
    entrancepatterneast2=invbool_2.Inverted,
    entrancepatternsouth1=trim_2,
    entrancepatternsouth2=trim_2,
    entrancepatternwest1=invbool_2.Inverted,
    entrancepatternwest2=merge_5,
    windowpatternnorth1=trim_2,
    windowpatternfront2=trim_2,
    windowpatterneast1=trim_2,
    windowpatterneast2=trim_2,
    windowpatternsouth1=trim_2,
    windowpatternsouth2=invbool_2.Inverted,
    windowpatternwest1=invbool_2.Inverted,
    windowpatternwest2=trim_2)  # -> so_2, C_2
capsuletower_2 = CapsuleTower(
    shafturi=concat_2,
    capsuleuri=concat_4,
    numberoffloors=number_slider,
    bridge=list_2,
    bridgelevels=genes,
    largetower=Toggle(False),
    entrancepatternnorth1=trim,
    entrancepatternfront2=merge_2,
    entrancepatterneast1=invbool_4.Inverted,
    entrancepatterneast2=trim,
    entrancepatternsouth1=invbool_3.Inverted,
    entrancepatternsouth2=trim,
    entrancepatternwest1=invbool_3.Inverted,
    entrancepatternwest2=invbool_3.Inverted,
    windowpatternnorth1=trim,
    windowpatternfront2=trim,
    windowpatterneast1=trim,
    windowpatterneast2=trim,
    windowpatternsouth1=merge_3,
    windowpatternsouth2=trim,
    windowpatternwest1=trim,
    windowpatternwest2=trim)  # -> so_2, C_2
capsuletower_3 = CapsuleTower(
    shafturi=concat_2,
    capsuleuri=concat_4,
    numberoffloors=number_slider_4,
    bridge=list_3,
    entrancepatternnorth1=trim_4,
    entrancepatternfront2=trim_4,
    entrancepatterneast1=trim_4,
    entrancepatterneast2=trim_4,
    entrancepatternsouth1=trim_4,
    entrancepatternsouth2=trim_4,
    entrancepatternwest1=trim_4,
    entrancepatternwest2=trim_4,
    windowpatternnorth1=trim_4,
    windowpatternfront2=trim_4,
    windowpatterneast1=trim_4,
    windowpatterneast2=trim_4,
    windowpatternsouth1=trim_4,
    windowpatternsouth2=trim_4,
    windowpatternwest1=trim_4,
    windowpatternwest2=trim_4)  # -> so_2, C_2
capsuletower_4 = CapsuleTower(
    shafturi=concat_2,
    capsuleuri=concat_4,
    numberoffloors=number_slider_3,
    bridge=list_4,
    entrancepatternnorth1=trim_3,
    entrancepatternfront2=trim_3,
    entrancepatterneast1=trim_3,
    entrancepatterneast2=trim_3,
    entrancepatternsouth1=trim_3,
    entrancepatternsouth2=trim_3,
    entrancepatternwest1=trim_3,
    entrancepatternwest2=trim_3,
    windowpatternnorth1=trim_3,
    windowpatternfront2=trim_3,
    windowpatterneast1=trim_3,
    windowpatterneast2=trim_3,
    windowpatternsouth1=trim_3,
    windowpatternsouth2=trim_3,
    windowpatternwest1=trim_3,
    windowpatternwest2=trim_3)  # -> so_2, C_2
geo = Geometry(Tree({0}: [{Plane=PlaneXY(-675, -725, 750), X=Domain(-275, 275), Y=Domain(-275, 275), Z=Domain(0, 2750)}], {1}: [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], {2}: [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], {3}: [{Plane=PlaneXY(-1875, -725, 750), X=Domain(-275, 275), Y=Domain(-275, 275), Z=Domain(0, 3300)}], {4}: [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], {5}: [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], {6}: [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], {7}: [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], {8}: [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], {9}: [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]))
txt = Text("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")
cluster = Cluster_2(D=txt)  # -> geo_2, planhash_2, centroid_2
number_slider_5 = Slider(11, range=0..100)
item = ListItem(List=capsuletower.so_2, Index=0, Wrap=True)
item_2 = ListItem(List=capsuletower_2.so_2, Index=0, Wrap=True)
merge_8 = Merge(Data1=sobject, Data2=item, Data3=item_2, Data4=sobject_5, Data5=sobject_3)
item_3 = ListItem(List=capsuletower_3.so_2, Index=0, Wrap=True)
item_4 = ListItem(List=capsuletower_4.so_2, Index=0, Wrap=True)
link_5 = ConstructLink(Ports="Top")
link_6 = ConstructLink(Ports="Bottom")
lito3p = ListInto3Parts(ListToSlice=flatten(cluster.centroid_2), StartIndex="0", EndIndex="-1")  # -> FilteredList, ItemsBefore, ItemsAfter; inputs ListToSlice: tree, StartIndex: tree of Int32, EndIndex: tree of Int32
# ---------- lito3p: Python ----------
if ghenv.Component.RunCount<2:
    __author__ = "Ueli Saluz"
    __version__ = "2020.05.28"
    
    ghenv.Component.Name = "ListInto3Parts"
    ghenv.Component.NickName = "LiTo3P"
    ghenv.Component.Description = "Slice list into 3 parts. All lists are sliced with the same indices. End index = 0 = length(list)."
    ghenv.Component.Message = "VER 1.6"

from System import Object
from Grasshopper import DataTree

def filterList(listToFilter,startIndex,endIndex):
    # Return: FilteredList, Before, After
    if (((startIndex == 0) or (startIndex is None)) and ((endIndex == 0) or (endIndex is None))) or (endIndex <= startIndex and endIndex > 0):
        return (listToFilter,None,None)
    elif (startIndex == 0) or (startIndex is None):
        return (listToFilter[:endIndex],None,listToFilter[endIndex:])
    elif (endIndex == 0) or (endIndex is None):
        print 1
        return (listToFilter[:startIndex],listToFilter[startIndex:],None)
    else:
        return (listToFilter[startIndex:endIndex],listToFilter[:startIndex],listToFilter[endIndex:])

if __name__ == "__main__":
    FilteredList = DataTree[Object]()
    ItemsBefore = DataTree[Object]()
    ItemsAfter = DataTree[Object]()
    
    for path in ListToSlice.Paths:
        listBranch = ListToSlice.Branch(path)
        pyList = list(listBranch)   #Convert .Net List to Python
        try: #terrible way of writing code but if I set the list to list access the performance decreases massivly due to many calls
            startIndex = StartIndex.Branch(path)
            startIndex = startIndex[0]
        except Exception:
            try:
                startIndex = StartIndex.Branch(0)
                startIndex = startIndex[0]
            except Exception:
                startIndex = 0
        try:
            endIndex = EndIndex.Branch(path)
            endIndex = endIndex[0]
        except Exception:
            try:
                endIndex = EndIndex.Branch(0)
                endIndex = endIndex[0]
            except Exception:
                endIndex = len(pyList)
        filtList=filterList(pyList,startIndex,endIndex)
        if filtList[0]:
            FilteredList.AddRange(filtList[0],path)
        if filtList[1]:
            ItemsBefore.AddRange(filtList[1],path)
        if filtList[2]:
            ItemsAfter.AddRange(filtList[2],path)
# ---------- end lito3p ----------
run = Boolean(Toggle(True))
server = Text("http://localhost:2999")
clrcache = ClearCache(Run=Button())
link_7 = ConstructLink(Ports="Top")
link_8 = ConstructLink(Ports="Bottom")
dup = DuplicateData(Data=concat_4, Number=Slider(10, range=0..10), Order=True)
connectable_5 = ConstructConnectable(Sobject=item, Link=link_5)
connectable_6 = ConstructConnectable(Sobject=item, Link=link_6)
connectable_7 = ConstructConnectable(Sobject=item_2, Link=link_5)
connectable_8 = ConstructConnectable(Sobject=item_2, Link=link_6)
trim_5 = TrimTree(Tree=dup, Depth=1)
connectable_9 = ConstructConnectable(Sobject=item_3, Link=link_7)
connectable_10 = ConstructConnectable(Sobject=item_3, Link=link_8)
connectable_11 = ConstructConnectable(Sobject=item_4, Link=link_7)
connectable_12 = ConstructConnectable(Sobject=item_4, Link=link_8)
connection = ConstructConnection(Connecting=connectable_6, Connected=connectable)
connection_2 = ConstructConnection(Connecting=sobject_3, Connected=connectable_5)
connection_3 = ConstructConnection(Connecting=sobject_5, Connected=connectable_7)
fjs = FormatJsonString(JSONString=connection_3)
connection_4 = ConstructConnection(Connecting=connectable_8, Connected=connectable_2)
merge_9 = Merge(Data1=connection, Data2=connection_4, Data3=connection_2, Data4=connection_3)
layout = ConstructLayout(Sobjects=merge_8, Connections=merge_9, Assembly=sobject)
sobject_7 = ConstructSobject(Plan=trim_5)
layout_design = LayoutDesign(Url=server, Layout=layout, Run=Toggle(False))
connection_5 = ConstructConnection(Connecting=connectable_10, Connected=connectable_3)
connection_6 = ConstructConnection(Connecting=sobject_4, Connected=connectable_9)
connection_7 = ConstructConnection(Connecting=sobject_6, Connected=connectable_11)
connection_8 = ConstructConnection(Connecting=connectable_12, Connected=connectable_4)
panel_2 = Panel("Windows")
pt = Point(lito3p.FilteredList)
item_5 = ListItem(List=sobject_7, Index=0, Wrap=True)
so = Sobject(item_3)
C = Connection()
merge_10 = Merge(Data1=connection_2, Data2=connection_3)
merge_11 = Merge(Data1=connection, Data2=connection_4)
pdecon = Deconstruct(Point=pt)  # -> XComponent, YComponent, ZComponent
design = ShowDesign(Design=layout_design, Concepts="All")
dedesign = DeconstructDesign(Design=layout_design)  # -> Prototypes, Elements
merge_12 = Merge(Data1=connection_6, Data2=connection_7)
merge_13 = Merge(Data1=connection_5, Data2=connection_8)
design_2 = ShowDesign(Design=layout_design, Concepts="Simple")
design_3 = ShowDesign(Design=layout_design, Concepts="Volume")
design_4 = ShowDesign(Design=layout_design, Concepts="Doors")
layout_2 = ConstructLayout(Sobjects=sobject_7, Assembly=item_5)
merge_14 = Merge(Data1=sobject, Data2=capsuletower.so_2, Data3=capsuletower_2.so_2, Data4=merge_6)
minmax = MinimumMaximum(L=flatten(pdecon.ZComponent))  # -> Max, MaxI, Min, MinI; inputs L: list
# ---------- minmax: Python ----------
#Component Information
#--------------------------------------------------------------------------------------------
if ghenv.Component.RunCount<2:
    #General
    #--------------------------------------------------------------------------------------------
    __author__ = "Ueli Saluz"
    __version__ = "2022.04.22"
    
    ghenv.Component.Name = "MinimumMaximum"
    ghenv.Component.NickName = "MinMax"
    ghenv.Component.Description = "Returns the maximum and mininum of a list and their corresponding index."
    ghenv.Component.Message = "VER 1.0"
    ghenv.Component.Category = "Maths"
    ghenv.Component.SubCategory = "Util"
    
     #Inputs
    #--------------------------------------------------------------------------------------------
    inputIndex=0
    
    ghenv.Component.Params.Input[inputIndex].Name = "L"
    ghenv.Component.Params.Input[inputIndex].NickName = "L"
    ghenv.Component.Params.Input[inputIndex].Description = "A list of numbers."
    ghenv.Component.Params.Input[inputIndex].Optional = False
    inputIndex+=1
    
    
    #Outputs
    #--------------------------------------------------------------------------------------------
    outputIndex=0
    
    ghenv.Component.Params.Output[outputIndex].Name = "Max"
    ghenv.Component.Params.Output[outputIndex].NickName = "Max"
    ghenv.Component.Params.Output[outputIndex].Description = "Maximum of the list"
    outputIndex+=1
    
    ghenv.Component.Params.Output[outputIndex].Name = "MaxI"
    ghenv.Component.Params.Output[outputIndex].NickName = "MaxI"
    ghenv.Component.Params.Output[outputIndex].Description = "Index of the maximum of the list"
    outputIndex+=1
    
    ghenv.Component.Params.Output[outputIndex].Name = "Min"
    ghenv.Component.Params.Output[outputIndex].NickName = "Min"
    ghenv.Component.Params.Output[outputIndex].Description = "Minimum of the list"
    outputIndex+=1
    
    ghenv.Component.Params.Output[outputIndex].Name = "MinI"
    ghenv.Component.Params.Output[outputIndex].NickName = "MinI"
    ghenv.Component.Params.Output[outputIndex].Description = "Index of the minimum of the list"
    outputIndex+=1


#Solver - Run with trees to enhance performance drastically
#--------------------------------------------------------------------------------------------
if __name__ == "__main__":
    
    maximum = max(L)
    MaxI = L.index(maximum)
    Max = maximum
    
    minimum = min(L)
    MinI = L.index(minimum)
    Min = minimum
# ---------- end minmax ----------
deprototype = DeconstructPrototype(Prototype=dedesign.Prototypes)  # -> PlanHash, Representations, Description
merge_15 = Merge(Data1=merge_11, Data2=capsuletower.C_2, Data3=capsuletower_2.C_2, Data4=merge_10)
layout_3 = ConstructLayout(Sobjects=capsuletower_2.so_2, Connections=capsuletower_2.C_2, Assembly=item_2)
layout_design_2 = LayoutDesign(Url=server, Layout=layout_2, Run=Toggle(False))
merge_16 = Merge(Data1=design_2, Data2=design_3, Data3=design_4, Data4=design)
panel_3 = Panel("E:\Nextcloud\UserData\Documents\Arbeit\Papers\semio_meta-model\Conference-Paper\Figures\DesignStory\nakagincapsuletowerv1.json")
merge_17 = Merge(Data1=merge_13, Data2=capsuletower_3.C_2, Data3=capsuletower_4.C_2, Data4=merge_12)
merge_18 = Merge(Data1=sobject_2, Data2=capsuletower_3.so_2, Data3=capsuletower_4.so_2, Data4=merge_7)
layout_4 = ConstructLayout(Sobjects=capsuletower_4.so_2, Connections=capsuletower_4.C_2, Assembly=item_4)
design_5 = ShowDesign(Design=layout_design, Concepts="Doors")
division = Division(A="5", B=minmax.Max)
layout_5 = ConstructLayout(Sobjects=merge_14, Connections=merge_15, Assembly=sobject)
imrepresentation = ImportRepresentation(Representation=deprototype.Representations)
dedesign_2 = DeconstructDesign(Design=layout_design_2)  # -> Prototypes, Elements
Z = UnitZ(Factor=minmax.Max)
pt_2 = Point(Point(-929.7454531, -470.7667442, 0))
pt_3 = Point(Point(-415.8739084, -979.097009, 0))
design_6 = ShowDesign(Design=layout_design_2, Concepts="All")
Z_2 = UnitZ(Factor=minmax.Max)
pt_4 = Point(Point(-2142.538609, -460.3468825, 0))
pt_5 = Point(Point(-1618.316792, -980.7102546, 0))
layout_design_3 = LayoutDesign(Url=server, Layout=layout_5, Run=run)
layout_6 = ConstructLayout(Sobjects=merge_18, Connections=merge_17, Assembly=sobject_2)
move = Move(Geometry=pt_3, Motion=Z)  # -> Geometry, Transform
Z_3 = UnitZ(Factor=minmax.Max)
pt_6 = Point(Point(-1287.357385, -1357.609836, 0))
geo_2 = Geometry([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])
pt_7 = Point(Point(-2708.915589, -81.3058032, 0))
move_2 = Move(Geometry=pt_5, Motion=Z_2)  # -> Geometry, Transform
layout_design_4 = LayoutDesign(Url=server, Layout=layout_3, Run=Toggle(False))
design_7 = ShowDesign(Design=layout_design_3, Concepts="All")
txt_2 = Text("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")
move_3 = Move(Geometry=pt_6, Motion=Z_3)  # -> Geometry, Transform
box = Box2Pt(PointA=pt_2, PointB=move.Geometry, Plane=PlaneXY(0, 0, 0))
txt_3 = Text("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")
txt_4 = Text("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")
final = Text("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")
layout_design_5 = LayoutDesign(Url=server, Layout=layout_6, Run=Toggle(False))
design_8 = ShowDesign(Design=layout_design_3, Concepts="Simple")
box_2 = Box2Pt(PointA=pt_4, PointB=move_2.Geometry, Plane=PlaneXY(0, 0, 0))
fjs_2 = FormatJsonString(JSONString=txt_4)
wires = BrepWireframe(Brep=geo_2, Density=-1)
box_3 = Box2Pt(PointA=pt_7, PointB=move_3.Geometry, Plane=PlaneXY(0, 0, 0))
design_9 = ShowDesign(Design=layout_design_4, Concepts="All")
cluster_2 = Cluster_2(D=layout_design_3)  # -> geo_2, planhash_2, centroid_2
cluster_3 = Cluster_2(D=layout_design_3)  # -> geo_2, planhash_2, centroid_2
geo_3 = Geometry(cluster_3.geo_2)
panel_4 = Panel("""134
152
158""")
panel_5 = Panel("""3
4
6""")
textfile = TextFile(FilePath=panel_3, SOF_STREAM_CONTENT=True)
trim_6 = TrimTree(Tree=wires, Depth=1)
brepinc = PointInBrep(Brep=box_3, Point=pt, Strict=False)
dispatch = Dispatch(List=pt, DispatchPattern=flatten(brepinc))  # -> ListA, ListB
brepinc_2 = PointInBrep(Brep=box, Point=dispatch.ListB, Strict=False)
brepinc_3 = PointInBrep(Brep=box_2, Point=dispatch.ListA, Strict=False)
dispatch_2 = Dispatch(List=dispatch.ListA, DispatchPattern=flatten(brepinc_3))  # -> ListA, ListB
dispatch_3 = Dispatch(List=dispatch.ListB, DispatchPattern=flatten(brepinc_2))  # -> ListA, ListB
item_6 = ListItem(List=dispatch_3.ListA, Index=0, Wrap=True)  # -> Item, Item1
item_7 = ListItem(List=dispatch_2.ListA, Index=0, Wrap=True)  # -> Item, Item1
item_8 = ListItem(List=panel_4, Index=0, Wrap=True)  # -> Item, Item1, Item2
item_9 = ListItem(List=panel_5, Index=0, Wrap=True)  # -> Item, Item1, Item2
lng = ListLength(List=pt)
merge_19 = Merge(Data1=item_9.Item2, Data2=item_8.Item2)
merge_20 = Merge(Data1=item_7.Item, Data2=item_6.Item)
pdecon_2 = Deconstruct(Point=merge_20)  # -> XComponent, YComponent, ZComponent
merge_21 = Merge(Data1=dispatch_2.ListB, Data2=dispatch_3.ListB)
item_10 = CherryPicker(merge_21, ListIndex=134)
item_11 = ListItem(List=merge_21, Index=panel_5, Wrap=True)
item_12 = ListItem(List=merge_21, Index=panel_4, Wrap=True)
merge_22 = Merge(Data1=graft(item_11), Data2=graft(item_12))
merge_23 = Merge(Data1=item_7.Item1, Data2=item_6.Item1)
pdecon_3 = Deconstruct(Point=merge_23)  # -> XComponent, YComponent, ZComponent
lng_2 = ListLength(List=dispatch_2.ListB)
number_slider_6 = Slider(48, range=0..100)
avgp = AveragePoint(P=merge_22)  # -> flatten(AvP); inputs P: list of Point3d, M: list of Double; same code as avgp
subtraction = Subtraction(A=lng, B="109")
pt_8 = ConstructPoint(XCoordinate=pdecon_2.XComponent, YCoordinate=pdecon_2.YComponent, ZCoordinate=pdecon_3.ZComponent)
pdecon_4 = Deconstruct(Point=item_7.Item)  # -> XComponent, YComponent, ZComponent
pt_9 = Point(Point(-1272.966108, -730.9504084, 0))
pdecon_5 = Deconstruct(Point=pt_9)  # -> XComponent, YComponent, ZComponent
multiplication = Multiplication(A=avgp, B=division)  # -> flatten(Result)
multiplication_2 = Multiplication(A=pt_9, B=division)  # -> flatten(Result)
multiplication_3 = Multiplication(A=merge_21, B=division)  # -> flatten(Result)
multiplication_4 = Multiplication(A=merge_20, B=division)  # -> flatten(Result)
panel_6 = Panel(multiplication_4)
multiplication_5 = Multiplication(A=pt_8, B=division)  # -> flatten(Result)
pt_10 = ConstructPoint(XCoordinate=pdecon_4.XComponent, YCoordinate=pdecon_4.YComponent, ZCoordinate=pdecon_5.ZComponent)
expression = Expression(x="capsule", y=merge_21, Expression="x")
multiplication_6 = Multiplication(A=merge_21, B=division)  # -> flatten(Result)
multiplication_7 = Multiplication(A=merge_23, B=division)  # -> flatten(Result)
panel_7 = Panel("""14
15
16
35
36
37
38
39
40
42
43""")
cluster_4 = Cluster_3(pt=multiplication, attributes="bridge,fill=white", idprefix="br", content="\bridgeIcon")  # -> nodes_2, ids_2, idnums_2, locations_2, circles_2
cluster_5 = Cluster_3(pt=multiplication_5, attributes="capital", idprefix="cp", content="\capitalIcon")  # -> nodes_2, ids_2, idnums_2, locations_2, circles_2
multiplication_8 = Multiplication(A=pt_10, B=division)  # -> flatten(Result)
cluster_6 = Cluster_3(pt=multiplication_5, attributes="capital,newSobject", idprefix="cp", content="\capitalIcon")  # -> nodes_2, ids_2, idnums_2, locations_2, circles_2
cluster_7 = Cluster_3(pt=multiplication, attributes="bridge,newSobject", idprefix="br", content="\bridgeIcon")  # -> nodes_2, ids_2, idnums_2, locations_2, circles_2
cluster_8 = Cluster_3(pt=multiplication_3, attributes="capsule", idprefix="c", content="\capsuleIcon")  # -> nodes_2, ids_2, idnums_2, locations_2, circles_2
cluster_9 = Cluster_3(pt=multiplication_2, attributes="base", idprefix="b", content="\baseIcon")  # -> nodes_2, ids_2, idnums_2, locations_2, circles_2
cluster_10 = Cluster_3(pt=multiplication_4, attributes="shaft", idprefix="s", content="\shaftIcon")  # -> nodes_2, ids_2, idnums_2, locations_2, circles_2
cluster_11 = Cluster_3(pt=multiplication_4, attributes="shaft,newSobject", idprefix="s", content="\shaftIcon")  # -> nodes_2, ids_2, idnums_2, locations_2, circles_2
panel_8 = Panel("""109
110
111
116
117
120
121
122
123""")
points = PointList(Points=merge_21, Size=number_slider_6)
cluster_12 = Cluster_3(pt=multiplication_7, attributes="capital", idprefix="cp", content="\capitalIcon")  # -> nodes_2, ids_2, idnums_2, locations_2, circles_2
cluster_13 = Cluster_3(pt=multiplication_6, attributes="capsule,newSobject", idprefix="c", content="\capsuleIcon")  # -> nodes_2, ids_2, idnums_2, locations_2, circles_2
cluster_14 = Cluster_3(pt=multiplication_8, attributes="base", idprefix="b", content="\baseIcon")  # -> nodes_2, ids_2, idnums_2, locations_2, circles_2
item_13 = ListItem(List=merge_21, Index=panel_7, Wrap=True)
sph = Sphere(Base=item_13, Radius=number_slider_6)
item_14 = ListItem(List=merge_21, Index=panel_8, Wrap=True)
lito3p_2 = ListInto3Parts(ListToSlice=flatten(cluster_8.nodes_2), StartIndex=lng_2)  # -> FilteredList, ItemsBefore, ItemsAfter; inputs ListToSlice: tree, StartIndex: tree of Int32, EndIndex: tree of Int32; same code as lito3p
lito3p_3 = ListInto3Parts(ListToSlice=flatten(cluster_8.ids_2), StartIndex=lng_2)  # -> FilteredList, ItemsBefore, ItemsAfter; inputs ListToSlice: tree, StartIndex: tree of Int32, EndIndex: tree of Int32; same code as lito3p
panel_9 = Panel("""60
61
62
63
64
65
66
67
68
69
76""")
vec = VectorXYZ(XComponent=Slider(1, range=-10..10), YComponent=Slider(1, range=-10..10), ZComponent=Slider(-1, range=-10..10))  # -> Vector, Length
item_15 = ListItem(List=cluster_10.ids_2, Index=0, Wrap=True)  # -> Item, Item1
item_16 = ListItem(List=cluster_10.nodes_2, Index=0, Wrap=True)  # -> Item, Item1
item_17 = ListItem(List=cluster_5.ids_2, Index=0, Wrap=True)  # -> Item, Item1
item_18 = ListItem(List=cluster_5.nodes_2, Index=0, Wrap=True)  # -> Item, Item1
item_19 = ListItem(List=cluster_4.nodes_2, Index=0, Wrap=True)  # -> Item, Item1, Item2
item_20 = ListItem(List=cluster_4.ids_2, Index=0, Wrap=True)  # -> Item, Item1, Item2
item_21 = ListItem(List=cluster_7.nodes_2, Index=0, Wrap=True)  # -> Item, Item1, Item2
lito3p_4 = ListInto3Parts(ListToSlice=flatten(cluster_13.ids_2), StartIndex=lng_2)  # -> FilteredList, ItemsBefore, ItemsAfter; inputs ListToSlice: tree, StartIndex: tree of Int32, EndIndex: tree of Int32; same code as lito3p
item_22 = ListItem(List=cluster_10.ids_2, Index=0, Wrap=True)  # -> Item, Item1
item_23 = ListItem(List=cluster_10.nodes_2, Index=0, Wrap=True)  # -> Item, Item1
lito3p_5 = ListInto3Parts(ListToSlice=flatten(cluster_13.nodes_2), StartIndex=lng_2)  # -> FilteredList, ItemsBefore, ItemsAfter; inputs ListToSlice: tree, StartIndex: tree of Int32, EndIndex: tree of Int32; same code as lito3p
item_24 = ListItem(List=cluster_11.nodes_2, Index=0, Wrap=True)  # -> Item, Item1
item_25 = ListItem(List=cluster_10.ids_2, Index=0, Wrap=True)  # -> Item, Item1
item_26 = ListItem(List=cluster_11.ids_2, Index=0, Wrap=True)  # -> Item, Item1
item_27 = ListItem(List=cluster_5.nodes_2, Index=0, Wrap=True)  # -> Item, Item1
lito3p_6 = ListInto3Parts(ListToSlice=flatten(cluster_8.ids_2), StartIndex=lng_2)  # -> FilteredList, ItemsBefore, ItemsAfter; inputs ListToSlice: tree, StartIndex: tree of Int32, EndIndex: tree of Int32; same code as lito3p
item_28 = ListItem(List=cluster_6.nodes_2, Index=0, Wrap=True)  # -> Item, Item1
item_29 = ListItem(List=cluster_5.ids_2, Index=0, Wrap=True)  # -> Item, Item1
item_30 = ListItem(List=cluster_6.ids_2, Index=0, Wrap=True)  # -> Item, Item1
item_31 = ListItem(List=cluster_7.ids_2, Index=0, Wrap=True)  # -> Item, Item1, Item2
lito3p_7 = ListInto3Parts(ListToSlice=flatten(cluster_8.nodes_2), StartIndex=lng_2)  # -> FilteredList, ItemsBefore, ItemsAfter; inputs ListToSlice: tree, StartIndex: tree of Int32, EndIndex: tree of Int32; same code as lito3p
swatch = ColourSwatch(SwatchColor=RGB(191, 216, 255))
swatch_2 = ColourSwatch(SwatchColor=RGB(0, 0, 0))
swatch_3 = ColourSwatch(SwatchColor=RGB(75, 85, 100))
swatch_4 = ColourSwatch(SwatchColor=RGB(37, 42, 50))
previewplane = PreviewPlane(axis_length=Slider(100, range=0..100))
lito3p_8 = ListInto3Parts(ListToSlice=flatten(cluster_13.ids_2), StartIndex="0", EndIndex=lng_2)  # -> FilteredList, ItemsBefore, ItemsAfter; inputs ListToSlice: tree, StartIndex: tree of Int32, EndIndex: tree of Int32; same code as lito3p
item_32 = ListItem(List=cluster_10.ids_2, Index=0, Wrap=True)  # -> Item, Item1
lito3p_9 = ListInto3Parts(ListToSlice=flatten(cluster_13.nodes_2), StartIndex="0", EndIndex=lng_2)  # -> FilteredList, ItemsBefore, ItemsAfter; inputs ListToSlice: tree, StartIndex: tree of Int32, EndIndex: tree of Int32; same code as lito3p
lito3p_10 = ListInto3Parts(ListToSlice=flatten(cluster_8.ids_2), StartIndex="0", EndIndex=lng_2)  # -> FilteredList, ItemsBefore, ItemsAfter; inputs ListToSlice: tree, StartIndex: tree of Int32, EndIndex: tree of Int32; same code as lito3p
lito3p_11 = ListInto3Parts(ListToSlice=flatten(cluster_8.nodes_2), StartIndex="0", EndIndex=lng_2)  # -> FilteredList, ItemsBefore, ItemsAfter; inputs ListToSlice: tree, StartIndex: tree of Int32, EndIndex: tree of Int32; same code as lito3p
subtraction_2 = Subtraction(A=panel_4, B=lng_2)
genes_2 = GenePool(Decimals=0, Maximum=10, Minimum=0, Value=[8, 8])
genes_3 = GenePool(Decimals=0, Maximum=10, Minimum=0, Value=[8, 8])
merge_24 = Merge(Data1=item_19.Item, Data2=item_19.Item1)
merge_25 = Merge(Data1=item_20.Item, Data2=item_20.Item1)
merge_26 = Merge(Data1=item_21.Item, Data2=item_21.Item1)
number_slider_7 = Slider(1, range=0..1)
merge_27 = Merge(Data1=item_31.Item, Data2=item_31.Item1)
subtraction_3 = Subtraction(A=panel_8, B=lng_2)
item_33 = ListItem(List=merge_21, Index=panel_9, Wrap=True)
swatch_5 = ColourSwatch(SwatchColor=RGB(240, 117, 24))
swatch_6 = ColourSwatch(SwatchColor=RGB(235, 52, 79))
swatch_7 = ColourSwatch(SwatchColor=RGB(0, 166, 157))
lito3p_12 = ListInto3Parts(ListToSlice=flatten(cluster_13.ids_2), StartIndex="0", EndIndex=lng_2)  # -> FilteredList, ItemsBefore, ItemsAfter; inputs ListToSlice: tree, StartIndex: tree of Int32, EndIndex: tree of Int32; same code as lito3p
dispdexs = DispatchIndices(List=lito3p_2.FilteredList, Indices=subtraction_2)  # -> AtI, NotI
item_34 = ListItem(List=cluster_10.ids_2, Index=0, Wrap=True)  # -> Item, Item1
lito3p_13 = ListInto3Parts(ListToSlice=flatten(cluster_13.nodes_2), StartIndex="0", EndIndex=lng_2)  # -> FilteredList, ItemsBefore, ItemsAfter; inputs ListToSlice: tree, StartIndex: tree of Int32, EndIndex: tree of Int32; same code as lito3p
dispdexs_2 = DispatchIndices(List=lito3p_2.ItemsBefore, Indices=panel_5)  # -> AtI, NotI
dispdexs_3 = DispatchIndices(List=lito3p_3.FilteredList, Indices=subtraction_2)  # -> AtI, NotI
dispdexs_4 = DispatchIndices(List=lito3p_3.ItemsBefore, Indices=panel_5)  # -> AtI, NotI
dispdexs_5 = DispatchIndices(List=lito3p_4.FilteredList, Indices=subtraction_3)  # -> AtI, NotI
draw = BooleanToggle(True)
dispdexs_6 = DispatchIndices(List=lito3p_7.FilteredList, Indices=subtraction_3)  # -> AtI, NotI
dispdexs_7 = DispatchIndices(List=lito3p_6.FilteredList, Indices=subtraction_3)  # -> AtI, NotI
dispdexs_8 = DispatchIndices(List=lito3p_5.FilteredList, Indices=subtraction_3)  # -> AtI, NotI
merge_28 = Merge(Data1=dispdexs_2.NotI, Data2=dispdexs.NotI)
merge_29 = Merge(Data1=dispdexs_4.NotI, Data2=dispdexs_3.NotI)
dispdexs_9 = DispatchIndices(List=lito3p_11.FilteredList, Indices=panel_7)  # -> AtI, NotI
dispdexs_10 = DispatchIndices(List=lito3p_9.FilteredList, Indices=panel_7)  # -> AtI, NotI
dispdexs_11 = DispatchIndices(List=lito3p_8.FilteredList, Indices=panel_7)  # -> AtI, NotI
dispdexs_12 = DispatchIndices(List=lito3p_10.FilteredList, Indices=panel_7)  # -> AtI, NotI
button = Button(ExpressionNormal="True", ExpressionPressed="False")
bbox = BoundingBox(Content=flatten(cluster_3.geo_2), Plane=PlaneXY(0, 0, 0), UnionBox=True)  # -> Box, Box_2
button_2 = Button(ExpressionNormal="True", ExpressionPressed="False")
pt_11 = ConstructPoint(
    XCoordinate=Slider(2000, range=0..10000),
    YCoordinate=Slider(-3000, range=-10000..-3000),
    ZCoordinate=Slider(2000, range=0..10000))
normallinethickness = Number(Slider(6, range=0..10))
explosionlinepattern = Number(genes_2)
hiddenlinethickness = Number(Slider(3, range=0..10))
saveviewports = Boolean(Button())
transparency = Number(Slider(0.2, range=0..1))
Z_4 = UnitZ(Factor=1)
hiddenlinepattern = Number(genes_3)
normallinecolor = Colour(swatch_2)
previewlw = CustomPreviewLineweights(Geometry=trim_6, Shader=normallinecolor, Thickness=normallinethickness, Absolute=False)
scalefactor = Number(Slider(5, range=0..10))
onoff = EnableDisableObject(Enabled=draw, AllObjects_Object=[make2d, previewlw_4, previewlw_5, previewlw_3, previewmat, previewmat_2, previewmat_3])
dispdexs_13 = DispatchIndices(List=lito3p_13.FilteredList, Indices=panel_9)  # -> AtI, NotI
dispdexs_14 = DispatchIndices(List=lito3p_12.FilteredList, Indices=panel_9)  # -> AtI, NotI
concat_7 = Concatenate(FragmentA="\draw (", FragmentB=item_25.Item1, FragmentC=") [newConnection]-- (", FragmentD=item_29.Item1, FragmentE=");")
concat_8 = Concatenate(
    FragmentA="\draw (",
    FragmentB=cluster_9.ids_2,
    FragmentC=") [newConnection]-- (",
    FragmentD=item_25.Item1,
    FragmentE=");")
merge_30 = Merge(Data1=lito3p_7.ItemsBefore, Data2=dispdexs_6.NotI)
concat_9 = Concatenate(FragmentA="\draw (", FragmentB=item_22.Item1, FragmentC=") -- (", FragmentD=dispdexs_5.NotI, FragmentE=");")
concat_10 = Concatenate(
    FragmentA="\draw (",
    FragmentB=item_15.Item1,
    FragmentC=") [newConnection]-- (",
    FragmentD=dispdexs_5.AtI,
    FragmentE=");")
concat_11 = Concatenate(FragmentA="\draw (", FragmentB=item_15.Item, FragmentC=") -- (", FragmentD=dispdexs_4.NotI, FragmentE=");")
concat_12 = Concatenate(FragmentA="\draw (", FragmentB=item_22.Item, FragmentC=") -- (", FragmentD=lito3p_4.ItemsBefore, FragmentE=");")
concat_13 = Concatenate(FragmentA="\draw (", FragmentB=cluster_10.ids_2, FragmentC=") -- (", FragmentD=cluster_12.ids_2, FragmentE=");")
concat_14 = Concatenate(FragmentA="\draw (", FragmentB=item_25.Item, FragmentC=") -- (", FragmentD=item_29.Item, FragmentE=");")
concat_15 = Concatenate(FragmentA="\draw (", FragmentB=cluster_9.ids_2, FragmentC=") -- (", FragmentD=item_25.Item, FragmentE=");")
dam = DataDam(DataA=bbox.Box, BufferDelay=10000000, BufferMode=0)
concat_16 = Concatenate(
    FragmentA="\draw (",
    FragmentB=graft(cluster_10.ids_2),
    FragmentC=") [newConnection]-- (",
    FragmentD=item_31.Item2,
    FragmentE=");")  # -> flatten(Result)
concat_17 = Concatenate(
    FragmentA="\draw (",
    FragmentB=item_32.Item,
    FragmentC=") [newConnection]-- (",
    FragmentD=dispdexs_11.AtI,
    FragmentE=");")
concat_18 = Concatenate(
    FragmentA="\draw (",
    FragmentB=graft(cluster_10.ids_2),
    FragmentC=") [newConnection]-- (",
    FragmentD=item_31.Item,
    FragmentE=");")  # -> flatten(Result)
concat_19 = Concatenate(FragmentA="\draw (", FragmentB=item_32.Item, FragmentC=") -- (", FragmentD=dispdexs_11.NotI, FragmentE=");")
concat_20 = Concatenate(FragmentA="\draw (", FragmentB=cluster_9.ids_2, FragmentC=") -- (", FragmentD=item_15.Item, FragmentE=");")
concat_21 = Concatenate(FragmentA="\draw (", FragmentB=graft(cluster_10.ids_2), FragmentC=") -- (", FragmentD=merge_27, FragmentE=");")  # -> flatten(Result)
concat_22 = Concatenate(FragmentA="\draw (", FragmentB=item_15.Item, FragmentC=") -- (", FragmentD=item_17.Item, FragmentE=");")
rhinovp = RhinoViewport(N="Diagram", P="0", WD=Domain2(u=0..1000, v=0..1000), T="False", A=button)  # -> F; inputs P: Int32, T: Boolean, A: Boolean
#   port P: 0 = None 1 = Top 2 = Bottom 3 = Left 4 = Right 5 = Front 6 = Back 7 = Perspective 8 = TwoPointPerspective
# ---------- rhinovp: Python ----------
#Component Information
#--------------------------------------------------------------------------------------------
if ghenv.Component.RunCount<2:
    #General
    #--------------------------------------------------------------------------------------------
    __author__ = "Ueli Saluz"
    __version__ = "2023.04.05"
    
    ghenv.Component.Name = "RhinoViewport"
    ghenv.Component.NickName = "RhinoVP"
    ghenv.Component.Description = "Launches or closes a Rhino viewport."
    ghenv.Component.Message = "VER 1.3"
    ghenv.Component.Category = "Display"
    ghenv.Component.SubCategory = "Camera"
    
     #Inputs
    #--------------------------------------------------------------------------------------------
    inputIndex=0
    
    ghenv.Component.Params.Input[inputIndex].Name = "Name"
    ghenv.Component.Params.Input[inputIndex].NickName = "N"
    ghenv.Component.Params.Input[inputIndex].Description = "Name of the viewport"
    ghenv.Component.Params.Input[inputIndex].Optional = False
    inputIndex+=1
    
    ghenv.Component.Params.Input[inputIndex].Name = "ViewportProjection"
    ghenv.Component.Params.Input[inputIndex].NickName = "P"
    ghenv.Component.Params.Input[inputIndex].Description = "0  = None \n1 = Top \n2 = Bottom \n3 = Left \n4 = Right \n5 = Front\n6 = Back\n7 = Perspective\n8 = TwoPointPerspective"
    ghenv.Component.Params.Input[inputIndex].Optional = False
    inputIndex+=1
    
    ghenv.Component.Params.Input[inputIndex].Name = "WindowDomain"
    ghenv.Component.Params.Input[inputIndex].NickName = "WD"
    ghenv.Component.Params.Input[inputIndex].Description = "The domain of the window. The U domain corresponds to X and the V domain to Y."
    ghenv.Component.Params.Input[inputIndex].Optional = False
    inputIndex+=1
    
    ghenv.Component.Params.Input[inputIndex].Name = "TitleVisible"
    ghenv.Component.Params.Input[inputIndex].NickName = "T"
    ghenv.Component.Params.Input[inputIndex].Description = "True if Rhino view title should be visible."
    ghenv.Component.Params.Input[inputIndex].Optional = True
    inputIndex+=1
    
    ghenv.Component.Params.Input[inputIndex].Name = "WallPaperPath"
    ghenv.Component.Params.Input[inputIndex].NickName = "WP"
    ghenv.Component.Params.Input[inputIndex].Description = "The domain of the window. The U domain corresponds to X and the V domain to Y."
    ghenv.Component.Params.Input[inputIndex].Optional = True
    inputIndex+=1
    
    ghenv.Component.Params.Input[inputIndex].Name = "ScaleFactor"
    ghenv.Component.Params.Input[inputIndex].NickName = "S"
    ghenv.Component.Params.Input[inputIndex].Description = "A scale factor that is applied on the window domains."
    ghenv.Component.Params.Input[inputIndex].Optional = True
    inputIndex+=1
    
    ghenv.Component.Params.Input[inputIndex].Name = "Active"
    ghenv.Component.Params.Input[inputIndex].NickName = "A"
    ghenv.Component.Params.Input[inputIndex].Description = "Activate or deactivate the window."
    ghenv.Component.Params.Input[inputIndex].Optional = False
    inputIndex+=1
    
    #Outputs
    #--------------------------------------------------------------------------------------------
    outputIndex=0
    
    ghenv.Component.Params.Output[outputIndex].Name = "Finished"
    ghenv.Component.Params.Output[outputIndex].NickName = "F"
    ghenv.Component.Params.Output[outputIndex].Description = "Sends True when finished. Just to trigger other depending components."
    outputIndex+=1


#Imports
#--------------------------------------------------------------------------------------------
from System import Object, Enum
from Grasshopper import DataTree
import System as sy
import Rhino as rc
import scriptcontext as sc
import clr
import System.Windows.Forms.Control

#Solver - Run with trees to enhance performance drastically
#--------------------------------------------------------------------------------------------
if __name__ == "__main__":
    
    vp = rc.RhinoDoc.ActiveDoc.Views.Find(N, False)
    if A:
        scaleFacor = 1 if S is None else S
        if vp:
            vp.Close()
        
        #The width is 16 pixel and height is 39 too little. Additionally the windows start 8 pixel shifted to the left. Why? I don't know.
        windowRectangle = sy.Drawing.Rectangle(WD.U0*scaleFacor-8,WD.V0*scaleFacor,WD.U.Length*scaleFacor+16,WD.V.Length*scaleFacor+39)
        newView = rc.RhinoDoc.ActiveDoc.Views.Add(N,Enum.ToObject(rc.Display.DefinedViewportProjection, P),windowRectangle,True)
        #newView seems to not set the name properly
        newView.MainViewport.Name = N
        if T==False:
            newView.TitleVisible = False
        viewport = newView.ActiveViewport
        if WP is not None:
            viewport.SetWallpaper(WP,False)
        
        viewport.ConstructionAxesVisible = False
        viewport.ConstructionGridVisible = False
        viewport.WorldAxesVisible = False
        
    else:
        if vp:
            vp.Close()
    F = True
# ---------- end rhinovp ----------
saveview = SaveViewportToFile(
    Run=saveviewports,
    ViewportName="Diagram",
    Render=False,
    FilePath="C:\git\semio\examples\capsuletower\axonometryrendering.png",
    ScaleFactor=scalefactor)
concat_23 = Concatenate(FragmentA="\draw (", FragmentB=item_15.Item, FragmentC=") -- (", FragmentD=dispdexs_4.NotI, FragmentE=");")
concat_24 = Concatenate(FragmentA="\draw (", FragmentB=item_15.Item1, FragmentC=") -- (", FragmentD=dispdexs_3.NotI, FragmentE=");")
setview = SetView(N="Diagram", P="0", L=pt_11, Up=Z_4, R=button_2)  # -> F; inputs P: Int32, L: Point3d, D: Vector3d, Up: Vector3d, R: Boolean
#   port P: 0 = Parallel view 1 = Perspective view
# ---------- setview: Python ----------
#Component Information
#--------------------------------------------------------------------------------------------
if ghenv.Component.RunCount<2:
    #General
    #--------------------------------------------------------------------------------------------
    __author__ = "Ueli Saluz"
    __version__ = "2022.05.22"
    
    ghenv.Component.Name = "SetView"
    ghenv.Component.NickName = "SetView"
    ghenv.Component.Description = "Set a camera view and projection."
    ghenv.Component.Message = "VER 1.1"
    ghenv.Component.Category = "Display"
    ghenv.Component.SubCategory = "Camera"
    
     #Inputs
    #--------------------------------------------------------------------------------------------
    inputIndex=0
    
    ghenv.Component.Params.Input[inputIndex].Name = "Name"
    ghenv.Component.Params.Input[inputIndex].NickName = "N"
    ghenv.Component.Params.Input[inputIndex].Description = "Name of the viewport"
    ghenv.Component.Params.Input[inputIndex].Optional = True
    inputIndex+=1
    
    ghenv.Component.Params.Input[inputIndex].Name = "Projection"
    ghenv.Component.Params.Input[inputIndex].NickName = "P"
    ghenv.Component.Params.Input[inputIndex].Description = "0 = Parallel view\n"+\
                                                           "1 = Perspective view"
    ghenv.Component.Params.Input[inputIndex].Optional = True
    inputIndex+=1
    
    
    ghenv.Component.Params.Input[inputIndex].Name = "CameraLocation"
    ghenv.Component.Params.Input[inputIndex].NickName = "L"
    ghenv.Component.Params.Input[inputIndex].Description = "Location of the camera."
    ghenv.Component.Params.Input[inputIndex].Optional = True
    inputIndex+=1
    
    ghenv.Component.Params.Input[inputIndex].Name = "CameraDirection"
    ghenv.Component.Params.Input[inputIndex].NickName = "D"
    ghenv.Component.Params.Input[inputIndex].Description = "Direction of the camera."
    ghenv.Component.Params.Input[inputIndex].Optional = True
    inputIndex+=1
    
    ghenv.Component.Params.Input[inputIndex].Name = "CameraUp"
    ghenv.Component.Params.Input[inputIndex].NickName = "Up"
    ghenv.Component.Params.Input[inputIndex].Description = "Up vector of the camera."
    ghenv.Component.Params.Input[inputIndex].Optional = True
    inputIndex+=1
    
    ghenv.Component.Params.Input[inputIndex].Name = "LensLength"
    ghenv.Component.Params.Input[inputIndex].NickName = "LL"
    ghenv.Component.Params.Input[inputIndex].Description = "Lens length of the camera. Only relevant if projection is perspective."
    ghenv.Component.Params.Input[inputIndex].Optional = True
    inputIndex+=1
    
    ghenv.Component.Params.Input[inputIndex].Name = "Run"
    ghenv.Component.Params.Input[inputIndex].NickName = "R"
    ghenv.Component.Params.Input[inputIndex].Description = "Zoom to the given bounding box."
    ghenv.Component.Params.Input[inputIndex].Optional = False
    inputIndex+=1
    
    #Outputs
    #--------------------------------------------------------------------------------------------
    outputIndex=0
    
    ghenv.Component.Params.Output[outputIndex].Name = "Finished"
    ghenv.Component.Params.Output[outputIndex].NickName = "F"
    ghenv.Component.Params.Output[outputIndex].Description = "Sends True when finished. Just to trigger other depending components."
    outputIndex+=1
    


#Imports
#--------------------------------------------------------------------------------------------
from Rhino import RhinoDoc
from Rhino.Geometry import Box

#Solver - Run with trees to enhance performance drastically
#--------------------------------------------------------------------------------------------
if __name__ == "__main__":
    
    if R:
        if N is not None:
            view = RhinoDoc.ActiveDoc.Views.Find(N, False)
        else:
            view = RhinoDoc.ActiveDoc.Views.ActiveView
        vp = view.ActiveViewport
        if P is not None:
            if (P==0):
                vp.ChangeToParallelProjection(True)
            else:
                vp.ChangeToPerspectiveProjection(True,LL)
        if L is not None:
            vp.SetCameraLocation(L,False)
        if D is not None:
            vp.SetCameraDirection(D,False)
        if Up is not None:
            vp.CameraUp = Up
    F = True
# ---------- end setview ----------
concat_25 = Concatenate(FragmentA="\draw (", FragmentB=cluster_9.ids_2, FragmentC=") -- (", FragmentD=cluster_10.ids_2, FragmentE=");")
concat_26 = Concatenate(FragmentA="\draw (", FragmentB=cluster_10.ids_2, FragmentC=") -- (", FragmentD=cluster_5.ids_2, FragmentE=");")
merge_31 = Merge(Data1=cluster_9.nodes_2, Data2=cluster_10.nodes_2, Data3=cluster_5.nodes_2, Data4=merge_30)
merge_32 = Merge(Data1=concat_12, Data2=concat_9)
merge_33 = Merge(Data1=dispdexs_8.AtI, Data2=concat_10)
merge_34 = Merge(Data1=concat_15, Data2=concat_14, Data3=concat_11)
merge_35 = Merge(Data1=item_24.Item1, Data2=item_28.Item1)
merge_36 = Merge(Data1=cluster_9.nodes_2, Data2=item_23.Item, Data3=item_27.Item, Data4=lito3p_2.ItemsBefore)
merge_37 = Merge(Data1=concat_8, Data2=concat_7)
concat_27 = Concatenate(
    FragmentA="\draw (",
    FragmentB=item_34.Item,
    FragmentC=") [newConnection]-- (",
    FragmentD=dispdexs_14.AtI,
    FragmentE=");")
concat_28 = Concatenate(FragmentA="\draw (", FragmentB=cluster_9.ids_2, FragmentC=") -- (", FragmentD=item_15.Item, FragmentE=");")
wires_2 = BrepWireframe(Brep=cluster_3.geo_2, Density=-1)
concat_29 = Concatenate(FragmentA="\draw (", FragmentB=item_15.Item, FragmentC=") -- (", FragmentD=item_17.Item, FragmentE=");")
wires_3 = BrepWireframe(Brep=cluster_3.geo_2, Density=-1)
merge_38 = Merge(Data1=dispdexs_10.AtI, Data2=concat_17)
merge_39 = Merge(Data1=item_21.Item2, Data2=concat_16)
merge_40 = Merge(Data1=item_21.Item, Data2=concat_18)
merge_41 = Merge(Data1=concat_20, Data2=concat_22, Data3=concat_19)
merge_42 = Merge(Data1=concat_23, Data2=concat_24)
zoom2bb = ZoomToBoundingBox(N="Diagram", BB=bbox.Box, S=0, R=setview)  # -> F, SBB; inputs BB: Box, R: Boolean
# ---------- zoom2bb: Python ----------
#Component Information
#--------------------------------------------------------------------------------------------
if ghenv.Component.RunCount<2:
    #General
    #--------------------------------------------------------------------------------------------
    __author__ = "Ueli Saluz"
    __version__ = "2022.05.21"
    
    ghenv.Component.Name = "ZoomToBoundingBox"
    ghenv.Component.NickName = "Zoom2BB"
    ghenv.Component.Description = "Zoom the view of a Rhino viewport to a bounding box."
    ghenv.Component.Message = "VER 1.0"
    ghenv.Component.Category = "Display"
    ghenv.Component.SubCategory = "Camera"
    
     #Inputs
    #--------------------------------------------------------------------------------------------
    inputIndex=0
    
    ghenv.Component.Params.Input[inputIndex].Name = "Name"
    ghenv.Component.Params.Input[inputIndex].NickName = "N"
    ghenv.Component.Params.Input[inputIndex].Description = "Name of the viewport"
    ghenv.Component.Params.Input[inputIndex].Optional = False
    inputIndex+=1
    
    ghenv.Component.Params.Input[inputIndex].Name = "BoundingBox"
    ghenv.Component.Params.Input[inputIndex].NickName = "BB"
    ghenv.Component.Params.Input[inputIndex].Description = ""
    ghenv.Component.Params.Input[inputIndex].Optional = False
    inputIndex+=1
    
    ghenv.Component.Params.Input[inputIndex].Name = "ScaleFactor"
    ghenv.Component.Params.Input[inputIndex].NickName = "S"
    ghenv.Component.Params.Input[inputIndex].Description = "A factor for the extension of the bounding box." \
    +"0 means 0 extension, a positive number makes the bounding box larger a negative smaller. The amount is proportional to the length."
    ghenv.Component.Params.Input[inputIndex].Optional = False
    inputIndex+=1
   
    
    ghenv.Component.Params.Input[inputIndex].Name = "Run"
    ghenv.Component.Params.Input[inputIndex].NickName = "R"
    ghenv.Component.Params.Input[inputIndex].Description = "Zoom to the given bounding box."
    ghenv.Component.Params.Input[inputIndex].Optional = False
    inputIndex+=1
    
    #Outputs
    #--------------------------------------------------------------------------------------------
    outputIndex=0
    
    ghenv.Component.Params.Output[outputIndex].Name = "Finished"
    ghenv.Component.Params.Output[outputIndex].NickName = "F"
    ghenv.Component.Params.Output[outputIndex].Description = "Sends True when finished. Just to trigger other depending components."
    outputIndex+=1
    
    ghenv.Component.Params.Output[outputIndex].Name = "ScaledBoundingBox"
    ghenv.Component.Params.Output[outputIndex].NickName = "SBB"
    ghenv.Component.Params.Output[outputIndex].Description = "The scaled bounding box."
    outputIndex+=1


#Imports
#--------------------------------------------------------------------------------------------
from Rhino import RhinoDoc
from Rhino.Geometry import Box

#Solver - Run with trees to enhance performance drastically
#--------------------------------------------------------------------------------------------
if __name__ == "__main__":
    
    vp = RhinoDoc.ActiveDoc.Views.Find(N, False).ActiveViewport
    if R:
        box = BB
        bb = BB.BoundingBox
        bb.Inflate(S*box.X.Length,S*box.Y.Length,S*box.Z.Length)
        vp.ZoomBoundingBox(bb)
        SBB = bb
    F = True
# ---------- end zoom2bb ----------

lng_3 = ListLength(List=cluster_3.planhash_2)
expression_2 = Expression(x=lng_3, Expression="x-1")
series = Series(Start=0, Step=1, Count=expression_2)
dup_2 = DuplicateData(Data=swatch_2, Number=expression_2, Order=True)
trim_7 = TrimTree(Tree=series, Depth=1)
trim_8 = TrimTree(Tree=dup_2, Depth=1)
concat_30 = Concatenate(FragmentA="capsule", FragmentB=trim_7)
merge_43 = Merge(Data1="shaft", Data2=concat_30)
merge_44 = Merge(Data1=swatch_2, Data2=swatch_6)
layer = CreateLayers(CreateToggle=Button(), LayerNames=merge_43, LayerColors=merge_44)

merge_45 = Merge(Data1=cluster_9.nodes_2, Data2=cluster_10.nodes_2, Data3=cluster_5.nodes_2, Data4=merge_28)
cleanlayer = BooleanToggle(False)
merge_46 = Merge(Data1=concat_25, Data2=concat_13, Data3=merge_32)
merge_47 = Merge(Data1=cluster_14.nodes_2, Data2=item_16.Item, Data3=item_18.Item, Data4=dispdexs_9.NotI)
merge_48 = Merge(Data1=merge_36, Data2=merge_34)
trim_9 = TrimTree(Tree=wires_2, Depth=1)
merge_49 = Merge(Data1=merge_35, Data2=merge_37)
trim_10 = TrimTree(Tree=wires_3, Depth=1)
panel_10 = Panel(merge_45)
merge_50 = Merge(Data1=dispdexs_13.AtI, Data2=concat_27)
merge_51 = Merge(Data1=cluster_3.geo_2, Data2=trim_10)
merge_52 = Merge(Data1=concat_28, Data2=concat_29)
number_slider_8 = Slider(5000, range=0..10000)
merge_53 = Merge(Data1=cluster_14.nodes_2, Data2=item_16.Item, Data3=item_18.Item)
merge_54 = Merge(Data1=concat_25, Data2=concat_26, Data3=merge_42)
swatch_8 = ColourSwatch(SwatchColor=RGB(255, 255, 255))
preview = CustomPreview(Geometry=geo_2, Material=swatch_8)
panel_11 = Panel(merge_33)
merge_55 = Merge(Data1=merge_47, Data2=merge_41)
panel_12 = Panel(merge_32)
merge_56 = Merge(Data1=merge_31, Data2=merge_46)
toggle_5 = BooleanToggle(True)  # disabled
number_slider_9 = Slider(1, range=-10..10)
toggle_6 = BooleanToggle(True)
panel_13 = Panel(merge_31)
number_slider_10 = Slider(1, range=-10..10)
panel_14 = Panel(merge_38)
panel_15 = Panel(concat_19)
m2d_rhino = Make2DRhinoView(Name="Diagram", Clip=True)
merge_57 = Merge(Data1=merge_45, Data2=merge_54)
merge_58 = Merge(Data1=merge_45, Data2=merge_57, Data3=merge_40)
onoff_2 = EnableDisableObject(Enabled=cleanlayer, AllObjects_Object=[layers, layertable, toggle_7, trim_12, toggle_5, difference])
merge_59 = Merge(Data1=merge_48, Data2=merge_49)
panel_16 = Panel(merge_47)
trim_11 = TrimTree(Tree=merge_51, Depth=1)
merge_60 = Merge(Data1=merge_56, Data2=merge_33)
panel_17 = Panel(merge_54)
previewlw_2 = CustomPreviewLineweights(Geometry=trim_9, Shader=normallinecolor, Thickness=normallinethickness, Absolute=False)
preview_2 = CustomPreview(Geometry=cluster_3.geo_2, Material=swatch_8)
merge_61 = Merge(Data1=merge_53, Data2=merge_52)
panel_18 = Panel(merge_36)
panel_19 = Panel(merge_58)
merge_62 = Merge(Data1=merge_55, Data2=merge_38)
panel_20 = Panel(merge_50)
layertable = LayerTable(Update=toggle_5, AutoUpdate=False)  # -> Layers, FullLayerPaths, LayerColors, Linetypes, MaterialNames, Visible, PrintWidth, PrintColor; disabled
make2d = Make2D(Geometry=merge_51, View=m2d_rhino, TangentEdges=toggle_6, TangentSeams=toggle_6, AutoComputeMake2D=False)  # -> VisibleCurves, VisibleIndex, VisibleType, HiddenCurves, HiddenIndex, HiddenType
panel_21 = Panel(merge_59)
panel_22 = Panel(merge_53)
panel_23 = Panel(merge_49)
merge_63 = Merge(Data1=merge_45, Data2=merge_57, Data3=merge_24, Data4=concat_21, Data5=merge_39)
panel_24 = Panel("Silhouette")
panel_25 = Panel("Silhouette, Boundary")
pt_12 = ConstructPoint(XCoordinate=number_slider_8, YCoordinate=number_slider_8, ZCoordinate=0)
panel_26 = Panel("Silhouette, Crease")
panel_27 = Panel("Crease")
panel_28 = Panel("Boundary")
merge_64 = Merge(Data1=merge_61, Data2=merge_50)
panel_29 = Panel(merge_60)
trim_12 = TrimTree(Tree=layertable.Layers, Depth=1)  # disabled
vec_2 = VectorXYZ(XComponent=0, YComponent=0, ZComponent=Slider(-1, range=-10..10))  # -> Vector, Length
Z_5 = UnitZ(Factor=1)
trim_13 = TrimTree(Tree=make2d.HiddenCurves, Depth=1)
trim_14 = TrimTree(Tree=make2d.VisibleCurves, Depth=1)
trim_15 = TrimTree(Tree=make2d.VisibleType, Depth=1)
toggle_7 = BooleanToggle(True)  # disabled
panel_30 = Panel(merge_62)
relay = Relay()
difference = SetDifference(SetA=trim_12, SetB=merge_43)  # disabled
panel_31 = Panel(merge_63)
move_4 = Move(Geometry=trim_13, Motion=pt_12)  # -> Geometry, Transform
move_5 = Move(Geometry=trim_14, Motion=pt_12)  # -> Geometry, Transform
saveview_2 = SaveViewportToFile(
    Run=saveviewports,
    ViewportName="Drawing",
    Render=False,
    FilePath="C:\git\semio\examples\capsuletower\axonometry.png",
    ScaleFactor=scalefactor)
setview_2 = SetView(N="Drawing", P="0", L=pt_12, D=vec_2.Vector, Up=Z_5, R=button_2)  # -> F; inputs P: Int32, L: Point3d, D: Vector3d, Up: Vector3d, R: Boolean; same code as setview
tmatch = MatchText(Text=trim_15, RegEx="Wire", Case=True)
rhinovp_2 = RhinoViewport(N="Drawing", P="0", WD=Domain2(u=0..1000, v=0..1000), T="False", A=button)  # -> F; inputs P: Int32, T: Boolean, A: Boolean; same code as rhinovp
union = BooleanToggle(False)
panel_32 = Panel(merge_64)
layers = CreateModifyLayers(LayerName=difference, DeleteLayer=toggle_7, enableFullPath=False)  # -> LayerNames, LayerFullPath; disabled
merge_65 = Merge(Data1=move_5.Geometry, Data2=move_4.Geometry)
dispatch_4 = Dispatch(List=move_5.Geometry, DispatchPattern=tmatch)  # -> ListA, ListB
bbox_2 = BoundingBox(Content=flatten(merge_65), Plane=PlaneXY(0, 0, 0), UnionBox=True)  # -> Box, Box_2
filter = StreamFilter(Gate=union, Stream0=move_5.Geometry)
panel_33 = Panel(make2d.VisibleType)
geo_4 = Geometry(dispatch_4.ListA)
convexhull = ConvexHull(C=move_5.Geometry)
zoom2bb_2 = ZoomToBoundingBox(N="Drawing", BB=bbox_2.Box, S=0, R=setview_2)  # -> F, SBB; inputs BB: Box, R: Boolean; same code as zoom2bb
drawinghidden = Curve()
drawingvisible = Curve(filter)
explosionaxonometry = ExplosionAxonometry(mainexplosiondistance=Slider(1000, range=0..10000), secondaryexplosiondistance=Slider(800, range=0..1000))  # -> capsules_2, explosionslines_2, explosiontransform_2
bang = ExplodeTree(Data=convexhull)  # -> Branch0, Branch1, Branch2, Branch3, Branch4, Branch5, Branch6
trim_16 = TrimTree(Depth=1)
dash = DashPattern(Curve=trim_16, Pattern=hiddenlinepattern)  # -> Dashes, Gaps
dash_2 = DashPattern(Curve=drawinghidden, Pattern=hiddenlinepattern)  # -> Dashes, Gaps
merge_66 = Merge(Data1=bang.Branch2, Data2=bang.Branch3, Data3=bang.Branch5, Data4=bang.Branch6)
merge_67 = Merge(Data1=bang.Branch1, Data2=bang.Branch4)
previewlw_3 = CustomPreviewLineweights(Geometry=dash.Dashes, Shader=normallinecolor, Thickness=hiddenlinethickness, Absolute=False)
previewlw_4 = CustomPreviewLineweights(Geometry=drawingvisible, Shader=normallinecolor, Thickness=normallinethickness, Absolute=False)
previewlw_5 = CustomPreviewLineweights(Geometry=dash_2.Dashes, Shader=normallinecolor, Thickness=hiddenlinethickness, Absolute=False)
previewmat = CustomPreviewMaterials(Geometry=bang.Branch0, DiffuseColor=swatch_5, Transparency=transparency)
previewmat_2 = CustomPreviewMaterials(Geometry=merge_67, DiffuseColor=swatch_5, Transparency=transparency)
previewmat_3 = CustomPreviewMaterials(Geometry=merge_66, DiffuseColor=swatch_6, Transparency=transparency)

# ==== cluster ConvexHull
C = ClusterInput()
explode = Explode(Curve=C, Recursive=True)  # -> Segments, Vertices
trim = TrimTree(Tree=explode.Vertices, Depth=1)
hull = ConvexHull(Points=trim, Plane=PlaneXY(0, 0, 0))  # -> Hull, HullZ, Indices
crv = Curve(hull.Hull)
srf = Surface(crv)
srf_2 = ClusterOutput(srf)

# ==== cluster ExplosionAxonometry
mainexplosiondistance = ClusterInput()
secondaryexplosiondistance = ClusterInput()
southcapsules = ClusterInput()
northcapsules = ClusterInput()
westcapsules = ClusterInput()
eastcapsules = ClusterInput()
mainexplosiondistance_2 = Number(mainexplosiondistance)
northcapsules_2 = Geometry(northcapsules)
southcapsules_2 = Geometry(southcapsules)
westcapsules_2 = Geometry(westcapsules)
eastcapsules_2 = Geometry(eastcapsules)
secondaryexplosiondistance_2 = Number(secondaryexplosiondistance)
neg = Negative(Value=mainexplosiondistance_2)
neg_2 = Negative(Value=secondaryexplosiondistance_2)
Y = UnitY(Factor=neg)
Z = UnitZ(Factor=secondaryexplosiondistance_2)
X = UnitX(Factor=mainexplosiondistance_2)
Z_2 = UnitZ(Factor=neg_2)
cluster = Cluster(geo=northcapsules_2, T_3=Y, T_2=Z_2, T=Z)  # -> geo_4, pt_2, transform_2
cluster_2 = Cluster(geo=southcapsules_2, T_3=Y, T_2=Z_2, T=Z)  # -> geo_4, pt_2, transform_2
cluster_3 = Cluster(geo=eastcapsules_2, T_3=X, T_2=Z_2, T=Z)  # -> geo_4, pt_2, transform_2
cluster_4 = Cluster(geo=southcapsules_2, T_3=Y, T_2=Z_2, T=Z)  # -> geo_4, pt_2, transform_2
merge = Merge(Data1=cluster_2.pt_2, Data2=cluster_3.pt_2)
merge_2 = Merge(Data1=cluster_2.transform_2, Data2=cluster_3.transform_2)
merge_3 = Merge(Data1=cluster_2.geo_4, Data2=cluster_3.geo_4)
pline = PolyLine(Vertices=merge, Closed=False)
explosiontransform = Transform(merge_2)
capsules = Geometry(merge_3)
explosionslines = Curve(pline)
explosiontransform_2 = ClusterOutput(explosiontransform)
capsules_2 = ClusterOutput(capsules)
explosionslines_2 = ClusterOutput(explosionslines)

# ==== cluster CapsuleTower
entrancepatternsouth1 = ClusterInput()
entrancepatternsouth2 = ClusterInput()
entrancepatternnorth1 = ClusterInput()
entrancepatterneast2 = ClusterInput()
entrancepatternwest1 = ClusterInput()
entrancepatternwest2 = ClusterInput()
entrancepatternfront2 = ClusterInput()
entrancepatterneast1 = ClusterInput()
windowpatternnorth1 = ClusterInput()
windowpatternsouth1 = ClusterInput()
windowpatternsouth2 = ClusterInput()
windowpatternfront2 = ClusterInput()
windowpatternwest1 = ClusterInput()
windowpatterneast2 = ClusterInput()
windowpatterneast1 = ClusterInput()
windowpatternwest2 = ClusterInput()
list = ValueList({"Round", "Rectangular"}, selected="Round")
entrancepatternnorth1_2 = Integer(entrancepatternnorth1)
entrancepatterneast2_2 = Integer(entrancepatterneast2)
entrancepatterneast1_2 = Integer(entrancepatterneast1)
entrancepatternsouth2_2 = Integer(entrancepatternsouth2)
entrancepatternfront2_2 = Integer(entrancepatternfront2)
entrancepatternsouth1_2 = Integer(entrancepatternsouth1)
entrancepatternwest1_2 = Integer(entrancepatternwest1)
entrancepatternwest2_2 = Integer(entrancepatternwest2)
windowpatternnorth1_2 = Integer(windowpatternnorth1)
windowpatterneast2_2 = Integer(windowpatterneast2)
windowpatterneast1_2 = Integer(windowpatterneast1)
windowpatternsouth2_2 = Integer(windowpatternsouth2)
windowpatternfront2_2 = Integer(windowpatternfront2)
windowpatternwest1_2 = Integer(windowpatternwest1)
windowpatternsouth1_2 = Integer(windowpatternsouth1)
windowpatternwest2_2 = Integer(windowpatternwest2)
list_2 = ValueList({"Back", "Side"}, selected="Back")
parameter = ConstructParameter(Name="Entrance", Value=list_2)
panel = Panel("""Back
Side""")
parameter_2 = ConstructParameter(Name="WindowShape", Value=list)
parameter_3 = ConstructParameter(Name="Length", Value=Slider(400, range=0..1000))
panel_2 = Panel("""Back
Side""")
list_3 = ValueList({"Front", "Side"}, selected="Front")
list_4 = ValueList({"Back", "Side"}, selected="Side")
parameter_4 = ConstructParameter(Name="Length", Value=Slider(420, range=0..1000))
parameter_5 = ConstructParameter(Name="Mirror", Value=Toggle(True))
item = ListItem(List=panel, Index=entrancepatternnorth1_2, Wrap=True)  # -> graft(Item)
item_2 = ListItem(List=panel, Index=entrancepatternfront2_2, Wrap=True)  # -> graft(Item)
item_3 = ListItem(List=panel, Index=entrancepatterneast1_2, Wrap=True)  # -> graft(Item)
item_4 = ListItem(List=panel, Index=entrancepatterneast2_2, Wrap=True)  # -> graft(Item)
item_5 = ListItem(List=panel, Index=entrancepatternsouth1_2, Wrap=True)  # -> graft(Item)
item_6 = ListItem(List=panel, Index=entrancepatternsouth2_2, Wrap=True)  # -> graft(Item)
item_7 = ListItem(List=panel, Index=entrancepatternwest1_2, Wrap=True)  # -> graft(Item)
item_8 = ListItem(List=panel, Index=entrancepatternwest2_2, Wrap=True)  # -> graft(Item)
parameter_6 = ConstructParameter(Name="Width", Value=Slider(270, range=0..1000))
item_9 = ListItem(List=panel_2, Index=windowpatternnorth1_2, Wrap=True)  # -> graft(Item)
item_10 = ListItem(List=panel_2, Index=windowpatternfront2_2, Wrap=True)  # -> graft(Item)
item_11 = ListItem(List=panel_2, Index=windowpatterneast1_2, Wrap=True)  # -> graft(Item)
item_12 = ListItem(List=panel_2, Index=windowpatterneast2_2, Wrap=True)  # -> graft(Item)
parameter_7 = ConstructParameter(Name="Height", Value=Slider(275, range=0..1000))
item_13 = ListItem(List=panel_2, Index=windowpatternsouth1_2, Wrap=True)  # -> graft(Item)
item_14 = ListItem(List=panel_2, Index=windowpatternsouth2_2, Wrap=True)  # -> graft(Item)
item_15 = ListItem(List=panel_2, Index=windowpatternwest1_2, Wrap=True)  # -> graft(Item)
item_16 = ListItem(List=panel_2, Index=windowpatternwest2_2, Wrap=True)  # -> graft(Item)
parameter_8 = ConstructParameter(Name="Entrance", Value=list_4)
parameter_9 = ConstructParameter(Name="Window", Value=list_3)
merge = Merge(Data2=parameter_2, Data3=parameter_3)
parameter_10 = ConstructParameter(Name="Entrance", Value=item)
parameter_11 = ConstructParameter(Name="Entrance", Value=item_2)
parameter_12 = ConstructParameter(Name="Entrance", Value=item_3)
parameter_13 = ConstructParameter(Name="Entrance", Value=item_4)
parameter_14 = ConstructParameter(Name="Entrance", Value=item_5)
parameter_15 = ConstructParameter(Name="Entrance", Value=item_6)
parameter_16 = ConstructParameter(Name="Entrance", Value=item_7)
parameter_17 = ConstructParameter(Name="Entrance", Value=item_8)
parameter_18 = ConstructParameter(Name="Window", Value=item_9)
parameter_19 = ConstructParameter(Name="Window", Value=item_10)
parameter_20 = ConstructParameter(Name="Window", Value=item_11)
parameter_21 = ConstructParameter(Name="Window", Value=item_12)
parameter_22 = ConstructParameter(Name="Window", Value=item_13)
parameter_23 = ConstructParameter(Name="Window", Value=item_14)
parameter_24 = ConstructParameter(Name="Window", Value=item_15)
parameter_25 = ConstructParameter(Name="Window", Value=item_16)
list_5 = ValueList({"Front", "Right", "Bottom", "Left"}, selected="Bottom")
commonmirror = Parameter([parameter_5, merge])
common = Parameter(merge)
numberoffloors = ClusterInput()
largetower = ClusterInput()
bridgelevels = ClusterInput()
bridgeuri = ClusterInput()
capsuleuri = ClusterInput()
shafturi = ClusterInput()
bridge = ClusterInput()
xy = XYPlane(Origin=Point(0, 0, 0))
largetower_2 = Boolean(largetower)
bridgelevels_2 = Integer(bridgelevels)
shafturi_2 = Text(shafturi)
capsuleuri_2 = Text(capsuleuri)
numberoffloors_2 = Integer(numberoffloors)
dup = DuplicateData(Data=graft(common), Number=numberoffloors_2, Order=True)
dup_2 = DuplicateData(Data=graft(commonmirror), Number=numberoffloors_2, Order=True)
bridge_2 = Text(bridge)
bridgeuri_2 = Text(bridgeuri)
trim = TrimTree(Tree=dup, Depth=1)
trim_2 = TrimTree(Tree=dup_2, Depth=1)
flip = FlipMatrix(Data=trim)
flip_2 = FlipMatrix(Data=trim_2)
series = Series(Start=0, Step=1, Count=numberoffloors_2)
link = ConstructLink(Ports="Door")
merge_2 = Merge(Data1=flip)
merge_3 = Merge(Data1=flip_2)
trim_3 = TrimTree(Tree=series, Depth=1)
parameter_26 = ConstructParameter(Name="Floor", Value=bridgelevels_2)  # -> graft(Parameter)
parameter_27 = ConstructParameter(Name="Floor", Value=trim_3)  # -> graft(Parameter)
link_2 = ConstructLink(Bias=parameter_27)
parameter_28 = ConstructParameter(Name="Floors", Value=numberoffloors_2)
parameter_29 = ConstructParameter(Name="SplitLevel", Value="1")
parameter_30 = ConstructParameter(Name="SplitLevel", Value="2")
parameter_31 = ConstructParameter(Name="SplitLevel", Value="1")
parameter_32 = ConstructParameter(Name="Door", Value="1")
parameter_33 = ConstructParameter(Name="Door", Value="2")
parameter_34 = ConstructParameter(Name="Door", Value="3")
expression = Expression(x=parameter_34, y=parameter_26, Expression="x")
link_3 = ConstructLink(Bias=[parameter_26, expression])
parameter_35 = ConstructParameter(Name="SecondDoor", Value="1")
parameter_36 = ConstructParameter(Name="Bridge", Value=bridge_2)
prot = RotatePlane(Plane=xy, Angle=degrees("180"))
prot_2 = RotatePlane(Plane=xy, Angle=degrees("90"))
prot_3 = RotatePlane(Plane=xy, Angle=degrees("-90"))
expression_2 = Expression(x=parameter_31, y=parameter_27, Expression="x")
expression_3 = Expression(x=parameter_32, y=parameter_27, Expression="x")
expression_4 = Expression(x=parameter_30, y=parameter_27, Expression="x")
expression_5 = Expression(x=parameter_29, y=parameter_27, Expression="x")
expression_6 = Expression(x=parameter_33, y=parameter_27, Expression="x")
expression_7 = Expression(x=parameter_34, y=parameter_27, Expression="x")
merge_4 = Merge(Data1=merge_3, Data2=parameter_10, Data3=parameter_18)
merge_5 = Merge(Data1=merge_3, Data2=parameter_14, Data3=parameter_22)
merge_6 = Merge(Data1=merge_2, Data2=parameter_11, Data3=parameter_19)
merge_7 = Merge(Data1=merge_3, Data2=parameter_16, Data3=parameter_24)
plan = ConstructPlan(Uri=shafturi_2, Parameters=[parameter_36, parameter_28, parameter_35])  # -> Plan, Hash
merge_8 = Merge(Data1=merge_2, Data2=parameter_13, Data3=parameter_21)
merge_9 = Merge(Data1=merge_3, Data2=parameter_12, Data3=parameter_20)
merge_10 = Merge(Data1=merge_2, Data2=parameter_17, Data3=parameter_25)
merge_11 = Merge(Data1=merge_2, Data2=parameter_15, Data3=parameter_23)
link_4 = ConstructLink(Bias=[parameter_27, expression_4])
link_5 = ConstructLink(Bias=[parameter_27, expression_5, expression_3])
link_6 = ConstructLink(Bias=[parameter_27, expression_6])
link_7 = ConstructLink(Bias=[parameter_27, expression_2])
link_8 = ConstructLink(Bias=[parameter_27, expression_7])
sobject = ConstructSobject(Plan=plan.Plan)
connectable = ConstructConnectable(Sobject=sobject, Link=link_3)
trim_4 = TrimTree(Tree=connectable, Depth=1)
plan_2 = ConstructPlan(Uri=capsuleuri_2, Parameters=merge_4)  # -> Plan, Hash
link_9 = ConstructLink(Bias=[parameter_27, expression_6, expression_3])
link_10 = ConstructLink(Bias=parameter_27)
plan_3 = ConstructPlan(Uri=capsuleuri_2, Parameters=merge_6)  # -> Plan, Hash
plan_4 = ConstructPlan(Uri=capsuleuri_2, Parameters=merge_8)  # -> Plan, Hash
plan_5 = ConstructPlan(Uri=capsuleuri_2, Parameters=merge_11)  # -> Plan, Hash
plan_6 = ConstructPlan(Uri=capsuleuri_2, Parameters=merge_10)  # -> Plan, Hash
plan_7 = ConstructPlan(Uri=capsuleuri_2, Parameters=merge_9)  # -> Plan, Hash
plan_8 = ConstructPlan(Uri=capsuleuri_2, Parameters=merge_5)  # -> Plan, Hash
link_11 = ConstructLink(Bias=[parameter_27, expression_3, expression_4])
plan_9 = ConstructPlan(Uri=capsuleuri_2, Parameters=merge_7)  # -> Plan, Hash
connectable_2 = ConstructConnectable(Sobject=sobject, Link=link_4)
sobject_2 = ConstructSobject(Plan=plan_2.Plan)
sobject_3 = ConstructSobject(Pose=prot_3, Plan=plan_4.Plan)
connectable_3 = ConstructConnectable(Sobject=sobject, Link=link_5)
sobject_4 = ConstructSobject(Plan=plan_3.Plan)
connectable_4 = ConstructConnectable(Sobject=sobject, Link=link_6)
connectable_5 = ConstructConnectable(Sobject=sobject, Link=link_7)
sobject_5 = ConstructSobject(Pose=prot, Plan=plan_8.Plan)
connectable_6 = ConstructConnectable(Sobject=sobject, Link=link_9)
connectable_7 = ConstructConnectable(Sobject=sobject, Link=link_8)
sobject_6 = ConstructSobject(Pose=prot_2, Plan=plan_6.Plan)
sobject_7 = ConstructSobject(Pose=prot, Plan=plan_5.Plan)
sobject_8 = ConstructSobject(Pose=prot_3, Plan=plan_7.Plan)
connectable_8 = ConstructConnectable(Sobject=sobject, Link=link_10)
sobject_9 = ConstructSobject(Pose=prot_2, Plan=plan_9.Plan)
connectable_9 = ConstructConnectable(Sobject=sobject, Link=link_11)
connectable_10 = ConstructConnectable(Sobject=sobject_2, Link=link)
connectable_11 = ConstructConnectable(Sobject=sobject_4, Link=link)
connection = ConstructConnection(Connecting=connectable_10, Connected=connectable_2)
connection_2 = ConstructConnection(Connecting=connectable_11, Connected=connectable_3)
connectable_12 = ConstructConnectable(Sobject=sobject_3, Link=link)
connectable_13 = ConstructConnectable(Sobject=sobject_8, Link=link)
connectable_14 = ConstructConnectable(Sobject=sobject_5, Link=link)
connection_3 = ConstructConnection(Connecting=connectable_14, Connected=connectable_4)
connection_4 = ConstructConnection(Connecting=connectable_13, Connected=connectable_5)
connectable_15 = ConstructConnectable(Sobject=sobject_7, Link=link)
connectable_16 = ConstructConnectable(Sobject=sobject_9, Link=link)
connectable_17 = ConstructConnectable(Sobject=sobject_6, Link=link)
connection_5 = ConstructConnection(Connecting=connectable_15, Connected=connectable_6)
connection_6 = ConstructConnection(Connecting=connectable_12, Connected=connectable_7)
connection_7 = ConstructConnection(Connecting=connectable_16, Connected=connectable_8)
connection_8 = ConstructConnection(Connecting=connectable_17, Connected=connectable_9)
trim_5 = TrimTree(Tree=sobject_8, Depth=1)
trim_6 = TrimTree(Tree=sobject_4, Depth=1)
trim_7 = TrimTree(Tree=sobject_5, Depth=1)
trim_8 = TrimTree(Tree=sobject_9, Depth=1)
trim_9 = TrimTree(Tree=sobject_2, Depth=1)
trim_10 = TrimTree(Tree=sobject_6, Depth=1)
trim_11 = TrimTree(Tree=sobject_7, Depth=1)
trim_12 = TrimTree(Tree=sobject_3, Depth=1)
trim_13 = TrimTree(Tree=connection, Depth=1)
trim_14 = TrimTree(Tree=connection_3, Depth=1)
trim_15 = TrimTree(Tree=connection_4, Depth=1)
trim_16 = TrimTree(Tree=connection_2, Depth=1)
trim_17 = TrimTree(Tree=connection_5, Depth=1)
trim_18 = TrimTree(Tree=connection_6, Depth=1)
trim_19 = TrimTree(Tree=connection_7, Depth=1)
trim_20 = TrimTree(Tree=connection_8, Depth=1)
lng = ListLength(List=bridgelevels_2)
panel_3 = Panel("""RightLength
LeftLength""")
cull_i = CullIndex(List=trim_8, Indices=bridgelevels_2, Wrap=True)
dup_3 = DuplicateData(Data=bridgeuri_2, Number=lng, Order=True)
trim_21 = TrimTree(Tree=cull_i, Depth=1)
cull_i_2 = CullIndex(List=trim_19, Indices=bridgelevels_2, Wrap=True)
parameter_37 = ConstructParameter(Name=panel_3, Value=Slider(310, range=0..1000))
trim_22 = TrimTree(Tree=dup_3, Depth=1)
panel_4 = Panel(trim_22)
filter = StreamFilter(Gate=largetower_2, Stream0=trim_21, Stream1=trim_8)
trim_23 = TrimTree(Tree=cull_i_2, Depth=1)
plan_10 = ConstructPlan(Uri=trim_22, Parameters=parameter_37)  # -> Plan, Hash
filter_2 = StreamFilter(Gate=largetower_2, Stream0=trim_23, Stream1=trim_19)
merge_12 = Merge(Data1=trim_9, Data2=trim_5, Data3=trim_7, Data4=filter)
sobject_10 = ConstructSobject(Plan=plan_10.Plan)
replace = ReplaceItems(List=trim_12, Item=sobject_10, Indices=bridgelevels_2, Wrap=False)
trim_24 = TrimTree(Tree=replace, Depth=1)
filter_3 = StreamFilter(Gate=largetower_2, Stream0=trim_12, Stream1=trim_24)
merge_13 = Merge(Data1=trim_6, Data2=trim_10, Data3=trim_11, Data4=filter_3)
merge_14 = Merge(Data1=trim_13, Data2=filter_2, Data3=trim_14, Data4=trim_15)
connectable_18 = ConstructConnectable(Sobject=sobject_10)
connection_9 = ConstructConnection(Connecting=connectable_18, Connected=trim_4)
replace_2 = ReplaceItems(List=trim_18, Item=connection_9, Indices=bridgelevels_2, Wrap=False)
trim_25 = TrimTree(Tree=replace_2, Depth=1)
filter_4 = StreamFilter(Gate=largetower_2, Stream0=trim_18, Stream1=trim_25)
merge_15 = Merge(Data1=trim_16, Data2=trim_20, Data3=trim_17, Data4=filter_4)
fjs = FormatJsonString(JSONString=filter_4)
merge_16 = Merge(Data1=merge_12, Data2=merge_13)
merge_17 = Merge(Data1=merge_14, Data2=merge_15)
panel_5 = Panel(fjs)
merge_18 = Merge(Data1=sobject, Data2=merge_16)
merge_19 = Merge(Data1=merge_17)
C = Connection(merge_19)
so = Sobject(merge_18)
layout = ConstructLayout(Sobjects=merge_18, Connections=merge_19, Assembly=sobject)
run = Boolean(Toggle(False))
server = Text("http://localhost:2999")
C_2 = ClusterOutput(C)
so_2 = ClusterOutput(so)
layout_design = LayoutDesign(Url=server, Layout=layout, Run=run)
design = ShowDesign(Design=layout_design, Concepts="All")
design_2 = ShowDesign(Design=layout_design, Concepts="Doors")
dedesign = DeconstructDesign(Design=layout_design)  # -> Prototypes, Elements

# ==== cluster PreviewPlane: Preview a plane with axis colors and naming.
axis_length = ClusterInput()
plane = ClusterInput()
axis_length_2 = Number(axis_length)
plane_2 = Plane(plane)
deplane = DeconstructPlane(Plane=plane_2)  # -> Origin, XAxis, YAxis, ZAxis
line = LineSDL(Start=deplane.Origin, Direction=deplane.YAxis, Length=axis_length_2)
line_2 = LineSDL(Start=deplane.Origin, Direction=deplane.XAxis, Length=axis_length_2)
line_3 = LineSDL(Start=deplane.Origin, Direction=deplane.ZAxis, Length=axis_length_2)
swatch = ColourSwatch(SwatchColor=RGB(235, 52, 79))
swatch_2 = ColourSwatch(SwatchColor=RGB(0, 166, 157))
swatch_3 = ColourSwatch(SwatchColor=RGB(240, 117, 24))
end = EndPoints(Curve=line_2)  # -> Start, End
end_2 = EndPoints(Curve=line)  # -> Start, End
end_3 = EndPoints(Curve=line_3)  # -> Start, End
tag = TextTag(Location=end.End, Text="X", Colour=swatch)
tag_2 = TextTag(Location=end_2.End, Text="Y", Colour=swatch_2)
tag_3 = TextTag(Location=end_3.End, Text="Z", Colour=swatch_3)
preview = CustomPreview(Geometry=line_2, Material=swatch)
preview_2 = CustomPreview(Geometry=line, Material=swatch_2)
preview_3 = CustomPreview(Geometry=line_3, Material=swatch_3)

# ==== cluster Cluster_2
D = ClusterInput()
D_2 = Design(D)
dedesign = DeconstructDesign(Design=D_2)  # -> Prototypes, Elements
trim = TrimTree(Tree=dedesign.Elements, Depth=1)
trim_2 = TrimTree(Tree=dedesign.Prototypes, Depth=1)
viewer = ParamViewer(dedesign.Elements)
deelement = DeconstructElement(Element=trim)  # -> SobjectId, PlanHash, Pose
deprototype = DeconstructPrototype(Prototype=trim_2)  # -> PlanHash, Representations, Description
tstat = TreeStatistics(Tree=deprototype.Representations)  # -> Paths, Length, Count
hash = NAME(x=deprototype.PlanHash)  # -> h
# ---------- hash: Python ----------
#Component Information
#--------------------------------------------------------------------------------------------
if ghenv.Component.RunCount<2:
    #General
    #--------------------------------------------------------------------------------------------
    __author__ = "YOUR NAME"
    __version__ = "2000.00.00"
h = hash(x)
# ---------- end hash ----------
hash_2 = NAME(x=deelement.PlanHash)  # -> h; same code as hash
pln = Plane(deelement.Pose)
sort = SortList(Keys=hash, ValuesA=tstat.Paths)  # -> Keys, ValuesA
sort_2 = SortList(Keys=hash_2, ValuesA=pln, ValuesB=deelement.SobjectId)  # -> Keys, ValuesA, ValuesB
branch = TreeBranch(Tree=deprototype.Representations, Path=sort.ValuesA, MaintainPaths=False)
cset = CreateSet(List=sort_2.Keys)  # -> Set, Map
path = ConstructPath(Indices=graft(cset.Map))
item = ListItem(List=branch, Index=0, Wrap="False")  # -> Item, Item1
trim_3 = TrimTree(Tree=path, Depth=1)
relblbrch = RelabelBranches(TreeToMatch=graft(sort_2.ValuesA), ListOfPaths=trim_3)  # -> RelabeledTree; inputs TreeToMatch: tree, ListOfPaths: list; same code as relblbrch
imrepresentation = ImportRepresentation(Representation=item.Item)
trim_4 = TrimTree(Tree=imrepresentation, Depth=1)
pln_2 = Plane(relblbrch)
mtontreecopy = MtoNTreeCopy(tree=trim_4, targettree=pln_2)  # -> tree_4, targettree_4
pl2pl = MoveObjectPlaneToPlane(G=mtontreecopy.tree_4, S=PlaneXY(0, 0, 0), T=mtontreecopy.targettree_4)  # -> TG, T; inputs S: Plane, T: Plane
# ---------- pl2pl: Python ----------
#Component Information
#--------------------------------------------------------------------------------------------
if ghenv.Component.RunCount<2:
    #General
    #--------------------------------------------------------------------------------------------
    __author__ = "Ueli Saluz"
    __version__ = "2023.02.12"
    
    ghenv.Component.Name = "MoveObjectPlaneToPlane"
    ghenv.Component.NickName = "Pl2Pl"
    ghenv.Component.Description = "Moves abitrary geometry from a source plane to a target plane."
    ghenv.Component.Message = "VER 1.2"
    ghenv.Component.Category = "Transform"
    ghenv.Component.SubCategory = "Euclidean"
    
     #Inputs
    #--------------------------------------------------------------------------------------------
    inputIndex=0
    
    ghenv.Component.Params.Input[inputIndex].Name = "Geometry"
    ghenv.Component.Params.Input[inputIndex].NickName = "G"
    ghenv.Component.Params.Input[inputIndex].Description = "Geometry to move."
    ghenv.Component.Params.Input[inputIndex].Optional = False
    inputIndex+=1
    
    ghenv.Component.Params.Input[inputIndex].Name = "SourcePlane"
    ghenv.Component.Params.Input[inputIndex].NickName = "S"
    ghenv.Component.Params.Input[inputIndex].Description = "Source plane of object."
    ghenv.Component.Params.Input[inputIndex].Optional = False
    inputIndex+=1
    
    ghenv.Component.Params.Input[inputIndex].Name = "TargetPlane"
    ghenv.Component.Params.Input[inputIndex].NickName = "T"
    ghenv.Component.Params.Input[inputIndex].Description = "Target plane of object."
    ghenv.Component.Params.Input[inputIndex].Optional = False
    inputIndex+=1
    
    #Outputs
    #--------------------------------------------------------------------------------------------
    outputIndex=0
    
    ghenv.Component.Params.Output[outputIndex].Name = "TranslatedGeometry"
    ghenv.Component.Params.Output[outputIndex].NickName = "TG"
    ghenv.Component.Params.Output[outputIndex].Description = "Translated geometry in target plane."
    outputIndex+=1
    
    ghenv.Component.Params.Output[outputIndex].Name = "Trasnform"
    ghenv.Component.Params.Output[outputIndex].NickName = "T"
    ghenv.Component.Params.Output[outputIndex].Description = "Transform describing translation form source to target plane."
    outputIndex+=1


#Imports
#--------------------------------------------------------------------------------------------
import Rhino.Geometry.Transform as trsf

def MvObjPlnToPln (geo,plnObj,plnDest):
    transform = trsf.PlaneToPlane(plnObj,plnDest)
    geo.Transform(transform)
    return (geo,transform)

TG, T = MvObjPlnToPln(G,S,T)
# ---------- end pl2pl ----------
area = Area(Geometry=pl2pl.TG)  # -> Area, Centroid
avgp = AveragePoint(P=area.Centroid)  # -> AvP; inputs P: list of Point3d, M: list of Double
# ---------- avgp: C# usings ----------
using System.Linq;
# ---------- avgp: C# ----------
    //Author: Ueli Saluz
    //Last modified: 29.05.2020
    //Contact: usaluz@outlook.de

    if (Component.RunCount < 2)
    {
      Component.Name = "AveragePoint";
      Component.NickName = "AvgP";
      Component.Description = "Get the average point from a set of planes. Provide multiplier to weight some planes more.";
      Component.Params.Input[0].Name = "Points";
      Component.Params.Input[0].Description = "Points to take average from.";
      Component.Params.Input[1].Name = "Multipliers";
      Component.Params.Input[1].Description = "Multipliers act like weights towards a point.";

      Component.Params.Output[0].Name = "AveragePoint";
      Component.Params.Output[0].Description = "Resulting average point.";

      Component.Message = "VER 1.0";
    }
    if(P != null)
      AvP = GetAveragePoint(P.ToArray(), M.ToArray());
# ---------- avgp: C# additional code ----------
  public Point3d GetAveragePoint(Point3d[] points, double[] multipliers)
  {
    if (multipliers.Length < points.Length)
      multipliers = multipliers.Concat(Enumerable.Repeat(1d, points.Length - multipliers.Length)).ToArray();
    else if (multipliers.Length > points.Length)
      multipliers = multipliers.Take(points.Length).ToArray();

    if (multipliers.Sum() == 0)
      multipliers = Enumerable.Repeat(1d, points.Length).ToArray();

    var sum = multipliers.Sum();
    multipliers = multipliers.Select(x => x / sum).ToArray();

    for (int i = 0; i < points.Length; i++)
      points[i].Transform(new Transform(multipliers[i]));

    return points.Aggregate((a,b) => a + b);;
  }
# ---------- end avgp ----------
geo = Geometry(pl2pl.TG)
centroid = Point(avgp)
planhash = Text(sort_2.ValuesB)
geo_2 = ClusterOutput(geo)
centroid_2 = ClusterOutput(centroid)
planhash_2 = ClusterOutput(planhash)

# ==== cluster Cluster_3
attributes = ClusterInput()
pt = ClusterInput()
idprefix = ClusterInput()
content = ClusterInput()
attributes_2 = Text(attributes)
pt_2 = Point(pt)
content_2 = Text(content)
idprefix_2 = Text(idprefix)
lng = ListLength(List=pt_2)
pdecon = Deconstruct(Point=pt_2)  # -> XComponent, YComponent, ZComponent
series = Series(Start=0, Step=1, Count=lng)
roundd = RoundToDecimalPlace(NumberX=pdecon.XComponent, DecimalPlace="2", RoundType=0)  # -> Rounded, Difference
roundd_2 = RoundToDecimalPlace(NumberX=pdecon.YComponent, DecimalPlace="2", RoundType=0)  # -> Rounded, Difference
roundd_3 = RoundToDecimalPlace(NumberX=pdecon.ZComponent, DecimalPlace="2", RoundType=0)  # -> Rounded, Difference
trim = TrimTree(Tree=series, Depth=1)
concat = Concatenate(
    FragmentA="\node [",
    FragmentJ=attributes_2,
    FragmentK="] (",
    FragmentL=idprefix_2,
    FragmentH=trim,
    FragmentI=") at (",
    FragmentB=roundd.Rounded,
    FragmentC=",",
    FragmentD=roundd_2.Rounded,
    FragmentE=",",
    FragmentF=roundd_3.Rounded,
    FragmentG="){",
    FragmentM=content_2,
    FragmentN="};")  # -> flatten(Result)
concat_2 = Concatenate(
    FragmentA="\draw [",
    FragmentJ=attributes_2,
    FragmentK="] (",
    FragmentB=roundd.Rounded,
    FragmentC=",",
    FragmentD=roundd_2.Rounded,
    FragmentE=",",
    FragmentF=roundd_3.Rounded,
    FragmentG=") circle;")  # -> flatten(Result)
pt_3 = ConstructPoint(XCoordinate=roundd.Rounded, YCoordinate=roundd_2.Rounded, ZCoordinate=roundd_3.Rounded)
concat_3 = Concatenate(FragmentA=idprefix_2, FragmentB=trim)
locations = Point(pt_3)
ids = Text(concat_3)
idnums = Integer(trim)
circles = Text(concat_2)
nodes = Text(concat)
ids_2 = ClusterOutput(ids)
locations_2 = ClusterOutput(locations)
idnums_2 = ClusterOutput(idnums)
circles_2 = ClusterOutput(circles)
nodes_2 = ClusterOutput(nodes)
panel = Panel(circles)

# ==== cluster Cluster
geo = ClusterInput()
T = ClusterInput()
T_2 = ClusterInput()
T_3 = ClusterInput()
geo_2 = Geometry(geo)

area = Area(Geometry=geo_2)  # -> Area, Centroid
move = Move(Geometry=geo_2, Motion=T_3)  # -> Geometry, Transform
trim = TrimTree(Tree=move.Geometry, Depth=1)
item = ListItem(List=trim, Index=0, Wrap=True)  # -> Item, Item1, Item2
move_2 = Move(Geometry=item.Item, Motion=T_2)  # -> Geometry, Transform
move_3 = Move(Geometry=item.Item2, Motion=T)  # -> Geometry, Transform
merge = Merge(Data1=move_2.Geometry, Data2=item.Item1, Data3=move_3.Geometry)
match = MatchTree(Tree=graft(merge), Guide=geo_2)
geo_3 = Geometry(match)
geo_4 = ClusterOutput(geo_3)

tstat = TreeStatistics(Tree=geo_2)  # -> Paths, Length, Count
item_2 = ListItem(List=tstat.Paths, Index=0, Wrap=True)  # -> Item, Item1, Item2
merge_2 = Merge(Data1=move_2.Transform, Data2=move_3.Transform)  # -> graft(Result)
merge_3 = Merge(Data1=item_2.Item, Data3=item_2.Item2)
relblbrch = RelabelBranches(TreeToMatch=merge_2, ListOfPaths=merge_3)  # -> RelabeledTree; inputs TreeToMatch: tree, ListOfPaths: list
# ---------- relblbrch: Python ----------
if ghenv.Component.RunCount<2:
    __author__ = "Your name"
    __version__ = "2000.00.00"
    
    ghenv.Component.Name = "RelabelBranches"
    ghenv.Component.NickName = "ReLblBrch"
    ghenv.Component.Description = "Relabel all the paths of the branches with a list of new paths. The amount of branches must match with the size of the list of pahts"
    ghenv.Component.Message = "VER 1.0"
    
    ghenv.Component.Params.Input[0].NickName = "TreeToMatch"
    ghenv.Component.Params.Input[1].NickName = "ListOfPaths"
    
    ghenv.Component.Params.Input[0].Description = "Tree that should be relabeled."
    ghenv.Component.Params.Input[1].Description = "List of paths to use for new branch paths."
    
    ghenv.Component.Params.Output[0].NickName = "RelabeledTree"
    ghenv.Component.Params.Output[0].Description = "Relabeled tree where all the paths of the branches have been replaced with new paths."

from System import Object
from Grasshopper import DataTree

def relabelBranchesWithLstOfPths (tree, paths):
    newTree = DataTree[Object]()
    for i,path in enumerate(tree.Paths):
        items = tree.Branch(path)
        for data in items:
            newTree.Add(data,paths[i])
    return newTree

if __name__ == "__main__":
    RelabeledTree = relabelBranchesWithLstOfPths(TreeToMatch,ListOfPaths)
# ---------- end relblbrch ----------
merge_4 = Merge(Data1=item_2.Item, Data3=item_2.Item2)
merge_5 = Merge(Data1=move.Transform, Data2=relblbrch)
transform = Transform(merge_5)
transform_2 = ClusterOutput(transform)

transform_3 = Transform(Geometry=area.Centroid, Transform=move.Transform)
trim_2 = TrimTree(Tree=transform_3, Depth=1)
item_3 = ListItem(List=trim_2, Index=0, Wrap=True)  # -> Item, Item1, Item2
transform_4 = Transform(Geometry=item_3.Item, Transform=move_2.Transform)
transform_5 = Transform(Geometry=item_3.Item2, Transform=move_3.Transform)
merge_6 = Merge(Data1=transform_4, Data3=transform_5)  # -> graft(Result)

relblbrch_2 = RelabelBranches(TreeToMatch=merge_6, ListOfPaths=merge_4)  # -> RelabeledTree; inputs TreeToMatch: tree, ListOfPaths: list; same code as relblbrch

merge_7 = Merge(Data1=area.Centroid, Data2=transform_3, Data3=relblbrch_2)
pt = Point(merge_7)
pt_2 = ClusterOutput(pt)

# ==== cluster MtoNTreeCopy
targettree = ClusterInput()
tree = ClusterInput()
targettree_2 = Data(targettree)
tree_2 = Data(tree)
tstat = TreeStatistics(Tree=tree_2)  # -> Paths, Length, Count
tstat_2 = TreeStatistics(Tree=targettree_2)  # -> Paths, Length, Count
multiplication = Multiplication(A=tstat.Length, B=tstat_2.Length)
equals = Equality(FirstNumber=tstat.Length, SecondNumber=multiplication)  # -> Equality, Inequality
equals_2 = Equality(FirstNumber=tstat_2.Length, SecondNumber=multiplication)  # -> Equality, Inequality
lng = ListLength(List=tstat.Paths)
series = Series(Start=0, Step=1, Count=lng)
or = GateOr(A=equals.Equality, B=equals_2.Equality)
trim = TrimTree(Tree=series, Depth=1)
dispatch = Dispatch(List=tstat.Paths, DispatchPattern=or)  # -> ListA, ListB
dispatch_2 = Dispatch(List=trim, DispatchPattern=or)  # -> ListA, ListB
branch = TreeBranch(Tree=tree_2, Path=dispatch.ListB, MaintainPaths=True)
item = ListItem(List=tstat.Length, Index=dispatch_2.ListB, Wrap=True)
dpath = DeconstructPath(Branch=dispatch.ListA)
dup = DuplicateData(Data=graft(branch), Number=item, Order=True)
dpath_2 = DeconstructPath(Branch=dispatch.ListB)
series_2 = Series(Start=0, Step=1, Count=item)
expression = Expression(x="0", y=dpath, Expression="x")
trim_2 = TrimTree(Tree=dpath_2, Depth=1)
trim_3 = TrimTree(Tree=series_2, Depth=1)
trim_4 = TrimTree(Tree=dup, Depth=1)
merge = Merge(Data1=dpath, Data2=expression)
expression_2 = Expression(x=trim_2, y=trim_3, Expression="x")
flip = FlipMatrix(Data=trim_4)
branch_2 = TreeBranch(Tree=tree_2, Path=dispatch.ListA, MaintainPaths=True)
branch_3 = TreeBranch(Tree=targettree_2, Path=dispatch.ListA, MaintainPaths=True)
path = ConstructPath(Indices=merge)  # -> flatten(Branch)
merge_2 = Merge(Data1=graft(expression_2), Data2=graft(trim_3))
l2o = List2Object(L=branch_2)  # -> O; inputs L: tree
# ---------- l2o: Python ----------
#Component Information
#--------------------------------------------------------------------------------------------
if ghenv.Component.RunCount<2:
    #General
    #--------------------------------------------------------------------------------------------
    __author__ = "Ueli Saluz"
    __version__ = "2022.04.24"
    
    ghenv.Component.Name = "List2Object"
    ghenv.Component.NickName = "L2O"
    ghenv.Component.Description = "Wraps a list of objects into a list object."
    ghenv.Component.Message = "VER 1.0"
    ghenv.Component.Category = "Sets"
    ghenv.Component.SubCategory = "Tree"
    
     #Inputs
    #--------------------------------------------------------------------------------------------
    inputIndex=0
    
    ghenv.Component.Params.Input[inputIndex].Name = "List"
    ghenv.Component.Params.Input[inputIndex].NickName = "L"
    ghenv.Component.Params.Input[inputIndex].Description = "Tree with lists to wrap."
    ghenv.Component.Params.Input[inputIndex].Optional = False
    inputIndex+=1
    

    #Outputs
    #--------------------------------------------------------------------------------------------
    outputIndex=0
    
    ghenv.Component.Params.Output[outputIndex].Name =  "ListObject" 
    ghenv.Component.Params.Output[outputIndex].NickName = "O"
    ghenv.Component.Params.Output[outputIndex].Description = "Python list object as single item."
    outputIndex+=1


#Imports
#--------------------------------------------------------------------------------------------
from System import Object
from Grasshopper import DataTree

#Solver - Run with trees to enhance performance drastically
#--------------------------------------------------------------------------------------------
if __name__ == "__main__":
    
    #Initialize trees
    #--------------------------------------------------------------------------------------------
    TreeToWrap = DataTree[Object]()
    
    #Data matching
    #--------------------------------------------------------------------------------------------
    for path in L.Paths:
        listBranch = L.Branch(path)
        TreeToWrap.Add(listBranch,path)
    
     #Assign trees to output
    #--------------------------------------------------------------------------------------------
    O = TreeToWrap
# ---------- end l2o ----------
relblbrch = RelabelBranches(TreeToMatch=branch_2, ListOfPaths=flatten(path))  # -> RelabeledTree; inputs TreeToMatch: tree, ListOfPaths: list; same code as relblbrch
path_2 = ConstructPath(Indices=merge_2)
mtchanc = MatchAncestor(AT=l2o, CT=graft(branch_3))  # -> MAT; inputs AT: tree, CT: tree
# ---------- mtchanc: Python ----------
if ghenv.Component.RunCount<2:
    __author__ = "Ueli Saluz"
    __version__ = "2022.04.25"
    
    ghenv.Component.Name = "Match Ancestor"
    ghenv.Component.NickName = "MtchAnc"
    ghenv.Component.Description = "Duplicates all elements of an ancestor tree to match the amount of elements in the child tree."
    ghenv.Component.Message = "VER 1.1"
    
    ghenv.Component.Params.Input[0].Name = "AncestorTree"
    ghenv.Component.Params.Input[0].NickName = "AT"
    ghenv.Component.Params.Input[0].Description = "Ancestor tree that data will the duplicated until it matches the child tree"
    ghenv.Component.Params.Input[0].Optional = False
    
    ghenv.Component.Params.Input[1].Name = "ChildTree"
    ghenv.Component.Params.Input[1].NickName = "CT"
    ghenv.Component.Params.Input[1].Description = "Child tree that branches will the guide to duplicat the data of the ancestor tree"
    ghenv.Component.Params.Input[0].Optional = False
    
    ghenv.Component.Params.Output[0].Name = "MatchedAncestorTree"
    ghenv.Component.Params.Output[0].NickName = "MAT"
    ghenv.Component.Params.Output[0].Description = "Matched ancestor tree with the amount of items and the branch paths of the child tree"

from System import Object
from Grasshopper import DataTree

"""Returns a new tree with the ancestor data being duplicated along all child branches which where child paths of that ancestor.
    Inputs:
        ancestorTree: Ancestor tree that data will the duplicated until it matches the child tree
        childTree: Child tree that branches will the guide to duplicat the data of the ancestor tree
    Output:
        matchedAncestorTree: Matched ancestor tree with the amount of items and the branch paths of the child tree"""
def MatchAncestorTreeToChildTree (ancestorTree, childTree):
    
    matchedAncestorTree = DataTree[Object]()
    dummy = 0
    for i,pathAncestor in enumerate(ancestorTree.Paths):
        branch = ancestorTree.Branch(pathAncestor)
        if len(branch)!=1:
            raise Exception("Ancestor must be grafted and containing one item per branch")
        #The item to be duplicated
        item = branch[0]
        for j,pathChild in enumerate(childTree.Paths):
            #Returns a tuple and not like in the documentation described a bool with a pointer to the int to store the generations
            checkAncestor = pathChild.IsAncestor(pathAncestor,dummy)
            if(checkAncestor[0]):
                matchedAncestorTree.AddRange([item]*childTree.Branch(pathChild).Count,pathChild)
    return matchedAncestorTree

if __name__ == "__main__":
    MAT = MatchAncestorTreeToChildTree (AT,CT)
# ---------- end mtchanc ----------
relblbrch_2 = RelabelBranches(TreeToMatch=flip, ListOfPaths=flatten(path_2))  # -> RelabeledTree; inputs TreeToMatch: tree, ListOfPaths: list; same code as relblbrch
o2l = Object2List(O=mtchanc)  # -> L; inputs O: tree
# ---------- o2l: Python ----------
#Component Information
#--------------------------------------------------------------------------------------------
if ghenv.Component.RunCount<2:
    #General
    #--------------------------------------------------------------------------------------------
    __author__ = "Ueli Saluz"
    __version__ = "2022.04.24"
    
    ghenv.Component.Name = "Object2List"
    ghenv.Component.NickName = "O2L"
    ghenv.Component.Description = "Unwraps a list of objects into a list object."
    ghenv.Component.Message = "VER 1.0"
    ghenv.Component.Category = "Sets"
    ghenv.Component.SubCategory = "Tree"
    
     #Inputs
    #--------------------------------------------------------------------------------------------
    inputIndex=0
    
    ghenv.Component.Params.Input[inputIndex].Name = "ListObject"
    ghenv.Component.Params.Input[inputIndex].NickName = "O"
    ghenv.Component.Params.Input[inputIndex].Description = "A python list object that will be unwrapped into a Grasshopper list."
    ghenv.Component.Params.Input[inputIndex].Optional = False
    inputIndex+=1
    

    #Outputs
    #--------------------------------------------------------------------------------------------
    outputIndex=0
    
    ghenv.Component.Params.Output[outputIndex].Name =  "List"
    ghenv.Component.Params.Output[outputIndex].NickName = "L"
    ghenv.Component.Params.Output[outputIndex].Description = "The unwrapped list."
    outputIndex+=1


#Imports
#--------------------------------------------------------------------------------------------
from System import Object
from Grasshopper import DataTree

#Solver - Run with trees to enhance performance drastically
#--------------------------------------------------------------------------------------------
if __name__ == "__main__":
    
    #Initialize trees
    #--------------------------------------------------------------------------------------------
    OriginalTree = DataTree[Object]()
    
    #Data matching
    #--------------------------------------------------------------------------------------------
    for path in O.Paths:
        listBranch = O.Branch(path)
        for i,listItem in enumerate(listBranch):
            OriginalTree.AddRange(list(listItem),path.AppendElement(i))
    
     #Assign trees to output
    #--------------------------------------------------------------------------------------------
    L = OriginalTree
# ---------- end o2l ----------
trim_5 = TrimTree(Tree=o2l, Depth=1)
merge_3 = Merge(Data1=relblbrch_2, Data2=trim_5)
targettree_3 = Data(graft(targettree_2))
tree_3 = Data(merge_3)
tree_4 = ClusterOutput(tree_3)
targettree_4 = ClusterOutput(targettree_3)
