# Grasshopper definition simplecapsuletower.gh (Grasshopper 1.0.7)
# plug-ins: Semio, Swiftlet, Human, LunchBox, MetaHopper

list = ValueList({"Front", "Side"}, selected="Front")
list_2 = ValueList({"Back", "Side"}, selected="Side")
parameter = ConstructParameter(Name="Length", Value=Slider(420, range=0..1000))
parameter_2 = ConstructParameter(Name="Width", Value=Slider(270, range=0..1000))
parameter_3 = ConstructParameter(Name="Height", Value=Slider(275, range=0..1000))
parameter_4 = ConstructParameter(Name="Entrance", Value=list_2)
parameter_5 = ConstructParameter(Name="Window", Value=list)
panel = Panel("C:\Git\Studium\PhD\semio\examples\nakagincapsuletower")
parameter_6 = ConstructParameter(Name="Width", Value=Slider(275, range=0..1000))
parameter_7 = ConstructParameter(Name="Length", Value=Slider(450, range=0..1000))
parameter_8 = ConstructParameter(Name="Height", Value=Slider(300, range=0..1000))
xy = XYPlane(Origin=Point(0, 0, 0))
parameter_9 = ConstructParameter(Name="Width", Value=Slider(300, range=0..1000))
parameter_10 = ConstructParameter(Name="Length", Value=Slider(400, range=0..1000))
parameter_11 = ConstructParameter(Name="Height", Value=Slider(300, range=0..1000))
merge = Merge(Data2=parameter_7, Data3=parameter_6, Data4=parameter_8)
merge_2 = Merge(Data2=parameter_10, Data3=parameter_9, Data4=parameter_11)
list_3 = ValueList({"Front", "Side"}, selected="Side")
list_4 = ValueList({"Back", "Side"}, selected="Side")
list_5 = ValueList({"Front", "Side"}, selected="Side")
list_6 = ValueList({"Back", "Side"}, selected="Side")
list_7 = ValueList({"Front", "Right", "Bottom", "Left"}, selected="Left")
concat = Concatenate(FragmentA=panel, FragmentB="\", FragmentC="base.gh")
concat_2 = Concatenate(FragmentA=panel, FragmentB="\", FragmentC="shaft.gh")
concat_3 = Concatenate(FragmentA=panel, FragmentB="\", FragmentC="capital.gh")
concat_4 = Concatenate(FragmentA=panel, FragmentB="\", FragmentC="capsule.gh")
parameter_12 = ConstructParameter(Name="Mirror", Value=Toggle(True))
parameter_13 = ConstructParameter(Name="Entrance", Value=list_4)
parameter_14 = ConstructParameter(Name="Window", Value=list_3)
prot = RotatePlane(Plane=xy, Angle=degrees("180"))
parameter_15 = ConstructParameter(Name="Mirror", Value=Toggle(True))
parameter_16 = ConstructParameter(Name="Entrance", Value=list_6)
parameter_17 = ConstructParameter(Name="Window", Value=list_5)
prot_2 = RotatePlane(Plane=xy, Angle=degrees("-90"))
parameter_18 = ConstructParameter(Name="Door", Value=Slider(1, range=0..10))
parameter_19 = ConstructParameter(Name="Floors", Value=Slider(4, range=0..10))
parameter_20 = ConstructParameter(Name="Door", Value=Slider(3, range=0..10))
parameter_21 = ConstructParameter(Name="FloorHeight", Value=Slider(300, range=0..1000))
parameter_22 = ConstructParameter(Name="Width", Value=Slider(400, range=0..1000))
parameter_23 = ConstructParameter(Name="SplitLevel", Value=Slider(1, range=0..10))
parameter_24 = ConstructParameter(Name="Bridge", Value=list_7)
parameter_25 = ConstructParameter(Name="Floor", Value=Slider(1, range=0..10))
parameter_26 = ConstructParameter(Name="Floor", Value=Slider(2, range=0..10))
parameter_27 = ConstructParameter(Name="Floor", Value=Slider(3, range=0..10))
plan = ConstructPlan(Uri=concat_4, Parameters=[merge, parameter_14])  # -> Plan, Hash
plan_2 = ConstructPlan(Uri=concat_4, Parameters=[merge, parameter_14])  # -> Plan, Hash
plan_3 = ConstructPlan(Uri=concat_4, Parameters=[merge, parameter_13, parameter_12])  # -> Plan, Hash
link = ConstructLink(Bias=parameter_20)
link_2 = ConstructLink(Bias=[parameter_25, parameter_20])
link_3 = ConstructLink(Bias=[parameter_26, parameter_20])
plan_4 = ConstructPlan(Uri=concat_4, Parameters=merge_2)  # -> Plan, Hash
link_4 = ConstructLink(Bias=[parameter_23, parameter_18])
plan_5 = ConstructPlan(Uri=concat_4, Parameters=merge_2)  # -> Plan, Hash
plan_6 = ConstructPlan(Uri=concat_4, Parameters=[merge_2, parameter_16, parameter_15, parameter_17])  # -> Plan, Hash
link_5 = ConstructLink(Bias=[parameter_23, parameter_18, parameter_25])
link_6 = ConstructLink(Bias=[parameter_23, parameter_27, parameter_18, parameter_26])
plan_7 = ConstructPlan(Uri=concat_2, Parameters=[parameter_22, parameter_24, parameter_19, parameter_21])  # -> Plan, Hash
sobject = ConstructSobject(Pose=prot, Plan=plan.Plan)
sobject_2 = ConstructSobject(Pose=prot, Plan=plan_2.Plan)
link_7 = ConstructLink(Ports="Door")
sobject_3 = ConstructSobject(Pose=prot, Plan=plan_3.Plan)
link_8 = ConstructLink(Ports="Door")
link_9 = ConstructLink(Ports="Door")
sobject_4 = ConstructSobject(Pose=prot_2, Plan=plan_4.Plan)
sobject_5 = ConstructSobject(Pose=prot_2, Plan=plan_5.Plan)
link_10 = ConstructLink(Ports="Door")
sobject_6 = ConstructSobject(Pose=prot_2, Plan=plan_6.Plan)
link_11 = ConstructLink(Ports="Door")
link_12 = ConstructLink(Ports="Door")
sobject_7 = ConstructSobject(Plan=plan_7.Plan)
connectable = ConstructConnectable(Sobject=sobject_7, Link=link)
connectable_2 = ConstructConnectable(Sobject=sobject_7, Link=link_2)
connectable_3 = ConstructConnectable(Sobject=sobject_7, Link=link_3)
connectable_4 = ConstructConnectable(Sobject=sobject_7, Link=link_4)
connectable_5 = ConstructConnectable(Sobject=sobject_7, Link=link_5)
connectable_6 = ConstructConnectable(Sobject=sobject_7, Link=link_6)
connectable_7 = ConstructConnectable(Sobject=sobject_2, Link=link_8)
connectable_8 = ConstructConnectable(Sobject=sobject, Link=link_9)
connectable_9 = ConstructConnectable(Sobject=sobject_3, Link=link_7)
connectable_10 = ConstructConnectable(Sobject=sobject_5, Link=link_11)
connectable_11 = ConstructConnectable(Sobject=sobject_4, Link=link_12)
connectable_12 = ConstructConnectable(Sobject=sobject_6, Link=link_10)
connection = ConstructConnection(Connecting=connectable_7, Connected=connectable)
connection_2 = ConstructConnection(Connecting=connectable_8, Connected=connectable_2)
connection_3 = ConstructConnection(Connecting=connectable_9, Connected=connectable_3)
connection_4 = ConstructConnection(Connecting=connectable_10, Connected=connectable_4)
connection_5 = ConstructConnection(Connecting=connectable_11, Connected=connectable_5)
connection_6 = ConstructConnection(Connecting=connectable_12, Connected=connectable_6)
run = Boolean(Toggle(True))
server = Text("http://localhost:2999")
merge_3 = Merge(Data1=connection, Data2=connection_2, Data3=connection_3)
merge_4 = Merge(Data1=connection_4, Data2=connection_5, Data3=connection_6)
merge_5 = Merge(Data1=sobject_2, Data2=sobject, Data3=sobject_3)
merge_6 = Merge(Data1=sobject_5, Data2=sobject_4, Data3=sobject_6)
merge_7 = Merge(Data1=sobject_7, Data2=sobject)
merge_8 = Merge(Data1=sobject_7, Data2=merge_5, Data3=merge_6)
merge_9 = Merge(Data1=merge_3, Data2=merge_4)
layout = ConstructLayout(Sobjects=merge_7, Connections=connection_2, Assembly=sobject_7)
layout_2 = ConstructLayout(Sobjects=merge_8, Connections=merge_9, Assembly=sobject_7)
fjs = FormatJsonString(JSONString=layout_2)
panel_2 = Panel(fjs)
layout_design = LayoutDesign(Url=server, Layout=layout, Run=run)
layout_design_2 = LayoutDesign(Url=server, Layout=layout_2, Run=run)
design = ShowDesign(Design=layout_design, Concepts="Simple")
design_2 = ShowDesign(Design=layout_design_2, Concepts="Simple")
D = Design(layout_design_2)
dedesign = DeconstructDesign(Design=D)  # -> Prototypes, Elements
trim = TrimTree(Tree=dedesign.Prototypes, Depth=1)
trim_2 = TrimTree(Tree=dedesign.Elements, Depth=1)
deelement = DeconstructElement(Element=trim_2)  # -> SobjectId, PlanHash, Pose
deprototype = DeconstructPrototype(Prototype=trim)  # -> PlanHash, Representations, Description
item = ListItem(List=deprototype.Representations, Index=0, Wrap="False")  # -> Item, Item1
imrepresentation = ImportRepresentation(Representation=item.Item)
pln = Plane(graft(deelement.Pose))
trim_3 = TrimTree(Tree=imrepresentation, Depth=1)
imrepresentation_2 = ImportRepresentation(Representation=item.Item1)
pl2pl = MoveObjectPlaneToPlane(G=trim_3, S=PlaneXY(0, 0, 0), T=pln)  # -> TG, T; inputs S: Plane, T: Plane
# ---------- pl2pl: Python ----------
#Component Information
#--------------------------------------------------------------------------------------------
if ghenv.Component.RunCount<2:
    #General
    #--------------------------------------------------------------------------------------------
    __author__ = "Ueli Saluz"
    __version__ = "2023.02.12"
    
    ghenv.Component.Name = "MoveObjectPlaneToPlane"
    ghenv.Component.NickName = "Pl2Pl"
    ghenv.Component.Description = "Moves abitrary geometry from a source plane to a target plane."
    ghenv.Component.Message = "VER 1.2"
    ghenv.Component.Category = "Transform"
    ghenv.Component.SubCategory = "Euclidean"
    
     #Inputs
    #--------------------------------------------------------------------------------------------
    inputIndex=0
    
    ghenv.Component.Params.Input[inputIndex].Name = "Geometry"
    ghenv.Component.Params.Input[inputIndex].NickName = "G"
    ghenv.Component.Params.Input[inputIndex].Description = "Geometry to move."
    ghenv.Component.Params.Input[inputIndex].Optional = False
    inputIndex+=1
    
    ghenv.Component.Params.Input[inputIndex].Name = "SourcePlane"
    ghenv.Component.Params.Input[inputIndex].NickName = "S"
    ghenv.Component.Params.Input[inputIndex].Description = "Source plane of object."
    ghenv.Component.Params.Input[inputIndex].Optional = False
    inputIndex+=1
    
    ghenv.Component.Params.Input[inputIndex].Name = "TargetPlane"
    ghenv.Component.Params.Input[inputIndex].NickName = "T"
    ghenv.Component.Params.Input[inputIndex].Description = "Target plane of object."
    ghenv.Component.Params.Input[inputIndex].Optional = False
    inputIndex+=1
    
    #Outputs
    #--------------------------------------------------------------------------------------------
    outputIndex=0
    
    ghenv.Component.Params.Output[outputIndex].Name = "TranslatedGeometry"
    ghenv.Component.Params.Output[outputIndex].NickName = "TG"
    ghenv.Component.Params.Output[outputIndex].Description = "Translated geometry in target plane."
    outputIndex+=1
    
    ghenv.Component.Params.Output[outputIndex].Name = "Trasnform"
    ghenv.Component.Params.Output[outputIndex].NickName = "T"
    ghenv.Component.Params.Output[outputIndex].Description = "Transform describing translation form source to target plane."
    outputIndex+=1


#Imports
#--------------------------------------------------------------------------------------------
import Rhino.Geometry.Transform as trsf

def MvObjPlnToPln (geo,plnObj,plnDest):
    transform = trsf.PlaneToPlane(plnObj,plnDest)
    geo.Transform(transform)
    return (geo,transform)

TG, T = MvObjPlnToPln(G,S,T)
# ---------- end pl2pl ----------
clean = CleanTree(RemoveNulls=True, RemoveInvalid=True, RemoveEmpty=True, Tree=imrepresentation_2)
vec = VectorXYZ(XComponent=Slider(1, range=-10..10), YComponent=Slider(1, range=-10..10), ZComponent=Slider(-1, range=-10..10))  # -> Vector, Length
swatch = ColourSwatch(SwatchColor=RGB(191, 216, 255))
swatch_2 = ColourSwatch(SwatchColor=RGB(0, 0, 0))
swatch_3 = ColourSwatch(SwatchColor=RGB(75, 85, 100))
swatch_4 = ColourSwatch(SwatchColor=RGB(37, 42, 50))
trim_4 = TrimTree(Tree=clean, Depth=1)
mcol = MeshColours(Colours=[RGB(127, 255, 0), RGB(0, 100, 0), RGB(34, 139, 34), RGB(124, 252, 0), RGB(154, 205, 50), RGB(173, 255, 47), RGB(50, 205, 50), RGB(152, 251, 152)])
genes = GenePool(Decimals=0, Maximum=10, Minimum=0, Value=[8, 8])
genes_2 = GenePool(Decimals=0, Maximum=10, Minimum=0, Value=[8, 8])
number_slider = Slider(1000, range=0..10000)
swatch_5 = ColourSwatch(SwatchColor=RGB(0, 166, 157))
swatch_6 = ColourSwatch(SwatchColor=RGB(240, 117, 24))
swatch_7 = ColourSwatch(SwatchColor=RGB(235, 52, 79))
tstat = TreeStatistics(Tree=trim_4)  # -> Paths, Length, Count
branch = TreeBranch(Tree=pln, Path=tstat.Paths, MaintainPaths=True)
button = Button(ExpressionNormal="True", ExpressionPressed="False")
bbox = BoundingBox(Content=flatten(pl2pl.TG), Plane=PlaneXY(0, 0, 0), UnionBox=True)  # -> Box, Box_2
button_2 = Button(ExpressionNormal="True", ExpressionPressed="False")
pl2pl_2 = MoveObjectPlaneToPlane(G=trim_4, S=PlaneXY(0, 0, 0), T=branch)  # -> TG, T; inputs S: Plane, T: Plane; same code as pl2pl
pt = ConstructPoint(
    XCoordinate=Slider(2000, range=0..10000),
    YCoordinate=Slider(-3000, range=-10000..-3000),
    ZCoordinate=Slider(2000, range=0..10000))
normallinethickness = Number(Slider(2, range=0..10))
explosionlinepattern = Number(genes)
transparency = Number(Slider(0.2, range=0..1))
hiddenlinethickness = Number(Slider(1, range=0..1))
saveviewports = Boolean(Button())
hiddenlinepattern = Number(genes_2)
vec_2 = VectorXYZ(XComponent=Slider(-1, range=-10..10), YComponent=Slider(1, range=-10..10), ZComponent=Slider(-1, range=-10..10))  # -> Vector, Length
normallinecolor = Colour(swatch_2)
Z = UnitZ(Factor=1)
scalefactor = Number(Slider(1, range=0..10))
bang = ExplodeTree(Data=pl2pl_2.TG)  # -> Branch0, Branch1, Branch2, Branch3, Branch4, Branch5, Branch6
rhinovp = RhinoViewport(N="Diagram", P="0", WD=Domain2(u=0..1000, v=0..1000), T="False", A=button)  # -> F; inputs P: Int32, T: Boolean, A: Boolean
#   port P: 0 = None 1 = Top 2 = Bottom 3 = Left 4 = Right 5 = Front 6 = Back 7 = Perspective 8 = TwoPointPerspective
# ---------- rhinovp: Python ----------
#Component Information
#--------------------------------------------------------------------------------------------
if ghenv.Component.RunCount<2:
    #General
    #--------------------------------------------------------------------------------------------
    __author__ = "Ueli Saluz"
    __version__ = "2023.04.05"
    
    ghenv.Component.Name = "RhinoViewport"
    ghenv.Component.NickName = "RhinoVP"
    ghenv.Component.Description = "Launches or closes a Rhino viewport."
    ghenv.Component.Message = "VER 1.3"
    ghenv.Component.Category = "Display"
    ghenv.Component.SubCategory = "Camera"
    
     #Inputs
    #--------------------------------------------------------------------------------------------
    inputIndex=0
    
    ghenv.Component.Params.Input[inputIndex].Name = "Name"
    ghenv.Component.Params.Input[inputIndex].NickName = "N"
    ghenv.Component.Params.Input[inputIndex].Description = "Name of the viewport"
    ghenv.Component.Params.Input[inputIndex].Optional = False
    inputIndex+=1
    
    ghenv.Component.Params.Input[inputIndex].Name = "ViewportProjection"
    ghenv.Component.Params.Input[inputIndex].NickName = "P"
    ghenv.Component.Params.Input[inputIndex].Description = "0  = None \n1 = Top \n2 = Bottom \n3 = Left \n4 = Right \n5 = Front\n6 = Back\n7 = Perspective\n8 = TwoPointPerspective"
    ghenv.Component.Params.Input[inputIndex].Optional = False
    inputIndex+=1
    
    ghenv.Component.Params.Input[inputIndex].Name = "WindowDomain"
    ghenv.Component.Params.Input[inputIndex].NickName = "WD"
    ghenv.Component.Params.Input[inputIndex].Description = "The domain of the window. The U domain corresponds to X and the V domain to Y."
    ghenv.Component.Params.Input[inputIndex].Optional = False
    inputIndex+=1
    
    ghenv.Component.Params.Input[inputIndex].Name = "TitleVisible"
    ghenv.Component.Params.Input[inputIndex].NickName = "T"
    ghenv.Component.Params.Input[inputIndex].Description = "True if Rhino view title should be visible."
    ghenv.Component.Params.Input[inputIndex].Optional = True
    inputIndex+=1
    
    ghenv.Component.Params.Input[inputIndex].Name = "WallPaperPath"
    ghenv.Component.Params.Input[inputIndex].NickName = "WP"
    ghenv.Component.Params.Input[inputIndex].Description = "The domain of the window. The U domain corresponds to X and the V domain to Y."
    ghenv.Component.Params.Input[inputIndex].Optional = True
    inputIndex+=1
    
    ghenv.Component.Params.Input[inputIndex].Name = "ScaleFactor"
    ghenv.Component.Params.Input[inputIndex].NickName = "S"
    ghenv.Component.Params.Input[inputIndex].Description = "A scale factor that is applied on the window domains."
    ghenv.Component.Params.Input[inputIndex].Optional = True
    inputIndex+=1
    
    ghenv.Component.Params.Input[inputIndex].Name = "Active"
    ghenv.Component.Params.Input[inputIndex].NickName = "A"
    ghenv.Component.Params.Input[inputIndex].Description = "Activate or deactivate the window."
    ghenv.Component.Params.Input[inputIndex].Optional = False
    inputIndex+=1
    
    #Outputs
    #--------------------------------------------------------------------------------------------
    outputIndex=0
    
    ghenv.Component.Params.Output[outputIndex].Name = "Finished"
    ghenv.Component.Params.Output[outputIndex].NickName = "F"
    ghenv.Component.Params.Output[outputIndex].Description = "Sends True when finished. Just to trigger other depending components."
    outputIndex+=1


#Imports
#--------------------------------------------------------------------------------------------
from System import Object, Enum
from Grasshopper import DataTree
import System as sy
import Rhino as rc
import scriptcontext as sc
import clr
import System.Windows.Forms.Control

#Solver - Run with trees to enhance performance drastically
#--------------------------------------------------------------------------------------------
if __name__ == "__main__":
    
    vp = rc.RhinoDoc.ActiveDoc.Views.Find(N, False)
    if A:
        scaleFacor = 1 if S is None else S
        if vp:
            vp.Close()
        
        #The width is 16 pixel and height is 39 too little. Additionally the windows start 8 pixel shifted to the left. Why? I don't know.
        windowRectangle = sy.Drawing.Rectangle(WD.U0*scaleFacor-8,WD.V0*scaleFacor,WD.U.Length*scaleFacor+16,WD.V.Length*scaleFacor+39)
        newView = rc.RhinoDoc.ActiveDoc.Views.Add(N,Enum.ToObject(rc.Display.DefinedViewportProjection, P),windowRectangle,True)
        #newView seems to not set the name properly
        newView.MainViewport.Name = N
        if T==False:
            newView.TitleVisible = False
        viewport = newView.ActiveViewport
        if WP is not None:
            viewport.SetWallpaper(WP,False)
        
        viewport.ConstructionAxesVisible = False
        viewport.ConstructionGridVisible = False
        viewport.WorldAxesVisible = False
        
    else:
        if vp:
            vp.Close()
    F = True
# ---------- end rhinovp ----------
dam = DataDam(DataA=bbox.Box, BufferDelay=10000000, BufferMode=0)
setview = SetView(N="Diagram", P="0", L=pt, D=vec_2.Vector, Up=Z, R=button_2)  # -> F; inputs P: Int32, L: Point3d, D: Vector3d, Up: Vector3d, R: Boolean
#   port P: 0 = Parallel view 1 = Perspective view
# ---------- setview: Python ----------
#Component Information
#--------------------------------------------------------------------------------------------
if ghenv.Component.RunCount<2:
    #General
    #--------------------------------------------------------------------------------------------
    __author__ = "Ueli Saluz"
    __version__ = "2022.05.22"
    
    ghenv.Component.Name = "SetView"
    ghenv.Component.NickName = "SetView"
    ghenv.Component.Description = "Set a camera view and projection."
    ghenv.Component.Message = "VER 1.1"
    ghenv.Component.Category = "Display"
    ghenv.Component.SubCategory = "Camera"
    
     #Inputs
    #--------------------------------------------------------------------------------------------
    inputIndex=0
    
    ghenv.Component.Params.Input[inputIndex].Name = "Name"
    ghenv.Component.Params.Input[inputIndex].NickName = "N"
    ghenv.Component.Params.Input[inputIndex].Description = "Name of the viewport"
    ghenv.Component.Params.Input[inputIndex].Optional = True
    inputIndex+=1
    
    ghenv.Component.Params.Input[inputIndex].Name = "Projection"
    ghenv.Component.Params.Input[inputIndex].NickName = "P"
    ghenv.Component.Params.Input[inputIndex].Description = "0 = Parallel view\n"+\
                                                           "1 = Perspective view"
    ghenv.Component.Params.Input[inputIndex].Optional = True
    inputIndex+=1
    
    
    ghenv.Component.Params.Input[inputIndex].Name = "CameraLocation"
    ghenv.Component.Params.Input[inputIndex].NickName = "L"
    ghenv.Component.Params.Input[inputIndex].Description = "Location of the camera."
    ghenv.Component.Params.Input[inputIndex].Optional = True
    inputIndex+=1
    
    ghenv.Component.Params.Input[inputIndex].Name = "CameraDirection"
    ghenv.Component.Params.Input[inputIndex].NickName = "D"
    ghenv.Component.Params.Input[inputIndex].Description = "Direction of the camera."
    ghenv.Component.Params.Input[inputIndex].Optional = True
    inputIndex+=1
    
    ghenv.Component.Params.Input[inputIndex].Name = "CameraUp"
    ghenv.Component.Params.Input[inputIndex].NickName = "Up"
    ghenv.Component.Params.Input[inputIndex].Description = "Up vector of the camera."
    ghenv.Component.Params.Input[inputIndex].Optional = True
    inputIndex+=1
    
    ghenv.Component.Params.Input[inputIndex].Name = "LensLength"
    ghenv.Component.Params.Input[inputIndex].NickName = "LL"
    ghenv.Component.Params.Input[inputIndex].Description = "Lens length of the camera. Only relevant if projection is perspective."
    ghenv.Component.Params.Input[inputIndex].Optional = True
    inputIndex+=1
    
    ghenv.Component.Params.Input[inputIndex].Name = "Run"
    ghenv.Component.Params.Input[inputIndex].NickName = "R"
    ghenv.Component.Params.Input[inputIndex].Description = "Zoom to the given bounding box."
    ghenv.Component.Params.Input[inputIndex].Optional = False
    inputIndex+=1
    
    #Outputs
    #--------------------------------------------------------------------------------------------
    outputIndex=0
    
    ghenv.Component.Params.Output[outputIndex].Name = "Finished"
    ghenv.Component.Params.Output[outputIndex].NickName = "F"
    ghenv.Component.Params.Output[outputIndex].Description = "Sends True when finished. Just to trigger other depending components."
    outputIndex+=1
    


#Imports
#--------------------------------------------------------------------------------------------
from Rhino import RhinoDoc
from Rhino.Geometry import Box

#Solver - Run with trees to enhance performance drastically
#--------------------------------------------------------------------------------------------
if __name__ == "__main__":
    
    if R:
        if N is not None:
            view = RhinoDoc.ActiveDoc.Views.Find(N, False)
        else:
            view = RhinoDoc.ActiveDoc.Views.ActiveView
        vp = view.ActiveViewport
        if P is not None:
            if (P==0):
                vp.ChangeToParallelProjection(True)
            else:
                vp.ChangeToPerspectiveProjection(True,LL)
        if L is not None:
            vp.SetCameraLocation(L,False)
        if D is not None:
            vp.SetCameraDirection(D,False)
        if Up is not None:
            vp.CameraUp = Up
    F = True
# ---------- end setview ----------
doors = Curve(pl2pl_2.TG)
zoom2bb = ZoomToBoundingBox(N="Diagram", BB=dam, S=0, R=setview)  # -> F, SBB; inputs BB: Box, R: Boolean
# ---------- zoom2bb: Python ----------
#Component Information
#--------------------------------------------------------------------------------------------
if ghenv.Component.RunCount<2:
    #General
    #--------------------------------------------------------------------------------------------
    __author__ = "Ueli Saluz"
    __version__ = "2022.05.21"
    
    ghenv.Component.Name = "ZoomToBoundingBox"
    ghenv.Component.NickName = "Zoom2BB"
    ghenv.Component.Description = "Zoom the view of a Rhino viewport to a bounding box."
    ghenv.Component.Message = "VER 1.0"
    ghenv.Component.Category = "Display"
    ghenv.Component.SubCategory = "Camera"
    
     #Inputs
    #--------------------------------------------------------------------------------------------
    inputIndex=0
    
    ghenv.Component.Params.Input[inputIndex].Name = "Name"
    ghenv.Component.Params.Input[inputIndex].NickName = "N"
    ghenv.Component.Params.Input[inputIndex].Description = "Name of the viewport"
    ghenv.Component.Params.Input[inputIndex].Optional = False
    inputIndex+=1
    
    ghenv.Component.Params.Input[inputIndex].Name = "BoundingBox"
    ghenv.Component.Params.Input[inputIndex].NickName = "BB"
    ghenv.Component.Params.Input[inputIndex].Description = ""
    ghenv.Component.Params.Input[inputIndex].Optional = False
    inputIndex+=1
    
    ghenv.Component.Params.Input[inputIndex].Name = "ScaleFactor"
    ghenv.Component.Params.Input[inputIndex].NickName = "S"
    ghenv.Component.Params.Input[inputIndex].Description = "A factor for the extension of the bounding box." \
    +"0 means 0 extension, a positive number makes the bounding box larger a negative smaller. The amount is proportional to the length."
    ghenv.Component.Params.Input[inputIndex].Optional = False
    inputIndex+=1
   
    
    ghenv.Component.Params.Input[inputIndex].Name = "Run"
    ghenv.Component.Params.Input[inputIndex].NickName = "R"
    ghenv.Component.Params.Input[inputIndex].Description = "Zoom to the given bounding box."
    ghenv.Component.Params.Input[inputIndex].Optional = False
    inputIndex+=1
    
    #Outputs
    #--------------------------------------------------------------------------------------------
    outputIndex=0
    
    ghenv.Component.Params.Output[outputIndex].Name = "Finished"
    ghenv.Component.Params.Output[outputIndex].NickName = "F"
    ghenv.Component.Params.Output[outputIndex].Description = "Sends True when finished. Just to trigger other depending components."
    outputIndex+=1
    
    ghenv.Component.Params.Output[outputIndex].Name = "ScaledBoundingBox"
    ghenv.Component.Params.Output[outputIndex].NickName = "SBB"
    ghenv.Component.Params.Output[outputIndex].Description = "The scaled bounding box."
    outputIndex+=1


#Imports
#--------------------------------------------------------------------------------------------
from Rhino import RhinoDoc
from Rhino.Geometry import Box

#Solver - Run with trees to enhance performance drastically
#--------------------------------------------------------------------------------------------
if __name__ == "__main__":
    
    vp = RhinoDoc.ActiveDoc.Views.Find(N, False).ActiveViewport
    if R:
        box = BB
        bb = BB.BoundingBox
        bb.Inflate(S*box.X.Length,S*box.Y.Length,S*box.Z.Length)
        vp.ZoomBoundingBox(bb)
        SBB = bb
    F = True
# ---------- end zoom2bb ----------

lng = ListLength(List=deelement.SobjectId)
expression = Expression(x=lng, Expression="x-1")
series = Series(Start=0, Step=1, Count=expression)
dup = DuplicateData(Data=swatch_2, Number=expression, Order=True)
trim_5 = TrimTree(Tree=series, Depth=1)
trim_6 = TrimTree(Tree=dup, Depth=1)
concat_5 = Concatenate(FragmentA="capsule", FragmentB=trim_5)
merge_10 = Merge(Data1="shaft", Data2=concat_5)
merge_11 = Merge(Data1=swatch_2, Data2=swatch_7)
layer = CreateLayers(CreateToggle=Button(), LayerNames=merge_10, LayerColors=merge_11)

cleanlayer = BooleanToggle(False)
number_slider_2 = Slider(5000, range=0..10000)
trim_7 = TrimTree(Tree=pl2pl.TG, Depth=1)
toggle = BooleanToggle(True)  # disabled
number_slider_3 = Slider(1, range=-10..10)
toggle_2 = BooleanToggle(True)
number_slider_4 = Slider(1, range=-10..10)
toggle_3 = BooleanToggle(True)
m2d_rhino = Make2DRhinoView(Name="Diagram", Clip=True)
doors_2 = Curve(doors)
onoff = EnableDisableObject(Enabled=cleanlayer, AllObjects_Object=[layers, layertable, toggle_4, trim_8, toggle, difference])
sunion = SolidUnion(Breps=trim_7)
layertable = LayerTable(Update=toggle, AutoUpdate=False)  # -> Layers, FullLayerPaths, LayerColors, Linetypes, MaterialNames, Visible, PrintWidth, PrintColor; disabled
make2d = Make2D(Geometry=pl2pl.TG, View=m2d_rhino, TangentEdges=toggle_2, TangentSeams=toggle_2, AutoComputeMake2D=True)  # -> VisibleCurves, VisibleIndex, VisibleType, HiddenCurves, HiddenIndex, HiddenType
make2d_2 = Make2D(Geometry=sunion, View=m2d_rhino, TangentEdges=toggle_2, TangentSeams=toggle_2, AutoComputeMake2D=True)  # -> VisibleCurves, VisibleIndex, VisibleType, HiddenCurves, HiddenIndex, HiddenType
make2d_3 = Make2D(Geometry=doors_2, View=m2d_rhino, TangentEdges=toggle_2, TangentSeams=toggle_2, AutoComputeMake2D=True)  # -> VisibleCurves, VisibleIndex, VisibleType, HiddenCurves, HiddenIndex, HiddenType
panel_3 = Panel("Silhouette")
panel_4 = Panel("Silhouette, Crease")
panel_5 = Panel("Crease")
pt_2 = ConstructPoint(XCoordinate=number_slider_2, YCoordinate=number_slider_2, ZCoordinate=0)
trim_8 = TrimTree(Tree=layertable.Layers, Depth=1)  # disabled
vec_3 = VectorXYZ(XComponent=0, YComponent=0, ZComponent=Slider(-1, range=-10..10))  # -> Vector, Length
Z_2 = UnitZ(Factor=1)
trim_9 = TrimTree(Tree=make2d_2.HiddenCurves, Depth=1)
trim_10 = TrimTree(Tree=make2d_2.VisibleCurves, Depth=1)
trim_11 = TrimTree(Tree=make2d.HiddenCurves, Depth=1)
trim_12 = TrimTree(Tree=make2d.VisibleCurves, Depth=1)
trim_13 = TrimTree(Tree=make2d_3.HiddenCurves, Depth=1)
trim_14 = TrimTree(Tree=make2d_3.VisibleCurves, Depth=1)
toggle_4 = BooleanToggle(True)  # disabled
geo = Geometry(pl2pl.TG)
tmatch = MatchText(Text=make2d.VisibleType, RegEx="Silhouette, Boundary", Case=True)
difference = SetDifference(SetA=trim_8, SetB=merge_10)  # disabled
saveview = SaveViewportToFile(Run=saveviewports, ViewportName="Drawing", Render=False, FilePath="axonometry.png", ScaleFactor=scalefactor)
move = Move(Geometry=trim_9, Motion=pt_2)  # -> Geometry, Transform
rhinovp_2 = RhinoViewport(N="Drawing", P="0", WD=Domain2(u=0..1000, v=0..1000), T="False", A=button)  # -> F; inputs P: Int32, T: Boolean, A: Boolean; same code as rhinovp
setview_2 = SetView(N="Drawing", P="0", L=pt_2, D=vec_3.Vector, Up=Z_2, R=button_2)  # -> F; inputs P: Int32, L: Point3d, D: Vector3d, Up: Vector3d, R: Boolean; same code as setview
move_2 = Move(Geometry=trim_13, Motion=pt_2)  # -> Geometry, Transform
move_3 = Move(Geometry=trim_10, Motion=pt_2)  # -> Geometry, Transform
move_4 = Move(Geometry=trim_14, Motion=pt_2)  # -> Geometry, Transform
move_5 = Move(Geometry=trim_11, Motion=pt_2)  # -> Geometry, Transform
move_6 = Move(Geometry=trim_12, Motion=pt_2)  # -> Geometry, Transform
layers = CreateModifyLayers(LayerName=difference, DeleteLayer=toggle_4, enableFullPath=False)  # -> LayerNames, LayerFullPath; disabled
dispatch = Dispatch(List=make2d.VisibleCurves, DispatchPattern=tmatch)  # -> ListA, ListB
merge_12 = Merge(Data1=move_6.Geometry, Data2=move_5.Geometry)
bbox_2 = BoundingBox(Content=flatten(merge_12), Plane=PlaneXY(0, 0, 0), UnionBox=True)  # -> Box, Box_2
zoom2bb_2 = ZoomToBoundingBox(N="Drawing", BB=bbox_2.Box, S=0, R=setview_2)  # -> F, SBB; inputs BB: Box, R: Boolean; same code as zoom2bb
convexhull = ConvexHull(C=move_6.Geometry)
drawinghidden = Curve(move.Geometry)
drawingvisible = Curve(move_3.Geometry)
bang_2 = ExplodeTree(Data=pl2pl.TG)  # -> Branch0, Branch1, Branch2, Branch3, Branch4, Branch5, Branch6
bang_3 = ExplodeTree(Data=convexhull)  # -> Branch0, Branch1, Branch2, Branch3, Branch4, Branch5, Branch6
trim_15 = TrimTree(Tree=move_4.Geometry, Depth=1)
expression_2 = Expression(x=number_slider, Expression="x/2")
layers_2 = CreateModifyLayers(LayerName="Default:LineType", DeleteLayer=False, enableFullPath=True)  # -> LayerNames, LayerFullPath
merge_13 = Merge(Data1=bang_2.Branch1, Data2=bang_2.Branch2, Data3=bang_2.Branch3)
merge_14 = Merge(Data1=bang_2.Branch4, Data2=bang_2.Branch5, Data3=bang_2.Branch6)
dash = DashPattern(Curve=drawinghidden, Pattern=hiddenlinepattern)  # -> Dashes, Gaps
dash_2 = DashPattern(Curve=trim_15, Pattern=hiddenlinepattern)  # -> Dashes, Gaps
merge_15 = Merge(Data1=bang_3.Branch2, Data2=bang_3.Branch3, Data3=bang_3.Branch5, Data4=bang_3.Branch6)
merge_16 = Merge(Data1=bang_3.Branch1, Data2=bang_3.Branch4)
pt_3 = ConstructPoint(XCoordinate=Slider(0.5, range=0..1), YCoordinate=0, ZCoordinate=0)
merge_17 = Merge(Data1=merge_13, Data2=merge_14)
explosionaxonometry = ExplosionAxonometry(
    southcapsules=merge_13,
    eastcapsules=merge_14,
    mainexplosiondistance=number_slider,
    secondaryexplosiondistance=Slider(800, range=0..1000))  # -> capsules_2, explosionslines_2, explosiontransform_2
previewlw = CustomPreviewLineweights(Geometry=dash_2.Dashes, Shader=normallinecolor, Thickness=hiddenlinethickness, Absolute=False)
previewlw_2 = CustomPreviewLineweights(Geometry=drawingvisible, Shader=normallinecolor, Thickness=normallinethickness, Absolute=False)
previewlw_3 = CustomPreviewLineweights(Geometry=dash.Dashes, Shader=normallinecolor, Thickness=hiddenlinethickness, Absolute=False)
previewmat = CustomPreviewMaterials(Geometry=bang_3.Branch0, DiffuseColor=swatch_6, Transparency=transparency)
previewmat_2 = CustomPreviewMaterials(Geometry=merge_16, DiffuseColor=swatch_6, Transparency=transparency)
previewmat_3 = CustomPreviewMaterials(Geometry=merge_15, DiffuseColor=swatch_7, Transparency=transparency)
multiplication = Multiplication(A=pt_2, B="2")
evalsrf = EvaluateSurface(Surface=reparameterize(pl2pl_2.TG), Point=pt_3)  # -> Point, Normal, UDirection, VDirection, Frame
area = Area(Geometry=merge_17)  # -> Area, Centroid
trim_16 = TrimTree(Tree=dash.Dashes, Depth=1)
trim_17 = TrimTree(Tree=dash_2.Dashes, Depth=1)
subtraction = Subtraction(A=evalsrf.Point, B=area.Centroid)
merge_18 = Merge(Data1=drawingvisible, Data2=trim_16, Data3=trim_17)
move_7 = Move(Geometry=explosionaxonometry.explosionslines_2, Motion=subtraction)  # -> Geometry, Transform
button_3 = Button()
comp = Compound(Transforms=explosionaxonometry.explosiontransform_2)
createatts = CreateAttributes(LayerName="Default", Color=swatch_2, enableFullPath=False)
number_slider_5 = Slider(1, range=-10..10)
createatts_2 = CreateAttributes(LayerName="Default", enableFullPath=False)
number_slider_6 = Slider(1, range=-10..10)
merge_19 = Merge(Data1=bang_2.Branch0, Data2=explosionaxonometry.capsules_2)
transform = Transform(Geometry=doors_2, Transform=comp)
bake = BakeGeometry(Bake=button_3, Geometry=merge_18, Attributes=createatts, DeleteOldBakes=False, PreserveTrees=False)
bake_2 = BakeGeometry(Bake=button_3, Attributes=createatts_2, DeleteOldBakes=False, PreserveTrees=False)
toggle_5 = BooleanToggle(True)
doors_3 = Curve(doors)
vec_4 = VectorXYZ(XComponent=0, YComponent=0, ZComponent=Slider(-1, range=-10..10))  # -> Vector, Length
Z_3 = UnitZ(Factor=1)
make2d_4 = Make2D(Geometry=merge_19, View=m2d_rhino, TangentEdges=toggle_5, TangentSeams=toggle_5, AutoComputeMake2D=True)  # -> VisibleCurves, VisibleIndex, VisibleType, HiddenCurves, HiddenIndex, HiddenType
make2d_5 = Make2D(Geometry=doors_3, View=m2d_rhino, TangentEdges=toggle_2, TangentSeams=toggle_2, AutoComputeMake2D=True)  # -> VisibleCurves, VisibleIndex, VisibleType, HiddenCurves, HiddenIndex, HiddenType
make2d_6 = Make2D(Geometry=move_7.Geometry, View=m2d_rhino, TangentEdges=toggle_5, TangentSeams=toggle_5, AutoComputeMake2D=True)  # -> VisibleCurves, VisibleIndex, VisibleType, HiddenCurves, HiddenIndex, HiddenType
make2d_7 = Make2D(Geometry=transform, View=m2d_rhino, TangentEdges=toggle_5, TangentSeams=toggle_5, AutoComputeMake2D=True)  # -> VisibleCurves, VisibleIndex, VisibleType, HiddenCurves, HiddenIndex, HiddenType
rhinovp_3 = RhinoViewport(N="Axonometrie", P="0", WD=Domain2(u=0..1000, v=0..1000), T="False", A=button)  # -> F; inputs P: Int32, T: Boolean, A: Boolean; same code as rhinovp
saveview_2 = SaveViewportToFile(
    Run=saveviewports,
    ViewportName="Axonometrie",
    Render=False,
    FilePath="explosionaxononmetry.png",
    ScaleFactor=scalefactor)
setview_3 = SetView(N="Axonometrie", P="0", L=pt_2, D=vec_4.Vector, Up=Z_3, R=button_2)  # -> F; inputs P: Int32, L: Point3d, D: Vector3d, Up: Vector3d, R: Boolean; same code as setview
trim_18 = TrimTree(Tree=make2d_4.HiddenCurves, Depth=1)
trim_19 = TrimTree(Tree=make2d_4.VisibleCurves, Depth=1)
trim_20 = TrimTree(Tree=make2d_5.VisibleCurves, Depth=1)
trim_21 = TrimTree(Tree=make2d_6.VisibleCurves, Depth=1)
trim_22 = TrimTree(Tree=make2d_7.VisibleCurves, Depth=1)
crv = Curve([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])
crv_2 = Curve([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])
crv_3 = Curve([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])
move_8 = Move(Geometry=trim_19, Motion=multiplication)  # -> Geometry, Transform
convexhull_2 = ConvexHull(C=move_8.Geometry)
bang_4 = ExplodeTree(Data=convexhull_2)  # -> Branch0, Branch1, Branch2, Branch3, Branch4, Branch5, Branch6
move_9 = Move(Geometry=trim_18, Motion=multiplication)  # -> Geometry, Transform
move_10 = Move(Geometry=trim_20, Motion=multiplication)  # -> Geometry, Transform
move_11 = Move(Geometry=trim_21, Motion=multiplication)  # -> Geometry, Transform
explosionlines = Curve(move_11.Geometry)
move_12 = Move(Geometry=trim_22, Motion=multiplication)  # -> Geometry, Transform
dash_3 = DashPattern(Curve=explosionlines, Pattern=hiddenlinepattern)  # -> Dashes, Gaps
merge_20 = Merge(Data1=bang_4.Branch2, Data2=bang_4.Branch3, Data3=bang_4.Branch5, Data4=bang_4.Branch6)
merge_21 = Merge(Data1=bang_4.Branch1, Data2=bang_4.Branch4)
bbox_3 = BoundingBox(Content=flatten(move_8.Geometry), Plane=PlaneXY(0, 0, 0), UnionBox=True)  # -> Box, Box_2
merge_22 = Merge(Data1=move_8.Geometry, Data2=move_10.Geometry)
drawingvisible_2 = Curve(merge_22)
merge_23 = Merge(Data1=move_12.Geometry, Data2=move_9.Geometry)
drawinghidden_2 = Curve(merge_23)
dash_4 = DashPattern(Curve=drawinghidden_2, Pattern=hiddenlinepattern)  # -> Dashes, Gaps
previewmat_4 = CustomPreviewMaterials(Geometry=merge_20, DiffuseColor=swatch_7, Transparency=transparency)
previewmat_5 = CustomPreviewMaterials(Geometry=bang_4.Branch0, DiffuseColor=swatch_6, Transparency=transparency)
previewmat_6 = CustomPreviewMaterials(Geometry=merge_21, DiffuseColor=swatch_6, Transparency=transparency)
previewlw_4 = CustomPreviewLineweights(Geometry=dash_3.Dashes, Shader=normallinecolor, Thickness=hiddenlinethickness, Absolute=False)
previewlw_5 = CustomPreviewLineweights(Geometry=drawingvisible_2, Shader=normallinecolor, Thickness=normallinethickness, Absolute=False)
previewlw_6 = CustomPreviewLineweights(Geometry=dash_4.Dashes, Shader=normallinecolor, Thickness=hiddenlinethickness, Absolute=False)
zoom2bb_3 = ZoomToBoundingBox(N="Axonometrie", BB=bbox_3.Box, S=0, R=setview_3)  # -> F, SBB; inputs BB: Box, R: Boolean; same code as zoom2bb

# ==== cluster ConvexHull
C = ClusterInput()
explode = Explode(Curve=C, Recursive=True)  # -> Segments, Vertices
trim = TrimTree(Tree=explode.Vertices, Depth=1)
hull = ConvexHull(Points=trim, Plane=PlaneXY(0, 0, 0))  # -> Hull, HullZ, Indices
crv = Curve(hull.Hull)
srf = Surface(crv)
srf_2 = ClusterOutput(srf)

# ==== cluster ExplosionAxonometry
mainexplosiondistance = ClusterInput()
secondaryexplosiondistance = ClusterInput()
southcapsules = ClusterInput()
eastcapsules = ClusterInput()
mainexplosiondistance_2 = Number(mainexplosiondistance)
secondaryexplosiondistance_2 = Number(secondaryexplosiondistance)
southcapsules_2 = Geometry(southcapsules)
eastcapsules_2 = Geometry(eastcapsules)
neg = Negative(Value=mainexplosiondistance_2)
neg_2 = Negative(Value=secondaryexplosiondistance_2)
Y = UnitY(Factor=neg)
Z = UnitZ(Factor=secondaryexplosiondistance_2)
Z_2 = UnitZ(Factor=neg_2)
X = UnitX(Factor=mainexplosiondistance_2)
cluster = Cluster(geo=eastcapsules_2, T_3=X, T_2=Z_2, T=Z)  # -> geo_4, pt_2, transform_2
cluster_2 = Cluster(geo=southcapsules_2, T_3=Y, T_2=Z_2, T=Z)  # -> geo_4, pt_2, transform_2
merge = Merge(Data1=cluster_2.geo_4, Data2=cluster.geo_4)
merge_2 = Merge(Data1=cluster_2.pt_2, Data2=cluster.pt_2)
merge_3 = Merge(Data1=cluster_2.transform_2, Data2=cluster.transform_2)
pline = PolyLine(Vertices=merge_2, Closed=False)
explosiontransform = Transform(merge_3)
capsules = Geometry(merge)
explosionslines = Curve(pline)
capsules_2 = ClusterOutput(capsules)
explosiontransform_2 = ClusterOutput(explosiontransform)
explosionslines_2 = ClusterOutput(explosionslines)

# ==== cluster Cluster
geo = ClusterInput()
T = ClusterInput()
T_2 = ClusterInput()
T_3 = ClusterInput()
geo_2 = Geometry(geo)

area = Area(Geometry=geo_2)  # -> Area, Centroid
move = Move(Geometry=geo_2, Motion=T_3)  # -> Geometry, Transform
trim = TrimTree(Tree=move.Geometry, Depth=1)
item = ListItem(List=trim, Index=0, Wrap=True)  # -> Item, Item1, Item2
move_2 = Move(Geometry=item.Item, Motion=T_2)  # -> Geometry, Transform
move_3 = Move(Geometry=item.Item2, Motion=T)  # -> Geometry, Transform
merge = Merge(Data1=move_2.Geometry, Data2=item.Item1, Data3=move_3.Geometry)
match = MatchTree(Tree=graft(merge), Guide=geo_2)
geo_3 = Geometry(match)
geo_4 = ClusterOutput(geo_3)

tstat = TreeStatistics(Tree=geo_2)  # -> Paths, Length, Count
item_2 = ListItem(List=tstat.Paths, Index=0, Wrap=True)  # -> Item, Item1, Item2
merge_2 = Merge(Data1=move_2.Transform, Data2=move_3.Transform)  # -> graft(Result)
merge_3 = Merge(Data1=item_2.Item, Data3=item_2.Item2)
relblbrch = RelabelBranches(TreeToMatch=merge_2, ListOfPaths=merge_3)  # -> RelabeledTree; inputs TreeToMatch: tree, ListOfPaths: list
# ---------- relblbrch: Python ----------
if ghenv.Component.RunCount<2:
    __author__ = "Your name"
    __version__ = "2000.00.00"
    
    ghenv.Component.Name = "RelabelBranches"
    ghenv.Component.NickName = "ReLblBrch"
    ghenv.Component.Description = "Relabel all the paths of the branches with a list of new paths. The amount of branches must match with the size of the list of pahts"
    ghenv.Component.Message = "VER 1.0"
    
    ghenv.Component.Params.Input[0].NickName = "TreeToMatch"
    ghenv.Component.Params.Input[1].NickName = "ListOfPaths"
    
    ghenv.Component.Params.Input[0].Description = "Tree that should be relabeled."
    ghenv.Component.Params.Input[1].Description = "List of paths to use for new branch paths."
    
    ghenv.Component.Params.Output[0].NickName = "RelabeledTree"
    ghenv.Component.Params.Output[0].Description = "Relabeled tree where all the paths of the branches have been replaced with new paths."

from System import Object
from Grasshopper import DataTree

def relabelBranchesWithLstOfPths (tree, paths):
    newTree = DataTree[Object]()
    for i,path in enumerate(tree.Paths):
        items = tree.Branch(path)
        for data in items:
            newTree.Add(data,paths[i])
    return newTree

if __name__ == "__main__":
    RelabeledTree = relabelBranchesWithLstOfPths(TreeToMatch,ListOfPaths)
# ---------- end relblbrch ----------
merge_4 = Merge(Data1=item_2.Item, Data3=item_2.Item2)
merge_5 = Merge(Data1=move.Transform, Data2=relblbrch)
transform = Transform(merge_5)
transform_2 = ClusterOutput(transform)

transform_3 = Transform(Geometry=area.Centroid, Transform=move.Transform)
trim_2 = TrimTree(Tree=transform_3, Depth=1)
item_3 = ListItem(List=trim_2, Index=0, Wrap=True)  # -> Item, Item1, Item2
transform_4 = Transform(Geometry=item_3.Item, Transform=move_2.Transform)
transform_5 = Transform(Geometry=item_3.Item2, Transform=move_3.Transform)
merge_6 = Merge(Data1=transform_4, Data3=transform_5)  # -> graft(Result)

relblbrch_2 = RelabelBranches(TreeToMatch=merge_6, ListOfPaths=merge_4)  # -> RelabeledTree; inputs TreeToMatch: tree, ListOfPaths: list; same code as relblbrch

merge_7 = Merge(Data1=area.Centroid, Data2=transform_3, Data3=relblbrch_2)
pt = Point(merge_7)
pt_2 = ClusterOutput(pt)
