# Grasshopper definition simplelayout.gh (Grasshopper 1.0.7)
# plug-ins: Semio, Swiftlet

concat = Concatenate(FragmentA="C:\Git\Studium\PhD\semio\examples\capsuletower", FragmentB="\", FragmentC="capsule.gh")
parameter = ConstructParameter(Name="Length", Value=Slider(450, range=0..1000))
plan = ConstructPlan(Uri=concat)  # -> Plan, Hash
sobject = ConstructSobject(Plan=plan.Plan)
link = ConstructLink(Ports="Top")
sobject_2 = ConstructSobject(Plan=plan.Plan)
link_2 = ConstructLink(Ports="Bottom")
connectable = ConstructConnectable(Sobject=sobject, Link=link)
connectable_2 = ConstructConnectable(Sobject=sobject_2, Link=link_2)
connection = ConstructConnection(Connecting=connectable_2, Connected=connectable)
layout = ConstructLayout(Sobjects=[sobject, sobject_2], Connections=connection, Assembly=sobject)
server = Text("http://localhost:2999")
layout_design = LayoutDesign(Url=server, Layout=layout, Run=Toggle(True))
fjs = FormatJsonString(JSONString=layout)
panel = Panel(fjs)
design = ShowDesign(Design=layout_design, Concepts="Simple")
