# Grasshopper definition helloworld.gh (Grasshopper 1.0.7)
# plug-ins: semio

curdir = CurrentDirectory()  # -> D, P
# ---------- curdir: Python ----------
#Component Information
#--------------------------------------------------------------------------------------------
if ghenv.Component.RunCount<2:
    #General
    #--------------------------------------------------------------------------------------------
    __author__ = "Ueli Saluz"
    __version__ = "2023.09.29"
    
    ghenv.Component.Name = "CurrentDirectory"
    ghenv.Component.NickName = "CurDir"
    ghenv.Component.Description = "Current directory of the current grasshopper file."
    ghenv.Component.Message = "VER 1.0"
    ghenv.Component.Category = "Params"
    ghenv.Component.SubCategory = "Util"
    
    #Outputs
    #--------------------------------------------------------------------------------------------
    outputIndex=0
    
    ghenv.Component.Params.Output[outputIndex].Name = "Directory"
    ghenv.Component.Params.Output[outputIndex].NickName = "D"
    ghenv.Component.Params.Output[outputIndex].Description = "Directory of the current grasshopper file."
    outputIndex+=1
    
    ghenv.Component.Params.Output[outputIndex].Name = "Path"
    ghenv.Component.Params.Output[outputIndex].NickName = "P"
    ghenv.Component.Params.Output[outputIndex].Description = "Path of the current grasshopper file."
    outputIndex+=1


#Imports
#--------------------------------------------------------------------------------------------
from os.path import dirname

#Solver - Run with trees to enhance performance drastically
#--------------------------------------------------------------------------------------------
if __name__ == "__main__":
    P = ghenv.Component.OnPingDocument().FilePath
    D = dirname(P)
# ---------- end curdir ----------
concat = Concatenate(FragmentA=curdir.D, FragmentB="\", FragmentC="text.gh")

# ---- group: World!
parameter = ConstructParameter(Name="Text", Value="World!")
plan = ConstructPlan(Uri=concat, Parameters=parameter)  # -> Plan, Hash
sobject = ConstructSobject(Plan=plan.Plan)

# ---- group: Hello
sobject_2 = ConstructSobject(Plan=concat)
link = ConstructLink(Ports="After")
connectable = ConstructConnectable(Sobject=sobject_2, Link=link)

# ----
connection = ConstructConnection(Connecting=sobject, Connected=connectable)
merge = Merge(Data1=sobject_2, Data2=sobject)

# ---- group: Set me to True!
run = BooleanToggle(False)

# ----
layout = ConstructLayout(Sobjects=merge, Connections=connection, Assembly=sobject_2)
layout_design = LayoutDesign(Url="http://localhost:2999", Layout=layout, Run=run)
importdesign = ImportDesign(D=layout_design)  # -> geo_2, planhash_2, centroid_2
geo = Geometry(importdesign.geo_2)

# ==== cluster ImportDesign
D = ClusterInput()
D_2 = Design(D)
dedesign = DeconstructDesign(Design=D_2)  # -> Prototypes, Elements
trim = TrimTree(Tree=dedesign.Elements, Depth=1)
trim_2 = TrimTree(Tree=dedesign.Prototypes, Depth=1)
viewer = ParamViewer(dedesign.Elements)
deelement = DeconstructElement(Element=trim)  # -> SobjectId, PlanHash, Pose
deprototype = DeconstructPrototype(Prototype=trim_2)  # -> PlanHash, Representations, Description
tstat = TreeStatistics(Tree=deprototype.Representations)  # -> Paths, Length, Count
hash = NAME(x=deprototype.PlanHash)  # -> h
# ---------- hash: Python ----------
#Component Information
#--------------------------------------------------------------------------------------------
if ghenv.Component.RunCount<2:
    #General
    #--------------------------------------------------------------------------------------------
    __author__ = "YOUR NAME"
    __version__ = "2000.00.00"
h = hash(x)
# ---------- end hash ----------
hash_2 = NAME(x=deelement.PlanHash)  # -> h; same code as hash
pln = Plane(deelement.Pose)
sort = SortList(Keys=hash, ValuesA=tstat.Paths)  # -> Keys, ValuesA
sort_2 = SortList(Keys=hash_2, ValuesA=pln, ValuesB=deelement.SobjectId)  # -> Keys, ValuesA, ValuesB
branch = TreeBranch(Tree=deprototype.Representations, Path=sort.ValuesA, MaintainPaths=False)
cset = CreateSet(List=sort_2.Keys)  # -> Set, Map
path = ConstructPath(Indices=graft(cset.Map))
item = ListItem(List=branch, Index=0, Wrap="False")  # -> Item, Item1
trim_3 = TrimTree(Tree=path, Depth=1)
relblbrch = RelabelBranches(TreeToMatch=graft(sort_2.ValuesA), ListOfPaths=trim_3)  # -> RelabeledTree; inputs TreeToMatch: tree, ListOfPaths: list; same code as relblbrch
imrepresentation = ImportRepresentation(Representation=item.Item)
trim_4 = TrimTree(Tree=imrepresentation, Depth=1)
pln_2 = Plane(relblbrch)
mtontreecopy = MtoNTreeCopy(tree=trim_4, targettree=pln_2)  # -> tree_4, targettree_4
pl2pl = MoveObjectPlaneToPlane(G=mtontreecopy.tree_4, S=PlaneXY(0, 0, 0), T=mtontreecopy.targettree_4)  # -> TG, T; inputs S: Plane, T: Plane
# ---------- pl2pl: Python ----------
#Component Information
#--------------------------------------------------------------------------------------------
if ghenv.Component.RunCount<2:
    #General
    #--------------------------------------------------------------------------------------------
    __author__ = "Ueli Saluz"
    __version__ = "2023.02.12"
    
    ghenv.Component.Name = "MoveObjectPlaneToPlane"
    ghenv.Component.NickName = "Pl2Pl"
    ghenv.Component.Description = "Moves abitrary geometry from a source plane to a target plane."
    ghenv.Component.Message = "VER 1.2"
    ghenv.Component.Category = "Transform"
    ghenv.Component.SubCategory = "Euclidean"
    
     #Inputs
    #--------------------------------------------------------------------------------------------
    inputIndex=0
    
    ghenv.Component.Params.Input[inputIndex].Name = "Geometry"
    ghenv.Component.Params.Input[inputIndex].NickName = "G"
    ghenv.Component.Params.Input[inputIndex].Description = "Geometry to move."
    ghenv.Component.Params.Input[inputIndex].Optional = False
    inputIndex+=1
    
    ghenv.Component.Params.Input[inputIndex].Name = "SourcePlane"
    ghenv.Component.Params.Input[inputIndex].NickName = "S"
    ghenv.Component.Params.Input[inputIndex].Description = "Source plane of object."
    ghenv.Component.Params.Input[inputIndex].Optional = False
    inputIndex+=1
    
    ghenv.Component.Params.Input[inputIndex].Name = "TargetPlane"
    ghenv.Component.Params.Input[inputIndex].NickName = "T"
    ghenv.Component.Params.Input[inputIndex].Description = "Target plane of object."
    ghenv.Component.Params.Input[inputIndex].Optional = False
    inputIndex+=1
    
    #Outputs
    #--------------------------------------------------------------------------------------------
    outputIndex=0
    
    ghenv.Component.Params.Output[outputIndex].Name = "TranslatedGeometry"
    ghenv.Component.Params.Output[outputIndex].NickName = "TG"
    ghenv.Component.Params.Output[outputIndex].Description = "Translated geometry in target plane."
    outputIndex+=1
    
    ghenv.Component.Params.Output[outputIndex].Name = "Trasnform"
    ghenv.Component.Params.Output[outputIndex].NickName = "T"
    ghenv.Component.Params.Output[outputIndex].Description = "Transform describing translation form source to target plane."
    outputIndex+=1


#Imports
#--------------------------------------------------------------------------------------------
import Rhino.Geometry.Transform as trsf

def MvObjPlnToPln (geo,plnObj,plnDest):
    transform = trsf.PlaneToPlane(plnObj,plnDest)
    geo.Transform(transform)
    return (geo,transform)

TG, T = MvObjPlnToPln(G,S,T)
# ---------- end pl2pl ----------
area = Area(Geometry=pl2pl.TG)  # -> Area, Centroid; disabled
avgp = AveragePoint(P=area.Centroid)  # -> AvP; inputs P: list of Point3d, M: list of Double; disabled
# ---------- avgp: C# usings ----------
using System.Linq;
# ---------- avgp: C# ----------
    //Author: Ueli Saluz
    //Last modified: 29.05.2020
    //Contact: usaluz@outlook.de

    if (Component.RunCount < 2)
    {
      Component.Name = "AveragePoint";
      Component.NickName = "AvgP";
      Component.Description = "Get the average point from a set of planes. Provide multiplier to weight some planes more.";
      Component.Params.Input[0].Name = "Points";
      Component.Params.Input[0].Description = "Points to take average from.";
      Component.Params.Input[1].Name = "Multipliers";
      Component.Params.Input[1].Description = "Multipliers act like weights towards a point.";

      Component.Params.Output[0].Name = "AveragePoint";
      Component.Params.Output[0].Description = "Resulting average point.";

      Component.Message = "VER 1.0";
    }
    if(P != null)
      AvP = GetAveragePoint(P.ToArray(), M.ToArray());
# ---------- avgp: C# additional code ----------
  public Point3d GetAveragePoint(Point3d[] points, double[] multipliers)
  {
    if (multipliers.Length < points.Length)
      multipliers = multipliers.Concat(Enumerable.Repeat(1d, points.Length - multipliers.Length)).ToArray();
    else if (multipliers.Length > points.Length)
      multipliers = multipliers.Take(points.Length).ToArray();

    if (multipliers.Sum() == 0)
      multipliers = Enumerable.Repeat(1d, points.Length).ToArray();

    var sum = multipliers.Sum();
    multipliers = multipliers.Select(x => x / sum).ToArray();

    for (int i = 0; i < points.Length; i++)
      points[i].Transform(new Transform(multipliers[i]));

    return points.Aggregate((a,b) => a + b);;
  }
# ---------- end avgp ----------
geo = Geometry(pl2pl.TG)
centroid = Point(avgp)
planhash = Text(sort_2.ValuesB)
geo_2 = ClusterOutput(geo)
centroid_2 = ClusterOutput(centroid)
planhash_2 = ClusterOutput(planhash)

# ==== cluster MtoNTreeCopy
targettree = ClusterInput()
tree = ClusterInput()
targettree_2 = Data(targettree)
tree_2 = Data(tree)
tstat = TreeStatistics(Tree=tree_2)  # -> Paths, Length, Count
tstat_2 = TreeStatistics(Tree=targettree_2)  # -> Paths, Length, Count
multiplication = Multiplication(A=tstat.Length, B=tstat_2.Length)
equals = Equality(FirstNumber=tstat.Length, SecondNumber=multiplication)  # -> Equality, Inequality
equals_2 = Equality(FirstNumber=tstat_2.Length, SecondNumber=multiplication)  # -> Equality, Inequality
lng = ListLength(List=tstat.Paths)
series = Series(Start=0, Step=1, Count=lng)
or = GateOr(A=equals.Equality, B=equals_2.Equality)
trim = TrimTree(Tree=series, Depth=1)
dispatch = Dispatch(List=tstat.Paths, DispatchPattern=or)  # -> ListA, ListB
dispatch_2 = Dispatch(List=trim, DispatchPattern=or)  # -> ListA, ListB
branch = TreeBranch(Tree=tree_2, Path=dispatch.ListB, MaintainPaths=True)
item = ListItem(List=tstat.Length, Index=dispatch_2.ListB, Wrap=True)
dpath = DeconstructPath(Branch=dispatch.ListA)
dup = DuplicateData(Data=graft(branch), Number=item, Order=True)
dpath_2 = DeconstructPath(Branch=dispatch.ListB)
series_2 = Series(Start=0, Step=1, Count=item)
expression = Expression(x="0", y=dpath, Expression="x")
trim_2 = TrimTree(Tree=dpath_2, Depth=1)
trim_3 = TrimTree(Tree=series_2, Depth=1)
trim_4 = TrimTree(Tree=dup, Depth=1)
merge = Merge(Data1=dpath, Data2=expression)
expression_2 = Expression(x=trim_2, y=trim_3, Expression="x")
flip = FlipMatrix(Data=trim_4)
branch_2 = TreeBranch(Tree=tree_2, Path=dispatch.ListA, MaintainPaths=True)
branch_3 = TreeBranch(Tree=targettree_2, Path=dispatch.ListA, MaintainPaths=True)
path = ConstructPath(Indices=merge)  # -> flatten(Branch)
merge_2 = Merge(Data1=graft(expression_2), Data2=graft(trim_3))
l2o = List2Object(L=branch_2)  # -> O; inputs L: tree
# ---------- l2o: Python ----------
#Component Information
#--------------------------------------------------------------------------------------------
if ghenv.Component.RunCount<2:
    #General
    #--------------------------------------------------------------------------------------------
    __author__ = "Ueli Saluz"
    __version__ = "2022.04.24"
    
    ghenv.Component.Name = "List2Object"
    ghenv.Component.NickName = "L2O"
    ghenv.Component.Description = "Wraps a list of objects into a list object."
    ghenv.Component.Message = "VER 1.0"
    ghenv.Component.Category = "Sets"
    ghenv.Component.SubCategory = "Tree"
    
     #Inputs
    #--------------------------------------------------------------------------------------------
    inputIndex=0
    
    ghenv.Component.Params.Input[inputIndex].Name = "List"
    ghenv.Component.Params.Input[inputIndex].NickName = "L"
    ghenv.Component.Params.Input[inputIndex].Description = "Tree with lists to wrap."
    ghenv.Component.Params.Input[inputIndex].Optional = False
    inputIndex+=1
    

    #Outputs
    #--------------------------------------------------------------------------------------------
    outputIndex=0
    
    ghenv.Component.Params.Output[outputIndex].Name =  "ListObject" 
    ghenv.Component.Params.Output[outputIndex].NickName = "O"
    ghenv.Component.Params.Output[outputIndex].Description = "Python list object as single item."
    outputIndex+=1


#Imports
#--------------------------------------------------------------------------------------------
from System import Object
from Grasshopper import DataTree

#Solver - Run with trees to enhance performance drastically
#--------------------------------------------------------------------------------------------
if __name__ == "__main__":
    
    #Initialize trees
    #--------------------------------------------------------------------------------------------
    TreeToWrap = DataTree[Object]()
    
    #Data matching
    #--------------------------------------------------------------------------------------------
    for path in L.Paths:
        listBranch = L.Branch(path)
        TreeToWrap.Add(listBranch,path)
    
     #Assign trees to output
    #--------------------------------------------------------------------------------------------
    O = TreeToWrap
# ---------- end l2o ----------
relblbrch = RelabelBranches(TreeToMatch=branch_2, ListOfPaths=flatten(path))  # -> RelabeledTree; inputs TreeToMatch: tree, ListOfPaths: list
# ---------- relblbrch: Python ----------
if ghenv.Component.RunCount<2:
    __author__ = "Your name"
    __version__ = "2000.00.00"
    
    ghenv.Component.Name = "RelabelBranches"
    ghenv.Component.NickName = "ReLblBrch"
    ghenv.Component.Description = "Relabel all the paths of the branches with a list of new paths. The amount of branches must match with the size of the list of pahts"
    ghenv.Component.Message = "VER 1.0"
    
    ghenv.Component.Params.Input[0].NickName = "TreeToMatch"
    ghenv.Component.Params.Input[1].NickName = "ListOfPaths"
    
    ghenv.Component.Params.Input[0].Description = "Tree that should be relabeled."
    ghenv.Component.Params.Input[1].Description = "List of paths to use for new branch paths."
    
    ghenv.Component.Params.Output[0].NickName = "RelabeledTree"
    ghenv.Component.Params.Output[0].Description = "Relabeled tree where all the paths of the branches have been replaced with new paths."

from System import Object
from Grasshopper import DataTree

def relabelBranchesWithLstOfPths (tree, paths):
    newTree = DataTree[Object]()
    for i,path in enumerate(tree.Paths):
        items = tree.Branch(path)
        for data in items:
            newTree.Add(data,paths[i])
    return newTree

if __name__ == "__main__":
    RelabeledTree = relabelBranchesWithLstOfPths(TreeToMatch,ListOfPaths)
# ---------- end relblbrch ----------
path_2 = ConstructPath(Indices=merge_2)
mtchanc = MatchAncestor(AT=l2o, CT=graft(branch_3))  # -> MAT; inputs AT: tree, CT: tree
# ---------- mtchanc: Python ----------
if ghenv.Component.RunCount<2:
    __author__ = "Ueli Saluz"
    __version__ = "2022.04.25"
    
    ghenv.Component.Name = "Match Ancestor"
    ghenv.Component.NickName = "MtchAnc"
    ghenv.Component.Description = "Duplicates all elements of an ancestor tree to match the amount of elements in the child tree."
    ghenv.Component.Message = "VER 1.1"
    
    ghenv.Component.Params.Input[0].Name = "AncestorTree"
    ghenv.Component.Params.Input[0].NickName = "AT"
    ghenv.Component.Params.Input[0].Description = "Ancestor tree that data will the duplicated until it matches the child tree"
    ghenv.Component.Params.Input[0].Optional = False
    
    ghenv.Component.Params.Input[1].Name = "ChildTree"
    ghenv.Component.Params.Input[1].NickName = "CT"
    ghenv.Component.Params.Input[1].Description = "Child tree that branches will the guide to duplicat the data of the ancestor tree"
    ghenv.Component.Params.Input[0].Optional = False
    
    ghenv.Component.Params.Output[0].Name = "MatchedAncestorTree"
    ghenv.Component.Params.Output[0].NickName = "MAT"
    ghenv.Component.Params.Output[0].Description = "Matched ancestor tree with the amount of items and the branch paths of the child tree"

from System import Object
from Grasshopper import DataTree

"""Returns a new tree with the ancestor data being duplicated along all child branches which where child paths of that ancestor.
    Inputs:
        ancestorTree: Ancestor tree that data will the duplicated until it matches the child tree
        childTree: Child tree that branches will the guide to duplicat the data of the ancestor tree
    Output:
        matchedAncestorTree: Matched ancestor tree with the amount of items and the branch paths of the child tree"""
def MatchAncestorTreeToChildTree (ancestorTree, childTree):
    
    matchedAncestorTree = DataTree[Object]()
    dummy = 0
    for i,pathAncestor in enumerate(ancestorTree.Paths):
        branch = ancestorTree.Branch(pathAncestor)
        if len(branch)!=1:
            raise Exception("Ancestor must be grafted and containing one item per branch")
        #The item to be duplicated
        item = branch[0]
        for j,pathChild in enumerate(childTree.Paths):
            #Returns a tuple and not like in the documentation described a bool with a pointer to the int to store the generations
            checkAncestor = pathChild.IsAncestor(pathAncestor,dummy)
            if(checkAncestor[0]):
                matchedAncestorTree.AddRange([item]*childTree.Branch(pathChild).Count,pathChild)
    return matchedAncestorTree

if __name__ == "__main__":
    MAT = MatchAncestorTreeToChildTree (AT,CT)
# ---------- end mtchanc ----------
relblbrch_2 = RelabelBranches(TreeToMatch=flip, ListOfPaths=flatten(path_2))  # -> RelabeledTree; inputs TreeToMatch: tree, ListOfPaths: list; same code as relblbrch
o2l = Object2List(O=mtchanc)  # -> L; inputs O: tree
# ---------- o2l: Python ----------
#Component Information
#--------------------------------------------------------------------------------------------
if ghenv.Component.RunCount<2:
    #General
    #--------------------------------------------------------------------------------------------
    __author__ = "Ueli Saluz"
    __version__ = "2022.04.24"
    
    ghenv.Component.Name = "Object2List"
    ghenv.Component.NickName = "O2L"
    ghenv.Component.Description = "Unwraps a list of objects into a list object."
    ghenv.Component.Message = "VER 1.0"
    ghenv.Component.Category = "Sets"
    ghenv.Component.SubCategory = "Tree"
    
     #Inputs
    #--------------------------------------------------------------------------------------------
    inputIndex=0
    
    ghenv.Component.Params.Input[inputIndex].Name = "ListObject"
    ghenv.Component.Params.Input[inputIndex].NickName = "O"
    ghenv.Component.Params.Input[inputIndex].Description = "A python list object that will be unwrapped into a Grasshopper list."
    ghenv.Component.Params.Input[inputIndex].Optional = False
    inputIndex+=1
    

    #Outputs
    #--------------------------------------------------------------------------------------------
    outputIndex=0
    
    ghenv.Component.Params.Output[outputIndex].Name =  "List"
    ghenv.Component.Params.Output[outputIndex].NickName = "L"
    ghenv.Component.Params.Output[outputIndex].Description = "The unwrapped list."
    outputIndex+=1


#Imports
#--------------------------------------------------------------------------------------------
from System import Object
from Grasshopper import DataTree

#Solver - Run with trees to enhance performance drastically
#--------------------------------------------------------------------------------------------
if __name__ == "__main__":
    
    #Initialize trees
    #--------------------------------------------------------------------------------------------
    OriginalTree = DataTree[Object]()
    
    #Data matching
    #--------------------------------------------------------------------------------------------
    for path in O.Paths:
        listBranch = O.Branch(path)
        for i,listItem in enumerate(listBranch):
            OriginalTree.AddRange(list(listItem),path.AppendElement(i))
    
     #Assign trees to output
    #--------------------------------------------------------------------------------------------
    L = OriginalTree
# ---------- end o2l ----------
trim_5 = TrimTree(Tree=o2l, Depth=1)
merge_3 = Merge(Data1=relblbrch_2, Data2=trim_5)
targettree_3 = Data(graft(targettree_2))
tree_3 = Data(merge_3)
tree_4 = ClusterOutput(tree_3)
targettree_4 = ClusterOutput(targettree_3)
