# Grasshopper definition text.gh (Grasshopper 1.0.7)
# plug-ins: semio

list = ValueList({"Before", "After"}, selected="Before")
panel = Panel("World!")
xy = XYPlane(Origin=Point(0, 0, 0))
text = GetString("Hello", AtLeast=1, AtMost=1, TreeAccess=False)
size = GetNumber(Slider(10, range=0..100), AtLeast=1, AtMost=1, Maximum=1.797693135e+308, Minimum=-1.797693135e+308, TreeAccess=False)
connection_ports = GetString(list, AtLeast=0, AtMost=1, TreeAccess=False)

# ---- group: Representation
expression = Expression(x=size, Expression="x/10")
X = UnitX(Factor=size)
rectangle = Rectangle(Plane=PlaneXY(0, 0, 0), XSize=size, YSize=size, Radius=0)  # -> Rectangle, Length
line = LineSDL(Start=xy, Direction=X, Length=size)
srf = Surface(rectangle.Rectangle)
textsrf = TextOnSurface(Text=text, Font="Sans Bold:no Italic:no", Height=size, Depth=expression, BaseLine=line, BaseSurface=srf)
serialize = Serialize(Input=textsrf)
representation = ConstructRepresentation(Body=serialize, Concepts="Default")
prepare = Prepare(Input=representation)

# ---- group: Port
contains = Contains(L=connection_ports, I="Before")  # -> R; inputs L: list, I: list
# ---------- contains: Python ----------
#Component Information
#--------------------------------------------------------------------------------------------
if ghenv.Component.RunCount<2:
    #General
    #--------------------------------------------------------------------------------------------
    __author__ = "Ueli Saluz"
    __version__ = "2023.02.04"
    
    ghenv.Component.Name = "Contains"
    ghenv.Component.NickName = "Contains"
    ghenv.Component.Description = "True if list contains one of the items."
    ghenv.Component.Message = "VER 1.0"
    ghenv.Component.Category = "Set"
    ghenv.Component.SubCategory = "List"
    
     #Inputs
    #--------------------------------------------------------------------------------------------
    inputIndex=0
    
    ghenv.Component.Params.Input[inputIndex].Name = "List"
    ghenv.Component.Params.Input[inputIndex].NickName = "L"
    ghenv.Component.Params.Input[inputIndex].Description = ""
    ghenv.Component.Params.Input[inputIndex].Optional = False
    inputIndex+=1
    
    ghenv.Component.Params.Input[inputIndex].Name = "Items"
    ghenv.Component.Params.Input[inputIndex].NickName = "I"
    ghenv.Component.Params.Input[inputIndex].Description = ""
    ghenv.Component.Params.Input[inputIndex].Optional = False
    inputIndex+=1
    
    #Outputs
    #--------------------------------------------------------------------------------------------
    outputIndex=0
    
    ghenv.Component.Params.Output[outputIndex].Name = "Contains"
    ghenv.Component.Params.Output[outputIndex].NickName = "R"
    ghenv.Component.Params.Output[outputIndex].Description = ""
    outputIndex+=1

R = False
for i in I:
    if i in L:
        R = True
# ---------- end contains ----------
addition = Addition(A=size, B=expression)
neg = Negative(Value=expression)
valueor0 = ValueOr0(value=contains)
X_2 = UnitX(Factor=addition)
X_3 = UnitX(Factor=neg)
filter = StreamFilter(Gate=valueor0, Stream0=X_2, Stream1=X_3)
move = Move(Geometry=xy, Motion=filter)  # -> Geometry, Transform

# ----
connection_point = Point(move.Geometry)
representations = Text(prepare)
context_bake = ContextBake(CONNECTIONPOINT=connection_point)
context_print = ContextPrint(REPRESENTATIONS=representations)

# ==== cluster ValueOr0
value = ClusterInput()
value_2 = Number(value)
null = NullItem(Item=value_2)  # -> NullFlags, InvalidFlags, Description
filter = StreamFilter(Gate=null.NullFlags, Stream0=value_2, Stream1="0")
valueor0 = Number(filter)
valueor0_2 = ClusterOutput(valueor0)
