# Grasshopper definition base.gh (Grasshopper 1.0.7)
# plug-ins: semio, eleFront

north_not_properly_places = Vector(Vector(0.922262801, -0.3865634823, 0))
safe = Button()
safe_2 = BooleanToggle(False)
icon_export = BooleanToggle(False)
pt = ConstructPoint(XCoordinate=0, YCoordinate=0, ZCoordinate=0)
amp = Amplitude(Vector=north_not_properly_places, Amplitude=Slider(1000, range=0..1000))
safe_3 = Button()
vdisex = VectorDisplayEx(Point=pt, Vector=amp, Colour=RGB(0, 0, 0), Width=2)
# ^
#                  |
# Preview    ->
loop_slider = PythonScript(Min="0", Max="1", stepSize="1", Delay=Slider(0, range=0..1), Run=Toggle(False), Reset=Button())  # inputs Run: Boolean, Reset: Boolean
# ---------- loop_slider: Python ----------
import time

def updateSliderInput(inputName,min,max,value,decimalPlace=2):
    for input in ghenv.Component.Params.Input:
        for source in input.Sources:
            if input.Name == str(inputName):
                source.Slider.DecimalPlaces = decimalPlace
                source.Slider.Minimum = min
                source.Slider.Maximum = max
                source.Slider.Value = value
                source.ExpireSolution(True)

def countDecimal(number):
    string= str(number)
    return string[::-1].find('.')

if Run == True:
    if SliderToModify < Max:
        time.sleep(Delay)
        updateSliderInput("SliderToModify",Min,Max,SliderToModify+stepSize,countDecimal(stepSize))
if Reset == True:
    updateSliderInput("SliderToModify",Min,Max,Min)
# ---------- end loop_slider ----------
# Parameters:
and = GateAnd(A=safe_2, B=icon_export)
# External
#      |
#      v
# Model:
cores = GetInteger(Slider(2, range=1..10), AtLeast=1, AtMost=1, Maximum=2147483647, Minimum=-2147483648, TreeAccess=False)
# Local ->
number_slider = Slider(350, range=0..1000)
floorgroundheight = Number(Slider(400, range=0..1000))
floorheight = Number(number_slider)
expression = Expression(x=floorgroundheight, Expression="x/100")
expression_2 = Expression(x=floorheight, Expression="x/100")
coreprimarylength = Number(Slider(550, range=0..1000))
coreprimarylength_2 = Number(coreprimarylength)
coressetbackdepth = Number(Slider(495, range=0..1000))
coressetbackwidth = Number(Slider(475, range=0..1000))
coreprimarywidth = Number(coreprimarylength)
coresecondarylength = Number(coreprimarylength)
coresecondarywidth = Number(coreprimarylength)
expression_3 = Expression(x=coreprimarylength_2, Expression="x/100")
expression_4 = Expression(x=coreprimarywidth, Expression="x/100")
expression_5 = Expression(x=coresecondarylength, Expression="x/100")
expression_6 = Expression(x=coresecondarywidth, Expression="x/100")
expression_7 = Expression(x=coressetbackdepth, Expression="x/100")
expression_8 = Expression(x=coressetbackwidth, Expression="x/100")
expression_9 = Expression(x=coreprimarylength, Expression="x/100")
panel = Panel("Parallel")  # disabled
m2d_rhino = Make2DRhinoView(Name=panel, Clip=True)  # disabled
number_slider_2 = Slider(876, range=0..1000)  # disabled
view_rectangle = ViewRectangle(view=m2d_rhino)  # disabled
plot = Curve(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)
columnssidelongsetbackwidth = Number(Slider(250, range=0..1000))
columnswidth = Number(Slider(40, range=0..100))
entrancesetback = Number(Slider(100, range=0..100))
entrancehallwidth = Number(Slider(560, range=0..1000))
sideshortsetbackdepth = Number(Slider(100, range=0..100))
columnssetbackdepth = Number(Slider(250, range=0..1000))
previewplane = PreviewPlane(plane=view_rectangle, axis_length=number_slider_2)  # disabled
scale = Scale(Geometry=plot, Center=Point(0, 0, 0), Factor=Slider(0.01, range=0..0.01))  # -> Geometry, Transform
crv = Curve(scale.Geometry)

curdir = CurrentDirectory()  # -> D, P, S
# ---------- curdir: Python ----------
#Component Information
#--------------------------------------------------------------------------------------------
if ghenv.Component.RunCount<2:
    #General
    #--------------------------------------------------------------------------------------------
    __author__ = "Ueli Saluz"
    __version__ = "2023.09.29"
    
    ghenv.Component.Name = "CurrentDirectory"
    ghenv.Component.NickName = "CurDir"
    ghenv.Component.Description = "Current directory of the current grasshopper file."
    ghenv.Component.Message = "VER 1.0"
    ghenv.Component.Category = "Params"
    ghenv.Component.SubCategory = "Util"
    
    #Outputs
    #--------------------------------------------------------------------------------------------
    outputIndex=0
    
    ghenv.Component.Params.Output[outputIndex].Name = "Directory"
    ghenv.Component.Params.Output[outputIndex].NickName = "D"
    ghenv.Component.Params.Output[outputIndex].Description = "Directory of the current grasshopper file."
    outputIndex+=1
    
    ghenv.Component.Params.Output[outputIndex].Name = "Path"
    ghenv.Component.Params.Output[outputIndex].NickName = "P"
    ghenv.Component.Params.Output[outputIndex].Description = "Path of the current grasshopper file."
    outputIndex+=1
    
    ghenv.Component.Params.Output[outputIndex].Name = "Separator"
    ghenv.Component.Params.Output[outputIndex].NickName = "S"
    ghenv.Component.Params.Output[outputIndex].Description = "Separator of the current system."
    outputIndex+=1

#Imports
#--------------------------------------------------------------------------------------------
from os.path import dirname
from os import sep

#Solver - Run with trees to enhance performance drastically
#--------------------------------------------------------------------------------------------
if __name__ == "__main__":
    P = ghenv.Component.OnPingDocument().FilePath
    D = dirname(P)
    S = sep
# ---------- end curdir ----------
concat = Concatenate(FragmentC="representations", FragmentD=curdir.S, FragmentA="base")
concat_2 = Concatenate(FragmentA=concat, FragmentB="_", FragmentE="1to500", FragmentG="_", FragmentF="volume")
concat_3 = Concatenate(FragmentA=concat, FragmentB="_", FragmentE="1to200", FragmentG="_", FragmentF="volume")
concat_4 = Concatenate(FragmentA=concat_2, FragmentB=".3dm")
concat_5 = Concatenate(FragmentA=concat_3, FragmentB=".3dm")
rep = ModelRepresentation(Url=concat_4, LevelOfDetail="1to500", Tags="volume")  # -> Representation, Url, LevelOfDetail, Tags
rep_2 = ModelRepresentation(Url=concat_5, LevelOfDetail="1to200", Tags="volume")  # -> Representation, Url, LevelOfDetail, Tags

expression_10 = Expression(x=entrancehallwidth, Expression="x/100")
expression_11 = Expression(x=sideshortsetbackdepth, Expression="x/100")
nakagincapsuletowerbasefloorplan = NakaginCapsuleTowerBaseFloorplan(
    plotoutline=crv,
    coressetbackdepth=expression_7,
    coressetbackwidth=expression_8,
    coreprimarylength=expression_3,
    coreprimarywidth=expression_4,
    coresecondarylength=expression_5,
    coresecondarywidth=expression_6,
    entrancehallwidth=expression_10,
    sideshortsetbackdepth=expression_11)  # -> sidebuilding_2, sideshort_2, sidemain_2, sidecorner_2, sidelong_2, coreprimary_2, coresecondary_2, sidemainfassadeside_2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
sidecorner = Curve(nakagincapsuletowerbasefloorplan.sidecorner_2)
sidebuilding = Curve(nakagincapsuletowerbasefloorplan.sidebuilding_2)
sideshort = Curve(nakagincapsuletowerbasefloorplan.sideshort_2)
sidemain = Curve(nakagincapsuletowerbasefloorplan.sidemain_2)
sidelong = Curve(nakagincapsuletowerbasefloorplan.sidelong_2)
coreprimary = Rectangle(nakagincapsuletowerbasefloorplan.coreprimary_2)
coresecondary = Rectangle(nakagincapsuletowerbasefloorplan.coresecondary_2)
sidemainfassadeside = Curve(nakagincapsuletowerbasefloorplan.sidemainfassadeside_2)
sidemainfassadeentrance = Curve(nakagincapsuletowerbasefloorplan.sidemainfassadeentrance_2)
sideshortfassade = Curve(nakagincapsuletowerbasefloorplan.sideshortfassade_2)
sidelongfassade = Curve(nakagincapsuletowerbasefloorplan.sidelongfassade_2)
basenoncore = Curve(nakagincapsuletowerbasefloorplan.basenoncore_2)
base = Curve(nakagincapsuletowerbasefloorplan.base_2)

Z = UnitZ(Factor=expression)
base_2 = Curve(base)
Z_2 = UnitZ(Factor=expression_2)
move = Move(Geometry=crv, Motion=Z)  # -> Geometry, Transform
extr = Extrude(Base=base_2, Direction=Z)
extr_2 = Extrude(Base=move.Geometry, Direction=Z_2)
cap = CapHoles(Brep=extr)
cap_2 = CapHoles(Brep=extr_2)
floorgroundvolume1to500 = Brep(cap)
floorfirstvolume1to500 = Brep(cap_2)

addition = Addition(A=expression, B=expression_2)
coresecondary_2 = Rectangle(coresecondary)
coreprimary_2 = Rectangle(coreprimary)
Z_3 = UnitZ(Factor=addition)
move_2 = Move(Geometry=coreprimary_2, Motion=Z_3)  # -> Geometry, Transform
move_3 = Move(Geometry=coresecondary_2, Motion=Z_3)  # -> Geometry, Transform
evalsrf = EvaluateSurface(Surface=reparameterize(move_2.Geometry), Point="0.5,0.5")  # -> Point, Normal, UDirection, VDirection, Frame
evalsrf_2 = EvaluateSurface(Surface=reparameterize(move_3.Geometry), Point="0.5,0.5")  # -> Point, Normal, UDirection, VDirection, Frame
panel_2 = Panel("""0
1""")
merge = Merge(Data1=evalsrf.Point, Data2=evalsrf_2.Point)
loc = ModelLocator(Group="core", Subgroup=panel_2)  # -> Locator, Group, Subgroup
concat_6 = Concatenate(FragmentA="c", FragmentB="-", FragmentC=panel_2)
por = ModelPort(Id=graft(concat_6), Plane=graft(merge), Locators=graft(loc.Locator))  # -> Port, Id, Plane, Locators
trim = TrimTree(Tree=por.Port, Depth=1)

expression_12 = Expression(x=columnssetbackdepth, Expression="x/100")
neg = Negative(Value=expression_12)
offset = OffsetCurve(Curve=sidemain, Distance=neg, Corners=1)
offset_2 = OffsetCurve(Curve=sidelong, Distance=neg, Corners=1)
trim_2 = TrimTree(Tree=offset, Depth=1)
trim_3 = TrimTree(Tree=offset_2, Depth=1)
columnsmainaxis = Curve(trim_2)
columnssideaxis = Curve(trim_3)
expression_13 = Expression(x=columnswidth, Expression="x/100")

expression_14 = Expression(x=expression_3, y=expression_13, Expression="x-2*y")
expression_15 = Expression(x=expression_5, y=expression_13, Expression="x-2*y")
subtraction = Subtraction(A=expression_8, B=expression_13)
merge_2 = Merge(
    Data1=expression_13,
    Data2=subtraction,
    Data3=expression_13,
    Data4=expression_14,
    Data5=expression_13,
    Data6=expression_10,
    Data7=expression_13,
    Data8=expression_15,
    Data9=expression_13)
ma = MassAddition(Input=merge_2)  # -> Result, PartialResults
eval = EvaluateLength(Curve=columnsmainaxis, Length=ma.PartialResults, Normalized="False")  # -> Point, Tangent, Parameter
shatter = Shatter(Curve=columnsmainaxis, Parameters=eval.Parameter)
trim_4 = TrimTree(Tree=shatter, Depth=1)
Z_4 = UnitZ(Factor=expression)
dispatch = Dispatch(List=trim_4, DispatchPattern=[True, False])  # -> ListA, ListB
extr_3 = Extrude(Base=dispatch.ListA, Direction=Z_4)
evalsrf_3 = EvaluateSurface(Surface=reparameterize(extr_3), Point="0.5,0.5")  # -> Point, Normal, UDirection, VDirection, Frame
amp_2 = Amplitude(Vector=evalsrf_3.Normal, Amplitude=expression_13)
extr_4 = Extrude(Base=extr_3, Direction=amp_2)
columnsmain = Brep(extr_4)

expression_16 = Expression(x=columnssidelongsetbackwidth, Expression="x/100")
expression_17 = Expression(x=entrancesetback, Expression="x/100")

eval_2 = EvaluateCurve(Curve=reparameterize(sidemainfassadeentrance), Parameter="0.5")  # -> Point, Tangent, Angle
Z_5 = UnitZ(Factor=1)
xprod = CrossProduct(VectorA=eval_2.Tangent, VectorB=Z_5, Unitize=False)  # -> Vector, Length
neg_2 = Negative(Value=xprod.Vector)
amp_3 = Amplitude(Vector=neg_2, Amplitude=expression_17)
extr_5 = Extrude(Base=sidemainfassadeentrance, Direction=amp_3)
Z_6 = UnitZ(Factor=expression_2)
extr_6 = Extrude(Base=extr_5, Direction=Z_6)
cap_3 = CapHoles(Brep=extr_6)
sdiff = SolidDifference(BrepsA=floorgroundvolume1to500, BrepsB=cap_3)
groundfloorvolume1to200 = Brep(sdiff)

merge_3 = Merge(Data1="2", Data2=expression_2, Data3=expression, Data4=cores, Data5=expression_9, Data6=expression_9)
panel_3 = Panel("""storeys
floor height
ground floor height
cores
core length
core width""")
panel_4 = Panel(merge_3)
panel_5 = Panel("""m
m

m
m""")
qlt = ModelQuality(Name=panel_3, Value=panel_4, Unit=panel_5)  # -> Quality, Name, Value, Unit

number_slider_3 = Slider(30, range=0..100)

txt = Text("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")
txt_2 = EncodeText(Text=txt)
concat_7 = Concatenate(FragmentA="data:image/svg+xml;base64,", FragmentB=txt_2)
icon1 = Text(concat_7)

concat_8 = Concatenate(FragmentA=concat, FragmentB=".glb")
rep_3 = ModelRepresentation(Url=concat_8)  # -> Representation, Url, LevelOfDetail, Tags
panel_6 = Panel("A two storey office building with a setback and a colonade on the groundfloor towards the street.")
merge_4 = Merge(Data1=rep_3.Representation, Data2=rep.Representation, Data3=rep_2.Representation)
panel_7 = Panel("🏫")
typ = ModelType(Name="Base", Description=panel_6, Icon=icon1, Representations=merge_4, Ports=trim, Qualities=qlt.Quality)  # -> Type, Name, Description, Icon, Variant, Unit, Representations, Ports, Qualities
typ_2 = RemoveType(TypeName=typ.Name, TypeVariant=typ.Variant, Run=safe_2)
or = GateOr(A=safe_2, B=typ_2)
typ_3 = AddType(Type=typ.Type, Run=or)

atticdepth = Number(number_slider_3)
fassadeedgesetback = Number(Slider(40, range=0..100))
windowparapetheight = Number(Slider(90, range=0..100))
windowheight = Number(Slider(150, range=0..1000))
atticheight = Number(number_slider_3)
previewplane_2 = PreviewPlane(plane=merge, axis_length=Slider(5, range=0..10))
expression_18 = Expression(x=fassadeedgesetback, Expression="x/100")
expression_19 = Expression(x=windowheight, Expression="x/100")
expression_20 = Expression(x=atticheight, Expression="x/100")

neg_3 = Negative(Value=expression_20)
neg_4 = Negative(Value=expression_20)
ext = ExtendCurve(Curve=columnssideaxis, Type=0, Start=neg_3, End=neg_4)
divide = DivideCurve(Curve=ext, Count="2", Kinks=False)  # -> Points, Tangents, Parameters
trim_5 = TrimTree(Tree=divide.Parameters, Depth=1)
eval_3 = EvaluateCurve(Curve=columnssideaxis, Parameter=trim_5)  # -> Point, Tangent, Angle
pl = ConstructPlane(Origin=eval_3.Point, XAxis=eval_3.Tangent, YAxis=Vector(0, 1, 0))
_2d = _2D(x=expression_13)
rectangle = Rectangle(Plane=pl, XSize=_2d, YSize=_2d, Radius=0)  # -> Rectangle, Length
Z_7 = UnitZ(Factor=expression)
extr_7 = Extrude(Base=rectangle.Rectangle, Direction=Z_7)
cap_4 = CapHoles(Brep=extr_7)
columnsside = Brep(cap_4)

merge_5 = Merge(Data1=columnsmain, Data2=columnsside)
columns = Brep(merge_5)

expression_21 = Expression(x=windowparapetheight, Expression="x/100")
expression_22 = Expression(x=atticdepth, Expression="x/100")

sidemain_2 = Curve(sidemain)
sidecorner_2 = Curve(sidecorner)
sidelong_2 = Curve(sidelong)
sideshort_2 = Curve(sideshort)
merge_6 = Merge(Data1=sideshort_2, Data2=sidemain_2, Data3=sidecorner_2, Data4=sidelong_2)
join = JoinCurves(Curves=merge_6, Preserve=False)
trim_6 = TrimTree(Tree=join, Depth=1)
move_4 = Move(Geometry=trim_6, Motion=Z)  # -> Geometry, Transform
neg_5 = Negative(Value=expression_18)
neg_6 = Negative(Value=expression_18)
move_5 = Move(Geometry=move_4.Geometry, Motion=Z_2)  # -> Geometry, Transform
neg_7 = Negative(Value=expression_18)
Z_8 = UnitZ(Factor=neg_6)
offset_3 = OffsetCurve(Curve=move_4.Geometry, Distance=neg_5, Corners=1)
Z_9 = UnitZ(Factor=expression_18)
offset_4 = OffsetCurve(Curve=move_5.Geometry, Distance=neg_7, Corners=1)
move_6 = Move(Geometry=move_4.Geometry, Motion=Z_9)  # -> Geometry, Transform
trim_7 = TrimTree(Tree=offset_3, Depth=1)
crv_2 = Curve(trim_7)
end = EndPoints(Curve=crv_2)  # -> Start, End
ln = Line(StartPoint=end.Start, EndPoint=end.End)
merge_7 = Merge(Data1=crv_2, Data2=ln)
move_7 = Move(Geometry=move_5.Geometry, Motion=Z_8)  # -> Geometry, Transform
trim_8 = TrimTree(Tree=offset_4, Depth=1)
crv_3 = Curve(trim_8)
end_2 = EndPoints(Curve=crv_3)  # -> Start, End
ln_2 = Line(StartPoint=end_2.Start, EndPoint=end_2.End)
merge_8 = Merge(Data1=crv_3, Data2=ln_2)
join_2 = JoinCurves(Curves=merge_7, Preserve=False)
join_3 = JoinCurves(Curves=merge_8, Preserve=False)
rulesrf = RuledSurface(CurveA=trim_7, CurveB=move_6.Geometry)
rulesrf_2 = RuledSurface(CurveA=move_6.Geometry, CurveB=move_7.Geometry)
rulesrf_3 = RuledSurface(CurveA=trim_8, CurveB=move_7.Geometry)
trim_9 = TrimTree(Tree=join_2, Depth=1)
trim_10 = TrimTree(Tree=join_3, Depth=1)
neg_8 = Negative(Value=expression_22)
merge_9 = Merge(Data1=rulesrf, Data2=rulesrf_2, Data3=rulesrf_3)
boundary = BoundarySurfaces(Edges=trim_9)
offset_5 = OffsetCurve(Curve=trim_10, Distance=neg_8, Corners=1)
boundary_2 = BoundarySurfaces(Edges=trim_10)
neg_9 = Negative(Value=expression_20)
Z_10 = UnitZ(Factor=neg_9)
trim_11 = TrimTree(Tree=offset_5, Depth=1)
fassadefirstfloor = Surface(merge_9)
rulesrf_4 = RuledSurface(CurveA=trim_10, CurveB=trim_11)
move_8 = Move(Geometry=trim_11, Motion=Z_10)  # -> Geometry, Transform
join_4 = BrepJoin(Breps=fassadefirstfloor)  # -> Breps, Closed
boundary_3 = BoundarySurfaces(Edges=move_8.Geometry)
rulesrf_5 = RuledSurface(CurveA=trim_11, CurveB=move_8.Geometry)
merge_10 = Merge(Data1=boundary, Data2=join_4.Breps, Data3=rulesrf_4, Data4=rulesrf_5, Data5=boundary_3)
move_9 = Move(Geometry=sidebuilding, Motion=Z)  # -> Geometry, Transform
Z_11 = UnitZ(Factor=expression_2)
join_5 = BrepJoin(Breps=merge_10)  # -> Breps, Closed
capex = CapHolesEx(Brep=join_5.Breps)  # -> Brep, Caps, Solid
floorfirstvolume1to200 = Brep(capex.Brep)

Z_12 = UnitZ(Factor=expression_21)
move_10 = Move(Geometry=move_4.Geometry, Motion=Z_12)  # -> Geometry, Transform
Z_13 = UnitZ(Factor=expression_19)
move_11 = Move(Geometry=move_10.Geometry, Motion=Z_13)  # -> Geometry, Transform
rulesrf_6 = RuledSurface(CurveA=move_10.Geometry, CurveB=move_11.Geometry)
windowribbon = Surface(rulesrf_6)

concat_9 = Concatenate(FragmentA="first floor", FragmentB="::", FragmentC="windows")
concat_10 = Concatenate(FragmentA="ground floor", FragmentB="::", FragmentC="columns")
concat_11 = Concatenate(FragmentA="first floor", FragmentB="::", FragmentC="volume")
concat_12 = Concatenate(FragmentA="ground floor", FragmentB="::", FragmentC="building")
floorgroundvolume1to500_2 = Brep(floorgroundvolume1to500)
floorfirstvolume1to500_2 = Brep(floorfirstvolume1to500)
groundfloorvolume1to200_2 = Brep(groundfloorvolume1to200)
floorfirstvolume1to200_2 = Brep(floorfirstvolume1to200)
concat_13 = Concatenate(FragmentA=concat_10, FragmentB="::", FragmentC="main")
concat_14 = Concatenate(FragmentA=concat_10, FragmentB="::", FragmentC="side")
windowribbon_2 = Surface(windowribbon)
columnsmain_2 = Brep(columnsmain)
columnsside_2 = Brep(columnsside)
expression_23 = Expression(x=concat_12, y=floorgroundvolume1to500_2, Expression="x")
expression_24 = Expression(x=concat_13, y=columnsmain_2, Expression="x")
expression_25 = Expression(x=concat_13, y=columnsmain_2, Expression="x")
expression_26 = Expression(x=concat_14, y=columnsside_2, Expression="x")
expression_27 = Expression(x=concat_11, y=floorfirstvolume1to500_2, Expression="x")
expression_28 = Expression(x=concat_9, y=windowribbon_2, Expression="x")
merge_11 = Merge(Data1=expression_23, Data2=expression_25, Data3=expression_26, Data4=expression_27, Data5=expression_28)
merge_12 = Merge(
    Data1=floorgroundvolume1to500_2,
    Data2=columnsmain_2,
    Data3=columnsside_2,
    Data4=floorfirstvolume1to500_2,
    Data5=windowribbon_2)
merge_13 = Merge(
    Data1=groundfloorvolume1to200_2,
    Data2=columnsmain_2,
    Data3=columnsside_2,
    Data4=floorfirstvolume1to200_2,
    Data5=windowribbon_2)
ef_layer = EleFrontLayer(FullPath=merge_11)  # -> Layer, FullPath, Hidden, Locked, DisplayColour, MaterialName, Linetype, PrintColour, PrintWidth
concat_15 = Concatenate(FragmentA=curdir.D, FragmentB=curdir.S, FragmentC=concat_4)
concat_16 = Concatenate(FragmentA=curdir.D, FragmentB=curdir.S, FragmentC=rep_2.Url)
ef_att = EleFrontAttributes(Layer=ef_layer.Layer)  # -> Attributes, Keys, Values, Name, Layer, ColourSource, DisplayColour, MaterialSource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
baketofile = BakeObjectsToFile(
    FilePath=concat_15,
    Geometry=merge_12,
    Attributes=ef_att.Attributes,
    Bake=safe_2,
    networkMode=False,
    ValueTable_networkMode=True,
    overwriteMode="Overwrite",
    preset="Safest")
baketofile_2 = BakeObjectsToFile(
    FilePath=concat_16,
    Geometry=merge_13,
    Attributes=ef_att.Attributes,
    Bake=safe_2,
    networkMode=False,
    ValueTable_networkMode=True,
    overwriteMode="Overwrite",
    preset="Safest")

# ----
# Outputs   ->
#                 |
#                 v
rec = Rectangle({Plane=Plane(origin=(-1970.889691, 1937.419247, 1956.598842), x=(0.7071067812, 0.7071067812, 0), y=(0.4082482905, -0.4082482905, 0.8164965809)), Size=Domain2(u=-46.34617503..46.34617503, v=-24.69844367..24.69844367)})
merge_14 = Merge()
m2d_parallel = Make2DParallelView(Projection=rec)
make2d = Make2D(Geometry=merge_13, View=m2d_parallel, TangentEdges="T", TangentSeams=False, AutoComputeMake2D=True)  # -> VisibleCurves, VisibleIndex, VisibleType, HiddenCurves, HiddenIndex, HiddenType
trim_12 = TrimTree(Tree=make2d.VisibleCurves, Depth=1)
shaft = Geometry(trim_12)

expression_29 = Expression(x="shaft", y=shaft, Expression="x")
concat_17 = Concatenate(FragmentC="icons", FragmentD=curdir.S, FragmentA="base")
merge_15 = Merge(Data1=expression_29)
merge_16 = Merge(Data1=shaft)
concat_18 = Concatenate(FragmentA=concat_17, FragmentB=".3dm")
ef_layer_2 = EleFrontLayer(FullPath=merge_15)  # -> Layer, FullPath, Hidden, Locked, DisplayColour, MaterialName, Linetype, PrintColour, PrintWidth
concat_19 = Concatenate(FragmentA=curdir.D, FragmentB=curdir.S, FragmentC=concat_18)
ef_att_2 = EleFrontAttributes(Layer=ef_layer_2.Layer)  # -> Attributes, Keys, Values, Name, Layer, ColourSource, DisplayColour, MaterialSource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
baketofile_3 = BakeObjectsToFile(
    FilePath=concat_19,
    Geometry=merge_16,
    Attributes=ef_att_2.Attributes,
    Bake=and,
    networkMode=False,
    ValueTable_networkMode=True,
    overwriteMode="Overwrite",
    preset="Safest")

typ_4 = SerializeType(Type=typ.Type)
type = Text(typ_4)
context_bake = ContextBake(Geometry=type)

# ==== cluster NakaginCapsuleTowerBaseFloorplan
sideshortsetbackdepth = ClusterInput()
plotoutline = ClusterInput()
coressetbackdepth = ClusterInput()
coressetbackwidth = ClusterInput()
coreprimarylength = ClusterInput()
coreprimarywidth = ClusterInput()
coresecondarylength = ClusterInput()
coresecondarywidth = ClusterInput()
entrancehallwidth = ClusterInput()
coressetbackdepth_2 = Number(coressetbackdepth)
coreprimarylength_2 = Number(coreprimarylength)
coreprimarywidth_2 = Number(coreprimarywidth)
coresecondarylength_2 = Number(coresecondarylength)
coressetbackwidth_2 = Number(coressetbackwidth)
plotoutline_2 = Curve(plotoutline)
coresecondarywidth_2 = Number(coresecondarywidth)
entrancehallwidth_2 = Number(entrancehallwidth)
sideshortsetbackdepth_2 = Number(sideshortsetbackdepth)
xy = XYPlane(Origin=Point(0, 0, 0))
merge = Merge(Data1=coressetbackwidth_2, Data2=coreprimarylength_2, Data3=entrancehallwidth_2, Data4=coresecondarylength_2)
neg = Negative(Value=coressetbackdepth_2)
ma = MassAddition(Input=merge)  # -> Result, PartialResults
explode = Explode(Curve=plotoutline_2, Recursive=True)  # -> Segments, Vertices
Y = UnitY(Factor=neg)
neg_2 = Negative(Value=ma.PartialResults)
trim = TrimTree(Tree=explode.Segments, Depth=1)
X = UnitX(Factor=neg_2)
move = Move(Geometry=xy, Motion=Y)  # -> Geometry, Transform
item = ListItem(List=trim, Index=0, Wrap=True)  # -> Item, Item1, Item2, Item3, Item4
move_2 = Move(Geometry=move.Geometry, Motion=X)  # -> Geometry, Transform
sidemain = Curve(item.Item2)
sidecorner = Curve(item.Item3)
sidelong = Curve(item.Item4)
sidebuilding = Curve(item.Item)
sideshort = Curve(item.Item1)
item_2 = ListItem(List=move_2.Geometry, Index=0, Wrap=True)  # -> Item, Item1, Item2, Item3
neg_3 = Negative(Value=coresecondarywidth_2)
neg_4 = Negative(Value=coreprimarywidth_2)
neg_5 = Negative(Value=entrancehallwidth_2)
sidebuilding_2 = ClusterOutput(sidebuilding)
sideshort_2 = ClusterOutput(sideshort)
sidemain_2 = ClusterOutput(sidemain)
sidecorner_2 = ClusterOutput(sidecorner)
sidelong_2 = ClusterOutput(sidelong)
rectangle = Rectangle(Plane=item_2.Item2, XSize=entrancehallwidth_2, YSize=neg_5, Radius=0)  # -> Rectangle, Length
rectangle_2 = Rectangle(Plane=item_2.Item1, XSize=coreprimarylength_2, YSize=neg_3, Radius=0)  # -> Rectangle, Length
rectangle_3 = Rectangle(Plane=item_2.Item3, XSize=coresecondarylength_2, YSize=neg_4, Radius=0)  # -> Rectangle, Length
coresecondary = Rectangle(rectangle_2.Rectangle)
coreprimary = Rectangle(rectangle_3.Rectangle)
explode_2 = Explode(Curve=rectangle.Rectangle, Recursive=True)  # -> Segments, Vertices
explode_3 = Explode(Curve=coreprimary, Recursive=True)  # -> Segments, Vertices
coreprimary_2 = ClusterOutput(coreprimary)
coresecondary_2 = ClusterOutput(coresecondary)
trim_2 = TrimTree(Tree=explode_2.Segments, Depth=1)
trim_3 = TrimTree(Tree=explode_3.Vertices, Depth=1)
item_3 = ListItem(List=trim_2, Index=0, Wrap=True)  # -> Item, Item1, Item2, Item3
item_4 = ListItem(List=trim_3, Index=0, Wrap=True)  # -> Item, Item1, Item2, Item3
neg_6 = Negative(Value=sideshortsetbackdepth_2)
offset = OffsetCurve(Curve=sideshort, Distance=neg_6, Corners=1)
trim_4 = TrimTree(Tree=offset, Depth=1)

X_2 = UnitX(Factor=1)
line = LineSDL(Start=move.Geometry, Direction=X_2, Length=1)
rotax = RotateAxis(Geometry=move.Geometry, Angle=degrees("90"), Axis=line)  # -> Geometry, Transform
pcx = CurvePlane(Curve=trim_4, Plane=rotax.Geometry)  # -> Points, ParamsC, ParamsP
trim_5 = TrimTree(Tree=pcx.Points, Depth=1)
crv_cp = CurveClosestPoint(Point=trim_5, Curve=trim_4)  # -> Point, Parameter, Distance
shatter = Shatter(Curve=trim_4, Parameters=crv_cp.Parameter)
trim_6 = TrimTree(Tree=shatter, Depth=1)
item_5 = ListItem(List=trim_6, Index=0, Wrap=True)

explode_4 = Explode(Curve=coresecondary, Recursive=True)  # -> Segments, Vertices
trim_7 = TrimTree(Tree=explode_4.Segments, Depth=1)
shift = ShiftList(List=trim_7, Shift="-2", Wrap=True)
panel = Panel("-1")
trim_8 = TrimTree(Tree=shift, Depth=1)
lito3p = ListInto3Parts(ListToSlice=trim_8, StartIndex="1")  # -> FilteredList, ItemsBefore, ItemsAfter; inputs ListToSlice: tree, StartIndex: tree of Int32, EndIndex: tree of Int32
# ---------- lito3p: Python ----------
if ghenv.Component.RunCount<2:
    __author__ = "Ueli Saluz"
    __version__ = "2020.05.28"
    
    ghenv.Component.Name = "ListInto3Parts"
    ghenv.Component.NickName = "LiTo3P"
    ghenv.Component.Description = "Slice list into 3 parts. All lists are sliced with the same indices. End index = 0 = length(list)."
    ghenv.Component.Message = "VER 1.6"

from System import Object
from Grasshopper import DataTree

def filterList(listToFilter,startIndex,endIndex):
    # Return: FilteredList, Before, After
    if (((startIndex == 0) or (startIndex is None)) and ((endIndex == 0) or (endIndex is None))) or (endIndex <= startIndex and endIndex > 0):
        return (listToFilter,None,None)
    elif (startIndex == 0) or (startIndex is None):
        return (listToFilter[:endIndex],None,listToFilter[endIndex:])
    elif (endIndex == 0) or (endIndex is None):
        print 1
        return (listToFilter[:startIndex],listToFilter[startIndex:],None)
    else:
        return (listToFilter[startIndex:endIndex],listToFilter[:startIndex],listToFilter[endIndex:])

if __name__ == "__main__":
    FilteredList = DataTree[Object]()
    ItemsBefore = DataTree[Object]()
    ItemsAfter = DataTree[Object]()
    
    for path in ListToSlice.Paths:
        listBranch = ListToSlice.Branch(path)
        pyList = list(listBranch)   #Convert .Net List to Python
        try: #terrible way of writing code but if I set the list to list access the performance decreases massivly due to many calls
            startIndex = StartIndex.Branch(path)
            startIndex = startIndex[0]
        except Exception:
            try:
                startIndex = StartIndex.Branch(0)
                startIndex = startIndex[0]
            except Exception:
                startIndex = 0
        try:
            endIndex = EndIndex.Branch(path)
            endIndex = endIndex[0]
        except Exception:
            try:
                endIndex = EndIndex.Branch(0)
                endIndex = endIndex[0]
            except Exception:
                endIndex = len(pyList)
        filtList=filterList(pyList,startIndex,endIndex)
        if filtList[0]:
            FilteredList.AddRange(filtList[0],path)
        if filtList[1]:
            ItemsBefore.AddRange(filtList[1],path)
        if filtList[2]:
            ItemsAfter.AddRange(filtList[2],path)
# ---------- end lito3p ----------

panel_2 = Panel(trim_5)
ln = Line(StartPoint=crv_cp.Point, EndPoint=item_2.Item)
ln_2 = Line(StartPoint=item_2.Item1, EndPoint=item_2.Item2)
ln_3 = Line(StartPoint=crv_cp.Point, EndPoint=item_4.Item3)
ln_4 = Line(StartPoint=item_4.Item3, EndPoint=item_4.Item)
ln_5 = Line(StartPoint=item_4.Item, EndPoint=item_4.Item1)
sidemainfassadeside = Curve(ln)
sideshortfassade = Curve(item_5)
sidemainfassadeentrance = Curve(ln_2)
sidemainfassadeentrance_2 = ClusterOutput(sidemainfassadeentrance)
sidemainfassadeside_2 = ClusterOutput(sidemainfassadeside)
sideshortfassade_2 = ClusterOutput(sideshortfassade)

xy_2 = XYPlane(Origin=Point(0, 0, 0))
rotate = Rotate(Geometry=xy_2, Angle=degrees("180"), Plane=PlaneXY(0, 0, 0))  # -> Geometry, Transform
brec = BoundingRectangle(geometry=plotoutline_2, plane=graft(rotate.Geometry))  # -> boundingrectangle_2, length_2
end = EndPoints(Curve=trim_4)  # -> Start, End
crv_cp_2 = CurveClosestPoint(Point=end.Start, Curve=sidebuilding)  # -> Point, Parameter, Distance

rec = Rectangle(brec.boundingrectangle_2)

trim_9 = TrimTree(Tree=rec, Depth=1)
drec = DeconstuctRectangle(Rectangle=trim_9)  # -> BasePlane, XInterval, YInterval
domprop = DomainProperties(I=drec.YInterval, In=True)  # -> L, M, T0, T1; inputs I: tree, In: tree of Boolean
# ---------- domprop: Python ----------
#Component Information
#--------------------------------------------------------------------------------------------
if ghenv.Component.RunCount<2:
    #General
    #--------------------------------------------------------------------------------------------
    __author__ = "Ueli Saluz"
    __version__ = "2021.11.22"
    
    ghenv.Component.Name = "DomainProperties"
    ghenv.Component.NickName = "DomProp"
    ghenv.Component.Description = "Returns some properties of a domain"
    ghenv.Component.Message = "VER 1.0"
    ghenv.Component.Category = "Maths"
    ghenv.Component.SubCategory = "Domain"
    
     #Inputs
    #--------------------------------------------------------------------------------------------
    inputIndex=0
    
    ghenv.Component.Params.Input[inputIndex].Name = "Domain"
    ghenv.Component.Params.Input[inputIndex].NickName = "I"
    ghenv.Component.Params.Input[inputIndex].Description = "Domain to evaluate"
    ghenv.Component.Params.Input[inputIndex].Optional = False
    inputIndex+=1
    
    ghenv.Component.Params.Input[inputIndex].Name = "MakeIncreasing"
    ghenv.Component.Params.Input[inputIndex].NickName = "In"
    ghenv.Component.Params.Input[inputIndex].Description = "Makes sure that the domain is increasing. If not it gets swapped."
    ghenv.Component.Params.Input[inputIndex].Optional = False
    inputIndex+=1
    
    #Outputs
    #--------------------------------------------------------------------------------------------
    outputIndex=0
    
    ghenv.Component.Params.Output[outputIndex].Name = "Length"
    ghenv.Component.Params.Output[outputIndex].NickName = "L"
    ghenv.Component.Params.Output[outputIndex].Description = "Length of the domain"
    outputIndex+=1
    
    ghenv.Component.Params.Output[outputIndex].Name = "Mid"
    ghenv.Component.Params.Output[outputIndex].NickName = "M"
    ghenv.Component.Params.Output[outputIndex].Description = "Middle of the of the domain"
    outputIndex+=1
    
    ghenv.Component.Params.Output[outputIndex].Name = "DomainStartParameter"
    ghenv.Component.Params.Output[outputIndex].NickName = "T0"
    ghenv.Component.Params.Output[outputIndex].Description = "Start parameter. Doens't have to be smaller than the end parameter."
    outputIndex+=1
    
    ghenv.Component.Params.Output[outputIndex].Name = "DomainEndParameter"
    ghenv.Component.Params.Output[outputIndex].NickName = "T1"
    ghenv.Component.Params.Output[outputIndex].Description = "End parameter. Doens't have to be bigger than the start parameter."
    outputIndex+=1
    


#Imports
#--------------------------------------------------------------------------------------------
from System import Object
from Grasshopper import DataTree

#Solver - Run with trees to enhance performance drastically
#--------------------------------------------------------------------------------------------
if __name__ == "__main__":
    
    #Initialize trees
    #--------------------------------------------------------------------------------------------
    LengthTree = DataTree[Object]()
    MidTree = DataTree[Object]()
    DomainStartParameterTree = DataTree[Object]()
    DomainEndParameterTree = DataTree[Object]()
    LengthTree = DataTree[Object]()
    
    #Data matching
    #--------------------------------------------------------------------------------------------
    for path in I.Paths:
        domainBranch = I.Branch(path)
        for i,domain in enumerate(domainBranch):
            if In==True:
                domain.MakeIncreasing()
            LengthTree.Add(domain.Length, path)
            MidTree.Add(domain.Mid, path)
            DomainStartParameterTree.Add(domain.T0, path)
            DomainEndParameterTree.Add(domain.T1, path)
    
     #Assign trees to output
    #--------------------------------------------------------------------------------------------
    L = LengthTree
    M = MidTree
    T0 = DomainStartParameterTree
    T1 = DomainEndParameterTree
# ---------- end domprop ----------
ext = ExtendCurve(Curve=item_3.Item3, Type=0, Start="0", End=domprop.L)
ccx = CurveCurve(CurveA=ext, CurveB=sidebuilding)  # -> Points, ParamsA, ParamsB
trim_10 = TrimTree(Tree=ccx.Points, Depth=1)
trim_11 = TrimTree(Tree=ccx.ParamsB, Depth=1)
merge_2 = Merge(Data1=trim_11, Data2=crv_cp_2.Parameter)
trim_12 = TrimTree(Tree=ccx.ParamsA, Depth=1)
shatter_2 = Shatter(Curve=sidebuilding, Parameters=merge_2)
shatter_3 = Shatter(Curve=ext, Parameters=trim_12)
trim_13 = TrimTree(Tree=shatter_2, Depth=1)
trim_14 = TrimTree(Tree=shatter_3, Depth=1)

item_6 = ListItem(List=trim_13, Index=0, Wrap=True)  # -> Item, Item1
item_7 = ListItem(List=trim_14, Index=0, Wrap=True)  # -> Item, Item1
ln_6 = Line(StartPoint=item_4.Item1, EndPoint=trim_10)
merge_3 = Merge(Data1=ln, Data2=lito3p.FilteredList, Data3=ln_2, Data4=item_7.Item, Data5=item_6.Item1, Data6=item_5)
merge_4 = Merge(Data1=ln_3, Data2=ln_4, Data3=ln_5, Data4=ln_6, Data5=item_6.Item1, Data6=item_5)
join = JoinCurves(Curves=merge_3, Preserve=False)
sidelongfassade = Curve(ln_6)
join_2 = JoinCurves(Curves=merge_4, Preserve=False)
trim_15 = TrimTree(Tree=join, Depth=1)
trim_16 = TrimTree(Tree=join_2, Depth=1)
end_2 = EndPoints(Curve=trim_15)  # -> Start, End
end_3 = EndPoints(Curve=trim_16)  # -> Start, End
ln_7 = Line(StartPoint=end_2.Start, EndPoint=end_2.End)
ln_8 = Line(StartPoint=end_3.Start, EndPoint=end_3.End)
merge_5 = Merge(Data1=ln_7, Data2=trim_15)
merge_6 = Merge(Data1=ln_8, Data2=trim_16)
sidelongfassade_2 = ClusterOutput(sidelongfassade)
join_3 = JoinCurves(Curves=merge_5, Preserve=False)
join_4 = JoinCurves(Curves=merge_6, Preserve=False)
trim_17 = TrimTree(Tree=join_3, Depth=1)
trim_18 = TrimTree(Tree=join_4, Depth=1)
simplify = SimplifyCurve(Curve=trim_17)  # -> Curve, Simplified
simplify_2 = SimplifyCurve(Curve=trim_18)  # -> Curve, Simplified
crv_cp_3 = CurveClosestPoint(Point=move.Geometry, Curve=simplify.Curve)  # -> Point, Parameter, Distance
crv_cp_4 = CurveClosestPoint(Point=move.Geometry, Curve=simplify_2.Curve)  # -> Point, Parameter, Distance
seam = Seam(Curve=simplify.Curve, Seam=crv_cp_3.Parameter)
seam_2 = Seam(Curve=simplify_2.Curve, Seam=crv_cp_4.Parameter)
crv_cp_5 = CurveClosestPoint(Point=crv_cp.Point, Curve=seam)  # -> Point, Parameter, Distance
crv_cp_6 = CurveClosestPoint(Point=crv_cp.Point, Curve=seam_2)  # -> Point, Parameter, Distance
seam_3 = Seam(Curve=seam, Seam=crv_cp_5.Parameter)
seam_4 = Seam(Curve=seam_2, Seam=crv_cp_6.Parameter)
flip = FlipCurve(Curve=seam_3, Guide=plotoutline_2)  # -> Curve, Flag
flip_2 = FlipCurve(Curve=seam_4, Guide=plotoutline_2)  # -> Curve, Flag
basenoncore = Curve(flip.Curve)
basenoncore_2 = ClusterOutput(basenoncore)
base = Curve(flip_2.Curve)
base_2 = ClusterOutput(base)

# ==== cluster _2D
x = ClusterInput()
expression = Expression(x=x, Expression="x/2")
neg = Negative(Value=expression)
dom = ConstructDomain(DomainStart=neg, DomainEnd=expression)
I = ClusterOutput(dom)

# ==== cluster PreviewPlane: Preview a plane with axis colors and naming.
axis_length = ClusterInput()
plane = ClusterInput()
axis_length_2 = Number(axis_length)
plane_2 = Plane(plane)
deplane = DeconstructPlane(Plane=plane_2)  # -> Origin, XAxis, YAxis, ZAxis
line = LineSDL(Start=deplane.Origin, Direction=deplane.YAxis, Length=axis_length_2)
line_2 = LineSDL(Start=deplane.Origin, Direction=deplane.XAxis, Length=axis_length_2)
line_3 = LineSDL(Start=deplane.Origin, Direction=deplane.ZAxis, Length=axis_length_2)
swatch = ColourSwatch(SwatchColor=RGB(235, 52, 79))
swatch_2 = ColourSwatch(SwatchColor=RGB(0, 166, 157))
swatch_3 = ColourSwatch(SwatchColor=RGB(240, 117, 24))
end = EndPoints(Curve=line_2)  # -> Start, End
end_2 = EndPoints(Curve=line)  # -> Start, End
end_3 = EndPoints(Curve=line_3)  # -> Start, End
tag = TextTag(Location=end.End, Text="X", Colour=swatch)
tag_2 = TextTag(Location=end_2.End, Text="Y", Colour=swatch_2)
tag_3 = TextTag(Location=end_3.End, Text="Z", Colour=swatch_3)
preview = CustomPreview(Geometry=line_2, Material=swatch)
preview_2 = CustomPreview(Geometry=line, Material=swatch_2)
preview_3 = CustomPreview(Geometry=line_3, Material=swatch_3)

# ==== cluster ViewRectangle
view = ClusterInput()
view_2 = Data(view)
nickname = NAME(view=view_2)  # -> c, x, y, z, h, w
# ---------- nickname: Python ----------
uselss, c, x, y, z = view.GetCameraFrame()
h = view.FrustumHeight
w = view.FrustumWidth
# ---------- end nickname ----------
rev = Reverse(Vector=nickname.x)
rev_2 = Reverse(Vector=nickname.y)
pl = ConstructPlane(Origin=nickname.c, XAxis=rev, YAxis=nickname.y)
_2d = _2D(x=nickname.w)
_2d_2 = _2D(x=nickname.h)
rectangle = Rectangle(Plane=pl, XSize=_2d, YSize=_2d_2, Radius=0)  # -> Rectangle, Length
rec = Rectangle(rectangle.Rectangle)
rec_2 = ClusterOutput(rec)

# ==== cluster BoundingRectangle: Get a bounding rectangle on a plane of individual geometry.
geometry = ClusterInput()
plane = ClusterInput()
plane_2 = Plane(plane)
geometry_2 = Geometry(geometry)
bbox = BoundingBox(Content=geometry_2, Plane=plane_2)  # -> Box, Box_2
trim = TrimTree(Tree=bbox.Box, Depth=1)
debox = DeconstructBox(Box=trim)  # -> Plane, X, Y, Z
rectangle = Rectangle(Plane=debox.Plane, XSize=debox.X, YSize=debox.Y, Radius=0)  # -> Rectangle, Length
boundingrectangle = Rectangle(rectangle.Rectangle)
length = Number(rectangle.Length)
length_2 = ClusterOutput(length)
boundingrectangle_2 = ClusterOutput(boundingrectangle)
