# Grasshopper definition capital.gh (Grasshopper 1.0.7)
# plug-ins: eleFront, semio

safe = Button()
safe_2 = BooleanToggle(False)
icon_export = BooleanToggle(False)
loop_slider = PythonScript(Min="0", Max="1", stepSize="1", Delay=Slider(0, range=0..1), Run=Toggle(False), Reset=Button())  # inputs Run: Boolean, Reset: Boolean
# ---------- loop_slider: Python ----------
import time

def updateSliderInput(inputName,min,max,value,decimalPlace=2):
    for input in ghenv.Component.Params.Input:
        for source in input.Sources:
            if input.Name == str(inputName):
                source.Slider.DecimalPlaces = decimalPlace
                source.Slider.Minimum = min
                source.Slider.Maximum = max
                source.Slider.Value = value
                source.ExpireSolution(True)

def countDecimal(number):
    string= str(number)
    return string[::-1].find('.')

if Run == True:
    if SliderToModify < Max:
        time.sleep(Delay)
        updateSliderInput("SliderToModify",Min,Max,SliderToModify+stepSize,countDecimal(stepSize))
if Reset == True:
    updateSliderInput("SliderToModify",Min,Max,Min)
# ---------- end loop_slider ----------
# ^
#                  |
# Preview    ->
# Parameters:
and = GateAnd(A=safe_2, B=icon_export)
number_slider = Slider(550, range=0..1000)
list = ValueList({"north east", "south east", "south west", "north west"}, selected="north west")
panel = Panel("""north east
south east
south west
north west""")
# External
#       |
#       v
peak = GetString(list, AtLeast=1, AtMost=1, TreeAccess=False)
itemindex = ItemIndex(L=panel, I=peak)  # -> i; inputs L: list
# ---------- itemindex: Python ----------
#Component Information
#--------------------------------------------------------------------------------------------
if ghenv.Component.RunCount<2:
    #General
    #--------------------------------------------------------------------------------------------
    __author__ = "Ueli Saluz"
    __version__ = "2022.11.18"
    
    ghenv.Component.Name = "ItemIndex"
    ghenv.Component.NickName = "ItemIndex"
    ghenv.Component.Description = "A better IdemIndex"
    ghenv.Component.Message = "VER 1.0"
    ghenv.Component.Category = "Set"
    ghenv.Component.SubCategory = "List"
    
     #Inputs
    #--------------------------------------------------------------------------------------------
    inputIndex=0
    
    ghenv.Component.Params.Input[inputIndex].Name = "List"
    ghenv.Component.Params.Input[inputIndex].NickName = "L"
    ghenv.Component.Params.Input[inputIndex].Description = "Input1 is..."
    ghenv.Component.Params.Input[inputIndex].Optional = False
    inputIndex+=1
    
    ghenv.Component.Params.Input[inputIndex].Name = "Item"
    ghenv.Component.Params.Input[inputIndex].NickName = "I"
    ghenv.Component.Params.Input[inputIndex].Description = "Input2 is..."
    ghenv.Component.Params.Input[inputIndex].Optional = False
    inputIndex+=1
    
    #Outputs
    #--------------------------------------------------------------------------------------------
    outputIndex=0
    
    ghenv.Component.Params.Output[outputIndex].Name = "Index"
    ghenv.Component.Params.Output[outputIndex].NickName = "i"
    ghenv.Component.Params.Output[outputIndex].Description = "Output1 is..."
    outputIndex+=1

i = L.index(I)
# ---------- end itemindex ----------
length = GetNumber(number_slider, AtLeast=1, AtMost=1, Maximum=1.797693135e+308, Minimum=-1.797693135e+308, TreeAccess=False)
lowerheight = GetNumber(Slider(100, range=0..100), AtLeast=1, AtMost=1, Maximum=1.797693135e+308, Minimum=-1.797693135e+308, TreeAccess=False)
width = GetNumber(number_slider, AtLeast=1, AtMost=1, Maximum=1.797693135e+308, Minimum=-1.797693135e+308, TreeAccess=False)
wallthickness = GetNumber(Slider(30, range=0..100), AtLeast=1, AtMost=1, Maximum=1.797693135e+308, Minimum=-1.797693135e+308, TreeAccess=False)
height = GetNumber(Slider(1150, range=0..10000), AtLeast=1, AtMost=1, Maximum=1.797693135e+308, Minimum=-1.797693135e+308, TreeAccess=False)
sideheight = GetNumber(Slider(550, range=0..1000), AtLeast=1, AtMost=1, Maximum=1.797693135e+308, Minimum=-1.797693135e+308, TreeAccess=False)
valueor0 = ValueOr0(value=itemindex)
expression = Expression(x=length, Expression="x/100")
expression_2 = Expression(x=width, Expression="x/100")
expression_3 = Expression(x=height, Expression="x/100")
expression_4 = Expression(x=sideheight, Expression="x/100")
expression_5 = Expression(x=lowerheight, Expression="x/100")
expression_6 = Expression(x=wallthickness, Expression="x/100")

# ----
# Outputs   ->
#                 |
#                 v
panel_2 = Panel("south west")
merge = Merge(
    Data1=panel_2,
    Data2=expression,
    Data3=expression_2,
    Data4=expression_2,
    Data5=expression_4,
    Data6=expression_5,
    Data7=expression_6)
panel_3 = Panel("""peak
length
width
height
height side
height low
wall thickness""")
panel_4 = Panel(merge)
panel_5 = Panel("""m
m
m
m
m
m""")
qlt = ModelQuality(Name=panel_3, Value=panel_4, Unit=panel_5)  # -> Quality, Name, Value, Unit

xy = XYPlane(Origin=Point(0, 0, 0))

curdir = CurrentDirectory()  # -> D, P, S
# ---------- curdir: Python ----------
#Component Information
#--------------------------------------------------------------------------------------------
if ghenv.Component.RunCount<2:
    #General
    #--------------------------------------------------------------------------------------------
    __author__ = "Ueli Saluz"
    __version__ = "2023.09.29"
    
    ghenv.Component.Name = "CurrentDirectory"
    ghenv.Component.NickName = "CurDir"
    ghenv.Component.Description = "Current directory of the current grasshopper file."
    ghenv.Component.Message = "VER 1.0"
    ghenv.Component.Category = "Params"
    ghenv.Component.SubCategory = "Util"
    
    #Outputs
    #--------------------------------------------------------------------------------------------
    outputIndex=0
    
    ghenv.Component.Params.Output[outputIndex].Name = "Directory"
    ghenv.Component.Params.Output[outputIndex].NickName = "D"
    ghenv.Component.Params.Output[outputIndex].Description = "Directory of the current grasshopper file."
    outputIndex+=1
    
    ghenv.Component.Params.Output[outputIndex].Name = "Path"
    ghenv.Component.Params.Output[outputIndex].NickName = "P"
    ghenv.Component.Params.Output[outputIndex].Description = "Path of the current grasshopper file."
    outputIndex+=1
    
    ghenv.Component.Params.Output[outputIndex].Name = "Separator"
    ghenv.Component.Params.Output[outputIndex].NickName = "S"
    ghenv.Component.Params.Output[outputIndex].Description = "Separator of the current system."
    outputIndex+=1

#Imports
#--------------------------------------------------------------------------------------------
from os.path import dirname
from os import sep

#Solver - Run with trees to enhance performance drastically
#--------------------------------------------------------------------------------------------
if __name__ == "__main__":
    P = ghenv.Component.OnPingDocument().FilePath
    D = dirname(P)
    S = sep
# ---------- end curdir ----------
concat = Concatenate(FragmentC="representations", FragmentD=curdir.S, FragmentA="capital")
concat_2 = Concatenate(FragmentA=concat, FragmentB="_", FragmentE="1to500", FragmentG="_", FragmentF="volume")
concat_3 = Concatenate(FragmentA=concat, FragmentB="_", FragmentE="1to200", FragmentG="_", FragmentF="volume")
concat_4 = Concatenate(FragmentA=concat, FragmentB=".glb")
concat_5 = Concatenate(FragmentA=concat_2, FragmentB=".3dm")
concat_6 = Concatenate(FragmentA=concat_3, FragmentB=".3dm")
rep = ModelRepresentation(Url=concat_4)  # -> Representation, Url, LevelOfDetail, Tags
rep_2 = ModelRepresentation(Url=concat_5, LevelOfDetail="1to500", Tags="volume")  # -> Representation, Url, LevelOfDetail, Tags
rep_3 = ModelRepresentation(Url=concat_6, LevelOfDetail="1to200", Tags="volume")  # -> Representation, Url, LevelOfDetail, Tags

_2d = _2D(x=expression_2)
_2d_2 = _2D(x=expression)
subtraction = Subtraction(A=expression_3, B=expression_5)
Z = UnitZ(Factor=expression_3)
rectangle = Rectangle(Plane=xy, XSize=_2d_2, YSize=_2d, Radius=0)  # -> Rectangle, Length
merge_2 = Merge(Data1="0", Data2=expression_4, Data3=subtraction, Data4=expression_4)
move = Move(Geometry=rectangle.Rectangle, Motion=Z)  # -> Geometry, Transform
debrep = DeconstructBrep(Brep=move.Geometry)  # -> Faces, Edges, Vertices
rulesrf = RuledSurface(CurveA=rectangle.Rectangle, CurveB=move.Geometry)
neg = Negative(Value=merge_2)
Z_2 = UnitZ(Factor=neg)
cap = CapHoles(Brep=rulesrf)
trim = TrimTree(Tree=debrep.Vertices, Depth=1)
move_2 = Move(Geometry=trim, Motion=Z_2)  # -> Geometry, Transform
item = ListItem(List=move_2.Geometry, Index=0, Wrap=True)  # -> Item, Item1, Item2, Item3
srf4pt = _4PointSurface(CornerA=item.Item, CornerB=item.Item1, CornerC=item.Item2, CornerD=item.Item3)

txt = Text("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")
txt_2 = EncodeText(Text=txt)
concat_7 = Concatenate(FragmentA="data:image/svg+xml;base64,", FragmentB=txt_2)
icon1 = Text(concat_7)

# ----
# Local ->
neg_2 = Negative(Value=expression_6)
offset = OffsetCurve(Curve=move.Geometry, Distance=neg_2, Corners=1)
trim_2 = TrimTree(Tree=offset, Depth=1)
Z_3 = UnitZ(Factor=expression_3)
rulesrf_2 = RuledSurface(CurveA=move.Geometry, CurveB=trim_2)
rev = Reverse(Vector=Z_3)
extr = Extrude(Base=rulesrf_2, Direction=rev)

merge_3 = Merge(Data1=rep.Representation, Data2=rep_2.Representation, Data3=rep_3.Representation)
panel_6 = Panel("🎓")
typ = ModelType(
    Name="Capital",
    Description="A roof that has the skin of a cut extruded cuboid.",
    Icon=icon1,
    Representations=merge_3,
    Ports=xy,
    Qualities=qlt.Quality)  # -> Type, Name, Description, Icon, Variant, Unit, Representations, Ports, Qualities
typ_2 = RemoveType(TypeName=typ.Name, TypeVariant=typ.Variant, Run=safe_2)
or = GateOr(A=safe_2, B=typ_2)
typ_3 = AddType(Type=typ.Type, Run=or)

split = SplitBrep(Brep=srf4pt, Cutter=extr)
split_2 = SplitBrep(Brep=extr, Cutter=srf4pt)
item_2 = ListItem(List=split, Index=0, Wrap=True)  # -> Item, Item1
item_3 = ListItem(List=split_2, Index=0, Wrap=True)  # -> Item, Item1
merge_4 = Merge(Data1=item_2.Item, Data2=item_3.Item1)
join = BrepJoin(Breps=merge_4)  # -> Breps, Closed
trim_3 = TrimTree(Tree=join.Breps, Depth=1)
panel_7 = Panel("""180
90
0
270""")
item_4 = ListItem(List=panel_7, Index=valueor0, Wrap=True)
rotate = Rotate(Geometry=trim_3, Angle=degrees(item_4), Plane=PlaneXY(0, 0, 0))  # -> Geometry, Transform
capital1to200 = Brep(rotate.Geometry)

split_3 = SplitBrep(Brep=cap, Cutter=srf4pt)
item_5 = ListItem(List=split_3, Index=0, Wrap=True)  # -> Item, Item1
capex = CapHolesEx(Brep=item_5.Item1)  # -> Brep, Caps, Solid
transform = Transform(Geometry=capex.Brep, Transform=rotate.Transform)
capital1to500 = Brep(transform)

expression_7 = Expression(x="volume", y=capital1to500, Expression="x")
ef_layer = EleFrontLayer(FullPath=expression_7)  # -> Layer, FullPath, Hidden, Locked, DisplayColour, MaterialName, Linetype, PrintColour, PrintWidth
concat_8 = Concatenate(FragmentA=curdir.D, FragmentB=curdir.S, FragmentC=rep_2.Url)
concat_9 = Concatenate(FragmentA=curdir.D, FragmentB=curdir.S, FragmentC=rep_3.Url)
ef_att = EleFrontAttributes(Layer=ef_layer.Layer)  # -> Attributes, Keys, Values, Name, Layer, ColourSource, DisplayColour, MaterialSource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
merge_5 = Merge(Data1=capital1to200)
merge_6 = Merge(Data1=ef_att.Attributes)
merge_7 = Merge(Data1=capital1to500)
merge_8 = Merge(Data1=ef_att.Attributes)
baketofile = BakeObjectsToFile(
    FilePath=concat_8,
    Geometry=merge_7,
    Attributes=merge_8,
    Bake=safe_2,
    networkMode=False,
    ValueTable_networkMode=True,
    overwriteMode="Overwrite",
    preset="Safest")
baketofile_2 = BakeObjectsToFile(
    FilePath=concat_9,
    Geometry=merge_5,
    Attributes=merge_6,
    Bake=safe_2,
    networkMode=False,
    ValueTable_networkMode=True,
    overwriteMode="Overwrite",
    preset="Safest")

typ_4 = SerializeType(Type=typ.Type)

rec = Rectangle({Plane=Plane(origin=(-1675.978212, -1680.385471, 1682.315001), x=(-0.7071067812, 0.7071067812, 0), y=(0.4082482905, 0.4082482905, 0.8164965809)), Size=Domain2(u=-22.8648997..22.8648997, v=-12.18498478..12.18498478)})
merge_9 = Merge()
m2d_parallel = Make2DParallelView(Projection=rec)
make2d = Make2D(Geometry=merge_5, View=m2d_parallel, TangentEdges="T", TangentSeams=False, AutoComputeMake2D=True)  # -> VisibleCurves, VisibleIndex, VisibleType, HiddenCurves, HiddenIndex, HiddenType
trim_4 = TrimTree(Tree=make2d.VisibleCurves, Depth=1)
shaft = Geometry(trim_4)

type = Text(typ_4)
context_bake = ContextBake(Geometry=type)

expression_8 = Expression(x="capital", y=shaft, Expression="x")
concat_10 = Concatenate(FragmentC="icons", FragmentD=curdir.S, FragmentA="capital")
merge_10 = Merge(Data1=expression_8)
merge_11 = Merge(Data1=shaft)
concat_11 = Concatenate(FragmentA=concat_10, FragmentB=".3dm")
ef_layer_2 = EleFrontLayer(FullPath=merge_10)  # -> Layer, FullPath, Hidden, Locked, DisplayColour, MaterialName, Linetype, PrintColour, PrintWidth
concat_12 = Concatenate(FragmentA=curdir.D, FragmentB=curdir.S, FragmentC=concat_11)
ef_att_2 = EleFrontAttributes(Layer=ef_layer_2.Layer)  # -> Attributes, Keys, Values, Name, Layer, ColourSource, DisplayColour, MaterialSource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
baketofile_3 = BakeObjectsToFile(
    FilePath=concat_12,
    Geometry=merge_11,
    Attributes=ef_att_2.Attributes,
    Bake=and,
    networkMode=False,
    ValueTable_networkMode=True,
    overwriteMode="Overwrite",
    preset="Safest")

panel_8 = Panel("Parallel")  # disabled
m2d_rhino = Make2DRhinoView(Name=panel_8, Clip=True)  # disabled
number_slider_2 = Slider(876, range=0..1000)  # disabled
view_rectangle = ViewRectangle(view=m2d_rhino)  # disabled
previewplane = PreviewPlane(plane=view_rectangle, axis_length=number_slider_2)  # disabled

# ==== cluster _2D
x = ClusterInput()
expression = Expression(x=x, Expression="x/2")
neg = Negative(Value=expression)
dom = ConstructDomain(DomainStart=neg, DomainEnd=expression)
I = ClusterOutput(dom)

# ==== cluster ValueOr0
value = ClusterInput()
value_2 = Number(value)
null = NullItem(Item=value_2)  # -> NullFlags, InvalidFlags, Description
filter = StreamFilter(Gate=null.NullFlags, Stream0=value_2, Stream1="0")
valueor0 = Number(filter)
valueor0_2 = ClusterOutput(valueor0)

# ==== cluster PreviewPlane: Preview a plane with axis colors and naming.
axis_length = ClusterInput()
plane = ClusterInput()
axis_length_2 = Number(axis_length)
plane_2 = Plane(plane)
deplane = DeconstructPlane(Plane=plane_2)  # -> Origin, XAxis, YAxis, ZAxis
line = LineSDL(Start=deplane.Origin, Direction=deplane.YAxis, Length=axis_length_2)
line_2 = LineSDL(Start=deplane.Origin, Direction=deplane.XAxis, Length=axis_length_2)
line_3 = LineSDL(Start=deplane.Origin, Direction=deplane.ZAxis, Length=axis_length_2)
swatch = ColourSwatch(SwatchColor=RGB(235, 52, 79))
swatch_2 = ColourSwatch(SwatchColor=RGB(0, 166, 157))
swatch_3 = ColourSwatch(SwatchColor=RGB(240, 117, 24))
end = EndPoints(Curve=line_2)  # -> Start, End
end_2 = EndPoints(Curve=line)  # -> Start, End
end_3 = EndPoints(Curve=line_3)  # -> Start, End
tag = TextTag(Location=end.End, Text="X", Colour=swatch)
tag_2 = TextTag(Location=end_2.End, Text="Y", Colour=swatch_2)
tag_3 = TextTag(Location=end_3.End, Text="Z", Colour=swatch_3)
preview = CustomPreview(Geometry=line_2, Material=swatch)
preview_2 = CustomPreview(Geometry=line, Material=swatch_2)
preview_3 = CustomPreview(Geometry=line_3, Material=swatch_3)

# ==== cluster ViewRectangle
view = ClusterInput()
view_2 = Data(view)
nickname = NAME(view=view_2)  # -> c, x, y, z, h, w
# ---------- nickname: Python ----------
uselss, c, x, y, z = view.GetCameraFrame()
h = view.FrustumHeight
w = view.FrustumWidth
# ---------- end nickname ----------
rev = Reverse(Vector=nickname.x)
rev_2 = Reverse(Vector=nickname.y)
pl = ConstructPlane(Origin=nickname.c, XAxis=rev, YAxis=nickname.y)
_2d = _2D(x=nickname.w)
_2d_2 = _2D(x=nickname.h)
rectangle = Rectangle(Plane=pl, XSize=_2d, YSize=_2d_2, Radius=0)  # -> Rectangle, Length
rec = Rectangle(rectangle.Rectangle)
rec_2 = ClusterOutput(rec)
