# Grasshopper definition capsule.gh (Grasshopper 1.0.7)
# plug-ins: semio, eleFront

merge = Merge(Data1="back", Data2="back", Data3="back", Data4="back", Data5="side", Data6="side", Data7="side", Data8="side")
variant = Slider(0, range=0..7)
series = Series(Start=0, Step=1, Count="8")
safe = BooleanToggle(False)
safe_2 = Button()
trim = TrimTree(Tree=series, Depth=1)
merge_2 = Merge(Data1="front", Data2="front", Data3="side", Data4="side", Data5="front", Data6="front", Data7="side", Data8="side")
icon_export = BooleanToggle(False)
filter = StreamFilter(Gate="0", Stream0=variant, Stream1=trim)
item = ListItem(List=merge, Index=filter, Wrap=True)
item_2 = ListItem(List=merge_2, Index=filter, Wrap=True)
merge_3 = Merge(Data1="F", Data2="T", Data3="F", Data4="T", Data5="F", Data6="T", Data7="F", Data8="T")
loop_slider = PythonScript(SliderToModify=variant, Min="0", Max="7", stepSize="1", Delay=Slider(0, range=0..1), Run=Toggle(False), Reset=Button())  # inputs Run: Boolean, Reset: Boolean
# ---------- loop_slider: Python ----------
import time

def updateSliderInput(inputName,min,max,value,decimalPlace=2):
    for input in ghenv.Component.Params.Input:
        for source in input.Sources:
            if input.Name == str(inputName):
                source.Slider.DecimalPlaces = decimalPlace
                source.Slider.Minimum = min
                source.Slider.Maximum = max
                source.Slider.Value = value
                source.ExpireSolution(True)

def countDecimal(number):
    string= str(number)
    return string[::-1].find('.')

if Run == True:
    if SliderToModify < Max:
        time.sleep(Delay)
        updateSliderInput("SliderToModify",Min,Max,SliderToModify+stepSize,countDecimal(stepSize))
if Reset == True:
    updateSliderInput("SliderToModify",Min,Max,Min)
# ---------- end loop_slider ----------
# ^
#                  |
# Preview    ->
and = GateAnd(A=safe, B=icon_export)
# Parameters:
item_3 = ListItem(List=merge_3, Index=filter, Wrap=True)
toggle = BooleanToggle(False)
list = ValueList({"Front", "Side"}, selected="Front")
list_2 = ValueList({"Back": "back", "Side": "side"}, selected="Back")
# External
#      |
#      v
entrance = GetString(item, AtLeast=0, AtMost=1, TreeAccess=False)
view = GetString(item_2, AtLeast=0, AtMost=1, TreeAccess=False)
mirror = GetBoolean(item_3, AtLeast=0, AtMost=1, FalseValue="False", TreeAccess=False, TrueValue="True")
panel = Panel("""round
rectangular""")
panel_2 = Panel("""front
side""")
panel_3 = Panel("""back
side""")
mirrored = Boolean(mirror)
filter_2 = StreamFilter(Gate=0)
itemindex = ItemIndex(L=panel_3, I=entrance)  # -> i; inputs L: list
# ---------- itemindex: Python ----------
#Component Information
#--------------------------------------------------------------------------------------------
if ghenv.Component.RunCount<2:
    #General
    #--------------------------------------------------------------------------------------------
    __author__ = "Ueli Saluz"
    __version__ = "2022.11.18"
    
    ghenv.Component.Name = "ItemIndex"
    ghenv.Component.NickName = "ItemIndex"
    ghenv.Component.Description = "A better IdemIndex"
    ghenv.Component.Message = "VER 1.0"
    ghenv.Component.Category = "Set"
    ghenv.Component.SubCategory = "List"
    
     #Inputs
    #--------------------------------------------------------------------------------------------
    inputIndex=0
    
    ghenv.Component.Params.Input[inputIndex].Name = "List"
    ghenv.Component.Params.Input[inputIndex].NickName = "L"
    ghenv.Component.Params.Input[inputIndex].Description = "Input1 is..."
    ghenv.Component.Params.Input[inputIndex].Optional = False
    inputIndex+=1
    
    ghenv.Component.Params.Input[inputIndex].Name = "Item"
    ghenv.Component.Params.Input[inputIndex].NickName = "I"
    ghenv.Component.Params.Input[inputIndex].Description = "Input2 is..."
    ghenv.Component.Params.Input[inputIndex].Optional = False
    inputIndex+=1
    
    #Outputs
    #--------------------------------------------------------------------------------------------
    outputIndex=0
    
    ghenv.Component.Params.Output[outputIndex].Name = "Index"
    ghenv.Component.Params.Output[outputIndex].NickName = "i"
    ghenv.Component.Params.Output[outputIndex].Description = "Output1 is..."
    outputIndex+=1

i = L.index(I)
# ---------- end itemindex ----------
itemindex_2 = ItemIndex(L=panel_2, I=view)  # -> i; inputs L: list; same code as itemindex
valueor0 = ValueOr0(value=itemindex)
valueor0_2 = ValueOr0(value=itemindex_2)
entrance_2 = Integer(valueor0)
entrance_3 = Integer(entrance_2)
multiplication = Multiplication(A=entrance_3, B="4")
view_2 = Integer(valueor0_2)
view_3 = Integer(view_2)
multiplication_2 = Multiplication(A=view_3, B="2")
addition = Addition(A=multiplication, B=multiplication_2, C=mirrored)
variant_2 = Integer(addition)

variant_3 = Integer(variant_2)
curdir = CurrentDirectory()  # -> D, P, S
# ---------- curdir: Python ----------
#Component Information
#--------------------------------------------------------------------------------------------
if ghenv.Component.RunCount<2:
    #General
    #--------------------------------------------------------------------------------------------
    __author__ = "Ueli Saluz"
    __version__ = "2023.09.29"
    
    ghenv.Component.Name = "CurrentDirectory"
    ghenv.Component.NickName = "CurDir"
    ghenv.Component.Description = "Current directory of the current grasshopper file."
    ghenv.Component.Message = "VER 1.0"
    ghenv.Component.Category = "Params"
    ghenv.Component.SubCategory = "Util"
    
    #Outputs
    #--------------------------------------------------------------------------------------------
    outputIndex=0
    
    ghenv.Component.Params.Output[outputIndex].Name = "Directory"
    ghenv.Component.Params.Output[outputIndex].NickName = "D"
    ghenv.Component.Params.Output[outputIndex].Description = "Directory of the current grasshopper file."
    outputIndex+=1
    
    ghenv.Component.Params.Output[outputIndex].Name = "Path"
    ghenv.Component.Params.Output[outputIndex].NickName = "P"
    ghenv.Component.Params.Output[outputIndex].Description = "Path of the current grasshopper file."
    outputIndex+=1
    
    ghenv.Component.Params.Output[outputIndex].Name = "Separator"
    ghenv.Component.Params.Output[outputIndex].NickName = "S"
    ghenv.Component.Params.Output[outputIndex].Description = "Separator of the current system."
    outputIndex+=1

#Imports
#--------------------------------------------------------------------------------------------
from os.path import dirname
from os import sep

#Solver - Run with trees to enhance performance drastically
#--------------------------------------------------------------------------------------------
if __name__ == "__main__":
    P = ghenv.Component.OnPingDocument().FilePath
    D = dirname(P)
    S = sep
# ---------- end curdir ----------
expression = Expression(x=variant_3, Expression="x+1")
concat = Concatenate(FragmentC="representations", FragmentD=curdir.S, FragmentA="capsule", FragmentB="_", FragmentE=expression)
concat_2 = Concatenate(FragmentA=concat, FragmentB="_", FragmentE="1to500", FragmentG="_", FragmentF="volume")
concat_3 = Concatenate(FragmentA=concat, FragmentB="_", FragmentE="1to200", FragmentG="_", FragmentF="volume")
concat_4 = Concatenate(FragmentA=concat_2, FragmentB=".3dm")
concat_5 = Concatenate(FragmentA=concat, FragmentB=".glb")
concat_6 = Concatenate(FragmentA=concat_3, FragmentB=".3dm")
rep = ModelRepresentation(Url=concat_4, LevelOfDetail="1to500", Tags="volume")  # -> Representation, Url, LevelOfDetail, Tags
rep_2 = ModelRepresentation(Url=concat_6, LevelOfDetail="1to200", Tags="volume")  # -> Representation, Url, LevelOfDetail, Tags
rep_3 = ModelRepresentation(Url=concat_5)  # -> Representation, Url, LevelOfDetail, Tags

panel_4 = Panel("data:image/svg+xml;base64,")
txt = Text("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")
txt_2 = Text("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")
txt_3 = Text("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")
txt_4 = Text("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")
txt_5 = Text("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")
txt_6 = Text("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")
txt_7 = Text("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")
# Outputs   ->
#                 |
#                 v
txt_8 = Text("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")
txt_9 = EncodeText(Text=txt_4)
txt_10 = EncodeText(Text=txt_5)
txt_11 = EncodeText(Text=txt_6)
txt_12 = EncodeText(Text=txt)
txt_13 = EncodeText(Text=txt_2)
txt_14 = EncodeText(Text=txt_3)
txt_15 = EncodeText(Text=txt_7)
txt_16 = EncodeText(Text=txt_8)
concat_7 = Concatenate(FragmentA=panel_4, FragmentB=txt_9)
concat_8 = Concatenate(FragmentA=panel_4, FragmentB=txt_10)
concat_9 = Concatenate(FragmentA=panel_4, FragmentB=txt_11)
concat_10 = Concatenate(FragmentA=panel_4, FragmentB=txt_12)
concat_11 = Concatenate(FragmentA=panel_4, FragmentB=txt_13)
concat_12 = Concatenate(FragmentA=panel_4, FragmentB=txt_14)
concat_13 = Concatenate(FragmentA=panel_4, FragmentB=txt_15)
concat_14 = Concatenate(FragmentA=panel_4, FragmentB=txt_16)
icon8 = Text(concat_14)
icon2 = Text(concat_8)
icon4 = Text(concat_10)
icon6 = Text(concat_12)
icon1 = Text(concat_7)
icon3 = Text(concat_9)
icon5 = Text(concat_11)
icon7 = Text(concat_13)
filter_3 = StreamFilter(
    Gate=variant_3,
    Stream0=icon1,
    Stream1=icon2,
    Stream2=icon3,
    Stream3=icon4,
    Stream4=icon5,
    Stream5=icon6,
    Stream6=icon7,
    Stream7=icon8)

expression_2 = Expression(x=Slider(420, range=0..1000), Expression="x/100")
expression_3 = Expression(x=Slider(260, range=0..1000), Expression="x/100")
expression_4 = Expression(x=Slider(250, range=0..1000), Expression="x/100")
bool = Boolean(invert(mirror))
length = Number(expression_2)
# Local ->
_2d = _2D(x=length)
width = Number(expression_3)
_2d_2 = _2D(x=width)
height = Number(expression_4)
filter_4 = StreamFilter(Gate=entrance_2, Stream0=mirror, Stream1=bool)
mirror_2 = Boolean(filter_4)
mirrored_2 = Boolean(mirror_2)
addition_2 = Addition(A=multiplication, B=multiplication_2, C=mirrored_2)
oldvariant = Integer(addition_2)
concat_15 = Concatenate(FragmentC="icons", FragmentD=curdir.S, FragmentA="capsule", FragmentB="_", FragmentE=expression)
expression_5 = Expression(x=Slider(20, range=0..100), Expression="x/100")
expression_6 = Expression(x=Slider(25, range=0..100), Expression="x/100")
concat_16 = Concatenate(FragmentA=concat_15, FragmentB=".3dm")
shellthickness = Number(expression_5)
subtraction = Subtraction(A=height, B=shellthickness)
neg = Negative(Value=shellthickness)
dom = ConstructDomain(DomainStart=neg, DomainEnd=subtraction)
box = DomainBox(Base=PlaneXY(0, 0, 0), X=_2d_2, Y=_2d, Z=dom)
volume1to500 = Box(box)
debrep = DeconstructBrep(Brep=volume1to500)  # -> Faces, Edges, Vertices
trim_2 = TrimTree(Tree=debrep.Edges, Depth=1)
trim_3 = TrimTree(Tree=debrep.Faces, Depth=1)
item_4 = ListItem(List=trim_3, Index=0, Wrap=True)  # -> Item, Item1, Item2, Item3, Item4, Item5
filletradius = Number(expression_6)

lng = ListLength(List=debrep.Edges)
series_2 = Series(Start=0, Step=1, Count=lng)
trim_4 = TrimTree(Tree=series_2, Depth=1)
filedge = FilletEdge(Shape=volume1to500, Blend=0, Metric=0, Edges=trim_4, Radii=filletradius)
trim_5 = TrimTree(Tree=filedge, Depth=1)

list_3 = ValueList({"Round": "round", "Rectangular": "rectangular"}, selected="Round")
expression_7 = Expression(x=Slider(30, range=0..100), Expression="x/100")
expression_8 = Expression(x=Slider(65, range=0..100), Expression="x/100")
windowcircleradius = Number(expression_8)
window_offset_wall = Number(expression_7)
windowshape = Text(list_3)
itemindex_3 = ItemIndex(L=panel, I=windowshape)  # -> i; inputs L: list; same code as itemindex
valueor0_3 = ValueOr0(value=itemindex_3)

merge_4 = Merge(Data1=entrance, Data2=view, Data3=length, Data4=width, Data5=height, Data6=windowshape)
panel_5 = Panel("""entrance
view
length
width
heigth
window shape""")
panel_6 = Panel(merge_4)
panel_7 = Panel("""m
m
m""")
ql = Quality("mirrored")
qlt = ModelQuality(Name=panel_5, Value=panel_6, Unit=panel_7)  # -> Quality, Name, Value, Unit
filter_5 = StreamFilter(Gate=mirror, Stream1=ql)
merge_5 = Merge(Data1=qlt.Quality, Data2=filter_5)

windowshape_2 = Integer(valueor0_3)

srf = Surface(item_4.Item)
srf_2 = Surface(item_4.Item3)
srf_3 = Surface(item_4.Item2)
srf_4 = Surface(item_4.Item4)
srf_5 = Surface(item_4.Item1)
srf_6 = Surface(item_4.Item5)
mirrored_3 = Boolean(mirror_2)
mirrored_4 = Boolean(mirror_2)
filter_6 = StreamFilter(Gate=mirrored_3, Stream0=srf_5, Stream1=srf_2)
filter_7 = StreamFilter(Gate=mirrored_4, Stream0=srf_2, Stream1=srf_5)
merge_6 = Merge(Data1=srf_5, Data2=srf_2)
merge_7 = Merge(Data1=srf_5, Data2=srf)
merge_8 = Merge(Data1=srf, Data2=srf_3)
merge_9 = Merge(Data1=srf_5, Data2=srf_3)
merge_10 = Merge(Data1=srf_2, Data2=srf_3)
merge_11 = Merge(Data1=srf, Data2=srf_2)
entrance_4 = Integer(entrance_2)
window = Integer(view_2)
filter_8 = StreamFilter(Gate=entrance_4, Stream0=srf, Stream1=filter_6)
filter_9 = StreamFilter(Gate=window, Stream0=srf_3, Stream1=filter_7)
filter_10 = StreamFilter(
    Gate=oldvariant,
    Stream0=merge_6,
    Stream1=merge_6,
    Stream2=merge_9,
    Stream3=merge_10,
    Stream4=merge_11,
    Stream5=merge_7,
    Stream6=merge_8,
    Stream7=merge_8)

expression_9 = Expression(x=Slider(80, range=0..100), Expression="x/100")
expression_10 = Expression(x=Slider(200, range=0..1000), Expression="x/100")
expression_11 = Expression(x=Slider(25, range=0..100), Expression="x/100")
merge_12 = Merge(Data1=filter_8, Data2=filter_9)
door_width = Number(expression_9)
door_offset_wall = Number(expression_11)
door_height = Number(expression_10)

item_5 = ListItem(List=trim_2, Index=0, Wrap=True)  # -> Item, Item1, Item2, Item3
flip = FlipCurve(Curve=item_5.Item)  # -> Curve, Flag
filter_11 = StreamFilter(Gate=mirror_2, Stream0=flip.Curve, Stream1=item_5.Item)
filter_12 = StreamFilter(Gate=mirror_2, Stream0=item_4.Item1, Stream1=item_4.Item3)
filter_13 = StreamFilter(Gate=entrance_2, Stream0=filter_11, Stream1=item_5.Item1)
filter_14 = StreamFilter(Gate=entrance_2, Stream0=item_4.Item, Stream1=filter_12)
addition_3 = Addition(A=door_offset_wall, B=shellthickness)
eval = EvaluateLength(Curve=filter_13, Length=addition_3, Normalized=False)  # -> Point, Tangent, Parameter
srf_cp = SurfaceClosestPoint(Point=eval.Point, Surface=filter_14)  # -> Point, UVPoint, Distance
evalsrf = EvaluateSurface(Surface=filter_14, Point=srf_cp.UVPoint)  # -> Point, Normal, UDirection, VDirection, Frame
neg_2 = Negative(Value=door_width)
filter_15 = StreamFilter(Gate=entrance_2, Stream0=neg_2, Stream1=door_width)
filter_16 = StreamFilter(Gate=mirror_2, Stream0=filter_15, Stream1=door_width)
and_2 = GateAnd(A=entrance_2, B=mirror_2)
filter_17 = StreamFilter(Gate=and_2, Stream0=filter_16, Stream1=neg_2)
rectangle = Rectangle(Plane=evalsrf.Frame, XSize=filter_17, YSize=door_height, Radius=0)  # -> Rectangle, Length
Z = UnitZ(Factor=shellthickness)
move = Move(Geometry=rectangle.Rectangle, Motion=Z)  # -> Geometry, Transform
door = Rectangle(move.Geometry)

flip_2 = FlipCurve(Curve=item_5.Item1)  # -> Curve, Flag
expression_12 = Expression(x=height, Expression="x/2")
filter_18 = StreamFilter(Gate=mirror_2, Stream0=item_5.Item3, Stream1=flip_2.Curve)
addition_4 = Addition(A=windowcircleradius, B=window_offset_wall, C=shellthickness)
Z_2 = UnitZ(Factor=expression_12)
filter_19 = StreamFilter(Gate=mirror_2, Stream0=item_4.Item3, Stream1=item_4.Item1)
eval_2 = EvaluateLength(Curve=filter_18, Length=addition_4, Normalized=False)  # -> Point, Tangent, Parameter
evalsrf_2 = EvaluateSurface(Surface=reparameterize(filter_19), Point="0.5,0.5")  # -> Point, Normal, UDirection, VDirection, Frame
move_2 = Move(Geometry=eval_2.Point, Motion=Z_2)  # -> Geometry, Transform
evalsrf_3 = EvaluateSurface(Surface=reparameterize(item_4.Item2), Point="0.5,0.5")  # -> Point, Normal, UDirection, VDirection, Frame
pl_origin = PlaneOrigin(Base=evalsrf_2.Frame, Origin=move_2.Geometry)
expression_13 = Expression(x=windowcircleradius, Expression="x*2")
filter_20 = StreamFilter(Gate=view_2, Stream0=evalsrf_3.Frame, Stream1=pl_origin)
_2d_3 = _2D(x=expression_13)
rectangle_2 = Rectangle(Plane=filter_20, XSize=_2d_3, YSize=_2d_3, Radius=0)  # -> Rectangle, Length
cir = Circle(Plane=filter_20, Radius=windowcircleradius)
filter_21 = StreamFilter(Gate=windowshape_2, Stream0=cir, Stream1=rectangle_2.Rectangle)
windowplane = Plane(filter_20)
window_2 = Geometry(filter_21)

windowplane_2 = Plane(windowplane)
deplane = DeconstructPlane(Plane=windowplane_2)  # -> Origin, XAxis, YAxis, ZAxis
expression_14 = Expression(x=shellthickness, Expression="x/3")
neg_3 = Negative(Value=deplane.ZAxis)
amp = Amplitude(Vector=neg_3, Amplitude=expression_14)
extr = Extrude(Base=window_2, Direction=amp)
cap = CapHoles(Brep=extr)

door_2 = Rectangle(door)
explode = Explode(Curve=door, Recursive=True)  # -> Segments, Vertices
trim_6 = TrimTree(Tree=explode.Segments, Depth=1)
item_6 = ListItem(List=trim_6, Index=0, Wrap=True)  # -> Item, Item1, Item2, Item3
eval_3 = EvaluateCurve(Curve=reparameterize(item_6.Item), Parameter="0.5")  # -> Point, Tangent, Angle
rev = Reverse(Vector=eval_3.Tangent)
Z_3 = UnitZ(Factor=1)
xprod = CrossProduct(VectorA=rev, VectorB=Z_3, Unitize=False)  # -> Vector, Length
pl = ConstructPlane(Origin=eval_3.Point, XAxis=eval_3.Tangent, YAxis=xprod.Vector)
doorentranceplane = Plane(pl)

loc = ModelLocator(Group="door", Subgroup="entrance")  # -> Locator, Group, Subgroup
por = ModelPort(Plane=doorentranceplane, Locators=loc.Locator)  # -> Port, Id, Plane, Locators

panel_8 = Panel("An apartment capsule for one person. It has the entrance on the ")
merge_13 = Merge(Data1=rep_3.Representation, Data2=rep.Representation, Data3=rep_2.Representation)
filter_22 = StreamFilter(Gate=mirror, Stream1=" It is mirrored compared to the normal one.")
concat_17 = Concatenate(
    FragmentA=panel_8,
    FragmentB=entrance,
    FragmentC=" and has the view to the ",
    FragmentD=view,
    FragmentF=".",
    FragmentE=filter_22)
typ = ModelType(
    Name="Capsule",
    Description=concat_17,
    Icon=filter_3,
    Variant=expression,
    Representations=merge_13,
    Ports=por.Port,
    Qualities=merge_5)  # -> Type, Name, Description, Icon, Variant, Unit, Representations, Ports, Qualities
typ_2 = RemoveType(TypeName=typ.Name, TypeVariant=typ.Variant, Run=safe)
or = GateOr(A=safe, B=typ_2)
typ_3 = AddType(Type=typ.Type, Run=or)

doorentranceplane_2 = Plane(doorentranceplane)
deplane_2 = DeconstructPlane(Plane=doorentranceplane_2)  # -> Origin, XAxis, YAxis, ZAxis
amp_2 = Amplitude(Vector=deplane_2.YAxis, Amplitude=shellthickness)
extr_2 = Extrude(Base=door, Direction=amp_2)
cap_2 = CapHoles(Brep=extr_2)

concat_18 = Concatenate(FragmentA="📦", FragmentB=expression)
merge_14 = Merge(Data1=cap_2, Data2=cap)
sdiff = SolidDifference(BrepsA=trim_5, BrepsB=merge_14)
typ_4 = SerializeType(Type=typ.Type)

rec = Rectangle({Plane=Plane(origin=(15.60693884, 14.69292436, 15.6245417), x=(0.7071067812, -0.7071067812, 0), y=(-0.4082482905, -0.4082482905, 0.8164965809)), Size=Domain2(u=-24.40970167..24.40970167, v=-18.06498235..18.06498235)})
m2d_parallel = Make2DParallelView(Projection=rec)
make2d = Make2D(Geometry=cap_2, View=m2d_parallel, TangentEdges=False, TangentSeams=False, AutoComputeMake2D=True)  # -> VisibleCurves, VisibleIndex, VisibleType, HiddenCurves, HiddenIndex, HiddenType
make2d_2 = Make2D(Geometry=cap, View=m2d_parallel, TangentEdges=False, TangentSeams=False, AutoComputeMake2D=True)  # -> VisibleCurves, VisibleIndex, VisibleType, HiddenCurves, HiddenIndex, HiddenType
make2d_3 = Make2D(Geometry=trim_5, View=m2d_parallel, TangentEdges="T", TangentSeams=False, AutoComputeMake2D=True)  # -> VisibleCurves, VisibleIndex, VisibleType, HiddenCurves, HiddenIndex, HiddenType
trim_7 = TrimTree(Tree=make2d_3.VisibleCurves, Depth=1)
trim_8 = TrimTree(Tree=make2d.VisibleCurves, Depth=1)
merge_15 = Merge(Data1=make2d_2.VisibleCurves, Data2=make2d_2.HiddenCurves)
trim_9 = TrimTree(Tree=merge_15, Depth=1)
shell = Geometry(trim_7)
door_3 = Geometry(trim_8)
window_3 = Geometry(trim_9)

volume1to200 = Brep(sdiff)

volume1to200_2 = Brep(volume1to200)
expression_15 = Expression(x="volume", y=volume1to200_2, Expression="x")
ef_layer = EleFrontLayer(FullPath=expression_15)  # -> Layer, FullPath, Hidden, Locked, DisplayColour, MaterialName, Linetype, PrintColour, PrintWidth
concat_19 = Concatenate(FragmentA=curdir.D, FragmentB=curdir.S, FragmentC=concat_6)
ef_att = EleFrontAttributes(Layer=ef_layer.Layer)  # -> Attributes, Keys, Values, Name, Layer, ColourSource, DisplayColour, MaterialSource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
baketofile = BakeObjectsToFile(
    FilePath=concat_19,
    Geometry=volume1to200_2,
    Attributes=ef_att.Attributes,
    Bake=safe,
    networkMode=False,
    ValueTable_networkMode=True,
    overwriteMode="Overwrite",
    preset="Safest")

type = Text(typ_4)
context_bake = ContextBake(Geometry=type)
merge_16 = Merge(Data1=door, Data2=window_2)
sdiff_2 = SolidDifference(BrepsA=merge_12, BrepsB=merge_16)
merge_17 = Merge(Data1=srf_4, Data2=filter_10, Data3=sdiff_2, Data4=srf_6)
shell_2 = Surface(merge_17)
panel_9 = Panel("Parallel")  # disabled
m2d_rhino = Make2DRhinoView(Name=panel_9, Clip=True)  # disabled
number_slider = Slider(876, range=0..1000)  # disabled
view_rectangle = ViewRectangle(view=m2d_rhino)  # disabled
previewplane = PreviewPlane(plane=view_rectangle, axis_length=number_slider)  # disabled
previewplane_2 = PreviewPlane(plane=doorentranceplane, axis_length=Slider(1, range=0..10))

door_4 = Surface(door)
shell_3 = Surface(shell_2)
window_4 = Surface(window_2)
expression_16 = Expression(x="shell", y=shell_3, Expression="x")
concat_20 = Concatenate(FragmentA=curdir.D, FragmentB=curdir.S, FragmentC=concat_4)

expression_17 = Expression(x="shell", y=shell, Expression="x")
expression_18 = Expression(x="window", y=window_3, Expression="x")
expression_19 = Expression(x="door", y=door_3, Expression="x")
merge_18 = Merge(Data1=expression_17, Data2=expression_19, Data3=expression_18)
merge_19 = Merge(Data1=shell, Data2=door_3, Data3=window_3)
ef_layer_2 = EleFrontLayer(FullPath=merge_18)  # -> Layer, FullPath, Hidden, Locked, DisplayColour, MaterialName, Linetype, PrintColour, PrintWidth
concat_21 = Concatenate(FragmentA=curdir.D, FragmentB=curdir.S, FragmentC=concat_16)
ef_att_2 = EleFrontAttributes(Layer=ef_layer_2.Layer)  # -> Attributes, Keys, Values, Name, Layer, ColourSource, DisplayColour, MaterialSource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
baketofile_2 = BakeObjectsToFile(
    FilePath=concat_21,
    Geometry=merge_19,
    Attributes=ef_att_2.Attributes,
    Bake=and,
    networkMode=False,
    ValueTable_networkMode=True,
    overwriteMode="Overwrite",
    preset="Safest")

merge_20 = Merge(Data1=shell_3, Data2=window_4, Data3=door_4)
merge_21 = Merge(Data1=expression_16, Data2="window", Data3="door")

ef_layer_3 = EleFrontLayer(FullPath=merge_21)  # -> Layer, FullPath, Hidden, Locked, DisplayColour, MaterialName, Linetype, PrintColour, PrintWidth
ef_att_3 = EleFrontAttributes(Layer=ef_layer_3.Layer)  # -> Attributes, Keys, Values, Name, Layer, ColourSource, DisplayColour, MaterialSource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
baketofile_3 = BakeObjectsToFile(
    FilePath=concat_20,
    Geometry=merge_20,
    Attributes=ef_att_3.Attributes,
    Bake=safe,
    networkMode=False,
    ValueTable_networkMode=True,
    overwriteMode="Overwrite",
    preset="Safest")

# ==== cluster _2D
x = ClusterInput()
expression = Expression(x=x, Expression="x/2")
neg = Negative(Value=expression)
dom = ConstructDomain(DomainStart=neg, DomainEnd=expression)
I = ClusterOutput(dom)

# ==== cluster ValueOr0
value = ClusterInput()
value_2 = Number(value)
null = NullItem(Item=value_2)  # -> NullFlags, InvalidFlags, Description
filter = StreamFilter(Gate=null.NullFlags, Stream0=value_2, Stream1="0")
valueor0 = Number(filter)
valueor0_2 = ClusterOutput(valueor0)

# ==== cluster PreviewPlane: Preview a plane with axis colors and naming.
axis_length = ClusterInput()
plane = ClusterInput()
axis_length_2 = Number(axis_length)
plane_2 = Plane(plane)
deplane = DeconstructPlane(Plane=plane_2)  # -> Origin, XAxis, YAxis, ZAxis
line = LineSDL(Start=deplane.Origin, Direction=deplane.YAxis, Length=axis_length_2)
line_2 = LineSDL(Start=deplane.Origin, Direction=deplane.XAxis, Length=axis_length_2)
line_3 = LineSDL(Start=deplane.Origin, Direction=deplane.ZAxis, Length=axis_length_2)
swatch = ColourSwatch(SwatchColor=RGB(235, 52, 79))
swatch_2 = ColourSwatch(SwatchColor=RGB(0, 166, 157))
swatch_3 = ColourSwatch(SwatchColor=RGB(240, 117, 24))
end = EndPoints(Curve=line_2)  # -> Start, End
end_2 = EndPoints(Curve=line)  # -> Start, End
end_3 = EndPoints(Curve=line_3)  # -> Start, End
tag = TextTag(Location=end.End, Text="X", Colour=swatch)
tag_2 = TextTag(Location=end_2.End, Text="Y", Colour=swatch_2)
tag_3 = TextTag(Location=end_3.End, Text="Z", Colour=swatch_3)
preview = CustomPreview(Geometry=line_2, Material=swatch)
preview_2 = CustomPreview(Geometry=line, Material=swatch_2)
preview_3 = CustomPreview(Geometry=line_3, Material=swatch_3)

# ==== cluster ViewRectangle
view = ClusterInput()
view_2 = Data(view)
nickname = NAME(view=view_2)  # -> c, x, y, z, h, w
# ---------- nickname: Python ----------
uselss, c, x, y, z = view.GetCameraFrame()
h = view.FrustumHeight
w = view.FrustumWidth
# ---------- end nickname ----------
rev = Reverse(Vector=nickname.x)
rev_2 = Reverse(Vector=nickname.y)
pl = ConstructPlane(Origin=nickname.c, XAxis=rev, YAxis=nickname.y)
_2d = _2D(x=nickname.w)
_2d_2 = _2D(x=nickname.h)
rectangle = Rectangle(Plane=pl, XSize=_2d, YSize=_2d_2, Radius=0)  # -> Rectangle, Length
rec = Rectangle(rectangle.Rectangle)
rec_2 = ClusterOutput(rec)
