# Grasshopper definition cylindricshaft.gh (Grasshopper 1.0.7)
# plug-ins: semio, eleFront

number_slider = Slider(0, range=0..10)
safe = Button()
filter = StreamFilter(Gate=number_slider, Stream0="9", Stream1="11")
filter_2 = StreamFilter(Gate=number_slider, Stream0="left", Stream1="right")
number_slider_2 = Slider(9, range=0..20)
# ^
#                  |
# Preview    ->
number_slider_3 = Slider(175, range=0..1000)
# Parameters:
number_slider_4 = Slider(650, range=0..1000)
list = ValueList({"Front": "front", "Right": "right", "Bottom": "bottom", "Left": "left"}, selected="Right")
# External
#       |
#       v
width = GetNumber(number_slider_4, AtLeast=1, AtMost=1, Maximum=1.797693135e+308, Minimum=-1.797693135e+308, TreeAccess=False)
floorheight = GetNumber(Slider(275, range=0..1000), AtLeast=1, AtMost=1, Maximum=1.797693135e+308, Minimum=-1.797693135e+308, TreeAccess=False)
platform = GetString(filter_2, AtLeast=1, AtMost=1, TreeAccess=False)
wallthickness = GetNumber(Slider(30, range=0..100), AtLeast=1, AtMost=1, Maximum=1.797693135e+308, Minimum=-1.797693135e+308, TreeAccess=False)
doorwidth = GetNumber(Slider(80, range=0..200), AtLeast=1, AtMost=1, Maximum=1.797693135e+308, Minimum=-1.797693135e+308, TreeAccess=False)
dooroffset = GetNumber(number_slider_3, AtLeast=1, AtMost=1, Maximum=1.797693135e+308, Minimum=-1.797693135e+308, TreeAccess=False)
doorheight = GetNumber(Slider(200, range=0..1000), AtLeast=1, AtMost=1, Maximum=1.797693135e+308, Minimum=-1.797693135e+308, TreeAccess=False)
floors = GetNumber(filter, AtLeast=1, AtMost=1, Maximum=1.797693135e+308, Minimum=-1.797693135e+308, TreeAccess=False)

series = Series(Start="1", Step=1, Count="2")
dup = DuplicateData(Data="0", Number="4", Order=True)
trim = TrimTree(Tree=series, Depth=1)  # -> graft(Tree)
trim_2 = TrimTree(Tree=dup, Depth=1)
dup_2 = DuplicateData(Data=trim, Number="2", Order=True)  # -> flatten(Data)
merge = Merge(Data1=trim_2, Data2=dup_2)
dup_3 = DuplicateData(Data=merge, Number=floors, Order=True)
trim_3 = TrimTree(Tree=dup_3, Depth=1)
spc = ModelSpecifier(Context="split level", Group=trim_3)  # -> Specifier, Context, Group

# ----
# Local ->
expression = Expression(x=width, Expression="x/2")

expression_2 = Expression(x=floors, Expression="x+1")
panel = Panel("""front
right
bottom
left""")
itemindex = ItemIndex(L=panel, I=platform)  # -> i; inputs L: list
# ---------- itemindex: Python ----------
#Component Information
#--------------------------------------------------------------------------------------------
if ghenv.Component.RunCount<2:
    #General
    #--------------------------------------------------------------------------------------------
    __author__ = "Ueli Saluz"
    __version__ = "2022.11.18"
    
    ghenv.Component.Name = "ItemIndex"
    ghenv.Component.NickName = "ItemIndex"
    ghenv.Component.Description = "A better IdemIndex"
    ghenv.Component.Message = "VER 1.0"
    ghenv.Component.Category = "Set"
    ghenv.Component.SubCategory = "List"
    
     #Inputs
    #--------------------------------------------------------------------------------------------
    inputIndex=0
    
    ghenv.Component.Params.Input[inputIndex].Name = "List"
    ghenv.Component.Params.Input[inputIndex].NickName = "L"
    ghenv.Component.Params.Input[inputIndex].Description = "Input1 is..."
    ghenv.Component.Params.Input[inputIndex].Optional = False
    inputIndex+=1
    
    ghenv.Component.Params.Input[inputIndex].Name = "Item"
    ghenv.Component.Params.Input[inputIndex].NickName = "I"
    ghenv.Component.Params.Input[inputIndex].Description = "Input2 is..."
    ghenv.Component.Params.Input[inputIndex].Optional = False
    inputIndex+=1
    
    #Outputs
    #--------------------------------------------------------------------------------------------
    outputIndex=0
    
    ghenv.Component.Params.Output[outputIndex].Name = "Index"
    ghenv.Component.Params.Output[outputIndex].NickName = "i"
    ghenv.Component.Params.Output[outputIndex].Description = "Output1 is..."
    outputIndex+=1

i = L.index(I)
# ---------- end itemindex ----------
int = Integer(expression_2)
multiplication = Multiplication(A=int, B=floorheight)
valueor0 = ValueOr0(value=itemindex)
coreheight = Number(multiplication)
dom = ConstructDomain(DomainStart=0, DomainEnd=coreheight)
_2d = _2D(x=width)
box = DomainBox(Base=PlaneXY(0, 0, 0), X=_2d, Y=_2d, Z=dom)
cyl = Cylinder(Base=PlaneXY(0, 0, 0), Radius=expression, Length=coreheight)
cap = CapHoles(Brep=cyl)
debrep = DeconstructBrep(Brep=box)  # -> Faces, Edges, Vertices
trim_4 = TrimTree(Tree=debrep.Faces, Depth=1)
item = ListItem(List=trim_4, Index=0, Wrap=True)  # -> Item, Item1, Item2, Item3, Item4
base = Surface(item.Item4)
explode = Explode(Curve=base, Recursive=True)  # -> Segments, Vertices
trim_5 = TrimTree(Tree=explode.Segments, Depth=1)
join = JoinCurves(Curves=explode.Segments, Preserve=False)
expression_3 = Expression(x=width, Expression="x/2")
expression_4 = Expression(x=doorwidth, Expression="x/2")
trim_6 = TrimTree(Tree=join, Depth=1)
curvepoint = PointOnCurve(trim_5, parameter=0.5)
subtraction = Subtraction(A=expression_3, B=expression_4, C=dooroffset, D=wallthickness)
crv_cp = CurveClosestPoint(Point=curvepoint, Curve=trim_5)  # -> Point, Parameter, Distance
addition = Addition(A=crv_cp.Parameter, B=subtraction)
subtraction_2 = Subtraction(A=crv_cp.Parameter, B=subtraction)
eval = EvaluateCurve(Curve=trim_5, Parameter=addition)  # -> Point, Tangent, Angle
eval_2 = EvaluateCurve(Curve=trim_5, Parameter=subtraction_2)  # -> Point, Tangent, Angle
shift = ShiftList(List=eval_2.Point, Shift=1, Wrap=True)
trim_7 = TrimTree(Tree=shift, Depth=1)
merge_2 = Merge(Data1=graft(eval.Point), Data2=graft(trim_7))

expression_5 = Expression(x=floorheight, Expression="x/3")
lng = ListLength(List=trim_5)
dup_4 = DuplicateData(Data=expression_5, Number=lng, Order=True)
trim_8 = TrimTree(Tree=dup_4, Depth=1)
expression_6 = Expression(x=int, Expression="(x-1)*4")
replace = ReplaceItems(List=trim_8, Item="0", Indices="1", Wrap=False)
repeat = RepeatData(Data=replace, Length=expression_6)
trim_9 = TrimTree(Tree=repeat, Depth=1)
ma = MassAddition(Input=trim_9)  # -> Result, PartialResults
flip = FlipMatrix(Data=ma.PartialResults)
doorheights = Number(flip)
Z = UnitZ(Factor=doorheights)
trim_10 = TrimTree(Tree=Z, Depth=1)
cset = CreateSet(List=trim_10)  # -> Set, graft(Map)
path = ConstructPath(Indices=cset.Map)
trim_11 = TrimTree(Tree=path, Depth=1)

series_2 = Series(Start=0, Step=1, Count=floors)
trim_12 = TrimTree(Tree=series_2, Depth=1)
dup_5 = DuplicateData(Data=graft(trim_12), Number="8", Order=True)
trim_13 = TrimTree(Tree=dup_5, Depth=1)
trim_14 = TrimTree(Tree=trim_13, Depth=1)
spc_2 = ModelSpecifier(Context="floor", Group=trim_14)  # -> Specifier, Context, Group

variant = Integer(number_slider)
rep = ReplaceText(Text="cylindric shaft", Find=" ", Replace="-", RecursiveReplace=False)
expression_7 = Expression(x=variant, Expression="x+1")
curdir = CurrentDirectory()  # -> D, P, S
# ---------- curdir: Python ----------
#Component Information
#--------------------------------------------------------------------------------------------
if ghenv.Component.RunCount<2:
    #General
    #--------------------------------------------------------------------------------------------
    __author__ = "Ueli Saluz"
    __version__ = "2023.09.29"
    
    ghenv.Component.Name = "CurrentDirectory"
    ghenv.Component.NickName = "CurDir"
    ghenv.Component.Description = "Current directory of the current grasshopper file."
    ghenv.Component.Message = "VER 1.0"
    ghenv.Component.Category = "Params"
    ghenv.Component.SubCategory = "Util"
    
    #Outputs
    #--------------------------------------------------------------------------------------------
    outputIndex=0
    
    ghenv.Component.Params.Output[outputIndex].Name = "Directory"
    ghenv.Component.Params.Output[outputIndex].NickName = "D"
    ghenv.Component.Params.Output[outputIndex].Description = "Directory of the current grasshopper file."
    outputIndex+=1
    
    ghenv.Component.Params.Output[outputIndex].Name = "Path"
    ghenv.Component.Params.Output[outputIndex].NickName = "P"
    ghenv.Component.Params.Output[outputIndex].Description = "Path of the current grasshopper file."
    outputIndex+=1
    
    ghenv.Component.Params.Output[outputIndex].Name = "Separator"
    ghenv.Component.Params.Output[outputIndex].NickName = "S"
    ghenv.Component.Params.Output[outputIndex].Description = "Separator of the current system."
    outputIndex+=1

#Imports
#--------------------------------------------------------------------------------------------
from os.path import dirname
from os import sep

#Solver - Run with trees to enhance performance drastically
#--------------------------------------------------------------------------------------------
if __name__ == "__main__":
    P = ghenv.Component.OnPingDocument().FilePath
    D = dirname(P)
    S = sep
# ---------- end curdir ----------
concat = Concatenate(
    FragmentC="representations",
    FragmentD=curdir.S,
    FragmentA="cylindric shaft",
    FragmentB="_",
    FragmentE=expression_7,
    FragmentF="_")
concat_2 = Concatenate(FragmentA=concat, FragmentE="1to500", FragmentG="_", FragmentF="volume")
concat_3 = Concatenate(FragmentA=concat, FragmentE="1to200", FragmentG="_", FragmentF="volume")
concat_4 = Concatenate(FragmentA=concat_2, FragmentB=".3dm")
concat_5 = Concatenate(FragmentA=concat_3, FragmentB=".3dm")
rep_2 = ModelRepresentation(Url=concat_4, LevelOfDetail="1to500", Tags="volume")  # -> Representation, Url, LevelOfDetail, Tags
rep_3 = ModelRepresentation(Url=concat_5, LevelOfDetail="1to200", Tags="volume")  # -> Representation, Url, LevelOfDetail, Tags

merge_3 = Merge(Data1=width, Data2=floors, Data3=floorheight, Data4=platform, Data5=doorwidth, Data6=doorheight, Data7=dooroffset)
panel_2 = Panel("""width
storeys
floor height
platform
door width
door height
door offset""")
panel_3 = Panel(merge_3)
panel_4 = Panel("""cm

cm
cm
cm
cm
cm""")
qlt = ModelQuality(Name=panel_2, Value=panel_3, Unit=panel_4)  # -> Quality, Name, Value, Unit

xy = XYPlane(Origin=Point(0, 0, 0))
Z_2 = UnitZ(Factor=coreheight)
move = Move(Geometry=xy, Motion=Z_2)  # -> Geometry, Transform
spc_3 = ModelSpecifier(Context="bottom", Group="true")  # -> Specifier, Context, Group
spc_4 = ModelSpecifier(Context="top", Group="true")  # -> Specifier, Context, Group
por = ModelPort(Plane=xy, Specifiers=spc_3.Specifier)  # -> Port, Plane, Specifiers
por_2 = ModelPort(Plane=move.Geometry, Specifiers=spc_4.Specifier)  # -> Port, Plane, Specifiers

slab_thickness = Number(Slider(20, range=0..100))

l2o = List2Object(L=merge_2)  # -> O; inputs L: tree
# ---------- l2o: Python ----------
#Component Information
#--------------------------------------------------------------------------------------------
if ghenv.Component.RunCount<2:
    #General
    #--------------------------------------------------------------------------------------------
    __author__ = "Ueli Saluz"
    __version__ = "2022.04.24"
    
    ghenv.Component.Name = "List2Object"
    ghenv.Component.NickName = "L2O"
    ghenv.Component.Description = "Wraps a list of objects into a list object."
    ghenv.Component.Message = "VER 1.0"
    ghenv.Component.Category = "Sets"
    ghenv.Component.SubCategory = "Tree"
    
     #Inputs
    #--------------------------------------------------------------------------------------------
    inputIndex=0
    
    ghenv.Component.Params.Input[inputIndex].Name = "List"
    ghenv.Component.Params.Input[inputIndex].NickName = "L"
    ghenv.Component.Params.Input[inputIndex].Description = "Tree with lists to wrap."
    ghenv.Component.Params.Input[inputIndex].Optional = False
    inputIndex+=1
    

    #Outputs
    #--------------------------------------------------------------------------------------------
    outputIndex=0
    
    ghenv.Component.Params.Output[outputIndex].Name =  "ListObject" 
    ghenv.Component.Params.Output[outputIndex].NickName = "O"
    ghenv.Component.Params.Output[outputIndex].Description = "Python list object as single item."
    outputIndex+=1


#Imports
#--------------------------------------------------------------------------------------------
from System import Object
from Grasshopper import DataTree

#Solver - Run with trees to enhance performance drastically
#--------------------------------------------------------------------------------------------
if __name__ == "__main__":
    
    #Initialize trees
    #--------------------------------------------------------------------------------------------
    TreeToWrap = DataTree[Object]()
    
    #Data matching
    #--------------------------------------------------------------------------------------------
    for path in L.Paths:
        listBranch = L.Branch(path)
        TreeToWrap.Add(listBranch,path)
    
     #Assign trees to output
    #--------------------------------------------------------------------------------------------
    O = TreeToWrap
# ---------- end l2o ----------
trim_15 = TrimTree(Tree=l2o, Depth=1)
repeat_2 = RepeatData(Data=trim_15, Length=expression_6)
trim_16 = TrimTree(Tree=repeat_2, Depth=1)
o2l = Object2List(O=trim_16)  # -> L; inputs O: tree
# ---------- o2l: Python ----------
#Component Information
#--------------------------------------------------------------------------------------------
if ghenv.Component.RunCount<2:
    #General
    #--------------------------------------------------------------------------------------------
    __author__ = "Ueli Saluz"
    __version__ = "2022.04.24"
    
    ghenv.Component.Name = "Object2List"
    ghenv.Component.NickName = "O2L"
    ghenv.Component.Description = "Unwraps a list of objects into a list object."
    ghenv.Component.Message = "VER 1.0"
    ghenv.Component.Category = "Sets"
    ghenv.Component.SubCategory = "Tree"
    
     #Inputs
    #--------------------------------------------------------------------------------------------
    inputIndex=0
    
    ghenv.Component.Params.Input[inputIndex].Name = "ListObject"
    ghenv.Component.Params.Input[inputIndex].NickName = "O"
    ghenv.Component.Params.Input[inputIndex].Description = "A python list object that will be unwrapped into a Grasshopper list."
    ghenv.Component.Params.Input[inputIndex].Optional = False
    inputIndex+=1
    

    #Outputs
    #--------------------------------------------------------------------------------------------
    outputIndex=0
    
    ghenv.Component.Params.Output[outputIndex].Name =  "List"
    ghenv.Component.Params.Output[outputIndex].NickName = "L"
    ghenv.Component.Params.Output[outputIndex].Description = "The unwrapped list."
    outputIndex+=1


#Imports
#--------------------------------------------------------------------------------------------
from System import Object
from Grasshopper import DataTree

#Solver - Run with trees to enhance performance drastically
#--------------------------------------------------------------------------------------------
if __name__ == "__main__":
    
    #Initialize trees
    #--------------------------------------------------------------------------------------------
    OriginalTree = DataTree[Object]()
    
    #Data matching
    #--------------------------------------------------------------------------------------------
    for path in O.Paths:
        listBranch = O.Branch(path)
        for i,listItem in enumerate(listBranch):
            OriginalTree.AddRange(list(listItem),path.AppendElement(i))
    
     #Assign trees to output
    #--------------------------------------------------------------------------------------------
    L = OriginalTree
# ---------- end o2l ----------
match = MatchTree(Tree=Z, Guide=o2l)
move_2 = Move(Geometry=o2l, Motion=match)  # -> Geometry, Transform
crv_cp_2 = CurveClosestPoint(Point=move_2.Geometry, Curve=trim_6)  # -> Point, Parameter, Distance
eval_3 = EvaluateCurve(Curve=trim_6, Parameter=crv_cp_2.Parameter)  # -> Point, Tangent, Angle
rev = Reverse(Vector=eval_3.Tangent)
line = LineSDL(Start=eval_3.Point, Direction=Vector(0, 0, 1), Length=1)
vrot = Rotate(Vector=rev, Axis=line, Angle=degrees("90"))
expression_8 = Expression(x=valueor0, Expression="-((x+2)*90)%360")
pl = ConstructPlane(Origin=eval_3.Point, XAxis=rev, YAxis=vrot)
move_3 = Move(Geometry=pl, Motion=Z)  # -> Geometry, Transform
rotate = Rotate(Geometry=move_3.Geometry, Angle=degrees(expression_8), Plane=PlaneXY(0, 0, 0))  # -> Geometry, Transform
neg = Negative(Value=expression_5)
relblbrch = RelabelBranches(TreeToMatch=rotate.Geometry, ListOfPaths=trim_11)  # -> RelabeledTree; inputs TreeToMatch: tree, ListOfPaths: list
# ---------- relblbrch: Python ----------
if ghenv.Component.RunCount<2:
    __author__ = "Your name"
    __version__ = "2000.00.00"
    
    ghenv.Component.Name = "RelabelBranches"
    ghenv.Component.NickName = "ReLblBrch"
    ghenv.Component.Description = "Relabel all the paths of the branches with a list of new paths. The amount of branches must match with the size of the list of pahts"
    ghenv.Component.Message = "VER 1.0"
    
    ghenv.Component.Params.Input[0].NickName = "TreeToMatch"
    ghenv.Component.Params.Input[1].NickName = "ListOfPaths"
    
    ghenv.Component.Params.Input[0].Description = "Tree that should be relabeled."
    ghenv.Component.Params.Input[1].Description = "List of paths to use for new branch paths."
    
    ghenv.Component.Params.Output[0].NickName = "RelabeledTree"
    ghenv.Component.Params.Output[0].Description = "Relabeled tree where all the paths of the branches have been replaced with new paths."

from System import Object
from Grasshopper import DataTree

def relabelBranchesWithLstOfPths (tree, paths):
    newTree = DataTree[Object]()
    for i,path in enumerate(tree.Paths):
        items = tree.Branch(path)
        for data in items:
            newTree.Add(data,paths[i])
    return newTree

if __name__ == "__main__":
    RelabeledTree = relabelBranchesWithLstOfPths(TreeToMatch,ListOfPaths)
# ---------- end relblbrch ----------
addition_2 = Addition(A=neg, B=slab_thickness)
Z_3 = UnitZ(Factor=addition_2)
move_4 = Move(Geometry=relblbrch, Motion=Z_3)  # -> Geometry, Transform
entranceplanes = Plane(move_4.Geometry)

graft = GraftTree(Tree=pl, IncludeEmptyLists=True, IncludeNullItems=True)
tstat = TreeStatistics(Tree=graft)  # -> Paths, Length, Count
expression_9 = Expression(x=valueor0, Expression="-((x+2)*90)%360")

cir = Circle(Plane=PlaneXY(0, 0, 0), Radius=expression)
crv_cp_3 = CurveClosestPoint(Point=merge_2, Curve=cir)  # -> Point, Parameter, Distance
eval_4 = EvaluateCurve(Curve=cir, Parameter=crv_cp_3.Parameter)  # -> Point, Tangent, Angle
Z_4 = UnitZ(Factor=1)
rev_2 = Reverse(Vector=eval_4.Tangent)
xprod = CrossProduct(VectorA=eval_4.Tangent, VectorB=Z_4, Unitize=False)  # -> Vector, Length
pl_2 = ConstructPlane(Origin=eval_4.Point, XAxis=rev_2, YAxis=xprod.Vector)

l2o_2 = List2Object(L=pl_2)  # -> O; inputs L: tree; same code as l2o
trim_17 = TrimTree(Tree=l2o_2, Depth=1)
repeat_3 = RepeatData(Data=trim_17, Length=expression_6)
trim_18 = TrimTree(Tree=repeat_3, Depth=1)
o2l_2 = Object2List(O=trim_18)  # -> graft(L); inputs O: tree; same code as o2l
relblbrch_2 = RelabelBranches(TreeToMatch=o2l_2, ListOfPaths=tstat.Paths)  # -> RelabeledTree; inputs TreeToMatch: tree, ListOfPaths: list; same code as relblbrch
trim_19 = TrimTree(Tree=relblbrch_2, Depth=1)
deplane = DeconstructPlane(Plane=pl_2)  # -> Origin, XAxis, YAxis, ZAxis
pl_3 = ConstructPlane(Origin=deplane.Origin, XAxis=deplane.XAxis, YAxis=deplane.ZAxis)
_2d_2 = _2D(x=doorwidth)
rectangle = Rectangle(Plane=pl_3, XSize=_2d_2, YSize=doorheight, Radius=0)  # -> Rectangle, Length
l2o_3 = List2Object(L=rectangle.Rectangle)  # -> O; inputs L: tree; same code as l2o
trim_20 = TrimTree(Tree=l2o_3, Depth=1)
explode_2 = Explode(Curve=rectangle.Rectangle, Recursive=True)  # -> Segments, Vertices
repeat_4 = RepeatData(Data=trim_20, Length=expression_6)
trim_21 = TrimTree(Tree=repeat_4, Depth=1)
graft_2 = GraftTree(Tree=pl, IncludeEmptyLists=True, IncludeNullItems=True)
item_2 = ListItem(List=explode_2.Vertices, Index=0, Wrap=True)  # -> Item, Item1
graft_3 = GraftTree(Tree=pl, IncludeEmptyLists=True, IncludeNullItems=True)
o2l_3 = Object2List(O=trim_21)  # -> graft(L); inputs O: tree; same code as o2l
tstat_2 = TreeStatistics(Tree=graft_2)  # -> Paths, Length, Count
trim_22 = TrimTree(Tree=item_2.Item1, Depth=1)
trim_23 = TrimTree(Tree=item_2.Item, Depth=1)
tstat_3 = TreeStatistics(Tree=graft_3)  # -> Paths, Length, Count
crv_cp_4 = CurveClosestPoint(Point=trim_23, Curve=cir)  # -> Point, Parameter, Distance
crv_cp_5 = CurveClosestPoint(Point=trim_22, Curve=cir)  # -> Point, Parameter, Distance
relblbrch_3 = RelabelBranches(TreeToMatch=o2l_3, ListOfPaths=tstat_2.Paths)  # -> RelabeledTree; inputs TreeToMatch: tree, ListOfPaths: list; same code as relblbrch
ln = Line(StartPoint=crv_cp_4.Point, EndPoint=crv_cp_5.Point)
Z_5 = UnitZ(Factor=1)
eval_5 = EvaluateCurve(Curve=reparameterize(ln), Parameter="0.5")  # -> Point, Tangent, Angle
rev_3 = Reverse(Vector=Z_5)
trim_24 = TrimTree(Tree=relblbrch_3, Depth=1)
xprod_2 = CrossProduct(VectorA=eval_5.Tangent, VectorB=rev_3, Unitize=False)  # -> Vector, Length
pl_4 = ConstructPlane(Origin=eval_5.Point, XAxis=eval_5.Tangent, YAxis=xprod_2.Vector)
deplane_2 = DeconstructPlane(Plane=pl_4)  # -> Origin, XAxis, YAxis, ZAxis
len = Length(Curve=ln)
item_3 = ListItem(List=flatten(len), Index=0, Wrap=True)
pl_5 = ConstructPlane(Origin=deplane_2.Origin, XAxis=deplane_2.XAxis, YAxis=deplane_2.ZAxis)
_2d_3 = _2D(x=len)
rectangle_2 = Rectangle(Plane=pl_5, XSize=_2d_3, YSize=doorheight, Radius=0)  # -> Rectangle, Length
panel_5 = Panel(item_3)
rulesrf = RuledSurface(CurveA=rectangle.Rectangle, CurveB=rectangle_2.Rectangle)
cap_2 = CapHoles(Brep=rulesrf)
l2o_4 = List2Object(L=cap_2)  # -> O; inputs L: tree; same code as l2o
trim_25 = TrimTree(Tree=l2o_4, Depth=1)
repeat_5 = RepeatData(Data=trim_25, Length=expression_6)
trim_26 = TrimTree(Tree=repeat_5, Depth=1)
o2l_4 = Object2List(O=trim_26)  # -> graft(L); inputs O: tree; same code as o2l
relblbrch_4 = RelabelBranches(TreeToMatch=o2l_4, ListOfPaths=tstat_3.Paths)  # -> RelabeledTree; inputs TreeToMatch: tree, ListOfPaths: list; same code as relblbrch
trim_27 = TrimTree(Tree=relblbrch_4, Depth=1)

l2o_5 = List2Object(L=merge_2)  # -> O; inputs L: tree; same code as l2o
trim_28 = TrimTree(Tree=l2o_5, Depth=1)
repeat_6 = RepeatData(Data=trim_28, Length=expression_6)
trim_29 = TrimTree(Tree=repeat_6, Depth=1)
o2l_5 = Object2List(O=trim_29)  # -> L; inputs O: tree; same code as o2l
match_2 = MatchTree(Tree=Z, Guide=o2l_5)
move_5 = Move(Geometry=o2l_5, Motion=match_2)  # -> Geometry, Transform
crv_cp_6 = CurveClosestPoint(Point=move_5.Geometry, Curve=trim_6)  # -> Point, Parameter, Distance
eval_6 = EvaluateCurve(Curve=trim_6, Parameter=crv_cp_6.Parameter)  # -> Point, Tangent, Angle
rev_4 = Reverse(Vector=eval_6.Tangent)
line_2 = LineSDL(Start=eval_6.Point, Direction=Vector(0, 0, 1), Length=1)
vrot_2 = Rotate(Vector=rev_4, Axis=line_2, Angle=degrees("90"))
neg_2 = Negative(Value=expression_5)
pl_6 = ConstructPlane(Origin=eval_6.Point, XAxis=rev_4, YAxis=vrot_2)
addition_3 = Addition(A=neg_2, B=slab_thickness)
move_6 = Move(Geometry=trim_19, Motion=Z)  # -> Geometry, Transform
Z_6 = UnitZ(Factor=addition_3)

rotate_2 = Rotate(Geometry=move_6.Geometry, Angle=degrees(expression_9), Plane=PlaneXY(0, 0, 0))  # -> Geometry, Transform

move_7 = Move(Geometry=rotate_2.Geometry, Motion=Z_6)  # -> Geometry, Transform
relblbrch_5 = RelabelBranches(TreeToMatch=move_7.Geometry, ListOfPaths=trim_11)  # -> RelabeledTree; inputs TreeToMatch: tree, ListOfPaths: list; same code as relblbrch
entranceplanes_2 = Plane(relblbrch_5)

# ----
# Outputs   ->
#                 |
#                 v
panel_6 = Panel("2")
series_3 = Series(Start=0, Step=1, Count="4")
series_4 = Series(Start=0, Step=1, Count=panel_6)
trim_30 = TrimTree(Tree=series_3, Depth=1)
trim_31 = TrimTree(Tree=series_4, Depth=1)
lng_2 = ListLength(List=flatten(entranceplanes_2))
merge_4 = Merge(Data1=trim_30, Data2=trim_31, Data3=trim_31)
repeat_7 = RepeatData(Data=merge_4, Length=lng_2)
trim_32 = TrimTree(Tree=repeat_7, Depth=1)
spc_5 = ModelSpecifier(Context="door", Group=trim_32)  # -> Specifier, Context, Group

entranceplanes_3 = Plane(flatten(entranceplanes_2))
merge_5 = Merge(Data1=graft(spc_2.Specifier), Data2=graft(spc.Specifier), Data3=graft(spc_5.Specifier))
por_3 = ModelPort(Plane=graft(entranceplanes_3), Specifiers=merge_5)  # -> flatten(Port), Plane, Specifiers

merge_6 = Merge(Data1=rep_2.Representation, Data2=rep_3.Representation)
merge_7 = Merge(Data1=por.Port, Data2=por_2.Port, Data3=por_3.Port)
typ = ModelType(
    Name="cylindric shaft",
    Explanation="An efficient core with many doors.",
    Icon="🛗",
    Representations=merge_6,
    Ports=merge_7,
    Qualities=qlt.Quality)  # -> Type, Name, Explanation, Icon, Representations, Ports, Qualities
typ_2 = RemoveType(TypeName=typ.Name, TypeQualities=typ.Qualities, Run=safe)
or = GateOr(A=safe, B=typ_2)
typ_3 = AddType(Type=typ.Type, Run=or)

typ_4 = SerializeType(Type=typ.Type)
type = Text(typ_4)
context_bake = ContextBake(Geometry=type)
previewplane = PreviewPlane(plane=graft(entranceplanes_2), axis_length=Slider(50, range=0..100))  # -> X_2, Y_2, Z_2
merge_8 = Merge(Data1=previewplane.X_2, Data2=previewplane.Y_2, Data3=previewplane.Z_2)
pl2pl = MoveObjectPlaneToPlane(G=trim_24, S=trim_19, T=move_7.Geometry)  # -> TG, T; inputs S: Plane, T: Plane
# ---------- pl2pl: Python ----------
#Component Information
#--------------------------------------------------------------------------------------------
if ghenv.Component.RunCount<2:
    #General
    #--------------------------------------------------------------------------------------------
    __author__ = "Ueli Saluz"
    __version__ = "2023.02.12"
    
    ghenv.Component.Name = "MoveObjectPlaneToPlane"
    ghenv.Component.NickName = "Pl2Pl"
    ghenv.Component.Description = "Moves abitrary geometry from a source plane to a target plane."
    ghenv.Component.Message = "VER 1.2"
    ghenv.Component.Category = "Transform"
    ghenv.Component.SubCategory = "Euclidean"
    
     #Inputs
    #--------------------------------------------------------------------------------------------
    inputIndex=0
    
    ghenv.Component.Params.Input[inputIndex].Name = "Geometry"
    ghenv.Component.Params.Input[inputIndex].NickName = "G"
    ghenv.Component.Params.Input[inputIndex].Description = "Geometry to move."
    ghenv.Component.Params.Input[inputIndex].Optional = False
    inputIndex+=1
    
    ghenv.Component.Params.Input[inputIndex].Name = "SourcePlane"
    ghenv.Component.Params.Input[inputIndex].NickName = "S"
    ghenv.Component.Params.Input[inputIndex].Description = "Source plane of object."
    ghenv.Component.Params.Input[inputIndex].Optional = False
    inputIndex+=1
    
    ghenv.Component.Params.Input[inputIndex].Name = "TargetPlane"
    ghenv.Component.Params.Input[inputIndex].NickName = "T"
    ghenv.Component.Params.Input[inputIndex].Description = "Target plane of object."
    ghenv.Component.Params.Input[inputIndex].Optional = False
    inputIndex+=1
    
    #Outputs
    #--------------------------------------------------------------------------------------------
    outputIndex=0
    
    ghenv.Component.Params.Output[outputIndex].Name = "TranslatedGeometry"
    ghenv.Component.Params.Output[outputIndex].NickName = "TG"
    ghenv.Component.Params.Output[outputIndex].Description = "Translated geometry in target plane."
    outputIndex+=1
    
    ghenv.Component.Params.Output[outputIndex].Name = "Trasnform"
    ghenv.Component.Params.Output[outputIndex].NickName = "T"
    ghenv.Component.Params.Output[outputIndex].Description = "Transform describing translation form source to target plane."
    outputIndex+=1


#Imports
#--------------------------------------------------------------------------------------------
import Rhino.Geometry.Transform as trsf

def MvObjPlnToPln (geo,plnObj,plnDest):
    transform = trsf.PlaneToPlane(plnObj,plnDest)
    geo.Transform(transform)
    return (geo,transform)

TG, T = MvObjPlnToPln(G,S,T)
# ---------- end pl2pl ----------
transform = Transform(Geometry=trim_27, Transform=pl2pl.T)
doors1to200 = Brep(transform)

trim_33 = TrimTree(Tree=doors1to200, Depth=1)
merge_9 = Merge(Data1=cap, Data2=trim_33)
volume1to200 = Brep(merge_9)

doors1to500 = Rectangle(pl2pl.TG)

doors1to500_2 = Rectangle(flatten(doors1to500))
doors1to200_2 = Brep(flatten(doors1to200))
volume1to500 = Geometry(cap)
volume1to200_2 = Brep(cap)
expression_10 = Expression(x="doors", y=doors1to500_2, Expression="x")
expression_11 = Expression(x="volume", y=volume1to500, Expression="x")
merge_10 = Merge(Data1=volume1to200_2, Data2=doors1to200_2)
merge_11 = Merge(Data1=volume1to500, Data2=doors1to500_2)
merge_12 = Merge(Data1=expression_11, Data2=expression_10)
ef_layer = EleFrontLayer(FullPath=merge_12)  # -> Layer, FullPath, Hidden, Locked, DisplayColour, MaterialName, Linetype, PrintColour, PrintWidth
ef_att = EleFrontAttributes(Layer=ef_layer.Layer)  # -> Attributes, Keys, Values, Name, Layer, ColourSource, DisplayColour, MaterialSource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
baketofile = BakeObjectsToFile(
    FilePath=rep_2.Url,
    Geometry=merge_11,
    Attributes=ef_att.Attributes,
    Bake=safe,
    networkMode=False,
    ValueTable_networkMode=True,
    overwriteMode="Overwrite",
    preset="Safest")
baketofile_2 = BakeObjectsToFile(
    FilePath=rep_3.Url,
    Geometry=merge_10,
    Attributes=ef_att.Attributes,
    Bake=safe,
    networkMode=False,
    ValueTable_networkMode=True,
    overwriteMode="Overwrite",
    preset="Safest")

# ==== cluster _2D
x = ClusterInput()
expression = Expression(x=x, Expression="x/2")
neg = Negative(Value=expression)
dom = ConstructDomain(DomainStart=neg, DomainEnd=expression)
I = ClusterOutput(dom)

# ==== cluster ValueOr0
value = ClusterInput()
value_2 = Number(value)
null = NullItem(Item=value_2)  # -> NullFlags, InvalidFlags, Description
filter = StreamFilter(Gate=null.NullFlags, Stream0=value_2, Stream1="0")
valueor0 = Number(filter)
valueor0_2 = ClusterOutput(valueor0)

# ==== cluster PreviewPlane: Preview a plane with axis colors and naming.
axis_length = ClusterInput()
plane = ClusterInput()
axis_length_2 = Number(axis_length)
plane_2 = Plane(plane)
deplane = DeconstructPlane(Plane=plane_2)  # -> Origin, XAxis, YAxis, ZAxis
line = LineSDL(Start=deplane.Origin, Direction=deplane.YAxis, Length=axis_length_2)
line_2 = LineSDL(Start=deplane.Origin, Direction=deplane.XAxis, Length=axis_length_2)
line_3 = LineSDL(Start=deplane.Origin, Direction=deplane.ZAxis, Length=axis_length_2)
swatch = ColourSwatch(SwatchColor=RGB(235, 52, 79))
swatch_2 = ColourSwatch(SwatchColor=RGB(0, 166, 157))
swatch_3 = ColourSwatch(SwatchColor=RGB(240, 117, 24))
end = EndPoints(Curve=line_2)  # -> Start, End
end_2 = EndPoints(Curve=line)  # -> Start, End
end_3 = EndPoints(Curve=line_3)  # -> Start, End
tag = TextTag(Location=end.End, Text="X", Colour=swatch)
tag_2 = TextTag(Location=end_2.End, Text="Y", Colour=swatch_2)
tag_3 = TextTag(Location=end_3.End, Text="Z", Colour=swatch_3)
preview = CustomPreview(Geometry=line_2, Material=swatch)
preview_2 = CustomPreview(Geometry=line, Material=swatch_2)
preview_3 = CustomPreview(Geometry=line_3, Material=swatch_3)
X = Line(line_2)
Y = Line(line)
Z = Line(line_3)
X_2 = ClusterOutput(X)
Y_2 = ClusterOutput(Y)
Z_2 = ClusterOutput(Z)
