# Grasshopper definition futuristiccapsule.gh (Grasshopper 1.0.7)
# plug-ins: semio, eleFront

merge = Merge(Data1="back", Data2="back", Data3="back", Data4="back", Data5="side", Data6="side", Data7="side", Data8="side")
variant = Slider(0, range=0..7)
series = Series(Start=0, Step=1, Count="8")
safe = Button()
trim = TrimTree(Tree=series, Depth=1)
merge_2 = Merge(Data1="front", Data2="front", Data3="side", Data4="side", Data5="front", Data6="front", Data7="side", Data8="side")
filter = StreamFilter(Gate="0", Stream0=variant, Stream1=trim)
item = ListItem(List=merge, Index=filter, Wrap=True)
item_2 = ListItem(List=merge_2, Index=filter, Wrap=True)
merge_3 = Merge(Data1="F", Data2="T", Data3="F", Data4="T", Data5="F", Data6="T", Data7="F", Data8="T")
# ^
#                  |
# Preview    ->
# Parameters:
item_3 = ListItem(List=merge_3, Index=filter, Wrap=True)
toggle = BooleanToggle(False)
list = ValueList({"Front", "Side"}, selected="Front")
list_2 = ValueList({"Back": "back", "Side": "side"}, selected="Back")
# External
#      |
#      v
entrance = GetString(item, AtLeast=0, AtMost=1, TreeAccess=False)
view = GetString(item_2, AtLeast=0, AtMost=1, TreeAccess=False)
mirror = GetBoolean(item_3, AtLeast=0, AtMost=1, FalseValue="False", TreeAccess=False, TrueValue="True")
panel = Panel("""round
rectangular""")
panel_2 = Panel("""front
side""")
panel_3 = Panel("""back
side""")
itemindex = ItemIndex(L=panel_3, I=entrance)  # -> i; inputs L: list
# ---------- itemindex: Python ----------
#Component Information
#--------------------------------------------------------------------------------------------
if ghenv.Component.RunCount<2:
    #General
    #--------------------------------------------------------------------------------------------
    __author__ = "Ueli Saluz"
    __version__ = "2022.11.18"
    
    ghenv.Component.Name = "ItemIndex"
    ghenv.Component.NickName = "ItemIndex"
    ghenv.Component.Description = "A better IdemIndex"
    ghenv.Component.Message = "VER 1.0"
    ghenv.Component.Category = "Set"
    ghenv.Component.SubCategory = "List"
    
     #Inputs
    #--------------------------------------------------------------------------------------------
    inputIndex=0
    
    ghenv.Component.Params.Input[inputIndex].Name = "List"
    ghenv.Component.Params.Input[inputIndex].NickName = "L"
    ghenv.Component.Params.Input[inputIndex].Description = "Input1 is..."
    ghenv.Component.Params.Input[inputIndex].Optional = False
    inputIndex+=1
    
    ghenv.Component.Params.Input[inputIndex].Name = "Item"
    ghenv.Component.Params.Input[inputIndex].NickName = "I"
    ghenv.Component.Params.Input[inputIndex].Description = "Input2 is..."
    ghenv.Component.Params.Input[inputIndex].Optional = False
    inputIndex+=1
    
    #Outputs
    #--------------------------------------------------------------------------------------------
    outputIndex=0
    
    ghenv.Component.Params.Output[outputIndex].Name = "Index"
    ghenv.Component.Params.Output[outputIndex].NickName = "i"
    ghenv.Component.Params.Output[outputIndex].Description = "Output1 is..."
    outputIndex+=1

i = L.index(I)
# ---------- end itemindex ----------
itemindex_2 = ItemIndex(L=panel_2, I=view)  # -> i; inputs L: list; same code as itemindex
valueor0 = ValueOr0(value=itemindex)
valueor0_2 = ValueOr0(value=itemindex_2)
entrance_2 = Integer(valueor0)
entrance_3 = Integer(entrance_2)
multiplication = Multiplication(A=entrance_3, B="4")
view_2 = Integer(valueor0_2)
view_3 = Integer(view_2)
multiplication_2 = Multiplication(A=view_3, B="2")
length = Number(Slider(420, range=0..1000))
# Local ->
_2d = _2D(x=length)
width = Number(Slider(260, range=0..1000))
_2d_2 = _2D(x=width)
height = Number(Slider(250, range=0..1000))
bool = Boolean(invert(mirror))
filter_2 = StreamFilter(Gate=entrance_2, Stream0=mirror, Stream1=bool)
mirror_2 = Boolean(filter_2)
# Outputs   ->
#                 |
#                 v
mirrored = Boolean(mirror_2)
addition = Addition(A=multiplication, B=multiplication_2, C=mirrored)
variant_2 = Integer(addition)

variant_3 = Integer(variant_2)
expression = Expression(x=variant_3, Expression="x+1")
rep = ReplaceText(Text="futuristic capsule", Find=" ", Replace="-", RecursiveReplace=False)
curdir = CurrentDirectory()  # -> D, P, S
# ---------- curdir: Python ----------
#Component Information
#--------------------------------------------------------------------------------------------
if ghenv.Component.RunCount<2:
    #General
    #--------------------------------------------------------------------------------------------
    __author__ = "Ueli Saluz"
    __version__ = "2023.09.29"
    
    ghenv.Component.Name = "CurrentDirectory"
    ghenv.Component.NickName = "CurDir"
    ghenv.Component.Description = "Current directory of the current grasshopper file."
    ghenv.Component.Message = "VER 1.0"
    ghenv.Component.Category = "Params"
    ghenv.Component.SubCategory = "Util"
    
    #Outputs
    #--------------------------------------------------------------------------------------------
    outputIndex=0
    
    ghenv.Component.Params.Output[outputIndex].Name = "Directory"
    ghenv.Component.Params.Output[outputIndex].NickName = "D"
    ghenv.Component.Params.Output[outputIndex].Description = "Directory of the current grasshopper file."
    outputIndex+=1
    
    ghenv.Component.Params.Output[outputIndex].Name = "Path"
    ghenv.Component.Params.Output[outputIndex].NickName = "P"
    ghenv.Component.Params.Output[outputIndex].Description = "Path of the current grasshopper file."
    outputIndex+=1
    
    ghenv.Component.Params.Output[outputIndex].Name = "Separator"
    ghenv.Component.Params.Output[outputIndex].NickName = "S"
    ghenv.Component.Params.Output[outputIndex].Description = "Separator of the current system."
    outputIndex+=1

#Imports
#--------------------------------------------------------------------------------------------
from os.path import dirname
from os import sep

#Solver - Run with trees to enhance performance drastically
#--------------------------------------------------------------------------------------------
if __name__ == "__main__":
    P = ghenv.Component.OnPingDocument().FilePath
    D = dirname(P)
    S = sep
# ---------- end curdir ----------
concat = Concatenate(FragmentC="representations", FragmentD=curdir.S, FragmentA=rep, FragmentB="_", FragmentE=expression, FragmentF="_")
concat_2 = Concatenate(FragmentA=concat, FragmentE="1to500", FragmentG="_", FragmentF="volume")
concat_3 = Concatenate(FragmentA=concat, FragmentE="1to200", FragmentG="_", FragmentF="volume")
concat_4 = Concatenate(FragmentA=concat_2, FragmentB=".3dm")
concat_5 = Concatenate(FragmentA=concat_3, FragmentB=".3dm")
rep_2 = ModelRepresentation(Url=concat_4, LevelOfDetail="1to500", Tags="volume")  # -> Representation, Url, LevelOfDetail, Tags
rep_3 = ModelRepresentation(Url=concat_5, LevelOfDetail="1to200", Tags="volume")  # -> Representation, Url, LevelOfDetail, Tags

filletradius = Number(Slider(25, range=0..100))
shellthickness = Number(Slider(20, range=0..100))
subtraction = Subtraction(A=height, B=shellthickness)
neg = Negative(Value=shellthickness)
dom = ConstructDomain(DomainStart=neg, DomainEnd=subtraction)
box = DomainBox(Base=PlaneXY(0, 0, 0), X=_2d_2, Y=_2d, Z=dom)
volume1to500 = Box(box)
debrep = DeconstructBrep(Brep=volume1to500)  # -> Faces, Edges, Vertices
trim_2 = TrimTree(Tree=debrep.Edges, Depth=1)
trim_3 = TrimTree(Tree=debrep.Faces, Depth=1)
item_4 = ListItem(List=trim_3, Index=0, Wrap=True)  # -> Item, Item1, Item2, Item3, Item4, Item5
list_3 = ValueList({"Round": "round", "Rectangular": "rectangular"}, selected="Round")
windowcircleradius = Number(Slider(65, range=0..100))
window_offset_wall = Number(Slider(30, range=0..100))
windowshape = Text(list_3)
itemindex_3 = ItemIndex(L=panel, I=windowshape)  # -> i; inputs L: list; same code as itemindex
valueor0_3 = ValueOr0(value=itemindex_3)
windowshape_2 = Integer(valueor0_3)

case = TextCase(Text=mirror, Culture=127)  # -> UpperCase, LowerCase
merge_4 = Merge(Data1=entrance, Data2=view, Data3=case.LowerCase, Data4=length, Data5=width, Data6=height, Data7=windowshape)
panel_4 = Panel("""entrance
view
mirrored
length
width
heigth
window shape""")
panel_5 = Panel(merge_4)
panel_6 = Panel("""cm
cm
cm""")
qlt = ModelQuality(Name=panel_4, Value=panel_5, Unit=panel_6)  # -> Quality, Name, Value, Unit

door_offset_wall = Number(Slider(25, range=0..100))
door_width = Number(Slider(80, range=0..100))
door_height = Number(Slider(200, range=0..1000))

item_5 = ListItem(List=trim_2, Index=0, Wrap=True)  # -> Item, Item1, Item2, Item3
flip = FlipCurve(Curve=item_5.Item)  # -> Curve, Flag
filter_3 = StreamFilter(Gate=mirror_2, Stream0=flip.Curve, Stream1=item_5.Item)
filter_4 = StreamFilter(Gate=mirror_2, Stream0=item_4.Item1, Stream1=item_4.Item3)
filter_5 = StreamFilter(Gate=entrance_2, Stream0=filter_3, Stream1=item_5.Item1)
filter_6 = StreamFilter(Gate=entrance_2, Stream0=item_4.Item, Stream1=filter_4)
addition_2 = Addition(A=door_offset_wall, B=shellthickness)
eval = EvaluateLength(Curve=filter_5, Length=addition_2, Normalized=False)  # -> Point, Tangent, Parameter
srf_cp = SurfaceClosestPoint(Point=eval.Point, Surface=filter_6)  # -> Point, UVPoint, Distance
evalsrf = EvaluateSurface(Surface=filter_6, Point=srf_cp.UVPoint)  # -> Point, Normal, UDirection, VDirection, Frame
neg_2 = Negative(Value=door_width)
filter_7 = StreamFilter(Gate=entrance_2, Stream0=neg_2, Stream1=door_width)
filter_8 = StreamFilter(Gate=mirror_2, Stream0=filter_7, Stream1=door_width)
and = GateAnd(A=entrance_2, B=mirror_2)
filter_9 = StreamFilter(Gate=and, Stream0=filter_8, Stream1=neg_2)
rectangle = Rectangle(Plane=evalsrf.Frame, XSize=filter_9, YSize=door_height, Radius=0)  # -> Rectangle, Length
Z = UnitZ(Factor=shellthickness)
move = Move(Geometry=rectangle.Rectangle, Motion=Z)  # -> Geometry, Transform
door = Rectangle(move.Geometry)

flip_2 = FlipCurve(Curve=item_5.Item1)  # -> Curve, Flag
expression_2 = Expression(x=height, Expression="x/2")
filter_10 = StreamFilter(Gate=mirror_2, Stream0=item_5.Item3, Stream1=flip_2.Curve)
addition_3 = Addition(A=windowcircleradius, B=window_offset_wall, C=shellthickness)
Z_2 = UnitZ(Factor=expression_2)
filter_11 = StreamFilter(Gate=mirror_2, Stream0=item_4.Item3, Stream1=item_4.Item1)
eval_2 = EvaluateLength(Curve=filter_10, Length=addition_3, Normalized=False)  # -> Point, Tangent, Parameter
evalsrf_2 = EvaluateSurface(Surface=reparameterize(filter_11), Point="0.5,0.5")  # -> Point, Normal, UDirection, VDirection, Frame
move_2 = Move(Geometry=eval_2.Point, Motion=Z_2)  # -> Geometry, Transform
evalsrf_3 = EvaluateSurface(Surface=reparameterize(item_4.Item2), Point="0.5,0.5")  # -> Point, Normal, UDirection, VDirection, Frame
pl_origin = PlaneOrigin(Base=evalsrf_2.Frame, Origin=move_2.Geometry)
expression_3 = Expression(x=windowcircleradius, Expression="x*2")
filter_12 = StreamFilter(Gate=view_2, Stream0=evalsrf_3.Frame, Stream1=pl_origin)
_2d_3 = _2D(x=expression_3)
rectangle_2 = Rectangle(Plane=filter_12, XSize=_2d_3, YSize=_2d_3, Radius=0)  # -> Rectangle, Length
cir = Circle(Plane=filter_12, Radius=windowcircleradius)
filter_13 = StreamFilter(Gate=windowshape_2, Stream0=cir, Stream1=rectangle_2.Rectangle)
windowplane = Plane(filter_12)
window = Geometry(filter_13)

srf = Surface(item_4.Item)
srf_2 = Surface(item_4.Item3)
srf_3 = Surface(item_4.Item2)
srf_4 = Surface(item_4.Item4)
srf_5 = Surface(item_4.Item1)
srf_6 = Surface(item_4.Item5)
mirrored_2 = Boolean(mirror_2)
mirrored_3 = Boolean(mirror_2)
filter_14 = StreamFilter(Gate=mirrored_2, Stream0=srf_5, Stream1=srf_2)
filter_15 = StreamFilter(Gate=mirrored_3, Stream0=srf_2, Stream1=srf_5)
merge_5 = Merge(Data1=srf_5, Data2=srf_2)
merge_6 = Merge(Data1=srf_5, Data2=srf)
merge_7 = Merge(Data1=srf, Data2=srf_3)
merge_8 = Merge(Data1=srf_5, Data2=srf_3)
merge_9 = Merge(Data1=srf_2, Data2=srf_3)
merge_10 = Merge(Data1=srf, Data2=srf_2)
entrance_4 = Integer(entrance_2)
window_2 = Integer(view_2)
filter_16 = StreamFilter(Gate=entrance_4, Stream0=srf, Stream1=filter_14)
filter_17 = StreamFilter(Gate=window_2, Stream0=srf_3, Stream1=filter_15)
filter_18 = StreamFilter(
    Gate=variant_2,
    Stream0=merge_5,
    Stream1=merge_5,
    Stream2=merge_8,
    Stream3=merge_9,
    Stream4=merge_10,
    Stream5=merge_6,
    Stream6=merge_7,
    Stream7=merge_7)

contourdistance = Number(Slider(25, range=0..100))
boltsdiameter = Number(Slider(4, range=0..10))
expression_4 = Expression(x=shellthickness, Expression="x/3")

door_2 = Rectangle(door)
explode = Explode(Curve=door, Recursive=True)  # -> Segments, Vertices
trim_4 = TrimTree(Tree=explode.Segments, Depth=1)
item_6 = ListItem(List=trim_4, Index=0, Wrap=True)  # -> Item, Item1, Item2, Item3
eval_3 = EvaluateCurve(Curve=reparameterize(item_6.Item), Parameter="0.5")  # -> Point, Tangent, Angle
rev = Reverse(Vector=eval_3.Tangent)
Z_3 = UnitZ(Factor=1)
xprod = CrossProduct(VectorA=rev, VectorB=Z_3, Unitize=False)  # -> Vector, Length
pl = ConstructPlane(Origin=eval_3.Point, XAxis=eval_3.Tangent, YAxis=xprod.Vector)
doorentranceplane = Plane(pl)

pln = Plane(doorentranceplane)
spc = Specifier(Context="doors", Group="front")  # -> Specifier, Context, Group
por = Port(Plane=pln, Specifiers=spc.Specifier)  # -> Port, Plane, Specifiers

merge_11 = Merge(Data1=rep_2.Representation, Data2=rep_3.Representation)
typ = ModelType(
    Name="futuristic capsule",
    Explanation="A futuristic living capsule for one person.",
    Representations=merge_11,
    Ports=por.Port,
    Qualities=qlt.Quality)  # -> Type, Name, Explanation, Icon, Representations, Ports, Qualities
typ_2 = RemoveType(TypeName=typ.Name, TypeQualities=typ.Qualities, Run=safe)
or = GateOr(A=safe, B=typ_2)
typ_3 = AddType(Type=typ.Type, Run=or)

typ_4 = SerializeType(Type=typ.Type)
type = Text(typ_4)
context_bake = ContextBake(Geometry=type)

cluster = Cluster(
    length=length,
    width=width,
    entrance=entrance_2,
    view=view_2,
    mirror=mirror_2,
    door=door,
    capsule=volume1to500,
    windowplane=windowplane,
    entranceplane=evalsrf.Frame,
    windowsurface=window,
    window_offset_wall=expression_4,
    contourdistance=contourdistance,
    boltsdiameter=boltsdiameter)  # -> capsule1500_2, door_4, srf_2, capsule1200_2, contours1to200_2, bolts_2
merge_12 = Merge(Data1=cluster.capsule1500_2, Data2=cluster.door_4, Data3=cluster.srf_2)
merge_13 = Merge(Data1=cluster.capsule1200_2, Data2=cluster.door_4)
sunion = SolidUnion(Breps=merge_12)
sunion_2 = SolidUnion(Breps=merge_13)

bolts = Circle(flatten(cluster.bolts_2))

volume1to500_2 = Brep(sunion)
volume1to200 = Brep(sunion_2)
door_3 = Brep(cluster.door_4)
window_3 = Surface(cluster.srf_2)
expression_5 = Expression(x="shell", y=volume1to500_2, Expression="x")
merge_14 = Merge(Data1="shell", Data2="window", Data3="door")
merge_15 = Merge(Data1=volume1to500_2, Data2=window_3, Data3=door_3)
merge_16 = Merge(Data1=volume1to200, Data2=door_3, Data3=bolts)
expression_6 = Expression(x="bolts", y=bolts, Expression="x")
merge_17 = Merge(Data1="shell", Data2="door", Data3=expression_6)
ef_layer = EleFrontLayer(FullPath=merge_14)  # -> Layer, FullPath, Hidden, Locked, DisplayColour, MaterialName, Linetype, PrintColour, PrintWidth
ef_layer_2 = EleFrontLayer(FullPath=merge_17)  # -> Layer, FullPath, Hidden, Locked, DisplayColour, MaterialName, Linetype, PrintColour, PrintWidth
ef_att = EleFrontAttributes(Layer=ef_layer.Layer)  # -> Attributes, Keys, Values, Name, Layer, ColourSource, DisplayColour, MaterialSource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
ef_att_2 = EleFrontAttributes(Layer=ef_layer_2.Layer)  # -> Attributes, Keys, Values, Name, Layer, ColourSource, DisplayColour, MaterialSource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
baketofile = BakeObjectsToFile(
    FilePath=concat_4,
    Geometry=merge_15,
    Attributes=ef_att.Attributes,
    Bake=safe,
    networkMode=False,
    ValueTable_networkMode=True,
    overwriteMode="Overwrite",
    preset="Safest")
baketofile_2 = BakeObjectsToFile(
    FilePath=rep_3.Url,
    Geometry=merge_16,
    Attributes=ef_att_2.Attributes,
    Bake=safe,
    networkMode=False,
    ValueTable_networkMode=True,
    overwriteMode="Overwrite",
    preset="Safest")

filtertype = FilterByType(ObjectType="Brep", Geometry=flatten(merge_16), invertFilter=False, returnNulls=False)  # -> ExcludedGeometry, IncludedGeometry
swatch = ColourSwatch(SwatchColor=RGB(0, 0, 0))
filtertype_2 = FilterByType(ObjectType="Circle", Geometry=flatten(merge_16), invertFilter=False, returnNulls=False)  # -> ExcludedGeometry, IncludedGeometry
debrep_2 = DeconstructBrep(Brep=volume1to200)  # -> Faces, Edges, Vertices
preview = CustomPreview(Geometry=flatten(filtertype.IncludedGeometry), Material=ColourSwatch(SwatchColor=RGB(255, 255, 255)))
preview_2 = CustomPreview(Geometry=flatten(filtertype_2.IncludedGeometry), Material=swatch)
preview_3 = CustomPreview(Geometry=flatten(debrep_2.Edges), Material=swatch)
previewplane = PreviewPlane(plane=doorentranceplane, axis_length=Slider(100, range=0..100))

# ==== cluster _2D
x = ClusterInput()
expression = Expression(x=x, Expression="x/2")
neg = Negative(Value=expression)
dom = ConstructDomain(DomainStart=neg, DomainEnd=expression)
I = ClusterOutput(dom)

# ==== cluster ValueOr0
value = ClusterInput()
value_2 = Number(value)
null = NullItem(Item=value_2)  # -> NullFlags, InvalidFlags, Description
filter = StreamFilter(Gate=null.NullFlags, Stream0=value_2, Stream1="0")
valueor0 = Number(filter)
valueor0_2 = ClusterOutput(valueor0)

# ==== cluster PreviewPlane: Preview a plane with axis colors and naming.
axis_length = ClusterInput()
plane = ClusterInput()
axis_length_2 = Number(axis_length)
plane_2 = Plane(plane)
deplane = DeconstructPlane(Plane=plane_2)  # -> Origin, XAxis, YAxis, ZAxis
line = LineSDL(Start=deplane.Origin, Direction=deplane.YAxis, Length=axis_length_2)
line_2 = LineSDL(Start=deplane.Origin, Direction=deplane.XAxis, Length=axis_length_2)
line_3 = LineSDL(Start=deplane.Origin, Direction=deplane.ZAxis, Length=axis_length_2)
swatch = ColourSwatch(SwatchColor=RGB(235, 52, 79))
swatch_2 = ColourSwatch(SwatchColor=RGB(0, 166, 157))
swatch_3 = ColourSwatch(SwatchColor=RGB(240, 117, 24))
end = EndPoints(Curve=line_2)  # -> Start, End
end_2 = EndPoints(Curve=line)  # -> Start, End
end_3 = EndPoints(Curve=line_3)  # -> Start, End
tag = TextTag(Location=end.End, Text="X", Colour=swatch)
tag_2 = TextTag(Location=end_2.End, Text="Y", Colour=swatch_2)
tag_3 = TextTag(Location=end_3.End, Text="Z", Colour=swatch_3)
preview = CustomPreview(Geometry=line_2, Material=swatch)
preview_2 = CustomPreview(Geometry=line, Material=swatch_2)
preview_3 = CustomPreview(Geometry=line_3, Material=swatch_3)

# ==== cluster Cluster
boltsdiameter = ClusterInput()
length = ClusterInput()
width = ClusterInput()
entrance = ClusterInput()
view = ClusterInput()
mirror = ClusterInput()
door = ClusterInput()
capsule = ClusterInput()
windowplane = ClusterInput()
entranceplane = ClusterInput()
windowsurface = ClusterInput()
window_offset_wall = ClusterInput()
contourdistance = ClusterInput()
boltsdiameter_2 = Number(boltsdiameter)
length_2 = Number(length)
width_2 = Number(width)
entrance_2 = Integer(entrance)
view_2 = Integer(view)
mirror_2 = Number(mirror)
door_2 = Rectangle(door)
capsule_2 = Box(capsule)
windowplane_2 = Plane(windowplane)
entranceplane_2 = Plane(entranceplane)
windowsurface_2 = Surface(windowsurface)
window_offset_wall_2 = Number(window_offset_wall)
contourdistance_2 = Integer(contourdistance)
expression = Expression(x=boltsdiameter_2, Expression="x/2")
box_subd = BoxSubD(box=capsule_2)
deplane = DeconstructPlane(Plane=windowplane_2)  # -> Origin, XAxis, YAxis, ZAxis
rev = Reverse(Vector=deplane.ZAxis)
brep = Brep(box_subd)
project = Project(Curve=windowsurface_2, Brep=brep, Direction=rev)
trim = TrimTree(Tree=project, Depth=1)
item = ListItem(List=trim, Index=0, Wrap=True)  # -> Item, Item1
filter = StreamFilter(Gate=entrance_2, Stream0=length_2, Stream1=width_2)
deplane_2 = DeconstructPlane(Plane=entranceplane_2)  # -> Origin, XAxis, YAxis, ZAxis
filter_2 = StreamFilter(Gate=mirror_2, Stream0=item.Item1, Stream1=item.Item)
expression_2 = Expression(x=filter, Expression="x/2")
rev_2 = Reverse(Vector=deplane_2.ZAxis)
filter_3 = StreamFilter(Gate=entrance_2, Stream0=item.Item1, Stream1=filter_2)
not = GateNot(A=view_2)
amp = Amplitude(Vector=rev_2, Amplitude=expression_2)
filter_4 = StreamFilter(Gate=view_2, Stream0=filter_3, Stream1=filter_2)
and = GateAnd(A=entrance_2, B=not, C=mirror_2)
extr = Extrude(Base=door_2, Direction=amp)
filter_5 = StreamFilter(Gate=and, Stream0=filter_4, Stream1=item.Item1)
patch = Patch(Curves=filter_5, Spans=20, Flexibility=1, Trim=True)
evalsrf = EvaluateSurface(Surface=reparameterize(patch), Point="0.5,0.5")  # -> Point, Normal, UDirection, VDirection, Frame
sec = BrepPlane(Brep=brep, Plane=evalsrf.Frame)  # -> Curves, Points
trim_2 = TrimTree(Tree=sec.Curves, Depth=1)
boundary = BoundarySurfaces(Edges=trim_2)
split = SplitBrep(Brep=brep, Cutter=boundary)
trim_3 = TrimTree(Tree=split, Depth=1)
entrance_3 = Box(extr)
item_2 = ListItem(List=trim_3, Index=0, Wrap=True)  # -> Item, Item1
cap = CapHoles(Brep=item_2.Item)
window = Surface(item_2.Item1)
crv = Curve(window)
capsule1500 = Brep(cap)
srf = Surface(crv)
evalsrf_2 = EvaluateSurface(Surface=reparameterize(srf), Point="0.5,0.5")  # -> Point, Normal, UDirection, VDirection, Frame
rev_3 = Reverse(Vector=evalsrf_2.Normal)
sdiff = SolidDifference(BrepsA=entrance_3, BrepsB=capsule1500)
amp_2 = Amplitude(Vector=rev_3, Amplitude=window_offset_wall_2)
extr_2 = Extrude(Base=srf, Direction=amp_2)
door_3 = Brep(sdiff)
Y = UnitY(Factor=1)
X = UnitX(Factor=1)
sdiff_2 = SolidDifference(BrepsA=capsule1500, BrepsB=extr_2)
capsule1500_2 = ClusterOutput(capsule1500)
door_4 = ClusterOutput(door_3)
srf_2 = ClusterOutput(srf)
contour = Contour(Shape=sdiff_2, Point=Point(0, 0, 0), Direction=Y, Distance=contourdistance_2)
contour_2 = Contour(Shape=sdiff_2, Point=Point(0, 0, 0), Direction=X, Distance=contourdistance_2)
capsule1200 = Brep(sdiff_2)
trim_4 = TrimTree(Tree=contour, Depth=1)
trim_5 = TrimTree(Tree=contour_2, Depth=1)
capsule1200_2 = ClusterOutput(capsule1200)
merge = Merge(Data1=trim_4, Data2=trim_5)
explode = Explode(Curve=merge, Recursive=True)  # -> Segments, Vertices
filtertype = FilterByType(ObjectType="Line", Geometry=explode.Segments, invertFilter=False, returnNulls=False)  # -> ExcludedGeometry, IncludedGeometry
trim_6 = TrimTree(Tree=filtertype.ExcludedGeometry, Depth=1)
join = JoinCurves(Curves=trim_6, Preserve=False)
trim_7 = TrimTree(Tree=join, Depth=1)
trim_8 = TrimTree(Tree=trim_7, Depth=1)
ccx = CurveCurve(CurveA=trim_8, CurveB=graft(trim_8))  # -> Points, ParamsA, ParamsB
trim_9 = TrimTree(Tree=ccx.Points, Depth=1)
srf_cp = SurfaceClosestPoint(Point=trim_9, Surface=srf)  # -> Point, UVPoint, Distance
smaller = SmallerThan(FirstNumber=srf_cp.Distance, SecondNumber="0.001")  # -> SmallerThan, OrEqualTo
contours1to200 = Curve(merge)
dispatch = Dispatch(List=trim_9, DispatchPattern=smaller.SmallerThan)  # -> ListA, ListB
contours1to200_2 = ClusterOutput(contours1to200)
brep_cp = BrepClosestPoint(Point=dispatch.ListB, Brep=capsule1200)  # -> Point, Normal, Distance
trim_10 = TrimTree(Tree=brep_cp.Point, Depth=1)
trim_11 = TrimTree(Tree=brep_cp.Normal, Depth=1)
pl = PlaneNormal(Origin=trim_10, ZAxis=trim_11)
cir = Circle(Plane=pl, Radius=expression)
bolts = Circle(cir)
bolts_2 = ClusterOutput(bolts)

# ==== cluster BoxSubD
box = ClusterInput()
box_2 = Box(box)
mesh = MeshBrep(
    Brep=box_2,
    Settings={GridMaxCount=0, GridMinCount=16, JaggedSeams=False, MaxEdgeLength=0, MinEdgeLength=0.0001, MinTolerance=0, Refine=True, RefineAngle=0, RelativeTolerance=0.65, SimplePlanes=True, Tolerance=0})
subdmesh = SubDFromMesh(Mesh=mesh, Creases=1, Corners=1, Interpolate=Toggle(False))
bbox = BoundingBox(Content=subdmesh, Plane=PlaneXY(0, 0, 0))  # -> Box, Box_2
trim = TrimTree(Tree=bbox.Box, Depth=1)
boxmap = BoxMapping(Geometry=subdmesh, Source=trim, Target=box_2)  # -> Geometry, Transform
subd = SubD(boxmap.Geometry)
subd_2 = ClusterOutput(subd)
