# Grasshopper definition kit.gh (Grasshopper 1.0.7)
# plug-ins: semio

list = ValueList({"1to500", "1to200"}, selected="1to500")
toggle = BooleanToggle(True)
curdir = CurrentDirectory()  # -> D, P, S
# ---------- curdir: Python ----------
#Component Information
#--------------------------------------------------------------------------------------------
if ghenv.Component.RunCount<2:
    #General
    #--------------------------------------------------------------------------------------------
    __author__ = "Ueli Saluz"
    __version__ = "2023.09.29"
    
    ghenv.Component.Name = "CurrentDirectory"
    ghenv.Component.NickName = "CurDir"
    ghenv.Component.Description = "Current directory of the current grasshopper file."
    ghenv.Component.Message = "VER 1.0"
    ghenv.Component.Category = "Params"
    ghenv.Component.SubCategory = "Util"
    
    #Outputs
    #--------------------------------------------------------------------------------------------
    outputIndex=0
    
    ghenv.Component.Params.Output[outputIndex].Name = "Directory"
    ghenv.Component.Params.Output[outputIndex].NickName = "D"
    ghenv.Component.Params.Output[outputIndex].Description = "Directory of the current grasshopper file."
    outputIndex+=1
    
    ghenv.Component.Params.Output[outputIndex].Name = "Path"
    ghenv.Component.Params.Output[outputIndex].NickName = "P"
    ghenv.Component.Params.Output[outputIndex].Description = "Path of the current grasshopper file."
    outputIndex+=1
    
    ghenv.Component.Params.Output[outputIndex].Name = "Separator"
    ghenv.Component.Params.Output[outputIndex].NickName = "S"
    ghenv.Component.Params.Output[outputIndex].Description = "Separator of the current system."
    outputIndex+=1

#Imports
#--------------------------------------------------------------------------------------------
from os.path import dirname
from os import sep

#Solver - Run with trees to enhance performance drastically
#--------------------------------------------------------------------------------------------
if __name__ == "__main__":
    P = ghenv.Component.OnPingDocument().FilePath
    D = dirname(P)
    S = sep
# ---------- end curdir ----------
kit = LoadKit(Run=toggle)  # -> Name, Description, Icon, Url, Types, Formations
trim = TrimTree(Tree=kit.Formations, Depth=1)
panel = Panel(trim)
item = ListItem(List=trim, Index=Slider(1, range=0..10), Wrap=True)
for = ModelFormation(Formation=item)  # -> Formation, Name, Description, Icon, Variant, Unit, Pieces, Attractions, Qualities
scn = GetScene(FormationName=for.Name, FormationVariant=for.Variant, Run=toggle)
scn_2 = FilterScene(Scene=scn, LevelOfDetails=list, Tags="volume", Formats=".3dm")  # -> Representations, Planes, PiecesIds, ParentsPiecesIds
load_geometry = LoadGeometry(rp=scn_2.Representations, pln=scn_2.Planes, di=curdir.D, sep=curdir.S)
semio_preview = SemioPreview(geo=load_geometry)

# ==== cluster LoadGeometry
di = ClusterInput()
sep = ClusterInput()
rp = ClusterInput()
pln = ClusterInput()

di_2 = FilePath(di)
sep_2 = Text(sep)
rp_2 = Representation(rp)
pln_2 = Plane(pln)
trim = TrimTree(Tree=pln_2, Depth=1)  # -> graft(Tree)
trim_2 = TrimTree(Tree=rp_2, Depth=1)
rep = ModelRepresentation(Representation=trim_2)  # -> Representation, Url, LevelOfDetail, Tags
concat = Concatenate(FragmentA=di_2, FragmentB=sep_2, FragmentC=rep.Url)
refbake = ReferenceByBakeName(FilePath=graft(concat), BakeName="*", Key="*", Val="*", lightweight=False)
trim_3 = TrimTree(Tree=refbake, Depth=1)
mtchanc = MatchAncestor(AT=trim, CT=graft(trim_3))  # -> MAT; inputs AT: tree, CT: tree
# ---------- mtchanc: Python ----------
if ghenv.Component.RunCount<2:
    __author__ = "Ueli Saluz"
    __version__ = "2022.04.25"
    
    ghenv.Component.Name = "Match Ancestor"
    ghenv.Component.NickName = "MtchAnc"
    ghenv.Component.Description = "Duplicates all elements of an ancestor tree to match the amount of elements in the child tree."
    ghenv.Component.Message = "VER 1.1"
    
    ghenv.Component.Params.Input[0].Name = "AncestorTree"
    ghenv.Component.Params.Input[0].NickName = "AT"
    ghenv.Component.Params.Input[0].Description = "Ancestor tree that data will the duplicated until it matches the child tree"
    ghenv.Component.Params.Input[0].Optional = False
    
    ghenv.Component.Params.Input[1].Name = "ChildTree"
    ghenv.Component.Params.Input[1].NickName = "CT"
    ghenv.Component.Params.Input[1].Description = "Child tree that branches will the guide to duplicat the data of the ancestor tree"
    ghenv.Component.Params.Input[0].Optional = False
    
    ghenv.Component.Params.Output[0].Name = "MatchedAncestorTree"
    ghenv.Component.Params.Output[0].NickName = "MAT"
    ghenv.Component.Params.Output[0].Description = "Matched ancestor tree with the amount of items and the branch paths of the child tree"

from System import Object
from Grasshopper import DataTree

"""Returns a new tree with the ancestor data being duplicated along all child branches which where child paths of that ancestor.
    Inputs:
        ancestorTree: Ancestor tree that data will the duplicated until it matches the child tree
        childTree: Child tree that branches will the guide to duplicat the data of the ancestor tree
    Output:
        matchedAncestorTree: Matched ancestor tree with the amount of items and the branch paths of the child tree"""
def MatchAncestorTreeToChildTree (ancestorTree, childTree):
    
    matchedAncestorTree = DataTree[Object]()
    dummy = 0
    for i,pathAncestor in enumerate(ancestorTree.Paths):
        branch = ancestorTree.Branch(pathAncestor)
        if len(branch)!=1:
            raise Exception("Ancestor must be grafted and containing one item per branch")
        #The item to be duplicated
        item = branch[0]
        for j,pathChild in enumerate(childTree.Paths):
            #Returns a tuple and not like in the documentation described a bool with a pointer to the int to store the generations
            checkAncestor = pathChild.IsAncestor(pathAncestor,dummy)
            if(checkAncestor[0]):
                matchedAncestorTree.AddRange([item]*childTree.Branch(pathChild).Count,pathChild)
    return matchedAncestorTree

if __name__ == "__main__":
    MAT = MatchAncestorTreeToChildTree (AT,CT)
# ---------- end mtchanc ----------
trim_4 = TrimTree(Tree=mtchanc, Depth=1)
transform = Transform(Geometry=trim_3, Transform=trim_4)
geo = Geometry(transform)

geo_2 = ClusterOutput(geo)

# ==== cluster SemioPreview
geo = ClusterInput()

geo_2 = Geometry(geo)
swatch = ColourSwatch(SwatchColor=RGB(0, 0, 0))
filtertype = FilterByType(ObjectType="Curve", Geometry=flatten(geo_2), invertFilter=False, returnNulls=False)  # -> ExcludedGeometry, IncludedGeometry
filtertype_2 = FilterByType(ObjectType="Brep", Geometry=flatten(geo_2), invertFilter=False, returnNulls=False)  # -> ExcludedGeometry, IncludedGeometry
debrep = DeconstructBrep(Brep=filtertype_2.IncludedGeometry)  # -> Faces, Edges, Vertices
preview = CustomPreview(Geometry=flatten(filtertype.IncludedGeometry), Material=swatch)
preview_2 = CustomPreview(Geometry=flatten(filtertype_2.IncludedGeometry), Material=ColourSwatch(SwatchColor=RGB(255, 255, 255)))
preview_3 = CustomPreview(Geometry=flatten(debrep.Edges), Material=swatch)
