# Grasshopper definition nakagincapsuletower.gh (Grasshopper 1.0.7)
# plug-ins: semio, eleFront

pln = Plane(Plane(origin=(16.54219356, -1.11520297, 0), x=(0.5971211751, 0, 0.802151047), y=(-0.6933560335, 0.5028547738, 0.5161341757)))
pln_2 = Plane(Plane(origin=(-30.53932401, 10.97645736, 0), x=(0, -1, 0), y=(-0.3410194715, 0, 0.9400562324)))
ty = Type([null x13])
remove_formations = BooleanToggle(False)
kit = CreateKit(
    Name="Metabolism",
    Explanation="Everything for metabolistic architecture.",
    Icon="🫀",
    Url="https://github.com/usalu/semio/examples/metabolism",
    Run=Toggle(False))
kit_2 = DeleteKit(Run=Toggle(False))
remove_types = BooleanToggle(False)
read_kit = BooleanToggle(True)
panel = Panel("Cylindric Shaft")
panel_2 = Panel("Cylindric Capital")
panel_3 = Panel("Capsule")
panel_4 = Panel("Base")
panel_5 = Panel("Capital")
panel_6 = Panel("Shaft")
panel_7 = Panel("The second tower (eleven storey) of the Nakagin Capule Tower.")
kit_3 = LoadKit(Run=read_kit)  # -> Name, Description, Icon, Url, Types, Formations
merge = Merge()
typ = ModelType(Type=kit_3.Types)  # -> Type, Name, Description, Icon, Variant, Unit, Representations, Ports, Qualities
rep = ModelRepresentation(Representation=typ.Representations)  # -> Representation, Url, LoD, Tags
qlt = ModelQuality(Quality=typ.Qualities)  # -> Quality, Name, Value, Unit
por = ModelPort(Port=typ.Ports)  # -> Port, Id, Plane, Locators
for = ModelFormation(Formation=kit_3.Formations)  # -> Formation, Name, Description, Icon, Variant, Unit, Pieces, Attractions, Qualities
panel_8 = Panel(typ.Type)
tmatch = MatchText(Text=typ.Name, Pattern="*", Case=True)
for_2 = RemoveFormation(FormationName=for.Name, FormationVariant=for.Variant, Run=remove_formations)
cull = CullPattern(List=kit_3.Types, CullPattern=tmatch)
typ_2 = ModelType(Type=cull)  # -> Type, Name, Description, Icon, Variant, Unit, Representations, Ports, Qualities

_1_to_500_or_200 = BooleanToggle(False)
cylindric = BooleanToggle(False)
futuristic = BooleanToggle(False)
run = BooleanToggle(True)

multiple_roots = BooleanToggle(False)
list = ValueList({"Full": 0, "First Tower": 1, "Second Tower": 2, "Multiple roots": 3}, selected="Full")
panel_9 = Panel(typ_2.Type)
typ_3 = RemoveType(TypeName=typ_2.Name, TypeVariant=typ_2.Variant, Run=remove_types)
filter = StreamFilter(Gate=_1_to_500_or_200, Stream0="1to500", Stream1="1to200")
toggle = BooleanToggle(False)  # disabled
swatch = ColourSwatch(SwatchColor=RGB(0, 0, 0))

# ---- group: No impact on design. Only on drawing of diagram.
diagram_piece_diameter = Panel("40")
expression = Expression(x=diagram_piece_diameter, Expression="x/2")
addition = Addition(A=diagram_piece_diameter, B=Slider(10, range=0..10))
multiplication = Multiplication(A=diagram_piece_diameter, B=Slider(2, range=0..10))
neg = Negative(Value=multiplication)
neg_2 = Negative(Value=addition)
neg_3 = Negative(Value=addition)
model_screen_point = ModelScreenPoint(X=addition, Y=neg)  # -> ScreenPoint, X, Y
addition_2 = Addition(A=model_screen_point.Y, B=neg)
addition_3 = Addition(A=model_screen_point.Y, B=neg)
model_screen_point_2 = ModelScreenPoint(X=model_screen_point.X, Y=addition_2)  # -> ScreenPoint, X, Y
addition_4 = Addition(A=model_screen_point_2.X, B=multiplication)
series = Series(Start=addition_4, Step=addition, Count="8")
trim = TrimTree(Tree=series, Depth=1)
model_screen_point_3 = ModelScreenPoint(X=neg_2, Y=neg)  # -> ScreenPoint, X, Y
model_screen_point_4 = ModelScreenPoint(X=model_screen_point_3.X, Y=addition_3)  # -> ScreenPoint, X, Y
subtraction = Subtraction(A=model_screen_point_4.X, B=multiplication)
series_2 = Series(Start=subtraction, Step=neg_2, Count="8")
trim_2 = TrimTree(Tree=series_2, Depth=1)

# ----
ids = RandomIds(Count=1, Seed=0, UniqueComponent=True)
ids_2 = RandomIds(Count=1, Seed=0, UniqueComponent=True)
ids_3 = RandomIds(Count=1, Seed=0, UniqueComponent=True)
ids_4 = RandomIds(Count=1, Seed=0, UniqueComponent=True)
trim_3 = TrimTree(Tree=ids, Depth=1)
trim_4 = TrimTree(Tree=ids_2, Depth=1)
trim_5 = TrimTree(Tree=ids_3, Depth=1)
trim_6 = TrimTree(Tree=ids_4, Depth=1)
pce = ModelPiece(Id=trim_3, TypeName="Shaft", TypeVariant="1", RootPlane=pln_2, DiagramScreenPoint=model_screen_point.ScreenPoint)  # -> Piece, Id, TypeName, TypeVariant, RootPlane, DiagramScreenPoint
pce_2 = ModelPiece(Id=trim_4, TypeName="Shaft", TypeVariant="2", RootPlane=pln, DiagramScreenPoint=model_screen_point_3.ScreenPoint)  # -> Piece, Id, TypeName, TypeVariant, RootPlane, DiagramScreenPoint
pce_3 = ModelPiece(Id=trim_5, TypeName="Capital", DiagramScreenPoint=model_screen_point_4.ScreenPoint)  # -> Piece, Id, TypeName, TypeVariant, RootPlane, DiagramScreenPoint
pce_4 = ModelPiece(Id=trim_6, TypeName="Capital", DiagramScreenPoint=model_screen_point_2.ScreenPoint)  # -> Piece, Id, TypeName, TypeVariant, RootPlane, DiagramScreenPoint
sde = ModelSide(PieceId=pce_2.Id, PieceTypePortSpecifiers="t")  # -> Side, PieceId, PieceTypePortSpecifiers
sde_2 = ModelSide(PieceId=pce_3.Id)  # -> Side, PieceId, PieceTypePortSpecifiers
sde_3 = ModelSide(PieceId=pce.Id, PieceTypePortSpecifiers="t")  # -> Side, PieceId, PieceTypePortSpecifiers
sde_4 = ModelSide(PieceId=pce_4.Id)  # -> Side, PieceId, PieceTypePortSpecifiers
atr = ModelAttraction(AttractingSide=sde.Side, AttractedSide=sde_2.Side)  # -> Attraction, AttractingSide, AttractedSide
atr_2 = ModelAttraction(AttractingSide=sde_3.Side, AttractedSide=sde_4.Side)  # -> Attraction, AttractingSide, AttractedSide

concat = Concatenate(FragmentD="b", FragmentC="_", FragmentA="s", FragmentB="2")
concat_2 = Concatenate(FragmentD=concat, FragmentC="_", FragmentA="c")
concat_3 = Concatenate(FragmentD="b", FragmentC="_", FragmentA="s", FragmentB="1")
concat_4 = Concatenate(FragmentD=concat_3, FragmentC="_", FragmentA="c")
pce_5 = ModelPiece(Id="b", TypeName="Base")  # -> Piece, Id, TypeName, TypeVariant, RootPlane, DiagramScreenPoint
pce_6 = ModelPiece(Id=concat_3, TypeName="Shaft", TypeVariant="1", DiagramScreenPoint=model_screen_point.ScreenPoint)  # -> Piece, Id, TypeName, TypeVariant, RootPlane, DiagramScreenPoint
pce_7 = ModelPiece(Id=concat, TypeName="Shaft", TypeVariant="2", DiagramScreenPoint=model_screen_point_3.ScreenPoint)  # -> Piece, Id, TypeName, TypeVariant, RootPlane, DiagramScreenPoint
pce_8 = ModelPiece(Id=concat_2, TypeName="Capital", DiagramScreenPoint=model_screen_point_4.ScreenPoint)  # -> Piece, Id, TypeName, TypeVariant, RootPlane, DiagramScreenPoint
pce_9 = ModelPiece(Id=concat_4, TypeName="Capital", DiagramScreenPoint=model_screen_point_2.ScreenPoint)  # -> Piece, Id, TypeName, TypeVariant, RootPlane, DiagramScreenPoint
core = Panel("c")
concat_5 = Concatenate(FragmentA=core, FragmentB="-", FragmentC="0")
concat_6 = Concatenate(FragmentA=core, FragmentB="-", FragmentC="1")
bottom = Panel("b")
top = Panel("t")
sde_5 = ModelSide(PieceId=pce_5.Id, PieceTypePortId=concat_6)  # -> Side, PieceId, PieceTypePortId
sde_6 = ModelSide(PieceId=pce_7.Id, PieceTypePortId=bottom)  # -> Side, PieceId, PieceTypePortId
sde_7 = ModelSide(PieceId=pce_5.Id, PieceTypePortId=concat_5)  # -> Side, PieceId, PieceTypePortId
sde_8 = ModelSide(PieceId=pce_6.Id, PieceTypePortId=bottom)  # -> Side, PieceId, PieceTypePortId
sde_9 = ModelSide(PieceId=pce_9.Id)  # -> Side, PieceId, PieceTypePortId
sde_10 = ModelSide(PieceId=pce_7.Id, PieceTypePortId=top)  # -> Side, PieceId, PieceTypePortId
sde_11 = ModelSide(PieceId=pce_6.Id, PieceTypePortId=top)  # -> Side, PieceId, PieceTypePortId
sde_12 = ModelSide(PieceId=pce_8.Id)  # -> Side, PieceId, PieceTypePortId
atr_3 = ModelAttraction(AttractingSide=sde_10.Side, AttractedSide=sde_12.Side)  # -> Attraction, AttractingSide, AttractedSide
atr_4 = ModelAttraction(AttractingSide=sde_5.Side, AttractedSide=sde_6.Side)  # -> Attraction, AttractingSide, AttractedSide
atr_5 = ModelAttraction(AttractingSide=sde_7.Side, AttractedSide=sde_8.Side)  # -> Attraction, AttractingSide, AttractedSide
atr_6 = ModelAttraction(AttractingSide=sde_11.Side, AttractedSide=sde_9.Side)  # -> Attraction, AttractingSide, AttractedSide

merge_2 = Merge(Data3=atr.Attraction, Data4=atr_2.Attraction)
merge_3 = Merge(Data2=pce_2.Piece, Data3=pce.Piece, Data4=pce_3.Piece, Data5=pce_4.Piece)
merge_4 = Merge(Data1=atr_4.Attraction, Data2=atr_5.Attraction, Data3=atr_6.Attraction, Data4=atr_3.Attraction)
merge_5 = Merge(Data1=pce_5.Piece, Data2=pce_7.Piece, Data3=pce_6.Piece, Data4=pce_8.Piece, Data5=pce_9.Piece)
merge_6 = Merge(Data1=pce_7.Id, Data2=pce_9.Id)

genes = GenePool(Decimals=0, Maximum=8, Minimum=0, Value=[0, 0, 0, 0, 0, 0, 0, 0, 0])
genes_2 = GenePool(Decimals=0, Maximum=8, Minimum=0, Value=[6, 6, 6, 6, 6, 6, 6, 6, 6])
genes_3 = GenePool(Decimals=0, Maximum=8, Minimum=0, Value=[6, 0, 0, 6, 6, 3, 3, 6, 0])
genes_4 = GenePool(Decimals=0, Maximum=8, Minimum=0, Value=[0, 1, 2, 3, 4, 5, 6, 7, 8])

# ---- group: No impact on design. Only on drawing of diagram. (continued)
expression_2 = Expression(x="9", Expression="x/2")
multiplication_2 = Multiplication(A=expression_2, B=neg_2)
addition_5 = Addition(A=model_screen_point_3.Y, B=multiplication_2, C=expression)
model_screen_point_5 = ModelScreenPoint(X=trim, Y=addition_5)  # -> ScreenPoint, X, Y

# ----
genes_5 = GenePool(Decimals=0, Maximum=8, Minimum=0, Value=[0, 0, 0, 0, 0, 0, 0, 0, 0])
genes_6 = GenePool(Decimals=0, Maximum=8, Minimum=0, Value=[6, 6, 6, 6, 6, 6, 6, 6, 6])
genes_7 = GenePool(Decimals=0, Maximum=8, Minimum=0, Value=[6, 0, 0, 6, 6, 3, 3, 6, 0])
genes_8 = GenePool(Decimals=0, Maximum=8, Minimum=0, Value=[0, 1, 2, 3, 4, 5, 6, 7, 8])
tower = Tower(
    number_of_floors="9",
    shaftpieceid=pce.Id,
    capsulepatternnortheast=genes_5,
    capsulepatternsoutheast=genes_6,
    capsulepatternsouthwest=genes_7,
    capsulepatternnorthwest=genes_8,
    diagramstarts=model_screen_point_5.ScreenPoint,
    diagramverticaldirection=addition)  # -> pc_2, at_2

tower_2 = Tower(
    number_of_floors="9",
    shaftpieceid=pce_6.Id,
    capsulepatternnortheast=genes,
    capsulepatternsoutheast=genes_2,
    capsulepatternsouthwest=genes_3,
    capsulepatternnorthwest=genes_4,
    diagramstarts=model_screen_point_5.ScreenPoint,
    diagramverticaldirection=addition)  # -> pc_2, at_2

merge_7 = Merge(Data1=atr_6.Attraction, Data2=tower_2.at_2)
merge_8 = Merge(Data1=pce_6.Piece, Data2=pce_9.Piece, Data3=tower_2.pc_2)
for_3 = ModelFormation(
    Name="Capsule Tower",
    Description="The first tower (nine storey) of the Nakagin Capule Tower.",
    Icon="📚9",
    Variant="1",
    Pieces=merge_8,
    Attractions=merge_7)  # -> Formation, Name, Description, Icon, Variant, Unit, Pieces, Attractions, Qualities

genes_9 = GenePool(Decimals=0, Maximum=8, Minimum=0, Value=[0, 0, 0, 0, 0, 0, 0, 0, 0, 0, 0])
genes_10 = GenePool(Decimals=0, Maximum=8, Minimum=0, Value=[6, 0, 0, 0, 6, 6, 0, 6, 0, 6, 3])
genes_11 = GenePool(Decimals=0, Maximum=8, Minimum=0, Value=[6, 6, 6, 6, 6, 6, 6, 6, 6, 6, 6])
genes_12 = GenePool(Decimals=0, Maximum=8, Minimum=0, Value=[8, 8, 8, 8, 8, 8, 8, 8, 8, 8, 8])

genes_13 = GenePool(Decimals=0, Maximum=8, Minimum=0, Value=[0, 0, 0, 0, 0, 0, 0, 0, 0, 0, 0])
genes_14 = GenePool(Decimals=0, Maximum=8, Minimum=0, Value=[6, 0, 0, 0, 6, 6, 0, 6, 0, 6, 3])
genes_15 = GenePool(Decimals=0, Maximum=8, Minimum=0, Value=[6, 6, 6, 6, 6, 6, 6, 6, 6, 6, 6])
genes_16 = GenePool(Decimals=0, Maximum=8, Minimum=0, Value=[8, 8, 8, 8, 8, 8, 8, 8, 8, 8, 8])

# ---- group: No impact on design. Only on drawing of diagram. (continued)
expression_3 = Expression(x="11", Expression="x/2")
multiplication_3 = Multiplication(A=expression_3, B=neg_2)
addition_6 = Addition(A=model_screen_point.Y, B=multiplication_3, C=expression)
model_screen_point_6 = ModelScreenPoint(X=trim_2, Y=addition_6)  # -> ScreenPoint, X, Y

# ----
tower_3 = Tower(
    number_of_floors="11",
    shaftpieceid=pce_2.Id,
    capsulepatternnortheast=genes_9,
    capsulepatternsoutheast=genes_11,
    capsulepatternsouthwest=genes_12,
    capsulepatternnorthwest=genes_10,
    diagramstarts=model_screen_point_6.ScreenPoint,
    diagramverticaldirection=addition)  # -> pc_2, at_2

tower_4 = Tower(
    number_of_floors="11",
    shaftpieceid=pce_7.Id,
    capsulepatternnortheast=genes_13,
    capsulepatternsoutheast=genes_15,
    capsulepatternsouthwest=genes_16,
    capsulepatternnorthwest=genes_14,
    diagramstarts=model_screen_point_6.ScreenPoint,
    diagramverticaldirection=addition)  # -> pc_2, at_2

merge_9 = Merge(Data1=atr_3.Attraction, Data2=tower_4.at_2)
merge_10 = Merge(Data1=pce_7.Piece, Data2=pce_8.Piece, Data3=tower_4.pc_2)
merge_11 = Merge(Data1=tower_4.pc_2, Data2=tower_2.pc_2)
merge_12 = Merge(Data1=tower_4.at_2, Data2=tower_2.at_2)
merge_13 = Merge(Data1=merge_2, Data3=tower_3.at_2, Data4=tower.at_2)
merge_14 = Merge(Data1=merge_3, Data2=tower_3.pc_2, Data3=tower.pc_2)
for_4 = ModelFormation(Name="Capsule Tower", Description=panel_7, Icon="📚11", Variant="2", Pieces=merge_10, Attractions=merge_9)  # -> Formation, Name, Description, Icon, Variant, Unit, Pieces, Attractions, Qualities
item = ListItem(List=merge_12, Index=0, Wrap=True)
merge_15 = Merge(Data1=merge_5, Data2=merge_11)
item_2 = ListItem(List=merge_11, Index=0, Wrap=True)
merge_16 = Merge(Data1=merge_4, Data2=merge_12)
for_5 = ModelFormation(
    Name="Nakagin Capsule Tower",
    Description="The former Nakagin Capsule Tower from Tokyio.",
    Icon="🏯2",
    Variant="2",
    Pieces=merge_14,
    Attractions=merge_13)  # -> Formation, Name, Description, Icon, Variant, Unit, Pieces, Attractions, Qualities
for_6 = ModelFormation(
    Name="Nakagin Capsule Tower",
    Description="The former Nakagin Capsule Tower from Tokyio.",
    Icon="🏯",
    Pieces=merge_15,
    Attractions=merge_16)  # -> Formation, Name, Description, Icon, Variant, Unit, Pieces, Attractions, Qualities
replacetypeinformation = ReplaceTypeInFormation(fo=for_6.Formation, old_type_name="Capsule", new_type_name="Futuristic Capsule")
for_7 = ModelFormation(Formation=for_6.Formation)  # -> Formation, Name, Description, Icon, Variant, Unit, Pieces, Attractions, Qualities
lng = ListLength(List=for_7.Pieces)
for_8 = SerializeFormation(Formation=for_6.Formation)
series_3 = Series(Start=Slider(1, range=0..1), Step=1, Count=lng)
filter_2 = StreamFilter(Gate=futuristic, Stream0=for_6.Formation, Stream1=replacetypeinformation)
replacetypeinformation_2 = ReplaceTypeInFormation(fo=filter_2, old_type_name="Shaft", new_type_name="Cylindric Shaft")
pce_10 = ModelPiece(Piece=for_7.Pieces)  # -> Piece, Id, TypeName, TypeVariant, RootPlane, DiagramScreenPoint
filter_3 = StreamFilter(Gate=cylindric, Stream0=filter_2, Stream1=replacetypeinformation_2)
replacetypeinformation_3 = ReplaceTypeInFormation(fo=filter_3, old_type_name="Capital", new_type_name="Cylindric Capital")
filter_4 = StreamFilter(Gate=cylindric, Stream0=filter_3, Stream1=replacetypeinformation_3)
txt = DecodeText(EncodedText=for_8)
trim_7 = TrimTree(Tree=series_3, Depth=1)
filter_5 = StreamFilter(Gate=list, Stream0=filter_4, Stream1=for_3.Formation, Stream2=for_4.Formation, Stream3=for_5.Formation)
for_9 = ModelFormation(Formation=filter_5)  # -> Formation, Name, Description, Icon, Variant, Unit, Pieces, Attractions, Qualities
rename_pieces = RenamePieces(fo=for_6.Formation, new_piece_names=trim_7)
for_10 = RemoveFormation(FormationName=for_9.Name, FormationVariant=for_9.Variant, Run=run)
or = GateOr(A=run, B=for_10)
remove_pieces = RemovePieces(fo=for_6.Formation, ids=merge_6)  # -> fo_4, removed_pieces_2, removed_attractions_2
for_11 = AddFormation(Formation=for_9.Formation, Run=or)
scn = GetScene(FormationName=for_9.Name, FormationVariant=for_9.Variant, Run=run)
scn_2 = FilterScene(Scene=scn, LevelOfDetails=filter, Tags="volume", Formats=".3dm")  # -> Representations, Planes, PiecesIds, ParentsPiecesIds

rp = Representation(scn_2.Representations)
pln_3 = Plane(scn_2.Planes)
trim_8 = TrimTree(Tree=pln_3, Depth=1)  # -> graft(Tree)
trim_9 = TrimTree(Tree=rp, Depth=1)
rep_2 = ModelRepresentation(Representation=trim_9)  # -> Representation, Url, LevelOfDetail, Tags
box = DomainBox(Base=PlaneXY(0, 0, 0), X=Domain(-2, 2), Y=Domain(-0.5, 0.5), Z=Domain(0, 0.25))
pl2pl = MoveObjectPlaneToPlane(G=box, S=PlaneXY(0, 0, 0), T=trim_8)  # -> TG, T; inputs S: Plane, T: Plane
# ---------- pl2pl: Python ----------
#Component Information
#--------------------------------------------------------------------------------------------
if ghenv.Component.RunCount<2:
    #General
    #--------------------------------------------------------------------------------------------
    __author__ = "Ueli Saluz"
    __version__ = "2023.02.12"
    
    ghenv.Component.Name = "MoveObjectPlaneToPlane"
    ghenv.Component.NickName = "Pl2Pl"
    ghenv.Component.Description = "Moves abitrary geometry from a source plane to a target plane."
    ghenv.Component.Message = "VER 1.2"
    ghenv.Component.Category = "Transform"
    ghenv.Component.SubCategory = "Euclidean"
    
     #Inputs
    #--------------------------------------------------------------------------------------------
    inputIndex=0
    
    ghenv.Component.Params.Input[inputIndex].Name = "Geometry"
    ghenv.Component.Params.Input[inputIndex].NickName = "G"
    ghenv.Component.Params.Input[inputIndex].Description = "Geometry to move."
    ghenv.Component.Params.Input[inputIndex].Optional = False
    inputIndex+=1
    
    ghenv.Component.Params.Input[inputIndex].Name = "SourcePlane"
    ghenv.Component.Params.Input[inputIndex].NickName = "S"
    ghenv.Component.Params.Input[inputIndex].Description = "Source plane of object."
    ghenv.Component.Params.Input[inputIndex].Optional = False
    inputIndex+=1
    
    ghenv.Component.Params.Input[inputIndex].Name = "TargetPlane"
    ghenv.Component.Params.Input[inputIndex].NickName = "T"
    ghenv.Component.Params.Input[inputIndex].Description = "Target plane of object."
    ghenv.Component.Params.Input[inputIndex].Optional = False
    inputIndex+=1
    
    #Outputs
    #--------------------------------------------------------------------------------------------
    outputIndex=0
    
    ghenv.Component.Params.Output[outputIndex].Name = "TranslatedGeometry"
    ghenv.Component.Params.Output[outputIndex].NickName = "TG"
    ghenv.Component.Params.Output[outputIndex].Description = "Translated geometry in target plane."
    outputIndex+=1
    
    ghenv.Component.Params.Output[outputIndex].Name = "Trasnform"
    ghenv.Component.Params.Output[outputIndex].NickName = "T"
    ghenv.Component.Params.Output[outputIndex].Description = "Transform describing translation form source to target plane."
    outputIndex+=1


#Imports
#--------------------------------------------------------------------------------------------
import Rhino.Geometry.Transform as trsf

def MvObjPlnToPln (geo,plnObj,plnDest):
    transform = trsf.PlaneToPlane(plnObj,plnDest)
    geo.Transform(transform)
    return (geo,transform)

TG, T = MvObjPlnToPln(G,S,T)
# ---------- end pl2pl ----------
curdir = CurrentDirectory()  # -> D, P, S
# ---------- curdir: Python ----------
#Component Information
#--------------------------------------------------------------------------------------------
if ghenv.Component.RunCount<2:
    #General
    #--------------------------------------------------------------------------------------------
    __author__ = "Ueli Saluz"
    __version__ = "2023.09.29"
    
    ghenv.Component.Name = "CurrentDirectory"
    ghenv.Component.NickName = "CurDir"
    ghenv.Component.Description = "Current directory of the current grasshopper file."
    ghenv.Component.Message = "VER 1.0"
    ghenv.Component.Category = "Params"
    ghenv.Component.SubCategory = "Util"
    
    #Outputs
    #--------------------------------------------------------------------------------------------
    outputIndex=0
    
    ghenv.Component.Params.Output[outputIndex].Name = "Directory"
    ghenv.Component.Params.Output[outputIndex].NickName = "D"
    ghenv.Component.Params.Output[outputIndex].Description = "Directory of the current grasshopper file."
    outputIndex+=1
    
    ghenv.Component.Params.Output[outputIndex].Name = "Path"
    ghenv.Component.Params.Output[outputIndex].NickName = "P"
    ghenv.Component.Params.Output[outputIndex].Description = "Path of the current grasshopper file."
    outputIndex+=1
    
    ghenv.Component.Params.Output[outputIndex].Name = "Separator"
    ghenv.Component.Params.Output[outputIndex].NickName = "S"
    ghenv.Component.Params.Output[outputIndex].Description = "Separator of the current system."
    outputIndex+=1

#Imports
#--------------------------------------------------------------------------------------------
from os.path import dirname
from os import sep

#Solver - Run with trees to enhance performance drastically
#--------------------------------------------------------------------------------------------
if __name__ == "__main__":
    P = ghenv.Component.OnPingDocument().FilePath
    D = dirname(P)
    S = sep
# ---------- end curdir ----------
concat_7 = Concatenate(FragmentA=curdir.D, FragmentB=curdir.S, FragmentC=rep_2.Url)
refbake = ReferenceByBakeName(FilePath=graft(concat_7), BakeName="*", Key="*", Val="*", lightweight=False)
trim_10 = TrimTree(Tree=refbake, Depth=1)  # -> graft(Tree)
mtchanc = MatchAncestor(AT=pl2pl.T, CT=trim_10)  # -> MAT; inputs AT: tree, CT: tree
# ---------- mtchanc: Python ----------
if ghenv.Component.RunCount<2:
    __author__ = "Ueli Saluz"
    __version__ = "2022.04.25"
    
    ghenv.Component.Name = "Match Ancestor"
    ghenv.Component.NickName = "MtchAnc"
    ghenv.Component.Description = "Duplicates all elements of an ancestor tree to match the amount of elements in the child tree."
    ghenv.Component.Message = "VER 1.1"
    
    ghenv.Component.Params.Input[0].Name = "AncestorTree"
    ghenv.Component.Params.Input[0].NickName = "AT"
    ghenv.Component.Params.Input[0].Description = "Ancestor tree that data will the duplicated until it matches the child tree"
    ghenv.Component.Params.Input[0].Optional = False
    
    ghenv.Component.Params.Input[1].Name = "ChildTree"
    ghenv.Component.Params.Input[1].NickName = "CT"
    ghenv.Component.Params.Input[1].Description = "Child tree that branches will the guide to duplicat the data of the ancestor tree"
    ghenv.Component.Params.Input[0].Optional = False
    
    ghenv.Component.Params.Output[0].Name = "MatchedAncestorTree"
    ghenv.Component.Params.Output[0].NickName = "MAT"
    ghenv.Component.Params.Output[0].Description = "Matched ancestor tree with the amount of items and the branch paths of the child tree"

from System import Object
from Grasshopper import DataTree

"""Returns a new tree with the ancestor data being duplicated along all child branches which where child paths of that ancestor.
    Inputs:
        ancestorTree: Ancestor tree that data will the duplicated until it matches the child tree
        childTree: Child tree that branches will the guide to duplicat the data of the ancestor tree
    Output:
        matchedAncestorTree: Matched ancestor tree with the amount of items and the branch paths of the child tree"""
def MatchAncestorTreeToChildTree (ancestorTree, childTree):
    
    matchedAncestorTree = DataTree[Object]()
    dummy = 0
    for i,pathAncestor in enumerate(ancestorTree.Paths):
        branch = ancestorTree.Branch(pathAncestor)
        if len(branch)!=1:
            raise Exception("Ancestor must be grafted and containing one item per branch")
        #The item to be duplicated
        item = branch[0]
        for j,pathChild in enumerate(childTree.Paths):
            #Returns a tuple and not like in the documentation described a bool with a pointer to the int to store the generations
            checkAncestor = pathChild.IsAncestor(pathAncestor,dummy)
            if(checkAncestor[0]):
                matchedAncestorTree.AddRange([item]*childTree.Branch(pathChild).Count,pathChild)
    return matchedAncestorTree

if __name__ == "__main__":
    MAT = MatchAncestorTreeToChildTree (AT,CT)
# ---------- end mtchanc ----------
trim_11 = TrimTree(Tree=mtchanc, Depth=1)
transform = Transform(Geometry=refbake, Transform=trim_11)
geo = Geometry(transform)

previewplane = PreviewPlane(plane=pln_3, axis_length=Slider(200, range=0..1000))
merge_17 = Merge(Data1=remove_pieces.fo_4, Data3=remove_pieces.removed_pieces_2, Data5=remove_pieces.removed_attractions_2)
panel_10 = Panel(merge_17)
filtertype = FilterByType(ObjectType="Brep", Geometry=flatten(geo), invertFilter=False, returnNulls=False)  # -> ExcludedGeometry, IncludedGeometry
filtertype_2 = FilterByType(ObjectType="Curve", Geometry=flatten(geo), invertFilter=False, returnNulls=False)  # -> ExcludedGeometry, IncludedGeometry
debrep = DeconstructBrep(Brep=filtertype.IncludedGeometry)  # -> Faces, Edges, Vertices
preview = CustomPreview(Geometry=flatten(filtertype.IncludedGeometry), Material=ColourSwatch(SwatchColor=RGB(255, 255, 255)))
preview_2 = CustomPreview(Geometry=flatten(filtertype_2.IncludedGeometry), Material=swatch)
preview_3 = CustomPreview(Geometry=flatten(debrep.Edges), Material=swatch)

# ==== cluster PreviewPlane: Preview a plane with axis colors and naming.
axis_length = ClusterInput()
plane = ClusterInput()
axis_length_2 = Number(axis_length)
plane_2 = Plane(plane)
deplane = DeconstructPlane(Plane=plane_2)  # -> Origin, XAxis, YAxis, ZAxis
line = LineSDL(Start=deplane.Origin, Direction=deplane.YAxis, Length=axis_length_2)
line_2 = LineSDL(Start=deplane.Origin, Direction=deplane.XAxis, Length=axis_length_2)
line_3 = LineSDL(Start=deplane.Origin, Direction=deplane.ZAxis, Length=axis_length_2)
swatch = ColourSwatch(SwatchColor=RGB(235, 52, 79))
swatch_2 = ColourSwatch(SwatchColor=RGB(0, 166, 157))
swatch_3 = ColourSwatch(SwatchColor=RGB(240, 117, 24))
end = EndPoints(Curve=line_2)  # -> Start, End
end_2 = EndPoints(Curve=line)  # -> Start, End
end_3 = EndPoints(Curve=line_3)  # -> Start, End
tag = TextTag(Location=end.End, Text="X", Colour=swatch)
tag_2 = TextTag(Location=end_2.End, Text="Y", Colour=swatch_2)
tag_3 = TextTag(Location=end_3.End, Text="Z", Colour=swatch_3)
preview = CustomPreview(Geometry=line_2, Material=swatch)
preview_2 = CustomPreview(Geometry=line, Material=swatch_2)
preview_3 = CustomPreview(Geometry=line_3, Material=swatch_3)

# ==== cluster Tower
diagramverticaldirection = ClusterInput()
number_of_floors = ClusterInput()
shaftpieceid = ClusterInput()
capsulepatternnortheast = ClusterInput()
capsulepatternsoutheast = ClusterInput()
capsulepatternsouthwest = ClusterInput()
capsulepatternnorthwest = ClusterInput()
diagramstarts = ClusterInput()
diagramverticaldirection_2 = Integer(diagramverticaldirection)
capsulepatternnorthwest_2 = Integer(capsulepatternnorthwest)
capsulepatternsoutheast_2 = Integer(capsulepatternsoutheast)
number_of_floors_2 = Integer(number_of_floors)
shaftpieceid_2 = Text(shaftpieceid)
capsulepatternsouthwest_2 = Integer(capsulepatternsouthwest)
diagramstarts_2 = ScreenPoint(diagramstarts)
item = ListItem(List=diagramstarts_2, Index=0, Wrap=True)  # -> Item, Item1, Item2, Item3, Item4, Item5, Item6, Item7
model_screen_point = ModelScreenPoint(ScreenPoint=item.Item)  # -> ScreenPoint, X, Y
model_screen_point_2 = ModelScreenPoint(ScreenPoint=item.Item2)  # -> ScreenPoint, X, Y
model_screen_point_3 = ModelScreenPoint(ScreenPoint=item.Item4)  # -> ScreenPoint, X, Y
model_screen_point_4 = ModelScreenPoint(ScreenPoint=item.Item1)  # -> ScreenPoint, X, Y
model_screen_point_5 = ModelScreenPoint(ScreenPoint=item.Item6)  # -> ScreenPoint, X, Y
model_screen_point_6 = ModelScreenPoint(ScreenPoint=item.Item3)  # -> ScreenPoint, X, Y
model_screen_point_7 = ModelScreenPoint(ScreenPoint=item.Item5)  # -> ScreenPoint, X, Y
model_screen_point_8 = ModelScreenPoint(ScreenPoint=item.Item7)  # -> ScreenPoint, X, Y
series = Series(Start=model_screen_point.Y, Step=diagramverticaldirection_2, Count=number_of_floors_2)
series_2 = Series(Start=model_screen_point_2.Y, Step=diagramverticaldirection_2, Count=number_of_floors_2)
series_3 = Series(Start=model_screen_point_3.Y, Step=diagramverticaldirection_2, Count=number_of_floors_2)
series_4 = Series(Start=model_screen_point_4.Y, Step=diagramverticaldirection_2, Count=number_of_floors_2)
series_5 = Series(Start=model_screen_point_5.Y, Step=diagramverticaldirection_2, Count=number_of_floors_2)
series_6 = Series(Start=model_screen_point_6.Y, Step=diagramverticaldirection_2, Count=number_of_floors_2)
series_7 = Series(Start=model_screen_point_7.Y, Step=diagramverticaldirection_2, Count=number_of_floors_2)
series_8 = Series(Start=model_screen_point_8.Y, Step=diagramverticaldirection_2, Count=number_of_floors_2)
trim = TrimTree(Tree=series, Depth=1)
trim_2 = TrimTree(Tree=series_2, Depth=1)
trim_3 = TrimTree(Tree=series_3, Depth=1)
trim_4 = TrimTree(Tree=series_4, Depth=1)
trim_5 = TrimTree(Tree=series_5, Depth=1)
trim_6 = TrimTree(Tree=series_6, Depth=1)
trim_7 = TrimTree(Tree=series_7, Depth=1)
trim_8 = TrimTree(Tree=series_8, Depth=1)
model_screen_point_9 = ModelScreenPoint(ScreenPoint=model_screen_point.ScreenPoint, Y=trim)  # -> graft(ScreenPoint), X, Y
model_screen_point_10 = ModelScreenPoint(ScreenPoint=model_screen_point_2.ScreenPoint, Y=trim_2)  # -> graft(ScreenPoint), X, Y
model_screen_point_11 = ModelScreenPoint(ScreenPoint=model_screen_point_3.ScreenPoint, Y=trim_3)  # -> graft(ScreenPoint), X, Y
model_screen_point_12 = ModelScreenPoint(ScreenPoint=model_screen_point_4.ScreenPoint, Y=trim_4)  # -> graft(ScreenPoint), X, Y
model_screen_point_13 = ModelScreenPoint(ScreenPoint=model_screen_point_5.ScreenPoint, Y=trim_5)  # -> graft(ScreenPoint), X, Y
model_screen_point_14 = ModelScreenPoint(ScreenPoint=model_screen_point_6.ScreenPoint, Y=trim_6)  # -> graft(ScreenPoint), X, Y
model_screen_point_15 = ModelScreenPoint(ScreenPoint=model_screen_point_7.ScreenPoint, Y=trim_7)  # -> graft(ScreenPoint), X, Y
model_screen_point_16 = ModelScreenPoint(ScreenPoint=model_screen_point_8.ScreenPoint, Y=trim_8)  # -> graft(ScreenPoint), X, Y
capsulepatternnortheast_2 = Integer(capsulepatternnortheast)
panel = Panel("""0
0
1
0
1
0
2
3
3""")
merge = Merge(Data1="1", Data2="3", Data3="5", Data4="7")
merge_2 = Merge(Data1="2", Data2="4", Data3="6", Data4="8")
panel_2 = Panel("""2
3
3
0
0
1
0
0
1""")

item_2 = ListItem(List=panel_2, Index=capsulepatternnortheast_2, Wrap=True)
capsuletypeeastleft = Integer(item_2)

item_3 = ListItem(List=panel, Index=capsulepatternnortheast_2, Wrap=True)
capsuletypenorthright = Integer(item_3)

item_4 = ListItem(List=panel, Index=capsulepatternsouthwest_2, Wrap=True)
capsuletypewestleft = Integer(item_4)
item_5 = ListItem(List=merge, Index=capsuletypewestleft, Wrap=True)  # -> graft(Item)

series_9 = Series(Start=0, Step=1, Count=number_of_floors_2)
trim_9 = TrimTree(Tree=series_9, Depth=1)  # -> graft(Tree)
door = Panel("d")
split_level = Panel("sl")
floor = Panel("f")
concat = Concatenate(FragmentA=floor, FragmentC="-", FragmentB=trim_9)

expression = Expression(x="2", y=trim_9, Expression="x")
concat_2 = Concatenate(FragmentA=door, FragmentC="-", FragmentB=expression)

item_6 = ListItem(List=panel_2, Index=capsulepatternsoutheast_2, Wrap=True)
capsuletypesouthleft = Integer(item_6)
item_7 = ListItem(List=merge, Index=capsuletypesouthleft, Wrap=True)  # -> graft(Item)

expression_2 = Expression(x="1", y=trim_9, Expression="x")
concat_3 = Concatenate(FragmentA=split_level, FragmentC="-", FragmentB=expression_2)

expression_3 = Expression(x="0", y=trim_9, Expression="x")
expression_4 = Expression(x="0", y=trim_9, Expression="x")

expression_5 = Expression(x="2", y=trim_9, Expression="x")
concat_4 = Concatenate(FragmentA=split_level, FragmentC="-", FragmentB=expression_5)

item_8 = ListItem(List=panel, Index=capsulepatternnorthwest_2, Wrap=True)
capsuletypenorthleft = Integer(item_8)
item_9 = ListItem(List=merge, Index=capsuletypenorthleft, Wrap=True)  # -> graft(Item)

item_10 = ListItem(List=merge, Index=capsuletypeeastleft, Wrap=True)  # -> graft(Item)

concat_5 = Concatenate(FragmentA=split_level, FragmentC="-", FragmentB=expression_3)
concat_6 = Concatenate(FragmentA=door, FragmentC="-", FragmentB=expression_4)
concat_7 = Concatenate(FragmentA=concat, FragmentD="#", FragmentB=concat_5, FragmentC="#", FragmentE=concat_6)
sde = ModelSide(PieceId=shaftpieceid_2, PieceTypePortId=concat_7)  # -> Side, PieceId, PieceTypePortId
concat_8 = Concatenate(FragmentA=shaftpieceid_2, FragmentB="_", FragmentD="c", FragmentE="#", FragmentC=concat_7)

pce = ModelPiece(Id=concat_8, TypeName="Capsule", TypeVariant=item_7, DiagramScreenPoint=model_screen_point_9.ScreenPoint)  # -> Piece, Id, TypeName, TypeVariant, RootPlane, DiagramScreenPoint
trim_10 = TrimTree(Tree=pce.Piece, Depth=1)
trim_11 = TrimTree(Tree=pce.Id, Depth=1)

sde_2 = ModelSide(PieceId=trim_11)  # -> Side, PieceId, PieceTypePortId

trim_12 = TrimTree(Tree=sde.Side, Depth=1)
atr = ModelAttraction(AttractingSide=trim_12, AttractedSide=sde_2.Side)  # -> Attraction, AttractingSide, AttractedSide

concat_9 = Concatenate(FragmentA=concat, FragmentD="#", FragmentB=concat_3, FragmentC="#", FragmentE=concat_6)
sde_3 = ModelSide(PieceId=shaftpieceid_2, PieceTypePortId=concat_9)  # -> Side, PieceId, PieceTypePortId
trim_13 = TrimTree(Tree=sde_3.Side, Depth=1)

concat_10 = Concatenate(FragmentA=shaftpieceid_2, FragmentB="_", FragmentD="c", FragmentE="#", FragmentC=concat_9)
pce_2 = ModelPiece(Id=concat_10, TypeName="Capsule", TypeVariant=item_9, DiagramScreenPoint=model_screen_point_11.ScreenPoint)  # -> Piece, Id, TypeName, TypeVariant, RootPlane, DiagramScreenPoint
trim_14 = TrimTree(Tree=pce_2.Id, Depth=1)
trim_15 = TrimTree(Tree=pce_2.Piece, Depth=1)

sde_4 = ModelSide(PieceId=trim_14)  # -> Side, PieceId, PieceTypePortId
atr_2 = ModelAttraction(AttractingSide=trim_13, AttractedSide=sde_4.Side)  # -> Attraction, AttractingSide, AttractedSide

concat_11 = Concatenate(FragmentA=concat, FragmentD="#", FragmentB=concat_4, FragmentC="#", FragmentE=concat_6)
sde_5 = ModelSide(PieceId=shaftpieceid_2, PieceTypePortId=concat_11)  # -> Side, PieceId, PieceTypePortId
trim_16 = TrimTree(Tree=sde_5.Side, Depth=1)

concat_12 = Concatenate(FragmentA=shaftpieceid_2, FragmentB="_", FragmentD="c", FragmentE="#", FragmentC=concat_11)
pce_3 = ModelPiece(Id=concat_12, TypeName="Capsule", TypeVariant=item_5, DiagramScreenPoint=model_screen_point_13.ScreenPoint)  # -> Piece, Id, TypeName, TypeVariant, RootPlane, DiagramScreenPoint
trim_17 = TrimTree(Tree=pce_3.Id, Depth=1)
trim_18 = TrimTree(Tree=pce_3.Piece, Depth=1)

sde_6 = ModelSide(PieceId=trim_17)  # -> Side, PieceId, PieceTypePortId
atr_3 = ModelAttraction(AttractingSide=trim_16, AttractedSide=sde_6.Side)  # -> Attraction, AttractingSide, AttractedSide

concat_13 = Concatenate(FragmentA=concat, FragmentD="#", FragmentB=concat_5, FragmentE="#", FragmentC=concat_2)
sde_7 = ModelSide(PieceId=shaftpieceid_2, PieceTypePortId=concat_13)  # -> Side, PieceId, PieceTypePortId
trim_19 = TrimTree(Tree=sde_7.Side, Depth=1)

concat_14 = Concatenate(FragmentA=shaftpieceid_2, FragmentB="_", FragmentD="c", FragmentE="#", FragmentC=concat_13)
pce_4 = ModelPiece(Id=concat_14, TypeName="Capsule", TypeVariant=item_10, DiagramScreenPoint=model_screen_point_10.ScreenPoint)  # -> Piece, Id, TypeName, TypeVariant, RootPlane, DiagramScreenPoint
trim_20 = TrimTree(Tree=pce_4.Piece, Depth=1)
trim_21 = TrimTree(Tree=pce_4.Id, Depth=1)

sde_8 = ModelSide(PieceId=trim_21)  # -> Side, PieceId, PieceTypePortId
atr_4 = ModelAttraction(AttractingSide=trim_19, AttractedSide=sde_8.Side)  # -> Attraction, AttractingSide, AttractedSide

item_11 = ListItem(List=panel_2, Index=capsulepatternnorthwest_2, Wrap=True)
capsuletypewestright = Integer(item_11)
item_12 = ListItem(List=merge_2, Index=capsuletypewestright, Wrap=True)  # -> graft(Item)

item_13 = ListItem(List=panel_2, Index=capsulepatternsouthwest_2, Wrap=True)
capsuletypesouthrigh = Integer(item_13)
item_14 = ListItem(List=merge_2, Index=capsuletypesouthrigh, Wrap=True)  # -> graft(Item)

expression_6 = Expression(x="3", y=trim_9, Expression="x")
concat_15 = Concatenate(FragmentA=door, FragmentC="-", FragmentB=expression_6)
concat_16 = Concatenate(FragmentA=concat, FragmentD="#", FragmentB=concat_5, FragmentC="#", FragmentE=concat_15)
sde_9 = ModelSide(PieceId=shaftpieceid_2, PieceTypePortId=concat_16)  # -> Side, PieceId, PieceTypePortId
trim_22 = TrimTree(Tree=sde_9.Side, Depth=1)

item_15 = ListItem(List=merge_2, Index=capsuletypenorthright, Wrap=True)  # -> graft(Item)
concat_17 = Concatenate(FragmentA=shaftpieceid_2, FragmentB="_", FragmentD="c", FragmentE="#", FragmentC=concat_16)
pce_5 = ModelPiece(Id=concat_17, TypeName="Capsule", TypeVariant=item_15, DiagramScreenPoint=model_screen_point_14.ScreenPoint)  # -> Piece, Id, TypeName, TypeVariant, RootPlane, DiagramScreenPoint
trim_23 = TrimTree(Tree=pce_5.Id, Depth=1)
trim_24 = TrimTree(Tree=pce_5.Piece, Depth=1)

sde_10 = ModelSide(PieceId=trim_23)  # -> Side, PieceId, PieceTypePortId
atr_5 = ModelAttraction(AttractingSide=trim_22, AttractedSide=sde_10.Side)  # -> Attraction, AttractingSide, AttractedSide

item_16 = ListItem(List=panel, Index=capsulepatternsoutheast_2, Wrap=True)
capsuletypeeastright = Integer(item_16)

expression_7 = Expression(x="1", y=trim_9, Expression="x")
concat_18 = Concatenate(FragmentA=door, FragmentC="-", FragmentB=expression_7)
concat_19 = Concatenate(FragmentA=concat, FragmentD="#", FragmentB=concat_5, FragmentC="#", FragmentE=concat_18)
sde_11 = ModelSide(PieceId=shaftpieceid_2, PieceTypePortId=concat_19)  # -> Side, PieceId, PieceTypePortId
trim_25 = TrimTree(Tree=sde_11.Side, Depth=1)

item_17 = ListItem(List=merge_2, Index=capsuletypeeastright, Wrap=True)  # -> graft(Item)
concat_20 = Concatenate(FragmentA=shaftpieceid_2, FragmentB="_", FragmentD="c", FragmentE="#", FragmentC=concat_19)
pce_6 = ModelPiece(Id=concat_20, TypeName="Capsule", TypeVariant=item_17, DiagramScreenPoint=model_screen_point_12.ScreenPoint)  # -> Piece, Id, TypeName, TypeVariant, RootPlane, DiagramScreenPoint
trim_26 = TrimTree(Tree=pce_6.Id, Depth=1)
trim_27 = TrimTree(Tree=pce_6.Piece, Depth=1)

sde_12 = ModelSide(PieceId=trim_26)  # -> Side, PieceId, PieceTypePortId

atr_6 = ModelAttraction(AttractingSide=trim_25, AttractedSide=sde_12.Side)  # -> Attraction, AttractingSide, AttractedSide

concat_21 = Concatenate(FragmentA=concat, FragmentD="#", FragmentB=concat_3, FragmentC="#", FragmentE=concat_18)
sde_13 = ModelSide(PieceId=shaftpieceid_2, PieceTypePortId=concat_21)  # -> Side, PieceId, PieceTypePortId
trim_28 = TrimTree(Tree=sde_13.Side, Depth=1)

concat_22 = Concatenate(FragmentA=shaftpieceid_2, FragmentB="_", FragmentD="c", FragmentE="#", FragmentC=concat_21)
pce_7 = ModelPiece(Id=concat_22, TypeName="Capsule", TypeVariant=item_12, DiagramScreenPoint=model_screen_point_15.ScreenPoint)  # -> Piece, Id, TypeName, TypeVariant, RootPlane, DiagramScreenPoint
trim_29 = TrimTree(Tree=pce_7.Id, Depth=1)
trim_30 = TrimTree(Tree=pce_7.Piece, Depth=1)

sde_14 = ModelSide(PieceId=trim_29)  # -> Side, PieceId, PieceTypePortId
atr_7 = ModelAttraction(AttractingSide=trim_28, AttractedSide=sde_14.Side)  # -> Attraction, AttractingSide, AttractedSide

concat_23 = Concatenate(FragmentA=concat, FragmentD="#", FragmentB=concat_4, FragmentC="#", FragmentE=concat_18)
sde_15 = ModelSide(PieceId=shaftpieceid_2, PieceTypePortId=concat_23)  # -> Side, PieceId, PieceTypePortId
trim_31 = TrimTree(Tree=sde_15.Side, Depth=1)

concat_24 = Concatenate(FragmentA=shaftpieceid_2, FragmentB="_", FragmentD="c", FragmentE="#", FragmentC=concat_23)
pce_8 = ModelPiece(Id=concat_24, TypeName="Capsule", TypeVariant=item_14, DiagramScreenPoint=model_screen_point_16.ScreenPoint)  # -> Piece, Id, TypeName, TypeVariant, RootPlane, DiagramScreenPoint
trim_32 = TrimTree(Tree=pce_8.Id, Depth=1)
trim_33 = TrimTree(Tree=pce_8.Piece, Depth=1)

sde_16 = ModelSide(PieceId=trim_32)  # -> Side, PieceId, PieceTypePortId
atr_8 = ModelAttraction(AttractingSide=trim_31, AttractedSide=sde_16.Side)  # -> Attraction, AttractingSide, AttractedSide

merge_3 = Merge(Data1=trim_10, Data2=trim_27, Data3=trim_20, Data4=trim_24, Data5=trim_15, Data6=trim_30, Data7=trim_18, Data8=trim_33)
merge_4 = Merge(
    Data1=atr.Attraction,
    Data2=atr_6.Attraction,
    Data3=atr_4.Attraction,
    Data4=atr_5.Attraction,
    Data5=atr_2.Attraction,
    Data6=atr_7.Attraction,
    Data7=atr_3.Attraction,
    Data8=atr_8.Attraction)
pc = Piece(merge_3)
at = Attraction(merge_4)
at_2 = ClusterOutput(at)
pc_2 = ClusterOutput(pc)

# ==== cluster ReplaceTypeInFormation
fo = ClusterInput()
old_type_name = ClusterInput()
new_type_name = ClusterInput()
fo_2 = Formation(fo)
old_type_name_2 = Text(old_type_name)
new_type_name_2 = Text(new_type_name)
for = ModelFormation(Formation=fo_2)  # -> Formation, Name, Description, Icon, Variant, Unit, Pieces, Attractions, Qualities
pce = ModelPiece(Piece=for.Pieces)  # -> Piece, Id, TypeName, TypeVariant, RootPlane, DiagramScreenPoint
tmatch = MatchText(Text=pce.TypeName, Pattern=old_type_name_2, Case=True)
dispatch = Dispatch(List=pce.Piece, DispatchPattern=tmatch)  # -> ListA, ListB
pce_2 = ModelPiece(Piece=dispatch.ListA, TypeName=new_type_name_2)  # -> Piece, Id, TypeName, TypeVariant, RootPlane, DiagramScreenPoint
merge = Merge(Data1=pce_2.Piece, Data2=dispatch.ListB)
for_2 = ModelFormation(Formation=fo_2, Pieces=merge)  # -> Formation, Name, Description, Icon, Variant, Unit, Pieces, Attractions, Qualities
fo_3 = Formation(for_2.Formation)
fo_4 = ClusterOutput(fo_3)

# ==== cluster RenamePieces
fo = ClusterInput()
new_piece_names = ClusterInput()
new_piece_names_2 = Text(new_piece_names)
fo_2 = Formation(fo)
for = ModelFormation(Formation=fo_2)  # -> Formation, Name, Description, Icon, Variant, Unit, Pieces, Attractions, Qualities
pce = ModelPiece(Piece=for.Pieces)  # -> Piece, Id, TypeName, TypeVariant, RootPlane, DiagramScreenPoint
atr = ModelAttraction(Attraction=for.Attractions)  # -> Attraction, AttractingSide, AttractedSide
sde = ModelSide(Side=atr.AttractingSide)  # -> Side, PieceId, PieceTypePortId
sde_2 = ModelSide(Side=atr.AttractedSide)  # -> Side, PieceId, PieceTypePortId
itemindex = ItemIndex(L=pce.Id, I=graft(sde.PieceId))  # -> i; inputs L: list
# ---------- itemindex: Python ----------
#Component Information
#--------------------------------------------------------------------------------------------
if ghenv.Component.RunCount<2:
    #General
    #--------------------------------------------------------------------------------------------
    __author__ = "Ueli Saluz"
    __version__ = "2022.11.18"
    
    ghenv.Component.Name = "ItemIndex"
    ghenv.Component.NickName = "ItemIndex"
    ghenv.Component.Description = "A better IdemIndex"
    ghenv.Component.Message = "VER 1.0"
    ghenv.Component.Category = "Set"
    ghenv.Component.SubCategory = "List"
    
     #Inputs
    #--------------------------------------------------------------------------------------------
    inputIndex=0
    
    ghenv.Component.Params.Input[inputIndex].Name = "List"
    ghenv.Component.Params.Input[inputIndex].NickName = "L"
    ghenv.Component.Params.Input[inputIndex].Description = "Input1 is..."
    ghenv.Component.Params.Input[inputIndex].Optional = False
    inputIndex+=1
    
    ghenv.Component.Params.Input[inputIndex].Name = "Item"
    ghenv.Component.Params.Input[inputIndex].NickName = "I"
    ghenv.Component.Params.Input[inputIndex].Description = "Input2 is..."
    ghenv.Component.Params.Input[inputIndex].Optional = False
    inputIndex+=1
    
    #Outputs
    #--------------------------------------------------------------------------------------------
    outputIndex=0
    
    ghenv.Component.Params.Output[outputIndex].Name = "Index"
    ghenv.Component.Params.Output[outputIndex].NickName = "i"
    ghenv.Component.Params.Output[outputIndex].Description = "Output1 is..."
    outputIndex+=1

i = L.index(I)
# ---------- end itemindex ----------
itemindex_2 = ItemIndex(L=pce.Id, I=graft(sde_2.PieceId))  # -> i; inputs L: list; same code as itemindex
item = ListItem(List=new_piece_names_2, Index=itemindex, Wrap=True)
item_2 = ListItem(List=new_piece_names_2, Index=itemindex_2, Wrap=True)
trim = TrimTree(Tree=item, Depth=1)
trim_2 = TrimTree(Tree=item_2, Depth=1)
sde_3 = ModelSide(Side=sde.Side, PieceId=trim)  # -> Side, PieceId, PieceTypePortId
sde_4 = ModelSide(Side=sde_2.Side, PieceId=trim_2)  # -> Side, PieceId, PieceTypePortId
pce_2 = ModelPiece(Piece=pce.Piece, Id=new_piece_names_2)  # -> Piece, Id, TypeName, TypeVariant, RootPlane, DiagramScreenPoint
atr_2 = ModelAttraction(Attraction=atr.Attraction, AttractingSide=sde_3.Side, AttractedSide=sde_4.Side)  # -> Attraction, AttractingSide, AttractedSide
for_2 = ModelFormation(Formation=for.Formation, Pieces=pce_2.Piece, Attractions=atr_2.Attraction)  # -> Formation, Name, Description, Icon, Variant, Unit, Pieces, Attractions, Qualities
fo_3 = Formation(for_2.Formation)
fo_4 = ClusterOutput(fo_3)

# ==== cluster RemovePieces
fo = ClusterInput()
ids = ClusterInput()
fo_2 = Formation(fo)
ids_2 = Text(ids)
for = ModelFormation(Formation=fo_2)  # -> Formation, Name, Description, Icon, Variant, Unit, Pieces, Attractions, Qualities

trim = TrimTree(Tree=for.Attractions, Depth=1)
atr = ModelAttraction(Attraction=trim)  # -> Attraction, AttractingSide, AttractedSide
sde = ModelSide(Side=atr.AttractedSide)  # -> Side, PieceId, PieceTypePortId
sde_2 = ModelSide(Side=atr.AttractingSide)  # -> Side, PieceId, PieceTypePortId
tmatch = MatchText(Text=graft(sde_2.PieceId), Pattern=ids_2, Case=True)
tmatch_2 = MatchText(Text=graft(sde.PieceId), Pattern=ids_2, Case=True)
ma = MassAddition(Input=tmatch)  # -> Result, PartialResults
ma_2 = MassAddition(Input=tmatch_2)  # -> Result, PartialResults
or = GateOr(A=ma.Result, B=ma_2.Result)
trim_2 = TrimTree(Tree=or, Depth=1)
dispatch = Dispatch(List=trim, DispatchPattern=trim_2)  # -> ListA, ListB

trim_3 = TrimTree(Tree=for.Pieces, Depth=1)
pce = ModelPiece(Piece=trim_3)  # -> Piece, Id, TypeName, TypeVariant, RootPlane, DiagramScreenPoint
tmatch_3 = MatchText(Text=graft(pce.Id), Pattern=ids_2, Case=True)
ma_3 = MassAddition(Input=tmatch_3)  # -> Result, PartialResults
trim_4 = TrimTree(Tree=ma_3.Result, Depth=1)
dispatch_2 = Dispatch(List=trim_3, DispatchPattern=trim_4)  # -> ListA, ListB

for_2 = ModelFormation(Formation=for.Formation, Pieces=dispatch_2.ListB, Attractions=dispatch.ListB)  # -> Formation, Name, Description, Icon, Variant, Unit, Pieces, Attractions, Qualities
fo_3 = Formation(for_2.Formation)
removed_pieces = Piece(dispatch_2.ListA)
removed_attractions = Attraction(dispatch.ListA)
fo_4 = ClusterOutput(fo_3)
removed_pieces_2 = ClusterOutput(removed_pieces)
removed_attractions_2 = ClusterOutput(removed_attractions)
