# Grasshopper definition blob-base.gh (Grasshopper 1.0.8)
# plug-ins: semio

save_representation = BooleanToggle(False)
icon_export = BooleanToggle(False)
save = BooleanToggle(False)
and = GateAnd(A=save, B=save_representation)
and_2 = GateAnd(A=save, B=icon_export)
expression = Expression(x=Slider(650, range=0..1000), Expression="x/100")
# ^
#                  |
# Preview    ->
# ^
#  |
# <- Meta
# Parameters:
# <- Variants
#   |
#   v
curdir = CurrentDirectory()  # -> PD, D, P, S
# ---------- curdir: Python ----------
# Component Information
# --------------------------------------------------------------------------------------------
if ghenv.Component.RunCount < 2:
    # General
    # --------------------------------------------------------------------------------------------
    __author__ = "Ueli Saluz"
    __version__ = "2024.07.26"

    ghenv.Component.Name = "CurrentDirectory"
    ghenv.Component.NickName = "CurDir"
    ghenv.Component.Description = "Current directory of the current grasshopper file."
    ghenv.Component.Message = "VER 1.1"
    ghenv.Component.Category = "Params"
    ghenv.Component.SubCategory = "Util"

    # Outputs
    # --------------------------------------------------------------------------------------------
    outputIndex = 0

    ghenv.Component.Params.Output[outputIndex].Name = "ParentDirectory"
    ghenv.Component.Params.Output[outputIndex].NickName = "PD"
    ghenv.Component.Params.Output[outputIndex].Description = "Parent directory of the current directory."
    outputIndex += 1

    ghenv.Component.Params.Output[outputIndex].Name = "Directory"
    ghenv.Component.Params.Output[outputIndex].NickName = "D"
    ghenv.Component.Params.Output[outputIndex].Description = "Directory of the current grasshopper file."
    outputIndex += 1

    ghenv.Component.Params.Output[outputIndex].Name = "Path"
    ghenv.Component.Params.Output[outputIndex].NickName = "P"
    ghenv.Component.Params.Output[outputIndex].Description = "Path of the current grasshopper file."
    outputIndex += 1

    ghenv.Component.Params.Output[outputIndex].Name = "Separator"
    ghenv.Component.Params.Output[outputIndex].NickName = "S"
    ghenv.Component.Params.Output[outputIndex].Description = "Separator of the current system."
    outputIndex += 1

# Imports
# --------------------------------------------------------------------------------------------
from os.path import dirname, abspath
from os import sep

# Solver - Run with trees to enhance performance drastically
# --------------------------------------------------------------------------------------------
if __name__ == "__main__":
    P = ghenv.Component.OnPingDocument().FilePath
    D = dirname(P)
    PD = dirname(D)
    S = sep
# ---------- end curdir ----------
# External
#      |
#      v
# Model:
core_length_m = GetNumber(expression, AtLeast=1, AtMost=1, Maximum=1.797693135e+308, Minimum=-1.797693135e+308, TreeAccess=False)
plot = Curve(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)
expression_2 = Expression(x=Slider(400, range=0..1000), Expression="x/100")
expression_3 = Expression(x=Slider(350, range=0..1000), Expression="x/100")
scale = Scale(Geometry=plot, Center=Point(0, 0, 0), Factor=Slider(0.01, range=0..0.01))  # -> Geometry, Transform
floor_height_m = Number(expression_3)
floor_ground_height_m = Number(expression_2)
plot_2 = Curve(scale.Geometry)
panel = Panel("Parallel")  # disabled
m2d_rhino = Make2DRhinoView(Name=panel, Clip=True)  # disabled
number_slider = Slider(876, range=0..1000)  # disabled
view_rectangle = ViewRectangle(view=m2d_rhino)  # disabled
previewplane = PreviewPlane(plane=view_rectangle, axis_length=number_slider)  # disabled
expression_4 = Expression(x=Slider(450, range=0..1000), Expression="x/100")
expression_5 = Expression(x=Slider(350, range=0..1000), Expression="x/100")
cores_setback_width_m = Number(expression_5)
core_primary_width_m = Number(core_length_m)
cores_setback_depth_m = Number(expression_4)
core_secondary_length_m = Number(core_length_m)
core_secondary_width_m = Number(core_length_m)
core_primary_length_m = Number(core_length_m)
expression_6 = Expression(x=Slider(560, range=0..1000), Expression="x/100")
expression_7 = Expression(x=Slider(100, range=0..100), Expression="x/100")
expression_8 = Expression(x=Slider(200, range=0..1000), Expression="x/100")
expression_9 = Expression(x=Slider(40, range=0..100), Expression="x/100")
expression_10 = Expression(x=Slider(250, range=0..1000), Expression="x/100")
expression_11 = Expression(x=Slider(100, range=0..100), Expression="x/100")

panel_2 = Panel("https://app.speckle.systems")
mime = ValueList({".stl": "model/stl", ".obj": "model/obj", ".glb": "model/gltf-binary", ".gltf": "model/gltf+json", ".3dm": "model/vnd.3dm", ".speckle": "model/vnd.speckle+json", ".png": "image/png", ".jpg": "image/jpeg", ".jpeg": "image/jpeg", ".svg": "image/svg+xml", ".pdf": "application/pdf", ".zip": "application/zip", ".json": "application/json", ".csv": "text/csv", ".txt": "text/plain"}, selected=".speckle")
concat = Concatenate(FragmentA="base_blob", FragmentB="_", FragmentE="1to500", FragmentG="_", FragmentF="volume")
concat_2 = Concatenate(FragmentA="base_blob", FragmentB="_", FragmentE="1to200", FragmentG="_", FragmentF="volume")
concat_3 = Concatenate(FragmentC="representations", FragmentD=curdir.S, FragmentA="base_blob")
concat_4 = Concatenate(FragmentC="representations", FragmentD=curdir.S, FragmentA=concat_2)
concat_5 = Concatenate(FragmentC="representations", FragmentD=curdir.S, FragmentA=concat)
concat_6 = Concatenate(FragmentA=panel_2, FragmentB="/projects/", FragmentC="e7de1a2f8f", FragmentD="/models/", FragmentE="897dd7af1e")
concat_7 = Concatenate(FragmentA=concat_3, FragmentB=".glb")
concat_8 = Concatenate(FragmentA=concat_5, FragmentB=".3dm")
concat_9 = Concatenate(FragmentA=concat_4, FragmentB=".3dm")
concat_10 = Concatenate(FragmentA=panel_2, FragmentB="/projects/", FragmentC="e7de1a2f8f", FragmentD="/models/", FragmentE="e5d9d8631c")
rep = ModelRepresentation(Url=concat_7)  # -> Representation, Url, Mime, LoD, Tags
concat_11 = Concatenate(FragmentA=concat_3, FragmentB=".3dm")
concat_12 = Concatenate(FragmentA=panel_2, FragmentB="/projects/", FragmentC="e7de1a2f8f", FragmentD="/models/", FragmentE="2069b62658")
rep_2 = ModelRepresentation(Url=concat_11)  # -> Representation, Url, Mime, LoD, Tags
rep_3 = ModelRepresentation(Url=concat_8, LevelOfDetail="1to500", Tags="volume")  # -> Representation, Url, Mime, LoD, Tags
rep_4 = ModelRepresentation(Url=concat_9, LevelOfDetail="1to200", Tags="volume")  # -> Representation, Url, Mime, LoD, Tags
rep_5 = ModelRepresentation(Url=concat_6, Mime=mime)  # -> Representation, Url, Mime, LoD, Tags
rep_6 = ModelRepresentation(Url=concat_10, Mime=mime, LevelOfDetail="1to500", Tags="volume")  # -> Representation, Url, Mime, LoD, Tags
rep_7 = ModelRepresentation(Url=concat_12, Mime=mime, LevelOfDetail="1to200", Tags="volume")  # -> Representation, Url, Mime, LoD, Tags
merge = Merge(
    Data1=rep.Representation,
    Data2=rep_2.Representation,
    Data3=rep_5.Representation,
    Data4=rep_3.Representation,
    Data5=rep_6.Representation,
    Data6=rep_4.Representation,
    Data7=rep_7.Representation)

entrance_setback_m = Number(expression_11)
side_short_setback_depth_m = Number(expression_7)
entrance_hall_width_m = Number(expression_6)
# Local ->
nakagincapsuletowerbasefloorplan = NakaginCapsuleTowerBaseFloorplan(
    plotoutline=plot_2,
    coressetbackdepth=cores_setback_depth_m,
    coressetbackwidth=cores_setback_width_m,
    coreprimarylength=core_primary_width_m,
    coreprimarywidth=core_secondary_length_m,
    coresecondarylength=core_secondary_length_m,
    coresecondarywidth=core_secondary_width_m,
    entrancehallwidth=entrance_hall_width_m,
    sideshortsetbackdepth=side_short_setback_depth_m)  # -> sidebuilding_2, sideshort_2, sidemain_2, sidecorner_2, sidelong_2, coreprimary_2, coresecondary_2, sidemainfassadeside_2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
sidemain = Curve(nakagincapsuletowerbasefloorplan.sidemain_2)
sidelong = Curve(nakagincapsuletowerbasefloorplan.sidelong_2)
sidemainfassadeside = Curve(nakagincapsuletowerbasefloorplan.sidemainfassadeside_2)
sidemainfassadeentrance = Curve(nakagincapsuletowerbasefloorplan.sidemainfassadeentrance_2)
sidebuilding = Curve(nakagincapsuletowerbasefloorplan.sidebuilding_2)
sideshort = Curve(nakagincapsuletowerbasefloorplan.sideshort_2)
sidecorner = Curve(nakagincapsuletowerbasefloorplan.sidecorner_2)
coreprimary = Rectangle(nakagincapsuletowerbasefloorplan.coreprimary_2)
coresecondary = Rectangle(nakagincapsuletowerbasefloorplan.coresecondary_2)
sideshortfassade = Curve(nakagincapsuletowerbasefloorplan.sideshortfassade_2)
sidelongfassade = Curve(nakagincapsuletowerbasefloorplan.sidelongfassade_2)
basenoncore = Curve(nakagincapsuletowerbasefloorplan.basenoncore_2)
base = Curve(nakagincapsuletowerbasefloorplan.base_2)
blobbase = Curve(nakagincapsuletowerbasefloorplan.blobbase_2)

addition = Addition(A=floor_ground_height_m, B=floor_height_m)
coresecondary_2 = Rectangle(coresecondary)
coreprimary_2 = Rectangle(coreprimary)
Z = UnitZ(Factor=addition)
move = Move(Geometry=coreprimary_2, Motion=Z)  # -> Geometry, Transform
move_2 = Move(Geometry=coresecondary_2, Motion=Z)  # -> Geometry, Transform
evalsrf = EvaluateSurface(Surface=reparameterize(move_2.Geometry), Point="0.5,0.5")  # -> Point, Normal, UDirection, VDirection, Frame
evalsrf_2 = EvaluateSurface(Surface=reparameterize(move.Geometry), Point="0.5,0.5")  # -> Point, Normal, UDirection, VDirection, Frame
merge_2 = Merge(Data1=evalsrf.Normal, Data2=evalsrf_2.Normal)
merge_3 = Merge(Data1=evalsrf.Point, Data2=evalsrf_2.Point)
panel_3 = Panel("""0
1""")
concat_13 = Concatenate(FragmentA="c", FragmentB="-", FragmentC=panel_3)
panel_4 = Panel("""east
west""")
loc = ModelLocator(Group="core", Subgroup=panel_4)  # -> Locator, Group, Subgroup
por = ModelPort(Id=graft(concat_13), Point=graft(merge_3), Direction=graft(merge_2), Locators=graft(loc.Locator))  # -> Port, Id, Point, Direction, Locators
trim = TrimTree(Tree=por.Port, Depth=1)

columns_setback_depth_m = Number(expression_8)
neg = Negative(Value=columns_setback_depth_m)
offset = OffsetCurve(Curve=sidemain, Distance=neg, Corners=1)
offset_2 = OffsetCurve(Curve=sidelong, Distance=neg, Corners=1)
trim_2 = TrimTree(Tree=offset, Depth=1)
trim_3 = TrimTree(Tree=offset_2, Depth=1)
columnsmainaxis = Curve(trim_2)
columnssideaxis = Curve(trim_3)
columns_width_m = Number(expression_9)

expression_12 = Expression(x=core_primary_width_m, y=columns_width_m, Expression="x-2*y")
expression_13 = Expression(x=core_secondary_length_m, y=columns_width_m, Expression="x-2*y")
subtraction = Subtraction(A=cores_setback_width_m, B=columns_width_m)
merge_4 = Merge(
    Data1=columns_width_m,
    Data2=subtraction,
    Data3=columns_width_m,
    Data4=expression_12,
    Data5=columns_width_m,
    Data6=entrance_hall_width_m,
    Data7=columns_width_m,
    Data8=expression_13,
    Data9=columns_width_m)
ma = MassAddition(Input=merge_4)  # -> Result, PartialResults
eval = EvaluateLength(Curve=columnsmainaxis, Length=ma.PartialResults, Normalized="False")  # -> Point, Tangent, Parameter
shatter = Shatter(Curve=columnsmainaxis, Parameters=eval.Parameter)
trim_4 = TrimTree(Tree=shatter, Depth=1)
Z_2 = UnitZ(Factor=floor_ground_height_m)
dispatch = Dispatch(List=trim_4, DispatchPattern=[True, False])  # -> ListA, ListB
extr = Extrude(Base=dispatch.ListA, Direction=Z_2)
evalsrf_3 = EvaluateSurface(Surface=reparameterize(extr), Point="0.5,0.5")  # -> Point, Normal, UDirection, VDirection, Frame
amp = Amplitude(Vector=evalsrf_3.Normal, Amplitude=columns_width_m)
expression_14 = Expression(x=columns_width_m, Expression="x/2")
eval_2 = EvaluateCurve(Curve=reparameterize(dispatch.ListA), Parameter="0.5")  # -> Point, Tangent, Angle
cir = Circle(Plane=eval_2.Point, Radius=expression_14)
expression_15 = Expression(x=amp, Expression="x/2")
move_3 = Move(Geometry=cir, Motion=expression_15)  # -> Geometry, Transform
extr_2 = Extrude(Base=extr, Direction=amp)
extr_3 = Extrude(Base=move_3.Geometry, Direction=Z_2)
cap = CapHoles(Brep=extr_3)
columnsmain = Brep(cap)

columns_side_long_setback_width_m = Number(expression_10)
expression_16 = Expression(x=Slider(150, range=0..1000), Expression="x/100")
expression_17 = Expression(x=Slider(40, range=0..100), Expression="x/100")
expression_18 = Expression(x=Slider(30, range=0..100), Expression="x/100")
expression_19 = Expression(x=Slider(90, range=0..100), Expression="x/100")
window_height_m = Number(expression_16)
attic_height_m = Number(expression_18)

neg_2 = Negative(Value=attic_height_m)
neg_3 = Negative(Value=attic_height_m)
ext = ExtendCurve(Curve=columnssideaxis, Type=0, Start=neg_2, End=neg_3)
divide = DivideCurve(Curve=ext, Count="2", Kinks=False)  # -> Points, Tangents, Parameters
trim_5 = TrimTree(Tree=divide.Parameters, Depth=1)
eval_3 = EvaluateCurve(Curve=columnssideaxis, Parameter=trim_5)  # -> Point, Tangent, Angle
pl = ConstructPlane(Origin=eval_3.Point, XAxis=eval_3.Tangent, YAxis=Vector(0, 1, 0))
_2d = _2D(x=columns_width_m)
rectangle = Rectangle(Plane=pl, XSize=_2d, YSize=_2d, Radius=0)  # -> Rectangle, Length
Z_3 = UnitZ(Factor=floor_ground_height_m)
cir_2 = Circle(Plane=pl, Radius=expression_14)
extr_4 = Extrude(Base=cir_2, Direction=Z_3)
cap_2 = CapHoles(Brep=extr_4)
columnsside = Brep(cap_2)

fassade_edge_setback_m = Number(expression_17)
window_parapet_height_m = Number(expression_19)
attic_depth_m = Number(expression_18)

txt = Text("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")
txt_2 = EncodeText(Text=txt)
concat_14 = Concatenate(FragmentA="data:image/svg+xml;base64,", FragmentB=txt_2)
icon1 = Text(concat_14)

merge_5 = Merge(Data1=columnsmain, Data2=columnsside)
columns = Brep(merge_5)

construction_area_factor = Number(Slider(0.2, range=0..1))
maintenance_expenses_month_eff_m² = Number(Slider(8.5, range=0..10))
construction_cost_eff_m² = Number(Slider(7500, range=0..10000))
income_month_eff_m² = Number(Slider(85, range=0..100))
amp_2 = Amplitude(Vector=por.Direction, Amplitude=Slider(3, range=0..10))
vdisex = VectorDisplayEx(Point=por.Point, Vector=amp_2, Colour=RGB(0, 0, 0), Width=2)
heating_energy_demand_kwh_m²a = Number(Slider(30, range=0..200))
cooling_energy_demand_kwh_m²a = Number(Slider(40, range=0..200))
technical_equipment_energy_demand_kwh_m² = Number(Slider(40, range=0..200))  # "Technical Equipment Energy Demand[kWh/m²a]"
construction_global_warming_potential_kg = Number(Slider(900, range=0..2000))  # "Construction Global Warming Potential [kgCO2e/eff. m²]"

maintenance_expenses_month_eff_m²_2 = Number(maintenance_expenses_month_eff_m²)
construction_global_warming_potential_kg_2 = Number(construction_global_warming_potential_kg)  # "Construction Global Warming Potential [kgCO2e/eff. m²]"
technical_equipment_energy_demand_kwh_m²_2 = Number(technical_equipment_energy_demand_kwh_m²)  # "Technical Equipment Energy Demand[kWh/m²a]"
income_month_eff_m²_2 = Number(income_month_eff_m²)
construction_area_factor_2 = Number(construction_area_factor)
cooling_energy_demand_kwh_m²a_2 = Number(cooling_energy_demand_kwh_m²a)
heating_energy_demand_kwh_m²a_2 = Number(heating_energy_demand_kwh_m²a)
area = Area(Geometry=plot_2)  # -> Area, Centroid
construction_cost_eff_m²_2 = Number(construction_cost_eff_m²)
area_2 = Area(Geometry=base)  # -> Area, Centroid
expression_20 = Expression(x=construction_area_factor_2, Expression="1-x")
addition_2 = Addition(A=area_2.Area, B=area.Area)
multiplication = Multiplication(A=addition_2, B=expression_20)
multiplication_2 = Multiplication(A=multiplication, B=maintenance_expenses_month_eff_m²_2)
multiplication_3 = Multiplication(A=multiplication, B=income_month_eff_m²_2)
expression_21 = Expression(x=multiplication_2, Expression="x*12")
expression_22 = Expression(x=multiplication_3, Expression="x*12")
multiplication_4 = Multiplication(A=multiplication, B=construction_cost_eff_m²_2)
multiplication_5 = Multiplication(A=heating_energy_demand_kwh_m²a_2, B=multiplication)
multiplication_6 = Multiplication(A=cooling_energy_demand_kwh_m²a_2, B=multiplication)
multiplication_7 = Multiplication(A=technical_equipment_energy_demand_kwh_m²_2, B=multiplication)
multiplication_8 = Multiplication(A=multiplication, B=construction_global_warming_potential_kg_2)
roundmult = RoundToMultiple(N=multiplication, M="0.01")  # -> R; inputs N: tree, M: tree
# ---------- roundmult: Python ----------
#Component Information
#--------------------------------------------------------------------------------------------
if ghenv.Component.RunCount<2:
    #General
    #--------------------------------------------------------------------------------------------
    __author__ = "YOUR NAME"
    __version__ = "2000.00.00"
    
    ghenv.Component.Name = "Round to Multiple"
    ghenv.Component.NickName = "RoundMult"
    ghenv.Component.Description = "Rounds a number to the nearest specified multiple."
    ghenv.Component.Message = "VER 1.0"
    ghenv.Component.Category = "Math"
    ghenv.Component.SubCategory = "Arithmetic"
    
     #Inputs
    #--------------------------------------------------------------------------------------------
    inputIndex=0
    
    ghenv.Component.Params.Input[inputIndex].Name = "Number"
    ghenv.Component.Params.Input[inputIndex].NickName = "N"
    ghenv.Component.Params.Input[inputIndex].Description = "Number to round."
    ghenv.Component.Params.Input[inputIndex].Optional = False
    inputIndex+=1
    
    ghenv.Component.Params.Input[inputIndex].Name = "Multiple"
    ghenv.Component.Params.Input[inputIndex].NickName = "M"
    ghenv.Component.Params.Input[inputIndex].Description = "Multiple to round to."
    ghenv.Component.Params.Input[inputIndex].Optional = False
    inputIndex+=1
    
    #Outputs
    #--------------------------------------------------------------------------------------------
    outputIndex=0
    
    ghenv.Component.Params.Output[outputIndex].Name = "Rounded"
    ghenv.Component.Params.Output[outputIndex].NickName = "R"
    ghenv.Component.Params.Output[outputIndex].Description = "Number rounded to the nearest specified multiple."
    outputIndex+=1


#Imports
#--------------------------------------------------------------------------------------------
from System import Object
from Grasshopper import DataTree
import math


#The Component function - Business logic only (e.g. working without trees)
#--------------------------------------------------------------------------------------------
"""Function that this component is computing.
    Inputs:
        number: The number to round.
        multiple: The multiple to round to.
    Output:
        rounded: The number rounded to the nearest specified multiple."""
def RoundToMultiple(number, multiple):
    rounded = math.ceil(number / multiple) * multiple
    return rounded

#Solver - Run with trees to enhance performance drastically
#--------------------------------------------------------------------------------------------
if __name__ == "__main__":
    
    #Initialize trees
    #--------------------------------------------------------------------------------------------
    RoundedTree = DataTree[Object]()
    
    #Data matching
    #--------------------------------------------------------------------------------------------
    for path in N.Paths:
        numberBranch = N.Branch(path)
        for i, number in enumerate(numberBranch):
            multiple = M.Branch(path)[i]
            rounded = RoundToMultiple(number, multiple)
            RoundedTree.Add(rounded, path)
    
     #Assign trees to output
    #--------------------------------------------------------------------------------------------
    R = RoundedTree
# ---------- end roundmult ----------
round = Round(Number=multiplication_4)  # -> Nearest, Floor, Ceiling
round_2 = Round(Number=multiplication_5)  # -> Nearest, Floor, Ceiling
round_3 = Round(Number=multiplication_6)  # -> Nearest, Floor, Ceiling
round_4 = Round(Number=multiplication_7)  # -> Nearest, Floor, Ceiling
round_5 = Round(Number=expression_22)  # -> Nearest, Floor, Ceiling
round_6 = Round(Number=expression_21)  # -> Nearest, Floor, Ceiling
round_7 = Round(Number=multiplication_8)  # -> Nearest, Floor, Ceiling
panel_5 = Panel("""https://identifier.buildingsmart.org/uri/buildingsmart/ifc/4.3/class/IfcBuildingStorey
https://identifier.buildingsmart.org/uri/buildingsmart/ifc/4.3/prop/GrossHeight
https://identifier.buildingsmart.org/uri/buildingsmart/ifc/4.3/prop/GrossHeight

https://identifier.buildingsmart.org/uri/buildingsmart/ifc/4.3/prop/Diameter
https://identifier.buildingsmart.org/uri/buildingsmart/ifc/4.3/prop/NetFloorArea

https://identifier.buildingsmart.org/uri/buildingsmart/ifc/4.3/prop/EnergyConsumption
https://identifier.buildingsmart.org/uri/buildingsmart/ifc/4.3/prop/EnergyConsumption
https://identifier.buildingsmart.org/uri/buildingsmart/ifc/4.3/prop/EnergyConsumption


https://identifier.buildingsmart.org/uri/etim/etim/9.0/prop/EF016979""")
merge_6 = Merge(
    Data1="2",
    Data2=floor_height_m,
    Data3=floor_ground_height_m,
    Data4="2",
    Data5=core_primary_length_m,
    Data6=roundmult,
    Data7=round.Nearest,
    Data8=round_2.Nearest,
    Data9=round_3.Nearest,
    Data10=round_4.Nearest,
    Data11=round_5.Nearest,
    Data12=round_6.Nearest,
    Data13=round_7.Nearest)
panel_6 = Panel("""storey
floor height
ground floor height
cores
core diameter
effective floor area
construction cost
heating energy demand
cooling energy demand
technical equipment energy demand
income
maintenance expenses
construction global warming potential""")
panel_7 = Panel(merge_6)
panel_8 = Panel("""m
m

m
m²
€
kWh/a
kWh/a
kWh/a
€/a
€/a
kgCO2e""")
qlt = ModelQuality(Name=panel_6, Value=panel_7, Unit=panel_8, Definition=panel_5)  # -> Quality, Name, Value, Unit, Definition

panel_9 = Panel("A two storey office building with an entrance hall and access to the staircases and elevators of the cores on the groundfloor. It has a setback and a colonade towards the street. On the second floor are the office rooms.")
panel_10 = Panel("🏫")
typ = ModelType(Name="Base", Description=panel_9, Icon=icon1, Variant="Blob", Representations=merge, Ports=trim, Qualities=qlt.Quality)  # -> Type, Name, Description, Icon, Variant, Unit, Representations, Ports, Qualities
typ_2 = RemoveType(TypeName=typ.Name, TypeVariant=typ.Variant, Directory=curdir.PD, Run=save)
or = GateOr(A=save, B=typ_2)
typ_3 = AddType(Type=typ.Type, Directory=curdir.PD, Run=or)

typ_4 = SerializeType(Type=typ.Type)
type = Text(typ_4)
context_bake = ContextBake(Geometry=type)

eval_4 = EvaluateCurve(Curve=reparameterize(sidemainfassadeentrance), Parameter="0.5")  # -> Point, Tangent, Angle
Z_4 = UnitZ(Factor=1)
xprod = CrossProduct(VectorA=eval_4.Tangent, VectorB=Z_4, Unitize=False)  # -> Vector, Length
neg_4 = Negative(Value=xprod.Vector)
amp_3 = Amplitude(Vector=neg_4, Amplitude=entrance_setback_m)
extr_5 = Extrude(Base=sidemainfassadeentrance, Direction=amp_3)
Z_5 = UnitZ(Factor=floor_height_m)
extr_6 = Extrude(Base=extr_5, Direction=Z_5)
cap_3 = CapHoles(Brep=extr_6)

sidemain_2 = Curve(sidemain)
sidecorner_2 = Curve(sidecorner)
sidelong_2 = Curve(sidelong)
sideshort_2 = Curve(sideshort)
merge_7 = Merge(Data1=sideshort_2, Data2=sidemain_2, Data3=sidecorner_2, Data4=sidelong_2)
join = JoinCurves(Curves=merge_7, Preserve=False)
trim_6 = TrimTree(Tree=join, Depth=1)
neg_5 = Negative(Value=fassade_edge_setback_m)
neg_6 = Negative(Value=fassade_edge_setback_m)
neg_7 = Negative(Value=fassade_edge_setback_m)
Z_6 = UnitZ(Factor=neg_6)
Z_7 = UnitZ(Factor=fassade_edge_setback_m)
neg_8 = Negative(Value=attic_depth_m)
neg_9 = Negative(Value=attic_height_m)
Z_8 = UnitZ(Factor=neg_9)
Z_9 = UnitZ(Factor=floor_height_m)

Z_10 = UnitZ(Factor=floor_ground_height_m)
base_2 = Curve(blobbase)
Z_11 = UnitZ(Factor=floor_height_m)
move_4 = Move(Geometry=plot_2, Motion=Z_10)  # -> Geometry, Transform
extr_7 = Extrude(Base=base_2, Direction=Z_10)
extr_8 = Extrude(Base=move_4.Geometry, Direction=Z_11)
cap_4 = CapHoles(Brep=extr_7)
cap_5 = CapHoles(Brep=extr_8)
floorgroundvolume1to500 = Brep(cap_4)

sdiff = SolidDifference(BrepsA=floorgroundvolume1to500, BrepsB=cap_3)
groundfloorvolume1to200 = Brep(sdiff)

move_5 = Move(Geometry=trim_6, Motion=Z_10)  # -> Geometry, Transform
move_6 = Move(Geometry=move_5.Geometry, Motion=Z_11)  # -> Geometry, Transform
offset_3 = OffsetCurve(Curve=move_5.Geometry, Distance=neg_5, Corners=1)
offset_4 = OffsetCurve(Curve=move_6.Geometry, Distance=neg_7, Corners=1)
move_7 = Move(Geometry=move_5.Geometry, Motion=Z_7)  # -> Geometry, Transform
trim_7 = TrimTree(Tree=offset_3, Depth=1)
crv = Curve(trim_7)
end = EndPoints(Curve=crv)  # -> Start, End
ln = Line(StartPoint=end.Start, EndPoint=end.End)
merge_8 = Merge(Data1=crv, Data2=ln)
move_8 = Move(Geometry=move_6.Geometry, Motion=Z_6)  # -> Geometry, Transform
trim_8 = TrimTree(Tree=offset_4, Depth=1)
crv_2 = Curve(trim_8)
end_2 = EndPoints(Curve=crv_2)  # -> Start, End
ln_2 = Line(StartPoint=end_2.Start, EndPoint=end_2.End)
merge_9 = Merge(Data1=crv_2, Data2=ln_2)
join_2 = JoinCurves(Curves=merge_8, Preserve=False)
join_3 = JoinCurves(Curves=merge_9, Preserve=False)
rulesrf = RuledSurface(CurveA=trim_7, CurveB=move_7.Geometry)
rulesrf_2 = RuledSurface(CurveA=move_7.Geometry, CurveB=move_8.Geometry)
rulesrf_3 = RuledSurface(CurveA=trim_8, CurveB=move_8.Geometry)
trim_9 = TrimTree(Tree=join_2, Depth=1)
trim_10 = TrimTree(Tree=join_3, Depth=1)
merge_10 = Merge(Data1=rulesrf, Data2=rulesrf_2, Data3=rulesrf_3)
merge_11 = Merge(Data1=trim_7, Data2=move_7.Geometry, Data3=move_8.Geometry, Data4=trim_8)
boundary = BoundarySurfaces(Edges=trim_9)
offset_5 = OffsetCurve(Curve=trim_10, Distance=neg_8, Corners=1)
boundary_2 = BoundarySurfaces(Edges=trim_10)
trim_11 = TrimTree(Tree=offset_5, Depth=1)
loft = Loft(Curves=merge_11, Options={Adjust=False, Closed=False, LoftEnds=0, LoftSimp=0, LoftType=0, Rebuild=10, Refit=0.01})
join_4 = BrepJoin(Breps=merge_10)  # -> Breps, Closed
rulesrf_4 = RuledSurface(CurveA=trim_10, CurveB=trim_11)
move_9 = Move(Geometry=trim_11, Motion=Z_8)  # -> Geometry, Transform
fassadefirstfloor = Geometry(loft)
boundary_3 = BoundarySurfaces(Edges=move_9.Geometry)
rulesrf_5 = RuledSurface(CurveA=trim_11, CurveB=move_9.Geometry)
move_10 = Move(Geometry=sidebuilding, Motion=Z_10)  # -> Geometry, Transform

explode = Explode(Curve=loft, Recursive=True)  # -> Segments, Vertices
trim_12 = TrimTree(Tree=explode.Vertices, Depth=1)
trim_13 = TrimTree(Tree=explode.Segments, Depth=1)
item = ListItem(List=trim_13, Index=0, Wrap=True)  # -> Item, Item1, Item2, Item3, Item4, Item5
item_2 = ListItem(List=trim_12, Index=0, Wrap=True)  # -> Item, Item1, Item2, Item3, Item4, Item5, Item6
ln_3 = Line(StartPoint=item_2.Item, EndPoint=item_2.Item1)
# Outputs   ->
#                 |
#                 v
ln_4 = Line(StartPoint=item_2.Item6, EndPoint=item_2.Item5)
merge_12 = Merge(Data1=item.Item, Data2=ln_3)
merge_13 = Merge(Data1=item.Item5, Data2=ln_4)
rulesrf_6 = RuledSurface(CurveA=ln_3, CurveB=ln_4)
join_5 = JoinCurves(Curves=merge_12, Preserve=False)
join_6 = JoinCurves(Curves=merge_13, Preserve=False)
trim_14 = TrimTree(Tree=join_5, Depth=1)
trim_15 = TrimTree(Tree=join_6, Depth=1)
srf = Surface(trim_14)
srf_2 = Surface(trim_15)
merge_14 = Merge(Data1=srf, Data2=srf_2, Data3=rulesrf_6)
join_7 = BrepJoin(Breps=merge_14)  # -> Breps, Closed

merge_15 = Merge(Data1=fassadefirstfloor, Data2=join_7.Breps)
join_8 = BrepJoin(Breps=merge_15)  # -> Breps, Closed
capex = CapHolesEx(Brep=join_8.Breps)  # -> Brep, Caps, Solid

floorfirstvolume1to500 = Brep(capex.Brep)

Z_12 = UnitZ(Factor=window_parapet_height_m)
move_11 = Move(Geometry=move_5.Geometry, Motion=Z_12)  # -> Geometry, Transform
Z_13 = UnitZ(Factor=window_height_m)
move_12 = Move(Geometry=move_11.Geometry, Motion=Z_13)  # -> Geometry, Transform
rulesrf_7 = RuledSurface(CurveA=move_11.Geometry, CurveB=move_12.Geometry)
windowribbon = Surface(rulesrf_7)

merge_16 = Merge(Data1=boundary, Data2=fassadefirstfloor, Data3=rulesrf_4, Data4=rulesrf_5, Data5=boundary_3, Data6=join_7.Breps)
join_9 = BrepJoin(Breps=merge_16)  # -> Breps, Closed
capex_2 = CapHolesEx(Brep=join_9.Breps)  # -> Brep, Caps, Solid
floorfirstvolume1to200 = Brep(capex_2.Brep)

concat_15 = Concatenate(FragmentA="first floor", FragmentB="::", FragmentC="windows")
concat_16 = Concatenate(FragmentA="ground floor", FragmentB="::", FragmentC="columns")
concat_17 = Concatenate(FragmentA="first floor", FragmentB="::", FragmentC="volume")
concat_18 = Concatenate(FragmentA="ground floor", FragmentB="::", FragmentC="building")
floorgroundvolume1to500_2 = Brep(floorgroundvolume1to500)
floorfirstvolume1to500_2 = Brep(floorfirstvolume1to500)
groundfloorvolume1to200_2 = Brep(groundfloorvolume1to200)
floorfirstvolume1to200_2 = Brep(floorfirstvolume1to200)
concat_19 = Concatenate(FragmentA=concat_16, FragmentB="::", FragmentC="main")
concat_20 = Concatenate(FragmentA=concat_16, FragmentB="::", FragmentC="side")
windowribbon_2 = Surface(windowribbon)
columnsmain_2 = Brep(columnsmain)
columnsside_2 = Brep(columnsside)
expression_23 = Expression(x=concat_18, y=floorgroundvolume1to500_2, Expression="x")
expression_24 = Expression(x=concat_19, y=columnsmain_2, Expression="x")
expression_25 = Expression(x=concat_19, y=columnsmain_2, Expression="x")
expression_26 = Expression(x=concat_20, y=columnsside_2, Expression="x")
expression_27 = Expression(x=concat_17, y=floorfirstvolume1to500_2, Expression="x")
expression_28 = Expression(x=concat_15, y=windowribbon_2, Expression="x")
merge_17 = Merge(Data1=floorgroundvolume1to500_2, Data2=columnsmain_2, Data3=columnsside_2, Data4=floorfirstvolume1to500_2)
merge_18 = Merge(Data1=groundfloorvolume1to200_2, Data2=columnsmain_2, Data3=columnsside_2, Data4=floorfirstvolume1to200_2)
merge_19 = Merge(Data1=expression_23, Data2=expression_25, Data3=expression_26, Data4=expression_27)
concat_21 = Concatenate(FragmentA=curdir.PD, FragmentB=curdir.S, FragmentC=rep_3.Url)
blc = ExportBlock(path=concat_21, name=concat, url=rep_3.Url, geo=merge_17, layer_name=merge_19, export=and)  # -> block_definition_3, path_4, exported_2
concat_22 = Concatenate(FragmentA=curdir.PD, FragmentB=curdir.S, FragmentC=rep_4.Url)
blc_2 = ExportBlock(path=concat_22, geo=merge_18, layer_name=merge_19)  # -> block_definition_3, path_4, exported_2

rec = Rectangle({Plane=Plane(origin=(-1970.889691, 1937.419247, 1956.598842), x=(0.7071067812, 0.7071067812, 0), y=(0.4082482905, -0.4082482905, 0.8164965809)), Size=Domain2(u=-46.34617503..46.34617503, v=-24.69844367..24.69844367)})
m2d_parallel = Make2DParallelView(Projection=rec)
make2d = Make2D(Geometry=merge_18, View=m2d_parallel, TangentEdges="T", TangentSeams=False, AutoComputeMake2D=True)  # -> VisibleCurves, VisibleIndex, VisibleType, HiddenCurves, HiddenIndex, HiddenType
trim_16 = TrimTree(Tree=make2d.VisibleCurves, Depth=1)
shaft = Geometry(trim_16)

expression_29 = Expression(x="shaft", y=shaft, Expression="x")
concat_23 = Concatenate(FragmentC="base_blob", FragmentD="_", FragmentA="icon")
concat_24 = Concatenate(FragmentC="icons", FragmentD=curdir.S)
concat_25 = Concatenate(FragmentA=concat_24)
concat_26 = Concatenate(FragmentA=curdir.PD, FragmentB=curdir.S, FragmentC=concat_25)
blc_3 = ExportBlock(path=concat_26, name=concat_23, geo=shaft, layer_name=expression_29)  # -> block_definition_3, path_4, exported_2

# ==== cluster NakaginCapsuleTowerBaseFloorplan
sideshortsetbackdepth = ClusterInput()
plotoutline = ClusterInput()
coressetbackdepth = ClusterInput()
coressetbackwidth = ClusterInput()
coreprimarylength = ClusterInput()
coreprimarywidth = ClusterInput()
coresecondarylength = ClusterInput()
coresecondarywidth = ClusterInput()
entrancehallwidth = ClusterInput()
coressetbackdepth_2 = Number(coressetbackdepth)
coreprimarylength_2 = Number(coreprimarylength)
coreprimarywidth_2 = Number(coreprimarywidth)
coresecondarylength_2 = Number(coresecondarylength)
coressetbackwidth_2 = Number(coressetbackwidth)
plotoutline_2 = Curve(plotoutline)
coresecondarywidth_2 = Number(coresecondarywidth)
entrancehallwidth_2 = Number(entrancehallwidth)
sideshortsetbackdepth_2 = Number(sideshortsetbackdepth)
xy = XYPlane(Origin=Point(0, 0, 0))
merge = Merge(Data1=coressetbackwidth_2, Data2=coreprimarylength_2, Data3=entrancehallwidth_2, Data4=coresecondarylength_2)
neg = Negative(Value=coressetbackdepth_2)
ma = MassAddition(Input=merge)  # -> Result, PartialResults
explode = Explode(Curve=plotoutline_2, Recursive=True)  # -> Segments, Vertices
Y = UnitY(Factor=neg)
neg_2 = Negative(Value=ma.PartialResults)
trim = TrimTree(Tree=explode.Segments, Depth=1)
X = UnitX(Factor=neg_2)
move = Move(Geometry=xy, Motion=Y)  # -> Geometry, Transform
item = ListItem(List=trim, Index=0, Wrap=True)  # -> Item, Item1, Item2, Item3, Item4
move_2 = Move(Geometry=move.Geometry, Motion=X)  # -> Geometry, Transform
sidemain = Curve(item.Item2)
sidecorner = Curve(item.Item3)
sidelong = Curve(item.Item4)
sidebuilding = Curve(item.Item)
sideshort = Curve(item.Item1)
item_2 = ListItem(List=move_2.Geometry, Index=0, Wrap=True)  # -> Item, Item1, Item2, Item3
neg_3 = Negative(Value=coresecondarywidth_2)
neg_4 = Negative(Value=entrancehallwidth_2)
neg_5 = Negative(Value=coreprimarywidth_2)
sidebuilding_2 = ClusterOutput(sidebuilding)
sideshort_2 = ClusterOutput(sideshort)
sidemain_2 = ClusterOutput(sidemain)
sidecorner_2 = ClusterOutput(sidecorner)
sidelong_2 = ClusterOutput(sidelong)
rectangle = Rectangle(Plane=item_2.Item2, XSize=entrancehallwidth_2, YSize=neg_4, Radius=0)  # -> Rectangle, Length
rectangle_2 = Rectangle(Plane=item_2.Item1, XSize=coreprimarylength_2, YSize=neg_3, Radius=0)  # -> Rectangle, Length
rectangle_3 = Rectangle(Plane=item_2.Item3, XSize=coresecondarylength_2, YSize=neg_5, Radius=0)  # -> Rectangle, Length
coresecondary = Rectangle(rectangle_2.Rectangle)
coreprimary = Rectangle(rectangle_3.Rectangle)
explode_2 = Explode(Curve=rectangle.Rectangle, Recursive=True)  # -> Segments, Vertices
explode_3 = Explode(Curve=coreprimary, Recursive=True)  # -> Segments, Vertices
coreprimary_2 = ClusterOutput(coreprimary)
coresecondary_2 = ClusterOutput(coresecondary)
trim_2 = TrimTree(Tree=explode_2.Segments, Depth=1)
trim_3 = TrimTree(Tree=explode_3.Vertices, Depth=1)
item_3 = ListItem(List=trim_2, Index=0, Wrap=True)  # -> Item, Item1, Item2, Item3
item_4 = ListItem(List=trim_3, Index=0, Wrap=True)  # -> Item, Item1, Item2, Item3
expression = Expression(x=neg_5, Expression="x/2")
expression_2 = Expression(x=coreprimarywidth_2, Expression="x/2")
Y_2 = UnitY(Factor=expression)
X_2 = UnitX(Factor=expression_2)
cir = Circle(Plane=item_2.Item3, Radius=expression_2)
addition = Addition(A=X_2, B=Y_2)
cir_2 = Circle(Plane=item_2.Item1, Radius=expression_2)
neg_6 = Negative(Value=sideshortsetbackdepth_2)
move_3 = Move(Geometry=cir, Motion=addition)  # -> Geometry, Transform
move_4 = Move(Geometry=cir_2, Motion=addition)  # -> Geometry, Transform
offset = OffsetCurve(Curve=sideshort, Distance=neg_6, Corners=1)
trim_4 = TrimTree(Tree=offset, Depth=1)

X_3 = UnitX(Factor=1)
line = LineSDL(Start=move.Geometry, Direction=X_3, Length=1)
rotax = RotateAxis(Geometry=move.Geometry, Angle=degrees("90"), Axis=line)  # -> Geometry, Transform
pcx = CurvePlane(Curve=trim_4, Plane=rotax.Geometry)  # -> Points, ParamsC, ParamsP
trim_5 = TrimTree(Tree=pcx.Points, Depth=1)
crv_cp = CurveClosestPoint(Point=trim_5, Curve=trim_4)  # -> Point, Parameter, Distance
shatter = Shatter(Curve=trim_4, Parameters=crv_cp.Parameter)
trim_6 = TrimTree(Tree=shatter, Depth=1)
item_5 = ListItem(List=trim_6, Index=0, Wrap=True)

series = Series(Start=0, Step="0.125", Count="8")
trim_7 = TrimTree(Tree=series, Depth=1)

explode_4 = Explode(Curve=coresecondary, Recursive=True)  # -> Segments, Vertices
trim_8 = TrimTree(Tree=explode_4.Segments, Depth=1)
shift = ShiftList(List=trim_8, Shift="-2", Wrap=True)
panel = Panel("-1")
trim_9 = TrimTree(Tree=shift, Depth=1)
lito3p = ListInto3Parts(ListToSlice=trim_9, StartIndex="1")  # -> FilteredList, ItemsBefore, ItemsAfter; inputs ListToSlice: tree, StartIndex: tree of Int32, EndIndex: tree of Int32
# ---------- lito3p: Python ----------
if ghenv.Component.RunCount<2:
    __author__ = "Ueli Saluz"
    __version__ = "2020.05.28"
    
    ghenv.Component.Name = "ListInto3Parts"
    ghenv.Component.NickName = "LiTo3P"
    ghenv.Component.Description = "Slice list into 3 parts. All lists are sliced with the same indices. End index = 0 = length(list)."
    ghenv.Component.Message = "VER 1.6"

from System import Object
from Grasshopper import DataTree

def filterList(listToFilter,startIndex,endIndex):
    # Return: FilteredList, Before, After
    if (((startIndex == 0) or (startIndex is None)) and ((endIndex == 0) or (endIndex is None))) or (endIndex <= startIndex and endIndex > 0):
        return (listToFilter,None,None)
    elif (startIndex == 0) or (startIndex is None):
        return (listToFilter[:endIndex],None,listToFilter[endIndex:])
    elif (endIndex == 0) or (endIndex is None):
        print 1
        return (listToFilter[:startIndex],listToFilter[startIndex:],None)
    else:
        return (listToFilter[startIndex:endIndex],listToFilter[:startIndex],listToFilter[endIndex:])

if __name__ == "__main__":
    FilteredList = DataTree[Object]()
    ItemsBefore = DataTree[Object]()
    ItemsAfter = DataTree[Object]()
    
    for path in ListToSlice.Paths:
        listBranch = ListToSlice.Branch(path)
        pyList = list(listBranch)   #Convert .Net List to Python
        try: #terrible way of writing code but if I set the list to list access the performance decreases massivly due to many calls
            startIndex = StartIndex.Branch(path)
            startIndex = startIndex[0]
        except Exception:
            try:
                startIndex = StartIndex.Branch(0)
                startIndex = startIndex[0]
            except Exception:
                startIndex = 0
        try:
            endIndex = EndIndex.Branch(path)
            endIndex = endIndex[0]
        except Exception:
            try:
                endIndex = EndIndex.Branch(0)
                endIndex = endIndex[0]
            except Exception:
                endIndex = len(pyList)
        filtList=filterList(pyList,startIndex,endIndex)
        if filtList[0]:
            FilteredList.AddRange(filtList[0],path)
        if filtList[1]:
            ItemsBefore.AddRange(filtList[1],path)
        if filtList[2]:
            ItemsAfter.AddRange(filtList[2],path)
# ---------- end lito3p ----------

eval = EvaluateCurve(Curve=reparameterize(move_3.Geometry), Parameter=trim_7)  # -> Point, Tangent, Angle
eval_2 = EvaluateCurve(Curve=reparameterize(move_4.Geometry), Parameter=trim_7)  # -> Point, Tangent, Angle
item_6 = ListItem(List=eval.Point, Index=0, Wrap=True)  # -> Item, Item1, Item2, Item3, Item4, Item5, Item6
item_7 = ListItem(List=eval_2.Point, Index=0, Wrap=True)  # -> Item, Item1, Item2, Item3, Item4
ln = Line(StartPoint=crv_cp.Point, EndPoint=item_2.Item)
ln_2 = Line(StartPoint=item_2.Item1, EndPoint=item_2.Item2)
ln_3 = Line(StartPoint=crv_cp.Point, EndPoint=item_4.Item3)
ln_4 = Line(StartPoint=item_4.Item3, EndPoint=item_4.Item)
ln_5 = Line(StartPoint=item_4.Item, EndPoint=item_4.Item1)
sidemainfassadeside = Curve(ln)
sideshortfassade = Curve(item_5)
sidemainfassadeentrance = Curve(ln_2)
sidemainfassadeentrance_2 = ClusterOutput(sidemainfassadeentrance)
sidemainfassadeside_2 = ClusterOutput(sidemainfassadeside)
sideshortfassade_2 = ClusterOutput(sideshortfassade)

xy_2 = XYPlane(Origin=Point(0, 0, 0))
rotate = Rotate(Geometry=xy_2, Angle=degrees("180"), Plane=PlaneXY(0, 0, 0))  # -> Geometry, Transform
brec = BoundingRectangle(geometry=plotoutline_2, plane=graft(rotate.Geometry))  # -> boundingrectangle_2, length_2
end = EndPoints(Curve=trim_4)  # -> Start, End
crv_cp_2 = CurveClosestPoint(Point=end.Start, Curve=sidebuilding)  # -> Point, Parameter, Distance

rec = Rectangle(brec.boundingrectangle_2)

trim_10 = TrimTree(Tree=rec, Depth=1)
drec = DeconstuctRectangle(Rectangle=trim_10)  # -> BasePlane, XInterval, YInterval
domprop = DomainProperties(I=drec.YInterval, In=True)  # -> L, M, T0, T1; inputs I: tree, In: tree of Boolean
# ---------- domprop: Python ----------
#Component Information
#--------------------------------------------------------------------------------------------
if ghenv.Component.RunCount<2:
    #General
    #--------------------------------------------------------------------------------------------
    __author__ = "Ueli Saluz"
    __version__ = "2021.11.22"
    
    ghenv.Component.Name = "DomainProperties"
    ghenv.Component.NickName = "DomProp"
    ghenv.Component.Description = "Returns some properties of a domain"
    ghenv.Component.Message = "VER 1.0"
    ghenv.Component.Category = "Maths"
    ghenv.Component.SubCategory = "Domain"
    
     #Inputs
    #--------------------------------------------------------------------------------------------
    inputIndex=0
    
    ghenv.Component.Params.Input[inputIndex].Name = "Domain"
    ghenv.Component.Params.Input[inputIndex].NickName = "I"
    ghenv.Component.Params.Input[inputIndex].Description = "Domain to evaluate"
    ghenv.Component.Params.Input[inputIndex].Optional = False
    inputIndex+=1
    
    ghenv.Component.Params.Input[inputIndex].Name = "MakeIncreasing"
    ghenv.Component.Params.Input[inputIndex].NickName = "In"
    ghenv.Component.Params.Input[inputIndex].Description = "Makes sure that the domain is increasing. If not it gets swapped."
    ghenv.Component.Params.Input[inputIndex].Optional = False
    inputIndex+=1
    
    #Outputs
    #--------------------------------------------------------------------------------------------
    outputIndex=0
    
    ghenv.Component.Params.Output[outputIndex].Name = "Length"
    ghenv.Component.Params.Output[outputIndex].NickName = "L"
    ghenv.Component.Params.Output[outputIndex].Description = "Length of the domain"
    outputIndex+=1
    
    ghenv.Component.Params.Output[outputIndex].Name = "Mid"
    ghenv.Component.Params.Output[outputIndex].NickName = "M"
    ghenv.Component.Params.Output[outputIndex].Description = "Middle of the of the domain"
    outputIndex+=1
    
    ghenv.Component.Params.Output[outputIndex].Name = "DomainStartParameter"
    ghenv.Component.Params.Output[outputIndex].NickName = "T0"
    ghenv.Component.Params.Output[outputIndex].Description = "Start parameter. Doens't have to be smaller than the end parameter."
    outputIndex+=1
    
    ghenv.Component.Params.Output[outputIndex].Name = "DomainEndParameter"
    ghenv.Component.Params.Output[outputIndex].NickName = "T1"
    ghenv.Component.Params.Output[outputIndex].Description = "End parameter. Doens't have to be bigger than the start parameter."
    outputIndex+=1
    


#Imports
#--------------------------------------------------------------------------------------------
from System import Object
from Grasshopper import DataTree

#Solver - Run with trees to enhance performance drastically
#--------------------------------------------------------------------------------------------
if __name__ == "__main__":
    
    #Initialize trees
    #--------------------------------------------------------------------------------------------
    LengthTree = DataTree[Object]()
    MidTree = DataTree[Object]()
    DomainStartParameterTree = DataTree[Object]()
    DomainEndParameterTree = DataTree[Object]()
    LengthTree = DataTree[Object]()
    
    #Data matching
    #--------------------------------------------------------------------------------------------
    for path in I.Paths:
        domainBranch = I.Branch(path)
        for i,domain in enumerate(domainBranch):
            if In==True:
                domain.MakeIncreasing()
            LengthTree.Add(domain.Length, path)
            MidTree.Add(domain.Mid, path)
            DomainStartParameterTree.Add(domain.T0, path)
            DomainEndParameterTree.Add(domain.T1, path)
    
     #Assign trees to output
    #--------------------------------------------------------------------------------------------
    L = LengthTree
    M = MidTree
    T0 = DomainStartParameterTree
    T1 = DomainEndParameterTree
# ---------- end domprop ----------
ext = ExtendCurve(Curve=item_3.Item3, Type=0, Start="0", End=domprop.L)
ccx = CurveCurve(CurveA=ext, CurveB=sidebuilding)  # -> Points, ParamsA, ParamsB
trim_11 = TrimTree(Tree=ccx.Points, Depth=1)
trim_12 = TrimTree(Tree=ccx.ParamsB, Depth=1)
merge_2 = Merge(Data1=trim_12, Data2=crv_cp_2.Parameter)
trim_13 = TrimTree(Tree=ccx.ParamsA, Depth=1)
shatter_2 = Shatter(Curve=sidebuilding, Parameters=merge_2)
shatter_3 = Shatter(Curve=ext, Parameters=trim_13)
trim_14 = TrimTree(Tree=shatter_2, Depth=1)
trim_15 = TrimTree(Tree=shatter_3, Depth=1)

merge_3 = Merge(
    Data1=crv_cp_2.Point,
    Data2=item_7.Item,
    Data3=item_7.Item1,
    Data4=item_7.Item2,
    Data5=item_7.Item3,
    Data6=item_7.Item4,
    Data7=item_6.Item,
    Data8=item_6.Item1,
    Data9=item_6.Item2,
    Data10=item_6.Item3,
    Data11=item_6.Item4,
    Data12=item_6.Item5,
    Data13=item_6.Item6,
    Data14=trim_11)
intcrv = Interpolate(Vertices=merge_3, Degree=3, Periodic=False, KnotStyle=1)  # -> Curve, Length, Domain
panel_2 = Panel(intcrv.Curve)
item_8 = ListItem(List=trim_14, Index=0, Wrap=True)  # -> Item, Item1
merge_4 = Merge(Data1=intcrv.Curve, Data2=item_8.Item1)
join = JoinCurves(Curves=merge_4, Preserve=False)
trim_16 = TrimTree(Tree=join, Depth=1)
item_9 = ListItem(List=trim_15, Index=0, Wrap=True)  # -> Item, Item1
ln_6 = Line(StartPoint=item_4.Item1, EndPoint=trim_11)
blobbase = Curve(trim_16)
merge_5 = Merge(Data1=ln, Data2=lito3p.FilteredList, Data3=ln_2, Data4=item_9.Item, Data5=item_8.Item1, Data6=item_5)
merge_6 = Merge(Data1=ln_3, Data2=ln_4, Data3=ln_5, Data4=ln_6, Data5=item_8.Item1, Data6=item_5)
join_2 = JoinCurves(Curves=merge_5, Preserve=False)
sidelongfassade = Curve(ln_6)
join_3 = JoinCurves(Curves=merge_6, Preserve=False)
trim_17 = TrimTree(Tree=join_2, Depth=1)
trim_18 = TrimTree(Tree=join_3, Depth=1)
end_2 = EndPoints(Curve=trim_17)  # -> Start, End
end_3 = EndPoints(Curve=trim_18)  # -> Start, End
ln_7 = Line(StartPoint=end_2.Start, EndPoint=end_2.End)
ln_8 = Line(StartPoint=end_3.Start, EndPoint=end_3.End)
merge_7 = Merge(Data1=ln_7, Data2=trim_17)
merge_8 = Merge(Data1=ln_8, Data2=trim_18)
sidelongfassade_2 = ClusterOutput(sidelongfassade)
join_4 = JoinCurves(Curves=merge_7, Preserve=False)
join_5 = JoinCurves(Curves=merge_8, Preserve=False)
trim_19 = TrimTree(Tree=join_4, Depth=1)
trim_20 = TrimTree(Tree=join_5, Depth=1)
simplify = SimplifyCurve(Curve=trim_19)  # -> Curve, Simplified
simplify_2 = SimplifyCurve(Curve=trim_20)  # -> Curve, Simplified
crv_cp_3 = CurveClosestPoint(Point=move.Geometry, Curve=simplify.Curve)  # -> Point, Parameter, Distance
crv_cp_4 = CurveClosestPoint(Point=move.Geometry, Curve=simplify_2.Curve)  # -> Point, Parameter, Distance
seam = Seam(Curve=simplify.Curve, Seam=crv_cp_3.Parameter)
seam_2 = Seam(Curve=simplify_2.Curve, Seam=crv_cp_4.Parameter)
blobbase_2 = ClusterOutput(blobbase)
crv_cp_5 = CurveClosestPoint(Point=crv_cp.Point, Curve=seam)  # -> Point, Parameter, Distance
crv_cp_6 = CurveClosestPoint(Point=crv_cp.Point, Curve=seam_2)  # -> Point, Parameter, Distance
seam_3 = Seam(Curve=seam, Seam=crv_cp_5.Parameter)
seam_4 = Seam(Curve=seam_2, Seam=crv_cp_6.Parameter)
flip = FlipCurve(Curve=seam_3, Guide=plotoutline_2)  # -> Curve, Flag
flip_2 = FlipCurve(Curve=seam_4, Guide=plotoutline_2)  # -> Curve, Flag
basenoncore = Curve(flip.Curve)
basenoncore_2 = ClusterOutput(basenoncore)
base = Curve(flip_2.Curve)
base_2 = ClusterOutput(base)

# ==== cluster _2D
x = ClusterInput()
expression = Expression(x=x, Expression="x/2")
neg = Negative(Value=expression)
dom = ConstructDomain(DomainStart=neg, DomainEnd=expression)
I = ClusterOutput(dom)

# ==== cluster PreviewPlane: Preview a plane with axis colors and naming.
axis_length = ClusterInput()
plane = ClusterInput()
axis_length_2 = Number(axis_length)
plane_2 = Plane(plane)
deplane = DeconstructPlane(Plane=plane_2)  # -> Origin, XAxis, YAxis, ZAxis
line = LineSDL(Start=deplane.Origin, Direction=deplane.YAxis, Length=axis_length_2)
line_2 = LineSDL(Start=deplane.Origin, Direction=deplane.XAxis, Length=axis_length_2)
line_3 = LineSDL(Start=deplane.Origin, Direction=deplane.ZAxis, Length=axis_length_2)
swatch = ColourSwatch(SwatchColor=RGB(235, 52, 79))
swatch_2 = ColourSwatch(SwatchColor=RGB(0, 166, 157))
swatch_3 = ColourSwatch(SwatchColor=RGB(240, 117, 24))
end = EndPoints(Curve=line_2)  # -> Start, End
end_2 = EndPoints(Curve=line)  # -> Start, End
end_3 = EndPoints(Curve=line_3)  # -> Start, End
tag = TextTag(Location=end.End, Text="X", Colour=swatch)
tag_2 = TextTag(Location=end_2.End, Text="Y", Colour=swatch_2)
tag_3 = TextTag(Location=end_3.End, Text="Z", Colour=swatch_3)
preview = CustomPreview(Geometry=line_2, Material=swatch)
preview_2 = CustomPreview(Geometry=line, Material=swatch_2)
preview_3 = CustomPreview(Geometry=line_3, Material=swatch_3)

# ==== cluster ViewRectangle
view = ClusterInput()
view_2 = Data(view)
nickname = NAME(view=view_2)  # -> c, x, y, z, h, w
# ---------- nickname: Python ----------
uselss, c, x, y, z = view.GetCameraFrame()
h = view.FrustumHeight
w = view.FrustumWidth
# ---------- end nickname ----------
rev = Reverse(Vector=nickname.x)
rev_2 = Reverse(Vector=nickname.y)
pl = ConstructPlane(Origin=nickname.c, XAxis=rev, YAxis=nickname.y)
_2d = _2D(x=nickname.w)
_2d_2 = _2D(x=nickname.h)
rectangle = Rectangle(Plane=pl, XSize=_2d, YSize=_2d_2, Radius=0)  # -> Rectangle, Length
rec = Rectangle(rectangle.Rectangle)
rec_2 = ClusterOutput(rec)

# ==== cluster ExportBlock: Export geometry with layer names to a file.
path = ClusterInput()
name = ClusterInput()
url = ClusterInput()
geo = ClusterInput()
layer_name = ClusterInput()
export = ClusterInput()
path_2 = FilePath(path)
name_2 = Text(name)
url_2 = Text(url)
geo_2 = Geometry(geo)
layer_name_2 = Text(layer_name)
export_2 = Boolean(export)
layer = ModelLayer(Name=layer_name_2)  # -> Layer, Name, Hidden, Locked, DisplayColour, Material, Linetype
object = ModelObject(Geometry=geo_2, Layer=layer.Layer)  # -> Object, Geometry, Name, Layer, Visibility, Display, Drafting, Render
block_definition = ModelBlockDefinition(Objects=object.Object, Name=name_2, URL=url_2)  # -> BlockDefinition, Objects, Units, Name, Notes, URL, URLDescription
export_definition = ExportModelBlockDefinition(BlockDefinition=block_definition.BlockDefinition, FilePath=path_2, Overwrite="T", Export=export_2)  # -> BlockDefinition, FilePath, Exported
block_definition_2 = ModelBlockDefinition(export_definition.BlockDefinition)
path_3 = FilePath(export_definition.FilePath)
exported = Boolean(export_definition.Exported)
path_4 = ClusterOutput(path_3)
exported_2 = ClusterOutput(exported)
block_definition_3 = ClusterOutput(block_definition_2)

# ==== cluster BoundingRectangle: Get a bounding rectangle on a plane of individual geometry.
geometry = ClusterInput()
plane = ClusterInput()
plane_2 = Plane(plane)
geometry_2 = Geometry(geometry)
bbox = BoundingBox(Content=geometry_2, Plane=plane_2)  # -> Box, Box_2
trim = TrimTree(Tree=bbox.Box, Depth=1)
debox = DeconstructBox(Box=trim)  # -> Plane, X, Y, Z
rectangle = Rectangle(Plane=debox.Plane, XSize=debox.X, YSize=debox.Y, Radius=0)  # -> Rectangle, Length
boundingrectangle = Rectangle(rectangle.Rectangle)
length = Number(rectangle.Length)
length_2 = ClusterOutput(length)
boundingrectangle_2 = ClusterOutput(boundingrectangle)
