# Grasshopper definition bridge.gh (Grasshopper 1.0.7)
# plug-ins: semio, eleFront

save_representation = BooleanToggle(False)
icon_export = BooleanToggle(False)
save = BooleanToggle(False)
and = GateAnd(B=icon_export)
and_2 = GateAnd(A=save, B=save_representation)
expression = Expression(x=Slider(260, range=0..1000), Expression="x/100")
# ^
#                  |
# Preview    ->
# ^
#  |
# <- Meta
# Parameters:
# <- Variants
#   |
#   v
curdir = CurrentDirectory()  # -> PD, D, P, S
# ---------- curdir: Python ----------
# Component Information
# --------------------------------------------------------------------------------------------
if ghenv.Component.RunCount < 2:
    # General
    # --------------------------------------------------------------------------------------------
    __author__ = "Ueli Saluz"
    __version__ = "2024.07.26"

    ghenv.Component.Name = "CurrentDirectory"
    ghenv.Component.NickName = "CurDir"
    ghenv.Component.Description = "Current directory of the current grasshopper file."
    ghenv.Component.Message = "VER 1.1"
    ghenv.Component.Category = "Params"
    ghenv.Component.SubCategory = "Util"

    # Outputs
    # --------------------------------------------------------------------------------------------
    outputIndex = 0

    ghenv.Component.Params.Output[outputIndex].Name = "ParentDirectory"
    ghenv.Component.Params.Output[outputIndex].NickName = "PD"
    ghenv.Component.Params.Output[outputIndex].Description = "Parent directory of the current directory."
    outputIndex += 1

    ghenv.Component.Params.Output[outputIndex].Name = "Directory"
    ghenv.Component.Params.Output[outputIndex].NickName = "D"
    ghenv.Component.Params.Output[outputIndex].Description = "Directory of the current grasshopper file."
    outputIndex += 1

    ghenv.Component.Params.Output[outputIndex].Name = "Path"
    ghenv.Component.Params.Output[outputIndex].NickName = "P"
    ghenv.Component.Params.Output[outputIndex].Description = "Path of the current grasshopper file."
    outputIndex += 1

    ghenv.Component.Params.Output[outputIndex].Name = "Separator"
    ghenv.Component.Params.Output[outputIndex].NickName = "S"
    ghenv.Component.Params.Output[outputIndex].Description = "Separator of the current system."
    outputIndex += 1

# Imports
# --------------------------------------------------------------------------------------------
from os.path import dirname, abspath
from os import sep

# Solver - Run with trees to enhance performance drastically
# --------------------------------------------------------------------------------------------
if __name__ == "__main__":
    P = ghenv.Component.OnPingDocument().FilePath
    D = dirname(P)
    PD = dirname(D)
    S = sep
# ---------- end curdir ----------
# External
#      |
#      v
length_m = GetNumber(expression, AtLeast=1, AtMost=1, Maximum=1.797693135e+308, Minimum=-1.797693135e+308, TreeAccess=False)
expression_2 = Expression(x=Slider(40, range=0..100), Expression="x/100")
expression_3 = Expression(x=Slider(250, range=0..1000), Expression="x/100")
width_m = Number(length_m)
east_length_m = Number(length_m)
gap_m = Number(expression_2)
height_m = Number(expression_3)
west_length_m = Number(length_m)
number_slider = Slider(125, range=0..1000)
genes = GenePool(Decimals=0, Maximum=100, Minimum=0, Value=80)
number_slider_2 = Slider(20, range=0..100)

addition = Addition(A=west_length_m, B=gap_m)
addition_2 = Addition(A=west_length_m, B=east_length_m, C=gap_m)
neg = Negative(Value=width_m)
dom = ConstructDomain(DomainStart=addition, DomainEnd=addition_2)
box = DomainBox(Base=PlaneXY(0, 0, 0), X=addition_2, Y=neg, Z=height_m)
box_2 = DomainBox(Base=PlaneXY(0, 0, 0), X=dom, Y=neg, Z=height_m)
volumeright = Box(box_2)
volumemain = Box(box)

expression_4 = Expression(x=number_slider_2, Expression="x/100")
expression_5 = Expression(x=Slider(1, range=0..100), Expression="x/100")
expression_6 = Expression(x=number_slider, Expression="x/100")
expression_7 = Expression(x=genes, Expression="x/100")
parapet_height_m = Number(expression_6)
platform_height_m = Number(expression_4)
parapet_segments_height_m = Number(expression_7)
flooring_height_m = Number(expression_5)
number_slider_3 = Slider(8, range=0..100)
number_slider_4 = Slider(10, range=0..100)
number_slider_5 = Slider(6, range=0..100)
expression_8 = Expression(x=number_slider_4, Expression="x/100")
expression_9 = Expression(x=number_slider_3, Expression="x/100")
expression_10 = Expression(x=number_slider_5, Expression="x/100")
frame_primary_diameter_m = Number(expression_8)

# ----
# Outputs   ->
#                 |
#                 v
neg_2 = Negative(Value=width_m)
addition_3 = Addition(A=west_length_m, B=gap_m)
addition_4 = Addition(A=neg_2, B=frame_primary_diameter_m)
neg_3 = Negative(Value=frame_primary_diameter_m)
dom_2 = ConstructDomain(DomainStart=west_length_m, DomainEnd=addition_3)
dom_3 = ConstructDomain(DomainStart=neg_3, DomainEnd=addition_4)
rectangle = Rectangle(Plane=PlaneXY(0, 0, 0), XSize=dom_2, YSize=dom_3, Radius=0)  # -> Rectangle, Length
srf = Surface(rectangle.Rectangle)

frame_secondary_diameter_m = Number(expression_9)
frame_tertiary_diameter_m = Number(expression_10)

concat = Concatenate(FragmentC="representations", FragmentD=curdir.S, FragmentA="bridge")
concat_2 = Concatenate(FragmentA=concat, FragmentB="_", FragmentE="1to200", FragmentG="_", FragmentF="volume")
concat_3 = Concatenate(FragmentA=concat, FragmentB="_", FragmentE="1to500", FragmentG="_", FragmentF="volume")
concat_4 = Concatenate(FragmentA=concat_3, FragmentB=".3dm")
concat_5 = Concatenate(FragmentA=concat_2, FragmentB=".3dm")
concat_6 = Concatenate(FragmentA=concat, FragmentB=".glb")
rep = ModelRepresentation(Url=concat_5, LevelOfDetail="1to200", Tags="volume")  # -> Representation, Url, LevelOfDetail, Tags
rep_2 = ModelRepresentation(Url=concat_4, LevelOfDetail="1to500", Tags="volume")  # -> Representation, Url, LevelOfDetail, Tags
rep_3 = ModelRepresentation(Url=concat_6)  # -> Representation, Url, LevelOfDetail, Tags

expression_11 = Expression(x=Slider(250, range=0..1000), Expression="x/100")
expression_12 = Expression(x=Slider(125, range=0..1000), Expression="x/100")
west_addition = Boolean(Toggle(True))
east_addition = Boolean(Toggle(False))
addition_length_m = Number(expression_11)
addition_width_m = Number(expression_12)

# ----
# Local ->
cluster = Cluster(
    length=west_length_m,
    width=width_m,
    height=height_m,
    parapetheight=parapet_height_m,
    parapetsegmentsheight=parapet_segments_height_m,
    addition=west_addition,
    additionlength=addition_length_m,
    additionwidth=addition_width_m,
    rodprimarydiameter=frame_primary_diameter_m,
    rodsecondarydiameter=frame_secondary_diameter_m,
    rodtertiarydiameter=frame_tertiary_diameter_m)  # -> ground_2, volume_2, volumeside_2, base_2, rods_2, mainframe_2, filledsurface_2
cluster_2 = Cluster(
    length=east_length_m,
    width=width_m,
    height=height_m,
    parapetheight=parapet_height_m,
    parapetsegmentsheight=parapet_segments_height_m,
    addition=east_addition,
    additionlength=addition_length_m,
    additionwidth=addition_width_m,
    rodprimarydiameter=frame_primary_diameter_m,
    rodsecondarydiameter=frame_secondary_diameter_m,
    rodtertiarydiameter=frame_tertiary_diameter_m)  # -> ground_2, volume_2, volumeside_2, base_2, rods_2, mainframe_2, filledsurface_2
area = Area(Geometry=cluster_2.volume_2)  # -> Area, Centroid
neg_4 = Negative(Value=platform_height_m)
sunion = SolidUnion(Breps=cluster_2.rods_2)
yz = YZPlane(Origin=area.Centroid)
Z = UnitZ(Factor=neg_4)
mirror = Mirror(Geometry=sunion, Plane=yz)  # -> Geometry, Transform
X = UnitX(Factor=addition_3)
extr = Extrude(Base=cluster.base_2, Direction=Z)
move = Move(Geometry=mirror.Geometry, Motion=X)  # -> Geometry, Transform
merge = Merge(Data1=mirror.Transform, Data2=move.Transform)
comp = Compound(Transforms=merge)
baseleft = Brep(extr)
merge_2 = Merge(Data1=cluster.rods_2, Data2=baseleft)
merge_3 = Merge(Data1=cluster.rods_2, Data2=move.Geometry)
transform = Transform(Geometry=cluster_2.ground_2, Transform=comp)
transform_2 = Transform(Geometry=cluster_2.base_2, Transform=comp)
transform_3 = Transform(Geometry=cluster_2.mainframe_2, Transform=comp)
merge_4 = Merge(Data1=cluster.mainframe_2, Data2=transform_3)
transform_4 = Transform(Geometry=cluster_2.filledsurface_2, Transform=comp)
merge_5 = Merge(Data1=cluster.filledsurface_2, Data2=transform_4)
sunion_2 = SolidUnion(Breps=merge_2)
rods = Brep(merge_3)
extr_2 = Extrude(Base=transform_2, Direction=Z)
rodsmain = Brep(merge_4)
surface = Brep(merge_5)
merge_6 = Merge(Data1=cluster.ground_2, Data2=srf, Data3=transform)
baseright = Brep(extr_2)
join = BrepJoin(Breps=merge_6)  # -> Breps, Closed
merge_7 = Merge(Data1=baseleft, Data2=baseright)
merge_8 = Merge(Data1=move.Geometry, Data2=baseright)
fmerge = MergeFaces(Brep=join.Breps)  # -> Breps, Before, After
Z_2 = UnitZ(Factor=flooring_height_m)
base = Brep(merge_7)
sunion_3 = SolidUnion(Breps=merge_8)
extr_3 = Extrude(Base=fmerge.Breps, Direction=Z_2)
merge_9 = Merge(Data1=sunion_2, Data2=sunion_3)
metalplate = Brep(extr_3)
merge_10 = Merge(Data1=extr_3, Data2=merge_9)
model1to200 = Brep(merge_10)

concat_7 = Concatenate(FragmentA=curdir.PD, FragmentB=curdir.S, FragmentC=rep_2.Url)
concat_8 = Concatenate(FragmentA=curdir.PD, FragmentB=curdir.S, FragmentC=rep.Url)
metalplate_2 = Brep(fmerge.Breps)
rodsmain_2 = Brep(rodsmain)
metalplate_3 = Brep(metalplate)
base_2 = Brep(base)
rods_2 = Brep(rods)
surface_2 = Brep(surface)
expression_13 = Expression(x="rods", y=rods_2, Expression="x")
expression_14 = Expression(x="rods", y=rodsmain_2, Expression="x")
expression_15 = Expression(x="railing", y=surface_2, Expression="x")
expression_16 = Expression(x="base", y=base_2, Expression="x")
expression_17 = Expression(x="metal plate", y=metalplate_2, Expression="x")
merge_11 = Merge(Data1=expression_16, Data2=expression_17, Data3=expression_13)
merge_12 = Merge(Data1=base_2, Data2=metalplate_3, Data3=rods_2)
merge_13 = Merge(Data1=base_2, Data2=metalplate_2, Data3=rodsmain_2, Data4=surface_2)
merge_14 = Merge(Data1=expression_16, Data2=expression_17, Data3=expression_14, Data4=expression_15)
ef_layer = EleFrontLayer(FullPath=merge_14)  # -> Layer, FullPath, Hidden, Locked, DisplayColour, MaterialName, Linetype, PrintColour, PrintWidth
ef_layer_2 = EleFrontLayer(FullPath=merge_11)  # -> Layer, FullPath, Hidden, Locked, DisplayColour, MaterialName, Linetype, PrintColour, PrintWidth
ef_att = EleFrontAttributes(Layer=ef_layer.Layer)  # -> Attributes, Keys, Values, Name, Layer, ColourSource, DisplayColour, MaterialSource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
ef_att_2 = EleFrontAttributes(Layer=ef_layer_2.Layer)  # -> Attributes, Keys, Values, Name, Layer, ColourSource, DisplayColour, MaterialSource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
baketofile = BakeObjectsToFile(
    FilePath=concat_7,
    Geometry=merge_13,
    Attributes=ef_att.Attributes,
    Bake=and_2,
    networkMode=False,
    ValueTable_networkMode=True,
    overwriteMode="Overwrite",
    preset="Safest")
baketofile_2 = BakeObjectsToFile(
    FilePath=concat_8,
    Geometry=merge_12,
    Attributes=ef_att_2.Attributes,
    Bake=and_2,
    networkMode=False,
    ValueTable_networkMode=True,
    overwriteMode="Overwrite",
    preset="Safest")

expression_18 = Expression(x=Slider(30, range=0..100), Expression="x/100")
expression_19 = Expression(x=Slider(80, range=0..100), Expression="x/100")
door_width_m = Number(expression_19)
door_offset_m = Number(expression_18)

expression_20 = Expression(x=door_width_m, Expression="x/2")
addition_5 = Addition(A=expression_20, B=door_offset_m, C=frame_primary_diameter_m)
neg_5 = Negative(Value=addition_5)
pt = ConstructPoint(XCoordinate=0, YCoordinate=0, ZCoordinate=0)
Y = UnitY(Factor=neg_5)
X_2 = UnitX(Factor=east_length_m)
addition_6 = Addition(A=X, B=X_2)
move_2 = Move(Geometry=pt, Motion=Y)  # -> Geometry, Transform
X_3 = UnitX(Factor=1)
rev = Reverse(Vector=X_3)
move_3 = Move(Geometry=move_2.Geometry, Motion=addition_6)  # -> Geometry, Transform
merge_15 = Merge(Data1=move_3.Geometry, Data2=move_2.Geometry)
merge_16 = Merge(Data1=X_3, Data2=rev)
panel = Panel("""east
west""")
panel_2 = Panel("""e
w""")
por = ModelPort(Id=graft(panel_2), Point=graft(merge_15), Direction=graft(merge_16), Locators=graft(panel))  # -> Port, Id, Point, Direction, Locators
trim = TrimTree(Tree=por.Port, Depth=1)

previewplane = PreviewPlane(plane=merge_15, axis_length=Slider(0.5, range=0..1))
maintenance_expenses_month_eff_m² = Number(Slider(5, range=0..10))
construction_cost_eff_m² = Number(Slider(4500, range=0..10000))
construction_global_warming_potential_kg = Number(Slider(400, range=0..2000))  # "Construction Global Warming Potential [kgCO2e/eff. m²]"

maintenance_expenses_month_eff_m²_2 = Number(maintenance_expenses_month_eff_m²)
construction_global_warming_potential_kg_2 = Number(construction_global_warming_potential_kg)  # "Construction Global Warming Potential [kgCO2e/eff. m²]"
construction_cost_eff_m²_2 = Number(construction_cost_eff_m²)
area_2 = Area(Geometry=cluster.ground_2)  # -> Area, Centroid
area_3 = Area(Geometry=cluster_2.ground_2)  # -> Area, Centroid
addition_7 = Addition(A=area_2.Area, B=area_3.Area)
multiplication = Multiplication(A=addition_7, B=maintenance_expenses_month_eff_m²_2)
expression_21 = Expression(x=multiplication, Expression="x*12")
multiplication_2 = Multiplication(A=addition_7, B=construction_global_warming_potential_kg_2)
multiplication_3 = Multiplication(A=addition_7, B=construction_cost_eff_m²_2)
round = Round(Number=expression_21)  # -> Nearest, Floor, Ceiling
round_2 = Round(Number=multiplication_2)  # -> Nearest, Floor, Ceiling
addition_8 = Addition(A=west_length_m, B=east_length_m, C=gap_m)
round_3 = Round(Number=multiplication_3)  # -> Nearest, Floor, Ceiling
merge_17 = Merge(
    Data1=addition_8,
    Data2=length_m,
    Data3=east_length_m,
    Data4=gap_m,
    Data5=width_m,
    Data6=height_m,
    Data7=number_slider_2,
    Data8=number_slider_4,
    Data9=number_slider_3,
    Data10=number_slider_5,
    Data11=number_slider,
    Data12=round_3.Nearest,
    Data13=round.Nearest,
    Data14=round_2.Nearest)
panel_3 = Panel("https://identifier.buildingsmart.org/uri/etim/etim/9.0/prop/EF016979")
panel_4 = Panel("""length
platform west length
platform east length
gap
width
height
base height
primary rod diameter
secondary rod diameter
tertiary rod diameter
parapet height
construction cost
maintenance expenses
construction global warming potential""")
panel_5 = Panel(merge_17)
panel_6 = Panel("""m
m
m
m
m
m
m
m
m
m
m
€
€/a
kgCO2e""")
qlt = ModelQuality(Name=panel_4, Value=panel_5, Unit=panel_6, Definition=panel_3)  # -> Quality, Name, Value, Unit, Definition

panel_7 = Panel("A bridge with two segments an addition on the west along the main path.")
merge_18 = Merge(Data1=rep_3.Representation, Data2=rep_2.Representation, Data3=rep.Representation)
typ = ModelType(Name="Bridge", Description=panel_7, Icon="🌉", Representations=merge_18, Ports=trim, Qualities=qlt.Quality)  # -> Type, Name, Description, Icon, Variant, Unit, Representations, Ports, Qualities
typ_2 = RemoveType(TypeName=typ.Name, TypeVariant=typ.Variant, Run=save)
or = GateOr(A=save, B=typ_2)
typ_3 = AddType(Type=typ.Type, Run=or)

typ_4 = SerializeType(Type=typ.Type)
type = Text(typ_4)
context_bake = ContextBake(Geometry=type)

# ==== cluster Cluster
length = ClusterInput()
width = ClusterInput()
height = ClusterInput()
parapetheight = ClusterInput()
parapetsegmentsheight = ClusterInput()
additionlength = ClusterInput()
additionwidth = ClusterInput()
rodprimarydiameter = ClusterInput()
rodsecondarydiameter = ClusterInput()
rodtertiarydiameter = ClusterInput()
addition = ClusterInput()
width_2 = Number(width)
parapetheight_2 = Number(parapetheight)
additionwidth_2 = Number(additionwidth)
rodprimarydiameter_2 = Number(rodprimarydiameter)
length_2 = Number(length)
height_2 = Number(height)
parapetsegmentsheight_2 = Number(parapetsegmentsheight)
addition_2 = Boolean(addition)
additionlength_2 = Number(additionlength)
rodsecondarydiameter_2 = Number(rodsecondarydiameter)
rodtertiarydiameter_2 = Number(rodtertiarydiameter)
neg = Negative(Value=width_2)
addition_3 = Addition(A=width_2, B=additionlength_2)
expression = Expression(x=rodprimarydiameter_2, Expression="x/2")
expression_2 = Expression(x=rodprimarydiameter_2, Expression="x*Sqrt(2)")
expression_3 = Expression(x=rodsecondarydiameter_2, Expression="x/2")
neg_2 = Negative(Value=rodprimarydiameter_2)
neg_3 = Negative(Value=addition_3)
neg_4 = Negative(Value=expression)
subtraction = Subtraction(A=additionwidth_2, B=expression_3)
addition_4 = Addition(A=neg_3, B=expression_3)
addition_5 = Addition(A=expression, B=length_2)
subtraction_2 = Subtraction(A=height_2, B=expression_2)
addition_6 = Addition(A=neg, B=expression)
addition_7 = Addition(A=neg, B=expression)
expression_4 = Expression(x=addition_5, y=expression, Expression="x-2*y")

dom = ConstructDomain(DomainStart=neg_4, DomainEnd=addition_6)
dom_2 = ConstructDomain(DomainStart=expression, DomainEnd=expression_4)
dom_3 = ConstructDomain(DomainStart=neg, DomainEnd=neg_3)
dom_4 = ConstructDomain(DomainStart=expression, DomainEnd=subtraction)
dom_5 = ConstructDomain(DomainStart=addition_7, DomainEnd=addition_4)
box = DomainBox(Base=PlaneXY(0, 0, 0), X=length_2, Y=neg, Z=height_2)
box_2 = DomainBox(Base=PlaneXY(0, 0, 0), X=dom_2, Y=dom, Z=subtraction_2)
box_3 = DomainBox(Base=PlaneXY(0, 0, 0), X=additionwidth_2, Y=dom_3, Z=height_2)
box_4 = DomainBox(Base=PlaneXY(0, 0, 0), X=dom_4, Y=dom_5, Z=subtraction_2)
volumesideinner = Box(box_4)
volumeinner = Box(box_2)
volumeside = Box(box_3)
volume = Box(box)

# ----
# Dimensions aren't exact!
domprop = DomainProperties(I=dom_5, In=True)  # -> L, M, T0, T1; inputs I: tree, In: tree of Boolean
# ---------- domprop: Python ----------
#Component Information
#--------------------------------------------------------------------------------------------
if ghenv.Component.RunCount<2:
    #General
    #--------------------------------------------------------------------------------------------
    __author__ = "Ueli Saluz"
    __version__ = "2021.11.22"
    
    ghenv.Component.Name = "DomainProperties"
    ghenv.Component.NickName = "DomProp"
    ghenv.Component.Description = "Returns some properties of a domain"
    ghenv.Component.Message = "VER 1.0"
    ghenv.Component.Category = "Maths"
    ghenv.Component.SubCategory = "Domain"
    
     #Inputs
    #--------------------------------------------------------------------------------------------
    inputIndex=0
    
    ghenv.Component.Params.Input[inputIndex].Name = "Domain"
    ghenv.Component.Params.Input[inputIndex].NickName = "I"
    ghenv.Component.Params.Input[inputIndex].Description = "Domain to evaluate"
    ghenv.Component.Params.Input[inputIndex].Optional = False
    inputIndex+=1
    
    ghenv.Component.Params.Input[inputIndex].Name = "MakeIncreasing"
    ghenv.Component.Params.Input[inputIndex].NickName = "In"
    ghenv.Component.Params.Input[inputIndex].Description = "Makes sure that the domain is increasing. If not it gets swapped."
    ghenv.Component.Params.Input[inputIndex].Optional = False
    inputIndex+=1
    
    #Outputs
    #--------------------------------------------------------------------------------------------
    outputIndex=0
    
    ghenv.Component.Params.Output[outputIndex].Name = "Length"
    ghenv.Component.Params.Output[outputIndex].NickName = "L"
    ghenv.Component.Params.Output[outputIndex].Description = "Length of the domain"
    outputIndex+=1
    
    ghenv.Component.Params.Output[outputIndex].Name = "Mid"
    ghenv.Component.Params.Output[outputIndex].NickName = "M"
    ghenv.Component.Params.Output[outputIndex].Description = "Middle of the of the domain"
    outputIndex+=1
    
    ghenv.Component.Params.Output[outputIndex].Name = "DomainStartParameter"
    ghenv.Component.Params.Output[outputIndex].NickName = "T0"
    ghenv.Component.Params.Output[outputIndex].Description = "Start parameter. Doens't have to be smaller than the end parameter."
    outputIndex+=1
    
    ghenv.Component.Params.Output[outputIndex].Name = "DomainEndParameter"
    ghenv.Component.Params.Output[outputIndex].NickName = "T1"
    ghenv.Component.Params.Output[outputIndex].Description = "End parameter. Doens't have to be bigger than the start parameter."
    outputIndex+=1
    


#Imports
#--------------------------------------------------------------------------------------------
from System import Object
from Grasshopper import DataTree

#Solver - Run with trees to enhance performance drastically
#--------------------------------------------------------------------------------------------
if __name__ == "__main__":
    
    #Initialize trees
    #--------------------------------------------------------------------------------------------
    LengthTree = DataTree[Object]()
    MidTree = DataTree[Object]()
    DomainStartParameterTree = DataTree[Object]()
    DomainEndParameterTree = DataTree[Object]()
    LengthTree = DataTree[Object]()
    
    #Data matching
    #--------------------------------------------------------------------------------------------
    for path in I.Paths:
        domainBranch = I.Branch(path)
        for i,domain in enumerate(domainBranch):
            if In==True:
                domain.MakeIncreasing()
            LengthTree.Add(domain.Length, path)
            MidTree.Add(domain.Mid, path)
            DomainStartParameterTree.Add(domain.T0, path)
            DomainEndParameterTree.Add(domain.T1, path)
    
     #Assign trees to output
    #--------------------------------------------------------------------------------------------
    L = LengthTree
    M = MidTree
    T0 = DomainStartParameterTree
    T1 = DomainEndParameterTree
# ---------- end domprop ----------
panel = Panel(domprop.L)
volumeinner_2 = Box(box_2)
volume_2 = ClusterOutput(volume)
volumeside_2 = ClusterOutput(volumeside)

debrep = DeconstructBrep(Brep=volumeside)  # -> Faces, Edges, Vertices
debrep_2 = DeconstructBrep(Brep=volume)  # -> Faces, Edges, Vertices
trim = TrimTree(Tree=debrep.Faces, Depth=1)
trim_2 = TrimTree(Tree=debrep_2.Faces, Depth=1)
trim_3 = TrimTree(Tree=debrep_2.Vertices, Depth=1)
item = ListItem(List=trim, Index=0, Wrap=True)  # -> Item2, Item1, Item
item_2 = ListItem(List=trim_2, Index=0, Wrap=True)  # -> Item2, Item1, Item
item_3 = ListItem(List=trim_3, Index=0, Wrap=True)
merge = Merge(Data1=item_2.Item2, Data2=item.Item2)
join = BrepJoin(Breps=merge)  # -> Breps, Closed
fmerge = MergeFaces(Brep=join.Breps)  # -> Breps, Before, After
filter = StreamFilter(Gate=addition_2, Stream0=item_2.Item2, Stream1=fmerge.Breps)
base = Brep(filter)

neg_5 = Negative(Value=expression)
neg_6 = Negative(Value=expression)
X = UnitX(Factor=rodprimarydiameter_2)
Y = UnitY(Factor=rodprimarydiameter_2)
base_2 = ClusterOutput(base)
rodcaptype = Integer(Slider(1, range=0..2))

rodmainprimarydiameter = Number(rodprimarydiameter_2)
area = Area(Geometry=volumeinner_2)  # -> Area, Centroid
debrep_3 = DeconstructBrep(Brep=volumeinner_2)  # -> Faces, Edges, Vertices
trim_4 = TrimTree(Tree=debrep_3.Vertices, Depth=1)
trim_5 = TrimTree(Tree=debrep_3.Edges, Depth=1)
item_4 = ListItem(List=trim_4, Index=0, Wrap=True)  # -> Item1, Item, Item1_2, Item2, Item3, Item4
item_5 = ListItem(List=trim_5, Index=0, Wrap=True)  # -> Item4, Item3, Item2, Item1, Item
ln = Line(StartPoint=item_4.Item1, EndPoint=item_4.Item2)
ln_2 = Line(StartPoint=item_4.Item4, EndPoint=item_4.Item1_2)
merge_2 = Merge(Data1=item_5.Item1, Data2=ln)
merge_3 = Merge(Data1=item_5.Item4, Data2=ln_2)
join_2 = JoinCurves(Curves=merge_2, Preserve=False)
join_3 = JoinCurves(Curves=merge_3, Preserve=False)
trim_6 = TrimTree(Tree=join_2, Depth=1)
trim_7 = TrimTree(Tree=join_3, Depth=1)
expression_5 = Expression(x=rodmainprimarydiameter, Expression="x/2")
merge_4 = Merge(Data1=trim_6, Data2=trim_7)
pipe = Pipe(Curve=merge_4, Radius=expression_5, Caps=rodcaptype)
trim_8 = TrimTree(Tree=pipe, Depth=1)
mainframe = Brep(trim_8)

intermediateposts = Integer(Slider(1, range=0..10))
expression_6 = Expression(x=intermediateposts, Expression="x+1")
Z = UnitZ(Factor=parapetheight_2)
Z_2 = UnitZ(Factor=parapetsegmentsheight_2)
expression_7 = Expression(x=rodtertiarydiameter_2, Expression="x/2")
expression_8 = Expression(x=rodsecondarydiameter_2, Expression="x/2")
expression_9 = Expression(x=rodtertiarydiameter_2, Expression="x/2")
mainframe_2 = ClusterOutput(mainframe)

debrep_4 = DeconstructBrep(Brep=volumesideinner)  # -> Faces, Edges, Vertices
debrep_5 = DeconstructBrep(Brep=volumeinner)  # -> Faces, Edges, Vertices
trim_9 = TrimTree(Tree=debrep_4.Faces, Depth=1)
trim_10 = TrimTree(Tree=debrep_4.Vertices, Depth=1)
trim_11 = TrimTree(Tree=debrep_5.Faces, Depth=1)
trim_12 = TrimTree(Tree=debrep_5.Vertices, Depth=1)
trim_13 = TrimTree(Tree=debrep_5.Edges, Depth=1)
item_6 = ListItem(List=trim_9, Index=0, Wrap=True)  # -> Item2, Item1, Item
item_7 = ListItem(List=trim_10, Index=0, Wrap=True)  # -> Item, Item1, Item2
item_8 = ListItem(List=trim_11, Index=0, Wrap=True)  # -> Item2, Item1, Item
item_9 = ListItem(List=trim_13, Index=0, Wrap=True)  # -> Item, Item1, Item2, Item3, Item4, Item5, Item6, Item7
item_10 = ListItem(List=trim_12, Index=0, Wrap=True)  # -> Item, Item1, Item2
basesideinner = Surface(item_6.Item2)
baseinner = Surface(item_8.Item2)
merge_5 = Merge(Data1=baseinner, Data2=basesideinner)
join_4 = BrepJoin(Breps=merge_5)  # -> Breps, Closed
fmerge_2 = MergeFaces(Brep=join_4.Breps)  # -> Breps, Before, After

offset = OffsetCurve(Curve=basesideinner, Distance=neg_5, Corners=1)
offset_2 = OffsetCurve(Curve=baseinner, Distance=neg_6, Corners=1)
trim_14 = TrimTree(Tree=offset_2, Depth=1)
trim_15 = TrimTree(Tree=offset, Depth=1)
explode = Explode(Curve=trim_14, Recursive=True)  # -> Segments, Vertices
explode_2 = Explode(Curve=trim_15, Recursive=True)  # -> Segments, Vertices
trim_16 = TrimTree(Tree=explode.Vertices, Depth=1)
trim_17 = TrimTree(Tree=explode_2.Vertices, Depth=1)
item_11 = ListItem(List=trim_16, Index=0, Wrap=True)  # -> Item3, Item2, Item1, Item, Item1_2
item_12 = ListItem(List=trim_17, Index=0, Wrap=True)  # -> Item, Item1, Item2, Item3
filter_2 = StreamFilter(Gate=addition_2, Stream0=item_8.Item2, Stream1=fmerge_2.Breps)
move = Move(Geometry=item_12.Item3, Motion=Y)  # -> Geometry, Transform
move_2 = Move(Geometry=item_11.Item3, Motion=X)  # -> Geometry, Transform
move_3 = Move(Geometry=item_11.Item2, Motion=X)  # -> Geometry, Transform

baseleft = Brep(filter_2)

merge_6 = Merge(Data1=item_11.Item, Data2=item_11.Item1_2, Data3=move_2.Geometry, Data4=move_3.Geometry, Data5=item_11.Item)
merge_7 = Merge(
    Data1=item_11.Item,
    Data2=item_12.Item1,
    Data3=item_12.Item2,
    Data4=move.Geometry,
    Data5=move_2.Geometry,
    Data6=move_3.Geometry,
    Data7=item_11.Item)
explode_3 = Explode(Curve=baseleft, Recursive=True)  # -> Segments, Vertices
pline = PolyLine(Vertices=merge_7, Closed=False)
pline_2 = PolyLine(Vertices=merge_6, Closed=False)
reprmcrv = ReparametrizeCurve(C=item_9.Item2)  # -> RC, I, IL; inputs C: tree, T0: tree, T1: tree
# ---------- reprmcrv: Python ----------
#Component Information
#--------------------------------------------------------------------------------------------
if ghenv.Component.RunCount<2:
    #General
    #--------------------------------------------------------------------------------------------
    __author__ = "Ueli Saluz"
    __version__ = "2021.11.15"
    #--------------------------------------------------------------------------------------------
    ghenv.Component.Name = "ReparametrizeCurve"
    ghenv.Component.NickName = "RePrmCrv"
    ghenv.Component.Description = "Reparametrize the domain of a curve to the interval from 0 to the length of the curve."
    ghenv.Component.Message = "VER 1.0"
    
    ghenv.Component.Category = "Curve"
    ghenv.Component.SubCategory = "Util"
    
    #Inputs
    #--------------------------------------------------------------------------------------------
    inputIndex=0
    
    ghenv.Component.Params.Input[inputIndex].Name = "Curve"
    ghenv.Component.Params.Input[inputIndex].NickName = "C"
    ghenv.Component.Params.Input[inputIndex].Description = "Curve to reparametrize domain to interval [0,length]"
    ghenv.Component.Params.Input[inputIndex].Optional = True
    inputIndex+=1
    
    ghenv.Component.Params.Input[inputIndex].Name = "DomainStart"
    ghenv.Component.Params.Input[inputIndex].NickName = "T0"
    ghenv.Component.Params.Input[inputIndex].Description = "Starting value of domain that will be used to reparametrized. Default is 0."
    ghenv.Component.Params.Input[inputIndex].Optional = True
    inputIndex+=1
    
    ghenv.Component.Params.Input[inputIndex].Name = "DomainEnd"
    ghenv.Component.Params.Input[inputIndex].NickName = "T1"
    ghenv.Component.Params.Input[inputIndex].Description = "End value of domain that will be used to reparametrized. Default is length."
    ghenv.Component.Params.Input[inputIndex].Optional = True
    inputIndex+=1
    
    #Outputs
    #--------------------------------------------------------------------------------------------
    outputIndex=0
    
    ghenv.Component.Params.Output[outputIndex].Name = "ReparametrizedCurve"
    ghenv.Component.Params.Output[outputIndex].NickName = "RC"
    ghenv.Component.Params.Output[outputIndex].Description = "Reparametrized curve"
    outputIndex+=1
    
    ghenv.Component.Params.Output[outputIndex].Name = "Domain"
    ghenv.Component.Params.Output[outputIndex].NickName = "I"
    ghenv.Component.Params.Output[outputIndex].Description = "Domain of the reparametrized curve"
    outputIndex+=1
    
    ghenv.Component.Params.Output[outputIndex].Name = "DomainLength"
    ghenv.Component.Params.Output[outputIndex].NickName = "IL"
    ghenv.Component.Params.Output[outputIndex].Description = "Length of the domain of the reparametrized curve"
    outputIndex+=1


#Imports
#--------------------------------------------------------------------------------------------
from Rhino.Geometry import Interval, Curve
from System import Object
from Grasshopper import DataTree


#The Component function - Buisness logic only (e.g. working without trees)
#--------------------------------------------------------------------------------------------
"""Reparametrize the domain of a curve to the interval from 0 to the length of the curve.
    Inputs:
        crv: curve to reparametrize domain to interval [0,length]
        t0: Starting value of domain that will be used to reparametrized. Default is 0.
        t1: End value of domain that will be used to reparametrized. Default is length.
    Output:
        rc: Reparametrized curve"""
def reparametrizeCurve (crv,t0=None,t1=None):
    if(t0 is None):
        t0=0
    if(t1 is None):
        t1=crv.GetLength()
    crv.Domain = Interval(t0,t1)
    return crv

#Solver - Run with trees to enhance performance drastically
#--------------------------------------------------------------------------------------------
if __name__ == "__main__":
    
    #Initialize trees
    #--------------------------------------------------------------------------------------------
    ReparametrizedCurveTree = DataTree[Object]()
    DomainTree = DataTree[Object]()
    DomainLengthTree = DataTree[Object]()
    
    #Data matching
    #--------------------------------------------------------------------------------------------
    for path in C.Paths:
        curveBranch = C.Branch(path)
        for i,curve in enumerate(curveBranch):
            reparametrizedCurve = reparametrizeCurve(curve)
            ReparametrizedCurveTree.Add(reparametrizedCurve,path)
            DomainTree.Add(reparametrizedCurve.Domain,path)
            DomainLengthTree.Add(reparametrizedCurve.Domain.Length, path)
            
    #Assign trees to output
    #--------------------------------------------------------------------------------------------
    RC=ReparametrizedCurveTree
    I=DomainTree
    IL=DomainLengthTree
# ---------- end reprmcrv ----------
trim_18 = TrimTree(Tree=explode_3.Segments, Depth=1)
item_13 = ListItem(List=trim_18, Index=0, Wrap=True)  # -> Item1, Item, Item1_2, Item2
ext = ExtendCurve(Curve=reprmcrv.RC, Type="1", Start=neg_2, End="0")
filter_3 = StreamFilter(Gate=addition_2, Stream0=pline_2, Stream1=pline)
divide = DivideCurve(Curve=item_13.Item1_2, Count=expression_6, Kinks=False)  # -> Points, Tangents, Parameters
crv_cp = CurveClosestPoint(Point=item_10.Item, Curve=item_13.Item1)  # -> Point, Parameter, Distance

reprmcrv_2 = ReparametrizeCurve(C=item_9.Item)  # -> RC, I, IL; inputs C: tree, T0: tree, T1: tree; same code as reprmcrv
ext_2 = ExtendCurve(Curve=reprmcrv_2.RC, Type="1", Start="0", End=neg_2)
divide_2 = DivideCurve(Curve=ext_2, Count=expression_6, Kinks=False)  # -> Points, Tangents, Parameters
trim_19 = TrimTree(Tree=divide_2.Points, Depth=1)
lito3p = ListInto3Parts(ListToSlice=trim_19, StartIndex="1", EndIndex=-1)  # -> FilteredList, ItemsBefore, ItemsAfter; inputs ListToSlice: tree, StartIndex: tree of Int32, EndIndex: tree of Int32
# ---------- lito3p: Python ----------
if ghenv.Component.RunCount<2:
    __author__ = "Ueli Saluz"
    __version__ = "2020.05.28"
    
    ghenv.Component.Name = "ListInto3Parts"
    ghenv.Component.NickName = "LiTo3P"
    ghenv.Component.Description = "Slice list into 3 parts. All lists are sliced with the same indices. End index = 0 = length(list)."
    ghenv.Component.Message = "VER 1.6"

from System import Object
from Grasshopper import DataTree

def filterList(listToFilter,startIndex,endIndex):
    # Return: FilteredList, Before, After
    if (((startIndex == 0) or (startIndex is None)) and ((endIndex == 0) or (endIndex is None))) or (endIndex <= startIndex and endIndex > 0):
        return (listToFilter,None,None)
    elif (startIndex == 0) or (startIndex is None):
        return (listToFilter[:endIndex],None,listToFilter[endIndex:])
    elif (endIndex == 0) or (endIndex is None):
        print 1
        return (listToFilter[:startIndex],listToFilter[startIndex:],None)
    else:
        return (listToFilter[startIndex:endIndex],listToFilter[:startIndex],listToFilter[endIndex:])

if __name__ == "__main__":
    FilteredList = DataTree[Object]()
    ItemsBefore = DataTree[Object]()
    ItemsAfter = DataTree[Object]()
    
    for path in ListToSlice.Paths:
        listBranch = ListToSlice.Branch(path)
        pyList = list(listBranch)   #Convert .Net List to Python
        try: #terrible way of writing code but if I set the list to list access the performance decreases massivly due to many calls
            startIndex = StartIndex.Branch(path)
            startIndex = startIndex[0]
        except Exception:
            try:
                startIndex = StartIndex.Branch(0)
                startIndex = startIndex[0]
            except Exception:
                startIndex = 0
        try:
            endIndex = EndIndex.Branch(path)
            endIndex = endIndex[0]
        except Exception:
            try:
                endIndex = EndIndex.Branch(0)
                endIndex = endIndex[0]
            except Exception:
                endIndex = len(pyList)
        filtList=filterList(pyList,startIndex,endIndex)
        if filtList[0]:
            FilteredList.AddRange(filtList[0],path)
        if filtList[1]:
            ItemsBefore.AddRange(filtList[1],path)
        if filtList[2]:
            ItemsAfter.AddRange(filtList[2],path)
# ---------- end lito3p ----------
end = EndPoints(Curve=item_9.Item)  # -> Start, End
line = LineSDL(Start=lito3p.FilteredList, Direction=Z, Length=parapetheight_2)
line_2 = LineSDL(Start=end.End, Direction=Z, Length=parapetheight_2)
move_4 = Move(Geometry=item_9.Item, Motion=Z)  # -> Geometry, Transform
merge_8 = Merge(Data1=move_4.Geometry, Data2=line_2)
join_5 = JoinCurves(Curves=merge_8, Preserve=False)
move_5 = Move(Geometry=item_9.Item, Motion=Z_2)  # -> Geometry, Transform
trim_20 = TrimTree(Tree=join_5, Depth=1)
pipe_2 = Pipe(Curve=trim_20, Radius=expression_8, Caps=rodcaptype)
pipe_3 = Pipe(Curve=line, Radius=expression_7, Caps=rodcaptype)
pipe_4 = Pipe(Curve=move_5.Geometry, Radius=expression_9, Caps=rodcaptype)
trim_21 = TrimTree(Tree=pipe_2, Depth=1)
trim_22 = TrimTree(Tree=pipe_3, Depth=1)
trim_23 = TrimTree(Tree=pipe_4, Depth=1)
railsecondarysupplement = Brep(trim_23)
railsecondaryposts = Brep(trim_22)
primaryrail = Brep(trim_21)
merge_9 = Merge(Data1=primaryrail, Data2=railsecondaryposts, Data3=railsecondarysupplement)

ground = Curve(filter_3)
divide_3 = DivideCurve(Curve=ext, Count=expression_6, Kinks=False)  # -> Points, Tangents, Parameters
trim_24 = TrimTree(Tree=divide.Points, Depth=1)
shatter = Shatter(Curve=item_13.Item1, Parameters=crv_cp.Parameter)
ground_2 = ClusterOutput(ground)
trim_25 = TrimTree(Tree=divide_3.Points, Depth=1)
lito3p_2 = ListInto3Parts(ListToSlice=trim_24, StartIndex="1", EndIndex="-1")  # -> FilteredList, ItemsBefore, ItemsAfter; inputs ListToSlice: tree, StartIndex: tree of Int32, EndIndex: tree of Int32; same code as lito3p
trim_26 = TrimTree(Tree=shatter, Depth=1)
lito3p_3 = ListInto3Parts(ListToSlice=trim_25, StartIndex="1", EndIndex="-1")  # -> FilteredList, ItemsBefore, ItemsAfter; inputs ListToSlice: tree, StartIndex: tree of Int32, EndIndex: tree of Int32; same code as lito3p
item_14 = ListItem(List=trim_26, Index=0, Wrap=True)  # -> Item, Item1
divide_4 = DivideCurve(Curve=item_14.Item1, Count=expression_6, Kinks=False)  # -> Points, Tangents, Parameters
trim_27 = TrimTree(Tree=divide_4.Points, Depth=1)
lito3p_4 = ListInto3Parts(ListToSlice=trim_27, StartIndex="1", EndIndex="-1")  # -> FilteredList, ItemsBefore, ItemsAfter; inputs ListToSlice: tree, StartIndex: tree of Int32, EndIndex: tree of Int32; same code as lito3p
merge_10 = Merge(
    Data1=lito3p_4.FilteredList,
    Data2=item_7.Item,
    Data3=item_7.Item1,
    Data4=lito3p_2.FilteredList,
    Data5=item_7.Item2,
    Data6=item_4.Item1_2)
merge_11 = Merge(Data1=item_14.Item1, Data2=item_13.Item, Data3=item_13.Item1_2, Data4=item_13.Item2)
line_3 = LineSDL(Start=merge_10, Direction=Z, Length=parapetheight_2)
join_6 = JoinCurves(Curves=merge_11, Preserve=False)
extr = Extrude(Base=reprmcrv.RC, Direction=Z)
move_6 = Move(Geometry=reprmcrv.RC, Motion=Z)  # -> Geometry, Transform
line_4 = LineSDL(Start=item_10.Item2, Direction=Z, Length=parapetheight_2)
merge_12 = Merge(Data1=item_14.Item1, Data2=item_13.Item1_2)
lito3p_5 = ListInto3Parts(ListToSlice=line_3, EndIndex="-1")  # -> FilteredList, ItemsBefore, ItemsAfter; inputs ListToSlice: tree, StartIndex: tree of Int32, EndIndex: tree of Int32; same code as lito3p
trim_28 = TrimTree(Tree=join_6, Depth=1)
secondaryrailsurface = Brep(extr)
merge_13 = Merge(Data1=move_6.Geometry, Data2=line_4)
line_5 = LineSDL(Start=lito3p_3.FilteredList, Direction=Z, Length=parapetheight_2)
join_7 = JoinCurves(Curves=merge_12, Preserve=False)
move_7 = Move(Geometry=trim_28, Motion=Z)  # -> Geometry, Transform
extr_2 = Extrude(Base=trim_28, Direction=Z)
join_8 = JoinCurves(Curves=merge_13, Preserve=False)
trim_29 = TrimTree(Tree=join_7, Depth=1)
move_8 = Move(Geometry=trim_28, Motion=Z_2)  # -> Geometry, Transform
primaryrailsurface = Brep(extr_2)
merge_14 = Merge(Data1=move_7.Geometry, Data2=lito3p_5.ItemsAfter)
merge_15 = Merge(Data1=baseleft, Data2=secondaryrailsurface)
trim_30 = TrimTree(Tree=join_8, Depth=1)
move_9 = Move(Geometry=reprmcrv.RC, Motion=Z_2)  # -> Geometry, Transform
extr_3 = Extrude(Base=trim_29, Direction=Z)
join_9 = JoinCurves(Curves=merge_14, Preserve=False)
pipe_5 = Pipe(Curve=move_8.Geometry, Radius=expression_9, Caps=rodcaptype)
pipe_6 = Pipe(Curve=line_5, Radius=expression_7, Caps=rodcaptype)
pipe_7 = Pipe(Curve=trim_30, Radius=expression_8, Caps=rodcaptype)
pipe_8 = Pipe(Curve=move_9.Geometry, Radius=expression_9, Caps=rodcaptype)
pipe_9 = Pipe(Curve=item_9.Item7, Radius=expression_5, Caps=rodcaptype)
merge_16 = Merge(Data1=extr_3, Data2=base)
merge_17 = Merge(Data1=primaryrailsurface, Data2=base, Data3=secondaryrailsurface)
trim_31 = TrimTree(Tree=join_9, Depth=1)
trim_32 = TrimTree(Tree=pipe_5, Depth=1)
trim_33 = TrimTree(Tree=pipe_6, Depth=1)
trim_34 = TrimTree(Tree=pipe_7, Depth=1)
trim_35 = TrimTree(Tree=pipe_9, Depth=1)
trim_36 = TrimTree(Tree=pipe_8, Depth=1)
filter_4 = StreamFilter(Gate=addition_2, Stream0=merge_16, Stream1=merge_17)
pipe_10 = Pipe(Curve=trim_31, Radius=expression_8, Caps=rodcaptype)
pipe_11 = Pipe(Curve=lito3p_5.FilteredList, Radius=expression_7, Caps=rodcaptype)
pipe_12 = Pipe(Curve=lito3p_5.FilteredList, Radius=expression_9, Caps=rodcaptype)
railsecondarysupplement_2 = Brep(trim_32)
secondaryrail = Brep(trim_34)
railsecondaryposts_2 = Brep(trim_33)
railsecondarysupplement_3 = Brep(trim_36)
secondarybar = Brep(trim_35)
trim_37 = TrimTree(Tree=pipe_10, Depth=1)
trim_38 = TrimTree(Tree=pipe_11, Depth=1)
join_10 = BrepJoin(Breps=filter_4)  # -> Breps, Closed
trim_39 = TrimTree(Tree=pipe_12, Depth=1)
filledsurface = Brep(join_10.Breps)
primaryrail_2 = Brep(trim_37)
railsecondary = Brep(trim_38)
railsecondaryposts_3 = Brep(trim_39)
merge_18 = Merge(Data1=secondaryrail, Data2=railsecondaryposts_2, Data3=railsecondarysupplement_3)
merge_19 = Merge(Data1=secondarybar, Data2=mainframe)
merge_20 = Merge(Data1=primaryrail_2, Data2=railsecondary, Data3=railsecondaryposts_3, Data4=railsecondarysupplement_2)
filter_5 = StreamFilter(Gate=addition_2, Stream0=merge_9, Stream1=merge_20)
merge_21 = Merge(Data1=merge_19, Data2=merge_18, Data3=filter_5)
rods = Brep(merge_21)
rods_2 = ClusterOutput(rods)
filledsurface_2 = ClusterOutput(filledsurface)

# ==== cluster PreviewPlane: Preview a plane with axis colors and naming.
axis_length = ClusterInput()
plane = ClusterInput()
axis_length_2 = Number(axis_length)
plane_2 = Plane(plane)
deplane = DeconstructPlane(Plane=plane_2)  # -> Origin, XAxis, YAxis, ZAxis
line = LineSDL(Start=deplane.Origin, Direction=deplane.YAxis, Length=axis_length_2)
line_2 = LineSDL(Start=deplane.Origin, Direction=deplane.XAxis, Length=axis_length_2)
line_3 = LineSDL(Start=deplane.Origin, Direction=deplane.ZAxis, Length=axis_length_2)
swatch = ColourSwatch(SwatchColor=RGB(235, 52, 79))
swatch_2 = ColourSwatch(SwatchColor=RGB(0, 166, 157))
swatch_3 = ColourSwatch(SwatchColor=RGB(240, 117, 24))
end = EndPoints(Curve=line_2)  # -> Start, End
end_2 = EndPoints(Curve=line)  # -> Start, End
end_3 = EndPoints(Curve=line_3)  # -> Start, End
tag = TextTag(Location=end.End, Text="X", Colour=swatch)
tag_2 = TextTag(Location=end_2.End, Text="Y", Colour=swatch_2)
tag_3 = TextTag(Location=end_3.End, Text="Z", Colour=swatch_3)
preview = CustomPreview(Geometry=line_2, Material=swatch)
preview_2 = CustomPreview(Geometry=line, Material=swatch_2)
preview_3 = CustomPreview(Geometry=line_3, Material=swatch_3)
