# Grasshopper definition cylindric-capital.gh (Grasshopper 1.0.8)
# plug-ins: semio

save_representation = BooleanToggle(False)
icon_export = BooleanToggle(False)
save = BooleanToggle(False)
and = GateAnd(A=save, B=save_representation)
and_2 = GateAnd(A=save, B=icon_export)
list = ValueList({"north east", "south east", "south west", "north west"}, selected="north west")
# ^
#                  |
# Preview    ->
# ^
#  |
# <- Meta
# Parameters:
# <- Variants
#   |
#   v
curdir = CurrentDirectory()  # -> PD, D, P, S
# ---------- curdir: Python ----------
# Component Information
# --------------------------------------------------------------------------------------------
if ghenv.Component.RunCount < 2:
    # General
    # --------------------------------------------------------------------------------------------
    __author__ = "Ueli Saluz"
    __version__ = "2024.07.26"

    ghenv.Component.Name = "CurrentDirectory"
    ghenv.Component.NickName = "CurDir"
    ghenv.Component.Description = "Current directory of the current grasshopper file."
    ghenv.Component.Message = "VER 1.1"
    ghenv.Component.Category = "Params"
    ghenv.Component.SubCategory = "Util"

    # Outputs
    # --------------------------------------------------------------------------------------------
    outputIndex = 0

    ghenv.Component.Params.Output[outputIndex].Name = "ParentDirectory"
    ghenv.Component.Params.Output[outputIndex].NickName = "PD"
    ghenv.Component.Params.Output[outputIndex].Description = "Parent directory of the current directory."
    outputIndex += 1

    ghenv.Component.Params.Output[outputIndex].Name = "Directory"
    ghenv.Component.Params.Output[outputIndex].NickName = "D"
    ghenv.Component.Params.Output[outputIndex].Description = "Directory of the current grasshopper file."
    outputIndex += 1

    ghenv.Component.Params.Output[outputIndex].Name = "Path"
    ghenv.Component.Params.Output[outputIndex].NickName = "P"
    ghenv.Component.Params.Output[outputIndex].Description = "Path of the current grasshopper file."
    outputIndex += 1

    ghenv.Component.Params.Output[outputIndex].Name = "Separator"
    ghenv.Component.Params.Output[outputIndex].NickName = "S"
    ghenv.Component.Params.Output[outputIndex].Description = "Separator of the current system."
    outputIndex += 1

# Imports
# --------------------------------------------------------------------------------------------
from os.path import dirname, abspath
from os import sep

# Solver - Run with trees to enhance performance drastically
# --------------------------------------------------------------------------------------------
if __name__ == "__main__":
    P = ghenv.Component.OnPingDocument().FilePath
    D = dirname(P)
    PD = dirname(D)
    S = sep
# ---------- end curdir ----------
expression = Expression(x=Slider(650, range=0..1000), Expression="x/100")
panel = Panel("""north east
south east
south west
north west""")
diameter_m = GetString(expression, AtLeast=1, AtMost=1, TreeAccess=False)
# External
#       |
#       v
peak = GetString(list, AtLeast=1, AtMost=1, TreeAccess=False)

panel_2 = Panel("https://app.speckle.systems")
mime = ValueList({".stl": "model/stl", ".obj": "model/obj", ".glb": "model/gltf-binary", ".gltf": "model/gltf+json", ".3dm": "model/vnd.3dm", ".speckle": "model/vnd.speckle+json", ".png": "image/png", ".jpg": "image/jpeg", ".jpeg": "image/jpeg", ".svg": "image/svg+xml", ".pdf": "application/pdf", ".zip": "application/zip", ".json": "application/json", ".csv": "text/csv", ".txt": "text/plain"}, selected=".speckle")
concat = Concatenate(FragmentA="cylindric-capital", FragmentB="_", FragmentE="1to500", FragmentG="_", FragmentF="volume")
concat_2 = Concatenate(FragmentA="cylindric-capital", FragmentB="_", FragmentE="1to200", FragmentG="_", FragmentF="volume")
concat_3 = Concatenate(FragmentC="representations", FragmentD=curdir.S, FragmentA="cylindric-capital")
concat_4 = Concatenate(FragmentC="representations", FragmentD=curdir.S, FragmentA=concat_2)
concat_5 = Concatenate(FragmentC="representations", FragmentD=curdir.S, FragmentA=concat)
concat_6 = Concatenate(FragmentA=panel_2, FragmentB="/projects/", FragmentC="e7de1a2f8f", FragmentD="/models/", FragmentE="91a2467032")
concat_7 = Concatenate(FragmentA=concat_3, FragmentB=".glb")
concat_8 = Concatenate(FragmentA=concat_5, FragmentB=".3dm")
concat_9 = Concatenate(FragmentA=concat_4, FragmentB=".3dm")
concat_10 = Concatenate(FragmentA=panel_2, FragmentB="/projects/", FragmentC="e7de1a2f8f", FragmentD="/models/", FragmentE="ae4ed21120")
rep = ModelRepresentation(Url=concat_7)  # -> Representation, Url, Mime, LoD, Tags
concat_11 = Concatenate(FragmentA=concat_3, FragmentB=".3dm")
concat_12 = Concatenate(FragmentA=panel_2, FragmentB="/projects/", FragmentC="e7de1a2f8f", FragmentD="/models/", FragmentE="9e40d26d9a")
rep_2 = ModelRepresentation(Url=concat_11)  # -> Representation, Url, Mime, LoD, Tags
rep_3 = ModelRepresentation(Url=concat_8, LevelOfDetail="1to500", Tags="volume")  # -> Representation, Url, Mime, LoD, Tags
rep_4 = ModelRepresentation(Url=concat_9, LevelOfDetail="1to200", Tags="volume")  # -> Representation, Url, Mime, LoD, Tags
rep_5 = ModelRepresentation(Url=concat_6, Mime=mime)  # -> Representation, Url, Mime, LoD, Tags
rep_6 = ModelRepresentation(Url=concat_10, Mime=mime, LevelOfDetail="1to500", Tags="volume")  # -> Representation, Url, Mime, LoD, Tags
rep_7 = ModelRepresentation(Url=concat_12, Mime=mime, LevelOfDetail="1to200", Tags="volume")  # -> Representation, Url, Mime, LoD, Tags
merge = Merge(
    Data1=rep.Representation,
    Data2=rep_2.Representation,
    Data3=rep_5.Representation,
    Data4=rep_3.Representation,
    Data5=rep_6.Representation,
    Data6=rep_4.Representation,
    Data7=rep_7.Representation)

itemindex = ItemIndex(L=panel, I=peak)  # -> i; inputs L: list
# ---------- itemindex: Python ----------
#Component Information
#--------------------------------------------------------------------------------------------
if ghenv.Component.RunCount<2:
    #General
    #--------------------------------------------------------------------------------------------
    __author__ = "Ueli Saluz"
    __version__ = "2022.11.18"
    
    ghenv.Component.Name = "ItemIndex"
    ghenv.Component.NickName = "ItemIndex"
    ghenv.Component.Description = "A better IdemIndex"
    ghenv.Component.Message = "VER 1.0"
    ghenv.Component.Category = "Set"
    ghenv.Component.SubCategory = "List"
    
     #Inputs
    #--------------------------------------------------------------------------------------------
    inputIndex=0
    
    ghenv.Component.Params.Input[inputIndex].Name = "List"
    ghenv.Component.Params.Input[inputIndex].NickName = "L"
    ghenv.Component.Params.Input[inputIndex].Description = "Input1 is..."
    ghenv.Component.Params.Input[inputIndex].Optional = False
    inputIndex+=1
    
    ghenv.Component.Params.Input[inputIndex].Name = "Item"
    ghenv.Component.Params.Input[inputIndex].NickName = "I"
    ghenv.Component.Params.Input[inputIndex].Description = "Input2 is..."
    ghenv.Component.Params.Input[inputIndex].Optional = False
    inputIndex+=1
    
    #Outputs
    #--------------------------------------------------------------------------------------------
    outputIndex=0
    
    ghenv.Component.Params.Output[outputIndex].Name = "Index"
    ghenv.Component.Params.Output[outputIndex].NickName = "i"
    ghenv.Component.Params.Output[outputIndex].Description = "Output1 is..."
    outputIndex+=1

i = L.index(I)
# ---------- end itemindex ----------
expression_2 = Expression(x=diameter_m, Expression="x/2")
xy = XYPlane(Origin=Point(0, 0, 0))
valueor0 = ValueOr0(value=itemindex)
cir = Circle(Plane=PlaneXY(0, 0, 0), Radius=expression_2)
curdir_2 = CurrentDirectory()  # -> PD, D, P, S; same code as curdir
expression_3 = Expression(x=Slider(100, range=0..100), Expression="x/100")
expression_4 = Expression(x=Slider(30, range=0..100), Expression="x/100")
expression_5 = Expression(x=Slider(550, range=0..1000), Expression="x/100")
wall_thickness_m = Number(expression_4)
side_height_m = Number(expression_5)
# Local ->
expression_6 = Expression(x=side_height_m, Expression="x*2")
height_m = Number(expression_6)
cyl = Cylinder(Base=PlaneXY(0, 0, 0), Radius=expression_2, Length=height_m)
cap = CapHoles(Brep=cyl)

neg = Negative(Value=wall_thickness_m)
offset = OffsetCurve(Curve=cir, Distance=neg, Corners=1)
trim = TrimTree(Tree=offset, Depth=1)
Z = UnitZ(Factor=height_m)
rulesrf = RuledSurface(CurveA=cir, CurveB=trim)
extr = Extrude(Base=rulesrf, Direction=Z)

lower_height_m = Number(expression_3)

_2d = _2D(x=diameter_m)
_2d_2 = _2D(x=diameter_m)
subtraction = Subtraction(A=height_m, B=lower_height_m)
rectangle = Rectangle(Plane=xy, XSize=_2d_2, YSize=_2d, Radius=0)  # -> Rectangle, Length
Z_2 = UnitZ(Factor=height_m)
merge_2 = Merge(Data1="0", Data2=side_height_m, Data3=subtraction, Data4=side_height_m)
move = Move(Geometry=rectangle.Rectangle, Motion=Z_2)  # -> Geometry, Transform
debrep = DeconstructBrep(Brep=move.Geometry)  # -> Faces, Edges, Vertices
rulesrf_2 = RuledSurface(CurveA=rectangle.Rectangle, CurveB=move.Geometry)
neg_2 = Negative(Value=merge_2)
Z_3 = UnitZ(Factor=neg_2)
cap_2 = CapHoles(Brep=rulesrf_2)
trim_2 = TrimTree(Tree=debrep.Vertices, Depth=1)
move_2 = Move(Geometry=trim_2, Motion=Z_3)  # -> Geometry, Transform
item = ListItem(List=move_2.Geometry, Index=0, Wrap=True)  # -> Item, Item1, Item2, Item3
srf4pt = _4PointSurface(CornerA=item.Item, CornerB=item.Item1, CornerC=item.Item2, CornerD=item.Item3)

Z_4 = UnitZ(Factor=1)
rev = Reverse(Vector=Z_4)
por = ModelPort(Direction=rev, Locators="bottom")  # -> Port, Id, Point, Direction, Locators

split = SplitBrep(Brep=cap, Cutter=srf4pt)
split_2 = SplitBrep(Brep=extr, Cutter=srf4pt)
trim_3 = TrimTree(Tree=split, Depth=1)
item_2 = ListItem(List=trim_3, Index=0, Wrap=True)  # -> Item, Item1
debrep_2 = DeconstructBrep(Brep=item_2.Item1)  # -> Faces, Edges, Vertices
trim_4 = TrimTree(Tree=debrep_2.Edges, Depth=1)
item_3 = ListItem(List=trim_4, Index=0, Wrap=True)  # -> Item, Item1, Item2, Item3, Item4, Item5
edgesrf = EdgeSurface(CurveA=item_3.Item2, CurveB=item_3.Item3, CurveC=item_3.Item4, CurveD=item_3.Item5)
merge_3 = Merge(Data1=item_2.Item1, Data2=edgesrf)
join = BrepJoin(Breps=merge_3)  # -> Breps, Closed
panel_3 = Panel("""180
90
0
270""")
item_4 = ListItem(List=panel_3, Index=valueor0, Wrap=True)
rotate = Rotate(Geometry=join.Breps, Angle=degrees(item_4), Plane=PlaneXY(0, 0, 0))  # -> Geometry, Transform
capital1to500 = Brep(rotate.Geometry)

trim_5 = TrimTree(Tree=split_2, Depth=1)
item_5 = ListItem(List=trim_5, Index=0, Wrap=True)  # -> Item, Item1
debrep_3 = DeconstructBrep(Brep=item_5.Item)  # -> Faces, Edges, Vertices
trim_6 = TrimTree(Tree=debrep_3.Edges, Depth=1)
item_6 = ListItem(List=trim_6, Index=0, Wrap=True)  # -> Item5, Item4, Item3, Item2, Item1, Item
merge_4 = Merge(Data1=item_6.Item5, Data2=item_6.Item4, Data3=item_6.Item3, Data4=item_6.Item2)
join_2 = JoinCurves(Curves=merge_4, Preserve=False)
trim_7 = TrimTree(Tree=join_2, Depth=1)
loft_opt = LoftOptions(Closed=False, Adjust=Toggle(True), Rebuild=0, Refit=0, Type=0)
merge_5 = Merge(Data1=trim_7, Data2=item_6.Item1)
loft = Loft(Curves=merge_5, Options=loft_opt)
merge_6 = Merge(Data1=item_5.Item, Data2=loft)
join_3 = BrepJoin(Breps=merge_6)  # -> Breps, Closed
transform = Transform(Geometry=join_3.Breps, Transform=rotate.Transform)
capital1to200 = Brep(transform)

maintenance_expenses_month_m² = Number(Slider(2.5, range=0..10))
construction_cost_m² = Number(Slider(4500, range=0..10000))
number_slider = Slider(876, range=0..1000)  # disabled

rec = Rectangle({Plane=Plane(origin=(-1675.978212, -1680.385471, 1682.315001), x=(-0.7071067812, 0.7071067812, 0), y=(0.4082482905, 0.4082482905, 0.8164965809)), Size=Domain2(u=-22.8648997..22.8648997, v=-12.18498478..12.18498478)})
m2d_parallel = Make2DParallelView(Projection=rec)
make2d = Make2D(Geometry=capital1to200, View=m2d_parallel, TangentEdges="T", TangentSeams=False, AutoComputeMake2D=True)  # -> VisibleCurves, VisibleIndex, VisibleType, HiddenCurves, HiddenIndex, HiddenType
trim_8 = TrimTree(Tree=make2d.VisibleCurves, Depth=1)
drawing = Geometry(trim_8)

split_3 = SplitBrep(Brep=cap_2, Cutter=srf4pt)
item_7 = ListItem(List=split_3, Index=0, Wrap=True)  # -> Item, Item1
capex = CapHolesEx(Brep=item_7.Item1)  # -> Brep, Caps, Solid
capital1to500_2 = Brep(capex.Brep)

panel_4 = Panel("Parallel")  # disabled
m2d_rhino = Make2DRhinoView(Name=panel_4, Clip=True)  # disabled
view_rectangle = ViewRectangle(view=m2d_rhino)  # disabled
previewplane = PreviewPlane(plane=view_rectangle, axis_length=number_slider)  # disabled
construction_global_warming_potential_kg = Number(Slider(300, range=0..2000))  # "Construction Global Warming Potential [kgCO2e/m²]"

maintenance_expenses_month_m²_2 = Number(maintenance_expenses_month_m²)
# Outputs   ->
#                 |
#                 v
construction_global_warming_potential_kg_2 = Number(construction_global_warming_potential_kg)  # "Construction Global Warming Potential [kgCO2e/eff. m²]"
construction_cost_eff_m² = Number(construction_cost_m²)
area = Area(Geometry=trim)  # -> Area, Centroid
multiplication = Multiplication(A=area.Area, B=maintenance_expenses_month_m²_2)
expression_7 = Expression(x=multiplication, Expression="x*12")
multiplication_2 = Multiplication(A=area.Area, B=construction_cost_eff_m²)
multiplication_3 = Multiplication(A=area.Area, B=construction_global_warming_potential_kg_2)
round = Round(Number=multiplication_2)  # -> Nearest, Floor, Ceiling
round_2 = Round(Number=expression_7)  # -> Nearest, Floor, Ceiling
round_3 = Round(Number=multiplication_3)  # -> Nearest, Floor, Ceiling
merge_7 = Merge(
    Data1="south west",
    Data2=diameter_m,
    Data3=side_height_m,
    Data4=lower_height_m,
    Data5=wall_thickness_m,
    Data6=round.Nearest,
    Data7=round_2.Nearest,
    Data8=round_3.Nearest)
panel_5 = Panel("""peak
diameter
height side
height low
wall thickness
construction cost
maintenance expenses
construction global warming potential""")
panel_6 = Panel(merge_7)
panel_7 = Panel("""m
m
m
m
€
€/a
kgCO2e""")
qlt = ModelQuality(Name=panel_5, Value=panel_6, Unit=panel_7)  # -> Quality, Name, Value, Unit, Definition

concat_13 = Concatenate(FragmentA=curdir.PD, FragmentB=curdir.S, FragmentC=rep_4.Url)
concat_14 = Concatenate(FragmentA=curdir.PD, FragmentB=curdir.S, FragmentC=rep_3.Url)
blc = ExportBlock(path=concat_13, geo=capital1to500, layer_name="volume", export=and)  # -> block_definition_3, path_4, exported_2
blc_2 = ExportBlock(path=concat_14, geo=capital1to500_2, layer_name="volume", export=and)  # -> block_definition_3, path_4, exported_2

concat_15 = Concatenate(FragmentA="cylindric-capital", FragmentB="_", FragmentC="icon")
concat_16 = Concatenate(FragmentC="icons", FragmentD=curdir.S, FragmentA="cylindric-capital")
expression_8 = Expression(x="capital", y=drawing, Expression="x")
concat_17 = Concatenate(FragmentA=concat_16, FragmentB=".3dm")
concat_18 = Concatenate(FragmentA=curdir_2.PD, FragmentB=curdir_2.S, FragmentC=concat_17)
blc_3 = ExportBlock(path=concat_18, name=concat_15, url=concat_17, geo=drawing, layer_name=expression_8, export=and_2)  # -> block_definition_3, path_4, exported_2

concat_19 = Concatenate(FragmentA=concat_16, FragmentB=".svg")
concat_20 = Concatenate(FragmentA=curdir.PD, FragmentB=curdir.S, FragmentC=concat_19)
file = ReadFile(File=concat_20, PerLineParse=False)
txt = EncodeText(Text=file)
concat_21 = Concatenate(FragmentA="data:image/svg+xml;base64,", FragmentB=txt)

panel_8 = Panel("⭕")
typ = ModelType(
    Name="Cylindric Capital",
    Description="A roof that has the skin of a cut extruded cylinder.",
    Icon=concat_21,
    Representations=merge,
    Ports=por.Port,
    Qualities=qlt.Quality)  # -> Type, Name, Description, Icon, Variant, Unit, Representations, Ports, Qualities
typ_2 = RemoveType(TypeName=typ.Name, TypeVariant=typ.Variant, Directory=curdir.PD, Run=save)
or = GateOr(A=save, B=typ_2)
typ_3 = AddType(Type=typ.Type, Directory=curdir.PD, Run=or)

typ_4 = SerializeType(Type=typ.Type)
type = Text(typ_4)
context_bake = ContextBake(Geometry=type)

# ==== cluster _2D
x = ClusterInput()
expression = Expression(x=x, Expression="x/2")
neg = Negative(Value=expression)
dom = ConstructDomain(DomainStart=neg, DomainEnd=expression)
I = ClusterOutput(dom)

# ==== cluster ValueOr0
value = ClusterInput()
value_2 = Number(value)
null = NullItem(Item=value_2)  # -> NullFlags, InvalidFlags, Description
filter = StreamFilter(Gate=null.NullFlags, Stream0=value_2, Stream1="0")
valueor0 = Number(filter)
valueor0_2 = ClusterOutput(valueor0)

# ==== cluster PreviewPlane: Preview a plane with axis colors and naming.
axis_length = ClusterInput()
plane = ClusterInput()
axis_length_2 = Number(axis_length)
plane_2 = Plane(plane)
deplane = DeconstructPlane(Plane=plane_2)  # -> Origin, XAxis, YAxis, ZAxis
line = LineSDL(Start=deplane.Origin, Direction=deplane.YAxis, Length=axis_length_2)
line_2 = LineSDL(Start=deplane.Origin, Direction=deplane.XAxis, Length=axis_length_2)
line_3 = LineSDL(Start=deplane.Origin, Direction=deplane.ZAxis, Length=axis_length_2)
swatch = ColourSwatch(SwatchColor=RGB(235, 52, 79))
swatch_2 = ColourSwatch(SwatchColor=RGB(0, 166, 157))
swatch_3 = ColourSwatch(SwatchColor=RGB(240, 117, 24))
end = EndPoints(Curve=line_2)  # -> Start, End
end_2 = EndPoints(Curve=line)  # -> Start, End
end_3 = EndPoints(Curve=line_3)  # -> Start, End
tag = TextTag(Location=end.End, Text="X", Colour=swatch)
tag_2 = TextTag(Location=end_2.End, Text="Y", Colour=swatch_2)
tag_3 = TextTag(Location=end_3.End, Text="Z", Colour=swatch_3)
preview = CustomPreview(Geometry=line_2, Material=swatch)
preview_2 = CustomPreview(Geometry=line, Material=swatch_2)
preview_3 = CustomPreview(Geometry=line_3, Material=swatch_3)

# ==== cluster ViewRectangle
view = ClusterInput()
view_2 = Data(view)
nickname = NAME(view=view_2)  # -> c, x, y, z, h, w
# ---------- nickname: Python ----------
uselss, c, x, y, z = view.GetCameraFrame()
h = view.FrustumHeight
w = view.FrustumWidth
# ---------- end nickname ----------
rev = Reverse(Vector=nickname.x)
rev_2 = Reverse(Vector=nickname.y)
pl = ConstructPlane(Origin=nickname.c, XAxis=rev, YAxis=nickname.y)
_2d = _2D(x=nickname.w)
_2d_2 = _2D(x=nickname.h)
rectangle = Rectangle(Plane=pl, XSize=_2d, YSize=_2d_2, Radius=0)  # -> Rectangle, Length
rec = Rectangle(rectangle.Rectangle)
rec_2 = ClusterOutput(rec)

# ==== cluster ExportBlock: Export geometry with layer names to a file.
path = ClusterInput()
name = ClusterInput()
url = ClusterInput()
geo = ClusterInput()
layer_name = ClusterInput()
export = ClusterInput()
path_2 = FilePath(path)
name_2 = Text(name)
url_2 = Text(url)
geo_2 = Geometry(geo)
layer_name_2 = Text(layer_name)
export_2 = Boolean(export)
layer = ModelLayer(Name=layer_name_2)  # -> Layer, Name, Hidden, Locked, DisplayColour, Material, Linetype
object = ModelObject(Geometry=geo_2, Layer=layer.Layer)  # -> Object, Geometry, Name, Layer, Visibility, Display, Drafting, Render
block_definition = ModelBlockDefinition(Objects=object.Object, Name=name_2, URL=url_2)  # -> BlockDefinition, Objects, Units, Name, Notes, URL, URLDescription
export_definition = ExportModelBlockDefinition(BlockDefinition=block_definition.BlockDefinition, FilePath=path_2, Overwrite="T", Export=export_2)  # -> BlockDefinition, FilePath, Exported
block_definition_2 = ModelBlockDefinition(export_definition.BlockDefinition)
path_3 = FilePath(export_definition.FilePath)
exported = Boolean(export_definition.Exported)
path_4 = ClusterOutput(path_3)
exported_2 = ClusterOutput(exported)
block_definition_3 = ClusterOutput(block_definition_2)
