# Grasshopper definition cylindric-tambour.gh (Grasshopper 1.0.8)
# plug-ins: semio

save_representation = BooleanToggle(False)
number_slider = Slider(0, range=0..3)
icon_export = BooleanToggle(False)
save = BooleanToggle(False)
loop_slider = PythonScript(
    SliderToModify=number_slider,
    Min="0",
    Max="3",
    stepSize="1",
    Delay=Slider(0, range=0..1),
    Run=Toggle(False),
    Reset=Button())  # inputs Run: Boolean, Reset: Boolean
# ---------- loop_slider: Python ----------
import time

def updateSliderInput(inputName,min,max,value,decimalPlace=2):
    for input in ghenv.Component.Params.Input:
        for source in input.Sources:
            if input.Name == str(inputName):
                source.Slider.DecimalPlaces = decimalPlace
                source.Slider.Minimum = min
                source.Slider.Maximum = max
                source.Slider.Value = value
                source.ExpireSolution(True)

def countDecimal(number):
    string= str(number)
    return string[::-1].find('.')

if Run == True:
    if SliderToModify < Max:
        time.sleep(Delay)
        updateSliderInput("SliderToModify",Min,Max,SliderToModify+stepSize,countDecimal(stepSize))
if Reset == True:
    updateSliderInput("SliderToModify",Min,Max,Min)
# ---------- end loop_slider ----------
and = GateAnd(A=save, B=save_representation)
and_2 = GateAnd(A=save, B=icon_export)
panel = Panel("""F
T
F
T""")
panel_2 = Panel("""F
F
T
T""")
number_slider_2 = Slider(9, range=0..20)
item = ListItem(List=panel, Index=number_slider, Wrap=True)
item_2 = ListItem(List=panel_2, Index=number_slider, Wrap=True)
# ^
#                  |
# Preview    ->
# ^
#  |
# <- Meta
# Parameters:
# <- Variants
#   |
#   v
curdir = CurrentDirectory()  # -> PD, D, P, S
# ---------- curdir: Python ----------
# Component Information
# --------------------------------------------------------------------------------------------
if ghenv.Component.RunCount < 2:
    # General
    # --------------------------------------------------------------------------------------------
    __author__ = "Ueli Saluz"
    __version__ = "2024.07.26"

    ghenv.Component.Name = "CurrentDirectory"
    ghenv.Component.NickName = "CurDir"
    ghenv.Component.Description = "Current directory of the current grasshopper file."
    ghenv.Component.Message = "VER 1.1"
    ghenv.Component.Category = "Params"
    ghenv.Component.SubCategory = "Util"

    # Outputs
    # --------------------------------------------------------------------------------------------
    outputIndex = 0

    ghenv.Component.Params.Output[outputIndex].Name = "ParentDirectory"
    ghenv.Component.Params.Output[outputIndex].NickName = "PD"
    ghenv.Component.Params.Output[outputIndex].Description = "Parent directory of the current directory."
    outputIndex += 1

    ghenv.Component.Params.Output[outputIndex].Name = "Directory"
    ghenv.Component.Params.Output[outputIndex].NickName = "D"
    ghenv.Component.Params.Output[outputIndex].Description = "Directory of the current grasshopper file."
    outputIndex += 1

    ghenv.Component.Params.Output[outputIndex].Name = "Path"
    ghenv.Component.Params.Output[outputIndex].NickName = "P"
    ghenv.Component.Params.Output[outputIndex].Description = "Path of the current grasshopper file."
    outputIndex += 1

    ghenv.Component.Params.Output[outputIndex].Name = "Separator"
    ghenv.Component.Params.Output[outputIndex].NickName = "S"
    ghenv.Component.Params.Output[outputIndex].Description = "Separator of the current system."
    outputIndex += 1

# Imports
# --------------------------------------------------------------------------------------------
from os.path import dirname, abspath
from os import sep

# Solver - Run with trees to enhance performance drastically
# --------------------------------------------------------------------------------------------
if __name__ == "__main__":
    P = ghenv.Component.OnPingDocument().FilePath
    D = dirname(P)
    PD = dirname(D)
    S = sep
# ---------- end curdir ----------
expression = Expression(x=Slider(275, range=0..1000), Expression="x/100")
expression_2 = Expression(x=Slider(650, range=0..1000), Expression="x/100")
list = ValueList({"North": "north", "East": "east", "South": "south", "West": "west"}, selected="North")
panel_3 = Panel("""_first-storey
_last-storey
_single-storey""")
panel_4 = Panel("""First Storey
Last Storey
Single Storey""")
include_bottom = GetBoolean(item, AtLeast=1, AtMost=1, FalseValue="False", TreeAccess=False, TrueValue="True")
int = Integer(include_bottom)
include_top = GetBoolean(item_2, AtLeast=1, AtMost=1, FalseValue="False", TreeAccess=False, TrueValue="True")
int_2 = Integer(include_top)
concat = Concatenate(FragmentA=int_2, FragmentB=int)
b2d = BinaryToDecimal(Binary=concat)  # -> Decimal
# ---------- b2d: Python ----------
if ghenv.Component.RunCount<2:
    __author__ = "Ueli Saluz"
    __version__ = "2021.11.14"
    
    ghenv.Component.Name = "BinaryToDecimal"
    ghenv.Component.NickName = "B2D"
    ghenv.Component.Description = "Converts a number in binary representation to a number in decimal representation."
    ghenv.Component.Message = "VER 1.0"
    
    ghenv.Component.Params.Input[0].NickName = "Binary"
    
    ghenv.Component.Params.Input[0].Description = "Binary representation of a number."
    
    ghenv.Component.Params.Output[0].NickName = "Decimal"
    
    ghenv.Component.Params.Output[0].Description = "Converted decimal representation of the same number."

if __name__ == "__main__":
    Decimal = int(Binary,2)
# ---------- end b2d ----------
# External
#       |
#       v
width_m = GetNumber(expression_2, AtLeast=1, AtMost=1, Maximum=1.797693135e+308, Minimum=-1.797693135e+308, TreeAccess=False)
floor_height_m = GetNumber(expression, AtLeast=1, AtMost=1, Maximum=1.797693135e+308, Minimum=-1.797693135e+308, TreeAccess=False)
platform = GetString(list, AtLeast=1, AtMost=1, TreeAccess=False)
item_3 = ListItem(List=panel_4, Index=b2d, Wrap=True)
item_4 = ListItem(List=panel_3, Index=b2d, Wrap=True)

panel_5 = Panel("""1a7ea02fd3
155c3bcb7c
6e372d67ee
025c85ea51
61d41a54c1
ec423cca22
4088e8e156
4a5b1a5243
b862062ab5
152ecb7f14
2a6977ed68
1152f570e6""")
dup = DuplicateData(Data="3", Number="4", Order=True)
concat_2 = Concatenate(FragmentA="https://app.speckle.systems/projects/e7de1a2f8f/models/", FragmentB=panel_5)
trim = TrimTree(Tree=dup, Depth=1)
partition = PartitionList(List=concat_2, Size=trim)
tstat = TreeStatistics(Tree=partition)  # -> Paths, Length, Count
item_5 = ListItem(List=flatten(tstat.Paths), Index=b2d, Wrap=True)
branch = TreeBranch(Tree=partition, Path=item_5, MaintainPaths=True)
item_6 = ListItem(List=flatten(branch), Index=0, Wrap=True)  # -> Item, Item1, Item2

expression_3 = Expression(x=Slider(20, range=0..100), Expression="x/100")
slab_thickness_m = Number(expression_3)

mime = ValueList({".stl": "model/stl", ".obj": "model/obj", ".glb": "model/gltf-binary", ".gltf": "model/gltf+json", ".3dm": "model/vnd.3dm", ".speckle": "model/vnd.speckle+json", ".png": "image/png", ".jpg": "image/jpeg", ".jpeg": "image/jpeg", ".svg": "image/svg+xml", ".pdf": "application/pdf", ".zip": "application/zip", ".json": "application/json", ".csv": "text/csv", ".txt": "text/plain"}, selected=".speckle")
concat_3 = Concatenate(FragmentC="cylindric-tambour", FragmentA=item_4)
concat_4 = Concatenate(FragmentA=concat_3, FragmentB="_", FragmentE="1to500", FragmentG="_", FragmentF="volume")
concat_5 = Concatenate(FragmentA=concat_3, FragmentB="_", FragmentE="1to200", FragmentG="_", FragmentF="volume")
concat_6 = Concatenate(FragmentC="representations", FragmentD=curdir.S, FragmentA=concat_3)
concat_7 = Concatenate(FragmentC="representations", FragmentD=curdir.S, FragmentA=concat_5)
concat_8 = Concatenate(FragmentC="representations", FragmentD=curdir.S, FragmentA=concat_4)
concat_9 = Concatenate(FragmentA=concat_6, FragmentB=".glb")
concat_10 = Concatenate(FragmentA=concat_8, FragmentB=".3dm")
concat_11 = Concatenate(FragmentA=concat_7, FragmentB=".3dm")
rep = ModelRepresentation(Url=concat_9)  # -> Representation, Url, Mime, LoD, Tags
concat_12 = Concatenate(FragmentA=concat_6, FragmentB=".3dm")
rep_2 = ModelRepresentation(Url=concat_12)  # -> Representation, Url, Mime, LoD, Tags
rep_3 = ModelRepresentation(Url=concat_10, LevelOfDetail="1to500", Tags="volume")  # -> Representation, Url, Mime, LoD, Tags
rep_4 = ModelRepresentation(Url=concat_11, LevelOfDetail="1to200", Tags="volume")  # -> Representation, Url, Mime, LoD, Tags
rep_5 = ModelRepresentation(Url=item_6.Item, Mime=mime)  # -> Representation, Url, Mime, LoD, Tags
rep_6 = ModelRepresentation(Url=item_6.Item1, Mime=mime, LevelOfDetail="1to500", Tags="volume")  # -> Representation, Url, Mime, LoD, Tags
rep_7 = ModelRepresentation(Url=item_6.Item2, Mime=mime, LevelOfDetail="1to200", Tags="volume")  # -> Representation, Url, Mime, LoD, Tags
merge = Merge(
    Data1=rep.Representation,
    Data2=rep_2.Representation,
    Data3=rep_5.Representation,
    Data4=rep_3.Representation,
    Data5=rep_6.Representation,
    Data6=rep_4.Representation,
    Data7=rep_7.Representation)

expression_4 = Expression(x=Slider(30, range=0..100), Expression="x/100")
expression_5 = Expression(x=Slider(80, range=0..200), Expression="x/100")
expression_6 = Expression(x=Slider(200, range=0..1000), Expression="x/100")
expression_7 = Expression(x=Slider(175, range=0..1000), Expression="x/100")
wall_thickness_m = Number(expression_4)
door_width_m = Number(expression_5)
door_height_m = Number(expression_6)
door_offset_m = Number(expression_7)
construction_area_factor = Number(Slider(0.2, range=0..1))
maintenance_expenses_month_eff_m² = Number(Slider(3.5, range=0..10))
construction_cost_eff_m² = Number(Slider(10500, range=0..15000))
panel_6 = Panel("Parallel")  # disabled
m2d_rhino = Make2DRhinoView(Name=panel_6, Clip=True)  # disabled
number_slider_3 = Slider(876, range=0..1000)  # disabled
view_rectangle = ViewRectangle(view=m2d_rhino)  # disabled
previewplane = PreviewPlane(plane=view_rectangle, axis_length=number_slider_3)  # disabled
cooling_energy_demand_kwh_m²a = Number(Slider(5, range=0..200))
heating_energy_demand_kwh_m²a = Number(Slider(15, range=0..200))
technical_equipment_energy_demand_kwh_m² = Number(Slider(20, range=0..200))  # "Technical Equipment Energy Demand[kWh/m²a]"
construction_global_warming_potential_kg = Number(Slider(1600, range=0..2000))  # "Construction Global Warming Potential [kgCO2e/eff. m²]"
_2d = _2D(x=door_width_m)
Z = UnitZ(Factor=1)
rev = Reverse(Vector=Z)

expression_8 = Expression(x=floor_height_m, Expression="x/3")
expression_9 = Expression(x=width_m, Expression="x/2")
expression_10 = Expression(x=floor_height_m, Expression="x*(2/3)")
_2d_2 = _2D(x=width_m)
addition = Addition(A=floor_height_m, B=expression_8)
addition_2 = Addition(A=addition, B=expression_8)
neg = Negative(Value=expression_9)
dom = ConstructDomain(DomainStart=expression_8, DomainEnd=expression_10)
dom_2 = ConstructDomain(DomainStart=addition, DomainEnd=addition_2)
box = DomainBox(Base=PlaneXY(0, 0, 0), X=_2d_2, Y=expression_9, Z=expression_8)
box_2 = DomainBox(Base=PlaneXY(0, 0, 0), X=neg, Y=expression_9, Z=dom)
box_3 = DomainBox(Base=PlaneXY(0, 0, 0), X=expression_9, Y=expression_9, Z=dom_2)
nand = GateNand(A=include_bottom, B=include_top)

# ----
# Local ->
expression_11 = Expression(x=width_m, Expression="x/2")
panel_7 = Panel("""north
east
south
west""")
itemindex = ItemIndex(L=panel_7, I=platform)  # -> i; inputs L: list
# ---------- itemindex: Python ----------
#Component Information
#--------------------------------------------------------------------------------------------
if ghenv.Component.RunCount<2:
    #General
    #--------------------------------------------------------------------------------------------
    __author__ = "Ueli Saluz"
    __version__ = "2022.11.18"
    
    ghenv.Component.Name = "ItemIndex"
    ghenv.Component.NickName = "ItemIndex"
    ghenv.Component.Description = "A better IdemIndex"
    ghenv.Component.Message = "VER 1.0"
    ghenv.Component.Category = "Set"
    ghenv.Component.SubCategory = "List"
    
     #Inputs
    #--------------------------------------------------------------------------------------------
    inputIndex=0
    
    ghenv.Component.Params.Input[inputIndex].Name = "List"
    ghenv.Component.Params.Input[inputIndex].NickName = "L"
    ghenv.Component.Params.Input[inputIndex].Description = "Input1 is..."
    ghenv.Component.Params.Input[inputIndex].Optional = False
    inputIndex+=1
    
    ghenv.Component.Params.Input[inputIndex].Name = "Item"
    ghenv.Component.Params.Input[inputIndex].NickName = "I"
    ghenv.Component.Params.Input[inputIndex].Description = "Input2 is..."
    ghenv.Component.Params.Input[inputIndex].Optional = False
    inputIndex+=1
    
    #Outputs
    #--------------------------------------------------------------------------------------------
    outputIndex=0
    
    ghenv.Component.Params.Output[outputIndex].Name = "Index"
    ghenv.Component.Params.Output[outputIndex].NickName = "i"
    ghenv.Component.Params.Output[outputIndex].Description = "Output1 is..."
    outputIndex+=1

i = L.index(I)
# ---------- end itemindex ----------
cir = Circle(Plane=PlaneXY(0, 0, 0), Radius=expression_11)
addition_3 = Addition(A=floor_height_m, B=expression_10)
valueor0 = ValueOr0(value=itemindex)
coreheight = Number(addition_3)
dom_3 = ConstructDomain(DomainStart=0, DomainEnd=coreheight)
_2d_3 = _2D(x=width_m)
box_4 = DomainBox(Base=PlaneXY(0, 0, 0), X=_2d_3, Y=_2d_3, Z=dom_3)
cyl = Cylinder(Base=PlaneXY(0, 0, 0), Radius=expression_11, Length=coreheight)
cap = CapHoles(Brep=cyl)
debrep = DeconstructBrep(Brep=box_4)  # -> Faces, Edges, Vertices
trim_2 = TrimTree(Tree=debrep.Faces, Depth=1)
item_7 = ListItem(List=trim_2, Index=0, Wrap=True)  # -> Item, Item1, Item2, Item3, Item4
base = Surface(item_7.Item4)
explode = Explode(Curve=base, Recursive=True)  # -> Segments, Vertices
trim_3 = TrimTree(Tree=explode.Segments, Depth=1)
join = JoinCurves(Curves=explode.Segments, Preserve=False)
expression_12 = Expression(x=width_m, Expression="x/2")
expression_13 = Expression(x=door_width_m, Expression="x/2")
trim_4 = TrimTree(Tree=join, Depth=1)
curvepoint = PointOnCurve(trim_3, parameter=0.5)
subtraction = Subtraction(A=expression_12, B=expression_13, C=door_offset_m, D=wall_thickness_m)
crv_cp = CurveClosestPoint(Point=curvepoint, Curve=trim_3)  # -> Point, Parameter, Distance
addition_4 = Addition(A=crv_cp.Parameter, B=subtraction)
subtraction_2 = Subtraction(A=crv_cp.Parameter, B=subtraction)
eval = EvaluateCurve(Curve=trim_3, Parameter=addition_4)  # -> Point, Tangent, Angle
eval_2 = EvaluateCurve(Curve=trim_3, Parameter=subtraction_2)  # -> Point, Tangent, Angle
shift = ShiftList(List=eval_2.Point, Shift=1, Wrap=True)
trim_5 = TrimTree(Tree=shift, Depth=1)
merge_2 = Merge(Data1=graft(eval.Point), Data2=graft(trim_5))

expression_14 = Expression(x=floor_height_m, Expression="x/3")
expression_15 = Expression(x="1", Expression="x+1")
lng = ListLength(List=trim_3)
dup_2 = DuplicateData(Data=expression_14, Number=lng, Order=True)
int_3 = Integer(expression_15)
trim_6 = TrimTree(Tree=dup_2, Depth=1)
expression_16 = Expression(x=int_3, Expression="(x-1)*4")
replace = ReplaceItems(List=trim_6, Item="0", Indices="1", Wrap=False)
repeat = RepeatData(Data=replace, Length=expression_16)
trim_7 = TrimTree(Tree=repeat, Depth=1)
ma = MassAddition(Input=trim_7)  # -> Result, PartialResults
flip = FlipMatrix(Data=ma.PartialResults)
doorheights = Number(flip)
Z_2 = UnitZ(Factor=doorheights)
trim_8 = TrimTree(Tree=Z_2, Depth=1)
cset = CreateSet(List=trim_8)  # -> Set, graft(Map)
path = ConstructPath(Indices=cset.Map)
trim_9 = TrimTree(Tree=path, Depth=1)

maintenance_expenses_month_m² = Number(maintenance_expenses_month_eff_m²)
# Outputs   ->
#                 |
#                 v
construction_global_warming_potential_kg_2 = Number(construction_global_warming_potential_kg)  # "Construction Global Warming Potential [kgCO2e/eff. m²]"
technical_equipment_energy_demand_kwh_m²_2 = Number(technical_equipment_energy_demand_kwh_m²)  # "Technical Equipment Energy Demand[kWh/m²a]"
construction_area_factor_2 = Number(construction_area_factor)
heating_energy_demand_kwh_m²a_2 = Number(heating_energy_demand_kwh_m²a)
cooling_energy_demand_kwh_m²a_2 = Number(cooling_energy_demand_kwh_m²a)
area = Area(Geometry=cir)  # -> Area, Centroid
construction_cost_eff_m²_2 = Number(construction_cost_eff_m²)
expression_17 = Expression(x=construction_area_factor_2, Expression="1-x")
multiplication = Multiplication(B=construction_global_warming_potential_kg_2)
multiplication_2 = Multiplication(A=area.Area, B="1")
round = Round(Number=multiplication)  # -> Nearest, Floor, Ceiling
multiplication_3 = Multiplication(A=multiplication_2, B=expression_17)
multiplication_4 = Multiplication(A=multiplication_3, B=maintenance_expenses_month_m²)
expression_18 = Expression(x=multiplication_4, Expression="x*12")
round_2 = Round(Number=expression_18)  # -> Nearest, Floor, Ceiling
multiplication_5 = Multiplication(A=heating_energy_demand_kwh_m²a_2, B=multiplication_3)
multiplication_6 = Multiplication(A=cooling_energy_demand_kwh_m²a_2, B=multiplication_3)
multiplication_7 = Multiplication(A=multiplication_3, B=construction_cost_eff_m²_2)
multiplication_8 = Multiplication(A=technical_equipment_energy_demand_kwh_m²_2, B=multiplication_3)
roundmult = RoundToMultiple(N=multiplication_3, M="0.01")  # -> R; inputs N: tree, M: tree
# ---------- roundmult: Python ----------
#Component Information
#--------------------------------------------------------------------------------------------
if ghenv.Component.RunCount<2:
    #General
    #--------------------------------------------------------------------------------------------
    __author__ = "YOUR NAME"
    __version__ = "2000.00.00"
    
    ghenv.Component.Name = "Round to Multiple"
    ghenv.Component.NickName = "RoundMult"
    ghenv.Component.Description = "Rounds a number to the nearest specified multiple."
    ghenv.Component.Message = "VER 1.0"
    ghenv.Component.Category = "Math"
    ghenv.Component.SubCategory = "Arithmetic"
    
     #Inputs
    #--------------------------------------------------------------------------------------------
    inputIndex=0
    
    ghenv.Component.Params.Input[inputIndex].Name = "Number"
    ghenv.Component.Params.Input[inputIndex].NickName = "N"
    ghenv.Component.Params.Input[inputIndex].Description = "Number to round."
    ghenv.Component.Params.Input[inputIndex].Optional = False
    inputIndex+=1
    
    ghenv.Component.Params.Input[inputIndex].Name = "Multiple"
    ghenv.Component.Params.Input[inputIndex].NickName = "M"
    ghenv.Component.Params.Input[inputIndex].Description = "Multiple to round to."
    ghenv.Component.Params.Input[inputIndex].Optional = False
    inputIndex+=1
    
    #Outputs
    #--------------------------------------------------------------------------------------------
    outputIndex=0
    
    ghenv.Component.Params.Output[outputIndex].Name = "Rounded"
    ghenv.Component.Params.Output[outputIndex].NickName = "R"
    ghenv.Component.Params.Output[outputIndex].Description = "Number rounded to the nearest specified multiple."
    outputIndex+=1


#Imports
#--------------------------------------------------------------------------------------------
from System import Object
from Grasshopper import DataTree
import math


#The Component function - Business logic only (e.g. working without trees)
#--------------------------------------------------------------------------------------------
"""Function that this component is computing.
    Inputs:
        number: The number to round.
        multiple: The multiple to round to.
    Output:
        rounded: The number rounded to the nearest specified multiple."""
def RoundToMultiple(number, multiple):
    rounded = math.ceil(number / multiple) * multiple
    return rounded

#Solver - Run with trees to enhance performance drastically
#--------------------------------------------------------------------------------------------
if __name__ == "__main__":
    
    #Initialize trees
    #--------------------------------------------------------------------------------------------
    RoundedTree = DataTree[Object]()
    
    #Data matching
    #--------------------------------------------------------------------------------------------
    for path in N.Paths:
        numberBranch = N.Branch(path)
        for i, number in enumerate(numberBranch):
            multiple = M.Branch(path)[i]
            rounded = RoundToMultiple(number, multiple)
            RoundedTree.Add(rounded, path)
    
     #Assign trees to output
    #--------------------------------------------------------------------------------------------
    R = RoundedTree
# ---------- end roundmult ----------
round_3 = Round(Number=multiplication_7)  # -> Nearest, Floor, Ceiling
round_4 = Round(Number=multiplication_5)  # -> Nearest, Floor, Ceiling
round_5 = Round(Number=multiplication_6)  # -> Nearest, Floor, Ceiling
round_6 = Round(Number=multiplication_8)  # -> Nearest, Floor, Ceiling
merge_3 = Merge(
    Data1=width_m,
    Data2="1",
    Data3=floor_height_m,
    Data4=platform,
    Data5=door_width_m,
    Data6=door_height_m,
    Data7=door_offset_m,
    Data8=roundmult,
    Data9=round_3.Nearest,
    Data10=round_4.Nearest,
    Data11=round_5.Nearest,
    Data12=round_6.Nearest,
    Data13=round_2.Nearest,
    Data14=round.Floor)
panel_8 = Panel("""diameter
storeys
floor height
platform
door width
door height
door offset
effective floor area
construction cost
heating energy demand
cooling energy demand
technical equipment energy demand
maintenance expenses
construction global warming potential""")
panel_9 = Panel("""https://identifier.buildingsmart.org/uri/buildingsmart/ifc/4.3/prop/Diameter
https://identifier.buildingsmart.org/uri/buildingsmart/ifc/4.3/class/IfcBuildingStorey
https://identifier.buildingsmart.org/uri/buildingsmart/ifc/4.3/prop/GrossHeight




https://identifier.buildingsmart.org/uri/buildingsmart/ifc/4.3/prop/NetFloorArea

https://identifier.buildingsmart.org/uri/buildingsmart/ifc/4.3/prop/EnergyConsumption
https://identifier.buildingsmart.org/uri/buildingsmart/ifc/4.3/prop/EnergyConsumption
https://identifier.buildingsmart.org/uri/buildingsmart/ifc/4.3/prop/EnergyConsumption

https://identifier.buildingsmart.org/uri/etim/etim/9.0/prop/EF016979""")
panel_10 = Panel(merge_3)
panel_11 = Panel("""m

m

m
m
m
m²
€
kWh/a
kWh/a
kWh/a
€/a
kgCO2e""")
qlt = ModelQuality(Name=panel_8, Value=panel_10, Unit=panel_11, Definition=panel_9)  # -> Quality, Name, Value, Unit, Definition

l2o = List2Object(L=merge_2)  # -> O; inputs L: tree
# ---------- l2o: Python ----------
#Component Information
#--------------------------------------------------------------------------------------------
if ghenv.Component.RunCount<2:
    #General
    #--------------------------------------------------------------------------------------------
    __author__ = "Ueli Saluz"
    __version__ = "2022.04.24"
    
    ghenv.Component.Name = "List2Object"
    ghenv.Component.NickName = "L2O"
    ghenv.Component.Description = "Wraps a list of objects into a list object."
    ghenv.Component.Message = "VER 1.0"
    ghenv.Component.Category = "Sets"
    ghenv.Component.SubCategory = "Tree"
    
     #Inputs
    #--------------------------------------------------------------------------------------------
    inputIndex=0
    
    ghenv.Component.Params.Input[inputIndex].Name = "List"
    ghenv.Component.Params.Input[inputIndex].NickName = "L"
    ghenv.Component.Params.Input[inputIndex].Description = "Tree with lists to wrap."
    ghenv.Component.Params.Input[inputIndex].Optional = False
    inputIndex+=1
    

    #Outputs
    #--------------------------------------------------------------------------------------------
    outputIndex=0
    
    ghenv.Component.Params.Output[outputIndex].Name =  "ListObject" 
    ghenv.Component.Params.Output[outputIndex].NickName = "O"
    ghenv.Component.Params.Output[outputIndex].Description = "Python list object as single item."
    outputIndex+=1


#Imports
#--------------------------------------------------------------------------------------------
from System import Object
from Grasshopper import DataTree

#Solver - Run with trees to enhance performance drastically
#--------------------------------------------------------------------------------------------
if __name__ == "__main__":
    
    #Initialize trees
    #--------------------------------------------------------------------------------------------
    TreeToWrap = DataTree[Object]()
    
    #Data matching
    #--------------------------------------------------------------------------------------------
    for path in L.Paths:
        listBranch = L.Branch(path)
        TreeToWrap.Add(listBranch,path)
    
     #Assign trees to output
    #--------------------------------------------------------------------------------------------
    O = TreeToWrap
# ---------- end l2o ----------
trim_10 = TrimTree(Tree=l2o, Depth=1)
repeat_2 = RepeatData(Data=trim_10, Length=expression_16)
trim_11 = TrimTree(Tree=repeat_2, Depth=1)
o2l = Object2List(O=trim_11)  # -> L; inputs O: tree
# ---------- o2l: Python ----------
#Component Information
#--------------------------------------------------------------------------------------------
if ghenv.Component.RunCount<2:
    #General
    #--------------------------------------------------------------------------------------------
    __author__ = "Ueli Saluz"
    __version__ = "2022.04.24"
    
    ghenv.Component.Name = "Object2List"
    ghenv.Component.NickName = "O2L"
    ghenv.Component.Description = "Unwraps a list of objects into a list object."
    ghenv.Component.Message = "VER 1.0"
    ghenv.Component.Category = "Sets"
    ghenv.Component.SubCategory = "Tree"
    
     #Inputs
    #--------------------------------------------------------------------------------------------
    inputIndex=0
    
    ghenv.Component.Params.Input[inputIndex].Name = "ListObject"
    ghenv.Component.Params.Input[inputIndex].NickName = "O"
    ghenv.Component.Params.Input[inputIndex].Description = "A python list object that will be unwrapped into a Grasshopper list."
    ghenv.Component.Params.Input[inputIndex].Optional = False
    inputIndex+=1
    

    #Outputs
    #--------------------------------------------------------------------------------------------
    outputIndex=0
    
    ghenv.Component.Params.Output[outputIndex].Name =  "List"
    ghenv.Component.Params.Output[outputIndex].NickName = "L"
    ghenv.Component.Params.Output[outputIndex].Description = "The unwrapped list."
    outputIndex+=1


#Imports
#--------------------------------------------------------------------------------------------
from System import Object
from Grasshopper import DataTree

#Solver - Run with trees to enhance performance drastically
#--------------------------------------------------------------------------------------------
if __name__ == "__main__":
    
    #Initialize trees
    #--------------------------------------------------------------------------------------------
    OriginalTree = DataTree[Object]()
    
    #Data matching
    #--------------------------------------------------------------------------------------------
    for path in O.Paths:
        listBranch = O.Branch(path)
        for i,listItem in enumerate(listBranch):
            OriginalTree.AddRange(list(listItem),path.AppendElement(i))
    
     #Assign trees to output
    #--------------------------------------------------------------------------------------------
    L = OriginalTree
# ---------- end o2l ----------
match = MatchTree(Tree=Z_2, Guide=o2l)
move = Move(Geometry=o2l, Motion=match)  # -> Geometry, Transform
crv_cp_2 = CurveClosestPoint(Point=move.Geometry, Curve=trim_4)  # -> Point, Parameter, Distance
eval_3 = EvaluateCurve(Curve=trim_4, Parameter=crv_cp_2.Parameter)  # -> Point, Tangent, Angle
rev_2 = Reverse(Vector=eval_3.Tangent)
line = LineSDL(Start=eval_3.Point, Direction=Vector(0, 0, 1), Length=1)
vrot = Rotate(Vector=rev_2, Axis=line, Angle=degrees("90"))
expression_19 = Expression(x=valueor0, Expression="-((x+2)*90)%360")
pl = ConstructPlane(Origin=eval_3.Point, XAxis=rev_2, YAxis=vrot)
move_2 = Move(Geometry=pl, Motion=Z_2)  # -> Geometry, Transform
rotate = Rotate(Geometry=move_2.Geometry, Angle=degrees(expression_19), Plane=PlaneXY(0, 0, 0))  # -> Geometry, Transform
neg_2 = Negative(Value=expression_14)
relblbrch = RelabelBranches(TreeToMatch=rotate.Geometry, ListOfPaths=trim_9)  # -> RelabeledTree; inputs TreeToMatch: tree, ListOfPaths: list
# ---------- relblbrch: Python ----------
if ghenv.Component.RunCount<2:
    __author__ = "Your name"
    __version__ = "2000.00.00"
    
    ghenv.Component.Name = "RelabelBranches"
    ghenv.Component.NickName = "ReLblBrch"
    ghenv.Component.Description = "Relabel all the paths of the branches with a list of new paths. The amount of branches must match with the size of the list of pahts"
    ghenv.Component.Message = "VER 1.0"
    
    ghenv.Component.Params.Input[0].NickName = "TreeToMatch"
    ghenv.Component.Params.Input[1].NickName = "ListOfPaths"
    
    ghenv.Component.Params.Input[0].Description = "Tree that should be relabeled."
    ghenv.Component.Params.Input[1].Description = "List of paths to use for new branch paths."
    
    ghenv.Component.Params.Output[0].NickName = "RelabeledTree"
    ghenv.Component.Params.Output[0].Description = "Relabeled tree where all the paths of the branches have been replaced with new paths."

from System import Object
from Grasshopper import DataTree

def relabelBranchesWithLstOfPths (tree, paths):
    newTree = DataTree[Object]()
    for i,path in enumerate(tree.Paths):
        items = tree.Branch(path)
        for data in items:
            newTree.Add(data,paths[i])
    return newTree

if __name__ == "__main__":
    RelabeledTree = relabelBranchesWithLstOfPths(TreeToMatch,ListOfPaths)
# ---------- end relblbrch ----------
addition_5 = Addition(A=neg_2, B=slab_thickness_m)
Z_3 = UnitZ(Factor=addition_5)
move_3 = Move(Geometry=relblbrch, Motion=Z_3)  # -> Geometry, Transform
entranceplanes = Plane(move_3.Geometry)

series = Series(Start=0, Step=1, Count="1")
trim_12 = TrimTree(Tree=series, Depth=1)
dup_3 = DuplicateData(Data=graft(trim_12), Number="8", Order=True)
trim_13 = TrimTree(Tree=dup_3, Depth=1)
trim_14 = TrimTree(Tree=trim_13, Depth=1)
loc = ModelLocator(Group="floor", Subgroup=trim_14)  # -> Locator, Group, Subgroup
concat_13 = Concatenate(FragmentA="f", FragmentB="-", FragmentC=trim_14)

series_2 = Series(Start="1", Step=1, Count="2")
dup_4 = DuplicateData(Data="0", Number="4", Order=True)
trim_15 = TrimTree(Tree=series_2, Depth=1)  # -> graft(Tree)
trim_16 = TrimTree(Tree=dup_4, Depth=1)
dup_5 = DuplicateData(Data=trim_15, Number="2", Order=True)  # -> flatten(Data)
merge_4 = Merge(Data1=trim_16, Data2=dup_5)
dup_6 = DuplicateData(Data=merge_4, Number="1", Order=True)
trim_17 = TrimTree(Tree=dup_6, Depth=1)
loc_2 = ModelLocator(Group="split level", Subgroup=trim_17)  # -> Locator, Group, Subgroup
concat_14 = Concatenate(FragmentA="sl", FragmentB="-", FragmentC=trim_17)

series_3 = Series(Start=0, Step=1, Count="4")
series_4 = Series(Start=0, Step=1, Count="2")
trim_18 = TrimTree(Tree=series_3, Depth=1)
trim_19 = TrimTree(Tree=series_4, Depth=1)
lng_2 = ListLength(List=flatten(entranceplanes))
merge_5 = Merge(Data1=trim_18, Data2=trim_19, Data3=trim_19)
repeat_3 = RepeatData(Data=merge_5, Length=lng_2)
trim_20 = TrimTree(Tree=repeat_3, Depth=1)
loc_3 = ModelLocator(Group="door", Subgroup=trim_20)  # -> Locator, Group, Subgroup
concat_15 = Concatenate(FragmentA="d", FragmentB="-", FragmentC=trim_20)

dom_4 = ConstructDomain(DomainStart=floor_height_m, DomainEnd=coreheight)
box_5 = DomainBox(Base=PlaneXY(0, 0, 0), X=_2d_2, Y=neg, Z=dom_4)
rotate_2 = Rotate(Geometry=box, Angle=degrees(expression_19), Plane=PlaneXY(0, 0, 0))  # -> Geometry, Transform
rotate_3 = Rotate(Geometry=box_2, Angle=degrees(expression_19), Plane=PlaneXY(0, 0, 0))  # -> Geometry, Transform
rotate_4 = Rotate(Geometry=box_3, Angle=degrees(expression_19), Plane=PlaneXY(0, 0, 0))  # -> Geometry, Transform
rotate_5 = Rotate(Geometry=box_5, Angle=degrees(expression_19), Plane=PlaneXY(0, 0, 0))  # -> Geometry, Transform
merge_6 = Merge(Data1=rotate_2.Geometry, Data2=rotate_3.Geometry)
merge_7 = Merge(Data1=rotate_4.Geometry, Data2=rotate_5.Geometry)
sunion = SolidUnion(Breps=merge_6)
sunion_2 = SolidUnion(Breps=merge_7)
filter = StreamFilter(Gate=include_top, Stream0=sunion_2)
filter_2 = StreamFilter(Gate=include_bottom, Stream0=sunion)
merge_8 = Merge(Data1=filter_2, Data2=filter)
sdiff = SolidDifference(BrepsA=cap, BrepsB=merge_8)
filter_3 = StreamFilter(Gate=nand, Stream0=cap, Stream1=sdiff)

panel_12 = Panel("""main
side""")
equals = Equality(FirstNumber=trim_17, SecondNumber="0")  # -> Equality, Inequality
item_8 = ListItem(List=panel_12, Index=equals.Equality, Wrap=True)
loc_4 = ModelLocator(Group="platform", Subgroup=item_8)  # -> Locator, Group, Subgroup

graft = GraftTree(Tree=pl, IncludeEmptyLists=True, IncludeNullItems=True)
tstat_2 = TreeStatistics(Tree=graft)  # -> Paths, Length, Count
expression_20 = Expression(x=valueor0, Expression="-((x+2)*90)%360")

panel_13 = Panel(" storey core with an elevator in the center, the main platform on the ")
panel_14 = Panel(", and on the other corners side platforms with two doors. The stairs are between the first and the last door of the platform.")
concat_16 = Concatenate(FragmentH="An efficient ", FragmentG="1", FragmentA=panel_13, FragmentB=platform, FragmentC=panel_14)

cir_2 = Circle(Plane=PlaneXY(0, 0, 0), Radius=expression_11)
crv_cp_3 = CurveClosestPoint(Point=merge_2, Curve=cir_2)  # -> Point, Parameter, Distance
eval_4 = EvaluateCurve(Curve=cir_2, Parameter=crv_cp_3.Parameter)  # -> Point, Tangent, Angle
Z_4 = UnitZ(Factor=1)
rev_3 = Reverse(Vector=eval_4.Tangent)
xprod = CrossProduct(VectorA=eval_4.Tangent, VectorB=Z_4, Unitize=False)  # -> Vector, Length
pl_2 = ConstructPlane(Origin=eval_4.Point, XAxis=rev_3, YAxis=xprod.Vector)

l2o_2 = List2Object(L=pl_2)  # -> O; inputs L: tree; same code as l2o
trim_21 = TrimTree(Tree=l2o_2, Depth=1)
repeat_4 = RepeatData(Data=trim_21, Length=expression_16)
trim_22 = TrimTree(Tree=repeat_4, Depth=1)
o2l_2 = Object2List(O=trim_22)  # -> graft(L); inputs O: tree; same code as o2l
relblbrch_2 = RelabelBranches(TreeToMatch=o2l_2, ListOfPaths=tstat_2.Paths)  # -> RelabeledTree; inputs TreeToMatch: tree, ListOfPaths: list; same code as relblbrch
trim_23 = TrimTree(Tree=relblbrch_2, Depth=1)
deplane = DeconstructPlane(Plane=pl_2)  # -> Origin, XAxis, YAxis, ZAxis
pl_3 = ConstructPlane(Origin=deplane.Origin, XAxis=deplane.XAxis, YAxis=deplane.ZAxis)
rectangle = Rectangle(Plane=pl_3, XSize=_2d, YSize=door_height_m, Radius=0)  # -> Rectangle, Length
l2o_3 = List2Object(L=rectangle.Rectangle)  # -> O; inputs L: tree; same code as l2o
trim_24 = TrimTree(Tree=l2o_3, Depth=1)
explode_2 = Explode(Curve=rectangle.Rectangle, Recursive=True)  # -> Segments, Vertices
repeat_5 = RepeatData(Data=trim_24, Length=expression_16)
trim_25 = TrimTree(Tree=repeat_5, Depth=1)
graft_2 = GraftTree(Tree=pl, IncludeEmptyLists=True, IncludeNullItems=True)
item_9 = ListItem(List=explode_2.Vertices, Index=0, Wrap=True)  # -> Item, Item1
graft_3 = GraftTree(Tree=pl, IncludeEmptyLists=True, IncludeNullItems=True)
o2l_3 = Object2List(O=trim_25)  # -> graft(L); inputs O: tree; same code as o2l
tstat_3 = TreeStatistics(Tree=graft_2)  # -> Paths, Length, Count
trim_26 = TrimTree(Tree=item_9.Item1, Depth=1)
trim_27 = TrimTree(Tree=item_9.Item, Depth=1)
tstat_4 = TreeStatistics(Tree=graft_3)  # -> Paths, Length, Count
crv_cp_4 = CurveClosestPoint(Point=trim_27, Curve=cir_2)  # -> Point, Parameter, Distance
crv_cp_5 = CurveClosestPoint(Point=trim_26, Curve=cir_2)  # -> Point, Parameter, Distance
relblbrch_3 = RelabelBranches(TreeToMatch=o2l_3, ListOfPaths=tstat_3.Paths)  # -> RelabeledTree; inputs TreeToMatch: tree, ListOfPaths: list; same code as relblbrch
ln = Line(StartPoint=crv_cp_4.Point, EndPoint=crv_cp_5.Point)
eval_5 = EvaluateCurve(Curve=reparameterize(ln), Parameter="0.5")  # -> Point, Tangent, Angle
trim_28 = TrimTree(Tree=relblbrch_3, Depth=1)
xprod_2 = CrossProduct(VectorA=eval_5.Tangent, VectorB=rev, Unitize=False)  # -> Vector, Length
pl_4 = ConstructPlane(Origin=eval_5.Point, XAxis=eval_5.Tangent, YAxis=xprod_2.Vector)
deplane_2 = DeconstructPlane(Plane=pl_4)  # -> Origin, XAxis, YAxis, ZAxis
len = Length(Curve=ln)
item_10 = ListItem(List=flatten(len), Index=0, Wrap=True)
pl_5 = ConstructPlane(Origin=deplane_2.Origin, XAxis=deplane_2.XAxis, YAxis=deplane_2.ZAxis)
_2d_4 = _2D(x=len)
rectangle_2 = Rectangle(Plane=pl_5, XSize=_2d_4, YSize=door_height_m, Radius=0)  # -> Rectangle, Length
panel_15 = Panel(item_10)
rulesrf = RuledSurface(CurveA=rectangle.Rectangle, CurveB=rectangle_2.Rectangle)
cap_2 = CapHoles(Brep=rulesrf)
l2o_4 = List2Object(L=cap_2)  # -> O; inputs L: tree; same code as l2o
trim_29 = TrimTree(Tree=l2o_4, Depth=1)
repeat_6 = RepeatData(Data=trim_29, Length=expression_16)
trim_30 = TrimTree(Tree=repeat_6, Depth=1)
o2l_4 = Object2List(O=trim_30)  # -> graft(L); inputs O: tree; same code as o2l
relblbrch_4 = RelabelBranches(TreeToMatch=o2l_4, ListOfPaths=tstat_4.Paths)  # -> RelabeledTree; inputs TreeToMatch: tree, ListOfPaths: list; same code as relblbrch
trim_31 = TrimTree(Tree=relblbrch_4, Depth=1)

l2o_5 = List2Object(L=merge_2)  # -> O; inputs L: tree; same code as l2o
trim_32 = TrimTree(Tree=l2o_5, Depth=1)
repeat_7 = RepeatData(Data=trim_32, Length=expression_16)
trim_33 = TrimTree(Tree=repeat_7, Depth=1)
o2l_5 = Object2List(O=trim_33)  # -> L; inputs O: tree; same code as o2l
match_2 = MatchTree(Tree=Z_2, Guide=o2l_5)
move_4 = Move(Geometry=o2l_5, Motion=match_2)  # -> Geometry, Transform
crv_cp_6 = CurveClosestPoint(Point=move_4.Geometry, Curve=trim_4)  # -> Point, Parameter, Distance
eval_6 = EvaluateCurve(Curve=trim_4, Parameter=crv_cp_6.Parameter)  # -> Point, Tangent, Angle
rev_4 = Reverse(Vector=eval_6.Tangent)
line_2 = LineSDL(Start=eval_6.Point, Direction=Vector(0, 0, 1), Length=1)
vrot_2 = Rotate(Vector=rev_4, Axis=line_2, Angle=degrees("90"))
neg_3 = Negative(Value=expression_14)
pl_6 = ConstructPlane(Origin=eval_6.Point, XAxis=rev_4, YAxis=vrot_2)
addition_6 = Addition(A=neg_3, B=slab_thickness_m)
move_5 = Move(Geometry=trim_23, Motion=Z_2)  # -> Geometry, Transform
Z_5 = UnitZ(Factor=addition_6)

rotate_6 = Rotate(Geometry=move_5.Geometry, Angle=degrees(expression_20), Plane=PlaneXY(0, 0, 0))  # -> Geometry, Transform

move_6 = Move(Geometry=rotate_6.Geometry, Motion=Z_5)  # -> Geometry, Transform
relblbrch_5 = RelabelBranches(TreeToMatch=move_6.Geometry, ListOfPaths=trim_9)  # -> RelabeledTree; inputs TreeToMatch: tree, ListOfPaths: list; same code as relblbrch
entranceplanes_2 = Plane(relblbrch_5)

pl2pl = MoveObjectPlaneToPlane(G=trim_28, S=trim_23, T=move_6.Geometry)  # -> TG, T; inputs S: Plane, T: Plane
# ---------- pl2pl: Python ----------
#Component Information
#--------------------------------------------------------------------------------------------
if ghenv.Component.RunCount<2:
    #General
    #--------------------------------------------------------------------------------------------
    __author__ = "Ueli Saluz"
    __version__ = "2023.02.12"
    
    ghenv.Component.Name = "MoveObjectPlaneToPlane"
    ghenv.Component.NickName = "Pl2Pl"
    ghenv.Component.Description = "Moves abitrary geometry from a source plane to a target plane."
    ghenv.Component.Message = "VER 1.2"
    ghenv.Component.Category = "Transform"
    ghenv.Component.SubCategory = "Euclidean"
    
     #Inputs
    #--------------------------------------------------------------------------------------------
    inputIndex=0
    
    ghenv.Component.Params.Input[inputIndex].Name = "Geometry"
    ghenv.Component.Params.Input[inputIndex].NickName = "G"
    ghenv.Component.Params.Input[inputIndex].Description = "Geometry to move."
    ghenv.Component.Params.Input[inputIndex].Optional = False
    inputIndex+=1
    
    ghenv.Component.Params.Input[inputIndex].Name = "SourcePlane"
    ghenv.Component.Params.Input[inputIndex].NickName = "S"
    ghenv.Component.Params.Input[inputIndex].Description = "Source plane of object."
    ghenv.Component.Params.Input[inputIndex].Optional = False
    inputIndex+=1
    
    ghenv.Component.Params.Input[inputIndex].Name = "TargetPlane"
    ghenv.Component.Params.Input[inputIndex].NickName = "T"
    ghenv.Component.Params.Input[inputIndex].Description = "Target plane of object."
    ghenv.Component.Params.Input[inputIndex].Optional = False
    inputIndex+=1
    
    #Outputs
    #--------------------------------------------------------------------------------------------
    outputIndex=0
    
    ghenv.Component.Params.Output[outputIndex].Name = "TranslatedGeometry"
    ghenv.Component.Params.Output[outputIndex].NickName = "TG"
    ghenv.Component.Params.Output[outputIndex].Description = "Translated geometry in target plane."
    outputIndex+=1
    
    ghenv.Component.Params.Output[outputIndex].Name = "Trasnform"
    ghenv.Component.Params.Output[outputIndex].NickName = "T"
    ghenv.Component.Params.Output[outputIndex].Description = "Transform describing translation form source to target plane."
    outputIndex+=1


#Imports
#--------------------------------------------------------------------------------------------
import Rhino.Geometry.Transform as trsf

def MvObjPlnToPln (geo,plnObj,plnDest):
    transform = trsf.PlaneToPlane(plnObj,plnDest)
    geo.Transform(transform)
    return (geo,transform)

TG, T = MvObjPlnToPln(G,S,T)
# ---------- end pl2pl ----------
transform = Transform(Geometry=trim_31, Transform=pl2pl.T)
doors1to200 = Brep(transform)

trim_34 = TrimTree(Tree=doors1to200, Depth=1)
merge_9 = Merge(Data1=cap, Data2=trim_34)
volume1to200 = Brep(merge_9)

doors1to500 = Rectangle(pl2pl.TG)

panel_16 = Panel("""west
south
south
east
east
north
north
west""")
door_tree = Data(doors1to500)
lng_3 = ListLength(List=flatten(door_tree))
expression_21 = Expression(x=valueor0, Expression="(-x)*2")
shift_2 = ShiftList(List=panel_16, Shift=expression_21, Wrap=True)
repeat_8 = RepeatData(Data=flatten(shift_2), Length=lng_3)
tstat_5 = TreeStatistics(Tree=door_tree)  # -> Paths, Length, Count
trim_35 = TrimTree(Tree=repeat_8, Depth=1)
partition_2 = PartitionList(List=trim_35, Size=tstat_5.Length)
match_3 = MatchTree(Tree=partition_2, Guide=door_tree)
loc_5 = ModelLocator(Group="facade", Subgroup=match_3)  # -> flatten(Locator), Group, Subgroup

entranceplanes_3 = Plane(flatten(entranceplanes_2))
merge_10 = Merge(
    Data1=graft(loc.Locator),
    Data2=graft(loc_2.Locator),
    Data3=graft(loc_3.Locator),
    Data4=graft(loc_5.Locator),
    Data5=graft(loc_4.Locator))
concat_17 = Concatenate(FragmentA=concat_13, FragmentB="#", FragmentC=concat_14, FragmentD="#", FragmentE=concat_15)  # -> graft(Result)
por = ModelPort(Port=graft(entranceplanes_3), Id=concat_17, Locators=merge_10)  # -> Port, Id, Point, Direction, Locators
trim_36 = TrimTree(Tree=por.Port, Depth=1)

subtraction_3 = Subtraction(A=coreheight, B=expression_8)
filter_4 = StreamFilter(Gate=include_top, Stream0=subtraction_3, Stream1=coreheight)
filter_5 = StreamFilter(Gate=include_bottom, Stream0=expression_8)
Z_6 = UnitZ(Factor=1)
rev_5 = Reverse(Vector=Z_6)
pt = ConstructPoint(XCoordinate=0, YCoordinate=0, ZCoordinate=filter_5)
pt_2 = ConstructPoint(XCoordinate=0, YCoordinate=0, ZCoordinate=filter_4)
por_2 = ModelPort(Id="b", Point=pt, Direction=rev_5, Locators="bottom")  # -> Port, Id, Point, Direction, Locators
por_3 = ModelPort(Id="t", Point=pt_2, Direction=Z_6, Locators="top")  # -> Port, Id, Point, Direction, Locators
merge_11 = Merge(Data1=por_2.Port, Data2=por_3.Port, Data3=trim_36)

doors1to500_2 = Rectangle(flatten(doors1to500))
doors1to200_2 = Brep(flatten(doors1to200))
volume1to500 = Geometry(filter_3)
volume1to200_2 = Brep(filter_3)
expression_22 = Expression(x="doors", y=doors1to500_2, Expression="x")
expression_23 = Expression(x="volume", y=volume1to500, Expression="x")
merge_12 = Merge(Data1=volume1to500, Data2=doors1to500_2)
merge_13 = Merge(Data1=expression_23, Data2=expression_22)
merge_14 = Merge(Data1=volume1to200_2, Data2=doors1to200_2)
concat_18 = Concatenate(FragmentA=curdir.PD, FragmentB=curdir.S, FragmentC=rep_3.Url)
blc = ExportBlock(path=concat_18, name=concat_4, url=rep_3.Url, geo=merge_12, layer_name=merge_13, export=save)  # -> block_definition_3, path_4, exported_2
concat_19 = Concatenate(FragmentA=curdir.PD, FragmentB=curdir.S, FragmentC=rep_4.Url)
blc_2 = ExportBlock(path=concat_19, name=concat_5, url=rep_4.Url, geo=merge_14, layer_name=merge_13, export=and)  # -> block_definition_3, path_4, exported_2

merge_15 = Merge(Data1=volume1to200_2)
rec = Rectangle({Plane=Plane(origin=(853.3612491, 852.5312947, 866.3069427), x=(0.7071067812, -0.7071067812, 0), y=(-0.4082482905, -0.4082482905, 0.8164965809)), Size=Domain2(u=-52.32632723..52.32632723, v=-27.88533994..27.88533994)})
m2d_parallel = Make2DParallelView(Projection=rec)
make2d = Make2D(Geometry=merge_15, View=m2d_parallel, TangentEdges="T", TangentSeams=False, AutoComputeMake2D=True)  # -> VisibleCurves, VisibleIndex, VisibleType, HiddenCurves, HiddenIndex, HiddenType
trim_37 = TrimTree(Tree=make2d.VisibleCurves, Depth=1)
trim_38 = TrimTree(Tree=make2d.HiddenCurves, Depth=1)

expression_24 = Expression(x="visible", y=trim_37, Expression="x")
expression_25 = Expression(x="hidden", y=trim_37, Expression="x")
concat_20 = Concatenate(FragmentA=concat_3, FragmentB="_", FragmentC="icon")
concat_21 = Concatenate(FragmentC="icons", FragmentD=curdir.S, FragmentA=concat_3)
concat_22 = Concatenate(FragmentA=concat_21, FragmentB=".3dm")
merge_16 = Merge(Data1=trim_37, Data2=trim_38)
merge_17 = Merge(Data1=expression_24, Data2=expression_25)
concat_23 = Concatenate(FragmentA=curdir.PD, FragmentB=curdir.S, FragmentC=concat_22)
blc_3 = ExportBlock(path=concat_23, name=concat_20, url=concat_22, geo=merge_16, layer_name=merge_17, export=and_2)  # -> block_definition_3, path_4, exported_2

concat_24 = Concatenate(FragmentA=concat_21, FragmentB=".svg")
concat_25 = Concatenate(FragmentA=curdir.PD, FragmentB=curdir.S, FragmentC=concat_24)
file = ReadFile(File=concat_25, PerLineParse=False)
txt = EncodeText(Text=file)
concat_26 = Concatenate(FragmentA="data:image/svg+xml;base64,", FragmentB=txt)

panel_17 = Panel("⚪")
typ = ModelType(
    Name="Cylindric Tambour",
    Description=concat_16,
    Icon=concat_26,
    Variant=item_3,
    Representations=merge,
    Ports=merge_11,
    Qualities=qlt.Quality)  # -> Type, Name, Description, Icon, Variant, Unit, Representations, Ports, Qualities
typ_2 = RemoveType(TypeName=typ.Name, TypeVariant=typ.Variant, Directory=curdir.PD, Run=save)
or = GateOr(A=save, B=typ_2)
typ_3 = AddType(Type=typ.Type, Directory=curdir.PD, Run=or)

typ_4 = SerializeType(Type=typ.Type)
type = Text(typ_4)
context_bake = ContextBake(Geometry=type)
por_4 = ModelPort(Port=merge_11)  # -> Port, Id, Point, Direction, Locators
vdisex = VectorDisplayEx(Point=por_4.Point, Vector=por_4.Direction, Colour=ColourSwatch(SwatchColor=RGB(0, 166, 157)), Width=2)
preview = CustomPreview(Geometry=por_4.Point, Material=ColourSwatch(SwatchColor=RGB(235, 52, 79)))

# ==== cluster _2D
x = ClusterInput()
expression = Expression(x=x, Expression="x/2")
neg = Negative(Value=expression)
dom = ConstructDomain(DomainStart=neg, DomainEnd=expression)
I = ClusterOutput(dom)

# ==== cluster ValueOr0
value = ClusterInput()
value_2 = Number(value)
null = NullItem(Item=value_2)  # -> NullFlags, InvalidFlags, Description
filter = StreamFilter(Gate=null.NullFlags, Stream0=value_2, Stream1="0")
valueor0 = Number(filter)
valueor0_2 = ClusterOutput(valueor0)

# ==== cluster PreviewPlane: Preview a plane with axis colors and naming.
axis_length = ClusterInput()
plane = ClusterInput()
axis_length_2 = Number(axis_length)
plane_2 = Plane(plane)
deplane = DeconstructPlane(Plane=plane_2)  # -> Origin, XAxis, YAxis, ZAxis
line = LineSDL(Start=deplane.Origin, Direction=deplane.YAxis, Length=axis_length_2)
line_2 = LineSDL(Start=deplane.Origin, Direction=deplane.XAxis, Length=axis_length_2)
line_3 = LineSDL(Start=deplane.Origin, Direction=deplane.ZAxis, Length=axis_length_2)
swatch = ColourSwatch(SwatchColor=RGB(235, 52, 79))
swatch_2 = ColourSwatch(SwatchColor=RGB(0, 166, 157))
swatch_3 = ColourSwatch(SwatchColor=RGB(240, 117, 24))
end = EndPoints(Curve=line_2)  # -> Start, End
end_2 = EndPoints(Curve=line)  # -> Start, End
end_3 = EndPoints(Curve=line_3)  # -> Start, End
tag = TextTag(Location=end.End, Text="X", Colour=swatch)
tag_2 = TextTag(Location=end_2.End, Text="Y", Colour=swatch_2)
tag_3 = TextTag(Location=end_3.End, Text="Z", Colour=swatch_3)
preview = CustomPreview(Geometry=line_2, Material=swatch)
preview_2 = CustomPreview(Geometry=line, Material=swatch_2)
preview_3 = CustomPreview(Geometry=line_3, Material=swatch_3)

# ==== cluster ViewRectangle
view = ClusterInput()
view_2 = Data(view)
nickname = NAME(view=view_2)  # -> c, x, y, z, h, w
# ---------- nickname: Python ----------
uselss, c, x, y, z = view.GetCameraFrame()
h = view.FrustumHeight
w = view.FrustumWidth
# ---------- end nickname ----------
rev = Reverse(Vector=nickname.x)
rev_2 = Reverse(Vector=nickname.y)
pl = ConstructPlane(Origin=nickname.c, XAxis=rev, YAxis=nickname.y)
_2d = _2D(x=nickname.w)
_2d_2 = _2D(x=nickname.h)
rectangle = Rectangle(Plane=pl, XSize=_2d, YSize=_2d_2, Radius=0)  # -> Rectangle, Length
rec = Rectangle(rectangle.Rectangle)
rec_2 = ClusterOutput(rec)

# ==== cluster ExportBlock: Export geometry with layer names to a file.
path = ClusterInput()
name = ClusterInput()
url = ClusterInput()
geo = ClusterInput()
layer_name = ClusterInput()
export = ClusterInput()
path_2 = FilePath(path)
name_2 = Text(name)
url_2 = Text(url)
geo_2 = Geometry(geo)
layer_name_2 = Text(layer_name)
export_2 = Boolean(export)
layer = ModelLayer(Name=layer_name_2)  # -> Layer, Name, Hidden, Locked, DisplayColour, Material, Linetype
object = ModelObject(Geometry=geo_2, Layer=layer.Layer)  # -> Object, Geometry, Name, Layer, Visibility, Display, Drafting, Render
block_definition = ModelBlockDefinition(Objects=object.Object, Name=name_2, URL=url_2)  # -> BlockDefinition, Objects, Units, Name, Notes, URL, URLDescription
export_definition = ExportModelBlockDefinition(BlockDefinition=block_definition.BlockDefinition, FilePath=path_2, Overwrite="T", Export=export_2)  # -> BlockDefinition, FilePath, Exported
block_definition_2 = ModelBlockDefinition(export_definition.BlockDefinition)
path_3 = FilePath(export_definition.FilePath)
exported = Boolean(export_definition.Exported)
path_4 = ClusterOutput(path_3)
exported_2 = ClusterOutput(exported)
block_definition_3 = ClusterOutput(block_definition_2)
