# Grasshopper definition shaft.gh (Grasshopper 1.0.8)
# plug-ins: eleFront, semio

number_slider = Slider(0, range=0..3)
save_representation = BooleanToggle(False)
icon_export = BooleanToggle(False)
save = BooleanToggle(False)
panel = Panel("""Bottom
Top
Single Storey""")
loop_slider = PythonScript(
    SliderToModify=number_slider,
    Min="0",
    Max="3",
    stepSize="1",
    Delay=Slider(0, range=0..1),
    Run=Toggle(False),
    Reset=Button())  # inputs Run: Boolean, Reset: Boolean
# ---------- loop_slider: Python ----------
import time

def updateSliderInput(inputName,min,max,value,decimalPlace=2):
    for input in ghenv.Component.Params.Input:
        for source in input.Sources:
            if input.Name == str(inputName):
                source.Slider.DecimalPlaces = decimalPlace
                source.Slider.Minimum = min
                source.Slider.Maximum = max
                source.Slider.Value = value
                source.ExpireSolution(True)

def countDecimal(number):
    string= str(number)
    return string[::-1].find('.')

if Run == True:
    if SliderToModify < Max:
        time.sleep(Delay)
        updateSliderInput("SliderToModify",Min,Max,SliderToModify+stepSize,countDecimal(stepSize))
if Reset == True:
    updateSliderInput("SliderToModify",Min,Max,Min)
# ---------- end loop_slider ----------
and = GateAnd(A=save, B=save_representation)
and_2 = GateAnd(A=save, B=icon_export)
panel_2 = Panel("""F
T
F
T""")
panel_3 = Panel("""F
F
T
T""")
item = ListItem(List=panel_2, Index=number_slider, Wrap=True)
item_2 = ListItem(List=panel_3, Index=number_slider, Wrap=True)
item_3 = ListItem(List=panel, Index=number_slider, Wrap=True)
expression = Expression(x=Slider(550, range=0..1000), Expression="x/100")
expression_2 = Expression(x=Slider(275, range=0..1000), Expression="x/100")
list = ValueList({"North": "north", "East": "east", "South": "south", "West": "west"}, selected="North")
# ^
#                  |
# Preview    ->
# ^
#  |
# <- Meta
# Parameters:
# <- Variants
#   |
#   v
curdir = CurrentDirectory()  # -> PD, D, P, S
# ---------- curdir: Python ----------
# Component Information
# --------------------------------------------------------------------------------------------
if ghenv.Component.RunCount < 2:
    # General
    # --------------------------------------------------------------------------------------------
    __author__ = "Ueli Saluz"
    __version__ = "2024.07.26"

    ghenv.Component.Name = "CurrentDirectory"
    ghenv.Component.NickName = "CurDir"
    ghenv.Component.Description = "Current directory of the current grasshopper file."
    ghenv.Component.Message = "VER 1.1"
    ghenv.Component.Category = "Params"
    ghenv.Component.SubCategory = "Util"

    # Outputs
    # --------------------------------------------------------------------------------------------
    outputIndex = 0

    ghenv.Component.Params.Output[outputIndex].Name = "ParentDirectory"
    ghenv.Component.Params.Output[outputIndex].NickName = "PD"
    ghenv.Component.Params.Output[outputIndex].Description = "Parent directory of the current directory."
    outputIndex += 1

    ghenv.Component.Params.Output[outputIndex].Name = "Directory"
    ghenv.Component.Params.Output[outputIndex].NickName = "D"
    ghenv.Component.Params.Output[outputIndex].Description = "Directory of the current grasshopper file."
    outputIndex += 1

    ghenv.Component.Params.Output[outputIndex].Name = "Path"
    ghenv.Component.Params.Output[outputIndex].NickName = "P"
    ghenv.Component.Params.Output[outputIndex].Description = "Path of the current grasshopper file."
    outputIndex += 1

    ghenv.Component.Params.Output[outputIndex].Name = "Separator"
    ghenv.Component.Params.Output[outputIndex].NickName = "S"
    ghenv.Component.Params.Output[outputIndex].Description = "Separator of the current system."
    outputIndex += 1

# Imports
# --------------------------------------------------------------------------------------------
from os.path import dirname, abspath
from os import sep

# Solver - Run with trees to enhance performance drastically
# --------------------------------------------------------------------------------------------
if __name__ == "__main__":
    P = ghenv.Component.OnPingDocument().FilePath
    D = dirname(P)
    PD = dirname(D)
    S = sep
# ---------- end curdir ----------
# External
#       |
#       v
width_m = GetNumber(expression, AtLeast=1, AtMost=1, Maximum=1.797693135e+308, Minimum=-1.797693135e+308, TreeAccess=False)
floor_height_m = GetNumber(expression_2, AtLeast=1, AtMost=1, Maximum=1.797693135e+308, Minimum=-1.797693135e+308, TreeAccess=False)
platform = GetString(list, AtLeast=1, AtMost=1, TreeAccess=False)
include_bottom = GetBoolean(item, AtLeast=1, AtMost=1, FalseValue="False", TreeAccess=False, TrueValue="True")
include_top = GetBoolean(item_2, AtLeast=1, AtMost=1, FalseValue="False", TreeAccess=False, TrueValue="True")
# Local ->
number_slider_2 = Slider(1, range=0..20)
floors = Integer(number_slider_2)

series = Series(Start=0, Step=1, Count=floors)
trim = TrimTree(Tree=series, Depth=1)
dup = DuplicateData(Data=graft(trim), Number="8", Order=True)
trim_2 = TrimTree(Tree=dup, Depth=1)
trim_3 = TrimTree(Tree=trim_2, Depth=1)
loc = ModelLocator(Group="floor", Subgroup=trim_3)  # -> Locator, Group, Subgroup
concat = Concatenate(FragmentA="f", FragmentB="-", FragmentC=trim_3)

series_2 = Series(Start="1", Step=1, Count="2")
dup_2 = DuplicateData(Data="0", Number="4", Order=True)
trim_4 = TrimTree(Tree=series_2, Depth=1)  # -> graft(Tree)
trim_5 = TrimTree(Tree=dup_2, Depth=1)
dup_3 = DuplicateData(Data=trim_4, Number="2", Order=True)  # -> flatten(Data)
merge = Merge(Data1=trim_5, Data2=dup_3)
dup_4 = DuplicateData(Data=merge, Number=floors, Order=True)
trim_6 = TrimTree(Tree=dup_4, Depth=1)
loc_2 = ModelLocator(Group="split level", Subgroup=trim_6)  # -> Locator, Group, Subgroup
concat_2 = Concatenate(FragmentA="sl", FragmentB="-", FragmentC=trim_6)

expression_3 = Expression(x=Slider(20, range=0..100), Expression="x/100")

panel_4 = Panel("""main
side""")
equals = Equality(FirstNumber=trim_6, SecondNumber="0")  # -> Equality, Inequality
item_4 = ListItem(List=panel_4, Index=equals.Equality, Wrap=True)
loc_3 = ModelLocator(Group="platform", Subgroup=item_4)  # -> Locator, Group, Subgroup

variant = Integer(number_slider)
expression_4 = Expression(x=variant, Expression="x+1")
concat_3 = Concatenate(FragmentC="representations", FragmentD=curdir.S, FragmentA="shaft", FragmentB="_", FragmentE=expression_4)
concat_4 = Concatenate(FragmentA=concat_3, FragmentB="_", FragmentE="1to500", FragmentG="_", FragmentF="volume")
concat_5 = Concatenate(FragmentA=concat_3, FragmentB="_", FragmentE="1to200", FragmentG="_", FragmentF="volume")
concat_6 = Concatenate(FragmentA=concat_4, FragmentB=".3dm")
concat_7 = Concatenate(FragmentA=concat_3, FragmentB=".glb")
concat_8 = Concatenate(FragmentA=concat_5, FragmentB=".3dm")
rep = ModelRepresentation(Url=concat_6, LevelOfDetail="1to500", Tags="volume")  # -> Representation, Url, LevelOfDetail, Tags, Tags_2
rep_2 = ModelRepresentation(Url=concat_8, LevelOfDetail="1to200", Tags="volume")  # -> Representation, Url, LevelOfDetail, Tags, Tags_2
rep_3 = ModelRepresentation(Url=concat_7)  # -> Representation, Url, LevelOfDetail, Tags, Tags_2

slab_thickness_m = Number(expression_3)

panel_5 = Panel(" storey core with an elevator in the center, the main platform on the ")
panel_6 = Panel(", and on the other corners side platforms with two doors. The stairs are between the first and the last door of the platform.")
concat_9 = Concatenate(FragmentH="An efficient ", FragmentA=panel_5, FragmentB=platform, FragmentC=panel_6)

expression_5 = Expression(x=Slider(30, range=0..100), Expression="x/100")
expression_6 = Expression(x=Slider(80, range=0..200), Expression="x/100")
expression_7 = Expression(x=Slider(200, range=0..1000), Expression="x/100")
expression_8 = Expression(x=Slider(115, range=0..1000), Expression="x/100")
wall_thickness_m = Number(expression_5)
door_width_m = Number(expression_6)
door_height_m = Number(expression_7)
door_offset_m = Number(expression_8)
maintenance_expenses_month_eff_m² = Slider(3.5, range=0..10)
construction_area_factor = Slider(0.2, range=0..1)
construction_cost_eff_m² = Slider(9000, range=0..10000)
panel_7 = Panel("Parallel")  # disabled
m2d_rhino = Make2DRhinoView(Name=panel_7, Clip=True)  # disabled
number_slider_3 = Slider(876, range=0..1000)  # disabled
construction_area_factor_2 = Number(construction_area_factor)
construction_cost_eff_m²_2 = Number(construction_cost_eff_m²)
maintenance_expenses_month_eff_m²_2 = Number(maintenance_expenses_month_eff_m²)
view_rectangle = ViewRectangle(view=m2d_rhino)  # disabled
previewplane = PreviewPlane(plane=view_rectangle, axis_length=number_slider_3)  # disabled
heating_energy_demand_kwh_m²a = Number(Slider(20, range=0..200))
cooling_energy_demand_kwh_m²a = Number(Slider(10, range=0..200))
construction_global_warming_potential_kg = Number(Slider(1500, range=0..2000))  # "Construction Global Warming Potential [kgCO2e/eff. m²]"
technical_equipment_energy_demand_kwh_m² = Number(Slider(20, range=0..200))  # "Technical Equipment Energy Demand[kWh/m²a]"

panel_8 = Panel("https://app.speckle.systems")
mime = ValueList({".stl": "model/stl", ".obj": "model/obj", ".glb": "model/gltf-binary", ".gltf": "model/gltf+json", ".3dm": "model/vnd.3dm", ".speckle": "model/vnd.speckle+json", ".png": "image/png", ".jpg": "image/jpeg", ".jpeg": "image/jpeg", ".svg": "image/svg+xml", ".pdf": "application/pdf", ".zip": "application/zip", ".json": "application/json", ".csv": "text/csv", ".txt": "text/plain"}, selected=".speckle")
concat_10 = Concatenate(FragmentA="cylindric-shaft", FragmentB="_", FragmentE="1to500", FragmentG="_", FragmentF="volume")
concat_11 = Concatenate(FragmentA="cylindric-shaft", FragmentB="_", FragmentE="1to200", FragmentG="_", FragmentF="volume")
concat_12 = Concatenate(FragmentC="representations", FragmentA="cylindric-shaft")
concat_13 = Concatenate(FragmentC="representations", FragmentA=concat_11)
concat_14 = Concatenate(FragmentC="representations", FragmentA=concat_10)
concat_15 = Concatenate(FragmentA=panel_8, FragmentB="/projects/", FragmentC="e7de1a2f8f", FragmentD="/models/", FragmentE="47481b6b08")
concat_16 = Concatenate(FragmentA=concat_12, FragmentB=".glb")
concat_17 = Concatenate(FragmentA=concat_14, FragmentB=".3dm")
concat_18 = Concatenate(FragmentA=concat_13, FragmentB=".3dm")
concat_19 = Concatenate(FragmentA=panel_8, FragmentB="/projects/", FragmentC="e7de1a2f8f", FragmentD="/models/", FragmentE="82fd28f19e")
rep_4 = ModelRepresentation(Url=concat_16)  # -> Representation, Url, Mime, LoD, Tags
concat_20 = Concatenate(FragmentA=panel_8, FragmentB="/projects/", FragmentC="e7de1a2f8f", FragmentD="/models/", FragmentE="90435c0046")
concat_21 = Concatenate(FragmentA=concat_12, FragmentB=".3dm")
rep_5 = ModelRepresentation(Url=concat_21)  # -> Representation, Url, Mime, LoD, Tags
rep_6 = ModelRepresentation(Url=concat_17, LevelOfDetail="1to500", Tags="volume")  # -> Representation, Url, Mime, LoD, Tags
rep_7 = ModelRepresentation(Url=concat_18, LevelOfDetail="1to200", Tags="volume")  # -> Representation, Url, Mime, LoD, Tags
rep_8 = ModelRepresentation(Url=concat_15, Mime=mime)  # -> Representation, Url, Mime, LoD, Tags
rep_9 = ModelRepresentation(Url=concat_19, Mime=mime, LevelOfDetail="1to500", Tags="volume")  # -> Representation, Url, Mime, LoD, Tags
rep_10 = ModelRepresentation(Url=concat_20, Mime=mime, LevelOfDetail="1to200", Tags="volume")  # -> Representation, Url, Mime, LoD, Tags
merge_2 = Merge(
    Data1=rep_4.Representation,
    Data2=rep_5.Representation,
    Data3=rep_8.Representation,
    Data4=rep_6.Representation,
    Data5=rep_9.Representation,
    Data6=rep_7.Representation,
    Data7=rep_10.Representation)

doors1to500 = Rectangle()
doors1to200 = Brep()
volume1to500 = Geometry()
volume1to200 = Brep()
expression_9 = Expression(x="doors", y=doors1to500, Expression="x")
expression_10 = Expression(x="volume", y=volume1to500, Expression="x")
merge_3 = Merge(Data1=volume1to500, Data2=doors1to500)
merge_4 = Merge(Data1=expression_10, Data2=expression_9)
merge_5 = Merge(Data1=volume1to200, Data2=doors1to200)
concat_22 = Concatenate(FragmentC=rep_6.Url)
blc = ExportBlock(path=concat_22, name=concat_10, url=rep_6.Url, geo=merge_3, layer_name=merge_4)  # -> block_definition_3, path_4, exported_2
concat_23 = Concatenate(FragmentC=rep_7.Url)
blc_2 = ExportBlock(path=concat_23, name=concat_11, url=rep_7.Url, geo=merge_5, layer_name=merge_4)  # -> block_definition_3, path_4, exported_2

merge_6 = Merge(Data1=volume1to200)
rec = Rectangle({Plane=Plane(origin=(853.3612491, 852.5312947, 866.3069427), x=(0.7071067812, -0.7071067812, 0), y=(-0.4082482905, -0.4082482905, 0.8164965809)), Size=Domain2(u=-52.32632723..52.32632723, v=-27.88533994..27.88533994)})
m2d_parallel = Make2DParallelView(Projection=rec)
make2d = Make2D(Geometry=merge_6, View=m2d_parallel, TangentEdges="T", TangentSeams=False, AutoComputeMake2D=True)  # -> VisibleCurves, VisibleIndex, VisibleType, HiddenCurves, HiddenIndex, HiddenType
trim_7 = TrimTree(Tree=make2d.VisibleCurves, Depth=1)
shaft = Geometry(trim_7)

expression_11 = Expression(x="shaft", y=shaft, Expression="x")
concat_24 = Concatenate(FragmentA="cylindric-shaft", FragmentB="_", FragmentC="icon")
concat_25 = Concatenate(FragmentC="icons", FragmentA="cylindric-shaft")
concat_26 = Concatenate(FragmentA=concat_25, FragmentB=".3dm")
concat_27 = Concatenate(FragmentC=concat_26)
blc_3 = ExportBlock(path=concat_27, name=concat_24, url=concat_26, geo=shaft, layer_name=expression_11)  # -> block_definition_3, path_4, exported_2

expression_12 = Expression(x=floors, Expression="x+1")
int = Integer(expression_12)
expression_13 = Expression(x=int, Expression="(x-1)*4")

panel_9 = Panel("""north
east
south
west""")
itemindex = ItemIndex(L=panel_9, I=platform)  # -> i; inputs L: list
# ---------- itemindex: Python ----------
#Component Information
#--------------------------------------------------------------------------------------------
if ghenv.Component.RunCount<2:
    #General
    #--------------------------------------------------------------------------------------------
    __author__ = "Ueli Saluz"
    __version__ = "2022.11.18"
    
    ghenv.Component.Name = "ItemIndex"
    ghenv.Component.NickName = "ItemIndex"
    ghenv.Component.Description = "A better IdemIndex"
    ghenv.Component.Message = "VER 1.0"
    ghenv.Component.Category = "Set"
    ghenv.Component.SubCategory = "List"
    
     #Inputs
    #--------------------------------------------------------------------------------------------
    inputIndex=0
    
    ghenv.Component.Params.Input[inputIndex].Name = "List"
    ghenv.Component.Params.Input[inputIndex].NickName = "L"
    ghenv.Component.Params.Input[inputIndex].Description = "Input1 is..."
    ghenv.Component.Params.Input[inputIndex].Optional = False
    inputIndex+=1
    
    ghenv.Component.Params.Input[inputIndex].Name = "Item"
    ghenv.Component.Params.Input[inputIndex].NickName = "I"
    ghenv.Component.Params.Input[inputIndex].Description = "Input2 is..."
    ghenv.Component.Params.Input[inputIndex].Optional = False
    inputIndex+=1
    
    #Outputs
    #--------------------------------------------------------------------------------------------
    outputIndex=0
    
    ghenv.Component.Params.Output[outputIndex].Name = "Index"
    ghenv.Component.Params.Output[outputIndex].NickName = "i"
    ghenv.Component.Params.Output[outputIndex].Description = "Output1 is..."
    outputIndex+=1

i = L.index(I)
# ---------- end itemindex ----------
valueor0 = ValueOr0(value=itemindex)
expression_14 = Expression(x=valueor0, Expression="-((x+2)*90)%360")
_2d = _2D(x=width_m)
rectangle = Rectangle(Plane=PlaneXY(0, 0, 0), XSize=_2d, YSize=_2d, Radius=0)  # -> Rectangle, Length
expression_15 = Expression(x=width_m, Expression="x/2")
expression_16 = Expression(x=door_width_m, Expression="x/2")
subtraction = Subtraction(A=expression_15, B=expression_16, C=door_offset_m, D=wall_thickness_m)

maintenance_expenses_month_eff_m²_3 = Number(maintenance_expenses_month_eff_m²_2)
# Outputs   ->
#                 |
#                 v
construction_global_warming_potential_kg_2 = Number(construction_global_warming_potential_kg)  # "Construction Global Warming Potential [kgCO2e/eff. m²]"
technical_equipment_energy_demand_kwh_m²_2 = Number(technical_equipment_energy_demand_kwh_m²)  # "Technical Equipment Energy Demand[kWh/m²a]"
construction_area_factor_3 = Number(construction_area_factor_2)
heating_energy_demand_kwh_m²a_2 = Number(heating_energy_demand_kwh_m²a)
cooling_energy_demand_kwh_m²a_2 = Number(cooling_energy_demand_kwh_m²a)
area = Area(Geometry=rectangle.Rectangle)  # -> Area, Centroid
construction_cost_eff_m²_3 = Number(construction_cost_eff_m²_2)
expression_17 = Expression(x=construction_area_factor_3, Expression="1-x")
multiplication = Multiplication(A=area.Area, B=floors)
multiplication_2 = Multiplication(A=multiplication, B=expression_17)
multiplication_3 = Multiplication(A=multiplication_2, B=maintenance_expenses_month_eff_m²_3)
expression_18 = Expression(x=multiplication_3, Expression="x*12")
multiplication_4 = Multiplication(A=heating_energy_demand_kwh_m²a_2, B=multiplication_2)
multiplication_5 = Multiplication(A=cooling_energy_demand_kwh_m²a_2, B=multiplication_2)
multiplication_6 = Multiplication(A=multiplication_2, B=construction_cost_eff_m²_3)
multiplication_7 = Multiplication(A=technical_equipment_energy_demand_kwh_m²_2, B=multiplication_2)
multiplication_8 = Multiplication(B=construction_global_warming_potential_kg_2)
roundmult = RoundToMultiple(N=multiplication_2, M="0.01")  # -> R; inputs N: tree, M: tree
# ---------- roundmult: Python ----------
#Component Information
#--------------------------------------------------------------------------------------------
if ghenv.Component.RunCount<2:
    #General
    #--------------------------------------------------------------------------------------------
    __author__ = "YOUR NAME"
    __version__ = "2000.00.00"
    
    ghenv.Component.Name = "Round to Multiple"
    ghenv.Component.NickName = "RoundMult"
    ghenv.Component.Description = "Rounds a number to the nearest specified multiple."
    ghenv.Component.Message = "VER 1.0"
    ghenv.Component.Category = "Math"
    ghenv.Component.SubCategory = "Arithmetic"
    
     #Inputs
    #--------------------------------------------------------------------------------------------
    inputIndex=0
    
    ghenv.Component.Params.Input[inputIndex].Name = "Number"
    ghenv.Component.Params.Input[inputIndex].NickName = "N"
    ghenv.Component.Params.Input[inputIndex].Description = "Number to round."
    ghenv.Component.Params.Input[inputIndex].Optional = False
    inputIndex+=1
    
    ghenv.Component.Params.Input[inputIndex].Name = "Multiple"
    ghenv.Component.Params.Input[inputIndex].NickName = "M"
    ghenv.Component.Params.Input[inputIndex].Description = "Multiple to round to."
    ghenv.Component.Params.Input[inputIndex].Optional = False
    inputIndex+=1
    
    #Outputs
    #--------------------------------------------------------------------------------------------
    outputIndex=0
    
    ghenv.Component.Params.Output[outputIndex].Name = "Rounded"
    ghenv.Component.Params.Output[outputIndex].NickName = "R"
    ghenv.Component.Params.Output[outputIndex].Description = "Number rounded to the nearest specified multiple."
    outputIndex+=1


#Imports
#--------------------------------------------------------------------------------------------
from System import Object
from Grasshopper import DataTree
import math


#The Component function - Business logic only (e.g. working without trees)
#--------------------------------------------------------------------------------------------
"""Function that this component is computing.
    Inputs:
        number: The number to round.
        multiple: The multiple to round to.
    Output:
        rounded: The number rounded to the nearest specified multiple."""
def RoundToMultiple(number, multiple):
    rounded = math.ceil(number / multiple) * multiple
    return rounded

#Solver - Run with trees to enhance performance drastically
#--------------------------------------------------------------------------------------------
if __name__ == "__main__":
    
    #Initialize trees
    #--------------------------------------------------------------------------------------------
    RoundedTree = DataTree[Object]()
    
    #Data matching
    #--------------------------------------------------------------------------------------------
    for path in N.Paths:
        numberBranch = N.Branch(path)
        for i, number in enumerate(numberBranch):
            multiple = M.Branch(path)[i]
            rounded = RoundToMultiple(number, multiple)
            RoundedTree.Add(rounded, path)
    
     #Assign trees to output
    #--------------------------------------------------------------------------------------------
    R = RoundedTree
# ---------- end roundmult ----------
round = Round(Number=multiplication_6)  # -> Nearest, Floor, Ceiling
round_2 = Round(Number=multiplication_4)  # -> Nearest, Floor, Ceiling
round_3 = Round(Number=multiplication_5)  # -> Nearest, Floor, Ceiling
round_4 = Round(Number=multiplication_7)  # -> Nearest, Floor, Ceiling
round_5 = Round(Number=expression_18)  # -> Nearest, Floor, Ceiling
round_6 = Round(Number=multiplication_8)  # -> Nearest, Floor, Ceiling
merge_7 = Merge(
    Data1=width_m,
    Data2=floors,
    Data3=floor_height_m,
    Data4=platform,
    Data5=door_width_m,
    Data6=door_height_m,
    Data7=door_offset_m,
    Data8=roundmult,
    Data9=round.Nearest,
    Data10=round_2.Nearest,
    Data11=round_3.Nearest,
    Data12=round_4.Nearest,
    Data13=round_5.Nearest,
    Data14=round_6.Nearest)
panel_10 = Panel("""width
storeys
floor height
platform
door width
door height
door offset
effective floor area
construction cost
heating energy demand
cooling energy demand
technical equipment energy demand
maintenance expenses
construction global warming potential""")
panel_11 = Panel("""https://identifier.buildingsmart.org/uri/buildingsmart/ifc/4.3/prop/Width 
https://identifier.buildingsmart.org/uri/buildingsmart/ifc/4.3/class/IfcBuildingStorey
https://identifier.buildingsmart.org/uri/buildingsmart/ifc/4.3/prop/GrossHeight




https://identifier.buildingsmart.org/uri/buildingsmart/ifc/4.3/prop/NetFloorArea

https://identifier.buildingsmart.org/uri/buildingsmart/ifc/4.3/prop/EnergyConsumption
https://identifier.buildingsmart.org/uri/buildingsmart/ifc/4.3/prop/EnergyConsumption
https://identifier.buildingsmart.org/uri/buildingsmart/ifc/4.3/prop/EnergyConsumption

https://identifier.buildingsmart.org/uri/etim/etim/9.0/prop/EF016979""")
panel_12 = Panel(merge_7)
panel_13 = Panel("""m

m

m
m
m
m²
€
kWh/a
kWh/a
kWh/a
€/a
kgCO2e""")
qlt = ModelQuality(Name=panel_10, Value=panel_12, Unit=panel_13, Definition=panel_11)  # -> Quality, Name, Value, Unit, Definition

expression_19 = Expression(x=floor_height_m, Expression="x/3")
expression_20 = Expression(x=floor_height_m, Expression="x*(2/3)")
_2d_2 = _2D(x=width_m)
expression_21 = Expression(x=width_m, Expression="x/2")
addition = Addition(A=floor_height_m, B=expression_19)
addition_2 = Addition(A=addition, B=expression_19)
neg = Negative(Value=expression_21)
dom = ConstructDomain(DomainStart=expression_19, DomainEnd=expression_20)
dom_2 = ConstructDomain(DomainStart=addition, DomainEnd=addition_2)
box = DomainBox(Base=PlaneXY(0, 0, 0), X=_2d_2, Y=expression_21, Z=expression_19)
box_2 = DomainBox(Base=PlaneXY(0, 0, 0), X=neg, Y=expression_21, Z=dom)
box_3 = DomainBox(Base=PlaneXY(0, 0, 0), X=expression_21, Y=expression_21, Z=dom_2)
rotate = Rotate(Geometry=box, Angle=degrees(expression_14), Plane=PlaneXY(0, 0, 0))  # -> Geometry, Transform
rotate_2 = Rotate(Geometry=box_2, Angle=degrees(expression_14), Plane=PlaneXY(0, 0, 0))  # -> Geometry, Transform
rotate_3 = Rotate(Geometry=box_3, Angle=degrees(expression_14), Plane=PlaneXY(0, 0, 0))  # -> Geometry, Transform
merge_8 = Merge(Data1=rotate.Geometry, Data2=rotate_2.Geometry)
sunion = SolidUnion(Breps=merge_8)
filter = StreamFilter(Gate=include_bottom, Stream0=sunion)
nand = GateNand(A=include_bottom, B=include_top)

addition_3 = Addition(A=floor_height_m, B=expression_20)
coreheight = Number(addition_3)
dom_3 = ConstructDomain(DomainStart=0, DomainEnd=coreheight)
box_4 = DomainBox(Base=PlaneXY(0, 0, 0), X=_2d, Y=_2d, Z=dom_3)
corevolume = Box(box_4)
debrep = DeconstructBrep(Brep=corevolume)  # -> Faces, Edges, Vertices
trim_8 = TrimTree(Tree=debrep.Faces, Depth=1)
item_5 = ListItem(List=trim_8, Index=0, Wrap=True)  # -> Item, Item1, Item2, Item3, Item4
base = Surface(item_5.Item4)
explode = Explode(Curve=base, Recursive=True)  # -> Segments, Vertices
trim_9 = TrimTree(Tree=explode.Segments, Depth=1)
join = JoinCurves(Curves=explode.Segments, Preserve=False)
trim_10 = TrimTree(Tree=join, Depth=1)
curvepoint = PointOnCurve(trim_9, parameter=0.5)
crv_cp = CurveClosestPoint(Point=curvepoint, Curve=trim_9)  # -> Point, Parameter, Distance
addition_4 = Addition(A=crv_cp.Parameter, B=subtraction)
subtraction_2 = Subtraction(A=crv_cp.Parameter, B=subtraction)
eval = EvaluateCurve(Curve=trim_9, Parameter=addition_4)  # -> Point, Tangent, Angle
eval_2 = EvaluateCurve(Curve=trim_9, Parameter=subtraction_2)  # -> Point, Tangent, Angle
shift = ShiftList(List=eval_2.Point, Shift=1, Wrap=True)
trim_11 = TrimTree(Tree=shift, Depth=1)
merge_9 = Merge(Data1=graft(eval.Point), Data2=graft(trim_11))

expression_22 = Expression(x=floor_height_m, Expression="x/3")
lng = ListLength(List=trim_9)
dup_5 = DuplicateData(Data=expression_22, Number=lng, Order=True)
trim_12 = TrimTree(Tree=dup_5, Depth=1)
replace = ReplaceItems(List=trim_12, Item="0", Indices="1", Wrap=False)
repeat = RepeatData(Data=replace, Length=expression_13)
trim_13 = TrimTree(Tree=repeat, Depth=1)
ma = MassAddition(Input=trim_13)  # -> Result, PartialResults
flip = FlipMatrix(Data=ma.PartialResults)
doorheights = Number(flip)
Z = UnitZ(Factor=doorheights)
trim_14 = TrimTree(Tree=Z, Depth=1)
cset = CreateSet(List=trim_14)  # -> Set, graft(Map)
path = ConstructPath(Indices=cset.Map)
trim_15 = TrimTree(Tree=path, Depth=1)

subtraction_3 = Subtraction(A=coreheight, B=expression_22)

l2o = List2Object(L=merge_9)  # -> O; inputs L: tree
# ---------- l2o: Python ----------
#Component Information
#--------------------------------------------------------------------------------------------
if ghenv.Component.RunCount<2:
    #General
    #--------------------------------------------------------------------------------------------
    __author__ = "Ueli Saluz"
    __version__ = "2022.04.24"
    
    ghenv.Component.Name = "List2Object"
    ghenv.Component.NickName = "L2O"
    ghenv.Component.Description = "Wraps a list of objects into a list object."
    ghenv.Component.Message = "VER 1.0"
    ghenv.Component.Category = "Sets"
    ghenv.Component.SubCategory = "Tree"
    
     #Inputs
    #--------------------------------------------------------------------------------------------
    inputIndex=0
    
    ghenv.Component.Params.Input[inputIndex].Name = "List"
    ghenv.Component.Params.Input[inputIndex].NickName = "L"
    ghenv.Component.Params.Input[inputIndex].Description = "Tree with lists to wrap."
    ghenv.Component.Params.Input[inputIndex].Optional = False
    inputIndex+=1
    

    #Outputs
    #--------------------------------------------------------------------------------------------
    outputIndex=0
    
    ghenv.Component.Params.Output[outputIndex].Name =  "ListObject" 
    ghenv.Component.Params.Output[outputIndex].NickName = "O"
    ghenv.Component.Params.Output[outputIndex].Description = "Python list object as single item."
    outputIndex+=1


#Imports
#--------------------------------------------------------------------------------------------
from System import Object
from Grasshopper import DataTree

#Solver - Run with trees to enhance performance drastically
#--------------------------------------------------------------------------------------------
if __name__ == "__main__":
    
    #Initialize trees
    #--------------------------------------------------------------------------------------------
    TreeToWrap = DataTree[Object]()
    
    #Data matching
    #--------------------------------------------------------------------------------------------
    for path in L.Paths:
        listBranch = L.Branch(path)
        TreeToWrap.Add(listBranch,path)
    
     #Assign trees to output
    #--------------------------------------------------------------------------------------------
    O = TreeToWrap
# ---------- end l2o ----------
trim_16 = TrimTree(Tree=l2o, Depth=1)
repeat_2 = RepeatData(Data=trim_16, Length=expression_13)
trim_17 = TrimTree(Tree=repeat_2, Depth=1)
o2l = Object2List(O=trim_17)  # -> L; inputs O: tree
# ---------- o2l: Python ----------
#Component Information
#--------------------------------------------------------------------------------------------
if ghenv.Component.RunCount<2:
    #General
    #--------------------------------------------------------------------------------------------
    __author__ = "Ueli Saluz"
    __version__ = "2022.04.24"
    
    ghenv.Component.Name = "Object2List"
    ghenv.Component.NickName = "O2L"
    ghenv.Component.Description = "Unwraps a list of objects into a list object."
    ghenv.Component.Message = "VER 1.0"
    ghenv.Component.Category = "Sets"
    ghenv.Component.SubCategory = "Tree"
    
     #Inputs
    #--------------------------------------------------------------------------------------------
    inputIndex=0
    
    ghenv.Component.Params.Input[inputIndex].Name = "ListObject"
    ghenv.Component.Params.Input[inputIndex].NickName = "O"
    ghenv.Component.Params.Input[inputIndex].Description = "A python list object that will be unwrapped into a Grasshopper list."
    ghenv.Component.Params.Input[inputIndex].Optional = False
    inputIndex+=1
    

    #Outputs
    #--------------------------------------------------------------------------------------------
    outputIndex=0
    
    ghenv.Component.Params.Output[outputIndex].Name =  "List"
    ghenv.Component.Params.Output[outputIndex].NickName = "L"
    ghenv.Component.Params.Output[outputIndex].Description = "The unwrapped list."
    outputIndex+=1


#Imports
#--------------------------------------------------------------------------------------------
from System import Object
from Grasshopper import DataTree

#Solver - Run with trees to enhance performance drastically
#--------------------------------------------------------------------------------------------
if __name__ == "__main__":
    
    #Initialize trees
    #--------------------------------------------------------------------------------------------
    OriginalTree = DataTree[Object]()
    
    #Data matching
    #--------------------------------------------------------------------------------------------
    for path in O.Paths:
        listBranch = O.Branch(path)
        for i,listItem in enumerate(listBranch):
            OriginalTree.AddRange(list(listItem),path.AppendElement(i))
    
     #Assign trees to output
    #--------------------------------------------------------------------------------------------
    L = OriginalTree
# ---------- end o2l ----------
match = MatchTree(Tree=Z, Guide=o2l)
move = Move(Geometry=o2l, Motion=match)  # -> Geometry, Transform
crv_cp_2 = CurveClosestPoint(Point=move.Geometry, Curve=trim_10)  # -> Point, Parameter, Distance
eval_3 = EvaluateCurve(Curve=trim_10, Parameter=crv_cp_2.Parameter)  # -> Point, Tangent, Angle
rev = Reverse(Vector=eval_3.Tangent)
line = LineSDL(Start=eval_3.Point, Direction=Vector(0, 0, 1), Length=1)
vrot = Rotate(Vector=rev, Axis=line, Angle=degrees("90"))
pl = ConstructPlane(Origin=eval_3.Point, XAxis=rev, YAxis=vrot)
move_2 = Move(Geometry=pl, Motion=Z)  # -> Geometry, Transform
rotate_4 = Rotate(Geometry=move_2.Geometry, Angle=degrees(expression_14), Plane=PlaneXY(0, 0, 0))  # -> Geometry, Transform
neg_2 = Negative(Value=expression_22)
relblbrch = RelabelBranches(TreeToMatch=rotate_4.Geometry, ListOfPaths=trim_15)  # -> RelabeledTree; inputs TreeToMatch: tree, ListOfPaths: list
# ---------- relblbrch: Python ----------
if ghenv.Component.RunCount<2:
    __author__ = "Your name"
    __version__ = "2000.00.00"
    
    ghenv.Component.Name = "RelabelBranches"
    ghenv.Component.NickName = "ReLblBrch"
    ghenv.Component.Description = "Relabel all the paths of the branches with a list of new paths. The amount of branches must match with the size of the list of pahts"
    ghenv.Component.Message = "VER 1.0"
    
    ghenv.Component.Params.Input[0].NickName = "TreeToMatch"
    ghenv.Component.Params.Input[1].NickName = "ListOfPaths"
    
    ghenv.Component.Params.Input[0].Description = "Tree that should be relabeled."
    ghenv.Component.Params.Input[1].Description = "List of paths to use for new branch paths."
    
    ghenv.Component.Params.Output[0].NickName = "RelabeledTree"
    ghenv.Component.Params.Output[0].Description = "Relabeled tree where all the paths of the branches have been replaced with new paths."

from System import Object
from Grasshopper import DataTree

def relabelBranchesWithLstOfPths (tree, paths):
    newTree = DataTree[Object]()
    for i,path in enumerate(tree.Paths):
        items = tree.Branch(path)
        for data in items:
            newTree.Add(data,paths[i])
    return newTree

if __name__ == "__main__":
    RelabeledTree = relabelBranchesWithLstOfPths(TreeToMatch,ListOfPaths)
# ---------- end relblbrch ----------
addition_5 = Addition(A=neg_2, B=slab_thickness_m)
Z_2 = UnitZ(Factor=addition_5)
move_3 = Move(Geometry=relblbrch, Motion=Z_2)  # -> Geometry, Transform
entranceplanes = Plane(move_3.Geometry)

filter_2 = StreamFilter(Gate=include_top, Stream0=subtraction_3, Stream1=coreheight)
filter_3 = StreamFilter(Gate=include_bottom, Stream0=expression_19)
Z_3 = UnitZ(Factor=1)
rev_2 = Reverse(Vector=Z_3)
pt = ConstructPoint(XCoordinate=0, YCoordinate=0, ZCoordinate=filter_3)
pt_2 = ConstructPoint(XCoordinate=0, YCoordinate=0, ZCoordinate=filter_2)
por = ModelPort(Id="b", Point=pt, Direction=rev_2, Locators="bottom")  # -> Port, Id, Point, Direction, Locators
por_2 = ModelPort(Id="t", Point=pt_2, Direction=Z_3, Locators="top")  # -> Port, Id, Point, Direction, Locators

series_3 = Series(Start=0, Step=1, Count="4")
series_4 = Series(Start=0, Step=1, Count="2")
trim_18 = TrimTree(Tree=series_3, Depth=1)
trim_19 = TrimTree(Tree=series_4, Depth=1)
lng_2 = ListLength(List=flatten(entranceplanes))
merge_10 = Merge(Data1=trim_18, Data2=trim_19, Data3=trim_19)
repeat_3 = RepeatData(Data=merge_10, Length=lng_2)
trim_20 = TrimTree(Tree=repeat_3, Depth=1)
loc_4 = ModelLocator(Group="door", Subgroup=trim_20)  # -> Locator, Group, Subgroup
concat_28 = Concatenate(FragmentA="d", FragmentB="-", FragmentC=trim_20)

dom_4 = ConstructDomain(DomainStart=floor_height_m, DomainEnd=coreheight)
box_5 = DomainBox(Base=PlaneXY(0, 0, 0), X=_2d_2, Y=neg, Z=dom_4)
rotate_5 = Rotate(Geometry=box_5, Angle=degrees(expression_14), Plane=PlaneXY(0, 0, 0))  # -> Geometry, Transform
merge_11 = Merge(Data1=rotate_3.Geometry, Data2=rotate_5.Geometry)
sunion_2 = SolidUnion(Breps=merge_11)
filter_4 = StreamFilter(Gate=include_top, Stream0=sunion_2)
merge_12 = Merge(Data1=filter, Data2=filter_4)
sdiff = SolidDifference(BrepsA=corevolume, BrepsB=merge_12)
filter_5 = StreamFilter(Gate=nand, Stream0=corevolume, Stream1=sdiff)

panel_14 = Panel(sunion)

deplane = DeconstructPlane(Plane=entranceplanes)  # -> Origin, XAxis, YAxis, ZAxis
pl_2 = ConstructPlane(Origin=deplane.Origin, XAxis=deplane.XAxis, YAxis=deplane.ZAxis)
_2d_3 = _2D(x=door_width_m)
rectangle_2 = Rectangle(Plane=pl_2, XSize=_2d_3, YSize=door_height_m, Radius=0)  # -> Rectangle, Length
doors = Rectangle(rectangle_2.Rectangle)

expression_23 = Expression(x=valueor0, Expression="(-x)*2")
panel_15 = Panel("""west
south
south
east
east
north
north
west""")
door_tree = Data(doors)
lng_3 = ListLength(List=flatten(door_tree))
shift_2 = ShiftList(List=panel_15, Shift=expression_23, Wrap=True)
repeat_4 = RepeatData(Data=flatten(shift_2), Length=lng_3)
tstat = TreeStatistics(Tree=door_tree)  # -> Paths, Length, Count
trim_21 = TrimTree(Tree=repeat_4, Depth=1)
partition = PartitionList(List=trim_21, Size=tstat.Length)
match_2 = MatchTree(Tree=partition, Guide=door_tree)
loc_5 = ModelLocator(Group="facade", Subgroup=match_2)  # -> flatten(Locator), Group, Subgroup

entranceplanes_2 = Plane(flatten(entranceplanes))
merge_13 = Merge(Data2=graft(loc_2.Locator), Data3=graft(loc_4.Locator), Data4=graft(loc_5.Locator), Data5=graft(loc_3.Locator))
concat_29 = Concatenate(FragmentC=concat_2, FragmentD="#", FragmentE=concat_28)  # -> graft(Result)
por_3 = ModelPort(Port=graft(entranceplanes_2), Id=concat_29, Locators=merge_13)  # -> Port, Id, Point, Direction, Locators
trim_22 = TrimTree(Tree=por_3.Port, Depth=1)

panel_16 = Panel(concat_29)

doors_2 = Rectangle(flatten(doors))
geo = Geometry(filter_5)
expression_24 = Expression(x="doors", y=doors_2, Expression="x")
expression_25 = Expression(x="volume", y=geo, Expression="x")
merge_14 = Merge(Data1=expression_25, Data2=expression_24)
merge_15 = Merge(Data1=geo, Data2=doors_2)
ef_layer = EleFrontLayer(FullPath=merge_14)  # -> Layer, FullPath, Hidden, Locked, DisplayColour, MaterialName, Linetype, PrintColour, PrintWidth
concat_30 = Concatenate(FragmentA=curdir.PD, FragmentB=curdir.S, FragmentC=rep.Url)
concat_31 = Concatenate(FragmentA=curdir.PD, FragmentB=curdir.S, FragmentC=rep_2.Url)
ef_att = EleFrontAttributes(Layer=ef_layer.Layer)  # -> Attributes, Keys, Values, Name, Layer, ColourSource, DisplayColour, MaterialSource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
baketofile = BakeObjectsToFile(
    FilePath=concat_30,
    Geometry=merge_15,
    Attributes=ef_att.Attributes,
    Bake=and,
    networkMode=False,
    ValueTable_networkMode=True,
    overwriteMode="Overwrite",
    preset="Safest")
baketofile_2 = BakeObjectsToFile(
    FilePath=concat_31,
    Geometry=merge_15,
    Attributes=ef_att.Attributes,
    Bake=and,
    networkMode=False,
    ValueTable_networkMode=True,
    overwriteMode="Overwrite",
    preset="Safest")

rec_2 = Rectangle({Plane=Plane(origin=(853.3612491, 852.5312947, 866.3069427), x=(0.7071067812, -0.7071067812, 0), y=(-0.4082482905, -0.4082482905, 0.8164965809)), Size=Domain2(u=-52.32632723..52.32632723, v=-27.88533994..27.88533994)})
merge_16 = Merge(Data1=geo, Data2=doors_2)
m2d_parallel_2 = Make2DParallelView(Projection=rec_2)
make2d_2 = Make2D(Geometry=merge_16, View=m2d_parallel_2, TangentEdges="T", TangentSeams=False, AutoComputeMake2D=True)  # -> VisibleCurves, VisibleIndex, VisibleType, HiddenCurves, HiddenIndex, HiddenType
trim_23 = TrimTree(Tree=make2d_2.VisibleCurves, Depth=1)
shaft_2 = Geometry(trim_23)

expression_26 = Expression(x="shaft", y=shaft_2, Expression="x")
concat_32 = Concatenate(FragmentC="icons", FragmentD=curdir.S, FragmentA="shaft", FragmentB="_", FragmentE=expression_4)
merge_17 = Merge(Data1=expression_26)
merge_18 = Merge(Data1=shaft_2)
concat_33 = Concatenate(FragmentA=concat_32, FragmentB=".3dm")
ef_layer_2 = EleFrontLayer(FullPath=merge_17)  # -> Layer, FullPath, Hidden, Locked, DisplayColour, MaterialName, Linetype, PrintColour, PrintWidth
concat_34 = Concatenate(FragmentA=curdir.PD, FragmentB=curdir.S, FragmentC=concat_33)
ef_att_2 = EleFrontAttributes(Layer=ef_layer_2.Layer)  # -> Attributes, Keys, Values, Name, Layer, ColourSource, DisplayColour, MaterialSource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
baketofile_3 = BakeObjectsToFile(
    FilePath=concat_34,
    Geometry=merge_18,
    Attributes=ef_att_2.Attributes,
    Bake=and_2,
    networkMode=False,
    ValueTable_networkMode=True,
    overwriteMode="Overwrite",
    preset="Safest")

concat_35 = Concatenate(FragmentA=concat_32, FragmentB=".svg")
concat_36 = Concatenate(FragmentA=curdir.PD, FragmentB=curdir.S, FragmentC=concat_35)
file = ReadFile(File=concat_36, PerLineParse=False)
txt = EncodeText(Text=file)
concat_37 = Concatenate(FragmentA="data:image/svg+xml;base64,", FragmentB=txt)

merge_19 = Merge(Data1=por.Port, Data2=por_2.Port, Data3=trim_22)
merge_20 = Merge(Data1=rep_3.Representation, Data2=rep.Representation, Data3=rep_2.Representation)
concat_38 = Concatenate(FragmentB=expression_4)
typ = ModelType(
    Name="Shaft",
    Description=concat_9,
    Icon=concat_37,
    Variant=item_3,
    Representations=merge_20,
    Ports=merge_19,
    Qualities=qlt.Quality)  # -> Type, Name, Description, Icon, Variant, Unit, Representations, Ports, Qualities
typ_2 = RemoveType(TypeName=typ.Name, TypeVariant=typ.Variant, Run=save)
or = GateOr(A=save, B=typ_2)
typ_3 = AddType(Type=typ.Type, Run=or)

typ_4 = SerializeType(Type=typ.Type)
type = Text(typ_4)
context_bake = ContextBake(Geometry=type)
item_6 = CherryPicker(entranceplanes, ListIndex=0)
por_4 = ModelPort(Port=merge_19)  # -> Port, Id, Point, Direction, Locators
previewplane_2 = PreviewPlane_2(plane=graft(item_6), axis_length=Slider(0.5, range=0..1))  # -> X_2, Y_2, Z_2
vdisex = VectorDisplayEx(Point=por_4.Point, Vector=por_4.Direction, Colour=ColourSwatch(SwatchColor=RGB(0, 166, 157)), Width=2)
preview = CustomPreview(Geometry=por_4.Point, Material=ColourSwatch(SwatchColor=RGB(235, 52, 79)))

# ==== cluster _2D
x = ClusterInput()
expression = Expression(x=x, Expression="x/2")
neg = Negative(Value=expression)
dom = ConstructDomain(DomainStart=neg, DomainEnd=expression)
I = ClusterOutput(dom)

# ==== cluster ValueOr0
value = ClusterInput()
value_2 = Number(value)
null = NullItem(Item=value_2)  # -> NullFlags, InvalidFlags, Description
filter = StreamFilter(Gate=null.NullFlags, Stream0=value_2, Stream1="0")
valueor0 = Number(filter)
valueor0_2 = ClusterOutput(valueor0)

# ==== cluster PreviewPlane: Preview a plane with axis colors and naming.
axis_length = ClusterInput()
plane = ClusterInput()
axis_length_2 = Number(axis_length)
plane_2 = Plane(plane)
deplane = DeconstructPlane(Plane=plane_2)  # -> Origin, XAxis, YAxis, ZAxis
line = LineSDL(Start=deplane.Origin, Direction=deplane.YAxis, Length=axis_length_2)
line_2 = LineSDL(Start=deplane.Origin, Direction=deplane.XAxis, Length=axis_length_2)
line_3 = LineSDL(Start=deplane.Origin, Direction=deplane.ZAxis, Length=axis_length_2)
swatch = ColourSwatch(SwatchColor=RGB(235, 52, 79))
swatch_2 = ColourSwatch(SwatchColor=RGB(0, 166, 157))
swatch_3 = ColourSwatch(SwatchColor=RGB(240, 117, 24))
end = EndPoints(Curve=line_2)  # -> Start, End
end_2 = EndPoints(Curve=line)  # -> Start, End
end_3 = EndPoints(Curve=line_3)  # -> Start, End
tag = TextTag(Location=end.End, Text="X", Colour=swatch)
tag_2 = TextTag(Location=end_2.End, Text="Y", Colour=swatch_2)
tag_3 = TextTag(Location=end_3.End, Text="Z", Colour=swatch_3)
preview = CustomPreview(Geometry=line_2, Material=swatch)
preview_2 = CustomPreview(Geometry=line, Material=swatch_2)
preview_3 = CustomPreview(Geometry=line_3, Material=swatch_3)

# ==== cluster ViewRectangle
view = ClusterInput()
view_2 = Data(view)
nickname = NAME(view=view_2)  # -> c, x, y, z, h, w
# ---------- nickname: Python ----------
uselss, c, x, y, z = view.GetCameraFrame()
h = view.FrustumHeight
w = view.FrustumWidth
# ---------- end nickname ----------
rev = Reverse(Vector=nickname.x)
rev_2 = Reverse(Vector=nickname.y)
pl = ConstructPlane(Origin=nickname.c, XAxis=rev, YAxis=nickname.y)
_2d = _2D(x=nickname.w)
_2d_2 = _2D(x=nickname.h)
rectangle = Rectangle(Plane=pl, XSize=_2d, YSize=_2d_2, Radius=0)  # -> Rectangle, Length
rec = Rectangle(rectangle.Rectangle)
rec_2 = ClusterOutput(rec)

# ==== cluster PreviewPlane_2: Preview a plane with axis colors and naming.
axis_length = ClusterInput()
plane = ClusterInput()
axis_length_2 = Number(axis_length)
plane_2 = Plane(plane)
deplane = DeconstructPlane(Plane=plane_2)  # -> Origin, XAxis, YAxis, ZAxis
line = LineSDL(Start=deplane.Origin, Direction=deplane.YAxis, Length=axis_length_2)
line_2 = LineSDL(Start=deplane.Origin, Direction=deplane.XAxis, Length=axis_length_2)
line_3 = LineSDL(Start=deplane.Origin, Direction=deplane.ZAxis, Length=axis_length_2)
swatch = ColourSwatch(SwatchColor=RGB(235, 52, 79))
swatch_2 = ColourSwatch(SwatchColor=RGB(0, 166, 157))
swatch_3 = ColourSwatch(SwatchColor=RGB(240, 117, 24))
end = EndPoints(Curve=line_2)  # -> Start, End
end_2 = EndPoints(Curve=line)  # -> Start, End
end_3 = EndPoints(Curve=line_3)  # -> Start, End
tag = TextTag(Location=end.End, Text="X", Colour=swatch)
tag_2 = TextTag(Location=end_2.End, Text="Y", Colour=swatch_2)
tag_3 = TextTag(Location=end_3.End, Text="Z", Colour=swatch_3)
preview = CustomPreview(Geometry=line_2, Material=swatch)
preview_2 = CustomPreview(Geometry=line, Material=swatch_2)
preview_3 = CustomPreview(Geometry=line_3, Material=swatch_3)
X = Line(line_2)
Y = Line(line)
Z = Line(line_3)
X_2 = ClusterOutput(X)
Y_2 = ClusterOutput(Y)
Z_2 = ClusterOutput(Z)

# ==== cluster ExportBlock: Export geometry with layer names to a file.
path = ClusterInput()
name = ClusterInput()
url = ClusterInput()
geo = ClusterInput()
layer_name = ClusterInput()
export = ClusterInput()
path_2 = FilePath(path)
name_2 = Text(name)
url_2 = Text(url)
geo_2 = Geometry(geo)
layer_name_2 = Text(layer_name)
export_2 = Boolean(export)
layer = ModelLayer(Name=layer_name_2)  # -> Layer, Name, Hidden, Locked, DisplayColour, Material, Linetype
object = ModelObject(Geometry=geo_2, Layer=layer.Layer)  # -> Object, Geometry, Name, Layer, Visibility, Display, Drafting, Render
block_definition = ModelBlockDefinition(Objects=object.Object, Name=name_2, URL=url_2)  # -> BlockDefinition, Objects, Units, Name, Notes, URL, URLDescription
export_definition = ExportModelBlockDefinition(BlockDefinition=block_definition.BlockDefinition, FilePath=path_2, Overwrite="T", Export=export_2)  # -> BlockDefinition, FilePath, Exported
block_definition_2 = ModelBlockDefinition(export_definition.BlockDefinition)
path_3 = FilePath(export_definition.FilePath)
exported = Boolean(export_definition.Exported)
path_4 = ClusterOutput(path_3)
exported_2 = ClusterOutput(exported)
block_definition_3 = ClusterOutput(block_definition_2)
