# Grasshopper definition shaft.gh (Grasshopper 1.0.7)
# plug-ins: eleFront, semio

number_slider = Slider(0, range=0..3)
safe = Button()
safe_2 = BooleanToggle(False)
filter = StreamFilter(Gate=number_slider, Stream0="9", Stream1="11", Stream2="6", Stream3="8")
icon_export = BooleanToggle(False)
loop_slider = PythonScript(
    SliderToModify=number_slider,
    Min="0",
    Max="3",
    stepSize="1",
    Delay=Slider(0, range=0..1),
    Run=Toggle(False),
    Reset=Button())  # inputs Run: Boolean, Reset: Boolean
# ---------- loop_slider: Python ----------
import time

def updateSliderInput(inputName,min,max,value,decimalPlace=2):
    for input in ghenv.Component.Params.Input:
        for source in input.Sources:
            if input.Name == str(inputName):
                source.Slider.DecimalPlaces = decimalPlace
                source.Slider.Minimum = min
                source.Slider.Maximum = max
                source.Slider.Value = value
                source.ExpireSolution(True)

def countDecimal(number):
    string= str(number)
    return string[::-1].find('.')

if Run == True:
    if SliderToModify < Max:
        time.sleep(Delay)
        updateSliderInput("SliderToModify",Min,Max,SliderToModify+stepSize,countDecimal(stepSize))
if Reset == True:
    updateSliderInput("SliderToModify",Min,Max,Min)
# ---------- end loop_slider ----------
filter_2 = StreamFilter(Gate=number_slider, Stream0="west", Stream1="east", Stream2="west", Stream3="east")
and = GateAnd(A=safe_2, B=icon_export)
number_slider_2 = Slider(9, range=0..20)
# ^
#                  |
# Preview    ->
# Parameters:
number_slider_3 = Slider(550, range=0..1000)
list = ValueList({"North": "north", "East": "east", "South": "south", "West": "west"}, selected="West")
# External
#       |
#       v
width = GetNumber(number_slider_3, AtLeast=1, AtMost=1, Maximum=1.797693135e+308, Minimum=-1.797693135e+308, TreeAccess=False)
floorheight = GetNumber(Slider(275, range=0..1000), AtLeast=1, AtMost=1, Maximum=1.797693135e+308, Minimum=-1.797693135e+308, TreeAccess=False)
platform = GetString(filter_2, AtLeast=1, AtMost=1, TreeAccess=False)
wallthickness = GetNumber(Slider(30, range=0..100), AtLeast=1, AtMost=1, Maximum=1.797693135e+308, Minimum=-1.797693135e+308, TreeAccess=False)
doorwidth = GetNumber(Slider(80, range=0..200), AtLeast=1, AtMost=1, Maximum=1.797693135e+308, Minimum=-1.797693135e+308, TreeAccess=False)
dooroffset = GetNumber(Slider(115, range=0..1000), AtLeast=1, AtMost=1, Maximum=1.797693135e+308, Minimum=-1.797693135e+308, TreeAccess=False)
doorheight = GetNumber(Slider(200, range=0..1000), AtLeast=1, AtMost=1, Maximum=1.797693135e+308, Minimum=-1.797693135e+308, TreeAccess=False)
floors = GetNumber(filter, AtLeast=1, AtMost=1, Maximum=1.797693135e+308, Minimum=-1.797693135e+308, TreeAccess=False)
# Local ->
expression = Expression(x=width, Expression="x/100")
expression_2 = Expression(x=floorheight, Expression="x/100")
expression_3 = Expression(x=wallthickness, Expression="x/100")
expression_4 = Expression(x=doorwidth, Expression="x/100")
expression_5 = Expression(x=doorheight, Expression="x/100")
expression_6 = Expression(x=dooroffset, Expression="x/100")

expression_7 = Expression(x=floors, Expression="x+1")
panel = Panel("""north
east
south
west""")
itemindex = ItemIndex(L=panel, I=platform)  # -> i; inputs L: list
# ---------- itemindex: Python ----------
#Component Information
#--------------------------------------------------------------------------------------------
if ghenv.Component.RunCount<2:
    #General
    #--------------------------------------------------------------------------------------------
    __author__ = "Ueli Saluz"
    __version__ = "2022.11.18"
    
    ghenv.Component.Name = "ItemIndex"
    ghenv.Component.NickName = "ItemIndex"
    ghenv.Component.Description = "A better IdemIndex"
    ghenv.Component.Message = "VER 1.0"
    ghenv.Component.Category = "Set"
    ghenv.Component.SubCategory = "List"
    
     #Inputs
    #--------------------------------------------------------------------------------------------
    inputIndex=0
    
    ghenv.Component.Params.Input[inputIndex].Name = "List"
    ghenv.Component.Params.Input[inputIndex].NickName = "L"
    ghenv.Component.Params.Input[inputIndex].Description = "Input1 is..."
    ghenv.Component.Params.Input[inputIndex].Optional = False
    inputIndex+=1
    
    ghenv.Component.Params.Input[inputIndex].Name = "Item"
    ghenv.Component.Params.Input[inputIndex].NickName = "I"
    ghenv.Component.Params.Input[inputIndex].Description = "Input2 is..."
    ghenv.Component.Params.Input[inputIndex].Optional = False
    inputIndex+=1
    
    #Outputs
    #--------------------------------------------------------------------------------------------
    outputIndex=0
    
    ghenv.Component.Params.Output[outputIndex].Name = "Index"
    ghenv.Component.Params.Output[outputIndex].NickName = "i"
    ghenv.Component.Params.Output[outputIndex].Description = "Output1 is..."
    outputIndex+=1

i = L.index(I)
# ---------- end itemindex ----------
int = Integer(expression_7)
multiplication = Multiplication(A=int, B=expression_2)
valueor0 = ValueOr0(value=itemindex)
coreheight = Number(multiplication)
expression_8 = Expression(x=valueor0, Expression="-((x+2)*90)%360")
dom = ConstructDomain(DomainStart=0, DomainEnd=coreheight)
_2d = _2D(x=expression)
box = DomainBox(Base=PlaneXY(0, 0, 0), X=_2d, Y=_2d, Z=dom)
corevolume = Box(box)
debrep = DeconstructBrep(Brep=corevolume)  # -> Faces, Edges, Vertices
trim = TrimTree(Tree=debrep.Faces, Depth=1)
item = ListItem(List=trim, Index=0, Wrap=True)  # -> Item, Item1, Item2, Item3, Item4
base = Surface(item.Item4)
explode = Explode(Curve=base, Recursive=True)  # -> Segments, Vertices
trim_2 = TrimTree(Tree=explode.Segments, Depth=1)
join = JoinCurves(Curves=explode.Segments, Preserve=False)
expression_9 = Expression(x=expression, Expression="x/2")
expression_10 = Expression(x=expression_4, Expression="x/2")
trim_3 = TrimTree(Tree=join, Depth=1)
curvepoint = PointOnCurve(trim_2, parameter=0.5)
subtraction = Subtraction(A=expression_9, B=expression_10, C=expression_6, D=expression_3)
crv_cp = CurveClosestPoint(Point=curvepoint, Curve=trim_2)  # -> Point, Parameter, Distance
addition = Addition(A=crv_cp.Parameter, B=subtraction)
subtraction_2 = Subtraction(A=crv_cp.Parameter, B=subtraction)
eval = EvaluateCurve(Curve=trim_2, Parameter=addition)  # -> Point, Tangent, Angle
eval_2 = EvaluateCurve(Curve=trim_2, Parameter=subtraction_2)  # -> Point, Tangent, Angle
shift = ShiftList(List=eval_2.Point, Shift=1, Wrap=True)
trim_4 = TrimTree(Tree=shift, Depth=1)
merge = Merge(Data1=graft(eval.Point), Data2=graft(trim_4))

Z = UnitZ(Factor=coreheight)
xy = XYPlane(Origin=Point(0, 0, 0))
move = Move(Geometry=xy, Motion=Z)  # -> Geometry, Transform
por = ModelPort(Id="b", Plane=xy, Locators="bottom")  # -> Port, Id, Plane, Locators
por_2 = ModelPort(Id="t", Plane=move.Geometry, Locators="top")  # -> Port, Id, Plane, Locators

expression_11 = Expression(x=expression_2, Expression="x/3")
lng = ListLength(List=trim_2)
dup = DuplicateData(Data=expression_11, Number=lng, Order=True)
trim_5 = TrimTree(Tree=dup, Depth=1)
expression_12 = Expression(x=int, Expression="(x-1)*4")
replace = ReplaceItems(List=trim_5, Item="0", Indices="1", Wrap=False)
repeat = RepeatData(Data=replace, Length=expression_12)
trim_6 = TrimTree(Tree=repeat, Depth=1)
ma = MassAddition(Input=trim_6)  # -> Result, PartialResults
flip = FlipMatrix(Data=ma.PartialResults)
doorheights = Number(flip)
Z_2 = UnitZ(Factor=doorheights)
trim_7 = TrimTree(Tree=Z_2, Depth=1)
cset = CreateSet(List=trim_7)  # -> Set, graft(Map)
path = ConstructPath(Indices=cset.Map)
trim_8 = TrimTree(Tree=path, Depth=1)

series = Series(Start=0, Step=1, Count=floors)
trim_9 = TrimTree(Tree=series, Depth=1)
dup_2 = DuplicateData(Data=graft(trim_9), Number="8", Order=True)
trim_10 = TrimTree(Tree=dup_2, Depth=1)
trim_11 = TrimTree(Tree=trim_10, Depth=1)
loc = ModelLocator(Group="floor", Subgroup=trim_11)  # -> Locator, Group, Subgroup
concat = Concatenate(FragmentA="f", FragmentB="-", FragmentC=trim_11)

series_2 = Series(Start="1", Step=1, Count="2")
dup_3 = DuplicateData(Data="0", Number="4", Order=True)
trim_12 = TrimTree(Tree=series_2, Depth=1)  # -> graft(Tree)
trim_13 = TrimTree(Tree=dup_3, Depth=1)
dup_4 = DuplicateData(Data=trim_12, Number="2", Order=True)  # -> flatten(Data)
merge_2 = Merge(Data1=trim_13, Data2=dup_4)
dup_5 = DuplicateData(Data=merge_2, Number=floors, Order=True)
trim_14 = TrimTree(Tree=dup_5, Depth=1)
loc_2 = ModelLocator(Group="split level", Subgroup=trim_14)  # -> Locator, Group, Subgroup
concat_2 = Concatenate(FragmentA="sl", FragmentB="-", FragmentC=trim_14)

panel_2 = Panel("""main
side""")
equals = Equality(FirstNumber=trim_14, SecondNumber="0")  # -> Equality, Inequality
item_2 = ListItem(List=panel_2, Index=equals.Equality, Wrap=True)
loc_3 = ModelLocator(Group="platform", Subgroup=item_2)  # -> Locator, Group, Subgroup

slab_thickness = Number(Slider(20, range=0..100))

variant = Integer(number_slider)
curdir = CurrentDirectory()  # -> D, P, S
# ---------- curdir: Python ----------
#Component Information
#--------------------------------------------------------------------------------------------
if ghenv.Component.RunCount<2:
    #General
    #--------------------------------------------------------------------------------------------
    __author__ = "Ueli Saluz"
    __version__ = "2023.09.29"
    
    ghenv.Component.Name = "CurrentDirectory"
    ghenv.Component.NickName = "CurDir"
    ghenv.Component.Description = "Current directory of the current grasshopper file."
    ghenv.Component.Message = "VER 1.0"
    ghenv.Component.Category = "Params"
    ghenv.Component.SubCategory = "Util"
    
    #Outputs
    #--------------------------------------------------------------------------------------------
    outputIndex=0
    
    ghenv.Component.Params.Output[outputIndex].Name = "Directory"
    ghenv.Component.Params.Output[outputIndex].NickName = "D"
    ghenv.Component.Params.Output[outputIndex].Description = "Directory of the current grasshopper file."
    outputIndex+=1
    
    ghenv.Component.Params.Output[outputIndex].Name = "Path"
    ghenv.Component.Params.Output[outputIndex].NickName = "P"
    ghenv.Component.Params.Output[outputIndex].Description = "Path of the current grasshopper file."
    outputIndex+=1
    
    ghenv.Component.Params.Output[outputIndex].Name = "Separator"
    ghenv.Component.Params.Output[outputIndex].NickName = "S"
    ghenv.Component.Params.Output[outputIndex].Description = "Separator of the current system."
    outputIndex+=1

#Imports
#--------------------------------------------------------------------------------------------
from os.path import dirname
from os import sep

#Solver - Run with trees to enhance performance drastically
#--------------------------------------------------------------------------------------------
if __name__ == "__main__":
    P = ghenv.Component.OnPingDocument().FilePath
    D = dirname(P)
    S = sep
# ---------- end curdir ----------
expression_13 = Expression(x=variant, Expression="x+1")
concat_3 = Concatenate(FragmentC="representations", FragmentD=curdir.S, FragmentA="shaft", FragmentB="_", FragmentE=expression_13)
concat_4 = Concatenate(FragmentA=concat_3, FragmentB="_", FragmentE="1to500", FragmentG="_", FragmentF="volume")
concat_5 = Concatenate(FragmentA=concat_3, FragmentB="_", FragmentE="1to200", FragmentG="_", FragmentF="volume")
concat_6 = Concatenate(FragmentA=concat_4, FragmentB=".3dm")
concat_7 = Concatenate(FragmentA=concat_3, FragmentB=".glb")
concat_8 = Concatenate(FragmentA=concat_5, FragmentB=".3dm")
rep = ModelRepresentation(Url=concat_6, LevelOfDetail="1to500", Tags="volume")  # -> Representation, Url, LevelOfDetail, Tags
rep_2 = ModelRepresentation(Url=concat_8, LevelOfDetail="1to200", Tags="volume")  # -> Representation, Url, LevelOfDetail, Tags
rep_3 = ModelRepresentation(Url=concat_7)  # -> Representation, Url, LevelOfDetail, Tags

# ----
# Outputs   ->
#                 |
#                 v
panel_3 = Panel("data:image/svg+xml;base64,")
txt = Text("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")
txt_2 = Text("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")
txt_3 = EncodeText(Text=txt)
txt_4 = EncodeText(Text=txt_2)
concat_9 = Concatenate(FragmentA=panel_3, FragmentB=txt_3)
concat_10 = Concatenate(FragmentA=panel_3, FragmentB=txt_4)
icon2 = Text(concat_10)
icon1 = Text(concat_9)
filter_3 = StreamFilter(Gate=variant, Stream0=icon1, Stream1=icon2)

expression_14 = Expression(x=slab_thickness, Expression="x/100")

l2o = List2Object(L=merge)  # -> O; inputs L: tree
# ---------- l2o: Python ----------
#Component Information
#--------------------------------------------------------------------------------------------
if ghenv.Component.RunCount<2:
    #General
    #--------------------------------------------------------------------------------------------
    __author__ = "Ueli Saluz"
    __version__ = "2022.04.24"
    
    ghenv.Component.Name = "List2Object"
    ghenv.Component.NickName = "L2O"
    ghenv.Component.Description = "Wraps a list of objects into a list object."
    ghenv.Component.Message = "VER 1.0"
    ghenv.Component.Category = "Sets"
    ghenv.Component.SubCategory = "Tree"
    
     #Inputs
    #--------------------------------------------------------------------------------------------
    inputIndex=0
    
    ghenv.Component.Params.Input[inputIndex].Name = "List"
    ghenv.Component.Params.Input[inputIndex].NickName = "L"
    ghenv.Component.Params.Input[inputIndex].Description = "Tree with lists to wrap."
    ghenv.Component.Params.Input[inputIndex].Optional = False
    inputIndex+=1
    

    #Outputs
    #--------------------------------------------------------------------------------------------
    outputIndex=0
    
    ghenv.Component.Params.Output[outputIndex].Name =  "ListObject" 
    ghenv.Component.Params.Output[outputIndex].NickName = "O"
    ghenv.Component.Params.Output[outputIndex].Description = "Python list object as single item."
    outputIndex+=1


#Imports
#--------------------------------------------------------------------------------------------
from System import Object
from Grasshopper import DataTree

#Solver - Run with trees to enhance performance drastically
#--------------------------------------------------------------------------------------------
if __name__ == "__main__":
    
    #Initialize trees
    #--------------------------------------------------------------------------------------------
    TreeToWrap = DataTree[Object]()
    
    #Data matching
    #--------------------------------------------------------------------------------------------
    for path in L.Paths:
        listBranch = L.Branch(path)
        TreeToWrap.Add(listBranch,path)
    
     #Assign trees to output
    #--------------------------------------------------------------------------------------------
    O = TreeToWrap
# ---------- end l2o ----------
trim_15 = TrimTree(Tree=l2o, Depth=1)
repeat_2 = RepeatData(Data=trim_15, Length=expression_12)
trim_16 = TrimTree(Tree=repeat_2, Depth=1)
o2l = Object2List(O=trim_16)  # -> L; inputs O: tree
# ---------- o2l: Python ----------
#Component Information
#--------------------------------------------------------------------------------------------
if ghenv.Component.RunCount<2:
    #General
    #--------------------------------------------------------------------------------------------
    __author__ = "Ueli Saluz"
    __version__ = "2022.04.24"
    
    ghenv.Component.Name = "Object2List"
    ghenv.Component.NickName = "O2L"
    ghenv.Component.Description = "Unwraps a list of objects into a list object."
    ghenv.Component.Message = "VER 1.0"
    ghenv.Component.Category = "Sets"
    ghenv.Component.SubCategory = "Tree"
    
     #Inputs
    #--------------------------------------------------------------------------------------------
    inputIndex=0
    
    ghenv.Component.Params.Input[inputIndex].Name = "ListObject"
    ghenv.Component.Params.Input[inputIndex].NickName = "O"
    ghenv.Component.Params.Input[inputIndex].Description = "A python list object that will be unwrapped into a Grasshopper list."
    ghenv.Component.Params.Input[inputIndex].Optional = False
    inputIndex+=1
    

    #Outputs
    #--------------------------------------------------------------------------------------------
    outputIndex=0
    
    ghenv.Component.Params.Output[outputIndex].Name =  "List"
    ghenv.Component.Params.Output[outputIndex].NickName = "L"
    ghenv.Component.Params.Output[outputIndex].Description = "The unwrapped list."
    outputIndex+=1


#Imports
#--------------------------------------------------------------------------------------------
from System import Object
from Grasshopper import DataTree

#Solver - Run with trees to enhance performance drastically
#--------------------------------------------------------------------------------------------
if __name__ == "__main__":
    
    #Initialize trees
    #--------------------------------------------------------------------------------------------
    OriginalTree = DataTree[Object]()
    
    #Data matching
    #--------------------------------------------------------------------------------------------
    for path in O.Paths:
        listBranch = O.Branch(path)
        for i,listItem in enumerate(listBranch):
            OriginalTree.AddRange(list(listItem),path.AppendElement(i))
    
     #Assign trees to output
    #--------------------------------------------------------------------------------------------
    L = OriginalTree
# ---------- end o2l ----------
match = MatchTree(Tree=Z_2, Guide=o2l)
move_2 = Move(Geometry=o2l, Motion=match)  # -> Geometry, Transform
crv_cp_2 = CurveClosestPoint(Point=move_2.Geometry, Curve=trim_3)  # -> Point, Parameter, Distance
eval_3 = EvaluateCurve(Curve=trim_3, Parameter=crv_cp_2.Parameter)  # -> Point, Tangent, Angle
rev = Reverse(Vector=eval_3.Tangent)
line = LineSDL(Start=eval_3.Point, Direction=Vector(0, 0, 1), Length=1)
vrot = Rotate(Vector=rev, Axis=line, Angle=degrees("90"))
pl = ConstructPlane(Origin=eval_3.Point, XAxis=rev, YAxis=vrot)
move_3 = Move(Geometry=pl, Motion=Z_2)  # -> Geometry, Transform
rotate = Rotate(Geometry=move_3.Geometry, Angle=degrees(expression_8), Plane=PlaneXY(0, 0, 0))  # -> Geometry, Transform
neg = Negative(Value=expression_11)
relblbrch = RelabelBranches(TreeToMatch=rotate.Geometry, ListOfPaths=trim_8)  # -> RelabeledTree; inputs TreeToMatch: tree, ListOfPaths: list
# ---------- relblbrch: Python ----------
if ghenv.Component.RunCount<2:
    __author__ = "Your name"
    __version__ = "2000.00.00"
    
    ghenv.Component.Name = "RelabelBranches"
    ghenv.Component.NickName = "ReLblBrch"
    ghenv.Component.Description = "Relabel all the paths of the branches with a list of new paths. The amount of branches must match with the size of the list of pahts"
    ghenv.Component.Message = "VER 1.0"
    
    ghenv.Component.Params.Input[0].NickName = "TreeToMatch"
    ghenv.Component.Params.Input[1].NickName = "ListOfPaths"
    
    ghenv.Component.Params.Input[0].Description = "Tree that should be relabeled."
    ghenv.Component.Params.Input[1].Description = "List of paths to use for new branch paths."
    
    ghenv.Component.Params.Output[0].NickName = "RelabeledTree"
    ghenv.Component.Params.Output[0].Description = "Relabeled tree where all the paths of the branches have been replaced with new paths."

from System import Object
from Grasshopper import DataTree

def relabelBranchesWithLstOfPths (tree, paths):
    newTree = DataTree[Object]()
    for i,path in enumerate(tree.Paths):
        items = tree.Branch(path)
        for data in items:
            newTree.Add(data,paths[i])
    return newTree

if __name__ == "__main__":
    RelabeledTree = relabelBranchesWithLstOfPths(TreeToMatch,ListOfPaths)
# ---------- end relblbrch ----------
addition_2 = Addition(A=neg, B=expression_14)
Z_3 = UnitZ(Factor=addition_2)
move_4 = Move(Geometry=relblbrch, Motion=Z_3)  # -> Geometry, Transform
entranceplanes = Plane(move_4.Geometry)

series_3 = Series(Start=0, Step=1, Count="4")
series_4 = Series(Start=0, Step=1, Count="2")
trim_17 = TrimTree(Tree=series_3, Depth=1)
trim_18 = TrimTree(Tree=series_4, Depth=1)
lng_2 = ListLength(List=flatten(entranceplanes))
merge_3 = Merge(Data1=trim_17, Data2=trim_18, Data3=trim_18)
repeat_3 = RepeatData(Data=merge_3, Length=lng_2)
trim_19 = TrimTree(Tree=repeat_3, Depth=1)
loc_4 = ModelLocator(Group="door", Subgroup=trim_19)  # -> Locator, Group, Subgroup
concat_11 = Concatenate(FragmentA="d", FragmentB="-", FragmentC=trim_19)

merge_4 = Merge(
    Data1=expression,
    Data2=floors,
    Data3=expression_2,
    Data4=platform,
    Data5=expression_4,
    Data6=expression_5,
    Data7=expression_6)
panel_4 = Panel("""width
storeys
floor height
platform
door width
door height
door offset""")
panel_5 = Panel(merge_4)
panel_6 = Panel("""m

m

m
m
m""")
qlt = ModelQuality(Name=panel_4, Value=panel_5, Unit=panel_6)  # -> Quality, Name, Value, Unit

previewplane = PreviewPlane(plane=graft(entranceplanes), axis_length=Slider(0.5, range=0..1))  # -> X_2, Y_2, Z_2
concat_12 = Concatenate(FragmentA=curdir.D, FragmentB=curdir.S, FragmentC=rep.Url)
merge_5 = Merge(Data1=previewplane.X_2, Data2=previewplane.Y_2, Data3=previewplane.Z_2)
panel_7 = Panel("Parallel")  # disabled

deplane = DeconstructPlane(Plane=entranceplanes)  # -> Origin, XAxis, YAxis, ZAxis
pl_2 = ConstructPlane(Origin=deplane.Origin, XAxis=deplane.XAxis, YAxis=deplane.ZAxis)
_2d_2 = _2D(x=expression_4)
rectangle = Rectangle(Plane=pl_2, XSize=_2d_2, YSize=expression_5, Radius=0)  # -> Rectangle, Length
doors = Rectangle(rectangle.Rectangle)

expression_15 = Expression(x=valueor0, Expression="(-x)*2")
panel_8 = Panel("""west
south
south
east
east
north
north
west""")
door_tree = Data(doors)
lng_3 = ListLength(List=flatten(door_tree))
shift_2 = ShiftList(List=panel_8, Shift=expression_15, Wrap=True)
repeat_4 = RepeatData(Data=flatten(shift_2), Length=lng_3)
tstat = TreeStatistics(Tree=door_tree)  # -> Paths, Length, Count
trim_20 = TrimTree(Tree=repeat_4, Depth=1)
partition = PartitionList(List=trim_20, Size=tstat.Length)
match_2 = MatchTree(Tree=partition, Guide=door_tree)
loc_5 = ModelLocator(Group="facade", Subgroup=match_2)  # -> flatten(Locator), Group, Subgroup

entranceplanes_2 = Plane(flatten(entranceplanes))
merge_6 = Merge(
    Data1=graft(loc.Locator),
    Data2=graft(loc_2.Locator),
    Data3=graft(loc_4.Locator),
    Data4=graft(loc_5.Locator),
    Data5=graft(loc_3.Locator))
concat_13 = Concatenate(FragmentA=concat, FragmentB="#", FragmentC=concat_2, FragmentD="#", FragmentE=concat_11)  # -> graft(Result)

por_3 = ModelPort(Id=concat_13, Plane=graft(entranceplanes_2), Locators=merge_6)  # -> Port, Id, Plane, Locators
trim_21 = TrimTree(Tree=por_3.Port, Depth=1)

panel_9 = Panel(" storey core with an elevator in the center, the main platform on the ")
panel_10 = Panel(", and on the other corners side platforms with two doors. The stairs are between the first and the last door of the platform.")
concat_14 = Concatenate(FragmentH="An efficient ", FragmentG=floors, FragmentA=panel_9, FragmentB=platform, FragmentC=panel_10)
merge_7 = Merge(Data1=por.Port, Data2=por_2.Port, Data3=trim_21)
merge_8 = Merge(Data1=rep_3.Representation, Data2=rep.Representation, Data3=rep_2.Representation)
concat_15 = Concatenate(FragmentA="🛗", FragmentB=expression_13)
typ = ModelType(
    Name="Shaft",
    Description=concat_14,
    Icon=filter_3,
    Variant=expression_13,
    Representations=merge_8,
    Ports=merge_7,
    Qualities=qlt.Quality)  # -> Type, Name, Description, Icon, Variant, Unit, Representations, Ports, Qualities
typ_2 = RemoveType(TypeName=typ.Name, TypeVariant=typ.Variant, Run=safe_2)
or = GateOr(A=safe_2, B=typ_2)
typ_3 = AddType(Type=typ.Type, Run=or)

typ_4 = SerializeType(Type=typ.Type)
type = Text(typ_4)
context_bake = ContextBake(Geometry=type)
m2d_rhino = Make2DRhinoView(Name=panel_7, Clip=True)  # disabled
number_slider_4 = Slider(876, range=0..1000)  # disabled
view_rectangle = ViewRectangle(view=m2d_rhino)  # disabled
previewplane_2 = PreviewPlane_2(plane=view_rectangle, axis_length=number_slider_4)  # disabled

rec = Rectangle({Plane=Plane(origin=(853.3612491, 852.5312947, 866.3069427), x=(0.7071067812, -0.7071067812, 0), y=(-0.4082482905, -0.4082482905, 0.8164965809)), Size=Domain2(u=-52.32632723..52.32632723, v=-27.88533994..27.88533994)})
m2d_parallel = Make2DParallelView(Projection=rec)

doors_2 = Rectangle(flatten(doors))
corevolume_2 = Box(corevolume)
expression_16 = Expression(x="volume", y=corevolume_2, Expression="x")
merge_9 = Merge(Data1=corevolume_2, Data2=doors_2)
concat_16 = Concatenate(FragmentA=curdir.D, FragmentB=curdir.S, FragmentC=rep_2.Url)

merge_10 = Merge(Data1=corevolume_2, Data2=doors_2)
make2d = Make2D(Geometry=merge_10, View=m2d_parallel, TangentEdges="T", TangentSeams=False, AutoComputeMake2D=True)  # -> VisibleCurves, VisibleIndex, VisibleType, HiddenCurves, HiddenIndex, HiddenType
trim_22 = TrimTree(Tree=make2d.VisibleCurves, Depth=1)
shaft = Geometry(trim_22)

expression_17 = Expression(x="doors", y=doors_2, Expression="x")
merge_11 = Merge(Data1=expression_16, Data2=expression_17)

ef_layer = EleFrontLayer(FullPath=merge_11)  # -> Layer, FullPath, Hidden, Locked, DisplayColour, MaterialName, Linetype, PrintColour, PrintWidth
ef_att = EleFrontAttributes(Layer=ef_layer.Layer)  # -> Attributes, Keys, Values, Name, Layer, ColourSource, DisplayColour, MaterialSource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
baketofile = BakeObjectsToFile(
    FilePath=concat_12,
    Geometry=merge_9,
    Attributes=ef_att.Attributes,
    Bake=safe_2,
    networkMode=False,
    ValueTable_networkMode=True,
    overwriteMode="Overwrite",
    preset="Safest")
baketofile_2 = BakeObjectsToFile(
    FilePath=concat_16,
    Geometry=merge_9,
    Attributes=ef_att.Attributes,
    Bake=safe_2,
    networkMode=False,
    ValueTable_networkMode=True,
    overwriteMode="Overwrite",
    preset="Safest")

expression_18 = Expression(x="shaft", y=shaft, Expression="x")
concat_17 = Concatenate(FragmentC="icons", FragmentD=curdir.S, FragmentA="shaft", FragmentB="_", FragmentE=expression_13)
merge_12 = Merge(Data1=expression_18)
merge_13 = Merge(Data1=shaft)
concat_18 = Concatenate(FragmentA=concat_17, FragmentB=".3dm")
ef_layer_2 = EleFrontLayer(FullPath=merge_12)  # -> Layer, FullPath, Hidden, Locked, DisplayColour, MaterialName, Linetype, PrintColour, PrintWidth
concat_19 = Concatenate(FragmentA=curdir.D, FragmentB=curdir.S, FragmentC=concat_18)
ef_att_2 = EleFrontAttributes(Layer=ef_layer_2.Layer)  # -> Attributes, Keys, Values, Name, Layer, ColourSource, DisplayColour, MaterialSource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
baketofile_3 = BakeObjectsToFile(
    FilePath=concat_19,
    Geometry=merge_13,
    Attributes=ef_att_2.Attributes,
    Bake=and,
    networkMode=False,
    ValueTable_networkMode=True,
    overwriteMode="Overwrite",
    preset="Safest")

# ==== cluster _2D
x = ClusterInput()
expression = Expression(x=x, Expression="x/2")
neg = Negative(Value=expression)
dom = ConstructDomain(DomainStart=neg, DomainEnd=expression)
I = ClusterOutput(dom)

# ==== cluster ValueOr0
value = ClusterInput()
value_2 = Number(value)
null = NullItem(Item=value_2)  # -> NullFlags, InvalidFlags, Description
filter = StreamFilter(Gate=null.NullFlags, Stream0=value_2, Stream1="0")
valueor0 = Number(filter)
valueor0_2 = ClusterOutput(valueor0)

# ==== cluster PreviewPlane: Preview a plane with axis colors and naming.
axis_length = ClusterInput()
plane = ClusterInput()
axis_length_2 = Number(axis_length)
plane_2 = Plane(plane)
deplane = DeconstructPlane(Plane=plane_2)  # -> Origin, XAxis, YAxis, ZAxis
line = LineSDL(Start=deplane.Origin, Direction=deplane.YAxis, Length=axis_length_2)
line_2 = LineSDL(Start=deplane.Origin, Direction=deplane.XAxis, Length=axis_length_2)
line_3 = LineSDL(Start=deplane.Origin, Direction=deplane.ZAxis, Length=axis_length_2)
swatch = ColourSwatch(SwatchColor=RGB(235, 52, 79))
swatch_2 = ColourSwatch(SwatchColor=RGB(0, 166, 157))
swatch_3 = ColourSwatch(SwatchColor=RGB(240, 117, 24))
end = EndPoints(Curve=line_2)  # -> Start, End
end_2 = EndPoints(Curve=line)  # -> Start, End
end_3 = EndPoints(Curve=line_3)  # -> Start, End
tag = TextTag(Location=end.End, Text="X", Colour=swatch)
tag_2 = TextTag(Location=end_2.End, Text="Y", Colour=swatch_2)
tag_3 = TextTag(Location=end_3.End, Text="Z", Colour=swatch_3)
preview = CustomPreview(Geometry=line_2, Material=swatch)
preview_2 = CustomPreview(Geometry=line, Material=swatch_2)
preview_3 = CustomPreview(Geometry=line_3, Material=swatch_3)
X = Line(line_2)
Y = Line(line)
Z = Line(line_3)
X_2 = ClusterOutput(X)
Y_2 = ClusterOutput(Y)
Z_2 = ClusterOutput(Z)

# ==== cluster PreviewPlane_2: Preview a plane with axis colors and naming.
axis_length = ClusterInput()
plane = ClusterInput()
axis_length_2 = Number(axis_length)
plane_2 = Plane(plane)
deplane = DeconstructPlane(Plane=plane_2)  # -> Origin, XAxis, YAxis, ZAxis
line = LineSDL(Start=deplane.Origin, Direction=deplane.YAxis, Length=axis_length_2)
line_2 = LineSDL(Start=deplane.Origin, Direction=deplane.XAxis, Length=axis_length_2)
line_3 = LineSDL(Start=deplane.Origin, Direction=deplane.ZAxis, Length=axis_length_2)
swatch = ColourSwatch(SwatchColor=RGB(235, 52, 79))
swatch_2 = ColourSwatch(SwatchColor=RGB(0, 166, 157))
swatch_3 = ColourSwatch(SwatchColor=RGB(240, 117, 24))
end = EndPoints(Curve=line_2)  # -> Start, End
end_2 = EndPoints(Curve=line)  # -> Start, End
end_3 = EndPoints(Curve=line_3)  # -> Start, End
tag = TextTag(Location=end.End, Text="X", Colour=swatch)
tag_2 = TextTag(Location=end_2.End, Text="Y", Colour=swatch_2)
tag_3 = TextTag(Location=end_3.End, Text="Z", Colour=swatch_3)
preview = CustomPreview(Geometry=line_2, Material=swatch)
preview_2 = CustomPreview(Geometry=line, Material=swatch_2)
preview_3 = CustomPreview(Geometry=line_3, Material=swatch_3)

# ==== cluster ViewRectangle
view = ClusterInput()
view_2 = Data(view)
nickname = NAME(view=view_2)  # -> c, x, y, z, h, w
# ---------- nickname: Python ----------
uselss, c, x, y, z = view.GetCameraFrame()
h = view.FrustumHeight
w = view.FrustumWidth
# ---------- end nickname ----------
rev = Reverse(Vector=nickname.x)
rev_2 = Reverse(Vector=nickname.y)
pl = ConstructPlane(Origin=nickname.c, XAxis=rev, YAxis=nickname.y)
_2d = _2D(x=nickname.w)
_2d_2 = _2D(x=nickname.h)
rectangle = Rectangle(Plane=pl, XSize=_2d, YSize=_2d_2, Radius=0)  # -> Rectangle, Length
rec = Rectangle(rectangle.Rectangle)
rec_2 = ClusterOutput(rec)
