# Grasshopper definition test-helper-scene.gh (Grasshopper 1.0.7)
# plug-ins: semio

list = ValueList({"Full": 0, "Bridge": 1, "Bridge-Capsule": 2}, selected="Full")
customroot = BooleanToggle(False)
swap_root = BooleanToggle(False)
swapsides = BooleanToggle(False)
list_2 = ValueList({"1to500", "1to200"}, selected="1to500")
run = BooleanToggle(True)
xy = XYPlane(Origin=Point(0, 0, 0))
plane = Plane(
    X=Slider(6.5, range=-10..10),
    Y=Slider(6.1, range=-10..10),
    Z=Slider(-6.1, range=-10..10),
    theta=Slider(86, range=-360..360),
    phi=Slider(34, range=-360..360))
number_slider = Slider(2, range=-10..10)
number_slider_2 = Slider(55, range=0..360)
filter = StreamFilter(Gate=customroot, Stream0=xy, Stream1=plane)
curdir = CurrentDirectory()  # -> D, P, S
# ---------- curdir: Python ----------
#Component Information
#--------------------------------------------------------------------------------------------
if ghenv.Component.RunCount<2:
    #General
    #--------------------------------------------------------------------------------------------
    __author__ = "Ueli Saluz"
    __version__ = "2023.09.29"
    
    ghenv.Component.Name = "CurrentDirectory"
    ghenv.Component.NickName = "CurDir"
    ghenv.Component.Description = "Current directory of the current grasshopper file."
    ghenv.Component.Message = "VER 1.0"
    ghenv.Component.Category = "Params"
    ghenv.Component.SubCategory = "Util"
    
    #Outputs
    #--------------------------------------------------------------------------------------------
    outputIndex=0
    
    ghenv.Component.Params.Output[outputIndex].Name = "Directory"
    ghenv.Component.Params.Output[outputIndex].NickName = "D"
    ghenv.Component.Params.Output[outputIndex].Description = "Directory of the current grasshopper file."
    outputIndex+=1
    
    ghenv.Component.Params.Output[outputIndex].Name = "Path"
    ghenv.Component.Params.Output[outputIndex].NickName = "P"
    ghenv.Component.Params.Output[outputIndex].Description = "Path of the current grasshopper file."
    outputIndex+=1
    
    ghenv.Component.Params.Output[outputIndex].Name = "Separator"
    ghenv.Component.Params.Output[outputIndex].NickName = "S"
    ghenv.Component.Params.Output[outputIndex].Description = "Separator of the current system."
    outputIndex+=1

#Imports
#--------------------------------------------------------------------------------------------
from os.path import dirname
from os import sep

#Solver - Run with trees to enhance performance drastically
#--------------------------------------------------------------------------------------------
if __name__ == "__main__":
    P = ghenv.Component.OnPingDocument().FilePath
    D = dirname(P)
    S = sep
# ---------- end curdir ----------
filter_2 = StreamFilter(Gate=swap_root, Stream1=filter)
filter_3 = StreamFilter(Gate=swap_root, Stream0=filter)
filter_4 = StreamFilter(Gate=swap_root, Stream0=filter)
panel = Panel("https://github.com/usalu/semio/releases/download/r24.07-1/examples.zip")

# ----
# Everything for metabolistic architecture.
panel_2 = Panel("https://github.com/usalu/semio/tree/main/examples/metabolism")
remove_formations = BooleanToggle(False)
remove_types = BooleanToggle(False)
read_kit = BooleanToggle(True)
kit = DeleteKit(Run=Toggle(False))
kit_2 = LoadKit(Run=read_kit)  # -> Name, Description, Icon, Url, Homepage, Types, Formations
panel_3 = Panel("Cylindric Shaft")
panel_4 = Panel("Cylindric Capital")
panel_5 = Panel("Capsule")
panel_6 = Panel("Base")
panel_7 = Panel("Capital")
panel_8 = Panel("Shaft")
typ = ModelType(Type=kit_2.Types)  # -> Type, Name, Description, Icon, Variant, Unit, Representations, Ports, Qualities
panel_9 = Panel(typ.Type)
for = ModelFormation(Formation=kit_2.Formations)  # -> Formation, Name, Description, Icon, Variant, Unit, Pieces, Attractions, Qualities
for_2 = RemoveFormation(FormationName=for.Name, FormationVariant=for.Variant, Run=remove_formations)
tmatch = MatchText(Text=typ.Name, Pattern="*", Case=True)
trim = TrimTree(Tree=kit_2.Types, Depth=1)
cull = CullPattern(List=kit_2.Types, CullPattern=tmatch)
por = ModelPort(Port=typ.Ports)  # -> Port, Id, Point, Direction, Locators
typ_2 = ModelType(Type=cull)  # -> Type, Name, Description, Icon, Variant, Unit, Representations, Ports, Qualities
panel_10 = Panel(typ_2.Type)
typ_3 = RemoveType(TypeName=typ_2.Name, TypeVariant=typ_2.Variant, Run=remove_types)

concat = Concatenate(FragmentD="b", FragmentC="_", FragmentA="s", FragmentB="1")
concat_2 = Concatenate(FragmentD=concat, FragmentC="_", FragmentA="c")
concat_3 = Concatenate(FragmentD=concat, FragmentC="_", FragmentA="ci")
concat_4 = Concatenate(FragmentD=concat, FragmentC="_", FragmentA="b", FragmentB="1")
concat_5 = Concatenate(FragmentD=concat, FragmentC="_", FragmentA="b", FragmentB="2")
pce = ModelPiece(Id=concat_2, TypeName="Capsule", TypeVariant=Slider(1, range=1..8))  # -> Piece, Id, TypeName, TypeVariant, RootPlane, DiagramScreenPoint
pce_2 = ModelPiece(Id=concat_3, TypeName="Capital")  # -> Piece, Id, TypeName, TypeVariant, RootPlane, DiagramScreenPoint
pce_3 = ModelPiece(Id="b", TypeName="Base", RootPlane=filter_4)  # -> Piece, Id, TypeName, TypeVariant, RootPlane, DiagramScreenPoint
pce_4 = ModelPiece(Id=concat, TypeName="Shaft", TypeVariant="1")  # -> Piece, Id, TypeName, TypeVariant, RootPlane, DiagramScreenPoint
pce_5 = ModelPiece(Id=concat_4, TypeName="Bridge", RootPlane=filter_2)  # -> Piece, Id, TypeName, TypeVariant, RootPlane, DiagramScreenPoint
pce_6 = ModelPiece(Id=concat_5, TypeName="Bridge", RootPlane=filter_3)  # -> Piece, Id, TypeName, TypeVariant, RootPlane, DiagramScreenPoint
ty = Type([null x28])
core = Panel("c")
kit_3 = CreateKit(Name="Metabolism", Icon="🫀", Url=panel, Homepage=panel_2, Types=ty, Run=Toggle(False))
top = Panel("t")
concat_6 = Concatenate(FragmentA=core, FragmentB="-", FragmentC="0")
bottom = Panel("b")
sde = ModelSide(PieceId=pce_5.Id, PieceTypePortId="e")  # -> Side, PieceId, PieceTypePortId
sde_2 = ModelSide(PieceId=pce_5.Id, PieceTypePortId="w")  # -> Side, PieceId, PieceTypePortId
sde_3 = ModelSide(PieceId=pce_6.Id, PieceTypePortId="e")  # -> Side, PieceId, PieceTypePortId
sde_4 = ModelSide(PieceId=pce_4.Id, PieceTypePortId="f-3#sl-1#d-1")  # -> Side, PieceId, PieceTypePortId
sde_5 = ModelSide(PieceId=pce_4.Id, PieceTypePortId="f-0#sl-0#d-0")  # -> Side, PieceId, PieceTypePortId
sde_6 = ModelSide(PieceId=pce.Id)  # -> Side, PieceId, PieceTypePortId
sde_7 = ModelSide(PieceId=pce_3.Id, PieceTypePortId=concat_6)  # -> Side, PieceId, PieceTypePortId
sde_8 = ModelSide(PieceId=pce_4.Id, PieceTypePortId=bottom)  # -> Side, PieceId, PieceTypePortId
sde_9 = ModelSide(PieceId=pce_4.Id, PieceTypePortId=top)  # -> Side, PieceId, PieceTypePortId
sde_10 = ModelSide(PieceId=pce_2.Id)  # -> Side, PieceId, PieceTypePortId
con = ModelConnection(ConnectedSide=sde_5.Side, ConnectingSide=sde_6.Side, Offset=Slider(1, range=-10..10), Rotation=Slider(90, range=0..360))  # -> Connection, ConnectedSide, ConnectingSide, Offset, Rotation
con_2 = ModelConnection(ConnectedSide=sde_7.Side, ConnectingSide=sde_8.Side, Offset=Slider(3, range=-10..10), Rotation=Slider(44, range=0..360))  # -> Connection, ConnectedSide, ConnectingSide, Offset, Rotation
con_3 = ModelConnection(ConnectedSide=sde_2.Side, ConnectingSide=sde_3.Side, Offset=number_slider, Rotation=number_slider_2)  # -> Connection, ConnectedSide, ConnectingSide, Offset, Rotation
con_4 = ModelConnection(ConnectedSide=sde_4.Side, ConnectingSide=sde.Side, Offset=Slider(2, range=-10..10), Rotation=Slider(10, range=0..360))  # -> Connection, ConnectedSide, ConnectingSide, Offset, Rotation
con_5 = ModelConnection(ConnectedSide=sde_9.Side, ConnectingSide=sde_10.Side, Offset=Slider(4, range=-10..10), Rotation=Slider(81, range=0..360))  # -> Connection, ConnectedSide, ConnectingSide, Offset, Rotation
con_6 = ModelConnection(ConnectedSide=sde_7.Side, ConnectingSide=sde_2.Side, Offset=number_slider, Rotation=number_slider_2)  # -> Connection, ConnectedSide, ConnectingSide, Offset, Rotation
number_slider_3 = Slider(330, range=0..1000)
qlt = ModelQuality(Quality=typ.Qualities)  # -> Quality, Name, Value, Unit, Definition
merge = Merge(Data1=pce_3.Piece, Data2=pce_4.Piece, Data3=pce_2.Piece, Data4=pce.Piece, Data5=pce_5.Piece, Data6=pce_6.Piece)
merge_2 = Merge(Data1=con_2.Connection, Data2=con_5.Connection, Data3=con.Connection, Data4=con_4.Connection, Data5=con_3.Connection)
merge_3 = Merge(Data1=pce_5.Piece, Data2=pce_6.Piece)
merge_4 = Merge(Data1=pce_3.Piece, Data2=pce_5.Piece)
merge_5 = Merge(Data1=merge)
merge_6 = Merge(Data1=merge_2)
for_3 = ModelFormation(Name="Test", Variant="Bridges", Pieces=merge_3, Connections=con_3.Connection)  # -> Formation, Name, Description, Icon, Variant, Unit, Pieces, Connections, Qualities
for_4 = ModelFormation(Name="Test", Pieces=merge_5, Attractions=merge_6)  # -> Formation, Name, Description, Icon, Variant, Unit, Pieces, Attractions, Qualities
for_5 = ModelFormation(Name="Test", Variant="Base-Bridge", Pieces=merge_4, Connections=con_6.Connection)  # -> Formation, Name, Description, Icon, Variant, Unit, Pieces, Connections, Qualities
item = CherryPicker(por.Id, ListIndex=3, TreePath_path="{0;0;11}")
filter_5 = StreamFilter(Gate=list, Stream0=for_4.Formation, Stream1=for_3.Formation, Stream2=for_5.Formation)
for_6 = ModelFormation(Formation=filter_5)  # -> Formation, Name, Description, Icon, Variant, Unit, Pieces, Connections, Qualities
panel_11 = Panel(item)
trim_2 = TrimTree(Tree=for_6.Connections, Depth=1)
con_7 = ModelConnection(Connection=trim_2)  # -> Connection, ConnectedSide, ConnectingSide, Offset, Rotation
con_8 = ModelConnection(Connection=con_7.Connection, ConnectedSide=con_7.ConnectingSide, ConnectingSide=con_7.ConnectedSide)  # -> Connection, ConnectedSide, ConnectingSide, Offset, Rotation
for_7 = ModelFormation(Formation=filter_5, Connections=con_8.Connection)  # -> Formation, Name, Description, Icon, Variant, Unit, Pieces, Connections, Qualities
filter_6 = StreamFilter(Gate=swapsides, Stream0=filter_5, Stream1=for_7.Formation)
for_8 = ModelFormation(Formation=filter_6)  # -> Formation, Name, Description, Icon, Variant, Unit, Pieces, Connections, Qualities

for_9 = RemoveFormation(FormationName=for_8.Name, FormationVariant=for_8.Variant, Run=run)
or = GateOr(A=run, B=for_9)
for_10 = AddFormation(Formation=for_8.Formation, Run=or)
scn = GetScene(FormationName=for_8.Name, FormationVariant=for_8.Variant, Run=for_10)
scn_2 = FilterScene(Scene=scn, LevelOfDetails=list_2, Tags="volume", Formats=".3dm")  # -> Representations, Planes, PiecesIds, ParentsPiecesIds
trim_3 = TrimTree(Tree=scn_2.Representations, Depth=1)
trim_4 = TrimTree(Tree=scn_2.Planes, Depth=1)
rep = ModelRepresentation(Representation=trim_3)  # -> Representation, Url, LevelOfDetail, Tags
concat_7 = Concatenate(FragmentA=curdir.D, FragmentB=curdir.S, FragmentC=rep.Url)
load_geometry = LoadGeometry(path=concat_7, pln=trim_4)

previewplane = PreviewPlane(plane=trim_4, axis_length=Slider(2, range=0..10))
semio_preview = SemioPreview(geo=load_geometry)

# ==== cluster PreviewPlane: Preview a plane with axis colors and naming.
axis_length = ClusterInput()
plane = ClusterInput()
axis_length_2 = Number(axis_length)
plane_2 = Plane(plane)
deplane = DeconstructPlane(Plane=plane_2)  # -> Origin, XAxis, YAxis, ZAxis
line = LineSDL(Start=deplane.Origin, Direction=deplane.YAxis, Length=axis_length_2)
line_2 = LineSDL(Start=deplane.Origin, Direction=deplane.XAxis, Length=axis_length_2)
line_3 = LineSDL(Start=deplane.Origin, Direction=deplane.ZAxis, Length=axis_length_2)
swatch = ColourSwatch(SwatchColor=RGB(235, 52, 79))
swatch_2 = ColourSwatch(SwatchColor=RGB(0, 166, 157))
swatch_3 = ColourSwatch(SwatchColor=RGB(240, 117, 24))
end = EndPoints(Curve=line_2)  # -> Start, End
end_2 = EndPoints(Curve=line)  # -> Start, End
end_3 = EndPoints(Curve=line_3)  # -> Start, End
tag = TextTag(Location=end.End, Text="X", Colour=swatch)
tag_2 = TextTag(Location=end_2.End, Text="Y", Colour=swatch_2)
tag_3 = TextTag(Location=end_3.End, Text="Z", Colour=swatch_3)
preview = CustomPreview(Geometry=line_2, Material=swatch)
preview_2 = CustomPreview(Geometry=line, Material=swatch_2)
preview_3 = CustomPreview(Geometry=line_3, Material=swatch_3)

# ==== cluster LoadGeometry
path = ClusterInput()
pln = ClusterInput()
path_2 = FilePath(path)

pln_2 = Plane(graft(pln))
cset = CreateSet(List=path_2)  # -> Set, Map
refbake = ReferenceByBakeName(FilePath=graft(cset.Set), BakeName="*", Key="*", Val="*", lightweight=False, DisableAutoUpdate=True)
lng = ListLength(List=cset.Set)
expression = Expression(x=lng, Expression="x>1")
trim = TrimTree(Tree=refbake, Depth=1)
filter = StreamFilter(Gate=expression, Stream0=refbake, Stream1=trim)
filtertype = FilterByType(ObjectType="Brep", Geometry=filter, invertFilter=False, returnNulls=False)  # -> ExcludedGeometry, IncludedGeometry
filtertype_2 = FilterByType(ObjectType="Curve", Geometry=filter, invertFilter=False, returnNulls=False)  # -> ExcludedGeometry, IncludedGeometry
filtertype_3 = FilterByType(ObjectType="Point", Geometry=filter, invertFilter=False, returnNulls=False)  # -> ExcludedGeometry, IncludedGeometry
trim_2 = TrimTree(Tree=filtertype.IncludedGeometry, Depth=1)
trim_3 = TrimTree(Tree=filtertype_2.IncludedGeometry, Depth=1)
trim_4 = TrimTree(Tree=filtertype_3.IncludedGeometry, Depth=1)
brep = Brep(trim_2)
crv = Curve(trim_3)
pt = Point(trim_4)

filtertype_4 = FilterByType(ObjectType="Mesh", Geometry=filter, invertFilter=False, returnNulls=False)  # -> ExcludedGeometry, IncludedGeometry
trim_5 = TrimTree(Tree=filtertype_4.IncludedGeometry, Depth=1)
mesh = Mesh(trim_5)

merge = Merge(Data1=mesh, Data2=brep, Data3=crv, Data4=pt)
tstat = TreeStatistics(Tree=merge)  # -> Paths, Length, Count
item = ListItem(List=tstat.Paths, Index=cset.Map, Wrap=True)
branch = TreeBranch(Tree=merge, Path=item, MaintainPaths=False)
match = MatchTree(Tree=branch, Guide=pln_2)
mtchanc = MatchAncestor(AT=pln_2, CT=graft(match))  # -> MAT; inputs AT: tree, CT: tree
# ---------- mtchanc: Python ----------
if ghenv.Component.RunCount<2:
    __author__ = "Ueli Saluz"
    __version__ = "2022.04.25"
    
    ghenv.Component.Name = "Match Ancestor"
    ghenv.Component.NickName = "MtchAnc"
    ghenv.Component.Description = "Duplicates all elements of an ancestor tree to match the amount of elements in the child tree."
    ghenv.Component.Message = "VER 1.1"
    
    ghenv.Component.Params.Input[0].Name = "AncestorTree"
    ghenv.Component.Params.Input[0].NickName = "AT"
    ghenv.Component.Params.Input[0].Description = "Ancestor tree that data will the duplicated until it matches the child tree"
    ghenv.Component.Params.Input[0].Optional = False
    
    ghenv.Component.Params.Input[1].Name = "ChildTree"
    ghenv.Component.Params.Input[1].NickName = "CT"
    ghenv.Component.Params.Input[1].Description = "Child tree that branches will the guide to duplicat the data of the ancestor tree"
    ghenv.Component.Params.Input[0].Optional = False
    
    ghenv.Component.Params.Output[0].Name = "MatchedAncestorTree"
    ghenv.Component.Params.Output[0].NickName = "MAT"
    ghenv.Component.Params.Output[0].Description = "Matched ancestor tree with the amount of items and the branch paths of the child tree"

from System import Object
from Grasshopper import DataTree

"""Returns a new tree with the ancestor data being duplicated along all child branches which where child paths of that ancestor.
    Inputs:
        ancestorTree: Ancestor tree that data will the duplicated until it matches the child tree
        childTree: Child tree that branches will the guide to duplicat the data of the ancestor tree
    Output:
        matchedAncestorTree: Matched ancestor tree with the amount of items and the branch paths of the child tree"""
def MatchAncestorTreeToChildTree (ancestorTree, childTree):
    
    matchedAncestorTree = DataTree[Object]()
    dummy = 0
    for i,pathAncestor in enumerate(ancestorTree.Paths):
        branch = ancestorTree.Branch(pathAncestor)
        if len(branch)!=1:
            raise Exception("Ancestor must be grafted and containing one item per branch")
        #The item to be duplicated
        item = branch[0]
        for j,pathChild in enumerate(childTree.Paths):
            #Returns a tuple and not like in the documentation described a bool with a pointer to the int to store the generations
            checkAncestor = pathChild.IsAncestor(pathAncestor,dummy)
            if(checkAncestor[0]):
                matchedAncestorTree.AddRange([item]*childTree.Branch(pathChild).Count,pathChild)
    return matchedAncestorTree

if __name__ == "__main__":
    MAT = MatchAncestorTreeToChildTree (AT,CT)
# ---------- end mtchanc ----------
trim_6 = TrimTree(Tree=mtchanc, Depth=1)
pl2pl = MoveObjectPlaneToPlane(G=match, S=PlaneXY(0, 0, 0), T=trim_6)  # -> TG, T; inputs S: Plane, T: Plane
# ---------- pl2pl: Python ----------
#Component Information
#--------------------------------------------------------------------------------------------
if ghenv.Component.RunCount<2:
    #General
    #--------------------------------------------------------------------------------------------
    __author__ = "Ueli Saluz"
    __version__ = "2023.02.12"
    
    ghenv.Component.Name = "MoveObjectPlaneToPlane"
    ghenv.Component.NickName = "Pl2Pl"
    ghenv.Component.Description = "Moves abitrary geometry from a source plane to a target plane."
    ghenv.Component.Message = "VER 1.2"
    ghenv.Component.Category = "Transform"
    ghenv.Component.SubCategory = "Euclidean"
    
     #Inputs
    #--------------------------------------------------------------------------------------------
    inputIndex=0
    
    ghenv.Component.Params.Input[inputIndex].Name = "Geometry"
    ghenv.Component.Params.Input[inputIndex].NickName = "G"
    ghenv.Component.Params.Input[inputIndex].Description = "Geometry to move."
    ghenv.Component.Params.Input[inputIndex].Optional = False
    inputIndex+=1
    
    ghenv.Component.Params.Input[inputIndex].Name = "SourcePlane"
    ghenv.Component.Params.Input[inputIndex].NickName = "S"
    ghenv.Component.Params.Input[inputIndex].Description = "Source plane of object."
    ghenv.Component.Params.Input[inputIndex].Optional = False
    inputIndex+=1
    
    ghenv.Component.Params.Input[inputIndex].Name = "TargetPlane"
    ghenv.Component.Params.Input[inputIndex].NickName = "T"
    ghenv.Component.Params.Input[inputIndex].Description = "Target plane of object."
    ghenv.Component.Params.Input[inputIndex].Optional = False
    inputIndex+=1
    
    #Outputs
    #--------------------------------------------------------------------------------------------
    outputIndex=0
    
    ghenv.Component.Params.Output[outputIndex].Name = "TranslatedGeometry"
    ghenv.Component.Params.Output[outputIndex].NickName = "TG"
    ghenv.Component.Params.Output[outputIndex].Description = "Translated geometry in target plane."
    outputIndex+=1
    
    ghenv.Component.Params.Output[outputIndex].Name = "Trasnform"
    ghenv.Component.Params.Output[outputIndex].NickName = "T"
    ghenv.Component.Params.Output[outputIndex].Description = "Transform describing translation form source to target plane."
    outputIndex+=1


#Imports
#--------------------------------------------------------------------------------------------
import Rhino.Geometry.Transform as trsf

def MvObjPlnToPln (geo,plnObj,plnDest):
    transform = trsf.PlaneToPlane(plnObj,plnDest)
    geo.Transform(transform)
    return (geo,transform)

TG, T = MvObjPlnToPln(G,S,T)
# ---------- end pl2pl ----------
geo = Geometry(pl2pl.TG)

geo_2 = ClusterOutput(geo)

# ==== cluster SemioPreview
geo = ClusterInput()

geo_2 = Geometry(geo)
swatch = ColourSwatch(SwatchColor=RGB(0, 0, 0))
filtertype = FilterByType(ObjectType="Curve", Geometry=flatten(geo_2), invertFilter=False, returnNulls=False)  # -> ExcludedGeometry, IncludedGeometry
filtertype_2 = FilterByType(ObjectType="Brep", Geometry=flatten(geo_2), invertFilter=False, returnNulls=False)  # -> ExcludedGeometry, IncludedGeometry
debrep = DeconstructBrep(Brep=filtertype_2.IncludedGeometry)  # -> Faces, Edges, Vertices
preview = CustomPreview(Geometry=flatten(filtertype.IncludedGeometry), Material=swatch)
preview_2 = CustomPreview(Geometry=flatten(filtertype_2.IncludedGeometry), Material=ColourSwatch(SwatchColor=RGB(255, 255, 255)))
preview_3 = CustomPreview(Geometry=flatten(debrep.Edges), Material=swatch)

# ==== cluster Plane
X = ClusterInput()
Y = ClusterInput()
Z = ClusterInput()
theta = ClusterInput()
phi = ClusterInput()
X_2 = UnitX(Factor=1)
Y_2 = UnitY(Factor=1)
Z_2 = UnitZ(Factor=1)
theta_2 = Number(theta)
phi_2 = Number(phi)
vrot = Rotate(Vector=Y_2, Axis=Z_2, Angle=degrees(theta_2))
pt = ConstructPoint(XCoordinate=X, YCoordinate=Y, ZCoordinate=Z)
vrot_2 = Rotate(Vector=vrot, Axis=X_2, Angle=degrees(phi_2))
xy = XYPlane(Origin=pt)
rotate = RotateDirection(Geometry=xy, Center=Point(0, 0, 0), From=Y_2, To=vrot_2)  # -> Geometry, Transform
pln = Plane(rotate.Geometry)
pln_2 = ClusterOutput(pln)
