# Grasshopper definition amporhous-capsule.gh (Grasshopper 1.0.8)
# Copyright: GNU Lesser General Public License Version 3
# plug-ins: RhinoCodePluginGH, semio

panel = Panel("""\
/
q
p
J
L
s
z""")
panel_2 = Panel("""backslash
slash
q
p
J
L
s
z""")
zoom = Button()
save_representation = BooleanToggle(True)
number_slider = Slider(3, range=0..10)
icon_export = BooleanToggle(False)
variant = Slider(5, range=0..7)
loop_slider = PythonScript(SliderToModify=variant, Min="0", Max="7", stepSize="1", Delay=Slider(0, range=0..1), Run=Toggle(False), Reset=Button())  # inputs Run: Boolean, Reset: Boolean
# ---------- loop_slider: Python ----------
import time

def updateSliderInput(inputName,min,max,value,decimalPlace=2):
    for input in ghenv.Component.Params.Input:
        for source in input.Sources:
            if input.Name == str(inputName):
                source.Slider.DecimalPlaces = decimalPlace
                source.Slider.Minimum = min
                source.Slider.Maximum = max
                source.Slider.Value = value
                source.ExpireSolution(True)

def countDecimal(number):
    string= str(number)
    return string[::-1].find('.')

if Run == True:
    if SliderToModify < Max:
        time.sleep(Delay)
        updateSliderInput("SliderToModify",Min,Max,SliderToModify+stepSize,countDecimal(stepSize))
if Reset == True:
    updateSliderInput("SliderToModify",Min,Max,Min)
# ---------- end loop_slider ----------
item = ListItem(List=panel, Index=variant, Wrap=True)
item_2 = ListItem(List=panel_2, Index=variant, Wrap=True)
validate = BooleanToggle(False)
save = BooleanToggle(False)
expression = Expression(x=Slider(420, range=0..1000), Expression="x/100")
expression_2 = Expression(x=Slider(250, range=0..1000), Expression="x/100")
expression_3 = Expression(x=Slider(150, range=70..150), Expression="x/100")
expression_4 = Expression(x=Slider(300, range=0..1000), Expression="x/100")
merge = Merge(Data1="front", Data2="front", Data3="side", Data4="side", Data5="front", Data6="front", Data7="side", Data8="side")
merge_2 = Merge(Data1="F", Data2="T", Data3="F", Data4="T", Data5="F", Data6="T", Data7="F", Data8="T")
merge_3 = Merge(Data1="back", Data2="back", Data3="back", Data4="back", Data5="side", Data6="side", Data7="side", Data8="side")
and = GateAnd(A=save, B=save_representation)
and_2 = GateAnd(A=save, B=icon_export)
angle = Number(Slider(15, range=0..100))
width_room_m = Number(expression_2)
weight = Number(width_room_m)
height_m = Number(expression_4)
length_m = Number(expression)
addition_m = Number(expression_3)
item_3 = ListItem(List=merge_3, Index=variant, Wrap=True)
item_4 = ListItem(List=merge_2, Index=variant, Wrap=True)
item_5 = ListItem(List=merge, Index=variant, Wrap=True)
neg = Negative(Value=angle)
Z = UnitZ(Factor=1)
addition = Addition(A=width_room_m, B=addition_m)
addition_2 = Addition(A=length_m, B=addition_m)
toggle = BooleanToggle(False)
# ^
#                  |
# Preview    ->
# ^
#  |
# <- Meta
# Parameters:
# <- Variants
#   |
#   v
curdir = CurrentDirectory()  # -> D, P, S
# ---------- curdir: C# ----------
#region Usings
using System;
using System.Linq;
using System.Collections;
using System.Collections.Generic;
using System.Drawing;
using System.IO;

using Rhino;
using Rhino.Geometry;

using Grasshopper;
using Grasshopper.Kernel;
using Grasshopper.Kernel.Data;
using Grasshopper.Kernel.Types;
#endregion

public class Script_Instance : GH_ScriptInstance
{
    private void RunScript(ref object D, ref object P, ref object S)
    {
        D = Path.GetDirectoryName(this.GrasshopperDocument.FilePath);
        P = new DirectoryInfo(this.GrasshopperDocument.FilePath).Parent.Parent;
        S = Path.DirectorySeparatorChar;
    }
}
# ---------- end curdir ----------
list = ValueList({"Front", "Side"}, selected="Front")
list_2 = ValueList({"Back": "back", "Side": "side"}, selected="Back")
_2d = _2D(x=addition_2)
_2d_2 = _2D(x=width_room_m)
_2d_3 = _2D(x=addition)
rectangle = Rectangle(Plane=PlaneXY(0, 0, 0), XSize=_2d_3, YSize=_2d, Radius=0)  # -> Rectangle, Length
rectangle_2 = Rectangle(Plane=PlaneXY(0, 0, 0), XSize=_2d_2, YSize=_2d, Radius=0)  # -> Rectangle, Length
area = Area(Geometry=rectangle_2.Rectangle)  # -> Area, Centroid
# External
#      |
#      v
entrance = GetString(item_3, AtLeast=0, AtMost=1, TreeAccess=False)
view = GetString(item_5, AtLeast=0, AtMost=1, TreeAccess=False)
mirror = GetBoolean(item_4, AtLeast=0, AtMost=1, FalseValue="False", TreeAccess=False, TrueValue="True")
list_3 = ValueList({"Round": "round", "Rectangular": "rectangular"}, selected="Round")
explode = Explode(Curve=rectangle.Rectangle, Recursive=True)  # -> Segments, Vertices
explode_2 = Explode(Curve=rectangle_2.Rectangle, Recursive=True)  # -> Segments, Vertices
explode_3 = Explode(Curve=rectangle_2.Rectangle, Recursive=True)  # -> Segments, Vertices
trim = TrimTree(Tree=explode.Vertices, Depth=1)
trim_2 = TrimTree(Tree=explode.Segments, Depth=1)
panel_3 = Panel("""round
rectangular""")
panel_4 = Panel(item)
panel_5 = Panel("""front
side""")
panel_6 = Panel("""back
side""")
addition_3 = Addition(A=angle, B="-90")
trim_3 = TrimTree(Tree=explode_2.Vertices, Depth=1)
trim_4 = TrimTree(Tree=explode_2.Segments, Depth=1)
trim_5 = TrimTree(Tree=explode_3.Vertices, Depth=1)
trim_6 = TrimTree(Tree=explode_3.Segments, Depth=1)
mirrored = Boolean(mirror)
expression_5 = Expression(x=Slider(30, range=0..100), Expression="x/100")
expression_6 = Expression(x=Slider(65, range=0..100), Expression="x/100")
item_6 = ListItem(List=trim, Index=0, Wrap=True)  # -> Item, Item1, Item2, Item3
item_7 = ListItem(List=trim_2, Index=0, Wrap=True)  # -> Item, Item1, Item2, Item3
X = UnitX(Factor=weight)
Y = UnitY(Factor=weight)
itemindex = ItemIndex(L=panel_6, I=entrance)  # -> i; inputs L: list
# ---------- itemindex: Python ----------
#Component Information
#--------------------------------------------------------------------------------------------
if ghenv.Component.RunCount<2:
    #General
    #--------------------------------------------------------------------------------------------
    __author__ = "Ueli Saluz"
    __version__ = "2022.11.18"
    
    ghenv.Component.Name = "ItemIndex"
    ghenv.Component.NickName = "ItemIndex"
    ghenv.Component.Description = "A better IdemIndex"
    ghenv.Component.Message = "VER 1.0"
    ghenv.Component.Category = "Set"
    ghenv.Component.SubCategory = "List"
    
     #Inputs
    #--------------------------------------------------------------------------------------------
    inputIndex=0
    
    ghenv.Component.Params.Input[inputIndex].Name = "List"
    ghenv.Component.Params.Input[inputIndex].NickName = "L"
    ghenv.Component.Params.Input[inputIndex].Description = "Input1 is..."
    ghenv.Component.Params.Input[inputIndex].Optional = False
    inputIndex+=1
    
    ghenv.Component.Params.Input[inputIndex].Name = "Item"
    ghenv.Component.Params.Input[inputIndex].NickName = "I"
    ghenv.Component.Params.Input[inputIndex].Description = "Input2 is..."
    ghenv.Component.Params.Input[inputIndex].Optional = False
    inputIndex+=1
    
    #Outputs
    #--------------------------------------------------------------------------------------------
    outputIndex=0
    
    ghenv.Component.Params.Output[outputIndex].Name = "Index"
    ghenv.Component.Params.Output[outputIndex].NickName = "i"
    ghenv.Component.Params.Output[outputIndex].Description = "Output1 is..."
    outputIndex+=1

i = L.index(I)
# ---------- end itemindex ----------
itemindex_2 = ItemIndex(L=panel_5, I=view)  # -> i; inputs L: list; same code as itemindex
item_8 = ListItem(List=trim_3, Index=0, Wrap=True)  # -> Item, Item1, Item2, Item3
item_9 = ListItem(List=trim_4, Index=0, Wrap=True)  # -> Item, Item1, Item2, Item3
X_2 = UnitX(Factor=weight)
Y_2 = UnitY(Factor=weight)
Y_3 = UnitY(Factor=weight)
item_10 = ListItem(List=trim_5, Index=0, Wrap=True)  # -> Item, Item1, Item2, Item3
item_11 = ListItem(List=trim_6, Index=0, Wrap=True)  # -> Item, Item1, Item2, Item3
rev = Reverse(Vector=X)
rotate = Rotate(Geometry=item_7.Item3, Angle=degrees(neg), Plane=item_6.Item3)  # -> Geometry, Transform
geo = Geometry(rotate.Geometry)
ln = Line(StartPoint=area.Centroid, EndPoint=item_6.Item2)
window_offset_wall_m = Number(expression_5)
window_shape = Text(list_3)
itemindex_3 = ItemIndex(L=panel_3, I=window_shape)  # -> i; inputs L: list; same code as itemindex
window_circle_radius_m = Number(expression_6)
valueor0 = ValueOr0(value=itemindex)
valueor0_2 = ValueOr0(value=itemindex_2)
valueor0_3 = ValueOr0(value=itemindex_3)
rev_2 = Reverse(Vector=X_2)
rev_3 = Reverse(Vector=Y_3)
rev_4 = Reverse(Vector=Y_2)
rotate_2 = Rotate(Geometry=item_9.Item2, Angle=degrees(angle), Plane=item_8.Item2)  # -> Geometry, Transform
rotate_3 = Rotate(Geometry=item_11.Item2, Angle=degrees(angle), Plane=item_10.Item2)  # -> Geometry, Transform
vrot = Rotate(Vector=Y, Axis=Z, Angle=degrees(angle))
vrot_2 = Rotate(Vector=X, Axis=Z, Angle=degrees(angle))
reprmcrv = ReparametrizeCurve(C=item_11.Item1)  # -> RC, I, IL; inputs C: tree, T0: tree, T1: tree
# ---------- reprmcrv: Python ----------
#Component Information
#--------------------------------------------------------------------------------------------
if ghenv.Component.RunCount<2:
    #General
    #--------------------------------------------------------------------------------------------
    __author__ = "Ueli Saluz"
    __version__ = "2021.11.15"
    #--------------------------------------------------------------------------------------------
    ghenv.Component.Name = "ReparametrizeCurve"
    ghenv.Component.NickName = "RePrmCrv"
    ghenv.Component.Description = "Reparametrize the domain of a curve to the interval from 0 to the length of the curve."
    ghenv.Component.Message = "VER 1.0"
    
    ghenv.Component.Category = "Curve"
    ghenv.Component.SubCategory = "Util"
    
    #Inputs
    #--------------------------------------------------------------------------------------------
    inputIndex=0
    
    ghenv.Component.Params.Input[inputIndex].Name = "Curve"
    ghenv.Component.Params.Input[inputIndex].NickName = "C"
    ghenv.Component.Params.Input[inputIndex].Description = "Curve to reparametrize domain to interval [0,length]"
    ghenv.Component.Params.Input[inputIndex].Optional = True
    inputIndex+=1
    
    ghenv.Component.Params.Input[inputIndex].Name = "DomainStart"
    ghenv.Component.Params.Input[inputIndex].NickName = "T0"
    ghenv.Component.Params.Input[inputIndex].Description = "Starting value of domain that will be used to reparametrized. Default is 0."
    ghenv.Component.Params.Input[inputIndex].Optional = True
    inputIndex+=1
    
    ghenv.Component.Params.Input[inputIndex].Name = "DomainEnd"
    ghenv.Component.Params.Input[inputIndex].NickName = "T1"
    ghenv.Component.Params.Input[inputIndex].Description = "End value of domain that will be used to reparametrized. Default is length."
    ghenv.Component.Params.Input[inputIndex].Optional = True
    inputIndex+=1
    
    #Outputs
    #--------------------------------------------------------------------------------------------
    outputIndex=0
    
    ghenv.Component.Params.Output[outputIndex].Name = "ReparametrizedCurve"
    ghenv.Component.Params.Output[outputIndex].NickName = "RC"
    ghenv.Component.Params.Output[outputIndex].Description = "Reparametrized curve"
    outputIndex+=1
    
    ghenv.Component.Params.Output[outputIndex].Name = "Domain"
    ghenv.Component.Params.Output[outputIndex].NickName = "I"
    ghenv.Component.Params.Output[outputIndex].Description = "Domain of the reparametrized curve"
    outputIndex+=1
    
    ghenv.Component.Params.Output[outputIndex].Name = "DomainLength"
    ghenv.Component.Params.Output[outputIndex].NickName = "IL"
    ghenv.Component.Params.Output[outputIndex].Description = "Length of the domain of the reparametrized curve"
    outputIndex+=1


#Imports
#--------------------------------------------------------------------------------------------
from Rhino.Geometry import Interval, Curve
from System import Object
from Grasshopper import DataTree


#The Component function - Buisness logic only (e.g. working without trees)
#--------------------------------------------------------------------------------------------
"""Reparametrize the domain of a curve to the interval from 0 to the length of the curve.
    Inputs:
        crv: curve to reparametrize domain to interval [0,length]
        t0: Starting value of domain that will be used to reparametrized. Default is 0.
        t1: End value of domain that will be used to reparametrized. Default is length.
    Output:
        rc: Reparametrized curve"""
def reparametrizeCurve (crv,t0=None,t1=None):
    if(t0 is None):
        t0=0
    if(t1 is None):
        t1=crv.GetLength()
    crv.Domain = Interval(t0,t1)
    return crv

#Solver - Run with trees to enhance performance drastically
#--------------------------------------------------------------------------------------------
if __name__ == "__main__":
    
    #Initialize trees
    #--------------------------------------------------------------------------------------------
    ReparametrizedCurveTree = DataTree[Object]()
    DomainTree = DataTree[Object]()
    DomainLengthTree = DataTree[Object]()
    
    #Data matching
    #--------------------------------------------------------------------------------------------
    for path in C.Paths:
        curveBranch = C.Branch(path)
        for i,curve in enumerate(curveBranch):
            reparametrizedCurve = reparametrizeCurve(curve)
            ReparametrizedCurveTree.Add(reparametrizedCurve,path)
            DomainTree.Add(reparametrizedCurve.Domain,path)
            DomainLengthTree.Add(reparametrizedCurve.Domain.Length, path)
            
    #Assign trees to output
    #--------------------------------------------------------------------------------------------
    RC=ReparametrizedCurveTree
    I=DomainTree
    IL=DomainLengthTree
# ---------- end reprmcrv ----------
vrot_3 = Rotate(Vector=rev, Axis=Z, Angle=degrees(angle))
eval = EvaluateCurve(Curve=reparameterize(ln), Parameter=Slider(0.5, range=0..1))  # -> Point, Tangent, Angle
reprmcrv_2 = ReparametrizeCurve(C=rotate.Geometry)  # -> RC, I, IL; inputs C: tree, T0: tree, T1: tree; same code as reprmcrv
vrot_4 = Rotate(Vector=rev_4, Axis=Z, Angle=degrees(angle))
vrot_5 = Rotate(Vector=Y_2, Axis=Z, Angle=degrees(angle))
vrot_6 = Rotate(Vector=X_2, Axis=Z, Angle=degrees(addition_3))
vrot_7 = Rotate(Vector=rev_2, Axis=Z, Angle=degrees(neg))
vrot_8 = Rotate(Vector=rev_3, Axis=Z, Angle=degrees(angle))
vrot_9 = Rotate(Vector=X_2, Axis=Z, Angle=degrees(neg))
vrot_10 = Rotate(Vector=rev_2, Axis=Z, Angle=degrees(angle))
end = EndPoints(Curve=rotate_2.Geometry)  # -> Start, End
subcrv = SubCurve(BaseCurve=reprmcrv.RC, Domain=width_room_m)
end_2 = EndPoints(Curve=rotate_3.Geometry)  # -> Start, End
entrance_2 = Integer(valueor0)
entrance_3 = Integer(entrance_2)
multiplication = Multiplication(A=entrance_3, B="4")
windowshape = Integer(valueor0_3)
view_2 = Integer(valueor0_2)
view_3 = Integer(view_2)
multiplication_2 = Multiplication(A=view_3, B="2")
addition_4 = Addition(A=multiplication, B=multiplication_2, C=mirrored)
merge_4 = Merge(Data1=item_6.Item1, Data2=eval.Point, Data3=item_6.Item3)
subcrv_2 = SubCurve(BaseCurve=reprmcrv_2.RC, Domain=width_room_m)
bzspan = BezierSpan()  # -> Curve, Length, Domain
variant_2 = Integer(addition_4)
expression_7 = Expression(x=Slider(420, range=0..1000), Expression="x/100")
expression_8 = Expression(x=Slider(260, range=0..1000), Expression="x/100")
expression_9 = Expression(x=Slider(250, range=0..1000), Expression="x/100")
bzspan_2 = BezierSpan(StartPoint=item_8.Item1, StartTangent=vrot_5, EndPoint=item_8.Item2, EndTangent=vrot_4)  # -> Curve, Length, Domain
bzspan_3 = BezierSpan(StartPoint=item_8.Item, StartTangent=vrot_5, EndPoint=end.End, EndTangent=vrot_4)  # -> Curve, Length, Domain
end_3 = EndPoints(Curve=subcrv)  # -> Start, End
bool = Boolean(invert(mirror))
bzspan_4 = BezierSpan(StartPoint=end_3.End, StartTangent=Y_3, EndPoint=item_10.Item3, EndTangent=vrot_6)  # -> Curve, Length, Domain
end_4 = EndPoints(Curve=subcrv_2)  # -> Start, End
bzspan_5 = BezierSpan(StartPoint=item_6.Item, StartTangent=vrot, EndPoint=end_4.End, EndTangent=vrot_2)  # -> Curve, Length, Domain
intcrv_t = InterpolateT(Vertices=merge_4, TangentStart=vrot, TangentEnd=vrot_3, KnotStyle=1)  # -> Curve, Length, Domain
merge_5 = Merge(Data1=item_7.Item, Data2=bzspan.Curve, Data3=rotate.Geometry, Data4=bzspan_5.Curve)
addition_5 = Addition(A=angle, B="180")
geo_2 = Geometry(item_8.Item1)
room_width_m = Number(expression_8)
_2d_4 = _2D(x=room_width_m)
room_length_m = Number(expression_7)
# Local ->
_2d_5 = _2D(x=room_length_m)
rectangle_3 = Rectangle(Plane=PlaneXY(0, 0, 0), XSize=_2d_4, YSize=_2d_5, Radius=0)  # -> Rectangle, Length
area_2 = Area(Geometry=rectangle_3.Rectangle)  # -> Area, Centroid
height_m_2 = Number(expression_9)
geo_3 = Geometry(end_3.End)
filter = StreamFilter(Gate=entrance_2, Stream0=mirror, Stream1=bool)
merge_6 = Merge(Data1=item_9.Item, Data2=bzspan_2.Curve, Data3=rotate_2.Geometry, Data4=bzspan_3.Curve)
rotate_4 = Rotate(Geometry=item_11.Item2, Angle=degrees(addition_5), Plane=item_10.Item3)  # -> Geometry, Transform
merge_7 = Merge(Data1=subcrv, Data2=bzspan_4.Curve, Data3=rotate_4.Geometry)
join = JoinCurves(Curves=merge_5, Preserve=False)
crv = Curve(subcrv_2)
join_2 = JoinCurves(Curves=merge_6, Preserve=False)
mirror_2 = Boolean(filter)
mirrored_2 = Boolean(mirror_2)
addition_6 = Addition(A=multiplication, B=multiplication_2, C=mirrored_2)
oldvariant = Integer(addition_6)
trim_7 = TrimTree(Tree=join, Depth=1)
join_3 = JoinCurves(Curves=merge_7, Preserve=False)
end_5 = EndPoints(Curve=rotate_4.Geometry)  # -> Start, End
merge_8 = Merge(Data1=end_5.Start, Data2=item_10.Item, Data3=item_10.Item1)
trim_8 = TrimTree(Tree=join_2, Depth=1)

filter_2 = StreamFilter(Gate=mirror, Stream1=" It is mirrored compared to the normal one.")
concat = Concatenate(
    FragmentA="An apartment capsule of the variant ",
    FragmentG=panel,
    FragmentH=" with a balcony for one person. It has the entrance on the",
    FragmentB=entrance,
    FragmentC=" and has the view to the ",
    FragmentD=view,
    FragmentF=".",
    FragmentE=filter_2)

trim_9 = TrimTree(Tree=join_3, Depth=1)
vdis = VectorDisplay(Anchor=item_10.Item1, Vector=vrot_10)
vdis_2 = VectorDisplay(Anchor=end_2.End, Vector=vrot_8)
intcrv_t_2 = InterpolateT(Vertices=merge_8, TangentStart=vrot_8, TangentEnd=vrot_10, KnotStyle=1)  # -> Curve, Length, Domain
panel_7 = Panel(trim_8)
expression_10 = Expression(x=Slider(20, range=0..100), Expression="x/100")
expression_11 = Expression(x=Slider(25, range=0..100), Expression="x/100")
filter_3 = StreamFilter(Gate=variant, Stream0=trim_8)
merge_9 = Merge(Data2=item_10.Item)
bzspan_6 = BezierSpan(StartPoint=end_5.Start, StartTangent=vrot_8, EndPoint=item_10.Item1, EndTangent=vrot_10)  # -> Curve, Length, Domain
fillet_radius_m = Number(expression_11)
shellthickness_m = Number(expression_10)
subtraction = Subtraction(A=height_m_2, B=shellthickness_m)
neg_2 = Negative(Value=shellthickness_m)
dom = ConstructDomain(DomainStart=neg_2, DomainEnd=subtraction)
box = DomainBox(Base=PlaneXY(0, 0, 0), X=_2d_4, Y=_2d_5, Z=dom)
volume1to500 = Box(box)
debrep = DeconstructBrep(Brep=volume1to500)  # -> Faces, Edges, Vertices
trim_10 = TrimTree(Tree=debrep.Edges, Depth=1)
trim_11 = TrimTree(Tree=debrep.Faces, Depth=1)
item_12 = ListItem(List=trim_11, Index=0, Wrap=True)  # -> Item, Item1, Item2, Item3, Item4, Item5

lng = ListLength(List=debrep.Edges)
series = Series(Start=0, Step=1, Count=lng)
trim_12 = TrimTree(Tree=series, Depth=1)
filedge = FilletEdge(Shape=volume1to500, Blend=0, Metric=0, Edges=trim_12, Radii=fillet_radius_m)
trim_13 = TrimTree(Tree=filedge, Depth=1)

panel_8 = Panel("""6f52c1e6b1
45ab357369
e6c366306e
f16baa9eba
9442aab847
29526c7d12
b3a9105a14
ff37b776dd
b7243eed93
5004160f7d
b8c26ca1c9
a6e1f7d736
0da1e26dff
a3b1c730a1
c696cc23a3
532cc5697c""")
dup = DuplicateData(Data="2", Number="8", Order=True)
concat_2 = Concatenate(FragmentA="https://app.speckle.systems/projects/e7de1a2f8f/models/", FragmentB=panel_8)
trim_14 = TrimTree(Tree=dup, Depth=1)
partition = PartitionList(List=concat_2, Size=trim_14)
tstat = TreeStatistics(Tree=partition)  # -> Paths, Length, Count
item_13 = ListItem(List=flatten(tstat.Paths), Index=variant_2, Wrap=True)
branch = TreeBranch(Tree=partition, Path=item_13, MaintainPaths=True)
item_14 = ListItem(List=flatten(branch), Index=0, Wrap=True)  # -> Item, Item1

mime = ValueList({".stl": "model/stl", ".obj": "model/obj", ".glb": "model/gltf-binary", ".gltf": "model/gltf+json", ".3dm": "model/vnd.3dm", ".speckle": "model/vnd.speckle+json", ".png": "image/png", ".jpg": "image/jpeg", ".jpeg": "image/jpeg", ".svg": "image/svg+xml", ".pdf": "application/pdf", ".zip": "application/zip", ".json": "application/json", ".csv": "text/csv", ".txt": "text/plain"}, selected=".speckle")
concat_3 = Concatenate(FragmentC="capsule-with-balcony", FragmentD="_", FragmentA=item_2)
concat_4 = Concatenate(FragmentA=concat_3, FragmentB="_", FragmentE="1to500", FragmentG="_", FragmentF="volume")
concat_5 = Concatenate(FragmentA=concat_3, FragmentB="_", FragmentE="1to200", FragmentG="_", FragmentF="volume")
concat_6 = Concatenate(FragmentC="representations", FragmentD=curdir.S, FragmentA=concat_3)
concat_7 = Concatenate(FragmentC="representations", FragmentD=curdir.S, FragmentA=concat_5)
concat_8 = Concatenate(FragmentC="representations", FragmentD=curdir.S, FragmentA=concat_4)
concat_9 = Concatenate(FragmentA=concat_6, FragmentB=".glb")
concat_10 = Concatenate(FragmentA=concat_8, FragmentB=".3dm")
concat_11 = Concatenate(FragmentA=concat_7, FragmentB=".3dm")
rep = ModelRepresentation(Validate=validate, Url=concat_9)  # -> Representation, Valid, Url, Mime, Lod, Tags
rep_2 = ModelRepresentation(Validate=validate, Url=concat_11, Lod="1to200", Tags="volume")  # -> Representation, Valid, Url, Mime, Lod, Tags
rep_3 = ModelRepresentation(Validate=validate, Url=concat_10, Lod="1to500", Tags="volume")  # -> Representation, Valid, Url, Mime, Lod, Tags
trim_15 = TrimTree(Tree=rep_3.Tags, Depth=1)
trim_16 = TrimTree(Tree=rep_2.Tags, Depth=1)
rep_4 = ModelRepresentation(Validate=validate, Url=item_14.Item, Mime=mime, Lod=rep_3.Lod, Tags=trim_15)  # -> Representation, Valid, Url, Mime, Lod, Tags
rep_5 = ModelRepresentation(Validate=validate, Url=item_14.Item1, Mime=mime, Lod=rep_2.Lod, Tags=trim_16)  # -> Representation, Valid, Url, Mime, Lod, Tags
merge_10 = Merge(
    Data1=rep.Representation,
    Data4=rep_3.Representation,
    Data5=rep_4.Representation,
    Data6=rep_2.Representation,
    Data7=rep_5.Representation)

concat_12 = Concatenate(FragmentA="icons/", FragmentB=concat_3, FragmentC=".svg")
expression_12 = Expression(x=Slider(150, range=70..150), Expression="x/100")
expression_13 = Expression(x=Slider(110, range=70..150), Expression="x/100")
expression_14 = Expression(x=Slider(10, range=3..10), Expression="x/100")
railing_count_front = Integer(Slider(3, range=0..10))
balkony_depth_m = Number(expression_12)
window_frame_m = Number(expression_14)

addition_7 = Addition(A=shellthickness_m, B=window_frame_m)
filter_4 = StreamFilter(Gate=mirror_2, Stream0=item_12.Item3, Stream1=item_12.Item1)
merge_11 = Merge(Data1=shellthickness_m, Data2=addition_7)
filter_5 = StreamFilter(Gate=view_2, Stream0=item_12.Item2, Stream1=filter_4)
neg_3 = Negative(Value=merge_11)
offset = OffsetCurve(Curve=filter_5, Distance=neg_3, Corners=1)
trim_17 = TrimTree(Tree=offset, Depth=1)
simplify = SimplifyCurve(Curve=trim_17)  # -> Curve, Simplified
loft = Loft(Curves=simplify.Curve, Options={Adjust=False, Closed=False, LoftEnds=0, LoftSimp=0, LoftType=0, Rebuild=10, Refit=0.01})
item_15 = ListItem(List=simplify.Curve, Index=0, Wrap=True)  # -> Item, Item1
window_frame_1to200 = Brep(loft)
window_1to200 = Surface(item_15.Item1)
window_1to500 = Brep(item_15.Item)

balkony_height_m = Number(expression_13)
railing_count_side = Integer(Slider(5, range=0..10))

srf = Surface(item_12.Item)
srf_2 = Surface(item_12.Item3)
srf_3 = Surface(item_12.Item2)
srf_4 = Surface(item_12.Item4)
srf_5 = Surface(item_12.Item1)
srf_6 = Surface(item_12.Item5)
mirrored_3 = Boolean(mirror_2)
mirrored_4 = Boolean(mirror_2)
filter_6 = StreamFilter(Gate=mirrored_3, Stream0=srf_5, Stream1=srf_2)
filter_7 = StreamFilter(Gate=mirrored_4, Stream0=srf_2, Stream1=srf_5)
merge_12 = Merge(Data1=srf_5, Data2=srf_2)
merge_13 = Merge(Data1=srf_5, Data2=srf)
merge_14 = Merge(Data1=srf, Data2=srf_3)
merge_15 = Merge(Data1=srf_5, Data2=srf_3)
merge_16 = Merge(Data1=srf_2, Data2=srf_3)
merge_17 = Merge(Data1=srf, Data2=srf_2)
entrance_4 = Integer(entrance_2)
window = Integer(view_2)
filter_8 = StreamFilter(Gate=entrance_4, Stream0=srf, Stream1=filter_6)
filter_9 = StreamFilter(Gate=window, Stream0=srf_3, Stream1=filter_7)
filter_10 = StreamFilter(
    Gate=oldvariant,
    Stream0=merge_12,
    Stream1=merge_12,
    Stream2=merge_15,
    Stream3=merge_16,
    Stream4=merge_17,
    Stream5=merge_13,
    Stream6=merge_14,
    Stream7=merge_14)

expression_15 = Expression(x=Slider(80, range=0..100), Expression="x/100")
expression_16 = Expression(x=Slider(200, range=0..1000), Expression="x/100")
expression_17 = Expression(x=Slider(25, range=0..100), Expression="x/100")
merge_18 = Merge(Data1=filter_8, Data2=filter_9)
panel_9 = Panel("Parallel")  # disabled
door_width_m = Number(expression_15)
door_offset_wall_m = Number(expression_17)
door_height_m = Number(expression_16)

item_16 = ListItem(List=trim_10, Index=0, Wrap=True)  # -> Item, Item1, Item2, Item3
flip = FlipCurve(Curve=item_16.Item)  # -> Curve, Flag
filter_11 = StreamFilter(Gate=mirror_2, Stream0=flip.Curve, Stream1=item_16.Item)
filter_12 = StreamFilter(Gate=mirror_2, Stream0=item_12.Item1, Stream1=item_12.Item3)
filter_13 = StreamFilter(Gate=entrance_2, Stream0=filter_11, Stream1=item_16.Item1)
filter_14 = StreamFilter(Gate=entrance_2, Stream0=item_12.Item, Stream1=filter_12)
addition_8 = Addition(A=door_offset_wall_m, B=shellthickness_m)
eval_2 = EvaluateLength(Curve=filter_13, Length=addition_8, Normalized=False)  # -> Point, Tangent, Parameter
srf_cp = SurfaceClosestPoint(Point=eval_2.Point, Surface=filter_14)  # -> Point, UVPoint, Distance
evalsrf = EvaluateSurface(Surface=filter_14, Point=srf_cp.UVPoint)  # -> Point, Normal, UDirection, VDirection, Frame
neg_4 = Negative(Value=door_width_m)
filter_15 = StreamFilter(Gate=entrance_2, Stream0=neg_4, Stream1=door_width_m)
filter_16 = StreamFilter(Gate=mirror_2, Stream0=filter_15, Stream1=door_width_m)
and_3 = GateAnd(A=entrance_2, B=mirror_2)
filter_17 = StreamFilter(Gate=and_3, Stream0=filter_16, Stream1=neg_4)
rectangle_4 = Rectangle(Plane=evalsrf.Frame, XSize=filter_17, YSize=door_height_m, Radius=0)  # -> Rectangle, Length
Z_2 = UnitZ(Factor=shellthickness_m)
move = Move(Geometry=rectangle_4.Rectangle, Motion=Z_2)  # -> Geometry, Transform
door = Rectangle(move.Geometry)

flip_2 = FlipCurve(Curve=item_16.Item1)  # -> Curve, Flag
expression_18 = Expression(x=height_m_2, Expression="x/2")
filter_18 = StreamFilter(Gate=mirror_2, Stream0=item_16.Item3, Stream1=flip_2.Curve)
addition_9 = Addition(A=window_circle_radius_m, B=window_offset_wall_m, C=shellthickness_m)
Z_3 = UnitZ(Factor=expression_18)
filter_19 = StreamFilter(Gate=mirror_2, Stream0=item_12.Item3, Stream1=item_12.Item1)
eval_3 = EvaluateLength(Curve=filter_18, Length=addition_9, Normalized=False)  # -> Point, Tangent, Parameter
evalsrf_2 = EvaluateSurface(Surface=reparameterize(filter_19), Point="0.5,0.5")  # -> Point, Normal, UDirection, VDirection, Frame
move_2 = Move(Geometry=eval_3.Point, Motion=Z_3)  # -> Geometry, Transform
evalsrf_3 = EvaluateSurface(Surface=reparameterize(item_12.Item2), Point="0.5,0.5")  # -> Point, Normal, UDirection, VDirection, Frame
pl_origin = PlaneOrigin(Base=evalsrf_2.Frame, Origin=move_2.Geometry)
expression_19 = Expression(x=window_circle_radius_m, Expression="x*2")
filter_20 = StreamFilter(Gate=view_2, Stream0=evalsrf_3.Frame, Stream1=pl_origin)
_2d_6 = _2D(x=expression_19)
rectangle_5 = Rectangle(Plane=filter_20, XSize=_2d_6, YSize=_2d_6, Radius=0)  # -> Rectangle, Length
cir = Circle(Plane=filter_20, Radius=window_circle_radius_m)
filter_21 = StreamFilter(Gate=windowshape, Stream0=cir, Stream1=rectangle_5.Rectangle)
window_2 = Geometry(filter_21)
windowplane = Plane(filter_20)

windowplane_2 = Plane(windowplane)
deplane = DeconstructPlane(Plane=windowplane_2)  # -> Origin, XAxis, YAxis, ZAxis
expression_20 = Expression(x=shellthickness_m, Expression="x/3")
neg_5 = Negative(Value=deplane.ZAxis)
amp = Amplitude(Vector=neg_5, Amplitude=expression_20)
extr = Extrude(Base=window_2, Direction=amp)
cap = CapHoles(Brep=extr)

door_2 = Rectangle(door)
explode_4 = Explode(Curve=door, Recursive=True)  # -> Segments, Vertices
trim_18 = TrimTree(Tree=explode_4.Segments, Depth=1)
item_17 = ListItem(List=trim_18, Index=0, Wrap=True)  # -> Item, Item1, Item2, Item3
eval_4 = EvaluateCurve(Curve=reparameterize(item_17.Item), Parameter="0.5")  # -> Point, Tangent, Angle
rev_5 = Reverse(Vector=eval_4.Tangent)
Z_4 = UnitZ(Factor=1)
xprod = CrossProduct(VectorA=eval_4.Tangent, VectorB=Z_4, Unitize=False)  # -> Vector, Length
xprod_2 = CrossProduct(VectorA=rev_5, VectorB=Z_4, Unitize=False)  # -> Vector, Length
pl = ConstructPlane(Origin=eval_4.Point, XAxis=eval_4.Tangent, YAxis=xprod_2.Vector)
doorentranceplane = Plane(pl)

doorentranceplane_2 = Plane(doorentranceplane)
deplane_2 = DeconstructPlane(Plane=doorentranceplane_2)  # -> Origin, XAxis, YAxis, ZAxis
amp_2 = Amplitude(Vector=deplane_2.YAxis, Amplitude=shellthickness_m)
extr_2 = Extrude(Base=door, Direction=amp_2)
move_3 = Move(Geometry=door, Motion=amp_2)  # -> Geometry, Transform
cap_2 = CapHoles(Brep=extr_2)
door_3 = Surface(move_3.Geometry)

por = ModelPort(Validate=validate, Point=eval_4.Point, Direction=xprod.Vector, Locators="entrance")  # -> Port, Valid, Id, Point, Direction, Locators

merge_19 = Merge(Data1=cap_2, Data2=cap)
sdiff = SolidDifference(BrepsA=trim_13, BrepsB=merge_19)
volume1to200 = Brep(sdiff)
porprv = SemioPortPreview(po=por.Port)
merge_20 = Merge(Data1=door, Data2=window_2)
sdiff_2 = SolidDifference(BrepsA=merge_18, BrepsB=merge_20)
m2d_rhino = Make2DRhinoView(Name=panel_9, Clip=True)  # disabled
number_slider_2 = Slider(876, range=0..1000)  # disabled
merge_21 = Merge(Data1=srf_4, Data2=filter_10, Data3=sdiff_2, Data4=srf_6)
view_rectangle = ViewRectangle(view=m2d_rhino)  # disabled
shell = Surface(merge_21)
previewplane = PreviewPlane(plane=view_rectangle, axis_length=number_slider_2)  # disabled
construction_area_factor = Number(Slider(0.2, range=0..1))
construction_cost_eff_m² = Number(Slider(9500, range=0..20000))
income_month_eff_m² = Number(Slider(125, range=0..200))
maintenance_expenses_month_eff_m² = Number(Slider(10, range=0..30))
heating_energy_demand_kwh_m²a = Number(Slider(45, range=0..200))
cooling_energy_demand_kwh_m²a = Number(Slider(30, range=0..200))
technical_equipment_energy_demand_kwh_m² = Number(Slider(30, range=0..200))  # "Technical Equipment Energy Demand[kWh/m²a]"
construction_global_warming_potential_kg = Number(Slider(1000, range=0..2000))  # "Construction Global Warming Potential [kgCO2e/eff. m²]"

addition_10 = Addition(A=room_length_m, B=balkony_depth_m)
addition_11 = Addition(A=balkony_depth_m, B=room_width_m)
construction_area_factor_2 = Number(construction_area_factor)
maintenance_expenses_month_eff_m²_2 = Number(maintenance_expenses_month_eff_m²)
# Outputs   ->
#                 |
#                 v
construction_global_warming_potential_kg_2 = Number(construction_global_warming_potential_kg)  # "Construction Global Warming Potential [kgCO2e/eff. m²]"
filter_22 = StreamFilter(Gate=view_2, Stream0=room_width_m, Stream1=addition_11)
technical_equipment_energy_demand_kwh_m²_2 = Number(technical_equipment_energy_demand_kwh_m²)  # "Technical Equipment Energy Demand[kWh/m²a]"
income_month_eff_m²_2 = Number(income_month_eff_m²)
expression_21 = Expression(x=construction_area_factor_2, Expression="1-x")
heating_energy_demand_kwh_m²a_2 = Number(heating_energy_demand_kwh_m²a)
cooling_energy_demand_kwh_m²a_2 = Number(cooling_energy_demand_kwh_m²a)
construction_cost_eff_m²_2 = Number(construction_cost_eff_m²)
multiplication_3 = Multiplication(A=area_2.Area, B=expression_21)
multiplication_4 = Multiplication(A=multiplication_3, B=income_month_eff_m²_2)
multiplication_5 = Multiplication(A=multiplication_3, B=maintenance_expenses_month_eff_m²_2)
expression_22 = Expression(x=multiplication_4, Expression="x*12")
expression_23 = Expression(x=multiplication_5, Expression="x*12")
multiplication_6 = Multiplication(A=multiplication_3, B=construction_global_warming_potential_kg_2)
multiplication_7 = Multiplication(A=heating_energy_demand_kwh_m²a_2, B=multiplication_3)
multiplication_8 = Multiplication(A=cooling_energy_demand_kwh_m²a_2, B=multiplication_3)
multiplication_9 = Multiplication(A=multiplication_3, B=construction_cost_eff_m²_2)
multiplication_10 = Multiplication(A=technical_equipment_energy_demand_kwh_m²_2, B=multiplication_3)
round = Round(Number=multiplication_9)  # -> Nearest, Floor, Ceiling
roundmult = RoundToMultiple(N=multiplication_6, M="0.01")  # -> R; inputs N: tree, M: tree
# ---------- roundmult: Python ----------
#Component Information
#--------------------------------------------------------------------------------------------
if ghenv.Component.RunCount<2:
    #General
    #--------------------------------------------------------------------------------------------
    __author__ = "YOUR NAME"
    __version__ = "2000.00.00"
    
    ghenv.Component.Name = "Round to Multiple"
    ghenv.Component.NickName = "RoundMult"
    ghenv.Component.Description = "Rounds a number to the nearest specified multiple."
    ghenv.Component.Message = "VER 1.0"
    ghenv.Component.Category = "Math"
    ghenv.Component.SubCategory = "Arithmetic"
    
     #Inputs
    #--------------------------------------------------------------------------------------------
    inputIndex=0
    
    ghenv.Component.Params.Input[inputIndex].Name = "Number"
    ghenv.Component.Params.Input[inputIndex].NickName = "N"
    ghenv.Component.Params.Input[inputIndex].Description = "Number to round."
    ghenv.Component.Params.Input[inputIndex].Optional = False
    inputIndex+=1
    
    ghenv.Component.Params.Input[inputIndex].Name = "Multiple"
    ghenv.Component.Params.Input[inputIndex].NickName = "M"
    ghenv.Component.Params.Input[inputIndex].Description = "Multiple to round to."
    ghenv.Component.Params.Input[inputIndex].Optional = False
    inputIndex+=1
    
    #Outputs
    #--------------------------------------------------------------------------------------------
    outputIndex=0
    
    ghenv.Component.Params.Output[outputIndex].Name = "Rounded"
    ghenv.Component.Params.Output[outputIndex].NickName = "R"
    ghenv.Component.Params.Output[outputIndex].Description = "Number rounded to the nearest specified multiple."
    outputIndex+=1


#Imports
#--------------------------------------------------------------------------------------------
from System import Object
from Grasshopper import DataTree
import math


#The Component function - Business logic only (e.g. working without trees)
#--------------------------------------------------------------------------------------------
"""Function that this component is computing.
    Inputs:
        number: The number to round.
        multiple: The multiple to round to.
    Output:
        rounded: The number rounded to the nearest specified multiple."""
def RoundToMultiple(number, multiple):
    rounded = math.ceil(number / multiple) * multiple
    return rounded

#Solver - Run with trees to enhance performance drastically
#--------------------------------------------------------------------------------------------
if __name__ == "__main__":
    
    #Initialize trees
    #--------------------------------------------------------------------------------------------
    RoundedTree = DataTree[Object]()
    
    #Data matching
    #--------------------------------------------------------------------------------------------
    for path in N.Paths:
        numberBranch = N.Branch(path)
        for i, number in enumerate(numberBranch):
            multiple = M.Branch(path)[i]
            rounded = RoundToMultiple(number, multiple)
            RoundedTree.Add(rounded, path)
    
     #Assign trees to output
    #--------------------------------------------------------------------------------------------
    R = RoundedTree
# ---------- end roundmult ----------
round_2 = Round(Number=multiplication_7)  # -> Nearest, Floor, Ceiling
round_3 = Round(Number=multiplication_8)  # -> Nearest, Floor, Ceiling
round_4 = Round(Number=multiplication_10)  # -> Nearest, Floor, Ceiling
round_5 = Round(Number=expression_22)  # -> Nearest, Floor, Ceiling
round_6 = Round(Number=expression_23)  # -> Nearest, Floor, Ceiling
panel_10 = Panel("""https://search.bsdd.buildingsmart.org/uri/buildingsmart/ifc/4.3/prop/Length
https://search.bsdd.buildingsmart.org/uri/buildingsmart/ifc/4.3/prop/Width
https://search.bsdd.buildingsmart.org/uri/buildingsmart/ifc/4.3/prop/Height

https://identifier.buildingsmart.org/uri/buildingsmart/ifc/4.3/prop/NetFloorArea

https://identifier.buildingsmart.org/uri/buildingsmart/ifc/4.3/prop/EnergyConsumption
https://identifier.buildingsmart.org/uri/buildingsmart/ifc/4.3/prop/EnergyConsumption
https://identifier.buildingsmart.org/uri/buildingsmart/ifc/4.3/prop/EnergyConsumption


https://identifier.buildingsmart.org/uri/etim/etim/9.0/prop/EF016979 """)
panel_11 = Panel("""entrance
view
length
width
heigth
window shape
effective floor area
construction cost
heating energy demand
cooling energy demand
technical equipment energy demand
income
maintenance expenses
construction global warming potential""")
panel_12 = Panel("""m
m
m

m²
€
kWh/a
kWh/a
kWh/a
€/a
€/a
kgCO2e""")
filter_23 = StreamFilter(Gate=mirror, Stream1="mirrored")

filter_24 = StreamFilter(Gate=view_2, Stream0=addition_10, Stream1=room_length_m)

expression_24 = Expression(x=room_length_m, Expression="x/2")
expression_25 = Expression(x=room_width_m, Expression="x/2")
expression_26 = Expression(x=height_m_2, Expression="x/2")
expression_27 = Expression(x=shellthickness_m, Expression="x/2")
filter_25 = StreamFilter(Gate=view_2, Stream0=expression_25, Stream1=expression_24)
filter_26 = StreamFilter(Gate=view_2, Stream0=evalsrf_3.Frame, Stream1=evalsrf_2.Frame)
expression_28 = Expression(x=balkony_depth_m, Expression="x/2")
addition_12 = Addition(A=expression_28, B=expression_27)
deplane_3 = DeconstructPlane(Plane=filter_26)  # -> Origin, XAxis, YAxis, ZAxis
box_2 = CenterBox(Base=filter_26, X=filter_25, Y=expression_26, Z=expression_28)
box_3 = CenterBox(Base=filter_26, X=filter_25, Y=expression_26, Z=addition_12)
amp_3 = Amplitude(Vector=deplane_3.ZAxis, Amplitude=addition_12)
amp_4 = Amplitude(Vector=deplane_3.ZAxis, Amplitude=expression_28)
amp_5 = Amplitude(Vector=deplane_3.ZAxis, Amplitude=expression_28)
move_4 = Move(Geometry=box_3, Motion=amp_3)  # -> Geometry, Transform
move_5 = Move(Geometry=box_2, Motion=amp_4)  # -> Geometry, Transform
debrep_2 = DeconstructBrep(Brep=move_5.Geometry)  # -> Faces, Edges, Vertices
trim_19 = TrimTree(Tree=debrep_2.Vertices, Depth=1)
item_18 = ListItem(List=trim_19, Index=0, Wrap=True)  # -> Item, Item1, Item2, Item3, Item4, Item5

merge_22 = Merge(Data1=volume1to500, Data2=move_4.Geometry)
sunion = SolidUnion(Breps=merge_22)
neg_6 = Negative(Value=shellthickness_m)
offsetbox = OffsetBox(box=sunion, length=neg_6)

neg_7 = Negative(Value=shellthickness_m)
expression_29 = Expression(x=fillet_radius_m, Expression="x/2")
neg_8 = Negative(Value=expression_29)

addition_13 = Addition(A=shellthickness_m, B=balkony_height_m, C=expression_29)

subtraction_2 = Subtraction(A=height_m_2, B=addition_13)
expression_30 = Expression(x=addition_13, Expression="x/2")
expression_31 = Expression(x=subtraction_2, Expression="x/2")
box_4 = CenterBox(Base=filter_26, X=filter_25, Y=expression_30, Z=expression_28)
amp_6 = Amplitude(Vector=deplane_3.YAxis, Amplitude=expression_31)
rev_6 = Reverse(Vector=amp_6)
move_6 = Move(Geometry=box_4, Motion=amp_5)  # -> Geometry, Transform
move_7 = Move(Geometry=move_6.Geometry, Motion=rev_6)  # -> Geometry, Transform
debrep_3 = DeconstructBrep(Brep=move_7.Geometry)  # -> Faces, Edges, Vertices
trim_20 = TrimTree(Tree=debrep_3.Vertices, Depth=1)
item_19 = ListItem(List=trim_20, Index=0, Wrap=True)  # -> Item2, Item1, Item
merge_23 = Merge(Data1=item_18.Item, Data2=item_18.Item3, Data3=item_19.Item1, Data4=item_18.Item4)
merge_24 = Merge(Data1=item_18.Item1, Data2=item_18.Item2, Data3=item_19.Item2, Data4=item_18.Item5)
pline = PolyLine(Vertices=merge_23, Closed=invert(False))
pline_2 = PolyLine(Vertices=merge_24, Closed=invert(False))
rulesrf = RuledSurface(CurveA=pline_2, CurveB=pline)
cap_3 = CapHoles(Brep=rulesrf)

merge_25 = Merge(Data1=cap_3, Data2=volume1to500)
sunion_2 = SolidUnion(Breps=merge_25)
fmerge = MergeFaces(Brep=sunion_2)  # -> Breps, Before, After
sdiff_3 = SolidDifference(BrepsA=fmerge.Breps, BrepsB=offsetbox)
sdiff_4 = SolidDifference(BrepsA=sdiff_3, BrepsB=cap_2)
shell_1to500 = Geometry(sdiff_4)

debrep_4 = DeconstructBrep(Brep=fmerge.Breps)  # -> Faces, Edges, Vertices
trim_21 = TrimTree(Tree=debrep_4.Edges, Depth=1)
lng_2 = ListLength(List=trim_21)
series_2 = Series(Start=0, Step=1, Count=lng_2)
trim_22 = TrimTree(Tree=series_2, Depth=1)
filedge_2 = FilletEdge(Shape=fmerge.Breps, Blend=0, Metric=0, Edges=trim_22, Radii=fillet_radius_m)
sdiff_5 = SolidDifference(BrepsA=filedge_2, BrepsB=offsetbox)
sdiff_6 = SolidDifference(BrepsA=sdiff_5, BrepsB=cap_2)
shell_1to200 = Geometry(sdiff_6)

extendbox = ExtendBox(boxe=move_7.Geometry, length=shellthickness_m, dimension="1")
extendbox_2 = ExtendBox(boxe=extendbox, length=shellthickness_m, dimension="2")
offsetbox_2 = OffsetBox(box=extendbox_2, length=neg_7)
extendbox_3 = ExtendBox(boxe=offsetbox_2, length=neg_8, dimension="1")
debrep_5 = DeconstructBrep(Brep=extendbox_3)  # -> Faces, Edges, Vertices
trim_23 = TrimTree(Tree=debrep_5.Faces, Depth=1)
item_20 = ListItem(List=trim_23, Index=0, Wrap=True)  # -> Item1, Item
railing_1to500 = Surface(item_20.Item1)

edges = BrepEdges(Brep=railing_1to500)  # -> Naked, Interior, NonManifold
trim_24 = TrimTree(Tree=edges.Naked, Depth=1)
filter_27 = StreamFilter(Gate=view_2, Stream0=railing_count_front, Stream1=railing_count_side)
item_21 = ListItem(List=trim_24, Index=0, Wrap=True)  # -> Item, Item1
divide = DivideCurve(Curve=item_21.Item, Count=filter_27, Kinks=False)  # -> Points, Tangents, Parameters
len = Length(Curve=item_21.Item1)
len_2 = Length(Curve=item_21.Item)
trim_25 = TrimTree(Tree=divide.Points, Depth=1)
Z_5 = UnitZ(Factor=1)
line = LineSDL(Start=trim_25, Direction=Z_5, Length=len)
srfsplit = SurfaceSplit(Surface=railing_1to500, Curves=line)
trim_26 = TrimTree(Tree=srfsplit, Depth=1)
railing_1to200 = Surface(trim_26)

mrg_a = MergeSeperatlyAppend(x=shell_1to500, u=door_3, y=window_1to500, z=railing_1to500)  # -> Mrgd; inputs x: tree, u: tree, y: tree, z: tree
# ---------- mrg_a: Python ----------
if ghenv.Component.RunCount<2:
    __author__ = "Ueli Saluz"
    __version__ = "2020.05.28"
    
    ghenv.Component.Name = "MergeSeperatly(Append)"
    ghenv.Component.NickName = "Mrg(A)"
    ghenv.Component.Description = "Merge inputs seperatly on a new path. Append index of input parameter for distincting."
    ghenv.Component.Message = "VER 1.0"

from System import Object
from Grasshopper import DataTree
from Grasshopper.Kernel import GH_ParamAccess as Access

if __name__ == "__main__":
    Mrgd = DataTree[Object]()
    access = Access()
    
    for input in ghenv.Component.Params.Input:  #set all Inputaccess to Tree Access
        input.Access = access.tree
    
    for i,input in enumerate(ghenv.Component.Params.Input):
        for j,source in enumerate(input.Sources):
            for path in source.VolatileData.Paths:
                Mrgd.AddRange(source.VolatileData[path],path.AppendElement(i))
# ---------- end mrg_a ----------
mrg_a_2 = MergeSeperatlyAppend(x=shell_1to200, u=door_3, y=window_frame_1to200, z=window_1to200, v=railing_1to200)  # -> Mrgd; inputs x: tree, u: tree, y: tree, z: tree, v: tree; same code as mrg_a
geometry_1to500 = Geometry(mrg_a)
geometry_1to200 = Geometry(mrg_a_2)

bbox = BoundingBox(Content=flatten(geometry_1to200), Plane=PlaneXY(0, 0, 0), UnionBox=True)  # -> Box, Box_2
zoom2bb = ZoomToBoundingBox(N=["Top", "Front", "Right", "Perspective", "Parallel"], BB=bbox.Box, S=0, R=zoom)  # -> F, SBB; inputs BB: Box, R: Boolean
# ---------- zoom2bb: Python ----------
#Component Information
#--------------------------------------------------------------------------------------------
if ghenv.Component.RunCount<2:
    #General
    #--------------------------------------------------------------------------------------------
    __author__ = "Ueli Saluz"
    __version__ = "2022.05.21"
    
    ghenv.Component.Name = "ZoomToBoundingBox"
    ghenv.Component.NickName = "Zoom2BB"
    ghenv.Component.Description = "Zoom the view of a Rhino viewport to a bounding box."
    ghenv.Component.Message = "VER 1.1"
    ghenv.Component.Category = "Display"
    ghenv.Component.SubCategory = "Camera"
    
     #Inputs
    #--------------------------------------------------------------------------------------------
    inputIndex=0
    
    ghenv.Component.Params.Input[inputIndex].Name = "Name"
    ghenv.Component.Params.Input[inputIndex].NickName = "N"
    ghenv.Component.Params.Input[inputIndex].Description = "Name of the viewport"
    ghenv.Component.Params.Input[inputIndex].Optional = False
    inputIndex+=1
    
    ghenv.Component.Params.Input[inputIndex].Name = "BoundingBox"
    ghenv.Component.Params.Input[inputIndex].NickName = "BB"
    ghenv.Component.Params.Input[inputIndex].Description = ""
    ghenv.Component.Params.Input[inputIndex].Optional = False
    inputIndex+=1
    
    ghenv.Component.Params.Input[inputIndex].Name = "ScaleFactor"
    ghenv.Component.Params.Input[inputIndex].NickName = "S"
    ghenv.Component.Params.Input[inputIndex].Description = "A factor for the extension of the bounding box." \
    +"0 means 0 extension, a positive number makes the bounding box larger a negative smaller. The amount is proportional to the length."
    ghenv.Component.Params.Input[inputIndex].Optional = False
    inputIndex+=1
   
    
    ghenv.Component.Params.Input[inputIndex].Name = "Run"
    ghenv.Component.Params.Input[inputIndex].NickName = "R"
    ghenv.Component.Params.Input[inputIndex].Description = "Zoom to the given bounding box."
    ghenv.Component.Params.Input[inputIndex].Optional = False
    inputIndex+=1
    
    #Outputs
    #--------------------------------------------------------------------------------------------
    outputIndex=0
    
    ghenv.Component.Params.Output[outputIndex].Name = "Finished"
    ghenv.Component.Params.Output[outputIndex].NickName = "F"
    ghenv.Component.Params.Output[outputIndex].Description = "Sends True when finished. Just to trigger other depending components."
    outputIndex+=1
    
    ghenv.Component.Params.Output[outputIndex].Name = "ScaledBoundingBox"
    ghenv.Component.Params.Output[outputIndex].NickName = "SBB"
    ghenv.Component.Params.Output[outputIndex].Description = "The scaled bounding box."
    outputIndex+=1


#Imports
#--------------------------------------------------------------------------------------------
from Rhino import RhinoDoc
from Rhino.Geometry import Box

#Solver - Run with trees to enhance performance drastically
#--------------------------------------------------------------------------------------------
if __name__ == "__main__":
    try:
        vp = RhinoDoc.ActiveDoc.Views.Find(N, False).ActiveViewport
        if R:
            box = BB
            bb = BB.BoundingBox
            bb.Inflate(S*box.X.Length,S*box.Y.Length,S*box.Z.Length)
            vp.ZoomBoundingBox(bb)
            SBB = bb
        F = True
    except:
        pass
# ---------- end zoom2bb ----------
geoprv = SemioGeometryPreview(geo=geometry_1to200)

door_4 = Surface(door_3)
railing_1to500_2 = Surface(railing_1to500)
shell_1to200_2 = Geometry(shell_1to200)
window_1to200_2 = Surface(window_1to200)
window_frame_1to200_2 = Brep(window_frame_1to200)
window_1to500_2 = Brep(window_1to500)
railing_1to200_2 = Surface(railing_1to200)
shell_1to500_2 = Geometry(shell_1to500)
concat_13 = Concatenate(FragmentA=curdir.P, FragmentB=curdir.S, FragmentC=concat_10)
concat_14 = Concatenate(FragmentA=curdir.P, FragmentB=curdir.S, FragmentC=concat_11)
expression_32 = Expression(x="window", y=window_1to200_2, Expression="x")
expression_33 = Expression(x="shell", y=shell_1to500_2, Expression="x")
expression_34 = Expression(x="shell", y=shell_1to200_2, Expression="x")
expression_35 = Expression(x="door", y=door_4, Expression="x")
expression_36 = Expression(x="window::frame", y=window_frame_1to200_2, Expression="x")
expression_37 = Expression(x="door", y=door_4, Expression="x")
expression_38 = Expression(x="window", y=window_1to500_2, Expression="x")
expression_39 = Expression(x="railing", y=railing_1to200_2, Expression="x")
expression_40 = Expression(x="railing", y=railing_1to500_2, Expression="x")
merge_26 = Merge(Data1=expression_33, Data2=expression_37, Data3=expression_38, Data4=expression_40)
merge_27 = Merge(Data1=shell_1to500_2, Data2=door_4, Data3=window_1to500_2, Data4=railing_1to500_2)
merge_28 = Merge(Data1=shell_1to200_2, Data2=door_4, Data3=window_1to200_2, Data4=window_frame_1to200_2, Data5=railing_1to200_2)
merge_29 = Merge(Data1=expression_34, Data2=expression_35, Data3=expression_32, Data4=expression_36, Data5=expression_39)
blc = ExportBlock(path=concat_13, name=concat_4, url=concat_10, geo=merge_27, layer_name=merge_26, export=and)  # -> block_definition_3, path_4, exported_2
blc_2 = ExportBlock(path=concat_14, name=concat_5, url=concat_11, geo=merge_28, layer_name=merge_29, export=and)  # -> block_definition_3, path_4, exported_2

rec = Rectangle({Plane=Plane(origin=(15.60693884, 14.69292436, 15.6245417), x=(0.7071067812, -0.7071067812, 0), y=(-0.4082482905, -0.4082482905, 0.8164965809)), Size=Domain2(u=-24.40970167..24.40970167, v=-18.06498235..18.06498235)})
m2d_parallel = Make2DParallelView(Projection=rec)
make2d = Make2D(Geometry=flatten(geometry_1to200), View=m2d_parallel, TangentEdges="T", TangentSeams=False, AutoComputeMake2D=True)  # -> VisibleCurves, VisibleIndex, VisibleType, HiddenCurves, HiddenIndex, HiddenType
trim_27 = TrimTree(Tree=make2d.VisibleCurves, Depth=1)
trim_28 = TrimTree(Tree=make2d.HiddenCurves, Depth=1)
hidden = Curve(trim_28)
visible = Curve(trim_27)

expression_41 = Expression(x="visible", y=visible, Expression="x")
expression_42 = Expression(x="hidden", y=hidden, Expression="x")
merge_30 = Merge(Data1=visible, Data2=hidden)
merge_31 = Merge(Data1=expression_41, Data2=expression_42)
concat_15 = Concatenate(FragmentA=concat_3, FragmentB="_", FragmentC="icon")
concat_16 = Concatenate(FragmentC="icons", FragmentD=curdir.S, FragmentA=concat_3)
concat_17 = Concatenate(FragmentA=concat_16, FragmentB=".3dm")
concat_18 = Concatenate(FragmentA=curdir.P, FragmentB=curdir.S, FragmentC=concat_17)
blc_3 = ExportBlock(path=concat_18, name=concat_15, url=concat_17, geo=merge_30, layer_name=merge_31, export=and_2)  # -> block_definition_3, path_4, exported_2

area_3 = Area(Geometry=item_20.Item)  # -> Area, Centroid

expression_43 = Expression(x=area_3.Area, Expression="x/2")
addition_14 = Addition(A=expression_43, B=multiplication_3)

roundmult_2 = RoundToMultiple(N=addition_14, M="0.01")  # -> R; inputs N: tree, M: tree; same code as roundmult
merge_32 = Merge(
    Data1=entrance,
    Data2=view,
    Data3=filter_24,
    Data4=filter_22,
    Data5=height_m_2,
    Data6=window_shape,
    Data7=roundmult_2,
    Data8=round.Nearest,
    Data9=round_2.Nearest,
    Data10=round_3.Nearest,
    Data11=round_4.Nearest,
    Data12=round_5.Nearest,
    Data13=round_6.Nearest,
    Data14=roundmult)
panel_13 = Panel(merge_32)

qal = ModelQuality(Validate=validate, Name=panel_11, Value=panel_13, Unit=panel_12, Definition=panel_10)  # -> Quality, Valid, Name, Value, Unit, Definition

merge_33 = Merge(Data1=qal.Quality, Data2=filter_23)

typ = ModelType(
    Validate=validate,
    Name="Capsule with Balcony",
    Description=concat,
    Icon=concat_12,
    Variant=item,
    Representations=merge_10,
    Ports=por.Port,
    Qualities=merge_33)  # -> Type, Valid, Name, Description, Icon, Variant, Unit, Representations, Ports, Qualities

typ_2 = SerializeType(Type=typ.Type)
txt = EncodeText(Text=typ_2)
type = Text(txt)
context_bake = ContextBake(Geometry=type)
typ_3 = PutType(Type=typ.Type, Uri=curdir.P, Run=save)

# ==== cluster _2D
x = ClusterInput()
expression = Expression(x=x, Expression="x/2")
neg = Negative(Value=expression)
dom = ConstructDomain(DomainStart=neg, DomainEnd=expression)
I = ClusterOutput(dom)

# ==== cluster ValueOr0
value = ClusterInput()
value_2 = Number(value)
null = NullItem(Item=value_2)  # -> NullFlags, InvalidFlags, Description
filter = StreamFilter(Gate=null.NullFlags, Stream0=value_2, Stream1="0")
valueor0 = Number(filter)
valueor0_2 = ClusterOutput(valueor0)

# ==== cluster PreviewPlane: Preview a plane with axis colors and naming.
axis_length = ClusterInput()
plane = ClusterInput()
axis_length_2 = Number(axis_length)
plane_2 = Plane(plane)
deplane = DeconstructPlane(Plane=plane_2)  # -> Origin, XAxis, YAxis, ZAxis
line = LineSDL(Start=deplane.Origin, Direction=deplane.YAxis, Length=axis_length_2)
line_2 = LineSDL(Start=deplane.Origin, Direction=deplane.XAxis, Length=axis_length_2)
line_3 = LineSDL(Start=deplane.Origin, Direction=deplane.ZAxis, Length=axis_length_2)
swatch = ColourSwatch(SwatchColor=RGB(235, 52, 79))
swatch_2 = ColourSwatch(SwatchColor=RGB(0, 166, 157))
swatch_3 = ColourSwatch(SwatchColor=RGB(240, 117, 24))
end = EndPoints(Curve=line_2)  # -> Start, End
end_2 = EndPoints(Curve=line)  # -> Start, End
end_3 = EndPoints(Curve=line_3)  # -> Start, End
tag = TextTag(Location=end.End, Text="X", Colour=swatch)
tag_2 = TextTag(Location=end_2.End, Text="Y", Colour=swatch_2)
tag_3 = TextTag(Location=end_3.End, Text="Z", Colour=swatch_3)
preview = CustomPreview(Geometry=line_2, Material=swatch)
preview_2 = CustomPreview(Geometry=line, Material=swatch_2)
preview_3 = CustomPreview(Geometry=line_3, Material=swatch_3)

# ==== cluster ViewRectangle
view = ClusterInput()
view_2 = Data(view)
nickname = NAME(view=view_2)  # -> c, x, y, z, h, w
# ---------- nickname: Python ----------
uselss, c, x, y, z = view.GetCameraFrame()
h = view.FrustumHeight
w = view.FrustumWidth
# ---------- end nickname ----------
rev = Reverse(Vector=nickname.x)
rev_2 = Reverse(Vector=nickname.y)
pl = ConstructPlane(Origin=nickname.c, XAxis=rev, YAxis=nickname.y)
_2d = _2D(x=nickname.w)
_2d_2 = _2D(x=nickname.h)
rectangle = Rectangle(Plane=pl, XSize=_2d, YSize=_2d_2, Radius=0)  # -> Rectangle, Length
rec = Rectangle(rectangle.Rectangle)
rec_2 = ClusterOutput(rec)

# ==== cluster ExportBlock: Export geometry with layer names to a file.
path = ClusterInput()
name = ClusterInput()
url = ClusterInput()
geo = ClusterInput()
layer_name = ClusterInput()
export = ClusterInput()
path_2 = FilePath(path)
name_2 = Text(name)
url_2 = Text(url)
geo_2 = Geometry(geo)
layer_name_2 = Text(layer_name)
export_2 = Boolean(export)
layer = ModelLayer(Name=layer_name_2)  # -> Layer, Name, Hidden, Locked, DisplayColour, Material, Linetype
object = ModelObject(Geometry=geo_2, Layer=layer.Layer)  # -> Object, Geometry, Name, Layer, Visibility, Display, Drafting, Render
block_definition = ModelBlockDefinition(Objects=object.Object, Name=name_2, URL=url_2)  # -> BlockDefinition, Objects, Units, Name, Notes, URL, URLDescription
export_definition = ExportModelBlockDefinition(BlockDefinition=block_definition.BlockDefinition, FilePath=path_2, Overwrite="T", Export=export_2)  # -> BlockDefinition, FilePath, Exported
block_definition_2 = ModelBlockDefinition(export_definition.BlockDefinition)
path_3 = FilePath(export_definition.FilePath)
exported = Boolean(export_definition.Exported)
path_4 = ClusterOutput(path_3)
exported_2 = ClusterOutput(exported)
block_definition_3 = ClusterOutput(block_definition_2)

# ==== cluster SemioGeometryPreview: semio styled preview of geometry.
geo = ClusterInput()
geo_2 = Geometry(flatten(geo))
debrep = DeconstructBrep(Brep=geo_2)  # -> Faces, Edges, Vertices
preview = CustomPreview(Geometry=flatten(debrep.Edges), Material=ColourSwatch(SwatchColor=RGB(0, 0, 0)))
preview_2 = CustomPreview(Geometry=geo_2, Material=ColourSwatch(SwatchColor=RGB(255, 255, 255)))

# ==== cluster SemioPortPreview: semio styled preview of ports.
po = ClusterInput()
po_2 = Port(po)
por = ModelPort(Port=po_2)  # -> Port, Valid, Id, Point, Direction, Locators
vdisex = VectorDisplayEx(Point=por.Point, Vector=por.Direction, Colour=ColourSwatch(SwatchColor=RGB(0, 166, 157)), Width=2)
preview = CustomPreview(Geometry=por.Point, Material=ColourSwatch(SwatchColor=RGB(235, 52, 79)))
tag = TextTag(Location=por.Point, Text=por.Id, Colour=ColourSwatch(SwatchColor=RGB(250, 149, 0)))

# ==== cluster OffsetBox: Offset a box by a certain length.
length = ClusterInput()
box = ClusterInput()
length_2 = Number(length)
box_2 = Box(box)
debox = DeconstructBox(Box=box_2)  # -> Plane, X, Y, Z
cluster = D(I=debox.X, length=length_2)
cluster_2 = D(I=debox.Y, length=length_2)
cluster_3 = D(I=debox.Z, length=length_2)
box_3 = DomainBox(Base=debox.Plane, X=cluster, Y=cluster_2, Z=cluster_3)
adjust_box = Box(box_3)
adjust_box_2 = ClusterOutput(adjust_box)

# ==== cluster ExtendBox: Extend (or trim) a box by a certain length in a certain dimension
length = ClusterInput()
dimension = ClusterInput()
boxe = ClusterInput()
dimension_2 = Integer(dimension)
length_2 = Number(length)
boxe_2 = Box(boxe)
debox = DeconstructBox(Box=boxe_2)  # -> Plane, X, Y, Z
filter = StreamFilter(Gate=dimension_2, Stream0=debox.X, Stream1=debox.Y, Stream2=debox.Z)
domprop = DomainProperties(I=filter, In=True)  # -> L, M, T0, T1; inputs I: tree, In: tree of Boolean; same code as domprop
addition = Addition(A=domprop.T1, B=length_2)
dom = ConstructDomain(DomainStart=domprop.T0, DomainEnd=addition)
gate = StreamGate(Stream=dom, Gate=dimension_2)  # -> Target0, Target1, Target2
filter_2 = StreamFilter(Gate=dimension_2, Stream0=debox.Y, Stream1=gate.Target1, Stream2=debox.Y)
filter_3 = StreamFilter(Gate=dimension_2, Stream0=debox.Z, Stream1=debox.Z, Stream2=gate.Target2)
filter_4 = StreamFilter(Gate=dimension_2, Stream0=gate.Target0, Stream1=debox.X, Stream2=debox.X)
box = DomainBox(Base=debox.Plane, X=filter_4, Y=filter_2, Z=filter_3)
adjusted_boxes = Box(box)
adjusted_boxes_2 = ClusterOutput(adjusted_boxes)

# ==== cluster D
length = ClusterInput()
I = ClusterInput()
length_2 = Number(length)
domprop = DomainProperties(I=I, In=True)  # -> L, M, T0, T1; inputs I: tree, In: tree of Boolean
# ---------- domprop: Python ----------
#Component Information
#--------------------------------------------------------------------------------------------
if ghenv.Component.RunCount<2:
    #General
    #--------------------------------------------------------------------------------------------
    __author__ = "Ueli Saluz"
    __version__ = "2021.11.22"
    
    ghenv.Component.Name = "DomainProperties"
    ghenv.Component.NickName = "DomProp"
    ghenv.Component.Description = "Returns some properties of a domain"
    ghenv.Component.Message = "VER 1.0"
    ghenv.Component.Category = "Maths"
    ghenv.Component.SubCategory = "Domain"
    
     #Inputs
    #--------------------------------------------------------------------------------------------
    inputIndex=0
    
    ghenv.Component.Params.Input[inputIndex].Name = "Domain"
    ghenv.Component.Params.Input[inputIndex].NickName = "I"
    ghenv.Component.Params.Input[inputIndex].Description = "Domain to evaluate"
    ghenv.Component.Params.Input[inputIndex].Optional = False
    inputIndex+=1
    
    ghenv.Component.Params.Input[inputIndex].Name = "MakeIncreasing"
    ghenv.Component.Params.Input[inputIndex].NickName = "In"
    ghenv.Component.Params.Input[inputIndex].Description = "Makes sure that the domain is increasing. If not it gets swapped."
    ghenv.Component.Params.Input[inputIndex].Optional = False
    inputIndex+=1
    
    #Outputs
    #--------------------------------------------------------------------------------------------
    outputIndex=0
    
    ghenv.Component.Params.Output[outputIndex].Name = "Length"
    ghenv.Component.Params.Output[outputIndex].NickName = "L"
    ghenv.Component.Params.Output[outputIndex].Description = "Length of the domain"
    outputIndex+=1
    
    ghenv.Component.Params.Output[outputIndex].Name = "Mid"
    ghenv.Component.Params.Output[outputIndex].NickName = "M"
    ghenv.Component.Params.Output[outputIndex].Description = "Middle of the of the domain"
    outputIndex+=1
    
    ghenv.Component.Params.Output[outputIndex].Name = "DomainStartParameter"
    ghenv.Component.Params.Output[outputIndex].NickName = "T0"
    ghenv.Component.Params.Output[outputIndex].Description = "Start parameter. Doens't have to be smaller than the end parameter."
    outputIndex+=1
    
    ghenv.Component.Params.Output[outputIndex].Name = "DomainEndParameter"
    ghenv.Component.Params.Output[outputIndex].NickName = "T1"
    ghenv.Component.Params.Output[outputIndex].Description = "End parameter. Doens't have to be bigger than the start parameter."
    outputIndex+=1
    


#Imports
#--------------------------------------------------------------------------------------------
from System import Object
from Grasshopper import DataTree

#Solver - Run with trees to enhance performance drastically
#--------------------------------------------------------------------------------------------
if __name__ == "__main__":
    
    #Initialize trees
    #--------------------------------------------------------------------------------------------
    LengthTree = DataTree[Object]()
    MidTree = DataTree[Object]()
    DomainStartParameterTree = DataTree[Object]()
    DomainEndParameterTree = DataTree[Object]()
    LengthTree = DataTree[Object]()
    
    #Data matching
    #--------------------------------------------------------------------------------------------
    for path in I.Paths:
        domainBranch = I.Branch(path)
        for i,domain in enumerate(domainBranch):
            if In==True:
                domain.MakeIncreasing()
            LengthTree.Add(domain.Length, path)
            MidTree.Add(domain.Mid, path)
            DomainStartParameterTree.Add(domain.T0, path)
            DomainEndParameterTree.Add(domain.T1, path)
    
     #Assign trees to output
    #--------------------------------------------------------------------------------------------
    L = LengthTree
    M = MidTree
    T0 = DomainStartParameterTree
    T1 = DomainEndParameterTree
# ---------- end domprop ----------
addition = Addition(A=domprop.T1, B=length_2)
subtraction = Subtraction(A=domprop.T0, B=length_2)
dom = ConstructDomain(DomainStart=subtraction, DomainEnd=addition)
I_2 = ClusterOutput(dom)
