# Grasshopper definition base.gh (Grasshopper 1.0.7)
# plug-ins: Semio, MetaHopper, Pufferfish

image_resource = ImageResource("C:\Git\Studium\PhD\semio\examples\nakagincapsuletower\floorplan.png")
number_slider = Slider(2875, range=0..10000)
number_slider_2 = Slider(350, range=0..10000)
number_slider_3 = Slider(2550, range=0..10000)
number_slider_4 = Slider(70, range=0..10000)
neg = Negative(Value=number_slider)
north_not_properly_places = Vector(Vector(0.922262801, -0.3865634823, 0))
neg_2 = Negative(Value=number_slider_3)
dom = ConstructDomain(DomainStart=number_slider_4, DomainEnd=neg)
dom_2 = ConstructDomain(DomainStart=number_slider_2, DomainEnd=neg_2)
context_not_properly_places = Curve([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])
pt = ConstructPoint(XCoordinate=0, YCoordinate=0, ZCoordinate=0)
amp = Amplitude(Vector=north_not_properly_places, Amplitude=Slider(1000, range=0..1000))
rectangle = Rectangle(Plane=PlaneXY(0, 0, 0), XSize=dom, YSize=dom_2, Radius=0)  # -> Rectangle, Length
plot = Curve(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)
vdisex = VectorDisplayEx(Point=pt, Vector=amp, Colour=RGB(0, 0, 0), Width=2)
# Parameters:
img = ImportImage(File=image_resource, Rectangle=rectangle.Rectangle)
# Outputs ->
number_slider_5 = Slider(0.5, range=0..1)
number_slider_6 = Slider(550, range=0..1000)
panel = Panel("Secondary")
panel_2 = Panel("Primary")
panel_3 = Panel("Bottom")
panel_4 = Panel("Top")
pt_2 = ConstructPoint(
    XCoordinate=Slider(84, range=-1000..1000),
    YCoordinate=Slider(51, range=-1000..1000),
    ZCoordinate=Slider(125, range=-1000..1000))
merge = Merge()
# Connection:
connection_ports = GetString(merge, AtLeast=0, AtMost=1, TreeAccess=False)
connection_bias_u = GetNumber(Slider(0.5, range=0..1), AtLeast=1, AtMost=1, Maximum=1.797693135e+308, Minimum=-1.797693135e+308, TreeAccess=False)
connection_bias_v = GetNumber(number_slider_5, AtLeast=1, AtMost=1, Maximum=1.797693135e+308, Minimum=-1.797693135e+308, TreeAccess=False)
floorgroundheight = GetNumber(Slider(400, range=0..1000), AtLeast=1, AtMost=1, Maximum=1.797693135e+308, Minimum=-1.797693135e+308, TreeAccess=False)
connection_point = GetPoint(pt_2, AtLeast=0, AtMost=1, Realtime=True, TreeAccess=False)
# External
#      |
#      v
# Model:
plotoutline = GetGeometry(plot, AtLeast=1, AtMost=1, DeleteInput=False, Filter=1074004029, TreeAccess=False)
coressetbackdepth = GetNumber(Slider(450, range=0..1000), AtLeast=1, AtMost=1, Maximum=1.797693135e+308, Minimum=-1.797693135e+308, TreeAccess=False)
coressetbackwidth = GetNumber(Slider(400, range=0..1000), AtLeast=1, AtMost=1, Maximum=1.797693135e+308, Minimum=-1.797693135e+308, TreeAccess=False)
coreprimarylength = GetNumber(number_slider_6, AtLeast=1, AtMost=1, Maximum=1.797693135e+308, Minimum=-1.797693135e+308, TreeAccess=False)
coreprimarywidth = GetNumber(number_slider_6, AtLeast=1, AtMost=1, Maximum=1.797693135e+308, Minimum=-1.797693135e+308, TreeAccess=False)
coresecondarylength = GetNumber(number_slider_6, AtLeast=1, AtMost=1, Maximum=1.797693135e+308, Minimum=-1.797693135e+308, TreeAccess=False)
coresecondarywidth = GetNumber(number_slider_6, AtLeast=1, AtMost=1, Maximum=1.797693135e+308, Minimum=-1.797693135e+308, TreeAccess=False)
entrancehallwidth = GetNumber(Slider(650, range=0..1000), AtLeast=1, AtMost=1, Maximum=1.797693135e+308, Minimum=-1.797693135e+308, TreeAccess=False)
sideshortsetbackdepth = GetNumber(Slider(100, range=0..100), AtLeast=1, AtMost=1, Maximum=1.797693135e+308, Minimum=-1.797693135e+308, TreeAccess=False)
slabfloorheight = GetNumber(Slider(40, range=0..100), AtLeast=1, AtMost=1, Maximum=1.797693135e+308, Minimum=-1.797693135e+308, TreeAccess=False)
columnssidelongsetbackwidth = GetNumber(Slider(250, range=0..1000), AtLeast=1, AtMost=1, Maximum=1.797693135e+308, Minimum=-1.797693135e+308, TreeAccess=False)
atticdepth = GetNumber(Slider(30, range=0..100), AtLeast=1, AtMost=1, Maximum=1.797693135e+308, Minimum=-1.797693135e+308, TreeAccess=False)
columnssetbackdepth = GetNumber(Slider(250, range=0..1000), AtLeast=1, AtMost=1, Maximum=1.797693135e+308, Minimum=-1.797693135e+308, TreeAccess=False)
floorheight = GetNumber(Slider(350, range=0..1000), AtLeast=1, AtMost=1, Maximum=1.797693135e+308, Minimum=-1.797693135e+308, TreeAccess=False)
fassadeedgesetback = GetNumber(Slider(40, range=0..100), AtLeast=1, AtMost=1, Maximum=1.797693135e+308, Minimum=-1.797693135e+308, TreeAccess=False)
atticheight = GetNumber(Slider(30, range=0..100), AtLeast=1, AtMost=1, Maximum=1.797693135e+308, Minimum=-1.797693135e+308, TreeAccess=False)
windowheight = GetNumber(Slider(150, range=0..1000), AtLeast=1, AtMost=1, Maximum=1.797693135e+308, Minimum=-1.797693135e+308, TreeAccess=False)
windowparapetheight = GetNumber(Slider(90, range=0..100), AtLeast=1, AtMost=1, Maximum=1.797693135e+308, Minimum=-1.797693135e+308, TreeAccess=False)
roofheight = GetNumber(Slider(40, range=0..100), AtLeast=1, AtMost=1, Maximum=1.797693135e+308, Minimum=-1.797693135e+308, TreeAccess=False)
columnswidth = GetNumber(Slider(40, range=0..100), AtLeast=1, AtMost=1, Maximum=1.797693135e+308, Minimum=-1.797693135e+308, TreeAccess=False)
# Debug ->
debug = BooleanToggle(True)
nakagincapsuletowerbasefloorplan = NakaginCapsuleTowerBaseFloorplan(
    plotoutline=plotoutline,
    coressetbackdepth=coressetbackdepth,
    coressetbackwidth=coressetbackwidth,
    coreprimarylength=coreprimarylength,
    coreprimarywidth=coreprimarywidth,
    coresecondarylength=coresecondarylength,
    coresecondarywidth=coresecondarywidth,
    entrancehallwidth=entrancehallwidth,
    sideshortsetbackdepth=sideshortsetbackdepth)  # -> sidebuilding_2, sideshort_2, sidemain_2, sidecorner_2, sidelong_2, coreprimary_2, coresecondary_2, sidemainfassadeside_2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
null = NullItem(Item=connection_point)  # -> NullFlags, InvalidFlags, Description
pt_3 = ConstructPoint(XCoordinate=connection_bias_u, YCoordinate=connection_bias_v, ZCoordinate=0)
panel_5 = Panel("""Primary
Secondary""")
# Local ->
onoff = EnableDisableObject(
    Enabled=debug,
    AllObjects_Object=[image_resource, img, rectangle, neg, number_slider, neg_2, number_slider_3, dom, number_slider_4, dom_2, number_slider_2])
contains = Contains(L=connection_ports, I="Top")  # -> R; inputs L: list, I: list
# ---------- contains: Python ----------
#Component Information
#--------------------------------------------------------------------------------------------
if ghenv.Component.RunCount<2:
    #General
    #--------------------------------------------------------------------------------------------
    __author__ = "Ueli Saluz"
    __version__ = "2023.02.04"
    
    ghenv.Component.Name = "Contains"
    ghenv.Component.NickName = "Contains"
    ghenv.Component.Description = "True if list contains one of the items."
    ghenv.Component.Message = "VER 1.0"
    ghenv.Component.Category = "Set"
    ghenv.Component.SubCategory = "List"
    
     #Inputs
    #--------------------------------------------------------------------------------------------
    inputIndex=0
    
    ghenv.Component.Params.Input[inputIndex].Name = "List"
    ghenv.Component.Params.Input[inputIndex].NickName = "L"
    ghenv.Component.Params.Input[inputIndex].Description = ""
    ghenv.Component.Params.Input[inputIndex].Optional = False
    inputIndex+=1
    
    ghenv.Component.Params.Input[inputIndex].Name = "Items"
    ghenv.Component.Params.Input[inputIndex].NickName = "I"
    ghenv.Component.Params.Input[inputIndex].Description = ""
    ghenv.Component.Params.Input[inputIndex].Optional = False
    inputIndex+=1
    
    #Outputs
    #--------------------------------------------------------------------------------------------
    outputIndex=0
    
    ghenv.Component.Params.Output[outputIndex].Name = "Contains"
    ghenv.Component.Params.Output[outputIndex].NickName = "R"
    ghenv.Component.Params.Output[outputIndex].Description = ""
    outputIndex+=1

R = False
for i in I:
    if i in L:
        R = True
# ---------- end contains ----------
contains_2 = Contains(L=connection_ports, I="Bottom")  # -> R; inputs L: list, I: list; same code as contains
contains_3 = Contains(L=connection_ports, I="Primary")  # -> R; inputs L: list, I: list; same code as contains
contains_4 = Contains(L=connection_ports, I="Secondary")  # -> R; inputs L: list, I: list; same code as contains
valueor0 = ValueOr0(value=contains)
valueor0_2 = ValueOr0(value=contains_2)
valueor0_3 = ValueOr0(value=contains_3)
valueor0_4 = ValueOr0(value=contains_4)
addition = Addition(A=floorgroundheight, B=floorheight)
sidemain = Curve(nakagincapsuletowerbasefloorplan.sidemain_2)
sidemain_2 = Curve(sidemain)
sidecorner = Curve(nakagincapsuletowerbasefloorplan.sidecorner_2)
sidecorner_2 = Curve(sidecorner)
sidelong = Curve(nakagincapsuletowerbasefloorplan.sidelong_2)
sidelong_2 = Curve(sidelong)
sidebuilding = Curve(nakagincapsuletowerbasefloorplan.sidebuilding_2)
sideshort = Curve(nakagincapsuletowerbasefloorplan.sideshort_2)
sideshort_2 = Curve(sideshort)
merge_2 = Merge(Data1=sideshort_2, Data2=sidemain_2, Data3=sidecorner_2, Data4=sidelong_2)
coreprimary = Rectangle(nakagincapsuletowerbasefloorplan.coreprimary_2)
coresecondary = Rectangle(nakagincapsuletowerbasefloorplan.coresecondary_2)
sidemainfassadeside = Curve(nakagincapsuletowerbasefloorplan.sidemainfassadeside_2)
sidemainfassadeentrance = Curve(nakagincapsuletowerbasefloorplan.sidemainfassadeentrance_2)
sideshortfassade = Curve(nakagincapsuletowerbasefloorplan.sideshortfassade_2)
sidelongfassade = Curve(nakagincapsuletowerbasefloorplan.sidelongfassade_2)
basenoncore = Curve(nakagincapsuletowerbasefloorplan.basenoncore_2)
base = Curve(nakagincapsuletowerbasefloorplan.base_2)
expression = Expression(x=addition, Expression="x/2")
join = JoinCurves(Curves=merge_2, Preserve=False)
trim = TrimTree(Tree=join, Depth=1)
coresecondary_2 = Rectangle(coresecondary)
Z = UnitZ(Factor=floorgroundheight)
coreprimary_2 = Rectangle(coreprimary)
Z_2 = UnitZ(Factor=expression)
and = GateAnd(A=valueor0_2, B=valueor0_3)
and_2 = GateAnd(A=valueor0_2, B=valueor0_4)
Z_3 = UnitZ(Factor=addition)
base_2 = Curve(base)
area = Area(Geometry=plotoutline)  # -> Area, Centroid
move = Move(Geometry=trim, Motion=Z)  # -> Geometry, Transform
evalsrf = EvaluateSurface(Surface=reparameterize(coreprimary_2), Point=pt_3)  # -> Point, Normal, UDirection, VDirection, Frame
evalsrf_2 = EvaluateSurface(Surface=reparameterize(coreprimary_2), Point=pt_3)  # -> Point, Normal, UDirection, VDirection, Frame
Z_4 = UnitZ(Factor=floorheight)
neg_3 = Negative(Value=fassadeedgesetback)
move_2 = Move(Geometry=plotoutline, Motion=Z)  # -> Geometry, Transform
extr = Extrude(Base=base_2, Direction=Z)
neg_4 = Negative(Value=fassadeedgesetback)
move_3 = Move(Geometry=coreprimary_2, Motion=Z_3)  # -> Geometry, Transform
move_4 = Move(Geometry=move.Geometry, Motion=Z_4)  # -> Geometry, Transform
move_5 = Move(Geometry=coresecondary_2, Motion=Z_3)  # -> Geometry, Transform
neg_5 = Negative(Value=fassadeedgesetback)
move_6 = Move(Geometry=area.Centroid, Motion=Z_3)  # -> Geometry, Transform
move_7 = Move(Geometry=area.Centroid, Motion=Z_2)  # -> Geometry, Transform
extr_2 = Extrude(Base=move_2.Geometry, Direction=Z_4)
cap = CapHoles(Brep=extr)
Z_5 = UnitZ(Factor=neg_4)
offset = OffsetCurve(Curve=move.Geometry, Distance=neg_3, Corners=1)
Z_6 = UnitZ(Factor=fassadeedgesetback)
offset_2 = OffsetCurve(Curve=move_4.Geometry, Distance=neg_5, Corners=1)
Z_7 = UnitZ(Factor=windowparapetheight)
evalsrf_3 = EvaluateSurface(Surface=reparameterize(move_3.Geometry), Point=pt_3)  # -> Point, Normal, UDirection, VDirection, Frame
evalsrf_4 = EvaluateSurface(Surface=reparameterize(move_5.Geometry), Point=pt_3)  # -> Point, Normal, UDirection, VDirection, Frame
neg_6 = Negative(Value=columnssetbackdepth)
addition_2 = Addition(A=move_7.Geometry, B=connection_point)
cap_2 = CapHoles(Brep=extr_2)
move_8 = Move(Geometry=move.Geometry, Motion=Z_6)  # -> Geometry, Transform
trim_2 = TrimTree(Tree=offset, Depth=1)
move_9 = Move(Geometry=move_4.Geometry, Motion=Z_5)  # -> Geometry, Transform
trim_3 = TrimTree(Tree=offset_2, Depth=1)
move_10 = Move(Geometry=move.Geometry, Motion=Z_7)  # -> Geometry, Transform
Z_8 = UnitZ(Factor=windowheight)
offset_3 = OffsetCurve(Curve=sidemain, Distance=neg_6, Corners=1)
offset_4 = OffsetCurve(Curve=sidelong, Distance=neg_6, Corners=1)
merge_3 = Merge(
    Data1=area.Centroid,
    Data2=move_6.Geometry,
    Data3=evalsrf.Point,
    Data4=evalsrf_2.Point,
    Data5=evalsrf_3.Point,
    Data6=evalsrf_4.Point)
floorgroundvolume = Brep(cap)
floorfirstvolume = Brep(cap_2)
rulesrf = RuledSurface(CurveA=trim_2, CurveB=move_8.Geometry)
rulesrf_2 = RuledSurface(CurveA=move_8.Geometry, CurveB=move_9.Geometry)
rulesrf_3 = RuledSurface(CurveA=trim_3, CurveB=move_9.Geometry)
clscrv = CloseCurve(Curve=trim_3, CloseType=0, Bulge=0.5, Tolerance=0)  # -> Closed, R
clscrv_2 = CloseCurve(Curve=trim_2, CloseType=0, Bulge=0.5, Tolerance=0)  # -> Closed, R
neg_7 = Negative(Value=atticdepth)
move_11 = Move(Geometry=move_10.Geometry, Motion=Z_8)  # -> Geometry, Transform
trim_4 = TrimTree(Tree=offset_3, Depth=1)
trim_5 = TrimTree(Tree=offset_4, Depth=1)
cp = ClosestPoint(Point=addition_2, Cloud=merge_3)  # -> ClosestPoint, CPIndex, Distance
filter = StreamFilter(Gate=null.NullFlags, Stream0=move_6.Geometry, Stream1=cp.ClosestPoint)
filter_2 = StreamFilter(Gate=valueor0, Stream0=filter, Stream1=move_6.Geometry)
merge_4 = Merge(Data1=rulesrf, Data2=rulesrf_2, Data3=rulesrf_3)
boundary = BoundarySurfaces(Edges=clscrv_2.Closed)
offset_5 = OffsetCurve(Curve=clscrv.Closed, Distance=neg_7, Corners=1)
boundary_2 = BoundarySurfaces(Edges=clscrv.Closed)
neg_8 = Negative(Value=atticheight)
rulesrf_4 = RuledSurface(CurveA=move_10.Geometry, CurveB=move_11.Geometry)
columnsmainaxis = Curve(trim_4)
columnssideaxis = Curve(trim_5)
filter_3 = StreamFilter(Gate=valueor0_2, Stream0=filter_2, Stream1=area.Centroid)
Z_9 = UnitZ(Factor=neg_8)
trim_6 = TrimTree(Tree=offset_5, Depth=1)
fassadefirstfloor = Surface(merge_4)
windowribbon = Surface(rulesrf_4)
filter_4 = StreamFilter(Gate=valueor0_3, Stream0=filter_3, Stream1=evalsrf_3.Point)
rulesrf_5 = RuledSurface(CurveA=clscrv.Closed, CurveB=trim_6)
move_12 = Move(Geometry=trim_6, Motion=Z_9)  # -> Geometry, Transform
join_2 = BrepJoin(Breps=fassadefirstfloor)  # -> Breps, Closed
boundary_3 = BoundarySurfaces(Edges=move_12.Geometry)
rulesrf_6 = RuledSurface(CurveA=trim_6, CurveB=move_12.Geometry)
filter_5 = StreamFilter(Gate=valueor0_4, Stream0=filter_3, Stream1=evalsrf_4.Point)

expression_2 = Expression(x=coreprimarylength, y=columnswidth, Expression="x-2*y")
expression_3 = Expression(x=coresecondarylength, y=columnswidth, Expression="x-2*y")
subtraction = Subtraction(A=coressetbackwidth, B=columnswidth)
merge_5 = Merge(
    Data1=columnswidth,
    Data2=subtraction,
    Data3=columnswidth,
    Data4=expression_2,
    Data5=columnswidth,
    Data6=entrancehallwidth,
    Data7=columnswidth,
    Data8=expression_3,
    Data9=columnswidth)
ma = MassAddition(Input=merge_5)  # -> Result, PartialResults
eval = EvaluateLength(Curve=columnsmainaxis, Length=ma.PartialResults, Normalized="False")  # -> Point, Tangent, Parameter
shatter = Shatter(Curve=columnsmainaxis, Parameters=eval.Parameter)
trim_7 = TrimTree(Tree=shatter, Depth=1)
Z_10 = UnitZ(Factor=floorgroundheight)
dispatch = Dispatch(List=trim_7, DispatchPattern=[True, False])  # -> ListA, ListB
extr_3 = Extrude(Base=dispatch.ListA, Direction=Z_10)
offsrf = OffsetSurface(Surface=extr_3, Distance=columnswidth, BothSides=False, CreateSolid=True)
trim_8 = TrimTree(Tree=offsrf, Depth=1)
columnsmain = Brep(trim_8)

merge_6 = Merge(Data1=boundary, Data2=join_2.Breps, Data3=rulesrf_5, Data4=rulesrf_6, Data5=boundary_3)

neg_9 = Negative(Value=columnssidelongsetbackwidth)
neg_10 = Negative(Value=columnssidelongsetbackwidth)
ext = ExtendCurve(Curve=columnssideaxis, Type=0, Start=neg_9, End=neg_10)
divide = DivideCurve(Curve=ext, Count="2", Kinks=False)  # -> Points, Tangents, Parameters
trim_9 = TrimTree(Tree=divide.Parameters, Depth=1)
eval_2 = EvaluateCurve(Curve=columnssideaxis, Parameter=trim_9)  # -> Point, Tangent, Angle
pl = ConstructPlane(Origin=eval_2.Point, XAxis=eval_2.Tangent, YAxis=Vector(0, 1, 0))
_2d = _2D(x=columnswidth)
rectangle_2 = Rectangle(Plane=pl, XSize=_2d, YSize=_2d, Radius=0)  # -> Rectangle, Length
Z_11 = UnitZ(Factor=floorgroundheight)
extr_4 = Extrude(Base=rectangle_2.Rectangle, Direction=Z_11)
offsrf_2 = OffsetSurface(Surface=extr_4, Distance=columnswidth, BothSides=False, CreateSolid=True)
trim_10 = TrimTree(Tree=offsrf_2, Depth=1)
columnsside = Brep(trim_10)

move_13 = Move(Geometry=sidebuilding, Motion=Z)  # -> Geometry, Transform
Z_12 = UnitZ(Factor=floorheight)
filter_6 = StreamFilter(Gate=and, Stream0=filter_5, Stream1=evalsrf.Point)
join_3 = BrepJoin(Breps=merge_6)  # -> Breps, Closed
filter_7 = StreamFilter(Gate=and_2, Stream0=filter_6, Stream1=evalsrf_2.Point)
floorfirstvolume_2 = Brep(join_3.Breps)
connection_pose = Plane(filter_7)

merge_7 = Merge(Data1=columnsmain, Data2=columnsside)
columns = Brep(merge_7)

merge_8 = Merge(Data1=floorgroundvolume, Data2=floorfirstvolume, Data3=columns)
merge_9 = Merge(Data1=floorgroundvolume, Data2=floorfirstvolume_2, Data3=windowribbon, Data4=columns)
geo = Geometry(merge_8)
geo_2 = Geometry(merge_9)
serialize = Serialize(Input=geo)
serialize_2 = Serialize(Input=geo_2)
representation = ConstructRepresentation(Body=serialize, Concepts="Simple")
representation_2 = ConstructRepresentation(Body=serialize_2, Concepts="Detailed")
merge_10 = Merge(Data1=representation, Data2=representation_2)
compress = Compress(Input=merge_10)
connection_point_2 = Point(connection_pose)
representations = Text(compress)
context_bake = ContextBake(CONNECTIONPOINT=connection_point_2)
context_print = ContextPrint(REPRESENTATIONS=representations)
item = ListItem(Index=0, Wrap=True)  # -> Item, Item1, Item2, Item3, Item4, Item5, Item6, Item7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; disabled
merge_11 = Merge(
    Data1=item.Item,
    Data2=item.Item3,
    Data3=item.Item5,
    Data4=item.Item10,
    Data5=item.Item12,
    Data6=item.Item18,
    Data7=item.Item19,
    Data8=item.Item22)  # disabled
join_4 = JoinCurves(Curves=merge_11, Preserve=False)  # disabled
trim_11 = TrimTree(Tree=join_4, Depth=1)  # disabled
patch = Patch(Curves=trim_11, Spans=20, Flexibility=1, Trim=True)  # disabled
merge_12 = Merge(Data1=join_3.Breps, Data2=patch)  # disabled
join_5 = BrepJoin(Breps=merge_12)  # -> Breps, Closed; disabled

# ==== cluster NakaginCapsuleTowerBaseFloorplan
sideshortsetbackdepth = ClusterInput()
plotoutline = ClusterInput()
coressetbackdepth = ClusterInput()
coressetbackwidth = ClusterInput()
coreprimarylength = ClusterInput()
coreprimarywidth = ClusterInput()
coresecondarylength = ClusterInput()
coresecondarywidth = ClusterInput()
entrancehallwidth = ClusterInput()
coressetbackdepth_2 = Number(coressetbackdepth)
coreprimarylength_2 = Number(coreprimarylength)
coreprimarywidth_2 = Number(coreprimarywidth)
coresecondarylength_2 = Number(coresecondarylength)
coressetbackwidth_2 = Number(coressetbackwidth)
plotoutline_2 = Curve(plotoutline)
coresecondarywidth_2 = Number(coresecondarywidth)
entrancehallwidth_2 = Number(entrancehallwidth)
sideshortsetbackdepth_2 = Number(sideshortsetbackdepth)
xy = XYPlane(Origin=Point(0, 0, 0))
merge = Merge(Data1=coressetbackwidth_2, Data2=coreprimarylength_2, Data3=entrancehallwidth_2, Data4=coresecondarylength_2)
neg = Negative(Value=coressetbackdepth_2)
ma = MassAddition(Input=merge)  # -> Result, PartialResults
explode = Explode(Curve=plotoutline_2, Recursive=True)  # -> Segments, Vertices
Y = UnitY(Factor=neg)
neg_2 = Negative(Value=ma.PartialResults)
trim = TrimTree(Tree=explode.Segments, Depth=1)
X = UnitX(Factor=neg_2)
move = Move(Geometry=xy, Motion=Y)  # -> Geometry, Transform
item = ListItem(List=trim, Index=0, Wrap=True)  # -> Item, Item1, Item2, Item3, Item4
move_2 = Move(Geometry=move.Geometry, Motion=X)  # -> Geometry, Transform
sidemain = Curve(item.Item2)
sidecorner = Curve(item.Item3)
sidelong = Curve(item.Item4)
sidebuilding = Curve(item.Item)
sideshort = Curve(item.Item1)
item_2 = ListItem(List=move_2.Geometry, Index=0, Wrap=True)  # -> Item, Item1, Item2, Item3
neg_3 = Negative(Value=coresecondarywidth_2)
neg_4 = Negative(Value=coreprimarywidth_2)
neg_5 = Negative(Value=entrancehallwidth_2)
sidebuilding_2 = ClusterOutput(sidebuilding)
sideshort_2 = ClusterOutput(sideshort)
sidemain_2 = ClusterOutput(sidemain)
sidecorner_2 = ClusterOutput(sidecorner)
sidelong_2 = ClusterOutput(sidelong)
rectangle = Rectangle(Plane=item_2.Item2, XSize=entrancehallwidth_2, YSize=neg_5, Radius=0)  # -> Rectangle, Length
rectangle_2 = Rectangle(Plane=item_2.Item1, XSize=coreprimarylength_2, YSize=neg_3, Radius=0)  # -> Rectangle, Length
rectangle_3 = Rectangle(Plane=item_2.Item3, XSize=coresecondarylength_2, YSize=neg_4, Radius=0)  # -> Rectangle, Length
coresecondary = Rectangle(rectangle_2.Rectangle)
coreprimary = Rectangle(rectangle_3.Rectangle)
explode_2 = Explode(Curve=rectangle.Rectangle, Recursive=True)  # -> Segments, Vertices
explode_3 = Explode(Curve=coreprimary, Recursive=True)  # -> Segments, Vertices
coreprimary_2 = ClusterOutput(coreprimary)
coresecondary_2 = ClusterOutput(coresecondary)
trim_2 = TrimTree(Tree=explode_2.Segments, Depth=1)
trim_3 = TrimTree(Tree=explode_3.Vertices, Depth=1)
item_3 = ListItem(List=trim_2, Index=0, Wrap=True)  # -> Item, Item1, Item2, Item3
item_4 = ListItem(List=trim_3, Index=0, Wrap=True)  # -> Item, Item1, Item2, Item3
neg_6 = Negative(Value=sideshortsetbackdepth_2)
offset = OffsetCurve(Curve=sideshort, Distance=neg_6, Corners=1)
trim_4 = TrimTree(Tree=offset, Depth=1)

X_2 = UnitX(Factor=1)
line = LineSDL(Start=move.Geometry, Direction=X_2, Length=1)
rotax = RotateAxis(Geometry=move.Geometry, Angle=degrees("90"), Axis=line)  # -> Geometry, Transform
pcx = CurvePlane(Curve=trim_4, Plane=rotax.Geometry)  # -> Points, ParamsC, ParamsP
trim_5 = TrimTree(Tree=pcx.Points, Depth=1)
crv_cp = CurveClosestPoint(Point=trim_5, Curve=trim_4)  # -> Point, Parameter, Distance
shatter = Shatter(Curve=trim_4, Parameters=crv_cp.Parameter)
trim_6 = TrimTree(Tree=shatter, Depth=1)
item_5 = ListItem(List=trim_6, Index=0, Wrap=True)

brec = BoundingRectangle(Geometry=plotoutline_2, Plane=PlaneXY(0, 0, 0), Axis=0, Slide=0, Union=True)  # -> Bounding, DimensionX, DimensionY
trim_7 = TrimTree(Tree=brec.Bounding, Depth=1)
drec = DeconstuctRectangle(Rectangle=trim_7)  # -> BasePlane, XInterval, YInterval
domprop = DomainProperties(I=drec.YInterval, In=True)  # -> L, M, T0, T1; inputs I: tree, In: tree of Boolean
# ---------- domprop: Python ----------
#Component Information
#--------------------------------------------------------------------------------------------
if ghenv.Component.RunCount<2:
    #General
    #--------------------------------------------------------------------------------------------
    __author__ = "Ueli Saluz"
    __version__ = "2021.11.22"
    
    ghenv.Component.Name = "DomainProperties"
    ghenv.Component.NickName = "DomProp"
    ghenv.Component.Description = "Returns some properties of a domain"
    ghenv.Component.Message = "VER 1.0"
    ghenv.Component.Category = "Maths"
    ghenv.Component.SubCategory = "Domain"
    
     #Inputs
    #--------------------------------------------------------------------------------------------
    inputIndex=0
    
    ghenv.Component.Params.Input[inputIndex].Name = "Domain"
    ghenv.Component.Params.Input[inputIndex].NickName = "I"
    ghenv.Component.Params.Input[inputIndex].Description = "Domain to evaluate"
    ghenv.Component.Params.Input[inputIndex].Optional = False
    inputIndex+=1
    
    ghenv.Component.Params.Input[inputIndex].Name = "MakeIncreasing"
    ghenv.Component.Params.Input[inputIndex].NickName = "In"
    ghenv.Component.Params.Input[inputIndex].Description = "Makes sure that the domain is increasing. If not it gets swapped."
    ghenv.Component.Params.Input[inputIndex].Optional = False
    inputIndex+=1
    
    #Outputs
    #--------------------------------------------------------------------------------------------
    outputIndex=0
    
    ghenv.Component.Params.Output[outputIndex].Name = "Length"
    ghenv.Component.Params.Output[outputIndex].NickName = "L"
    ghenv.Component.Params.Output[outputIndex].Description = "Length of the domain"
    outputIndex+=1
    
    ghenv.Component.Params.Output[outputIndex].Name = "Mid"
    ghenv.Component.Params.Output[outputIndex].NickName = "M"
    ghenv.Component.Params.Output[outputIndex].Description = "Middle of the of the domain"
    outputIndex+=1
    
    ghenv.Component.Params.Output[outputIndex].Name = "DomainStartParameter"
    ghenv.Component.Params.Output[outputIndex].NickName = "T0"
    ghenv.Component.Params.Output[outputIndex].Description = "Start parameter. Doens't have to be smaller than the end parameter."
    outputIndex+=1
    
    ghenv.Component.Params.Output[outputIndex].Name = "DomainEndParameter"
    ghenv.Component.Params.Output[outputIndex].NickName = "T1"
    ghenv.Component.Params.Output[outputIndex].Description = "End parameter. Doens't have to be bigger than the start parameter."
    outputIndex+=1
    


#Imports
#--------------------------------------------------------------------------------------------
from System import Object
from Grasshopper import DataTree

#Solver - Run with trees to enhance performance drastically
#--------------------------------------------------------------------------------------------
if __name__ == "__main__":
    
    #Initialize trees
    #--------------------------------------------------------------------------------------------
    LengthTree = DataTree[Object]()
    MidTree = DataTree[Object]()
    DomainStartParameterTree = DataTree[Object]()
    DomainEndParameterTree = DataTree[Object]()
    LengthTree = DataTree[Object]()
    
    #Data matching
    #--------------------------------------------------------------------------------------------
    for path in I.Paths:
        domainBranch = I.Branch(path)
        for i,domain in enumerate(domainBranch):
            if In==True:
                domain.MakeIncreasing()
            LengthTree.Add(domain.Length, path)
            MidTree.Add(domain.Mid, path)
            DomainStartParameterTree.Add(domain.T0, path)
            DomainEndParameterTree.Add(domain.T1, path)
    
     #Assign trees to output
    #--------------------------------------------------------------------------------------------
    L = LengthTree
    M = MidTree
    T0 = DomainStartParameterTree
    T1 = DomainEndParameterTree
# ---------- end domprop ----------
end = EndPoints(Curve=trim_4)  # -> Start, End
ext = ExtendCurve(Curve=item_3.Item3, Type=0, Start="0", End=domprop.L)
crv_cp_2 = CurveClosestPoint(Point=end.Start, Curve=sidebuilding)  # -> Point, Parameter, Distance
ccx = CurveCurve(CurveA=ext, CurveB=sidebuilding)  # -> Points, ParamsA, ParamsB
trim_8 = TrimTree(Tree=ccx.Points, Depth=1)
trim_9 = TrimTree(Tree=ccx.ParamsB, Depth=1)
merge_2 = Merge(Data1=trim_9, Data2=crv_cp_2.Parameter)
trim_10 = TrimTree(Tree=ccx.ParamsA, Depth=1)
shatter_2 = Shatter(Curve=sidebuilding, Parameters=merge_2)
shatter_3 = Shatter(Curve=ext, Parameters=trim_10)
trim_11 = TrimTree(Tree=shatter_2, Depth=1)
trim_12 = TrimTree(Tree=shatter_3, Depth=1)

explode_4 = Explode(Curve=coresecondary, Recursive=True)  # -> Segments, Vertices
trim_13 = TrimTree(Tree=explode_4.Segments, Depth=1)
shift = ShiftList(List=trim_13, Shift="-2", Wrap=True)
panel = Panel("-1")
trim_14 = TrimTree(Tree=shift, Depth=1)
lito3p = ListInto3Parts(ListToSlice=trim_14, StartIndex="1")  # -> FilteredList, ItemsBefore, ItemsAfter; inputs ListToSlice: tree, StartIndex: tree of Int32, EndIndex: tree of Int32
# ---------- lito3p: Python ----------
if ghenv.Component.RunCount<2:
    __author__ = "Ueli Saluz"
    __version__ = "2020.05.28"
    
    ghenv.Component.Name = "ListInto3Parts"
    ghenv.Component.NickName = "LiTo3P"
    ghenv.Component.Description = "Slice list into 3 parts. All lists are sliced with the same indices. End index = 0 = length(list)."
    ghenv.Component.Message = "VER 1.6"

from System import Object
from Grasshopper import DataTree

def filterList(listToFilter,startIndex,endIndex):
    # Return: FilteredList, Before, After
    if (((startIndex == 0) or (startIndex is None)) and ((endIndex == 0) or (endIndex is None))) or (endIndex <= startIndex and endIndex > 0):
        return (listToFilter,None,None)
    elif (startIndex == 0) or (startIndex is None):
        return (listToFilter[:endIndex],None,listToFilter[endIndex:])
    elif (endIndex == 0) or (endIndex is None):
        print 1
        return (listToFilter[:startIndex],listToFilter[startIndex:],None)
    else:
        return (listToFilter[startIndex:endIndex],listToFilter[:startIndex],listToFilter[endIndex:])

if __name__ == "__main__":
    FilteredList = DataTree[Object]()
    ItemsBefore = DataTree[Object]()
    ItemsAfter = DataTree[Object]()
    
    for path in ListToSlice.Paths:
        listBranch = ListToSlice.Branch(path)
        pyList = list(listBranch)   #Convert .Net List to Python
        try: #terrible way of writing code but if I set the list to list access the performance decreases massivly due to many calls
            startIndex = StartIndex.Branch(path)
            startIndex = startIndex[0]
        except Exception:
            try:
                startIndex = StartIndex.Branch(0)
                startIndex = startIndex[0]
            except Exception:
                startIndex = 0
        try:
            endIndex = EndIndex.Branch(path)
            endIndex = endIndex[0]
        except Exception:
            try:
                endIndex = EndIndex.Branch(0)
                endIndex = endIndex[0]
            except Exception:
                endIndex = len(pyList)
        filtList=filterList(pyList,startIndex,endIndex)
        if filtList[0]:
            FilteredList.AddRange(filtList[0],path)
        if filtList[1]:
            ItemsBefore.AddRange(filtList[1],path)
        if filtList[2]:
            ItemsAfter.AddRange(filtList[2],path)
# ---------- end lito3p ----------

panel_2 = Panel(trim_5)
item_6 = ListItem(List=trim_11, Index=0, Wrap=True)  # -> Item, Item1
item_7 = ListItem(List=trim_12, Index=0, Wrap=True)  # -> Item, Item1
ln = Line(StartPoint=crv_cp.Point, EndPoint=item_2.Item)
ln_2 = Line(StartPoint=item_2.Item1, EndPoint=item_2.Item2)
ln_3 = Line(StartPoint=crv_cp.Point, EndPoint=item_4.Item3)
ln_4 = Line(StartPoint=item_4.Item3, EndPoint=item_4.Item)
ln_5 = Line(StartPoint=item_4.Item, EndPoint=item_4.Item1)
ln_6 = Line(StartPoint=item_4.Item1, EndPoint=trim_8)
merge_3 = Merge(Data1=ln, Data2=lito3p.FilteredList, Data3=ln_2, Data4=item_7.Item, Data5=item_6.Item1, Data6=item_5)
merge_4 = Merge(Data1=ln_3, Data2=ln_4, Data3=ln_5, Data4=ln_6, Data5=item_6.Item1, Data6=item_5)
join = JoinCurves(Curves=merge_3, Preserve=False)
sidemainfassadeside = Curve(ln)
sidemainfassadeentrance = Curve(ln_2)
sideshortfassade = Curve(item_5)
sidelongfassade = Curve(ln_6)
join_2 = JoinCurves(Curves=merge_4, Preserve=False)
trim_15 = TrimTree(Tree=join, Depth=1)
trim_16 = TrimTree(Tree=join_2, Depth=1)
clscrv = CloseCurve(Curve=trim_15, CloseType=0, Bulge=0.5, Tolerance=0)  # -> Closed, R
clscrv_2 = CloseCurve(Curve=trim_16, CloseType=0, Bulge=0.5, Tolerance=0)  # -> Closed, R
simplify = SimplifyCurve(Curve=clscrv.Closed)  # -> Curve, Simplified
simplify_2 = SimplifyCurve(Curve=clscrv_2.Closed)  # -> Curve, Simplified
crv_cp_3 = CurveClosestPoint(Point=move.Geometry, Curve=simplify.Curve)  # -> Point, Parameter, Distance
crv_cp_4 = CurveClosestPoint(Point=move.Geometry, Curve=simplify_2.Curve)  # -> Point, Parameter, Distance
sidemainfassadeentrance_2 = ClusterOutput(sidemainfassadeentrance)
sidemainfassadeside_2 = ClusterOutput(sidemainfassadeside)
sidelongfassade_2 = ClusterOutput(sidelongfassade)
sideshortfassade_2 = ClusterOutput(sideshortfassade)
seam = Seam(Curve=simplify.Curve, Seam=crv_cp_3.Parameter)
seam_2 = Seam(Curve=simplify_2.Curve, Seam=crv_cp_4.Parameter)
seam2crvcorn = SeamToCurveCorner(Curve=seam)  # -> Adjusted, Point, R
seam2crvcorn_2 = SeamToCurveCorner(Curve=seam_2)  # -> Adjusted, Point, R
flip = FlipCurve(Curve=seam2crvcorn.Adjusted, Guide=plotoutline_2)  # -> Curve, Flag
flip_2 = FlipCurve(Curve=seam2crvcorn_2.Adjusted, Guide=plotoutline_2)  # -> Curve, Flag
panel_3 = Panel(flip.Curve)
basenoncore = Curve(flip.Curve)
base = Curve(flip_2.Curve)
base_2 = ClusterOutput(base)
basenoncore_2 = ClusterOutput(basenoncore)

# ==== cluster _2D
x = ClusterInput()
expression = Expression(x=x, Expression="x/2")
neg = Negative(Value=expression)
dom = ConstructDomain(DomainStart=neg, DomainEnd=expression)
I = ClusterOutput(dom)

# ==== cluster ValueOr0
value = ClusterInput()
value_2 = Number(value)
null = NullItem(Item=value_2)  # -> NullFlags, InvalidFlags, Description
filter = StreamFilter(Gate=null.NullFlags, Stream0=value_2, Stream1="0")
valueor0 = Number(filter)
valueor0_2 = ClusterOutput(valueor0)
