# Grasshopper definition capital.gh (Grasshopper 1.0.7)

number_slider = Slider(472, range=0..1000)
number_slider_2 = Slider(600, range=0..1000)
merge = Merge(Data1=Slider(0, range=0..1000), Data2=number_slider, Data3=Slider(751, range=0..10000), Data4=number_slider)
length = GetNumber(number_slider_2, AtLeast=1, AtMost=1, Maximum=1.797693135e+308, Minimum=-1.797693135e+308, TreeAccess=False)
height = GetNumber(Slider(1150, range=0..10000), AtLeast=1, AtMost=1, Maximum=1.797693135e+308, Minimum=-1.797693135e+308, TreeAccess=False)
width = GetNumber(number_slider_2, AtLeast=1, AtMost=1, Maximum=1.797693135e+308, Minimum=-1.797693135e+308, TreeAccess=False)
edgeheights = GetNumber(merge, AtLeast=1, AtMost=1, Maximum=1.797693135e+308, Minimum=-1.797693135e+308, TreeAccess=False)
wallthickness = GetNumber(Slider(30, range=0..100), AtLeast=1, AtMost=1, Maximum=1.797693135e+308, Minimum=-1.797693135e+308, TreeAccess=False)
xy = XYPlane(Origin=Point(0, 0, 0))
Z = UnitZ(Factor=height)
move = Move(Geometry=xy, Motion=Z)  # -> Geometry, Transform
_2d = _2D(x=length)
_2d_2 = _2D(x=width)
neg = Negative(Value=wallthickness)
rectangle = Rectangle(Plane=move.Geometry, XSize=_2d, YSize=_2d_2, Radius=0)  # -> Rectangle, Length
offset = OffsetCurve(Curve=rectangle.Rectangle, Distance=neg, Corners=1)
debrep = DeconstructBrep(Brep=rectangle.Rectangle)  # -> Faces, Edges, Vertices
neg_2 = Negative(Value=edgeheights)
trim = TrimTree(Tree=offset, Depth=1)
Z_2 = UnitZ(Factor=neg_2)
trim_2 = TrimTree(Tree=debrep.Vertices, Depth=1)
move_2 = Move(Geometry=trim_2, Motion=Z_2)  # -> Geometry, Transform
Z_3 = UnitZ(Factor=height)
rulesrf = RuledSurface(CurveA=rectangle.Rectangle, CurveB=trim)
item = ListItem(List=move_2.Geometry, Index=0, Wrap=True)  # -> Item, Item1, Item2, Item3
rev = Reverse(Vector=Z_3)
extr = Extrude(Base=rulesrf, Direction=rev)
srf4pt = _4PointSurface(CornerA=item.Item, CornerB=item.Item1, CornerC=item.Item2, CornerD=item.Item3)
split = SplitBrep(Brep=srf4pt, Cutter=extr)
split_2 = SplitBrep(Brep=extr, Cutter=srf4pt)
item_2 = ListItem(List=split, Index=0, Wrap=True)  # -> Item, Item1
item_3 = ListItem(List=split_2, Index=0, Wrap=True)  # -> Item, Item1
merge_2 = Merge(Data1=item_2.Item, Data2=item_3.Item1)
join = BrepJoin(Breps=merge_2)  # -> Breps, Closed
trim_3 = TrimTree(Tree=join.Breps, Depth=1)
head = Brep(trim_3)

# ==== cluster _2D
x = ClusterInput()
expression = Expression(x=x, Expression="x/2")
neg = Negative(Value=expression)
dom = ConstructDomain(DomainStart=neg, DomainEnd=expression)
I = ClusterOutput(dom)
