# Grasshopper definition core.gh (Grasshopper 1.0.7)

list = ValueList({"Front", "Right", "Bottom", "Left"}, selected="Right")
width = GetNumber(Slider(600, range=0..1000), AtLeast=1, AtMost=1, Maximum=1.797693135e+308, Minimum=-1.797693135e+308, TreeAccess=False)
capsules = GetInteger(Slider(10, range=0..20), AtLeast=1, AtMost=1, Maximum=2147483647, Minimum=-2147483648, TreeAccess=False)
capsuleheight = GetNumber(Slider(275, range=0..1000), AtLeast=1, AtMost=1, Maximum=1.797693135e+308, Minimum=-1.797693135e+308, TreeAccess=False)
bottomheight = GetNumber(Slider(600, range=0..1000), AtLeast=1, AtMost=1, Maximum=1.797693135e+308, Minimum=-1.797693135e+308, TreeAccess=False)
headheight = GetNumber(Slider(1150, range=0..10000), AtLeast=1, AtMost=1, Maximum=1.797693135e+308, Minimum=-1.797693135e+308, TreeAccess=False)
nocapsule_side_floor = GetBoolean(AtLeast=1, AtMost=1, FalseValue="False", TreeAccess=True, TrueValue="True")
bridge = GetString(list, AtLeast=1, AtMost=1, TreeAccess=False)
dooroffset = GetNumber(Slider(100, range=0..200), AtLeast=1, AtMost=1, Maximum=1.797693135e+308, Minimum=-1.797693135e+308, TreeAccess=False)
gap = GetNumber(Slider(20, range=0..100), AtLeast=1, AtMost=1, Maximum=1.797693135e+308, Minimum=-1.797693135e+308, TreeAccess=False)
multiplication = Multiplication(A=capsules, B=capsuleheight)
panel = Panel("""Front
Right
Bottom
Left""")
addition = Addition(A=multiplication, B=bottomheight)
itemindex = ItemIndex(L=panel, I=bridge)  # -> i; inputs L: list
# ---------- itemindex: Python ----------
#Component Information
#--------------------------------------------------------------------------------------------
if ghenv.Component.RunCount<2:
    #General
    #--------------------------------------------------------------------------------------------
    __author__ = "Ueli Saluz"
    __version__ = "2022.11.18"
    
    ghenv.Component.Name = "ItemIndex"
    ghenv.Component.NickName = "ItemIndex"
    ghenv.Component.Description = "A better IdemIndex"
    ghenv.Component.Message = "VER 1.0"
    ghenv.Component.Category = "Set"
    ghenv.Component.SubCategory = "List"
    
     #Inputs
    #--------------------------------------------------------------------------------------------
    inputIndex=0
    
    ghenv.Component.Params.Input[inputIndex].Name = "List"
    ghenv.Component.Params.Input[inputIndex].NickName = "L"
    ghenv.Component.Params.Input[inputIndex].Description = "Input1 is..."
    ghenv.Component.Params.Input[inputIndex].Optional = False
    inputIndex+=1
    
    ghenv.Component.Params.Input[inputIndex].Name = "Item"
    ghenv.Component.Params.Input[inputIndex].NickName = "I"
    ghenv.Component.Params.Input[inputIndex].Description = "Input2 is..."
    ghenv.Component.Params.Input[inputIndex].Optional = False
    inputIndex+=1
    
    #Outputs
    #--------------------------------------------------------------------------------------------
    outputIndex=0
    
    ghenv.Component.Params.Output[outputIndex].Name = "Index"
    ghenv.Component.Params.Output[outputIndex].NickName = "i"
    ghenv.Component.Params.Output[outputIndex].Description = "Output1 is..."
    outputIndex+=1

i = L.index(I)
# ---------- end itemindex ----------
addition_2 = Addition(A=multiplication, B=bottomheight, C=headheight)
dom = ConstructDomain(DomainStart=bottomheight, DomainEnd=addition)
_2d = _2D(x=width)
valueor0 = ValueOr0(value=itemindex)
box = DomainBox(Base=PlaneXY(0, 0, 0), X=_2d, Y=_2d, Z=dom)
box_2 = DomainBox(Base=PlaneXY(0, 0, 0), X=_2d, Y=_2d, Z=addition_2)
capsuleshaft = Box(box)
core = Box(box_2)
debrep = DeconstructBrep(Brep=capsuleshaft)  # -> Faces, Edges, Vertices
trim = TrimTree(Tree=debrep.Faces, Depth=1)
item = ListItem(List=trim, Index=0, Wrap=True)  # -> Item, Item1, Item2, Item3, Item4
base = Surface(item.Item4)
explode = Explode(Curve=base, Recursive=True)  # -> Segments, Vertices
trim_2 = TrimTree(Tree=explode.Segments, Depth=1)
join = JoinCurves(Curves=explode.Segments, Preserve=False)
trim_3 = TrimTree(Tree=join, Depth=1)
curvepoint = PointOnCurve(trim_2, parameter=0.5)
expression = Expression(x=gap, Expression="x/2")
crv_cp = CurveClosestPoint(Point=curvepoint, Curve=trim_2)  # -> Point, Parameter, Distance
addition_3 = Addition(A=expression, B=dooroffset)
addition_4 = Addition(A=crv_cp.Parameter, B=addition_3)
subtraction = Subtraction(A=crv_cp.Parameter, B=addition_3)
expression_2 = Expression(x=capsuleheight, Expression="x/2")
eval = EvaluateCurve(Curve=trim_2, Parameter=addition_4)  # -> Point, Tangent, Angle
eval_2 = EvaluateCurve(Curve=trim_2, Parameter=subtraction)  # -> Point, Tangent, Angle
lng = ListLength(List=trim_2)
shift = ShiftList(List=eval_2.Point, Shift=1, Wrap=True)
dup = DuplicateData(Data=expression_2, Number=lng, Order=True)
expression_3 = Expression(x=valueor0, y=lng, Expression="(y-x-1)%y")
trim_4 = TrimTree(Tree=shift, Depth=1)
trim_5 = TrimTree(Tree=dup, Depth=1)
expression_4 = Expression(x=capsules, Expression="x*4")
merge = Merge(Data1=graft(eval.Point), Data2=graft(trim_4))
replace = ReplaceItems(List=trim_5, Item="0", Indices=expression_3, Wrap=False)
repeat = RepeatData(Data=replace, Length=expression_4)
l2o = List2Object(L=merge)  # -> O; inputs L: tree
# ---------- l2o: Python ----------
#Component Information
#--------------------------------------------------------------------------------------------
if ghenv.Component.RunCount<2:
    #General
    #--------------------------------------------------------------------------------------------
    __author__ = "Ueli Saluz"
    __version__ = "2022.04.24"
    
    ghenv.Component.Name = "List2Object"
    ghenv.Component.NickName = "L2O"
    ghenv.Component.Description = "Wraps a list of objects into a list object."
    ghenv.Component.Message = "VER 1.0"
    ghenv.Component.Category = "Sets"
    ghenv.Component.SubCategory = "Tree"
    
     #Inputs
    #--------------------------------------------------------------------------------------------
    inputIndex=0
    
    ghenv.Component.Params.Input[inputIndex].Name = "List"
    ghenv.Component.Params.Input[inputIndex].NickName = "L"
    ghenv.Component.Params.Input[inputIndex].Description = "Tree with lists to wrap."
    ghenv.Component.Params.Input[inputIndex].Optional = False
    inputIndex+=1
    

    #Outputs
    #--------------------------------------------------------------------------------------------
    outputIndex=0
    
    ghenv.Component.Params.Output[outputIndex].Name =  "ListObject" 
    ghenv.Component.Params.Output[outputIndex].NickName = "O"
    ghenv.Component.Params.Output[outputIndex].Description = "Python list object as single item."
    outputIndex+=1


#Imports
#--------------------------------------------------------------------------------------------
from System import Object
from Grasshopper import DataTree

#Solver - Run with trees to enhance performance drastically
#--------------------------------------------------------------------------------------------
if __name__ == "__main__":
    
    #Initialize trees
    #--------------------------------------------------------------------------------------------
    TreeToWrap = DataTree[Object]()
    
    #Data matching
    #--------------------------------------------------------------------------------------------
    for path in L.Paths:
        listBranch = L.Branch(path)
        TreeToWrap.Add(listBranch,path)
    
     #Assign trees to output
    #--------------------------------------------------------------------------------------------
    O = TreeToWrap
# ---------- end l2o ----------
points = PointList(Points=merge, Size=Slider(49, range=0..110))
trim_6 = TrimTree(Tree=repeat, Depth=1)
trim_7 = TrimTree(Tree=l2o, Depth=1)
ma = MassAddition(Input=trim_6)  # -> Result, PartialResults
repeat_2 = RepeatData(Data=trim_7, Length=expression_4)
flip = FlipMatrix(Data=ma.PartialResults)
trim_8 = TrimTree(Tree=repeat_2, Depth=1)
Z = UnitZ(Factor=flip)
o2l = Object2List(O=trim_8)  # -> L; inputs O: tree
# ---------- o2l: Python ----------
#Component Information
#--------------------------------------------------------------------------------------------
if ghenv.Component.RunCount<2:
    #General
    #--------------------------------------------------------------------------------------------
    __author__ = "Ueli Saluz"
    __version__ = "2022.04.24"
    
    ghenv.Component.Name = "Object2List"
    ghenv.Component.NickName = "O2L"
    ghenv.Component.Description = "Unwraps a list of objects into a list object."
    ghenv.Component.Message = "VER 1.0"
    ghenv.Component.Category = "Sets"
    ghenv.Component.SubCategory = "Tree"
    
     #Inputs
    #--------------------------------------------------------------------------------------------
    inputIndex=0
    
    ghenv.Component.Params.Input[inputIndex].Name = "ListObject"
    ghenv.Component.Params.Input[inputIndex].NickName = "O"
    ghenv.Component.Params.Input[inputIndex].Description = "A python list object that will be unwrapped into a Grasshopper list."
    ghenv.Component.Params.Input[inputIndex].Optional = False
    inputIndex+=1
    

    #Outputs
    #--------------------------------------------------------------------------------------------
    outputIndex=0
    
    ghenv.Component.Params.Output[outputIndex].Name =  "List"
    ghenv.Component.Params.Output[outputIndex].NickName = "L"
    ghenv.Component.Params.Output[outputIndex].Description = "The unwrapped list."
    outputIndex+=1


#Imports
#--------------------------------------------------------------------------------------------
from System import Object
from Grasshopper import DataTree

#Solver - Run with trees to enhance performance drastically
#--------------------------------------------------------------------------------------------
if __name__ == "__main__":
    
    #Initialize trees
    #--------------------------------------------------------------------------------------------
    OriginalTree = DataTree[Object]()
    
    #Data matching
    #--------------------------------------------------------------------------------------------
    for path in O.Paths:
        listBranch = O.Branch(path)
        for i,listItem in enumerate(listBranch):
            OriginalTree.AddRange(list(listItem),path.AppendElement(i))
    
     #Assign trees to output
    #--------------------------------------------------------------------------------------------
    L = OriginalTree
# ---------- end o2l ----------
match = MatchTree(Tree=Z, Guide=o2l)
move = Move(Geometry=o2l, Motion=match)  # -> Geometry, Transform
crv_cp_2 = CurveClosestPoint(Point=move.Geometry, Curve=trim_3)  # -> Point, Parameter, Distance
eval_3 = EvaluateCurve(Curve=trim_3, Parameter=crv_cp_2.Parameter)  # -> Point, Tangent, Angle
item_2 = ListItem(List=flatten(move.Geometry), Index=Slider(0, range=0..10), Wrap=True)
panel_2 = Panel(move.Geometry)
rev = Reverse(Vector=eval_3.Tangent)
line = LineSDL(Start=eval_3.Point, Direction=Vector(0, 0, 1), Length=1)
vrot = Rotate(Vector=rev, Axis=line, Angle=degrees("90"))
pl = ConstructPlane(Origin=eval_3.Point, XAxis=rev, YAxis=vrot)
move_2 = Move(Geometry=pl, Motion=Z)  # -> Geometry, Transform
panel_3 = Panel(move_2.Geometry)
number_slider = Slider(100, range=0..100)
amp = Amplitude(Vector=rev, Amplitude=number_slider)
vdisex = VectorDisplayEx(Point=eval_3.Point, Vector=amp, Colour=RGB(0, 0, 0), Width=Slider(3, range=0..10))
capsuleconnectionplanes = Plane(move_2.Geometry)
previewplane = PreviewPlane(plane=capsuleconnectionplanes, axis_length=number_slider)

# ==== cluster _2D
x = ClusterInput()
expression = Expression(x=x, Expression="x/2")
neg = Negative(Value=expression)
dom = ConstructDomain(DomainStart=neg, DomainEnd=expression)
I = ClusterOutput(dom)

# ==== cluster ValueOr0
value = ClusterInput()
value_2 = Number(value)
null = NullItem(Item=value_2)  # -> NullFlags, InvalidFlags, Description
filter = StreamFilter(Gate=null.NullFlags, Stream0=value_2, Stream1="0")
valueor0 = Number(filter)
valueor0_2 = ClusterOutput(valueor0)

# ==== cluster PreviewPlane: Preview a plane with axis colors and naming.
axis_length = ClusterInput()
plane = ClusterInput()
axis_length_2 = Number(axis_length)
plane_2 = Plane(plane)
deplane = DeconstructPlane(Plane=plane_2)  # -> Origin, XAxis, YAxis, ZAxis
line = LineSDL(Start=deplane.Origin, Direction=deplane.YAxis, Length=axis_length_2)
line_2 = LineSDL(Start=deplane.Origin, Direction=deplane.XAxis, Length=axis_length_2)
line_3 = LineSDL(Start=deplane.Origin, Direction=deplane.ZAxis, Length=axis_length_2)
swatch = ColourSwatch(SwatchColor=RGB(235, 52, 79))
swatch_2 = ColourSwatch(SwatchColor=RGB(0, 166, 157))
swatch_3 = ColourSwatch(SwatchColor=RGB(240, 117, 24))
end = EndPoints(Curve=line_2)  # -> Start, End
end_2 = EndPoints(Curve=line)  # -> Start, End
end_3 = EndPoints(Curve=line_3)  # -> Start, End
tag = TextTag(Location=end.End, Text="X", Colour=swatch)
tag_2 = TextTag(Location=end_2.End, Text="Y", Colour=swatch_2)
tag_3 = TextTag(Location=end_3.End, Text="Z", Colour=swatch_3)
preview = CustomPreview(Geometry=line_2, Material=swatch)
preview_2 = CustomPreview(Geometry=line, Material=swatch_2)
preview_3 = CustomPreview(Geometry=line_3, Material=swatch_3)
