# Grasshopper definition nakagincapsuletower.gh (Grasshopper 1.0.7)
# plug-ins: Semio, Swiftlet, Octopus

list = ValueList({"Front", "Side"}, selected="Front")
list_2 = ValueList({"Back", "Side"}, selected="Side")
parameter = ConstructParameter(Name="Length", Value=Slider(420, range=0..1000))
parameter_2 = ConstructParameter(Name="Width", Value=Slider(270, range=0..1000))
parameter_3 = ConstructParameter(Name="Height", Value=Slider(275, range=0..1000))
parameter_4 = ConstructParameter(Name="Mirror", Value=Toggle(False))
parameter_5 = ConstructParameter(Name="Entrance", Value=list_2)
parameter_6 = ConstructParameter(Name="Window", Value=list)
xy = XYPlane(Origin=Point(0, 0, 0))
xy_2 = XYPlane(Origin=Point(0, 0, 0))
panel = Panel("C:\Git\Studium\PhD\semio\examples\nakagincapsuletower")
common = Parameter()
prot = RotatePlane(Plane=xy, Angle=degrees("180"))
prot_2 = RotatePlane(Plane=xy_2, Angle=degrees("180"))
parameter_7 = ConstructParameter(Name="Length", Value=Slider(420, range=0..1000))
po = Pose()
common_2 = Parameter(common)
list_3 = ValueList({"Front", "Side"}, selected="Front")
capsules = Integer(Slider(10, range=0..10))
concat = Concatenate(FragmentA=panel, FragmentB="\", FragmentC="base.gh")
concat_2 = Concatenate(FragmentA=panel, FragmentB="\", FragmentC="shaft.gh")
concat_3 = Concatenate(FragmentA=panel, FragmentB="\", FragmentC="capital.gh")
concat_4 = Concatenate(FragmentA=panel, FragmentB="\", FragmentC="capsule.gh")
uri = Text(concat_4)

list_4 = ValueList({"Front", "Side"}, selected="Side")
parameter_8 = ConstructParameter(Name="Mirror", Value=Toggle(True))
parameter_9 = ConstructParameter(Name="Window", Value=list_4)
merge = Merge(Data1=common_2, Data2=parameter_9, Data3=parameter_8)
plan = ConstructPlan(Uri=uri, Parameters=merge)  # -> Plan, Hash
dup = DuplicateData(Data=plan.Plan, Number=Slider(10, range=0..10), Order=True)
trim = TrimTree(Tree=dup, Depth=1)
topbottom = TopBottom(pl=trim, po=prot_2)  # -> so_2, C_2, first_2, last_2

merge_2 = Merge(Data1=common_2)
plan_2 = ConstructPlan(Uri=uri, Parameters=merge_2)  # -> Plan, Hash
dup_2 = DuplicateData(Data=plan_2.Plan, Number=Slider(11, range=0..100), Order=True)
trim_2 = TrimTree(Tree=dup_2, Depth=1)
topbottom_2 = TopBottom(pl=trim_2, po=prot_2)  # -> so_2, C_2, first_2, last_2

list_5 = ValueList({"Back", "Side"}, selected="Side")
number_slider = Slider(300, range=0..1000)
parameter_10 = ConstructParameter(Name="Window", Value=list_3)
parameter_11 = ConstructParameter(Name="Mirror", Value=Toggle(True))
dup_3 = DuplicateData(Data=concat_4, Number=capsules, Order=True)

sobject = ConstructSobject(Plan=concat)
link = ConstructLink(Ports="Primary")
link_2 = ConstructLink(Ports="Secondary")
connectable = ConstructConnectable(Sobject=sobject, Link=link)
connectable_2 = ConstructConnectable(Sobject=sobject, Link=link_2)

sobject_2 = ConstructSobject(Plan=concat_2)
link_3 = ConstructLink(Ports="Bottom")
link_4 = ConstructLink(Ports="Door")
connectable_3 = ConstructConnectable(Sobject=sobject_2, Link=link_3)
connectable_4 = ConstructConnectable(Sobject=sobject_2, Link=link_4)

sobject_3 = ConstructSobject(Plan=concat_2)
link_5 = ConstructLink(Ports="Bottom")
link_6 = ConstructLink(Ports="Door")
connectable_5 = ConstructConnectable(Sobject=sobject_3, Link=link_5)
connectable_6 = ConstructConnectable(Sobject=sobject_3, Link=link_6)

parameter_12 = ConstructParameter(Name="Length", Value=Slider(440, range=0..1000))
parameter_13 = ConstructParameter(Name="Entrance", Value=list_5)
number_slider_2 = Slider(-5, range=-1000..1000)
merge_3 = Merge(Data1=parameter_11, Data2=parameter_10)
trim_3 = TrimTree(Tree=dup_3, Depth=1)
parameter_14 = ConstructParameter(Name="Height", Value=Slider(500, range=0..1000))

parameter_15 = ConstructParameter(Name="V", Value="0")
link_7 = ConstructLink(Ports="Side")
link_8 = ConstructLink(Ports="Side", Bias=parameter_15)
connectable_7 = ConstructConnectable(Sobject=topbottom_2.first_2, Link=link_7)
connectable_8 = ConstructConnectable(Sobject=topbottom.first_2, Link=link_8)
connection = ConstructConnection(Connecting=connectable_8, Connected=connectable_7)

xy_3 = XYPlane(Origin=Point(0, 0, 0))
Z = UnitZ(Factor=number_slider)
X = UnitX(Factor=number_slider)
merge_4 = Merge(Data1=parameter_12, Data3=parameter_13)
link_9 = ConstructLink(Ports="Bottom")
link_10 = ConstructLink(Ports="Top")
concat_5 = Concatenate(FragmentA=panel, FragmentB="\", FragmentC="bouleenewtoncapsule.gh")
plan_3 = ConstructPlan(Uri=trim_3, Parameters=merge_3)  # -> Plan, Hash
plan_4 = ConstructPlan(Uri=concat_4, Parameters=parameter_14)  # -> Plan, Hash
arrlinear = LinearArray(Geometry=xy_3, Direction=X, Count=capsules)  # -> Geometry, Transform
plan_5 = ConstructPlan(Url=concat_4, Parameters=merge_4)  # -> Plan, Hash
sobject_4 = ConstructSobject(Pose=prot_2, Plan=plan_3.Plan)
trim_4 = TrimTree(Tree=arrlinear.Geometry, Depth=1)
sobject_5 = ConstructSobject(Plan=plan_4.Plan)
cluster = Cluster(
    X=Slider(-400, range=-1000..1000),
    Y=Slider(10, range=-1000..1000),
    Z=0,
    yaw=Slider(0, range=-360..360),
    pitch=Slider(0, range=-360..360),
    roll=Slider(0, range=-360..360))
connection_2 = ConstructConnection(Connecting=connectable_5, Connected=connectable_2)
connection_3 = ConstructConnection(Connecting=connectable_3, Connected=connectable)
sobject_6 = ConstructSobject(Pose=trim_4, Plan=plan_5.Plan)
link_11 = ConstructLink(Protocol="Simple")
item = ListItem(List=sobject_4, Index=0, Wrap=True)
link_12 = ConstructLink(Ports="Bottom")
link_13 = ConstructLink(Ports="Top")
connectable_9 = ConstructConnectable(Sobject=sobject_6, Link=link_11)
shift = ShiftList(List=sobject_4, Shift=1, Wrap="False")
trim_5 = TrimTree(Tree=shift, Depth=1)
shift_2 = ShiftList(List=sobject_4, Shift="-1", Wrap="False")
trim_6 = TrimTree(Tree=shift_2, Depth=1)
connectable_10 = ConstructConnectable(Sobject=sobject_5, Link=link_12)
run = Boolean(Toggle(False))
server = Text("http://localhost:2999")
connectable_11 = ConstructConnectable(Sobject=sobject_5, Link=link_13)
layout = ConstructLayout(Sobjects=[sobject, sobject_2], Connections=connection_3, Assembly=sobject)
merge_5 = Merge(Data1=arrlinear.Geometry)
shift_3 = ShiftList(List=connectable_9, Shift="-1", Wrap="False")
shift_4 = ShiftList(List=connectable_9, Shift=1, Wrap="False")
connectable_12 = ConstructConnectable(Sobject=trim_6, Link=link_10)
connectable_13 = ConstructConnectable(Sobject=trim_5, Link=link_9)
merge_6 = Merge(Data1=topbottom_2.C_2, Data2=connection, Data3=topbottom.C_2)
merge_7 = Merge(Data1=topbottom_2.so_2, Data2=topbottom.so_2)
layout_design = LayoutDesign(Url=server, Layout=layout, Run=Toggle(False))
connection_4 = ConstructConnection(Connecting=connectable_10, Connected=connectable)
connection_5 = ConstructConnection(Connecting=connectable_3, Connected=connectable_11)
previewplane = PreviewPlane(plane=merge_5, axis_length=Slider(200, range=0..1000))
trim_7 = TrimTree(Tree=shift_3, Depth=1)
trim_8 = TrimTree(Tree=shift_4, Depth=1)
link_14 = ConstructLink(Ports="Door")
connection_6 = ConstructConnection(Connecting=connectable_13, Connected=connectable_12)
so = Sobject(merge_7)
C = Connection(merge_6)
merge_8 = Merge(Data1=C, Data2=connection)
panel_2 = Panel("Simple")
merge_9 = Merge(Data1=connection_4, Data2=connection_5)
connectable_14 = ConstructConnectable(Sobject=topbottom_2.first_2, Link=link_14)
connection_7 = ConstructConnection(Connecting=trim_7, Connected=trim_8)
item_2 = ListItem(List=sobject_6, Index=0, Wrap=True)
merge_10 = Merge(Data1=sobject, Data2=sobject_2, Data3=sobject_3, Data4=so, Data5=sobject_5)
design = ShowDesign(Design=layout_design, Concepts="Detailed")
layout_2 = ConstructLayout(Sobjects=so, Connections=C, Assembly=topbottom_2.first_2)
layout_3 = ConstructLayout(Sobjects=sobject_6, Connections=connection_7, Assembly=item_2)
connection_8 = ConstructConnection(Connecting=connectable_4, Connected=connectable_14)
merge_11 = Merge(Data1=connection_8, Data2=connection_2, Data3=merge_8, Data4=merge_9)
panel_3 = Panel("Wireframe")
panel_4 = Panel("Detailed")
layout_4 = ConstructLayout(Sobjects=merge_10, Connections=merge_11, Assembly=sobject)
layout_design_2 = LayoutDesign(Url=server, Layout=layout_2, Run=Toggle(True))
layout_design_3 = LayoutDesign(Url=server, Layout=layout_3, Run=run)
layout_design_4 = LayoutDesign(Url=server, Layout=layout_4, Run=Toggle(True))
design_2 = ShowDesign(Design=layout_design_3, Concepts="Surfaces")
dedesign = DeconstructDesign(Design=layout_design_3)  # -> Prototypes, Elements
mutate_an_octopus_solution = Mutate(MutationProbability=topbottom_2.last_2, MutationRate=0.1)
design_3 = ShowDesign(Design=layout_design_2, Concepts="Simple")
deelement = DeconstructElement(Element=dedesign.Elements)  # -> SobjectId, PlanHash, Pose
m2d_rhino = Make2DRhinoView(Name="Perspective", Clip=True)
design_4 = ShowDesign(Design=layout_design_2, Concepts="Surfaces")
design_5 = ShowDesign(Design=layout_design_4, Concepts="Simple")
previewplane_2 = PreviewPlane(plane=deelement.Pose, axis_length=Slider(100, range=0..1000))
number_slider_3 = Slider(0, range=0..1)
make2d = Make2D(Geometry=design_4, View=m2d_rhino, TangentEdges=False, TangentSeams=False, AutoComputeMake2D=False)  # -> VisibleCurves, VisibleIndex, VisibleType, HiddenCurves, HiddenIndex, HiddenType
m2d_parallel = Make2DParallelView()
crv = Curve(make2d.VisibleCurves)
setview = SetView()  # -> F; inputs P: Int32, L: Point3d, D: Vector3d, Up: Vector3d, R: Boolean
#   port P: 0 = Parallel view 1 = Perspective view
# ---------- setview: Python ----------
#Component Information
#--------------------------------------------------------------------------------------------
if ghenv.Component.RunCount<2:
    #General
    #--------------------------------------------------------------------------------------------
    __author__ = "Ueli Saluz"
    __version__ = "2022.05.22"
    
    ghenv.Component.Name = "SetView"
    ghenv.Component.NickName = "SetView"
    ghenv.Component.Description = "Set a camera view and projection."
    ghenv.Component.Message = "VER 1.1"
    ghenv.Component.Category = "Display"
    ghenv.Component.SubCategory = "Camera"
    
     #Inputs
    #--------------------------------------------------------------------------------------------
    inputIndex=0
    
    ghenv.Component.Params.Input[inputIndex].Name = "Name"
    ghenv.Component.Params.Input[inputIndex].NickName = "N"
    ghenv.Component.Params.Input[inputIndex].Description = "Name of the viewport"
    ghenv.Component.Params.Input[inputIndex].Optional = True
    inputIndex+=1
    
    ghenv.Component.Params.Input[inputIndex].Name = "Projection"
    ghenv.Component.Params.Input[inputIndex].NickName = "P"
    ghenv.Component.Params.Input[inputIndex].Description = "0 = Parallel view\n"+\
                                                           "1 = Perspective view"
    ghenv.Component.Params.Input[inputIndex].Optional = True
    inputIndex+=1
    
    
    ghenv.Component.Params.Input[inputIndex].Name = "CameraLocation"
    ghenv.Component.Params.Input[inputIndex].NickName = "L"
    ghenv.Component.Params.Input[inputIndex].Description = "Location of the camera."
    ghenv.Component.Params.Input[inputIndex].Optional = True
    inputIndex+=1
    
    ghenv.Component.Params.Input[inputIndex].Name = "CameraDirection"
    ghenv.Component.Params.Input[inputIndex].NickName = "D"
    ghenv.Component.Params.Input[inputIndex].Description = "Direction of the camera."
    ghenv.Component.Params.Input[inputIndex].Optional = True
    inputIndex+=1
    
    ghenv.Component.Params.Input[inputIndex].Name = "CameraUp"
    ghenv.Component.Params.Input[inputIndex].NickName = "Up"
    ghenv.Component.Params.Input[inputIndex].Description = "Up vector of the camera."
    ghenv.Component.Params.Input[inputIndex].Optional = True
    inputIndex+=1
    
    ghenv.Component.Params.Input[inputIndex].Name = "LensLength"
    ghenv.Component.Params.Input[inputIndex].NickName = "LL"
    ghenv.Component.Params.Input[inputIndex].Description = "Lens length of the camera. Only relevant if projection is perspective."
    ghenv.Component.Params.Input[inputIndex].Optional = True
    inputIndex+=1
    
    ghenv.Component.Params.Input[inputIndex].Name = "Run"
    ghenv.Component.Params.Input[inputIndex].NickName = "R"
    ghenv.Component.Params.Input[inputIndex].Description = "Zoom to the given bounding box."
    ghenv.Component.Params.Input[inputIndex].Optional = False
    inputIndex+=1
    
    #Outputs
    #--------------------------------------------------------------------------------------------
    outputIndex=0
    
    ghenv.Component.Params.Output[outputIndex].Name = "Finished"
    ghenv.Component.Params.Output[outputIndex].NickName = "F"
    ghenv.Component.Params.Output[outputIndex].Description = "Sends True when finished. Just to trigger other depending components."
    outputIndex+=1
    


#Imports
#--------------------------------------------------------------------------------------------
from Rhino import RhinoDoc
from Rhino.Geometry import Box

#Solver - Run with trees to enhance performance drastically
#--------------------------------------------------------------------------------------------
if __name__ == "__main__":
    
    if R:
        if N is not None:
            view = RhinoDoc.ActiveDoc.Views.Find(N, False)
        else:
            view = RhinoDoc.ActiveDoc.Views.ActiveView
        vp = view.ActiveViewport
        if P is not None:
            if (P==0):
                vp.ChangeToParallelProjection(True)
            else:
                vp.ChangeToPerspectiveProjection(True,LL)
        if L is not None:
            vp.SetCameraLocation(L,False)
        if D is not None:
            vp.SetCameraDirection(D,False)
        if Up is not None:
            vp.CameraUp = Up
    F = True
# ---------- end setview ----------
fjs = FormatJsonString(JSONString=sobject_6)
panel_5 = Panel(fjs)
sobject_7 = ConstructSobject(Plan=concat)
sobject_8 = ConstructSobject(Plan=concat)
sobject_9 = ConstructSobject(Plan=concat_2)
connectable_15 = ConstructConnectable(Sobject=sobject_8)
connectable_16 = ConstructConnectable(Sobject=sobject_7)
merge_12 = Merge(Data1=sobject_8, Data2=sobject_7)
layout_5 = ConstructLayout(Sobjects=sobject_9, Assembly=sobject_9)
layout_6 = ConstructLayout(Sobjects=sobject_8, Assembly=sobject_8)
link_15 = ConstructLink()
layout_design_5 = LayoutDesign(Url=server, Layout=layout_5, Run=Toggle(True))
layout_design_6 = LayoutDesign(Url=server, Layout=layout_6, Run=Toggle(True))
design_6 = ShowDesign(Design=layout_design_6, Concepts="Detailed")
design_7 = ShowDesign(Design=layout_design_5, Concepts="Surfaces")

# ==== cluster Cluster
X = ClusterInput()
Y = ClusterInput()
Z = ClusterInput()
yaw = ClusterInput()
pitch = ClusterInput()
roll = ClusterInput()
yawpitchroll = NAME(yaw=yaw, pitch=pitch, roll=roll)  # -> t
# ---------- yawpitchroll: Python ----------
from Rhino.Geometry import Transform
from math import radians

t = Transform.RotationZYX(radians(yaw),radians(pitch),radians(roll))
# ---------- end yawpitchroll ----------
pt = ConstructPoint(XCoordinate=X, YCoordinate=Y, ZCoordinate=Z)
xy = XYPlane(Origin=Point(0, 0, 0))
transform = Transform(Geometry=xy, Transform=yawpitchroll)
pl_origin = PlaneOrigin(Base=transform, Origin=pt)
pln = Plane(pl_origin)
pln_2 = ClusterOutput(pln)

# ==== cluster PreviewPlane: Preview a plane with axis colors and naming.
axis_length = ClusterInput()
plane = ClusterInput()
axis_length_2 = Number(axis_length)
plane_2 = Plane(plane)
deplane = DeconstructPlane(Plane=plane_2)  # -> Origin, XAxis, YAxis, ZAxis
line = LineSDL(Start=deplane.Origin, Direction=deplane.YAxis, Length=axis_length_2)
line_2 = LineSDL(Start=deplane.Origin, Direction=deplane.XAxis, Length=axis_length_2)
line_3 = LineSDL(Start=deplane.Origin, Direction=deplane.ZAxis, Length=axis_length_2)
swatch = ColourSwatch(SwatchColor=RGB(235, 52, 79))
swatch_2 = ColourSwatch(SwatchColor=RGB(0, 166, 157))
swatch_3 = ColourSwatch(SwatchColor=RGB(240, 117, 24))
end = EndPoints(Curve=line_2)  # -> Start, End
end_2 = EndPoints(Curve=line)  # -> Start, End
end_3 = EndPoints(Curve=line_3)  # -> Start, End
tag = TextTag(Location=end.End, Text="X", Colour=swatch)
tag_2 = TextTag(Location=end_2.End, Text="Y", Colour=swatch_2)
tag_3 = TextTag(Location=end_3.End, Text="Z", Colour=swatch_3)
preview = CustomPreview(Geometry=line_2, Material=swatch)
preview_2 = CustomPreview(Geometry=line, Material=swatch_2)
preview_3 = CustomPreview(Geometry=line_3, Material=swatch_3)

# ==== cluster TopBottom
po = ClusterInput()
pl = ClusterInput()
po_2 = Pose(po)
pl_2 = Plan(pl)
sobject = ConstructSobject(Pose=po_2, Plan=pl_2)
link = ConstructLink(Ports="Top")
link_2 = ConstructLink(Ports="Bottom")
item = ListItem(List=sobject, Index=0, Wrap=True)  # -> Item1, Item
shift = ShiftList(List=sobject, Shift="-1", Wrap="False")
shift_2 = ShiftList(List=sobject, Shift=1, Wrap="False")
trim = TrimTree(Tree=shift_2, Depth=1)
trim_2 = TrimTree(Tree=shift, Depth=1)
connectable = ConstructConnectable(Sobject=trim_2, Link=link)
connectable_2 = ConstructConnectable(Sobject=trim, Link=link_2)
connection = ConstructConnection(Connecting=connectable_2, Connected=connectable)
C = Connection(connection)
first = Sobject(item.Item)
last = Sobject(item.Item1)
so = Sobject(sobject)
C_2 = ClusterOutput(C)
first_2 = ClusterOutput(first)
last_2 = ClusterOutput(last)
so_2 = ClusterOutput(so)
