# Grasshopper definition shaft.gh (Grasshopper 1.0.7)
# plug-ins: Semio

# Connection:
# |
# |
# |
# |
# |
# |
number_slider = Slider(0, range=0..10)
# Outputs ->
number_slider_2 = Slider(0, range=0..10)
# Parameters:
# Model:
# |
# |
# |
# |
# |
# |
# |
# |
# |
# |
# |
number_slider_3 = Slider(600, range=0..1000)
list = ValueList({"Front", "Right", "Bottom", "Left"}, selected="Right")
connection_bias_floor = GetInteger(number_slider, AtLeast=1, AtMost=1, Maximum=2147483647, Minimum=-2147483648, TreeAccess=False)
# Debug ->
# External
#       |
#       v
width = GetNumber(number_slider_3, AtLeast=1, AtMost=1, Maximum=1.797693135e+308, Minimum=-1.797693135e+308, TreeAccess=False)
floors = GetInteger(Slider(10, range=0..20), AtLeast=1, AtMost=1, Maximum=2147483647, Minimum=-2147483648, TreeAccess=False)
floorheight = GetNumber(Slider(275, range=0..1000), AtLeast=1, AtMost=1, Maximum=1.797693135e+308, Minimum=-1.797693135e+308, TreeAccess=False)
connection_bias_splitlevel = GetInteger(Slider(0, range=0..10), AtLeast=1, AtMost=1, Maximum=2147483647, Minimum=-2147483648, TreeAccess=False)
connection_bias_door = GetInteger(number_slider_2, AtLeast=1, AtMost=1, Maximum=2147483647, Minimum=-2147483648, TreeAccess=False)
bridge = GetString(list, AtLeast=1, AtMost=1, TreeAccess=False)
dooroffset = GetNumber(Slider(100, range=0..200), AtLeast=1, AtMost=1, Maximum=1.797693135e+308, Minimum=-1.797693135e+308, TreeAccess=False)
gap = GetNumber(Slider(20, range=0..100), AtLeast=1, AtMost=1, Maximum=1.797693135e+308, Minimum=-1.797693135e+308, TreeAccess=False)
panel = Panel("""Front
Right
Bottom
Left""")
# Local ->
multiplication = Multiplication(A=floors, B=floorheight)
itemindex = ItemIndex(L=panel, I=bridge)  # -> i; inputs L: list
# ---------- itemindex: Python ----------
#Component Information
#--------------------------------------------------------------------------------------------
if ghenv.Component.RunCount<2:
    #General
    #--------------------------------------------------------------------------------------------
    __author__ = "Ueli Saluz"
    __version__ = "2022.11.18"
    
    ghenv.Component.Name = "ItemIndex"
    ghenv.Component.NickName = "ItemIndex"
    ghenv.Component.Description = "A better IdemIndex"
    ghenv.Component.Message = "VER 1.0"
    ghenv.Component.Category = "Set"
    ghenv.Component.SubCategory = "List"
    
     #Inputs
    #--------------------------------------------------------------------------------------------
    inputIndex=0
    
    ghenv.Component.Params.Input[inputIndex].Name = "List"
    ghenv.Component.Params.Input[inputIndex].NickName = "L"
    ghenv.Component.Params.Input[inputIndex].Description = "Input1 is..."
    ghenv.Component.Params.Input[inputIndex].Optional = False
    inputIndex+=1
    
    ghenv.Component.Params.Input[inputIndex].Name = "Item"
    ghenv.Component.Params.Input[inputIndex].NickName = "I"
    ghenv.Component.Params.Input[inputIndex].Description = "Input2 is..."
    ghenv.Component.Params.Input[inputIndex].Optional = False
    inputIndex+=1
    
    #Outputs
    #--------------------------------------------------------------------------------------------
    outputIndex=0
    
    ghenv.Component.Params.Output[outputIndex].Name = "Index"
    ghenv.Component.Params.Output[outputIndex].NickName = "i"
    ghenv.Component.Params.Output[outputIndex].Description = "Output1 is..."
    outputIndex+=1

i = L.index(I)
# ---------- end itemindex ----------
coreheight = Number(multiplication)
expression = Expression(x=connection_bias_floor, Expression="x*3")
valueor0 = ValueOr0(value=itemindex)
addition = Addition(A=expression, B=connection_bias_splitlevel)
dom = ConstructDomain(DomainStart=0, DomainEnd=coreheight)
_2d = _2D(x=width)
expression_2 = Expression(x=valueor0, Expression="-((x+2)*90)%360")
box = DomainBox(Base=PlaneXY(0, 0, 0), X=_2d, Y=_2d, Z=dom)
corevolume = Box(box)
wires = BrepWireframe(Brep=corevolume, Density=-1)
trim = TrimTree(Tree=wires, Depth=1)
geo = Geometry(trim)
geo_2 = Geometry(corevolume)
debrep = DeconstructBrep(Brep=corevolume)  # -> Faces, Edges, Vertices
serialize = Serialize(Input=geo)
serialize_2 = Serialize(Input=geo_2)
trim_2 = TrimTree(Tree=debrep.Faces, Depth=1)
representation = ConstructRepresentation(Body=serialize, Concepts="Wireframe")
representation_2 = ConstructRepresentation(Body=serialize_2, Concepts="Surfaces")
item = ListItem(List=trim_2, Index=0, Wrap=True)  # -> Item, Item1, Item2, Item3, Item4
merge = Merge(Data1=representation, Data2=representation_2)
base = Surface(item.Item4)
explode = Explode(Curve=base, Recursive=True)  # -> Segments, Vertices
compress = Compress(Input=merge)
trim_3 = TrimTree(Tree=explode.Segments, Depth=1)
join = JoinCurves(Curves=explode.Segments, Preserve=False)
representations = Text(compress)
trim_4 = TrimTree(Tree=join, Depth=1)
curvepoint = PointOnCurve(trim_3, parameter=0.5)
expression_3 = Expression(x=gap, Expression="x/2")
context_print = ContextPrint(REPRESENTATIONS=representations)
crv_cp = CurveClosestPoint(Point=curvepoint, Curve=trim_3)  # -> Point, Parameter, Distance
addition_2 = Addition(A=expression_3, B=dooroffset)
expression_4 = Expression(x=floorheight, Expression="x/2")
lng = ListLength(List=trim_3)
addition_3 = Addition(A=crv_cp.Parameter, B=addition_2)
subtraction = Subtraction(A=crv_cp.Parameter, B=addition_2)
dup = DuplicateData(Data=expression_4, Number=lng, Order=True)
eval = EvaluateCurve(Curve=trim_3, Parameter=addition_3)  # -> Point, Tangent, Angle
eval_2 = EvaluateCurve(Curve=trim_3, Parameter=subtraction)  # -> Point, Tangent, Angle
trim_5 = TrimTree(Tree=dup, Depth=1)
shift = ShiftList(List=eval_2.Point, Shift=1, Wrap=True)
expression_5 = Expression(x=floors, Expression="x*3")
replace = ReplaceItems(List=trim_5, Item="0", Indices="1", Wrap=False)
trim_6 = TrimTree(Tree=shift, Depth=1)
repeat = RepeatData(Data=replace, Length=expression_5)
merge_2 = Merge(Data1=graft(eval.Point), Data2=graft(trim_6))
trim_7 = TrimTree(Tree=repeat, Depth=1)
item_2 = CherryPicker(merge_2, ListIndex=0, TreePath_path="{0;3}")
l2o = List2Object(L=merge_2)  # -> O; inputs L: tree
# ---------- l2o: Python ----------
#Component Information
#--------------------------------------------------------------------------------------------
if ghenv.Component.RunCount<2:
    #General
    #--------------------------------------------------------------------------------------------
    __author__ = "Ueli Saluz"
    __version__ = "2022.04.24"
    
    ghenv.Component.Name = "List2Object"
    ghenv.Component.NickName = "L2O"
    ghenv.Component.Description = "Wraps a list of objects into a list object."
    ghenv.Component.Message = "VER 1.0"
    ghenv.Component.Category = "Sets"
    ghenv.Component.SubCategory = "Tree"
    
     #Inputs
    #--------------------------------------------------------------------------------------------
    inputIndex=0
    
    ghenv.Component.Params.Input[inputIndex].Name = "List"
    ghenv.Component.Params.Input[inputIndex].NickName = "L"
    ghenv.Component.Params.Input[inputIndex].Description = "Tree with lists to wrap."
    ghenv.Component.Params.Input[inputIndex].Optional = False
    inputIndex+=1
    

    #Outputs
    #--------------------------------------------------------------------------------------------
    outputIndex=0
    
    ghenv.Component.Params.Output[outputIndex].Name =  "ListObject" 
    ghenv.Component.Params.Output[outputIndex].NickName = "O"
    ghenv.Component.Params.Output[outputIndex].Description = "Python list object as single item."
    outputIndex+=1


#Imports
#--------------------------------------------------------------------------------------------
from System import Object
from Grasshopper import DataTree

#Solver - Run with trees to enhance performance drastically
#--------------------------------------------------------------------------------------------
if __name__ == "__main__":
    
    #Initialize trees
    #--------------------------------------------------------------------------------------------
    TreeToWrap = DataTree[Object]()
    
    #Data matching
    #--------------------------------------------------------------------------------------------
    for path in L.Paths:
        listBranch = L.Branch(path)
        TreeToWrap.Add(listBranch,path)
    
     #Assign trees to output
    #--------------------------------------------------------------------------------------------
    O = TreeToWrap
# ---------- end l2o ----------
points = PointList(Points=merge_2, Size=Slider(49, range=0..110))
ma = MassAddition(Input=trim_7)  # -> Result, PartialResults
trim_8 = TrimTree(Tree=l2o, Depth=1)
flip = FlipMatrix(Data=ma.PartialResults)
repeat_2 = RepeatData(Data=trim_8, Length=expression_5)
doorheights = Number(flip)
trim_9 = TrimTree(Tree=repeat_2, Depth=1)
Z = UnitZ(Factor=doorheights)
o2l = Object2List(O=trim_9)  # -> L; inputs O: tree
# ---------- o2l: Python ----------
#Component Information
#--------------------------------------------------------------------------------------------
if ghenv.Component.RunCount<2:
    #General
    #--------------------------------------------------------------------------------------------
    __author__ = "Ueli Saluz"
    __version__ = "2022.04.24"
    
    ghenv.Component.Name = "Object2List"
    ghenv.Component.NickName = "O2L"
    ghenv.Component.Description = "Unwraps a list of objects into a list object."
    ghenv.Component.Message = "VER 1.0"
    ghenv.Component.Category = "Sets"
    ghenv.Component.SubCategory = "Tree"
    
     #Inputs
    #--------------------------------------------------------------------------------------------
    inputIndex=0
    
    ghenv.Component.Params.Input[inputIndex].Name = "ListObject"
    ghenv.Component.Params.Input[inputIndex].NickName = "O"
    ghenv.Component.Params.Input[inputIndex].Description = "A python list object that will be unwrapped into a Grasshopper list."
    ghenv.Component.Params.Input[inputIndex].Optional = False
    inputIndex+=1
    

    #Outputs
    #--------------------------------------------------------------------------------------------
    outputIndex=0
    
    ghenv.Component.Params.Output[outputIndex].Name =  "List"
    ghenv.Component.Params.Output[outputIndex].NickName = "L"
    ghenv.Component.Params.Output[outputIndex].Description = "The unwrapped list."
    outputIndex+=1


#Imports
#--------------------------------------------------------------------------------------------
from System import Object
from Grasshopper import DataTree

#Solver - Run with trees to enhance performance drastically
#--------------------------------------------------------------------------------------------
if __name__ == "__main__":
    
    #Initialize trees
    #--------------------------------------------------------------------------------------------
    OriginalTree = DataTree[Object]()
    
    #Data matching
    #--------------------------------------------------------------------------------------------
    for path in O.Paths:
        listBranch = O.Branch(path)
        for i,listItem in enumerate(listBranch):
            OriginalTree.AddRange(list(listItem),path.AppendElement(i))
    
     #Assign trees to output
    #--------------------------------------------------------------------------------------------
    L = OriginalTree
# ---------- end o2l ----------
trim_10 = TrimTree(Tree=Z, Depth=1)
match = MatchTree(Tree=Z, Guide=o2l)
cset = CreateSet(List=trim_10)  # -> Set, graft(Map)
move = Move(Geometry=o2l, Motion=match)  # -> Geometry, Transform
path = ConstructPath(Indices=cset.Map)
crv_cp_2 = CurveClosestPoint(Point=move.Geometry, Curve=trim_4)  # -> Point, Parameter, Distance
trim_11 = TrimTree(Tree=path, Depth=1)
eval_3 = EvaluateCurve(Curve=trim_4, Parameter=crv_cp_2.Parameter)  # -> Point, Tangent, Angle
rev = Reverse(Vector=eval_3.Tangent)
line = LineSDL(Start=eval_3.Point, Direction=Vector(0, 0, 1), Length=1)
vrot = Rotate(Vector=rev, Axis=line, Angle=degrees("90"))
pl = ConstructPlane(Origin=eval_3.Point, XAxis=rev, YAxis=vrot)
move_2 = Move(Geometry=pl, Motion=Z)  # -> Geometry, Transform
rotate = Rotate(Geometry=move_2.Geometry, Angle=degrees(expression_2), Plane=PlaneXY(0, 0, 0))  # -> Geometry, Transform
relblbrch = RelabelBranches(TreeToMatch=rotate.Geometry, ListOfPaths=trim_11)  # -> RelabeledTree; inputs TreeToMatch: tree, ListOfPaths: list
# ---------- relblbrch: Python ----------
if ghenv.Component.RunCount<2:
    __author__ = "Your name"
    __version__ = "2000.00.00"
    
    ghenv.Component.Name = "RelabelBranches"
    ghenv.Component.NickName = "ReLblBrch"
    ghenv.Component.Description = "Relabel all the paths of the branches with a list of new paths. The amount of branches must match with the size of the list of pahts"
    ghenv.Component.Message = "VER 1.0"
    
    ghenv.Component.Params.Input[0].NickName = "TreeToMatch"
    ghenv.Component.Params.Input[1].NickName = "ListOfPaths"
    
    ghenv.Component.Params.Input[0].Description = "Tree that should be relabeled."
    ghenv.Component.Params.Input[1].Description = "List of paths to use for new branch paths."
    
    ghenv.Component.Params.Output[0].NickName = "RelabeledTree"
    ghenv.Component.Params.Output[0].Description = "Relabeled tree where all the paths of the branches have been replaced with new paths."

from System import Object
from Grasshopper import DataTree

def relabelBranchesWithLstOfPths (tree, paths):
    newTree = DataTree[Object]()
    for i,path in enumerate(tree.Paths):
        items = tree.Branch(path)
        for data in items:
            newTree.Add(data,paths[i])
    return newTree

if __name__ == "__main__":
    RelabeledTree = relabelBranchesWithLstOfPths(TreeToMatch,ListOfPaths)
# ---------- end relblbrch ----------
number_slider_4 = Slider(100, range=0..100)
amp = Amplitude(Vector=rev, Amplitude=number_slider_4)
vdisex = VectorDisplayEx(Point=eval_3.Point, Vector=amp, Colour=RGB(0, 0, 0), Width=Slider(3, range=0..10))
entranceplanes = Plane(relblbrch)
tstat = TreeStatistics(Tree=entranceplanes)  # -> Paths, Length, Count
item_3 = ListItem(List=tstat.Paths, Index=addition, Wrap=True)
previewplane = PreviewPlane(plane=entranceplanes, axis_length=number_slider_4)
branch = TreeBranch(Tree=entranceplanes, Path=item_3, MaintainPaths=True)
item_4 = ListItem(List=branch, Index=connection_bias_door, Wrap=True)
connection_pose = Plane(item_4)
connection_point = Point(connection_pose)
previewplane_2 = PreviewPlane(plane=connection_pose, axis_length=number_slider_4)
context_bake = ContextBake(CONNECTIONPOINT=connection_point)

# ==== cluster _2D
x = ClusterInput()
expression = Expression(x=x, Expression="x/2")
neg = Negative(Value=expression)
dom = ConstructDomain(DomainStart=neg, DomainEnd=expression)
I = ClusterOutput(dom)

# ==== cluster ValueOr0
value = ClusterInput()
value_2 = Number(value)
null = NullItem(Item=value_2)  # -> NullFlags, InvalidFlags, Description
filter = StreamFilter(Gate=null.NullFlags, Stream0=value_2, Stream1="0")
valueor0 = Number(filter)
valueor0_2 = ClusterOutput(valueor0)

# ==== cluster PreviewPlane: Preview a plane with axis colors and naming.
axis_length = ClusterInput()
plane = ClusterInput()
axis_length_2 = Number(axis_length)
plane_2 = Plane(plane)
deplane = DeconstructPlane(Plane=plane_2)  # -> Origin, XAxis, YAxis, ZAxis
line = LineSDL(Start=deplane.Origin, Direction=deplane.YAxis, Length=axis_length_2)
line_2 = LineSDL(Start=deplane.Origin, Direction=deplane.XAxis, Length=axis_length_2)
line_3 = LineSDL(Start=deplane.Origin, Direction=deplane.ZAxis, Length=axis_length_2)
swatch = ColourSwatch(SwatchColor=RGB(235, 52, 79))
swatch_2 = ColourSwatch(SwatchColor=RGB(0, 166, 157))
swatch_3 = ColourSwatch(SwatchColor=RGB(240, 117, 24))
end = EndPoints(Curve=line_2)  # -> Start, End
end_2 = EndPoints(Curve=line)  # -> Start, End
end_3 = EndPoints(Curve=line_3)  # -> Start, End
tag = TextTag(Location=end.End, Text="X", Colour=swatch)
tag_2 = TextTag(Location=end_2.End, Text="Y", Colour=swatch_2)
tag_3 = TextTag(Location=end_3.End, Text="Z", Colour=swatch_3)
preview = CustomPreview(Geometry=line_2, Material=swatch)
preview_2 = CustomPreview(Geometry=line, Material=swatch_2)
preview_3 = CustomPreview(Geometry=line_3, Material=swatch_3)
