# Grasshopper definition simpletower.gh (Grasshopper 1.0.7)
# plug-ins: Semio, Swiftlet, Human, LunchBox, MetaHopper

list = ValueList({"Front", "Side"}, selected="Front")
list_2 = ValueList({"Back", "Side"}, selected="Side")
parameter = ConstructParameter(Name="Length", Value=Slider(420, range=0..1000))
parameter_2 = ConstructParameter(Name="Width", Value=Slider(270, range=0..1000))
parameter_3 = ConstructParameter(Name="Height", Value=Slider(275, range=0..1000))
parameter_4 = ConstructParameter(Name="Entrance", Value=list_2)
parameter_5 = ConstructParameter(Name="Window", Value=list)
panel = Panel("C:\Git\Studium\PhD\semio\examples\nakagincapsuletower")
xy = XYPlane(Origin=Point(0, 0, 0))
parameter_6 = ConstructParameter(Name="Width", Value=Slider(275, range=0..1000))
parameter_7 = ConstructParameter(Name="Length", Value=Slider(400, range=0..1000))
parameter_8 = ConstructParameter(Name="Height", Value=Slider(300, range=0..1000))
list_3 = ValueList({"Front", "Side"}, selected="Side")
list_4 = ValueList({"Back", "Side"}, selected="Side")
merge = Merge(Data2=parameter_7, Data3=parameter_6, Data4=parameter_8)
parameter_9 = ConstructParameter(Name="Entrance", Value=list_4)
parameter_10 = ConstructParameter(Name="Width", Value=Slider(275, range=0..1000))
parameter_11 = ConstructParameter(Name="Window", Value=list_3)
parameter_12 = ConstructParameter(Name="Mirror", Value=Toggle(True))
parameter_13 = ConstructParameter(Name="Length", Value=Slider(400, range=0..1000))
parameter_14 = ConstructParameter(Name="Height", Value=Slider(300, range=0..1000))
list_5 = ValueList({"Front", "Side"}, selected="Side")
merge_2 = Merge(Data2=parameter_13, Data3=parameter_10, Data4=parameter_14)
list_6 = ValueList({"Back", "Side"}, selected="Side")
list_7 = ValueList({"Front", "Right", "Bottom", "Left"}, selected="Left")
concat = Concatenate(FragmentA=panel, FragmentB="\", FragmentC="base.gh")
concat_2 = Concatenate(FragmentA=panel, FragmentB="\", FragmentC="shaft.gh")
concat_3 = Concatenate(FragmentA=panel, FragmentB="\", FragmentC="capital.gh")
concat_4 = Concatenate(FragmentA=panel, FragmentB="\", FragmentC="capsule.gh")
prot = RotatePlane(Plane=xy, Angle=degrees("180"))
parameter_15 = ConstructParameter(Name="Mirror", Value=Toggle(True))
parameter_16 = ConstructParameter(Name="Entrance", Value=list_6)
parameter_17 = ConstructParameter(Name="Window", Value=list_5)
prot_2 = RotatePlane(Plane=xy, Angle=degrees("-90"))
parameter_18 = ConstructParameter(Name="Door", Value=Slider(1, range=0..10))
parameter_19 = ConstructParameter(Name="Floors", Value=Slider(4, range=0..10))
parameter_20 = ConstructParameter(Name="Door", Value=Slider(3, range=0..10))
parameter_21 = ConstructParameter(Name="Bridge", Value=list_7)
parameter_22 = ConstructParameter(Name="FloorHeight", Value=Slider(300, range=0..1000))
parameter_23 = ConstructParameter(Name="Width", Value=Slider(400, range=0..1000))
parameter_24 = ConstructParameter(Name="SplitLevel", Value=Slider(1, range=0..10))
parameter_25 = ConstructParameter(Name="Floor", Value=Slider(1, range=0..10))
parameter_26 = ConstructParameter(Name="Floor", Value=Slider(2, range=0..10))
parameter_27 = ConstructParameter(Name="Floor", Value=Slider(3, range=0..10))
plan = ConstructPlan(Uri=concat_4, Parameters=merge_2)  # -> Plan, Hash
plan_2 = ConstructPlan(Uri=concat_4, Parameters=merge_2)  # -> Plan, Hash
plan_3 = ConstructPlan(Uri=concat_4, Parameters=[merge_2, parameter_9, parameter_12, parameter_11])  # -> Plan, Hash
link = ConstructLink(Bias=parameter_20)
link_2 = ConstructLink(Bias=[parameter_25, parameter_20])
link_3 = ConstructLink(Bias=[parameter_26, parameter_20])
plan_4 = ConstructPlan(Uri=concat_4, Parameters=[merge, parameter_17])  # -> Plan, Hash
link_4 = ConstructLink(Bias=[parameter_24, parameter_18])
plan_5 = ConstructPlan(Uri=concat_4, Parameters=[merge, parameter_17])  # -> Plan, Hash
plan_6 = ConstructPlan(Uri=concat_4, Parameters=[merge, parameter_16, parameter_15, parameter_17])  # -> Plan, Hash
link_5 = ConstructLink(Bias=[parameter_24, parameter_18, parameter_25])
link_6 = ConstructLink(Bias=[parameter_24, parameter_27, parameter_18, parameter_26])
plan_7 = ConstructPlan(Uri=concat_2, Parameters=[parameter_23, parameter_21, parameter_19, parameter_22])  # -> Plan, Hash
sobject = ConstructSobject(Pose=prot, Plan=plan.Plan)
sobject_2 = ConstructSobject(Pose=prot, Plan=plan_2.Plan)
link_7 = ConstructLink(Ports="Door")
sobject_3 = ConstructSobject(Pose=prot, Plan=plan_3.Plan)
link_8 = ConstructLink(Ports="Door")
link_9 = ConstructLink(Ports="Door")
sobject_4 = ConstructSobject(Pose=prot_2, Plan=plan_4.Plan)
sobject_5 = ConstructSobject(Pose=prot_2, Plan=plan_5.Plan)
link_10 = ConstructLink(Ports="Door")
sobject_6 = ConstructSobject(Pose=prot_2, Plan=plan_6.Plan)
link_11 = ConstructLink(Ports="Door")
link_12 = ConstructLink(Ports="Door")
sobject_7 = ConstructSobject(Plan=plan_7.Plan)
connectable = ConstructConnectable(Sobject=sobject_7, Link=link)
connectable_2 = ConstructConnectable(Sobject=sobject_7, Link=link_2)
connectable_3 = ConstructConnectable(Sobject=sobject_7, Link=link_3)
connectable_4 = ConstructConnectable(Sobject=sobject_7, Link=link_4)
connectable_5 = ConstructConnectable(Sobject=sobject_7, Link=link_5)
connectable_6 = ConstructConnectable(Sobject=sobject_7, Link=link_6)
connectable_7 = ConstructConnectable(Sobject=sobject_2, Link=link_8)
connectable_8 = ConstructConnectable(Sobject=sobject, Link=link_9)
connectable_9 = ConstructConnectable(Sobject=sobject_3, Link=link_7)
connectable_10 = ConstructConnectable(Sobject=sobject_5, Link=link_11)
connectable_11 = ConstructConnectable(Sobject=sobject_4, Link=link_12)
connectable_12 = ConstructConnectable(Sobject=sobject_6, Link=link_10)
connection = ConstructConnection(Connecting=connectable_7, Connected=connectable)
connection_2 = ConstructConnection(Connecting=connectable_8, Connected=connectable_2)
connection_3 = ConstructConnection(Connecting=connectable_9, Connected=connectable_3)
connection_4 = ConstructConnection(Connecting=connectable_10, Connected=connectable_4)
connection_5 = ConstructConnection(Connecting=connectable_11, Connected=connectable_5)
connection_6 = ConstructConnection(Connecting=connectable_12, Connected=connectable_6)
run = Boolean(Toggle(True))
server = Text("http://localhost:2999")
merge_3 = Merge(Data1=connection, Data2=connection_2, Data3=connection_3)
merge_4 = Merge(Data1=connection_4, Data2=connection_5, Data3=connection_6)
merge_5 = Merge(Data1=sobject_2, Data2=sobject, Data3=sobject_3)
merge_6 = Merge(Data1=sobject_5, Data2=sobject_4, Data3=sobject_6)
merge_7 = Merge(Data1=sobject_7, Data2=sobject)
merge_8 = Merge(Data1=sobject_7, Data2=merge_5, Data3=merge_6)
merge_9 = Merge(Data1=merge_3, Data2=merge_4)
layout = ConstructLayout(Sobjects=merge_7, Connections=connection_2, Assembly=sobject_7)
layout_2 = ConstructLayout(Sobjects=merge_8, Connections=merge_9, Assembly=sobject_7)
fjs = FormatJsonString(JSONString=layout_2)
panel_2 = Panel(fjs)
layout_design = LayoutDesign(Url=server, Layout=layout, Run=run)
layout_design_2 = LayoutDesign(Url=server, Layout=layout_2, Run=run)
design = ShowDesign(Design=layout_design, Concepts="Simple")
design_2 = ShowDesign(Design=layout_design_2, Concepts="Simple")
D = Design(layout_design_2)
dedesign = DeconstructDesign(Design=D)  # -> Prototypes, Elements
trim = TrimTree(Tree=dedesign.Prototypes, Depth=1)
trim_2 = TrimTree(Tree=dedesign.Elements, Depth=1)
deelement = DeconstructElement(Element=trim_2)  # -> SobjectId, PlanHash, Pose
deprototype = DeconstructPrototype(Prototype=trim)  # -> PlanHash, Representations, Description
item = ListItem(List=deprototype.Representations, Index=0, Wrap=True)
imrepresentation = ImportRepresentation(Representation=item)
pln = Plane(graft(deelement.Pose))
trim_3 = TrimTree(Tree=imrepresentation, Depth=1)
pl2pl = MoveObjectPlaneToPlane(G=trim_3, S=PlaneXY(0, 0, 0), T=pln)  # -> TG, T; inputs S: Plane, T: Plane
# ---------- pl2pl: Python ----------
#Component Information
#--------------------------------------------------------------------------------------------
if ghenv.Component.RunCount<2:
    #General
    #--------------------------------------------------------------------------------------------
    __author__ = "Ueli Saluz"
    __version__ = "2023.02.12"
    
    ghenv.Component.Name = "MoveObjectPlaneToPlane"
    ghenv.Component.NickName = "Pl2Pl"
    ghenv.Component.Description = "Moves abitrary geometry from a source plane to a target plane."
    ghenv.Component.Message = "VER 1.2"
    ghenv.Component.Category = "Transform"
    ghenv.Component.SubCategory = "Euclidean"
    
     #Inputs
    #--------------------------------------------------------------------------------------------
    inputIndex=0
    
    ghenv.Component.Params.Input[inputIndex].Name = "Geometry"
    ghenv.Component.Params.Input[inputIndex].NickName = "G"
    ghenv.Component.Params.Input[inputIndex].Description = "Geometry to move."
    ghenv.Component.Params.Input[inputIndex].Optional = False
    inputIndex+=1
    
    ghenv.Component.Params.Input[inputIndex].Name = "SourcePlane"
    ghenv.Component.Params.Input[inputIndex].NickName = "S"
    ghenv.Component.Params.Input[inputIndex].Description = "Source plane of object."
    ghenv.Component.Params.Input[inputIndex].Optional = False
    inputIndex+=1
    
    ghenv.Component.Params.Input[inputIndex].Name = "TargetPlane"
    ghenv.Component.Params.Input[inputIndex].NickName = "T"
    ghenv.Component.Params.Input[inputIndex].Description = "Target plane of object."
    ghenv.Component.Params.Input[inputIndex].Optional = False
    inputIndex+=1
    
    #Outputs
    #--------------------------------------------------------------------------------------------
    outputIndex=0
    
    ghenv.Component.Params.Output[outputIndex].Name = "TranslatedGeometry"
    ghenv.Component.Params.Output[outputIndex].NickName = "TG"
    ghenv.Component.Params.Output[outputIndex].Description = "Translated geometry in target plane."
    outputIndex+=1
    
    ghenv.Component.Params.Output[outputIndex].Name = "Trasnform"
    ghenv.Component.Params.Output[outputIndex].NickName = "T"
    ghenv.Component.Params.Output[outputIndex].Description = "Transform describing translation form source to target plane."
    outputIndex+=1


#Imports
#--------------------------------------------------------------------------------------------
import Rhino.Geometry.Transform as trsf

def MvObjPlnToPln (geo,plnObj,plnDest):
    transform = trsf.PlaneToPlane(plnObj,plnDest)
    geo.Transform(transform)
    return (geo,transform)

TG, T = MvObjPlnToPln(G,S,T)
# ---------- end pl2pl ----------
swatch = ColourSwatch(SwatchColor=RGB(0, 166, 157))
swatch_2 = ColourSwatch(SwatchColor=RGB(240, 117, 24))
swatch_3 = ColourSwatch(SwatchColor=RGB(235, 52, 79))
bang = ExplodeTree(Data=pl2pl.TG)  # -> Branch0, Branch1, Branch2, Branch3, Branch4, Branch5, Branch6
button = Button(ExpressionNormal="True", ExpressionPressed="False")
merge_10 = Merge(Data1=bang.Branch2, Data2=bang.Branch3, Data3=bang.Branch5, Data4=bang.Branch6)
merge_11 = Merge(Data1=bang.Branch1, Data2=bang.Branch4)
bbox = BoundingBox(Content=flatten(pl2pl.TG), Plane=PlaneXY(0, 0, 0), UnionBox=True)  # -> Box, Box_2
button_2 = Button(ExpressionNormal="True", ExpressionPressed="False")
pt = ConstructPoint(
    XCoordinate=Slider(2000, range=0..10000),
    YCoordinate=Slider(-3000, range=-10000..-3000),
    ZCoordinate=Slider(2000, range=0..10000))
vec = VectorXYZ(XComponent=Slider(-1, range=-10..10), YComponent=Slider(1, range=-10..10), ZComponent=Slider(-1, range=-10..10))  # -> Vector, Length
Z = UnitZ(Factor=1)
item_2 = ListItem(List=merge_10, Index=0, Wrap=True)  # -> Item, Item1, Item2
item_3 = ListItem(List=merge_11, Index=0, Wrap=True)  # -> Item, Item1, Item2
rhinovp = RhinoViewport(N="Diagram", P="0", WD=Domain2(u=0..1000, v=0..1000), T=Toggle(True), A=button)  # -> F; inputs P: Int32, T: Boolean, A: Boolean
#   port P: 0 = None 1 = Top 2 = Bottom 3 = Left 4 = Right 5 = Front 6 = Back 7 = Perspective 8 = TwoPointPerspective
# ---------- rhinovp: Python ----------
#Component Information
#--------------------------------------------------------------------------------------------
if ghenv.Component.RunCount<2:
    #General
    #--------------------------------------------------------------------------------------------
    __author__ = "Ueli Saluz"
    __version__ = "2023.04.05"
    
    ghenv.Component.Name = "RhinoViewport"
    ghenv.Component.NickName = "RhinoVP"
    ghenv.Component.Description = "Launches or closes a Rhino viewport."
    ghenv.Component.Message = "VER 1.3"
    ghenv.Component.Category = "Display"
    ghenv.Component.SubCategory = "Camera"
    
     #Inputs
    #--------------------------------------------------------------------------------------------
    inputIndex=0
    
    ghenv.Component.Params.Input[inputIndex].Name = "Name"
    ghenv.Component.Params.Input[inputIndex].NickName = "N"
    ghenv.Component.Params.Input[inputIndex].Description = "Name of the viewport"
    ghenv.Component.Params.Input[inputIndex].Optional = False
    inputIndex+=1
    
    ghenv.Component.Params.Input[inputIndex].Name = "ViewportProjection"
    ghenv.Component.Params.Input[inputIndex].NickName = "P"
    ghenv.Component.Params.Input[inputIndex].Description = "0  = None \n1 = Top \n2 = Bottom \n3 = Left \n4 = Right \n5 = Front\n6 = Back\n7 = Perspective\n8 = TwoPointPerspective"
    ghenv.Component.Params.Input[inputIndex].Optional = False
    inputIndex+=1
    
    ghenv.Component.Params.Input[inputIndex].Name = "WindowDomain"
    ghenv.Component.Params.Input[inputIndex].NickName = "WD"
    ghenv.Component.Params.Input[inputIndex].Description = "The domain of the window. The U domain corresponds to X and the V domain to Y."
    ghenv.Component.Params.Input[inputIndex].Optional = False
    inputIndex+=1
    
    ghenv.Component.Params.Input[inputIndex].Name = "TitleVisible"
    ghenv.Component.Params.Input[inputIndex].NickName = "T"
    ghenv.Component.Params.Input[inputIndex].Description = "True if Rhino view title should be visible."
    ghenv.Component.Params.Input[inputIndex].Optional = True
    inputIndex+=1
    
    ghenv.Component.Params.Input[inputIndex].Name = "WallPaperPath"
    ghenv.Component.Params.Input[inputIndex].NickName = "WP"
    ghenv.Component.Params.Input[inputIndex].Description = "The domain of the window. The U domain corresponds to X and the V domain to Y."
    ghenv.Component.Params.Input[inputIndex].Optional = True
    inputIndex+=1
    
    ghenv.Component.Params.Input[inputIndex].Name = "ScaleFactor"
    ghenv.Component.Params.Input[inputIndex].NickName = "S"
    ghenv.Component.Params.Input[inputIndex].Description = "A scale factor that is applied on the window domains."
    ghenv.Component.Params.Input[inputIndex].Optional = True
    inputIndex+=1
    
    ghenv.Component.Params.Input[inputIndex].Name = "Active"
    ghenv.Component.Params.Input[inputIndex].NickName = "A"
    ghenv.Component.Params.Input[inputIndex].Description = "Activate or deactivate the window."
    ghenv.Component.Params.Input[inputIndex].Optional = False
    inputIndex+=1
    
    #Outputs
    #--------------------------------------------------------------------------------------------
    outputIndex=0
    
    ghenv.Component.Params.Output[outputIndex].Name = "Finished"
    ghenv.Component.Params.Output[outputIndex].NickName = "F"
    ghenv.Component.Params.Output[outputIndex].Description = "Sends True when finished. Just to trigger other depending components."
    outputIndex+=1


#Imports
#--------------------------------------------------------------------------------------------
from System import Object, Enum
from Grasshopper import DataTree
import System as sy
import Rhino as rc
import scriptcontext as sc
import clr
import System.Windows.Forms.Control

#Solver - Run with trees to enhance performance drastically
#--------------------------------------------------------------------------------------------
if __name__ == "__main__":
    
    vp = rc.RhinoDoc.ActiveDoc.Views.Find(N, False)
    if A:
        scaleFacor = 1 if S is None else S
        if vp:
            vp.Close()
        
        #The width is 16 pixel and height is 39 too little. Additionally the windows start 8 pixel shifted to the left. Why? I don't know.
        windowRectangle = sy.Drawing.Rectangle(WD.U0*scaleFacor-8,WD.V0*scaleFacor,WD.U.Length*scaleFacor+16,WD.V.Length*scaleFacor+39)
        newView = rc.RhinoDoc.ActiveDoc.Views.Add(N,Enum.ToObject(rc.Display.DefinedViewportProjection, P),windowRectangle,True)
        #newView seems to not set the name properly
        newView.MainViewport.Name = N
        if T==False:
            newView.TitleVisible = False
        viewport = newView.ActiveViewport
        if WP is not None:
            viewport.SetWallpaper(WP,False)
        
        viewport.ConstructionAxesVisible = False
        viewport.ConstructionGridVisible = False
        viewport.WorldAxesVisible = False
        
    else:
        if vp:
            vp.Close()
    F = True
# ---------- end rhinovp ----------
dam = DataDam(DataA=bbox.Box, BufferDelay=10000000, BufferMode=0)
setview = SetView(N="Diagram", P="0", L=pt, D=vec.Vector, Up=Z, R=button_2)  # -> F; inputs P: Int32, L: Point3d, D: Vector3d, Up: Vector3d, R: Boolean
#   port P: 0 = Parallel view 1 = Perspective view
# ---------- setview: Python ----------
#Component Information
#--------------------------------------------------------------------------------------------
if ghenv.Component.RunCount<2:
    #General
    #--------------------------------------------------------------------------------------------
    __author__ = "Ueli Saluz"
    __version__ = "2022.05.22"
    
    ghenv.Component.Name = "SetView"
    ghenv.Component.NickName = "SetView"
    ghenv.Component.Description = "Set a camera view and projection."
    ghenv.Component.Message = "VER 1.1"
    ghenv.Component.Category = "Display"
    ghenv.Component.SubCategory = "Camera"
    
     #Inputs
    #--------------------------------------------------------------------------------------------
    inputIndex=0
    
    ghenv.Component.Params.Input[inputIndex].Name = "Name"
    ghenv.Component.Params.Input[inputIndex].NickName = "N"
    ghenv.Component.Params.Input[inputIndex].Description = "Name of the viewport"
    ghenv.Component.Params.Input[inputIndex].Optional = True
    inputIndex+=1
    
    ghenv.Component.Params.Input[inputIndex].Name = "Projection"
    ghenv.Component.Params.Input[inputIndex].NickName = "P"
    ghenv.Component.Params.Input[inputIndex].Description = "0 = Parallel view\n"+\
                                                           "1 = Perspective view"
    ghenv.Component.Params.Input[inputIndex].Optional = True
    inputIndex+=1
    
    
    ghenv.Component.Params.Input[inputIndex].Name = "CameraLocation"
    ghenv.Component.Params.Input[inputIndex].NickName = "L"
    ghenv.Component.Params.Input[inputIndex].Description = "Location of the camera."
    ghenv.Component.Params.Input[inputIndex].Optional = True
    inputIndex+=1
    
    ghenv.Component.Params.Input[inputIndex].Name = "CameraDirection"
    ghenv.Component.Params.Input[inputIndex].NickName = "D"
    ghenv.Component.Params.Input[inputIndex].Description = "Direction of the camera."
    ghenv.Component.Params.Input[inputIndex].Optional = True
    inputIndex+=1
    
    ghenv.Component.Params.Input[inputIndex].Name = "CameraUp"
    ghenv.Component.Params.Input[inputIndex].NickName = "Up"
    ghenv.Component.Params.Input[inputIndex].Description = "Up vector of the camera."
    ghenv.Component.Params.Input[inputIndex].Optional = True
    inputIndex+=1
    
    ghenv.Component.Params.Input[inputIndex].Name = "LensLength"
    ghenv.Component.Params.Input[inputIndex].NickName = "LL"
    ghenv.Component.Params.Input[inputIndex].Description = "Lens length of the camera. Only relevant if projection is perspective."
    ghenv.Component.Params.Input[inputIndex].Optional = True
    inputIndex+=1
    
    ghenv.Component.Params.Input[inputIndex].Name = "Run"
    ghenv.Component.Params.Input[inputIndex].NickName = "R"
    ghenv.Component.Params.Input[inputIndex].Description = "Zoom to the given bounding box."
    ghenv.Component.Params.Input[inputIndex].Optional = False
    inputIndex+=1
    
    #Outputs
    #--------------------------------------------------------------------------------------------
    outputIndex=0
    
    ghenv.Component.Params.Output[outputIndex].Name = "Finished"
    ghenv.Component.Params.Output[outputIndex].NickName = "F"
    ghenv.Component.Params.Output[outputIndex].Description = "Sends True when finished. Just to trigger other depending components."
    outputIndex+=1
    


#Imports
#--------------------------------------------------------------------------------------------
from Rhino import RhinoDoc
from Rhino.Geometry import Box

#Solver - Run with trees to enhance performance drastically
#--------------------------------------------------------------------------------------------
if __name__ == "__main__":
    
    if R:
        if N is not None:
            view = RhinoDoc.ActiveDoc.Views.Find(N, False)
        else:
            view = RhinoDoc.ActiveDoc.Views.ActiveView
        vp = view.ActiveViewport
        if P is not None:
            if (P==0):
                vp.ChangeToParallelProjection(True)
            else:
                vp.ChangeToPerspectiveProjection(True,LL)
        if L is not None:
            vp.SetCameraLocation(L,False)
        if D is not None:
            vp.SetCameraDirection(D,False)
        if Up is not None:
            vp.CameraUp = Up
    F = True
# ---------- end setview ----------
merge_12 = Merge(Data1=item_3.Item1, Data2=item_2.Item1)
zoom2bb = ZoomToBoundingBox(N="Diagram", BB=dam, S=0, R=setview)  # -> F, SBB; inputs BB: Box, R: Boolean
# ---------- zoom2bb: Python ----------
#Component Information
#--------------------------------------------------------------------------------------------
if ghenv.Component.RunCount<2:
    #General
    #--------------------------------------------------------------------------------------------
    __author__ = "Ueli Saluz"
    __version__ = "2022.05.21"
    
    ghenv.Component.Name = "ZoomToBoundingBox"
    ghenv.Component.NickName = "Zoom2BB"
    ghenv.Component.Description = "Zoom the view of a Rhino viewport to a bounding box."
    ghenv.Component.Message = "VER 1.0"
    ghenv.Component.Category = "Display"
    ghenv.Component.SubCategory = "Camera"
    
     #Inputs
    #--------------------------------------------------------------------------------------------
    inputIndex=0
    
    ghenv.Component.Params.Input[inputIndex].Name = "Name"
    ghenv.Component.Params.Input[inputIndex].NickName = "N"
    ghenv.Component.Params.Input[inputIndex].Description = "Name of the viewport"
    ghenv.Component.Params.Input[inputIndex].Optional = False
    inputIndex+=1
    
    ghenv.Component.Params.Input[inputIndex].Name = "BoundingBox"
    ghenv.Component.Params.Input[inputIndex].NickName = "BB"
    ghenv.Component.Params.Input[inputIndex].Description = ""
    ghenv.Component.Params.Input[inputIndex].Optional = False
    inputIndex+=1
    
    ghenv.Component.Params.Input[inputIndex].Name = "ScaleFactor"
    ghenv.Component.Params.Input[inputIndex].NickName = "S"
    ghenv.Component.Params.Input[inputIndex].Description = "A factor for the extension of the bounding box." \
    +"0 means 0 extension, a positive number makes the bounding box larger a negative smaller. The amount is proportional to the length."
    ghenv.Component.Params.Input[inputIndex].Optional = False
    inputIndex+=1
   
    
    ghenv.Component.Params.Input[inputIndex].Name = "Run"
    ghenv.Component.Params.Input[inputIndex].NickName = "R"
    ghenv.Component.Params.Input[inputIndex].Description = "Zoom to the given bounding box."
    ghenv.Component.Params.Input[inputIndex].Optional = False
    inputIndex+=1
    
    #Outputs
    #--------------------------------------------------------------------------------------------
    outputIndex=0
    
    ghenv.Component.Params.Output[outputIndex].Name = "Finished"
    ghenv.Component.Params.Output[outputIndex].NickName = "F"
    ghenv.Component.Params.Output[outputIndex].Description = "Sends True when finished. Just to trigger other depending components."
    outputIndex+=1
    
    ghenv.Component.Params.Output[outputIndex].Name = "ScaledBoundingBox"
    ghenv.Component.Params.Output[outputIndex].NickName = "SBB"
    ghenv.Component.Params.Output[outputIndex].Description = "The scaled bounding box."
    outputIndex+=1


#Imports
#--------------------------------------------------------------------------------------------
from Rhino import RhinoDoc
from Rhino.Geometry import Box

#Solver - Run with trees to enhance performance drastically
#--------------------------------------------------------------------------------------------
if __name__ == "__main__":
    
    vp = RhinoDoc.ActiveDoc.Views.Find(N, False).ActiveViewport
    if R:
        box = BB
        bb = BB.BoundingBox
        bb.Inflate(S*box.X.Length,S*box.Y.Length,S*box.Z.Length)
        vp.ZoomBoundingBox(bb)
        SBB = bb
    F = True
# ---------- end zoom2bb ----------
previewmat = CustomPreviewMaterials(Geometry=bang.Branch0, DiffuseColor=swatch_2)
trim_4 = TrimTree(Tree=pl2pl.TG, Depth=1)
previewmat_2 = CustomPreviewMaterials(Geometry=merge_12, DiffuseColor=ColourSwatch(SwatchColor=RGB(191, 216, 255)))
previewmat_3 = CustomPreviewMaterials(Geometry=bang.Branch0, DiffuseColor=swatch_2)
previewmat_4 = CustomPreviewMaterials(Geometry=merge_11, DiffuseColor=swatch_2)
cleanlayer = BooleanToggle(False)
swatch_4 = ColourSwatch(SwatchColor=RGB(0, 166, 157))
swatch_5 = ColourSwatch(SwatchColor=RGB(240, 117, 24))
swatch_6 = ColourSwatch(SwatchColor=RGB(235, 52, 79))
toggle = BooleanToggle(True)
number_slider = Slider(5000, range=0..10000)
number_slider_2 = Slider(1, range=-10..10)
number_slider_3 = Slider(1, range=-10..10)
toggle_2 = BooleanToggle(False)
m2d_rhino = Make2DRhinoView(Name="Diagram", Clip=True)
onoff = EnableDisableObject(Enabled=cleanlayer, AllObjects_Object=[layers, layertable, toggle_4, trim_11, toggle_3, difference])

lng = ListLength(List=deelement.SobjectId)
expression = Expression(x=lng, Expression="x-1")
swatch_7 = ColourSwatch(SwatchColor=RGB(0, 0, 0))
series = Series(Start=0, Step=1, Count=expression)
dup = DuplicateData(Data=swatch_7, Number=expression, Order=True)
trim_5 = TrimTree(Tree=series, Depth=1)
trim_6 = TrimTree(Tree=dup, Depth=1)
concat_5 = Concatenate(FragmentA="capsule", FragmentB=trim_5)
merge_13 = Merge(Data1="shaft", Data2=concat_5)
merge_14 = Merge(Data1=swatch_7, Data2=ColourSwatch(SwatchColor=RGB(235, 52, 79)))
layer = CreateLayers(CreateToggle=Button(), LayerNames=merge_13, LayerColors=merge_14)

sunion = SolidUnion(Breps=trim_4)
toggle_3 = BooleanToggle(True)  # disabled
make2d = Make2D(Geometry=pl2pl.TG, View=m2d_rhino, TangentEdges=toggle, TangentSeams=toggle, AutoComputeMake2D=False)  # -> VisibleCurves, VisibleIndex, VisibleType, HiddenCurves, HiddenIndex, HiddenType
make2d_2 = Make2D(Geometry=sunion, View=m2d_rhino, TangentEdges=toggle, TangentSeams=toggle, AutoComputeMake2D=False)  # -> VisibleCurves, VisibleIndex, VisibleType, HiddenCurves, HiddenIndex, HiddenType
panel_3 = Panel("Silhouette")
panel_4 = Panel("Silhouette, Crease")
panel_5 = Panel("Crease")
layertable = LayerTable(Update=toggle_3, AutoUpdate=False)  # -> Layers, FullLayerPaths, LayerColors, Linetypes, MaterialNames, Visible, PrintWidth, PrintColor; disabled
pt_2 = ConstructPoint(XCoordinate=number_slider, YCoordinate=number_slider, ZCoordinate=0)
vec_2 = VectorXYZ(XComponent=0, YComponent=0, ZComponent=Slider(-1, range=-10..10))  # -> Vector, Length
Z_2 = UnitZ(Factor=1)
trim_7 = TrimTree(Tree=make2d_2.HiddenCurves, Depth=1)
trim_8 = TrimTree(Tree=make2d.HiddenCurves, Depth=1)
trim_9 = TrimTree(Tree=make2d.VisibleCurves, Depth=1)
trim_10 = TrimTree(Tree=make2d_2.VisibleCurves, Depth=1)
genes = GenePool(Decimals=0, Maximum=10, Minimum=0, Value=[10, 10])
trim_11 = TrimTree(Tree=layertable.Layers, Depth=1)  # disabled
tmatch = MatchText(Text=make2d.VisibleType, RegEx="Silhouette, Boundary", Case=True)
toggle_4 = BooleanToggle(True)  # disabled
rhinovp_2 = RhinoViewport(N="Drawing", P="0", WD=Domain2(u=0..1000, v=0..1000), T="False", A=button)  # -> F; inputs P: Int32, T: Boolean, A: Boolean; same code as rhinovp
setview_2 = SetView(N="Drawing", P="0", L=pt_2, D=vec_2.Vector, Up=Z_2, R=button_2)  # -> F; inputs P: Int32, L: Point3d, D: Vector3d, Up: Vector3d, R: Boolean; same code as setview
filter = StreamFilter(Gate=toggle_2, Stream0=trim_9, Stream1=trim_10)
filter_2 = StreamFilter(Gate=toggle_2, Stream0=trim_8, Stream1=trim_7)
difference = SetDifference(SetA=trim_11, SetB=merge_13)  # disabled
dispatch = Dispatch(List=make2d.VisibleCurves, DispatchPattern=tmatch)  # -> ListA, ListB
move = Move(Geometry=filter_2, Motion=pt_2)  # -> Geometry, Transform
move_2 = Move(Geometry=filter, Motion=pt_2)  # -> Geometry, Transform
layers = CreateModifyLayers(LayerName=difference, DeleteLayer=toggle_4, enableFullPath=False)  # -> LayerNames, LayerFullPath; disabled
merge_15 = Merge(Data1=move_2.Geometry, Data2=move.Geometry)
dash = DashPattern(Curve=move.Geometry, Pattern=genes)  # -> Dashes, Gaps
bbox_2 = BoundingBox(Content=flatten(merge_15), Plane=PlaneXY(0, 0, 0), UnionBox=True)  # -> Box, Box_2
zoom2bb_2 = ZoomToBoundingBox(N="Drawing", BB=bbox_2.Box, S=0, R=setview_2)  # -> F, SBB; inputs BB: Box, R: Boolean; same code as zoom2bb
move_3 = Move(Geometry=trim_7, Motion=pt_2)  # -> Geometry, Transform
move_4 = Move(Geometry=trim_10, Motion=pt_2)  # -> Geometry, Transform
dash_2 = DashPattern(Curve=move_3.Geometry, Pattern=genes)  # -> Dashes, Gaps
bake = BakeGeometry(Bake=False, DeleteOldBakes=False, PreserveTrees=False)
panel_6 = Panel(make2d.VisibleType)
createatts = CreateAttributes(LayerName=graft(merge_13), enableFullPath=False)
