# Grasshopper definition shed.gh (Grasshopper 1.0.7)
# plug-ins: Semio

panel = Panel("C:\Git\Studium\PhD\semio\examples\schlenkertoolshed")
concat = Concatenate(FragmentA=panel, FragmentB="\", FragmentC="framemodule.gh")
concat_2 = Concatenate(FragmentA=panel, FragmentB="\", FragmentC="lmodule.gh")
concat_3 = Concatenate(FragmentA=panel, FragmentB="\", FragmentC="door.gh")
xy = XYPlane(Origin=Point(0, 0, 0))
X = UnitX(Factor=1)
Z = UnitZ(Factor=1)
pl = ConstructPlane(Origin=Point(0, 0, 0), XAxis=X, YAxis=Z)
plan = ConstructPlan(Uri=concat_2)  # -> Plan, Hash
sobject = ConstructSobject(Pose=pl, Plan=plan.Plan)
layout = ConstructLayout(Sobjects=sobject, Assembly=sobject)
run = Boolean(Toggle(False))
server = Text("http://localhost:2999")
merge = Merge()
previewplane = PreviewPlane(plane=merge, axis_length=Slider(200, range=0..1000))

# ==== cluster PreviewPlane: Preview a plane with axis colors and naming.
axis_length = ClusterInput()
plane = ClusterInput()
axis_length_2 = Number(axis_length)
plane_2 = Plane(plane)
deplane = DeconstructPlane(Plane=plane_2)  # -> Origin, XAxis, YAxis, ZAxis
line = LineSDL(Start=deplane.Origin, Direction=deplane.YAxis, Length=axis_length_2)
line_2 = LineSDL(Start=deplane.Origin, Direction=deplane.XAxis, Length=axis_length_2)
line_3 = LineSDL(Start=deplane.Origin, Direction=deplane.ZAxis, Length=axis_length_2)
swatch = ColourSwatch(SwatchColor=RGB(235, 52, 79))
swatch_2 = ColourSwatch(SwatchColor=RGB(0, 166, 157))
swatch_3 = ColourSwatch(SwatchColor=RGB(240, 117, 24))
end = EndPoints(Curve=line_2)  # -> Start, End
end_2 = EndPoints(Curve=line)  # -> Start, End
end_3 = EndPoints(Curve=line_3)  # -> Start, End
tag = TextTag(Location=end.End, Text="X", Colour=swatch)
tag_2 = TextTag(Location=end_2.End, Text="Y", Colour=swatch_2)
tag_3 = TextTag(Location=end_3.End, Text="Z", Colour=swatch_3)
preview = CustomPreview(Geometry=line_2, Material=swatch)
preview_2 = CustomPreview(Geometry=line, Material=swatch_2)
preview_3 = CustomPreview(Geometry=line_3, Material=swatch_3)
