# Grasshopper definition results.gh (Grasshopper 1.0.8)
# Copyright: GNU Lesser General Public License Version 3
# plug-ins: Monoceros, semio

_10_types_groups = Data([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])
_10_types_modules = Module([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])
_10_types = Type([null x10])
S = Slot([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])
_10_types_18x18 = Slot([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])
_10_types_20x20 = Slot([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])
_10_types_19x19 = Slot([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])
S_2 = Slot([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])
_10_types_20x20_2 = Data(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)
materialize = MaterializeSlots(Modules=flatten(_10_types_modules), Slots=S_2)  # -> Geometry, Transform
compile_city = CompileCity(S=_10_types_20x20, ty=_10_types, gr=_10_types_groups, S_2=42)  # -> city_2, geometry_2
_10_types_20x20_buildings = Brep([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])
preview_city = PreviewCity(geometry=_10_types_20x20_2)

# ==== cluster CompileCity: Compile the city to a design, merge geometry and compute metrics.
S = ClusterInput()
ty = ClusterInput()
S_2 = ClusterInput()
gr = ClusterInput()
qal = StandardQuality({"Effective Floor Area": "effective floor area"}, selected="Effective Floor Area")
S_3 = RandomSeed(S_2)
S_4 = Slot(S)
lng = ListLength(List=S_4)
ty_2 = Type(ty)
typ = ModelType(Type=ty_2)  # -> Type, Valid, Name, Description, Icon, Image, Variant, Unit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
gr_2 = Group(gr)
bang = ExplodeTree(Data=typ.Qualities)  # -> flatten(Branch0)
sqrt = SquareRoot(Value=lng)
slts = SlotsToDesign(S=S_4, ty=ty_2)
rep = ReplaceText(Text=typ.Variant, Find="_", Replace="-", RecursiveReplace=False)
rep_2 = ReplaceText(Text=rep, Find="/", Replace="slash", RecursiveReplace=False)
qal_2 = ModelQuality(Quality=bang)  # -> Quality, Valid, Name, Value, Unit, Definition
grp = PiecesToGroup(dn=slts, ty=ty_2, gr=gr_2)
join = TextJoin(Text=rep_2, Join="_")
concat = Concatenate(FragmentA=sqrt, FragmentB="_", FragmentC=join, FragmentE="_", FragmentD=S_3)
ungroup = Ungroup(Group=grp)
qal_3 = SumQualities(dn=slts, ty=ty_2, na="footprint area")  # -> nu_2, ql_2
qal_4 = SumQualities(dn=slts, ty=ty_2, na="green area")  # -> nu_2, ql_2
qal_5 = SumQualities(dn=slts, ty=ty_2, na="car area")  # -> nu_2, ql_2
qal_6 = SumQualities(dn=slts, ty=ty_2, na="pedestrian area")  # -> nu_2, ql_2
qal_7 = SumQualities(dn=slts, ty=ty_2, na="street area")  # -> nu_2, ql_2
qal_8 = SumQualities(dn=slts, ty=ty_2, na=qal)  # -> nu_2, ql_2
cull_i = CullIndex(List=qal_2.Quality, Indices="0", Wrap=True)
item = ListItem(List=ungroup, Index=0, Wrap=True)  # -> flatten(Item), flatten(Item1), flatten(Item2), flatten(Item3)
merge = Merge(Data1=qal, Data2="footprint area", Data3="green area", Data4="car area", Data5="pedestrian area", Data6="street area")
merge_2 = Merge(Data1=qal_8.nu_2, Data2=qal_3.nu_2, Data3=qal_4.nu_2, Data4=qal_5.nu_2, Data5=qal_6.nu_2, Data6=qal_7.nu_2)
trim = TrimTree(Tree=cull_i, Depth=1)
qal_9 = ModelQuality(Name=merge, Value=merge_2, Unit="m²")  # -> Quality, Valid, Name, Value, Unit, Definition
merge_3 = Merge(Data1=trim, Data2=qal_9.Quality)
dsn = ModelDesign(Design=slts, Name="City", Variant=concat, Qualities=merge_3)  # -> Design, Valid, Name, Description, Icon, Image, Variant, View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
ungroup_2 = Ungroup(Group=item.Item)  # -> flatten(Geometry)
sunion = SolidUnion(Breps=ungroup_2)
join_2 = BrepJoin(Breps=item.Item2)  # -> Breps, Closed
join_3 = BrepJoin(Breps=item.Item3)  # -> Breps, Closed
join_4 = BrepJoin(Breps=item.Item1)  # -> Breps, Closed
fmerge = MergeFaces(Brep=sunion)  # -> flatten(Breps), Before, After
fmerge_2 = MergeFaces(Brep=join_4.Breps)  # -> flatten(Breps), Before, After
fmerge_3 = MergeFaces(Brep=join_2.Breps)  # -> flatten(Breps), Before, After
fmerge_4 = MergeFaces(Brep=join_3.Breps)  # -> flatten(Breps), Before, After
group = Group(Geometry=fmerge.Breps)
group_2 = Group(Geometry=fmerge_2.Breps)
group_3 = Group(Geometry=ungroup_2)
group_4 = Group(Geometry=fmerge_3.Breps)
group_5 = Group(Geometry=fmerge_4.Breps)
buildings = Group(group)
cars = Group(group_2)
pedestrians = Group(group_4)
green = Group(group_5)
building_segments = Group(group_3)
city = Design(dsn.Design)
footprint_area_m² = Number(qal_3.nu_2)
effective_floor_area_m² = Number(qal_8.nu_2)
street_area_m² = Number(qal_7.nu_2)
car_area_m² = Number(qal_3.nu_2)
merge_4 = Merge(Data1=group, Data2=group_2, Data3=group_4, Data4=group_5)
pedestrian_area_m² = Number(qal_6.nu_2)
group_6 = Group(Geometry=merge_4)
geometry = Group(group_6)
city_2 = ClusterOutput(city)
geometry_2 = ClusterOutput(geometry)

# ==== cluster PreviewCity: Preview the city with colors and shadows.
geometry = ClusterInput()
geometry_2 = Group(geometry)
ungroup = Ungroup(Group=geometry_2)
item = ListItem(List=ungroup, Index=0, Wrap=True)  # -> Item, Item1, Item2, Item3
pedestrians = Group(item.Item2)
green = Group(item.Item3)
buildings = Group(item.Item)
cars = Group(item.Item1)
ungroup_2 = Ungroup(Group=buildings)  # -> flatten(Geometry)
merge = Merge(Data1=cars, Data2=pedestrians, Data3=green)
vec = VectorXYZ(XComponent=Slider(0.7, range=-1..1), YComponent=Slider(0.6, range=-1..1), ZComponent=Slider(-1, range=-1..1))  # -> Vector, Length
mshadow = MeshShadow(Mesh=ungroup_2, Light=vec.Vector, Plane=PlaneXY(0, 0, 0))
bbox = BoundingBox(Content=cars, Plane=PlaneXY(0, 0, 0), UnionBox=True)  # -> Box, Box_2
swatch = ColourSwatch(SwatchColor=RGBA(0, 0, 0, 0))
Z = UnitZ(Factor="0.1")
runion = RegionUnion(Curves=mshadow)
srf = Surface(bbox.Box)
material = CreateMaterial(
    Diffuse=ColourSwatch(SwatchColor=RGB(252, 207, 5)),
    Specular=swatch,
    Emission=swatch,
    Transparency=Slider(0.79, range=0..1),
    Shine=Slider(43, range=0..100))
material_2 = CreateMaterial(
    Diffuse=ColourSwatch(SwatchColor=RGB(0, 0, 0)),
    Specular=RGB(255, 255, 255),
    Emission=RGB(0, 0, 0),
    Transparency=Slider(0.84, range=0..1),
    Shine=0)
srf_2 = Surface(flatten(runion))
move = Move(Geometry=srf_2, Motion=Z)  # -> Geometry, Transform
mesh = MeshBrep(
    Brep=move.Geometry,
    Settings={GridMaxCount=0, GridMinCount=16, JaggedSeams=False, MaxEdgeLength=0, MinEdgeLength=0.0001, MinTolerance=0, Refine=True, RefineAngle=0, RelativeTolerance=0.65, SimplePlanes=True, Tolerance=0})
sint = SolidIntersection(BrepsA=srf, BrepsB=srf_2)
move_2 = Move(Geometry=sint, Motion=Z)  # -> Geometry, Transform
mesh_2 = MeshBrep(
    Brep=move_2.Geometry,
    Settings={GridMaxCount=0, GridMinCount=16, JaggedSeams=False, MaxEdgeLength=0, MinEdgeLength=0.0001, MinTolerance=0, Refine=True, RefineAngle=0, RelativeTolerance=0.65, SimplePlanes=True, Tolerance=0})
geo = PreviewGeometry(geo=buildings, sc=1)
preview = CustomPreview(Geometry=cars, Material=ColourSwatch(SwatchColor=RGBA(0, 17, 23, 64)))
preview_2 = CustomPreview(Geometry=pedestrians, Material=ColourSwatch(SwatchColor=RGBA(0, 17, 23, 128)))
preview_3 = CustomPreview(Geometry=green, Material=ColourSwatch(SwatchColor=RGB(50, 171, 50)))
preview_4 = CustomPreview(Geometry=mesh_2, Material=material)  # disabled
preview_5 = CustomPreview(Geometry=mesh, Material=material_2)
preview_6 = CustomPreview(Geometry=merge, Material=ColourSwatch(SwatchColor=RGB(0, 0, 0)))

# ==== cluster SlotsToDesign: Convert Monoceros slots to a semio design.
S = ClusterInput()
ty = ClusterInput()
S_2 = Slot(S)
ty_2 = Type(ty)
deconslot = DeconstructSlot(Slot=S_2)  # -> Center, BasePlane, Diagonal, AllowedModuleNames, IsDeterministic, AllowsAllModules, AllowsNothing, IsValid
trim = TrimTree(Tree=deconslot.BasePlane, Depth=1)
trim_2 = TrimTree(Tree=deconslot.Center, Depth=1)
txt = Text(deconslot.AllowedModuleNames)

pt = ConstructPoint(XCoordinate=0, YCoordinate=0, ZCoordinate=0)
txt_2 = Text(ty_2)
dup = DuplicateData(Data=graft(ty_2), Number="10", Order=True)
constmodule = ConstructModule(ModuleName=txt_2, ModulePartPoints=pt, BasePlane=PlaneXY(0, 0, 0), ModulePartDiagonal=Vector(1, 1, 1))
trim_3 = TrimTree(Tree=dup, Depth=1)
deconmodule = DeconstructModule(Module=constmodule)  # -> ModuleName, ModulePartCenterPoints, Geometry, BasePlane, ModulePartDiagonal, IsCompact, IsValid, Connectors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
trim_4 = TrimTree(Tree=trim_3, Depth=1)
trim_5 = TrimTree(Tree=deconmodule.ModuleName, Depth=1)
txt_3 = Text(trim_5)
concat = Concatenate(FragmentA=txt_3, FragmentB="↺", FragmentC="90", FragmentD="°", FragmentE="x")
concat_2 = Concatenate(FragmentA=txt_3, FragmentB="↺", FragmentC="90", FragmentD="°", FragmentE="y")
concat_3 = Concatenate(FragmentA=txt_3, FragmentB="↺", FragmentC="90", FragmentD="°", FragmentE="z")
concat_4 = Concatenate(FragmentA=txt_3, FragmentB="↺", FragmentC="180", FragmentD="°", FragmentE="x")
concat_5 = Concatenate(FragmentA=txt_3, FragmentB="↺", FragmentC="180", FragmentD="°", FragmentE="y")
concat_6 = Concatenate(FragmentA=txt_3, FragmentB="↺", FragmentC="180", FragmentD="°", FragmentE="z")
concat_7 = Concatenate(FragmentA=txt_3, FragmentB="↺", FragmentC="270", FragmentD="°", FragmentE="x")
concat_8 = Concatenate(FragmentA=txt_3, FragmentB="↺", FragmentC="270", FragmentD="°", FragmentE="y")
concat_9 = Concatenate(FragmentA=txt_3, FragmentB="↺", FragmentC="270", FragmentD="°", FragmentE="z")
merge = Merge(
    Data1=graft(txt_3),
    Data2=graft(concat),
    Data3=graft(concat_2),
    Data4=graft(concat_3),
    Data5=graft(concat_4),
    Data6=graft(concat_5),
    Data7=graft(concat_6),
    Data8=graft(concat_7),
    Data9=graft(concat_8),
    Data10=graft(concat_9))
item = ListItem(List=txt, Index=0, Wrap=True)
trim_6 = TrimTree(Tree=item, Depth=1)
trim_7 = TrimTree(Tree=merge, Depth=1)
lng = ListLength(List=trim_7)
series = Series(Start=0, Step=1, Count=lng)
expression = Expression(x=trim_6, y=merge, Expression="x=y")
trim_8 = TrimTree(Tree=series, Depth=1)
keysearch = KeyValueSearch(Keys=trim_7, Values=trim_8, Search=trim_6)
expression_2 = Expression(x=keysearch, Expression="x%10")
item_2 = ListItem(List=trim_4, Index=keysearch, Wrap=True)
ty_3 = Type(item_2)
rt = Integer(expression_2)

orient = Orient(Geometry=trim_2, Source=trim, Target=PlaneXY(0, 0, 0))  # -> Geometry, Transform
xz = XZPlane(Origin=Point(0, 0, 0))
yz = YZPlane(Origin=Point(0, 0, 0))
xy = XYPlane(Origin=Point(0, 0, 0))
transform = Transform(0)
rotate = Rotate(Angle=degrees("90"), Plane=xy)  # -> Geometry, Transform
rotate_2 = Rotate(Angle=degrees("90"), Plane=yz)  # -> Geometry, Transform
rotate_3 = Rotate(Angle=degrees("90"), Plane=xz)  # -> Geometry, Transform
rotate_4 = Rotate(Angle=degrees("180"), Plane=xy)  # -> Geometry, Transform
rotate_5 = Rotate(Angle=degrees("180"), Plane=yz)  # -> Geometry, Transform
rotate_6 = Rotate(Angle=degrees("180"), Plane=xz)  # -> Geometry, Transform
rotate_7 = Rotate(Angle=degrees("270"), Plane=xy)  # -> Geometry, Transform
rotate_8 = Rotate(Angle=degrees("270"), Plane=yz)  # -> Geometry, Transform
rotate_9 = Rotate(Angle=degrees("270"), Plane=xz)  # -> Geometry, Transform
merge_2 = Merge(
    Data1=graft(transform),
    Data2=graft(rotate_2.Transform),
    Data3=graft(rotate_3.Transform),
    Data4=graft(rotate.Transform),
    Data5=graft(rotate_5.Transform),
    Data6=graft(rotate_6.Transform),
    Data7=graft(rotate_4.Transform),
    Data8=graft(rotate_8.Transform),
    Data9=graft(rotate_9.Transform),
    Data10=graft(rotate_7.Transform))
item_3 = ListItem(List=merge_2, Index=rt, Wrap=True)
xy_2 = XYPlane(Origin=Point(0, 0, 0))
c_script = CSharpScript(X=item_3)  # -> T, R, I; inputs X: Transform
# ---------- c_script: C# ----------
// Grasshopper Script Instance
#region Usings
using System;
using System.Linq;
using System.Collections;
using System.Collections.Generic;
using System.Drawing;

using Rhino;
using Rhino.Geometry;

using Grasshopper;
using Grasshopper.Kernel;
using Grasshopper.Kernel.Data;
using Grasshopper.Kernel.Types;
#endregion

public class Script_Instance : GH_ScriptInstance
{
    #region Notes
    /* 
      Members:
        RhinoDoc RhinoDocument
        GH_Document GrasshopperDocument
        IGH_Component Component
        int Iteration

      Methods (Virtual & overridable):
        Print(string text)
        Print(string format, params object[] args)
        Reflect(object obj)
        Reflect(object obj, string method_name)
    */
    #endregion

    private void RunScript(Transform X, ref object T, ref object R, ref object I)
    {
        var i = new Transform();
        T = X.TryGetInverse(out i);
        var translation = new Vector3d();
        var rotation = new Transform();
        var orthogonal = new Transform();
        var diagonal = new Vector3d();
        X.DecomposeAffine(out translation, out rotation, out orthogonal,out diagonal);
        T = translation;
        R = rotation;
        I = i;
    }
}
# ---------- end c_script ----------
transform_2 = Transform(Geometry=xy_2, Transform=c_script.R)
pl_origin = PlaneOrigin(Base=transform_2, Origin=orient.Geometry)
pce = ModelPiece(Piece=ty_3, Id=orient.Geometry, Plane=pl_origin)  # -> Piece, Valid, Id, Description, TypeName, TypeVariant, Plane, Center, Qualities
dsn = ModelDesign(Pieces=pce.Piece)  # -> Design, Valid, Name, Description, Icon, Image, Variant, View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
dn = Design(dsn.Design)
dn_2 = ClusterOutput(dn)

# ==== cluster PiecesToGroup: Convert every piece to a group. If you need more a sophisticated approach where you can switch between represenstations and don't waste space use: Design to Block
dn = ClusterInput()
ty = ClusterInput()
gr = ClusterInput()
dn_2 = Design(graft(dn))
ty_2 = Type(ty)
gr_2 = Group(gr)
fltdsn = FlattenDesign(Design=dn_2, Type=ty_2)
dsn = ModelDesign(Design=fltdsn)  # -> Design, Valid, Name, Description, Icon, Image, Variant, View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
trim = TrimTree(Tree=dsn.Pieces, Depth=1)
typ = SelectTypeByPiece(ty=ty_2, pc=trim)  # -> ty_4, i_2
item = ListItem(List=gr_2, Index=typ.i_2, Wrap=True)
pce = ModelPiece(Piece=dsn.Pieces)  # -> Piece, Valid, Id, Description, TypeName, TypeVariant, Plane, Center, Qualities
trim_2 = TrimTree(Tree=item, Depth=1)
orient = Orient(Geometry=trim_2, Source=PlaneXY(0, 0, 0), Target=pce.Plane)  # -> Geometry, Transform
gr_3 = Group(orient.Geometry)
gr_4 = ClusterOutput(gr_3)

# ==== cluster SumQualities: Sum up the qualities of a type for each piece with this type in a design.
dn = ClusterInput()
ty = ClusterInput()
na = ClusterInput()
dn_2 = Design(dn)
ty_2 = Type(ty)
na_2 = Name(na)
dsn = ModelDesign(Design=dn_2)  # -> Design, Valid, Name, Description, Icon, Image, Variant, View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
trim = TrimTree(Tree=dsn.Pieces, Depth=1)
typ = SelectTypeByPiece(ty=ty_2, pc=trim)  # -> ty_4, i_2
typ_2 = ModelType(Type=typ.ty_4)  # -> Type, Valid, Name, Description, Icon, Image, Variant, Unit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
qal = SelectQuality(ql=typ_2.Qualities, na=na_2)
qal_2 = ModelQuality(Quality=qal)  # -> Quality, Valid, Name, Value, Unit, Definition
ma = MassAddition(Input=qal_2.Value)  # -> Result, PartialResults
nu = Number(ma.Result)
ql = Quality(qal_2.Quality)
nu_2 = ClusterOutput(nu)
ql_2 = ClusterOutput(ql)

# ==== cluster PreviewGeometry: Preview geometry by ungrouping everything, showing light surfaces and dark edges.
sc = ClusterInput()
geo = ClusterInput()
geo_2 = Geometry(flatten(geo))
sc_2 = Number(sc)
expression = Expression(x=sc_2, Expression="x+1")
swatch = ColourSwatch(SwatchColor=RGB(0, 0, 0))
swatch_2 = ColourSwatch(SwatchColor=RGB(255, 255, 255))
ungroup = Ungroup(Group=geo_2)
ungroup_2 = Ungroup(Group=ungroup)
ungroup_3 = Ungroup(Group=ungroup_2)
ungroup_4 = Ungroup(Group=ungroup_3)
log = Logarithm(Value=expression)
clean = CleanTree(RemoveNulls=True, RemoveInvalid=True, RemoveEmpty=invert(False), Tree=ungroup_4)  # -> flatten(Tree)
multiplication = Multiplication(A=log, B=Slider(0.05, range=0..1))
linetype = ModelLinetype(Name="semio", Width=multiplication)  # -> ModelLinetype, Name, Segments, CapStyle, JoinStyle, Width, WidthUnits, TaperWidths, TaperPositions
dispatch = CSharpScript(D=clean)  # -> P, C, B, M, R
# ---------- dispatch: C# ----------
// Grasshopper Script Instance
#region Usings
using System;
using System.Linq;
using System.Collections;
using System.Collections.Generic;
using System.Drawing;

using Rhino;
using Rhino.Geometry;

using Grasshopper;
using Grasshopper.Kernel;
using Grasshopper.Kernel.Data;
using Grasshopper.Kernel.Types;
#endregion

public class Script_Instance : GH_ScriptInstance
{
    #region Notes
    /* 
      Members:
        RhinoDoc RhinoDocument
        GH_Document GrasshopperDocument
        IGH_Component Component
        int Iteration

      Methods (Virtual & overridable):
        Print(string text)
        Print(string format, params object[] args)
        Reflect(object obj)
        Reflect(object obj, string method_name)
    */
    #endregion

    private void RunScript(
	object D,
	ref object P,
	ref object C,
	ref object B,
	ref object M,
	ref object R)
    {
        if (D is Curve) C = D; // Curve
        else if (
            D is Rhino.Geometry.Point ||
            D is PointCloud
            )
            P = D; // Point
        else if ( D is Mesh) M = D; // Mesh
        else if (
            D is Surface ||
            D is Extrusion ||
            D is SubD ||
            D is Brep
            )
            B = D; // Brep
        else R = D; // Rest
            
    }
}
# ---------- end dispatch ----------
clean_2 = CleanTree(RemoveNulls=True, RemoveInvalid=True, RemoveEmpty=False, Tree=dispatch.M)
clean_3 = CleanTree(RemoveNulls=True, RemoveInvalid=True, RemoveEmpty=False, Tree=dispatch.R)
clean_4 = CleanTree(RemoveNulls=True, RemoveInvalid=True, RemoveEmpty=False, Tree=dispatch.B)
clean_5 = CleanTree(RemoveNulls=True, RemoveInvalid=True, RemoveEmpty=False, Tree=dispatch.P)
clean_6 = CleanTree(RemoveNulls=True, RemoveInvalid=True, RemoveEmpty=False, Tree=dispatch.C)
debrep = DeconstructBrep(Brep=clean_4)  # -> Faces, Edges, Vertices
preview = CustomPreview(Geometry=flatten(clean_5), Material=swatch)
preview_2 = CustomPreview(Geometry=flatten(debrep.Faces), Material=swatch_2)
preview_3 = CustomPreview(Geometry=flatten(clean_2), Material=swatch_2)
preview_4 = CustomPreview(Geometry=flatten(clean_3), Material=swatch)
curve_preview = CustomCurvePreview(Curve=clean_6, Linetype=linetype.ModelLinetype, Colour=swatch)
curve_preview_2 = CustomCurvePreview(Curve=debrep.Edges, Linetype=linetype.ModelLinetype, Colour=swatch)

# ==== cluster SelectTypeByPiece: Select the type of a piece.
ty = ClusterInput()
pc = ClusterInput()
pc_2 = Piece(graft(pc))
ty_2 = Type(ty)
pce = ModelPiece(Piece=pc_2)  # -> Piece, Valid, Id, Description, TypeName, TypeVariant, Plane, Center, Qualities
typ = SelectType(ty=ty_2, na=pce.TypeName, variant=pce.TypeVariant)  # -> ty_4, i_2
trim = TrimTree(Tree=typ.ty_4, Depth=1)
trim_2 = TrimTree(Tree=typ.i_2, Depth=1)
ty_3 = Type(trim)
i = Integer(trim_2)
ty_4 = ClusterOutput(ty_3)
i_2 = ClusterOutput(i)

# ==== cluster SelectQuality: Select a quality by its name. If no quality matches, null is returned.
ql = ClusterInput()
na = ClusterInput()
na_2 = Name(graft(na))
ql_2 = Quality(ql)
qal = ModelQuality(Quality=ql_2)  # -> Quality, Valid, Name, Value, Unit, Definition
expression = Expression(x=qal.Name, y=na_2, Expression="x=y")
cull = CullPattern(List=qal.Quality, CullPattern=expression)
nulltobranch = AddNullToEmptyBranch(D=cull)  # -> R; inputs D: tree
# ---------- nulltobranch: C# ----------
#region Usings
using System;
using System.Linq;
using System.Collections;
using System.Collections.Generic;
using System.Drawing;

using Rhino;
using Rhino.Geometry;

using Grasshopper;
using Grasshopper.Kernel;
using Grasshopper.Kernel.Data;
using Grasshopper.Kernel.Types;
#endregion

public class Script_Instance : GH_ScriptInstance
{

    private void RunScript(DataTree<object> D, ref object R)
    {
        foreach (GH_Path path in D.Paths)
            if (D.Branch(path).Count == 0)
                D.Add(null, path);

        R = D;
    }
}
# ---------- end nulltobranch ----------
trim = TrimTree(Tree=nulltobranch, Depth=1)
ql_3 = Quality(trim)
ql_4 = ClusterOutput(ql_3)

# ==== cluster SelectType: Select a type with a name and an optional variant. If no variant is provided it will select all variants. If you want to select the default type then use the empty text.
ty = ClusterInput()
na = ClusterInput()
variant = ClusterInput()
na_2 = Name(na)
variant_2 = Variant(variant)
ty_2 = Type(ty)
typ = ModelType(Type=ty_2)  # -> Type, Valid, Name, Description, Icon, Image, Variant, Unit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
expression = Expression(x=typ.Name, y=na_2, Expression="x=y")
cull = CullPattern(List=typ.Type, CullPattern=expression)
typ_2 = ModelType(Type=cull)  # -> Type, Valid, Name, Description, Icon, Image, Variant, Unit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
expression_2 = Expression(x=typ_2.Variant, y=variant_2, Expression="x=y")
txt = Text(ty_2)
cull_2 = CullPattern(List=typ_2.Type, CullPattern=expression_2)
null = NullItem(Item=variant_2)  # -> NullFlags, InvalidFlags, Description
filter = StreamFilter(Gate=null.NullFlags, Stream0=cull_2, Stream1=cull)
txt_2 = Text(filter)
mindex = MemberIndex(Set=txt, Member=txt_2)  # -> Index, Count
trim = TrimTree(Tree=mindex.Index, Depth=1)
ty_3 = Type(filter)
i = Integer(trim)
ty_4 = ClusterOutput(ty_3)
i_2 = ClusterOutput(i)
