# Grasshopper definition voxel.gh (Grasshopper 1.0.8)
# Copyright: GNU Lesser General Public License Version 3

tiefe = Slider(130, range=0..130)
höhe = Slider(130, range=0..130)
breite = Slider(130, range=0..130)
list = ValueList({"Linie": 0, "Bogen": 1, "Interpolierte Welle": 2}, selected="Interpolierte Welle")
punkt_1 = Slider(0.05, range=-1..1)
punkt_2 = Slider(0.05, range=-1..1)
anzahl_der_wellen_1 = Slider(5, range=0..10)
amplitude_1 = Slider(4, range=0..10)
amplitude_2 = Slider(10, range=0..10)
list_2 = ValueList({"Nicht verzahnt": 0, "Halbverzahnt": 1, "Vollverzahnt": 2}, selected="Nicht verzahnt")
wurzelverschiebung = Slider(-4, range=-10..10)
anzahl_der_wellen_2 = Slider(4, range=0..10)
xy = XYPlane(Origin=Point(0, 0, 0))
dom = ConstructDomain(DomainStart=0, DomainEnd=breite)
dom_2 = ConstructDomain(DomainStart=0, DomainEnd=tiefe)
dom_3 = ConstructDomain(DomainStart=0, DomainEnd=höhe)
box = DomainBox(Base=xy, X=dom, Y=dom_2, Z=dom_3)
box_2 = Box(box)
schnittkurve = Schnittkurve(
    box=box_2,
    punkt_1=punkt_1,
    punkt_2=punkt_2,
    anzahl_der_wellen_1=anzahl_der_wellen_1,
    amplitude_1=amplitude_1,
    anzahl_der_wellen_2=anzahl_der_wellen_2,
    amplitude_2=amplitude_2,
    konstruktionsart=list,
    symmetrisch=Toggle(True),
    verzahnt=list_2,
    wurzelverschiebung=wurzelverschiebung)
expression = Expression(x=breite, y=punkt_1, Expression="x*y")
xz = XZPlane(Origin=Point(0, 0, 0))
schalendicke = Panel(expression)
rectangle = Rectangle(Plane=xz, XSize=dom_2, YSize=dom_3, Radius=0)  # -> Rectangle, Length
X = UnitX(Factor=expression)
offsets = OffsetOnSrf(Curve=schnittkurve, Distance=X, Surface=rectangle.Rectangle)
list_3 = ValueList({"Gegenüber": 0, "Seitlich oben": 1, "Seitlich unten": 2, "Seitlich rechts": 3, "Seitlich links": 4}, selected="Seitlich links")
list_4 = ValueList({"Massiv": 0, "Schale": 1}, selected="Massiv")
trim = TrimTree(Tree=offsets, Depth=1)
merge = Merge(Data1=schnittkurve, Data2=trim)
filter = StreamFilter(Gate=list_4, Stream0=schnittkurve, Stream1=trim)
schnitt = Schnitt(
    breite=box_2,
    schnittkurve=merge,
    spiegelung_vorne_xy=Toggle(False),
    spiegelung_vorne_yz=Toggle(False),
    spiegelung_seitlich_xy=Toggle(False),
    spiegelung_seitlich_yz=Toggle(False),
    _2_seite=list_3)  # -> boxrahmen_2, schnittfläche_2, vordere_crv_schnitt_2, hintere_crv_schnitt_2
crv = Curve(schnitt.vordere_crv_schnitt_2)
crv_2 = Curve(schnitt.hintere_crv_schnitt_2)
srf = Surface(schnitt.schnittfläche_2)
brep = Brep(schnitt.schnittfläche_2)
wires = BrepWireframe(Brep=box, Density=-1)

# ==== cluster Schnitt
breite = ClusterInput()
_2_seite = ClusterInput()
schnittkurve = ClusterInput()  # Schnittkurve
spiegelung_vorne_xy = ClusterInput()
spiegelung_vorne_yz = ClusterInput()
spiegelung_seitlich_xy = ClusterInput()
spiegelung_seitlich_yz = ClusterInput()
box = Box(breite)
_2_seite_2 = Integer(_2_seite)
schnittkurve_2 = Curve(schnittkurve)
wires = BrepWireframe(Brep=box, Density=-1)
spiegelung_vorne_xy_2 = Boolean(spiegelung_vorne_xy)
spiegelung_vorne_yz_2 = Boolean(spiegelung_vorne_yz)
spiegelung_seitlich_xy_2 = Boolean(spiegelung_seitlich_xy)
spiegelung_seitlich_yz_2 = Boolean(spiegelung_seitlich_yz)

debox = DeconstructBox(Box=box)  # -> Plane, X, Y, Z
deplane = DeconstructPlane(Plane=debox.Plane)  # -> Origin, XAxis, YAxis, ZAxis
breite_2 = Number(debox.X)
tiefe = Number(debox.Y)
höhe = Number(debox.Z)
pdecon = Deconstruct(Point=deplane.Origin)  # -> XComponent, YComponent, ZComponent
expression = Expression(x=pdecon.YComponent, y=tiefe, Expression="x+y/2")
expression_2 = Expression(x=pdecon.ZComponent, y=höhe, Expression="x+y/2")
expression_3 = Expression(x=pdecon.XComponent, y=breite_2, Expression="x+y/2")
pt = ConstructPoint(XCoordinate=expression_3, YCoordinate=expression, ZCoordinate=expression_2)
xy = XYPlane(Origin=pt)
yz = YZPlane(Origin=pt)
rad = Radians(Degrees=180)
deplane_2 = DeconstructPlane(Plane=xy)  # -> Origin, XAxis, YAxis, ZAxis
rad_2 = Radians(Degrees=135)
rad_3 = Radians(Degrees=45)
rad_4 = Radians(Degrees=45)
rad_5 = Radians(Degrees=135)
vrot = Rotate(Vector=deplane_2.XAxis, Axis=deplane.ZAxis, Angle=rad)
vrot_2 = Rotate(Vector=deplane_2.XAxis, Axis=deplane.ZAxis, Angle=rad_2)
vrot_3 = Rotate(Vector=deplane_2.XAxis, Axis=deplane.ZAxis, Angle=rad_3)
vrot_4 = Rotate(Vector=deplane_2.YAxis, Axis=deplane.XAxis, Angle=rad_4)
vrot_5 = Rotate(Vector=deplane_2.YAxis, Axis=deplane.XAxis, Angle=rad_5)
pl = ConstructPlane(Origin=pt, XAxis=vrot, YAxis=deplane_2.ZAxis)
pl_2 = ConstructPlane(Origin=pt, XAxis=vrot_2, YAxis=deplane_2.ZAxis)
pl_3 = ConstructPlane(Origin=pt, XAxis=vrot_3, YAxis=deplane_2.ZAxis)
pl_4 = ConstructPlane(Origin=pt, XAxis=deplane_2.XAxis, YAxis=vrot_4)
pl_5 = ConstructPlane(Origin=pt, XAxis=deplane_2.XAxis, YAxis=vrot_5)

xnor = GateXnor(A=spiegelung_vorne_xy_2, B=spiegelung_vorne_yz_2)
xnor_2 = GateXnor(A=spiegelung_seitlich_xy_2, B=spiegelung_seitlich_yz_2)
equals = Equality(FirstNumber=spiegelung_vorne_xy_2, SecondNumber=spiegelung_seitlich_xy_2)  # -> Equality, Inequality
xnor_3 = GateXnor(A=spiegelung_vorne_yz_2, B=spiegelung_seitlich_xy_2)
xnor_4 = GateXnor(A=spiegelung_vorne_xy_2, B=spiegelung_seitlich_yz_2)
and = GateAnd(A=xnor_3, B=xnor_4)
and_2 = GateAnd(A=xnor, B=xnor_2)
expression_4 = Expression(x=and_2, y=equals.Inequality, z=and, Expression="if(x=false,if(y=false,true,y),y)")
expression_5 = Expression(x=and_2, y=expression_4, z=and, Expression="if(x=y,1,if(z=y,1,0))")

and_3 = GateAnd(A=spiegelung_vorne_xy_2, B=spiegelung_vorne_yz_2)
nor = GateNor(A=spiegelung_vorne_xy_2, B=spiegelung_vorne_yz_2)
expression_6 = Expression(x=and_3, y=spiegelung_vorne_xy_2, z=spiegelung_vorne_yz_2, u=nor, Expression="if(x=true,3,if(u=true,0,if(y=true,1,2)))")
mirror = Mirror(Geometry=schnittkurve_2, Plane=xy)  # -> Geometry, Transform
mirror_2 = Mirror(Geometry=schnittkurve_2, Plane=yz)  # -> Geometry, Transform
mirror_3 = Mirror(Geometry=mirror.Geometry, Plane=yz)  # -> Geometry, Transform
filter = StreamFilter(Gate=expression_6, Stream0=schnittkurve_2, Stream1=mirror.Geometry, Stream2=mirror_2.Geometry, Stream3=mirror_3.Geometry)

and_4 = GateAnd(A=spiegelung_seitlich_xy_2, B=spiegelung_seitlich_yz_2)
nor_2 = GateNor(A=spiegelung_seitlich_xy_2, B=spiegelung_seitlich_yz_2)
expression_7 = Expression(
    x=and_4,
    y=spiegelung_seitlich_xy_2,
    z=spiegelung_seitlich_yz_2,
    u=nor_2,
    Expression="if(x=true,3,if(u=true,0,if(y=true,1,2)))")
mirror_4 = Mirror(Geometry=schnittkurve_2, Plane=pl_2)  # -> Geometry, Transform
mirror_5 = Mirror(Geometry=mirror_4.Geometry, Plane=pl)  # -> Geometry, Transform
mirror_6 = Mirror(Geometry=mirror_4.Geometry, Plane=xy)  # -> Geometry, Transform
mirror_7 = Mirror(Geometry=mirror_5.Geometry, Plane=xy)  # -> Geometry, Transform
filter_2 = StreamFilter(
    Gate=expression_7,
    Stream0=mirror_4.Geometry,
    Stream1=mirror_6.Geometry,
    Stream2=mirror_5.Geometry,
    Stream3=mirror_7.Geometry)

and_5 = GateAnd(A=spiegelung_seitlich_xy_2, B=spiegelung_seitlich_yz_2)
nor_3 = GateNor(A=spiegelung_seitlich_xy_2, B=spiegelung_seitlich_yz_2)
expression_8 = Expression(
    x=and_5,
    y=spiegelung_seitlich_xy_2,
    z=spiegelung_seitlich_yz_2,
    u=nor_3,
    Expression="if(x=true,3,if(u=true,0,if(y=true,1,2)))")
mirror_8 = Mirror(Geometry=schnittkurve_2, Plane=pl_3)  # -> Geometry, Transform
mirror_9 = Mirror(Geometry=mirror_8.Geometry, Plane=pl)  # -> Geometry, Transform
mirror_10 = Mirror(Geometry=mirror_8.Geometry, Plane=xy)  # -> Geometry, Transform
mirror_11 = Mirror(Geometry=mirror_9.Geometry, Plane=xy)  # -> Geometry, Transform
filter_3 = StreamFilter(
    Gate=expression_8,
    Stream0=mirror_8.Geometry,
    Stream1=mirror_10.Geometry,
    Stream2=mirror_9.Geometry,
    Stream3=mirror_11.Geometry)

and_6 = GateAnd(A=spiegelung_seitlich_xy_2, B=spiegelung_seitlich_yz_2)
nor_4 = GateNor(A=spiegelung_seitlich_xy_2, B=spiegelung_seitlich_yz_2)
expression_9 = Expression(
    x=and_6,
    y=spiegelung_seitlich_xy_2,
    z=spiegelung_seitlich_yz_2,
    u=nor_4,
    Expression="if(x=true,3,if(u=true,0,if(y=true,1,2)))")
mirror_12 = Mirror(Geometry=schnittkurve_2, Plane=pl_4)  # -> Geometry, Transform
mirror_13 = Mirror(Geometry=mirror_12.Geometry, Plane=pl)  # -> Geometry, Transform
mirror_14 = Mirror(Geometry=mirror_12.Geometry, Plane=yz)  # -> Geometry, Transform
mirror_15 = Mirror(Geometry=mirror_14.Geometry, Plane=pl)  # -> Geometry, Transform
filter_4 = StreamFilter(
    Gate=expression_9,
    Stream0=mirror_12.Geometry,
    Stream1=mirror_13.Geometry,
    Stream2=mirror_14.Geometry,
    Stream3=mirror_15.Geometry)

and_7 = GateAnd(A=spiegelung_seitlich_xy_2, B=spiegelung_seitlich_yz_2)
nor_5 = GateNor(A=spiegelung_seitlich_xy_2, B=spiegelung_seitlich_yz_2)
expression_10 = Expression(
    x=and_7,
    y=spiegelung_seitlich_xy_2,
    z=spiegelung_seitlich_yz_2,
    u=nor_5,
    Expression="if(x=true,3,if(u=true,0,if(y=true,1,2)))")
mirror_16 = Mirror(Geometry=schnittkurve_2, Plane=pl)  # -> Geometry, Transform
mirror_17 = Mirror(Geometry=mirror_16.Geometry, Plane=yz)  # -> Geometry, Transform
mirror_18 = Mirror(Geometry=mirror_16.Geometry, Plane=xy)  # -> Geometry, Transform
mirror_19 = Mirror(Geometry=mirror_17.Geometry, Plane=xy)  # -> Geometry, Transform
filter_5 = StreamFilter(
    Gate=expression_10,
    Stream0=mirror_16.Geometry,
    Stream1=mirror_18.Geometry,
    Stream2=mirror_17.Geometry,
    Stream3=mirror_19.Geometry)

and_8 = GateAnd(A=spiegelung_seitlich_xy_2, B=spiegelung_seitlich_yz_2)
nor_6 = GateNor(A=spiegelung_seitlich_xy_2, B=spiegelung_seitlich_yz_2)
expression_11 = Expression(
    x=and_8,
    y=spiegelung_seitlich_xy_2,
    z=spiegelung_seitlich_yz_2,
    u=nor_6,
    Expression="if(x=true,3,if(u=true,0,if(y=true,1,2)))")
mirror_20 = Mirror(Geometry=schnittkurve_2, Plane=pl_5)  # -> Geometry, Transform
mirror_21 = Mirror(Geometry=mirror_20.Geometry, Plane=pl)  # -> Geometry, Transform
mirror_22 = Mirror(Geometry=mirror_20.Geometry, Plane=yz)  # -> Geometry, Transform
mirror_23 = Mirror(Geometry=mirror_22.Geometry, Plane=pl)  # -> Geometry, Transform
filter_6 = StreamFilter(
    Gate=expression_11,
    Stream0=mirror_20.Geometry,
    Stream1=mirror_21.Geometry,
    Stream2=mirror_22.Geometry,
    Stream3=mirror_23.Geometry)

flip = FlipCurve(Curve=filter)  # -> Curve, Flag
filter_7 = StreamFilter(Gate=expression_5, Stream0=filter, Stream1=flip.Curve)

equals_2 = Equality(FirstNumber=spiegelung_vorne_xy_2, SecondNumber=spiegelung_seitlich_xy_2)  # -> Equality, Inequality
equals_3 = Equality(FirstNumber=spiegelung_vorne_xy_2, SecondNumber=spiegelung_vorne_yz_2)  # -> Equality, Inequality
equals_4 = Equality(FirstNumber=spiegelung_seitlich_xy_2, SecondNumber=spiegelung_seitlich_yz_2)  # -> Equality, Inequality
and_9 = GateAnd(A=equals_2.Equality, B=equals_3.Equality, C=equals_4.Equality)
rev = ReverseList(List=filter_7)
int = Integer(and_9)
filter_8 = StreamFilter(Gate=int, Stream0=rev, Stream1=filter_7)
graft = GraftTree(Tree=filter_8, IncludeEmptyLists=True, IncludeNullItems=True)  # -> simplify(Tree)

filter_9 = StreamFilter(Gate=_2_seite_2, Stream0=filter_5, Stream1=filter_6, Stream2=filter_4, Stream3=filter_2, Stream4=filter_3)
expression_12 = Expression(x=deplane.YAxis, y=tiefe, Expression="[x]*y")
move = Move(Geometry=deplane.Origin, Motion=expression_12)  # -> Geometry, Transform

expression_13 = Expression(x=deplane.ZAxis, y=höhe, Expression="[x]*y")
expression_14 = Expression(x=deplane.XAxis, y=breite_2, Expression="[x]*y")
move_2 = Move(Geometry=deplane.Origin, Motion=expression_13)  # -> Geometry, Transform
move_3 = Move(Geometry=deplane.Origin, Motion=expression_14)  # -> Geometry, Transform
xz = XZPlane(Origin=move.Geometry)
xy_2 = XYPlane(Origin=deplane.Origin)
yz_2 = YZPlane(Origin=deplane.Origin)
yz_3 = YZPlane(Origin=move_3.Geometry)
xy_3 = XYPlane(Origin=move_2.Geometry)
filter_10 = StreamFilter(Gate=_2_seite_2, Stream0=xz, Stream1=xy_3, Stream2=xy_2, Stream3=yz_3, Stream4=yz_2)
project = Project(Geometry=filter_9, Plane=filter_10)  # -> simplify(graft(Geometry)), Transform

boxrahmen = Geometry(wires)
vordere_crv_schnitt = Curve(filter_7)
hintere_crv_schnitt = Curve(project.Geometry)
vordere_crv_schnitt_2 = ClusterOutput(vordere_crv_schnitt)
hintere_crv_schnitt_2 = ClusterOutput(hintere_crv_schnitt)
boxrahmen_2 = ClusterOutput(boxrahmen)
loft = Loft(
    Curves=simplify([project.Geometry, graft]),
    Options={Adjust=False, Closed=False, LoftEnds=0, LoftSimp=0, LoftType=0, Rebuild=10, Refit=0.01})
schnittfläche = Brep(loft)
schnittfläche_2 = ClusterOutput(schnittfläche)

# ==== cluster Schnittkurve
box = ClusterInput()
punkt_1 = ClusterInput()
punkt_2 = ClusterInput()
anzahl_der_wellen_1 = ClusterInput()
amplitude_1 = ClusterInput()
anzahl_der_wellen_2 = ClusterInput()
amplitude_2 = ClusterInput()
konstruktionsart = ClusterInput()
symmetrisch = ClusterInput()
verzahnt = ClusterInput()
wurzelverschiebung = ClusterInput()
box_2 = Box(box)
wurzelverschiebung_2 = Number(wurzelverschiebung)
verzahnt_2 = Integer(verzahnt)
anzahl_der_wellen_1_2 = Integer(anzahl_der_wellen_1)
amplitude_1_2 = Number(amplitude_1)
anzahl_der_wellen_2_2 = Integer(anzahl_der_wellen_2)
amplitude_2_2 = Number(amplitude_2)
konstruktionsart_2 = Integer(konstruktionsart)
symmetrisch_2 = Integer(symmetrisch)
debox = DeconstructBox(Box=box_2)  # -> Plane, X, Y, Z
tiefe = Number(debox.Y)
höhe = Number(debox.Z)
breite = Number(debox.X)
punkt_1_2 = Number(punkt_1)
punkt_2_2 = Number(punkt_2)

abs = Absolute(Value=punkt_2_2)
abs_2 = Absolute(Value=punkt_1_2)
equals = Equality(FirstNumber=punkt_2_2, SecondNumber=abs)  # -> Equality, Inequality
equals_2 = Equality(FirstNumber=punkt_1_2, SecondNumber=abs_2)  # -> Equality, Inequality
expression = Expression(x=equals_2.Equality, Expression="if(x=true,0,1)")
expression_2 = Expression(x=abs_2, y=breite, Expression="x*y")
expression_3 = Expression(x=abs_2, y=höhe, Expression="x*y")
expression_4 = Expression(x=equals.Equality, Expression="if(x=true,0,1)")
expression_5 = Expression(x=abs, y=breite, Expression="y-x*y")
expression_6 = Expression(x=abs, y=höhe, Expression="y-x*y")
X = UnitX(Factor=expression_2)
Z = UnitZ(Factor=expression_3)
X_2 = UnitX(Factor=expression_5)
X_3 = UnitX(Factor=breite)
Z_2 = UnitZ(Factor=expression_6)
Z_3 = UnitZ(Factor=höhe)
filter = StreamFilter(Gate=expression, Stream0=X, Stream1=Z)
filter_2 = StreamFilter(Gate=expression_4, Stream0=X_2, Stream1=X_3)
filter_3 = StreamFilter(Gate=expression_4, Stream0=Z_3, Stream1=Z_2)
deplane = DeconstructPlane(Plane=debox.Plane)  # -> Origin, XAxis, YAxis, ZAxis
addition = Addition(A=filter_2, B=filter_3)
move = Move(Geometry=deplane.Origin, Motion=filter)  # -> Geometry, Transform
move_2 = Move(Geometry=deplane.Origin, Motion=addition)  # -> Geometry, Transform
ln = Line(StartPoint=move.Geometry, EndPoint=move_2.Geometry)

expression_7 = Expression(x=equals.Equality, Expression="if(x=true,0,1)")
expression_8 = Expression(x=equals_2.Equality, Expression="if(x=true,0,1)")
X_4 = UnitX(Factor=1)
Z_4 = UnitZ(Factor=1)
filter_4 = StreamFilter(Gate=expression_7, Stream0=Z_4, Stream1=X_4)
filter_5 = StreamFilter(Gate=expression_8, Stream0=Z_4, Stream1=X_4)
biarc = BiArc(StartPoint=move.Geometry, StartTangent=filter_5, EndPoint=move_2.Geometry, EndTangent=filter_4, Ratio=0.5)  # -> FirstArc, SecondArc, BiArc

curvepoint = PointOnCurve(ln, parameter=0.5)
curvepoint_2 = PointOnCurve(ln, parameter=0)
filter_6 = StreamFilter(Gate=symmetrisch_2, Stream0=curvepoint, Stream1=curvepoint_2)
crv_cp = CurveClosestPoint(Point=filter_6, Curve=ln)  # -> Point, Parameter, Distance
shatter = Shatter(Curve=ln, Parameters=crv_cp.Parameter)
item = ListItem(List=shatter, Index=0, Wrap=True)
divide = DivideCurve(Curve=item, Count=anzahl_der_wellen_1_2, Kinks=False)  # -> Points, Tangents, Parameters
lng = ListLength(List=divide.Points)
lng_2 = ListLength(List=divide.Points)
expression_9 = Expression(x=lng_2, Expression="x-1")
expression_10 = Expression(x=lng_2, Expression="x-2")
Y = UnitY(Factor=1)
filter_7 = StreamFilter(Gate=symmetrisch_2, Stream0=expression_9, Stream1=expression_10)
item_2 = ListItem(List=divide.Points, Index=expr("x-1", lng), Wrap=True)
item_3 = ListItem(List=divide.Points, Index=0, Wrap=True)  # -> flatten(Item)
dom = ConstructDomain(DomainStart=1, DomainEnd=filter_7)
subset = SubList(List=divide.Points, Domain=dom, Wrap=True)  # -> List, Index
dispatch = Dispatch(List=subset.List, DispatchPattern=[True, False])  # -> ListA, ListB
expression_11 = Expression(x=verzahnt_2, Expression="if(x=0,0,1)")

item_4 = ListItem(List=shatter, Index=1, Wrap=True)
divide_2 = DivideCurve(Curve=item_4, Count=anzahl_der_wellen_2_2, Kinks=False)  # -> Points, Tangents, Parameters
lng_3 = ListLength(List=divide_2.Points)  # -> expr("x-2", Length)
expression_12 = Expression(x=anzahl_der_wellen_1_2, Expression="if(x%2=0,0,1)")
dom_2 = ConstructDomain(DomainStart=1, DomainEnd=lng_3)
subset_2 = SubList(List=divide_2.Points, Domain=dom_2, Wrap=True)  # -> List, Index
dispatch_2 = Dispatch(List=subset_2.List, DispatchPattern=[True, False])  # -> ListA, ListB
lng_4 = ListLength(List=divide_2.Points)
item_5 = ListItem(List=divide_2.Points, Index=expr("x-1", lng_4), Wrap=True)

vec = Vector(ln)
unit = UnitVector(Vector=vec)
filter_8 = StreamFilter(Gate=symmetrisch_2, Stream0=unit, Stream1=filter_4)

vrot = Rotate(Vector=unit, Axis=Y, Angle=degrees("90"))
amp = Amplitude(Vector=vrot, Amplitude=amplitude_1_2)
amp_2 = Amplitude(Vector=unit, Amplitude=wurzelverschiebung_2)
neg = Negative(Value=amp)
rev = Reverse(Vector=amp_2)
addition_2 = Addition(A=amp, B=amp_2)
addition_3 = Addition(A=amp, B=rev)
move_3 = Move(Geometry=dispatch.ListA, Motion=addition_2)  # -> graft(Geometry), Transform
move_4 = Move(Geometry=dispatch.ListA, Motion=neg)  # -> graft(Geometry), Transform
move_5 = Move(Geometry=dispatch.ListB, Motion=neg)  # -> graft(Geometry), Transform
move_6 = Move(Geometry=dispatch.ListB, Motion=addition_3)  # -> graft(Geometry), Transform
merge = Merge(Data1=move_3.Geometry, Data2=move_5.Geometry)  # -> flatten(Result)
merge_2 = Merge(Data1=move_3.Geometry, Data2=move_4.Geometry, Data3=move_5.Geometry, Data4=move_6.Geometry)  # -> flatten(Result)
filter_9 = StreamFilter(Gate=expression_11, Stream0=merge, Stream1=merge_2)
lng_5 = ListLength(List=filter_9)  # -> expr("x+1", Length)
path_mapper = PathMapper(filter_9, source="{A}(i)", target="(i+1)")
flatten = FlattenTree(Tree=item_2, Path=lng_5)
filter_10 = StreamFilter(Gate=symmetrisch_2, Stream1=flatten)
merge_3 = Merge(Data1=item_3, Data2=path_mapper, Data3=filter_10)

amp_3 = Amplitude(Vector=vrot, Amplitude=amplitude_2_2)
neg_2 = Negative(Value=amp_3)
filter_11 = StreamFilter(Gate=expression_12, Stream0=amp_3, Stream1=neg_2)
filter_12 = StreamFilter(Gate=expression_12, Stream0=neg_2, Stream1=amp_3)
move_7 = Move(Geometry=dispatch_2.ListA, Motion=filter_11)  # -> graft(Geometry), Transform
move_8 = Move(Geometry=dispatch_2.ListA, Motion=filter_12)  # -> graft(Geometry), Transform
move_9 = Move(Geometry=dispatch_2.ListB, Motion=filter_12)  # -> graft(Geometry), Transform
move_10 = Move(Geometry=dispatch_2.ListB, Motion=filter_11)  # -> graft(Geometry), Transform
merge_4 = Merge(Data1=move_7.Geometry, Data2=move_9.Geometry)  # -> flatten(Result)
merge_5 = Merge(Data1=move_7.Geometry, Data2=move_8.Geometry, Data3=move_9.Geometry, Data4=move_10.Geometry)  # -> flatten(Result)
filter_13 = StreamFilter(Gate=expression_11, Stream0=merge_4, Stream1=merge_5)
lng_6 = ListLength(List=filter_13)  # -> expr("x+1", Length)
path_mapper_2 = PathMapper(filter_13, source="{A}(i)", target="(i+1)")
flatten_2 = FlattenTree(Tree=item_5, Path=lng_6)
merge_6 = Merge(Data1=path_mapper_2, Data2=flatten_2)

merge_7 = Merge(Data1=flatten(merge_3), Data2=flatten(merge_6))

filter_14 = StreamFilter(Gate=symmetrisch_2, Stream0=merge_7, Stream1=flatten(merge_3))  # -> flatten(Stream)
lng_7 = ListLength(List=filter_14)  # -> expr("x-2", Length)
merge_8 = Merge(Data1=1, Data2=lng_7)
cull_i = CullIndex(List=filter_14, Indices=merge_8, Wrap=True)
filter_15 = StreamFilter(Gate=verzahnt_2, Stream0=merge, Stream1=filter_14, Stream2=cull_i)
filter_16 = StreamFilter(Gate=expression_11, Stream0=filter_14, Stream1=filter_15)
intcrv_t = InterpolateT(Vertices=filter_16, Degree=3, TangentStart=filter_5, TangentEnd=filter_8, KnotStyle=1)  # -> Curve, Length, Domain

filter_17 = StreamFilter(Gate=konstruktionsart_2, Stream0=ln, Stream1=biarc.BiArc, Stream2=intcrv_t.Curve)
schnittkurve = Curve(filter_17)
schnittkurve_2 = ClusterOutput(schnittkurve)
