# Grasshopper definition voxels.gh (Grasshopper 1.0.8)
# Copyright: GNU Lesser General Public License Version 3
# plug-ins: Monoceros

xy = XYPlane(Origin="-0.25,-0.25,-0.125")
vec = VectorXYZ(XComponent="0.5", YComponent="0.5", ZComponent="0.25")  # -> Vector, Length
saddle_bottom_south_east = Brep(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)
saddle_bottom_north_east = Brep(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)
saddle_bottom_north_west = Brep(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)
saddle_top_south_west = Brep(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)
saddle_top_south_east = Brep(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)
saddle_top_north_east = Brep(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)
saddle_top_north_west = Brep(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)
gem_bottom_south_east = Brep(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)
gem_bottom_north_east = Brep(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)
gem_top_south_west = Brep(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)
gem_top_south_east = Brep(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)
saddle_pillow_top_south_west = Brep([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])
saddle_pillow_top_south_east = Brep([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])
saddle_bottom_south_west = Brep(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)
gem_bottom_south_west = Brep(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)
gem_bottom_north_west = Brep(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)
gem_top_north_east = Brep(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)
gem_top_north_west = Brep(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)
saddle_pillow_top_north_east = Brep([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])
saddle_pillow_top_north_west = Brep([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])
pillow_saddle_top_south_west = Brep([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])
pillow_saddle_top_south_east = Brep([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])
pillow_saddle_top_north_east = Brep([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])
pillow_saddle_top_north_west = Brep([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])
saddle_gem_top_south_west = Brep([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])
saddle_gem_top_south_east = Brep([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])
pillow_bottom_south_east = Brep(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)
pillow_top_south_west = Brep(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)
saddle_saddle_top_south_west = Brep([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])
saddle_saddle_top_south_east = Brep([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])
saddle_gem_top_north_east = Brep([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])
saddle_gem_top_north_west = Brep([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])
pillow_bottom_south_west = Brep(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)
pillow_bottom_north_east = Brep(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)
pillow_bottom_north_west = Brep(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)
pillow_top_south_east = Brep(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)
pillow_top_north_east = Brep(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)
pillow_top_north_west = Brep(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)
saddle_saddle_top_north_east = Brep([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])
saddle_saddle_top_north_west = Brep([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])
merge = Merge(Data1=gem_top_south_west, Data2=gem_top_south_east, Data3=gem_top_north_east, Data4=gem_top_north_west)  # -> graft(Result)
merge_2 = Merge(Data1=gem_bottom_south_west, Data2=gem_bottom_south_east, Data3=gem_bottom_north_east, Data4=gem_bottom_north_west)  # -> graft(Result)
series = Series(Start=0, Step="0.25", Count="6")  # -> flatten(Series)
merge_3 = Merge(Data1=saddle_top_south_west, Data2=saddle_top_south_east, Data3=saddle_top_north_east, Data4=saddle_top_north_west)  # -> graft(Result)
merge_4 = Merge(
    Data1=pillow_bottom_south_west,
    Data2=pillow_bottom_south_east,
    Data3=pillow_bottom_north_east,
    Data4=pillow_bottom_north_west)  # -> graft(Result)
merge_5 = Merge(
    Data1=saddle_bottom_south_west,
    Data2=saddle_bottom_south_east,
    Data3=saddle_bottom_north_east,
    Data4=saddle_bottom_north_west)  # -> graft(Result)
merge_6 = Merge(Data1=pillow_top_south_west, Data2=pillow_top_south_east, Data3=pillow_top_north_east, Data4=pillow_top_north_west)  # -> graft(Result)
entwine = Entwine(
    Branch00=saddle_saddle_top_south_west,
    Branch01=saddle_saddle_top_south_east,
    Branch02=saddle_saddle_top_north_east,
    Branch03=saddle_saddle_top_north_west,
    FlattenInputs=True)
entwine_2 = Entwine(
    Branch00=pillow_saddle_top_south_west,
    Branch01=pillow_saddle_top_south_east,
    Branch02=pillow_saddle_top_north_east,
    Branch03=pillow_saddle_top_north_west,
    FlattenInputs=True)
entwine_3 = Entwine(
    Branch00=saddle_gem_top_south_west,
    Branch01=saddle_gem_top_south_east,
    Branch02=saddle_gem_top_north_east,
    Branch03=saddle_gem_top_north_west,
    FlattenInputs=True)
entwine_4 = Entwine(
    Branch00=saddle_pillow_top_south_west,
    Branch01=saddle_pillow_top_south_east,
    Branch02=saddle_pillow_top_north_east,
    Branch03=saddle_pillow_top_north_west,
    FlattenInputs=True)
neg = Negative(Value=series)
entwine_5 = Entwine(Branch0X=merge_2, Branch1X=merge, FlattenInputs=False)
entwine_6 = Entwine(Branch0X=merge_5, Branch1X=merge_3, FlattenInputs=False)
entwine_7 = Entwine(Branch0X=merge_4, Branch1X=merge_6, FlattenInputs=False)
panel = Panel("""0,0
-0.5,0
-0.5,-0.5
0,-0.5""")
entwine_8 = Entwine(Branch0X=entwine_2, Branch1X=entwine, Branch2X=entwine_3, Branch3X=entwine_4, FlattenInputs=False)
panel_2 = Panel("""p-s-sw
p-s-se
p-s-ne
p-s-nw
s-s-sw
s-s-se
s-s-ne
s-s-nw
s-g-sw
s-g-se
s-g-ne
s-g-nw
g-p-sw
g-p-se
g-p-ne
g-p-nw""")
Z = UnitZ(Factor=neg)
panel_3 = Panel("""p-b-sw
p-b-se
p-b-ne
p-b-nw
p-t-sw
p-t-se
p-t-ne
p-t-nw
s-b-sw
s-b-se
s-b-ne
s-b-nw
s-t-sw
s-t-se
s-t-ne
s-t-nw
g-b-sw
g-b-se
g-b-ne
g-b-nw
g-t-sw
g-t-se
g-t-ne
g-t-nw""")
entwine_9 = Entwine(Branch0X=entwine_7, Branch1X=entwine_6, Branch2X=entwine_5, FlattenInputs=False)
geo = Geometry(entwine_8)
box = Box(Tree({0;0;0}: [{Plane=PlaneXY(0, 0, 0), X=Domain(2, 2.5), Y=Domain(0, 0.5), Z=Domain(0.75, 1)}], {0;0;1}: [{Plane=PlaneXY(0, 0, 0), X=Domain(3, 3.5), Y=Domain(0, 0.5), Z=Domain(0.75, 1)}], {0;0;2}: [{Plane=PlaneXY(0, 0, 0), X=Domain(3, 3.5), Y=Domain(1, 1.5), Z=Domain(0.75, 1)}], {0;0;3}: [{Plane=PlaneXY(0, 0, 0), X=Domain(2, 2.5), Y=Domain(1, 1.5), Z=Domain(0.75, 1)}], {1;0;0}: [{Plane=PlaneXY(0, 0, 0), X=Domain(2, 2.5), Y=Domain(0, 0.5), Z=Domain(1.25, 1.5)}], {1;0;1}: [{Plane=PlaneXY(0, 0, 0), X=Domain(3, 3.5), Y=Domain(0, 0.5), Z=Domain(1.25, 1.5)}]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))
name = Text(panel_2)
merge_7 = Merge(Data1=graft(Z), Data2=graft(Z), Data3=graft(Z), Data4=graft(Z))
geo_2 = Geometry(entwine_9)
box_2 = Box(Tree({0;0;0;0}: [{Plane=PlaneXY(0, 0, 0), X=Domain(0, 0.5), Y=Domain(0, 0.5), Z=Domain(0, 0.25)}], {0;0;0;1}: [{Plane=PlaneXY(1, 0, 0), X=Domain(0, 0.5), Y=Domain(0, 0.5), Z=Domain(0, 0.25)}], {0;0;0;2}: [{Plane=PlaneXY(1, 1, 0), X=Domain(0, 0.5), Y=Domain(0, 0.5), Z=Domain(0, 0.25)}], {0;0;0;3}: [{Plane=PlaneXY(0, 1, 0), X=Domain(0, 0.5), Y=Domain(0, 0.5), Z=Domain(0, 0.25)}], {0;1;0;0}: [{Plane=PlaneXY(0, 0, 0.5), X=Domain(0, 0.5), Y=Domain(0, 0.5), Z=Domain(0, 0.25)}], {0;1;0;1}: [{Plane=PlaneXY(1, 0, 0.5), X=Domain(0, 0.5), Y=Domain(0, 0.5), Z=Domain(0, 0.25)}]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))
area = Area(Geometry=box)  # -> Area, Centroid
name_2 = Text(panel_3)
unflatten = UnflattenTree(Tree=name, Guide=box)
move = Move(Geometry=box_2, Motion=merge_7)  # -> Geometry, Transform
area_2 = Area(Geometry=box_2)  # -> Area, Centroid
unflatten_2 = UnflattenTree(Tree=name_2, Guide=geo_2)
constmodule = ConstructModule(ModuleName=unflatten, ModulePartPoints=area.Centroid, Geometry=geo, BasePlane=xy, ModulePartDiagonal=vec.Vector)  # -> flatten(Module)
wires = BrepWireframe(Density=-1)
move_2 = Move(Geometry=move.Geometry, Motion=panel)  # -> Geometry, Transform
constmodule_2 = ConstructModule(ModuleName=unflatten_2, ModulePartPoints=area_2.Centroid, Geometry=geo_2, BasePlane=xy, ModulePartDiagonal=vec.Vector)  # -> flatten(Module)
merge_8 = Merge(Data1=constmodule_2, Data2=constmodule)
merge_9 = Merge(Data1=graft(move.Transform), Data2=graft(move_2.Transform))
M = Module(merge_8)
ruletyp = ConstructTypedRule()
comp = Compound(Transforms=merge_9)
trim = TrimTree(Tree=comp, Depth=1)
saddle_internal = Curve([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])
pillow_internal = Curve([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])
gem_internal = Curve([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])
panel_4 = Panel("""g-sw
g-se
g-nw
g-ne""")
panel_5 = Panel("""s-sw
s-se
s-nw
s-ne""")
panel_6 = Panel("""p-sw
p-se
p-nw
p-ne""")
pillow = Curve([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])
saddle = Curve([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])
gem = Curve([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])
transform = Transform(Geometry=box_2, Transform=trim)
transform_2 = Transform(Geometry=geo_2, Transform=trim)
transform_3 = Transform(Geometry=area_2.Centroid, Transform=trim)
panel_7 = Panel("""p-sw
p-se
p-nw
p-ne
s-sw
s-se
s-nw
s-ne
s-sw
s-se
s-nw
s-ne
g-sw
g-se
g-nw
g-ne
p-sw
p-se
p-nw
p-ne
s-sw
s-se
s-nw
s-ne""")
crv = Curve([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])
end = EndPoints(Curve=crv)  # -> Start, End
points = PointList(Points=end.Start, Size=Slider(0.15, range=0..1))
ruleexpcrv = ExplicitRuleFromCurve(Modules=M, ConnectionCurve=pillow_internal)  # -> flatten(Rules)
ruleexpcrv_2 = ExplicitRuleFromCurve(Modules=M, ConnectionCurve=saddle_internal)  # -> flatten(Rules)
ruleexpcrv_3 = ExplicitRuleFromCurve(Modules=M, ConnectionCurve=gem_internal)  # -> flatten(Rules)
ruleexpcrv_4 = ExplicitRuleFromCurve(Modules=M, ConnectionCurve=pillow)  # -> flatten(Rules)
ruleexpcrv_5 = ExplicitRuleFromCurve(Modules=M, ConnectionCurve=saddle)  # -> flatten(Rules)
ruleexpcrv_6 = ExplicitRuleFromCurve(Modules=M, ConnectionCurve=gem)  # -> flatten(Rules)
ruleexpcrv_7 = ExplicitRuleFromCurve(Modules=M, ConnectionCurve=crv)  # -> flatten(Rules)
deconruleexp = DeconstructExplicitRule(Rule=ruleexpcrv_4)  # -> SourceModuleName, SourceConnectorIndex, TargetModuleName, TargetConnectorIndex
deconruleexp_2 = DeconstructExplicitRule(Rule=ruleexpcrv_5)  # -> SourceModuleName, SourceConnectorIndex, TargetModuleName, TargetConnectorIndex
deconruleexp_3 = DeconstructExplicitRule(Rule=ruleexpcrv_6)  # -> SourceModuleName, SourceConnectorIndex, TargetModuleName, TargetConnectorIndex
series_2 = Series(Start=0, Step="0.25", Count="3")  # -> flatten(Series)
trim_2 = TrimTree(Tree=transform_2, Depth=1)
merge_10 = Merge(Data1=ruleexpcrv, Data2=ruleexpcrv_2, Data3=ruleexpcrv_3)
deconruleexp_4 = DeconstructExplicitRule(Rule=ruleexpcrv_7)  # -> SourceModuleName, SourceConnectorIndex, TargetModuleName, TargetConnectorIndex
ruletyp_2 = ConstructTypedRule(ModuleName=deconruleexp.SourceModuleName, ConnectorIndex=deconruleexp.SourceConnectorIndex, Type=panel_6)
ruletyp_3 = ConstructTypedRule(ModuleName=deconruleexp.TargetModuleName, ConnectorIndex=deconruleexp.TargetConnectorIndex, Type=panel_6)
ruletyp_4 = ConstructTypedRule(ModuleName=deconruleexp_2.SourceModuleName, ConnectorIndex=deconruleexp_2.SourceConnectorIndex, Type=panel_5)
ruletyp_5 = ConstructTypedRule(ModuleName=deconruleexp_2.TargetModuleName, ConnectorIndex=deconruleexp_2.TargetConnectorIndex, Type=panel_5)
ruletyp_6 = ConstructTypedRule(ModuleName=deconruleexp_3.SourceModuleName, ConnectorIndex=deconruleexp_3.SourceConnectorIndex, Type=panel_4)
ruletyp_7 = ConstructTypedRule(ModuleName=deconruleexp_3.TargetModuleName, ConnectorIndex=deconruleexp_3.TargetConnectorIndex, Type=panel_4)
neg_2 = Negative(Value=series_2)
ruletyp_8 = ConstructTypedRule(ModuleName=deconruleexp_4.SourceModuleName, ConnectorIndex=deconruleexp_4.SourceConnectorIndex, Type=panel_7)
ruletyp_9 = ConstructTypedRule(ModuleName=deconruleexp_4.TargetModuleName, ConnectorIndex=deconruleexp_4.TargetConnectorIndex, Type=panel_7)
merge_11 = Merge(Data1=ruletyp_2, Data2=ruletyp_3)
merge_12 = Merge(Data1=ruletyp_4, Data2=ruletyp_5)
merge_13 = Merge(Data1=ruletyp_6, Data2=ruletyp_7)
Z_2 = UnitZ(Factor=neg_2)
pillow_saddle = Curve([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])
saddle_gem = Curve([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])
panel_8 = Panel("""p-s-sw
p-s-se
p-s-nw
p-s-ne""")
panel_9 = Panel("""s-g-sw
s-g-se
s-g-nw
s-g-ne""")
merge_14 = Merge(Data1=ruletyp_8, Data2=ruletyp_9)
move_3 = Move(Geometry=transform_3, Motion=graft(Z_2))  # -> Geometry, Transform
move_4 = Move(Geometry=trim_2, Motion=graft(Z_2))  # -> Geometry, Transform
move_5 = Move(Geometry=transform, Motion=graft(Z_2))  # -> Geometry, Transform
ruleexpcrv_8 = ExplicitRuleFromCurve(Modules=M, ConnectionCurve=pillow_saddle)  # -> flatten(Rules)
ruleexpcrv_9 = ExplicitRuleFromCurve(Modules=M, ConnectionCurve=saddle_gem)  # -> flatten(Rules)
unflatten_3 = UnflattenTree(Tree=flatten(move_4.Geometry), Guide=transform_2)
unflatten_4 = UnflattenTree(Tree=flatten(move_4.Geometry), Guide=transform_2)
deconruleexp_5 = DeconstructExplicitRule(Rule=ruleexpcrv_8)  # -> SourceModuleName, SourceConnectorIndex, TargetModuleName, TargetConnectorIndex
deconruleexp_6 = DeconstructExplicitRule(Rule=ruleexpcrv_9)  # -> SourceModuleName, SourceConnectorIndex, TargetModuleName, TargetConnectorIndex
collectrules = CollectRules(Modules=M)
bang = ExplodeTree(Data=unflatten_4)  # -> _0000, _0001, _0002, _0003, _0100, _0101
bang_2 = ExplodeTree(Data=unflatten_3)  # -> _0000, _0001, _0002, _0003, _0100, _0101
ruletyp_10 = ConstructTypedRule(ModuleName=deconruleexp_5.SourceModuleName, ConnectorIndex=deconruleexp_5.SourceConnectorIndex, Type=panel_8)
ruletyp_11 = ConstructTypedRule(ModuleName=deconruleexp_5.TargetModuleName, ConnectorIndex=deconruleexp_5.TargetConnectorIndex, Type=panel_8)
ruletyp_12 = ConstructTypedRule(ModuleName=deconruleexp_6.SourceModuleName, ConnectorIndex=deconruleexp_6.SourceConnectorIndex, Type=panel_9)
ruletyp_13 = ConstructTypedRule(ModuleName=deconruleexp_6.TargetModuleName, ConnectorIndex=deconruleexp_6.TargetConnectorIndex, Type=panel_9)
merge_15 = Merge(Data1=ruletyp_10, Data2=ruletyp_11)
merge_16 = Merge(Data1=bang._0001, Data2=bang._0002, Data3=bang._0003, Data4=bang._0100)
merge_17 = Merge(Data1=ruletyp_12, Data2=ruletyp_13)
merge_18 = Merge(Data1=merge_11, Data2=merge_15, Data3=merge_12, Data4=merge_17, Data5=merge_13, Data6=ruleexpcrv_7)
merge_19 = Merge(Data1=merge_18, Data2=merge_10)
ruleindiffunused = IndifferentRulesForUnusedConnectors(Module=M, Rules=merge_19)  # -> flatten(RulesIndifferent)
merge_20 = Merge(Data1=merge_19, Data2=ruleindiffunused)
merge_21 = Merge(Data1=bang_2._0001, Data2=bang_2._0002, Data3=bang_2._0003, Data4=bang_2._0100)
rulepreview = PreviewRules(Modules=M, Rules=merge_19)  # disabled
number_slider = Slider(0.75, range=0..1)
number_slider_2 = Slider(0.25, range=0..1)
bang_3 = ExplodeTree(Data=merge_21)  # -> flatten(_0001), flatten(_0002), flatten(_0003), flatten(_0100)
number_slider_3 = Slider(2.5, range=0..10)
number_slider_4 = Slider(3, range=0..10)
expression = Expression(Expression="1/3")
number_slider_5 = Slider(1, range=0..2)
panel_10 = Panel("0.33")
merge_22 = Merge(Data1=graft(bang_3._0003), Data2=graft(bang_3._0100))
vec_2 = VectorXYZ(XComponent="0.5", YComponent="0.5", ZComponent=expression)  # -> Vector, Length
geo_3 = Geometry(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)
geo_4 = Geometry(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)
Z_3 = UnitZ(Factor=Slider(1.25, range=0..10))
X = UnitX(Factor=Slider(2, range=0..10))
Y = UnitY(Factor=Slider(0.5, range=0..1))
bang_4 = ExplodeTree(Data=merge_22)  # -> Branch0, Branch1, Branch2, Branch3
popslots = PopulateGeometryWithSlotCenters(Geometry=geo_3, BasePlane=xy, GridSlotDiagonal=vec.Vector, Fill=number_slider_5, Precision=0.5)
popslots_2 = PopulateGeometryWithSlotCenters(Geometry=geo_4, BasePlane=xy, GridSlotDiagonal=vec_2.Vector, Fill=number_slider_5, Precision=0.5)
addition = Addition(A=Z_3, B=X, C=Y)
slotall = ConstructSlotWithAllModulesAllowed(SlotPoint=popslots, BasePlane=xy, GridSlotDiagonal=vec.Vector)
slotall_2 = ConstructSlotWithAllModulesAllowed(SlotPoint=popslots_2, BasePlane=xy, GridSlotDiagonal=vec_2.Vector)
move_6 = Move(Geometry=bang_4.Branch3, Motion=addition)  # -> Geometry, Transform
saddle_bottom_south_east_2 = Brep(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)
saddle_bottom_north_east_2 = Brep(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)
saddle_top_south_west_2 = Brep(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)
saddle_top_south_east_2 = Brep(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)
saddle_bottom_south_west_2 = Brep(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)
saddle_bottom_north_west_2 = Brep(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)
saddle_top_north_east_2 = Brep(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)
saddle_top_north_west_2 = Brep(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)
gem_bottom_south_west_2 = Brep(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)
gem_bottom_south_east_2 = Brep(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)
gem_bottom_north_east_2 = Brep(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)
gem_bottom_north_west_2 = Brep(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)
gem_top_south_west_2 = Brep(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)
gem_top_south_east_2 = Brep(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)
gem_top_north_east_2 = Brep(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)
gem_top_north_west_2 = Brep(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)
X_2 = UnitX(Factor=Slider(2, range=0..10))
panel_11 = Panel("""0
1
2
3
4
5
6
7""")
panel_12 = Panel("""p-t-s
p-t-w
indifferent
indifferent
indifferent
p-sw""")
panel_13 = Panel("""p-t-n
indifferent
indifferent
indifferent
p-t-w
p-nw""")
panel_14 = Panel("""p-b-s
p-b-w
p-sw
indifferent
indifferent
indifferent""")
panel_15 = Panel("""p-b-n
indifferent
p-nw
indifferent
p-b-w
indifferent""")
move_7 = Move(Geometry=box_2, Motion=X_2)  # -> Geometry, Transform
item = ListItem(List=M, Index=panel_11, Wrap=True)
panel_16 = Panel("""indifferent
p-t-e
indifferent
p-t-s
indifferent
p-se""")
panel_17 = Panel("""indifferent
indifferent
indifferent
p-t-n
p-t-e
p-ne""")
panel_18 = Panel("""indifferent
p-b-e
p-se
p-b-s
indifferent
indifferent""")
panel_19 = Panel("""indifferent
indifferent
p-ne
p-b-n
p-b-e
indifferent""")
deconmodule = DeconstructModule(Module=M)  # -> flatten(ModuleName), ModulePartCenterPoints, Geometry, BasePlane, ModulePartDiagonal, IsCompact, IsValid, Connectors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
series_3 = Series(Start=0, Step=1, Count="6")  # -> flatten(Series)
item_2 = ListItem(List=slotall, Index=0, Wrap=True)
deconslot = DeconstructSlot(Slot=item_2)  # -> Center, BasePlane, Diagonal, AllowedModuleNames, IsDeterministic, AllowsAllModules, AllowsNothing, IsValid
item_3 = ListItem(List=deconmodule.ModuleName, Index=0, Wrap=True)  # -> Item, Item1, Item2, Item3, Item4, Item5, Item6, Item7
ruletyp_14 = ConstructTypedRule(ModuleName=item_3.Item6, ConnectorIndex=series_3, Type=panel_13)
ruletyp_15 = ConstructTypedRule(ModuleName=item_3.Item4, ConnectorIndex=series_3, Type=panel_12)
ruletyp_16 = ConstructTypedRule(ModuleName=item_3.Item3, ConnectorIndex=series_3, Type=panel_15)
ruletyp_17 = ConstructTypedRule(ModuleName=item_3.Item, ConnectorIndex=series_3, Type=panel_14)
item_4 = ListItem(List=deconmodule.ModuleName, Index=panel_11, Wrap=True)
ruletyp_18 = ConstructTypedRule(ModuleName=item_3.Item7, ConnectorIndex=series_3, Type=panel_17)
ruletyp_19 = ConstructTypedRule(ModuleName=item_3.Item5, ConnectorIndex=series_3, Type=panel_16)
ruletyp_20 = ConstructTypedRule(ModuleName=item_3.Item2, ConnectorIndex=series_3, Type=panel_19)
ruletyp_21 = ConstructTypedRule(ModuleName=item_3.Item1, ConnectorIndex=series_3, Type=panel_18)
slotmodules = ConstructSlotWithListedModulesAllowed(
    SlotPoint=deconslot.Center,
    BasePlane=deconslot.BasePlane,
    GridSlotDiagonal=deconslot.Diagonal,
    AllowedModuleNames=item_3.Item)
merge_23 = Merge(Data1=ruletyp_15, Data2=ruletyp_19, Data3=ruletyp_18, Data4=ruletyp_14)
merge_24 = Merge(Data1=ruletyp_17, Data2=ruletyp_21, Data3=ruletyp_20, Data4=ruletyp_16)
replace = ReplaceItems(List=slotall, Item=slotmodules, Indices="0", Wrap=False)
merge_25 = Merge(Data1=merge_24, Data2=merge_23)
wfc = MonocerosWFCSolver(
    Slots=replace,
    Modules=item,
    Rules=merge_25,
    RandomSeed=42,
    MaxAttempts=10,
    MaxObservations=2147483647,
    MaxTime=0,
    UseShannonEntropy=False)  # -> Out, Slots, Deterministic, Contradictory, Seed, Attempts, Observations
merge_26 = Merge()
rulepreview_2 = PreviewRules(Modules=item, Rules=merge_25)
ruletyp_22 = ConstructTypedRule(ModuleName=graft(item_4), ConnectorIndex=series_3, Type="indifferent")  # -> flatten(Rule)
deconruletyp = DeconstructTypedRule(Rule=merge_25)  # -> ModuleName, ConnectorIndex, Type
materialize = MaterializeModule(Module=M, Slots=wfc.Slots)  # -> Geometry, Transform
