# Grasshopper definition helpers.gh (Grasshopper 1.0.7)

pt = ConstructPoint(XCoordinate=Slider(0.9, range=0..1), YCoordinate=Slider(0.15, range=0..1), ZCoordinate=Slider(-1.75, range=-10..-1.75))
pt_2 = ConstructPoint(XCoordinate=Slider(1, range=0..1), YCoordinate=Slider(2, range=0..10), ZCoordinate=Slider(3, range=0..10))
pt_3 = ConstructPoint(XCoordinate=Slider(0.4, range=0..1), YCoordinate=Slider(0.85, range=0..1), ZCoordinate=Slider(-2, range=-10..-1.75))
pt_4 = ConstructPoint(XCoordinate=Slider(-6, range=-10..-6), YCoordinate=Slider(-3, range=-10..-3), ZCoordinate=Slider(8, range=0..10))
Z = UnitZ(Factor=1)
xy = XYPlane(Origin=Point(0, 0, 0))
pl = ConstructPlane(Origin=pt_2, XAxis=Vector(1, 0, 0), YAxis=Vector(0, 1, 0))
pl_2 = ConstructPlane(Origin=pt_4, XAxis=pt, YAxis=pt_3)
pl_3 = ConstructPlane(Origin=Point(0, 0, 0), XAxis=Vector(1, 0, 0), YAxis=Z)
merge = Merge(Data1=xy, Data2=pl, Data3=pl_2)  # -> graft(Result)
deplane = DeconstructPlane(Plane=merge)  # -> Origin, XAxis, YAxis, ZAxis
pdecon = Deconstruct(Point=deplane.Origin)  # -> XComponent, YComponent, ZComponent
devec = DeconstructVector(Vector=deplane.XAxis)  # -> XComponent, YComponent, ZComponent
devec_2 = DeconstructVector(Vector=deplane.YAxis)  # -> XComponent, YComponent, ZComponent
devec_3 = DeconstructVector(Vector=deplane.ZAxis)  # -> XComponent, YComponent, ZComponent
merge_2 = Merge(Data1=pdecon.XComponent, Data2=pdecon.YComponent, Data3=pdecon.ZComponent)
merge_3 = Merge(Data1=devec.XComponent, Data2=devec.YComponent, Data3=devec.ZComponent)
merge_4 = Merge(Data1=devec_2.XComponent, Data2=devec_2.YComponent, Data3=devec_2.ZComponent)
merge_5 = Merge(Data1=devec_3.XComponent, Data2=devec_3.YComponent, Data3=devec_3.ZComponent)
join = TextJoin(Text=merge_2, Join=",")
plcoord = PlaneCoordinates(Point=deplane.Origin, System=pl_3)  # -> XCoordinate, YCoordinate, ZCoordinate
plcoord_2 = PlaneCoordinates(Point=deplane.XAxis, System=pl_3)  # -> XCoordinate, YCoordinate, ZCoordinate
plcoord_3 = PlaneCoordinates(Point=deplane.YAxis, System=pl_3)  # -> XCoordinate, YCoordinate, ZCoordinate
panel = Panel(deplane.XAxis)
panel_2 = Panel(join)
merge_6 = Merge(Data1=plcoord.XCoordinate, Data2=plcoord.YCoordinate, Data3=plcoord.ZCoordinate)
merge_7 = Merge(Data1=plcoord_2.XCoordinate, Data2=plcoord_2.YCoordinate, Data3=plcoord_2.ZCoordinate)
merge_8 = Merge(Data1=plcoord_3.XCoordinate, Data2=plcoord_3.YCoordinate, Data3=plcoord_3.ZCoordinate)
join_2 = TextJoin(Text=merge_6, Join=",")
join_3 = TextJoin(Text=merge_7, Join=",")
join_4 = TextJoin(Text=merge_8, Join=",")
# test('convertPlaneToTransform', () => {
#     expect(
#         convertPlaneToTransform({
#             origin: { x: 1, y: 2, z: 3 },
#             xAxis: { x: 1, y: 0, z: 0 },
#             yAxis: { x: 0, y: 1, z: 0 }
#         } as Plane)
#     ).toBeCloseToMatrix(new Matrix4().set(
#         1, 0, 0, 1,
#         0, 1, 0, 3,
#         0, 0, 1, -2,
#         0, 0, 0, 1))
# })
panel_3 = Panel(join)
panel_4 = Panel(join_2)
