# Grasshopper definition assess-perfomance.gh (Grasshopper 1.0.8)
# Copyright: GNU Lesser General Public License Version 3
# plug-ins: semio

kt = Kit()
kit = ModelKit(Kit=kt)  # -> Kit, Valid, Name, Description, Icon, Image, Preview, Version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
typ = ModelType(Type=kit.Types)  # -> Type, Valid, Name, Description, Icon, Image, Variant, Stock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
dsn = ModelDesign(Design=kit.Designs)  # -> Design, Valid, Name, Description, Icon, Image, Variant, View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
item = ListItem(List=kit.Designs, Index=0, Wrap=True)  # -> Item, Item1
por = ModelPort(Port=typ.Ports)  # -> Port, Valid, Id, Description, Mandatory, Family, CompatibleFamilies, Point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
rep = ModelRepresentation(Representation=typ.Representations)  # -> Representation, Valid, Url, Description, Tags, Qualities
con = ModelConnection(Connection=dsn.Connections)  # -> Connection, Valid, ConnectedPieceId, ConnectedDesignPieceId, ConnectedPieceTypePortId, ConnectingPieceId, ConnectingDesignPieceId, ConnectingPieceTypePortId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
pce = ModelPiece(Piece=dsn.Pieces)  # -> Piece, Valid, Id, Description, TypeName, TypeVariant, DesignName, DesignVariant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
panel = Panel(dsn.Pieces)
merge = Merge(Data1=item.Item, Data2=item.Item)
dn = Design(flatten(merge))
ty = Type(flatten(kit.Types))
prf = AssessPerformance(dn=dn, ty=ty)  # -> dn_3, interest_2, area_efficiency_eff_m²_m²_2, area_comfort_m²_person_2, income_a_3, expenses_a_3, energy_expenses_a_3, effective_floor_area_m²_12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

# ==== cluster AssessPerformance: Simple performance assement based on the following qualities of the types (No unit conversion is applied for now, so make sure that all your types have the values with the same unit.): floor area, effective floor area, residents, workspaces, construction cost, maintenance expenses, income, transmission heat loss, ventilation heat loss, cooling energy demand, technical equipment energy demand,construction global warming potential, heating load, cooling load, ventilation air flow volume
dn = ClusterInput()
ty = ClusterInput()
technical_equipment_cost = ClusterInput()
technical_equipment_gwp_kgco2e = ClusterInput()
ventilation_heat_recovery_factor = ClusterInput()
heating_efficiency_factor = ClusterInput()
heating_primary_energy_factor = ClusterInput()
heating_energy_price_kwh = ClusterInput()
heating_global_warming_potential_kgco2e = ClusterInput()  # "Heating Global Warming Potential [kgCO2e/kWh]"
cooling_efficiency_factor = ClusterInput()
cooling_primary_energy_factor = ClusterInput()
cooling_global_warming_potential_kgco2e = ClusterInput()  # "Cooling Global Warming Potential [kgCO2e/kWh]"
cooling_energy_price_kwh = ClusterInput()
electrictiy_primary_energy_factor = ClusterInput()
electrictiy_global_warming_potential_kgc = ClusterInput()  # "Electrictiy Global Warming Potential [kgCO2e/kWh]"
electrictiy_energy_price_kwh = ClusterInput()
co2_price_tco2e = ClusterInput()
life_cycle_a = ClusterInput()
dn_2 = Design(graft(dn))
electrictiy_energy_price_kwh_2 = Number(electrictiy_energy_price_kwh)
heating_primary_energy_factor_2 = Number(heating_primary_energy_factor)
heating_energy_price_kwh_2 = Number(heating_energy_price_kwh)
heating_global_warming_potential_kgco2e_2 = Number(heating_global_warming_potential_kgco2e)  # "Heating Global Warming Potential [kgCO2e/kWh]"
cooling_energy_price_kwh_2 = Number(cooling_energy_price_kwh)
electrictiy_primary_energy_factor_2 = Number(electrictiy_primary_energy_factor)
ventilation_heat_recovery_factor_2 = Number(ventilation_heat_recovery_factor)
heating_efficiency_factor_2 = Number(heating_efficiency_factor)
cooling_efficiency_factor_2 = Number(cooling_efficiency_factor)
cooling_primary_energy_factor_2 = Number(cooling_primary_energy_factor)
cooling_global_warming_potential_kgco2e_2 = Number(cooling_global_warming_potential_kgco2e)  # "Cooling Global Warming Potential [kgCO2e/kWh]"
electrictiy_global_warming_potential_kgc_2 = Number(electrictiy_global_warming_potential_kgc)  # "Electrictiy Global Warming Potential [kgCO2e/kWh]"
co2_price_tco2e_2 = Number(co2_price_tco2e)
life_cycle_a_2 = Number(life_cycle_a)
ty_2 = Type(ty)
technical_equipment_cost_2 = Number(technical_equipment_cost)
technical_equipment_gwp_kgco2e_2 = Number(technical_equipment_gwp_kgco2e)
expression = Expression(x=co2_price_tco2e_2, Expression="x/1000")
co2_price_kgco2e = Number(expression)

dsn = ModelDesign(Design=dn_2)  # -> Design, Valid, Name, Description, Icon, Image, Variant, View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
trim = TrimTree(Tree=dsn.Pieces, Depth=1)
typ = SelectTypeByPiece(ty=ty_2, pc=trim)  # -> ty_4, i_2
typ_2 = ModelType(Type=typ.ty_4)  # -> Type, Valid, Name, Description, Icon, Image, Variant, Stock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

panel = Panel("""residents
workspace""")
qal = SumQualities(dn=dn_2, ty=ty_2, na="floor area")  # -> num_2, ql_2; disabled
qal_2 = SumQualities(dn=dn_2, ty=ty_2, na="effective floor area")  # -> num_2, ql_2; disabled
qal_3 = SumQualities(dn=dn_2, ty=ty_2, na="construction cost")  # -> num_2, ql_2; disabled
qal_4 = SumQualities(dn=dn_2, ty=ty_2, na="maintenance expenses")  # -> num_2, ql_2; disabled
qal_5 = SumQualities(dn=dn_2, ty=ty_2, na="income")  # -> num_2, ql_2; disabled
qal_6 = SumQualities(dn=dn_2, ty=ty_2, na="transmission heat demand")  # -> num_2, ql_2; disabled
qal_7 = SumQualities(dn=dn_2, ty=ty_2, na="ventilation heat demand")  # -> num_2, ql_2; disabled
qal_8 = SumQualities(dn=dn_2, ty=ty_2, na="cooling energy demand")  # -> num_2, ql_2; disabled
qal_9 = SumQualities(dn=dn_2, ty=ty_2, na="technical equipment energy demand")  # -> num_2, ql_2; disabled
qal_10 = SumQualities(dn=dn_2, ty=ty_2, na="construction global warming potential")  # -> num_2, ql_2; disabled
qal_11 = SumQualities(dn=dn_2, ty=ty_2, na="heating load")  # -> num_2, ql_2; disabled
qal_12 = SumQualities(dn=dn_2, ty=ty_2, na="cooling load")  # -> num_2, ql_2; disabled
qal_13 = SumQualities(dn=dn_2, ty=ty_2, na="ventilation air flow volume")  # -> num_2, ql_2; disabled
ql = Quality(typ_2.Qualities)  # disabled
# für jedes Child braucht es einen Faktor!!
# (sobald man einen angibt brauch man für alle
# einen, damit nicht eine Faktor auf alle childs
# angewendet wird)
old = OLD(
    ql_19=ql,
    ql_12=ql,
    ql_11=ql,
    heating_energy_price_kwh=heating_energy_price_kwh_2,
    ql_16=ql,
    ql_6=ql,
    heating_efficiency_factor=heating_efficiency_factor_2,
    ql_13=ql,
    co2_price_kgco2e_5=co2_price_kgco2e,
    heating_global_warming_potential_kgco2e=heating_global_warming_potential_kgco2e_2,
    ventilation_heat_recovery_factor=ventilation_heat_recovery_factor_2,
    ql_22=ql,
    ql_7=ql,
    ql_20=ql,
    ql=ql,
    ql_14=ql,
    cooling_energy_price_kwh=cooling_energy_price_kwh_2,
    ql_8=ql,
    co2_price_kgco2e=co2_price_kgco2e,
    cooling_efficiency_factor=cooling_efficiency_factor_2,
    cooling_global_warming_potential_kgco2e=cooling_global_warming_potential_kgco2e_2,
    ql_21=ql,
    ql_5=ql,
    ql_15=ql,
    ql_10=ql,
    electrictiy_energy_price_kwh=electrictiy_energy_price_kwh_2,
    co2_price_kgco2e_2=co2_price_kgco2e,
    electrictiy_global_warming_potential_kgc=electrictiy_global_warming_potential_kgc_2,
    ql_2=ql,
    ql_9=ql,
    life_cycle_a=life_cycle_a_2,
    ql_17=ql,
    heating_primary_energy_factor=heating_primary_energy_factor_2,
    ql_3=ql,
    ql_18=ql,
    cooling_primary_energy_factor=cooling_primary_energy_factor_2,
    ql_4=ql,
    electrictiy_primary_energy_factor=electrictiy_primary_energy_factor_2)  # disabled
qal_14 = SumQualitiesByHierachy(ql=ql, na="users", cna=panel, value="0")  # -> value_4, pa_2, ch_2; disabled
users_person = Number(qal_14.value_4)
ventilation_heat_recovery_factor_3 = Number(ventilation_heat_recovery_factor_2)  # disabled
ventiation_heat_loss_kwh_a = Number(qal_7.num_2)  # disabled

addition = Addition()  # -> graft(Result)
merge = Merge()
qal_15 = SumQualitiesByHierachy(ql=ql, na="Water Costs, Wastewater Fees", cna=merge, value=addition)  # -> value_4, pa_2, ch_2

addition_2 = Addition()  # -> graft(Result)
merge_2 = Merge()
qal_16 = SumQualitiesByHierachy(ql=ql, na="regular maintenance", cna=merge_2, value=addition_2)  # -> value_4, pa_2, ch_2

addition_3 = Addition()  # -> graft(Result)
merge_3 = Merge()
qal_17 = SumQualitiesByHierachy(ql=ql, na="Replacement of COmponents", cna=merge_3, value=addition_3)  # -> value_4, pa_2, ch_2

expression_2 = Expression(x=ventilation_heat_recovery_factor_3, Expression="1-x")  # disabled
transmission_heat_loss_kwh_a = Number(qal_6.num_2)  # disabled

addition_4 = Addition()  # -> graft(Result)
merge_4 = Merge()
qal_18 = SumQualitiesByHierachy(ql=ql, na="Energy Costs", cna=merge_4, value=addition_4)  # -> value_4, pa_2, ch_2

addition_5 = Addition()  # -> graft(Result)
merge_5 = Merge()
qal_19 = SumQualitiesByHierachy(ql=ql, na="Modernization", cna=merge_5, value=addition_5)  # -> value_4, pa_2, ch_2

addition_6 = Addition()  # -> graft(Result)
merge_6 = Merge()
qal_20 = SumQualitiesByHierachy(ql=ql, na="Demolation Costs", cna=merge_6, value=addition_6)  # -> value_4, pa_2, ch_2

addition_7 = Addition()  # -> graft(Result)
merge_7 = Merge()
qal_21 = SumQualitiesByHierachy(ql=ql, na="Reuse", cna=merge_7, value=addition_7)  # -> value_4, pa_2, ch_2

addition_8 = Addition()  # -> graft(Result)
merge_8 = Merge()
qal_22 = SumQualitiesByHierachy(ql=ql, na="Disposal", cna=merge_8, value=addition_8)  # -> value_4, pa_2, ch_2

multiplication = Multiplication(A=ventiation_heat_loss_kwh_a, B=expression_2)  # disabled
heating_global_warming_potential_kgco2e_3 = Number(heating_global_warming_potential_kgco2e_2)  # "Heating Global Warming Potential [kgCO2e/kWh]"; disabled
electrictiy_global_warming_potential_kgc_3 = Number(electrictiy_global_warming_potential_kgc_2)  # "Electrictiy Global Warming Potential [kgCO2e/kWh]"; disabled
cooling_global_warming_potential_kgco2e_3 = Number(cooling_global_warming_potential_kgco2e_2)  # "Cooling Global Warming Potential [kgCO2e/kWh]"; disabled
addition_9 = Addition(A=transmission_heat_loss_kwh_a, B=multiplication)  # disabled
technical_equipment_energy_demand_kwh_a = Number(qal_9.num_2)  # disabled
electricity_energy_demand_kwh_a = Number(technical_equipment_energy_demand_kwh_a)  # disabled
cooling_energy_demand_kwh_a = Number(qal_8.num_2)  # disabled
heating_energy_demand_kwh_a = Number(addition_9)  # disabled
cooling_efficiency_factor_3 = Number(cooling_efficiency_factor_2)  # disabled
heating_efficiency_factor_3 = Number(heating_efficiency_factor_2)  # disabled

# ----
# Operating Costs
panel_2 = Panel("Operating Costs")
addition_10 = Addition(A=qal_18.value_4, B=qal_15.value_4)  # -> graft(Result)
merge_9 = Merge(Data1="Energy Costs", Data2="Water Costs, Wastewater Fees")
qal_23 = SumQualitiesByHierachy(ql=ql, na=panel_2, cna=merge_9, value=addition_10)  # -> value_4, pa_2, ch_2

addition_11 = Addition(A=qal_16.value_4, B=qal_17.value_4, C=qal_19.value_4)  # -> graft(Result)
merge_10 = Merge(Data1="regular maintenance", Data2="Replacement of COmponents", Data3="Modernization")
# Maintenance
qal_24 = SumQualitiesByHierachy(ql=ql, na="Maintenance", cna=merge_10, value=addition_11)  # -> value_4, pa_2, ch_2

# ----
# Dismantling Costs
panel_3 = Panel("Dismantling costs")
addition_12 = Addition(A=qal_20.value_4, B=qal_22.value_4, C=qal_21.value_4)  # -> graft(Result)
merge_11 = Merge(Data1="Demolation Costs", Data2="Disposal", Data3="Reuse")
qal_25 = SumQualitiesByHierachy(ql=ql, na=panel_3, cna=merge_11, value=addition_12)  # -> value_4, pa_2, ch_2

multiplication_2 = Multiplication(A=electricity_energy_demand_kwh_a, B=electrictiy_global_warming_potential_kgc_3)  # disabled
multiplication_3 = Multiplication(A=cooling_energy_demand_kwh_a, B=cooling_efficiency_factor_3)  # disabled
final_cooling_energy_demand_kwh_a = Number(multiplication_3)  # disabled
multiplication_4 = Multiplication(A=final_cooling_energy_demand_kwh_a, B=cooling_global_warming_potential_kgco2e_3)  # disabled
multiplication_5 = Multiplication(A=heating_energy_demand_kwh_a, B=heating_efficiency_factor_3)  # disabled
final_heating_energy_demand_kwh_a = Number(multiplication_5)  # disabled
multiplication_6 = Multiplication(A=final_heating_energy_demand_kwh_a, B=heating_global_warming_potential_kgco2e_3)  # disabled
heating_global_warming_potential_kgco2e_4 = Number(multiplication_6)  # "Heating Global Warming Potential [kgCO2e/a]"; disabled
cooling_global_warming_potential_kgco2e_4 = Number(multiplication_4)  # "Cooling Global Warming Potential [kgCO2e/a]"; disabled
electricity_global_warming_potential_kgc = Number(multiplication_2)  # "Electricity Global Warming Potential [kgCO2e/a]"; disabled
final_heating_energy_demand_kwh_a_2 = Number(multiplication_5)  # disabled
final_cooling_energy_demand_kwh_a_2 = Number(multiplication_3)  # disabled
electricity_energy_demand_kwh_a_2 = Number(technical_equipment_energy_demand_kwh_a)  # disabled
cooling_energy_price_kwh_3 = Number(cooling_energy_price_kwh_2)  # disabled
heating_energy_price_kwh_3 = Number(heating_energy_price_kwh_2)  # disabled
electrictiy_energy_price_kwh_3 = Number(electrictiy_energy_price_kwh_2)  # disabled
co2_price_kgco2e_2 = Number(co2_price_kgco2e)  # disabled
co2_price_kgco2e_3 = Number(co2_price_kgco2e)  # disabled
co2_price_kgco2e_4 = Number(co2_price_kgco2e)  # disabled
multiplication_7 = Multiplication(A=final_heating_energy_demand_kwh_a_2, B=heating_energy_price_kwh_3)  # disabled
multiplication_8 = Multiplication(A=electricity_energy_demand_kwh_a_2, B=electrictiy_energy_price_kwh_3)  # disabled
multiplication_9 = Multiplication(A=heating_global_warming_potential_kgco2e_4, B=co2_price_kgco2e_2)  # disabled
multiplication_10 = Multiplication(A=final_cooling_energy_demand_kwh_a_2, B=cooling_energy_price_kwh_3)  # disabled
multiplication_11 = Multiplication(A=cooling_global_warming_potential_kgco2e_4, B=co2_price_kgco2e_3)  # disabled
multiplication_12 = Multiplication(A=electricity_global_warming_potential_kgc, B=co2_price_kgco2e_4)  # disabled
electricity_global_warming_potential_kgc_2 = Number(electricity_global_warming_potential_kgc)  # "Electricity Global Warming Potential [kgCO2e/a]"; disabled
heating_global_warming_potential_kgco2e_5 = Number(heating_global_warming_potential_kgco2e_4)  # "Heating Global Warming Potential [kgCO2e/a]"; disabled
cooling_global_warming_potential_kgco2e_5 = Number(cooling_global_warming_potential_kgco2e_4)  # "Cooling Global Warming Potential [kgCO2e/a]"; disabled

addition_13 = Addition()  # -> graft(Result)
merge_12 = Merge()
qal_26 = SumQualitiesByHierachy(ql=ql, na="Buidling - Structural Components", cna=merge_12, value=addition_13)  # -> value_4, pa_2, ch_2

addition_14 = Addition()  # -> graft(Result)
merge_13 = Merge()
qal_27 = SumQualitiesByHierachy(ql=ql, na="Construction Ancillary Costs", cna=merge_13, value=addition_14)  # -> value_4, pa_2, ch_2

heating_co2_price_a = Number(multiplication_9)  # disabled
electricity_energy_price_a = Number(multiplication_8)  # disabled
heating_energy_price_a = Number(multiplication_7)  # disabled
cooling_energy_price_a = Number(multiplication_10)  # disabled
electricity_co2_price_a = Number(multiplication_12)  # disabled
final_heating_energy_demand_kwh_a_3 = Number(final_heating_energy_demand_kwh_a_2)  # disabled
cooling_co2_price_a = Number(multiplication_11)  # disabled
final_cooling_energy_demand_kwh_a_3 = Number(final_cooling_energy_demand_kwh_a_2)  # disabled
electricity_energy_demand_kwh_a_3 = Number(electricity_energy_demand_kwh_a_2)  # disabled
electricity_energy_demand_kwh_a_4 = Number(electricity_energy_demand_kwh_a_2)  # disabled
final_heating_energy_demand_kwh_a_4 = Number(final_heating_energy_demand_kwh_a_2)  # disabled
electrictiy_primary_energy_factor_3 = Number(electrictiy_primary_energy_factor_2)  # disabled
heating_primary_energy_factor_3 = Number(heating_primary_energy_factor_2)  # disabled
final_cooling_energy_demand_kwh_a_4 = Number(final_cooling_energy_demand_kwh_a_2)  # disabled
cooling_primary_energy_factor_3 = Number(cooling_primary_energy_factor_2)  # disabled

addition_15 = Addition()  # -> graft(Result)
merge_14 = Merge()
qal_28 = SumQualitiesByHierachy(ql=ql, na="Equipment and Artworks", cna=merge_14, value=addition_15)  # -> value_4, pa_2, ch_2

addition_16 = Addition()  # -> graft(Result)
merge_15 = Merge()
qal_29 = SumQualitiesByHierachy(ql=ql, na="Technical Systems", cna=merge_15, value=addition_16)  # -> value_4, pa_2, ch_2

addition_17 = Addition()  # -> graft(Result)
merge_16 = Merge()
qal_30 = SumQualitiesByHierachy(ql=ql, na="Development Costs", cna=merge_16, value=addition_17)  # -> value_4, pa_2, ch_2

addition_18 = Addition()  # -> graft(Result)
merge_17 = Merge()
qal_31 = SumQualitiesByHierachy(ql=ql, na="Land Costs", cna=merge_17, value=addition_18)  # -> value_4, pa_2, ch_2

addition_19 = Addition()  # -> graft(Result)
merge_18 = Merge()
qal_32 = SumQualitiesByHierachy(ql=ql, na="Financing", cna=merge_18, value=addition_19)  # -> value_4, pa_2, ch_2

addition_20 = Addition()  # -> graft(Result)
merge_19 = Merge()
qal_33 = SumQualitiesByHierachy(ql=ql, na="Taxes & Duties", cna=merge_19, value=addition_20)  # -> value_4, pa_2, ch_2

addition_21 = Addition()  # -> graft(Result)
merge_20 = Merge()
qal_34 = SumQualitiesByHierachy(ql=ql, na="Outdoor space", cna=merge_20, value=addition_21)  # -> value_4, pa_2, ch_2

building_construction_gwp_kgco2e = Number(qal_10.num_2)  # disabled
technical_equipment_gwp_kgco2e_3 = Number(technical_equipment_gwp_kgco2e_2)  # disabled
addition_22 = Addition(A=cooling_energy_price_a, B=cooling_co2_price_a)  # disabled
addition_23 = Addition(A=heating_energy_price_a, B=heating_co2_price_a)  # disabled
addition_24 = Addition(A=electricity_energy_price_a, B=electricity_co2_price_a)  # disabled
addition_25 = Addition(
    A=heating_global_warming_potential_kgco2e_5,
    B=cooling_global_warming_potential_kgco2e_5,
    C=electricity_global_warming_potential_kgc_2)  # disabled
addition_26 = Addition(A=final_heating_energy_demand_kwh_a_3, B=final_cooling_energy_demand_kwh_a_3, C=electricity_energy_demand_kwh_a_4)  # disabled
multiplication_13 = Multiplication(A=electricity_energy_demand_kwh_a_3, B=electrictiy_primary_energy_factor_3)  # disabled
multiplication_14 = Multiplication(A=final_heating_energy_demand_kwh_a_4, B=heating_primary_energy_factor_3)  # disabled
multiplication_15 = Multiplication(A=final_cooling_energy_demand_kwh_a_4, B=cooling_primary_energy_factor_3)  # disabled
electricity_expenses_a = Number(addition_24)  # disabled
heating_expenses_a = Number(addition_23)  # disabled
cooling_expenses_a = Number(addition_22)  # disabled
energy_global_warming_potential_kgco2e_a = Number(addition_25)  # disabled
final_energy_demand_kwh_a = Number(addition_26)  # disabled
primary_heating_energy_demand_kwh_a = Number(multiplication_14)  # disabled
primary_cooling_energy_demand_kwh_a = Number(multiplication_15)  # disabled
primary_electricity_energy_demand_kwh_a = Number(multiplication_13)  # disabled
addition_27 = Addition(A=building_construction_gwp_kgco2e, B=technical_equipment_gwp_kgco2e_3)  # disabled
addition_28 = Addition(A=heating_expenses_a, B=cooling_expenses_a, C=electricity_expenses_a)  # disabled
life_cycle_a_3 = Number(life_cycle_a_2)  # disabled

# ----
# Investment Costs
panel_4 = Panel("Investment Costs")
addition_29 = Addition(
    A=qal_31.value_4,
    B=qal_30.value_4,
    C=qal_26.value_4,
    D=qal_29.value_4,
    E=qal_34.value_4,
    F=qal_28.value_4,
    G=qal_27.value_4,
    H=qal_32.value_4,
    I=qal_33.value_4)  # -> graft(Result)
merge_21 = Merge(
    Data1="Land Costs",
    Data2="Development Costs",
    Data3="Buidling - Structural Components",
    Data4="Technical Systems",
    Data5="Outdoor space",
    Data6="Equipment and Artworks",
    Data7="Construction Ancillary Costs",
    Data8="Financing",
    Data9="Taxes & Duties")
qal_35 = SumQualitiesByHierachy(ql=ql, na=panel_4, cna=merge_21, value=addition_29)  # -> value_4, pa_2, ch_2

construction_gwp_kgco2e = Number(addition_27)  # disabled
maintenance_expenses_a = Number(qal_4.num_2)  # disabled
energy_expenses_a = Number(addition_28)  # disabled
multiplication_16 = Multiplication(A=energy_global_warming_potential_kgco2e_a, B=life_cycle_a_3)  # disabled
addition_30 = Addition(A=primary_heating_energy_demand_kwh_a, B=primary_cooling_energy_demand_kwh_a, C=primary_electricity_energy_demand_kwh_a)  # disabled

addition_31 = Addition(A=qal_25.value_4, B=qal_24.value_4, C=qal_23.value_4, D=qal_35.value_4)  # -> graft(Result)
merge_22 = Merge(Data1="Dismantling costs", Data2="Maintenance", Data3="Operating Costs", Data4="Investment Costs")
qal_36 = SumQualitiesByHierachy(ql=ql, na="Life Cycle Costs", cna=merge_22, value=addition_31)  # -> value_4, pa_2, ch_2

addition_32 = Addition(A=multiplication_16, B=construction_gwp_kgco2e)  # disabled
addition_33 = Addition(A=maintenance_expenses_a, B=energy_expenses_a)  # disabled
building_construction_cost = Number(qal_3.num_2)  # disabled
technical_equipment_cost_3 = Number(technical_equipment_cost_2)  # disabled
primary_energy_demand_kwh_a = Number(addition_30)  # disabled
life_cycle_gwp_kgco2e = Number(addition_32)  # disabled
expenses_a = Number(addition_33)  # disabled
life_cycle_a_4 = Number(life_cycle_a_2)  # disabled
multiplication_17 = Multiplication(A=expenses_a, B=life_cycle_a_4)  # disabled
addition_34 = Addition(A=building_construction_cost, B=technical_equipment_cost_3)  # disabled
life_cycle_expenses = Number(multiplication_17)  # disabled
construction_cost = Number(addition_34)  # disabled
life_cycle_a_5 = Number(life_cycle_a_2)  # disabled
income_a = Number(qal_5.num_2)  # disabled
life_cycle_costs = Number(qal_36.value_4)
addition_35 = Addition(A=construction_cost, B=life_cycle_expenses)  # disabled
multiplication_18 = Multiplication(A=income_a, B=life_cycle_a_5)  # disabled
cooling_energy_demand_kwh_a_2 = Number(cooling_energy_demand_kwh_a)  # disabled
heating_energy_demand_kwh_a_2 = Number(heating_energy_demand_kwh_a)  # disabled
heating_energy_demand_kwh_a_3 = Number(heating_energy_demand_kwh_a)  # disabled
cooling_energy_demand_kwh_a_3 = Number(cooling_energy_demand_kwh_a)  # disabled
primary_energy_demand_kwh_a_2 = Number(primary_energy_demand_kwh_a)  # disabled
primary_energy_demand_kwh_a_3 = Number(primary_energy_demand_kwh_a)  # disabled
final_energy_demand_kwh_a_2 = Number(final_energy_demand_kwh_a)  # disabled
final_energy_demand_kwh_a_3 = Number(final_energy_demand_kwh_a)  # disabled
construction_gwp_kgco2e_2 = Number(construction_gwp_kgco2e)  # disabled
construction_gwp_kgco2e_3 = Number(construction_gwp_kgco2e)  # disabled
life_cycle_gwp_kgco2e_2 = Number(life_cycle_gwp_kgco2e)  # disabled
life_cycle_gwp_kgco2e_3 = Number(life_cycle_gwp_kgco2e)  # disabled
effective_floor_area_m² = Number(qal_2.num_2)  # disabled
effective_floor_area_m²_2 = Number(qal_2.num_2)  # disabled
effective_floor_area_m²_3 = Number(qal_2.num_2)  # disabled
effective_floor_area_m²_4 = Number(qal_2.num_2)  # disabled
effective_floor_area_m²_5 = Number(qal_2.num_2)  # disabled
effective_floor_area_m²_6 = Number(qal_2.num_2)  # disabled
effective_floor_area_m²_7 = Number(qal_2.num_2)  # disabled
effective_floor_area_m²_8 = Number(qal_2.num_2)  # disabled
effective_floor_area_m²_9 = Number(qal_2.num_2)  # disabled
effective_floor_area_m²_10 = Number(qal_2.num_2)  # disabled
construction_cost_2 = Number(addition_34)  # disabled
life_cycle_income = Number(multiplication_18)  # disabled
construction_cost_3 = Number(addition_34)  # disabled
life_cycle_cost = Number(addition_35)  # disabled
life_cycle_cost_2 = Number(addition_35)  # disabled
life_cycle_cost_3 = Number(addition_35)  # disabled
floor_area_m² = Number(qal.num_2)  # disabled
users_person_2 = Number(users_person)  # disabled
users_person_3 = Number(users_person)  # disabled
users_person_4 = Number(users_person)  # disabled
users_person_5 = Number(users_person)  # disabled
users_person_6 = Number(users_person)  # disabled
users_person_7 = Number(users_person)  # disabled
users_person_8 = Number(users_person)  # disabled
users_person_9 = Number(users_person)  # disabled
users_person_10 = Number(users_person)  # disabled
division = Division(A=effective_floor_area_m²_5, B=users_person_5)  # disabled
division_2 = Division(A=construction_cost_2, B=effective_floor_area_m²_2)  # disabled
division_3 = Division(A=construction_cost_3, B=users_person_6)  # disabled
division_4 = Division(A=life_cycle_cost_2, B=effective_floor_area_m²_3)  # disabled
division_5 = Division(A=life_cycle_cost_3, B=users_person_7)  # disabled
division_6 = Division(A=construction_gwp_kgco2e_2, B=effective_floor_area_m²_6)  # disabled
division_7 = Division(A=construction_gwp_kgco2e_3, B=users_person_8)  # disabled
division_8 = Division(A=life_cycle_gwp_kgco2e_2, B=effective_floor_area_m²_4)  # disabled
division_9 = Division(A=life_cycle_gwp_kgco2e_3, B=users_person_9)  # disabled
division_10 = Division(A=primary_energy_demand_kwh_a_2, B=effective_floor_area_m²_7)  # disabled
division_11 = Division(A=primary_energy_demand_kwh_a_3, B=users_person_10)  # disabled
division_12 = Division(A=final_energy_demand_kwh_a_2, B=effective_floor_area_m²_8)  # disabled
division_13 = Division(A=final_energy_demand_kwh_a_3, B=users_person_2)  # disabled
division_14 = Division(A=heating_energy_demand_kwh_a_3, B=users_person_3)  # disabled
division_15 = Division(A=cooling_energy_demand_kwh_a_2, B=effective_floor_area_m²_10)  # disabled
division_16 = Division(A=cooling_energy_demand_kwh_a_3, B=users_person_4)  # disabled
division_17 = Division(A=effective_floor_area_m², B=floor_area_m²)  # disabled
division_18 = Division(A=heating_energy_demand_kwh_a_2, B=effective_floor_area_m²_9)  # disabled
expression_3 = Expression(Start=construction_cost, End=life_cycle_income, Expression="((End-Start)/Start)*100")  # disabled
heating_energy_demand_kwh_a_4 = Number(heating_energy_demand_kwh_a)  # disabled
life_cycle_cost_4 = Number(life_cycle_cost)  # disabled
area_comfort_m²_person = Number(division)  # disabled
income_a_2 = Number(qal_5.num_2)  # disabled
expenses_a_2 = Number(addition_33)  # disabled
energy_expenses_a_2 = Number(addition_28)  # disabled
effective_floor_area_m²_11 = Number(qal_2.num_2)  # disabled
floor_area_m²_2 = Number(qal.num_2)  # disabled
users_person_11 = Number(users_person)  # disabled
construction_cost_4 = Number(addition_34)  # disabled
construction_cost_per_user_person = Number(division_3)  # disabled
specific_life_cycle_cost_m² = Number(division_4)  # disabled
construction_global_warming_potential_pe = Number(division_7)  # "Construction Global Warming Potential per User [kgCO2e/Person]"; disabled
specific_life_cycle_global_warming_poten = Number(division_8)  # "Specific Life Cycle Global Warming Potential [kgCO2e/m²]"; disabled
life_cycle_global_warming_potential_per = Number(division_9)  # "Life Cycle Global Warming Potential per User [kgCO2e/Person]"; disabled
primary_energy_demand_kwh_a_4 = Number(primary_energy_demand_kwh_a)  # disabled
primary_energy_demand_per_user_kwh_perso = Number(division_11)  # "Primary Energy Demand per User [kWh/Person a]"; disabled
final_energy_demand_kwh_a_4 = Number(final_energy_demand_kwh_a)  # disabled
specific_final_energy_demand_kwh_m²a = Number(division_12)  # disabled
heating_load_kw = Number(qal_11.num_2)  # disabled
specific_heating_energy_demand_kwh_m²a = Number(division_18)  # disabled
cooling_load_kw = Number(qal_12.num_2)  # disabled
cooling_energy_demand_kwh_a_4 = Number(cooling_energy_demand_kwh_a)  # disabled
ventilation_air_flow_volume_m³_s = Number(qal_13.num_2)  # disabled
area_efficiency_eff_m²_m² = Number(division_17)  # disabled
specific_construction_cost_m² = Number(division_2)  # disabled
life_cycle_cost_per_user_person = Number(division_5)  # disabled
construction_global_warming_potential_kg = Number(construction_gwp_kgco2e)  # "Construction Global Warming Potential [kgCO2e]"; disabled
specific_construction_global_warming_pot = Number(division_6)  # "Specific Construction Global Warming Potential [kgCO2e/m²]"; disabled
life_cycle_global_warming_potential_kgco = Number(life_cycle_gwp_kgco2e)  # "Life Cycle Global Warming Potential [kgCO2e]"; disabled
specific_primary_energy_demand_kwh_m²a = Number(division_10)  # disabled
final_energy_demand_per_user_kwh_person = Number(division_13)  # "Final Energy Demand per User [kWh/Person a]"; disabled
heating_energy_demand_per_user_kwh_perso = Number(division_14)  # "Heating Energy Demand per User [kWh/Person a]"; disabled
specific_cooling_energy_demand_kwh_m²a = Number(division_15)  # disabled
cooling_energy_demand_per_user_kwh_perso = Number(division_16)  # "Cooling Energy Demand per User [kWh/Person a]"; disabled
interest = Number(expression_3)  # disabled
merge_23 = Merge(
    Data1=interest,
    Data2=area_efficiency_eff_m²_m²,
    Data3=area_comfort_m²_person,
    Data4=income_a_2,
    Data5=expenses_a_2,
    Data6=energy_expenses_a_2,
    Data7=effective_floor_area_m²_11,
    Data8=floor_area_m²_2,
    Data9=users_person_11,
    Data10=construction_cost_4,
    Data11=specific_construction_cost_m²,
    Data12=construction_cost_per_user_person,
    Data13=life_cycle_cost_4,
    Data14=specific_life_cycle_cost_m²,
    Data15=life_cycle_cost_per_user_person,
    Data16=construction_global_warming_potential_kg,
    Data17=specific_construction_global_warming_pot,
    Data18=construction_global_warming_potential_pe,
    Data19=life_cycle_global_warming_potential_kgco,
    Data20=specific_life_cycle_global_warming_poten,
    Data21=life_cycle_global_warming_potential_per,
    Data22=primary_energy_demand_kwh_a_4,
    Data23=specific_primary_energy_demand_kwh_m²a,
    Data24=primary_energy_demand_per_user_kwh_perso,
    Data25=final_energy_demand_kwh_a_4,
    Data26=specific_final_energy_demand_kwh_m²a,
    Data27=final_energy_demand_per_user_kwh_person,
    Data28=heating_load_kw,
    Data29=heating_energy_demand_kwh_a_4,
    Data30=specific_heating_energy_demand_kwh_m²a,
    Data31=heating_energy_demand_per_user_kwh_perso,
    Data32=cooling_load_kw,
    Data33=cooling_energy_demand_kwh_a_4,
    Data34=specific_cooling_energy_demand_kwh_m²a,
    Data35=cooling_energy_demand_per_user_kwh_perso,
    Data36=ventilation_air_flow_volume_m³_s)  # disabled
dsn_2 = ModelDesign(Design=dn_2)  # -> Design, Valid, Name, Description, Icon, Image, Variant, View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; disabled
trim_2 = TrimTree(Tree=dsn_2.Qualities, Depth=1)  # disabled
interest_2 = ClusterOutput(interest)  # disabled
area_efficiency_eff_m²_m²_2 = ClusterOutput(area_efficiency_eff_m²_m²)  # disabled
area_comfort_m²_person_2 = ClusterOutput(area_comfort_m²_person)  # disabled
income_a_3 = ClusterOutput(income_a_2)  # disabled
expenses_a_3 = ClusterOutput(expenses_a_2)  # disabled
energy_expenses_a_3 = ClusterOutput(energy_expenses_a_2)  # disabled
effective_floor_area_m²_12 = ClusterOutput(effective_floor_area_m²_11)  # disabled
floor_area_m²_3 = ClusterOutput(floor_area_m²_2)  # disabled
users_person_12 = ClusterOutput(users_person_11)  # disabled
construction_cost_5 = ClusterOutput(construction_cost_4)  # disabled
specific_construction_cost_m²_2 = ClusterOutput(specific_construction_cost_m²)  # disabled
construction_cost_per_user_person_2 = ClusterOutput(construction_cost_per_user_person)  # disabled
life_cycle_cost_5 = ClusterOutput(life_cycle_cost_4)  # disabled
specific_life_cycle_cost_m²_2 = ClusterOutput(specific_life_cycle_cost_m²)  # disabled
life_cycle_cost_per_user_person_2 = ClusterOutput(life_cycle_cost_per_user_person)  # disabled
construction_global_warming_potential_kg_2 = ClusterOutput(construction_global_warming_potential_kg)  # "Construction Global Warming Potential [kgCO2e]"; disabled
specific_construction_global_warming_pot_2 = ClusterOutput(specific_construction_global_warming_pot)  # "Specific Construction Global Warming Potential [kgCO2e/m²]"; disabled
construction_global_warming_potential_pe_2 = ClusterOutput(construction_global_warming_potential_pe)  # "Construction Global Warming Potential per User [kgCO2e/Person]"; disabled
life_cycle_global_warming_potential_kgco_2 = ClusterOutput(life_cycle_global_warming_potential_kgco)  # "Life Cycle Global Warming Potential [kgCO2e]"; disabled
specific_life_cycle_global_warming_poten_2 = ClusterOutput(specific_life_cycle_global_warming_poten)  # "Specific Life Cycle Global Warming Potential [kgCO2e/m²]"; disabled
life_cycle_global_warming_potential_per_2 = ClusterOutput(life_cycle_global_warming_potential_per)  # "Life Cycle Global Warming Potential per User [kgCO2e/Person]"; disabled
primary_energy_demand_kwh_a_5 = ClusterOutput(primary_energy_demand_kwh_a_4)  # disabled
specific_primary_energy_demand_kwh_m²a_2 = ClusterOutput(specific_primary_energy_demand_kwh_m²a)  # disabled
primary_energy_demand_per_user_kwh_perso_2 = ClusterOutput(primary_energy_demand_per_user_kwh_perso)  # "Primary Energy Demand per User [kWh/Person a]"; disabled
final_energy_demand_kwh_a_5 = ClusterOutput(final_energy_demand_kwh_a_4)  # disabled
specific_final_energy_demand_kwh_m²a_2 = ClusterOutput(specific_final_energy_demand_kwh_m²a)  # disabled
final_energy_demand_per_user_kwh_person_2 = ClusterOutput(final_energy_demand_per_user_kwh_person)  # "Final Energy Demand per User [kWh/Person a]"; disabled
heating_load_kw_2 = ClusterOutput(heating_load_kw)  # disabled
heating_energy_demand_kwh_a_5 = ClusterOutput(heating_energy_demand_kwh_a_4)  # disabled
specific_heating_energy_demand_kwh_m²a_2 = ClusterOutput(specific_heating_energy_demand_kwh_m²a)  # disabled
heating_energy_demand_per_user_kwh_perso_2 = ClusterOutput(heating_energy_demand_per_user_kwh_perso)  # "Heating Energy Demand per User [kWh/Person a]"; disabled
cooling_load_kw_2 = ClusterOutput(cooling_load_kw)  # disabled
cooling_energy_demand_kwh_a_5 = ClusterOutput(cooling_energy_demand_kwh_a_4)  # disabled
specific_cooling_energy_demand_kwh_m²a_2 = ClusterOutput(specific_cooling_energy_demand_kwh_m²a)  # disabled
cooling_energy_demand_per_user_kwh_perso_2 = ClusterOutput(cooling_energy_demand_per_user_kwh_perso)  # "Cooling Energy Demand per User [kWh/Person a]"; disabled
ventilation_air_flow_volume_m³_s_2 = ClusterOutput(ventilation_air_flow_volume_m³_s)  # disabled
panel_5 = Panel("""interest
area efficiency 
area comfort 
income
expenses 
energy expenses 
effective floor area 
floor area 
users 
construction cost 
specific construction cost 
construction cost per user 
life cycle cost 
specific life cycle cost 
life cycle cost per user 
construction global warming potential 
specific construction global warming potential 
construction global warming potential per user 
life cycle global warming potential 
specific life cycle global warming potential 
life cycle global warming potential per user 
primary energy demand 
specific primary energy demand 
primary energy demand per user 
final energy demand 
specific final energy demand 
final energy demand per user 
heating load 
heating energy demand 
specific heating energy demand 
heating energy demand per user 
cooling load 
cooling energy demand 
specific cooling energy demand 
cooling energy demand per user 
ventilation air flow volume  """)
panel_6 = Panel(merge_23)
panel_7 = Panel("""%
eff. m²/m²
m²/Person
€/a
€/a
€/a
m²
m²
Person
€
€/m²
€/Person
€
€/m²
€/Person
kgCO2e
kgCO2e/m²
kgCO2e/Person
kgCO2e
kgCO2e/m²
kgCO2e/Person
kWh/a
kWh/m²a
kWh/Person a
kWh/a
kWh/m²a
kWh/Person a
kW
kWh/a
kWh/m²a
kWh/Person a
kW
kWh/a
kWh/m²a
kWh/Person a
m³/s""")
qal_37 = ModelQuality(Name=panel_5, Value=merge_23, Unit=panel_7)  # -> Quality, Valid, Name, Value, Unit, Definition; disabled
merge_24 = Merge(Data1=trim_2, Data2=qal_37.Quality)  # disabled
dsn_3 = ModelDesign(Design=dsn_2.Design, Qualities=merge_24)  # -> Design, Valid, Name, Description, Icon, Image, Variant, View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; disabled
dn_3 = ClusterOutput(dsn_3.Design)  # disabled

# ==== cluster SumQualities: Sum up the qualities of a type for each piece with this type in a design.
dn = ClusterInput()
ty = ClusterInput()
na = ClusterInput()
dn_2 = Design(dn)
ty_2 = Type(ty)
na_2 = Name(na)
dsn = ModelDesign(Design=dn_2)  # -> Design, Valid, Name, Description, Icon, Image, Variant, View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
typ = ModelType(Type=ty_2)  # -> Type, Valid, Name, Description, Icon, Image, Variant, Stock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
panel = Panel(ty_2)
qal = ModelQuality(Quality=typ.Qualities)  # -> Quality, Valid, Name, Value, Unit, Definition
trim = TrimTree(Tree=dsn.Pieces, Depth=1)
pce = ModelPiece(Piece=trim)  # -> Piece, Valid, Id, Description, TypeName, TypeVariant, Plane, Center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
expression = Expression(x=graft(pce.TypeName), y=typ.Name, Expression="x=y")
expression_2 = Expression(x=na_2, y=qal.Name, Expression="x=y")
expression_3 = Expression(x=graft(pce.TypeVariant), y=typ.Variant, Expression="x=y")
panel_2 = Panel(pce.TypeName)
panel_3 = Panel(typ.Qualities)
cull = CullPattern(List=typ.Qualities, CullPattern=expression_2)
and = GateAnd(A=expression, B=expression_3)
cull_2 = CullPattern(List=ty_2, CullPattern=and)
qal_2 = ModelQuality(Quality=cull)  # -> Quality, Valid, Name, flatten(Value), Unit, Definition
lng = ListLength(List=ty_2)
txt = Text(cull_2)
txt_2 = Text(ty_2)
series = Series(Start=0, Step=1, Count=lng)
expression_4 = Expression(x=txt, y=txt_2, Expression="x=y")
trim_2 = TrimTree(Tree=series, Depth=1)
panel_5 = Panel(qal_2.Quality)
cull_3 = CullPattern(List=trim_2, CullPattern=expression_4)
trim_3 = TrimTree(Tree=cull_3, Depth=1)
item = ListItem(List=qal_2.Value, Index=trim_3, Wrap=True)
clean = CleanTree(RemoveNulls=True, RemoveInvalid=True, RemoveEmpty=False, Tree=item)
ma = MassAddition(Input=clean)  # -> Result, PartialResults
num = Number(ma.Result)
ql = Quality(qal_2.Quality)
num_2 = ClusterOutput(num)
ql_2 = ClusterOutput(ql)

# ==== cluster SelectTypeByPiece: Select the type of a piece.
ty = ClusterInput()
pc = ClusterInput()
pc_2 = Piece(graft(pc))
ty_2 = Type(ty)
pce = ModelPiece(Piece=pc_2)  # -> Piece, Valid, Id, Description, TypeName, TypeVariant, Plane, Center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
typ = SelectType(ty=ty_2, na=pce.TypeName, variant=pce.TypeVariant)  # -> ty_4, i_2
trim = TrimTree(Tree=typ.ty_4, Depth=1)
trim_2 = TrimTree(Tree=typ.i_2, Depth=1)
ty_3 = Type(trim)
i = Integer(trim_2)
ty_4 = ClusterOutput(ty_3)
i_2 = ClusterOutput(i)

# ==== cluster SumQualitiesByHierachy: Return the numeric quality of the parent hierachy. If not defined return the sum of the child qualities. If not defined return the default value.
ql = ClusterInput()
na = ClusterInput()
cna = ClusterInput()
value = ClusterInput()
cfa = ClusterInput()
ql_2 = Quality(ql)
cna_2 = Name(cna)
value_2 = Value(value)
cfa_2 = Number(cfa)
na_2 = Name(na)
item = ListItem(List=flatten(cna_2), Index=0, Wrap=True)
item_2 = ListItem(List=flatten(cfa_2), Index=0, Wrap=True)
expression = Expression(x=cna_2, Expression="1")
qal = SelectQuality(ql=ql_2, na=cna_2)
qal_2 = SelectQuality(ql=ql_2, na=na_2)
null = NullItem(Item=item)  # -> NullFlags, InvalidFlags, Description
null_2 = NullItem(Item=item_2)  # -> NullFlags, InvalidFlags, Description
trim = TrimTree(Tree=qal, Depth=1)
trim_2 = TrimTree(Tree=qal_2, Depth=1)
filter = StreamFilter(Gate=null_2.NullFlags, Stream0=cfa_2, Stream1=expression)
clean = CleanTree(RemoveNulls=True, RemoveInvalid=True, RemoveEmpty=False, Tree=trim_2)
clean_2 = CleanTree(RemoveNulls=True, RemoveInvalid=True, RemoveEmpty=False, Tree=trim)
qal_3 = ModelQuality(Quality=clean)  # -> Quality, Valid, Name, Value, Unit, Definition
null_3 = NullItem(Item=clean_2)  # -> NullFlags, InvalidFlags, Description
qal_4 = ModelQuality(Quality=clean_2)  # -> Quality, Valid, Name, Value, Unit, Definition
null_4 = NullItem(Item=clean)  # -> NullFlags, InvalidFlags, Description
not = GateNot(A=null_4.NullFlags)
mm = MassMultiplication(Input=null_3.NullFlags)  # -> Result, PartialResults
null_5 = EmptyStringToNull(T=qal_4.Value)  # -> NT; inputs T: tree
# ---------- null_5: Python ----------
# Component Information
# --------------------------------------------------------------------------------------------
if ghenv.Component.RunCount < 2:
    # General
    # --------------------------------------------------------------------------------------------
    __author__ = "Ueli Saluz"
    __version__ = "2024.08.08"

    ghenv.Component.Name = "EmptyStringToNull"
    ghenv.Component.NickName = "\"\"->Null"
    ghenv.Component.Description = "Replaces empty strings with Null."
    ghenv.Component.Message = "VER 1.1"
    ghenv.Component.Category = "Sets"
    ghenv.Component.SubCategory = "Text"

    # Inputs
    # --------------------------------------------------------------------------------------------
    inputIndex = 0

    ghenv.Component.Params.Input[inputIndex].Name = "String"
    ghenv.Component.Params.Input[inputIndex].NickName = "T"
    ghenv.Component.Params.Input[inputIndex].Description = "Strings that are potentially empty."
    ghenv.Component.Params.Input[inputIndex].Optional = False
    inputIndex += 1

    # Outputs
    # --------------------------------------------------------------------------------------------
    outputIndex = 0

    ghenv.Component.Params.Output[outputIndex].Name = "NullifiedString"
    ghenv.Component.Params.Output[outputIndex].NickName = "NT"
    ghenv.Component.Params.Output[outputIndex].Description = "Original string if not empty, Null otherwise."
    outputIndex += 1

# Imports
# --------------------------------------------------------------------------------------------
from System import Object
from Grasshopper import DataTree

# Solver - Run with trees to enhance performance drastically
# --------------------------------------------------------------------------------------------
if __name__ == "__main__":
    
    # Initialize trees
    # --------------------------------------------------------------------------------------------
    NullifiedStringTree = DataTree[Object]()
    
    # Data matching
    # --------------------------------------------------------------------------------------------
    for path in T.Paths:
        stringBranch = T.Branch(path)
        for i, string in enumerate(stringBranch):
            nullifiedString = string if string != "" else None
            NullifiedStringTree.Add(nullifiedString, path)
    
    # Assign trees to output
    # --------------------------------------------------------------------------------------------
    NT = NullifiedStringTree
# ---------- end null_5 ----------
not_2 = GateNot(A=null_3.NullFlags)
expression_2 = Expression(x=value_2, y=clean, Expression="x")
not_3 = GateNot(A=mm.Result)
int = Integer(not)
nullrep = ReplaceNulls(Items=null_5, Replacements="0")  # -> Items, Count
multiplication = Multiplication(A=not_3, B="2")
addition = Addition(A=int, B=multiplication)
multiplication_2 = Multiplication(A=nullrep.Items, B=filter)
ma = MassAddition(Input=multiplication_2)  # -> Result, PartialResults
trim_3 = TrimTree(Tree=not, Depth=1)
trim_4 = TrimTree(Tree=not_3, Depth=1)
filter_2 = StreamFilter(Gate=null.NullFlags, Stream0=ma.Result, Stream1=expression_2)
merge = Merge(Data1=expression_2, Data2=qal_3.Value, Data3=filter_2, Data4=qal_3.Value)
item_3 = ListItem(List=merge, Index=addition, Wrap=invert(True))
trim_5 = TrimTree(Tree=item_3, Depth=1)
value_3 = Value(trim_5)
pa = Boolean(trim_3)
ch = Boolean(trim_4)
value_4 = ClusterOutput(value_3)
pa_2 = ClusterOutput(pa)
ch_2 = ClusterOutput(ch)

# ==== cluster OLD
ventilation_heat_recovery_factor = ClusterInput()
cooling_primary_energy_factor = ClusterInput()
heating_primary_energy_factor = ClusterInput()
electrictiy_primary_energy_factor = ClusterInput()
cooling_efficiency_factor = ClusterInput()
electrictiy_energy_price_kwh = ClusterInput()
ql = ClusterInput()

cooling_efficiency_factor_2 = Number(cooling_efficiency_factor)  # disabled
merge = Merge(Data1="Cooling Energy Demand")  # disabled
panel = Panel("0")  # disabled
qal = SumQualitiesByHierachy(ql=ql, na="Final Cooling Energy Demand", cna=merge, value=panel, cfa=cooling_efficiency_factor_2)  # -> value_4, pa_2, ch_2; disabled

ql_2 = ClusterInput()
ql_3 = ClusterInput()

cooling_primary_energy_factor_2 = Number(cooling_primary_energy_factor)  # disabled
multiplication = Multiplication(A=qal.value_4, B=cooling_primary_energy_factor_2)  # -> graft(Result); disabled
merge_2 = Merge(Data1="Final Cooling Energy Demand")  # disabled
qal_2 = SumQualitiesByHierachy(ql=ql_3, na="Primary Cooling Energy Demand", cna=merge_2, value=multiplication, cfa=cooling_primary_energy_factor_2)  # -> value_4, pa_2, ch_2; disabled

ql_4 = ClusterInput()

electrictiy_primary_energy_factor_2 = Number(electrictiy_primary_energy_factor)  # disabled
merge_3 = Merge(Data1="Technical Equipment Energy Demand")  # disabled
panel_2 = Panel("0")  # disabled
qal_3 = SumQualitiesByHierachy(ql=ql_4, na="Primary Electricity Energy Demand", cna=merge_3, value=panel_2, cfa=electrictiy_primary_energy_factor_2)  # -> value_4, pa_2, ch_2; disabled

ql_5 = ClusterInput()

# ----
# Electricity
panel_3 = Panel("Technical Equipment Energy Demand")
electrictiy_energy_price_kwh_2 = Number(electrictiy_energy_price_kwh)  # disabled
merge_4 = Merge(Data1=panel_3)  # disabled
panel_4 = Panel("0")  # disabled
qal_4 = SumQualitiesByHierachy(ql=ql_5, na="Electricity Energy Price", cna=merge_4, value=panel_4, cfa=electrictiy_energy_price_kwh_2)  # -> value_4, pa_2, ch_2; disabled

ql_6 = ClusterInput()

# ----
# Cooling
ventilation_heat_recovery_factor_2 = Number(ventilation_heat_recovery_factor)  # disabled
# Heating
panel_5 = Panel("transmission heat demand")
expression = Expression(x=ventilation_heat_recovery_factor_2, Expression="1-x")  # disabled
panel_6 = Panel("1")  # disabled
merge_5 = Merge(Data1=panel_5, Data2="ventilation heat demand")  # disabled
merge_6 = Merge(Data1=panel_6, Data2=expression)  # disabled
panel_7 = Panel("0")  # disabled
qal_5 = SumQualitiesByHierachy(ql=ql_6, na="heating energy demand", cna=merge_5, value=panel_7, cfa=merge_6)  # -> value_4, pa_2, ch_2; disabled

cooling_global_warming_potential_kgco2e = ClusterInput()  # "Cooling Global Warming Potential [kgCO2e/kWh]"
electrictiy_global_warming_potential_kgc = ClusterInput()  # "Electrictiy Global Warming Potential [kgCO2e/kWh]"
cooling_energy_price_kwh = ClusterInput()
heating_efficiency_factor = ClusterInput()
ql_7 = ClusterInput()

cooling_energy_price_kwh_2 = Number(cooling_energy_price_kwh)  # disabled
merge_7 = Merge(Data1="Final Cooling Energy Demand")  # disabled
qal_6 = SumQualitiesByHierachy(ql=ql_7, na="Cooling Energy Price", cna=merge_7, value=graft(qal.value_4), cfa=cooling_energy_price_kwh_2)  # -> value_4, pa_2, ch_2; disabled

ql_8 = ClusterInput()

cooling_global_warming_potential_kgco2e_2 = Number(cooling_global_warming_potential_kgco2e)  # "Cooling Global Warming Potential [kgCO2e/kWh]"; disabled
merge_8 = Merge(Data1="Final Cooling Energy Demand")  # disabled
panel_8 = Panel("0")  # disabled
qal_7 = SumQualitiesByHierachy(
    ql=ql_8,
    na="Cooling Global Warming Influence",
    cna=merge_8,
    value=graft(qal.value_4),
    cfa=cooling_global_warming_potential_kgco2e_2)  # -> value_4, pa_2, ch_2; disabled

ql_9 = ClusterInput()
ql_10 = ClusterInput()

electrictiy_global_warming_potential_kgc_2 = Number(electrictiy_global_warming_potential_kgc)  # "Electrictiy Global Warming Potential [kgCO2e/kWh]"; disabled
merge_9 = Merge(Data1="Technical Equipment Energy Demand")  # disabled
panel_9 = Panel("0")  # disabled
qal_8 = SumQualitiesByHierachy(
    ql=ql_10,
    na="Electricity Global Warming Influence",
    cna=merge_9,
    value=panel_9,
    cfa=electrictiy_global_warming_potential_kgc_2)  # -> value_4, pa_2, ch_2; disabled

ql_11 = ClusterInput()

heating_efficiency_factor_2 = Number(heating_efficiency_factor)  # disabled
merge_10 = Merge(Data1="heating energy demand")  # disabled
qal_9 = SumQualitiesByHierachy(ql=ql_11, na="Final Heating Energy Demand", cna=merge_10, value=graft(qal_5.value_4), cfa=heating_efficiency_factor_2)  # -> value_4, pa_2, ch_2; disabled

heating_primary_energy_factor_2 = Number(heating_primary_energy_factor)  # disabled
multiplication_2 = Multiplication(A=qal_9.value_4, B=heating_primary_energy_factor_2)  # -> graft(Result); disabled
merge_11 = Merge(Data1="Final Heating Energy Demand")  # disabled
qal_10 = SumQualitiesByHierachy(ql=ql_2, na="Primary Heating Energy Demand", cna=merge_11, value=multiplication_2, cfa=heating_primary_energy_factor_2)  # -> value_4, pa_2, ch_2; disabled

addition = Addition(A=qal_10.value_4, B=qal_2.value_4, C=qal_3.value_4)  # -> graft(Result); disabled
merge_12 = Merge(Data1="Final Heating Energy Demand", Data2="Final Cooling Energy Demand", Data3="Technical Equipment Energy Demand")  # disabled
qal_11 = SumQualitiesByHierachy(ql=ql_9, na="Primary Energy Demand", cna=merge_12, value=addition, cfa=heating_primary_energy_factor_2)  # -> value_4, pa_2, ch_2; disabled
primary_energy_demand_kwh_a = Number(qal_11.value_4)  # disabled

heating_global_warming_potential_kgco2e = ClusterInput()  # "Heating Global Warming Potential [kgCO2e/kWh]"
heating_energy_price_kwh = ClusterInput()
co2_price_kgco2e = ClusterInput()
co2_price_kgco2e_2 = ClusterInput()
ql_12 = ClusterInput()

heating_energy_price_kwh_2 = Number(heating_energy_price_kwh)  # disabled
merge_13 = Merge(Data1="Final Heating Energy Demand")  # disabled
qal_12 = SumQualitiesByHierachy(ql=ql_12, na="Heating Energy Price", cna=merge_13, value=graft(qal_9.value_4), cfa=heating_energy_price_kwh_2)  # -> value_4, pa_2, ch_2; disabled

ql_13 = ClusterInput()

heating_global_warming_potential_kgco2e_2 = Number(heating_global_warming_potential_kgco2e)  # "Heating Global Warming Potential [kgCO2e/kWh]"; disabled
merge_14 = Merge(Data1="Final Heating Energy Demand")  # disabled
qal_13 = SumQualitiesByHierachy(
    ql=ql_13,
    na="Heating Global Warming Influence",
    cna=merge_14,
    value=graft(qal_9.value_4),
    cfa=heating_global_warming_potential_kgco2e_2)  # -> value_4, pa_2, ch_2; disabled

ql_14 = ClusterInput()

co2_price_kgco2e_3 = Number(co2_price_kgco2e)  # disabled
merge_15 = Merge(Data1="Cooling Global Warming Influence")  # disabled
qal_14 = SumQualitiesByHierachy(ql=ql_14, na="Cooling CO2 Price", cna=merge_15, value=graft(qal_7.value_4), cfa=co2_price_kgco2e_3)  # -> value_4, pa_2, ch_2; disabled

ql_15 = ClusterInput()

co2_price_kgco2e_4 = Number(co2_price_kgco2e_2)  # disabled
merge_16 = Merge(Data1="Electricity Global Warming Influence")  # disabled
qal_15 = SumQualitiesByHierachy(ql=ql_15, na="Electricity CO2 Price", cna=merge_16, value=graft(qal_8.value_4), cfa=co2_price_kgco2e_4)  # -> value_4, pa_2, ch_2; disabled

co2_price_kgco2e_5 = ClusterInput()
ql_16 = ClusterInput()

co2_price_kgco2e_6 = Number(co2_price_kgco2e_5)  # disabled
merge_17 = Merge(Data1="Heating Global Warming Influence")  # disabled
qal_16 = SumQualitiesByHierachy(ql=ql_16, na="Heating CO2 Price", cna=merge_17, value=graft(qal_13.value_4), cfa=co2_price_kgco2e_6)  # -> value_4, pa_2, ch_2; disabled

life_cycle_a = ClusterInput()
ql_17 = ClusterInput()

electricity_global_warming_influence_kgc = Number(qal_8.value_4)  # "Electricity Global Warming Influence [kgCO2e/a]"; disabled
heating_global_warming_influence_kgco2e = Number(qal_13.value_4)  # "Heating Global Warming Influence [kgCO2e/a]"; disabled
cooling_global_warming_influence_kgco2e = Number(qal_7.value_4)  # "Cooling Global Warming Influence [kgCO2e/a]"; disabled
addition_2 = Addition(
    A=heating_global_warming_influence_kgco2e,
    B=cooling_global_warming_influence_kgco2e,
    C=electricity_global_warming_influence_kgc)  # disabled
energy_global_warming_potential_kgco2e_a = Number(addition_2)  # disabled
merge_18 = Merge(Data1="construction global warming potential", Data2="Technical Equipment Energy Demand")  # disabled
life_cycle_a_2 = Number(life_cycle_a)  # disabled
panel_11 = Panel("0")  # disabled
qal_17 = SumQualitiesByHierachy(ql=ql_17, na="Construction GWP", cna=merge_18, value=panel_11)  # -> value_4, pa_2, ch_2; disabled
multiplication_3 = Multiplication(A=energy_global_warming_potential_kgco2e_a, B=life_cycle_a_2)  # disabled
addition_3 = Addition(A=multiplication_3, B=qal_17.value_4)  # disabled
life_cycle_gwp_kgco2e = Number(addition_3)  # disabled

ql_18 = ClusterInput()

expression_2 = Expression(x="0", y=qal.value_4, Expression="x")  # disabled
merge_19 = Merge(Data1=qal_9.value_4, Data2=qal.value_4, Data3=expression_2)  # -> graft(Result); disabled
merge_20 = Merge(Data1="Final Heating Energy Demand", Data2="Final Cooling Energy Demand", Data3="Technical Equipment Energy Demand")  # disabled
qal_18 = SumQualitiesByHierachy(ql=ql_18, na="Final Energy Demand", cna=merge_20, value=merge_19)  # -> value_4, pa_2, ch_2; disabled
final_energy_demand_kwh_a = Number(qal_18.value_4)  # disabled

ql_19 = ClusterInput()

addition_4 = Addition(A=qal_12.value_4, B=qal_16.value_4)  # -> graft(Result); disabled
merge_21 = Merge(Data1="Heating Energy Price", Data2="Heating CO2 Price")  # disabled
qal_19 = SumQualitiesByHierachy(ql=ql_19, na="Heating Expenses", cna=merge_21, value=addition_4)  # -> value_4, pa_2, ch_2; disabled

ql_20 = ClusterInput()

addition_5 = Addition(A=qal_6.value_4, B=qal_14.value_4)  # -> graft(Result); disabled
merge_22 = Merge(Data1="Cooling Energy Price", Data2="Cooling CO2 Price")  # disabled
qal_20 = SumQualitiesByHierachy(ql=ql_20, na="Cooling Expenses", cna=merge_22, value=addition_5)  # -> value_4, pa_2, ch_2; disabled

ql_21 = ClusterInput()

addition_6 = Addition(A=qal_4.value_4, B=qal_15.value_4)  # -> graft(Result); disabled
merge_23 = Merge(Data1="Electricity Energy Price", Data2="Electricity CO2 Price")  # disabled
qal_21 = SumQualitiesByHierachy(ql=ql_21, na="Electricity Expenses", cna=merge_23, value=addition_6)  # -> value_4, pa_2, ch_2; disabled

panel_12 = Panel("heating expenses")
panel_13 = Panel("cooling expenses")
panel_14 = Panel("electricity expenses")
panel_15 = Panel("pre installed furniture")
panel_16 = Panel("heating equipment")
panel_17 = Panel("cooling equipment")
panel_18 = Panel("windows")
panel_19 = Panel("electrical equipment")
panel_20 = Panel("roof")
panel_21 = Panel("shell construction")
panel_22 = Panel("facade")
ql_22 = ClusterInput()

addition_7 = Addition(A=qal_19.value_4, B=qal_20.value_4, C=qal_21.value_4)  # -> graft(Result)
merge_24 = Merge(Data1="Heating Expenses", Data2="Cooling Expenses", Data3="Electricity Expenses")
qal_22 = SumQualitiesByHierachy(ql=ql_22, na="Energy Expenses", cna=merge_24, value=addition_7)  # -> value_4, pa_2, ch_2
energy_expenses_a = Number(qal_22.value_4)

panel_23 = Panel("insurance")
panel_24 = Panel("staff")
panel_25 = Panel("replacements")
panel_26 = Panel("renovation")
# Water and Waste water
panel_27 = Panel("energy")
panel_28 = Panel("technical equipment")
panel_29 = Panel("outdoor area/facilities")
panel_30 = Panel("building")
panel_31 = Panel("architectual")
panel_32 = Panel("demolition works")
panel_33 = Panel("disposal costs")
panel_34 = Panel("engineering")
panel_35 = Panel("expenses")
panel_36 = Panel("maintance")
panel_37 = Panel(qal_22.value_4)
panel_38 = Panel("demolition")
panel_39 = Panel("planning")
panel_40 = Panel("construction")
panel_41 = Panel("property")
panel_42 = Panel("expert opinions")
panel_43 = Panel("interest")
panel_44 = Panel("running")
panel_45 = Panel("market value increase")
panel_46 = Panel("rental Income")
panel_47 = Panel("commercial Income")
panel_48 = Panel("operation")
panel_49 = Panel("investment")
panel_50 = Panel(" Life Cycle Income")
panel_51 = Panel(" Life Cycle Cost")

# ==== cluster SelectType: Select a type with a name and an optional variant. If no variant is provided it will select all variants. If you want to select the default type then use the empty text.
ty = ClusterInput()
na = ClusterInput()
variant = ClusterInput()
na_2 = Name(na)
variant_2 = Variant(variant)
ty_2 = Type(ty)
typ = ModelType(Type=ty_2)  # -> Type, Valid, Name, Description, Icon, Image, Variant, Stock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
expression = Expression(x=typ.Name, y=na_2, Expression="x=y")
cull = CullPattern(List=typ.Type, CullPattern=expression)
typ_2 = ModelType(Type=cull)  # -> Type, Valid, Name, Description, Icon, Image, Variant, Stock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
expression_2 = Expression(x=typ_2.Variant, y=variant_2, Expression="x=y")
txt = Text(ty_2)
cull_2 = CullPattern(List=typ_2.Type, CullPattern=expression_2)
null = NullItem(Item=variant_2)  # -> NullFlags, InvalidFlags, Description
filter = StreamFilter(Gate=null.NullFlags, Stream0=cull_2, Stream1=cull)
txt_2 = Text(filter)
mindex = MemberIndex(Set=txt, Member=txt_2)  # -> Index, Count
trim = TrimTree(Tree=mindex.Index, Depth=1)
ty_3 = Type(filter)
i = Integer(trim)
ty_4 = ClusterOutput(ty_3)
i_2 = ClusterOutput(i)

# ==== cluster SelectQuality: Select a quality by its name. If no quality matches, null is returned.
ql = ClusterInput()
na = ClusterInput()
na_2 = Name(na)
ql_2 = Quality(ql)
flatten = FlattenTree(Tree=ql_2, Path="{0}")
tstat = TreeStatistics(Tree=flatten)  # -> Paths, Length, Count
lng = ListLength(List=tstat.Paths)
qal = ModelQuality(Quality=flatten)  # -> Quality, Valid, Name, Value, Unit, Definition
expression = Expression(x=lng, Expression="x=0")
lng_2 = ListLength(List=na_2)
dup = DuplicateData(Data=graft(flatten), Number=lng_2, Order=True)
filter = StreamFilter(Gate=expression, Stream0=graft(qal.Name), Stream1=qal.Name)
filter_2 = StreamFilter(Gate=expression, Stream0=na_2, Stream1=graft(na_2))
trim = TrimTree(Tree=dup, Depth=1)
expression_2 = Expression(x=filter, y=filter_2, Expression="x=y")
cull = CullPattern(List=graft(trim), CullPattern=graft(expression_2))
dup_2 = DuplicateData(Data=graft(ql_2), Number=lng_2, Order=True)
nulltobranch = AddNullToEmptyBranch(D=cull)  # -> R; inputs D: tree
# ---------- nulltobranch: C# ----------
#region Usings
using System;
using System.Linq;
using System.Collections;
using System.Collections.Generic;
using System.Drawing;

using Rhino;
using Rhino.Geometry;

using Grasshopper;
using Grasshopper.Kernel;
using Grasshopper.Kernel.Data;
using Grasshopper.Kernel.Types;
#endregion

public class Script_Instance : GH_ScriptInstance
{

    private void RunScript(DataTree<object> D, ref object R)
    {
        foreach (GH_Path path in D.Paths)
            if (D.Branch(path).Count == 0)
                D.Add(null, path);

        R = D;
    }
}
# ---------- end nulltobranch ----------
trim_2 = TrimTree(Tree=nulltobranch, Depth=1)
trim_3 = TrimTree(Tree=dup_2, Depth=1)
match = MatchTree(Tree=trim_2, Guide=trim_3)
ql_3 = Quality(match)
ql_4 = ClusterOutput(ql_3)
