# Grasshopper definition empty-get.gh (Grasshopper 1.0.8)
# Copyright: GNU Lesser General Public License Version 3
# plug-ins: semio

kt = Kit("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")
kit = ModelKit(Kit=kt)  # -> Kit, Valid, Name, Description, Icon, Image, Preview, Version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
loc = ModelLocation(Longitude=Slider(4.3, range=0..10), Latitude=Slider(1.2, range=0..10))  # -> Location, Valid, Longitude, Latitude
dsn = ModelDesign(Design=kit.Designs)  # -> Design, Valid, Name, Description, Icon, Image, Variant, View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
typ = ModelType(Type=kit.Types, Location=loc.Location)  # -> Type, Valid, Name, Description, Icon, Image, Variant, Stock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
kit_2 = ModelKit(Kit=kit.Kit, Types=typ.Type, Designs=dsn.Design)  # -> Kit, Valid, Name, Description, Icon, Image, Preview, Version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
item = ListItem(List=typ.Type, Index=0, Wrap=True)
typ_2 = SerializeType(Type=item, Indent="  ")
lcn = License({"CC0 1.0": "CC0-1.0", "CC BY 4.0": "CC-BY-4.0", "CC BY-SA 4.0": "CC-BY-SA-4.0", "CC BY-NC": "CC-BY-NC-4.0", "CC BY-NC-SA": "CC-BY-NC-SA-4.0", "CC BY-NC-ND": "CC-BY-NC-ND-4.0", "GPL3 or later": "GPL-3.0-or-later", "AGPL3 or later": "AGPL-3.0-or-later", "LGPL3 or later": "LGPL-3.0-or-later", "MIT"}, selected="CC BY-NC")
kt_2 = Kit("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")
kit_3 = CreateKit(Kit=kt_2, Run=Toggle(False))
kit_4 = LoadKit(Run=Toggle(False))  # -> Success, Kit, LocalDirectory
kit_5 = ModelKit(Kit=kit_4.Kit)  # -> Kit, Valid, Name, Description, Icon, Image, Preview, Version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
typ_3 = ModelType(Type=kit_5.Types)  # -> Type, Valid, Name, Description, Icon, Image, Variant, Stock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
