# Grasshopper definition expression-bug.gh (Grasshopper 1.0.8)
# Copyright: GNU Lesser General Public License v3.0 or later
# plug-ins: RhinoCodePluginGH

data = Data(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)
data_2 = Data(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)
panel = Panel(data_2)
c_script = CSharpScript(x=data_2, y=data)  # -> a
# ---------- c_script: C# ----------
// Grasshopper Script Instance
#region Usings
using System;
using System.Linq;
using System.Collections;
using System.Collections.Generic;
using System.Drawing;

using Rhino;
using Rhino.Geometry;

using Grasshopper;
using Grasshopper.Kernel;
using Grasshopper.Kernel.Data;
using Grasshopper.Kernel.Types;
#endregion

public class Script_Instance : GH_ScriptInstance
{
    #region Notes
    /* 
      Members:
        RhinoDoc RhinoDocument
        GH_Document GrasshopperDocument
        IGH_Component Component
        int Iteration

      Methods (Virtual & overridable):
        Print(string text)
        Print(string format, params object[] args)
        Reflect(object obj)
        Reflect(object obj, string method_name)
    */
    #endregion

    private void RunScript(object x, object y, ref object a)
    {
        // Write your logic here
        a = x;
    }
}
# ---------- end c_script ----------
expression = Expression(x=data_2, y=data, Expression="x")
panel_2 = Panel(c_script)
panel_3 = Panel(expression)
