# Grasshopper definition preview-connection.gh (Grasshopper 1.0.8)
# Copyright: GNU Lesser General Public License Version 3
# plug-ins: semio

genes = GenePool(Decimals=0, Maximum=165, Minimum=-165, Value=[-50, 0, 55, -165])
genes_2 = GenePool(Decimals=0, Maximum=110, Minimum=-110, Value=[44, 39, 22, 22])
genes_3 = GenePool(Decimals=0, Maximum=110, Minimum=-110, Value=[0, 0, 0, 0])
genes_4 = GenePool(Decimals=0, Maximum=360, Minimum=0, Value=[85, 180, 180, 180])
genes_5 = GenePool(Decimals=0, Maximum=360, Minimum=0, Value=[97, 0, 0, 0])
genes_6 = GenePool(Decimals=0, Maximum=360, Minimum=0, Value=[48, 0, 0, 0])
con = ModelConnection(Gap=genes_2, Shift=genes, Raise=genes_3, Rotation=genes_4, Turn=genes_5, Tilt=genes_6)  # -> Connection, Valid, ConnectedPieceId, ConnectedPieceTypePortId, ConnectingPieceId, ConnectingPieceTypePortId, Description, Gap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
panel = Panel("""i
L1
L2
L2""")
panel_2 = Panel("""L1
L2
e1
e2""")
profile = Profile(amount="5", width="110")  # -> ty_2, srf_3, geo_2
profile_2 = Profile(amount="4", width="110")  # -> ty_2, srf_3, geo_2
profile_3 = Profile(amount="2", width="110")  # -> ty_2, srf_3, geo_2
xy = XYPlane(Origin=Point(0, 0, 0))
panel_3 = Panel("""w
e
n
n""")
panel_4 = Panel("""w
e
w
w""")
con_2 = ModelConnection(
    Connection=con.Connection,
    ConnectedPieceId=panel,
    ConnectedPieceTypePortId=panel_3,
    ConnectingPieceId=panel_2,
    ConnectingPieceTypePortId=panel_4)  # -> Connection, Valid, ConnectedPieceId, ConnectedPieceTypePortId, ConnectingPieceId, ConnectingPieceTypePortId, Description, Gap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
prot = RotatePlane(Plane=xy, Angle=degrees("-90"))
merge = Merge(Data1=profile_3.ty_2, Data2=profile_2.ty_2, Data3=profile.ty_2)
merge_2 = Merge(Data1=profile_3.srf_3, Data2=profile_2.srf_3, Data3=profile.srf_3)
merge_3 = Merge(Data1=profile_3.geo_2, Data2=profile_2.geo_2, Data3=profile.geo_2)
merge_4 = Merge(Data1=profile_2.ty_2, Data2=profile.ty_2, Data3=profile.ty_2, Data4=profile_3.ty_2, Data5=profile_3.ty_2)
panel_5 = Panel("""i
L1
L2
e1
e2""")
pce = ModelPiece(Piece=merge_4, Id=panel_5)  # -> Piece, Valid, Id, Description, TypeName, TypeVariant, Plane, Center, Qualities
item = ListItem(List=pce.Piece, Index=0, Wrap=True)
pce_2 = ModelPiece(Piece=item, Plane=prot)  # -> Piece, Valid, Id, Description, TypeName, TypeVariant, Plane, Center, Qualities
replace = ReplaceItems(List=pce.Piece, Item=pce_2.Piece, Indices="0", Wrap=False)
dsn = ModelDesign(Name="Logo", Pieces=replace, Connections=con_2.Connection)  # -> Design, Valid, Name, Description, Icon, Image, Variant, View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
dsn_2 = PreviewDesign(dn=dsn.Design, ty=merge, ob=merge_2, sc=1)
con_3 = PreviewConnections(dn=dsn.Design, ty=merge, sc=Slider(43, range=0..100), W=Slider(4, range=0..10))
po = Port()
swatch = ColourSwatch(SwatchColor=RGB(235, 52, 79))
por = ModelPort(Port=po)  # -> Port, Valid, Id, Description, Family, CompatibleFamilies, Point, Direction, Locators, T
lng = ListLength(List=por.CompatibleFamilies)
expression = Expression(x=por.Family, Expression="x=\"\"")
join = TextJoin(Text=por.CompatibleFamilies, Join=",")
expression_2 = Expression(x=lng, Expression="x=0")
merge_5 = Merge(Data1=":")
trim = TrimTree(Tree=join, Depth=1)
panel_6 = Panel(trim)
item_2 = ListItem(List=merge_5, Index=expression, Wrap=True)
concat = Concatenate(FragmentA="[", FragmentB=trim, FragmentC="]")
item_3 = ListItem(List=merge_5, Index=expression, Wrap=True)
concat_2 = Concatenate(FragmentA=por.Id, FragmentB=item_2, FragmentC=por.Family)
tag = TextTag(Location=por.Point, Text=concat_2, Colour=swatch)
vdisex = VectorDisplayEx(Point=por.Point, Vector=por.Direction, Colour=ColourSwatch(SwatchColor=RGB(0, 166, 157)), Width=2)
preview = CustomPreview(Geometry=por.Point, Material=swatch)

# ==== cluster Profile
width = ClusterInput()
amount = ClusterInput()
amount_2 = Integer(amount)
width_2 = Number(width)

multiplication = Multiplication(A=amount_2, B=width_2)
subtraction = Subtraction(A=amount_2, B="1")
rectangle = Rectangle(Plane=PlaneXY(0, 0, 0), XSize=multiplication, YSize=width_2, Radius=0)  # -> Rectangle, Length
multiplication_2 = Multiplication(A=subtraction, B=width_2)
explode = Explode(Curve=rectangle.Rectangle, Recursive=True)  # -> Segments, Vertices
trim = TrimTree(Tree=explode.Vertices, Depth=1)
cull_i = CullIndex(List=trim, Indices="-1", Wrap=True)
pt = ConstructPoint(XCoordinate=multiplication_2, YCoordinate=width_2, ZCoordinate=0)
trim_2 = TrimTree(Tree=cull_i, Depth=1)
replace = ReplaceItems(List=trim_2, Item=pt, Indices="2", Wrap=False)
trim_3 = TrimTree(Tree=replace, Depth=1)
intcrv = Interpolate(Vertices=trim_3, Degree="1", Periodic=invert(False), KnotStyle=1)  # -> Curve, Length, Domain

tiefe_der_fase_radius = Slider(3, range=0..5)
versatz_blockprofil = Slider(2, range=0..5)
anzahl_der_innennuten = Slider(2, range=0..5)
breite_der_innennut = Slider(3, range=0..5)
höhe_der_innennut = Slider(3, range=0..5)
anzahl_der_elemente = Slider(1, range=1..20)
profilhöhe = Slider(16, range=0..30)
nuttiefe = Slider(8, range=0..10)
nutbreite = Slider(5, range=0..10)
federtiefe = Slider(7, range=0..10)
federbreite = Slider(4, range=0..10)
versatz = Slider(5, range=0..30)
winkel_der_fase = Slider(30, range=0..100)
list = ValueList({"Ohne Innennut": 0, "Mit Innennut": 1}, selected="Mit Innennut")
list_2 = ValueList({"Einfach": 0, "Fase": 1, "Softline": 2, "Trapez": 3, "Blockhaus": 4, "Diagonal": 5}, selected="Softline")
xy = XYPlane(Origin=Point(0, 0, 0))
item = ListItem(List=trim_3, Index=0, Wrap=True)  # -> Item, Item1, Item2
expression = Expression(x=profilhöhe, Expression="x/2")
vec2pt = Vector2Pt(PointA=item.Item1, PointB=item.Item2, Unitize=invert(False))  # -> Vector, Length
profiledwoodelements = ProfiledWoodElements(
    baseplane=xy,
    elementbreadth=width_2,
    elementcount=anzahl_der_elemente,
    lengthelement=multiplication,
    profiletype=list_2,
    innergrooves=list,
    profileheight=profilhöhe,
    groovedepth=nuttiefe,
    groovebreadth=nutbreite,
    tonguedepth=federtiefe,
    tonguebreadth=federbreite,
    innergroovecount=anzahl_der_innennuten,
    innergroovebreadth=breite_der_innennut,
    innergrooveheight=höhe_der_innennut,
    chamferdepth_radius=tiefe_der_fase_radius,
    chamferangle=winkel_der_fase,
    offset=versatz,
    offsetblockprofile=versatz_blockprofil)
Z = UnitZ(Factor=1)
neg = Negative(Value=expression)
pl = ConstructPlane(Origin=item.Item1, XAxis=vec2pt.Vector, YAxis=Z)
Z_2 = UnitZ(Factor=neg)
move = Move(Geometry=profiledwoodelements, Motion=Z_2)  # -> Geometry, Transform
sec = BrepPlane(Brep=move.Geometry, Plane=pl)  # -> Curves, Points
trim_4 = TrimTree(Tree=sec.Curves, Depth=1)
scale = Scale(Geometry=profiledwoodelements, Center=Point(0, 0, 0), Factor="0.1")  # -> Geometry, Transform
srf = Surface(trim_4)
split = SplitBrep(Brep=move.Geometry, Cutter=srf)
trim_5 = TrimTree(Tree=split, Depth=1)
item_2 = ListItem(List=trim_5, Index=0, Wrap=True)  # -> Item, Item1
cap = CapHoles(Brep=item_2.Item1)

explode_2 = Explode(Curve=intcrv.Curve, Recursive=True)  # -> Segments, Vertices
trim_6 = TrimTree(Tree=explode_2.Segments, Depth=1)
midpt = CurveMiddle(Curve=trim_6)
crv_cp = CurveClosestPoint(Point=midpt, Curve=intcrv.Curve)  # -> Point, Parameter, Distance
eval = EvaluateCurve(Curve=intcrv.Curve, Parameter=crv_cp.Parameter)  # -> Point, Tangent, Angle
Z_3 = UnitZ(Factor=1)
vrot = Rotate(Vector=eval.Tangent, Axis=Z_3, Angle=degrees("-90"))

panel = Panel("""s
e
n
w""")
por = ModelPort(Id=panel, Point=midpt, Direction=vrot)  # -> Port, Valid, Id, Description, Family, CompatibleFamilies, Point, Direction, T, Qualities
typ = ModelType(Name="Profile", Variant=amount_2, Ports=por.Port)  # -> Type, Valid, Name, Description, Icon, Image, Variant, Unit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
ty = Type(typ.Type)
srf_2 = Surface(intcrv.Curve)
geo = Geometry(cap)
ty_2 = ClusterOutput(ty)
srf_3 = ClusterOutput(srf_2)
geo_2 = ClusterOutput(geo)

# ==== cluster PreviewConnections: Preview all connections of a design by visualizing the ports of the types and the connection parameters.
dn = ClusterInput()
ty = ClusterInput()
sc = ClusterInput()
W = ClusterInput()
sc_2 = Number(sc)
W_2 = Width(W)
dn_2 = Design(dn)
ty_2 = Type(ty)
fltdsn = FlattenDesign(Design=dn_2, Types=ty_2)
dsn = ModelDesign(Design=fltdsn)  # -> Design, Valid, Name, Description, Icon, Image, Variant, View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
dsn_2 = ModelDesign(Design=dn_2)  # -> Design, Valid, Name, Description, Icon, Image, Variant, View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
trim = TrimTree(Tree=dsn.Pieces, Depth=1)
trim_2 = TrimTree(Tree=dsn_2.Connections, Depth=1)
trim_3 = TrimTree(Tree=dsn_2.Pieces, Depth=1)
roo = SelectRoot(pc=trim_3)  # -> ro_2, i_2
cull_i = CullIndex(List=trim, Indices=roo.i_2, Wrap=True)
pce = ModelPiece(Piece=cull_i)  # -> Piece, Valid, Id, Description, TypeName, TypeVariant, Plane, Center, Qualities
panel = Panel("semio.parent")
qal = ModelQuality(Quality=pce.Qualities)  # -> Quality, Valid, Name, Value, Unit, Definition
trim_4 = TrimTree(Tree=qal.Value, Depth=1)
pce_2 = SelectPiece(pc=trim, id=trim_4)  # -> pc_4, i_2
con = SelectConnection(co=trim_2, cdpc=trim_4, cgpc=pce.Id)  # -> co_4, i_2, fl_2
parent = Piece(pce_2.pc_4)
co = Connection(con.co_4)
child = Piece(cull_i)
pce_3 = ModelPiece(Piece=parent)  # -> Piece, Valid, Id, Description, TypeName, TypeVariant, Plane, Center, Qualities
pce_4 = ModelPiece(Piece=child)  # -> Piece, Valid, Id, Description, TypeName, TypeVariant, Plane, Center, Qualities
con_2 = ModelConnection(Connection=co)  # -> Connection, Valid, ConnectedPieceId, ConnectedPieceTypePortId, ConnectingPieceId, ConnectingPieceTypePortId, Description, Gap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
typ = SelectTypeByPiece(ty=ty_2, pc=pce_3.Piece)  # -> ty_4, i_2
typ_2 = SelectTypeByPiece(ty=ty_2, pc=pce_4.Piece)  # -> ty_4, i_2
merge = Merge(Data1=graft(con_2.ConnectedPieceTypePortId), Data2=graft(con_2.ConnectingPieceTypePortId))
merge_2 = Merge(Data1=graft(con_2.ConnectingPieceTypePortId), Data2=graft(con_2.ConnectedPieceTypePortId))
typ_3 = ModelType(Type=typ.ty_4)  # -> Type, Valid, Name, Description, Icon, Image, Variant, Unit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
typ_4 = ModelType(Type=typ_2.ty_4)  # -> Type, Valid, Name, Description, Icon, Image, Variant, Unit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
item = ListItem(List=merge, Index=graft(con.fl_2), Wrap=True)
item_2 = ListItem(List=merge_2, Index=graft(con.fl_2), Wrap=True)
por = SelectPort(po=typ_3.Ports, id=item)  # -> po_4, i_2
por_2 = SelectPort(po=typ_4.Ports, id=item_2)  # -> po_4, i_2
deplane = DeconstructPlane(Plane=pce_4.Plane)  # -> Origin, XAxis, YAxis, ZAxis
orient = Orient(Source=PlaneXY(0, 0, 0), Target=pce_4.Plane)  # -> Geometry, Transform
orient_2 = Orient(Source=PlaneXY(0, 0, 0), Target=pce_3.Plane)  # -> Geometry, Transform
trim_5 = TrimTree(Tree=por.po_4, Depth=1)
trim_6 = TrimTree(Tree=por_2.po_4, Depth=1)
Y = UnitY(Factor=1)
c_script = CSharpScript(X=orient.Transform)  # -> T, R, I; inputs X: Transform
# ---------- c_script: C# ----------
// Grasshopper Script Instance
#region Usings
using System;
using System.Linq;
using System.Collections;
using System.Collections.Generic;
using System.Drawing;

using Rhino;
using Rhino.Geometry;

using Grasshopper;
using Grasshopper.Kernel;
using Grasshopper.Kernel.Data;
using Grasshopper.Kernel.Types;
#endregion

public class Script_Instance : GH_ScriptInstance
{
    #region Notes
    /* 
      Members:
        RhinoDoc RhinoDocument
        GH_Document GrasshopperDocument
        IGH_Component Component
        int Iteration

      Methods (Virtual & overridable):
        Print(string text)
        Print(string format, params object[] args)
        Reflect(object obj)
        Reflect(object obj, string method_name)
    */
    #endregion

    private void RunScript(Transform X, ref object T, ref object R, ref object I)
    {
        var i = new Transform();
        T = X.TryGetInverse(out i);
        var translation = new Vector3d();
        var rotation = new Transform();
        var orthogonal = new Transform();
        var diagonal = new Vector3d();
        X.DecomposeAffine(out translation, out rotation, out orthogonal,out diagonal);
        T = translation;
        R = rotation;
        I = i;
    }
}
# ---------- end c_script ----------
c_script_2 = CSharpScript(X=orient_2.Transform)  # -> T, R, I; inputs X: Transform; same code as c_script
Z = UnitZ(Factor=1)
rotate = RotateDirection(Center=Point(0, 0, 0), From=Y, To=deplane.YAxis)  # -> Geometry, Transform
parent_po = Port(trim_5)
child_po = Port(trim_6)
inverse = InverseTransform(Transform=rotate.Transform)
por_3 = ModelPort(Port=parent_po)  # -> Port, Valid, Id, Description, Family, CompatibleFamilies, Point, Direction, T, Qualities
por_4 = ModelPort(Port=child_po)  # -> Port, Valid, Id, Description, Family, CompatibleFamilies, Point, Direction, T, Qualities
transform = Transform(Geometry=Z, Transform=c_script_2.R)
transform_2 = Transform(Geometry=por_3.Point, Transform=orient_2.Transform)
transform_3 = Transform(Geometry=por_3.Direction, Transform=c_script_2.R)
transform_4 = Transform(Geometry=por_4.Point, Transform=orient.Transform)
transform_5 = Transform(Geometry=por_4.Direction, Transform=c_script.R)
por_5 = ModelPort(Port=por_3.Port, Point=transform_2, Direction=transform_3)  # -> Port, Valid, Id, Description, Family, CompatibleFamilies, Point, Direction, T, Qualities
por_6 = ModelPort(Port=por_4.Port, Point=transform_4, Direction=transform_5)  # -> Port, Valid, Id, Description, Family, CompatibleFamilies, Point, Direction, T, Qualities
prv = PreviewPort(po=por_5.Port, W=W_2)
prv_2 = PreviewPort(po=por_6.Port, W=W_2)
ln = Line(StartPoint=por_5.Point, EndPoint=por_6.Point)
preview = CustomPreview(Geometry=ln, Material=ColourSwatch(SwatchColor=RGB(250, 149, 0)))
pl = ConstructPlane(Origin=por_5.Point, XAxis=transform, YAxis=por_5.Direction)
expression = Expression(x=con_2.Raise, Expression="x≠0")
expression_2 = Expression(x=con_2.Shift, Expression="x≠0")
expression_3 = Expression(x=con_2.Gap, Expression="x≠0")
deplane_2 = DeconstructPlane(Plane=pl)  # -> Origin, XAxis, YAxis, ZAxis
rev = Reverse(Vector=deplane_2.ZAxis)
pl_2 = ConstructPlane(Origin=por_6.Point, XAxis=rev, YAxis=deplane_2.XAxis)
rev_2 = Reverse(Vector=deplane_2.ZAxis)
expression_4 = Expression(x=sc_2, Expression="x/2")
prot = RotatePlane(Plane=pl_2, Angle=degrees(con_2.Rotation))
deplane_3 = DeconstructPlane(Plane=prot)  # -> Origin, XAxis, YAxis, ZAxis
rev_3 = Reverse(Vector=deplane_3.ZAxis)
pl_3 = ConstructPlane(Origin=deplane_3.Origin, XAxis=deplane_3.XAxis, YAxis=rev_3)
prot_2 = RotatePlane(Plane=pl_3, Angle=degrees(con_2.Turn))
deplane_4 = DeconstructPlane(Plane=prot_2)  # -> Origin, XAxis, YAxis, ZAxis
rev_4 = Reverse(Vector=deplane_4.ZAxis)
pl_4 = ConstructPlane(Origin=deplane_4.Origin, XAxis=deplane_4.YAxis, YAxis=deplane_4.ZAxis)
amp = Amplitude(Vector=rev_2, Amplitude=con_2.Shift)
amp_2 = Amplitude(Vector=deplane_2.XAxis, Amplitude=con_2.Raise)
amp_3 = Amplitude(Vector=por_5.Direction, Amplitude=con_2.Gap)
move = Move(Geometry=por_5.Point, Motion=amp_3)  # -> Geometry, Transform
move_2 = Move(Geometry=move.Geometry, Motion=amp)  # -> Geometry, Transform
rotate_2 = Rotate(Angle=degrees(con_2.Turn), Plane=PlaneXY(0, 0, 0))  # -> Geometry, Transform
cull = CullPattern(List=move_2.Geometry, CullPattern=expression)
cull_2 = CullPattern(List=por_5.Point, CullPattern=expression_3)
cull_3 = CullPattern(List=amp_3, CullPattern=expression_3)
cull_4 = CullPattern(List=amp, CullPattern=expression_2)
cull_5 = CullPattern(List=amp_2, CullPattern=expression)
cull_6 = CullPattern(List=move.Geometry, CullPattern=expression_2)
cir = Circle(Plane=pl_2, Radius=expression_4)
remap = RemapNumbers(Value=con_2.Rotation, Source="360", Target=Domain(0, 1))  # -> Mapped, Clipped
cir_2 = Circle(Plane=pl_3, Radius=expression_4)
cir_3 = Circle(Plane=pl_4, Radius=expression_4)
vdisex = VectorDisplayEx(Point=cull_2, Vector=cull_3, Colour=ColourSwatch(SwatchColor=RGB(252, 207, 5)), Width=W_2)
remap_2 = RemapNumbers(Value=con_2.Turn, Source="360", Target=Domain(0, 1))  # -> Mapped, Clipped
remap_3 = RemapNumbers(Value=con_2.Tilt, Source="360", Target=Domain(0, 1))  # -> Mapped, Clipped
vdisex_2 = VectorDisplayEx(Point=cull_6, Vector=cull_4, Colour=ColourSwatch(SwatchColor=RGB(126, 183, 127)), Width=W_2)
vdisex_3 = VectorDisplayEx(Point=cull, Vector=cull_5, Colour=ColourSwatch(SwatchColor=RGB(219, 190, 161)), Width=W_2)
expression_5 = Expression(x=con_2.Rotation, Expression="x≠0")
eval = EvaluateCurve(Curve=reparameterize(cir), Parameter="0")  # -> Point, Tangent, Angle
eval_2 = EvaluateCurve(Curve=reparameterize(cir), Parameter=remap.Mapped)  # -> Point, Tangent, Angle
expression_6 = Expression(x=con_2.Turn, Expression="x≠0")
expression_7 = Expression(x=con_2.Tilt, Expression="x≠0")
eval_3 = EvaluateCurve(Curve=reparameterize(cir_2), Parameter="0")  # -> Point, Tangent, Angle
eval_4 = EvaluateCurve(Curve=reparameterize(cir_3), Parameter="0")  # -> Point, Tangent, Angle
eval_5 = EvaluateCurve(Curve=reparameterize(cir_2), Parameter=remap_2.Mapped)  # -> Point, Tangent, Angle
eval_6 = EvaluateCurve(Curve=reparameterize(cir_3), Parameter=remap_3.Mapped)  # -> Point, Tangent, Angle
cull_7 = CullPattern(List=cir, CullPattern=expression_5)
cull_8 = CullPattern(List=eval.Point, CullPattern=expression_5)
cull_9 = CullPattern(List=eval_2.Point, CullPattern=expression_5)
cull_10 = CullPattern(List=cir_2, CullPattern=expression_6)
cull_11 = CullPattern(List=cir_3, CullPattern=expression_7)
cull_12 = CullPattern(List=eval_3.Point, CullPattern=expression_6)
cull_13 = CullPattern(List=eval_4.Point, CullPattern=expression_7)
cull_14 = CullPattern(List=eval_5.Point, CullPattern=expression_6)
cull_15 = CullPattern(List=eval_6.Point, CullPattern=expression_7)
circledim = CircularDimension(Circle=cull_7, PointA=cull_8, PointB=cull_9, Text="{0:0}°", Size=sc_2)
circledim_2 = CircularDimension(Circle=cull_10, PointA=cull_12, PointB=cull_14, Text="{0:0}°", Size=sc_2)
circledim_3 = CircularDimension(Circle=cull_11, PointA=cull_13, PointB=cull_15, Text="{0:0}°", Size=sc_2)

# ==== cluster PreviewDesign: Preview the pieces and connections of a design.
dn = ClusterInput()
ty = ClusterInput()
ob = ClusterInput()
sc = ClusterInput()
tags = ClusterInput()
dn_2 = Design(dn)
ty_2 = Type(ty)
ob_2 = Data(ob)
tags_2 = Tags(tags)
sc_2 = Number(sc)
pce_modified = PreviewPieces(dn=dn_2, ty=ty_2, ob=ob_2, tags=tags_2, sc=sc_2)
con = PreviewConnections_2(dn=dn_2, ty=ty_2, sc=sc_2)

# ==== cluster ProfiledWoodElements: Create an array of profiled wood elements.
baseplane = ClusterInput()
elementbreadth = ClusterInput()
elementcount = ClusterInput()
lengthelement = ClusterInput()
profiletype = ClusterInput()
innergrooves = ClusterInput()
profileheight = ClusterInput()
groovedepth = ClusterInput()
groovebreadth = ClusterInput()
tonguedepth = ClusterInput()
tonguebreadth = ClusterInput()
innergroovecount = ClusterInput()
innergroovebreadth = ClusterInput()
innergrooveheight = ClusterInput()
chamferdepth_radius = ClusterInput()
chamferangle = ClusterInput()
offset = ClusterInput()
offsetblockprofile = ClusterInput()
profileheight_2 = Number(profileheight)
groovedepth_2 = Number(groovedepth)
tonguedepth_2 = Number(tonguedepth)
tonguebreadth_2 = Number(tonguebreadth)
innergroovecount_2 = Number(innergroovecount)
innergroovebreadth_2 = Number(innergroovebreadth)
innergrooveheight_2 = Number(innergrooveheight)
chamferangle_2 = Number(chamferangle)
offset_2 = Number(offset)
offsetblockprofile_2 = Number(offsetblockprofile)
groovebreadth_2 = Number(groovebreadth)
chamferdepth_radius_2 = Number(chamferdepth_radius)
elementbreadth_2 = Number(elementbreadth)
lengthelement_2 = Number(lengthelement)
elementcount_2 = Integer(elementcount)
profiletype_2 = Integer(profiletype)
baseplane_2 = Plane(baseplane)
innergrooves_2 = Boolean(innergrooves)

# ----
# Originally script was built with another reference plane.
# Therefore the plane is moved and the seam later adjusted.
deplane = DeconstructPlane(Plane=baseplane_2)  # -> Origin, XAxis, YAxis, ZAxis
amp = Amplitude(Vector=deplane.YAxis, Amplitude=elementbreadth_2)
move = Move(Geometry=baseplane_2, Motion=amp)  # -> Geometry, Transform
deplane_2 = DeconstructPlane(Plane=move.Geometry)  # -> Origin, XAxis, YAxis, ZAxis
rev = Reverse(Vector=deplane_2.YAxis)

line = LineSDL(Start=deplane_2.Origin, Direction=rev, Length=elementbreadth_2)
expression = Expression(x=profileheight_2, y=groovebreadth_2, Expression="(x-y)/2")
expression_2 = Expression(x=profileheight_2, y=tonguebreadth_2, Expression="(x-y)/2")
end = EndPoints(Curve=line)  # -> Start, End
line_2 = LineSDL(Start=end.End, Direction=deplane_2.ZAxis, Length=expression)
line_3 = LineSDL(Start=end.Start, Direction=deplane_2.ZAxis, Length=expression_2)
end_2 = EndPoints(Curve=line_2)  # -> Start, End
end_3 = EndPoints(Curve=line_3)  # -> Start, End
line_4 = LineSDL(Start=end_2.End, Direction=rev, Length=expr("-x", groovedepth_2))
line_5 = LineSDL(Start=end_3.End, Direction=rev, Length=expr("-x", tonguedepth_2))
merge = Merge(Data1=line_3, Data2=line_5)
end_4 = EndPoints(Curve=line_4)  # -> Start, End
end_5 = EndPoints(Curve=line_5)  # -> Start, End
line_6 = LineSDL(Start=end_4.End, Direction=deplane_2.ZAxis, Length=groovebreadth_2)
federbasis = Curve(merge)
line_7 = LineSDL(Start=end_5.End, Direction=deplane_2.ZAxis, Length=tonguebreadth_2)
end_6 = EndPoints(Curve=line_7)  # -> Start, End
end_7 = EndPoints(Curve=line_6)  # -> Start, End
line_8 = LineSDL(Start=end_6.End, Direction=rev, Length=tonguedepth_2)
line_9 = LineSDL(Start=end_7.End, Direction=rev, Length=groovedepth_2)
end_8 = EndPoints(Curve=line_8)  # -> Start, End
end_9 = EndPoints(Curve=line_9)  # -> Start, End
line_10 = LineSDL(Start=end_8.End, Direction=deplane_2.ZAxis, Length=expression_2)
line_11 = LineSDL(Start=end_9.End, Direction=deplane_2.ZAxis, Length=expression)
end_10 = EndPoints(Curve=line_10)  # -> Start, End
end_11 = EndPoints(Curve=line_11)  # -> Start, End
merge_2 = Merge(Data1=line_7, Data2=line_8)
merge_3 = Merge(Data1=line_7, Data2=line_8, Data3=line_10)
ln = Line(StartPoint=end_10.End, EndPoint=end_11.End)
blockhausfederoberseite = Curve(merge_2)
simplefederoberseite = Curve(merge_3)
merge_4 = Merge(Data1=line_9, Data2=line_6, Data3=line_4, Data4=line_2)
rev_2 = ReverseList(List=merge_4)
flip = FlipCurve(Curve=merge_4)  # -> Curve, Flag
flip_2 = FlipCurve(Curve=line_11)  # -> Curve, Flag
nutbasis = Curve(flip.Curve)
merge_5 = Merge(Data1=flip_2.Curve, Data2=nutbasis)
einfachenut = Curve(merge_5)

expression_3 = Expression(x=elementbreadth_2, y=innergroovecount_2, z=innergroovebreadth_2, Expression="(x-z*y)/(y+1)")
line_12 = LineSDL(Start=deplane_2.Origin, Direction=rev, Length=expression_3)
end_12 = EndPoints(Curve=line_12)  # -> Start, End
line_13 = LineSDL(Start=end_12.End, Direction=deplane_2.ZAxis, Length=innergrooveheight_2)
end_13 = EndPoints(Curve=line_13)  # -> Start, End
line_14 = LineSDL(Start=end_13.End, Direction=rev, Length=innergroovebreadth_2)
end_14 = EndPoints(Curve=line_14)  # -> Start, End
line_15 = LineSDL(Start=end_14.End, Direction=deplane_2.ZAxis, Length=expr("-x", innergrooveheight_2))
merge_6 = Merge(Data1=line_12, Data2=line_13, Data3=line_14, Data4=line_15)
expression_4 = Expression(x=elementbreadth_2, y=innergroovecount_2, z=innergroovebreadth_2, Expression="(x-z*y)/(y+1)+z")
join = JoinCurves(Curves=merge_6, Preserve=False)
trim = TrimTree(Tree=join, Depth=1)
amp_2 = Amplitude(Vector=rev, Amplitude=expression_4)
flip_3 = FlipCurve(Curve=trim)  # -> Curve, Flag
arrlinear = LinearArray(Geometry=flip_3.Curve, Direction=amp_2, Count=innergroovecount_2)  # -> Geometry, Transform
trim_2 = TrimTree(Tree=arrlinear.Geometry, Depth=1)
join_2 = JoinCurves(Curves=trim_2, Preserve=False)
trim_3 = TrimTree(Tree=join_2, Depth=1)
end_15 = EndPoints(Curve=trim_3)  # -> Start, End
line_16 = LineSDL(Start=end_15.Start, Direction=rev, Length=expression_3)
merge_7 = Merge(Data1=line_16, Data2=trim_3)
join_3 = JoinCurves(Curves=merge_7, Preserve=False)
trim_4 = TrimTree(Tree=join_3, Depth=1)
innennut = StreamFilter(Gate=innergrooves_2, Stream0=line, Stream1=trim_4)
unterseite = Curve(innennut)

rad = Radians(Degrees=expr("x+90", chamferangle_2))
rad_2 = Radians(Degrees=expr("90-x", chamferangle_2))
expression_5 = Expression(x=profileheight_2, y=groovebreadth_2, z=offset_2, Expression="(x-y)/2+z")
rad_3 = Radians(Degrees=expr("90-x", chamferangle_2))
sin = Sine(Value=rad_2)
line_17 = LineSDL(Start=end_7.End, Direction=rev, Length=groovedepth_2)
line_18 = LineSDL(Start=end_6.End, Direction=rev, Length=expression_5)
rad_4 = Radians(Degrees=expr("90-x", chamferangle_2))
sin_2 = Sine(Value=rad_3)
vrot = Rotate(Vector=rev, Axis=deplane_2.XAxis, Angle=rad)
end_16 = EndPoints(Curve=line_17)  # -> Start, End
division = Division(A=expression, B=sin)
end_17 = EndPoints(Curve=line_18)  # -> Start, End
division_2 = Division(A=expression_2, B=sin_2)
vrot_2 = Rotate(Vector=rev, Axis=deplane_2.XAxis, Angle=rad_4)
line_19 = LineSDL(Start=end_16.End, Direction=vrot, Length=division)
line_20 = LineSDL(Start=end_17.End, Direction=vrot_2, Length=division_2)
flip_4 = FlipCurve(Curve=line_19)  # -> Curve, Flag
end_18 = EndPoints(Curve=line_20)  # -> Start, End
end_19 = EndPoints(Curve=flip_4.Curve)  # -> Start, End
ln_2 = Line(StartPoint=end_18.End, EndPoint=end_19.Start)
merge_8 = Merge(Data1=line_7, Data2=line_18)
merge_9 = Merge(Data2=line_20, Data3=ln_2, Data4=flip_4.Curve)
oberseitetrapez = Curve(merge_9)
fasenfederoberseite = Curve(merge_8)

expression_6 = Expression(x=profileheight_2, y=groovebreadth_2, z=chamferdepth_radius_2, Expression="(x-y)/2-z")
rad_5 = Radians(Degrees=expr("90-x", chamferangle_2))
rad_6 = Radians(Degrees=expr("x+90", chamferangle_2))
sin_3 = Sine(Value=rad_5)
expression_7 = Expression(x=profileheight_2, y=tonguebreadth_2, z=chamferdepth_radius_2, Expression="(x-y)/2-z")
line_21 = LineSDL(Start=end_16.End, Direction=deplane_2.ZAxis, Length=expression_6)
rad_7 = Radians(Degrees=expr("90-x", chamferangle_2))
end_20 = EndPoints(Curve=line_18)  # -> Start, End
division_3 = Division(A=chamferdepth_radius_2, B=sin_3)
flip_5 = FlipCurve(Curve=line_21)  # -> Curve, Flag
vrot_3 = Rotate(Vector=rev, Axis=deplane_2.XAxis, Angle=rad_6)
rad_8 = Radians(Degrees=expr("90-x", chamferangle_2))
sin_4 = Sine(Value=rad_7)
line_22 = LineSDL(Start=end_20.End, Direction=deplane_2.ZAxis, Length=expression_7)
end_21 = EndPoints(Curve=flip_5.Curve)  # -> Start, End
line_23 = LineSDL(Start=end_21.Start, Direction=vrot_3, Length=division_3)
division_4 = Division(A=chamferdepth_radius_2, B=sin_4)
vrot_4 = Rotate(Vector=rev, Axis=deplane_2.XAxis, Angle=rad_8)
end_22 = EndPoints(Curve=line_22)  # -> Start, End
flip_6 = FlipCurve(Curve=line_23)  # -> Curve, Flag
end_23 = EndPoints(Curve=flip_6.Curve)  # -> Start, End
line_24 = LineSDL(Start=end_22.End, Direction=vrot_4, Length=division_4)
end_24 = EndPoints(Curve=line_24)  # -> Start, End
ln_3 = Line(StartPoint=end_24.End, EndPoint=end_23.Start)
merge_10 = Merge(Data1=line_22, Data2=line_24, Data3=ln_3, Data4=flip_6.Curve, Data5=flip_5.Curve)
oberseitefase = Curve(merge_10)

merge_11 = Merge(Data1=line_9, Data2=line_6, Data3=line_4, Data4=line_2)

amp_3 = Amplitude(Vector=deplane_2.ZAxis, Amplitude=chamferdepth_radius_2)
amp_4 = Amplitude(Vector=rev, Amplitude=chamferdepth_radius_2)
amp_5 = Amplitude(Vector=rev, Amplitude=expr("-x", chamferdepth_radius_2))
amp_6 = Amplitude(Vector=deplane_2.ZAxis, Amplitude=chamferdepth_radius_2)
addition = Addition(A=amp_4, B=amp_3)
addition_2 = Addition(A=amp_5, B=amp_6)
move_2 = Move(Geometry=end_22.End, Motion=addition)  # -> Geometry, Transform
move_3 = Move(Geometry=end_21.Start, Motion=addition_2)  # -> Geometry, Transform
arc = ArcSED(Start=end_22.End, End=move_2.Geometry, Direction=deplane_2.ZAxis)  # -> Arc, Plane, Radius
arc_2 = ArcSED(Start=end_21.Start, End=move_3.Geometry, Direction=deplane_2.ZAxis)  # -> Arc, Plane, Radius
flip_7 = FlipCurve(Curve=arc_2.Arc)  # -> Curve, Flag
end_25 = EndPoints(Curve=arc.Arc)  # -> Start, End
end_26 = EndPoints(Curve=flip_7.Curve)  # -> Start, End
ln_4 = Line(StartPoint=end_25.End, EndPoint=end_26.Start)
merge_12 = Merge(Data1=line_22, Data2=arc.Arc, Data3=ln_4, Data4=flip_7.Curve, Data5=flip_5.Curve)
oberseitesoftline = Curve(merge_12)

vec2pt = Vector2Pt(PointA=end_8.End, PointB=end_11.End, Unitize=False)  # -> Vector, Length
angle = Angle(VectorA=vec2pt.Vector, VectorB=rev)  # -> Angle, Reflex
cos = Cosine(Value=angle.Angle)
division_5 = Division(A=tonguedepth_2, B=cos)
addition_3 = Addition(A=vec2pt.Length, B=division_5)
line_25 = LineSDL(Start=end_11.End, Direction=vec2pt.Vector, Length=expr("-x", addition_3))
flip_8 = FlipCurve(Curve=line_25)  # -> Curve, Flag
end_27 = EndPoints(Curve=flip_8.Curve)  # -> Start, End
ln_5 = Line(StartPoint=end_5.End, EndPoint=end_27.Start)
merge_13 = Merge(Data1=ln_5, Data2=flip_8.Curve)
oberseiteundfederdiagonal = Curve(merge_13)

expression_8 = Expression(x=profileheight_2, y=tonguebreadth_2, z=offsetblockprofile_2, Expression="(x-y)/2-z")
amp_7 = Amplitude(Vector=rev, Amplitude=expr("x/2", elementbreadth_2))
amp_8 = Amplitude(Vector=deplane_2.ZAxis, Amplitude=profileheight_2)
line_26 = LineSDL(Start=end_8.End, Direction=deplane_2.ZAxis, Length=expression_8)
addition_4 = Addition(A=amp_7, B=amp_8)
line_27 = LineSDL(Start=end_9.End, Direction=deplane_2.ZAxis, Length=expression_8)
flip_9 = FlipCurve(Curve=line_27)  # -> Curve, Flag
end_28 = EndPoints(Curve=line_26)  # -> Start, End
move_4 = Move(Geometry=deplane_2.Origin, Motion=addition_4)  # -> Geometry, Transform
end_29 = EndPoints(Curve=flip_9.Curve)  # -> Start, End
arc_3 = Arc3Pt(PointA=end_28.End, PointB=move_4.Geometry, PointC=end_29.Start)  # -> Arc, Plane, Radius
merge_14 = Merge(Data1=line_26, Data2=arc_3.Arc, Data3=flip_9.Curve)
oberseiteblockprofil = Curve(merge_14)

# ----
# Sadly the tangnet doesn't always point in the same direction.
# The join algorithm is not consistent
# and the forcing of the seam apparently has different rounding errors
# and sometimes y and sometimes the z tangent is the start tangent.
merge_15 = Merge(Data1=federbasis, Data2=fasenfederoberseite, Data3=oberseitefase, Data4=nutbasis)
merge_16 = Merge(Data1=federbasis, Data2=simplefederoberseite, Data3=ln, Data4=einfachenut)
merge_17 = Merge(Data1=federbasis, Data2=fasenfederoberseite, Data3=oberseitesoftline, Data4=nutbasis)
merge_18 = Merge(Data1=federbasis, Data2=fasenfederoberseite, Data3=oberseitetrapez, Data4=nutbasis)
merge_19 = Merge(Data1=federbasis, Data2=blockhausfederoberseite, Data3=oberseiteblockprofil, Data4=nutbasis)
merge_20 = Merge(Data1=federbasis, Data2=oberseiteundfederdiagonal, Data3=einfachenut)
fase = Curve(merge_15)
softline = Curve(merge_17)
blockhaus = Curve(merge_19)
trapez = Curve(merge_18)
diagonalprofile = Curve(merge_20)
simpleprofile = Curve(merge_16)
profil = StreamFilter(
    Gate=profiletype_2,
    Stream0=simpleprofile,
    Stream1=fase,
    Stream2=softline,
    Stream3=trapez,
    Stream4=blockhaus,
    Stream5=diagonalprofile)
join_4 = JoinCurves(Curves=profil, Preserve=True)
trim_5 = TrimTree(Tree=join_4, Depth=1)
merge_21 = Merge(Data1=trim_5, Data2=unterseite)
join_5 = JoinCurves(Curves=merge_21, Preserve=True)
trim_6 = TrimTree(Tree=join_5, Depth=1)
crv_cp = CurveClosestPoint(Point=deplane_2.Origin, Curve=trim_6)  # -> Point, Parameter, Distance
seam = Seam(Curve=trim_6, Seam=crv_cp.Parameter)
profiles = Curve(seam)

crv = Curve(seam)
end_30 = EndPoints(Curve=crv)  # -> Start, End
number_slider = Slider(3, range=0..10)
crv_cp_2 = CurveClosestPoint(Point=end_30.Start, Curve=crv)  # -> Point, Parameter, Distance
eval = EvaluateCurve(Curve=crv, Parameter=crv_cp_2.Parameter)  # -> Point, Tangent, Angle
points = PointList(Points=flatten(end_30.Start), Size=number_slider)
vdisex = VectorDisplayEx(Point=end_30.Start, Vector=eval.Tangent, Colour=RGB(179, 255, 38), Width=number_slider)

amp_9 = Amplitude(Vector=deplane_2.XAxis, Amplitude=lengthelement_2)
extr = Extrude(Base=profiles, Direction=amp_9)
cap = CapHoles(Brep=extr)
amp_10 = Amplitude(Vector=deplane_2.YAxis, Amplitude=elementbreadth_2)
arrlinear_2 = LinearArray(Geometry=cap, Direction=amp_10, Count=elementcount_2)  # -> Geometry, Transform
trim_7 = TrimTree(Tree=arrlinear_2.Geometry, Depth=1)
profilewood = Brep(trim_7)

profilewood_2 = ClusterOutput(profilewood)

# ==== cluster SelectRoot: Select a root piece. A piece is a root when it has a plane (and a center).
pc = ClusterInput()
pc_2 = Piece(pc)
lng = ListLength(List=pc_2)
pce = ModelPiece(Piece=pc_2)  # -> Piece, Valid, Id, Description, TypeName, TypeVariant, Plane, Center, Qualities
series = Series(Start=0, Step=1, Count=lng)
trim = TrimTree(Tree=series, Depth=1)
null = NullItem(Item=pce.Plane)  # -> NullFlags, InvalidFlags, Description
dispatch = Dispatch(List=pc_2, DispatchPattern=null.NullFlags)  # -> ListA, ListB
dispatch_2 = Dispatch(List=trim, DispatchPattern=null.NullFlags)  # -> ListA, ListB
ro = Piece(dispatch.ListB)
i = Integer(dispatch_2.ListB)
ro_2 = ClusterOutput(ro)
i_2 = ClusterOutput(i)

# ==== cluster SelectPiece: Select a piece with the id.
pc = ClusterInput()
id = ClusterInput()
id_2 = Id(graft(id))
pc_2 = Piece(pc)
lng = ListLength(List=pc_2)
pce = ModelPiece(Piece=pc_2)  # -> Piece, Valid, Id, Description, TypeName, TypeVariant, Plane, Center, Qualities
series = Series(Start=0, Step=1, Count=lng)
expression = Expression(x=pce.Id, y=id_2, Expression="x=y")
trim = TrimTree(Tree=series, Depth=1)
cull = CullPattern(List=pce.Piece, CullPattern=expression)
cull_2 = CullPattern(List=trim, CullPattern=expression)
trim_2 = TrimTree(Tree=cull_2, Depth=1)
trim_3 = TrimTree(Tree=cull, Depth=1)
pc_3 = Piece(trim_3)
i = Integer(trim_2)
pc_4 = ClusterOutput(pc_3)
i_2 = ClusterOutput(i)

# ==== cluster SelectPort: Select a port with the id. If no port matches, null is returned.
po = ClusterInput()
id = ClusterInput()
id_2 = Id(graft(id))
po_2 = Port(po)
lng = ListLength(List=po_2)
por = ModelPort(Port=po_2)  # -> Port, Valid, Id, Description, Family, CompatibleFamilies, Point, Direction, T, Qualities
series = Series(Start=0, Step=1, Count=lng)
trim = TrimTree(Tree=series, Depth=1)
expression = Expression(x=por.Id, y=id_2, Expression="x=y")
cull = CullPattern(List=po_2, CullPattern=expression)
cull_2 = CullPattern(List=trim, CullPattern=expression)
nulltobranch = AddNullToEmptyBranch(D=cull_2)  # -> R; inputs D: tree
# ---------- nulltobranch: C# ----------
#region Usings
using System;
using System.Linq;
using System.Collections;
using System.Collections.Generic;
using System.Drawing;

using Rhino;
using Rhino.Geometry;

using Grasshopper;
using Grasshopper.Kernel;
using Grasshopper.Kernel.Data;
using Grasshopper.Kernel.Types;
#endregion

public class Script_Instance : GH_ScriptInstance
{

    private void RunScript(DataTree<object> D, ref object R)
    {
        foreach (GH_Path path in D.Paths)
            if (D.Branch(path).Count == 0)
                D.Add(null, path);

        R = D;
    }
}
# ---------- end nulltobranch ----------
nulltobranch_2 = AddNullToEmptyBranch(D=cull)  # -> R; inputs D: tree; same code as nulltobranch
trim_2 = TrimTree(Tree=nulltobranch, Depth=1)
trim_3 = TrimTree(Tree=nulltobranch_2, Depth=1)
i = Integer(trim_2)
po_3 = Port(trim_3)
i_2 = ClusterOutput(i)
po_4 = ClusterOutput(po_3)

# ==== cluster SelectTypeByPiece: Select the type of a piece.
ty = ClusterInput()
pc = ClusterInput()
pc_2 = Piece(graft(pc))
ty_2 = Type(ty)
pce = ModelPiece(Piece=pc_2)  # -> Piece, Valid, Id, Description, TypeName, TypeVariant, Plane, Center, Qualities
typ = SelectType(ty=ty_2, na=pce.TypeName, variant=pce.TypeVariant)  # -> ty_4, i_2
trim = TrimTree(Tree=typ.ty_4, Depth=1)
trim_2 = TrimTree(Tree=typ.i_2, Depth=1)
ty_3 = Type(trim)
i = Integer(trim_2)
ty_4 = ClusterOutput(ty_3)
i_2 = ClusterOutput(i)

# ==== cluster SelectConnection: Select a connection with the connected id and the connecting id. The connections are symetric, so if the conected is the connecting and vice versa it will still selct them.
co = ClusterInput()
cdpc = ClusterInput()
cgpc = ClusterInput()
cdpc_2 = ConnectedPieceId(graft(cdpc))
cgpc_2 = ConnectingPieceId(graft(cgpc))
co_2 = Connection(co)
con = ModelConnection(Connection=co_2)  # -> Connection, Valid, ConnectedPieceId, ConnectedPieceTypePortId, ConnectingPieceId, ConnectingPieceTypePortId, Description, Gap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
expression = Expression(x=con.ConnectedPieceId, y=cdpc_2, Expression="x=y")
expression_2 = Expression(x=con.ConnectedPieceId, y=cgpc_2, Expression="x=y")
expression_3 = Expression(x=con.ConnectingPieceId, y=cgpc_2, Expression="x=y")
expression_4 = Expression(x=con.ConnectingPieceId, y=cdpc_2, Expression="x=y")
lng = ListLength(List=co_2)
series = Series(Start=0, Step=1, Count=lng)
and = GateAnd(A=expression, B=expression_3)
and_2 = GateAnd(A=expression_2, B=expression_4)
trim = TrimTree(Tree=series, Depth=1)
or = GateOr(A=and, B=and_2)
not = GateNot(A=and)
cull = CullPattern(List=con.Connection, CullPattern=or)
and_3 = GateAnd(A=not, B=and_2)
cull_2 = CullPattern(List=trim, CullPattern=or)
nulltobranch = AddNullToEmptyBranch(D=cull)  # -> R; inputs D: tree; same code as nulltobranch
nulltobranch_2 = AddNullToEmptyBranch(D=cull_2)  # -> R; inputs D: tree; same code as nulltobranch
ma = MassAddition(Input=and_3)  # -> Result, PartialResults
trim_2 = TrimTree(Tree=nulltobranch, Depth=1)
trim_3 = TrimTree(Tree=nulltobranch_2, Depth=1)
trim_4 = TrimTree(Tree=ma.Result, Depth=1)
co_3 = Connection(trim_2)
fl = Boolean(trim_4)
i = Integer(trim_3)
co_4 = ClusterOutput(co_3)
fl_2 = ClusterOutput(fl)
i_2 = ClusterOutput(i)

# ==== cluster PreviewPort: Preview a port by showing the point and direction and if exists: id, family and compatible families.
po = ClusterInput()
W = ClusterInput()
W_2 = Width(W)
po_2 = Port(po)
swatch = ColourSwatch(SwatchColor=RGB(235, 52, 79))
swatch_2 = ColourSwatch(SwatchColor=RGB(250, 149, 0))
por = ModelPort(Port=po_2)  # -> Port, Valid, Id, Description, Family, CompatibleFamilies, Point, Direction, Locators, T
lng = ListLength(List=por.CompatibleFamilies)
expression = Expression(x=por.Family, Expression="x=\"\"")
cull = CullPattern(List=por.Point, CullPattern=expression)
expression_2 = Expression(x=lng, Expression="x=0")
join = TextJoin(Text=por.CompatibleFamilies, Join=",")
merge = Merge(Data1=":")
trim = TrimTree(Tree=join, Depth=1)
trim_2 = TrimTree(Tree=expression_2, Depth=1)
item = ListItem(List=merge, Index=expression, Wrap=invert(True))
concat = Concatenate(FragmentA="[", FragmentB=trim, FragmentC="]")
expression_3 = Expression(y=trim_2, Expression="x")
merge_2 = Merge(Data1=graft(concat), Data2=graft(expression_3))
item_2 = ListItem(List=merge_2, Index=graft(expression), Wrap=invert(True))
trim_3 = TrimTree(Tree=item_2, Depth=1)
concat_2 = Concatenate(FragmentA=por.Id, FragmentB=item, FragmentC=por.Family, FragmentD=trim_3)
vdisex = VectorDisplayEx(Point=por.Point, Vector=por.Direction, Colour=ColourSwatch(SwatchColor=RGB(0, 166, 157)), Width=W_2)
preview = CustomPreview(Geometry=cull, Material=swatch)
tag = TextTag(Location=por.Point, Text=concat_2, Colour=swatch)

# ==== cluster PreviewConnections_2: Preview all connections of a design by visualizing the ports of the types and the connection parameters.
dn = ClusterInput()
ty = ClusterInput()
sc = ClusterInput()
sc_2 = Number(sc)
dn_2 = Design(dn)
ty_2 = Type(ty)
fltdsn = FlattenDesign(Design=dn_2, Types=ty_2)
dsn = ModelDesign(Design=fltdsn)  # -> Design, Valid, Name, Description, Icon, Image, Variant, View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
dsn_2 = ModelDesign(Design=dn_2)  # -> Design, Valid, Name, Description, Icon, Image, Variant, View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
trim = TrimTree(Tree=dsn.Pieces, Depth=1)
trim_2 = TrimTree(Tree=dsn_2.Connections, Depth=1)
trim_3 = TrimTree(Tree=dsn_2.Pieces, Depth=1)
roo = SelectRoot(pc=trim_3)  # -> ro_2, i_2
null = NullItem(Item=roo.i_2)  # -> NullFlags, InvalidFlags, Description
filter = StreamFilter(Gate=null.NullFlags, Stream0=roo.i_2, Stream1="0")
cull_i = CullIndex(List=trim, Indices=filter, Wrap=True)
pce = ModelPiece(Piece=cull_i)  # -> Piece, Valid, Id, Description, TypeName, TypeVariant, Plane, Center, Qualities
panel = Panel("semio.parent")
qal = ModelQuality(Quality=pce.Qualities)  # -> Quality, Valid, Name, Value, Unit, Definition
trim_4 = TrimTree(Tree=qal.Value, Depth=1)
pce_2 = SelectPiece(pc=trim, id=trim_4)  # -> pc_4, i_2
con = SelectConnection(co=trim_2, cdpc=trim_4, cgpc=pce.Id)  # -> co_4, i_2, fl_2
co = Connection(con.co_4)
parent = Piece(pce_2.pc_4)
child = Piece(cull_i)
pce_3 = ModelPiece(Piece=parent)  # -> Piece, Valid, Id, Description, TypeName, TypeVariant, Plane, Center, Qualities
con_2 = ModelConnection(Connection=co)  # -> Connection, Valid, ConnectedPieceId, ConnectedPieceTypePortId, ConnectingPieceId, ConnectingPieceTypePortId, Description, Gap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
pce_4 = ModelPiece(Piece=child)  # -> Piece, Valid, Id, Description, TypeName, TypeVariant, Plane, Center, Qualities
typ = SelectTypeByPiece(ty=ty_2, pc=pce_3.Piece)  # -> ty_4, i_2
typ_2 = SelectTypeByPiece(ty=ty_2, pc=pce_4.Piece)  # -> ty_4, i_2
merge = Merge(Data1=graft(con_2.ConnectedPieceTypePortId), Data2=graft(con_2.ConnectingPieceTypePortId))
merge_2 = Merge(Data1=graft(con_2.ConnectingPieceTypePortId), Data2=graft(con_2.ConnectedPieceTypePortId))
typ_3 = ModelType(Type=typ.ty_4)  # -> Type, Valid, Name, Description, Icon, Image, Variant, Unit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
typ_4 = ModelType(Type=typ_2.ty_4)  # -> Type, Valid, Name, Description, Icon, Image, Variant, Unit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
item = ListItem(List=merge, Index=graft(con.fl_2), Wrap=True)
item_2 = ListItem(List=merge_2, Index=graft(con.fl_2), Wrap=True)
por = SelectPort(po=typ_3.Ports, id=item)  # -> po_4, i_2
por_2 = SelectPort(po=typ_4.Ports, id=item_2)  # -> po_4, i_2
deplane = DeconstructPlane(Plane=pce_4.Plane)  # -> Origin, XAxis, YAxis, ZAxis
orient = Orient(Source=PlaneXY(0, 0, 0), Target=pce_4.Plane)  # -> Geometry, Transform
orient_2 = Orient(Source=PlaneXY(0, 0, 0), Target=pce_3.Plane)  # -> Geometry, Transform
trim_5 = TrimTree(Tree=por.po_4, Depth=1)
trim_6 = TrimTree(Tree=por_2.po_4, Depth=1)
Y = UnitY(Factor=1)
c_script = CSharpScript(X=orient.Transform)  # -> T, R, I; inputs X: Transform; same code as c_script
c_script_2 = CSharpScript(X=orient_2.Transform)  # -> T, R, I; inputs X: Transform; same code as c_script
Z = UnitZ(Factor=1)
rotate = RotateDirection(Center=Point(0, 0, 0), From=Y, To=deplane.YAxis)  # -> Geometry, Transform
parent_po = Port(trim_5)
child_po = Port(trim_6)
por_3 = ModelPort(Port=parent_po)  # -> Port, Valid, Id, Description, Family, CompatibleFamilies, Point, Direction, T, Qualities
por_4 = ModelPort(Port=child_po)  # -> Port, Valid, Id, Description, Family, CompatibleFamilies, Point, Direction, T, Qualities
deplane_2 = DeconstructPlane(Plane=pce_3.Plane)  # -> Origin, XAxis, YAxis, ZAxis
transform = Transform(Geometry=por_3.Direction, Transform=c_script_2.R)
transform_2 = Transform(Geometry=por_3.Point, Transform=orient_2.Transform)
transform_3 = Transform(Geometry=por_4.Point, Transform=orient.Transform)
transform_4 = Transform(Geometry=por_4.Direction, Transform=c_script.R)
Y_2 = UnitY(Factor=1)
por_5 = ModelPort(Port=por_3.Port, Point=transform_2, Direction=transform)  # -> Port, Valid, Id, Description, Family, CompatibleFamilies, Point, Direction, T, Qualities
por_6 = ModelPort(Port=por_4.Port, Point=transform_3, Direction=transform_4)  # -> Port, Valid, Id, Description, Family, CompatibleFamilies, Point, Direction, T, Qualities
transform_5 = Transform(Geometry=Z, Transform=c_script_2.R)
transform_6 = Transform(Geometry=Y_2, Transform=c_script_2.R)
expression = Expression(x=transform_6, y=por_5.Direction, Expression="x")
prv = PreviewPort_2(po=por_5.Port, sc=sc_2)
prv_2 = PreviewPort_2(po=por_6.Port, sc=sc_2)
ln = Line(StartPoint=por_5.Point, EndPoint=por_6.Point)
merge_3 = Merge(Data1=graft(transform_5), Data2=graft(expression))
expression_2 = Expression(x=transform, y=por_5.Direction, Expression="x=y")
preview = CustomPreview(Geometry=ln, Material=ColourSwatch(SwatchColor=RGB(250, 149, 0)))
pl = ConstructPlane(Origin=por_5.Point, XAxis=Z, YAxis=por_5.Direction)
item_3 = ListItem(List=merge_3, Index=graft(expression_2), Wrap=True)
log = Logarithm(Value=sc_2)
expression_3 = Expression(x=con_2.Raise, Expression="x≠0")
expression_4 = Expression(x=con_2.Shift, Expression="x≠0")
expression_5 = Expression(x=con_2.Gap, Expression="x≠0")
deplane_3 = DeconstructPlane(Plane=pl)  # -> Origin, XAxis, YAxis, ZAxis
rev = Reverse(Vector=deplane_3.ZAxis)
pl_2 = ConstructPlane(Origin=por_6.Point, XAxis=rev, YAxis=deplane_3.XAxis)
rev_2 = Reverse(Vector=deplane_3.ZAxis)
expression_6 = Expression(x=sc_2, Expression="x/2")
prot = RotatePlane(Plane=pl_2, Angle=degrees(con_2.Rotation))
deplane_4 = DeconstructPlane(Plane=prot)  # -> Origin, XAxis, YAxis, ZAxis
rev_3 = Reverse(Vector=deplane_4.ZAxis)
pl_3 = ConstructPlane(Origin=deplane_4.Origin, XAxis=deplane_4.XAxis, YAxis=rev_3)
prot_2 = RotatePlane(Plane=pl_3, Angle=degrees(con_2.Turn))
deplane_5 = DeconstructPlane(Plane=prot_2)  # -> Origin, XAxis, YAxis, ZAxis
rev_4 = Reverse(Vector=deplane_5.ZAxis)
pl_4 = ConstructPlane(Origin=deplane_5.Origin, XAxis=deplane_5.YAxis, YAxis=deplane_5.ZAxis)
multiplication = Multiplication(A=log, B=Slider(2, range=0..10))
trim_7 = TrimTree(Tree=item_3, Depth=1)
amp = Amplitude(Vector=rev_2, Amplitude=con_2.Shift)
amp_2 = Amplitude(Vector=deplane_3.XAxis, Amplitude=con_2.Raise)
amp_3 = Amplitude(Vector=por_5.Direction, Amplitude=con_2.Gap)
move = Move(Geometry=por_5.Point, Motion=amp_3)  # -> Geometry, Transform
move_2 = Move(Geometry=move.Geometry, Motion=amp)  # -> Geometry, Transform
swatch = ColourSwatch(SwatchColor=RGB(219, 190, 161))
swatch_2 = ColourSwatch(SwatchColor=RGB(0, 0, 0))
swatch_3 = ColourSwatch(SwatchColor=RGB(252, 207, 5))
swatch_4 = ColourSwatch(SwatchColor=RGB(126, 183, 127))
rotate_2 = Rotate(Angle=degrees(con_2.Turn), Plane=PlaneXY(0, 0, 0))  # -> Geometry, Transform
cull = CullPattern(List=move_2.Geometry, CullPattern=expression_3)
cull_2 = CullPattern(List=por_5.Point, CullPattern=expression_5)
cull_3 = CullPattern(List=amp_3, CullPattern=expression_5)
cull_4 = CullPattern(List=amp, CullPattern=expression_4)
cull_5 = CullPattern(List=amp_2, CullPattern=expression_3)
cull_6 = CullPattern(List=move.Geometry, CullPattern=expression_4)
cir = Circle(Plane=pl_2, Radius=expression_6)
remap = RemapNumbers(Value=con_2.Rotation, Source="360", Target=Domain(0, 1))  # -> Mapped, Clipped
cir_2 = Circle(Plane=pl_3, Radius=expression_6)
cir_3 = Circle(Plane=pl_4, Radius=expression_6)
remap_2 = RemapNumbers(Value=con_2.Turn, Source="360", Target=Domain(0, 1))  # -> Mapped, Clipped
remap_3 = RemapNumbers(Value=con_2.Tilt, Source="360", Target=Domain(0, 1))  # -> Mapped, Clipped
vdisex = VectorDisplayEx(Point=cull_2, Vector=cull_3, Colour=swatch_3, Width=multiplication)
vdisex_2 = VectorDisplayEx(Point=cull_6, Vector=cull_4, Colour=swatch_4, Width=multiplication)
vdisex_3 = VectorDisplayEx(Point=cull, Vector=cull_5, Colour=swatch, Width=multiplication)
expression_7 = Expression(x=con_2.Rotation, Expression="x≠0")
eval = EvaluateCurve(Curve=reparameterize(cir), Parameter="0")  # -> Point, Tangent, Angle
eval_2 = EvaluateCurve(Curve=reparameterize(cir), Parameter=remap.Mapped)  # -> Point, Tangent, Angle
expression_8 = Expression(x=con_2.Turn, Expression="x≠0")
expression_9 = Expression(x=con_2.Tilt, Expression="x≠0")
eval_3 = EvaluateCurve(Curve=reparameterize(cir_2), Parameter="0")  # -> Point, Tangent, Angle
eval_4 = EvaluateCurve(Curve=reparameterize(cir_3), Parameter="0")  # -> Point, Tangent, Angle
eval_5 = EvaluateCurve(Curve=reparameterize(cir_2), Parameter=remap_2.Mapped)  # -> Point, Tangent, Angle
eval_6 = EvaluateCurve(Curve=reparameterize(cir_3), Parameter=remap_3.Mapped)  # -> Point, Tangent, Angle
expression_10 = Expression(x=amp_3, Expression="x/2")
expression_11 = Expression(x=amp, Expression="x/2")
expression_12 = Expression(x=amp_2, Expression="x/2")
cull_7 = CullPattern(List=cir, CullPattern=expression_7)
cull_8 = CullPattern(List=eval.Point, CullPattern=expression_7)
cull_9 = CullPattern(List=eval_2.Point, CullPattern=expression_7)
cull_10 = CullPattern(List=cir_2, CullPattern=expression_8)
cull_11 = CullPattern(List=cir_3, CullPattern=expression_9)
cull_12 = CullPattern(List=eval_3.Point, CullPattern=expression_8)
cull_13 = CullPattern(List=eval_4.Point, CullPattern=expression_9)
cull_14 = CullPattern(List=eval_5.Point, CullPattern=expression_8)
cull_15 = CullPattern(List=eval_6.Point, CullPattern=expression_9)
move_3 = Move(Geometry=por_5.Point, Motion=expression_10)  # -> Geometry, Transform
move_4 = Move(Geometry=move.Geometry, Motion=expression_11)  # -> Geometry, Transform
move_5 = Move(Geometry=move_2.Geometry, Motion=expression_12)  # -> Geometry, Transform
concat = Concatenate(FragmentA=con_2.Gap, FragmentC=" ", FragmentB=dsn_2.Unit)
concat_2 = Concatenate(FragmentA=con_2.Gap, FragmentC=" ", FragmentB=dsn_2.Unit)
concat_3 = Concatenate(FragmentA=con_2.Raise, FragmentC=" ", FragmentB=dsn_2.Unit)
circledim = CircularDimension(Circle=cull_7, PointA=cull_8, PointB=cull_9, Text="{0:0}°", Size=sc_2)
circledim_2 = CircularDimension(Circle=cull_10, PointA=cull_12, PointB=cull_14, Text="{0:0}°", Size=sc_2)
circledim_3 = CircularDimension(Circle=cull_11, PointA=cull_13, PointB=cull_15, Text="{0:0}°", Size=sc_2)
cull_16 = CullPattern(List=move_3.Geometry, CullPattern=expression_5)
cull_17 = CullPattern(List=concat, CullPattern=expression_5)
cull_18 = CullPattern(List=move_4.Geometry, CullPattern=expression_5)
cull_19 = CullPattern(List=concat_2, CullPattern=expression_5)
cull_20 = CullPattern(List=move_5.Geometry, CullPattern=expression_3)
cull_21 = CullPattern(List=concat_3, CullPattern=expression_3)
tag = TextTag(Location=cull_16, Text=cull_17, Colour=swatch_3)
tag_2 = TextTag(Location=cull_18, Text=cull_19, Colour=swatch_4)
tag_3 = TextTag(Location=cull_20, Text=cull_21, Colour=swatch)

# ==== cluster PreviewPieces: Preview pieces in a design. Use tags to select matching representations of the types of the pieces.
dn = ClusterInput()
ty = ClusterInput()
ob = ClusterInput()
sc = ClusterInput()
tags = ClusterInput()
dn_2 = Design(graft(dn))
ty_2 = Type(ty)
lng = ListLength(List=ty_2)
ob_2 = Data(ob)
tstat = TreeStatistics(Tree=ob_2)  # -> Paths, Length, Count
trim = TrimTree(Tree=ob_2, Depth=1)
item = ListItem(List=tstat.Length, Index=0, Wrap=True)
lng_2 = ListLength(List=tstat.Paths)
lng_3 = ListLength(List=trim)
lng_4 = ListLength(List=trim)
sc_2 = Number(sc)
tags_2 = Tags(tags)
trim_2 = TrimTree(Tree=lng_4, Depth=1)
null = NullItem(Item=trim_2)  # -> NullFlags, InvalidFlags, Description
fltdsn = FlattenDesign(Design=dn_2, Type=ty_2)
item_2 = ListItem(List=null.NullFlags, Index=0, Wrap=True)
item_3 = ListItem(List=trim_2, Index=0, Wrap=True)
dsn = ModelDesign(Design=fltdsn)  # -> Design, Valid, Name, Description, Icon, Image, Variant, View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
trim_3 = TrimTree(Tree=dsn.Pieces, Depth=1)
filter = StreamFilter(Gate=item_2, Stream0=item_3, Stream1=lng_3)
null_2 = NullItem(Item=filter)  # -> NullFlags, InvalidFlags, Description
typ = SelectTypeByPiece(ty=ty_2, pc=trim_3)  # -> ty_4, i_2
typ_2 = ModelType(Type=typ.ty_4)  # -> Type, Valid, Name, Description, Icon, Image, Variant, Unit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
object = ModelObject(Object=ob_2)  # -> Object, Geometry, Name, Layer, Visibility, Display, Drafting, Render
filter_2 = StreamFilter(Gate=null_2.NullFlags, Stream0=filter, Stream1=lng)
expression = Expression(x=lng_2, y=item, z=lng, u=filter_2, Expression="If((x=1)and(y=1)and(z=1),0,If((x=1)and(y=z),1,If((x=z)and(u=z),2,3)))")
lng_5 = ListLength(List=typ_2.Representations)
rep = SelectRepresentation(rp=typ_2.Representations, tags=tags_2)  # -> rp_4, i_2
group = Group(Geometry=object.Geometry)
expression_2 = Expression(x="0", y=typ.ty_4, Expression="x")
trim_4 = TrimTree(Tree=lng_5, Depth=1)
merge = Merge(Data1=graft(expression_2), Data2=graft(rep.i_2))
trim_5 = TrimTree(Tree=group, Depth=1)
group_2 = Group(Geometry=trim_5)
trim_6 = TrimTree(Tree=group_2, Depth=1)
expression_3 = Expression(x=trim_4, Expression="x=0")
filter_3 = StreamFilter(Gate=expression, Stream0=ob_2, Stream1=object.Geometry, Stream2=trim_5, Stream3=trim_6)
item_4 = ListItem(List=filter_3, Index=typ.i_2, Wrap=True)
ungroup = Ungroup(Group=item_4)
filter_4 = StreamFilter(Gate=expression, Stream0=item_4, Stream1=ungroup, Stream2=ungroup, Stream3=ungroup)
bool = Boolean(invert(graft(expression_3)))
item_5 = ListItem(List=merge, Index=bool, Wrap=True)
i = Integer(item_5)
pce = ModelPiece(Piece=dsn.Pieces)  # -> Piece, Valid, Id, Description, TypeName, TypeVariant, Plane, Center, Qualities
item_6 = ListItem(List=filter_4, Index=i, Wrap=True)
trim_7 = TrimTree(Tree=item_6, Depth=1)
orient = Orient(Geometry=trim_7, Source=PlaneXY(0, 0, 0), Target=pce.Plane)  # -> Geometry, Transform
geo_modified = PreviewGeometry(geo=orient.Geometry, sc=sc_2)

# ==== cluster SelectType: Select a type with a name and an optional variant. If no variant is provided it will select all variants. If you want to select the default type then use the empty text.
ty = ClusterInput()
na = ClusterInput()
variant = ClusterInput()
na_2 = Name(na)
variant_2 = Variant(variant)
ty_2 = Type(ty)
typ = ModelType(Type=ty_2)  # -> Type, Valid, Name, Description, Icon, Image, Variant, Unit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
expression = Expression(x=typ.Name, y=na_2, Expression="x=y")
cull = CullPattern(List=typ.Type, CullPattern=expression)
typ_2 = ModelType(Type=cull)  # -> Type, Valid, Name, Description, Icon, Image, Variant, Unit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
expression_2 = Expression(x=typ_2.Variant, y=variant_2, Expression="x=y")
txt = Text(ty_2)
cull_2 = CullPattern(List=typ_2.Type, CullPattern=expression_2)
null = NullItem(Item=variant_2)  # -> NullFlags, InvalidFlags, Description
filter = StreamFilter(Gate=null.NullFlags, Stream0=cull_2, Stream1=cull)
txt_2 = Text(filter)
mindex = MemberIndex(Set=txt, Member=txt_2)  # -> Index, Count
trim = TrimTree(Tree=mindex.Index, Depth=1)
ty_3 = Type(filter)
i = Integer(trim)
ty_4 = ClusterOutput(ty_3)
i_2 = ClusterOutput(i)

# ==== cluster PreviewPort_2: Preview a port by showing the point and direction and if exists: id, family and compatible families.
po = ClusterInput()
sc = ClusterInput()
sc_2 = Number(sc)
po_2 = Port(po)
swatch = ColourSwatch(SwatchColor=RGB(235, 52, 79))
swatch_2 = ColourSwatch(SwatchColor=RGB(250, 149, 0))
por = ModelPort(Port=po_2)  # -> Port, Valid, Id, Description, Family, CompatibleFamilies, Point, Direction, Locators, T
amp = Amplitude(Vector=por.Direction, Amplitude=sc_2)
lng = ListLength(List=por.CompatibleFamilies)
expression = Expression(x=por.Family, Expression="x=\"\"")
cull = CullPattern(List=por.Point, CullPattern=expression)
expression_2 = Expression(x=lng, Expression="x=0")
join = TextJoin(Text=por.CompatibleFamilies, Join=",")
merge = Merge(Data1=":")
trim = TrimTree(Tree=join, Depth=1)
trim_2 = TrimTree(Tree=expression_2, Depth=1)
item = ListItem(List=merge, Index=expression, Wrap=invert(True))
log = Logarithm(Value=sc_2)
concat = Concatenate(FragmentA="[", FragmentB=trim, FragmentC="]")
expression_3 = Expression(y=trim_2, Expression="x")
merge_2 = Merge(Data1=graft(concat), Data2=graft(expression_3))
item_2 = ListItem(List=merge_2, Index=graft(expression), Wrap=invert(True))
multiplication = Multiplication(A=log, B=Slider(2, range=0..10))
trim_3 = TrimTree(Tree=item_2, Depth=1)
concat_2 = Concatenate(FragmentA=por.Id, FragmentB=item, FragmentC=por.Family, FragmentD=trim_3)
preview = CustomPreview(Geometry=cull, Material=swatch)
tag = TextTag(Location=por.Point, Text=concat_2, Colour=swatch)
vdisex = VectorDisplayEx(Point=por.Point, Vector=amp, Colour=ColourSwatch(SwatchColor=RGB(0, 166, 157)), Width=multiplication)

# ==== cluster PreviewGeometry: Preview geometry by ungrouping everything, showing light surfaces and dark edges.
sc = ClusterInput()
geo = ClusterInput()
geo_2 = Geometry(flatten(geo))
sc_2 = Number(sc)
swatch = ColourSwatch(SwatchColor=RGBA(0, 0, 0, 64))
swatch_2 = ColourSwatch(SwatchColor=RGBA(255, 255, 255, 64))
ungroup = Ungroup(Group=geo_2)
clean = CleanTree(RemoveNulls=True, RemoveInvalid=True, RemoveEmpty=invert(False), Tree=ungroup)  # -> flatten(Tree)
multiplication = Multiplication(A=sc_2, B=Slider(0.03, range=0..1))
linetype = ModelLinetype(Name="semio", Width=multiplication)  # -> ModelLinetype, Name, Segments, CapStyle, JoinStyle, Width, WidthUnits, TaperWidths, TaperPositions
dispatch = CSharpScript(D=clean)  # -> P, C, B, M, R
# ---------- dispatch: C# ----------
// Grasshopper Script Instance
#region Usings
using System;
using System.Linq;
using System.Collections;
using System.Collections.Generic;
using System.Drawing;

using Rhino;
using Rhino.Geometry;

using Grasshopper;
using Grasshopper.Kernel;
using Grasshopper.Kernel.Data;
using Grasshopper.Kernel.Types;
#endregion

public class Script_Instance : GH_ScriptInstance
{
    #region Notes
    /* 
      Members:
        RhinoDoc RhinoDocument
        GH_Document GrasshopperDocument
        IGH_Component Component
        int Iteration

      Methods (Virtual & overridable):
        Print(string text)
        Print(string format, params object[] args)
        Reflect(object obj)
        Reflect(object obj, string method_name)
    */
    #endregion

    private void RunScript(
	object D,
	ref object P,
	ref object C,
	ref object B,
	ref object M,
	ref object R)
    {
        if (D is Curve) C = D; // Curve
        else if (
            D is Rhino.Geometry.Point ||
            D is PointCloud
            )
            P = D; // Point
        else if ( D is Mesh) M = D; // Mesh
        else if (
            D is Surface ||
            D is Extrusion ||
            D is SubD ||
            D is Brep
            )
            B = D; // Brep
        else R = D; // Rest
            
    }
}
# ---------- end dispatch ----------
clean_2 = CleanTree(RemoveNulls=True, RemoveInvalid=True, RemoveEmpty=False, Tree=dispatch.M)
clean_3 = CleanTree(RemoveNulls=True, RemoveInvalid=True, RemoveEmpty=False, Tree=dispatch.R)
clean_4 = CleanTree(RemoveNulls=True, RemoveInvalid=True, RemoveEmpty=False, Tree=dispatch.B)
clean_5 = CleanTree(RemoveNulls=True, RemoveInvalid=True, RemoveEmpty=False, Tree=dispatch.P)
clean_6 = CleanTree(RemoveNulls=True, RemoveInvalid=True, RemoveEmpty=False, Tree=dispatch.C)
debrep = DeconstructBrep(Brep=clean_4)  # -> Faces, Edges, Vertices
preview = CustomPreview(Geometry=flatten(clean_5), Material=swatch)
preview_2 = CustomPreview(Geometry=flatten(debrep.Faces), Material=swatch_2)
preview_3 = CustomPreview(Geometry=flatten(clean_2), Material=swatch_2)
preview_4 = CustomPreview(Geometry=flatten(clean_3), Material=swatch)
curve_preview = CustomCurvePreview(Curve=clean_6, Linetype=linetype.ModelLinetype, Colour=swatch)
curve_preview_2 = CustomCurvePreview(Curve=debrep.Edges, Linetype=linetype.ModelLinetype, Colour=swatch)

# ==== cluster SelectRepresentation: Select exactly one representation based on tags. The tag matching is based on the highest Jaccard index (|∩|/|∪|).
rp = ClusterInput()
tags = ClusterInput()
rp_2 = Representation(rp)
tags_2 = Tags(tags)
rep = ModelRepresentation(Representation=rp_2)  # -> Representation, Valid, Url, Description, Mime, Tags, Qualities
jac = JaccardIndex(set1=tags_2, set2=rep.Tags)
trim = TrimTree(Tree=jac, Depth=1)
minmax = MinimumMaximum(L=trim)  # -> Max, MaxI, Min, MinI; inputs L: list
# ---------- minmax: Python ----------
#Component Information
#--------------------------------------------------------------------------------------------
if ghenv.Component.RunCount<2:
    #General
    #--------------------------------------------------------------------------------------------
    __author__ = "Ueli Saluz"
    __version__ = "2022.04.22"
    
    ghenv.Component.Name = "MinimumMaximum"
    ghenv.Component.NickName = "MinMax"
    ghenv.Component.Description = "Returns the maximum and mininum of a list and their corresponding index."
    ghenv.Component.Message = "VER 1.0"
    ghenv.Component.Category = "Maths"
    ghenv.Component.SubCategory = "Util"
    
     #Inputs
    #--------------------------------------------------------------------------------------------
    inputIndex=0
    
    ghenv.Component.Params.Input[inputIndex].Name = "L"
    ghenv.Component.Params.Input[inputIndex].NickName = "L"
    ghenv.Component.Params.Input[inputIndex].Description = "A list of numbers."
    ghenv.Component.Params.Input[inputIndex].Optional = False
    inputIndex+=1
    
    
    #Outputs
    #--------------------------------------------------------------------------------------------
    outputIndex=0
    
    ghenv.Component.Params.Output[outputIndex].Name = "Max"
    ghenv.Component.Params.Output[outputIndex].NickName = "Max"
    ghenv.Component.Params.Output[outputIndex].Description = "Maximum of the list"
    outputIndex+=1
    
    ghenv.Component.Params.Output[outputIndex].Name = "MaxI"
    ghenv.Component.Params.Output[outputIndex].NickName = "MaxI"
    ghenv.Component.Params.Output[outputIndex].Description = "Index of the maximum of the list"
    outputIndex+=1
    
    ghenv.Component.Params.Output[outputIndex].Name = "Min"
    ghenv.Component.Params.Output[outputIndex].NickName = "Min"
    ghenv.Component.Params.Output[outputIndex].Description = "Minimum of the list"
    outputIndex+=1
    
    ghenv.Component.Params.Output[outputIndex].Name = "MinI"
    ghenv.Component.Params.Output[outputIndex].NickName = "MinI"
    ghenv.Component.Params.Output[outputIndex].Description = "Index of the minimum of the list"
    outputIndex+=1


#Solver - Run with trees to enhance performance drastically
#--------------------------------------------------------------------------------------------
if __name__ == "__main__":
    
    maximum = max(L)
    MaxI = L.index(maximum)
    Max = maximum
    
    minimum = min(L)
    MinI = L.index(minimum)
    Min = minimum
# ---------- end minmax ----------
txt = Text(rp_2)
item = ListItem(List=rep.Representation, Index=minmax.MaxI, Wrap=True)
txt_2 = Text(item)
itemindex = ItemIndex(L=txt, I=txt_2)  # -> i; inputs L: list
# ---------- itemindex: Python ----------
#Component Information
#--------------------------------------------------------------------------------------------
if ghenv.Component.RunCount<2:
    #General
    #--------------------------------------------------------------------------------------------
    __author__ = "Ueli Saluz"
    __version__ = "2022.11.18"
    
    ghenv.Component.Name = "ItemIndex"
    ghenv.Component.NickName = "ItemIndex"
    ghenv.Component.Description = "A better IdemIndex"
    ghenv.Component.Message = "VER 1.0"
    ghenv.Component.Category = "Set"
    ghenv.Component.SubCategory = "List"
    
     #Inputs
    #--------------------------------------------------------------------------------------------
    inputIndex=0
    
    ghenv.Component.Params.Input[inputIndex].Name = "List"
    ghenv.Component.Params.Input[inputIndex].NickName = "L"
    ghenv.Component.Params.Input[inputIndex].Description = "Input1 is..."
    ghenv.Component.Params.Input[inputIndex].Optional = False
    inputIndex+=1
    
    ghenv.Component.Params.Input[inputIndex].Name = "Item"
    ghenv.Component.Params.Input[inputIndex].NickName = "I"
    ghenv.Component.Params.Input[inputIndex].Description = "Input2 is..."
    ghenv.Component.Params.Input[inputIndex].Optional = False
    inputIndex+=1
    
    #Outputs
    #--------------------------------------------------------------------------------------------
    outputIndex=0
    
    ghenv.Component.Params.Output[outputIndex].Name = "Index"
    ghenv.Component.Params.Output[outputIndex].NickName = "i"
    ghenv.Component.Params.Output[outputIndex].Description = "Output1 is..."
    outputIndex+=1

i = L.index(I)
# ---------- end itemindex ----------
trim_2 = TrimTree(Tree=itemindex, Depth=1)
trim_3 = TrimTree(Tree=item, Depth=1)
i = Integer(trim_2)
rp_3 = Representation(trim_3)
i_2 = ClusterOutput(i)
rp_4 = ClusterOutput(rp_3)

# ==== cluster JaccardIndex: Compute the Jaccard Index of two sets.
set1 = ClusterInput()
set2 = ClusterInput()
set1_2 = Data(set1)
set2_2 = Data(set2)
cset = CreateSet(List=set2_2)  # -> Set, Map
cset_2 = CreateSet(List=set1_2)  # -> Set, Map
lng = ListLength(List=set1_2)
lng_2 = ListLength(List=set2_2)
intersection = SetIntersection(SetA=cset_2.Set, SetB=cset.Set)
expression = Expression(x=lng, Expression="x=0")
expression_2 = Expression(x=lng_2, Expression="x=0")
sunion = SetUnion(SetA=cset_2.Set, SetB=cset.Set)
null = NullItem(Item=lng)  # -> NullFlags, InvalidFlags, Description
null_2 = NullItem(Item=lng_2)  # -> NullFlags, InvalidFlags, Description
lng_3 = ListLength(List=sunion)
lng_4 = ListLength(List=intersection)
or = GateOr(A=null.NullFlags, B=expression)
or_2 = GateOr(A=null_2.NullFlags, B=expression_2)
division = Division(A=lng_4, B=lng_3)
int = Integer(or)
int_2 = Integer(or_2)
concat = Concatenate(FragmentA=int, FragmentB=int_2)
b2d = BinaryToDecimal(Binary=concat)  # -> Decimal
# ---------- b2d: Python ----------
if ghenv.Component.RunCount<2:
    __author__ = "Ueli Saluz"
    __version__ = "2021.11.14"
    
    ghenv.Component.Name = "BinaryToDecimal"
    ghenv.Component.NickName = "B2D"
    ghenv.Component.Description = "Converts a number in binary representation to a number in decimal representation."
    ghenv.Component.Message = "VER 1.0"
    
    ghenv.Component.Params.Input[0].NickName = "Binary"
    
    ghenv.Component.Params.Input[0].Description = "Binary representation of a number."
    
    ghenv.Component.Params.Output[0].NickName = "Decimal"
    
    ghenv.Component.Params.Output[0].Description = "Converted decimal representation of the same number."

if __name__ == "__main__":
    Decimal = int(Binary,2)
# ---------- end b2d ----------
expression_3 = Expression(c=b2d, x=division, Expression="If(c=0,x,If(c=3,1,0))")
N = Number(expression_3)
N_2 = ClusterOutput(N)
