# Grasshopper definition select.gh (Grasshopper 1.0.8)
# Copyright: GNU Lesser General Public License Version 3
# plug-ins: semio

po = Port(Tree({0;0}: [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, "{\"id_\":\"w\",\"description\":\"Bottom center of the west street side.\",\"family\":\"s\",\"compatibleFamilies\":[\"s\"],\"point\":{\"x\":-0.5,\"y\":0.0,\"z\":0.5},\"direction\":{\"x\":-1.0,\"y\":-0.0,\"z\":-0.0},\"t\":0.75,\"qualities\":[{\"name\":\"monoceros.connector.out\",\"value\":\"True\",\"unit\":\"\",\"definition\":\"\"}]}", "{\"id_\":\"s\",\"description\":\"Bottom center of the south street side.\",\"family\":\"s\",\"compatibleFamilies\":[\"s\"],\"point\":{\"x\":0.0,\"y\":-0.5,\"z\":0.5},\"direction\":{\"x\":-0.0,\"y\":-1.0,\"z\":-0.0},\"t\":0.5,\"qualities\":[{\"name\":\"monoceros.connector.out\",\"value\":\"True\",\"unit\":\"\",\"definition\":\"\"}]}"], {0;1}: [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, "{\"id_\":\"w\",\"description\":\"Bottom center of the west backyard side.\",\"family\":\"by\",\"compatibleFamilies\":[\"by\"],\"point\":{\"x\":-0.5,\"y\":0.0,\"z\":0.5},\"direction\":{\"x\":-1.0,\"y\":-0.0,\"z\":-0.0},\"t\":0.75,\"qualities\":[{\"name\":\"monoceros.connector.out\",\"value\":\"True\",\"unit\":\"\",\"definition\":\"\"}]}", "{\"id_\":\"s\",\"description\":\"Bottom center of the south backyard side.\",\"family\":\"by\",\"compatibleFamilies\":[\"by\"],\"point\":{\"x\":0.0,\"y\":-0.5,\"z\":0.5},\"direction\":{\"x\":-0.0,\"y\":-1.0,\"z\":-0.0},\"t\":0.5,\"qualities\":[{\"name\":\"monoceros.connector.out\",\"value\":\"True\",\"unit\":\"\",\"definition\":\"\"}]}"], {0;2}: [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, "{\"id_\":\"w\",\"description\":\"Bottom center of the west street side.\",\"family\":\"s\",\"compatibleFamilies\":[\"s\"],\"point\":{\"x\":-0.5,\"y\":0.0,\"z\":0.5},\"direction\":{\"x\":-1.0,\"y\":-0.0,\"z\":-0.0},\"t\":0.75,\"qualities\":[{\"name\":\"monoceros.connector.out\",\"value\":\"True\",\"unit\":\"\",\"definition\":\"\"}]}", "{\"id_\":\"e\",\"description\":\"Bottom center of the east backyard side.\",\"family\":\"by\",\"compatibleFamilies\":[\"by\"],\"point\":{\"x\":0.5,\"y\":0.0,\"z\":0.5},\"direction\":{\"x\":1.0,\"y\":0.0,\"z\":0.0},\"t\":0.25,\"qualities\":[{\"name\":\"monoceros.connector.out\",\"value\":\"False\",\"unit\":\"\",\"definition\":\"\"}]}"]))
id = Id(["e", "n", "t", "w", "s", "b"])
por = SelectPort(po=po, id=id)  # -> po_4, i_2

# ==== cluster SelectPort: Select a port with the id. If no port matches, null will be returned.
po = ClusterInput()
id = ClusterInput()
id_2 = Id(graft(id))
po_2 = Port(po)
lng = ListLength(List=po_2)
por = ModelPort(Port=po_2)  # -> Port, Valid, Id, Description, Family, CompatibleFamilies, Point, Direction, T, Qualities
series = Series(Start=0, Step=1, Count=lng)
trim = TrimTree(Tree=series, Depth=1)
expression = Expression(x=por.Id, y=id_2, Expression="x=y")
cull = CullPattern(List=po_2, CullPattern=expression)
cull_2 = CullPattern(List=trim, CullPattern=expression)
nulltobranch = AddNullToEmptyBranch(D=cull_2)  # -> R; inputs D: tree
# ---------- nulltobranch: C# ----------
#region Usings
using System;
using System.Linq;
using System.Collections;
using System.Collections.Generic;
using System.Drawing;

using Rhino;
using Rhino.Geometry;

using Grasshopper;
using Grasshopper.Kernel;
using Grasshopper.Kernel.Data;
using Grasshopper.Kernel.Types;
#endregion

public class Script_Instance : GH_ScriptInstance
{

    private void RunScript(DataTree<object> D, ref object R)
    {
        foreach (GH_Path path in D.Paths)
            if (D.Branch(path).Count == 0)
                D.Add(null, path);

        R = D;
    }
}
# ---------- end nulltobranch ----------
nulltobranch_2 = AddNullToEmptyBranch(D=cull)  # -> R; inputs D: tree; same code as nulltobranch
trim_2 = TrimTree(Tree=nulltobranch, Depth=1)
trim_3 = TrimTree(Tree=nulltobranch_2, Depth=1)
i = Integer(trim_2)
po_3 = Port(trim_3)
i_2 = ClusterOutput(i)
po_4 = ClusterOutput(po_3)
