# Grasshopper definition test-update.gh (Grasshopper 1.0.8)
# Copyright: GNU Lesser General Public License Version 3
# plug-ins: semio

data = Data(False)
data_2 = Data(["c0", "c1"])
data_3 = Data([Point(-7.5, -7.7, 7.5), Point(-18.6, -7.7, 7.5)])
data_4 = Data([Vector(0, 0, 1), Vector(0, 0, 1)])
data_5 = Data(["{\"group\":\"core\",\"subgroup\":\"east\"}", "{\"group\":\"core\",\"subgroup\":\"west\"}"])
data_6 = Data([Point(-7.5, -7.7, 7.5), Point(-18.6, -7.7, 7.5)])
data_7 = Data([Vector(0, 0, 1), Vector(0, 0, 1)])
data_8 = Data(["{\"group\":\"core\",\"subgroup\":\"east\"}", "{\"group\":\"core\",\"subgroup\":\"west\"}"])
data_9 = Data(False)
data_10 = Data(["c0", "c1"])
por = ModelPort(Validate=data, Id=graft(data_2), Point=graft(data_3), Direction=graft(data_4), Locators=graft(data_5))  # -> Port, Valid, Id, Point, Direction, Locators, Locators_2
por_2 = ModelPort(Validate=data_9, Id=data_10, Description="Des", Point=data_6, Direction=data_7, Locators=data_8)  # -> Port, Valid, Id, Description, Point, Direction, Locators
