# Grasshopper definition three.gh (Grasshopper 1.0.8)
# Copyright: GNU Lesser General Public License Version 3

Z = UnitZ(Factor=1)
xy = XYPlane(Origin=Point(0, 0, 0))
pl = ConstructPlane(Origin=Point(0, 0, 0), XAxis=Vector(1, 0, 0), YAxis=Z)
semio = Plane(xy)
three = Plane(pl)
pt = ConstructPoint(
    XCoordinate=Slider(-18, range=-100..100),
    YCoordinate=Slider(24, range=-100..100),
    ZCoordinate=Slider(16, range=-100..100))
vec = VectorXYZ(XComponent=Slider(1, range=-1..1), YComponent=Slider(0, range=-1..1), ZComponent=Slider(0, range=-1..1))  # -> Vector, Length
orient = Orient(Source=semio, Target=three)  # -> Geometry, Transform
orient_2 = Orient(Source=three, Target=semio)  # -> Geometry, Transform
pl_2 = ConstructPlane(Origin=pt, XAxis=vec.Vector, YAxis=Vector(0, 1, 0))
semio_three = Transform(orient.Transform)
three_semio = Transform(orient_2.Transform)
semio_o = Data(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)
semio_o_2 = Data(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)
semio_p = Plane(pl_2)
orient_3 = Orient(Geometry=semio_o, Source=PlaneXY(0, 0, 0), Target=semio_p)  # -> Geometry, Transform
transform = Transform(Geometry=semio_p, Transform=semio_three)
transform_2 = Transform(Geometry=semio_o, Transform=semio_three)
three_p = Plane(transform)
three_o = Data(transform_2)
orient_4 = Orient(Geometry=semio_o, Source=PlaneXY(0, 0, 0), Target=three_p)  # -> Geometry, Transform
transform_3 = Transform(Geometry=transform_2, Transform=three_semio)
plcoord = PlaneCoordinates(System=PlaneXY(0, 0, 0))  # -> XCoordinate, YCoordinate, ZCoordinate
