# Grasshopper definition Blocks.gh (Grasshopper 1.0.7)
# plug-ins: eleFront, Pufferfish

number_slider = Slider(50, range=0..1000)
panel = Panel("""1
2
3""")
geo = Geometry(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)
dom = ConstructDomain(DomainStart="0.5", DomainEnd="10")
defembed = DefineEmbeddedBlock(Geometry=geo, BlockName="c", BasePlane=PlaneXY(0, 0, 0))
random = Random(Range=dom, Number=number_slider, Seed=panel, Integers=True)
random_2 = Random(Range="360", Number=number_slider, Seed=2, Integers=True)
random_3 = Random(Range="2", Number=number_slider, Seed=2, Integers=True)
bang = ExplodeTree(Data=random)  # -> Branch0, Branch1, Branch2
roteuler = RotateEuler(
    Geometry=defembed,
    Plane=PlaneXY(0, 0, 0),
    Axis1=random_3,
    Axis2=random_3,
    Axis3=random_3,
    Degrees1=random_2,
    Degrees2=random_2,
    Degrees3=random_2)  # -> Rotated, Plane1, Plane2, Plane3, Transform
scale_nu = ScaleNU(Geometry=roteuler.Rotated, Plane=PlaneXY(0, 0, 0), ScaleX=bang.Branch0, ScaleY=bang.Branch1, ScaleZ=bang.Branch2)  # -> Geometry, Transform
mirror = Mirror(Geometry=scale_nu.Geometry, Plane=roteuler.Plane2)  # -> Geometry, Transform
block_info = GetBlockInfo(Block=mirror.Geometry)  # -> Name, Plane, Transform, BlockType, FilePath, Active
baketofile = BakeObjectsToFile(
    FilePath="C:\git\semio\local\ElefrontExport.3dm",
    Geometry=mirror.Geometry,
    Bake=Button(),
    networkMode=True,
    overwriteMode="Overwrite BN",
    preset="Moderate")
transform = Transform(Geometry=geo, Transform=block_info.Transform)
output = DataOutput(
    DataInput=transform,
    Destination="C:\git\semio\local\OutputExport.ghdata",
    RelativePath="C:\git\semio\local\OutputExport.ghdata|OutputExport.ghdata")
