# Grasshopper definition test-helper.gh (Grasshopper 1.0.8)
# plug-ins: RhinoCodePluginGH

theta = Slider(45, range=-360..360)
list = ValueList({"semio": 0, "native": 1}, selected="semio")
xy = XYPlane(Origin=Point(0, 0, 0))
X = UnitX(Factor=1)
Y = UnitY(Factor=1)
Z = UnitZ(Factor=1)
vrot = Rotate(Vector=Y, Axis=Z, Angle=degrees(Slider(-135, range=-360..360)))
number_slider = Slider(4, range=0..10)
vrot_2 = Rotate(Vector=vrot, Axis=X, Angle=degrees(Slider(-30, range=-360..360)))
y_axis = Panel(vrot_2)
angle = Angle(VectorA=Y, VectorB=vrot_2)  # -> Angle, Reflex
deg = Degrees(Radians=angle.Angle)
roundmult = RoundToMultiple(N=angle.Angle, M="0.000001")  # -> R; inputs N: tree, M: tree
# ---------- roundmult: Python ----------
#Component Information
#--------------------------------------------------------------------------------------------
if ghenv.Component.RunCount<2:
    #General
    #--------------------------------------------------------------------------------------------
    __author__ = "YOUR NAME"
    __version__ = "2000.00.00"
    
    ghenv.Component.Name = "Round to Multiple"
    ghenv.Component.NickName = "RoundMult"
    ghenv.Component.Description = "Rounds a number to the nearest specified multiple."
    ghenv.Component.Message = "VER 1.0"
    ghenv.Component.Category = "Math"
    ghenv.Component.SubCategory = "Arithmetic"
    
     #Inputs
    #--------------------------------------------------------------------------------------------
    inputIndex=0
    
    ghenv.Component.Params.Input[inputIndex].Name = "Number"
    ghenv.Component.Params.Input[inputIndex].NickName = "N"
    ghenv.Component.Params.Input[inputIndex].Description = "Number to round."
    ghenv.Component.Params.Input[inputIndex].Optional = False
    inputIndex+=1
    
    ghenv.Component.Params.Input[inputIndex].Name = "Multiple"
    ghenv.Component.Params.Input[inputIndex].NickName = "M"
    ghenv.Component.Params.Input[inputIndex].Description = "Multiple to round to."
    ghenv.Component.Params.Input[inputIndex].Optional = False
    inputIndex+=1
    
    #Outputs
    #--------------------------------------------------------------------------------------------
    outputIndex=0
    
    ghenv.Component.Params.Output[outputIndex].Name = "Rounded"
    ghenv.Component.Params.Output[outputIndex].NickName = "R"
    ghenv.Component.Params.Output[outputIndex].Description = "Number rounded to the nearest specified multiple."
    outputIndex+=1


#Imports
#--------------------------------------------------------------------------------------------
from System import Object
from Grasshopper import DataTree
import math


#The Component function - Business logic only (e.g. working without trees)
#--------------------------------------------------------------------------------------------
"""Function that this component is computing.
    Inputs:
        number: The number to round.
        multiple: The multiple to round to.
    Output:
        rounded: The number rounded to the nearest specified multiple."""
def RoundToMultiple(number, multiple):
    rounded = math.ceil(number / multiple) * multiple
    return rounded

#Solver - Run with trees to enhance performance drastically
#--------------------------------------------------------------------------------------------
if __name__ == "__main__":
    
    #Initialize trees
    #--------------------------------------------------------------------------------------------
    RoundedTree = DataTree[Object]()
    
    #Data matching
    #--------------------------------------------------------------------------------------------
    for path in N.Paths:
        numberBranch = N.Branch(path)
        for i, number in enumerate(numberBranch):
            multiple = M.Branch(path)[i]
            rounded = RoundToMultiple(number, multiple)
            RoundedTree.Add(rounded, path)
    
     #Assign trees to output
    #--------------------------------------------------------------------------------------------
    R = RoundedTree
# ---------- end roundmult ----------
rad = Radians(Degrees=theta)
panel = Panel(roundmult)
rotate = RotateDirection(Geometry=xy, Center=Point(0, 0, 0), From=Y, To=vrot_2)  # -> Geometry, Transform
matrix = TransformMatrix(rotate.Transform, Digits=3)
angle_2 = Angle(VectorA=Z, VectorB=vrot_2)  # -> Angle, Reflex
c_script = CSharpScript(normal=vrot_2, omega=rad)  # -> q; inputs normal: Vector3d, omega: Double
# ---------- c_script: C# ----------
// Grasshopper Script Instance
#region Usings
using System;
using System.Linq;
using System.Collections;
using System.Collections.Generic;
using System.Drawing;

using Rhino;
using Rhino.Geometry;

using Grasshopper;
using Grasshopper.Kernel;
using Grasshopper.Kernel.Data;
using Grasshopper.Kernel.Types;
#endregion

public class Script_Instance : GH_ScriptInstance
{
    #region Notes
    /* 
      Members:
        RhinoDoc RhinoDocument
        GH_Document GrasshopperDocument
        IGH_Component Component
        int Iteration

      Methods (Virtual & overridable):
        Print(string text)
        Print(string format, params object[] args)
        Reflect(object obj)
        Reflect(object obj, string method_name)
    */
    #endregion

    private void RunScript(Vector3d normal, double omega, ref object q)
    {
        var n_q = new Quaternion(0,normal.X,normal.Y,normal.Z);
        var sin_omega_half = Math.Sin(omega/2);
        q = new Quaternion(Math.Cos(omega/2),0,0,0)+(new Quaternion(sin_omega_half,0,0,0)*n_q);

    }
}
# ---------- end c_script ----------
neg = Negative(Value=rad)
deplane = DeconstructPlane(Plane=rotate.Geometry)  # -> Origin, XAxis, YAxis, ZAxis
deg_2 = Degrees(Radians=angle_2.Angle)
py3 = Python3Script(O=xy, N=vrot_2, P=neg)  # -> Pl; inputs O: Point3d, N: Vector3d, P: Double
# ---------- py3: Python ----------
from math import sin,cos
from Rhino.Geometry import Point3d, Plane, Vector3d
from System import Double

def planeFromNormal(normal, phi=0.0, origin=None):
    if origin is None:
        origin = Point3d(0, 0, 0)

    # Normalize the normal vector
    normal_length = normal.Length
    normalized_normal = Vector3d(normal.X / normal_length, normal.Y / normal_length, normal.Z / normal_length)

    # Rodrigues' rotation formula for x-axis
    k = normalized_normal  # Rotation axis
    x_axis = Vector3d(
        Double(cos(phi) + k.X**2 * (1 - cos(phi))),
        Double(k.X * k.Y * (1 - cos(phi)) - k.Z * sin(phi)),
        Double(k.X * k.Z * (1 - cos(phi)) + k.Y * sin(phi)),
    )

    # y-axis is the cross product of the normal and the x-axis.
    y_axis = Vector3d.CrossProduct(normalized_normal, x_axis)

    return Plane(origin, x_axis, y_axis)


Pl = planeFromNormal(N,P,O)
# ---------- end py3 ----------
panel_2 = Panel(deg)
c_script_2 = CSharpScript(q=c_script, p=Y)  # -> oriented_p, q_inverted; inputs p: Point3d
# ---------- c_script_2: C# ----------
// Grasshopper Script Instance
#region Usings
using System;
using System.Linq;
using System.Collections;
using System.Collections.Generic;
using System.Drawing;

using Rhino;
using Rhino.Geometry;

using Grasshopper;
using Grasshopper.Kernel;
using Grasshopper.Kernel.Data;
using Grasshopper.Kernel.Types;
#endregion

public class Script_Instance : GH_ScriptInstance
{
    #region Notes
    /* 
      Members:
        RhinoDoc RhinoDocument
        GH_Document GrasshopperDocument
        IGH_Component Component
        int Iteration

      Methods (Virtual & overridable):
        Print(string text)
        Print(string format, params object[] args)
        Reflect(object obj)
        Reflect(object obj, string method_name)
    */
    #endregion

    private void RunScript(
	object q,
	Point3d p,
	ref object oriented_p,
	ref object q_inverted)
    {
        var p_q = new Quaternion(0,p.X,p.Y,p.Z);
        var q_clone = new Quaternion(((Quaternion)q).A,((Quaternion)q).B,((Quaternion)q).C,((Quaternion)q).D);
        q_clone.Invert();
        q_inverted = q_clone;
        var oriented_p_q = ((Quaternion)q)*p_q*((Quaternion)q_inverted);
        oriented_p = new Point3d(oriented_p_q.B,oriented_p_q.C,oriented_p_q.D);
    }
}
# ---------- end c_script_2 ----------
c_script_3 = CSharpScript(q=c_script, p=X)  # -> oriented_p, q_inverted; inputs p: Point3d; same code as c_script_2
c_script_4 = CSharpScript(q=c_script)  # -> p
# ---------- c_script_4: C# ----------
// Grasshopper Script Instance
#region Usings
using System;
using System.Linq;
using System.Collections;
using System.Collections.Generic;
using System.Drawing;

using Rhino;
using Rhino.Geometry;

using Grasshopper;
using Grasshopper.Kernel;
using Grasshopper.Kernel.Data;
using Grasshopper.Kernel.Types;
#endregion

public class Script_Instance : GH_ScriptInstance
{
    #region Notes
    /* 
      Members:
        RhinoDoc RhinoDocument
        GH_Document GrasshopperDocument
        IGH_Component Component
        int Iteration

      Methods (Virtual & overridable):
        Print(string text)
        Print(string format, params object[] args)
        Reflect(object obj)
        Reflect(object obj, string method_name)
    */
    #endregion

    private void RunScript(object q, ref object p)
    {
        var temp_p = new Plane();
        ((Quaternion)q).GetRotation(out temp_p);
        p = temp_p;
    }
}
# ---------- end c_script_4 ----------
c_script_5 = CSharpScript()  # -> q; inputs t: Transform
# ---------- c_script_5: C# ----------
// Grasshopper Script Instance
#region Usings
using System;
using System.Linq;
using System.Collections;
using System.Collections.Generic;
using System.Drawing;

using Rhino;
using Rhino.Geometry;

using Grasshopper;
using Grasshopper.Kernel;
using Grasshopper.Kernel.Data;
using Grasshopper.Kernel.Types;
#endregion

public class Script_Instance : GH_ScriptInstance
{
    #region Notes
    /* 
      Members:
        RhinoDoc RhinoDocument
        GH_Document GrasshopperDocument
        IGH_Component Component
        int Iteration

      Methods (Virtual & overridable):
        Print(string text)
        Print(string format, params object[] args)
        Reflect(object obj)
        Reflect(object obj, string method_name)
    */
    #endregion

    private void RunScript(Transform t, ref object q)
    {
        var temp_q = new Quaternion();
        t.GetQuaternion(out temp_q);
        q = temp_q;
    }
}
# ---------- end c_script_5 ----------
rev = Reverse(Vector=deplane.ZAxis)
panel_3 = Panel(deg_2)
amp = Amplitude(Vector=vrot_2, Amplitude=number_slider)
pl = ConstructPlane(Origin=deplane.Origin, XAxis=deplane.XAxis, YAxis=rev)
vdisex = VectorDisplayEx(Point=xy, Vector=amp, Colour=RGB(0, 0, 0), Width=number_slider)
pl_2 = ConstructPlane(Origin=Point(0, 0, 0), XAxis=c_script_3.oriented_p, YAxis=c_script_2.oriented_p)
prot = RotatePlane(Plane=pl, Angle=degrees(theta))
pl2pl = MoveObjectPlaneToPlane(G=xy, S=pl, T=prot)  # -> TG, T; inputs S: Plane, T: Plane
# ---------- pl2pl: Python ----------
#Component Information
#--------------------------------------------------------------------------------------------
if ghenv.Component.RunCount<2:
    #General
    #--------------------------------------------------------------------------------------------
    __author__ = "Ueli Saluz"
    __version__ = "2023.02.12"
    
    ghenv.Component.Name = "MoveObjectPlaneToPlane"
    ghenv.Component.NickName = "Pl2Pl"
    ghenv.Component.Description = "Moves abitrary geometry from a source plane to a target plane."
    ghenv.Component.Message = "VER 1.2"
    ghenv.Component.Category = "Transform"
    ghenv.Component.SubCategory = "Euclidean"
    
     #Inputs
    #--------------------------------------------------------------------------------------------
    inputIndex=0
    
    ghenv.Component.Params.Input[inputIndex].Name = "Geometry"
    ghenv.Component.Params.Input[inputIndex].NickName = "G"
    ghenv.Component.Params.Input[inputIndex].Description = "Geometry to move."
    ghenv.Component.Params.Input[inputIndex].Optional = False
    inputIndex+=1
    
    ghenv.Component.Params.Input[inputIndex].Name = "SourcePlane"
    ghenv.Component.Params.Input[inputIndex].NickName = "S"
    ghenv.Component.Params.Input[inputIndex].Description = "Source plane of object."
    ghenv.Component.Params.Input[inputIndex].Optional = False
    inputIndex+=1
    
    ghenv.Component.Params.Input[inputIndex].Name = "TargetPlane"
    ghenv.Component.Params.Input[inputIndex].NickName = "T"
    ghenv.Component.Params.Input[inputIndex].Description = "Target plane of object."
    ghenv.Component.Params.Input[inputIndex].Optional = False
    inputIndex+=1
    
    #Outputs
    #--------------------------------------------------------------------------------------------
    outputIndex=0
    
    ghenv.Component.Params.Output[outputIndex].Name = "TranslatedGeometry"
    ghenv.Component.Params.Output[outputIndex].NickName = "TG"
    ghenv.Component.Params.Output[outputIndex].Description = "Translated geometry in target plane."
    outputIndex+=1
    
    ghenv.Component.Params.Output[outputIndex].Name = "Trasnform"
    ghenv.Component.Params.Output[outputIndex].NickName = "T"
    ghenv.Component.Params.Output[outputIndex].Description = "Transform describing translation form source to target plane."
    outputIndex+=1


#Imports
#--------------------------------------------------------------------------------------------
import Rhino.Geometry.Transform as trsf

def MvObjPlnToPln (geo,plnObj,plnDest):
    transform = trsf.PlaneToPlane(plnObj,plnDest)
    geo.Transform(transform)
    return (geo,transform)

TG, T = MvObjPlnToPln(G,S,T)
# ---------- end pl2pl ----------
matrix_2 = TransformMatrix(pl2pl.T, Digits=3)
deplane_2 = DeconstructPlane(Plane=prot)  # -> Origin, XAxis, YAxis, ZAxis
x_axis = Panel(deplane_2.XAxis)
dprod = DotProduct(VectorA=deplane_2.XAxis, VectorB=deplane_2.ZAxis, Unitize=False)
previewplane = PreviewPlane(plane=c_script_4, axis_length=number_slider)
pl_3 = ConstructPlane(Origin=deplane_2.Origin, XAxis=deplane_2.XAxis, YAxis=deplane_2.ZAxis)
pl_4 = PlaneNormal(Origin=deplane_2.Origin, ZAxis=deplane_2.YAxis)
previewplane_2 = PreviewPlane(plane=pl_2, axis_length=number_slider)
volume1to200 = Brep(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)
filter = StreamFilter(Gate=list, Stream0=pl_3, Stream1=pl_4)
pl2pl_2 = MoveObjectPlaneToPlane(G=xy, S=PlaneXY(0, 0, 0), T=filter)  # -> TG, T; inputs S: Plane, T: Plane; same code as pl2pl
matrix_3 = TransformMatrix(pl2pl_2.T, Digits=3)
previewplane_3 = PreviewPlane(plane=filter, axis_length=number_slider)
transform = Transform(Geometry=volume1to200, Transform=pl2pl_2.T)

# ==== cluster PreviewPlane: Preview a plane with axis colors and naming.
axis_length = ClusterInput()
plane = ClusterInput()
axis_length_2 = Number(axis_length)
plane_2 = Plane(plane)
deplane = DeconstructPlane(Plane=plane_2)  # -> Origin, XAxis, YAxis, ZAxis
line = LineSDL(Start=deplane.Origin, Direction=deplane.YAxis, Length=axis_length_2)
line_2 = LineSDL(Start=deplane.Origin, Direction=deplane.XAxis, Length=axis_length_2)
line_3 = LineSDL(Start=deplane.Origin, Direction=deplane.ZAxis, Length=axis_length_2)
swatch = ColourSwatch(SwatchColor=RGB(235, 52, 79))
swatch_2 = ColourSwatch(SwatchColor=RGB(0, 166, 157))
swatch_3 = ColourSwatch(SwatchColor=RGB(240, 117, 24))
end = EndPoints(Curve=line_2)  # -> Start, End
end_2 = EndPoints(Curve=line)  # -> Start, End
end_3 = EndPoints(Curve=line_3)  # -> Start, End
tag = TextTag(Location=end.End, Text="X", Colour=swatch)
tag_2 = TextTag(Location=end_2.End, Text="Y", Colour=swatch_2)
tag_3 = TextTag(Location=end_3.End, Text="Z", Colour=swatch_3)
preview = CustomPreview(Geometry=line_2, Material=swatch)
preview_2 = CustomPreview(Geometry=line, Material=swatch_2)
preview_3 = CustomPreview(Geometry=line_3, Material=swatch_3)
