# Grasshopper definition hello-semio.gh (Grasshopper 1.0.8)
# Copyright: GNU Lesser General Public License Version 3
# Copyright: GNU Lesser General Public License v3.0 or later
# plug-ins: RhinoCodePluginGH, semio

# 1.
number_slider = Slider(5, range=1..10)
# 2.
number_slider_2 = Slider(110, range=50..200)
dir = Directory()  # -> D
# ---------- dir: C# ----------
#region Usings
using System;
using System.Linq;
using System.Collections;
using System.Collections.Generic;
using System.Drawing;
using System.IO;

using Rhino;
using Rhino.Geometry;

using Grasshopper;
using Grasshopper.Kernel;
using Grasshopper.Kernel.Data;
using Grasshopper.Kernel.Types;
#endregion

public class Script_Instance : GH_ScriptInstance
{
    private void RunScript(ref object D)
    {
        D = Path.GetDirectoryName(this.GrasshopperDocument.FilePath);
    }
}
# ---------- end dir ----------
toggle = BooleanToggle(True)
# 2.
dir_2 = Directory()  # -> D; same code as dir
toggle_2 = BooleanToggle(True)
# 3.
panel = Panel("""L1
L2""")
panel_2 = Panel("""5
5""")
pce = ModelPiece(Id=panel, TypeName="Profile", TypeVariant=panel_2)  # -> Piece, Valid, Id, Description, TypeName, TypeVariant, Plane, Center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
# Doubleclick Me!
panel_3 = Panel("2")
cluster = Cluster(amount=panel_3, width="110", path=dir, R=toggle)
# 2025 Kinan Sarakbi
# 2025 Elduane Lumpine
# 2025 Ueli Saluz
amount = Integer(number_slider)
width = Number(number_slider_2)
cluster_2 = Cluster(amount="5", width="110", path=dir, R=toggle)
cluster_3 = Cluster(amount="4", width="110", path=dir, R=toggle)
cluster_4 = Cluster(amount="2", width="110", path=dir_2, R=toggle_2)
cluster_5 = Cluster(amount="5", width="110", path=dir_2, R=toggle_2)
cluster_6 = Cluster(amount="4", width="110", path=dir_2, R=toggle_2)
xy = XYPlane(Origin=Point(0, 0, 0))

# ----
# Permission is hereby granted, free of charge, to any person obtaining a copy
# of this Grasshopper file and associated documentation files (the "Document"),
# to deal in the Document without restriction, including without limitation the
# rights to use, copy, modify, merge, publish, distribute, sublicense, and/or sell
# copies of the Document, and to permit persons to whom the Document is
# furnished to do so.
# 
# Individual clusters used inside this document might be licensed under
# different terms. This is indicated through a similar copyright notice group
# inside the cluster and otherwise in the license field of the cluster. If you
# have any question please reach out to us: license@semio-tech.com
# 
# THE DOCUMENT IS PROVIDED "AS IS", WITHOUT WARRANTY OF ANY
# KIND, EXPRESS OR IMPLIED, INCLUDING BUT NOT LIMITED TO THE
# WARRANTIES OF MERCHANTABILITY, FITNESS FOR A PARTICULAR
# PURPOSE AND NONINFRINGEMENT. IN NO EVENT SHALL THE
# AUTHORS OR COPYRIGHT HOLDERS BE LIABLE FOR ANY CLAIM,
# DAMAGES OR OTHER LIABILITY, WHETHER IN AN ACTION OF
# CONTRACT, TORT OR OTHERWISE, ARISING FROM, OUT OF OR IN
# CONNECTION WITH THE DOCUMENT OR THE USE OR OTHER
# DEALINGS IN THE DOCUMENT.
multiplication = Multiplication(A=amount, B=width)
subtraction = Subtraction(A=amount, B="1")
rectangle = Rectangle(Plane=PlaneXY(0, 0, 0), XSize=multiplication, YSize=width, Radius=0)  # -> Rectangle, Length
multiplication_2 = Multiplication(A=subtraction, B=width)
explode = Explode(Curve=rectangle.Rectangle, Recursive=True)  # -> Segments, Vertices
cull_i = CullIndex(List=explode.Vertices, Indices="-1", Wrap=True)
pt = ConstructPoint(XCoordinate=multiplication_2, YCoordinate=width, ZCoordinate=0)
trim = TrimTree(Tree=cull_i, Depth=1)
replace = ReplaceItems(List=trim, Item=pt, Indices="2", Wrap=False)
intcrv = Interpolate(Vertices=replace, Degree="1", Periodic=invert(False), KnotStyle=1)  # -> Curve, Length, Domain

item = ListItem(List=pce.Piece, Index=0, Wrap=True)
prot = RotatePlane(Plane=xy, Angle=degrees("-90"))
merge = Merge(Data1=cluster, Data2=cluster_3, Data3=cluster_2)
merge_2 = Merge(Data1=cluster_4, Data2=cluster_6, Data3=cluster_5)
pce_2 = ModelPiece(Piece=item, Plane=prot)  # -> Piece, Valid, Id, Description, TypeName, TypeVariant, Plane, Center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
trim_2 = TrimTree(Tree=merge, Depth=1)
trim_3 = TrimTree(Tree=merge_2, Depth=1)
cluster_7 = Cluster_4(amount="110", width="5")  # -> srf_2, ty_2
cluster_8 = Cluster_3(amount=Slider(5, range=1..10), width=Slider(110, range=50..200))
genes = GenePool(Decimals=0, Maximum=165, Minimum=-165, Value=[-55, 0, 55, -165])  # disabled
genes_2 = GenePool(Decimals=0, Maximum=110, Minimum=-110, Value=[95, 22, 22, 22])  # disabled
genes_3 = GenePool(Decimals=0, Maximum=110, Minimum=-110, Value=[0, 0, 0, 0])  # disabled
genes_4 = GenePool(Decimals=0, Maximum=360, Minimum=0, Value=[180, 180, 180, 180])  # disabled
replace_2 = ReplaceItems(List=pce.Piece, Item=pce_2.Piece, Indices="0", Wrap=False)
genes_5 = GenePool(Decimals=0, Maximum=360, Minimum=0, Value=[0, 0, 0, 0])  # disabled
genes_6 = GenePool(Decimals=0, Maximum=165, Minimum=-165, Value=[-55, 0, 55, -165])
genes_7 = GenePool(Decimals=0, Maximum=360, Minimum=0, Value=[90, 0, 0, 0])  # disabled
genes_8 = GenePool(Decimals=0, Maximum=110, Minimum=-110, Value=[95, 22, 22, 22])
genes_9 = GenePool(Decimals=0, Maximum=110, Minimum=-110, Value=[0, 0, 0, 0])
genes_10 = GenePool(Decimals=0, Maximum=360, Minimum=0, Value=[180, 180, 180, 180])
genes_11 = GenePool(Decimals=0, Maximum=360, Minimum=0, Value=[0, 0, 0, 0])
genes_12 = GenePool(Decimals=0, Maximum=360, Minimum=0, Value=[90, 0, 0, 0])
dsn = ModelDesign(Name="Logo", Pieces=replace_2)  # -> Design, Valid, Name, Description, Icon, Image, Variant, View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
con = ModelConnection(Gap=genes_2, Shift=genes, Raise=genes_3, Rotation=genes_4, Turn=genes_7, Tilt=genes_5)  # -> Connection, Valid, ConnectedPieceId, ConnectedPieceTypePortId, ConnectingPieceId, ConnectingPieceTypePortId, Description, Gap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
srf = Surface(intcrv.Curve)
kit = ModelKit()  # -> Kit, Valid, Name, Description, Icon, Image, Preview, Version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
con_2 = ModelConnection(Gap=genes_8, Shift=genes_6, Raise=genes_9, Rotation=genes_10, Turn=genes_12, Tilt=genes_11)  # -> Connection, Valid, ConnectedPieceId, ConnectedPieceTypePortId, ConnectingPieceId, ConnectingPieceTypePortId, Description, Gap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
dsn_2 = ShowDesign(dn=dsn.Design)  # -> object_2, id_2, rp_2, pln_2
cluster_9 = Cluster_2(path=dir, co=con.Connection, ty=trim_2)
cluster_10 = Cluster_2(path=dir_2, co=con_2.Connection, ty=trim_3)
geo = PreviewGeometry(geo=dsn_2.object_2)
kit_2 = ModelKit(Name="hello semio", Description="The most simple semio kit.", Types=trim_2, Designs=cluster_9)  # -> Kit, Valid, Name, Description, Icon, Image, Preview, Version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
kit_3 = ModelKit(Name="hello semio", Description="The most simple semio kit.", Types=trim_3, Designs=cluster_10)  # -> Kit, Valid, Name, Description, Icon, Image, Preview, Version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
kit_4 = CreateKit(Kit=kit_2.Kit, Uri=dir, Run=Toggle(False))
kit_5 = CreateKit(Kit=kit_3.Kit, Uri=dir_2, Run=Toggle(False))

# ==== cluster Cluster
R = ClusterInput()
path = ClusterInput()
amount = ClusterInput()
width = ClusterInput()
amount_2 = Integer(amount)
width_2 = Number(width)
expression = Expression(x=width_2, Expression="x*10")  # disabled

multiplication = Multiplication(A=amount_2, B=width_2)
subtraction = Subtraction(A=amount_2, B="1")
rectangle = Rectangle(Plane=PlaneXY(0, 0, 0), XSize=multiplication, YSize=width_2, Radius=0)  # -> Rectangle, Length
multiplication_2 = Multiplication(A=subtraction, B=width_2)
explode = Explode(Curve=rectangle.Rectangle, Recursive=True)  # -> Segments, Vertices
cull_i = CullIndex(List=explode.Vertices, Indices="-1", Wrap=True)
pt = ConstructPoint(XCoordinate=multiplication_2, YCoordinate=width_2, ZCoordinate=0)
trim = TrimTree(Tree=cull_i, Depth=1)
replace = ReplaceItems(List=trim, Item=pt, Indices="2", Wrap=False)
intcrv = Interpolate(Vertices=replace, Degree="1", Periodic=invert(False), KnotStyle=1)  # -> Curve, Length, Domain

explode_2 = Explode(Curve=intcrv.Curve, Recursive=True)  # -> Segments, Vertices
trim_2 = TrimTree(Tree=explode_2.Segments, Depth=1)
midpt = CurveMiddle(Curve=trim_2)
crv_cp = CurveClosestPoint(Point=midpt, Curve=intcrv.Curve)  # -> Point, Parameter, Distance
eval = EvaluateCurve(Curve=intcrv.Curve, Parameter=crv_cp.Parameter)  # -> Point, Tangent, Angle
Z = UnitZ(Factor=1)
vrot = Rotate(Vector=eval.Tangent, Axis=Z, Angle=degrees("-90"))

expression_2 = Expression(x=multiplication, Expression="x*10")  # disabled
panel = Panel(amount_2)
panel_2 = Panel("0.1")  # disabled
srf = Surface(intcrv.Curve)
outline = Curve(intcrv.Curve)
pt_2 = Point(midpt)
dr = Direction(vrot)
path_2 = FilePath(path)
sep = Separator()  # -> S
# ---------- sep: C# ----------
#region Usings
using System;
using System.Linq;
using System.Collections;
using System.Collections.Generic;
using System.Drawing;
using System.IO;

using Rhino;
using Rhino.Geometry;

using Grasshopper;
using Grasshopper.Kernel;
using Grasshopper.Kernel.Data;
using Grasshopper.Kernel.Types;
#endregion

public class Script_Instance : GH_ScriptInstance
{
    private void RunScript(ref object S)
    {
        S = Path.DirectorySeparatorChar;
    }
}
# ---------- end sep ----------
concat = Concatenate(FragmentA="profile", FragmentB="_", FragmentC=amount_2, FragmentD=".glb")  # -> graft(Result)
jagged = SettingsSpeed()
concat_2 = Concatenate(FragmentF=path_2, FragmentE=sep, FragmentA=concat)
panel_3 = Panel("""s
e
n
w""")
por = ModelPort(Id=panel_3, Point=pt_2, Direction=dr)  # -> Port, Valid, Id, Description, Family, CompatibleFamilies, Point, Direction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
rep = ModelRepresentation(Url=concat)  # -> Representation, Valid, Url, Mime, Tags, Qualities
typ = ModelType(Name="Profile", Variant=graft(amount_2), Representations=rep.Representation, Ports=por.Port)  # -> Type, Valid, Name, Description, Icon, Image, Variant, Unit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
prv = PreviewPort(po=por.Port)
ty = Type(typ.Type)
ty_2 = ClusterOutput(ty)

tiefe_der_fase_radius = Slider(3, range=0..5)  # disabled
versatz_blockprofil = Slider(2, range=0..5)  # disabled
anzahl_der_innennuten = Slider(2, range=0..5)  # disabled
breite_der_innennut = Slider(3, range=0..5)  # disabled
höhe_der_innennut = Slider(3, range=0..5)  # disabled
anzahl_der_elemente = Slider(1, range=1..20)  # disabled
profilhöhe = Slider(16, range=0..30)  # disabled
nuttiefe = Slider(8, range=0..10)  # disabled
nutbreite = Slider(5, range=0..10)  # disabled
federtiefe = Slider(7, range=0..10)  # disabled
federbreite = Slider(4, range=0..10)  # disabled
versatz = Slider(5, range=0..30)  # disabled
winkel_der_fase = Slider(30, range=0..100)  # disabled
list = ValueList({"Ohne Innennut": 0, "Mit Innennut": 1}, selected="Mit Innennut")  # disabled
list_2 = ValueList({"Einfach": 0, "Fase": 1, "Softline": 2, "Trapez": 3, "Blockhaus": 4, "Diagonal": 5}, selected="Softline")  # disabled
xy = XYPlane(Origin=Point(0, 0, 0))  # disabled
item = ListItem(List=replace, Index=0, Wrap=True)  # -> Item, Item1, Item2; disabled
expression_3 = Expression(x=profilhöhe, Expression="x/2")  # disabled
vec2pt = Vector2Pt(PointA=item.Item1, PointB=item.Item2, Unitize=invert(False))  # -> Vector, Length; disabled
profiledwoodelements = ProfiledWoodElements(
    baseplane=xy,
    elementbreadth=expression,
    elementcount=anzahl_der_elemente,
    lengthelement=expression_2,
    profiletype=list_2,
    innergrooves=list,
    profileheight=profilhöhe,
    groovedepth=nuttiefe,
    groovebreadth=nutbreite,
    tonguedepth=federtiefe,
    tonguebreadth=federbreite,
    innergroovecount=anzahl_der_innennuten,
    innergroovebreadth=breite_der_innennut,
    innergrooveheight=höhe_der_innennut,
    chamferdepth_radius=tiefe_der_fase_radius,
    chamferangle=winkel_der_fase,
    offset=versatz,
    offsetblockprofile=versatz_blockprofil)  # disabled
Z_2 = UnitZ(Factor=1)  # disabled
neg = Negative(Value=expression_3)  # disabled
pl = ConstructPlane(Origin=item.Item1, XAxis=vec2pt.Vector, YAxis=Z_2)  # disabled
Z_3 = UnitZ(Factor=neg)  # disabled

scale = Scale(Geometry=profiledwoodelements, Center=Point(0, 0, 0), Factor=panel_2)  # -> Geometry, Transform; disabled

move = Move(Geometry=scale.Geometry, Motion=Z_3)  # -> Geometry, Transform; disabled
sec = BrepPlane(Brep=move.Geometry, Plane=pl)  # -> Curves, Points; disabled
srf_2 = Surface(sec.Curves)  # disabled
split = SplitBrep(Brep=move.Geometry, Cutter=srf_2)  # disabled
item_2 = ListItem(List=split, Index=0, Wrap=True)  # -> Item, Item1; disabled
cap = CapHoles(Brep=item_2.Item1)  # disabled

geo = Geometry(cap)
mesh = MeshBrep(Brep=geo, Settings=jagged)
geo_2 = ExportGeometry(F=concat_2, G=mesh, R=R)  # -> S; inputs G: tree of GeometryBase, R: Boolean
# ---------- geo_2: C# ----------
// Grasshopper Script Instance
#region Usings
using System;
using System.Linq;
using System.Collections;
using System.Collections.Generic;
using System.Drawing;
using System.IO;

using Rhino;
using Rhino.Geometry;

using Grasshopper;
using Grasshopper.Kernel;
using Grasshopper.Kernel.Data;
using Grasshopper.Kernel.Types;
#endregion

public class Script_Instance : GH_ScriptInstance
{
    #region Notes
    /* 
      Members:
        RhinoDoc RhinoDocument
        GH_Document GrasshopperDocument
        IGH_Component Component
        int Iteration

      Methods (Virtual & overridable):
        Print(string text)
        Print(string format, params object[] args)
        Reflect(object obj)
        Reflect(object obj, string method_name)
    */
    #endregion

    private void RunScript(object F, DataTree<GeometryBase> G, bool R, ref object S)
    {
        // inspired from https://github.com/jhorikawa/GrasshopperProgrammingTutorials/blob/master/0015%20Export%20Geometry%20with%20Grasshopper%20C%23/Export%20Geometry%20with%20Grasshopper%20C%23.gh
        if(R){
            var guids = new List<Guid>();

            for(int i = 0; i < G.BranchCount; i++){
                for(int n = 0; n < G.Branches[i].Count; n++){
                var geom = G.Branches[i][n];
                var guid = Rhino.RhinoDoc.ActiveDoc.Objects.Add(geom);
                guids.Add(guid);
                }
            }

            Rhino.RhinoDoc.ActiveDoc.Objects.Select(guids);

            string cmd = "_-Export " + "\"" + F + "\"" + " _Enter _Enter";

            Rhino.RhinoApp.RunScript(cmd, false);

            Rhino.RhinoDoc.ActiveDoc.Objects.Delete(guids, true);
            S = true;
        }
    }
}
# ---------- end geo_2 ----------
geo_3 = PreviewGeometry(geo=geo)

# ==== cluster Cluster_2
path = ClusterInput()
co = ClusterInput()
ty = ClusterInput()
path_2 = FilePath(path)
co_2 = Connection(co)
panel = Panel("""i
L1
L2
e1
e2""")
panel_2 = Panel("""4
5
5
2
2""")
pce = ModelPiece(Id=panel, TypeName="Profile", TypeVariant=panel_2)  # -> Piece, Valid, Id, Description, TypeName, TypeVariant, Plane, Center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
xy = XYPlane(Origin=Point(0, 0, 0))
item = ListItem(List=pce.Piece, Index=0, Wrap=True)
prot = RotatePlane(Plane=xy, Angle=degrees("-90"))
panel_3 = Panel("""i
L1
L2
L2""")
panel_4 = Panel("""L1
L2
e1
e2""")
pce_2 = ModelPiece(Piece=item, Plane=prot)  # -> Piece, Valid, Id, Description, TypeName, TypeVariant, Plane, Center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
panel_5 = Panel("""w
e
n
n""")
panel_6 = Panel("""w
e
w
w""")
replace = ReplaceItems(List=pce.Piece, Item=pce_2.Piece, Indices="0", Wrap=False)
con = ModelConnection(
    Connection=co_2,
    ConnectedPieceId=panel_3,
    ConnectedPieceTypePortId=panel_5,
    ConnectingPieceId=panel_4,
    ConnectingPieceTypePortId=panel_6)  # -> Connection, Valid, ConnectedPieceId, ConnectedPieceTypePortId, ConnectingPieceId, ConnectingPieceTypePortId, Description, Gap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
dsn = ModelDesign(Name="Logo", Pieces=replace, Connections=con.Connection)  # -> Design, Valid, Name, Description, Icon, Image, Variant, View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
typ = ModelType(Type=ty)  # -> Type, Valid, Name, Description, Icon, Image, Variant, Unit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
rep = ModelRepresentation(Representation=typ.Representations)  # -> Representation, Valid, Url, Description, Mime, Tags
sep = Separator()  # -> S; same code as sep
concat = Concatenate(FragmentA=path_2, FragmentB=sep, FragmentC=rep.Url)
import = ImportContent(
    FilePath=concat,
    Name="*",
    Layer="*",
    Linetype="*",
    HatchPattern="*",
    AnnotationStyles="*",
    Materials="*",
    BlockDefinitions="*",
    Import="T")  # -> ModelTransform, Objects, Layers, Linetypes, HatchPatterns, AnnotationStyles, Materials, BlockDefinitions
dsn_2 = ShowDesign(dn=dsn.Design, ty=ty, ob=import.Objects)  # -> object_2, id_2, rp_2, pln_2
panel_7 = Panel(import.Objects)
geo = PreviewGeometry(geo=dsn_2.object_2)
dn = Design(dsn.Design)
dn_2 = ClusterOutput(dn)

# ==== cluster Cluster_3
amount = ClusterInput()
width = ClusterInput()
amount_2 = Integer(amount)
width_2 = Number(width)

multiplication = Multiplication(A=amount_2, B=width_2)
subtraction = Subtraction(A=amount_2, B="1")
rectangle = Rectangle(Plane=PlaneXY(0, 0, 0), XSize=multiplication, YSize=width_2, Radius=0)  # -> Rectangle, Length
multiplication_2 = Multiplication(A=subtraction, B=width_2)
explode = Explode(Curve=rectangle.Rectangle, Recursive=True)  # -> Segments, Vertices
cull_i = CullIndex(List=explode.Vertices, Indices="-1", Wrap=True)
pt = ConstructPoint(XCoordinate=multiplication_2, YCoordinate=width_2, ZCoordinate=0)
trim = TrimTree(Tree=cull_i, Depth=1)
replace = ReplaceItems(List=trim, Item=pt, Indices="2", Wrap=False)
intcrv = Interpolate(Vertices=replace, Degree="1", Periodic=invert(False), KnotStyle=1)  # -> Curve, Length, Domain

srf = Surface(intcrv.Curve)
srf_2 = ClusterOutput(srf)

# ==== cluster Cluster_4
amount = ClusterInput()
width = ClusterInput()
amount_2 = Integer(amount)
width_2 = Number(width)

multiplication = Multiplication(A=amount_2, B=width_2)
subtraction = Subtraction(A=amount_2, B="1")
rectangle = Rectangle(Plane=PlaneXY(0, 0, 0), XSize=multiplication, YSize=width_2, Radius=0)  # -> Rectangle, Length
multiplication_2 = Multiplication(A=subtraction, B=width_2)
explode = Explode(Curve=rectangle.Rectangle, Recursive=True)  # -> Segments, Vertices
cull_i = CullIndex(List=explode.Vertices, Indices="-1", Wrap=True)
pt = ConstructPoint(XCoordinate=multiplication_2, YCoordinate=width_2, ZCoordinate=0)
trim = TrimTree(Tree=cull_i, Depth=1)
replace = ReplaceItems(List=trim, Item=pt, Indices="2", Wrap=False)
intcrv = Interpolate(Vertices=replace, Degree="1", Periodic=invert(False), KnotStyle=1)  # -> Curve, Length, Domain

explode_2 = Explode(Curve=intcrv.Curve, Recursive=True)  # -> Segments, Vertices
trim_2 = TrimTree(Tree=explode_2.Segments, Depth=1)
midpt = CurveMiddle(Curve=trim_2)
crv_cp = CurveClosestPoint(Point=midpt, Curve=intcrv.Curve)  # -> Point, Parameter, Distance
eval = EvaluateCurve(Curve=intcrv.Curve, Parameter=crv_cp.Parameter)  # -> Point, Tangent, Angle
Z = UnitZ(Factor=1)
vrot = Rotate(Vector=eval.Tangent, Axis=Z, Angle=degrees("-90"))

panel = Panel("""s
e
n
w""")
por = ModelPort(Id=panel, Point=midpt, Direction=vrot)  # -> Port, Valid, Id, Description, Family, CompatibleFamilies, Point, Direction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
typ = ModelType(Variant=graft(amount_2), Ports=por.Port)  # -> Type, Valid, Name, Description, Icon, Image, Variant, Unit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
srf = Surface(intcrv.Curve)
ty = Type(typ.Type)
ty_2 = ClusterOutput(ty)
srf_2 = ClusterOutput(srf)

# ==== cluster ProfiledWoodElements: Create an array of profiled wood elements.
baseplane = ClusterInput()
elementbreadth = ClusterInput()
elementcount = ClusterInput()
lengthelement = ClusterInput()
profiletype = ClusterInput()
innergrooves = ClusterInput()
profileheight = ClusterInput()
groovedepth = ClusterInput()
groovebreadth = ClusterInput()
tonguedepth = ClusterInput()
tonguebreadth = ClusterInput()
innergroovecount = ClusterInput()
innergroovebreadth = ClusterInput()
innergrooveheight = ClusterInput()
chamferdepth_radius = ClusterInput()
chamferangle = ClusterInput()
offset = ClusterInput()
offsetblockprofile = ClusterInput()
profileheight_2 = Number(profileheight)
groovedepth_2 = Number(groovedepth)
tonguedepth_2 = Number(tonguedepth)
tonguebreadth_2 = Number(tonguebreadth)
innergroovecount_2 = Number(innergroovecount)
innergroovebreadth_2 = Number(innergroovebreadth)
innergrooveheight_2 = Number(innergrooveheight)
chamferangle_2 = Number(chamferangle)
offset_2 = Number(offset)
offsetblockprofile_2 = Number(offsetblockprofile)
groovebreadth_2 = Number(groovebreadth)
chamferdepth_radius_2 = Number(chamferdepth_radius)
elementbreadth_2 = Number(elementbreadth)
lengthelement_2 = Number(lengthelement)
elementcount_2 = Integer(elementcount)
profiletype_2 = Integer(profiletype)
baseplane_2 = Plane(baseplane)
innergrooves_2 = Boolean(innergrooves)

# ----
# Originally script was built with another reference plane.
# Therefore the plane is moved and the seam later adjusted.
deplane = DeconstructPlane(Plane=baseplane_2)  # -> Origin, XAxis, YAxis, ZAxis
amp = Amplitude(Vector=deplane.YAxis, Amplitude=elementbreadth_2)
move = Move(Geometry=baseplane_2, Motion=amp)  # -> Geometry, Transform
deplane_2 = DeconstructPlane(Plane=move.Geometry)  # -> Origin, XAxis, YAxis, ZAxis
rev = Reverse(Vector=deplane_2.YAxis)

line = LineSDL(Start=deplane_2.Origin, Direction=rev, Length=elementbreadth_2)
expression = Expression(x=profileheight_2, y=groovebreadth_2, Expression="(x-y)/2")
expression_2 = Expression(x=profileheight_2, y=tonguebreadth_2, Expression="(x-y)/2")
end = EndPoints(Curve=line)  # -> Start, End
line_2 = LineSDL(Start=end.End, Direction=deplane_2.ZAxis, Length=expression)
line_3 = LineSDL(Start=end.Start, Direction=deplane_2.ZAxis, Length=expression_2)
end_2 = EndPoints(Curve=line_2)  # -> Start, End
end_3 = EndPoints(Curve=line_3)  # -> Start, End
line_4 = LineSDL(Start=end_2.End, Direction=rev, Length=expr("-x", groovedepth_2))
line_5 = LineSDL(Start=end_3.End, Direction=rev, Length=expr("-x", tonguedepth_2))
merge = Merge(Data1=line_3, Data2=line_5)
end_4 = EndPoints(Curve=line_4)  # -> Start, End
end_5 = EndPoints(Curve=line_5)  # -> Start, End
line_6 = LineSDL(Start=end_4.End, Direction=deplane_2.ZAxis, Length=groovebreadth_2)
federbasis = Curve(merge)
line_7 = LineSDL(Start=end_5.End, Direction=deplane_2.ZAxis, Length=tonguebreadth_2)
end_6 = EndPoints(Curve=line_7)  # -> Start, End
end_7 = EndPoints(Curve=line_6)  # -> Start, End
line_8 = LineSDL(Start=end_6.End, Direction=rev, Length=tonguedepth_2)
line_9 = LineSDL(Start=end_7.End, Direction=rev, Length=groovedepth_2)
end_8 = EndPoints(Curve=line_8)  # -> Start, End
end_9 = EndPoints(Curve=line_9)  # -> Start, End
line_10 = LineSDL(Start=end_8.End, Direction=deplane_2.ZAxis, Length=expression_2)
line_11 = LineSDL(Start=end_9.End, Direction=deplane_2.ZAxis, Length=expression)
end_10 = EndPoints(Curve=line_10)  # -> Start, End
end_11 = EndPoints(Curve=line_11)  # -> Start, End
merge_2 = Merge(Data1=line_7, Data2=line_8)
merge_3 = Merge(Data1=line_7, Data2=line_8, Data3=line_10)
ln = Line(StartPoint=end_10.End, EndPoint=end_11.End)
blockhausfederoberseite = Curve(merge_2)
simplefederoberseite = Curve(merge_3)
merge_4 = Merge(Data1=line_9, Data2=line_6, Data3=line_4, Data4=line_2)
rev_2 = ReverseList(List=merge_4)
flip = FlipCurve(Curve=merge_4)  # -> Curve, Flag
flip_2 = FlipCurve(Curve=line_11)  # -> Curve, Flag
nutbasis = Curve(flip.Curve)
merge_5 = Merge(Data1=flip_2.Curve, Data2=nutbasis)
einfachenut = Curve(merge_5)

expression_3 = Expression(x=elementbreadth_2, y=innergroovecount_2, z=innergroovebreadth_2, Expression="(x-z*y)/(y+1)")
line_12 = LineSDL(Start=deplane_2.Origin, Direction=rev, Length=expression_3)
end_12 = EndPoints(Curve=line_12)  # -> Start, End
line_13 = LineSDL(Start=end_12.End, Direction=deplane_2.ZAxis, Length=innergrooveheight_2)
end_13 = EndPoints(Curve=line_13)  # -> Start, End
line_14 = LineSDL(Start=end_13.End, Direction=rev, Length=innergroovebreadth_2)
end_14 = EndPoints(Curve=line_14)  # -> Start, End
line_15 = LineSDL(Start=end_14.End, Direction=deplane_2.ZAxis, Length=expr("-x", innergrooveheight_2))
merge_6 = Merge(Data1=line_12, Data2=line_13, Data3=line_14, Data4=line_15)
expression_4 = Expression(x=elementbreadth_2, y=innergroovecount_2, z=innergroovebreadth_2, Expression="(x-z*y)/(y+1)+z")
join = JoinCurves(Curves=merge_6, Preserve=False)
trim = TrimTree(Tree=join, Depth=1)
amp_2 = Amplitude(Vector=rev, Amplitude=expression_4)
flip_3 = FlipCurve(Curve=trim)  # -> Curve, Flag
arrlinear = LinearArray(Geometry=flip_3.Curve, Direction=amp_2, Count=innergroovecount_2)  # -> Geometry, Transform
trim_2 = TrimTree(Tree=arrlinear.Geometry, Depth=1)
join_2 = JoinCurves(Curves=trim_2, Preserve=False)
trim_3 = TrimTree(Tree=join_2, Depth=1)
end_15 = EndPoints(Curve=trim_3)  # -> Start, End
line_16 = LineSDL(Start=end_15.Start, Direction=rev, Length=expression_3)
merge_7 = Merge(Data1=line_16, Data2=trim_3)
join_3 = JoinCurves(Curves=merge_7, Preserve=False)
trim_4 = TrimTree(Tree=join_3, Depth=1)
innennut = StreamFilter(Gate=innergrooves_2, Stream0=line, Stream1=trim_4)
unterseite = Curve(innennut)

rad = Radians(Degrees=expr("x+90", chamferangle_2))
rad_2 = Radians(Degrees=expr("90-x", chamferangle_2))
expression_5 = Expression(x=profileheight_2, y=groovebreadth_2, z=offset_2, Expression="(x-y)/2+z")
rad_3 = Radians(Degrees=expr("90-x", chamferangle_2))
sin = Sine(Value=rad_2)
line_17 = LineSDL(Start=end_7.End, Direction=rev, Length=groovedepth_2)
line_18 = LineSDL(Start=end_6.End, Direction=rev, Length=expression_5)
rad_4 = Radians(Degrees=expr("90-x", chamferangle_2))
sin_2 = Sine(Value=rad_3)
vrot = Rotate(Vector=rev, Axis=deplane_2.XAxis, Angle=rad)
end_16 = EndPoints(Curve=line_17)  # -> Start, End
division = Division(A=expression, B=sin)
end_17 = EndPoints(Curve=line_18)  # -> Start, End
division_2 = Division(A=expression_2, B=sin_2)
vrot_2 = Rotate(Vector=rev, Axis=deplane_2.XAxis, Angle=rad_4)
line_19 = LineSDL(Start=end_16.End, Direction=vrot, Length=division)
line_20 = LineSDL(Start=end_17.End, Direction=vrot_2, Length=division_2)
flip_4 = FlipCurve(Curve=line_19)  # -> Curve, Flag
end_18 = EndPoints(Curve=line_20)  # -> Start, End
end_19 = EndPoints(Curve=flip_4.Curve)  # -> Start, End
ln_2 = Line(StartPoint=end_18.End, EndPoint=end_19.Start)
merge_8 = Merge(Data1=line_7, Data2=line_18)
merge_9 = Merge(Data2=line_20, Data3=ln_2, Data4=flip_4.Curve)
oberseitetrapez = Curve(merge_9)
fasenfederoberseite = Curve(merge_8)

expression_6 = Expression(x=profileheight_2, y=groovebreadth_2, z=chamferdepth_radius_2, Expression="(x-y)/2-z")
rad_5 = Radians(Degrees=expr("90-x", chamferangle_2))
rad_6 = Radians(Degrees=expr("x+90", chamferangle_2))
sin_3 = Sine(Value=rad_5)
expression_7 = Expression(x=profileheight_2, y=tonguebreadth_2, z=chamferdepth_radius_2, Expression="(x-y)/2-z")
line_21 = LineSDL(Start=end_16.End, Direction=deplane_2.ZAxis, Length=expression_6)
rad_7 = Radians(Degrees=expr("90-x", chamferangle_2))
end_20 = EndPoints(Curve=line_18)  # -> Start, End
division_3 = Division(A=chamferdepth_radius_2, B=sin_3)
flip_5 = FlipCurve(Curve=line_21)  # -> Curve, Flag
vrot_3 = Rotate(Vector=rev, Axis=deplane_2.XAxis, Angle=rad_6)
rad_8 = Radians(Degrees=expr("90-x", chamferangle_2))
sin_4 = Sine(Value=rad_7)
line_22 = LineSDL(Start=end_20.End, Direction=deplane_2.ZAxis, Length=expression_7)
end_21 = EndPoints(Curve=flip_5.Curve)  # -> Start, End
line_23 = LineSDL(Start=end_21.Start, Direction=vrot_3, Length=division_3)
division_4 = Division(A=chamferdepth_radius_2, B=sin_4)
vrot_4 = Rotate(Vector=rev, Axis=deplane_2.XAxis, Angle=rad_8)
end_22 = EndPoints(Curve=line_22)  # -> Start, End
flip_6 = FlipCurve(Curve=line_23)  # -> Curve, Flag
end_23 = EndPoints(Curve=flip_6.Curve)  # -> Start, End
line_24 = LineSDL(Start=end_22.End, Direction=vrot_4, Length=division_4)
end_24 = EndPoints(Curve=line_24)  # -> Start, End
ln_3 = Line(StartPoint=end_24.End, EndPoint=end_23.Start)
merge_10 = Merge(Data1=line_22, Data2=line_24, Data3=ln_3, Data4=flip_6.Curve, Data5=flip_5.Curve)
oberseitefase = Curve(merge_10)

merge_11 = Merge(Data1=line_9, Data2=line_6, Data3=line_4, Data4=line_2)

amp_3 = Amplitude(Vector=deplane_2.ZAxis, Amplitude=chamferdepth_radius_2)
amp_4 = Amplitude(Vector=rev, Amplitude=chamferdepth_radius_2)
amp_5 = Amplitude(Vector=rev, Amplitude=expr("-x", chamferdepth_radius_2))
amp_6 = Amplitude(Vector=deplane_2.ZAxis, Amplitude=chamferdepth_radius_2)
addition = Addition(A=amp_4, B=amp_3)
addition_2 = Addition(A=amp_5, B=amp_6)
move_2 = Move(Geometry=end_22.End, Motion=addition)  # -> Geometry, Transform
move_3 = Move(Geometry=end_21.Start, Motion=addition_2)  # -> Geometry, Transform
arc = ArcSED(Start=end_22.End, End=move_2.Geometry, Direction=deplane_2.ZAxis)  # -> Arc, Plane, Radius
arc_2 = ArcSED(Start=end_21.Start, End=move_3.Geometry, Direction=deplane_2.ZAxis)  # -> Arc, Plane, Radius
flip_7 = FlipCurve(Curve=arc_2.Arc)  # -> Curve, Flag
end_25 = EndPoints(Curve=arc.Arc)  # -> Start, End
end_26 = EndPoints(Curve=flip_7.Curve)  # -> Start, End
ln_4 = Line(StartPoint=end_25.End, EndPoint=end_26.Start)
merge_12 = Merge(Data1=line_22, Data2=arc.Arc, Data3=ln_4, Data4=flip_7.Curve, Data5=flip_5.Curve)
oberseitesoftline = Curve(merge_12)

vec2pt = Vector2Pt(PointA=end_8.End, PointB=end_11.End, Unitize=False)  # -> Vector, Length
angle = Angle(VectorA=vec2pt.Vector, VectorB=rev)  # -> Angle, Reflex
cos = Cosine(Value=angle.Angle)
division_5 = Division(A=tonguedepth_2, B=cos)
addition_3 = Addition(A=vec2pt.Length, B=division_5)
line_25 = LineSDL(Start=end_11.End, Direction=vec2pt.Vector, Length=expr("-x", addition_3))
flip_8 = FlipCurve(Curve=line_25)  # -> Curve, Flag
end_27 = EndPoints(Curve=flip_8.Curve)  # -> Start, End
ln_5 = Line(StartPoint=end_5.End, EndPoint=end_27.Start)
merge_13 = Merge(Data1=ln_5, Data2=flip_8.Curve)
oberseiteundfederdiagonal = Curve(merge_13)

expression_8 = Expression(x=profileheight_2, y=tonguebreadth_2, z=offsetblockprofile_2, Expression="(x-y)/2-z")
amp_7 = Amplitude(Vector=rev, Amplitude=expr("x/2", elementbreadth_2))
amp_8 = Amplitude(Vector=deplane_2.ZAxis, Amplitude=profileheight_2)
line_26 = LineSDL(Start=end_8.End, Direction=deplane_2.ZAxis, Length=expression_8)
addition_4 = Addition(A=amp_7, B=amp_8)
line_27 = LineSDL(Start=end_9.End, Direction=deplane_2.ZAxis, Length=expression_8)
flip_9 = FlipCurve(Curve=line_27)  # -> Curve, Flag
end_28 = EndPoints(Curve=line_26)  # -> Start, End
move_4 = Move(Geometry=deplane_2.Origin, Motion=addition_4)  # -> Geometry, Transform
end_29 = EndPoints(Curve=flip_9.Curve)  # -> Start, End
arc_3 = Arc3Pt(PointA=end_28.End, PointB=move_4.Geometry, PointC=end_29.Start)  # -> Arc, Plane, Radius
merge_14 = Merge(Data1=line_26, Data2=arc_3.Arc, Data3=flip_9.Curve)
oberseiteblockprofil = Curve(merge_14)

# ----
# Sadly the tangnet doesn't always point in the same direction.
# The join algorithm is not consistent
# and the forcing of the seam apparently has different rounding errors
# and sometimes y and sometimes the z tangent is the start tangent.
merge_15 = Merge(Data1=federbasis, Data2=fasenfederoberseite, Data3=oberseitefase, Data4=nutbasis)
merge_16 = Merge(Data1=federbasis, Data2=simplefederoberseite, Data3=ln, Data4=einfachenut)
merge_17 = Merge(Data1=federbasis, Data2=fasenfederoberseite, Data3=oberseitesoftline, Data4=nutbasis)
merge_18 = Merge(Data1=federbasis, Data2=fasenfederoberseite, Data3=oberseitetrapez, Data4=nutbasis)
merge_19 = Merge(Data1=federbasis, Data2=blockhausfederoberseite, Data3=oberseiteblockprofil, Data4=nutbasis)
merge_20 = Merge(Data1=federbasis, Data2=oberseiteundfederdiagonal, Data3=einfachenut)
fase = Curve(merge_15)
softline = Curve(merge_17)
blockhaus = Curve(merge_19)
trapez = Curve(merge_18)
diagonalprofile = Curve(merge_20)
simpleprofile = Curve(merge_16)
profil = StreamFilter(
    Gate=profiletype_2,
    Stream0=simpleprofile,
    Stream1=fase,
    Stream2=softline,
    Stream3=trapez,
    Stream4=blockhaus,
    Stream5=diagonalprofile)
join_4 = JoinCurves(Curves=profil, Preserve=True)
trim_5 = TrimTree(Tree=join_4, Depth=1)
merge_21 = Merge(Data1=trim_5, Data2=unterseite)
join_5 = JoinCurves(Curves=merge_21, Preserve=True)
trim_6 = TrimTree(Tree=join_5, Depth=1)
crv_cp = CurveClosestPoint(Point=deplane_2.Origin, Curve=trim_6)  # -> Point, Parameter, Distance
seam = Seam(Curve=trim_6, Seam=crv_cp.Parameter)
profiles = Curve(seam)

crv = Curve(seam)
end_30 = EndPoints(Curve=crv)  # -> Start, End
number_slider = Slider(3, range=0..10)
crv_cp_2 = CurveClosestPoint(Point=end_30.Start, Curve=crv)  # -> Point, Parameter, Distance
eval = EvaluateCurve(Curve=crv, Parameter=crv_cp_2.Parameter)  # -> Point, Tangent, Angle
points = PointList(Points=flatten(end_30.Start), Size=number_slider)
vdisex = VectorDisplayEx(Point=end_30.Start, Vector=eval.Tangent, Colour=RGB(179, 255, 38), Width=number_slider)

amp_9 = Amplitude(Vector=deplane_2.XAxis, Amplitude=lengthelement_2)
extr = Extrude(Base=profiles, Direction=amp_9)
cap = CapHoles(Brep=extr)
amp_10 = Amplitude(Vector=deplane_2.YAxis, Amplitude=elementbreadth_2)
arrlinear_2 = LinearArray(Geometry=cap, Direction=amp_10, Count=elementcount_2)  # -> Geometry, Transform
trim_7 = TrimTree(Tree=arrlinear_2.Geometry, Depth=1)
profilewood = Brep(trim_7)

profilewood_2 = ClusterOutput(profilewood)

# ==== cluster PreviewPort: semio styled preview of ports.
po = ClusterInput()
po_2 = Port(po)
por = ModelPort(Port=po_2)  # -> Port, Valid, Id, Description, Family, CompatibleFamilies, Point, Direction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
vdisex = VectorDisplayEx(Point=por.Point, Vector=por.Direction, Colour=ColourSwatch(SwatchColor=RGB(0, 166, 157)), Width=2)
preview = CustomPreview(Geometry=por.Point, Material=ColourSwatch(SwatchColor=RGB(235, 52, 79)))
tag = TextTag(Location=por.Point, Text=por.Id, Colour=ColourSwatch(SwatchColor=RGB(250, 149, 0)))

# ==== cluster PreviewGeometry: semio styled preview of geometry.
geo = ClusterInput()
swatch = ColourSwatch(SwatchColor=RGB(255, 255, 255))
swatch_2 = ColourSwatch(SwatchColor=RGB(0, 0, 0))
geo_2 = Geometry(flatten(geo))
dispatch = CSharpScript(D=geo_2)  # -> P, C, B, M, R
# ---------- dispatch: C# ----------
// Grasshopper Script Instance
#region Usings
using System;
using System.Linq;
using System.Collections;
using System.Collections.Generic;
using System.Drawing;

using Rhino;
using Rhino.Geometry;

using Grasshopper;
using Grasshopper.Kernel;
using Grasshopper.Kernel.Data;
using Grasshopper.Kernel.Types;
#endregion

public class Script_Instance : GH_ScriptInstance
{
    #region Notes
    /* 
      Members:
        RhinoDoc RhinoDocument
        GH_Document GrasshopperDocument
        IGH_Component Component
        int Iteration

      Methods (Virtual & overridable):
        Print(string text)
        Print(string format, params object[] args)
        Reflect(object obj)
        Reflect(object obj, string method_name)
    */
    #endregion

    private void RunScript(
	object D,
	ref object P,
	ref object C,
	ref object B,
	ref object M,
	ref object R)
    {
        if (D is Curve) C = D; // Curve
        else if (
            D is Rhino.Geometry.Point ||
            D is PointCloud
            )
            P = D; // Point
        else if ( D is Mesh) M = D; // Mesh
        else if (
            D is Surface ||
            D is Extrusion ||
            D is SubD ||
            D is Brep
            )
            B = D; // Brep
        else R = D; // Rest
            
    }
}
# ---------- end dispatch ----------
clean = CleanTree(RemoveNulls=True, RemoveInvalid=True, RemoveEmpty=False, Tree=dispatch.P)
clean_2 = CleanTree(RemoveNulls=True, RemoveInvalid=True, RemoveEmpty=False, Tree=dispatch.C)
clean_3 = CleanTree(RemoveNulls=True, RemoveInvalid=True, RemoveEmpty=False, Tree=dispatch.B)
clean_4 = CleanTree(RemoveNulls=True, RemoveInvalid=True, RemoveEmpty=False, Tree=dispatch.M)
clean_5 = CleanTree(RemoveNulls=True, RemoveInvalid=True, RemoveEmpty=False, Tree=dispatch.R)
debrep = DeconstructBrep(Brep=clean_3)  # -> Faces, Edges, Vertices
preview = CustomPreview(Geometry=flatten(clean_5), Material=swatch_2)
preview_2 = CustomPreview(Geometry=flatten(clean), Material=swatch_2)
preview_3 = CustomPreview(Geometry=flatten(clean_2), Material=swatch_2)
preview_4 = CustomPreview(Geometry=flatten(debrep.Faces), Material=swatch)
preview_5 = CustomPreview(Geometry=flatten(debrep.Edges), Material=swatch_2)
preview_6 = CustomPreview(Geometry=flatten(clean_4), Material=swatch)

# ==== cluster ShowDesign: Show a design by flattening it and selecting representations based on mime and tags. Select exactly one representation based on mime and tags. The tag matching is based on the highest Jaccard index (|∩|/|∪|). If the mime type is not given or does not exist, then all representations are used to search for closest match. If index is equally high the first representation is picked.
dn = ClusterInput()
ty = ClusterInput()
ob = ClusterInput()
mm = ClusterInput()
tags = ClusterInput()
ty_2 = Type(ty)
dn_2 = Design(dn)
ob_2 = Data(ob)
mm_2 = Mime(mm)
tags_2 = Tags(tags)
fltdsn = FlattenDesign(Design=dn_2, Type=ty_2)
dsn = ModelDesign(Design=fltdsn)  # -> Design, Valid, Name, Description, Icon, Image, Variant, View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
typ = ModelType(Type=ty_2)  # -> Type, Valid, Name, Description, Icon, Image, Variant, Unit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
trim = TrimTree(Tree=dsn.Pieces, Depth=1)
rep = ModelRepresentation(Representation=typ.Representations)  # -> Representation, Valid, Url, Description, Mime, Tags
tstat = TreeStatistics(Tree=typ.Representations)  # -> Paths, Length, Count
pce = ModelPiece(Piece=trim)  # -> Piece, Valid, Id, Description, TypeName, TypeVariant, Plane, Center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
tstat_2 = TreeStatistics(Tree=graft(rep.Url))  # -> Paths, Length, Count
trim_2 = TrimTree(Tree=rep.Url, Depth=1)
expression = Expression(x=graft(pce.TypeName), y=typ.Name, Expression="x=y")
expression_2 = Expression(x=graft(pce.TypeVariant), y=typ.Variant, Expression="x=y")
and = GateAnd(A=expression, B=expression_2)
cull = CullPattern(List=ty_2, CullPattern=and)
lng = ListLength(List=ty_2)
txt = Text(cull)
series = Series(Start=0, Step=1, Count=lng)
txt_2 = Text(ty_2)
expression_3 = Expression(x=txt, y=txt_2, Expression="x=y")
trim_3 = TrimTree(Tree=series, Depth=1)
cull_2 = CullPattern(List=trim_3, CullPattern=expression_3)
trim_4 = TrimTree(Tree=cull_2, Depth=1)
item = ListItem(List=tstat.Paths, Index=trim_4, Wrap=True)
branch = TreeBranch(Tree=typ.Representations, Path=item, MaintainPaths=False)
mrg_p = MergeSeperatlyPrepend(x=branch)  # -> Mrgd; inputs x: tree
# ---------- mrg_p: Python ----------
if ghenv.Component.RunCount<2:
    __author__ = "Ueli Saluz"
    __version__ = "2020.05.28"
    
    ghenv.Component.Name = "MergeSeperatly(Prepend)"
    ghenv.Component.NickName = "Mrg(P)"
    ghenv.Component.Description = "Merge inputs seperatly on a new path. Prepend index of input parameter for distincting."
    ghenv.Component.Message = "VER 1.0"

from System import Object
from Grasshopper import DataTree
from Grasshopper.Kernel import GH_ParamAccess as Access

if __name__ == "__main__":
    Mrgd = DataTree[Object]()
    access = Access()
    
    for input in ghenv.Component.Params.Input:  #set all Inputaccess to Tree Access
        input.Access = access.tree
    
    for i,input in enumerate(ghenv.Component.Params.Input):
        for j,source in enumerate(input.Sources):
            for path in source.VolatileData.Paths:
                Mrgd.AddRange(source.VolatileData[path],path.PrependElement(i))
# ---------- end mrg_p ----------
rep_2 = SelectRepresentation(rp=mrg_p, mm=mm_2, tags=tags_2)  # -> rp_5, i_2, ur_2, pa_ur_2
trim_5 = TrimTree(Tree=rep_2.ur_2, Depth=1)
itemindex = ItemIndex(L=trim_2, I=trim_5)  # -> i; inputs L: list; same code as itemindex
item_2 = ListItem(List=tstat_2.Paths, Index=itemindex, Wrap=True)
branch_2 = TreeBranch(Tree=ob_2, Path=item_2, MaintainPaths=False)
mrg_p_2 = MergeSeperatlyPrepend(x=branch_2)  # -> Mrgd; inputs x: tree; same code as mrg_p
trim_6 = TrimTree(Tree=rep_2.pa_ur_2, Depth=1)
trim_7 = TrimTree(Tree=rep_2.rp_5, Depth=1)
id = Id(pce.Id)
rp = Representation(trim_7)
pln = Plane(pce.Plane)
orient = Orient(Geometry=mrg_p_2, Source=PlaneXY(0, 0, 0), Target=graft(pln))  # -> Geometry, Transform
object = Data(orient.Geometry)
rp_2 = ClusterOutput(rp)
pln_2 = ClusterOutput(pln)
object_2 = ClusterOutput(object)
id_2 = ClusterOutput(id)

# ==== cluster SelectRepresentation: Select exactly one representation based on mime and tags. The tag matching is based on the highest Jaccard index (|∩|/|∪|). If the mime type is not given or does not exist, then all representations are used to search for closest match. If index is equally high the first representation is picked.
mm = ClusterInput()
tags = ClusterInput()
rp = ClusterInput()
rp_2 = Representation(rp)
mm_2 = Mime(mm)
tags_2 = Tags(tags)
l2o = List2Object(L=rp_2)  # -> O; inputs L: tree
# ---------- l2o: Python ----------
#Component Information
#--------------------------------------------------------------------------------------------
if ghenv.Component.RunCount<2:
    #General
    #--------------------------------------------------------------------------------------------
    __author__ = "Ueli Saluz"
    __version__ = "2022.04.24"
    
    ghenv.Component.Name = "List2Object"
    ghenv.Component.NickName = "L2O"
    ghenv.Component.Description = "Wraps a list of objects into a list object."
    ghenv.Component.Message = "VER 1.0"
    ghenv.Component.Category = "Sets"
    ghenv.Component.SubCategory = "Tree"
    
     #Inputs
    #--------------------------------------------------------------------------------------------
    inputIndex=0
    
    ghenv.Component.Params.Input[inputIndex].Name = "List"
    ghenv.Component.Params.Input[inputIndex].NickName = "L"
    ghenv.Component.Params.Input[inputIndex].Description = "Tree with lists to wrap."
    ghenv.Component.Params.Input[inputIndex].Optional = False
    inputIndex+=1
    

    #Outputs
    #--------------------------------------------------------------------------------------------
    outputIndex=0
    
    ghenv.Component.Params.Output[outputIndex].Name =  "ListObject" 
    ghenv.Component.Params.Output[outputIndex].NickName = "O"
    ghenv.Component.Params.Output[outputIndex].Description = "Python list object as single item."
    outputIndex+=1


#Imports
#--------------------------------------------------------------------------------------------
from System import Object
from Grasshopper import DataTree

#Solver - Run with trees to enhance performance drastically
#--------------------------------------------------------------------------------------------
if __name__ == "__main__":
    
    #Initialize trees
    #--------------------------------------------------------------------------------------------
    TreeToWrap = DataTree[Object]()
    
    #Data matching
    #--------------------------------------------------------------------------------------------
    for path in L.Paths:
        listBranch = L.Branch(path)
        TreeToWrap.Add(listBranch,path)
    
     #Assign trees to output
    #--------------------------------------------------------------------------------------------
    O = TreeToWrap
# ---------- end l2o ----------

rep = ModelRepresentation(Representation=graft(rp_2))  # -> Representation, Valid, Url, Description, Mime, Tags
lng = ListLength(List=mm_2)
expression = Expression(x=rep.Mime, y=mm_2, Expression="x=y")
null = NullItem(Item=lng)  # -> NullFlags, InvalidFlags, Description
expression_2 = Expression(x=lng, Expression="x=0")
ma = MassAddition(Input=expression)  # -> Result, PartialResults
or = GateOr(A=expression_2, B=null.NullFlags)
cull = CullPattern(List=rep.Representation, CullPattern=ma.Result)
trim = TrimTree(Tree=cull, Depth=1)
mime_match = Representation(trim)
nulltobranch = CSharpScript(D=mime_match)  # -> R; inputs D: tree
# ---------- nulltobranch: C# ----------
#region Usings
using System;
using System.Linq;
using System.Collections;
using System.Collections.Generic;
using System.Drawing;

using Rhino;
using Rhino.Geometry;

using Grasshopper;
using Grasshopper.Kernel;
using Grasshopper.Kernel.Data;
using Grasshopper.Kernel.Types;
#endregion

public class Script_Instance : GH_ScriptInstance
{

    private void RunScript(DataTree<object> D, ref object R)
    {
        foreach (GH_Path path in D.Paths)
            if (D.Branch(path).Count == 0)
                D.Add(null, path);

        R = D;
    }
}
# ---------- end nulltobranch ----------
nullrep = ReplaceNulls(Items=nulltobranch, Replacements=l2o)  # -> graft(Items), Count

o2l = Object2List(O=nullrep.Items)  # -> L; inputs O: tree
# ---------- o2l: Python ----------
# Component Information
# --------------------------------------------------------------------------------------------
if ghenv.Component.RunCount < 2:
    # General
    # --------------------------------------------------------------------------------------------
    __author__ = "Ueli Saluz"
    __version__ = "2025.02.19"

    ghenv.Component.Name = "Object2List"
    ghenv.Component.NickName = "O2L"
    ghenv.Component.Description = "Unwraps a list of objects into a list object and returns the object if it is not iterable."
    ghenv.Component.Message = "VER 1.1"
    ghenv.Component.Category = "Sets"
    ghenv.Component.SubCategory = "Tree"

    # Inputs
    # --------------------------------------------------------------------------------------------
    inputIndex = 0

    ghenv.Component.Params.Input[inputIndex].Name = "ListObject"
    ghenv.Component.Params.Input[inputIndex].NickName = "O"
    ghenv.Component.Params.Input[inputIndex].Description = "A python list object that will be unwrapped into a Grasshopper list or returned as is if not iterable."
    ghenv.Component.Params.Input[inputIndex].Optional = False
    inputIndex += 1

    # Outputs
    # --------------------------------------------------------------------------------------------
    outputIndex = 0

    ghenv.Component.Params.Output[outputIndex].Name = "List"
    ghenv.Component.Params.Output[outputIndex].NickName = "L"
    ghenv.Component.Params.Output[outputIndex].Description = "The unwrapped list."
    outputIndex += 1

# Imports
# --------------------------------------------------------------------------------------------
from System import Object
from Grasshopper import DataTree
from collections import Iterable

# Solver - Run with trees to enhance performance drastically
# --------------------------------------------------------------------------------------------
if __name__ == "__main__":

    # Initialize trees
    # --------------------------------------------------------------------------------------------
    OriginalTree = DataTree[Object]()

    # Data matching
    # --------------------------------------------------------------------------------------------
    for path in O.Paths:
        listBranch = O.Branch(path)
        for i, listItem in enumerate(listBranch):
            if isinstance(listItem, Iterable) and not isinstance(listItem, str):
                OriginalTree.AddRange(list(listItem), path.AppendElement(i))
            else:
                OriginalTree.Add(listItem, path.AppendElement(i))

    # Assign trees to output
    # --------------------------------------------------------------------------------------------
    L = OriginalTree
# ---------- end o2l ----------
trim_2 = TrimTree(Tree=o2l, Depth=1)
trim_3 = TrimTree(Tree=trim_2, Depth=1)

filter = StreamFilter(Gate=or, Stream0=trim_3, Stream1=rp_2)
rp_3 = Representation(filter)

rep_2 = ModelRepresentation(Representation=rp_3)  # -> Representation, Valid, Url, Description, Mime, Tags
jac = JaccardIndex(set1=tags_2, set2=rep_2.Tags)
trim_4 = TrimTree(Tree=jac, Depth=1)
minmax = MinimumMaximum(L=trim_4)  # -> Max, MaxI, Min, MinI; inputs L: list
# ---------- minmax: Python ----------
#Component Information
#--------------------------------------------------------------------------------------------
if ghenv.Component.RunCount<2:
    #General
    #--------------------------------------------------------------------------------------------
    __author__ = "Ueli Saluz"
    __version__ = "2022.04.22"
    
    ghenv.Component.Name = "MinimumMaximum"
    ghenv.Component.NickName = "MinMax"
    ghenv.Component.Description = "Returns the maximum and mininum of a list and their corresponding index."
    ghenv.Component.Message = "VER 1.0"
    ghenv.Component.Category = "Maths"
    ghenv.Component.SubCategory = "Util"
    
     #Inputs
    #--------------------------------------------------------------------------------------------
    inputIndex=0
    
    ghenv.Component.Params.Input[inputIndex].Name = "L"
    ghenv.Component.Params.Input[inputIndex].NickName = "L"
    ghenv.Component.Params.Input[inputIndex].Description = "A list of numbers."
    ghenv.Component.Params.Input[inputIndex].Optional = False
    inputIndex+=1
    
    
    #Outputs
    #--------------------------------------------------------------------------------------------
    outputIndex=0
    
    ghenv.Component.Params.Output[outputIndex].Name = "Max"
    ghenv.Component.Params.Output[outputIndex].NickName = "Max"
    ghenv.Component.Params.Output[outputIndex].Description = "Maximum of the list"
    outputIndex+=1
    
    ghenv.Component.Params.Output[outputIndex].Name = "MaxI"
    ghenv.Component.Params.Output[outputIndex].NickName = "MaxI"
    ghenv.Component.Params.Output[outputIndex].Description = "Index of the maximum of the list"
    outputIndex+=1
    
    ghenv.Component.Params.Output[outputIndex].Name = "Min"
    ghenv.Component.Params.Output[outputIndex].NickName = "Min"
    ghenv.Component.Params.Output[outputIndex].Description = "Minimum of the list"
    outputIndex+=1
    
    ghenv.Component.Params.Output[outputIndex].Name = "MinI"
    ghenv.Component.Params.Output[outputIndex].NickName = "MinI"
    ghenv.Component.Params.Output[outputIndex].Description = "Index of the minimum of the list"
    outputIndex+=1


#Solver - Run with trees to enhance performance drastically
#--------------------------------------------------------------------------------------------
if __name__ == "__main__":
    
    maximum = max(L)
    MaxI = L.index(maximum)
    Max = maximum
    
    minimum = min(L)
    MinI = L.index(minimum)
    Min = minimum
# ---------- end minmax ----------
item = ListItem(List=rep_2.Representation, Index=minmax.MaxI, Wrap=True)
rep_3 = ModelRepresentation(Representation=item)  # -> Representation, Valid, Url, Description, Mime, Tags
sep = Separator()  # -> S; same code as sep
txt = Text(rp_2)
txt_2 = Text(item)
rep_4 = ReplaceText(Text=rep_3.Url, Find="/", Replace=sep, RecursiveReplace=False)
itemindex = ItemIndex(L=txt, I=txt_2)  # -> i; inputs L: list
# ---------- itemindex: Python ----------
#Component Information
#--------------------------------------------------------------------------------------------
if ghenv.Component.RunCount<2:
    #General
    #--------------------------------------------------------------------------------------------
    __author__ = "Ueli Saluz"
    __version__ = "2022.11.18"
    
    ghenv.Component.Name = "ItemIndex"
    ghenv.Component.NickName = "ItemIndex"
    ghenv.Component.Description = "A better IdemIndex"
    ghenv.Component.Message = "VER 1.0"
    ghenv.Component.Category = "Set"
    ghenv.Component.SubCategory = "List"
    
     #Inputs
    #--------------------------------------------------------------------------------------------
    inputIndex=0
    
    ghenv.Component.Params.Input[inputIndex].Name = "List"
    ghenv.Component.Params.Input[inputIndex].NickName = "L"
    ghenv.Component.Params.Input[inputIndex].Description = "Input1 is..."
    ghenv.Component.Params.Input[inputIndex].Optional = False
    inputIndex+=1
    
    ghenv.Component.Params.Input[inputIndex].Name = "Item"
    ghenv.Component.Params.Input[inputIndex].NickName = "I"
    ghenv.Component.Params.Input[inputIndex].Description = "Input2 is..."
    ghenv.Component.Params.Input[inputIndex].Optional = False
    inputIndex+=1
    
    #Outputs
    #--------------------------------------------------------------------------------------------
    outputIndex=0
    
    ghenv.Component.Params.Output[outputIndex].Name = "Index"
    ghenv.Component.Params.Output[outputIndex].NickName = "i"
    ghenv.Component.Params.Output[outputIndex].Description = "Output1 is..."
    outputIndex+=1

i = L.index(I)
# ---------- end itemindex ----------
rp_4 = Representation(item)
ur = Url(rep_3.Url)
pa_ur = Text(rep_4)

i = Integer(itemindex)
i_2 = ClusterOutput(i)
ur_2 = ClusterOutput(ur)
pa_ur_2 = ClusterOutput(pa_ur)
rp_5 = ClusterOutput(rp_4)

# ==== cluster JaccardIndex: Compute the Jaccard Index of two sets.
set1 = ClusterInput()
set2 = ClusterInput()
set1_2 = Data(set1)
set2_2 = Data(set2)
cset = CreateSet(List=set2_2)  # -> Set, Map
cset_2 = CreateSet(List=set1_2)  # -> Set, Map
lng = ListLength(List=set1_2)
lng_2 = ListLength(List=set2_2)
intersection = SetIntersection(SetA=cset_2.Set, SetB=cset.Set)
expression = Expression(x=lng, Expression="x=0")
expression_2 = Expression(x=lng_2, Expression="x=0")
sunion = SetUnion(SetA=cset_2.Set, SetB=cset.Set)
null = NullItem(Item=lng)  # -> NullFlags, InvalidFlags, Description
null_2 = NullItem(Item=lng_2)  # -> NullFlags, InvalidFlags, Description
lng_3 = ListLength(List=sunion)
lng_4 = ListLength(List=intersection)
or = GateOr(A=null.NullFlags, B=expression)
or_2 = GateOr(A=null_2.NullFlags, B=expression_2)
division = Division(A=lng_4, B=lng_3)
int = Integer(or)
int_2 = Integer(or_2)
concat = Concatenate(FragmentA=int, FragmentB=int_2)
b2d = BinaryToDecimal(Binary=concat)  # -> Decimal
# ---------- b2d: Python ----------
if ghenv.Component.RunCount<2:
    __author__ = "Ueli Saluz"
    __version__ = "2021.11.14"
    
    ghenv.Component.Name = "BinaryToDecimal"
    ghenv.Component.NickName = "B2D"
    ghenv.Component.Description = "Converts a number in binary representation to a number in decimal representation."
    ghenv.Component.Message = "VER 1.0"
    
    ghenv.Component.Params.Input[0].NickName = "Binary"
    
    ghenv.Component.Params.Input[0].Description = "Binary representation of a number."
    
    ghenv.Component.Params.Output[0].NickName = "Decimal"
    
    ghenv.Component.Params.Output[0].Description = "Converted decimal representation of the same number."

if __name__ == "__main__":
    Decimal = int(Binary,2)
# ---------- end b2d ----------
expression_3 = Expression(c=b2d, x=division, Expression="If(c=0,x,If(c=3,1,0))")
N = Number(expression_3)
N_2 = ClusterOutput(N)
