# Grasshopper definition old_tests.gh (Grasshopper 1.0.8)
# Copyright: GNU Lesser General Public License Version 3
# Copyright: GNU Lesser General Public License v3.0 or later
# plug-ins: RhinoCodePluginGH, semio

kt = Kit()
kit = ModelKit(Kit=kt)  # -> Kit, Valid, Name, Description, Icon, Image, Preview, Version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
typ = ModelType(Type=kit.Types)  # -> Type, Valid, Name, Description, Icon, Image, Variant, Stock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
rep = ModelRepresentation(Representation=typ.Representations)  # -> Representation, Valid, Url, Description, Tags, Qualities
rep_2 = ModelRepresentation(Representation=graft(rep.Representation), Tags=rep.Tags)  # -> Representation, Valid, Url, Description, Tags, Qualities
trim = TrimTree(Tree=rep_2.Representation, Depth=1)
typ_2 = ModelType(Type=graft(typ.Type), Representations=trim)  # -> Type, Valid, Name, Description, Icon, Image, Variant, Stock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
trim_2 = TrimTree(Tree=typ_2.Type, Depth=1)
kit_2 = ModelKit(Kit=kit.Kit, Types=trim_2)  # -> Kit, Valid, Name, Description, Icon, Image, Preview, Version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
qal = ModelQuality(Name="1")  # -> Quality, Valid, Name, Value, Unit, Definition
qal_2 = ModelQuality(Name="2")  # -> Quality, Valid, Name, Value, Unit, Definition
merge = Merge(Data1=qal.Quality, Data2=qal.Quality)
mrg_a = MergeSeperatlyAppend(x=merge, y=qal_2.Quality)  # -> Mrgd; inputs x: tree, y: tree
# ---------- mrg_a: Python ----------
if ghenv.Component.RunCount<2:
    __author__ = "Ueli Saluz"
    __version__ = "2020.05.28"
    
    ghenv.Component.Name = "MergeSeperatly(Append)"
    ghenv.Component.NickName = "Mrg(A)"
    ghenv.Component.Description = "Merge inputs seperatly on a new path. Append index of input parameter for distincting."
    ghenv.Component.Message = "VER 1.0"

from System import Object
from Grasshopper import DataTree
from Grasshopper.Kernel import GH_ParamAccess as Access

if __name__ == "__main__":
    Mrgd = DataTree[Object]()
    access = Access()
    
    for input in ghenv.Component.Params.Input:  #set all Inputaccess to Tree Access
        input.Access = access.tree
    
    for i,input in enumerate(ghenv.Component.Params.Input):
        for j,source in enumerate(input.Sources):
            for path in source.VolatileData.Paths:
                Mrgd.AddRange(source.VolatileData[path],path.AppendElement(i))
# ---------- end mrg_a ----------
qal_3 = ModelQuality(Quality=mrg_a)  # -> Quality, Valid, Name, Value, Unit, Definition

dir = Directory()  # -> D
# ---------- dir: C# ----------
#region Usings
using System;
using System.Linq;
using System.Collections;
using System.Collections.Generic;
using System.Drawing;
using System.IO;

using Rhino;
using Rhino.Geometry;

using Grasshopper;
using Grasshopper.Kernel;
using Grasshopper.Kernel.Data;
using Grasshopper.Kernel.Types;
#endregion

public class Script_Instance : GH_ScriptInstance
{
    private void RunScript(ref object D)
    {
        D = Path.GetDirectoryName(this.GrasshopperDocument.FilePath);
    }
}
# ---------- end dir ----------
sep = Separator()  # -> S; same code as sep
par = ParentDirectory(D=dir)  # -> P; inputs D: String
# ---------- par: C# ----------
#region Usings
using System;
using System.Linq;
using System.Collections;
using System.Collections.Generic;
using System.Drawing;
using System.IO;

using Rhino;
using Rhino.Geometry;

using Grasshopper;
using Grasshopper.Kernel;
using Grasshopper.Kernel.Data;
using Grasshopper.Kernel.Types;
#endregion

public class Script_Instance : GH_ScriptInstance
{
    private void RunScript(string D, ref object P)
    {
        P = new DirectoryInfo(D).Parent;
    }
}
# ---------- end par ----------
concat = Concatenate(FragmentA=dir, FragmentD=sep, FragmentB="temp")
par_2 = ParentDirectory(D=par)  # -> P; inputs D: String; same code as par
concat_2 = Concatenate(FragmentA=concat, FragmentC=sep, FragmentE="kit")
concat_3 = Concatenate(FragmentA=concat, FragmentD=sep, FragmentC="ai")
concat_4 = Concatenate(FragmentA=par_2, FragmentB=sep, FragmentC="examples")
concat_5 = Concatenate(FragmentA=concat_4, FragmentB=sep, FragmentC="metabolism")
concat_6 = Concatenate(FragmentA=par_2, FragmentC=sep, FragmentE="python", FragmentB=sep, FragmentD="engine", FragmentF=sep, FragmentG="log")
concat_7 = Concatenate(FragmentA=concat_5, FragmentB=sep, FragmentC="kit", FragmentD=".gh")

kt_2 = Kit("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")
kit_3 = ModelKit(Kit=kt_2)  # -> Kit, Valid, Name, Description, Icon, Image, Preview, Version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
typ_3 = ModelType(Type=kit_3.Types)  # -> Type, Valid, Name, Description, Icon, Image, Variant, Stock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
dsn = ModelDesign(Design=kit_3.Designs)  # -> Design, Valid, Name, Description, Icon, Image, Variant, View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
con = ModelConnection(Connection=dsn.Connections)  # -> Connection, Valid, ConnectedPieceId, ConnectedDesignPieceId, ConnectedPieceTypePortId, ConnectingPieceId, ConnectingDesignPieceId, ConnectingPieceTypePortId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
pce = ModelPiece(Piece=dsn.Pieces)  # -> Piece, Valid, Id, Description, TypeName, TypeVariant, DesignName, DesignVariant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
por = ModelPort(Port=typ_3.Ports)  # -> Port, Valid, Id, Description, Mandatory, Family, CompatibleFamilies, Point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
rep_3 = ModelRepresentation(Representation=typ_3.Representations)  # -> Representation, Valid, Url, Description, Tags, Qualities
mrg_a_2 = MergeSeperatlyAppend(
    x=kit_3.Qualities,
    y=typ_3.Qualities,
    z=dsn.Qualities,
    u=rep_3.Qualities,
    v=por.Qualities,
    w=pce.Qualities,
    s=con.Qualities)  # -> Mrgd; inputs x: tree, y: tree, z: tree, u: tree, v: tree, w: tree, s: tree; same code as mrg_a
mrg_a_3 = MergeSeperatlyAppend(x=typ_3.Qualities, y=dsn.Qualities)  # -> Mrgd; inputs x: tree, y: tree; same code as mrg_a
clean = CleanTree(RemoveNulls=True, RemoveInvalid=True, RemoveEmpty=invert(False), Tree=mrg_a_2)
kit_4 = CacheKit(uri=concat_5, R=Toggle(False))  # -> ty_2, ur_2, objects_2, urpa_2, urpalc_2, urpare_2
aut = ModelAuthor(Author=mrg_a_3)  # -> Author, Valid, Name, Email
qal_4 = ModelQuality(Quality=clean)  # -> Quality, Valid, Name, Value, Unit, Definition
ob = Data(Tree({0;0;0}: [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], {0;0;1}: [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], {0;0;2}: [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], {0;0;3}: [], {0;0;4}: [], {0;0;5}: [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]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))
kt_3 = Kit(kit_3.Kit)
ty = Type(kit_3.Types)
co = Connection(dsn.Connections)
dn = Design(kit_3.Designs)
rp = Representation(typ_3.Representations)
po = Port(typ_3.Ports)
ql = Quality(clean)
au = Author(mrg_a_3)
pc = Piece(pce.Piece)

panel = Panel("-")
txt = EncodeText(Text=concat_2, Mode=0)
panel_2 = Panel(txt)
concat_8 = Concatenate(FragmentA=par_2, FragmentB=sep, FragmentC="assets", FragmentD=sep, FragmentE="semio")
po_2 = Port(po)
kt_4 = Kit(kt_3)
ty_2 = Type(ty)
rp_2 = Representation(rp)
dn_2 = Design(dn)
validate = BooleanToggle(False)
ql_2 = Quality(ql)
au_2 = Author(au)
co_2 = Connection(co)
pc_2 = Piece(pc)
ob_2 = Data(ob)
concat_9 = Concatenate(FragmentA=concat_8, FragmentB=sep, FragmentE="kit", FragmentF="_", FragmentC="metabolism", FragmentD=".json")

write = BooleanToggle(False)
kit_5 = SerializeKit(Kit=kt_2)
write_2 = Write(T=kit_5, P=concat_9, R=write)  # -> S; inputs T: String, P: String, R: Boolean
# ---------- write_2: C# ----------
#region Usings
using System;
using System.Linq;
using System.Collections;
using System.Collections.Generic;
using System.Drawing;
using System.IO;

using Rhino;
using Rhino.Geometry;

using Grasshopper;
using Grasshopper.Kernel;
using Grasshopper.Kernel.Data;
using Grasshopper.Kernel.Types;
#endregion

public class Script_Instance : GH_ScriptInstance
{
    private void RunScript(string T, string P, bool R, ref object S)
    {
        if (R == true)
        {
            File.WriteAllText(P, T);
            S = true;
        }
        else
        {
            S = false;
        }
    }
}
# ---------- end write_2 ----------

ty_3 = Type(ty)
typ_txt = TypTxt(ty=ty_3)
typ_4 = SerializeType(Type=ty_3)
concat_10 = Concatenate(FragmentA=concat_8, FragmentC=sep, FragmentB=typ_txt, FragmentD=".json")
txt_2 = WriteText(T=typ_4, P=concat_10, R=write)  # -> S; inputs T: String, P: String, R: Boolean; same code as write_2

dn_3 = Design(dn)
fltdsn = FlattenDesign(Design=graft(dn_3), Types=ty_3)  # -> flatten(Design)
dsn_txt = DsnTxt(dn=dn_3)
dsn_2 = SerializeDesign(Design=fltdsn)
dsn_3 = SerializeDesign(Design=dn_3)
concat_11 = Concatenate(FragmentA=concat_8, FragmentC=sep, FragmentB=dsn_txt, FragmentF="_", FragmentE="flat", FragmentD=".json")
concat_12 = Concatenate(FragmentA=concat_8, FragmentC=sep, FragmentB=dsn_txt, FragmentD=".json")
txt_3 = WriteText(T=dsn_3, P=concat_12, R=write)  # -> S; inputs T: String, P: String, R: Boolean; same code as write_2
txt_4 = WriteText(T=dsn_2, P=concat_11, R=write)  # -> S; inputs T: String, P: String, R: Boolean; same code as write_2

panel_3 = Panel("IdToooooooooooooooooooooooooooooooooooooooLooooooooooooooooooooooooooooooooooooooooooooooooooongggggggggggggggggggggggggggggggggg")
panel_4 = Panel("NameToooooooooooooooooLoooooooooooooooooooooonggggggggggggggggggg")
panel_5 = Panel("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")

dpt = ModelDiagramPoint(Validate=validate)  # -> DiagramPoint, Valid, X, Y

# ----
# Point missing
# Direction missing
por_2 = ModelPort(Validate=validate)  # -> Port, Valid, Id, Description, Mandatory, Family, CompatibleFamilies, Point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

# ----
# Url missing
rep_4 = ModelRepresentation(Validate=validate)  # -> Representation, Valid, Url, Description, Tags, Qualities

panel_6 = Panel("SecondName")

# ----
# Special
# Connected equal Connecting
con_2 = ModelConnection(Validate=validate, ConnectedPieceId="0", ConnectingPieceId="0")  # -> Connection, Valid, ConnectedPieceId, ConnectedDesignPieceId, ConnectedPieceTypePortId, ConnectingPieceId, ConnectingDesignPieceId, ConnectingPieceTypePortId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

# ----
# Validation
# Constructors
# Name missing
qal_5 = ModelQuality(Validate=validate)  # -> Quality, Valid, Name, Value, Unit, Definition

# ----
# Id too long
pt = ConstructPoint(XCoordinate=0, YCoordinate=0, ZCoordinate=0)
X = UnitX(Factor=1)
por_3 = ModelPort(Validate=validate, Id=panel_3, Point=pt, Direction=X)  # -> Port, Valid, Id, Description, Mandatory, Family, CompatibleFamilies, Point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

# ----
# Connected equal Connecting
con_3 = ModelConnection(Validate=validate)  # -> Connection, Valid, ConnectedPieceId, ConnectedDesignPieceId, ConnectedPieceTypePortId, ConnectingPieceId, ConnectingDesignPieceId, ConnectingPieceTypePortId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

# ----
# Url too long
rep_5 = ModelRepresentation(Validate=validate, Url="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")  # -> Representation, Valid, Url, Description, Tags, Qualities

# ----
# Description too long
typ_5 = ModelType(Validate=validate, Name="Name", Description=panel_5)  # -> Type, Valid, Name, Description, Icon, Image, Variant, Stock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

# ----
# Type Name missing
pce_2 = ModelPiece(Validate=validate)  # -> Piece, Valid, Id, Description, TypeName, TypeVariant, DesignName, DesignVariant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

# ----
# Piece not part
con_4 = ModelConnection(ConnectedPieceId="0", ConnectingPieceId="1")  # -> Connection, Valid, ConnectedPieceId, ConnectedDesignPieceId, ConnectedPieceTypePortId, ConnectingPieceId, ConnectingDesignPieceId, ConnectingPieceTypePortId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
dsn_4 = ModelDesign(Validate=validate, Name="Name", Connections=con_4.Connection)  # -> Design, Valid, Name, Description, Icon, Image, Variant, View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

# ----
# Id too long
pce_3 = ModelPiece(Validate=validate, Id=panel_3, TypeName="Name")  # -> Piece, Valid, Id, Description, TypeName, TypeVariant, DesignName, DesignVariant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

# ----
# Props
# Tag too long
rep_6 = ModelRepresentation(Validate=validate, Url="https://url", Tags="https://url")  # -> Representation, Valid, Url, Description, Tags, Qualities

# ----
# Name missing
dsn_5 = ModelDesign(Validate=validate)  # -> Design, Valid, Name, Description, Icon, Image, Variant, View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

# ----
# Description too long
dsn_6 = ModelDesign(Validate=validate, Name="Name", Description=panel_5)  # -> Design, Valid, Name, Description, Icon, Image, Variant, View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

# ----
# Name missing
typ_6 = ModelType(Validate=validate)  # -> Type, Valid, Name, Description, Icon, Image, Variant, Stock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

# ----
# Mime too long
rep_7 = ModelRepresentation(Validate=validate, Url="https://url", Tags=panel_3)  # -> Representation, Valid, Url, Description, Tags, Qualities

number_slider = Slider(0, range=-20..20)
number_slider_2 = Slider(0, range=-20..20)
number_slider_3 = Slider(0, range=0..360)
number_slider_4 = Slider(0, range=0..360)
number_slider_5 = Slider(0, range=0..360)
number_slider_6 = Slider(0, range=0..360)
number_slider_7 = Slider(0, range=0..360)
number_slider_8 = Slider(12.9, range=-20..20)
number_slider_9 = Slider(0, range=-20..20)
number_slider_10 = Slider(360, range=0..360)
number_slider_11 = Slider(0, range=-20..20)
number_slider_12 = Slider(0, range=-20..20)
number_slider_13 = Slider(0, range=0..360)
number_slider_14 = Slider(0, range=0..360)
number_slider_15 = Slider(0, range=0..360)
number_slider_16 = Slider(0, range=-20..20)

# ----
# Name missing
kit_6 = ModelKit(Validate=validate)  # -> Kit, Valid, Name, Description, Icon, Image, Preview, Version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

data = Data("(-Z)")
data_2 = Data("(Z)")

# ----
# Description too long
kit_7 = ModelKit(Validate=validate, Name="Name", Description=panel_5)  # -> Kit, Valid, Name, Description, Icon, Image, Preview, Version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

data_3 = Data("(-Y)")
data_4 = Data("(Y)")
data_5 = Data("(X)")
data_6 = Data("(-X)")
con_5 = ModelConnection(
    ConnectedPieceTypePortId=data_5,
    ConnectingPieceTypePortId=data_6,
    Gap=number_slider_9,
    Shift=number_slider_9,
    Rise=number_slider_16,
    Rotation=number_slider_10,
    Turn=number_slider_7,
    Tilt=number_slider_6)  # -> Connection, Valid, ConnectedPieceId, ConnectedDesignPieceId, ConnectedPieceTypePortId, ConnectingPieceId, ConnectingDesignPieceId, ConnectingPieceTypePortId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
con_6 = ModelConnection(
    ConnectedPieceTypePortId=data_2,
    ConnectingPieceTypePortId=data,
    Gap=Slider(0, range=-20..20),
    Shift=number_slider_9,
    Rise=number_slider_16,
    Rotation=number_slider_10,
    Turn=number_slider_7,
    Tilt=number_slider_6)  # -> Connection, Valid, ConnectedPieceId, ConnectedDesignPieceId, ConnectedPieceTypePortId, ConnectingPieceId, ConnectingDesignPieceId, ConnectingPieceTypePortId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
con_7 = ModelConnection(
    ConnectedPieceTypePortId=data_4,
    ConnectingPieceTypePortId=data_3,
    Gap=Slider(0, range=-20..20),
    Shift=number_slider_9,
    Rise=number_slider_16,
    Rotation=number_slider_10,
    Turn=number_slider_7,
    Tilt=number_slider_6)  # -> Connection, Valid, ConnectedPieceId, ConnectedDesignPieceId, ConnectedPieceTypePortId, ConnectingPieceId, ConnectingDesignPieceId, ConnectingPieceTypePortId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

ty_4 = Type(flatten(ty))
pc_3 = Piece(ty_4)
typ_7 = ModelType(Type=ty_4)  # -> Type, Valid, Name, Description, Icon, Image, Variant, Stock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
ty_5 = Type(pc_3)
# Casts
typ_8 = ModelType(Type=ty_5)  # -> Type, Valid, Name, Description, Icon, Image, Variant, Stock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
txt_5 = Text(ty_4)
txt_6 = Text(ty_5)
expression = Expression(x=typ_8.Name, Expression="x≠y")
expression_2 = Expression(x=txt_5, y=txt_6, Expression="x=y")
mm = MassMultiplication(Input=expression)  # -> Result, PartialResults
mm_2 = MassMultiplication(Input=expression_2)  # -> Result, PartialResults
and = GateAnd(A=mm_2.Result, B=mm.Result)
success = Panel(and)

panel_7 = Panel(con_5.Connection)
panel_8 = Panel(con_6.Connection)
panel_9 = Panel(con_7.Connection)
mesh = Mesh(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)
ty_6 = Type()

# ---- group: Final Linear Pcs Generator
ty_7 = Type(ty_6)
pcs = LinearPieces(ty=ty_7, X=Slider(10, range=0..10))

# ---- group: Final Grid Pcs Generator
ty_8 = Type(ty_6)
gnrt_grid_pcs = GnrtGridPcs(ty=ty_8, X=Slider(14, range=0..20), Y=Slider(13, range=0..20))

# ---- group: Final Linear Pcs Generator
ty_9 = Type(ty_6)
pcs_2 = LinearPieces(ty=ty_9, X=Slider(8, range=0..10))

ty_10 = Type(ty_6)
pcs_3 = LinearPieces(ty=ty_10, X=Slider(8, range=0..10))

# ---- group: Final Grid Pcs Generator
ty_11 = Type(ty_6)
gnrt_grid_pcs_2 = GnrtGridPcs(ty=ty_11, X=Slider(14, range=0..20), Y=Slider(13, range=0..20))

ty_12 = Type(ty_6)
gnrt_grid_pcs_3 = GnrtGridPcs(ty=ty_12, X=Slider(14, range=0..20), Y=Slider(13, range=0..20))

# ----
and_2 = GateAnd(B=and)
success_2 = Panel(and_2)

# ---- group: Final Linear
cons = LinearConnections(pc=pcs_3, co=con_6.Connection)

# ---- group: Final Grid
gridcons = LinearConnections_2(pc=gnrt_grid_pcs, cox=con_5.Connection, coy=con_7.Connection)

# ---- group: Final Linear
cons_2 = LinearConnections(pc=pcs_2, co=con_6.Connection)

# ---- group: Final Grid
gridcons_2 = LinearConnections_2(pc=gnrt_grid_pcs_2, cox=con_5.Connection, coy=con_7.Connection)

gridcons_3 = LinearConnections_2(pc=gnrt_grid_pcs_3, cox=con_5.Connection, coy=con_7.Connection)

# ----
# Assitant
list = ValueList({"Dsn(Nakagin Capsule Tower)": 0, "Dsn(Nakagin Capsule Tower,Slanted)": 1, "Dsn(Nakagin Capsule Tower,Twisted)": 2, "Dsn(Nakagin Capsule Tower,Dancing,Explosion Axonometry)": 3}, selected="Dsn(Nakagin Capsule Tower)")
list_2 = ValueList({"Typ(Base)": 0, "Typ(Base,Blob)": 1, "Typ(Bridge)": 2, "Typ(Capital)": 3, "Typ(Cylindric Capital)": 4, "Typ(Capsule,\)": 5, "Typ(Capsule,/)": 6, "Typ(Capsule,q)": 7, "Typ(Capsule,p)": 8, "Typ(Capsule,J)": 9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}, selected=["Typ(Capsule,\)", "Typ(Capsule,/)", "Typ(Capsule,q)", "Typ(Capsule,p)", "Typ(Capsule,J)", "Typ(Capsule,L)": 10, "Typ(Capsule,s)": 11, "Typ(Capsule,z)": 12, "Typ(Tambour)": 37, "Typ(Tambour,First Storey)": 38, "Typ(Tambour,Last Storey)": 39])
item = ListItem(List=ty, Index=list_2, Wrap=True)
item_2 = ListItem(List=ty, Index=list_2, Wrap=True)
concat_13 = Concatenate(FragmentA=concat_6, FragmentC=sep, FragmentE="014")
dsn_7 = PredictDesign(Description="Tambour with a capsule on every door.", Types=item, Run=Toggle(False))  # -> Success, Design
concat_14 = Concatenate(FragmentA=concat_13, FragmentC=sep, FragmentE="predicted-design-healed.json")
dsn_8 = PredictDesign(Description="A stack of 5 tambours with 8 capsules each.", Types=item_2, Run=Toggle(False))  # -> Success, Design
dn_4 = Design("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")
file = ReadFile(File=concat_14, PerLineParse=False)
dn_5 = Design("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")
dn_6 = Design("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")
dn_7 = Design("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")
dsn_9 = DeserializeDesign(Text=file)
dn_8 = Design(dsn_9)
mime = Mime({".glb": "model/gltf-binary", ".gltf": "model/gltf+json", ".stl": "model/stl", ".obj": "model/obj", ".blend": "model/x-blender", ".3dm": "model/vnd.3dm", ".ifc": "model/x-ifc", ".dwg": "model/acad", ".dxf": "model/dxf", ".rvt": "model/vnd.revit"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}, selected=".3dm")
list_3 = ValueList({"1to500", "1to200"}, selected="1to500")
dsn_10 = PreviewDesign(ty=flatten(ty), ob=ob, tags=list_3, sc=1)

number_slider_17 = Slider(0, range=0..2)

# ----
# Überarbeiten von ShowDesign in den Clustern
dsn_bl = DesignToBlock()  # -> block_definition_3, block_instance_3, i_2
typ_9 = LoadType(mm="model/vnd.3dm", R=False)  # -> ty_2, object_2, shader_2, ur_2, path_2
dsn_11 = LoadDesign(mm="model/vnd.3dm", R=False)  # -> dn_2, object_2, shader_2, ur_2, path_2, id_2, pln_2

# ----
# Normalization not affecting semantics
item_3 = ListItem(List=dn, Index=0, Wrap=True)
dsn_12 = NormalizeDesign_2(dn=item_3)
shwdsn = ShowDesign(dn=item_3, ty=ty, mm="model/vnd.3dm")  # -> id_2, ur_2, pln_2
shwdsn_2 = ShowDesign(dn=dsn_12, ty=ty, mm="model/vnd.3dm")  # -> id_2, ur_2, pln_2
tsort = SortText(Keys=shwdsn_2.id_2, Values=shwdsn_2.pln_2, Culture=127)  # -> Keys, Values
tsort_2 = SortText(Keys=shwdsn.id_2, Values=shwdsn.pln_2, Culture=127)  # -> Keys, Values
expression_3 = Expression(x=tsort_2.Values, y=tsort.Values, Expression="x=y")
mm_3 = MassMultiplication(Input=expression_3)  # -> Result, PartialResults
bool = Boolean(mm_3.Result)
success_3 = Panel(bool)

number_slider_18 = Slider(0, range=0..2)
graft = GraftTree(Tree=mesh, IncludeEmptyLists=True, IncludeNullItems=True)

# ----
# Native Components
kt_5 = Kit(flatten(kt_3))
ty_13 = Type(flatten(ty))
dn_9 = Design(flatten(dn))
rp_3 = Representation(flatten(rp))
po_3 = Port(flatten(po))
ql_3 = Quality(flatten(ql))
au_3 = Author(flatten(au))
pc_4 = Piece(flatten(pc))
co_3 = Connection(flatten(co))
merge_2 = Merge(Data1=kt_5, Data2=ty_13, Data3=dn_9, Data4=rp_3, Data5=po_3, Data6=ql_3, Data7=au_3, Data8=pc_4, Data9=co_3)
panel_10 = Panel("""(
)
, """)
rev = ReverseList(List=panel_10)
panel_11 = Panel("""--
_""")
rev_2 = ReverseList(List=panel_11)
txt_7 = Text(merge_2)
panel_12 = Panel(txt_7)
panel_13 = Panel("""§
&""")
rev_3 = ReverseList(List=panel_13)
panel_14 = Panel("""[
]
;""")
rev_4 = ReverseList(List=panel_14)
txt_8 = EncodeText(Text=txt_7, Mode=0)
txt_9 = EncodeText(Text=txt_7, Mode="1")
txt_10 = EncodeText(Text=txt_7, Mode="2", Forbidden=panel_10, Replace=panel_14)
txt_11 = EncodeText(Text=txt_7, Mode=0, Forbidden=panel_11, Replace=panel_13)
txt_12 = EncodeText(Text=txt_7, Mode="1", Forbidden=panel_11, Replace=panel_13)
txt_13 = EncodeText(Text=txt_7, Mode="2", Forbidden=panel_11, Replace=panel_13)
txt_14 = DecodeText(EncodedText=txt_8, Mode=0)
txt_15 = DecodeText(EncodedText=txt_9, Mode="1")
txt_16 = DecodeText(EncodedText=txt_10, Mode="2", Replace=rev_4, Original=rev)
txt_17 = DecodeText(EncodedText=txt_11, Mode=0, Replace=rev_3, Original=rev_2)
txt_18 = DecodeText(EncodedText=txt_12, Mode="1", Replace=rev_3, Original=rev_2)
txt_19 = DecodeText(EncodedText=txt_13, Mode="2", Replace=rev_3, Original=rev_2)
panel_15 = Panel(txt_13)
expression_4 = Expression(x=txt_7, y=txt_14, Expression="x=y")
expression_5 = Expression(x=txt_7, y=txt_15, Expression="x=y")
expression_6 = Expression(x=txt_7, y=txt_16, Expression="x=y")
expression_7 = Expression(x=txt_7, y=txt_17, Expression="x=y")
expression_8 = Expression(x=txt_7, y=txt_18, Expression="x=y")
expression_9 = Expression(x=txt_7, y=txt_19, Expression="x=y")
mm_4 = MassMultiplication(Input=flatten(expression_4))  # -> Result, PartialResults
mm_5 = MassMultiplication(Input=flatten(expression_5))  # -> Result, PartialResults
mm_6 = MassMultiplication(Input=flatten(expression_6))  # -> Result, PartialResults
mm_7 = MassMultiplication(Input=flatten(expression_7))  # -> Result, PartialResults
mm_8 = MassMultiplication(Input=flatten(expression_8))  # -> Result, PartialResults
mm_9 = MassMultiplication(Input=flatten(expression_9))  # -> Result, PartialResults
and_3 = GateAnd(A=mm_4.Result, B=mm_5.Result, C=mm_6.Result, D=mm_7.Result, E=mm_8.Result, F=mm_9.Result)
success_4 = Panel(and_3)

panel_16 = Panel("""Some RANDOM_texT WItH ➕ & "§/\? 
21st .3 at((r3),76 cr-azy""")
txt_20 = NormalizeText(Text=panel_16)  # -> Norm, Title, Underscore, Kebab, Pascal
panel_17 = Panel(txt_20.Norm)
panel_18 = Panel(txt_20.Title)
panel_19 = Panel(txt_20.Underscore)
panel_20 = Panel(txt_20.Kebab)
panel_21 = Panel(txt_20.Pascal)

panel_22 = Panel("""Some RANDOM_texT WItH ➕ & "§/\? 
21st .3 at((r3),76 cr-azy""")
txt_21 = TruncateText(Text=panel_22, Length=Slider(7, range=0..10), Termination="…")  # -> Strict, Characters, Words
panel_23 = Panel(txt_21.Strict)
panel_24 = Panel(txt_21.Characters)
panel_25 = Panel(txt_21.Words)

dn_10 = Design(dn)
objs_txt = ObjectsToText(Objects=dn_10)
panel_26 = Panel(objs_txt)

typ_10 = ReplaceType(dn=dn_8, old_na="Capsule", new_na="Capsule with Balcony")

dn_11 = Design(dn)
ty_14 = Type(ty)
item_4 = ListItem(List=dn_11, Index=0, Wrap=True)
dn_12 = Design()
dsn_13 = PreviewDesign(dn=item_4, ty=ty_14, sc=1)  # disabled

co_4 = Connection("{\"connected\":{\"piece\":{\"id_\":\"\"},\"designPiece\":null,\"port\":{\"id_\":\"t\"}},\"connecting\":{\"piece\":{\"id_\":\"\"},\"designPiece\":null,\"port\":{\"id_\":\"b\"}},\"description\":\"\",\"gap\":0.0,\"shift\":0.0,\"rise\":0.0,\"rotation\":0.0,\"turn\":0.0,\"tilt\":0.0,\"x\":0.0,\"y\":2.96,\"qualities\":[]}")
pc_5 = Piece(["{\"id_\":\"t_f0_b_c0\",\"description\":\"\",\"type\":{\"name\":\"Tambour\",\"variant\":\"First Storey\"},\"design\":null,\"plane\":null,\"center\":null,\"hidden\":false,\"locked\":false,\"qualities\":[]}", "{\"id_\":\"t_f1_b_c0\",\"description\":\"\",\"type\":{\"name\":\"Tambour\",\"variant\":\"\"},\"design\":null,\"plane\":null,\"center\":null,\"hidden\":false,\"locked\":false,\"qualities\":[]}", "{\"id_\":\"t_f2_b_c0\",\"description\":\"\",\"type\":{\"name\":\"Tambour\",\"variant\":\"\"},\"design\":null,\"plane\":null,\"center\":null,\"hidden\":false,\"locked\":false,\"qualities\":[]}", "{\"id_\":\"t_f3_b_c0\",\"description\":\"\",\"type\":{\"name\":\"Tambour\",\"variant\":\"\"},\"design\":null,\"plane\":null,\"center\":null,\"hidden\":false,\"locked\":false,\"qualities\":[]}", "{\"id_\":\"t_f4_b_c0\",\"description\":\"\",\"type\":{\"name\":\"Tambour\",\"variant\":\"\"},\"design\":null,\"plane\":null,\"center\":null,\"hidden\":false,\"locked\":false,\"qualities\":[]}", "{\"id_\":\"t_f5_b_c0\",\"description\":\"\",\"type\":{\"name\":\"Tambour\",\"variant\":\"\"},\"design\":null,\"plane\":null,\"center\":null,\"hidden\":false,\"locked\":false,\"qualities\":[]}", "{\"id_\":\"t_f6_b_c0\",\"description\":\"\",\"type\":{\"name\":\"Tambour\",\"variant\":\"\"},\"design\":null,\"plane\":null,\"center\":null,\"hidden\":false,\"locked\":false,\"qualities\":[]}", "{\"id_\":\"t_f7_b_c0\",\"description\":\"\",\"type\":{\"name\":\"Tambour\",\"variant\":\"\"},\"design\":null,\"plane\":null,\"center\":null,\"hidden\":false,\"locked\":false,\"qualities\":[]}", "{\"id_\":\"t_f8_b_c0\",\"description\":\"\",\"type\":{\"name\":\"Tambour\",\"variant\":\"Last Storey\"},\"design\":null,\"plane\":null,\"center\":null,\"hidden\":false,\"locked\":false,\"qualities\":[]}"])
con_8 = ModelConnection(
    Connection=co_4,
    Gap=Slider(0.7, range=0..1),
    Shift=Slider(0, range=0..1),
    Rise=Slider(0.3, range=0..1),
    Rotation=Slider(28, range=0..100),
    Turn=Slider(0, range=0..100),
    Tilt=Slider(0, range=0..100))  # -> Connection, Valid, ConnectedPieceId, ConnectedDesignPieceId, ConnectedPieceTypePortId, ConnectingPieceId, ConnectingDesignPieceId, ConnectingPieceTypePortId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
cons_3 = LinearConnections(pc=pc_5, co=con_8.Connection)
list_4 = ValueList({"", "1to500", "1to200", "collider", "energy"}, selected="1to500")
dsn_14 = ModelDesign(Pieces=pc_5, Connections=cons_3)  # -> Design, Valid, Name, Description, Icon, Image, Variant, View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
ty_15 = Type(flatten(ty))
ob_3 = Data(ob)
dsn_15 = PreviewDesign(dn=dsn_14.Design, ty=ty_15, ob=ob_3, tags=list_4, sc=1)  # disabled

new_vn = TypeVariant("Blob")
na = TypeName("Base")
dn_13 = Design("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")
mime_2 = Mime({".glb": "model/gltf-binary", ".gltf": "model/gltf+json", ".stl": "model/stl", ".obj": "model/obj", ".blend": "model/x-blender", ".3dm": "model/vnd.3dm", ".ifc": "model/x-ifc", ".dwg": "model/acad", ".dxf": "model/dxf", ".rvt": "model/vnd.revit"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}, selected=".3dm")
typ_11 = VaryTypes(dn=dn_13, na=na, new_vn=new_vn)
list_5 = ValueList({"1to500", "1to200", "collider", "energy"}, selected="1to500")
ty_16 = Type(flatten(ty))
ob_4 = Data(ob)
dsn_16 = PreviewDesign(dn=typ_11, ty=ty_16, ob=ob_4, tags=list_5, sc=1)  # disabled
dsn_17 = PreviewDesign(dn=dn_13, ty=ty_16, ob=ob_4, tags=list_5, sc=1)  # disabled

# ----
# Old Version
dn_14 = Design(dn)
item_5 = ListItem(List=dn_14, Index=0, Wrap=True)  # -> Item, Item1, Item2
dsns = InterpolateDesigns(S=item_5.Item1, T=item_5.Item2, t=Slider(0.4, range=0..1))  # -> dn_s_u_t_2, dn_s_t_2, dn_t_s_2
mime_3 = Mime({".glb": "model/gltf-binary", ".gltf": "model/gltf+json", ".stl": "model/stl", ".obj": "model/obj", ".blend": "model/x-blender", ".3dm": "model/vnd.3dm", ".ifc": "model/x-ifc", ".dwg": "model/acad", ".dxf": "model/dxf", ".rvt": "model/vnd.revit"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}, selected=".3dm")
ty_17 = Type(flatten(ty))
list_6 = ValueList({"1to500", "1to200", "collider", "energy"}, selected="1to500")
ob_5 = Data(ob)
dsn_18 = PreviewDesign(dn=dsns.dn_s_u_t_2, ty=ty_17, ob=ob_5, tags=list_6, sc=1)  # disabled
inpdsn = InterpolateDesigns()  # -> dn_s_u_t_2, dn_s_t_2, dn_t_s_2

dn_15 = Design(dn)
item_6 = ListItem(List=dn_15, Index=0, Wrap=True)
panel_27 = Panel("Capsule")
mime_4 = Mime({".glb": "model/gltf-binary", ".gltf": "model/gltf+json", ".stl": "model/stl", ".obj": "model/obj", ".blend": "model/x-blender", ".3dm": "model/vnd.3dm", ".ifc": "model/x-ifc", ".dwg": "model/acad", ".dxf": "model/dxf", ".rvt": "model/vnd.revit"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}, selected=".3dm")
typ_12 = ReplaceType(dn=item_6, old_na=item_6, new_na="Capsule with Balcony")
list_7 = ValueList({"1to500", "1to200", "collider", "energy"}, selected="1to500")
ty_18 = Type(flatten(ty))
ob_6 = Data(ob)
dsn_19 = PreviewDesign(dn=typ_12, ty=ty_18, ob=ob_6, tags=list_7, sc=1)  # disabled

dn_16 = Design(flatten(dn))
mime_5 = Mime({".glb": "model/gltf-binary", ".gltf": "model/gltf+json", ".stl": "model/stl", ".obj": "model/obj", ".blend": "model/x-blender", ".3dm": "model/vnd.3dm", ".ifc": "model/x-ifc", ".dwg": "model/acad", ".dxf": "model/dxf", ".rvt": "model/vnd.revit"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}, selected=".3dm")
item_7 = ListItem(List=dn_16, Index=0, Wrap=True)  # -> Item, Item1, Item2
list_8 = ValueList({"1to500", "1to200", "collider", "energy"}, selected="1to200")
flatten = FlattenTree(Tree=ty, Path="{0}")
dsn_bl_2 = DesignToBlock_2(dn=item_7.Item2, ty=flatten, ob=ob, mm=mime_5, tags=list_8)  # -> block_definition_3, block_instance_3, i_2

merge_3 = Merge(Data1="1to200", Data2="plan", Data3="floor")
merge_4 = Merge(Data1="1to200", Data2="plan")
merge_5 = Merge(Data1="plan", Data2="floor", Data3="ground")
merge_6 = Merge(Data1="1to200", Data2="plan", Data3="floor", Data4="ground")
mrg_a_4 = MergeSeperatlyAppend(x=merge_4, y=merge_5, z=merge_6)  # -> Mrgd; inputs x: tree, y: tree, z: tree; same code as mrg_a
num = Number(Tree({0;0}: [0.6666666667], {0;1}: [0.5], {0;2}: [0.75]))
jac = JaccardIndex(set1=merge_3, set2=mrg_a_4)
panel_28 = Panel(num)
panel_29 = Panel(merge_3)
expression_10 = Expression(x=jac, y=num, Expression="x=y")
panel_30 = Panel(mrg_a_4)
mm_10 = MassMultiplication(Input=flatten(expression_10))  # -> Result, PartialResults
success_5 = Panel(mm_10.Result)

ghbkit = GitHubKit(domain="github.com", account="usalu", repo="metabolism", branch="main")  # -> remote_2, homepage_2
ghbkit_2 = GitHubKit(domain="github.com", account="usalu", repo="metabolism", branch="dev")  # -> remote_2, homepage_2
ghbkit_3 = GitHubKit(domain="github.com", account="usalu", repo="metabolism", tag="main-tag")  # -> remote_2, homepage_2
ghbkit_4 = GitHubKit(domain="github.com", account="usalu", repo="metabolism", commit="1ef59aec9f6d93a2878d3771c6401209c9ba597c")  # -> remote_2, homepage_2
panel_31 = Panel("https://github.com/usalu/metabolism/archive/refs/tags/main-tag.zip")
panel_32 = Panel("https://github.com/usalu/metabolism/archive/refs/heads/dev.zip")
panel_33 = Panel("https://github.com/usalu/metabolism/archive/1ef59aec9f6d93a2878d3771c6401209c9ba597c.zip")
panel_34 = Panel("https://github.com/usalu/metabolism/tree/1ef59aec9f6d93a2878d3771c6401209c9ba597c")
panel_35 = Panel("https://github.com/usalu/metabolism/archive/refs/heads/main.zip")
# UserObjects
expression_11 = Expression(x=ghbkit.remote_2, y=panel_35, Expression="x=y")
expression_12 = Expression(x=ghbkit.homepage_2, y="https://github.com/usalu/metabolism/tree/main", Expression="x=y")
expression_13 = Expression(x=ghbkit_2.remote_2, y=panel_32, Expression="x=y")
expression_14 = Expression(x=ghbkit_2.homepage_2, y="https://github.com/usalu/metabolism/tree/dev", Expression="x=y")
expression_15 = Expression(x=ghbkit_3.remote_2, y=panel_31, Expression="x=y")
expression_16 = Expression(x=ghbkit_3.homepage_2, y="https://github.com/usalu/metabolism/tree/main-tag", Expression="x=y")
expression_17 = Expression(x=ghbkit_4.remote_2, y=panel_33, Expression="x=y")
expression_18 = Expression(x=ghbkit_4.homepage_2, y=panel_34, Expression="x=y")
and_4 = GateAnd(A=expression_11, B=expression_12)
and_5 = GateAnd(A=expression_13, B=expression_14)
and_6 = GateAnd(A=expression_15, B=expression_16)
and_7 = GateAnd(A=expression_17, B=expression_18)
and_8 = GateAnd(A=and_4, B=and_5, C=and_6, D=and_7)
success_6 = Panel(and_8)

dn_17 = Design(dn)

mime_6 = Mime({".glb": "model/gltf-binary", ".gltf": "model/gltf+json", ".stl": "model/stl", ".obj": "model/obj", ".blend": "model/x-blender", ".3dm": "model/vnd.3dm", ".ifc": "model/x-ifc", ".dwg": "model/acad", ".dxf": "model/dxf", ".rvt": "model/vnd.revit"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}, selected=".glb")
mime_7 = Mime({".glb": "model/gltf-binary", ".gltf": "model/gltf+json", ".stl": "model/stl", ".obj": "model/obj", ".blend": "model/x-blender", ".3dm": "model/vnd.3dm", ".ifc": "model/x-ifc", ".dwg": "model/acad", ".dxf": "model/dxf", ".rvt": "model/vnd.revit"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}, selected=".3dm")
mime_8 = Mime({".glb": "model/gltf-binary", ".gltf": "model/gltf+json", ".stl": "model/stl", ".obj": "model/obj", ".blend": "model/x-blender", ".3dm": "model/vnd.3dm", ".ifc": "model/x-ifc", ".dwg": "model/acad", ".dxf": "model/dxf", ".rvt": "model/vnd.revit"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}, selected=".ifc")
mime_9 = Mime({".glb": "model/gltf-binary", ".gltf": "model/gltf+json", ".stl": "model/stl", ".obj": "model/obj", ".blend": "model/x-blender", ".3dm": "model/vnd.3dm", ".ifc": "model/x-ifc", ".dwg": "model/acad", ".dxf": "model/dxf", ".rvt": "model/vnd.revit"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}, selected=".speckle": "model/vnd.speckle+json")
rp_4 = Representation(rp)
mtchanc = MatchAncestor(AT=mime_7, CT=rp_4)  # -> MAT; inputs AT: tree, CT: tree
# ---------- mtchanc: Python ----------
if ghenv.Component.RunCount<2:
    __author__ = "Ueli Saluz"
    __version__ = "2022.04.25"
    
    ghenv.Component.Name = "Match Ancestor"
    ghenv.Component.NickName = "MtchAnc"
    ghenv.Component.Description = "Duplicates all elements of an ancestor tree to match the amount of elements in the child tree."
    ghenv.Component.Message = "VER 1.1"
    
    ghenv.Component.Params.Input[0].Name = "AncestorTree"
    ghenv.Component.Params.Input[0].NickName = "AT"
    ghenv.Component.Params.Input[0].Description = "Ancestor tree that data will the duplicated until it matches the child tree"
    ghenv.Component.Params.Input[0].Optional = False
    
    ghenv.Component.Params.Input[1].Name = "ChildTree"
    ghenv.Component.Params.Input[1].NickName = "CT"
    ghenv.Component.Params.Input[1].Description = "Child tree that branches will the guide to duplicat the data of the ancestor tree"
    ghenv.Component.Params.Input[0].Optional = False
    
    ghenv.Component.Params.Output[0].Name = "MatchedAncestorTree"
    ghenv.Component.Params.Output[0].NickName = "MAT"
    ghenv.Component.Params.Output[0].Description = "Matched ancestor tree with the amount of items and the branch paths of the child tree"

from System import Object
from Grasshopper import DataTree

"""Returns a new tree with the ancestor data being duplicated along all child branches which where child paths of that ancestor.
    Inputs:
        ancestorTree: Ancestor tree that data will the duplicated until it matches the child tree
        childTree: Child tree that branches will the guide to duplicat the data of the ancestor tree
    Output:
        matchedAncestorTree: Matched ancestor tree with the amount of items and the branch paths of the child tree"""
def MatchAncestorTreeToChildTree (ancestorTree, childTree):
    
    matchedAncestorTree = DataTree[Object]()
    dummy = 0
    for i,pathAncestor in enumerate(ancestorTree.Paths):
        branch = ancestorTree.Branch(pathAncestor)
        if len(branch)!=1:
            raise Exception("Ancestor must be grafted and containing one item per branch")
        #The item to be duplicated
        item = branch[0]
        for j,pathChild in enumerate(childTree.Paths):
            #Returns a tuple and not like in the documentation described a bool with a pointer to the int to store the generations
            checkAncestor = pathChild.IsAncestor(pathAncestor,dummy)
            if(checkAncestor[0]):
                matchedAncestorTree.AddRange([item]*childTree.Branch(pathChild).Count,pathChild)
    return matchedAncestorTree

if __name__ == "__main__":
    MAT = MatchAncestorTreeToChildTree (AT,CT)
# ---------- end mtchanc ----------
merge_7 = Merge(Data1=mime_9, Data2="1to200")
merge_8 = Merge(Data1="1to200", Data2="does not exist", Data3=mime_8)
rep_8 = SelectRepresentation(rp=rp_4)  # -> rp_4, i_2
rep_9 = SelectRepresentation(rp=rp_4, tags=mime_6)  # -> rp_4, i_2
rep_10 = SelectRepresentation(rp=rp_4, tags=mime_7)  # -> rp_4, i_2
rep_11 = SelectRepresentation(rp=rp_4, tags=mtchanc)  # -> rp_4, i_2
rep_12 = SelectRepresentation(rp=rp_4, tags="1to200")  # -> rp_4, i_2
rep_13 = SelectRepresentation(rp=rp_4, tags=merge_7)  # -> rp_4, i_2
rep_14 = SelectRepresentation(rp=rp_4, tags="does not exist")  # -> rp_4, i_2
rep_15 = SelectRepresentation(rp=rp_4, tags=merge_8)  # -> rp_4, i_2
rep_16 = SelectRepresentation(rp=rp_4, tags="collider")  # -> rp_4, i_2
_5 = Panel(rep_16.i_2)
the_first_1to200_representation = Panel(rep_12.rp_4)
the_speckle_1to200_representation = Panel(rep_13.rp_4)
the_closest_tagged_representation = Panel(rep_15.rp_4)
the_first_rhino_representation = Panel(rep_10.rp_4)
the_first_rhino_representation_2 = Panel(rep_11.rp_4)
the_first_least_tagged_representation = Panel(rep_14.rp_4)
the_glb_default_representations = Panel(rep_9.rp_4)
the_first_default_representations = Panel("""Rep(model/gltf-binary)
Rep(model/gltf-binary)
Rep(model/gltf-binary)
Rep(model/gltf-binary)
Rep(model/gltf-binary)
Rep(model/gltf-binary)
Rep(model/gltf-binary)
Rep(model/gltf-binary)
Rep(model/gltf-binary)
Rep(model/gltf-binary)
Rep(model/gltf-binary)
Rep(model/gltf-binary)
Rep(model/gltf-binary)
Rep(model/gltf-binary)
Rep(model/gltf-binary)
Rep(model/gltf-binary)
Rep(model/gltf-binary)
Rep(model/gltf-binary)
Rep(model/gltf-binary)
Rep(model/gltf-binary)
Rep(model/gltf-binary)
Rep(model/gltf-binary)
Rep(model/gltf-binary)
Rep(model/gltf-binary)
Rep(model/gltf-binary)
Rep(model/gltf-binary)
Rep(model/gltf-binary)
Rep(model/gltf-binary)
Rep(model/gltf-binary)
Rep(model/gltf-binary)
Rep(model/gltf-binary)
Rep(model/gltf-binary)
Rep(model/gltf-binary)
Rep(model/gltf-binary)
Rep(model/gltf-binary)
Rep(model/gltf-binary)
Rep(model/gltf-binary)
Rep(model/gltf-binary)
Rep(model/gltf-binary)
Rep(model/gltf-binary)
Rep(model/gltf-binary)
Rep(model/gltf-binary)
Rep(model/gltf-binary)
Rep(model/gltf-binary)
Rep(model/gltf-binary)""")
txt_22 = Text(rep_8.rp_4)
int = Integer("0")
expression_19 = Expression(x=rep_8.i_2, y=int, Expression="x=y")
expression_20 = Expression(x=txt_22, y=rep_8.rp_4, Expression="x=y")
and_9 = GateAnd(A=expression_20, B=expression_19)
mm_11 = MassMultiplication(Input=and_9)  # -> Result, PartialResults
success_7 = Panel(mm_11.Result)
and_10 = GateAnd(A=mm_11.Result)
success_8 = Panel(and_10)

kt_6 = Kit(kt_3)
kit_8 = NormalizeKit(kt=kt_6)
panel_36 = Panel(kit_8)

ty_19 = Type(ty)
typ_13 = NormalizeType_2(ty=ty_19)

piece = Piece(["{\"id_\":\"t_f0_b_c0\",\"description\":\"\",\"type\":{\"name\":\"Tambour\",\"variant\":\"First Storey\"},\"design\":null,\"plane\":null,\"center\":null,\"hidden\":false,\"locked\":false,\"qualities\":[]}", "{\"id_\":\"t_f0_b_c1\",\"description\":\"\",\"type\":{\"name\":\"Tambour\",\"variant\":\"First Storey\"},\"design\":null,\"plane\":null,\"center\":null,\"hidden\":false,\"locked\":false,\"qualities\":[]}", "{\"id_\":\"t_f1_b_c0\",\"description\":\"\",\"type\":{\"name\":\"Tambour\",\"variant\":\"\"},\"design\":null,\"plane\":null,\"center\":null,\"hidden\":false,\"locked\":false,\"qualities\":[]}", "{\"id_\":\"cs_sl0_d0_t_f0_b_c0\",\"description\":\"\",\"type\":{\"name\":\"Capsule\",\"variant\":\"\\\\\"},\"design\":null,\"plane\":null,\"center\":null,\"hidden\":false,\"locked\":false,\"qualities\":[]}", "{\"id_\":\"cs_sl0_d1_t_f0_b_c0\",\"description\":\"\",\"type\":{\"name\":\"Capsule\",\"variant\":\"L\"},\"design\":null,\"plane\":null,\"center\":null,\"hidden\":false,\"locked\":false,\"qualities\":[]}", "{\"id_\":\"cs_sl0_d2_t_f0_b_c0\",\"description\":\"\",\"type\":{\"name\":\"Capsule\",\"variant\":\"J\"},\"design\":null,\"plane\":null,\"center\":null,\"hidden\":false,\"locked\":false,\"qualities\":[]}"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])
ty_20 = Type()
pce_4 = ModelPiece(Piece=piece)  # -> Piece, Valid, Id, Description, TypeName, TypeVariant, DesignName, DesignVariant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
typ_14 = SelectType(ty=ty_20, na=graft(pce_4.TypeName), variant=graft(pce_4.TypeVariant))  # -> ty_4, i_2

dn_18 = Design(flatten(dn))
ty_21 = Type(flatten(ty))
item_8 = ListItem(List=dn_17, Index=0, Wrap=True)  # -> Item1, Item
ob_7 = Data(ob)
dsn_20 = PreviewDesign(dn=item_8.Item, ty=ty_21, ob=ob_7, sc=1)  # disabled
dsn_21 = PreviewDesign(dn=item_8.Item1, ty=ty_21, ob=ob_7, sc=1)  # disabled
dn_19 = Design("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")
ty_22 = Type()
O = Data(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)
dsn_22 = PreviewDesign(dn=dn_19, ty=ty_22, ob=O, sc=1)  # disabled

ql_4 = Quality(ql)
qal_6 = SelectQuality(ql=ql_4, na="storeys")
panel_37 = Panel(qal_6)

genes = GenePool(Decimals=0, Maximum=165, Minimum=-165, Value=[-55, 0, 55, -165])
number_slider_19 = Slider(32, range=0..100)
genes_2 = GenePool(Decimals=0, Maximum=110, Minimum=-110, Value=[95, 22, 22, 22])
genes_3 = GenePool(Decimals=0, Maximum=110, Minimum=-110, Value=[36, 0, 0, 0])
genes_4 = GenePool(Decimals=0, Maximum=360, Minimum=0, Value=[151, 180, 180, 180])
genes_5 = GenePool(Decimals=0, Maximum=360, Minimum=0, Value=[75, 0, 0, 0])
genes_6 = GenePool(Decimals=0, Maximum=360, Minimum=0, Value=[39, 0, 0, 0])
number_slider_20 = Slider(4, range=0..10)
con_9 = ModelConnection(Gap=genes_2, Shift=genes, Rise=genes_3, Rotation=genes_4, Turn=genes_5, Tilt=genes_6)  # -> Connection, Valid, ConnectedPieceId, ConnectedDesignPieceId, ConnectedPieceTypePortId, ConnectingPieceId, ConnectingDesignPieceId, ConnectingPieceTypePortId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
panel_38 = Panel("""i
L1
L2
L2""")
panel_39 = Panel("""L1
L2
e1
e2""")
profile = Profile(amount="5", width="110")  # -> ty_2, srf_3, geo_2
profile_2 = Profile(amount="4", width="110")  # -> ty_2, srf_3, geo_2
profile_3 = Profile(amount="2", width="110")  # -> ty_2, srf_3, geo_2
xy = XYPlane(Origin=Point(0, 0, 0))
panel_40 = Panel("""w
e
n
n""")
panel_41 = Panel("""w
e
w
w""")
prot = RotatePlane(Plane=xy, Angle=degrees("-90"))
merge_9 = Merge(Data1=profile_3.ty_2, Data2=profile_2.ty_2, Data3=profile.ty_2)
merge_10 = Merge(Data1=profile_3.srf_3, Data2=profile_2.srf_3, Data3=profile.srf_3)
merge_11 = Merge(Data1=profile_3.geo_2, Data2=profile_2.geo_2, Data3=profile.geo_2)
graft_2 = GraftTree(Tree=merge_11, IncludeEmptyLists=True, IncludeNullItems=True)
con_10 = ModelConnection(
    Connection=con_9.Connection,
    ConnectedPieceId=panel_38,
    ConnectedPieceTypePortId=panel_40,
    ConnectingPieceId=panel_39,
    ConnectingPieceTypePortId=panel_41)  # -> Connection, Valid, ConnectedPieceId, ConnectedDesignPieceId, ConnectedPieceTypePortId, ConnectingPieceId, ConnectingDesignPieceId, ConnectingPieceTypePortId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
merge_12 = Merge(Data1=profile_2.ty_2, Data2=profile.ty_2, Data3=profile.ty_2, Data4=profile_3.ty_2, Data5=profile_3.ty_2)
panel_42 = Panel("""i
L1
L2
e1
e2""")
pce_5 = ModelPiece(Piece=merge_12, Id=panel_42)  # -> Piece, Valid, Id, Description, TypeName, TypeVariant, DesignName, DesignVariant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
item_9 = ListItem(List=pce_5.Piece, Index=0, Wrap=True)
pce_6 = ModelPiece(Piece=item_9, Plane=prot)  # -> Piece, Valid, Id, Description, TypeName, TypeVariant, DesignName, DesignVariant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
replace = ReplaceItems(List=pce_5.Piece, Item=pce_6.Piece, Indices="0", Wrap=False)
dsn_23 = ModelDesign(Name="Logo", Unit="mm", Pieces=replace, Connections=con_10.Connection)  # -> Design, Valid, Name, Description, Icon, Image, Variant, View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
dsn_24 = PreviewDesign(dn=dsn_23.Design, ty=merge_9, ob=merge_11, sc=number_slider_19)  # disabled

transform = Transform({TransformCount=1, Name="Orientation", source.origin.x=0, source.origin.y=0, source.origin.z=0, source.xaxis.x=1, source.xaxis.y=0, source.xaxis.z=0, source.yaxis.x=0, source.yaxis.y=1, source.yaxis.z=0, target.origin.x=0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})
dn_20 = Design("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")
list_9 = ValueList({"", "1to500", "1to200", "collider", "energy"}, selected="1to500")
dsn_25 = MoveDesign(dn=dn_20, pn=transform)
ty_23 = Type(flatten(ty))
ob_8 = Data(ob)
dsn_26 = PreviewDesign(dn=dsn_25, ty=ty_23, ob=ob_8, tags=list_9, sc=1)  # disabled

dn_21 = Design([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])
na_2 = Name("Capsule Dream")
description = Description("A wild dream of capsule towers.")
icon = Icon("icons/capsule-dream.svg")
variant = Variant("")
view = View("")
image = Image("images/capsule-dream.png")
authors = Authors("{\"name\":\"Ueli Saluz\",\"email\":\"ueli@semio-tech.org\"}")
ob_9 = Data(ob)
dsns_2 = MergeDesigns(dn=dn_21, na=na_2, description=description, icon=icon, image=image, variant=variant, view=view, authors=authors)
ty_24 = Type(flatten(ty))
list_10 = ValueList({"", "1to500", "1to200", "collider", "energy"}, selected="1to500")
dsn_27 = PreviewDesign(dn=dsns_2, ty=ty_24, ob=ob_9, tags=list_10, sc=1)  # disabled

dn_22 = Design(dn)
item_10 = ListItem(List=dn_22, Index=0, Wrap=True)  # -> Item, Item1, Item2
mime_10 = Mime({".glb": "model/gltf-binary", ".gltf": "model/gltf+json", ".stl": "model/stl", ".obj": "model/obj", ".blend": "model/x-blender", ".3dm": "model/vnd.3dm", ".ifc": "model/x-ifc", ".dwg": "model/acad", ".dxf": "model/dxf", ".rvt": "model/vnd.revit"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}, selected=".3dm")
dsn_28 = NormalizeDesign(dn=item_10.Item)
list_11 = ValueList({"1to500", "1to200", "collider", "energy"}, selected="1to500")
ty_25 = Type(flatten(ty))
ob_10 = Data(ob)
dsn_29 = PreviewDesign(dn=dsn_28, ty=ty_25, ob=ob_10, tags=list_11, sc=1)  # disabled

por_4 = ModelPort()  # -> Port, Valid, Id, Description, Mandatory, Family, CompatibleFamilies, Point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
path = FilePath(concat)
ob_11 = Data(ob)
bang = ExplodeTree(Data=ob_11)  # -> flatten(Branch0), Branch1
item_11 = ListItem(List=bang.Branch0, Index=0, Wrap=True)
ty_26 = Type(ty)
dsn_30 = PreviewDesign(dn=dsn_23.Design, ty=merge_9, ob=graft(graft_2), sc=number_slider_19)  # disabled
dsn_31 = PreviewDesign(dn=dsn_23.Design, ty=merge_9, ob=merge_11, sc=number_slider_19)  # disabled
dsn_32 = PreviewDesign(dn=dsn_23.Design, ty=merge_9, ob=graft_2, sc=number_slider_19)  # disabled
panel_43 = Panel("""First storey
last door
r23.5-1
\
/
📦""")
panel_44 = Panel("""floor plan
1to200""")
aut_2 = ModelAuthor()  # -> Author, Valid, Name, Email
panel_45 = Panel("""floor plan
1to500""")
qal_7 = ModelQuality()  # -> Quality, Valid, Name, Value, Unit, Definition

dn_23 = Design(dn)
ty_27 = Type(ty)
typ_15 = ModelType(Type=ty_27)  # -> Type, Valid, Name, Description, Icon, Image, Variant, Stock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
qal_8 = ModelQuality(Quality=typ_15.Qualities)  # -> Quality, Valid, Name, Value, Unit, Definition
qal_9 = SumQualities(dn=dn_23, ty=ty_27, na=qal_8.Name)  # -> vl_2, ql_2
panel_46 = Panel(qal_9.ql_2)
panel_47 = Panel(qal_9.vl_2)

entwine = Entwine(Branch00=panel_45, Branch01=panel_44, FlattenInputs=True)
item_12 = ListItem(List=panel_43, Index=0, Wrap=True)  # -> Item, Item1, Item2, Item3, Item4, Item5, Item6

glbkit = GitLabKit(
    domain="gitlab.uni-hannover.de",
    account="ueli.saluz",
    repo="at-24-25",
    commit="d53b5dbdb0bfb49a7dfc9ebcbc85558f8076be9d")  # -> remote_2, homepage_2
glbkit_2 = GitLabKit(domain="gitlab.uni-hannover.de", account="ueli.saluz", repo="at-24-25", branch="dev")  # -> remote_2, homepage_2
glbkit_3 = GitLabKit(domain="gitlab.uni-hannover.de", account="ueli.saluz", repo="at-24-25", branch="main")  # -> remote_2, homepage_2
glbkit_4 = GitLabKit(domain="gitlab.uni-hannover.de", account="ueli.saluz", repo="at-24-25", tag="main-tag")  # -> remote_2, homepage_2
panel_48 = Panel("https://gitlab.uni-hannover.de/ueli.saluz/at-24-25/-/archive/d53b5dbdb0bfb49a7dfc9ebcbc85558f8076be9d/at-24-25-d53b5dbdb0bfb49a7dfc9ebcbc85558f8076be9d.zip")
panel_49 = Panel("https://gitlab.uni-hannover.de/ueli.saluz/at-24-25/-/tree/d53b5dbdb0bfb49a7dfc9ebcbc85558f8076be9d")
panel_50 = Panel("https://gitlab.uni-hannover.de/ueli.saluz/at-24-25/-/tree/main?ref_type=heads")
panel_51 = Panel("https://gitlab.uni-hannover.de/ueli.saluz/at-24-25/-/archive/main/at-24-25-main.zip")
panel_52 = Panel("https://gitlab.uni-hannover.de/ueli.saluz/at-24-25/-/archive/main-tag/at-24-25-main-tag.zip")
panel_53 = Panel("https://gitlab.uni-hannover.de/ueli.saluz/at-24-25/-/tree/main-tag?ref_type=tags")
panel_54 = Panel("https://gitlab.uni-hannover.de/ueli.saluz/at-24-25/-/archive/dev/at-24-25-dev.zip")
panel_55 = Panel("https://gitlab.uni-hannover.de/ueli.saluz/at-24-25/-/tree/dev?ref_type=heads")
expression_21 = Expression(x=glbkit_3.remote_2, y=panel_51, Expression="x=y")
expression_22 = Expression(x=glbkit_3.homepage_2, y=panel_50, Expression="x=y")
expression_23 = Expression(x=glbkit_2.remote_2, y=panel_54, Expression="x=y")
expression_24 = Expression(x=glbkit_2.homepage_2, y=panel_55, Expression="x=y")
expression_25 = Expression(x=glbkit_4.remote_2, y=panel_52, Expression="x=y")
expression_26 = Expression(x=glbkit_4.homepage_2, y=panel_53, Expression="x=y")
expression_27 = Expression(x=glbkit.remote_2, y=panel_48, Expression="x=y")
expression_28 = Expression(x=glbkit.homepage_2, y=panel_49, Expression="x=y")
and_11 = GateAnd(A=expression_21, B=expression_22)
and_12 = GateAnd(A=expression_23, B=expression_24)
and_13 = GateAnd(A=expression_25, B=expression_26)
and_14 = GateAnd(A=expression_27, B=expression_28)
and_15 = GateAnd(A=and_11, B=and_12, C=and_13, D=and_14)
success_9 = Panel(and_15)

typ_16 = OppinionatedType(
    path=path,
    na="capsule",
    description="some capsule",
    variant=item_12.Item3,
    default=bang.Branch0,
    collider=item_11,
    O=bang.Branch0,
    tags=entwine,
    po=por_4.Port,
    authors=aut_2.Author,
    qualities=qal_7.Quality,
    export=Toggle(False))  # -> ty_2, ba_2

dn_24 = Design(dn)
dsn_33 = SelectDesign(dn=dn_24, na="Nakagin Capsule Tower")
dsn_34 = SelectDesign(dn=dn_24, variant="Dancing")
dsn_35 = SelectDesign(dn=dn_24, na="Nakagin Capsule Tower")
dsn_36 = SelectDesign(dn=dn_24, na="Nakagin Capsule Tower", view="Explosion Axonometry")
dsn_37 = SelectDesign(dn=dn_24, na="Nakagin Capsule Tower")
all_variants_and_all_views = Panel(dsn_37)
all_variants_and_default_view = Panel(dsn_33)
variant_and_default_view = Panel(dsn_34)
all_variants_and_view = Panel(dsn_36)
default_variant_and_view = Panel(dsn_35)

co_5 = Connection(co)
merge_13 = Merge(Data1="b", Data2="t_f0_b_c0")
con_11 = SelectConnection(co=co_5, cdpc="b")  # -> co_4, i_2, fl_2
con_12 = SelectConnection(co=co_5, cgpc="b")  # -> co_4, i_2, fl_2
con_13 = SelectConnection(co=co_5, cdpc="t_f0_b_c0", cgpc="b")  # -> co_4, i_2, fl_2
con_14 = SelectConnection(co=co_5, cdpc="b", cgpc="t_f0_b_c0")  # -> co_4, i_2, fl_2
con_15 = SelectConnection(co=co_5, cdpc=merge_13)  # -> co_4, i_2, fl_2
all_connections_with_piece_b = Panel(con_12.co_4)
all_connections_with_piece_b_connected_t = Panel(con_13.co_4)  # "all connections with piece b connected to t_f0_b_c0"
all_connections_with_piece_b_or_t_f0_b_c = Panel(con_15.co_4)  # "all connections with piece b or t_f0_b_c0"
all_connections_with_piece_b_2 = Panel(con_11.co_4)
all_connections_with_piece_b_connected_t_2 = Panel(con_14.co_4)  # "all connections with piece b connected to t_f0_b_c0"
expression_29 = Expression(x=con_11.co_4, y=con_12.co_4, Expression="x=y")
expression_30 = Expression(x=con_13.co_4, y=con_14.co_4, Expression="x=y")
mm_12 = MassMultiplication(Input=flatten(expression_29))  # -> Result, PartialResults
mm_13 = MassMultiplication(Input=flatten(expression_30))  # -> Result, PartialResults
and_16 = GateAnd(A=mm_12.Result, B=mm_13.Result)
success_10 = Panel(and_16)

panel_56 = Panel([typ_16.ty_2, typ_16.ba_2])

panel_57 = Panel("/")
merge_14 = Merge(Data1="Capital", Data2="Capsule")
merge_15 = Merge(Data2="Capsule")
pc_6 = Piece(pc)
pces = SelectPieces(pc=pc_6, na="Base", variant="Blob")
pces_2 = SelectPieces(pc=pc_6, na="Base")
pces_3 = SelectPieces(pc=pc_6, na=merge_14)
pces_4 = SelectPieces(pc=pc_6, na=merge_14, variant=merge_15)
pces_5 = SelectPieces(pc=pc_6)
base_blob_pieces = Panel(pces)
base_pieces = Panel(pces_2)
capsule_and_capital_pieces = Panel(pces_3)
default_and_slash_capsule_and_default_ca = Panel(pces_4)  # "default and slash capsule and default capital pieces"
all_pieces = Panel(pces_5)

pcs_4 = RemovePieces()  # -> dn_4, pc_2, co_2
dsn_38 = SortDesign()
dsn_39 = FlattenDesign()
objs_txt_2 = ObjectsToText()
txt_23 = NormalizeText()  # -> Strict, Title, Underscore, Kebab, Pascal
dsn_40 = SimplifyDesign()
txt_24 = TruncateText(Termination="…")  # -> Strict, Characters, Words
and_17 = GateAnd(A=and_8, D=and_15, B=mm_10.Result, C=mm_12.Result)
success_11 = Panel(and_17)

# ---- group: Final Grid Pcs Generator
ty_28 = Type(ty_6)

# ----
cons_4 = LinearConnections(pc=pcs, co=con_6.Connection)

# ---- group: Final Grid Pcs Generator (continued)
gnrt_grid_pcs_4 = GnrtGridPcs_2(ty=ty_28, X=Slider(3, range=0..10), Y=Slider(3, range=0..10), Z=Slider(3, range=0..10))

# ----
gridcons_4 = LinearConnections_3(pc=gnrt_grid_pcs_4, cox=con_5.Connection, coy=con_7.Connection, coz=con_6.Connection)

filter = StreamFilter(Gate=number_slider_17, Stream0=pcs, Stream1=gnrt_grid_pcs, Stream2=gnrt_grid_pcs_4)
filter_2 = StreamFilter(Gate=number_slider_17, Stream0=cons_4, Stream1=gridcons, Stream2=gridcons_4)

# ---- group: Final Grid Pcs Generator
ty_29 = Type(ty_6)

ty_30 = Type(ty_6)

gnrt_grid_pcs_5 = GnrtGridPcs_2(ty=ty_29, X=Slider(3, range=0..10), Y=Slider(3, range=0..10), Z=Slider(3, range=0..10))

# ----
gridcons_5 = LinearConnections_3(pc=gnrt_grid_pcs_5, cox=con_5.Connection, coy=con_7.Connection, coz=con_6.Connection)

filter_3 = StreamFilter(Gate=number_slider_17, Stream0=pcs_3, Stream1=gnrt_grid_pcs_2, Stream2=gnrt_grid_pcs_5)
filter_4 = StreamFilter(Gate=number_slider_17, Stream0=cons, Stream1=gridcons_2, Stream2=gridcons_5)

# ---- group: Final Grid Pcs Generator (continued)
gnrt_grid_pcs_6 = GnrtGridPcs_2(ty=ty_30, X=Slider(3, range=0..10), Y=Slider(3, range=0..10), Z=Slider(3, range=0..10))

# ----
gridcons_6 = LinearConnections_3(pc=gnrt_grid_pcs_6, cox=con_5.Connection, coy=con_7.Connection, coz=con_6.Connection)

filter_5 = StreamFilter(Gate=number_slider_17, Stream0=pcs_2, Stream1=gnrt_grid_pcs_3, Stream2=gnrt_grid_pcs_6)
filter_6 = StreamFilter(Gate=number_slider_17, Stream0=cons_2, Stream1=gridcons_3, Stream2=gridcons_6)

# ---- group: Test Nr
filter_7 = StreamFilter(Gate=number_slider_18, Stream0=filter_2, Stream1=filter_6, Stream2=filter_4)

filter_8 = StreamFilter(Gate=number_slider_18, Stream0=filter, Stream1=filter_5, Stream2=filter_3)

# ----
dsn_41 = ModelDesign(Name="Sphere Packing", Pieces=flatten(filter_8), Connections=flatten(filter_7))  # -> Design, Valid, Name, Description, Icon, Image, Variant, View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

dsn_42 = PreviewDesign(dn=dsn_41.Design, ty=ty_6, ob=graft(graft), sc=1)

# ----
# CRUDs
test = BooleanToggle(False)

# ----
# Engine
# Creating Kit without losing information
kit_9 = DeleteKit(Url=concat_2, Run=test)
kt_7 = Kit(kt_3)
expression_31 = Expression(x=test, y=kit_9, Expression="x")
kit_10 = SerializeKit(Kit=kt_7)
kit_11 = CreateKit(Kit=kt_7, Uri=concat_2, Run=expression_31)
expression_32 = Expression(x=test, y=kit_11, Expression="x")
kit_12 = LoadKit(Uri=concat_2, Run=expression_32)  # -> Success, Kit, LocalDirectory
kit_13 = SerializeKit(Kit=kit_12.Kit)
expression_33 = Expression(x=kit_10, y=kit_13, Expression="x=y")
success_12 = Panel(expression_33)

# ----
# Overwrite types and designs
expression_34 = Expression(x=test, y=expression_33, Expression="x")
kt_8 = Kit(kt_3)
kit_14 = ModelKit(Kit=kt_8)  # -> Kit, Valid, Name, Description, Icon, Image, Preview, Version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
kit_15 = DeleteKit(Url=concat_2, Run=expression_34)
expression_35 = Expression(x=expression_34, y=kit_15, Expression="x")
kit_16 = NormalizeKit(kt=kt_8)
trim_3 = TrimTree(Tree=kit_14.Types, Depth=1)
trim_4 = TrimTree(Tree=kit_14.Designs, Depth=1)
kit_17 = CreateKit(Kit=kt_8, Uri=concat_2, Run=test)
typ_17 = PutType(Type=trim_3, Uri=concat_2, Run=False)
kit_18 = SerializeKit()
dsn_43 = PutDesign(Design=trim_4, Uri=concat_2, Run=False)
kit_19 = SerializeKit()
expression_36 = Expression(x=expression_34, y=kit_17, Expression="x")
item_13 = ListItem(List=typ_17, Index=0, Wrap=True)
expression_37 = Expression(x=expression_34, y=item_13, Expression="x")
item_14 = ListItem(List=dsn_43, Index=0, Wrap=True)
expression_38 = Expression(x=kit_19, y=kit_18, Expression="x=y")
kit_20 = LoadKit(Uri=concat_2, Run=expression_36)  # -> Success, Kit, LocalDirectory
expression_39 = Expression(x=expression_34, y=kit_20.Success, Expression="x")
expression_40 = Expression(x=expression_34, y=item_14, Expression="x")
kit_21 = LoadKit(Uri=concat_2, Run=expression_40)  # -> Success, Kit, LocalDirectory
kit_22 = NormalizeKit(kt=kit_21.Kit)
success_13 = Panel(expression_38)

and_18 = GateAnd(A=expression_33, B=expression_38, C=expression_33)
success_14 = Panel(and_18)

and_19 = GateAnd(D=and_2, A=and_3, B=and_17, C=and_18)
success_15 = Panel(and_19)

# ==== cluster ShowDesign: Show a design by flattening it and selecting only representations with the same mime, lod and tags.
ty = ClusterInput()
dn = ClusterInput()
mm = ClusterInput()
lod = ClusterInput()
tags = ClusterInput()
ty_2 = Type(ty)
mm_2 = Mime(mm)
tags_2 = Tags(tags)
dn_2 = Design(dn)
lod_2 = Lod(lod)
fltdsn = FlattenDesign(Design=dn_2, Type=ty_2)
dsn = ModelDesign(Design=fltdsn)  # -> Design, Valid, Name, Description, Icon, Image, Variant, View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
typ = ModelType(Type=ty_2)  # -> Type, Valid, Name, Description, Icon, Image, Variant, Stock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
tstat = TreeStatistics(Tree=typ.Representations)  # -> Paths, Length, Count
trim = TrimTree(Tree=dsn.Pieces, Depth=1)
pce = ModelPiece(Piece=trim)  # -> Piece, Valid, Id, Description, TypeName, TypeVariant, DesignName, DesignVariant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
lng = ListLength(List=ty_2)
expression = Expression(x=graft(pce.TypeName), y=typ.Name, Expression="x=y")
expression_2 = Expression(x=graft(pce.TypeVariant), y=typ.Variant, Expression="x=y")
series = Series(Start=0, Step=1, Count=lng)
and = GateAnd(A=expression, B=expression_2)
trim_2 = TrimTree(Tree=series, Depth=1)
cull = CullPattern(List=ty_2, CullPattern=and)
txt = Text(cull)
txt_2 = Text(ty_2)
expression_3 = Expression(x=txt, y=txt_2, Expression="x=y")
cull_2 = CullPattern(List=trim_2, CullPattern=expression_3)
trim_3 = TrimTree(Tree=cull_2, Depth=1)
item = ListItem(List=tstat.Paths, Index=trim_3, Wrap=True)
branch = TreeBranch(Tree=typ.Representations, Path=item, MaintainPaths=False)
mrg_p = MergeSeperatlyPrepend(x=branch)  # -> Mrgd; inputs x: tree
# ---------- mrg_p: Python ----------
if ghenv.Component.RunCount<2:
    __author__ = "Ueli Saluz"
    __version__ = "2020.05.28"
    
    ghenv.Component.Name = "MergeSeperatly(Prepend)"
    ghenv.Component.NickName = "Mrg(P)"
    ghenv.Component.Description = "Merge inputs seperatly on a new path. Prepend index of input parameter for distincting."
    ghenv.Component.Message = "VER 1.0"

from System import Object
from Grasshopper import DataTree
from Grasshopper.Kernel import GH_ParamAccess as Access

if __name__ == "__main__":
    Mrgd = DataTree[Object]()
    access = Access()
    
    for input in ghenv.Component.Params.Input:  #set all Inputaccess to Tree Access
        input.Access = access.tree
    
    for i,input in enumerate(ghenv.Component.Params.Input):
        for j,source in enumerate(input.Sources):
            for path in source.VolatileData.Paths:
                Mrgd.AddRange(source.VolatileData[path],path.PrependElement(i))
# ---------- end mrg_p ----------
rep = ModelRepresentation()  # -> Representation, Valid, Url, Mime, Lod, Qualities
rep_2 = ModelRepresentation(Representation=mrg_p)  # -> Representation, Valid, Url, Description, Tags, Qualities
expression_4 = Expression(x=[rep.Mime, rep_2.Tags], y=mm_2, Expression="x=y")
cull_3 = CullPattern(List=rep_2.Representation, CullPattern=expression_4)
rep_3 = ModelRepresentation(Representation=cull_3)  # -> Representation, Valid, Url, Description, Tags, Qualities
rep_4 = ModelRepresentation()  # -> Representation, Valid, Url, Mime, Lod, Qualities
expression_5 = Expression(x=[rep_4.Lod, rep_3.Tags], y=lod_2, Expression="x=y")
cull_4 = CullPattern(List=rep_3.Representation, CullPattern=expression_5)
trim_4 = TrimTree(Tree=cull_4, Depth=1)
rep_5 = ModelRepresentation(Representation=trim_4)  # -> Representation, Valid, Url, Description, Tags, Qualities
ur = Url(rep_5.Url)
pln = Plane(pce.Plane)
id = Id(pce.Id)
ur_2 = ClusterOutput(ur)
pln_2 = ClusterOutput(pln)
id_2 = ClusterOutput(id)

# ==== cluster NormalizeKit: Normalize a kit to this document. This normalizes all types and designs and reorders them. Types are reordered after name and variant and designs after name, variant and view.
kt = ClusterInput()
kt_2 = Kit(graft(kt))
kit = ModelKit(Kit=kt_2)  # -> Kit, Valid, Name, Description, Icon, Image, Preview, Version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
trim = TrimTree(Tree=kit.Types, Depth=1)
trim_2 = TrimTree(Tree=kit.Designs, Depth=1)
dsn = NormalizeDesign(dn=trim_2)
typ = NormalizeType(ty=trim)
dsn_2 = ModelDesign(Design=dsn)  # -> Design, Valid, Name, Description, Icon, Image, Variant, View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
typ_2 = ModelType(Type=typ)  # -> Type, Valid, Name, Description, Icon, Image, Variant, Stock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
concat = Concatenate(FragmentA=dsn_2.Name, FragmentB="##", FragmentC=dsn_2.Variant, FragmentD="##", FragmentE=dsn_2.View)
concat_2 = Concatenate(FragmentA=typ_2.Name, FragmentB="##", FragmentC=typ_2.Variant)
tsort = SortText(Keys=concat, Values=dsn_2.Design, Culture=127)  # -> Keys, Values
tsort_2 = SortText(Keys=concat_2, Values=typ_2.Type, Culture=127)  # -> Keys, Values
trim_3 = TrimTree(Tree=tsort.Values, Depth=1)
trim_4 = TrimTree(Tree=tsort_2.Values, Depth=1)
kit_2 = ModelKit(Kit=kit.Kit, Types=trim_4, Designs=trim_3)  # -> Kit, Valid, Name, Description, Icon, Image, Preview, Version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
trim_5 = TrimTree(Tree=kit_2.Kit, Depth=1)
kt_3 = Kit(trim_5)
kt_4 = ClusterOutput(kt_3)

# ==== cluster TypTxt
ty = ClusterInput()
ty_2 = Type(graft(ty))
typ = ModelType(Type=ty_2)  # -> Type, Valid, Name, Description, Icon, Image, Variant, Stock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
txt = NormalizeText(Text=typ.Variant)  # -> Strict, Title, Underscore, Kebab, Pascal
txt_2 = NormalizeText(Text=typ.Name)  # -> Strict, Title, Underscore, Kebab, Pascal
panel = Panel("""slash
backslash""")
panel_2 = Panel("""/
\
""")
expression = Expression(x=typ.Variant, Expression="x=\"\"")
replace = ReplaceMembers(Set=txt.Kebab, Find=panel_2, Replace=panel)
concat = Concatenate(FragmentA=txt_2.Kebab, FragmentB="_", FragmentC=replace)
merge = Merge(Data1=concat, Data2=txt_2.Kebab)
item = ListItem(List=merge, Index=expression, Wrap=True)
trim = TrimTree(Tree=item, Depth=1)
concat_2 = Concatenate(FragmentA="type", FragmentB="_", FragmentC=trim)
txt_3 = Text(concat_2)
txt_4 = ClusterOutput(txt_3)

# ==== cluster DsnTxt
dn = ClusterInput()
dn_2 = Design(graft(dn))
dsn = ModelDesign(Design=dn_2)  # -> Design, Valid, Name, Description, Icon, Image, Variant, View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
txt = NormalizeText(Text=dsn.Name)  # -> Strict, Title, Underscore, Kebab, Pascal
txt_2 = NormalizeText(Text=dsn.Variant)  # -> Strict, Title, Underscore, Kebab, Pascal
panel = Panel("""slash
backslash""")
panel_2 = Panel("""/
\
""")
expression = Expression(x=dsn.Variant, Expression="x=\"\"")
replace = ReplaceMembers(Set=txt_2.Kebab, Find=panel_2, Replace=panel)
concat = Concatenate(FragmentA=txt.Kebab, FragmentB="_", FragmentC=replace)
merge = Merge(Data1=concat, Data2=txt.Kebab)
item = ListItem(List=merge, Index=expression, Wrap=True)
trim = TrimTree(Tree=item, Depth=1)
concat_2 = Concatenate(FragmentA="design", FragmentB="_", FragmentC=trim)
txt_3 = Text(concat_2)
txt_4 = ClusterOutput(txt_3)

# ==== cluster JaccardIndex: Compute the Jaccard Index of two sets.
set1 = ClusterInput()
set2 = ClusterInput()
set1_2 = Data(set1)
set2_2 = Data(set2)
lng = ListLength(List=flatten(set1_2))
cset = CreateSet(List=set2_2)  # -> Set, Map
cset_2 = CreateSet(List=set1_2)  # -> Set, Map
intersection = SetIntersection(SetA=cset_2.Set, SetB=cset.Set)
expression = Expression(x=lng, Expression="x=0")
sunion = SetUnion(SetA=cset_2.Set, SetB=cset.Set)
null = NullItem(Item=lng)  # -> NullFlags, InvalidFlags, Description
lng_2 = ListLength(List=intersection)
lng_3 = ListLength(List=sunion)
or = GateOr(A=null.NullFlags, B=expression)
better_filter = BetterFilter(i=or, a=lng_2, b="0")  # -> R; inputs i: tree of Int32, a: tree, b: tree, c: tree, d: tree
# ---------- better_filter: C# ----------
// Grasshopper Script Instance
#region Usings
using System;
using System.Linq;
using System.Collections;
using System.Collections.Generic;
using System.Drawing;

using Rhino;
using Rhino.Geometry;

using Grasshopper;
using Grasshopper.Kernel;
using Grasshopper.Kernel.Data;
using Grasshopper.Kernel.Types;
#endregion

public class Script_Instance : GH_ScriptInstance
{
    private void RunScript(
	DataTree<int> i,
	DataTree<object> a,
	DataTree<object> b,
	DataTree<object> c,
	DataTree<object> d,
	ref object R)
    {
        foreach (var branch in i.Branches)
        {
            foreach (var index in branch)
            {
                switch (index)
                {
                    case 0:
                        R = a;
                        break;
                    case 1:
                        R = b;
                        break;
                    case 2:
                        R = c;
                        break;
                    case 3:
                        R = d;
                        break;
                    default:
                        throw new ArgumentOutOfRangeException(nameof(i), "Invalid value for i");
                }
            }
            
        }
       
    }
}
# ---------- end better_filter ----------
division = Division(A=better_filter, B=lng_3)
N = Number(division)
N_2 = ClusterOutput(N)

# ==== cluster InterpolateDesigns: Interpolate between a source design and a target design. The target will act as a blueprint. The result is an interpolated union design and two unmodified but filtered difference design. Piece planes and connection values are linearly interpolated.
T = ClusterInput()
S = ClusterInput()
t = ClusterInput()
T_2 = Design(T)
S_2 = Design(S)
t_2 = Number(t)
dsn = NormalizeDesign_2(dn=S_2)
dsn_2 = NormalizeDesign_2(dn=T_2)
dsn_3 = ModelDesign(Design=dsn)  # -> Design, Valid, Name, Description, Icon, Image, Variant, View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
dsn_4 = ModelDesign(Design=dsn_2)  # -> Design, Valid, Name, Description, Icon, Image, Variant, View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
trim = TrimTree(Tree=dsn_3.Pieces, Depth=1)
trim_2 = TrimTree(Tree=dsn_4.Pieces, Depth=1)
trim_3 = TrimTree(Tree=dsn_4.Connections, Depth=1)
trim_4 = TrimTree(Tree=dsn_3.Connections, Depth=1)
con = ModelConnection(Connection=trim_3)  # -> Connection, Valid, ConnectedPieceId, ConnectedPieceTypePortId, ConnectingPieceId, ConnectingPieceTypePortId, Description, Gap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
con_2 = ModelConnection(Connection=trim_4)  # -> Connection, Valid, ConnectedPieceId, ConnectedPieceTypePortId, ConnectingPieceId, ConnectingPieceTypePortId, Description, Gap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
pce = ModelPiece(Piece=trim_2)  # -> Piece, Valid, Id, Description, TypeName, TypeVariant, Plane, Center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
pce_2 = ModelPiece(Piece=trim)  # -> Piece, Valid, Id, Description, TypeName, TypeVariant, Plane, Center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
intersection = SetIntersection(SetA=pce_2.Id, SetB=pce.Id)
difference = SetDifference(SetA=pce_2.Id, SetB=pce.Id)
difference_2 = SetDifference(SetA=pce.Id, SetB=pce_2.Id)
con_3 = SelectConnection(co=trim_3, cdpc=con_2.ConnectedPieceId, cgpc=con_2.ConnectingPieceId)  # -> co_4, i_2, fl_2
con_4 = SelectConnection(co=trim_4, cdpc=con.ConnectedPieceId, cgpc=con.ConnectingPieceId)  # -> co_4, i_2, fl_2
pce_3 = SelectPiece(pc=pce_2.Piece, id=difference)  # -> pc_4, i_2
pce_4 = SelectPiece(pc=pce_2.Piece, id=intersection)  # -> pc_4, i_2
pce_5 = SelectPiece(pc=pce.Piece, id=intersection)  # -> pc_4, i_2
pce_6 = SelectPiece(pc=pce.Piece, id=difference_2)  # -> pc_4, i_2
expression = Expression(x=t_2, Expression="1-x")
trim_5 = TrimTree(Tree=con_3.co_4, Depth=1)
trim_6 = TrimTree(Tree=con_4.co_4, Depth=1)
trim_7 = TrimTree(Tree=pce_6.pc_4, Depth=1)
trim_8 = TrimTree(Tree=pce_5.pc_4, Depth=1)
trim_9 = TrimTree(Tree=pce_4.pc_4, Depth=1)
trim_10 = TrimTree(Tree=pce_3.pc_4, Depth=1)
con_5 = ModelConnection(Connection=trim_6)  # -> Connection, Valid, ConnectedPieceId, ConnectedPieceTypePortId, ConnectingPieceId, ConnectingPieceTypePortId, Description, Gap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
con_6 = ModelConnection(Connection=trim_5)  # -> Connection, Valid, ConnectedPieceId, ConnectedPieceTypePortId, ConnectingPieceId, ConnectingPieceTypePortId, Description, Gap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
pce_7 = ModelPiece(Piece=trim_9)  # -> Piece, Valid, Id, Description, TypeName, TypeVariant, Plane, Center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
pce_8 = ModelPiece(Piece=trim_8)  # -> Piece, Valid, Id, Description, TypeName, TypeVariant, Plane, Center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
merge = Merge(Data1=expression, Data2=t_2)
expression_2 = Expression(x=con_5.Rotation, y=con_6.Rotation, Expression="If(Abs(x-y)≤180,y,-(360-y))")
expression_3 = Expression(x=con_5.Tilt, y=con_6.Tilt, Expression="If(Abs(x-y)≤180,y,-(360-y))")
merge_2 = Merge(Data1=graft(pce_7.Plane), Data2=graft(pce_8.Plane))
merge_3 = Merge(Data1=graft(con_5.Gap), Data2=graft(con_6.Gap))
merge_4 = Merge(Data1=graft(con_5.Shift), Data2=graft(con_6.Shift))
merge_5 = Merge(Data1=graft(con_5.Tilt), Data2=graft(expression_3))
merge_6 = Merge(Data1=graft(con_5.Rotation), Data2=graft(expression_2))
tstat = TreeStatistics(Tree=con_4.co_4)  # -> Paths, Length, Count
tstat_2 = TreeStatistics(Tree=con_3.co_4)  # -> Paths, Length, Count
concat = Concatenate(FragmentA=dsn_3.Name, FragmentE=",", FragmentF=dsn_3.Variant)
concat_2 = Concatenate(FragmentA=dsn_4.Name, FragmentE=",", FragmentF=dsn_4.Variant)
expression_4 = Expression(x=t_2, Expression="x≥0.5")
avgpl = AveragePlane(Pl=merge_2, M=merge)  # -> AvPl; inputs Pl: list of Plane, M: list of Double
# ---------- avgpl: C# usings ----------
using System.Linq;
# ---------- avgpl: C# ----------
    //Author: Ueli Saluz
    //Last modified: 29.05.2020
    //Contact: usaluz@outlook.de

    if (Component.RunCount < 2)
    {
      Component.Name = "AveragePlane";
      Component.NickName = "AvgPl";
      Component.Description = "Get the average plane from a set of planes. Provide multiplier to weight some planes more.";

      Component.Params.Input[0].Name = "Planes";
      Component.Params.Input[0].Description = "Planes to take average from.";
      Component.Params.Input[1].Name = "weights";
      Component.Params.Input[1].Description = "weights act like weights towards a plane.";

      Component.Params.Output[0].Name = "AveragePlane";
      Component.Params.Output[0].Description = "Resulting average plane.";

      Component.Message = "VER 1.0";
    }
    AvPl = GetAveragePlane(Pl.ToArray(), M.ToArray());
# ---------- avgpl: C# additional code ----------
  /// <summary>
  /// Gets the average plane from a set of of planes. Each plane can have a weight.
  /// </summary>
  /// <param name="planes"></param>
  /// <param name="weights"></param>
  /// <returns>Average plane under consideration of weights</returns>
  public Plane GetAveragePlane(Plane[] planes, double[] weights)
  {
    //If there are less weights than planes then the weight of 1 is assumed.
    if (weights.Length < planes.Length)
      weights = weights.Concat(Enumerable.Repeat(1d, planes.Length - weights.Length)).ToArray();
    //If there are more weights than planes then the last ones will be ignored.
    else if (weights.Length > planes.Length)
      weights = weights.Take(planes.Length).ToArray();

    if (weights.Sum() == 0)
      weights = Enumerable.Repeat(1d, planes.Length).ToArray();

    var sum = weights.Sum();
    weights = weights.Select(x => x / sum).ToArray();

    var origins = planes.Select(x => x.Origin).ToArray();
    var xAxes = planes.Select(x => x.XAxis).ToArray();
    var yAxes = planes.Select(x => x.YAxis).ToArray();

    for (int i = 0; i < planes.Length; i++)
    {
      origins[i].Transform(new Transform(weights[i]));
      xAxes[i].Transform(new Transform(weights[i]));
      yAxes[i].Transform(new Transform(weights[i]));
    }

    return new Plane(origins.Aggregate((a,b) => a + b), xAxes.Aggregate((a,b) => a + b), yAxes.Aggregate((a,b) => a + b));
  }
# ---------- end avgpl ----------
trim_11 = TrimTree(Tree=tstat_2.Length, Depth=1)
trim_12 = TrimTree(Tree=tstat.Length, Depth=1)
interp = InterpolateData(Data=merge_6, Parameter=t_2, Interpolation=2)
interp_2 = InterpolateData(Data=merge_3, Parameter=t_2, Interpolation=2)
interp_3 = InterpolateData(Data=merge_4, Parameter=t_2, Interpolation=2)
interp_4 = InterpolateData(Data=merge_5, Parameter=t_2, Interpolation=2)
concat_3 = Concatenate(FragmentD=")")
concat_4 = Concatenate(FragmentA=concat_2, FragmentB="(", FragmentD=")")
c_script = CSharpScript(x=avgpl)  # -> a; inputs x: Plane
# ---------- c_script: C# ----------
// Grasshopper Script Instance
#region Usings
using System;
using System.Linq;
using System.Collections;
using System.Collections.Generic;
using System.Drawing;

using Rhino;
using Rhino.Geometry;

using Grasshopper;
using Grasshopper.Kernel;
using Grasshopper.Kernel.Data;
using Grasshopper.Kernel.Types;
#endregion

public class Script_Instance : GH_ScriptInstance
{
    #region Notes
    /* 
      Members:
        RhinoDoc RhinoDocument
        GH_Document GrasshopperDocument
        IGH_Component Component
        int Iteration

      Methods (Virtual & overridable):
        Print(string text)
        Print(string format, params object[] args)
        Reflect(object obj)
        Reflect(object obj, string method_name)
    */
    #endregion

    private void RunScript(Plane x, ref object a)
    {
        a = x.IsValid ? x : null;
    }
}
# ---------- end c_script ----------
filter = StreamFilter(Gate=expression_4, Stream0=con_5.Connection, Stream1=con_6.Connection)
equals = Equality(FirstNumber=trim_12, SecondNumber="0")  # -> Equality, Inequality
equals_2 = Equality(FirstNumber=trim_11, SecondNumber="0")  # -> Equality, Inequality
trim_13 = TrimTree(Tree=interp, Depth=1)
trim_14 = TrimTree(Tree=interp_4, Depth=1)
trim_15 = TrimTree(Tree=interp_2, Depth=1)
trim_16 = TrimTree(Tree=interp_3, Depth=1)
filter_2 = StreamFilter(Gate=expression_4, Stream0=pce_7.Piece, Stream1=pce_8.Piece)
concat_5 = Concatenate(FragmentA=concat, FragmentB=" U ", FragmentC=concat_2)
concat_6 = Concatenate(FragmentA=concat, FragmentB=" \ ", FragmentC=concat_2)
concat_7 = Concatenate(FragmentA=concat, FragmentB=" \ ", FragmentC=concat_2)
trim_17 = TrimTree(Tree=c_script, Depth=1)
cull = CullPattern(List=trim_4, CullPattern=equals_2.Equality)
cull_2 = CullPattern(List=trim_3, CullPattern=equals.Equality)
con_7 = ModelConnection(Connection=filter, Gap=trim_15, Shift=trim_16, Rotation=trim_13, Tilt=trim_14)  # -> Connection, Valid, ConnectedPieceId, ConnectedPieceTypePortId, ConnectingPieceId, ConnectingPieceTypePortId, Description, Gap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
pce_9 = ModelPiece(Piece=filter_2, Plane=trim_17)  # -> Piece, Valid, Id, Description, TypeName, TypeVariant, Plane, Center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
concat_8 = Concatenate(FragmentA=t_2, FragmentB=",", FragmentC=expression)
pc_s_u_t = Piece(pce_9.Piece)
pc_s_t = Piece(trim_10)
pc_t_s = Piece(trim_7)
co_s_u_t = Connection(con_7.Connection)
co_s_t = Connection(cull)
co_t_s = Connection(cull_2)
dsn_5 = ModelDesign(Name=concat_5, Variant=concat_8, Pieces=pc_s_u_t, Connections=co_s_u_t)  # -> Design, Valid, Name, Description, Icon, Image, Variant, View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
dsn_6 = ModelDesign(Name=concat_6, Pieces=pc_s_t, Connections=co_s_t)  # -> Design, Valid, Name, Description, Icon, Image, Variant, View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
dsn_7 = ModelDesign(Name=concat_7, Pieces=pc_t_s, Connections=co_t_s)  # -> Design, Valid, Name, Description, Icon, Image, Variant, View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
dn_s_u_t = Design(dsn_5.Design)
dn_s_t = Design(dsn_6.Design)
dn_t_s = Design(dsn_7.Design)
dn_t_s_2 = ClusterOutput(dn_t_s)
dn_s_t_2 = ClusterOutput(dn_s_t)
dn_s_u_t_2 = ClusterOutput(dn_s_u_t)

# ==== cluster SelectRepresentation: Select exactly one representation based on tags. The tag matching is based on the highest Jaccard index (|∩|/|∪|).
rp = ClusterInput()
tags = ClusterInput()
rp_2 = Representation(rp)
tags_2 = Tags(tags)
rep = ModelRepresentation(Representation=rp_2)  # -> Representation, Valid, Url, Description, Tags, Qualities
jac = JaccardIndex_2(set1=tags_2, set2=rep.Tags)
trim = TrimTree(Tree=jac, Depth=1)
minmax = MinimumMaximum(L=trim)  # -> Max, MaxI, Min, MinI; inputs L: list
# ---------- minmax: Python ----------
#Component Information
#--------------------------------------------------------------------------------------------
if ghenv.Component.RunCount<2:
    #General
    #--------------------------------------------------------------------------------------------
    __author__ = "Ueli Saluz"
    __version__ = "2022.04.22"
    
    ghenv.Component.Name = "MinimumMaximum"
    ghenv.Component.NickName = "MinMax"
    ghenv.Component.Description = "Returns the maximum and mininum of a list and their corresponding index."
    ghenv.Component.Message = "VER 1.0"
    ghenv.Component.Category = "Maths"
    ghenv.Component.SubCategory = "Util"
    
     #Inputs
    #--------------------------------------------------------------------------------------------
    inputIndex=0
    
    ghenv.Component.Params.Input[inputIndex].Name = "L"
    ghenv.Component.Params.Input[inputIndex].NickName = "L"
    ghenv.Component.Params.Input[inputIndex].Description = "A list of numbers."
    ghenv.Component.Params.Input[inputIndex].Optional = False
    inputIndex+=1
    
    
    #Outputs
    #--------------------------------------------------------------------------------------------
    outputIndex=0
    
    ghenv.Component.Params.Output[outputIndex].Name = "Max"
    ghenv.Component.Params.Output[outputIndex].NickName = "Max"
    ghenv.Component.Params.Output[outputIndex].Description = "Maximum of the list"
    outputIndex+=1
    
    ghenv.Component.Params.Output[outputIndex].Name = "MaxI"
    ghenv.Component.Params.Output[outputIndex].NickName = "MaxI"
    ghenv.Component.Params.Output[outputIndex].Description = "Index of the maximum of the list"
    outputIndex+=1
    
    ghenv.Component.Params.Output[outputIndex].Name = "Min"
    ghenv.Component.Params.Output[outputIndex].NickName = "Min"
    ghenv.Component.Params.Output[outputIndex].Description = "Minimum of the list"
    outputIndex+=1
    
    ghenv.Component.Params.Output[outputIndex].Name = "MinI"
    ghenv.Component.Params.Output[outputIndex].NickName = "MinI"
    ghenv.Component.Params.Output[outputIndex].Description = "Index of the minimum of the list"
    outputIndex+=1


#Solver - Run with trees to enhance performance drastically
#--------------------------------------------------------------------------------------------
if __name__ == "__main__":
    
    maximum = max(L)
    MaxI = L.index(maximum)
    Max = maximum
    
    minimum = min(L)
    MinI = L.index(minimum)
    Min = minimum
# ---------- end minmax ----------
txt = Text(rp_2)
item = ListItem(List=rep.Representation, Index=minmax.MaxI, Wrap=True)
txt_2 = Text(item)
itemindex = ItemIndex(L=txt, I=txt_2)  # -> i; inputs L: list
# ---------- itemindex: Python ----------
#Component Information
#--------------------------------------------------------------------------------------------
if ghenv.Component.RunCount<2:
    #General
    #--------------------------------------------------------------------------------------------
    __author__ = "Ueli Saluz"
    __version__ = "2022.11.18"
    
    ghenv.Component.Name = "ItemIndex"
    ghenv.Component.NickName = "ItemIndex"
    ghenv.Component.Description = "A better IdemIndex"
    ghenv.Component.Message = "VER 1.0"
    ghenv.Component.Category = "Set"
    ghenv.Component.SubCategory = "List"
    
     #Inputs
    #--------------------------------------------------------------------------------------------
    inputIndex=0
    
    ghenv.Component.Params.Input[inputIndex].Name = "List"
    ghenv.Component.Params.Input[inputIndex].NickName = "L"
    ghenv.Component.Params.Input[inputIndex].Description = "Input1 is..."
    ghenv.Component.Params.Input[inputIndex].Optional = False
    inputIndex+=1
    
    ghenv.Component.Params.Input[inputIndex].Name = "Item"
    ghenv.Component.Params.Input[inputIndex].NickName = "I"
    ghenv.Component.Params.Input[inputIndex].Description = "Input2 is..."
    ghenv.Component.Params.Input[inputIndex].Optional = False
    inputIndex+=1
    
    #Outputs
    #--------------------------------------------------------------------------------------------
    outputIndex=0
    
    ghenv.Component.Params.Output[outputIndex].Name = "Index"
    ghenv.Component.Params.Output[outputIndex].NickName = "i"
    ghenv.Component.Params.Output[outputIndex].Description = "Output1 is..."
    outputIndex+=1

i = L.index(I)
# ---------- end itemindex ----------
trim_2 = TrimTree(Tree=itemindex, Depth=1)
trim_3 = TrimTree(Tree=item, Depth=1)
i = Integer(trim_2)
rp_3 = Representation(trim_3)
i_2 = ClusterOutput(i)
rp_4 = ClusterOutput(rp_3)

# ==== cluster CacheKit: Cache a kit by downloading the remote kit with all remote representations.
uri = ClusterInput()
R = ClusterInput()
R_2 = Run(R)
uri_2 = Uri(uri)
kit = LoadKit(Uri=uri_2, Run=R_2)  # -> Success, Kit, LocalDirectory
sep = Separator()  # -> S
# ---------- sep: C# ----------
#region Usings
using System;
using System.Linq;
using System.Collections;
using System.Collections.Generic;
using System.Drawing;
using System.IO;

using Rhino;
using Rhino.Geometry;

using Grasshopper;
using Grasshopper.Kernel;
using Grasshopper.Kernel.Data;
using Grasshopper.Kernel.Types;
#endregion

public class Script_Instance : GH_ScriptInstance
{
    private void RunScript(ref object S)
    {
        S = Path.DirectorySeparatorChar;
    }
}
# ---------- end sep ----------
kit_2 = ModelKit(Kit=kit.Kit)  # -> Kit, Valid, Name, Description, Icon, Image, Preview, Version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
trim = TrimTree(Tree=kit_2.Types, Depth=1)
typ = ModelType(Type=trim)  # -> Type, Valid, Name, Description, Icon, Image, Variant, Stock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
rep = ModelRepresentation(Representation=typ.Representations)  # -> Representation, Valid, Url, Description, Tags, Qualities
tmatch = MatchText(Text=rep.Url, Pattern="http*", Case=True)
dispatch = Dispatch(List=rep.Url, DispatchPattern=tmatch)  # -> ListA, ListB
rep_2 = ReplaceText(Text=dispatch.ListB, Find="/", Replace=sep, RecursiveReplace=False)
rep_3 = CacheRepresentation(Url=dispatch.ListA, Run=R_2)  # -> Path, Success
concat = Concatenate(FragmentA=kit.LocalDirectory, FragmentB=sep, FragmentC=rep_2)
weave = Weave(Pattern=tmatch, Stream0=concat, Stream1=rep_3.Path, NullGaps=False)
import = ImportContent(FilePath=weave, Import=R_2)  # -> ModelTransform, Objects, Layers, Linetypes, HatchPatterns, AnnotationStyles, Materials, BlockDefinitions
objects = Data(import.Objects)
ur = Url(rep.Url)
urpa = Url(weave)
urpalc = Url(concat)
urpare = Url(rep_3.Path)
ty = Type(trim)
objects_2 = ClusterOutput(objects)
urpa_2 = ClusterOutput(urpa)
urpalc_2 = ClusterOutput(urpalc)
urpare_2 = ClusterOutput(urpare)
ty_2 = ClusterOutput(ty)
ur_2 = ClusterOutput(ur)

# ==== cluster SelectDesign: Select a design with a name, an optional variant and an optional view. If no variant is provided it will select all variants. If you want to select the default variant then use the empty text. If no view is provided it will select all views. If you want to select the default view then use the empty text.
dn = ClusterInput()
na = ClusterInput()
variant = ClusterInput()
view = ClusterInput()
dn_2 = Design(dn)
na_2 = Name(na)
variant_2 = Variant(variant)
view_2 = View(view)
dsn = ModelDesign(Design=dn_2)  # -> Design, Valid, Name, Description, Icon, Image, Variant, View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
expression = Expression(x=dsn.Name, y=na_2, Expression="x=y")
cull = CullPattern(List=dsn.Design, CullPattern=expression)
dsn_2 = ModelDesign(Design=cull)  # -> Design, Valid, Name, Description, Icon, Image, Variant, View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
expression_2 = Expression(x=dsn_2.Variant, y=variant_2, Expression="x=y")
null = NullItem(Item=view_2)  # -> NullFlags, InvalidFlags, Description
cull_2 = CullPattern(List=dsn_2.Design, CullPattern=expression_2)
not = GateNot(A=null.NullFlags)
null_2 = NullItem(Item=variant_2)  # -> NullFlags, InvalidFlags, Description
and = GateAnd(A=not, B=null_2.NullFlags)
filter = StreamFilter(Gate=and, Stream0=cull_2, Stream1=cull)
dsn_3 = ModelDesign(Design=filter)  # -> Design, Valid, Name, Description, Icon, Image, Variant, View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
expression_3 = Expression(x=view_2, y=dsn_3.View, Expression="x=y")
cull_3 = CullPattern(List=dsn_3.Design, CullPattern=expression_3)
filter_2 = StreamFilter(Gate=null.NullFlags, Stream0=cull_3, Stream1=cull_2)
filter_3 = StreamFilter(Gate=null_2.NullFlags, Stream0=filter_2, Stream1=cull)
filter_4 = StreamFilter(Gate=and, Stream0=filter_3, Stream1=cull_3)
dn_3 = Design(filter_4)
dn_4 = ClusterOutput(dn_3)

# ==== cluster SelectQuality: Select a quality by its name.
ql = ClusterInput()
na = ClusterInput()
na_2 = Name(graft(na))
ql_2 = Quality(ql)
qal = ModelQuality(Quality=ql_2)  # -> Quality, Valid, Name, Value, Unit, Definition
expression = Expression(x=qal.Name, y=na_2, Expression="x=y")
cull = CullPattern(List=qal.Quality, CullPattern=expression)
trim = TrimTree(Tree=cull, Depth=1)
ql_3 = Quality(trim)
ql_4 = ClusterOutput(ql_3)

# ==== cluster PreviewDesign: Preview a design from objects that match to the representations of the types. Use tags to select matching representations.
dn = ClusterInput()
ty = ClusterInput()
ob = ClusterInput()
sc = ClusterInput()
tags = ClusterInput()
dn_2 = Design(dn)
ty_2 = Type(ty)
ob_2 = Data(ob)
tags_2 = Tags(tags)
sc_2 = Number(sc)
dn_3 = Design(graft(dn_2))
ty_3 = Type(ty_2)
lng = ListLength(List=ty_3)
ob_3 = Data(ob_2)
trim = TrimTree(Tree=ob_3, Depth=1)
sc_3 = Number(sc_2)
tags_3 = Tags(tags_2)
lng_2 = ListLength(List=trim)
lng_3 = ListLength(List=trim)
fltdsn = FlattenDesign(Design=dn_3, Type=ty_3)
tstat = TreeStatistics(Tree=ob_3)  # -> Paths, Length, Count
item = ListItem(List=tstat.Length, Index=0, Wrap=True)
lng_4 = ListLength(List=tstat.Paths)
trim_2 = TrimTree(Tree=lng_3, Depth=1)
null = NullItem(Item=trim_2)  # -> NullFlags, InvalidFlags, Description
item_2 = ListItem(List=null.NullFlags, Index=0, Wrap=True)
item_3 = ListItem(List=trim_2, Index=0, Wrap=True)
dsn = ModelDesign(Design=fltdsn)  # -> Design, Valid, Name, Description, Icon, Image, Variant, View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
trim_3 = TrimTree(Tree=dsn.Pieces, Depth=1)
filter = StreamFilter(Gate=item_2, Stream0=item_3, Stream1=lng_2)
null_2 = NullItem(Item=filter)  # -> NullFlags, InvalidFlags, Description
typ = SelectTypeByPiece(ty=ty_3, pc=trim_3)  # -> ty_4, i_2
typ_2 = ModelType(Type=typ.ty_4)  # -> Type, Valid, Name, Description, Icon, Image, Variant, Stock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
object = ModelObject(Object=ob_3)  # -> Object, Geometry, Name, Layer, Visibility, Display, Drafting, Render
filter_2 = StreamFilter(Gate=null_2.NullFlags, Stream0=filter, Stream1=lng)
expression = Expression(x=lng_4, y=item, z=lng, u=filter_2, Expression="If((x=1)and(y=1)and(z=1),0,If((x=1)and(y=z),1,If((x=z)and(u=z),2,3)))")
lng_5 = ListLength(List=typ_2.Representations)
rep = SelectRepresentation(rp=typ_2.Representations, tags=tags_3)  # -> rp_4, i_2
group = Group(Geometry=object.Geometry)
expression_2 = Expression(x="0", y=typ.ty_4, Expression="x")
trim_4 = TrimTree(Tree=lng_5, Depth=1)
merge = Merge(Data1=graft(expression_2), Data2=graft(rep.i_2))
trim_5 = TrimTree(Tree=group, Depth=1)
group_2 = Group(Geometry=trim_5)
trim_6 = TrimTree(Tree=group_2, Depth=1)
expression_3 = Expression(x=trim_4, Expression="x=0")
filter_3 = StreamFilter(Gate=expression, Stream0=ob_3, Stream1=object.Geometry, Stream2=trim_5, Stream3=trim_6)
item_4 = ListItem(List=filter_3, Index=typ.i_2, Wrap=True)
ungroup = Ungroup(Group=item_4)
filter_4 = StreamFilter(Gate=expression, Stream0=item_4, Stream1=ungroup, Stream2=ungroup, Stream3=ungroup)
bool = Boolean(invert(graft(expression_3)))
item_5 = ListItem(List=merge, Index=bool, Wrap=True)
i = Integer(item_5)
item_6 = ListItem(List=filter_4, Index=i, Wrap=True)
pce = ModelPiece(Piece=dsn.Pieces)  # -> Piece, Valid, Id, Description, TypeName, TypeVariant, DesignName, DesignVariant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
trim_7 = TrimTree(Tree=item_6, Depth=1)
orient = Orient(Geometry=trim_7, Source=PlaneXY(0, 0, 0), Target=pce.Plane)  # -> Geometry, Transform
geo = PreviewGeometry(geo=orient.Geometry, sc=sc_3)
con = PreviewConnections(dn=dn_2, ty=ty_2, sc=sc_2)

# ==== cluster GitLabKit: Get the uri and the homepage of the remote kit of a specific version (either a branch name, a tag name or a commit sha) for a kit hosted as a repository on GitLab. If you don't want the main branch, you have to clear the branch param.
domain = ClusterInput()
account = ClusterInput()
repo = ClusterInput()
branch = ClusterInput()
tag = ClusterInput()
commit = ClusterInput()
domain_2 = Text(domain)
account_2 = Text(account)
repo_2 = Text(repo)
branch_2 = Text(branch)
tag_2 = Text(tag)
commit_2 = Text(commit)
null = NullItem(Item=tag_2)  # -> NullFlags, InvalidFlags, Description
null_2 = NullItem(Item=commit_2)  # -> NullFlags, InvalidFlags, Description
null_3 = NullItem(Item=branch_2)  # -> NullFlags, InvalidFlags, Description
not = GateNot(A=null_3.NullFlags)
not_2 = GateNot(A=null.NullFlags)
not_3 = GateNot(A=null_2.NullFlags)
and = GateAnd(A=null_3.NullFlags, B=null.NullFlags, C=null_2.NullFlags)
and_2 = GateAnd(A=not, B=not_2, C=not_3)
or = GateOr(A=and, B=and_2)
filter = StreamFilter(Gate=null_3.NullFlags, Stream0=branch_2, Stream1=tag_2)
filter_2 = StreamFilter(Gate=null_3.NullFlags, Stream0="heads", Stream1="tags")
filter_3 = StreamFilter(Gate=null_2.NullFlags, Stream0=commit_2, Stream1=filter)
concat = Concatenate(FragmentA="?ref_type=", FragmentB=filter_2)
filter_4 = StreamFilter(Gate=null_2.NullFlags, Stream1=concat)
concat_2 = Concatenate(FragmentA="https://", FragmentE=domain_2, FragmentF="/", FragmentB=account_2, FragmentC="/", FragmentD=repo_2)
concat_3 = Concatenate(FragmentA=concat_2, FragmentE="/-/tree/", FragmentH=filter_3, FragmentD=filter_4)
concat_4 = Concatenate(
    FragmentA=concat_2,
    FragmentE="/-/archive/",
    FragmentH=filter_3,
    FragmentB="/",
    FragmentC=repo_2,
    FragmentD="-",
    FragmentF=filter_3,
    FragmentG=".zip")
filter_5 = StreamFilter(Gate=or, Stream0=concat_3)
filter_6 = StreamFilter(Gate=or, Stream0=concat_4)
remote = Remote(filter_6)
homepage = Homepage(filter_5)
remote_2 = ClusterOutput(remote)
homepage_2 = ClusterOutput(homepage)

# ==== cluster GitHubKit: Get the uri and the homepage of the remote kit of a specific version (either a branch name, a tag name or a commit sha) for a kit hosted as a repository on GitHub. If you don't want the main branch, you have to clear the branch param.
domain = ClusterInput()
account = ClusterInput()
repo = ClusterInput()
branch = ClusterInput()
tag = ClusterInput()
commit = ClusterInput()
commit_2 = Text(commit)
domain_2 = Text(domain)
account_2 = Text(account)
repo_2 = Text(repo)
branch_2 = Text(branch)
tag_2 = Text(tag)
null = NullItem(Item=domain_2)  # -> NullFlags, InvalidFlags, Description

null_2 = NullItem(Item=tag_2)  # -> NullFlags, InvalidFlags, Description
null_3 = NullItem(Item=commit_2)  # -> NullFlags, InvalidFlags, Description
null_4 = NullItem(Item=branch_2)  # -> NullFlags, InvalidFlags, Description
not = GateNot(A=null_2.NullFlags)
not_2 = GateNot(A=null_3.NullFlags)
not_3 = GateNot(A=null_4.NullFlags)
merge = Merge(Data1=not_3, Data2=not, Data3=not_2)
int = Integer(merge)
ma = MassAddition(Input=int)  # -> Result, PartialResults
expression = Expression(x=ma.Result, Expression="x≠1")
null_5 = NullItem(Item=account_2)  # -> NullFlags, InvalidFlags, Description
null_6 = NullItem(Item=repo_2)  # -> NullFlags, InvalidFlags, Description
or = GateOr(A=expression, D=null.NullFlags, B=null_5.NullFlags, C=null_6.NullFlags)

filter = StreamFilter(Gate=null_4.NullFlags, Stream0="heads", Stream1="tags")
filter_2 = StreamFilter(Gate=null_4.NullFlags, Stream0=branch_2, Stream1=tag_2)
concat = Concatenate(FragmentA="https://", FragmentE=domain_2, FragmentF="/", FragmentB=account_2, FragmentC="/", FragmentD=repo_2)
concat_2 = Concatenate(FragmentA="refs/", FragmentB=filter, FragmentC="/")
filter_3 = StreamFilter(Gate=null_3.NullFlags, Stream1=concat_2)
filter_4 = StreamFilter(Gate=null_3.NullFlags, Stream0=commit_2, Stream1=filter_2)
concat_3 = Concatenate(FragmentA=concat, FragmentE="/archive/", FragmentC=filter_3, FragmentF=filter_4, FragmentG=".zip")
concat_4 = Concatenate(
    FragmentA=concat,
    FragmentB="/",
    FragmentC="tree",
    FragmentF="/",
    FragmentD=branch_2,
    FragmentE=tag_2,
    FragmentG=commit_2)

filter_5 = StreamFilter(Gate=or, Stream0=concat_3)
filter_6 = StreamFilter(Gate=or, Stream0=concat_4)
remote = Remote(filter_5)
homepage = Homepage(filter_6)
remote_2 = ClusterOutput(remote)
homepage_2 = ClusterOutput(homepage)

# ==== cluster LinearConnections_2: Create an array of linear connections where the connecting port is always going to the connected port.
pc = ClusterInput()
cox = ClusterInput()
coy = ClusterInput()
pc_2 = Piece(pc)
cox_2 = Connection(cox)
coy_2 = Connection(coy)
flip = FlipMatrix(Data=pc_2)
bang = ExplodeTree(Data=flip)
trim = TrimTree(Tree=bang, Depth=1)
cons = LinearConnections(pc=trim, co=coy_2)
cons_2 = LinearConnections(pc=pc_2, co=cox_2)
weave = Weave(Pattern=[0, 1], Stream0=graft(cons), Stream1=cons_2, NullGaps=False)
co = Connection(weave)
co_2 = ClusterOutput(co)

# ==== cluster GnrtGridPcs
X = ClusterInput()
Y = ClusterInput()
ty = ClusterInput()
ty_2 = Type(ty)
X_2 = Number(X)
Y_2 = Number(Y)
dup = DuplicateData(Data=ty_2, Number=X_2, Order=True)
trim = TrimTree(Tree=dup, Depth=1)
dup_2 = DuplicateData(Data=trim, Number=Y_2, Order=True)
trim_2 = TrimTree(Tree=dup_2, Depth=1)
partition = PartitionList(List=trim_2, Size=X_2)
tstat = TreeStatistics(Tree=partition)  # -> Paths, Length, Count
trim_3 = TrimTree(Tree=tstat.Count, Depth=1)
lng = ListLength(List=partition)
series = Series(Start=0, Step=1, Count=trim_3)
series_2 = Series(Start=0, Step=1, Count=lng)
trim_4 = TrimTree(Tree=series, Depth=1)  # -> graft(Tree)
concat = Concatenate(FragmentA=trim_4, FragmentB=",", FragmentC=series_2)
trim_5 = TrimTree(Tree=concat, Depth=1)
pce = ModelPiece(Piece=ty_2, Id=trim_5)  # -> Piece, Valid, Id, Description, TypeName, TypeVariant, DesignName, DesignVariant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
pc = Piece(pce.Piece)
pc_2 = ClusterOutput(pc)

# ==== cluster LinearPieces: Create a list of x-amount pieces (with id of the index) of a certain type. The pieces fit to linear connections.
X = ClusterInput()
ty = ClusterInput()
ty_2 = Type(ty)
X_2 = Number(X)
dup = DuplicateData(Data=ty_2, Number=X_2, Order=True)
trim = TrimTree(Tree=dup, Depth=1)
lng = ListLength(List=trim)
series = Series(Start=0, Step=1, Count=lng)
trim_2 = TrimTree(Tree=series, Depth=1)
pce = ModelPiece(Piece=ty_2, Id=trim_2)  # -> Piece, Valid, Id, Description, TypeName, TypeVariant, DesignName, DesignVariant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
pc = Piece(pce.Piece)
pc_2 = ClusterOutput(pc)

# ==== cluster GnrtGridPcs_2
ty = ClusterInput()
X = ClusterInput()
Y = ClusterInput()
Z = ClusterInput()
Z_2 = Number(Z)
ty_2 = Type(ty)
X_2 = Number(X)
Y_2 = Number(Y)
series = Series(Start=graft(0), Step=1, Count=Z_2)
series_2 = Series(Start=graft(0), Step=1, Count=Y_2)
series_3 = Series(Start=0, Step=1, Count=X_2)
trim = TrimTree(Tree=series_3, Depth=1)
trim_2 = TrimTree(Tree=series_2, Depth=1)
trim_3 = TrimTree(Tree=series, Depth=1)
concat = Concatenate(FragmentA=graft(trim), FragmentB=",", FragmentC=trim_2)
concat_2 = Concatenate(FragmentA=graft(concat), FragmentB=",", FragmentC=trim_3)
pce = ModelPiece(Piece=ty_2, Id=concat_2)  # -> Piece, Valid, Id, Description, TypeName, TypeVariant, DesignName, DesignVariant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
pc = Piece(pce.Piece)
pc_2 = ClusterOutput(pc)

# ==== cluster LinearConnections_3: Create an array of linear connections where the connecting port is always going to the connected port.
pc = ClusterInput()
cox = ClusterInput()
coy = ClusterInput()
coz = ClusterInput()
pc_2 = Piece(pc)
cox_2 = Connection(cox)
coy_2 = Connection(coy)
coz_2 = Connection(coz)
bang = ExplodeTree(Data=pc_2)
path_mapper = PathMapper(pc_2, source="{A;X;Y}(Z)", target="{A;Z;Y;X}")
path_mapper_2 = PathMapper(pc_2, source="{A;X;Y}(Z)", target="{A;Z;X;Y}")
trim = TrimTree(Tree=path_mapper, Depth=1)
trim_2 = TrimTree(Tree=path_mapper_2, Depth=1)
cons = LinearConnections(pc=trim, co=cox_2)
cons_2 = LinearConnections(pc=trim_2, co=coy_2)
cons_3 = LinearConnections(pc=bang, co=coz_2)
entwine = Entwine(Branch00=cons, Branch01=cons_2, Branch02=cons_3, FlattenInputs=True)
co = Connection(entwine)
co_2 = ClusterOutput(co)

# ==== cluster OppinionatedType: Construct a type following the oppinionated conventions of semio. All representations are saved under representations folder where each representation is saved once natively (.3dm) and once exported (.glb). Further a collider representation is required. All names and file names are standardized.
O = ClusterInput()
tags = ClusterInput()
po = ClusterInput()
authors = ClusterInput()
qualities = ClusterInput()
export = ClusterInput()
path = ClusterInput()
na = ClusterInput()
description = ClusterInput()
variant = ClusterInput()
default = ClusterInput()
collider = ClusterInput()
O_2 = ModelObject(O)
tags_2 = Tags(tags)
po_2 = Port(po)
authors_2 = Authors(authors)
qualities_2 = Qualities(qualities)
export_2 = Boolean(export)
path_2 = FilePath(path)
na_2 = Name(na)
description_2 = Description(description)
variant_2 = Variant(graft(variant))
default_2 = ModelObject(default)
collider_2 = Mesh(collider)
txt = NormalizeText(Text=na_2)  # -> Strict, Title, Underscore, Kebab, Pascal
sep = Separator()  # -> S; same code as sep
rep = ReplaceText(Text=variant_2, Find="/", Replace="slash", RecursiveReplace=False)
rep_2 = ReplaceText(Text=rep, Find="\", Replace="backslash", RecursiveReplace=False)
txt_2 = NormalizeText(Text=rep_2)  # -> Strict, Title, Underscore, Kebab, Pascal
join = TextJoin(Text=tags_2, Join="_")
concat = Concatenate(FragmentA=txt.Kebab, FragmentD="_", FragmentB=txt_2.Kebab)
concat_2 = Concatenate(FragmentA="images", FragmentB=sep, FragmentC=concat, FragmentD=".png")
concat_3 = Concatenate(FragmentA="icons", FragmentB=sep, FragmentC=concat, FragmentD=".svg")
concat_4 = Concatenate(FragmentA=concat, FragmentB=".glb")
concat_5 = Concatenate(FragmentA=concat, FragmentB=".3dm")
concat_6 = Concatenate(FragmentA=concat, FragmentD="_", FragmentB=join)
concat_7 = Concatenate(FragmentA="representations", FragmentB=sep, FragmentC=concat, FragmentD=".glb")
concat_8 = Concatenate(FragmentA="representations", FragmentB=sep, FragmentC=concat, FragmentD=".3dm")
concat_9 = Concatenate(FragmentA=concat_6, FragmentB=".3dm")
concat_10 = Concatenate(FragmentA=concat_6, FragmentB=".glb")
concat_11 = Concatenate(FragmentA=concat_6, FragmentC="_", FragmentB="collider", FragmentD=".glb")
concat_12 = Concatenate(FragmentA="representations", FragmentB=sep, FragmentC=concat_11)
concat_13 = Concatenate(FragmentA="representations", FragmentB=sep, FragmentC=concat_9)
concat_14 = Concatenate(FragmentA="representations", FragmentB=sep, FragmentC=concat_10)
rep_3 = ModelRepresentation(Url=concat_7)  # -> Representation, Valid, Url, Description, Tags, Qualities
rep_4 = ModelRepresentation(Url=concat_8)  # -> Representation, Valid, Url, Description, Tags, Qualities
rep_5 = ModelRepresentation(Url=concat_13, Tags=tags_2)  # -> Representation, Valid, Url, Description, Tags, Qualities
rep_6 = ModelRepresentation(Url=concat_14, Tags=tags_2)  # -> Representation, Valid, Url, Description, Tags, Qualities
rep_7 = ModelRepresentation(Url=concat_12, Tags="collider")  # -> Representation, Valid, Url, Description, Tags, Qualities
merge = Merge(
    Data1=rep_3.Representation,
    Data2=rep_4.Representation,
    Data3=rep_5.Representation,
    Data4=rep_6.Representation,
    Data5=rep_7.Representation)
typ = ModelType(
    Name=txt.Title,
    Description=description_2,
    Icon=concat_3,
    Image=concat_2,
    Variant=variant_2,
    Representations=merge,
    Ports=po_2,
    Authors=authors_2,
    Qualities=qualities_2)  # -> Type, Valid, Name, Description, Icon, Image, Variant, Stock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
concat_15 = Concatenate(FragmentA=path_2, FragmentB=sep, FragmentC=concat_12)
concat_16 = Concatenate(FragmentA=path_2, FragmentB=sep, FragmentC=concat_13)
concat_17 = Concatenate(FragmentA=path_2, FragmentB=sep, FragmentC=concat_14)
ty = Type(typ.Type)
ba = Text(concat)
blc = ExportBlock(export=export_2)  # -> block_definition_3, path_4, exported_2
geo = ExportGeometry(F=concat_15, G=collider_2)  # -> S; inputs G: tree of GeometryBase, R: Boolean
# ---------- geo: C# ----------
// Grasshopper Script Instance
#region Usings
using System;
using System.Linq;
using System.Collections;
using System.Collections.Generic;
using System.Drawing;
using System.IO;

using Rhino;
using Rhino.Geometry;

using Grasshopper;
using Grasshopper.Kernel;
using Grasshopper.Kernel.Data;
using Grasshopper.Kernel.Types;
#endregion

public class Script_Instance : GH_ScriptInstance
{
    #region Notes
    /* 
      Members:
        RhinoDoc RhinoDocument
        GH_Document GrasshopperDocument
        IGH_Component Component
        int Iteration

      Methods (Virtual & overridable):
        Print(string text)
        Print(string format, params object[] args)
        Reflect(object obj)
        Reflect(object obj, string method_name)
    */
    #endregion

    private void RunScript(object F, DataTree<GeometryBase> G, bool R, ref object S)
    {
        // inspired from https://github.com/jhorikawa/GrasshopperProgrammingTutorials/blob/master/0015%20Export%20Geometry%20with%20Grasshopper%20C%23/Export%20Geometry%20with%20Grasshopper%20C%23.gh
        if(R){
            var guids = new List<Guid>();

            for(int i = 0; i < G.BranchCount; i++){
                for(int n = 0; n < G.Branches[i].Count; n++){
                var geom = G.Branches[i][n];
                var guid = Rhino.RhinoDoc.ActiveDoc.Objects.Add(geom);
                guids.Add(guid);
                }
            }

            Rhino.RhinoDoc.ActiveDoc.Objects.Select(guids);

            string cmd = "_-Export " + "\"" + F + "\"" + " _Enter _Enter";

            Rhino.RhinoApp.RunScript(cmd, false);

            Rhino.RhinoDoc.ActiveDoc.Objects.Delete(guids, true);
            S = true;
        }
    }
}
# ---------- end geo ----------
ty_2 = ClusterOutput(ty)
ba_2 = ClusterOutput(ba)

# ==== cluster Profile
width = ClusterInput()
amount = ClusterInput()
amount_2 = Integer(amount)
width_2 = Number(width)

multiplication = Multiplication(A=amount_2, B=width_2)
subtraction = Subtraction(A=amount_2, B="1")
rectangle = Rectangle(Plane=PlaneXY(0, 0, 0), XSize=multiplication, YSize=width_2, Radius=0)  # -> Rectangle, Length
multiplication_2 = Multiplication(A=subtraction, B=width_2)
explode = Explode(Curve=rectangle.Rectangle, Recursive=True)  # -> Segments, Vertices
trim = TrimTree(Tree=explode.Vertices, Depth=1)
cull_i = CullIndex(List=trim, Indices="-1", Wrap=True)
pt = ConstructPoint(XCoordinate=multiplication_2, YCoordinate=width_2, ZCoordinate=0)
trim_2 = TrimTree(Tree=cull_i, Depth=1)
replace = ReplaceItems(List=trim_2, Item=pt, Indices="2", Wrap=False)
trim_3 = TrimTree(Tree=replace, Depth=1)
intcrv = Interpolate(Vertices=trim_3, Degree="1", Periodic=invert(False), KnotStyle=1)  # -> Curve, Length, Domain

tiefe_der_fase_radius = Slider(3, range=0..5)
versatz_blockprofil = Slider(2, range=0..5)
anzahl_der_innennuten = Slider(2, range=0..5)
breite_der_innennut = Slider(3, range=0..5)
höhe_der_innennut = Slider(3, range=0..5)
anzahl_der_elemente = Slider(1, range=1..20)
profilhöhe = Slider(16, range=0..30)
nuttiefe = Slider(8, range=0..10)
nutbreite = Slider(5, range=0..10)
federtiefe = Slider(7, range=0..10)
federbreite = Slider(4, range=0..10)
versatz = Slider(5, range=0..30)
winkel_der_fase = Slider(30, range=0..100)
list = ValueList({"Ohne Innennut": 0, "Mit Innennut": 1}, selected="Mit Innennut")
list_2 = ValueList({"Einfach": 0, "Fase": 1, "Softline": 2, "Trapez": 3, "Blockhaus": 4, "Diagonal": 5}, selected="Softline")
xy = XYPlane(Origin=Point(0, 0, 0))
item = ListItem(List=trim_3, Index=0, Wrap=True)  # -> Item, Item1, Item2
expression = Expression(x=profilhöhe, Expression="x/2")
vec2pt = Vector2Pt(PointA=item.Item1, PointB=item.Item2, Unitize=invert(False))  # -> Vector, Length
profiledwoodelements = ProfiledWoodElements(
    baseplane=xy,
    elementbreadth=width_2,
    elementcount=anzahl_der_elemente,
    lengthelement=multiplication,
    profiletype=list_2,
    innergrooves=list,
    profileheight=profilhöhe,
    groovedepth=nuttiefe,
    groovebreadth=nutbreite,
    tonguedepth=federtiefe,
    tonguebreadth=federbreite,
    innergroovecount=anzahl_der_innennuten,
    innergroovebreadth=breite_der_innennut,
    innergrooveheight=höhe_der_innennut,
    chamferdepth_radius=tiefe_der_fase_radius,
    chamferangle=winkel_der_fase,
    offset=versatz,
    offsetblockprofile=versatz_blockprofil)
Z = UnitZ(Factor=1)
neg = Negative(Value=expression)
pl = ConstructPlane(Origin=item.Item1, XAxis=vec2pt.Vector, YAxis=Z)
Z_2 = UnitZ(Factor=neg)
move = Move(Geometry=profiledwoodelements, Motion=Z_2)  # -> Geometry, Transform
sec = BrepPlane(Brep=move.Geometry, Plane=pl)  # -> Curves, Points
trim_4 = TrimTree(Tree=sec.Curves, Depth=1)
scale = Scale(Geometry=profiledwoodelements, Center=Point(0, 0, 0), Factor="0.1")  # -> Geometry, Transform
srf = Surface(trim_4)
split = SplitBrep(Brep=move.Geometry, Cutter=srf)
trim_5 = TrimTree(Tree=split, Depth=1)
item_2 = ListItem(List=trim_5, Index=0, Wrap=True)  # -> Item, Item1
cap = CapHoles(Brep=item_2.Item1)

explode_2 = Explode(Curve=intcrv.Curve, Recursive=True)  # -> Segments, Vertices
trim_6 = TrimTree(Tree=explode_2.Segments, Depth=1)
midpt = CurveMiddle(Curve=trim_6)
crv_cp = CurveClosestPoint(Point=midpt, Curve=intcrv.Curve)  # -> Point, Parameter, Distance
eval = EvaluateCurve(Curve=intcrv.Curve, Parameter=crv_cp.Parameter)  # -> Point, Tangent, Angle
Z_3 = UnitZ(Factor=1)
vrot = Rotate(Vector=eval.Tangent, Axis=Z_3, Angle=degrees("-90"))

panel = Panel("""s
e
n
w""")
por = ModelPort(Id=panel, Point=midpt, Direction=vrot)  # -> Port, Valid, Id, Description, Mandatory, Family, CompatibleFamilies, Point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
typ = ModelType(Name="Profile", Variant=amount_2, Unit="mm", Ports=por.Port)  # -> Type, Valid, Name, Description, Icon, Image, Variant, Stock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
ty = Type(typ.Type)
srf_2 = Surface(intcrv.Curve)
geo = Geometry(cap)
ty_2 = ClusterOutput(ty)
srf_3 = ClusterOutput(srf_2)
geo_2 = ClusterOutput(geo)

# ==== cluster NormalizeType_2: Normalize a type for this document. This converts the length unit of the type to the length unit of this document and it scales the ports by the right scaling factor. Further it sorts the representations, ports, qualities by it's keys. The order of authors is not changed.
ty = ClusterInput()
ty_2 = Type(graft(ty))
typ = ModelType()  # -> Type, Valid, Name, Description, Icon, Image, Variant, Stock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
typ_2 = ModelType(Type=ty_2)  # -> Type, Valid, Name, Description, Icon, Image, Variant, Stock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
cnvunt = ConvertUnit(Value=1, FromUnit=typ_2.Unit, ToUnit=typ.Unit)
trim = TrimTree(Tree=typ_2.Ports, Depth=1)
trim_2 = TrimTree(Tree=typ_2.Representations, Depth=1)
trim_3 = TrimTree(Tree=typ_2.Qualities, Depth=1)
por = ModelPort(Port=trim)  # -> Port, Valid, Id, Description, Mandatory, Family, CompatibleFamilies, Point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
qal = ModelQuality(Quality=trim_3)  # -> Quality, Valid, Name, Value, Unit, Definition
rep = ModelRepresentation(Representation=trim_2)  # -> Representation, Valid, Url, Description, Tags, Qualities
scale = Scale(Geometry=por.Point, Center=Point(0, 0, 0), Factor=cnvunt)  # -> Geometry, Transform
scale_2 = Scale(Geometry=por.Direction, Center=Point(0, 0, 0), Factor=cnvunt)  # -> Geometry, Transform
join = TextJoin(Text=rep.Tags, Join="##")
tsort = SortText(Keys=qal.Name, Values=qal.Quality, Culture=127)  # -> Keys, Values
concat = Concatenate(FragmentB=join)
por_2 = ModelPort(Port=por.Port, Point=scale.Geometry, Direction=scale_2.Geometry)  # -> Port, Valid, Id, Description, Mandatory, Family, CompatibleFamilies, Point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
trim_4 = TrimTree(Tree=tsort.Values, Depth=1)
trim_5 = TrimTree(Tree=concat, Depth=1)
tsort_2 = SortText(Keys=por_2.Id, Values=por_2.Port, Culture=127)  # -> Keys, Values
tsort_3 = SortText(Keys=trim_5, Values=rep.Representation, Culture=127)  # -> Keys, Values
trim_6 = TrimTree(Tree=tsort_2.Values, Depth=1)
trim_7 = TrimTree(Tree=tsort_3.Values, Depth=1)
typ_3 = ModelType(Type=typ_2.Type, Unit=typ.Unit, Representations=trim_7, Ports=trim_6, Qualities=trim_4)  # -> Type, Valid, Name, Description, Icon, Image, Variant, Stock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
trim_8 = TrimTree(Tree=typ_3.Type, Depth=1)
ty_3 = Type(trim_8)
ty_4 = ClusterOutput(ty_3)

# ==== cluster LoadDesign: Load the design. If the representations are urls to files then the objects are loaded for a certain level of details and tags.
uri = ClusterInput()
na = ClusterInput()
variant = ClusterInput()
view = ClusterInput()
mm = ClusterInput()
lod = ClusterInput()
tags = ClusterInput()
R = ClusterInput()
view_2 = View(view)
uri_2 = Uri(uri)
na_2 = Name(na)
variant_2 = Variant(variant)
mm_2 = Mime(mm)
lod_2 = Lod(lod)
tags_2 = Tags(tags)
R_2 = Run(R)
kit = LoadKit(Uri=uri_2, Run=R_2)  # -> Success, Kit, LocalDirectory
kit_2 = ModelKit(Kit=kit.Kit)  # -> Kit, Valid, Name, Description, Icon, Image, Preview, Version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
trim = TrimTree(Tree=kit_2.Designs, Depth=1)
seldsn = SelectDesign(dn=trim, na=na_2, variant=variant_2, view=view_2)
trim_2 = TrimTree(Tree=kit_2.Types, Depth=1)
shwdsn = ShowDesign_2(dn=seldsn, ty=trim_2, mm=mm_2, lod=lod_2, tags=tags_2)  # -> id_2, ur_2, pa_ur_2, pln_2
sep = Separator()  # -> S; same code as sep
concat = Concatenate(FragmentA=kit.LocalDirectory, FragmentB=sep, FragmentC=shwdsn.pa_ur_2)
geo = LoadGeometry(path=concat, pln=shwdsn.pln_2, run=R_2)  # -> object_4, col_2, shader_2
pln = Plane(flatten(shwdsn.pln_2))
dn = Design(seldsn)
object = ModelObject(geo.object_4)
shader = Shader(geo.shader_2)
ur = Url(shwdsn.ur_2)
path = FilePath(concat)
id = Id(shwdsn.id_2)
dn_2 = ClusterOutput(dn)
object_2 = ClusterOutput(object)
shader_2 = ClusterOutput(shader)
ur_2 = ClusterOutput(ur)
path_2 = ClusterOutput(path)
id_2 = ClusterOutput(id)
pln_2 = ClusterOutput(pln)

# ==== cluster LoadType: Load the type. If the representations are urls to files then the geometry is loaded for a certain level of details and tags.
uri = ClusterInput()
na = ClusterInput()
variant = ClusterInput()
mm = ClusterInput()
lod = ClusterInput()
tags = ClusterInput()
R = ClusterInput()
uri_2 = Uri(uri)
na_2 = Name(na)
variant_2 = Variant(variant)
mm_2 = Mime(mm)
lod_2 = Lod(lod)
tags_2 = Tags(tags)
R_2 = Run(R)
kit = LoadKit(Uri=uri_2, Run=R_2)  # -> Success, Kit, LocalDirectory
kit_2 = ModelKit(Kit=kit.Kit)  # -> Kit, Valid, Name, Description, Icon, Image, Preview, Version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
trim = TrimTree(Tree=kit_2.Types, Depth=1)
typ = SelectType(ty=trim, na=na_2, variant=variant_2)  # -> ty_4, i_2
typ_2 = ModelType(Type=typ.ty_4)  # -> Type, Valid, Name, Description, Icon, Image, Variant, Stock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
trim_2 = TrimTree(Tree=typ_2.Representations, Depth=1)
selrep = SelectRepresentation_3(rp=trim_2, mm=mm_2, lod=lod_2, tags=tags_2)  # -> rp_4, ur_2, pa_ur_2
rep = SelectRepresentation()  # -> rp_4, i_2
sep = Separator()  # -> S; same code as sep
concat = Concatenate(FragmentA=kit.LocalDirectory, FragmentB=sep, FragmentC=selrep.pa_ur_2)
xy = XYPlane(Origin=Point(0, 0, 0))
geo = LoadGeometry(path=concat, pln=xy, run=R_2)  # -> object_4, col_2, shader_2
object = ModelObject(geo.object_4)
ty = Type(typ_2.Type)
shader = Shader(geo.shader_2)
ur = Url(selrep.ur_2)
path = FilePath(concat)
path_2 = ClusterOutput(path)
ty_2 = ClusterOutput(ty)
object_2 = ClusterOutput(object)
shader_2 = ClusterOutput(shader)
ur_2 = ClusterOutput(ur)

# ==== cluster DesignToBlock: Bake the design to blocks: by selecting a representation with mime and tags and turn it to block-definitions and flatten the design and turn every piece into a block-definition with the plane as it transform.
dn = ClusterInput()
ty = ClusterInput()
ob = ClusterInput()
mm = ClusterInput()
tags = ClusterInput()
dn_2 = Design(dn)
ob_2 = Data(ob)
ty_2 = Type(ty)
mm_2 = Mime(mm)
tags_2 = Tags(tags)
dsn = ModelDesign(Pieces=ty_2)  # -> Design, Valid, Name, Description, Icon, Image, Variant, View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
fltdsn = FlattenDesign(Design=dn_2, Types=ty_2)
dsn_modified = ShowDesign_3(dn=dsn.Design, ty=ty_2, ob=ob_2, mm=mm_2, tags=tags_2)  # -> object_2, id_2, rp_2, pln_2
dsn_2 = ModelDesign(Design=fltdsn)  # -> Design, Valid, Name, Description, Icon, Image, Variant, View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
trim = TrimTree(Tree=dsn_2.Pieces, Depth=1)
tstat = TreeStatistics(Tree=dsn_modified.object_2)  # -> Paths, Length, Count
ty_3 = Type(trim)
txt = Text(ty_3)
cset = CreateSet(List=txt)  # -> Set, Map
txt_2 = Text(ty_2)
mindex = MemberIndex(Set=txt_2, Member=cset.Set)  # -> Index, Count
trim_2 = TrimTree(Tree=mindex.Index, Depth=1)
item = ListItem(List=dsn_modified.rp_2, Index=trim_2, Wrap=True)
item_2 = ListItem(List=tstat.Paths, Index=trim_2, Wrap=True)
rep = ModelRepresentation(Representation=item)  # -> Representation, Valid, Url, Description, Tags, Qualities
branch = TreeBranch(Tree=dsn_modified.object_2, Path=item_2, MaintainPaths=False)
item_3 = ListItem(List=ty_2, Index=trim_2, Wrap=True)
typ = SerializeType(Type=item_3)
typ_2 = ModelType(Type=item_3)  # -> Type, Valid, Name, Description, Icon, Image, Variant, Stock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
block_definition = ModelBlockDefinition(Objects=branch, Name=graft(item_3), Notes=graft(typ), URL=graft(rep.Url), URLDescription=graft(typ_2.Description))  # -> BlockDefinition, Objects, Units, Name, Notes, URL, URLDescription
pce = ModelPiece(Piece=trim)  # -> Piece, Valid, Id, Description, TypeName, TypeVariant, Plane, Center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
typ_3 = SelectType(ty=ty_2, na=graft(pce.TypeName), variant=graft(pce.TypeVariant))  # -> ty_4, i_2
orient = Orient(Source=PlaneXY(0, 0, 0), Target=pce.Plane)  # -> Geometry, Transform
trim_3 = TrimTree(Tree=block_definition.BlockDefinition, Depth=1)
trim_4 = TrimTree(Tree=typ_3.i_2, Depth=1)
item_4 = ListItem(List=trim_3, Index=trim_4, Wrap=True)
block_instance = ModelBlockInstance(Transform=orient.Transform, BlockDefinition=item_4)  # -> BlockInstance, Transform, BlockDefinition
block_instance_2 = BlockInstance(block_instance.BlockInstance)
i = Integer(trim_4)
block_definition_2 = ModelBlockDefinition(trim_3)
block_definition_3 = ClusterOutput(block_definition_2)
block_instance_3 = ClusterOutput(block_instance_2)
i_2 = ClusterOutput(i)

# ==== cluster ReplaceType: Replace a type (name) in a design. All variants stay the same and must exist in the new type.
dn = ClusterInput()
old_na = ClusterInput()
new_na = ClusterInput()
dn_2 = Design(dn)
old_na_2 = Text(old_na)
new_na_2 = Text(new_na)
dsn = ModelDesign(Design=dn_2)  # -> Design, Valid, Name, Description, Icon, Image, Variant, View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
trim = TrimTree(Tree=dsn.Pieces, Depth=1)
lng = ListLength(List=trim)
pce = ModelPiece(Piece=trim)  # -> Piece, Valid, Id, Description, TypeName, TypeVariant, DesignName, DesignVariant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
series = Series(Start=0, Step=1, Count=lng)
trim_2 = TrimTree(Tree=series, Depth=1)
expression = Expression(x=pce.TypeName, y=old_na_2, Expression="x=y")
dispatch = Dispatch(List=pce.Piece, DispatchPattern=expression)  # -> ListA, ListB
dispatch_2 = Dispatch(List=trim_2, DispatchPattern=expression)  # -> ListA, ListB
pce_2 = ModelPiece(Piece=dispatch.ListA, TypeName=new_na_2)  # -> Piece, Valid, Id, Description, TypeName, TypeVariant, DesignName, DesignVariant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
replace = ReplaceItems(List=trim, Item=pce_2.Piece, Indices=dispatch_2.ListA, Wrap=False)
trim_3 = TrimTree(Tree=replace, Depth=1)
dsn_2 = ModelDesign(Design=dsn.Design, Pieces=trim_3)  # -> Design, Valid, Name, Description, Icon, Image, Variant, View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
dn_3 = Design(dsn_2.Design)
dn_4 = ClusterOutput(dn_3)

# ==== cluster SelectPieces: Select pieces of a certain type. If no variant is provided it will select all variants. If you want to select the default type then use the empty text.
pc = ClusterInput()
na = ClusterInput()
variant = ClusterInput()
pc_2 = Piece(graft(pc))
na_2 = Name(na)
variant_2 = Variant(variant)

pce = ModelPiece(Piece=pc_2)  # -> Piece, Valid, Id, Description, TypeName, TypeVariant, DesignName, DesignVariant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
expression = Expression(x=pce.TypeName, y=na_2, Expression="x=y")
expression_2 = Expression(x=na_2, y=pc_2, Expression="x")
lng = ListLength(List=na_2)
ma = MassAddition(Input=expression)  # -> Result, PartialResults
expression_3 = Expression(x=lng, Expression="x=0")
null = NullItem(Item=lng)  # -> NullFlags, InvalidFlags, Description
cull = CullPattern(List=pce.Piece, CullPattern=ma.Result)
or = GateOr(A=expression_3, B=null.NullFlags)
filter = StreamFilter(Gate=or, Stream0=cull, Stream1=pc_2)

pce_2 = ModelPiece(Piece=filter)  # -> Piece, Valid, Id, Description, TypeName, TypeVariant, DesignName, DesignVariant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
expression_4 = Expression(x=pce_2.TypeVariant, y=variant_2, Expression="x=y")
expression_5 = Expression(x=variant_2, y=pc_2, Expression="x")
lng_2 = ListLength(List=variant_2)
ma_2 = MassAddition(Input=expression_4)  # -> Result, PartialResults
expression_6 = Expression(x=lng_2, Expression="x=0")
null_2 = NullItem(Item=lng_2)  # -> NullFlags, InvalidFlags, Description
cull_2 = CullPattern(List=pce_2.Piece, CullPattern=ma_2.Result)
or_2 = GateOr(A=expression_6, B=null_2.NullFlags)
filter_2 = StreamFilter(Gate=or_2, Stream0=cull_2, Stream1=filter)

trim = TrimTree(Tree=filter_2, Depth=1)
pc_3 = Pieces(trim)
pc_4 = ClusterOutput(pc_3)

# ==== cluster SimplifyDesign: Simplify the design by replacing all ids of the pieces with a list of numbers in which the pieces appear first in the design.
dn = ClusterInput()
dn_2 = Design(dn)
dsn = ModelDesign(Design=dn_2)  # -> Design, Valid, Name, Description, Icon, Image, Variant, View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
con = ModelConnection(Connection=dsn.Connections)  # -> Connection, Valid, ConnectedPieceId, ConnectedDesignPieceId, ConnectedPieceTypePortId, ConnectingPieceId, ConnectingDesignPieceId, ConnectingPieceTypePortId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
pce = ModelPiece(Piece=dsn.Pieces)  # -> Piece, Valid, Id, Description, TypeName, TypeVariant, DesignName, DesignVariant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
itemindex = ItemIndex(L=pce.Id, I=graft(con.ConnectedPieceId))  # -> i; inputs L: list; same code as itemindex
itemindex_2 = ItemIndex(L=pce.Id, I=graft(con.ConnectingPieceId))  # -> i; inputs L: list; same code as itemindex
trim = TrimTree(Tree=dsn.Pieces, Depth=1)
lng = ListLength(List=trim)
series = Series(Start=0, Step=1, Count=lng)
trim_2 = TrimTree(Tree=series, Depth=1)
item = ListItem(List=trim_2, Index=itemindex, Wrap=True)
item_2 = ListItem(List=trim_2, Index=itemindex_2, Wrap=True)
trim_3 = TrimTree(Tree=item, Depth=1)
trim_4 = TrimTree(Tree=item_2, Depth=1)
con_2 = ModelConnection(Connection=con.Connection, ConnectedPieceId=trim_3, ConnectingPieceId=trim_4)  # -> Connection, Valid, ConnectedPieceId, ConnectedDesignPieceId, ConnectedPieceTypePortId, ConnectingPieceId, ConnectingDesignPieceId, ConnectingPieceTypePortId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
pce_2 = ModelPiece(Piece=pce.Piece, Id=trim_2)  # -> Piece, Valid, Id, Description, TypeName, TypeVariant, DesignName, DesignVariant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
dsn_2 = ModelDesign(Design=dsn.Design, Pieces=pce_2.Piece, Connections=con_2.Connection)  # -> Design, Valid, Name, Description, Icon, Image, Variant, View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
dn_3 = Design(dsn_2.Design)
dn_4 = ClusterOutput(dn_3)

# ==== cluster RemovePieces: Remove all pieces (and all associated connections) from a design.
dn = ClusterInput()
ids = ClusterInput()
dn_2 = Design(dn)
ids_2 = Text(ids)
dsn = ModelDesign(Design=dn_2)  # -> Design, Valid, Name, Description, Icon, Image, Variant, View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

trim = TrimTree(Tree=dsn.Connections, Depth=1)
con = ModelConnection(Connection=trim)  # -> Connection, Valid, ConnectedPieceId, ConnectedPieceTypePortId, ConnectingPieceId, ConnectingPieceTypePortId, Description, Gap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
expression = Expression(x=graft(con.ConnectedPieceId), y=ids_2, Expression="x=y")
expression_2 = Expression(x=graft(con.ConnectingPieceId), y=ids_2, Expression="x=y")
ma = MassAddition(Input=expression)  # -> Result, PartialResults
ma_2 = MassAddition(Input=expression_2)  # -> Result, PartialResults
or = GateOr(A=ma.Result, B=ma_2.Result)
trim_2 = TrimTree(Tree=or, Depth=1)
dispatch = Dispatch(List=trim, DispatchPattern=trim_2)  # -> ListA, ListB

trim_3 = TrimTree(Tree=dsn.Pieces, Depth=1)
pce = ModelPiece(Piece=trim_3)  # -> Piece, Valid, Id, Description, TypeName, TypeVariant, DesignName, DesignVariant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
expression_3 = Expression(x=graft(pce.Id), y=ids_2, Expression="x=y")
ma_3 = MassAddition(Input=expression_3)  # -> Result, PartialResults
trim_4 = TrimTree(Tree=ma_3.Result, Depth=1)
dispatch_2 = Dispatch(List=trim_3, DispatchPattern=trim_4)  # -> ListA, ListB

dsn_2 = ModelDesign(Design=dsn.Design, Pieces=dispatch_2.ListB, Connections=dispatch.ListB)  # -> Design, Valid, Name, Description, Icon, Image, Variant, View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
dn_3 = Design(dsn_2.Design)
pc = Pieces(dispatch_2.ListA)
co = Connections(dispatch.ListA)
dn_4 = ClusterOutput(dn_3)
pc_2 = ClusterOutput(pc)
co_2 = ClusterOutput(co)

# ==== cluster SumQualities: Sum up the qualities of a type for each piece with this type in a design.
dn = ClusterInput()
ty = ClusterInput()
na = ClusterInput()
dn_2 = Design(dn)
ty_2 = Type(ty)
na_2 = Name(na)
dsn = ModelDesign(Design=dn_2)  # -> Design, Valid, Name, Description, Icon, Image, Variant, View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
typ = ModelType(Type=ty_2)  # -> Type, Valid, Name, Description, Icon, Image, Variant, Stock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
qal = ModelQuality(Quality=typ.Qualities)  # -> Quality, Valid, Name, Value, Unit, Definition
trim = TrimTree(Tree=dsn.Pieces, Depth=1)
pce = ModelPiece(Piece=trim)  # -> Piece, Valid, Id, Description, TypeName, TypeVariant, DesignName, DesignVariant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
expression = Expression(x=na_2, y=qal.Name, Expression="x=y")
expression_2 = Expression(x=graft(pce.TypeName), y=typ.Name, Expression="x=y")
expression_3 = Expression(x=graft(pce.TypeVariant), y=typ.Variant, Expression="x=y")
cull = CullPattern(List=typ.Qualities, CullPattern=expression)
and = GateAnd(A=expression_2, B=expression_3)
qal_2 = ModelQuality(Quality=cull)  # -> Quality, Valid, Name, flatten(Value), Unit, Definition
cull_2 = CullPattern(List=ty_2, CullPattern=and)
lng = ListLength(List=ty_2)
txt = Text(ty_2)
txt_2 = Text(cull_2)
series = Series(Start=0, Step=1, Count=lng)
expression_4 = Expression(x=txt_2, y=txt, Expression="x=y")
trim_2 = TrimTree(Tree=series, Depth=1)
cull_3 = CullPattern(List=trim_2, CullPattern=expression_4)
trim_3 = TrimTree(Tree=cull_3, Depth=1)
item = ListItem(List=qal_2.Value, Index=trim_3, Wrap=True)
clean = CleanTree(RemoveNulls=True, RemoveInvalid=True, RemoveEmpty=False, Tree=item)
ma = MassAddition(Input=clean)  # -> Result, PartialResults
vl = Value(ma.Result)
ql = Quality(qal_2.Quality)
vl_2 = ClusterOutput(vl)
ql_2 = ClusterOutput(ql)

# ==== cluster MergeDesigns: Merge a list of distinct designs into a new design. All designs are normalized first, so the connections align. All the pieces have the name and variant as a prefix to ensure uniqueness. Make sure every design is distinct by having a unique combination of name and variant.
dn = ClusterInput()
na = ClusterInput()
description = ClusterInput()
icon = ClusterInput()
image = ClusterInput()
variant = ClusterInput()
view = ClusterInput()
qualities = ClusterInput()
authors = ClusterInput()
na_2 = Name(na)
description_2 = Description(description)
icon_2 = Icon(icon)
image_2 = Image(image)
variant_2 = Variant(variant)
view_2 = View(view)
qualities_2 = Qualities(qualities)
authors_2 = Authors(authors)
dn_2 = Design(dn)
dsn = NormalizeDesign(dn=dn_2)
dsn_2 = ModelDesign(Design=dsn)  # -> Design, Valid, Name, Description, Icon, Image, Variant, View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
con = ModelConnection(Connection=dsn_2.Connections)  # -> Connection, Valid, ConnectedPieceId, ConnectedDesignPieceId, ConnectedPieceTypePortId, ConnectingPieceId, ConnectingDesignPieceId, ConnectingPieceTypePortId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
pce = ModelPiece(Piece=dsn_2.Pieces)  # -> Piece, Valid, Id, Description, TypeName, TypeVariant, DesignName, DesignVariant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
concat = Concatenate(FragmentA=dsn_2.Name, FragmentB=",", FragmentC=dsn_2.Variant, FragmentD=",", FragmentE=dsn_2.View)
concat_2 = Concatenate(FragmentC=graft(concat), FragmentA=",", FragmentB=pce.Id)
concat_3 = Concatenate(FragmentC=graft(concat), FragmentA=",", FragmentB=con.ConnectedPieceId)
concat_4 = Concatenate(FragmentC=graft(concat), FragmentA=",", FragmentB=con.ConnectingPieceId)
con_2 = ModelConnection(Connection=con.Connection, ConnectedPieceId=concat_3, ConnectingPieceId=concat_4)  # -> Connection, Valid, ConnectedPieceId, ConnectedDesignPieceId, ConnectedPieceTypePortId, ConnectingPieceId, ConnectingDesignPieceId, ConnectingPieceTypePortId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
pce_2 = ModelPiece(Piece=pce.Piece, Id=concat_2)  # -> Piece, Valid, Id, Description, TypeName, TypeVariant, DesignName, DesignVariant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
trim = TrimTree(Tree=pce_2.Piece, Depth=1)
trim_2 = TrimTree(Tree=con_2.Connection, Depth=1)
dsn_3 = ModelDesign(
    Name=na_2,
    Description=description_2,
    Icon=icon_2,
    Image=image_2,
    Variant=variant_2,
    View=view_2,
    Pieces=trim,
    Connections=trim_2,
    Authors=authors_2,
    Qualities=qualities_2)  # -> Design, Valid, Name, Description, Icon, Image, Variant, View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
dn_3 = MergedDesign(dsn_3.Design)
dn_4 = ClusterOutput(dn_3)

# ==== cluster MoveDesign: Move (translate and rotate) the design by moving all planes and centers.
ce = ClusterInput()
dn = ClusterInput()
pn = ClusterInput()
dn_2 = Design(dn)
ce_2 = Transform(ce)
pn_2 = Transform(pn)
dsn = ModelDesign(Design=dn_2)  # -> Design, Valid, Name, Description, Icon, Image, Variant, View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
trim = TrimTree(Tree=dsn.Pieces, Depth=1)
pce = ModelPiece(Piece=trim)  # -> Piece, Valid, Id, Description, TypeName, TypeVariant, DesignName, DesignVariant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
pt = Point(pce.Center)
pt_2 = Point(ce_2)
transform = Transform(Geometry=pce.Plane, Transform=pn_2)
transform_2 = Transform(Geometry=pt, Transform=pt_2)
pce_2 = ModelPiece(Piece=pce.Piece, Plane=transform, Center=transform_2)  # -> Piece, Valid, Id, Description, TypeName, TypeVariant, DesignName, DesignVariant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
dsn_2 = ModelDesign(Design=dsn.Design, Pieces=pce_2.Piece)  # -> Design, Valid, Name, Description, Icon, Image, Variant, View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
dn_3 = MovedDesign(dsn_2.Design)
dn_4 = ClusterOutput(dn_3)

# ==== cluster VaryTypes: Change a variant (name) from one type to another variant of the same type for all pieces of a design.
dn = ClusterInput()
na = ClusterInput()
old_vn = ClusterInput()
new_vn = ClusterInput()
na_2 = TypeName(na)
old_vn_2 = TypeVariant(old_vn)
dn_2 = Design(dn)
new_vn_2 = TypeVariant(new_vn)
dsn = ModelDesign(Design=dn_2)  # -> Design, Valid, Name, Description, Icon, Image, Variant, View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
trim = TrimTree(Tree=dsn.Pieces, Depth=1)
pce = ModelPiece(Piece=trim)  # -> Piece, Valid, Id, Description, TypeName, TypeVariant, DesignName, DesignVariant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
lng = ListLength(List=trim)
expression = Expression(x=pce.TypeName, y=na_2, Expression="x=y")
expression_2 = Expression(x=pce.TypeVariant, y=old_vn_2, Expression="x=y")
series = Series(Start=0, Step=1, Count=lng)
and = GateAnd(A=expression, B=expression_2)
trim_2 = TrimTree(Tree=series, Depth=1)
dispatch = Dispatch(List=pce.Piece, DispatchPattern=and)  # -> ListA, ListB
dispatch_2 = Dispatch(List=trim_2, DispatchPattern=and)  # -> ListA, ListB
pce_2 = ModelPiece(Piece=dispatch.ListA, TypeVariant=new_vn_2)  # -> Piece, Valid, Id, Description, TypeName, TypeVariant, DesignName, DesignVariant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
replace = ReplaceItems(List=trim, Item=pce_2.Piece, Indices=dispatch_2.ListA, Wrap=False)
trim_3 = TrimTree(Tree=replace, Depth=1)
dsn_2 = ModelDesign(Design=dsn.Design, Pieces=trim_3)  # -> Design, Valid, Name, Description, Icon, Image, Variant, View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
dn_3 = Design(dsn_2.Design)
dn_4 = ClusterOutput(dn_3)

# ==== cluster DesignToBlock_2: Bake the design to blocks: by selecting a representation with mime and tags and turn it to block-definitions and flatten the design and turn every piece into a block-definition with the plane as it transform.
dn = ClusterInput()
ty = ClusterInput()
ob = ClusterInput()
mm = ClusterInput()
tags = ClusterInput()
dn_2 = Design(dn)
ob_2 = Data(ob)
ty_2 = Type(ty)
mm_2 = Mime(mm)
tags_2 = Tags(tags)
dsn = ModelDesign(Pieces=ty_2)  # -> Design, Valid, Name, Description, Icon, Image, Variant, View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
fltdsn = FlattenDesign(Design=dn_2, Types=ty_2)
dsn_modified = ShowDesign_4(dn=dsn.Design, ty=ty_2, ob=ob_2, mm=mm_2, tags=tags_2)  # -> object_2, id_2, rp_2, pln_2
dsn_2 = ModelDesign(Design=fltdsn)  # -> Design, Valid, Name, Description, Icon, Image, Variant, View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
trim = TrimTree(Tree=dsn_2.Pieces, Depth=1)
tstat = TreeStatistics(Tree=dsn_modified.object_2)  # -> Paths, Length, Count
ty_3 = Type(trim)
txt = Text(ty_3)
cset = CreateSet(List=txt)  # -> Set, Map
txt_2 = Text(ty_2)
mindex = MemberIndex(Set=txt_2, Member=cset.Set)  # -> Index, Count
trim_2 = TrimTree(Tree=mindex.Index, Depth=1)
item = ListItem(List=dsn_modified.rp_2, Index=trim_2, Wrap=True)
item_2 = ListItem(List=tstat.Paths, Index=trim_2, Wrap=True)
rep = ModelRepresentation(Representation=item)  # -> Representation, Valid, Url, Description, Tags, Qualities
branch = TreeBranch(Tree=dsn_modified.object_2, Path=item_2, MaintainPaths=False)
item_3 = ListItem(List=ty_2, Index=trim_2, Wrap=True)
typ = SerializeType(Type=item_3)
typ_2 = ModelType(Type=item_3)  # -> Type, Valid, Name, Description, Icon, Image, Variant, Stock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
pce = ModelPiece(Piece=trim)  # -> Piece, Valid, Id, Description, TypeName, TypeVariant, DesignName, DesignVariant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
block_definition = ModelBlockDefinition(Objects=branch, Name=graft(item_3), Notes=graft(typ), URL=graft(rep.Url), URLDescription=graft(typ_2.Description))  # -> BlockDefinition, Objects, Units, Name, Notes, URL, URLDescription
typ_3 = SelectType(ty=ty_2, na=graft(pce.TypeName), variant=graft(pce.TypeVariant))  # -> ty_4, i_2
orient = Orient(Source=PlaneXY(0, 0, 0), Target=pce.Plane)  # -> Geometry, Transform
trim_3 = TrimTree(Tree=block_definition.BlockDefinition, Depth=1)
trim_4 = TrimTree(Tree=typ_3.i_2, Depth=1)
item_4 = ListItem(List=trim_3, Index=trim_4, Wrap=True)
block_instance = ModelBlockInstance(Transform=orient.Transform, BlockDefinition=item_4)  # -> BlockInstance, Transform, BlockDefinition
block_instance_2 = BlockInstance(block_instance.BlockInstance)
i = Integer(trim_4)
block_definition_2 = ModelBlockDefinition(trim_3)
block_definition_3 = ClusterOutput(block_definition_2)
block_instance_3 = ClusterOutput(block_instance_2)
i_2 = ClusterOutput(i)

# ==== cluster NormalizeType: Normalize a type for this document. This converts the length unit of the type to the length unit of this document and it scales the ports by the right scaling factor. Further it sorts the representations, ports, qualities by it's keys. The order of authors is not changed.
ty = ClusterInput()
ty_2 = Type(graft(ty))
typ = ModelType(Type=ty_2)  # -> Type, Valid, Name, Description, Icon, Image, Variant, Stock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
typ_2 = ModelType()  # -> Type, Valid, Name, Description, Icon, Image, Variant, Stock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
cnvunt = ConvertUnit(Value=1, FromUnit=typ.Unit, ToUnit=typ_2.Unit)
trim = TrimTree(Tree=typ.Ports, Depth=1)
trim_2 = TrimTree(Tree=typ.Representations, Depth=1)
trim_3 = TrimTree(Tree=typ.Qualities, Depth=1)
por = ModelPort(Port=trim)  # -> Port, Valid, Id, Description, Mandatory, Family, CompatibleFamilies, Point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
qal = ModelQuality(Quality=trim_3)  # -> Quality, Valid, Name, Value, Unit, Definition
rep = ModelRepresentation(Representation=trim_2)  # -> Representation, Valid, Url, Description, Tags, Qualities
scale = Scale(Geometry=por.Point, Center=Point(0, 0, 0), Factor=cnvunt)  # -> Geometry, Transform
scale_2 = Scale(Geometry=por.Direction, Center=Point(0, 0, 0), Factor=cnvunt)  # -> Geometry, Transform
join = TextJoin(Text=rep.Tags, Join="##")
tsort = SortText(Keys=qal.Name, Values=qal.Quality, Culture=127)  # -> Keys, Values
concat = Concatenate(FragmentB=join)
por_2 = ModelPort(Port=por.Port, Point=scale.Geometry, Direction=scale_2.Geometry)  # -> Port, Valid, Id, Description, Mandatory, Family, CompatibleFamilies, Point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
trim_4 = TrimTree(Tree=tsort.Values, Depth=1)
trim_5 = TrimTree(Tree=concat, Depth=1)
tsort_2 = SortText(Keys=por_2.Id, Values=por_2.Port, Culture=127)  # -> Keys, Values
tsort_3 = SortText(Keys=trim_5, Values=rep.Representation, Culture=127)  # -> Keys, Values
trim_6 = TrimTree(Tree=tsort_2.Values, Depth=1)
trim_7 = TrimTree(Tree=tsort_3.Values, Depth=1)
typ_3 = ModelType(Type=typ.Type, Unit=typ_2.Unit, Representations=trim_7, Ports=trim_6, Qualities=trim_4)  # -> Type, Valid, Name, Description, Icon, Image, Variant, Stock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
trim_8 = TrimTree(Tree=typ_3.Type, Depth=1)
ty_3 = Type(trim_8)
ty_4 = ClusterOutput(ty_3)

# ==== cluster NormalizeDesign: Normalize a design for this document. This includes changing the unit to the document unit and rescaling the affected values. Further it reoders pieces, connections and qualities. Connections might be swapped, so that the connected piece id is lexically first. The order of authors is not changed.
dn = ClusterInput()
dn_2 = Design(graft(dn))
dsn = ModelDesign()  # -> Design, Valid, Name, Description, Icon, Image, Variant, View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
dsn_2 = ModelDesign(Design=dn_2)  # -> Design, Valid, Name, Description, Icon, Image, Variant, View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
cnvunt = ConvertUnit(Value=1, FromUnit=dsn_2.Unit, ToUnit=dsn.Unit)
trim = TrimTree(Tree=dsn_2.Pieces, Depth=1)
trim_2 = TrimTree(Tree=dsn_2.Connections, Depth=1)
trim_3 = TrimTree(Tree=dsn_2.Qualities, Depth=1)
con = ModelConnection(Connection=trim_2)  # -> Connection, Valid, ConnectedPieceId, ConnectedDesignPieceId, ConnectedPieceTypePortId, ConnectingPieceId, ConnectingDesignPieceId, ConnectingPieceTypePortId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
multiplication = Multiplication(A=con.Gap, B=cnvunt)
multiplication_2 = Multiplication(A=con.Shift, B=cnvunt)
multiplication_3 = Multiplication(A=con.Rise, B=cnvunt)
con_2 = ModelConnection(Connection=con.Connection, Gap=multiplication, Shift=multiplication_2, Rise=multiplication_3)  # -> Connection, Valid, ConnectedPieceId, ConnectedDesignPieceId, ConnectedPieceTypePortId, ConnectingPieceId, ConnectingDesignPieceId, ConnectingPieceTypePortId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
merge = Merge(Data1=graft(con_2.ConnectedPieceId), Data2=graft(con_2.ConnectingPieceId))
tsort = SortText(Keys=merge, Culture=127)  # -> Keys, Values
trim_4 = TrimTree(Tree=tsort.Keys, Depth=1)
expression = Expression(x=merge, y=trim_4, Expression="x=y")
item = ListItem(List=expression, Index=0, Wrap=True)
trim_5 = TrimTree(Tree=item, Depth=1)
dispatch = Dispatch(List=con_2.Connection, DispatchPattern=trim_5)  # -> ListA, ListB
con_3 = ModelConnection(Connection=dispatch.ListB)  # -> Connection, Valid, ConnectedPieceId, ConnectedDesignPieceId, ConnectedPieceTypePortId, ConnectingPieceId, ConnectingDesignPieceId, ConnectingPieceTypePortId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
txt = Text(dispatch.ListB)
clean = CleanTree(RemoveNulls=True, RemoveInvalid=True, RemoveEmpty=invert(False), Tree=txt)
con_4 = ModelConnection(
    Connection=dispatch.ListB,
    ConnectedPieceId=con_3.ConnectingPieceId,
    ConnectedPieceTypePortId=con_3.ConnectingPieceTypePortId,
    ConnectingPieceId=con_3.ConnectedPieceId,
    ConnectingPieceTypePortId=con_3.ConnectedPieceTypePortId)  # -> Connection, Valid, ConnectedPieceId, ConnectedDesignPieceId, ConnectedPieceTypePortId, ConnectingPieceId, ConnectingDesignPieceId, ConnectingPieceTypePortId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
tstat = TreeStatistics(Tree=clean)  # -> Paths, Length, Count
branch = TreeBranch(Tree=con_4.Connection, Path=tstat.Paths, MaintainPaths=True)
merge_2 = Merge(Data1=dispatch.ListA, Data2=branch)
con_5 = ModelConnection(Connection=merge_2)  # -> Connection, Valid, ConnectedPieceId, ConnectedDesignPieceId, ConnectedPieceTypePortId, ConnectingPieceId, ConnectingDesignPieceId, ConnectingPieceTypePortId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
pce = ModelPiece(Piece=trim)  # -> Piece, Valid, Id, Description, TypeName, TypeVariant, DesignName, DesignVariant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
qal = ModelQuality(Quality=trim_3)  # -> Quality, Valid, Name, Value, Unit, Definition
concat = Concatenate(FragmentA=con_5.ConnectedPieceId, FragmentC="##", FragmentB=con_5.ConnectingPieceId)
tsort_2 = SortText(Keys=concat, Values=con_5.Connection, Culture=127)  # -> Keys, Values
tsort_3 = SortText(Keys=pce.Id, Values=pce.Piece, Culture=127)  # -> Keys, Values
tsort_4 = SortText(Keys=qal.Name, Values=qal.Quality, Culture=127)  # -> Keys, Values
trim_6 = TrimTree(Tree=tsort_2.Values, Depth=1)
trim_7 = TrimTree(Tree=tsort_3.Values, Depth=1)
trim_8 = TrimTree(Tree=tsort_4.Values, Depth=1)
dsn_3 = ModelDesign(Design=dsn_2.Design, Unit=dsn.Unit, Pieces=trim_7, Connections=trim_6, Qualities=trim_8)  # -> Design, Valid, Name, Description, Icon, Image, Variant, View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
trim_9 = TrimTree(Tree=dsn_3.Design, Depth=1)
dn_3 = Design(trim_9)
dn_4 = ClusterOutput(dn_3)

# ==== cluster SelectConnection: Select a connection with the connected id and the connecting id. The connections are symetric, so if the conected is the connecting and vice versa it will still selct them.
co = ClusterInput()
cdpc = ClusterInput()
cgpc = ClusterInput()
cdpc_2 = ConnectedPieceId(graft(cdpc))
cgpc_2 = ConnectingPieceId(graft(cgpc))
co_2 = Connection(co)
con = ModelConnection(Connection=co_2)  # -> Connection, Valid, ConnectedPieceId, ConnectedPieceTypePortId, ConnectingPieceId, ConnectingPieceTypePortId, Description, Gap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
expression = Expression(x=con.ConnectedPieceId, y=cdpc_2, Expression="x=y")
expression_2 = Expression(x=con.ConnectedPieceId, y=cgpc_2, Expression="x=y")
expression_3 = Expression(x=con.ConnectingPieceId, y=cgpc_2, Expression="x=y")
expression_4 = Expression(x=con.ConnectingPieceId, y=cdpc_2, Expression="x=y")
lng = ListLength(List=co_2)
series = Series(Start=0, Step=1, Count=lng)
and = GateAnd(A=expression, B=expression_3)
and_2 = GateAnd(A=expression_2, B=expression_4)
trim = TrimTree(Tree=series, Depth=1)
or = GateOr(A=and, B=and_2)
not = GateNot(A=and)
cull = CullPattern(List=con.Connection, CullPattern=or)
and_3 = GateAnd(A=not, B=and_2)
cull_2 = CullPattern(List=trim, CullPattern=or)
nulltobranch = AddNullToEmptyBranch(D=cull)  # -> R; inputs D: tree
# ---------- nulltobranch: C# ----------
#region Usings
using System;
using System.Linq;
using System.Collections;
using System.Collections.Generic;
using System.Drawing;

using Rhino;
using Rhino.Geometry;

using Grasshopper;
using Grasshopper.Kernel;
using Grasshopper.Kernel.Data;
using Grasshopper.Kernel.Types;
#endregion

public class Script_Instance : GH_ScriptInstance
{

    private void RunScript(DataTree<object> D, ref object R)
    {
        foreach (GH_Path path in D.Paths)
            if (D.Branch(path).Count == 0)
                D.Add(null, path);

        R = D;
    }
}
# ---------- end nulltobranch ----------
nulltobranch_2 = AddNullToEmptyBranch(D=cull_2)  # -> R; inputs D: tree; same code as nulltobranch
ma = MassAddition(Input=and_3)  # -> Result, PartialResults
trim_2 = TrimTree(Tree=nulltobranch, Depth=1)
trim_3 = TrimTree(Tree=nulltobranch_2, Depth=1)
trim_4 = TrimTree(Tree=ma.Result, Depth=1)
co_3 = Connection(trim_2)
fl = Boolean(trim_4)
i = Integer(trim_3)
co_4 = ClusterOutput(co_3)
fl_2 = ClusterOutput(fl)
i_2 = ClusterOutput(i)

# ==== cluster NormalizeDesign_2: Normalize a design for this document. This includes changing the unit to the document unit and rescaling the affected values. Further it reoders pieces, connections and qualities. Connections might be swapped, so that the connected piece id is lexically first. The order of authors is not changed.
dn = ClusterInput()
dn_2 = Design(graft(dn))
dsn = ModelDesign()  # -> Design, Valid, Name, Description, Icon, Image, Variant, View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
dsn_2 = ModelDesign(Design=dn_2)  # -> Design, Valid, Name, Description, Icon, Image, Variant, View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
cnvunt = ConvertUnit(Value=1, FromUnit=dsn_2.Unit, ToUnit=dsn.Unit)
trim = TrimTree(Tree=dsn_2.Pieces, Depth=1)
trim_2 = TrimTree(Tree=dsn_2.Connections, Depth=1)
trim_3 = TrimTree(Tree=dsn_2.Qualities, Depth=1)
con = ModelConnection(Connection=trim_2)  # -> Connection, Valid, ConnectedPieceId, ConnectedPieceTypePortId, ConnectingPieceId, ConnectingPieceTypePortId, Description, Gap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
multiplication = Multiplication(A=con.Gap, B=cnvunt)
multiplication_2 = Multiplication(A=con.Shift, B=cnvunt)
multiplication_3 = Multiplication(A=con.Raise, B=cnvunt)
con_2 = ModelConnection(Connection=con.Connection, Gap=multiplication, Shift=multiplication_2, Raise=multiplication_3)  # -> Connection, Valid, ConnectedPieceId, ConnectedPieceTypePortId, ConnectingPieceId, ConnectingPieceTypePortId, Description, Gap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
merge = Merge(Data1=graft(con_2.ConnectedPieceId), Data2=graft(con_2.ConnectingPieceId))
tsort = SortText(Keys=merge, Culture=127)  # -> Keys, Values
trim_4 = TrimTree(Tree=tsort.Keys, Depth=1)
expression = Expression(x=merge, y=trim_4, Expression="x=y")
item = ListItem(List=expression, Index=0, Wrap=True)
trim_5 = TrimTree(Tree=item, Depth=1)
dispatch = Dispatch(List=con_2.Connection, DispatchPattern=trim_5)  # -> ListA, ListB
con_3 = ModelConnection(Connection=dispatch.ListB)  # -> Connection, Valid, ConnectedPieceId, ConnectedPieceTypePortId, ConnectingPieceId, ConnectingPieceTypePortId, Description, Gap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
txt = Text(dispatch.ListB)
clean = CleanTree(RemoveNulls=True, RemoveInvalid=True, RemoveEmpty=invert(False), Tree=txt)
con_4 = ModelConnection(
    Connection=dispatch.ListB,
    ConnectedPieceId=con_3.ConnectingPieceId,
    ConnectedPieceTypePortId=con_3.ConnectingPieceTypePortId,
    ConnectingPieceId=con_3.ConnectedPieceId,
    ConnectingPieceTypePortId=con_3.ConnectedPieceTypePortId)  # -> Connection, Valid, ConnectedPieceId, ConnectedPieceTypePortId, ConnectingPieceId, ConnectingPieceTypePortId, Description, Gap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
tstat = TreeStatistics(Tree=clean)  # -> Paths, Length, Count
branch = TreeBranch(Tree=con_4.Connection, Path=tstat.Paths, MaintainPaths=True)
merge_2 = Merge(Data1=dispatch.ListA, Data2=branch)
con_5 = ModelConnection(Connection=merge_2)  # -> Connection, Valid, ConnectedPieceId, ConnectedPieceTypePortId, ConnectingPieceId, ConnectingPieceTypePortId, Description, Gap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
pce = ModelPiece(Piece=trim)  # -> Piece, Valid, Id, Description, TypeName, TypeVariant, Plane, Center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
qal = ModelQuality(Quality=trim_3)  # -> Quality, Valid, Name, Value, Unit, Definition
concat = Concatenate(FragmentA=con_5.ConnectedPieceId, FragmentC="##", FragmentB=con_5.ConnectingPieceId)
tsort_2 = SortText(Keys=pce.Id, Values=pce.Piece, Culture=127)  # -> Keys, Values
tsort_3 = SortText(Keys=qal.Name, Values=qal.Quality, Culture=127)  # -> Keys, Values
tsort_4 = SortText(Keys=concat, Values=con_5.Connection, Culture=127)  # -> Keys, Values
trim_6 = TrimTree(Tree=tsort_2.Values, Depth=1)
trim_7 = TrimTree(Tree=tsort_4.Values, Depth=1)
trim_8 = TrimTree(Tree=tsort_3.Values, Depth=1)
dsn_3 = ModelDesign(Design=dsn_2.Design, Unit=dsn.Unit, Pieces=trim_6, Connections=trim_7, Qualities=trim_8)  # -> Design, Valid, Name, Description, Icon, Image, Variant, View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
trim_9 = TrimTree(Tree=dsn_3.Design, Depth=1)
dn_3 = Design(trim_9)
dn_4 = ClusterOutput(dn_3)

# ==== cluster SelectPiece: Select a piece with the id.
pc = ClusterInput()
id = ClusterInput()
id_2 = Id(graft(id))
pc_2 = Piece(pc)
lng = ListLength(List=pc_2)
pce = ModelPiece(Piece=pc_2)  # -> Piece, Valid, Id, Description, TypeName, TypeVariant, Plane, Center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
series = Series(Start=0, Step=1, Count=lng)
trim = TrimTree(Tree=series, Depth=1)
expression = Expression(x=pce.Id, y=id_2, Expression="x=y")
cull = CullPattern(List=pce.Piece, CullPattern=expression)
cull_2 = CullPattern(List=trim, CullPattern=expression)
trim_2 = TrimTree(Tree=cull_2, Depth=1)
trim_3 = TrimTree(Tree=cull, Depth=1)
pc_3 = Piece(trim_3)
i = Integer(trim_2)
pc_4 = ClusterOutput(pc_3)
i_2 = ClusterOutput(i)

# ==== cluster JaccardIndex_2: Compute the Jaccard Index of two sets.
set1 = ClusterInput()
set2 = ClusterInput()
set1_2 = Data(set1)
set2_2 = Data(set2)
cset = CreateSet(List=set2_2)  # -> Set, Map
cset_2 = CreateSet(List=set1_2)  # -> Set, Map
lng = ListLength(List=set1_2)
lng_2 = ListLength(List=set2_2)
intersection = SetIntersection(SetA=cset_2.Set, SetB=cset.Set)
expression = Expression(x=lng, Expression="x=0")
expression_2 = Expression(x=lng_2, Expression="x=0")
sunion = SetUnion(SetA=cset_2.Set, SetB=cset.Set)
null = NullItem(Item=lng)  # -> NullFlags, InvalidFlags, Description
null_2 = NullItem(Item=lng_2)  # -> NullFlags, InvalidFlags, Description
lng_3 = ListLength(List=sunion)
lng_4 = ListLength(List=intersection)
or = GateOr(A=null.NullFlags, B=expression)
or_2 = GateOr(A=null_2.NullFlags, B=expression_2)
division = Division(A=lng_4, B=lng_3)
int = Integer(or)
int_2 = Integer(or_2)
concat = Concatenate(FragmentA=int, FragmentB=int_2)
b2d = BinaryToDecimal(Binary=concat)  # -> Decimal
# ---------- b2d: Python ----------
if ghenv.Component.RunCount<2:
    __author__ = "Ueli Saluz"
    __version__ = "2021.11.14"
    
    ghenv.Component.Name = "BinaryToDecimal"
    ghenv.Component.NickName = "B2D"
    ghenv.Component.Description = "Converts a number in binary representation to a number in decimal representation."
    ghenv.Component.Message = "VER 1.0"
    
    ghenv.Component.Params.Input[0].NickName = "Binary"
    
    ghenv.Component.Params.Input[0].Description = "Binary representation of a number."
    
    ghenv.Component.Params.Output[0].NickName = "Decimal"
    
    ghenv.Component.Params.Output[0].Description = "Converted decimal representation of the same number."

if __name__ == "__main__":
    Decimal = int(Binary,2)
# ---------- end b2d ----------
expression_3 = Expression(c=b2d, x=division, Expression="If(c=0,x,If(c=3,1,0))")
N = Number(expression_3)
N_2 = ClusterOutput(N)

# ==== cluster SelectTypeByPiece: Select the type of a piece.
ty = ClusterInput()
pc = ClusterInput()
pc_2 = Piece(graft(pc))
ty_2 = Type(ty)
pce = ModelPiece(Piece=pc_2)  # -> Piece, Valid, Id, Description, TypeName, TypeVariant, DesignName, DesignVariant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
typ = SelectType(ty=ty_2, na=pce.TypeName, variant=pce.TypeVariant)  # -> ty_4, i_2
trim = TrimTree(Tree=typ.ty_4, Depth=1)
trim_2 = TrimTree(Tree=typ.i_2, Depth=1)
ty_3 = Type(trim)
i = Index(trim_2)
ty_4 = ClusterOutput(ty_3)
i_2 = ClusterOutput(i)

# ==== cluster PreviewGeometry: Preview geometry by ungrouping everything, showing light surfaces and dark edges.
sc = ClusterInput()
geo = ClusterInput()
geo_2 = Geometry(flatten(geo))
sc_2 = Number(sc)
expression = Expression(x=sc_2, Expression="x+1")
swatch = ColourSwatch(SwatchColor=RGB(0, 0, 0))
swatch_2 = ColourSwatch(SwatchColor=RGB(255, 255, 255))
ungroup = Ungroup(Group=geo_2)
ungroup_2 = Ungroup(Group=ungroup)
ungroup_3 = Ungroup(Group=ungroup_2)
ungroup_4 = Ungroup(Group=ungroup_3)
log = Logarithm(Value=expression)
clean = CleanTree(RemoveNulls=True, RemoveInvalid=True, RemoveEmpty=invert(False), Tree=ungroup_4)  # -> flatten(Tree)
multiplication = Multiplication(A=log, B=Slider(0.05, range=0..1))
linetype = ModelLinetype(Name="semio", Width=multiplication)  # -> ModelLinetype, Name, Segments, CapStyle, JoinStyle, Width, WidthUnits, TaperWidths, TaperPositions
dispatch = CSharpScript(D=clean)  # -> P, C, B, M, R
# ---------- dispatch: C# ----------
// Grasshopper Script Instance
#region Usings
using System;
using System.Linq;
using System.Collections;
using System.Collections.Generic;
using System.Drawing;

using Rhino;
using Rhino.Geometry;

using Grasshopper;
using Grasshopper.Kernel;
using Grasshopper.Kernel.Data;
using Grasshopper.Kernel.Types;
#endregion

public class Script_Instance : GH_ScriptInstance
{
    #region Notes
    /* 
      Members:
        RhinoDoc RhinoDocument
        GH_Document GrasshopperDocument
        IGH_Component Component
        int Iteration

      Methods (Virtual & overridable):
        Print(string text)
        Print(string format, params object[] args)
        Reflect(object obj)
        Reflect(object obj, string method_name)
    */
    #endregion

    private void RunScript(
	object D,
	ref object P,
	ref object C,
	ref object B,
	ref object M,
	ref object R)
    {
        if (D is Curve) C = D; // Curve
        else if (
            D is Rhino.Geometry.Point ||
            D is PointCloud
            )
            P = D; // Point
        else if ( D is Mesh) M = D; // Mesh
        else if (
            D is Surface ||
            D is Extrusion ||
            D is SubD ||
            D is Brep
            )
            B = D; // Brep
        else R = D; // Rest
            
    }
}
# ---------- end dispatch ----------
clean_2 = CleanTree(RemoveNulls=True, RemoveInvalid=True, RemoveEmpty=False, Tree=dispatch.M)
clean_3 = CleanTree(RemoveNulls=True, RemoveInvalid=True, RemoveEmpty=False, Tree=dispatch.R)
clean_4 = CleanTree(RemoveNulls=True, RemoveInvalid=True, RemoveEmpty=False, Tree=dispatch.B)
clean_5 = CleanTree(RemoveNulls=True, RemoveInvalid=True, RemoveEmpty=False, Tree=dispatch.P)
clean_6 = CleanTree(RemoveNulls=True, RemoveInvalid=True, RemoveEmpty=False, Tree=dispatch.C)
debrep = DeconstructBrep(Brep=clean_4)  # -> Faces, Edges, Vertices
preview = CustomPreview(Geometry=flatten(clean_5), Material=swatch)
preview_2 = CustomPreview(Geometry=flatten(debrep.Faces), Material=swatch_2)
preview_3 = CustomPreview(Geometry=flatten(clean_2), Material=swatch_2)
preview_4 = CustomPreview(Geometry=flatten(clean_3), Material=swatch)
curve_preview = CustomCurvePreview(Curve=clean_6, Linetype=linetype.ModelLinetype, Colour=swatch)
curve_preview_2 = CustomCurvePreview(Curve=debrep.Edges, Linetype=linetype.ModelLinetype, Colour=swatch)

# ==== cluster PreviewConnections: Preview all connections of a design by visualizing the ports of the types and the connection parameters.
dn = ClusterInput()
ty = ClusterInput()
sc = ClusterInput()
sc_2 = Number(sc)
dn_2 = Design(dn)
ty_2 = Type(ty)
fltdsn = FlattenDesign(Design=dn_2, Types=ty_2)
dsn = ModelDesign(Design=dn_2)  # -> Design, Valid, Name, Description, Icon, Image, Variant, View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
dsn_2 = ModelDesign(Design=fltdsn)  # -> Design, Valid, Name, Description, Icon, Image, Variant, View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
trim = TrimTree(Tree=dsn_2.Pieces, Depth=1)
trim_2 = TrimTree(Tree=dsn.Connections, Depth=1)
trim_3 = TrimTree(Tree=dsn.Pieces, Depth=1)
roo = SelectRoot(pc=trim_3)  # -> ro_2, i_2
null = NullItem(Item=roo.i_2)  # -> NullFlags, InvalidFlags, Description
panel = Panel("semio.parent")
filter = StreamFilter(Gate=null.NullFlags, Stream0=roo.i_2, Stream1="0")
cull_i = CullIndex(List=trim, Indices=filter, Wrap=True)
pce = ModelPiece(Piece=cull_i)  # -> Piece, Valid, Id, Description, TypeName, TypeVariant, DesignName, DesignVariant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
qal = ModelQuality(Quality=pce.Qualities)  # -> Quality, Valid, Name, Value, Unit, Definition
trim_4 = TrimTree(Tree=qal.Value, Depth=1)
con = SelectConnection_2(co=trim_2, cdpc=trim_4, cgpc=pce.Id)  # -> co_4, i_2, fl_2
pce_2 = SelectPiece_2(pc=trim, id=trim_4)  # -> pc_4, i_2
co = Connection(con.co_4)
parent = Piece(pce_2.pc_4)
child = Piece(cull_i)
con_2 = ModelConnection(Connection=co)  # -> Connection, Valid, ConnectedPieceId, ConnectedDesignPieceId, ConnectedPieceTypePortId, ConnectingPieceId, ConnectingDesignPieceId, ConnectingPieceTypePortId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
pce_3 = ModelPiece(Piece=parent)  # -> Piece, Valid, Id, Description, TypeName, TypeVariant, DesignName, DesignVariant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
pce_4 = ModelPiece(Piece=child)  # -> Piece, Valid, Id, Description, TypeName, TypeVariant, DesignName, DesignVariant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
typ = SelectTypeByPiece(ty=ty_2, pc=pce_4.Piece)  # -> ty_4, i_2
merge = Merge(Data1=graft(con_2.ConnectedPieceTypePortId), Data2=graft(con_2.ConnectingPieceTypePortId))
merge_2 = Merge(Data1=graft(con_2.ConnectingPieceTypePortId), Data2=graft(con_2.ConnectedPieceTypePortId))
typ_2 = SelectTypeByPiece(ty=ty_2, pc=pce_3.Piece)  # -> ty_4, i_2
typ_3 = ModelType(Type=typ_2.ty_4)  # -> Type, Valid, Name, Description, Icon, Image, Variant, Stock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
typ_4 = ModelType(Type=typ.ty_4)  # -> Type, Valid, Name, Description, Icon, Image, Variant, Stock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
item = ListItem(List=merge, Index=graft(con.fl_2), Wrap=True)
item_2 = ListItem(List=merge_2, Index=graft(con.fl_2), Wrap=True)
por = SelectPort(po=typ_3.Ports, id=item)  # -> po_4, i_2
por_2 = SelectPort(po=typ_4.Ports, id=item_2)  # -> po_4, i_2
deplane = DeconstructPlane(Plane=pce_4.Plane)  # -> Origin, XAxis, YAxis, ZAxis
orient = Orient(Source=PlaneXY(0, 0, 0), Target=pce_4.Plane)  # -> Geometry, Transform
orient_2 = Orient(Source=PlaneXY(0, 0, 0), Target=pce_3.Plane)  # -> Geometry, Transform
trim_5 = TrimTree(Tree=por.po_4, Depth=1)
trim_6 = TrimTree(Tree=por_2.po_4, Depth=1)
Y = UnitY(Factor=1)
c_script = CSharpScript(X=orient.Transform)  # -> T, R, I; inputs X: Transform
# ---------- c_script: C# ----------
// Grasshopper Script Instance
#region Usings
using System;
using System.Linq;
using System.Collections;
using System.Collections.Generic;
using System.Drawing;

using Rhino;
using Rhino.Geometry;

using Grasshopper;
using Grasshopper.Kernel;
using Grasshopper.Kernel.Data;
using Grasshopper.Kernel.Types;
#endregion

public class Script_Instance : GH_ScriptInstance
{
    #region Notes
    /* 
      Members:
        RhinoDoc RhinoDocument
        GH_Document GrasshopperDocument
        IGH_Component Component
        int Iteration

      Methods (Virtual & overridable):
        Print(string text)
        Print(string format, params object[] args)
        Reflect(object obj)
        Reflect(object obj, string method_name)
    */
    #endregion

    private void RunScript(Transform X, ref object T, ref object R, ref object I)
    {
        var i = new Transform();
        T = X.TryGetInverse(out i);
        var translation = new Vector3d();
        var rotation = new Transform();
        var orthogonal = new Transform();
        var diagonal = new Vector3d();
        X.DecomposeAffine(out translation, out rotation, out orthogonal,out diagonal);
        T = translation;
        R = rotation;
        I = i;
    }
}
# ---------- end c_script ----------
c_script_2 = CSharpScript(X=orient_2.Transform)  # -> T, R, I; inputs X: Transform; same code as c_script
Z = UnitZ(Factor=1)
rotate = RotateDirection(Center=Point(0, 0, 0), From=Y, To=deplane.YAxis)  # -> Geometry, Transform
parent_po = Port(trim_5)
child_po = Port(trim_6)
por_3 = ModelPort(Port=parent_po)  # -> Port, Valid, Id, Description, Mandatory, Family, CompatibleFamilies, Point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
por_4 = ModelPort(Port=child_po)  # -> Port, Valid, Id, Description, Mandatory, Family, CompatibleFamilies, Point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
deplane_2 = DeconstructPlane(Plane=pce_3.Plane)  # -> Origin, XAxis, YAxis, ZAxis
transform = Transform(Geometry=por_3.Direction, Transform=c_script_2.R)
transform_2 = Transform(Geometry=por_3.Point, Transform=orient_2.Transform)
transform_3 = Transform(Geometry=por_4.Point, Transform=orient.Transform)
transform_4 = Transform(Geometry=por_4.Direction, Transform=c_script.R)
Y_2 = UnitY(Factor=1)
por_5 = ModelPort(Port=por_3.Port, Point=transform_2, Direction=transform)  # -> Port, Valid, Id, Description, Mandatory, Family, CompatibleFamilies, Point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
por_6 = ModelPort(Port=por_4.Port, Point=transform_3, Direction=transform_4)  # -> Port, Valid, Id, Description, Mandatory, Family, CompatibleFamilies, Point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
transform_5 = Transform(Geometry=Z, Transform=c_script_2.R)
transform_6 = Transform(Geometry=Y_2, Transform=c_script_2.R)
expression = Expression(x=transform_6, Expression="x")
prv = PreviewPort(po=por_5.Port, sc=sc_2)
prv_2 = PreviewPort(po=por_6.Port, sc=sc_2)
ln = Line(EndPoint=por_6.Point)
merge_3 = Merge(Data1=graft(transform_5), Data2=graft(expression))
expression_2 = Expression(x=transform, Expression="x=y")
preview = CustomPreview(Geometry=ln, Material=ColourSwatch(SwatchColor=RGB(250, 149, 0)))
pl = ConstructPlane(Origin=Point(0, 0, 0), XAxis=Z, YAxis=Vector(0, 1, 0))
item_3 = ListItem(List=merge_3, Index=graft(expression_2), Wrap=True)
log = Logarithm(Value=sc_2)
expression_3 = Expression(x=con_2.Rise, Expression="x≠0")
expression_4 = Expression(x=con_2.Shift, Expression="x≠0")
expression_5 = Expression(x=con_2.Gap, Expression="x≠0")
deplane_3 = DeconstructPlane(Plane=pl)  # -> Origin, XAxis, YAxis, ZAxis
rev = Reverse(Vector=deplane_3.ZAxis)
pl_2 = ConstructPlane(Origin=por_6.Point, XAxis=rev, YAxis=deplane_3.XAxis)
rev_2 = Reverse(Vector=deplane_3.ZAxis)
expression_6 = Expression(x=sc_2, Expression="x/2")
prot = RotatePlane(Plane=pl_2, Angle=degrees(con_2.Rotation))
deplane_4 = DeconstructPlane(Plane=prot)  # -> Origin, XAxis, YAxis, ZAxis
rev_3 = Reverse(Vector=deplane_4.ZAxis)
pl_3 = ConstructPlane(Origin=deplane_4.Origin, XAxis=deplane_4.XAxis, YAxis=rev_3)
prot_2 = RotatePlane(Plane=pl_3, Angle=degrees(con_2.Turn))
deplane_5 = DeconstructPlane(Plane=prot_2)  # -> Origin, XAxis, YAxis, ZAxis
rev_4 = Reverse(Vector=deplane_5.ZAxis)
pl_4 = ConstructPlane(Origin=deplane_5.Origin, XAxis=deplane_5.YAxis, YAxis=deplane_5.ZAxis)
multiplication = Multiplication(A=log, B=Slider(2, range=0..10))
trim_7 = TrimTree(Tree=item_3, Depth=1)
amp = Amplitude(Vector=rev_2, Amplitude=con_2.Shift)
amp_2 = Amplitude(Vector=deplane_3.XAxis, Amplitude=con_2.Rise)
amp_3 = Amplitude(Amplitude=con_2.Gap)
move = Move(Motion=amp_3)  # -> Geometry, Transform
move_2 = Move(Geometry=move.Geometry, Motion=amp)  # -> Geometry, Transform
swatch = ColourSwatch(SwatchColor=RGB(219, 190, 161))
swatch_2 = ColourSwatch(SwatchColor=RGB(0, 0, 0))
swatch_3 = ColourSwatch(SwatchColor=RGB(252, 207, 5))
swatch_4 = ColourSwatch(SwatchColor=RGB(126, 183, 127))
rotate_2 = Rotate(Angle=degrees(con_2.Turn), Plane=PlaneXY(0, 0, 0))  # -> Geometry, Transform
cull = CullPattern(List=move_2.Geometry, CullPattern=expression_3)
cull_2 = CullPattern(CullPattern=expression_5)
cull_3 = CullPattern(List=amp_3, CullPattern=expression_5)
cull_4 = CullPattern(List=amp, CullPattern=expression_4)
cull_5 = CullPattern(List=amp_2, CullPattern=expression_3)
cull_6 = CullPattern(List=move.Geometry, CullPattern=expression_4)
cir = Circle(Plane=pl_2, Radius=expression_6)
remap = RemapNumbers(Value=con_2.Rotation, Source="360", Target=Domain(0, 1))  # -> Mapped, Clipped
cir_2 = Circle(Plane=pl_3, Radius=expression_6)
cir_3 = Circle(Plane=pl_4, Radius=expression_6)
remap_2 = RemapNumbers(Value=con_2.Turn, Source="360", Target=Domain(0, 1))  # -> Mapped, Clipped
remap_3 = RemapNumbers(Value=con_2.Tilt, Source="360", Target=Domain(0, 1))  # -> Mapped, Clipped
vdisex = VectorDisplayEx(Point=cull_2, Vector=cull_3, Colour=swatch_3, Width=multiplication)
vdisex_2 = VectorDisplayEx(Point=cull_6, Vector=cull_4, Colour=swatch_4, Width=multiplication)
vdisex_3 = VectorDisplayEx(Point=cull, Vector=cull_5, Colour=swatch, Width=multiplication)
expression_7 = Expression(x=con_2.Rotation, Expression="x≠0")
eval = EvaluateCurve(Curve=reparameterize(cir), Parameter="0")  # -> Point, Tangent, Angle
eval_2 = EvaluateCurve(Curve=reparameterize(cir), Parameter=remap.Mapped)  # -> Point, Tangent, Angle
expression_8 = Expression(x=con_2.Turn, Expression="x≠0")
expression_9 = Expression(x=con_2.Tilt, Expression="x≠0")
eval_3 = EvaluateCurve(Curve=reparameterize(cir_2), Parameter="0")  # -> Point, Tangent, Angle
eval_4 = EvaluateCurve(Curve=reparameterize(cir_3), Parameter="0")  # -> Point, Tangent, Angle
eval_5 = EvaluateCurve(Curve=reparameterize(cir_2), Parameter=remap_2.Mapped)  # -> Point, Tangent, Angle
eval_6 = EvaluateCurve(Curve=reparameterize(cir_3), Parameter=remap_3.Mapped)  # -> Point, Tangent, Angle
expression_10 = Expression(x=amp_3, Expression="x/2")
expression_11 = Expression(x=amp, Expression="x/2")
expression_12 = Expression(x=amp_2, Expression="x/2")
cull_7 = CullPattern(List=cir, CullPattern=expression_7)
cull_8 = CullPattern(List=eval.Point, CullPattern=expression_7)
cull_9 = CullPattern(List=eval_2.Point, CullPattern=expression_7)
cull_10 = CullPattern(List=cir_2, CullPattern=expression_8)
cull_11 = CullPattern(List=cir_3, CullPattern=expression_9)
cull_12 = CullPattern(List=eval_3.Point, CullPattern=expression_8)
cull_13 = CullPattern(List=eval_4.Point, CullPattern=expression_9)
cull_14 = CullPattern(List=eval_5.Point, CullPattern=expression_8)
cull_15 = CullPattern(List=eval_6.Point, CullPattern=expression_9)
move_3 = Move(Motion=expression_10)  # -> Geometry, Transform
move_4 = Move(Geometry=move.Geometry, Motion=expression_11)  # -> Geometry, Transform
move_5 = Move(Geometry=move_2.Geometry, Motion=expression_12)  # -> Geometry, Transform
concat = Concatenate(FragmentA=con_2.Gap, FragmentC=" ", FragmentB=dsn.Unit)
concat_2 = Concatenate(FragmentA=con_2.Gap, FragmentC=" ", FragmentB=dsn.Unit)
concat_3 = Concatenate(FragmentA=con_2.Rise, FragmentC=" ", FragmentB=dsn.Unit)
circledim = CircularDimension(Circle=cull_7, PointA=cull_8, PointB=cull_9, Text="{0:0}°", Size=sc_2)
circledim_2 = CircularDimension(Circle=cull_10, PointA=cull_12, PointB=cull_14, Text="{0:0}°", Size=sc_2)
circledim_3 = CircularDimension(Circle=cull_11, PointA=cull_13, PointB=cull_15, Text="{0:0}°", Size=sc_2)
cull_16 = CullPattern(List=move_3.Geometry, CullPattern=expression_5)
cull_17 = CullPattern(List=concat, CullPattern=expression_5)
cull_18 = CullPattern(List=move_4.Geometry, CullPattern=expression_5)
cull_19 = CullPattern(List=concat_2, CullPattern=expression_5)
cull_20 = CullPattern(List=move_5.Geometry, CullPattern=expression_3)
cull_21 = CullPattern(List=concat_3, CullPattern=expression_3)
tag = TextTag(Location=cull_16, Text=cull_17, Colour=swatch_3)
tag_2 = TextTag(Location=cull_18, Text=cull_19, Colour=swatch_4)
tag_3 = TextTag(Location=cull_20, Text=cull_21, Colour=swatch)

# ==== cluster LinearConnections: Create an array of linear connections (for n pieces this creates n-1 connections) where every piece is connected with the next piece. The spacing units are connections.
pc = ClusterInput()
co = ClusterInput()
co_2 = Connection(co)
pc_2 = Piece(pc)
shift = ShiftList(List=pc_2, Shift=1, Wrap=invert(True))
shift_2 = ShiftList(List=pc_2, Shift="-1", Wrap=invert(True))
trim = TrimTree(Tree=shift, Depth=1)
trim_2 = TrimTree(Tree=shift_2, Depth=1)
pce = ModelPiece(Piece=trim_2)  # -> Piece, Valid, Id, Description, TypeName, TypeVariant, DesignName, DesignVariant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
pce_2 = ModelPiece(Piece=trim)  # -> Piece, Valid, Id, Description, TypeName, TypeVariant, DesignName, DesignVariant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
con = ModelConnection(Connection=co_2, ConnectedPieceId=pce.Id, ConnectingPieceId=pce_2.Id)  # -> Connection, Valid, ConnectedPieceId, ConnectedDesignPieceId, ConnectedPieceTypePortId, ConnectingPieceId, ConnectingDesignPieceId, ConnectingPieceTypePortId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
co_3 = Connections(con.Connection)
co_4 = ClusterOutput(co_3)

# ==== cluster ExportBlock: Export geometry with layer names to a file.
dc = ClusterInput()
layer_n = ClusterInput()
path = ClusterInput()
name = ClusterInput()
url = ClusterInput()
geo = ClusterInput()
export = ClusterInput()
path_2 = FilePath(path)
name_2 = Text(name)
url_2 = Text(url)
geo_2 = Geometry(geo)
export_2 = Boolean(export)
layer_n_2 = Name(layer_n)
dc_2 = DisplayColour(dc)
layer = ModelLayer(Name=layer_n_2, DisplayColour=dc_2)  # -> Layer, Name, Hidden, Locked, DisplayColour, Material, Linetype, PrintColour, PrintWidth
object = ModelObject(Geometry=geo_2, Layer=layer.Layer)  # -> Object, Geometry, Name, Layer, Visibility, Display, Drafting, Render
block_definition = ModelBlockDefinition(Objects=object.Object, Name=name_2, URL=url_2)  # -> BlockDefinition, Objects, Units, Name, Notes, URL, URLDescription
export_definition = ExportModelBlockDefinition(BlockDefinition=block_definition.BlockDefinition, FilePath=path_2, Overwrite="T", Export=export_2)  # -> BlockDefinition, FilePath, Exported
block_definition_2 = ModelBlockDefinition(export_definition.BlockDefinition)
path_3 = FilePath(export_definition.FilePath)
exported = Boolean(export_definition.Exported)
path_4 = ClusterOutput(path_3)
exported_2 = ClusterOutput(exported)
block_definition_3 = ClusterOutput(block_definition_2)

# ==== cluster ProfiledWoodElements: Create an array of profiled wood elements.
baseplane = ClusterInput()
elementbreadth = ClusterInput()
elementcount = ClusterInput()
lengthelement = ClusterInput()
profiletype = ClusterInput()
innergrooves = ClusterInput()
profileheight = ClusterInput()
groovedepth = ClusterInput()
groovebreadth = ClusterInput()
tonguedepth = ClusterInput()
tonguebreadth = ClusterInput()
innergroovecount = ClusterInput()
innergroovebreadth = ClusterInput()
innergrooveheight = ClusterInput()
chamferdepth_radius = ClusterInput()
chamferangle = ClusterInput()
offset = ClusterInput()
offsetblockprofile = ClusterInput()
profileheight_2 = Number(profileheight)
groovedepth_2 = Number(groovedepth)
tonguedepth_2 = Number(tonguedepth)
tonguebreadth_2 = Number(tonguebreadth)
innergroovecount_2 = Number(innergroovecount)
innergroovebreadth_2 = Number(innergroovebreadth)
innergrooveheight_2 = Number(innergrooveheight)
chamferangle_2 = Number(chamferangle)
offset_2 = Number(offset)
offsetblockprofile_2 = Number(offsetblockprofile)
groovebreadth_2 = Number(groovebreadth)
chamferdepth_radius_2 = Number(chamferdepth_radius)
elementbreadth_2 = Number(elementbreadth)
lengthelement_2 = Number(lengthelement)
elementcount_2 = Integer(elementcount)
profiletype_2 = Integer(profiletype)
baseplane_2 = Plane(baseplane)
innergrooves_2 = Boolean(innergrooves)

# ----
# Originally script was built with another reference plane.
# Therefore the plane is moved and the seam later adjusted.
deplane = DeconstructPlane(Plane=baseplane_2)  # -> Origin, XAxis, YAxis, ZAxis
amp = Amplitude(Vector=deplane.YAxis, Amplitude=elementbreadth_2)
move = Move(Geometry=baseplane_2, Motion=amp)  # -> Geometry, Transform
deplane_2 = DeconstructPlane(Plane=move.Geometry)  # -> Origin, XAxis, YAxis, ZAxis
rev = Reverse(Vector=deplane_2.YAxis)

line = LineSDL(Start=deplane_2.Origin, Direction=rev, Length=elementbreadth_2)
expression = Expression(x=profileheight_2, y=groovebreadth_2, Expression="(x-y)/2")
expression_2 = Expression(x=profileheight_2, y=tonguebreadth_2, Expression="(x-y)/2")
end = EndPoints(Curve=line)  # -> Start, End
line_2 = LineSDL(Start=end.End, Direction=deplane_2.ZAxis, Length=expression)
line_3 = LineSDL(Start=end.Start, Direction=deplane_2.ZAxis, Length=expression_2)
end_2 = EndPoints(Curve=line_2)  # -> Start, End
end_3 = EndPoints(Curve=line_3)  # -> Start, End
line_4 = LineSDL(Start=end_2.End, Direction=rev, Length=expr("-x", groovedepth_2))
line_5 = LineSDL(Start=end_3.End, Direction=rev, Length=expr("-x", tonguedepth_2))
merge = Merge(Data1=line_3, Data2=line_5)
end_4 = EndPoints(Curve=line_4)  # -> Start, End
end_5 = EndPoints(Curve=line_5)  # -> Start, End
line_6 = LineSDL(Start=end_4.End, Direction=deplane_2.ZAxis, Length=groovebreadth_2)
federbasis = Curve(merge)
line_7 = LineSDL(Start=end_5.End, Direction=deplane_2.ZAxis, Length=tonguebreadth_2)
end_6 = EndPoints(Curve=line_7)  # -> Start, End
end_7 = EndPoints(Curve=line_6)  # -> Start, End
line_8 = LineSDL(Start=end_6.End, Direction=rev, Length=tonguedepth_2)
line_9 = LineSDL(Start=end_7.End, Direction=rev, Length=groovedepth_2)
end_8 = EndPoints(Curve=line_8)  # -> Start, End
end_9 = EndPoints(Curve=line_9)  # -> Start, End
line_10 = LineSDL(Start=end_8.End, Direction=deplane_2.ZAxis, Length=expression_2)
line_11 = LineSDL(Start=end_9.End, Direction=deplane_2.ZAxis, Length=expression)
end_10 = EndPoints(Curve=line_10)  # -> Start, End
end_11 = EndPoints(Curve=line_11)  # -> Start, End
merge_2 = Merge(Data1=line_7, Data2=line_8)
merge_3 = Merge(Data1=line_7, Data2=line_8, Data3=line_10)
ln = Line(StartPoint=end_10.End, EndPoint=end_11.End)
blockhausfederoberseite = Curve(merge_2)
simplefederoberseite = Curve(merge_3)
merge_4 = Merge(Data1=line_9, Data2=line_6, Data3=line_4, Data4=line_2)
rev_2 = ReverseList(List=merge_4)
flip = FlipCurve(Curve=merge_4)  # -> Curve, Flag
flip_2 = FlipCurve(Curve=line_11)  # -> Curve, Flag
nutbasis = Curve(flip.Curve)
merge_5 = Merge(Data1=flip_2.Curve, Data2=nutbasis)
einfachenut = Curve(merge_5)

expression_3 = Expression(x=elementbreadth_2, y=innergroovecount_2, z=innergroovebreadth_2, Expression="(x-z*y)/(y+1)")
line_12 = LineSDL(Start=deplane_2.Origin, Direction=rev, Length=expression_3)
end_12 = EndPoints(Curve=line_12)  # -> Start, End
line_13 = LineSDL(Start=end_12.End, Direction=deplane_2.ZAxis, Length=innergrooveheight_2)
end_13 = EndPoints(Curve=line_13)  # -> Start, End
line_14 = LineSDL(Start=end_13.End, Direction=rev, Length=innergroovebreadth_2)
end_14 = EndPoints(Curve=line_14)  # -> Start, End
line_15 = LineSDL(Start=end_14.End, Direction=deplane_2.ZAxis, Length=expr("-x", innergrooveheight_2))
merge_6 = Merge(Data1=line_12, Data2=line_13, Data3=line_14, Data4=line_15)
expression_4 = Expression(x=elementbreadth_2, y=innergroovecount_2, z=innergroovebreadth_2, Expression="(x-z*y)/(y+1)+z")
join = JoinCurves(Curves=merge_6, Preserve=False)
trim = TrimTree(Tree=join, Depth=1)
amp_2 = Amplitude(Vector=rev, Amplitude=expression_4)
flip_3 = FlipCurve(Curve=trim)  # -> Curve, Flag
arrlinear = LinearArray(Geometry=flip_3.Curve, Direction=amp_2, Count=innergroovecount_2)  # -> Geometry, Transform
trim_2 = TrimTree(Tree=arrlinear.Geometry, Depth=1)
join_2 = JoinCurves(Curves=trim_2, Preserve=False)
trim_3 = TrimTree(Tree=join_2, Depth=1)
end_15 = EndPoints(Curve=trim_3)  # -> Start, End
line_16 = LineSDL(Start=end_15.Start, Direction=rev, Length=expression_3)
merge_7 = Merge(Data1=line_16, Data2=trim_3)
join_3 = JoinCurves(Curves=merge_7, Preserve=False)
trim_4 = TrimTree(Tree=join_3, Depth=1)
innennut = StreamFilter(Gate=innergrooves_2, Stream0=line, Stream1=trim_4)
unterseite = Curve(innennut)

rad = Radians(Degrees=expr("x+90", chamferangle_2))
rad_2 = Radians(Degrees=expr("90-x", chamferangle_2))
expression_5 = Expression(x=profileheight_2, y=groovebreadth_2, z=offset_2, Expression="(x-y)/2+z")
rad_3 = Radians(Degrees=expr("90-x", chamferangle_2))
sin = Sine(Value=rad_2)
line_17 = LineSDL(Start=end_7.End, Direction=rev, Length=groovedepth_2)
line_18 = LineSDL(Start=end_6.End, Direction=rev, Length=expression_5)
rad_4 = Radians(Degrees=expr("90-x", chamferangle_2))
sin_2 = Sine(Value=rad_3)
vrot = Rotate(Vector=rev, Axis=deplane_2.XAxis, Angle=rad)
end_16 = EndPoints(Curve=line_17)  # -> Start, End
division = Division(A=expression, B=sin)
end_17 = EndPoints(Curve=line_18)  # -> Start, End
division_2 = Division(A=expression_2, B=sin_2)
vrot_2 = Rotate(Vector=rev, Axis=deplane_2.XAxis, Angle=rad_4)
line_19 = LineSDL(Start=end_16.End, Direction=vrot, Length=division)
line_20 = LineSDL(Start=end_17.End, Direction=vrot_2, Length=division_2)
flip_4 = FlipCurve(Curve=line_19)  # -> Curve, Flag
end_18 = EndPoints(Curve=line_20)  # -> Start, End
end_19 = EndPoints(Curve=flip_4.Curve)  # -> Start, End
ln_2 = Line(StartPoint=end_18.End, EndPoint=end_19.Start)
merge_8 = Merge(Data1=line_7, Data2=line_18)
merge_9 = Merge(Data2=line_20, Data3=ln_2, Data4=flip_4.Curve)
oberseitetrapez = Curve(merge_9)
fasenfederoberseite = Curve(merge_8)

expression_6 = Expression(x=profileheight_2, y=groovebreadth_2, z=chamferdepth_radius_2, Expression="(x-y)/2-z")
rad_5 = Radians(Degrees=expr("90-x", chamferangle_2))
rad_6 = Radians(Degrees=expr("x+90", chamferangle_2))
sin_3 = Sine(Value=rad_5)
expression_7 = Expression(x=profileheight_2, y=tonguebreadth_2, z=chamferdepth_radius_2, Expression="(x-y)/2-z")
line_21 = LineSDL(Start=end_16.End, Direction=deplane_2.ZAxis, Length=expression_6)
rad_7 = Radians(Degrees=expr("90-x", chamferangle_2))
end_20 = EndPoints(Curve=line_18)  # -> Start, End
division_3 = Division(A=chamferdepth_radius_2, B=sin_3)
flip_5 = FlipCurve(Curve=line_21)  # -> Curve, Flag
vrot_3 = Rotate(Vector=rev, Axis=deplane_2.XAxis, Angle=rad_6)
rad_8 = Radians(Degrees=expr("90-x", chamferangle_2))
sin_4 = Sine(Value=rad_7)
line_22 = LineSDL(Start=end_20.End, Direction=deplane_2.ZAxis, Length=expression_7)
end_21 = EndPoints(Curve=flip_5.Curve)  # -> Start, End
line_23 = LineSDL(Start=end_21.Start, Direction=vrot_3, Length=division_3)
division_4 = Division(A=chamferdepth_radius_2, B=sin_4)
vrot_4 = Rotate(Vector=rev, Axis=deplane_2.XAxis, Angle=rad_8)
end_22 = EndPoints(Curve=line_22)  # -> Start, End
flip_6 = FlipCurve(Curve=line_23)  # -> Curve, Flag
end_23 = EndPoints(Curve=flip_6.Curve)  # -> Start, End
line_24 = LineSDL(Start=end_22.End, Direction=vrot_4, Length=division_4)
end_24 = EndPoints(Curve=line_24)  # -> Start, End
ln_3 = Line(StartPoint=end_24.End, EndPoint=end_23.Start)
merge_10 = Merge(Data1=line_22, Data2=line_24, Data3=ln_3, Data4=flip_6.Curve, Data5=flip_5.Curve)
oberseitefase = Curve(merge_10)

merge_11 = Merge(Data1=line_9, Data2=line_6, Data3=line_4, Data4=line_2)

amp_3 = Amplitude(Vector=deplane_2.ZAxis, Amplitude=chamferdepth_radius_2)
amp_4 = Amplitude(Vector=rev, Amplitude=chamferdepth_radius_2)
amp_5 = Amplitude(Vector=rev, Amplitude=expr("-x", chamferdepth_radius_2))
amp_6 = Amplitude(Vector=deplane_2.ZAxis, Amplitude=chamferdepth_radius_2)
addition = Addition(A=amp_4, B=amp_3)
addition_2 = Addition(A=amp_5, B=amp_6)
move_2 = Move(Geometry=end_22.End, Motion=addition)  # -> Geometry, Transform
move_3 = Move(Geometry=end_21.Start, Motion=addition_2)  # -> Geometry, Transform
arc = ArcSED(Start=end_22.End, End=move_2.Geometry, Direction=deplane_2.ZAxis)  # -> Arc, Plane, Radius
arc_2 = ArcSED(Start=end_21.Start, End=move_3.Geometry, Direction=deplane_2.ZAxis)  # -> Arc, Plane, Radius
flip_7 = FlipCurve(Curve=arc_2.Arc)  # -> Curve, Flag
end_25 = EndPoints(Curve=arc.Arc)  # -> Start, End
end_26 = EndPoints(Curve=flip_7.Curve)  # -> Start, End
ln_4 = Line(StartPoint=end_25.End, EndPoint=end_26.Start)
merge_12 = Merge(Data1=line_22, Data2=arc.Arc, Data3=ln_4, Data4=flip_7.Curve, Data5=flip_5.Curve)
oberseitesoftline = Curve(merge_12)

vec2pt = Vector2Pt(PointA=end_8.End, PointB=end_11.End, Unitize=False)  # -> Vector, Length
angle = Angle(VectorA=vec2pt.Vector, VectorB=rev)  # -> Angle, Reflex
cos = Cosine(Value=angle.Angle)
division_5 = Division(A=tonguedepth_2, B=cos)
addition_3 = Addition(A=vec2pt.Length, B=division_5)
line_25 = LineSDL(Start=end_11.End, Direction=vec2pt.Vector, Length=expr("-x", addition_3))
flip_8 = FlipCurve(Curve=line_25)  # -> Curve, Flag
end_27 = EndPoints(Curve=flip_8.Curve)  # -> Start, End
ln_5 = Line(StartPoint=end_5.End, EndPoint=end_27.Start)
merge_13 = Merge(Data1=ln_5, Data2=flip_8.Curve)
oberseiteundfederdiagonal = Curve(merge_13)

expression_8 = Expression(x=profileheight_2, y=tonguebreadth_2, z=offsetblockprofile_2, Expression="(x-y)/2-z")
amp_7 = Amplitude(Vector=rev, Amplitude=expr("x/2", elementbreadth_2))
amp_8 = Amplitude(Vector=deplane_2.ZAxis, Amplitude=profileheight_2)
line_26 = LineSDL(Start=end_8.End, Direction=deplane_2.ZAxis, Length=expression_8)
addition_4 = Addition(A=amp_7, B=amp_8)
line_27 = LineSDL(Start=end_9.End, Direction=deplane_2.ZAxis, Length=expression_8)
flip_9 = FlipCurve(Curve=line_27)  # -> Curve, Flag
end_28 = EndPoints(Curve=line_26)  # -> Start, End
move_4 = Move(Geometry=deplane_2.Origin, Motion=addition_4)  # -> Geometry, Transform
end_29 = EndPoints(Curve=flip_9.Curve)  # -> Start, End
arc_3 = Arc3Pt(PointA=end_28.End, PointB=move_4.Geometry, PointC=end_29.Start)  # -> Arc, Plane, Radius
merge_14 = Merge(Data1=line_26, Data2=arc_3.Arc, Data3=flip_9.Curve)
oberseiteblockprofil = Curve(merge_14)

# ----
# Sadly the tangnet doesn't always point in the same direction.
# The join algorithm is not consistent
# and the forcing of the seam apparently has different rounding errors
# and sometimes y and sometimes the z tangent is the start tangent.
merge_15 = Merge(Data1=federbasis, Data2=fasenfederoberseite, Data3=oberseitefase, Data4=nutbasis)
merge_16 = Merge(Data1=federbasis, Data2=simplefederoberseite, Data3=ln, Data4=einfachenut)
merge_17 = Merge(Data1=federbasis, Data2=fasenfederoberseite, Data3=oberseitesoftline, Data4=nutbasis)
merge_18 = Merge(Data1=federbasis, Data2=fasenfederoberseite, Data3=oberseitetrapez, Data4=nutbasis)
merge_19 = Merge(Data1=federbasis, Data2=blockhausfederoberseite, Data3=oberseiteblockprofil, Data4=nutbasis)
merge_20 = Merge(Data1=federbasis, Data2=oberseiteundfederdiagonal, Data3=einfachenut)
fase = Curve(merge_15)
softline = Curve(merge_17)
blockhaus = Curve(merge_19)
trapez = Curve(merge_18)
diagonalprofile = Curve(merge_20)
simpleprofile = Curve(merge_16)
profil = StreamFilter(
    Gate=profiletype_2,
    Stream0=simpleprofile,
    Stream1=fase,
    Stream2=softline,
    Stream3=trapez,
    Stream4=blockhaus,
    Stream5=diagonalprofile)
join_4 = JoinCurves(Curves=profil, Preserve=True)
trim_5 = TrimTree(Tree=join_4, Depth=1)
merge_21 = Merge(Data1=trim_5, Data2=unterseite)
join_5 = JoinCurves(Curves=merge_21, Preserve=True)
trim_6 = TrimTree(Tree=join_5, Depth=1)
crv_cp = CurveClosestPoint(Point=deplane_2.Origin, Curve=trim_6)  # -> Point, Parameter, Distance
seam = Seam(Curve=trim_6, Seam=crv_cp.Parameter)
profiles = Curve(seam)

crv = Curve(seam)
end_30 = EndPoints(Curve=crv)  # -> Start, End
number_slider = Slider(3, range=0..10)
crv_cp_2 = CurveClosestPoint(Point=end_30.Start, Curve=crv)  # -> Point, Parameter, Distance
eval = EvaluateCurve(Curve=crv, Parameter=crv_cp_2.Parameter)  # -> Point, Tangent, Angle
points = PointList(Points=flatten(end_30.Start), Size=number_slider)
vdisex = VectorDisplayEx(Point=end_30.Start, Vector=eval.Tangent, Colour=RGB(179, 255, 38), Width=number_slider)

amp_9 = Amplitude(Vector=deplane_2.XAxis, Amplitude=lengthelement_2)
extr = Extrude(Base=profiles, Direction=amp_9)
cap = CapHoles(Brep=extr)
amp_10 = Amplitude(Vector=deplane_2.YAxis, Amplitude=elementbreadth_2)
arrlinear_2 = LinearArray(Geometry=cap, Direction=amp_10, Count=elementcount_2)  # -> Geometry, Transform
trim_7 = TrimTree(Tree=arrlinear_2.Geometry, Depth=1)
profilewood = Brep(trim_7)

profilewood_2 = ClusterOutput(profilewood)

# ==== cluster ShowDesign_2: Show a design by flattening it and selecting only representations with the same mime, lod and tags.
ty = ClusterInput()
dn = ClusterInput()
mm = ClusterInput()
lod = ClusterInput()
tags = ClusterInput()
ty_2 = Type(ty)
mm_2 = Mime(mm)
tags_2 = Tags(tags)
dn_2 = Design(dn)
lod_2 = Lod(lod)
fltdsn = FlattenDesign(Design=dn_2, Type=ty_2)
typ = ModelType(Type=ty_2)  # -> Type, Valid, Name, Description, Icon, Image, Variant, Stock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
dsn = ModelDesign(Design=fltdsn)  # -> Design, Valid, Name, Description, Icon, Image, Variant, View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
trim = TrimTree(Tree=dsn.Pieces, Depth=1)
tstat = TreeStatistics(Tree=typ.Representations)  # -> Paths, Length, Count
pce = ModelPiece(Piece=trim)  # -> Piece, Valid, Id, TypeName, TypeVariant, Plane, ScreenPoint, Center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
expression = Expression(x=graft(pce.TypeName), y=typ.Name, Expression="x=y")
expression_2 = Expression(x=graft(pce.TypeVariant), y=typ.Variant, Expression="x=y")
and = GateAnd(A=expression, B=expression_2)
cull = CullPattern(List=ty_2, CullPattern=and)
lng = ListLength(List=ty_2)
txt = Text(cull)
series = Series(Start=0, Step=1, Count=lng)
txt_2 = Text(ty_2)
expression_3 = Expression(x=txt, y=txt_2, Expression="x=y")
trim_2 = TrimTree(Tree=series, Depth=1)
cull_2 = CullPattern(List=trim_2, CullPattern=expression_3)
trim_3 = TrimTree(Tree=cull_2, Depth=1)
item = ListItem(List=tstat.Paths, Index=trim_3, Wrap=True)
branch = TreeBranch(Tree=typ.Representations, Path=item, MaintainPaths=False)
mrg_p = MergeSeperatlyPrepend(x=branch)  # -> Mrgd; inputs x: tree; same code as mrg_p
selrep = SelectRepresentation_2(rp=mrg_p, mm=mm_2, lod=lod_2, tags=tags_2)  # -> rp_4, ur_2, pa_ur_2
rep = SelectRepresentation()  # -> rp_4, i_2
trim_4 = TrimTree(Tree=selrep.ur_2, Depth=1)
trim_5 = TrimTree(Tree=selrep.pa_ur_2, Depth=1)
id = Id(pce.Id)
ur = Url(trim_4)
pa_ur = Url(trim_5)
pln = Plane(pce.Plane)
id_2 = ClusterOutput(id)
ur_2 = ClusterOutput(ur)
pa_ur_2 = ClusterOutput(pa_ur)
pln_2 = ClusterOutput(pln)

# ==== cluster LoadGeometry: Load local geometry from absolute file paths to planes.
path = ClusterInput()
pln = ClusterInput()
run = ClusterInput()
pln_2 = Plane(graft(pln))
path_2 = FilePath(path)
run_2 = Boolean(run)
import = ImportContent(
    FilePath=path_2,
    Name="*",
    Layer="*",
    Linetype="*",
    HatchPattern="*",
    AnnotationStyles="*",
    Materials="*",
    BlockDefinitions="*",
    Import=run_2)  # -> ModelTransform, Objects, Layers, Linetypes, HatchPatterns, AnnotationStyles, Materials, BlockDefinitions
object = ModelObject(Object=import.Objects)  # -> Object, Geometry, Name, Layer, Visibility, Display, Drafting, Render
orient = Orient(Geometry=object.Geometry, Source=PlaneXY(0, 0, 0), Target=pln_2)  # -> Geometry, Transform
object_2 = ModelObject(Object=object.Object, Geometry=orient.Geometry)  # -> Object, Geometry, Name, Layer, Visibility, Display, Drafting, Render
layer = ModelLayer(Layer=object_2.Layer)  # -> Layer, Name, Hidden, Locked, DisplayColour, Material, Linetype
display = DisplayAttributes(Display=object_2.Display)  # -> Display, DisplayColour, DisplayMode
display_colour = DisplayColour(DisplayColour=layer.DisplayColour)  # -> DisplayColour, Source, Colour
material = ModelMaterial(Material=layer.Material)  # -> Material, Name, Shader
display_colour_2 = DisplayColour(DisplayColour=display.DisplayColour)  # -> DisplayColour, Source, Colour
object_3 = ModelObject(object_2.Object)
col = Colour(display_colour.DisplayColour)
shader = Shader(material.Shader)
preview = CustomPreview(Geometry=object_3, Material=material.Shader)
object_4 = ClusterOutput(object_3)
shader_2 = ClusterOutput(shader)
col_2 = ClusterOutput(col)

# ==== cluster SelectRepresentation_3: Select a representation based on mime, lod and tags. The mime and lod must be equal and the tags must contain all the given tags.
rp = ClusterInput()
mm = ClusterInput()
lod = ClusterInput()
tags = ClusterInput()
rp_2 = Representation(rp)
mm_2 = Mime(mm)
lod_2 = Lod(lod)
tags_2 = Tags(tags)
rep = ModelRepresentation(Representation=rp_2)  # -> Representation, Valid, Url, Mime, Lod, Tags
expression = Expression(x=rep.Mime, y=mm_2, Expression="x=y")
cull = CullPattern(List=rep.Representation, CullPattern=expression)
rep_2 = ModelRepresentation(Representation=cull)  # -> Representation, Valid, Url, Mime, Lod, Tags
expression_2 = Expression(x=rep_2.Lod, y=lod_2, Expression="x=y")
cull_2 = CullPattern(List=rep_2.Representation, CullPattern=expression_2)
rep_3 = ModelRepresentation(Representation=cull_2)  # -> Representation, Valid, Url, Mime, Lod, Tags
trim = TrimTree(Tree=rep_3.Tags, Depth=1)
contains = Contains(L=trim, I=tags_2)  # -> R; inputs L: list, I: list; same code as contains
ma = MassAddition(Input=contains)  # -> Result, PartialResults
lng = ListLength(List=contains)
equals = Equality(FirstNumber=ma.Result, SecondNumber=lng)  # -> Equality, Inequality
cull_3 = CullPattern(List=rep_3.Representation, CullPattern=equals.Equality)
rep_4 = ModelRepresentation(Representation=cull_3)  # -> Representation, Valid, Url, Mime, Lod, Tags
sep = Separator()  # -> S; same code as sep
rep_5 = ReplaceText(Text=rep_4.Url, Find="/", Replace=sep, RecursiveReplace=False)
rp_3 = Representation(rep_4.Representation)
pa_ur = Text(rep_5)
ur = Url(rep_4.Url)
rp_4 = ClusterOutput(rp_3)
ur_2 = ClusterOutput(ur)
pa_ur_2 = ClusterOutput(pa_ur)

# ==== cluster ShowDesign_3: Show a design by flattening it and selecting representations based on mime and tags. Select exactly one representation based on mime and tags. The tag matching is based on the highest Jaccard index (|∩|/|∪|). If the mime type is not given or does not exist, then all representations are used to search for closest match. If index is equally high the first representation is picked.
dn = ClusterInput()
ty = ClusterInput()
ob = ClusterInput()
mm = ClusterInput()
tags = ClusterInput()
ty_2 = Type(ty)
dn_2 = Design(dn)
ob_2 = Data(ob)
mm_2 = Mime(mm)
tags_2 = Tags(tags)
dsn = ModelDesign(Design=dn_2)  # -> Design, Valid, Name, Description, Icon, Image, Variant, View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
typ = ModelType(Type=ty_2)  # -> Type, Valid, Name, Description, Icon, Image, Variant, Unit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
trim = TrimTree(Tree=dsn.Pieces, Depth=1)
xy = XYPlane(Origin=Point(0, 0, 0))
pce = ModelPiece(Piece=trim, Plane=xy)  # -> Piece, Valid, Id, Description, TypeName, TypeVariant, Plane, Center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
rep = ModelRepresentation(Representation=typ.Representations)  # -> Representation, Valid, Url, Description, Tags, Qualities
tstat = TreeStatistics(Tree=typ.Representations)  # -> Paths, Length, Count
tstat_2 = TreeStatistics(Tree=graft(rep.Url))  # -> Paths, Length, Count
expression = Expression(x=graft(pce.TypeName), y=typ.Name, Expression="x=y")
expression_2 = Expression(x=graft(pce.TypeVariant), y=typ.Variant, Expression="x=y")
trim_2 = TrimTree(Tree=rep.Url, Depth=1)
and = GateAnd(A=expression, B=expression_2)
cull = CullPattern(List=ty_2, CullPattern=and)
lng = ListLength(List=ty_2)
series = Series(Start=0, Step=1, Count=lng)
txt = Text(cull)
txt_2 = Text(ty_2)
expression_3 = Expression(x=txt, y=txt_2, Expression="x=y")
trim_3 = TrimTree(Tree=series, Depth=1)
cull_2 = CullPattern(List=trim_3, CullPattern=expression_3)
trim_4 = TrimTree(Tree=cull_2, Depth=1)
item = ListItem(List=tstat.Paths, Index=trim_4, Wrap=True)
branch = TreeBranch(Tree=typ.Representations, Path=item, MaintainPaths=False)
mrg_p = MergeSeperatlyPrepend(x=branch)  # -> Mrgd; inputs x: tree; same code as mrg_p
rep_2 = SelectRepresentation_4(mm=mm_2)  # -> rp_5, i_2, ur_2, pa_ur_2
rep_3 = SelectRepresentation(rp=mrg_p, tags=tags_2)  # -> rp_4, i_2
trim_5 = TrimTree(Tree=rep_3.rp_4, Depth=1)
trim_6 = TrimTree(Tree=rep_2.ur_2, Depth=1)
itemindex = ItemIndex(L=trim_2, I=trim_6)  # -> i; inputs L: list; same code as itemindex
item_2 = ListItem(List=tstat_2.Paths, Index=itemindex, Wrap=True)
branch_2 = TreeBranch(Tree=ob_2, Path=item_2, MaintainPaths=False)
mrg_p_2 = MergeSeperatlyPrepend(x=branch_2)  # -> Mrgd; inputs x: tree; same code as mrg_p
trim_7 = TrimTree(Tree=rep_2.pa_ur_2, Depth=1)
pln = Plane(pce.Plane)
id = Id(pce.Id)
orient = Orient(Geometry=mrg_p_2, Source=PlaneXY(0, 0, 0), Target=graft(pln))  # -> Geometry, Transform
object = Data(orient.Geometry)
rp = Representation(trim_5)
object_2 = ClusterOutput(object)
rp_2 = ClusterOutput(rp)
pln_2 = ClusterOutput(pln)
id_2 = ClusterOutput(id)

# ==== cluster ShowDesign_4: Show a design by flattening it and selecting representations based on mime and tags. Select exactly one representation based on mime and tags. The tag matching is based on the highest Jaccard index (|∩|/|∪|). If the mime type is not given or does not exist, then all representations are used to search for closest match. If index is equally high the first representation is picked.
dn = ClusterInput()
ty = ClusterInput()
ob = ClusterInput()
mm = ClusterInput()
tags = ClusterInput()
ty_2 = Type(ty)
dn_2 = Design(dn)
ob_2 = Data(ob)
mm_2 = Mime(mm)
tags_2 = Tags(tags)
dsn = ModelDesign(Design=dn_2)  # -> Design, Valid, Name, Description, Icon, Image, Variant, View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
typ = ModelType(Type=ty_2)  # -> Type, Valid, Name, Description, Icon, Image, Variant, Unit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
xy = XYPlane(Origin=Point(0, 0, 0))
trim = TrimTree(Tree=dsn.Pieces, Depth=1)
pce = ModelPiece(Piece=trim, Plane=xy)  # -> Piece, Valid, Id, Description, TypeName, TypeVariant, DesignName, DesignVariant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
rep = ModelRepresentation(Representation=typ.Representations)  # -> Representation, Valid, Url, Description, Tags, Qualities
tstat = TreeStatistics(Tree=typ.Representations)  # -> Paths, Length, Count
expression = Expression(x=graft(pce.TypeName), y=typ.Name, Expression="x=y")
expression_2 = Expression(x=graft(pce.TypeVariant), y=typ.Variant, Expression="x=y")
tstat_2 = TreeStatistics(Tree=graft(rep.Url))  # -> Paths, Length, Count
trim_2 = TrimTree(Tree=rep.Url, Depth=1)
and = GateAnd(A=expression, B=expression_2)
cull = CullPattern(List=ty_2, CullPattern=and)
lng = ListLength(List=ty_2)
series = Series(Start=0, Step=1, Count=lng)
txt = Text(cull)
txt_2 = Text(ty_2)
expression_3 = Expression(x=txt, y=txt_2, Expression="x=y")
trim_3 = TrimTree(Tree=series, Depth=1)
cull_2 = CullPattern(List=trim_3, CullPattern=expression_3)
trim_4 = TrimTree(Tree=cull_2, Depth=1)
item = ListItem(List=tstat.Paths, Index=trim_4, Wrap=True)
branch = TreeBranch(Tree=typ.Representations, Path=item, MaintainPaths=False)
mrg_p = MergeSeperatlyPrepend(x=branch)  # -> Mrgd; inputs x: tree; same code as mrg_p
rep_2 = SelectRepresentation_4(mm=mm_2)  # -> rp_5, i_2, ur_2, pa_ur_2
rep_3 = SelectRepresentation(rp=mrg_p, tags=tags_2)  # -> rp_4, i_2
trim_5 = TrimTree(Tree=rep_3.rp_4, Depth=1)
trim_6 = TrimTree(Tree=rep_2.ur_2, Depth=1)
itemindex = ItemIndex(L=trim_2, I=trim_6)  # -> i; inputs L: list; same code as itemindex
item_2 = ListItem(List=tstat_2.Paths, Index=itemindex, Wrap=True)
branch_2 = TreeBranch(Tree=ob_2, Path=item_2, MaintainPaths=False)
mrg_p_2 = MergeSeperatlyPrepend(x=branch_2)  # -> Mrgd; inputs x: tree; same code as mrg_p
trim_7 = TrimTree(Tree=rep_2.pa_ur_2, Depth=1)
pln = Plane(pce.Plane)
id = Id(pce.Id)
orient = Orient(Geometry=mrg_p_2, Source=PlaneXY(0, 0, 0), Target=graft(pln))  # -> Geometry, Transform
object = Data(orient.Geometry)
rp = Representation(trim_5)
object_2 = ClusterOutput(object)
rp_2 = ClusterOutput(rp)
pln_2 = ClusterOutput(pln)
id_2 = ClusterOutput(id)

# ==== cluster SelectType: Select a type with a name and an optional variant. If no variant is provided it will select all variants. If you want to select the default type then use the empty text.
ty = ClusterInput()
na = ClusterInput()
variant = ClusterInput()
na_2 = Name(na)
variant_2 = Variant(variant)
ty_2 = Type(ty)
typ = ModelType(Type=ty_2)  # -> Type, Valid, Name, Description, Icon, Image, Variant, Stock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
expression = Expression(x=typ.Name, y=na_2, Expression="x=y")
cull = CullPattern(List=typ.Type, CullPattern=expression)
typ_2 = ModelType(Type=cull)  # -> Type, Valid, Name, Description, Icon, Image, Variant, Stock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
expression_2 = Expression(x=typ_2.Variant, y=variant_2, Expression="x=y")
txt = Text(ty_2)
cull_2 = CullPattern(List=typ_2.Type, CullPattern=expression_2)
null = NullItem(Item=variant_2)  # -> NullFlags, InvalidFlags, Description
filter = StreamFilter(Gate=null.NullFlags, Stream0=cull_2, Stream1=cull)
txt_2 = Text(filter)
mindex = MemberIndex(Set=txt, Member=txt_2)  # -> Index, Count
trim = TrimTree(Tree=mindex.Index, Depth=1)
ty_3 = Type(filter)
i = Integer(trim)
ty_4 = ClusterOutput(ty_3)
i_2 = ClusterOutput(i)

# ==== cluster SelectPort: Select a port with the id. If no port matches, null is returned.
po = ClusterInput()
id = ClusterInput()
id_2 = Id(graft(id))
po_2 = Port(po)
lng = ListLength(List=po_2)
por = ModelPort(Port=po_2)  # -> Port, Valid, Id, Description, Mandatory, Family, CompatibleFamilies, Point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
series = Series(Start=0, Step=1, Count=lng)
expression = Expression(x=por.Id, y=id_2, Expression="x=y")
trim = TrimTree(Tree=series, Depth=1)
cull = CullPattern(List=po_2, CullPattern=expression)
cull_2 = CullPattern(List=trim, CullPattern=expression)
nulltobranch = AddNullToEmptyBranch(D=cull_2)  # -> R; inputs D: tree; same code as nulltobranch
nulltobranch_2 = AddNullToEmptyBranch(D=cull)  # -> R; inputs D: tree; same code as nulltobranch
trim_2 = TrimTree(Tree=nulltobranch, Depth=1)
trim_3 = TrimTree(Tree=nulltobranch_2, Depth=1)
i = Integer(trim_2)
po_3 = Port(trim_3)
i_2 = ClusterOutput(i)
po_4 = ClusterOutput(po_3)

# ==== cluster PreviewPort: Preview a port by showing the point and direction and if exists: id, family and compatible families.
po = ClusterInput()
sc = ClusterInput()
sc_2 = Number(sc)
po_2 = Port(po)
por = ModelPort(Port=po_2)  # -> Port, Valid, Id, Description, Mandatory, Family, CompatibleFamilies, Point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
swatch = ColourSwatch(SwatchColor=RGB(235, 52, 79))
swatch_2 = ColourSwatch(SwatchColor=RGB(250, 149, 0))
amp = Amplitude(Vector=por.Direction, Amplitude=sc_2)
lng = ListLength(List=por.CompatibleFamilies)
expression = Expression(x=por.Family, Expression="x=\"\"")
cull = CullPattern(List=por.Point, CullPattern=expression)
expression_2 = Expression(x=lng, Expression="x=0")
join = TextJoin(Text=por.CompatibleFamilies, Join=",")
merge = Merge(Data1=":")
trim = TrimTree(Tree=join, Depth=1)
trim_2 = TrimTree(Tree=expression_2, Depth=1)
item = ListItem(List=merge, Index=expression, Wrap=invert(True))
log = Logarithm(Value=sc_2)
concat = Concatenate(FragmentA="[", FragmentB=trim, FragmentC="]")
expression_3 = Expression(y=trim_2, Expression="x")
merge_2 = Merge(Data1=graft(concat), Data2=graft(expression_3))
item_2 = ListItem(List=merge_2, Index=graft(expression), Wrap=invert(True))
multiplication = Multiplication(A=log, B=Slider(2, range=0..10))
trim_3 = TrimTree(Tree=item_2, Depth=1)
concat_2 = Concatenate(FragmentA=por.Id, FragmentB=item, FragmentC=por.Family, FragmentD=trim_3)
preview = CustomPreview(Geometry=cull, Material=swatch)
tag = TextTag(Location=por.Point, Text=concat_2, Colour=swatch)
vdisex = VectorDisplayEx(Point=por.Point, Vector=amp, Colour=ColourSwatch(SwatchColor=RGB(0, 166, 157)), Width=multiplication)

# ==== cluster SelectRoot: Select a root piece. A piece is a root when it has a plane (and a center).
pc = ClusterInput()
pc_2 = Piece(pc)
lng = ListLength(List=pc_2)
pce = ModelPiece(Piece=pc_2)  # -> Piece, Valid, Id, Description, TypeName, TypeVariant, DesignName, DesignVariant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
series = Series(Start=0, Step=1, Count=lng)
null = NullItem(Item=pce.Plane)  # -> NullFlags, InvalidFlags, Description
trim = TrimTree(Tree=series, Depth=1)
dispatch = Dispatch(List=pc_2, DispatchPattern=null.NullFlags)  # -> ListA, ListB
dispatch_2 = Dispatch(List=trim, DispatchPattern=null.NullFlags)  # -> ListA, ListB
ro = Piece(dispatch.ListB)
i = Integer(dispatch_2.ListB)
ro_2 = ClusterOutput(ro)
i_2 = ClusterOutput(i)

# ==== cluster SelectConnection_2: Select a connection with the connected id and the connecting id. The connections are symetric, so if the conected is the connecting and vice versa it will still selct them.
co = ClusterInput()
cdpc = ClusterInput()
cgpc = ClusterInput()
cdpc_2 = ConnectedPieceId(graft(cdpc))
cgpc_2 = ConnectingPieceId(graft(cgpc))
co_2 = Connection(co)
con = ModelConnection(Connection=co_2)  # -> Connection, Valid, ConnectedPieceId, ConnectedDesignPieceId, ConnectedPieceTypePortId, ConnectingPieceId, ConnectingDesignPieceId, ConnectingPieceTypePortId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
expression = Expression(x=con.ConnectedPieceId, y=cgpc_2, Expression="x=y")
expression_2 = Expression(x=con.ConnectingPieceId, y=cgpc_2, Expression="x=y")
expression_3 = Expression(x=con.ConnectingPieceId, y=cdpc_2, Expression="x=y")
expression_4 = Expression(x=con.ConnectedPieceId, y=cdpc_2, Expression="x=y")
lng = ListLength(List=co_2)
series = Series(Start=0, Step=1, Count=lng)
and = GateAnd(A=expression_4, B=expression_2)
and_2 = GateAnd(A=expression, B=expression_3)
not = GateNot(A=and)
trim = TrimTree(Tree=series, Depth=1)
or = GateOr(A=and, B=and_2)
cull = CullPattern(List=con.Connection, CullPattern=or)
cull_2 = CullPattern(List=trim, CullPattern=or)
and_3 = GateAnd(A=not, B=and_2)
nulltobranch = AddNullToEmptyBranch(D=cull)  # -> R; inputs D: tree; same code as nulltobranch
nulltobranch_2 = AddNullToEmptyBranch(D=cull_2)  # -> R; inputs D: tree; same code as nulltobranch
ma = MassAddition(Input=and_3)  # -> Result, PartialResults
trim_2 = TrimTree(Tree=nulltobranch, Depth=1)
trim_3 = TrimTree(Tree=ma.Result, Depth=1)
trim_4 = TrimTree(Tree=nulltobranch_2, Depth=1)
co_3 = Connection(trim_2)
fl = Flipped(trim_3)
i = Index(trim_4)
co_4 = ClusterOutput(co_3)
i_2 = ClusterOutput(i)
fl_2 = ClusterOutput(fl)

# ==== cluster SelectPiece_2: Select a piece with the id.
pc = ClusterInput()
id = ClusterInput()
id_2 = Id(graft(id))
pc_2 = Piece(pc)
lng = ListLength(List=pc_2)
pce = ModelPiece(Piece=pc_2)  # -> Piece, Valid, Id, Description, TypeName, TypeVariant, DesignName, DesignVariant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
series = Series(Start=0, Step=1, Count=lng)
trim = TrimTree(Tree=series, Depth=1)
expression = Expression(x=pce.Id, y=id_2, Expression="x=y")
cull = CullPattern(List=pce.Piece, CullPattern=expression)
cull_2 = CullPattern(List=trim, CullPattern=expression)
trim_2 = TrimTree(Tree=cull_2, Depth=1)
trim_3 = TrimTree(Tree=cull, Depth=1)
pc_3 = Piece(trim_3)
i = Index(trim_2)
pc_4 = ClusterOutput(pc_3)
i_2 = ClusterOutput(i)

# ==== cluster SelectRepresentation_2: Select a representation based on mime, lod and tags. The mime and lod must be equal and the tags must contain all the given tags.
rp = ClusterInput()
mm = ClusterInput()
lod = ClusterInput()
tags = ClusterInput()
rp_2 = Representation(rp)
mm_2 = Mime(mm)
lod_2 = Lod(lod)
tags_2 = Tags(tags)
rep = ModelRepresentation(Representation=rp_2)  # -> Representation, Valid, Url, Mime, Lod, Tags
expression = Expression(x=rep.Mime, y=mm_2, Expression="x=y")
cull = CullPattern(List=rep.Representation, CullPattern=expression)
rep_2 = ModelRepresentation(Representation=cull)  # -> Representation, Valid, Url, Mime, Lod, Tags
expression_2 = Expression(x=rep_2.Lod, y=lod_2, Expression="x=y")
cull_2 = CullPattern(List=rep_2.Representation, CullPattern=expression_2)
rep_3 = ModelRepresentation(Representation=cull_2)  # -> Representation, Valid, Url, Mime, Lod, Tags
trim = TrimTree(Tree=rep_3.Tags, Depth=1)
contains = Contains(L=trim, I=tags_2)  # -> R; inputs L: list, I: list
# ---------- contains: Python ----------
#Component Information
#--------------------------------------------------------------------------------------------
if ghenv.Component.RunCount<2:
    #General
    #--------------------------------------------------------------------------------------------
    __author__ = "Ueli Saluz"
    __version__ = "2023.02.04"
    
    ghenv.Component.Name = "Contains"
    ghenv.Component.NickName = "Contains"
    ghenv.Component.Description = "True if list contains one of the items."
    ghenv.Component.Message = "VER 1.0"
    ghenv.Component.Category = "Set"
    ghenv.Component.SubCategory = "List"
    
     #Inputs
    #--------------------------------------------------------------------------------------------
    inputIndex=0
    
    ghenv.Component.Params.Input[inputIndex].Name = "List"
    ghenv.Component.Params.Input[inputIndex].NickName = "L"
    ghenv.Component.Params.Input[inputIndex].Description = ""
    ghenv.Component.Params.Input[inputIndex].Optional = False
    inputIndex+=1
    
    ghenv.Component.Params.Input[inputIndex].Name = "Items"
    ghenv.Component.Params.Input[inputIndex].NickName = "I"
    ghenv.Component.Params.Input[inputIndex].Description = ""
    ghenv.Component.Params.Input[inputIndex].Optional = False
    inputIndex+=1
    
    #Outputs
    #--------------------------------------------------------------------------------------------
    outputIndex=0
    
    ghenv.Component.Params.Output[outputIndex].Name = "Contains"
    ghenv.Component.Params.Output[outputIndex].NickName = "R"
    ghenv.Component.Params.Output[outputIndex].Description = ""
    outputIndex+=1

R = False
for i in I:
    if i in L:
        R = True
# ---------- end contains ----------
ma = MassAddition(Input=contains)  # -> Result, PartialResults
lng = ListLength(List=contains)
equals = Equality(FirstNumber=ma.Result, SecondNumber=lng)  # -> Equality, Inequality
cull_3 = CullPattern(List=rep_3.Representation, CullPattern=equals.Equality)
rep_4 = ModelRepresentation(Representation=cull_3)  # -> Representation, Valid, Url, Mime, Lod, Tags
curdir = CSharpScript()  # -> D, S
# ---------- curdir: C# ----------
#region Usings
using System;
using System.Linq;
using System.Collections;
using System.Collections.Generic;
using System.Drawing;
using System.IO;

using Rhino;
using Rhino.Geometry;

using Grasshopper;
using Grasshopper.Kernel;
using Grasshopper.Kernel.Data;
using Grasshopper.Kernel.Types;
#endregion

public class Script_Instance : GH_ScriptInstance
{
    private void RunScript(ref object D, ref object S)
    {
        D = Path.GetDirectoryName(this.GrasshopperDocument.FilePath);
        S = Path.DirectorySeparatorChar;
    }
}
# ---------- end curdir ----------
rep_5 = ReplaceText(Text=rep_4.Url, Find="/", Replace=curdir.S, RecursiveReplace=False)
rp_3 = Representation(rep_4.Representation)
pa_ur = Text(rep_5)
ur = Url(rep_4.Url)
rp_4 = ClusterOutput(rp_3)
ur_2 = ClusterOutput(ur)
pa_ur_2 = ClusterOutput(pa_ur)

# ==== cluster SelectRepresentation_4: Select exactly one representation based on mime and tags. The tag matching is based on the highest Jaccard index (|∩|/|∪|). If the mime type is not given or does not exist, then all representations are used to search for closest match. If index is equally high the first representation is picked.
mm = ClusterInput()
tags = ClusterInput()
rp = ClusterInput()
rp_2 = Representation(rp)
mm_2 = Mime(mm)
tags_2 = Tags(tags)
l2o = List2Object(L=rp_2)  # -> O; inputs L: tree
# ---------- l2o: Python ----------
#Component Information
#--------------------------------------------------------------------------------------------
if ghenv.Component.RunCount<2:
    #General
    #--------------------------------------------------------------------------------------------
    __author__ = "Ueli Saluz"
    __version__ = "2022.04.24"
    
    ghenv.Component.Name = "List2Object"
    ghenv.Component.NickName = "L2O"
    ghenv.Component.Description = "Wraps a list of objects into a list object."
    ghenv.Component.Message = "VER 1.0"
    ghenv.Component.Category = "Sets"
    ghenv.Component.SubCategory = "Tree"
    
     #Inputs
    #--------------------------------------------------------------------------------------------
    inputIndex=0
    
    ghenv.Component.Params.Input[inputIndex].Name = "List"
    ghenv.Component.Params.Input[inputIndex].NickName = "L"
    ghenv.Component.Params.Input[inputIndex].Description = "Tree with lists to wrap."
    ghenv.Component.Params.Input[inputIndex].Optional = False
    inputIndex+=1
    

    #Outputs
    #--------------------------------------------------------------------------------------------
    outputIndex=0
    
    ghenv.Component.Params.Output[outputIndex].Name =  "ListObject" 
    ghenv.Component.Params.Output[outputIndex].NickName = "O"
    ghenv.Component.Params.Output[outputIndex].Description = "Python list object as single item."
    outputIndex+=1


#Imports
#--------------------------------------------------------------------------------------------
from System import Object
from Grasshopper import DataTree

#Solver - Run with trees to enhance performance drastically
#--------------------------------------------------------------------------------------------
if __name__ == "__main__":
    
    #Initialize trees
    #--------------------------------------------------------------------------------------------
    TreeToWrap = DataTree[Object]()
    
    #Data matching
    #--------------------------------------------------------------------------------------------
    for path in L.Paths:
        listBranch = L.Branch(path)
        TreeToWrap.Add(listBranch,path)
    
     #Assign trees to output
    #--------------------------------------------------------------------------------------------
    O = TreeToWrap
# ---------- end l2o ----------

rep = ModelRepresentation(Representation=graft(rp_2))  # -> Representation, Valid, Url, Description, Mime, Tags
lng = ListLength(List=mm_2)
expression = Expression(x=rep.Mime, y=mm_2, Expression="x=y")
null = NullItem(Item=lng)  # -> NullFlags, InvalidFlags, Description
expression_2 = Expression(x=lng, Expression="x=0")
ma = MassAddition(Input=expression)  # -> Result, PartialResults
or = GateOr(A=expression_2, B=null.NullFlags)
cull = CullPattern(List=rep.Representation, CullPattern=ma.Result)
trim = TrimTree(Tree=cull, Depth=1)
mime_match = Representation(trim)
nulltobranch = CSharpScript(D=mime_match)  # -> R; inputs D: tree; same code as nulltobranch
nullrep = ReplaceNulls(Items=nulltobranch, Replacements=l2o)  # -> graft(Items), Count

o2l = Object2List(O=nullrep.Items)  # -> L; inputs O: tree
# ---------- o2l: Python ----------
# Component Information
# --------------------------------------------------------------------------------------------
if ghenv.Component.RunCount < 2:
    # General
    # --------------------------------------------------------------------------------------------
    __author__ = "Ueli Saluz"
    __version__ = "2025.02.19"

    ghenv.Component.Name = "Object2List"
    ghenv.Component.NickName = "O2L"
    ghenv.Component.Description = "Unwraps a list of objects into a list object and returns the object if it is not iterable."
    ghenv.Component.Message = "VER 1.1"
    ghenv.Component.Category = "Sets"
    ghenv.Component.SubCategory = "Tree"

    # Inputs
    # --------------------------------------------------------------------------------------------
    inputIndex = 0

    ghenv.Component.Params.Input[inputIndex].Name = "ListObject"
    ghenv.Component.Params.Input[inputIndex].NickName = "O"
    ghenv.Component.Params.Input[inputIndex].Description = "A python list object that will be unwrapped into a Grasshopper list or returned as is if not iterable."
    ghenv.Component.Params.Input[inputIndex].Optional = False
    inputIndex += 1

    # Outputs
    # --------------------------------------------------------------------------------------------
    outputIndex = 0

    ghenv.Component.Params.Output[outputIndex].Name = "List"
    ghenv.Component.Params.Output[outputIndex].NickName = "L"
    ghenv.Component.Params.Output[outputIndex].Description = "The unwrapped list."
    outputIndex += 1

# Imports
# --------------------------------------------------------------------------------------------
from System import Object
from Grasshopper import DataTree
from collections import Iterable

# Solver - Run with trees to enhance performance drastically
# --------------------------------------------------------------------------------------------
if __name__ == "__main__":

    # Initialize trees
    # --------------------------------------------------------------------------------------------
    OriginalTree = DataTree[Object]()

    # Data matching
    # --------------------------------------------------------------------------------------------
    for path in O.Paths:
        listBranch = O.Branch(path)
        for i, listItem in enumerate(listBranch):
            if isinstance(listItem, Iterable) and not isinstance(listItem, str):
                OriginalTree.AddRange(list(listItem), path.AppendElement(i))
            else:
                OriginalTree.Add(listItem, path.AppendElement(i))

    # Assign trees to output
    # --------------------------------------------------------------------------------------------
    L = OriginalTree
# ---------- end o2l ----------
trim_2 = TrimTree(Tree=o2l, Depth=1)
trim_3 = TrimTree(Tree=trim_2, Depth=1)

filter = StreamFilter(Gate=or, Stream0=trim_3, Stream1=rp_2)
rp_3 = Representation(filter)

rep_2 = ModelRepresentation(Representation=rp_3)  # -> Representation, Valid, Url, Description, Mime, Tags
jac = JaccardIndex_2(set1=tags_2, set2=rep_2.Tags)
trim_4 = TrimTree(Tree=jac, Depth=1)
minmax = MinimumMaximum(L=trim_4)  # -> Max, MaxI, Min, MinI; inputs L: list; same code as minmax
item = ListItem(List=rep_2.Representation, Index=minmax.MaxI, Wrap=True)
rep_3 = ModelRepresentation(Representation=item)  # -> Representation, Valid, Url, Description, Mime, Tags
sep = Separator()  # -> S; same code as sep
txt = Text(rp_2)
txt_2 = Text(item)
rep_4 = ReplaceText(Text=rep_3.Url, Find="/", Replace=sep, RecursiveReplace=False)
itemindex = ItemIndex(L=txt, I=txt_2)  # -> i; inputs L: list; same code as itemindex
rp_4 = Representation(item)
ur = Url(rep_3.Url)
pa_ur = Text(rep_4)

i = Integer(itemindex)
i_2 = ClusterOutput(i)
ur_2 = ClusterOutput(ur)
pa_ur_2 = ClusterOutput(pa_ur)
rp_5 = ClusterOutput(rp_4)
