# Grasshopper definition representation-param.gh (Grasshopper 1.0.8)
# Copyright: GNU Lesser General Public License Version 3

te = Test({Plane=PlaneXY(3.036011203, -20.6915238, 0), X=Domain(0, 6.357325295), Y=Domain(0, 31.46004444), Z=Domain(0, 11.57219747)})
prm = ModelParam(Pr=te, Na="test", NN="Te", Dc="Description  a", Op=Toggle(False), Ru=Toggle(False))  # -> Param, Name, NickName, Description, Optional, Success; inputs Pr: tree, Op: Boolean, Ru: Boolean
# ---------- prm: Python ----------
#Component Information
#--------------------------------------------------------------------------------------------
if ghenv.Component.RunCount<2:
    #General
    #--------------------------------------------------------------------------------------------
    __author__ = "Ueli Saluz"
    __version__ = "2025.06.18"
    
    ghenv.Component.Name = "Model Param"
    ghenv.Component.NickName = "~Prm"
    ghenv.Component.Description = "Deconstruct or modify a param."
    ghenv.Component.Message = "VER 1.0"
    ghenv.Component.Category = "semio"
    ghenv.Component.SubCategory = "Scripting"
    
     #Inputs
    #--------------------------------------------------------------------------------------------
    inputIndex=0
    
    ghenv.Component.Params.Input[inputIndex].Name = "Param"
    ghenv.Component.Params.Input[inputIndex].NickName = "Pr"
    ghenv.Component.Params.Input[inputIndex].Description = "Connect the param to desconstruct or modify here with one wire."
    ghenv.Component.Params.Input[inputIndex].Optional = False
    inputIndex+=1

    ghenv.Component.Params.Input[inputIndex].Name = "Name"
    ghenv.Component.Params.Input[inputIndex].NickName = "Na"
    ghenv.Component.Params.Input[inputIndex].Description = "Name of the param."
    ghenv.Component.Params.Input[inputIndex].Optional = False
    inputIndex+=1
    
    ghenv.Component.Params.Input[inputIndex].Name = "NickName"
    ghenv.Component.Params.Input[inputIndex].NickName = "NN"
    ghenv.Component.Params.Input[inputIndex].Description = "Nickname of the param."
    ghenv.Component.Params.Input[inputIndex].Optional = False
    inputIndex+=1
    
    ghenv.Component.Params.Input[inputIndex].Name = "Description"
    ghenv.Component.Params.Input[inputIndex].NickName = "Dc"
    ghenv.Component.Params.Input[inputIndex].Description = "Description of the param."
    ghenv.Component.Params.Input[inputIndex].Optional = True
    inputIndex+=1
    
    ghenv.Component.Params.Input[inputIndex].Name = "Optional"
    ghenv.Component.Params.Input[inputIndex].NickName = "Op"
    ghenv.Component.Params.Input[inputIndex].Description = "Wheather the param is optional."
    ghenv.Component.Params.Input[inputIndex].Optional = True
    inputIndex+=1
    
    ghenv.Component.Params.Input[inputIndex].Name = "Run"
    ghenv.Component.Params.Input[inputIndex].NickName = "Ru"
    ghenv.Component.Params.Input[inputIndex].Description = "Modify the param."
    ghenv.Component.Params.Input[inputIndex].Optional = True
    inputIndex+=1
    
    #Outputs
    #--------------------------------------------------------------------------------------------
    outputIndex=0
    
    ghenv.Component.Params.Output[outputIndex].Name = "Param"
    ghenv.Component.Params.Output[outputIndex].NickName = "Param"
    ghenv.Component.Params.Output[outputIndex].Description = "The desconstruct or modified param"
    ghenv.Component.Params.Output[outputIndex].Optional = False
    outputIndex+=1
    
    ghenv.Component.Params.Output[outputIndex].Name = "Name"
    ghenv.Component.Params.Output[outputIndex].NickName = "Name"
    ghenv.Component.Params.Output[outputIndex].Description = "Name of the param."
    ghenv.Component.Params.Output[outputIndex].Optional = False
    outputIndex+=1
    
    ghenv.Component.Params.Output[outputIndex].Name = "NickName"
    ghenv.Component.Params.Output[outputIndex].NickName = "NickName"
    ghenv.Component.Params.Output[outputIndex].Description = "Nickname of the param."
    ghenv.Component.Params.Output[outputIndex].Optional = False
    outputIndex+=1
    
    ghenv.Component.Params.Output[outputIndex].Name = "Description"
    ghenv.Component.Params.Output[outputIndex].NickName = "Description"
    ghenv.Component.Params.Output[outputIndex].Description = "Description of the param."
    ghenv.Component.Params.Output[outputIndex].Optional = True
    outputIndex+=1
    
    ghenv.Component.Params.Output[outputIndex].Name = "Optional"
    ghenv.Component.Params.Output[outputIndex].NickName = "Optional"
    ghenv.Component.Params.Output[outputIndex].Description = "Wheather the param is optional."
    ghenv.Component.Params.Output[outputIndex].Optional = True
    outputIndex+=1
    
    ghenv.Component.Params.Output[outputIndex].Name = "Success"
    ghenv.Component.Params.Output[outputIndex].NickName = "Success"
    ghenv.Component.Params.Output[outputIndex].Description = "Wheather the operation was successful."
    ghenv.Component.Params.Output[outputIndex].Optional = False
    outputIndex+=1

input = ghenv.Component.Params.Input[0]
param = input.Sources[0]
if Ru:
    if Na:
        param.Name = Na
    if NN:
        param.NickName = NN
    if Dc:
        param.Description = Dc
    if Op:
        param.Optional = Op
    Success = True
else:
    Success = False
Param = param
Name = param.Name
NickName = param.NickName
Description = param.Description
Optional = param.Optional
# ---------- end prm ----------
