# Grasshopper definition kit.gh (Grasshopper 1.0.8)
# Copyright: GNU Lesser General Public License Version 3
# plug-ins: RhinoCodePluginGH, semio

panel = Panel("White")
panel_2 = Panel("""Black
Dark Red
Olive Drab
Dark Green
Deep Teal
Deep Blue
Dark Magenta
Dark Red
Mustard Yellow
Forest Green
Teal
Royal Blue
Deep Pink
Muted Coral
Golden Yellow
Mint Green
Soft Cyan
Periwinkle
Hot Pink
White""")
mesh = Mesh(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)
geo = Geometry([Line((-6.929598784, -74.55266759, 51.84156011), (-6.929598784, -74.55266759, 46.84156011)), Line((0.1414690278, -74.55266759, 54.7704923), (3.677002934, -74.55266759, 51.23495839)), Line((-3.207161262, -68.54072457, 54.7704923), (-1.345942501, -65.53475306, 51.23495839)), Line((-10.65203631, -68.54072457, 54.7704923), (-12.51325507, -65.53475306, 51.23495839)), Line((-14.0006666, -74.55266759, 54.7704923), (-17.5362005, -74.55266759, 51.23495839)), Line((-10.65203631, -80.56461062, 54.7704923), (-12.51325507, -83.57058213, 51.23495839))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])
item = ListItem(Index=0, Wrap=True)  # -> Item, Item1, Item2, Item3, Item4, Item5, Item6, Item7
end = EndPoints(Curve=geo)  # -> Start, End
vec2pt = Vector2Pt(PointA=end.Start, PointB=end.End, Unitize=False)  # -> unitize(Vector), Length

number_slider = Slider(5, range=2..10)
amp = Amplitude(Vector=vec2pt.Vector, Amplitude=number_slider)
pt = Point(end.Start)
vdis = VectorDisplay(Anchor=pt, Vector=amp)

addition = Addition(A=Slider(4, range=0..4), B=number_slider)
amp_2 = Amplitude(Vector=vec2pt.Vector, Amplitude=addition)
move = Move(Geometry=end.Start, Motion=amp_2)  # -> Geometry, Transform
tag = TextTag(Location=move.Geometry, Text=panel_2, Colour=ColourSwatch(SwatchColor=RGB(255, 255, 255)))

geo_2 = Geometry([item.Item5, item.Item4, item.Item6, item.Item7])
geo_3 = Geometry(geo_2)
curvepoint = PointOnCurve(geo_3, parameter=0.509)
points = PointList(Points=curvepoint, Size=Slider(3, range=0..10))

# ---- group: Modeling Ports / Port Vectors
vec = Vector(unitize(vec2pt.Vector))

# ---- group: Modeling Ports / Port ID's
data = Data(panel_2)

# ---- group: Modeling Ports / Port Points
pt_2 = Point(pt)

# ---- group: Modeling Ports
por = ModelPort(Id=data, Point=pt_2, Direction=vec)  # -> Port, Valid, Id, Description, Family, CompatibleFamilies, Point, Direction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

# ----
geo_4 = ExportGeometry()  # -> S; inputs G: tree of GeometryBase, R: Boolean
# ---------- geo_4: C# ----------
// Grasshopper Script Instance
#region Usings
using System;
using System.Linq;
using System.Collections;
using System.Collections.Generic;
using System.Drawing;
using System.IO;

using Rhino;
using Rhino.Geometry;

using Grasshopper;
using Grasshopper.Kernel;
using Grasshopper.Kernel.Data;
using Grasshopper.Kernel.Types;
#endregion

public class Script_Instance : GH_ScriptInstance
{
    #region Notes
    /* 
      Members:
        RhinoDoc RhinoDocument
        GH_Document GrasshopperDocument
        IGH_Component Component
        int Iteration

      Methods (Virtual & overridable):
        Print(string text)
        Print(string format, params object[] args)
        Reflect(object obj)
        Reflect(object obj, string method_name)
    */
    #endregion

    private void RunScript(object F, DataTree<GeometryBase> G, bool R, ref object S)
    {
        // inspired from https://github.com/jhorikawa/GrasshopperProgrammingTutorials/blob/master/0015%20Export%20Geometry%20with%20Grasshopper%20C%23/Export%20Geometry%20with%20Grasshopper%20C%23.gh
        if(R){
            var guids = new List<Guid>();

            for(int i = 0; i < G.BranchCount; i++){
                for(int n = 0; n < G.Branches[i].Count; n++){
                var geom = G.Branches[i][n];
                var guid = Rhino.RhinoDoc.ActiveDoc.Objects.Add(geom);
                guids.Add(guid);
                }
            }

            Rhino.RhinoDoc.ActiveDoc.Objects.Select(guids);

            string cmd = "_-Export " + "\"" + F + "\"" + " _Enter _Enter";

            Rhino.RhinoApp.RunScript(cmd, false);

            Rhino.RhinoDoc.ActiveDoc.Objects.Delete(guids, true);
            S = true;
        }
    }
}
# ---------- end geo_4 ----------
# 2025 Kinan Sarakbi
# Permission is hereby granted, free of charge, to any person obtaining a copy
# of this Grasshopper file and associated documentation files (the "Document"),
# to deal in the Document without restriction, including without limitation the
# rights to use, copy, modify, merge, publish, distribute, sublicense, and/or sell
# copies of the Document, and to permit persons to whom the Document is
# furnished to do so.
# 
# Individual clusters used inside this document might be licensed under
# different terms. This is indicated through a similar copyright notice group
# inside the cluster and otherwise in the license field of the cluster. If you
# have any question please reach out to us: license@semio-tech.com
# 
# THE DOCUMENT IS PROVIDED "AS IS", WITHOUT WARRANTY OF ANY
# KIND, EXPRESS OR IMPLIED, INCLUDING BUT NOT LIMITED TO THE
# WARRANTIES OF MERCHANTABILITY, FITNESS FOR A PARTICULAR
# PURPOSE AND NONINFRINGEMENT. IN NO EVENT SHALL THE
# AUTHORS OR COPYRIGHT HOLDERS BE LIABLE FOR ANY CLAIM,
# DAMAGES OR OTHER LIABILITY, WHETHER IN AN ACTION OF
# CONTRACT, TORT OR OTHERWISE, ARISING FROM, OUT OF OR IN
# CONNECTION WITH THE DOCUMENT OR THE USE OR OTHER
# DEALINGS IN THE DOCUMENT.
panel_3 = Panel(por.Port)
rep = ModelRepresentation()  # -> Representation, Valid, Url, Description, Mime, Tags

# ---- group: Modeling Type
typ = ModelType(Name="Sphere", Variant=graft("BIG"), Representations=rep.Representation, Ports=por.Port)  # -> flatten(Type), Valid, Name, Description, Icon, Image, Variant, Unit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

# ----
panel_4 = Panel(typ.Type)

# ---- group: Modeling Pieces
xy = XYPlane(Origin=Point(0, 0, 0))
pce = ModelPiece(Id="The Giver", TypeName=typ.Name, TypeVariant=typ.Variant)  # -> Piece, Valid, Id, TypeName, TypeVariant, Plane, Center, Qualities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
pce_2 = ModelPiece(Id="The Taker", TypeName=typ.Name, TypeVariant=typ.Variant, Plane=xy)  # -> Piece, Valid, Id, TypeName, TypeVariant, Plane, Center, Qualities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
merge = Merge(Data1=pce.Piece, Data2=pce_2.Piece)

# ----
panel_5 = Panel(pce.Piece)
concat = Concatenate(FragmentA="N", FragmentB="E")
concat_2 = Concatenate(FragmentA="N", FragmentB="W")
concat_3 = Concatenate(FragmentA="S", FragmentB="E")
concat_4 = Concatenate(FragmentA="S", FragmentB="W")
concat_5 = Concatenate(FragmentA="N", FragmentB="W")
concat_6 = Concatenate(FragmentA="S", FragmentB="E")
concat_7 = Concatenate(FragmentA="N", FragmentB="E")
concat_8 = Concatenate(FragmentA="S", FragmentB="W")
concat_9 = Concatenate(
    FragmentA="Red",
    FragmentB=", ",
    FragmentC="Stroke",
    FragmentD=", ",
    FragmentE=concat,
    FragmentF=", ",
    FragmentG="Bottom")
concat_10 = Concatenate(
    FragmentA="Green",
    FragmentB=", ",
    FragmentC="Stroke",
    FragmentD=", ",
    FragmentE=concat_4,
    FragmentF=", ",
    FragmentG="Bottom")
concat_11 = Concatenate(
    FragmentA="Green",
    FragmentB=", ",
    FragmentC="Stroke",
    FragmentD=", ",
    FragmentE=concat_5,
    FragmentF=", ",
    FragmentG="Bottom")
concat_12 = Concatenate(
    FragmentA="Red",
    FragmentB=", ",
    FragmentC="Stroke",
    FragmentD=", ",
    FragmentE=concat_6,
    FragmentF=", ",
    FragmentG="Bottom")
concat_13 = Concatenate(FragmentA="Red", FragmentB=", ", FragmentC="Stroke", FragmentD=", ", FragmentE=concat_3, FragmentF=", ", FragmentG="Top")
concat_14 = Concatenate(
    FragmentA="Green",
    FragmentB=", ",
    FragmentC="Stroke",
    FragmentD=", ",
    FragmentE=concat_8,
    FragmentF=", ",
    FragmentG="Top")
concat_15 = Concatenate(
    FragmentA="Green",
    FragmentB=", ",
    FragmentC="Stroke",
    FragmentD=", ",
    FragmentE=concat_7,
    FragmentF=", ",
    FragmentG="Top")
concat_16 = Concatenate(FragmentA="Red", FragmentB=", ", FragmentC="Stroke", FragmentD=", ", FragmentE=concat_2, FragmentF=", ", FragmentG="Top")
panel_6 = Panel(concat_12)
panel_7 = Panel(concat_10)
panel_8 = Panel(concat_11)
panel_9 = Panel(concat_9)
panel_10 = Panel(concat_13)
panel_11 = Panel(concat_14)
panel_12 = Panel(concat_15)
panel_13 = Panel(concat_16)
concat_17 = Concatenate(FragmentA="Green", FragmentB=", ", FragmentC="Filled", FragmentD=", ", FragmentE="W", FragmentF=", ", FragmentG="Center")
concat_18 = Concatenate(FragmentA="Green", FragmentB=", ", FragmentC="Filled", FragmentD=", ", FragmentE="W", FragmentF=", ", FragmentG="Center")
concat_19 = Concatenate(FragmentA="Blue", FragmentB=", ", FragmentC="Filled", FragmentD=", ", FragmentE="N", FragmentF=", ", FragmentG="Center")
concat_20 = Concatenate(FragmentA="Blue", FragmentB=", ", FragmentC="Filled", FragmentD=", ", FragmentE="S", FragmentF=", ", FragmentG="Center")
concat_21 = Concatenate(FragmentA="Green", FragmentB=", ", FragmentC="Filled", FragmentD=", ", FragmentE="W", FragmentF=", ", FragmentG="Bottom")
concat_22 = Concatenate(FragmentA="Green", FragmentB=", ", FragmentC="Filled", FragmentD=", ", FragmentE="W", FragmentF=", ", FragmentG="Bottom")
panel_14 = Panel(concat_20)
panel_15 = Panel(concat_18)
panel_16 = Panel(concat_19)
panel_17 = Panel(concat_17)
panel_18 = Panel(concat_21)
panel_19 = Panel(concat_22)

data_2 = Data(data)

item_2 = ListItem(List=data_2, Index=Slider(2, range=0..10), Wrap=True)

con = ModelConnection(
    ConnectedPieceId=pce.Id,
    ConnectedPieceTypePortId=item_2,
    ConnectingPieceId=pce_2.Id,
    ConnectingPieceTypePortId=item_2,
    Gap=Slider(0, range=0..10),
    Shift=Slider(0, range=0..40),
    Raise=Slider(0, range=0..40),
    Rotation=Slider(0, range=0..360),
    Turn=Slider(0, range=0..360),
    Tilt=Slider(0, range=0..360))  # -> Connection, Valid, ConnectedPieceId, ConnectedPieceTypePortId, ConnectingPieceId, ConnectingPieceTypePortId, Gap, Shift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

dsn = ModelDesign(Name="Sphere Packing", Pieces=merge, Connections=con.Connection)  # -> Design, Valid, Name, Description, Icon, Image, Variant, View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

panel_20 = Panel(con.Connection)

# ---- group: Modeling Kit
kit = ModelKit(Name="Geometry", Description="The most Colorful kit.", Types=typ.Type, Designs=dsn.Design)  # -> Kit, Valid, Name, Description, Icon, Image, Preview, Version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

# ----
kit_2 = SerializeKit(Kit=kit.Kit)

graft = GraftTree(Tree=mesh, IncludeEmptyLists=True, IncludeNullItems=True)
dsn_2 = ShowDesign(dn=dsn.Design, ty=typ.Type, ob=graft(graft))  # -> object_2, id_2, rp_2, pln_2
data_3 = Data(dsn_2.object_2)
object = ModelObject(Object=data_3)  # -> Object, Geometry, Name, Layer, Visibility, Display, Drafting, Render

txt = EncodeText(Text=kit_2, Mode=0)
hops = ContextPrint(Text=txt)

# ==== cluster ShowDesign: Show a design by flattening it and selecting representations based on mime and tags. Select exactly one representation based on mime and tags. The tag matching is based on the highest Jaccard index (|∩|/|∪|). If the mime type is not given or does not exist, then all representations are used to search for closest match. If index is equally high the first representation is picked.
dn = ClusterInput()
ty = ClusterInput()
ob = ClusterInput()
mm = ClusterInput()
tags = ClusterInput()
ty_2 = Type(ty)
dn_2 = Design(dn)
ob_2 = Data(ob)
mm_2 = Mime(mm)
tags_2 = Tags(tags)
fltdsn = FlattenDesign(Design=dn_2, Type=ty_2)
dsn = ModelDesign(Design=fltdsn)  # -> Design, Valid, Name, Description, Icon, Image, Variant, View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
typ = ModelType(Type=ty_2)  # -> Type, Valid, Name, Description, Icon, Image, Variant, Unit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
trim = TrimTree(Tree=dsn.Pieces, Depth=1)
rep = ModelRepresentation(Representation=typ.Representations)  # -> Representation, Valid, Url, Mime, Tags, Qualities
tstat = TreeStatistics(Tree=typ.Representations)  # -> Paths, Length, Count
pce = ModelPiece(Piece=trim)  # -> Piece, Valid, Id, TypeName, TypeVariant, Plane, ScreenPoint, Qualities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
tstat_2 = TreeStatistics(Tree=graft(rep.Url))  # -> Paths, Length, Count
trim_2 = TrimTree(Tree=rep.Url, Depth=1)
expression = Expression(x=graft(pce.TypeName), y=typ.Name, Expression="x=y")
expression_2 = Expression(x=graft(pce.TypeVariant), y=typ.Variant, Expression="x=y")
and = GateAnd(A=expression, B=expression_2)
cull = CullPattern(List=ty_2, CullPattern=and)
lng = ListLength(List=ty_2)
txt = Text(cull)
series = Series(Start=0, Step=1, Count=lng)
txt_2 = Text(ty_2)
expression_3 = Expression(x=txt, y=txt_2, Expression="x=y")
trim_3 = TrimTree(Tree=series, Depth=1)
cull_2 = CullPattern(List=trim_3, CullPattern=expression_3)
trim_4 = TrimTree(Tree=cull_2, Depth=1)
item = ListItem(List=tstat.Paths, Index=trim_4, Wrap=True)
branch = TreeBranch(Tree=typ.Representations, Path=item, MaintainPaths=False)
mrg_p = MergeSeperatlyPrepend(x=branch)  # -> Mrgd; inputs x: tree
# ---------- mrg_p: Python ----------
if ghenv.Component.RunCount<2:
    __author__ = "Ueli Saluz"
    __version__ = "2020.05.28"
    
    ghenv.Component.Name = "MergeSeperatly(Prepend)"
    ghenv.Component.NickName = "Mrg(P)"
    ghenv.Component.Description = "Merge inputs seperatly on a new path. Prepend index of input parameter for distincting."
    ghenv.Component.Message = "VER 1.0"

from System import Object
from Grasshopper import DataTree
from Grasshopper.Kernel import GH_ParamAccess as Access

if __name__ == "__main__":
    Mrgd = DataTree[Object]()
    access = Access()
    
    for input in ghenv.Component.Params.Input:  #set all Inputaccess to Tree Access
        input.Access = access.tree
    
    for i,input in enumerate(ghenv.Component.Params.Input):
        for j,source in enumerate(input.Sources):
            for path in source.VolatileData.Paths:
                Mrgd.AddRange(source.VolatileData[path],path.PrependElement(i))
# ---------- end mrg_p ----------
rep_2 = SelectRepresentation(rp=mrg_p, mm=mm_2, tags=tags_2)  # -> rp_5, ur_2, pa_ur_2
trim_5 = TrimTree(Tree=rep_2.ur_2, Depth=1)
itemindex = ItemIndex(L=trim_2, I=trim_5)  # -> i; inputs L: list
# ---------- itemindex: Python ----------
#Component Information
#--------------------------------------------------------------------------------------------
if ghenv.Component.RunCount<2:
    #General
    #--------------------------------------------------------------------------------------------
    __author__ = "Ueli Saluz"
    __version__ = "2022.11.18"
    
    ghenv.Component.Name = "ItemIndex"
    ghenv.Component.NickName = "ItemIndex"
    ghenv.Component.Description = "A better IdemIndex"
    ghenv.Component.Message = "VER 1.0"
    ghenv.Component.Category = "Set"
    ghenv.Component.SubCategory = "List"
    
     #Inputs
    #--------------------------------------------------------------------------------------------
    inputIndex=0
    
    ghenv.Component.Params.Input[inputIndex].Name = "List"
    ghenv.Component.Params.Input[inputIndex].NickName = "L"
    ghenv.Component.Params.Input[inputIndex].Description = "Input1 is..."
    ghenv.Component.Params.Input[inputIndex].Optional = False
    inputIndex+=1
    
    ghenv.Component.Params.Input[inputIndex].Name = "Item"
    ghenv.Component.Params.Input[inputIndex].NickName = "I"
    ghenv.Component.Params.Input[inputIndex].Description = "Input2 is..."
    ghenv.Component.Params.Input[inputIndex].Optional = False
    inputIndex+=1
    
    #Outputs
    #--------------------------------------------------------------------------------------------
    outputIndex=0
    
    ghenv.Component.Params.Output[outputIndex].Name = "Index"
    ghenv.Component.Params.Output[outputIndex].NickName = "i"
    ghenv.Component.Params.Output[outputIndex].Description = "Output1 is..."
    outputIndex+=1

i = L.index(I)
# ---------- end itemindex ----------
item_2 = ListItem(List=tstat_2.Paths, Index=itemindex, Wrap=True)
branch_2 = TreeBranch(Tree=ob_2, Path=item_2, MaintainPaths=False)
mrg_p_2 = MergeSeperatlyPrepend(x=branch_2)  # -> Mrgd; inputs x: tree; same code as mrg_p
trim_6 = TrimTree(Tree=rep_2.pa_ur_2, Depth=1)
trim_7 = TrimTree(Tree=rep_2.rp_5, Depth=1)
id = Id(pce.Id)
rp = Representation(trim_7)
pln = Plane(pce.Plane)
orient = Orient(Geometry=mrg_p_2, Source=PlaneXY(0, 0, 0), Target=graft(pln))  # -> Geometry, Transform
object = Data(orient.Geometry)
rp_2 = ClusterOutput(rp)
pln_2 = ClusterOutput(pln)
object_2 = ClusterOutput(object)
id_2 = ClusterOutput(id)

# ==== cluster SelectRepresentation: Select exactly one representation based on mime and tags. The tag matching is based on the Jaccard index. If the mime type is not given or does not exist, then all representations are used to search for closest match. If decisions rank equally hight always the first representation is picked.
mm = ClusterInput()
tags = ClusterInput()
rp = ClusterInput()
rp_2 = Representation(rp)
mm_2 = Mime(mm)
tags_2 = Tags(tags)
l2o = List2Object(L=rp_2)  # -> O; inputs L: tree
# ---------- l2o: Python ----------
#Component Information
#--------------------------------------------------------------------------------------------
if ghenv.Component.RunCount<2:
    #General
    #--------------------------------------------------------------------------------------------
    __author__ = "Ueli Saluz"
    __version__ = "2022.04.24"
    
    ghenv.Component.Name = "List2Object"
    ghenv.Component.NickName = "L2O"
    ghenv.Component.Description = "Wraps a list of objects into a list object."
    ghenv.Component.Message = "VER 1.0"
    ghenv.Component.Category = "Sets"
    ghenv.Component.SubCategory = "Tree"
    
     #Inputs
    #--------------------------------------------------------------------------------------------
    inputIndex=0
    
    ghenv.Component.Params.Input[inputIndex].Name = "List"
    ghenv.Component.Params.Input[inputIndex].NickName = "L"
    ghenv.Component.Params.Input[inputIndex].Description = "Tree with lists to wrap."
    ghenv.Component.Params.Input[inputIndex].Optional = False
    inputIndex+=1
    

    #Outputs
    #--------------------------------------------------------------------------------------------
    outputIndex=0
    
    ghenv.Component.Params.Output[outputIndex].Name =  "ListObject" 
    ghenv.Component.Params.Output[outputIndex].NickName = "O"
    ghenv.Component.Params.Output[outputIndex].Description = "Python list object as single item."
    outputIndex+=1


#Imports
#--------------------------------------------------------------------------------------------
from System import Object
from Grasshopper import DataTree

#Solver - Run with trees to enhance performance drastically
#--------------------------------------------------------------------------------------------
if __name__ == "__main__":
    
    #Initialize trees
    #--------------------------------------------------------------------------------------------
    TreeToWrap = DataTree[Object]()
    
    #Data matching
    #--------------------------------------------------------------------------------------------
    for path in L.Paths:
        listBranch = L.Branch(path)
        TreeToWrap.Add(listBranch,path)
    
     #Assign trees to output
    #--------------------------------------------------------------------------------------------
    O = TreeToWrap
# ---------- end l2o ----------

rep = ModelRepresentation(Representation=graft(rp_2))  # -> Representation, Valid, Url, Mime, Tags, Qualities
lng = ListLength(List=mm_2)
expression = Expression(x=rep.Mime, y=mm_2, Expression="x=y")
null = NullItem(Item=lng)  # -> NullFlags, InvalidFlags, Description
expression_2 = Expression(x=lng, Expression="x=0")
ma = MassAddition(Input=expression)  # -> Result, PartialResults
or = GateOr(A=expression_2, B=null.NullFlags)
cull = CullPattern(List=rep.Representation, CullPattern=ma.Result)
trim = TrimTree(Tree=cull, Depth=1)
mime_match = Representation(trim)
nulltobranch = CSharpScript(D=mime_match)  # -> R; inputs D: tree
# ---------- nulltobranch: C# ----------
#region Usings
using System;
using System.Linq;
using System.Collections;
using System.Collections.Generic;
using System.Drawing;

using Rhino;
using Rhino.Geometry;

using Grasshopper;
using Grasshopper.Kernel;
using Grasshopper.Kernel.Data;
using Grasshopper.Kernel.Types;
#endregion

public class Script_Instance : GH_ScriptInstance
{

    private void RunScript(DataTree<object> D, ref object R)
    {
        foreach (GH_Path path in D.Paths)
            if (D.Branch(path).Count == 0)
                D.Add(null, path);

        R = D;
    }
}
# ---------- end nulltobranch ----------
nullrep = ReplaceNulls(Items=nulltobranch, Replacements=l2o)  # -> graft(Items), Count

panel = Panel(nullrep.Items)
o2l = Object2List(O=nullrep.Items)  # -> L; inputs O: tree
# ---------- o2l: Python ----------
# Component Information
# --------------------------------------------------------------------------------------------
if ghenv.Component.RunCount < 2:
    # General
    # --------------------------------------------------------------------------------------------
    __author__ = "Ueli Saluz"
    __version__ = "2025.02.19"

    ghenv.Component.Name = "Object2List"
    ghenv.Component.NickName = "O2L"
    ghenv.Component.Description = "Unwraps a list of objects into a list object and returns the object if it is not iterable."
    ghenv.Component.Message = "VER 1.1"
    ghenv.Component.Category = "Sets"
    ghenv.Component.SubCategory = "Tree"

    # Inputs
    # --------------------------------------------------------------------------------------------
    inputIndex = 0

    ghenv.Component.Params.Input[inputIndex].Name = "ListObject"
    ghenv.Component.Params.Input[inputIndex].NickName = "O"
    ghenv.Component.Params.Input[inputIndex].Description = "A python list object that will be unwrapped into a Grasshopper list or returned as is if not iterable."
    ghenv.Component.Params.Input[inputIndex].Optional = False
    inputIndex += 1

    # Outputs
    # --------------------------------------------------------------------------------------------
    outputIndex = 0

    ghenv.Component.Params.Output[outputIndex].Name = "List"
    ghenv.Component.Params.Output[outputIndex].NickName = "L"
    ghenv.Component.Params.Output[outputIndex].Description = "The unwrapped list."
    outputIndex += 1

# Imports
# --------------------------------------------------------------------------------------------
from System import Object
from Grasshopper import DataTree
from collections import Iterable

# Solver - Run with trees to enhance performance drastically
# --------------------------------------------------------------------------------------------
if __name__ == "__main__":

    # Initialize trees
    # --------------------------------------------------------------------------------------------
    OriginalTree = DataTree[Object]()

    # Data matching
    # --------------------------------------------------------------------------------------------
    for path in O.Paths:
        listBranch = O.Branch(path)
        for i, listItem in enumerate(listBranch):
            if isinstance(listItem, Iterable) and not isinstance(listItem, str):
                OriginalTree.AddRange(list(listItem), path.AppendElement(i))
            else:
                OriginalTree.Add(listItem, path.AppendElement(i))

    # Assign trees to output
    # --------------------------------------------------------------------------------------------
    L = OriginalTree
# ---------- end o2l ----------
l2o_2 = List2Object(L=mime_match)  # -> O; inputs L: tree; same code as l2o
trim_2 = TrimTree(Tree=o2l, Depth=1)
trim_3 = TrimTree(Tree=trim_2, Depth=1)

filter = StreamFilter(Gate=or, Stream0=trim_3, Stream1=rp_2)
rp_3 = Representation(filter)

rep_2 = ModelRepresentation(Representation=rp_3)  # -> Representation, Valid, Url, Mime, Tags, Qualities
jac = JaccardIndex(set1=tags_2, set2=rep_2.Tags)
trim_4 = TrimTree(Tree=jac, Depth=1)
minmax = MinimumMaximum(L=trim_4)  # -> Max, MaxI, Min, MinI; inputs L: list
# ---------- minmax: Python ----------
#Component Information
#--------------------------------------------------------------------------------------------
if ghenv.Component.RunCount<2:
    #General
    #--------------------------------------------------------------------------------------------
    __author__ = "Ueli Saluz"
    __version__ = "2022.04.22"
    
    ghenv.Component.Name = "MinimumMaximum"
    ghenv.Component.NickName = "MinMax"
    ghenv.Component.Description = "Returns the maximum and mininum of a list and their corresponding index."
    ghenv.Component.Message = "VER 1.0"
    ghenv.Component.Category = "Maths"
    ghenv.Component.SubCategory = "Util"
    
     #Inputs
    #--------------------------------------------------------------------------------------------
    inputIndex=0
    
    ghenv.Component.Params.Input[inputIndex].Name = "L"
    ghenv.Component.Params.Input[inputIndex].NickName = "L"
    ghenv.Component.Params.Input[inputIndex].Description = "A list of numbers."
    ghenv.Component.Params.Input[inputIndex].Optional = False
    inputIndex+=1
    
    
    #Outputs
    #--------------------------------------------------------------------------------------------
    outputIndex=0
    
    ghenv.Component.Params.Output[outputIndex].Name = "Max"
    ghenv.Component.Params.Output[outputIndex].NickName = "Max"
    ghenv.Component.Params.Output[outputIndex].Description = "Maximum of the list"
    outputIndex+=1
    
    ghenv.Component.Params.Output[outputIndex].Name = "MaxI"
    ghenv.Component.Params.Output[outputIndex].NickName = "MaxI"
    ghenv.Component.Params.Output[outputIndex].Description = "Index of the maximum of the list"
    outputIndex+=1
    
    ghenv.Component.Params.Output[outputIndex].Name = "Min"
    ghenv.Component.Params.Output[outputIndex].NickName = "Min"
    ghenv.Component.Params.Output[outputIndex].Description = "Minimum of the list"
    outputIndex+=1
    
    ghenv.Component.Params.Output[outputIndex].Name = "MinI"
    ghenv.Component.Params.Output[outputIndex].NickName = "MinI"
    ghenv.Component.Params.Output[outputIndex].Description = "Index of the minimum of the list"
    outputIndex+=1


#Solver - Run with trees to enhance performance drastically
#--------------------------------------------------------------------------------------------
if __name__ == "__main__":
    
    maximum = max(L)
    MaxI = L.index(maximum)
    Max = maximum
    
    minimum = min(L)
    MinI = L.index(minimum)
    Min = minimum
# ---------- end minmax ----------
item = ListItem(List=rep_2.Representation, Index=minmax.MaxI, Wrap=True)
rep_3 = ModelRepresentation(Representation=item)  # -> Representation, Valid, Url, Mime, Lod, Qualities
sep = Separator()  # -> S
# ---------- sep: C# ----------
#region Usings
using System;
using System.Linq;
using System.Collections;
using System.Collections.Generic;
using System.Drawing;
using System.IO;

using Rhino;
using Rhino.Geometry;

using Grasshopper;
using Grasshopper.Kernel;
using Grasshopper.Kernel.Data;
using Grasshopper.Kernel.Types;
#endregion

public class Script_Instance : GH_ScriptInstance
{
    private void RunScript(ref object S)
    {
        S = Path.DirectorySeparatorChar;
    }
}
# ---------- end sep ----------
rep_4 = ReplaceText(Text=rep_3.Url, Find="/", Replace=sep, RecursiveReplace=False)
rp_4 = Representation(item)
pa_ur = Text(rep_4)
ur = Url(rep_3.Url)

rp_5 = ClusterOutput(rp_4)
ur_2 = ClusterOutput(ur)
pa_ur_2 = ClusterOutput(pa_ur)

# ==== cluster JaccardIndex: Compute the Jaccard Index of two sets.
set1 = ClusterInput()
set2 = ClusterInput()
set1_2 = Data(set1)
set2_2 = Data(set2)
cset = CreateSet(List=set2_2)  # -> Set, Map
cset_2 = CreateSet(List=set1_2)  # -> Set, Map
lng = ListLength(List=set1_2)
lng_2 = ListLength(List=set2_2)
intersection = SetIntersection(SetA=cset_2.Set, SetB=cset.Set)
expression = Expression(x=lng, Expression="x=0")
expression_2 = Expression(x=lng_2, Expression="x=0")
sunion = SetUnion(SetA=cset_2.Set, SetB=cset.Set)
null = NullItem(Item=lng)  # -> NullFlags, InvalidFlags, Description
null_2 = NullItem(Item=lng_2)  # -> NullFlags, InvalidFlags, Description
lng_3 = ListLength(List=sunion)
lng_4 = ListLength(List=intersection)
or = GateOr(A=null.NullFlags, B=expression)
or_2 = GateOr(A=null_2.NullFlags, B=expression_2)
division = Division(A=lng_4, B=lng_3)
int = Integer(or)
int_2 = Integer(or_2)
concat = Concatenate(FragmentA=int, FragmentB=int_2)
b2d = BinaryToDecimal(Binary=concat)  # -> Decimal
# ---------- b2d: Python ----------
if ghenv.Component.RunCount<2:
    __author__ = "Ueli Saluz"
    __version__ = "2021.11.14"
    
    ghenv.Component.Name = "BinaryToDecimal"
    ghenv.Component.NickName = "B2D"
    ghenv.Component.Description = "Converts a number in binary representation to a number in decimal representation."
    ghenv.Component.Message = "VER 1.0"
    
    ghenv.Component.Params.Input[0].NickName = "Binary"
    
    ghenv.Component.Params.Input[0].Description = "Binary representation of a number."
    
    ghenv.Component.Params.Output[0].NickName = "Decimal"
    
    ghenv.Component.Params.Output[0].Description = "Converted decimal representation of the same number."

if __name__ == "__main__":
    Decimal = int(Binary,2)
# ---------- end b2d ----------
expression_3 = Expression(c=b2d, x=division, Expression="If(c=0,x,If(c=3,1,0))")
N = Number(expression_3)
N_2 = ClusterOutput(N)
