# Grasshopper definition capsule.gh (Grasshopper 1.0.8)
# Copyright: GNU Lesser General Public License Version 3
# Copyright: GNU Lesser General Public License v3.0 or later
# plug-ins: RhinoCodePluginGH, semio

outdoor_seating_floor_area = Data("0")
storage_living_floor_area = Data("0")
common_room_floor_area = Data("0")
detention_room_floor_area = Data("0")
supervision_room_floor_area = Data("0")
technology_room_floor_area = Data("0")
other_office_work_floor_area = Data("0")
waiting_room_floor_area = Data("0")
dining_room_floor_area = Data("0")
break_room_floor_area = Data("0")
counter_room_floor_area = Data("0")
meeting_room_floor_area = Data("0")
control_room_floor_area = Data("0")
design_room_floor_area = Data("0")
office_room_floor_area = Data("0")
open_office_floor_area = Data("0")
addition = Addition(
    A=office_room_floor_area,
    B=open_office_floor_area,
    C=meeting_room_floor_area,
    D=design_room_floor_area,
    E=counter_room_floor_area,
    F=control_room_floor_area,
    G=supervision_room_floor_area,
    H=technology_room_floor_area,
    I=other_office_work_floor_area)
production_experiments_work_floor_area = Data("0")
education_culture_instruction_floor_are = Data("0")
storage_distribution_sales_floor_area = Data("0")
healing_and_care_floor_area = Data("0")
office_work_floor_area = Data(addition)
other_usable_floor_are = Data("0")
other_construction_floor_area = Data("0")
partition_wall_floor_area = Data("0")
circulation_floor_area = Data("0")
technical_floor_area = Data("0")
column_floor_area = Data("0")
beam_floor_area = Data("0")
shaft_floor_area = Data("0")
variant = Slider(0, range=0..7)
save_representation = BooleanToggle(False)
icon_export = BooleanToggle(False)
validate = BooleanToggle(False)
save = BooleanToggle(False)
panel = Panel("""\
/
q
p
J
L
s
z""")
sep = Separator()  # -> S; same code as sep
dir = Directory()  # -> D
# ---------- dir: C# ----------
#region Usings
using System;
using System.Linq;
using System.Collections;
using System.Collections.Generic;
using System.Drawing;
using System.IO;

using Rhino;
using Rhino.Geometry;

using Grasshopper;
using Grasshopper.Kernel;
using Grasshopper.Kernel.Data;
using Grasshopper.Kernel.Types;
#endregion

public class Script_Instance : GH_ScriptInstance
{
    private void RunScript(ref object D)
    {
        D = Path.GetDirectoryName(this.GrasshopperDocument.FilePath);
    }
}
# ---------- end dir ----------
and = GateAnd(A=save, B=save_representation)
and_2 = GateAnd(A=save, B=icon_export)
loop_slider = PythonScript(SliderToModify=variant, Min="0", Max="7", stepSize="1", Delay=Slider(0, range=0..1), Run=Toggle(False), Reset=Button())  # inputs Run: Boolean, Reset: Boolean
# ---------- loop_slider: Python ----------
import time

def updateSliderInput(inputName,min,max,value,decimalPlace=2):
    for input in ghenv.Component.Params.Input:
        for source in input.Sources:
            if input.Name == str(inputName):
                source.Slider.DecimalPlaces = decimalPlace
                source.Slider.Minimum = min
                source.Slider.Maximum = max
                source.Slider.Value = value
                source.ExpireSolution(True)

def countDecimal(number):
    string= str(number)
    return string[::-1].find('.')

if Run == True:
    if SliderToModify < Max:
        time.sleep(Delay)
        updateSliderInput("SliderToModify",Min,Max,SliderToModify+stepSize,countDecimal(stepSize))
if Reset == True:
    updateSliderInput("SliderToModify",Min,Max,Min)
# ---------- end loop_slider ----------
# ^                                    ^
#    |                                     |
# <-- Constants    Preview -->
# Parameters    External    Local -->
# <-- Meta               |
#      |                       v
#      v
par = ParentDirectory(D=dir)  # -> P; inputs D: String
# ---------- par: C# ----------
#region Usings
using System;
using System.Linq;
using System.Collections;
using System.Collections.Generic;
using System.Drawing;
using System.IO;

using Rhino;
using Rhino.Geometry;

using Grasshopper;
using Grasshopper.Kernel;
using Grasshopper.Kernel.Data;
using Grasshopper.Kernel.Types;
#endregion

public class Script_Instance : GH_ScriptInstance
{
    private void RunScript(string D, ref object P)
    {
        P = new DirectoryInfo(D).Parent;
    }
}
# ---------- end par ----------
item = ListItem(List=panel, Index=variant, Wrap=True)
panel_2 = Panel(item)
variant_2 = GetString(item, AtLeast=0, AtMost=1, TreeAccess=False)

panel_3 = Panel("The middle of the main entrance door of the upper entrance floor.")

itemindex = ItemIndex(L=panel, I=variant_2)  # -> i; inputs L: list
# ---------- itemindex: Python ----------
#Component Information
#--------------------------------------------------------------------------------------------
if ghenv.Component.RunCount<2:
    #General
    #--------------------------------------------------------------------------------------------
    __author__ = "Ueli Saluz"
    __version__ = "2022.11.18"
    
    ghenv.Component.Name = "ItemIndex"
    ghenv.Component.NickName = "ItemIndex"
    ghenv.Component.Description = "A better IdemIndex"
    ghenv.Component.Message = "VER 1.0"
    ghenv.Component.Category = "Set"
    ghenv.Component.SubCategory = "List"
    
     #Inputs
    #--------------------------------------------------------------------------------------------
    inputIndex=0
    
    ghenv.Component.Params.Input[inputIndex].Name = "List"
    ghenv.Component.Params.Input[inputIndex].NickName = "L"
    ghenv.Component.Params.Input[inputIndex].Description = "Input1 is..."
    ghenv.Component.Params.Input[inputIndex].Optional = False
    inputIndex+=1
    
    ghenv.Component.Params.Input[inputIndex].Name = "Item"
    ghenv.Component.Params.Input[inputIndex].NickName = "I"
    ghenv.Component.Params.Input[inputIndex].Description = "Input2 is..."
    ghenv.Component.Params.Input[inputIndex].Optional = False
    inputIndex+=1
    
    #Outputs
    #--------------------------------------------------------------------------------------------
    outputIndex=0
    
    ghenv.Component.Params.Output[outputIndex].Name = "Index"
    ghenv.Component.Params.Output[outputIndex].NickName = "i"
    ghenv.Component.Params.Output[outputIndex].Description = "Output1 is..."
    outputIndex+=1

i = L.index(I)
# ---------- end itemindex ----------
zoom = Button()
panel_4 = Panel("""backslash
slash
q
p
J
L
s
z""")
item_2 = ListItem(List=panel_4, Index=itemindex, Wrap=True)
merge = Merge(Data1="front", Data2="front", Data3="side", Data4="side", Data5="front", Data6="front", Data7="side", Data8="side")
merge_2 = Merge(Data1="F", Data2="T", Data3="F", Data4="T", Data5="F", Data6="T", Data7="F", Data8="T")
merge_3 = Merge(Data1="back", Data2="back", Data3="back", Data4="back", Data5="side", Data6="side", Data7="side", Data8="side")

aut = ModelAuthor(Name="Ueli Saluz", Email="ueli@semio-tech.org")  # -> Author, Valid, Name, Email, Attributes

list = ValueList({"Back": "back", "Side": "side"}, selected="Back")
item_3 = ListItem(List=merge_3, Index=itemindex, Wrap=True)
toggle = BooleanToggle(False)
item_4 = ListItem(List=merge_2, Index=itemindex, Wrap=True)
mirror = Boolean(item_4)
list_2 = ValueList({"Front", "Side"}, selected="Front")
item_5 = ListItem(List=merge, Index=itemindex, Wrap=True)
expression = Expression(x=Slider(420, range=0..1000), Expression="x/100")
expression_2 = Expression(x=Slider(260, range=0..1000), Expression="x/100")
expression_3 = Expression(x=Slider(250, range=0..1000), Expression="x/100")
expression_4 = Expression(x=Slider(150, range=0..1000), Expression="x/100")
expression_5 = Expression(x=Slider(100, range=0..1000), Expression="x/100")

concat = Concatenate(FragmentA="images/", FragmentC=".png")

entrance = Text(item_3)
view = Text(item_5)
length_m = Number(expression)
bathwidth_m = Number(expression_5)
panel_5 = Panel("""round
rectangular""")
bathlength_m = Number(expression_4)
height_m = Number(expression_3)
width_m = Number(expression_2)
panel_6 = Panel("""back
side""")
panel_7 = Panel("""front
side""")
_2d = _2D(x=length_m)
_2d_2 = _2D(x=width_m)
mirrored = Boolean(mirror)
itemindex_2 = ItemIndex(L=panel_6, I=entrance)  # -> i; inputs L: list; same code as itemindex
itemindex_3 = ItemIndex(L=panel_7, I=view)  # -> i; inputs L: list; same code as itemindex
rectangle = Rectangle(Plane=PlaneXY(0, 0, 0), XSize=_2d_2, YSize=_2d, Radius=0)  # -> Rectangle, Length
valueor0 = ValueOr0(value=itemindex_2)
valueor0_2 = ValueOr0(value=itemindex_3)
expression_6 = Expression(x=Slider(10, range=0..100), Expression="x/100")
expression_7 = Expression(x=Slider(15, range=0..100), Expression="x/100")
expression_8 = Expression(x=Slider(25, range=0..100), Expression="x/100")
bool = Boolean(invert(mirror))
entrance_2 = Integer(valueor0)
entrance_3 = Integer(entrance_2)
multiplication = Multiplication(A=entrance_3, B="4")
view_2 = Integer(valueor0_2)
view_3 = Integer(view_2)
multiplication_2 = Multiplication(A=view_3, B="2")
addition_2 = Addition(A=multiplication, B=multiplication_2, C=mirrored)
variant_3 = Integer(addition_2)
filter = StreamFilter(Gate=entrance_2, Stream0=mirror, Stream1=bool)
wallthicknessindoor_m = Data(expression_6)
fillet_radius_m = Number(expression_8)
shellthickness_m = Number(expression_7)
subtraction = Subtraction(A=height_m, B=shellthickness_m)
neg = Negative(Value=shellthickness_m)
dom = ConstructDomain(DomainStart=neg, DomainEnd=subtraction)
box = DomainBox(Base=PlaneXY(0, 0, 0), X=_2d_2, Y=_2d, Z=dom)
volume1to500 = Box(box)
debrep = DeconstructBrep(Brep=volume1to500)  # -> Faces, Edges, Vertices
trim = TrimTree(Tree=debrep.Edges, Depth=1)
trim_2 = TrimTree(Tree=debrep.Faces, Depth=1)
mirror_2 = Boolean(filter)
mirrored_2 = Boolean(mirror_2)
addition_3 = Addition(A=multiplication, B=multiplication_2, C=mirrored_2)
oldvariant = Integer(addition_3)

lng = ListLength(List=debrep.Edges)
series = Series(Start=0, Step=1, Count=lng)
trim_3 = TrimTree(Tree=series, Depth=1)
filedge = FilletEdge(Shape=volume1to500, Blend=0, Metric=0, Edges=trim_3, Radii=fillet_radius_m)
trim_4 = TrimTree(Tree=filedge, Depth=1)

item_6 = ListItem(List=trim_2, Index=0, Wrap=True)  # -> Item, Item1, Item2, Item3, Item4, Item5
# 2023-2025 Ueli Saluz
# 2025 Elduane Lumpine
# 2025 Christian Hödtke
# Permission is hereby granted, free of charge, to any person obtaining a copy
# of this Grasshopper file and associated documentation files (the "Document"),
# to deal in the Document without restriction, including without limitation the
# rights to use, copy, modify, merge, publish, distribute, sublicense, and/or sell
# copies of the Document, and to permit persons to whom the Document is
# furnished to do so.
# 
# Individual clusters used inside this document might be licensed under
# different terms. This is indicated through a similar copyright notice group
# inside the cluster and otherwise in the license field of the cluster. If you
# have any question please reach out to us: license@semio-tech.com
# 
# THE DOCUMENT IS PROVIDED "AS IS", WITHOUT WARRANTY OF ANY
# KIND, EXPRESS OR IMPLIED, INCLUDING BUT NOT LIMITED TO THE
# WARRANTIES OF MERCHANTABILITY, FITNESS FOR A PARTICULAR
# PURPOSE AND NONINFRINGEMENT. IN NO EVENT SHALL THE
# AUTHORS OR COPYRIGHT HOLDERS BE LIABLE FOR ANY CLAIM,
# DAMAGES OR OTHER LIABILITY, WHETHER IN AN ACTION OF
# CONTRACT, TORT OR OTHERWISE, ARISING FROM, OUT OF OR IN
# CONNECTION WITH THE DOCUMENT OR THE USE OR OTHER
# DEALINGS IN THE DOCUMENT.
list_3 = ValueList({"Round": "round", "Rectangular": "rectangular"}, selected="Round")
m2d_rhino = Make2DRhinoView(Clip=True)  # disabled
number_slider = Slider(876, range=0..1000)  # disabled
expression_9 = Expression(x=Slider(30, range=0..100), Expression="x/100")
expression_10 = Expression(x=Slider(65, range=0..100), Expression="x/100")
view_rectangle = ViewRectangle(view=m2d_rhino)  # disabled
window_shape = Text(list_3)
itemindex_4 = ItemIndex(L=panel_5, I=window_shape)  # -> i; inputs L: list; same code as itemindex
valueor0_3 = ValueOr0(value=itemindex_4)
windowshape = Integer(valueor0_3)
window_circle_radius_m = Number(expression_10)
window_offset_wall_m = Number(expression_9)
previewplane = PreviewPlane(plane=view_rectangle, axis_length=number_slider)  # disabled

srf = Surface(item_6.Item)
srf_2 = Surface(item_6.Item1)
srf_3 = Surface(item_6.Item3)
srf_4 = Surface(item_6.Item2)
srf_5 = Surface(item_6.Item4)
srf_6 = Surface(item_6.Item5)
mirrored_3 = Boolean(mirror_2)
mirrored_4 = Boolean(mirror_2)
filter_2 = StreamFilter(Gate=mirrored_3, Stream0=srf_2, Stream1=srf_3)
filter_3 = StreamFilter(Gate=mirrored_4, Stream0=srf_3, Stream1=srf_2)
merge_4 = Merge(Data1=srf_2, Data2=srf_3)
merge_5 = Merge(Data1=srf_2, Data2=srf)
merge_6 = Merge(Data1=srf, Data2=srf_4)
merge_7 = Merge(Data1=srf_2, Data2=srf_4)
merge_8 = Merge(Data1=srf_3, Data2=srf_4)
merge_9 = Merge(Data1=srf, Data2=srf_3)
entrance_4 = Integer(entrance_2)
window = Integer(view_2)
filter_4 = StreamFilter(Gate=entrance_4, Stream0=srf, Stream1=filter_2)
filter_5 = StreamFilter(
    Gate=oldvariant,
    Stream0=merge_4,
    Stream1=merge_4,
    Stream2=merge_7,
    Stream3=merge_8,
    Stream4=merge_9,
    Stream5=merge_5,
    Stream6=merge_6,
    Stream7=merge_6)
filter_6 = StreamFilter(Gate=window, Stream0=srf_4, Stream1=filter_3)

area = Area(Geometry=srf_5)  # -> Area, Centroid
gross_floor_area = Data(area.Area)
gross_floor_area_2 = Data(gross_floor_area)
panel_8 = Panel(gross_floor_area_2)
expression_11 = Expression(x=Slider(80, range=0..100), Expression="x/100")
expression_12 = Expression(x=Slider(200, range=0..1000), Expression="x/100")
expression_13 = Expression(x=Slider(30, range=0..100), Expression="x/100")
door_width_m = Number(expression_11)
door_offset_wall_m = Number(expression_13)
door_height_m = Number(expression_12)
construction_area_factor = Number(Slider(0.2, range=0..1))
construction_cost_eff_m² = Number(Slider(9500, range=0..20000))
income_month_eff_m² = Number(Slider(125, range=0..200))
maintenance_expenses_month_eff_m² = Number(Slider(10, range=0..30))
merge_10 = Merge(Data1=filter_4, Data2=filter_6)
heating_energy_demand_kwh_m²a = Number(Slider(45, range=0..200))
cooling_energy_demand_kwh_m²a = Number(Slider(30, range=0..200))
technical_equipment_energy_demand_kwh_m² = Number(Slider(30, range=0..200))  # "Technical Equipment Energy Demand[kWh/m²a]"
construction_global_warming_potential_kg = Number(Slider(1000, range=0..2000))  # "Construction Global Warming Potential [kgCO2e/eff. m²]"

# ----
# https://search.bsdd.buildingsmart.org/uri/buildingsmart/ifc/4.3/prop/Length
# https://search.bsdd.buildingsmart.org/uri/buildingsmart/ifc/4.3/prop/Width
# https://search.bsdd.buildingsmart.org/uri/buildingsmart/ifc/4.3/prop/Height
# 
# https://identifier.buildingsmart.org/uri/buildingsmart/ifc/4.3/prop/NetFloorArea
# 
# https://identifier.buildingsmart.org/uri/buildingsmart/ifc/4.3/prop/EnergyConsumption
# https://identifier.buildingsmart.org/uri/buildingsmart/ifc/4.3/prop/EnergyConsumption
# https://identifier.buildingsmart.org/uri/buildingsmart/ifc/4.3/prop/EnergyConsumption
# 
# 
# https://identifier.buildingsmart.org/uri/etim/etim/9.0/prop/EF016979
maintenance_expenses_month_eff_m²_2 = Number(maintenance_expenses_month_eff_m²)
construction_global_warming_potential_kg_2 = Number(construction_global_warming_potential_kg)  # "Construction Global Warming Potential [kgCO2e/eff. m²]"
technical_equipment_energy_demand_kwh_m²_2 = Number(technical_equipment_energy_demand_kwh_m²)  # "Technical Equipment Energy Demand[kWh/m²a]"
construction_area_factor_2 = Number(construction_area_factor)
income_month_eff_m²_2 = Number(income_month_eff_m²)
heating_energy_demand_kwh_m²a_2 = Number(heating_energy_demand_kwh_m²a)
cooling_energy_demand_kwh_m²a_2 = Number(cooling_energy_demand_kwh_m²a)
construction_cost_eff_m²_2 = Number(construction_cost_eff_m²)
expression_14 = Expression(x=construction_area_factor_2, Expression="1-x")
area_2 = Area(Geometry=rectangle.Rectangle)  # -> Area, Centroid
multiplication_3 = Multiplication(A=area_2.Area, B=expression_14)
multiplication_4 = Multiplication(A=multiplication_3, B=income_month_eff_m²_2)
multiplication_5 = Multiplication(A=multiplication_3, B=maintenance_expenses_month_eff_m²_2)
expression_15 = Expression(x=multiplication_4, Expression="x*12")
expression_16 = Expression(x=multiplication_5, Expression="x*12")
multiplication_6 = Multiplication(A=multiplication_3, B=construction_global_warming_potential_kg_2)
multiplication_7 = Multiplication(A=heating_energy_demand_kwh_m²a_2, B=multiplication_3)
multiplication_8 = Multiplication(A=cooling_energy_demand_kwh_m²a_2, B=multiplication_3)
multiplication_9 = Multiplication(A=technical_equipment_energy_demand_kwh_m²_2, B=multiplication_3)
multiplication_10 = Multiplication(A=multiplication_3, B=construction_cost_eff_m²_2)
roundmult = RoundToMultiple(N=multiplication_3, M="0.01")  # -> R; inputs N: tree, M: tree
# ---------- roundmult: Python ----------
#Component Information
#--------------------------------------------------------------------------------------------
if ghenv.Component.RunCount<2:
    #General
    #--------------------------------------------------------------------------------------------
    __author__ = "YOUR NAME"
    __version__ = "2000.00.00"
    
    ghenv.Component.Name = "Round to Multiple"
    ghenv.Component.NickName = "RoundMult"
    ghenv.Component.Description = "Rounds a number to the nearest specified multiple."
    ghenv.Component.Message = "VER 1.0"
    ghenv.Component.Category = "Math"
    ghenv.Component.SubCategory = "Arithmetic"
    
     #Inputs
    #--------------------------------------------------------------------------------------------
    inputIndex=0
    
    ghenv.Component.Params.Input[inputIndex].Name = "Number"
    ghenv.Component.Params.Input[inputIndex].NickName = "N"
    ghenv.Component.Params.Input[inputIndex].Description = "Number to round."
    ghenv.Component.Params.Input[inputIndex].Optional = False
    inputIndex+=1
    
    ghenv.Component.Params.Input[inputIndex].Name = "Multiple"
    ghenv.Component.Params.Input[inputIndex].NickName = "M"
    ghenv.Component.Params.Input[inputIndex].Description = "Multiple to round to."
    ghenv.Component.Params.Input[inputIndex].Optional = False
    inputIndex+=1
    
    #Outputs
    #--------------------------------------------------------------------------------------------
    outputIndex=0
    
    ghenv.Component.Params.Output[outputIndex].Name = "Rounded"
    ghenv.Component.Params.Output[outputIndex].NickName = "R"
    ghenv.Component.Params.Output[outputIndex].Description = "Number rounded to the nearest specified multiple."
    outputIndex+=1


#Imports
#--------------------------------------------------------------------------------------------
from System import Object
from Grasshopper import DataTree
import math


#The Component function - Business logic only (e.g. working without trees)
#--------------------------------------------------------------------------------------------
"""Function that this component is computing.
    Inputs:
        number: The number to round.
        multiple: The multiple to round to.
    Output:
        rounded: The number rounded to the nearest specified multiple."""
def RoundToMultiple(number, multiple):
    rounded = math.ceil(number / multiple) * multiple
    return rounded

#Solver - Run with trees to enhance performance drastically
#--------------------------------------------------------------------------------------------
if __name__ == "__main__":
    
    #Initialize trees
    #--------------------------------------------------------------------------------------------
    RoundedTree = DataTree[Object]()
    
    #Data matching
    #--------------------------------------------------------------------------------------------
    for path in N.Paths:
        numberBranch = N.Branch(path)
        for i, number in enumerate(numberBranch):
            multiple = M.Branch(path)[i]
            rounded = RoundToMultiple(number, multiple)
            RoundedTree.Add(rounded, path)
    
     #Assign trees to output
    #--------------------------------------------------------------------------------------------
    R = RoundedTree
# ---------- end roundmult ----------
round = Round(Number=multiplication_10)  # -> Nearest, Floor, Ceiling
round_2 = Round(Number=multiplication_9)  # -> Nearest, Floor, Ceiling
roundmult_2 = RoundToMultiple(N=multiplication_6, M="0.01")  # -> R; inputs N: tree, M: tree; same code as roundmult
round_3 = Round(Number=multiplication_7)  # -> Nearest, Floor, Ceiling
round_4 = Round(Number=multiplication_8)  # -> Nearest, Floor, Ceiling
round_5 = Round(Number=expression_15)  # -> Nearest, Floor, Ceiling
round_6 = Round(Number=expression_16)  # -> Nearest, Floor, Ceiling
merge_11 = Merge(
    Data1=entrance,
    Data2=view,
    Data3=length_m,
    Data4=width_m,
    Data5=height_m,
    Data6=window_shape,
    Data7=roundmult,
    Data8=round.Nearest,
    Data9=round_3.Nearest,
    Data10=round_4.Nearest,
    Data11=round_2.Nearest,
    Data12=round_5.Nearest,
    Data13=round_6.Nearest,
    Data14=roundmult_2)
panel_9 = Panel("""entrance
view
length
width
heigth
window shape
effective floor area
construction cost
heating energy demand
cooling energy demand
technical equipment energy demand
income
maintenance expenses
construction global warming potential""")
panel_10 = Panel(merge_11)
panel_11 = Panel("""m
m
m

m²
€
kWh/a
kWh/a
kWh/a
€/a
€/a
kgCO2e""")
qal = ModelQuality(Validate=validate, Name=panel_9, Value=panel_10, Unit=panel_11)  # -> Quality, Valid, Name, Value, Unit
filter_7 = StreamFilter(Gate=mirror, Stream1="mirrored")
merge_12 = Merge(Data1=qal.Quality, Data2=filter_7)

jagged = SettingsSpeed()
mesh = MeshBrep(Brep=volume1to500, Settings=jagged)
collider = Mesh(mesh)

panel_12 = Panel("""east
west""")
panel_13 = Panel("""west
east""")
panel_14 = Panel("An apartment capsule for one person. It has the entrance on the ")
item_7 = ListItem(List=panel_12, Index=mirror, Wrap=True)
item_8 = ListItem(List=panel_13, Index=mirror, Wrap=True)
concat_2 = Concatenate(FragmentA="door capsule", FragmentC=" ", FragmentB=item_7)
concat_3 = Concatenate(FragmentA="door tambour", FragmentC=" ", FragmentB=item_8)
filter_8 = StreamFilter(Gate=mirror, Stream1=" It is mirrored compared to the normal one.")
concat_4 = Concatenate(
    FragmentA=panel_14,
    FragmentB=entrance,
    FragmentC=" and has the view to the ",
    FragmentD=view,
    FragmentF=".",
    FragmentE=filter_8)

# ----
# Interior
bbox = BoundingBox(Content=box, Plane=PlaneXY(0, 0, 0))  # -> Box, Box_2
wallthicknessindoor = Data(wallthicknessindoor_m)
shellthickness_m_2 = Number(expression_7)
bathlength = Number(bathlength_m)
bathwidth = Number(bathwidth_m)
sort_surfaces = SortSurfacesByOrientation(B=bbox.Box)  # -> base_2, roof_2, walls_2
item_9 = ListItem(List=sort_surfaces.walls_2, Index="3", Wrap=True)
addition_4 = Addition(A=shellthickness_m_2, B=bathwidth, C="0.07", D=wallthicknessindoor)
addition_5 = Addition(A=shellthickness_m_2, B=bathlength, C="0.07", D=wallthicknessindoor)
edges = BrepEdges(Brep=item_9)  # -> Naked, Interior, NonManifold
disc = Discontinuity(Curve=item_9, Level=1)  # -> Points, Parameters
debrep_2 = DeconstructBrep(Brep=sort_surfaces.base_2)  # -> Faces, Edges, Vertices
flip = Flip(Surface=item_9)  # -> Surface, Result
panel_15 = Panel("""0
2""")
item_10 = ListItem(List=debrep_2.Edges, Index=panel_15, Wrap=True)
item_11 = ListItem(List=disc.Points, Index="2", Wrap=True)  # -> flatten(Item)
item_12 = ListItem(List=edges.Naked, Index="2", Wrap=True)
item_13 = ListItem(List=edges.Naked, Index="0", Wrap=True)
facen = FaceNormals(Mesh=flip.Surface)  # -> Centers, Normals
midpt = CurveMiddle(Curve=item_10)
end = EndPoints(Curve=item_12)  # -> Start, End
end_2 = EndPoints(Curve=item_13)  # -> Start, End
amp = Amplitude(Vector=facen.Normals, Amplitude=addition_4)  # -> flatten(Vector)
item_14 = ListItem(List=midpt, Index=0, Wrap=True)  # -> Item, Item1
Z = UnitZ(Factor=1)
merge_13 = Merge(Data1=end.End, Data2=end_2.Start)  # -> flatten(Result)
move = Move(Geometry=item_14.Item, Motion=Z)  # -> Geometry, Transform
ln = Line(StartPoint=item_14.Item, EndPoint=item_14.Item1)
vec2pt = Vector2Pt(PointA=item_11, PointB=merge_13, Unitize=False)  # -> Vector, Length
lnpt = LinePt(Line=ln, Point=move.Geometry)
item_15 = ListItem(List=vec2pt.Vector, Index=0, Wrap=True)  # -> Item, Item1
amp_2 = Amplitude(Vector=item_15.Item1, Amplitude=addition_5)
vec = VectorXYZ(XComponent=amp, YComponent=amp_2, ZComponent=item_15.Item)  # -> Vector, Length
move_2 = Move(Geometry=item_11, Motion=vec.Vector)  # -> Geometry, Transform
rectangle_2 = Rectangle(Plane=move_2.Geometry, XSize=Slider(1.5, range=0..10), YSize=Slider(0.99, range=0..10), Radius=0)  # -> Rectangle, Length
area_3 = Area(Geometry=rectangle_2.Rectangle)  # -> Area, Centroid
box_2 = Box2Pt(PointA=move_2.Geometry, PointB=item_11, Plane=PlaneXY(0, 0, 0))
ln_2 = Line(StartPoint=area_3.Centroid, EndPoint=move_2.Geometry)
move_3 = Move(Geometry=rectangle_2.Rectangle, Motion=ln_2)  # -> Geometry, Transform
neg_2 = Negative(Value=height_m)
Z_2 = UnitZ(Factor=neg_2)
extr = Extrude(Base=move_3.Geometry, Direction=Z_2)
rotate = Rotate(Geometry=extr, Angle=degrees(Slider(-43, range=-360..0)), Plane=move_2.Geometry)  # -> Geometry, Transform
cap = CapHoles(Brep=rotate.Geometry)
trim_5 = TrimSolid(Shape=box_2, Cutters=cap)
panel_16 = Panel("""9
10""")
cap_2 = CapHoles(Brep=trim_5)
debrep_3 = DeconstructBrep(Brep=cap_2)  # -> Faces, Edges, Vertices
filedge_2 = FilletEdge(Shape=cap_2, Blend=0, Metric=0, Edges=panel_16, Radii=Slider(0.41, range=0..3))
debrep_4 = DeconstructBrep(Brep=filedge_2)  # -> Faces, Edges, Vertices
sort_surfaces_2 = SortSurfacesByOrientation(B=debrep_4.Faces)  # -> base_2, roof_2, walls_2
panel_17 = Panel("""0
1""")
cull_i = CullIndex(List=sort_surfaces_2.walls_2, Indices=panel_17, Wrap=True)
neg_3 = Negative(Value=wallthicknessindoor)
panel_18 = Panel("""1
8
9
10
12
13""")

subtraction_2 = Subtraction(A=width_m, B=shellthickness_m, C=addition_4)

filter_9 = StreamFilter(Gate=entrance_2, Stream0="3", Stream1="5")
Z_3 = UnitZ(Factor="0.6")

# ---- group: Kitchen
addition_6 = Addition(A=shellthickness_m, B=door_offset_wall_m, C=door_width_m)
panel_19 = Panel("1")
addition_7 = Addition(A=door_offset_wall_m, B=door_width_m)
pt = ConstructPoint(XCoordinate=0, YCoordinate=0, ZCoordinate=0)
Z_4 = UnitZ(Factor="0.2")
subtraction_3 = Subtraction(A=door_offset_wall_m, B="0.55")
pt_2 = ConstructPoint(XCoordinate=0, YCoordinate=0, ZCoordinate=0)
panel_20 = Panel("3")

# ----
filter_10 = StreamFilter(Gate=entrance_2, Stream0=panel_19, Stream1=subtraction_2)

concat_5 = Concatenate(FragmentA="icons/", FragmentC=".svg")

# ---- group: Kitchen (continued)
pt_3 = ConstructPoint(XCoordinate=subtraction_3, YCoordinate=filter_10, ZCoordinate=Slider(0.7, range=0..1))
box_3 = Box2Pt(PointA=pt_2, PointB=pt_3, Plane=PlaneXY(0, 0, 0))
debrep_5 = DeconstructBrep(Brep=box_3)  # -> Faces, Edges, Vertices
item_16 = ListItem(List=debrep_5.Vertices, Index="4", Wrap=True)  # -> Item, Item1, Item2, Item3
move_4 = Move(Geometry=item_16.Item2, Motion=Z_4)  # -> Geometry, Transform
move_5 = Move(Geometry=item_16.Item3, Motion=Z_4)  # -> Geometry, Transform
vec2pt_2 = Vector2Pt(PointA=item_16.Item3, PointB=item_16.Item, Unitize=False)  # -> Vector, Length
box_4 = Box2Pt(PointA=item_16.Item, PointB=move_4.Geometry, Plane=PlaneXY(0, 0, 0))
ln_3 = Line(StartPoint=item_16.Item2, EndPoint=move_5.Geometry)
extr_2 = Extrude(Base=ln_3, Direction=vec2pt_2.Vector)
debrep_6 = DeconstructBrep(Brep=box_3)  # -> Faces, Edges, Vertices
split = SplitBrep(Brep=box_4, Cutter=extr_2)
item_17 = ListItem(List=split, Index=0, Wrap=True)  # -> Item, Item1
item_18 = ListItem(List=debrep_6.Faces, Index="3", Wrap=True)
cap_3 = CapHoles(Brep=item_17.Item)  # -> flatten(Brep)
area_4 = Area(Geometry=item_18)  # -> Area, Centroid
sunion = SolidUnion(Breps=[cap_3, box_3])

# ----
expression_17 = Expression(x=shellthickness_m, Expression="x/3")

rec = Rectangle({Plane=Plane(origin=(15.60693884, 14.69292436, 15.6245417), x=(0.7071067812, -0.7071067812, 0), y=(-0.4082482905, -0.4082482905, 0.8164965809)), Size=Domain2(u=-24.40970167..24.40970167, v=-18.06498235..18.06498235)})
m2d_parallel = Make2DParallelView(Projection=rec)
make2d = Make2D(Geometry=trim_4, View=m2d_parallel, TangentEdges="T", TangentSeams=False, AutoComputeMake2D=True)  # -> VisibleCurves, VisibleIndex, VisibleType, HiddenCurves, HiddenIndex, HiddenType
trim_6 = TrimTree(Tree=make2d.VisibleCurves, Depth=1)
shell = Geometry(trim_6)

# ---- group: Kitchen
Z_5 = UnitZ(Factor="-0.2")

# ----
stool = Brep(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)
desk = Brep(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)
edges_2 = BrepEdges(Brep=stool)  # -> Naked, Interior, NonManifold
debrep_7 = DeconstructBrep(Brep=desk)  # -> Faces, Edges, Vertices
item_19 = ListItem(List=edges_2.Interior, Index="1", Wrap=True)
item_20 = ListItem(List=debrep_7.Vertices, Index="15", Wrap=True)
item_21 = ListItem(List=debrep_7.Vertices, Index="10", Wrap=True)
midpt_2 = CurveMiddle(Curve=item_19)
item_22 = ListItem(List=debrep_7.Edges, Index="16", Wrap=True)
vec2pt_3 = Vector2Pt(PointA=item_20, PointB=item_21, Unitize=False)  # -> Vector, Length
len = Length(Curve=item_22)

expression_18 = Expression(x=height_m, Expression="x/2")
addition_8 = Addition(A=window_circle_radius_m, B=window_offset_wall_m, C=shellthickness_m)
Z_6 = UnitZ(Factor=expression_18)
filter_11 = StreamFilter(Gate=mirror_2, Stream0=item_6.Item3, Stream1=item_6.Item1)
evalsrf = EvaluateSurface(Surface=reparameterize(filter_11), Point="0.5,0.5")  # -> Point, Normal, UDirection, VDirection, Frame
evalsrf_2 = EvaluateSurface(Surface=reparameterize(item_6.Item2), Point="0.5,0.5")  # -> Point, Normal, UDirection, VDirection, Frame
expression_19 = Expression(x=window_circle_radius_m, Expression="x*2")
_2d_3 = _2D(x=expression_19)

Z_7 = UnitZ(Factor="-0.2")

item_23 = ListItem(List=trim, Index=0, Wrap=True)  # -> Item, Item1, Item2, Item3
flip_2 = FlipCurve(Curve=item_23.Item)  # -> Curve, Flag
filter_12 = StreamFilter(Gate=mirror_2, Stream0=flip_2.Curve, Stream1=item_23.Item)
filter_13 = StreamFilter(Gate=mirror_2, Stream0=item_6.Item1, Stream1=item_6.Item3)
filter_14 = StreamFilter(Gate=entrance_2, Stream0=filter_12, Stream1=item_23.Item1)
addition_9 = Addition(A=door_offset_wall_m, B=shellthickness_m)
filter_15 = StreamFilter(Gate=entrance_2, Stream0=item_6.Item, Stream1=filter_13)
eval = EvaluateLength(Curve=filter_14, Length=addition_9, Normalized=False)  # -> Point, Tangent, Parameter
srf_cp = SurfaceClosestPoint(Point=eval.Point, Surface=filter_15)  # -> Point, UVPoint, Distance
evalsrf_3 = EvaluateSurface(Surface=filter_15, Point=srf_cp.UVPoint)  # -> Point, Normal, UDirection, VDirection, Frame
neg_4 = Negative(Value=door_width_m)
filter_16 = StreamFilter(Gate=entrance_2, Stream0=neg_4, Stream1=door_width_m)
and_3 = GateAnd(A=entrance_2, B=mirror_2)
filter_17 = StreamFilter(Gate=mirror_2, Stream0=filter_16, Stream1=door_width_m)
filter_18 = StreamFilter(Gate=and_3, Stream0=filter_17, Stream1=neg_4)
rectangle_3 = Rectangle(Plane=evalsrf_3.Frame, XSize=filter_18, YSize=door_height_m, Radius=0)  # -> Rectangle, Length

flip_3 = FlipCurve(Curve=item_23.Item1)  # -> Curve, Flag
filter_19 = StreamFilter(Gate=mirror_2, Stream0=item_23.Item3, Stream1=flip_3.Curve)
eval_2 = EvaluateLength(Curve=filter_19, Length=addition_8, Normalized=False)  # -> Point, Tangent, Parameter
move_6 = Move(Geometry=eval_2.Point, Motion=Z_6)  # -> Geometry, Transform
pl_origin = PlaneOrigin(Base=evalsrf.Frame, Origin=move_6.Geometry)
filter_20 = StreamFilter(Gate=view_2, Stream0=evalsrf_2.Frame, Stream1=pl_origin)
rectangle_4 = Rectangle(Plane=filter_20, XSize=_2d_3, YSize=_2d_3, Radius=0)  # -> Rectangle, Length
cir = Circle(Plane=filter_20, Radius=window_circle_radius_m)
filter_21 = StreamFilter(Gate=windowshape, Stream0=cir, Stream1=rectangle_4.Rectangle)
windowplane = Plane(filter_20)
window_2 = Geometry(filter_21)

windowplane_2 = Plane(windowplane)
deplane = DeconstructPlane(Plane=windowplane_2)  # -> Origin, XAxis, YAxis, ZAxis
neg_5 = Negative(Value=deplane.ZAxis)
amp_3 = Amplitude(Vector=neg_5, Amplitude=expression_17)
extr_3 = Extrude(Base=window_2, Direction=amp_3)
cap_4 = CapHoles(Brep=extr_3)

make2d_2 = Make2D(Geometry=cap_4, View=m2d_parallel, TangentEdges=False, TangentSeams=False, AutoComputeMake2D=True)  # -> VisibleCurves, VisibleIndex, VisibleType, HiddenCurves, HiddenIndex, HiddenType
merge_14 = Merge(Data1=make2d_2.VisibleCurves, Data2=make2d_2.HiddenCurves)
trim_7 = TrimTree(Tree=merge_14, Depth=1)
window_3 = Geometry(trim_7)

expression_20 = Expression(y=shell, Expression="x")
expression_21 = Expression(y=window_3, Expression="x")
concat_6 = Concatenate(FragmentC="icon")
concat_7 = Concatenate(FragmentC="icons", FragmentD=sep)
concat_8 = Concatenate(FragmentA=concat_7)
concat_9 = Concatenate(FragmentA=par, FragmentB=sep, FragmentC=concat_8)

volume = Data(trim_4)
Y = UnitY(Factor=window_circle_radius_m)
X = UnitX(Factor=window_circle_radius_m)
base = Data(srf_5)
roof = Data(srf_6)
Z_8 = UnitZ(Factor=window_circle_radius_m)
filter_22 = StreamFilter(Gate=view_2, Stream0=X, Stream1="0")
filter_23 = StreamFilter(Gate=view_2, Stream0="0", Stream1=Y)
debrep_8 = DeconstructBrep(Brep=filter_4)  # -> Faces, Edges, Vertices
deplane_2 = DeconstructPlane(Plane=filter_20)  # -> Origin, XAxis, YAxis, ZAxis
vec_2 = VectorXYZ(XComponent=filter_22, YComponent=filter_23, ZComponent=Z_8)  # -> Vector, Length
item_24 = ListItem(List=debrep_8.Edges, Index=Slider(3, range=0..3), Wrap=True)  # -> Item, Item1
item_25 = ListItem(List=debrep_8.Vertices, Index=0, Wrap=True)
neg_6 = Negative(Value=vec_2.Vector)
pln = Plane(cir)
move_7 = Move(Geometry=deplane_2.Origin, Motion=vec_2.Vector)  # -> Geometry, Transform
move_8 = Move(Geometry=deplane_2.Origin, Motion=neg_6)  # -> Geometry, Transform
pl = ConstructPlane(Origin=item_25, XAxis=item_24.Item, YAxis=item_24.Item1)
rec_2pt = Rectangle2Pt(Plane=pln, PointA=move_7.Geometry, PointB=move_8.Geometry, Radius=0)  # -> Rectangle, Length
merge_15 = Merge(Data1=srf, Data2=srf_2, Data3=srf_3, Data4=srf_4)
walls = Data(merge_15)
merge_16 = Merge(Data1=walls, Data2=roof, Data3=base)
join = BrepJoin(Breps=merge_16)  # -> Breps, Closed
window_4 = Surface(rec_2pt.Rectangle)
group = NamedGroup(Geometry=join.Breps, Name="floors")  # -> Group, Geometry, Name
group_2 = NamedGroup(Geometry=srf_5, Name="Base")  # -> Group, Geometry, Name
group_3 = NamedGroup(Geometry=merge_15, Name="walls")  # -> Group, Geometry, Name
group_4 = NamedGroup(Geometry=window_4, Name="window")  # -> Group, Geometry, Name
group_5 = NamedGroup(Geometry=srf_6, Name="roof")  # -> Group, Geometry, Name
data = Data(concat_4)
data_2 = Data(variant_2)
rep = ModelRepresentation(Tags="1 to 100")  # -> Representation, Valid, Url, Description, Tags, Attributes
collider_2 = Mesh(collider)
au = Author(aut.Author)
ql = Quality(qal.Quality)

abs = Absolute(Value="-0.05")
addition_10 = Addition(A=shellthickness_m, B=abs)

Z_9 = UnitZ(Factor=addition_10)
move_9 = Move(Geometry=rectangle_3.Rectangle, Motion=Z_9)  # -> Geometry, Transform
door = Rectangle(move_9.Geometry)

door_2 = Rectangle(door)
explode = Explode(Curve=door, Recursive=True)  # -> Segments, Vertices
trim_8 = TrimTree(Tree=explode.Segments, Depth=1)
item_26 = ListItem(List=trim_8, Index=0, Wrap=True)  # -> Item, Item1, Item2, Item3
eval_3 = EvaluateCurve(Curve=reparameterize(item_26.Item), Parameter="0.5")  # -> Point, Tangent, Angle
rev = Reverse(Vector=eval_3.Tangent)
Z_10 = UnitZ(Factor=1)
xprod = CrossProduct(VectorA=eval_3.Tangent, VectorB=Z_10, Unitize=False)  # -> Vector, Length
xprod_2 = CrossProduct(VectorA=rev, VectorB=Z_10, Unitize=False)  # -> Vector, Length
pl_2 = ConstructPlane(Origin=eval_3.Point, XAxis=eval_3.Tangent, YAxis=xprod_2.Vector)
doorentranceplane = Plane(pl_2)

por = ModelPort(
    Validate=validate,
    Description=panel_3,
    Family=concat_2,
    CompatibleFamilies=concat_3,
    Point=eval_3.Point,
    Direction=xprod.Vector,
    Qualities="entrance")  # -> Port, Valid, Id, Description, Mandatory, Family, CompatibleFamilies, Point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

prv = PreviewPort(po=por.Port, sc=1)

typ = ModelType(
    Validate=validate,
    Name="Capsule",
    Description=concat_4,
    Icon=concat_5,
    Image=concat,
    Variant=variant_2,
    Unit="m",
    Ports=por.Port,
    Authors=aut.Author,
    Qualities=merge_12)  # -> Type, Valid, Name, Description, Icon, Image, Variant, Stock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
typ_2 = PutType(Type=typ.Type, Uri=par, Run=save)

doorentranceplane_2 = Plane(doorentranceplane)
deplane_3 = DeconstructPlane(Plane=doorentranceplane_2)  # -> Origin, XAxis, YAxis, ZAxis
amp_4 = Amplitude(Vector=deplane_3.YAxis, Amplitude=shellthickness_m)
extr_4 = Extrude(Base=door, Direction=amp_4)
cap_5 = CapHoles(Brep=extr_4)

make2d_3 = Make2D(Geometry=cap_5, View=m2d_parallel, TangentEdges=False, TangentSeams=False, AutoComputeMake2D=True)  # -> VisibleCurves, VisibleIndex, VisibleType, HiddenCurves, HiddenIndex, HiddenType
trim_9 = TrimTree(Tree=make2d_3.VisibleCurves, Depth=1)
door_3 = Geometry(trim_9)

expression_22 = Expression(y=door_3, Expression="x")
merge_17 = Merge(Data1=expression_20, Data2=expression_22, Data3=expression_21)
merge_18 = Merge(Data1=shell, Data2=door_3, Data3=window_3)
blc = ExportBlock(path=concat_9, name=concat_6, url=concat_8, geo=merge_18, layer_name=merge_17, export=and_2)  # -> block_definition_3, path_4, exported_2

merge_19 = Merge(Data1=cap_5, Data2=cap_4)
sdiff = SolidDifference(BrepsA=trim_4, BrepsB=merge_19)
typ_3 = SerializeType(Type=typ.Type)
volume1to200 = Brep(sdiff)
bbox_2 = BoundingBox(Content=flatten(volume1to200), Plane=PlaneXY(0, 0, 0), UnionBox=True)  # -> Box, Box_2
zoom2bb = ZoomToBoundingBox(N=["Top", "Front", "Right", "Perspective", "Parallel"], BB=bbox_2.Box, S=0, R=zoom)  # -> F, SBB; inputs BB: Box, R: Boolean
# ---------- zoom2bb: Python ----------
#Component Information
#--------------------------------------------------------------------------------------------
if ghenv.Component.RunCount<2:
    #General
    #--------------------------------------------------------------------------------------------
    __author__ = "Ueli Saluz"
    __version__ = "2022.05.21"
    
    ghenv.Component.Name = "ZoomToBoundingBox"
    ghenv.Component.NickName = "Zoom2BB"
    ghenv.Component.Description = "Zoom the view of a Rhino viewport to a bounding box."
    ghenv.Component.Message = "VER 1.1"
    ghenv.Component.Category = "Display"
    ghenv.Component.SubCategory = "Camera"
    
     #Inputs
    #--------------------------------------------------------------------------------------------
    inputIndex=0
    
    ghenv.Component.Params.Input[inputIndex].Name = "Name"
    ghenv.Component.Params.Input[inputIndex].NickName = "N"
    ghenv.Component.Params.Input[inputIndex].Description = "Name of the viewport"
    ghenv.Component.Params.Input[inputIndex].Optional = False
    inputIndex+=1
    
    ghenv.Component.Params.Input[inputIndex].Name = "BoundingBox"
    ghenv.Component.Params.Input[inputIndex].NickName = "BB"
    ghenv.Component.Params.Input[inputIndex].Description = ""
    ghenv.Component.Params.Input[inputIndex].Optional = False
    inputIndex+=1
    
    ghenv.Component.Params.Input[inputIndex].Name = "ScaleFactor"
    ghenv.Component.Params.Input[inputIndex].NickName = "S"
    ghenv.Component.Params.Input[inputIndex].Description = "A factor for the extension of the bounding box." \
    +"0 means 0 extension, a positive number makes the bounding box larger a negative smaller. The amount is proportional to the length."
    ghenv.Component.Params.Input[inputIndex].Optional = False
    inputIndex+=1
   
    
    ghenv.Component.Params.Input[inputIndex].Name = "Run"
    ghenv.Component.Params.Input[inputIndex].NickName = "R"
    ghenv.Component.Params.Input[inputIndex].Description = "Zoom to the given bounding box."
    ghenv.Component.Params.Input[inputIndex].Optional = False
    inputIndex+=1
    
    #Outputs
    #--------------------------------------------------------------------------------------------
    outputIndex=0
    
    ghenv.Component.Params.Output[outputIndex].Name = "Finished"
    ghenv.Component.Params.Output[outputIndex].NickName = "F"
    ghenv.Component.Params.Output[outputIndex].Description = "Sends True when finished. Just to trigger other depending components."
    outputIndex+=1
    
    ghenv.Component.Params.Output[outputIndex].Name = "ScaledBoundingBox"
    ghenv.Component.Params.Output[outputIndex].NickName = "SBB"
    ghenv.Component.Params.Output[outputIndex].Description = "The scaled bounding box."
    outputIndex+=1


#Imports
#--------------------------------------------------------------------------------------------
from Rhino import RhinoDoc
from Rhino.Geometry import Box

#Solver - Run with trees to enhance performance drastically
#--------------------------------------------------------------------------------------------
if __name__ == "__main__":
    try:
        vp = RhinoDoc.ActiveDoc.Views.Find(N, False).ActiveViewport
        if R:
            box = BB
            bb = BB.BoundingBox
            bb.Inflate(S*box.X.Length,S*box.Y.Length,S*box.Z.Length)
            vp.ZoomBoundingBox(bb)
            SBB = bb
        F = True
    except:
        pass
# ---------- end zoom2bb ----------
txt = EncodeText(Text=typ_3, Mode=0)
type = Text(txt)
context_bake = ContextBake(Geometry=type)
merge_20 = Merge(Data1=door, Data2=window_2)
sdiff_2 = SolidDifference(BrepsA=merge_10, BrepsB=merge_20)
merge_21 = Merge(Data1=srf_5, Data2=filter_5, Data3=sdiff_2, Data4=srf_6)
shell_2 = Surface(merge_21)
merge_22 = Merge(Data1=volume1to500, Data2=door, Data3=window_2)
group_6 = NamedGroup(Geometry=merge_22)  # -> Group, Geometry, Name

# ---- group: Kitchen (continued)
abs_2 = Absolute(Value="-0.05")
addition_11 = Addition(A=shellthickness_m, B=abs_2)
multiplication_11 = Multiplication(A=addition_11, B="2")
subtraction_4 = Subtraction(A=height_m, B=multiplication_11)
pt_4 = ConstructPoint(XCoordinate=door_offset_wall_m, YCoordinate=filter_10, ZCoordinate=subtraction_4)
box_5 = Box2Pt(PointA=pt, PointB=pt_4, Plane=PlaneXY(0, 0, 0))
debrep_9 = DeconstructBrep(Brep=box_5)  # -> Faces, Edges, Vertices
item_27 = ListItem(List=debrep_9.Vertices, Index="1", Wrap=True)

# ----
item_28 = ListItem(List=debrep_9.Edges, Index="1", Wrap=True)
midpt_3 = CurveMiddle(Curve=item_28)
move_10 = Move(Geometry=midpt_3, Motion=Z_4)  # -> Geometry, Transform
ln_4 = Line(StartPoint=midpt_3, EndPoint=move_10.Geometry)

shellthickness = Number(amp_4)
neg_7 = Negative(Value=shellthickness)
offsetbox = OffsetBox(box=join.Breps, length=neg_7)
shellthickness_2 = Number(amp_4)
amp_5 = Amplitude(Vector=deplane.ZAxis, Amplitude=shellthickness_2)
neg_8 = Negative(Value=amp_5)
doorentranceplane_3 = Plane(doorentranceplane)
neg_9 = Negative(Value=shellthickness_2)
neg_10 = Negative(Value=amp_5)
sort_surfaces_3 = SortSurfacesByOrientation(B=offsetbox)  # -> base_2, roof_2, walls_2
extr_5 = Extrude(Base=window_2, Direction=neg_8)
extr_6 = Extrude(Base=window_2, Direction=neg_10)
offsetbox_2 = OffsetBox(box=volume, length=neg_9)
sort_surfaces_4 = SortSurfacesByOrientation(B=offsetbox_2)  # -> base_2, roof_2, walls_2
facen_2 = FaceNormals(Mesh=sort_surfaces_4.roof_2)  # -> Centers, Normals
facen_3 = FaceNormals(Mesh=sort_surfaces_4.base_2)  # -> Centers, Normals
deplane_4 = DeconstructPlane(Plane=doorentranceplane_3)  # -> Origin, XAxis, YAxis, ZAxis
cap_6 = CapHoles(Brep=extr_5)
facen_4 = FaceNormals(Mesh=sort_surfaces_3.base_2)  # -> Centers, Normals
amp_6 = Amplitude(Vector=[facen_3.Normals, facen_2.Centers], Amplitude="-0.05")
facen_5 = FaceNormals(Mesh=sort_surfaces_3.roof_2)  # -> Centers, Normals
door_4 = Surface(door)
cap_7 = CapHoles(Brep=extr_6)
extr_7 = Extrude(Base=[sort_surfaces_4.base_2, sort_surfaces_4.roof_2], Direction=amp_6)
amp_7 = Amplitude(Vector=deplane_4.YAxis, Amplitude="0.05")
amp_8 = Amplitude(Vector=[facen_4.Normals, facen_5.Centers], Amplitude="-0.05")
sdiff_3 = SolidDifference(BrepsA=offsetbox_2, BrepsB=extr_7)
merge_23 = Merge(Data1=cap_5, Data2=sdiff_3, Data3=cap_7)
extr_8 = Extrude(Base=door, Direction=amp_7)
neg_11 = Negative(Value=amp_7)
extr_9 = Extrude(Base=[sort_surfaces_3.base_2, sort_surfaces_3.roof_2], Direction=amp_8)
sdiff_4 = SolidDifference(BrepsA=offsetbox_2, BrepsB=extr_9)
merge_24 = Merge(Data1=cap_5, Data2=flatten(sdiff_4), Data3=cap_6)
join_2 = BrepJoin(Breps=merge_24)  # -> Breps, Closed
cap_8 = CapHoles(Brep=extr_8)
join_3 = BrepJoin(Breps=merge_23)  # -> Breps, Closed
sdiff_5 = SolidDifference(BrepsA=join.Breps, BrepsB=join_2.Breps)
sdiff_6 = SolidDifference(BrepsA=volume, BrepsB=join_2.Breps)
move_11 = Move(Geometry=cap_8, Motion=amp_7)  # -> Geometry, Transform
move_12 = Move(Geometry=cap_4, Motion=neg_11)  # -> Geometry, Transform
project = Project(Geometry=door_4, Plane=pl)  # -> flatten(Geometry), Transform
group_7 = NamedGroup(Geometry=project.Geometry, Name="door")  # -> Group, Geometry, Name
group_8 = NamedGroup(Geometry=move_11.Geometry, Name="door")  # -> Group, Geometry, Name
group_9 = NamedGroup(Geometry=move_12.Geometry, Name="window")  # -> Group, Geometry, Name
group_10 = NamedGroup(Geometry=move_11.Geometry, Name="door")  # -> Group, Geometry, Name
group_11 = NamedGroup(Geometry=move_12.Geometry, Name="window")  # -> Group, Geometry, Name
merge_25 = Merge(
    Data1=group.Group,
    Data2=group_2.Group,
    Data3=group_3.Group,
    Data4=group_4.Group,
    Data5=group_7.Group,
    Data7=group_5.Group)
group_12 = NamedGroup(Geometry=merge_25)  # -> Group, Geometry, Name
po = Port(por.Port)
energy_representation = Data(group_12.Group)

# ----
# Outputs   ->
#                 |
#                 v
debrep_10 = DeconstructBrep(Brep=offsetbox_2)  # -> Faces, Edges, Vertices
disc_2 = Discontinuity(Curve=debrep_10.Edges, Level=1)  # -> flatten(Points), Parameters
cullpt = CullDuplicates(Points=disc_2.Points, Tolerance=0.1, CullMode=3)  # -> Points, Indices, Valence
item_29 = ListItem(List=cullpt.Points, Index="2", Wrap=True)
item_30 = ListItem(List=cullpt.Points, Index="4", Wrap=True)  # -> Item, Item1, Item2
inner_corner_point = Point(item_29)
vec2pt_4 = Vector2Pt(PointA=item_29, PointB=item_30.Item, Unitize=False)  # -> Vector, Length
ln_5 = Line(StartPoint=item_30.Item, EndPoint=item_30.Item2)
main_direction_for_orientation_interior = Vector(vec2pt_4.Vector)

vdis = VectorDisplay(Anchor=item_29, Vector=main_direction_for_orientation_interior)

amp_9 = Amplitude(Vector=[facen_4.Normals, facen_5.Centers], Amplitude="2")
amp_10 = Amplitude(Vector=[facen_4.Normals, facen_5.Centers], Amplitude="-0.5")
extr_10 = Extrude(Base=[sort_surfaces_3.base_2, sort_surfaces_3.roof_2], Direction=amp_9)
move_13 = Move(Geometry=extr_10, Motion=amp_10)  # -> Geometry, Transform
join_4 = BrepJoin(Breps=[merge_24, move_13.Geometry])  # -> flatten(Breps), Closed
sdiff_7 = SolidDifference(BrepsA=join.Breps, BrepsB=join_4.Breps)
sort_surfaces_5 = SortSurfacesByOrientation(B=sdiff_7)  # -> base_2, roof_2, walls_2
area_5 = Area(Geometry=sort_surfaces_5.base_2)  # -> Area, Centroid
pdecon = Deconstruct(Point=area_5.Centroid)  # -> XComponent, YComponent, ZComponent
smaller = SmallerThan(FirstNumber=pdecon.ZComponent, SecondNumber="0.1")  # -> SmallerThan, OrEqualTo
cull = CullPattern(List=sort_surfaces_5.base_2, CullPattern=smaller.SmallerThan)
area_6 = Area(Geometry=cull)  # -> Area, Centroid
exerior_wall_floor_area = Data(area_6.Area)

exerior_wall_floor_area_2 = Data(exerior_wall_floor_area)
exterior_wall_construction_floor_area = Data(exerior_wall_floor_area_2)
exteriorwall = Data(cull)

join_5 = BrepJoin(Breps=[sdiff_4, cap_6])  # -> flatten(Breps), Closed
sdiff_8 = SolidDifference(BrepsA=join.Breps, BrepsB=join_5.Breps)

amp_11 = Amplitude(Vector=main_direction_for_orientation_interior, Amplitude="-1.2")
bedconstruction_line = Line(ln_5)
move_14 = Move(Geometry=bedconstruction_line, Motion=amp_11)  # -> Geometry, Transform
loft = Loft(
    Curves=[bedconstruction_line, move_14.Geometry],
    Options={Adjust=False, Closed=False, LoftEnds=0, LoftSimp=0, LoftType=0, Rebuild=10, Refit=0.01})
area_7 = Area(Geometry=loft)  # -> Area, Centroid
end_3 = EndPoints(Curve=move_14.Geometry)  # -> Start, End
extr_11 = Extrude(Base=loft, Direction=Z_3)  # -> flatten(Extrusion)
end_4 = EndPoints(Curve=bedconstruction_line)  # -> Start, End
ln_6 = Line(StartPoint=end_4.Start, EndPoint=end_3.Start)
len_2 = Length(Curve=ln_6)

sleeping = Data(loft)

# ---- group: Kitchen (continued)
subtraction_5 = Subtraction(A=length_m, B=addition_6, C=len_2, D=len, E=shellthickness_m)
filter_24 = StreamFilter(Gate=entrance_2, Stream0="10", Stream1=subtraction_5)
amp_12 = Amplitude(Vector=main_direction_for_orientation_interior, Amplitude=addition_7)
move_15 = Move(Geometry=item_29, Motion=amp_12)  # -> Geometry, Transform
amp_13 = Amplitude(Vector=main_direction_for_orientation_interior, Amplitude="0.7")
move_16 = Move(Geometry=inner_corner_point, Motion=amp_13)  # -> Geometry, Transform
vec2pt_5 = Vector2Pt(PointA=item_27, PointB=move_16.Geometry, Unitize=False)  # -> Vector, Length
move_17 = Move(Geometry=box_5, Motion=vec2pt_5.Vector)  # -> Geometry, Transform
explode_2 = ExplodeObject(Object=move_17.Geometry, Recursive=False)
item_31 = ListItem(List=explode_2, Index="1", Wrap=True)  # -> Item, Item1
facen_6 = FaceNormals(Mesh=item_31.Item1)  # -> Centers, Normals
item_32 = ListItem(List=facen_6.Normals, Index=0, Wrap=True)
amp_14 = Amplitude(Vector=item_32, Amplitude=filter_24)
extr_12 = Extrude(Base=item_31.Item1, Direction=amp_14)
sint = SolidIntersection(BrepsA=extr_12, BrepsB=offsetbox_2)  # -> flatten(Result)
edges_3 = BrepEdges(Brep=sint)  # -> Naked, Interior, NonManifold
item_33 = ListItem(List=edges_3.Interior, Index="1", Wrap=True)
end_5 = EndPoints(Curve=item_33)  # -> Start, End
vec2pt_6 = Vector2Pt(PointA=end_5.Start, PointB=move_15.Geometry, Unitize=False)  # -> Vector, Length
move_18 = Move(Geometry=sint, Motion=vec2pt_6.Vector)  # -> flatten(Geometry), Transform
filter_25 = StreamFilter(Gate=entrance_2, Stream0=sint, Stream1=move_18.Geometry)
area_8 = Area(Geometry=item_31.Item)  # -> Area, Centroid
vec2pt_7 = Vector2Pt(PointA=area_4.Centroid, PointB=area_8.Centroid, Unitize=False)  # -> Vector, Length
move_19 = Move(Geometry=sunion, Motion=vec2pt_7.Vector)  # -> Geometry, Transform
move_20 = Move(Geometry=move_19.Geometry, Motion=Z_4)  # -> Geometry, Transform
sdiff_9 = SolidDifference(BrepsA=move_17.Geometry, BrepsB=move_20.Geometry)

# ----
mirror_3 = Mirror(Geometry=extr_11, Plane=lnpt)  # -> flatten(Geometry), Transform
filter_26 = StreamFilter(Gate=mirrored_3, Stream0=extr_11, Stream1=mirror_3.Geometry)  # -> flatten(Stream)

bed = Brep(filter_26)
sleeping_floor_area = Data(flatten(area_7.Area))
sleeping_floor_area_2 = Data(sleeping_floor_area)

rotax = RotateAxis(Geometry=sdiff_9, Angle=degrees("-90"), Axis=ln_4)  # -> Geometry, Transform
edges_4 = BrepEdges(Brep=rotax.Geometry)  # -> Naked, Interior, NonManifold
item_34 = ListItem(List=edges_4.Interior, Index=0, Wrap=True)  # -> Item, Item1
end_6 = EndPoints(Curve=item_34.Item1)  # -> Start, End
vec2pt_8 = Vector2Pt(PointA=end_6.End, PointB=item_29, Unitize=False)  # -> Vector, Length
move_21 = Move(Geometry=rotax.Geometry, Motion=vec2pt_8.Vector)  # -> Geometry, Transform

# ---- group: Kitchen
mirror_4 = Mirror(Geometry=filter_25, Plane=lnpt)  # -> flatten(Geometry), Transform
filter_27 = StreamFilter(Gate=mirrored_3, Stream0=filter_25, Stream1=mirror_4.Geometry)  # -> flatten(Stream)

# ----
filter_28 = StreamFilter(Gate=entrance_2, Stream0=sdiff_9, Stream1=move_21.Geometry)

# ---- group: Kitchen
mirror_5 = Mirror(Geometry=filter_28, Plane=lnpt)  # -> flatten(Geometry), Transform
filter_29 = StreamFilter(Gate=mirrored_3, Stream0=filter_28, Stream1=mirror_5.Geometry)  # -> flatten(Stream)

# ----
kitchen = Data(filter_29)
wardrobe = Brep(filter_27)

explode_3 = ExplodeObject(Object=filter_25, Recursive=False)
item_35 = ListItem(List=explode_3, Index=filter_9, Wrap=True)
area_9 = Area(Geometry=item_35)  # -> Area, Centroid

living_room_2 = Data(item_35)

# ---- group: Kitchen (continued)
debrep_11 = DeconstructBrep(Brep=sdiff_9)  # -> Faces, Edges, Vertices
vec_3 = Vector(bedconstruction_line)
item_36 = ListItem(List=debrep_11.Edges, Index="9", Wrap=True)  # -> Item, Item1
amp_15 = Amplitude(Vector=vec_3, Amplitude="3")
extr_13 = Extrude(Base=item_36.Item1, Direction=amp_15)
extr_14 = Extrude(Base=item_36.Item, Direction=amp_15)
neg_12 = Negative(Value=amp_15)
amp_16 = Amplitude(Vector=neg_12, Amplitude="0.5")
move_22 = Move(Geometry=[extr_14, extr_13], Motion=amp_16)  # -> Geometry, Transform
move_23 = Move(Geometry=move_22.Geometry, Motion=Z_5)  # -> flatten(Geometry), Transform
item_37 = ListItem(List=move_23.Geometry, Index=0, Wrap=True)  # -> Item, Item1

# ----
debrep_12 = DeconstructBrep(Brep=move_21.Geometry)  # -> Faces, Edges, Vertices
item_38 = ListItem(List=debrep_12.Edges, Index="10", Wrap=True)
explode_4 = ExplodeObject(Object=offsetbox_2, Recursive=False)
move_24 = Move(Geometry=item_38, Motion=amp_12)  # -> Geometry, Transform
vec_4 = Vector(bedconstruction_line)
sort_surfaces_6 = SortSurfacesByOrientation(B=explode_4)  # -> base_2, roof_2, walls_2
extr_15 = Extrude(Base=move_24.Geometry, Direction=vec_4)

move_25 = Move(Geometry=item_30.Item, Motion=amp_11)  # -> Geometry, Transform
vec_5 = Vector(move_14.Geometry)
rotate_2 = RotateDirection(Geometry=desk, Center=item_20, From=vec_5, To=vec2pt_3.Vector)  # -> Geometry, Transform
vec2pt_9 = Vector2Pt(PointA=item_20, PointB=move_25.Geometry, Unitize=False)  # -> Vector, Length
move_26 = Move(Geometry=rotate_2.Geometry, Motion=vec2pt_9.Vector)  # -> flatten(Geometry), Transform

mirror_6 = Mirror(Geometry=move_26.Geometry, Plane=lnpt)  # -> flatten(Geometry), Transform
filter_30 = StreamFilter(Gate=mirrored_3, Stream0=move_26.Geometry, Stream1=mirror_6.Geometry)

desk_placed = Brep(filter_30)

sdiff_10 = SolidDifference(BrepsA=filedge_2, BrepsB=sdiff_8)
bathvolume = Brep(sdiff_10)
mirror_7 = Mirror(Geometry=sdiff_10, Plane=lnpt)  # -> flatten(Geometry), Transform
debrep_13 = DeconstructBrep(Brep=sdiff_10)  # -> Faces, Edges, Vertices
item_39 = ListItem(List=debrep_13.Faces, Index=0, Wrap=True)
floorareabath = Surface(item_39)
item_40 = ListItem(List=debrep_13.Faces, Index="4", Wrap=True)
disc_3 = Discontinuity(Curve=item_40, Level=1)  # -> Points, Parameters
filter_31 = StreamFilter(Gate=mirrored_3, Stream0=sdiff_10, Stream1=mirror_7.Geometry)
sort_surfaces_7 = SortSurfacesByOrientation(B=debrep_13.Faces)  # -> base_2, roof_2, walls_2
item_41 = ListItem(List=disc_3.Points, Index="2", Wrap=True)  # -> Item, Item1, Item2
floorbath = Surface(sort_surfaces_7.base_2)
item_42 = ListItem(List=sort_surfaces_7.walls_2, Index="2", Wrap=True)  # -> Item, Item1, Item2, Item3, Item4
item_43 = ListItem(List=sort_surfaces_7.walls_2, Index=panel_17, Wrap=True)
pl_3pt = Plane3Pt(PointA=item_41.Item, PointB=item_41.Item1, PointC=item_41.Item2)
merge_26 = Merge(Data1=item_42.Item3, Data2=item_42.Item4)
merge_27 = Merge(Data1=item_42.Item, Data2=item_42.Item1, Data3=item_42.Item2)
facen_7 = FaceNormals(Mesh=item_43)  # -> Centers, flatten(Normals)
rectangle_5 = Rectangle(Plane=pl_3pt, XSize="2", YSize="0.6", Radius=0)  # -> Rectangle, Length
area_10 = Area(Geometry=merge_26)  # -> Area, graft(Centroid)
facen_8 = FaceNormals(Mesh=merge_26)  # -> Centers, Normals
facen_9 = FaceNormals(Mesh=merge_27)  # -> Centers, Normals
bathdoor = Surface(flatten(rectangle_5.Rectangle))
facen_10 = FaceNormals(Mesh=bathdoor)  # -> Centers, Normals
item_44 = ListItem(List=facen_7.Normals, Index=0, Wrap=True)  # -> Item, Item1, Item2
cp = ClosestPoint(Point=area_10.Centroid, Cloud=facen_8.Centers)  # -> flatten(ClosestPoint), CPIndex, Distance
item_45 = ListItem(List=facen_9.Normals, Index=0, Wrap=True)  # -> flatten(Item)
item_46 = ListItem(List=facen_10.Normals, Index=0, Wrap=True)
amp_17 = Amplitude(Vector=item_46, Amplitude="-0.03")
item_47 = ListItem(List=facen_8.Normals, Index=cp.CPIndex, Wrap=True)  # -> flatten(Item)
amp_18 = Amplitude(Vector=item_46, Amplitude=neg_3)
amp_19 = Amplitude(Vector=item_45, Amplitude=neg_3)
amp_20 = Amplitude(Vector=item_47, Amplitude=neg_3)
extr_16 = Extrude(Base=bathdoor, Direction=amp_18)
amp_21 = Amplitude(Vector=[item_44.Item, item_44.Item2], Amplitude="-0.07")
extr_17 = Extrude(Base=merge_27, Direction=amp_19)
extr_18 = Extrude(Base=merge_26, Direction=amp_20)
extr_19 = Extrude(Base=item_43, Direction=amp_21)
merge_28 = Merge(Data1=extr_19, Data2=extr_17, Data3=extr_18)
sunion_2 = SolidUnion(Breps=merge_28)
sort_surfaces_8 = SortSurfacesByOrientation(B=sunion_2)  # -> base_2, roof_2, walls_2
item_48 = ListItem(List=sort_surfaces_8.walls_2, Index=panel_18, Wrap=True)
edges_5 = BrepEdges(Brep=item_48)  # -> flatten(Naked), Interior, NonManifold
end_7 = EndPoints(Curve=edges_5.Naked)  # -> Start, End
end_8 = EndPoints(Curve=edges_5.Naked)  # -> Start, End
pdecon_2 = Deconstruct(Point=end_7.Start)  # -> XComponent, YComponent, ZComponent
pdecon_3 = Deconstruct(Point=end_7.End)  # -> XComponent, YComponent, ZComponent
item_49 = ListItem(List=end_8.End, Index="1", Wrap=True)
item_50 = ListItem(List=end_8.Start, Index="23", Wrap=True)
smaller_2 = SmallerThan(FirstNumber=pdecon_3.ZComponent, SecondNumber="0.1")  # -> SmallerThan, OrEqualTo
smaller_3 = SmallerThan(FirstNumber=pdecon_2.ZComponent, SecondNumber="0.1")  # -> SmallerThan, OrEqualTo
ln_7 = Line(StartPoint=item_49, EndPoint=item_50)
and_4 = GateAnd(A=smaller_3.SmallerThan, B=smaller_2.SmallerThan)
dispatch = Dispatch(List=edges_5.Naked, DispatchPattern=and_4)  # -> ListA, ListB
boundary = BoundarySurfaces(Edges=[dispatch.ListA, ln_7])
area_11 = Area(Geometry=boundary)  # -> Area, Centroid
useablefloorarea_bath = Data(area_11.Area)

sanitary_floor_area = Data(useablefloorarea_bath)
sanitary = Data(boundary)

# ---- group: Kitchen (continued)
merge_29 = Merge(Data1=bathvolume, Data2=bed, Data3=sint)  # -> flatten(Result)
move_27 = Move(Geometry=merge_29, Motion=Z_5)  # -> Geometry, Transform
trim_10 = TrimSolid(Shape=sort_surfaces_6.base_2, Cutters=move_27.Geometry)  # -> flatten(Result)
split_2 = SplitBrep(Brep=trim_10, Cutter=item_37.Item)
item_51 = ListItem(List=split_2, Index=0, Wrap=True)  # -> Item, Item1
split_3 = SplitBrep(Brep=item_51.Item, Cutter=item_37.Item1)
area_12 = Area(Geometry=item_51.Item1)  # -> Area, Centroid
item_52 = ListItem(List=split_3, Index=0, Wrap=True)  # -> Item, Item1
area_13 = Area(Geometry=item_52.Item)  # -> Area, Centroid
area_14 = Area(Geometry=item_52.Item1)  # -> Area, Centroid

# ----
living_room_1 = Data(item_52.Item)
circulation = Data(item_51.Item1)
kitchen_1 = Data(item_52.Item1)
merge_30 = Merge(Data1=sleeping, Data2=living_room_1, Data3=sanitary, Data4=kitchen_1, Data5=circulation, Data6=living_room_2)  # -> flatten(Result)
all_surfaces_for_the_net_floor_area = Data(merge_30)

addition_12 = Addition(A=area_9.Area, B=area_13.Area)

living_room_floor_area = Data(addition_12)

merge_31 = Merge(Data1=bathvolume, Data2=bed)  # -> flatten(Result)
move_28 = Move(Geometry=merge_31, Motion=Z_7)  # -> Geometry, Transform
trim_11 = TrimSolid(Shape=sort_surfaces_6.base_2, Cutters=move_28.Geometry)
split_4 = SplitBrep(Brep=trim_11, Cutter=extr_15)
item_53 = ListItem(List=split_4, Index=0, Wrap=True)  # -> Item, Item1
area_15 = Area(Geometry=item_53.Item)  # -> Area, Centroid
area_16 = Area(Geometry=item_53.Item1)  # -> Area, Centroid

filter_32 = StreamFilter(Gate=entrance_2, Stream0=living_room_floor_area, Stream1=area_16.Area)
filter_33 = StreamFilter(Gate=entrance_2, Stream0=area_14.Area, Stream1=area_15.Area)
kitchen_floor_area = Data(filter_33)
kitchen_floor_area_2 = Data(kitchen_floor_area)
living_room_floor_area_2 = Data(filter_32)
living_room_floor_area_3 = Data(living_room_floor_area_2)
circulation_living_floor_area = Data(area_12.Area)
filter_34 = StreamFilter(Gate=entrance_2, Stream0=circulation_living_floor_area, Stream1="0")  # -> flatten(Stream)
circulation_living_floor_area_2 = Data(filter_34)
addition_13 = Addition(
    A=living_room_floor_area_3,
    B=kitchen_floor_area_2,
    C=sanitary_floor_area,
    D=circulation_living_floor_area_2,
    E=outdoor_seating_floor_area,
    F=storage_living_floor_area,
    G=sleeping_floor_area_2)
living_floor_area = Data(addition_13)
addition_14 = Addition(
    A=living_floor_area,
    B=common_room_floor_area,
    C=break_room_floor_area,
    D=waiting_room_floor_area,
    E=dining_room_floor_area,
    F=detention_room_floor_area)
living_and_staying_floor_area = Data(addition_14)
addition_15 = Addition(
    A=living_and_staying_floor_area,
    B=office_work_floor_area,
    C=production_experiments_work_floor_area,
    D=storage_distribution_sales_floor_area,
    E=education_culture_instruction_floor_are,
    F=healing_and_care_floor_area,
    G=other_usable_floor_are)
usable_floor_area = Data(addition_15)
addition_16 = Addition(A=usable_floor_area, B=technical_floor_area, C=circulation_floor_area)
net_floor_area = Data(addition_16)
mirror_8 = Mirror(Geometry=bathdoor, Plane=lnpt)  # -> flatten(Geometry), Transform
filter_35 = StreamFilter(Gate=mirrored_3, Stream0=bathdoor, Stream1=mirror_8.Geometry)

extr_20 = Extrude(Base=bathdoor, Direction=amp_17)  # -> flatten(Extrusion)
mirror_9 = Mirror(Geometry=extr_20, Plane=lnpt)  # -> flatten(Geometry), Transform
filter_36 = StreamFilter(Gate=mirrored_3, Stream0=extr_20, Stream1=mirror_9.Geometry)

sdiff_11 = SolidDifference(BrepsA=sunion_2, BrepsB=extr_16)  # -> flatten(Result)
mirror_10 = Mirror(Geometry=sdiff_11, Plane=lnpt)  # -> flatten(Geometry), Transform
filter_37 = StreamFilter(Gate=mirrored_3, Stream0=sdiff_11, Stream1=mirror_10.Geometry)

doorbath = Brep(filter_36)
bath = Brep(filter_37)
sort_surfaces_9 = SortSurfacesByOrientation(B=bath)  # -> base_2, roof_2, walls_2
area_17 = Area(Geometry=sort_surfaces_9.base_2)  # -> Area, Centroid
pdecon_4 = Deconstruct(Point=area_17.Centroid)  # -> XComponent, YComponent, ZComponent
smaller_4 = SmallerThan(FirstNumber=pdecon_4.ZComponent, SecondNumber="0.1")  # -> SmallerThan, OrEqualTo
dispatch_2 = Dispatch(List=sort_surfaces_9.base_2, DispatchPattern=smaller_4.SmallerThan)  # -> ListA, ListB
area_18 = Area(Geometry=dispatch_2.ListB)  # -> Area, Centroid
join_6 = BrepJoin(Breps=dispatch_2.ListA)  # -> Breps, Closed
area_19 = Area(Geometry=join_6.Breps)  # -> Area, Centroid
addition_17 = Addition(A=area_19.Area, B=area_18.Area)
wall_area_bath = Data(addition_17)

wall_area_bath_2 = Data(wall_area_bath)
interior_wall_construction_floor_area = Data(wall_area_bath_2)
interiorwall_1 = Data(dispatch_2.ListA)
interiorwall_1_2 = Data(dispatch_2.ListB)
merge_32 = Merge(Data1=interiorwall_1, Data2=interiorwall_1_2, Data3=exteriorwall)  # -> flatten(Result)
addition_18 = Addition(
    A=exterior_wall_construction_floor_area,
    B=interior_wall_construction_floor_area,
    C=partition_wall_floor_area,
    D=column_floor_area,
    E=shaft_floor_area,
    F=beam_floor_area,
    G=other_construction_floor_area)
construction_floor_area = Data(addition_18)
all_surfaces_for_construction_floor_area = Data(merge_32)
addition_19 = Addition(A=net_floor_area, B=construction_floor_area)  # -> flatten(Result)
gross_floor_area_3 = Data(addition_19)
panel_21 = Panel(gross_floor_area_3)

area_20 = Area(Geometry=item_53.Item1)  # -> Area, Centroid
vec2pt_10 = Vector2Pt(PointA=midpt_2, PointB=area_20.Centroid, Unitize=False)  # -> Vector, Length

amp_22 = Amplitude(Vector=vec2pt_10.Vector, Amplitude="0.65")

move_29 = Move(Geometry=stool, Motion=amp_22)  # -> flatten(Geometry), Transform

mirror_11 = Mirror(Geometry=move_29.Geometry, Plane=lnpt)  # -> flatten(Geometry), Transform
filter_38 = StreamFilter(Gate=mirrored_3, Stream0=move_29.Geometry, Stream1=mirror_11.Geometry)

stool_placed = Brep(filter_38)

bath_2 = Brep(bath)
merge_33 = Merge(Data1=filter_31, Data2=sdiff_5)  # -> flatten(Result)
merge_34 = Merge(Data1=bath_2, Data2=sdiff_6)
sunion_3 = SolidUnion(Breps=merge_34)
group_13 = NamedGroup(Geometry=sort_surfaces_7.walls_2, Name="inner walls")  # -> Group, Geometry, Name
group_14 = NamedGroup(Geometry=merge_33, Name="shell")  # -> Group, Geometry, Name
group_15 = NamedGroup(Geometry=filter_35, Name="DoorBath")  # -> Group, Geometry, Name
group_16 = NamedGroup(Geometry=sunion_3, Name="shell")  # -> Group, Geometry, Name
group_17 = NamedGroup(Geometry=doorbath, Name="DoorBath")  # -> Group, Geometry, Name
group_18 = NamedGroup(Geometry=kitchen, Name="Kitchen")  # -> Group, Geometry, Name
group_19 = NamedGroup(Geometry=wardrobe, Name="Wardrobe")  # -> Group, Geometry, Name
group_20 = NamedGroup(Geometry=bed, Name="Bed")  # -> Group, Geometry, Name
group_21 = NamedGroup(Geometry=desk_placed, Name="desk")  # -> Group, Geometry, Name
group_22 = NamedGroup(Geometry=stool_placed, Name="stool")  # -> Group, Geometry, Name
merge_35 = Merge(
    Data1=group_10.Group,
    Data2=group_16.Group,
    Data3=group_11.Group,
    Data4=group_17.Group,
    Data5=group_18.Group,
    Data6=group_19.Group,
    Data7=group_20.Group,
    Data8=group_21.Group,
    Data9=group_22.Group)
merge_36 = Merge(Data1=group_8.Group, Data2=group_14.Group, Data3=group_9.Group, Data4=group_15.Group)
merge_37 = Merge(
    Data1=project.Geometry,
    Data2=window_2,
    Data3=join.Breps,
    Data4=cull_i,
    Data5=kitchen,
    Data6=wardrobe,
    Data7=bed,
    Data8=desk_placed,
    Data9=stool_placed)
wires = BrepWireframe(Brep=merge_37, Density=-1)  # -> flatten(Wireframe)
group_23 = NamedGroup(Geometry=merge_36)  # -> Group, Geometry, Name
group_24 = NamedGroup(Geometry=merge_35)  # -> Group, Geometry, Name
merge_38 = Merge(
    Data1=join.Breps,
    Data2=wires,
    Data3=cull_i,
    Data4=rectangle_5.Rectangle,
    Data5=kitchen,
    Data6=wardrobe,
    Data7=bed,
    Data8=desk_placed,
    Data9=stool_placed)  # -> flatten(Result)
typ_4 = OppinionatedType(
    path=dir,
    na="Capsule",
    description=data,
    variant=data_2,
    de=group_23.Group,
    paper=merge_38,
    collider=collider_2,
    volume=group_6.Group,
    group=group_24.Group,
    rp=rep.Representation,
    po=po,
    authors=au,
    qualities=ql,
    ex=and)  # -> ty_2, ba_2

geo = PreviewGeometry(geo=group_24.Group, sc=1)

# ==== cluster _2D
x = ClusterInput()
expression = Expression(x=x, Expression="x/2")
neg = Negative(Value=expression)
dom = ConstructDomain(DomainStart=neg, DomainEnd=expression)
I = ClusterOutput(dom)

# ==== cluster ValueOr0
value = ClusterInput()
value_2 = Number(value)
null = NullItem(Item=value_2)  # -> NullFlags, InvalidFlags, Description
filter = StreamFilter(Gate=null.NullFlags, Stream0=value_2, Stream1="0")
valueor0 = Number(filter)
valueor0_2 = ClusterOutput(valueor0)

# ==== cluster PreviewPlane: Preview a plane with axis colors and naming.
axis_length = ClusterInput()
plane = ClusterInput()
axis_length_2 = Number(axis_length)
plane_2 = Plane(plane)
deplane = DeconstructPlane(Plane=plane_2)  # -> Origin, XAxis, YAxis, ZAxis
line = LineSDL(Start=deplane.Origin, Direction=deplane.YAxis, Length=axis_length_2)
line_2 = LineSDL(Start=deplane.Origin, Direction=deplane.XAxis, Length=axis_length_2)
line_3 = LineSDL(Start=deplane.Origin, Direction=deplane.ZAxis, Length=axis_length_2)
swatch = ColourSwatch(SwatchColor=RGB(235, 52, 79))
swatch_2 = ColourSwatch(SwatchColor=RGB(0, 166, 157))
swatch_3 = ColourSwatch(SwatchColor=RGB(240, 117, 24))
end = EndPoints(Curve=line_2)  # -> Start, End
end_2 = EndPoints(Curve=line)  # -> Start, End
end_3 = EndPoints(Curve=line_3)  # -> Start, End
tag = TextTag(Location=end.End, Text="X", Colour=swatch)
tag_2 = TextTag(Location=end_2.End, Text="Y", Colour=swatch_2)
tag_3 = TextTag(Location=end_3.End, Text="Z", Colour=swatch_3)
preview = CustomPreview(Geometry=line_2, Material=swatch)
preview_2 = CustomPreview(Geometry=line, Material=swatch_2)
preview_3 = CustomPreview(Geometry=line_3, Material=swatch_3)

# ==== cluster ViewRectangle
view = ClusterInput()
view_2 = Data(view)
nickname = NAME(view=view_2)  # -> c, x, y, z, h, w
# ---------- nickname: Python ----------
uselss, c, x, y, z = view.GetCameraFrame()
h = view.FrustumHeight
w = view.FrustumWidth
# ---------- end nickname ----------
rev = Reverse(Vector=nickname.x)
rev_2 = Reverse(Vector=nickname.y)
pl = ConstructPlane(Origin=nickname.c, XAxis=rev, YAxis=nickname.y)
_2d = _2D(x=nickname.w)
_2d_2 = _2D(x=nickname.h)
rectangle = Rectangle(Plane=pl, XSize=_2d, YSize=_2d_2, Radius=0)  # -> Rectangle, Length
rec = Rectangle(rectangle.Rectangle)
rec_2 = ClusterOutput(rec)

# ==== cluster ExportBlock: Export geometry with layer names to a file.
path = ClusterInput()
name = ClusterInput()
url = ClusterInput()
geo = ClusterInput()
layer_name = ClusterInput()
export = ClusterInput()
path_2 = FilePath(path)
name_2 = Text(name)
url_2 = Text(url)
geo_2 = Geometry(geo)
layer_name_2 = Text(layer_name)
export_2 = Boolean(export)
layer = ModelLayer(Name=layer_name_2)  # -> Layer, Name, Hidden, Locked, DisplayColour, Material, Linetype
object = ModelObject(Geometry=geo_2, Layer=layer.Layer)  # -> Object, Geometry, Name, Layer, Visibility, Display, Drafting, Render
block_definition = ModelBlockDefinition(Objects=object.Object, Name=name_2, URL=url_2)  # -> BlockDefinition, Objects, Units, Name, Notes, URL, URLDescription
export_definition = ExportModelBlockDefinition(BlockDefinition=block_definition.BlockDefinition, FilePath=path_2, Overwrite="T", Export=export_2)  # -> BlockDefinition, FilePath, Exported
block_definition_2 = ModelBlockDefinition(export_definition.BlockDefinition)
path_3 = FilePath(export_definition.FilePath)
exported = Boolean(export_definition.Exported)
path_4 = ClusterOutput(path_3)
exported_2 = ClusterOutput(exported)
block_definition_3 = ClusterOutput(block_definition_2)

# ==== cluster PreviewGeometry: Preview geometry by ungrouping everything, showing light surfaces and dark edges.
sc = ClusterInput()
geo = ClusterInput()
geo_2 = Geometry(flatten(geo))
sc_2 = Number(sc)
expression = Expression(x=sc_2, Expression="x+1")
swatch = ColourSwatch(SwatchColor=RGB(0, 0, 0))
swatch_2 = ColourSwatch(SwatchColor=RGB(255, 255, 255))
ungroup = Ungroup(Group=geo_2)
ungroup_2 = Ungroup(Group=ungroup)
ungroup_3 = Ungroup(Group=ungroup_2)
ungroup_4 = Ungroup(Group=ungroup_3)
log = Logarithm(Value=expression)
clean = CleanTree(RemoveNulls=True, RemoveInvalid=True, RemoveEmpty=invert(False), Tree=ungroup_4)  # -> flatten(Tree)
multiplication = Multiplication(A=log, B=Slider(0.05, range=0..1))
linetype = ModelLinetype(Name="semio", Width=multiplication)  # -> ModelLinetype, Name, Segments, CapStyle, JoinStyle, Width, WidthUnits, TaperWidths, TaperPositions
dispatch = CSharpScript(D=clean)  # -> P, C, B, M, R
# ---------- dispatch: C# ----------
// Grasshopper Script Instance
#region Usings
using System;
using System.Linq;
using System.Collections;
using System.Collections.Generic;
using System.Drawing;

using Rhino;
using Rhino.Geometry;

using Grasshopper;
using Grasshopper.Kernel;
using Grasshopper.Kernel.Data;
using Grasshopper.Kernel.Types;
#endregion

public class Script_Instance : GH_ScriptInstance
{
    #region Notes
    /* 
      Members:
        RhinoDoc RhinoDocument
        GH_Document GrasshopperDocument
        IGH_Component Component
        int Iteration

      Methods (Virtual & overridable):
        Print(string text)
        Print(string format, params object[] args)
        Reflect(object obj)
        Reflect(object obj, string method_name)
    */
    #endregion

    private void RunScript(
	object D,
	ref object P,
	ref object C,
	ref object B,
	ref object M,
	ref object R)
    {
        if (D is Curve) C = D; // Curve
        else if (
            D is Rhino.Geometry.Point ||
            D is PointCloud
            )
            P = D; // Point
        else if ( D is Mesh) M = D; // Mesh
        else if (
            D is Surface ||
            D is Extrusion ||
            D is SubD ||
            D is Brep
            )
            B = D; // Brep
        else R = D; // Rest
            
    }
}
# ---------- end dispatch ----------
clean_2 = CleanTree(RemoveNulls=True, RemoveInvalid=True, RemoveEmpty=False, Tree=dispatch.M)
clean_3 = CleanTree(RemoveNulls=True, RemoveInvalid=True, RemoveEmpty=False, Tree=dispatch.R)
clean_4 = CleanTree(RemoveNulls=True, RemoveInvalid=True, RemoveEmpty=False, Tree=dispatch.B)
clean_5 = CleanTree(RemoveNulls=True, RemoveInvalid=True, RemoveEmpty=False, Tree=dispatch.P)
clean_6 = CleanTree(RemoveNulls=True, RemoveInvalid=True, RemoveEmpty=False, Tree=dispatch.C)
debrep = DeconstructBrep(Brep=clean_4)  # -> Faces, Edges, Vertices
preview = CustomPreview(Geometry=flatten(clean_5), Material=swatch)
preview_2 = CustomPreview(Geometry=flatten(debrep.Faces), Material=swatch_2)
preview_3 = CustomPreview(Geometry=flatten(clean_2), Material=swatch_2)
preview_4 = CustomPreview(Geometry=flatten(clean_3), Material=swatch)
curve_preview = CustomCurvePreview(Curve=clean_6, Linetype=linetype.ModelLinetype, Colour=swatch)
curve_preview_2 = CustomCurvePreview(Curve=debrep.Edges, Linetype=linetype.ModelLinetype, Colour=swatch)

# ==== cluster PreviewPort: Preview a port by showing the point and direction and if exists: id, family and compatible families.
po = ClusterInput()
sc = ClusterInput()
sc_2 = Number(sc)
po_2 = Port(po)
por = ModelPort(Port=po_2)  # -> Port, Valid, Id, Description, Mandatory, Family, CompatibleFamilies, Point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
swatch = ColourSwatch(SwatchColor=RGB(235, 52, 79))
swatch_2 = ColourSwatch(SwatchColor=RGB(250, 149, 0))
amp = Amplitude(Vector=por.Direction, Amplitude=sc_2)
lng = ListLength(List=por.CompatibleFamilies)
expression = Expression(x=por.Family, Expression="x=\"\"")
cull = CullPattern(List=por.Point, CullPattern=expression)
expression_2 = Expression(x=lng, Expression="x=0")
join = TextJoin(Text=por.CompatibleFamilies, Join=",")
expression_3 = Expression(x=sc_2, Expression="x+1")
merge = Merge(Data1=":")
trim = TrimTree(Tree=join, Depth=1)
trim_2 = TrimTree(Tree=expression_2, Depth=1)
log = Logarithm(Value=expression_3)
item = ListItem(List=merge, Index=expression, Wrap=invert(True))
concat = Concatenate(FragmentA="[", FragmentB=trim, FragmentC="]")
expression_4 = Expression(y=trim_2, Expression="x")
merge_2 = Merge(Data1=graft(concat), Data2=graft(expression_4))
item_2 = ListItem(List=merge_2, Index=graft(expression), Wrap=invert(True))
multiplication = Multiplication(A=log, B=Slider(2, range=0..10))
trim_3 = TrimTree(Tree=item_2, Depth=1)
concat_2 = Concatenate(FragmentA=por.Id, FragmentB=item, FragmentC=por.Family, FragmentD=trim_3)
preview = CustomPreview(Geometry=cull, Material=swatch)
tag = TextTag(Location=por.Point, Text=concat_2, Colour=swatch)
vdisex = VectorDisplayEx(Point=por.Point, Vector=amp, Colour=ColourSwatch(SwatchColor=RGB(0, 166, 157)), Width=multiplication)

# ==== cluster OppinionatedType: Construct a type following the oppinionated conventions of semio. All representations are saved under representations folder where each representation is saved once natively (.3dm) and once exported (.glb). Further a collider representation is required. All names and file names are standardized.
emoji = Panel("")
name = Panel("Default")
abbreviation = Panel("Dft?")
nn = Panel("De")
prm = ModelParam(Na=name, NN=nn, Dc="The optional default representation geometry group.", Op=Toggle(True), Ru=Toggle(True))  # -> Param, Name, NickName, Description, Optional, Success; inputs Pr: tree, Op: Boolean, Ru: Boolean
# ---------- prm: Python ----------
#Component Information
#--------------------------------------------------------------------------------------------
if ghenv.Component.RunCount<2:
    #General
    #--------------------------------------------------------------------------------------------
    __author__ = "Ueli Saluz"
    __version__ = "2025.06.18"
    
    ghenv.Component.Name = "Model Param"
    ghenv.Component.NickName = "~Prm"
    ghenv.Component.Description = "Deconstruct or modify a param."
    ghenv.Component.Message = "VER 1.0"
    ghenv.Component.Category = "semio"
    ghenv.Component.SubCategory = "Scripting"
    
     #Inputs
    #--------------------------------------------------------------------------------------------
    inputIndex=0
    
    ghenv.Component.Params.Input[inputIndex].Name = "Param"
    ghenv.Component.Params.Input[inputIndex].NickName = "Pr"
    ghenv.Component.Params.Input[inputIndex].Description = "Connect the param to desconstruct or modify here with one wire."
    ghenv.Component.Params.Input[inputIndex].Optional = False
    inputIndex+=1

    ghenv.Component.Params.Input[inputIndex].Name = "Name"
    ghenv.Component.Params.Input[inputIndex].NickName = "Na"
    ghenv.Component.Params.Input[inputIndex].Description = "Name of the param."
    ghenv.Component.Params.Input[inputIndex].Optional = False
    inputIndex+=1
    
    ghenv.Component.Params.Input[inputIndex].Name = "NickName"
    ghenv.Component.Params.Input[inputIndex].NickName = "NN"
    ghenv.Component.Params.Input[inputIndex].Description = "Nickname of the param."
    ghenv.Component.Params.Input[inputIndex].Optional = False
    inputIndex+=1
    
    ghenv.Component.Params.Input[inputIndex].Name = "Description"
    ghenv.Component.Params.Input[inputIndex].NickName = "Dc"
    ghenv.Component.Params.Input[inputIndex].Description = "Description of the param."
    ghenv.Component.Params.Input[inputIndex].Optional = True
    inputIndex+=1
    
    ghenv.Component.Params.Input[inputIndex].Name = "Optional"
    ghenv.Component.Params.Input[inputIndex].NickName = "Op"
    ghenv.Component.Params.Input[inputIndex].Description = "Wheather the param is optional."
    ghenv.Component.Params.Input[inputIndex].Optional = True
    inputIndex+=1
    
    ghenv.Component.Params.Input[inputIndex].Name = "Run"
    ghenv.Component.Params.Input[inputIndex].NickName = "Ru"
    ghenv.Component.Params.Input[inputIndex].Description = "Modify the param."
    ghenv.Component.Params.Input[inputIndex].Optional = True
    inputIndex+=1
    
    #Outputs
    #--------------------------------------------------------------------------------------------
    outputIndex=0
    
    ghenv.Component.Params.Output[outputIndex].Name = "Param"
    ghenv.Component.Params.Output[outputIndex].NickName = "Param"
    ghenv.Component.Params.Output[outputIndex].Description = "The desconstruct or modified param"
    ghenv.Component.Params.Output[outputIndex].Optional = False
    outputIndex+=1
    
    ghenv.Component.Params.Output[outputIndex].Name = "Name"
    ghenv.Component.Params.Output[outputIndex].NickName = "Name"
    ghenv.Component.Params.Output[outputIndex].Description = "Name of the param."
    ghenv.Component.Params.Output[outputIndex].Optional = False
    outputIndex+=1
    
    ghenv.Component.Params.Output[outputIndex].Name = "NickName"
    ghenv.Component.Params.Output[outputIndex].NickName = "NickName"
    ghenv.Component.Params.Output[outputIndex].Description = "Nickname of the param."
    ghenv.Component.Params.Output[outputIndex].Optional = False
    outputIndex+=1
    
    ghenv.Component.Params.Output[outputIndex].Name = "Description"
    ghenv.Component.Params.Output[outputIndex].NickName = "Description"
    ghenv.Component.Params.Output[outputIndex].Description = "Description of the param."
    ghenv.Component.Params.Output[outputIndex].Optional = True
    outputIndex+=1
    
    ghenv.Component.Params.Output[outputIndex].Name = "Optional"
    ghenv.Component.Params.Output[outputIndex].NickName = "Optional"
    ghenv.Component.Params.Output[outputIndex].Description = "Wheather the param is optional."
    ghenv.Component.Params.Output[outputIndex].Optional = True
    outputIndex+=1
    
    ghenv.Component.Params.Output[outputIndex].Name = "Success"
    ghenv.Component.Params.Output[outputIndex].NickName = "Success"
    ghenv.Component.Params.Output[outputIndex].Description = "Wheather the operation was successful."
    ghenv.Component.Params.Output[outputIndex].Optional = False
    outputIndex+=1

input = ghenv.Component.Params.Input[0]
param = input.Sources[0]
if Ru:
    if Na:
        param.Name = Na
    if NN:
        param.NickName = NN
    if Dc:
        param.Description = Dc
    if Op:
        param.Optional = Op
    Success = True
else:
    Success = False
Param = param
Name = param.Name
NickName = param.NickName
Description = param.Description
Optional = param.Optional
# ---------- end prm ----------
concat = Concatenate(FragmentA="\"", FragmentB=prm.Description, FragmentC="\"")
merge = Merge(Data1=emoji, Data2=prm.NickName, Data3=abbreviation, Data4=prm.Name, Data5=concat)
join = TextJoin(Text=merge, Join=",")
de = ClusterInput()
paper = ClusterInput()
panel = Panel(join)
path = ClusterInput()
na = ClusterInput()
description = ClusterInput()
variant = ClusterInput()
rp = ClusterInput()
collider = ClusterInput()
volume = ClusterInput()
ex = ClusterInput()
group = ClusterInput()
po = ClusterInput()
authors = ClusterInput()
qualities = ClusterInput()
sep = Separator()  # -> S; same code as sep
path_2 = FilePath(path)
na_2 = Name(na)
description_2 = Description(description)
variant_2 = Variant(variant)
de_2 = Default(de)
rp_2 = Representation(rp)
volume_2 = Volume(volume)
group_2 = Group(group)
paper_2 = Paper(paper)
collider_2 = Collider(collider)
authors_2 = Authors(authors)
qualities_2 = Qualities(qualities)
po_2 = Port(po)
ex_2 = Export(ex)
merge_2 = Merge(Data1=de_2, Data2=paper_2, Data3=collider_2, Data4=volume_2)
rep = ModelRepresentation(Representation=rp_2)  # -> Representation, Valid, Url, Description, Tags, Qualities
rep_2 = ReplaceText(Text=variant_2, Find="/", Replace="slash", RecursiveReplace=False)
txt = NormalizeText(Text=na_2)  # -> Strict, Title, Underscore, Kebab, Pascal
split = SplitList(List=rep.Tags, Index="1")  # -> ListA, ListB
rep_3 = ReplaceText(Text=rep_2, Find="\", Replace="backslash", RecursiveReplace=False)
panel_2 = Panel(rp_2)
txt_2 = NormalizeText(Text=rep_3)  # -> Strict, Title, Underscore, Kebab, Pascal
join_2 = TextJoin(Text=split.ListB, Join="_")
panel_3 = Panel("""default
paper
collider
volume""")
concat_2 = Concatenate(FragmentA=txt.Kebab, FragmentD="_", FragmentB=txt_2.Kebab)
concat_3 = Concatenate(FragmentA="images", FragmentB=sep, FragmentC=concat_2, FragmentD=".png")
concat_4 = Concatenate(FragmentA="icons", FragmentB=sep, FragmentC=concat_2, FragmentD=".svg")
concat_5 = Concatenate(FragmentA=concat_2, FragmentB=".glb")
concat_6 = Concatenate(FragmentA=concat_2, FragmentD="_", FragmentB=join_2)
concat_7 = Concatenate(FragmentA="representations", FragmentB=sep, FragmentC=concat_2, FragmentD=".glb")
concat_8 = Concatenate(FragmentA="representations", FragmentB=sep, FragmentC=concat_2, FragmentD=".3dm")
concat_9 = Concatenate(FragmentA=concat_6, FragmentB=".glb")
concat_10 = Concatenate(FragmentA=concat_6, FragmentB=".3dm")
concat_11 = Concatenate(FragmentD=concat_2, FragmentC="_", FragmentA=panel_3, FragmentB=".3dm")
concat_12 = Concatenate(FragmentA=concat_2, FragmentC="_", FragmentB=panel_3, FragmentD=".glb")
concat_13 = Concatenate(FragmentA="representations", FragmentB=sep, FragmentC=concat_10)
concat_14 = Concatenate(FragmentA="representations", FragmentB=sep, FragmentC=concat_9)
concat_15 = Concatenate(FragmentA="representations", FragmentB=sep, FragmentC=concat_11)
concat_16 = Concatenate(FragmentA="representations", FragmentB=sep, FragmentC=concat_12)
panel_4 = Panel(concat_13)
rep_4 = ModelRepresentation(Url=concat_13, Tags=split.ListB)  # -> Representation, Valid, Url, Description, Tags, Qualities
rep_5 = ModelRepresentation(Url=graft(concat_16), Tags=graft(panel_3))  # -> Representation, Valid, Url, Description, Tags, Qualities
rep_6 = ModelRepresentation(Url=concat_14, Tags=split.ListB)  # -> Representation, Valid, Url, Description, Tags, Qualities
rep_7 = ModelRepresentation(Url=graft(concat_15), Tags=graft(panel_3))  # -> Representation, Valid, Url, Description, Tags, Qualities
rep_8 = ModelRepresentation(Url=concat_7)  # -> Representation, Valid, Url, Description, Tags, Qualities
rep_9 = ModelRepresentation(Url=concat_8)  # -> Representation, Valid, Url, Description, Tags, Qualities
trim = TrimTree(Tree=rep_4.Representation, Depth=1)
trim_2 = TrimTree(Tree=rep_6.Representation, Depth=1)
trim_3 = TrimTree(Tree=rep_7.Representation, Depth=1)
trim_4 = TrimTree(Tree=rep_5.Representation, Depth=1)
merge_3 = Merge(Data1=rep_8.Representation, Data2=rep_9.Representation, Data3=trim, Data4=trim_2, Data5=trim_4, Data6=trim_3)
concat_17 = Concatenate(FragmentA=path_2, FragmentB=sep, FragmentC=concat_16)
concat_18 = Concatenate(FragmentA=path_2, FragmentB=sep, FragmentC=concat_14)
concat_collider_glb = Concatenate(FragmentA=path_2, FragmentB=sep, FragmentC=concat_16)
cluster = Cluster(gr=merge_2)  # -> geo_2, txt_2
typ = ModelType(
    Name=txt.Title,
    Description=description_2,
    Icon=concat_4,
    Image=concat_3,
    Variant=variant_2,
    Representations=merge_3,
    Ports=po_2,
    Authors=authors_2,
    Qualities=qualities_2)  # -> Type, Valid, Name, Description, Icon, Image, Variant, Stock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
geo = ExportGeometry(F=concat_collider_glb, G=collider_2, R=ex_2)  # -> S; inputs G: tree of GeometryBase, R: Boolean
# ---------- geo: C# ----------
// Grasshopper Script Instance
#region Usings
using System;
using System.Linq;
using System.Collections;
using System.Collections.Generic;
using System.Drawing;
using System.IO;

using Rhino;
using Rhino.Geometry;

using Grasshopper;
using Grasshopper.Kernel;
using Grasshopper.Kernel.Data;
using Grasshopper.Kernel.Types;
#endregion

public class Script_Instance : GH_ScriptInstance
{
    #region Notes
    /* 
      Members:
        RhinoDoc RhinoDocument
        GH_Document GrasshopperDocument
        IGH_Component Component
        int Iteration

      Methods (Virtual & overridable):
        Print(string text)
        Print(string format, params object[] args)
        Reflect(object obj)
        Reflect(object obj, string method_name)
    */
    #endregion

    private void RunScript(object F, DataTree<GeometryBase> G, bool R, ref object S)
    {
        // inspired from https://github.com/jhorikawa/GrasshopperProgrammingTutorials/blob/master/0015%20Export%20Geometry%20with%20Grasshopper%20C%23/Export%20Geometry%20with%20Grasshopper%20C%23.gh
        if(R){
            var guids = new List<Guid>();

            for(int i = 0; i < G.BranchCount; i++){
                for(int n = 0; n < G.Branches[i].Count; n++){
                var geom = G.Branches[i][n];
                var guid = Rhino.RhinoDoc.ActiveDoc.Objects.Add(geom);
                guids.Add(guid);
                }
            }

            Rhino.RhinoDoc.ActiveDoc.Objects.Select(guids);

            string cmd = "_-Export " + "\"" + F + "\"" + " _Enter _Enter";

            Rhino.RhinoApp.RunScript(cmd, false);

            Rhino.RhinoDoc.ActiveDoc.Objects.Delete(guids, true);
            S = true;
        }
    }
}
# ---------- end geo ----------
concat_3dm = Concatenate(FragmentA=path_2, FragmentB=sep, FragmentC=concat_13)
geo_2 = ExportGeometry(F=concat_18, G=collider_2, R=ex_2)  # -> S; inputs G: tree of GeometryBase, R: Boolean; same code as geo
geo_3 = ExportGeometry(F=concat_17, G=cluster.geo_2, R=ex_2)  # -> S; inputs G: tree of GeometryBase, R: Boolean; same code as geo
geo_4 = ExportGeometry()  # -> S; inputs G: tree of GeometryBase, R: Boolean; same code as geo
ty = Type(typ.Type)
ba = Text(concat_2)
ty_2 = ClusterOutput(ty)
ba_2 = ClusterOutput(ba)
blc = ExportBlock_3(export=ex_2, ob=group_2)  # -> block_definition_3, path_4, exported_2
blc_2 = ExportBlock_2(path=path_2, gr=group_2, ty=typ.Type, rp=rp_2, export=ex_2)  # -> block_definition_3, path_4, exported_2
blc_3 = ExportBlock_2(path=path_2, export=ex_2)  # -> block_definition_3, path_4, exported_2
geo_5 = ExportGeometry(F=concat_3dm, G=group_2, R=ex_2)  # -> S; inputs G: tree of GeometryBase, R: Boolean; same code as geo

# ==== cluster OffsetBox: Offset a box by a certain length.
length = ClusterInput()
box = ClusterInput()
length_2 = Number(length)
box_2 = Box(box)
debox = DeconstructBox(Box=box_2)  # -> Plane, X, Y, Z
cluster = D(I=debox.X, length=length_2)
cluster_2 = D(I=debox.Y, length=length_2)
cluster_3 = D(I=debox.Z, length=length_2)
box_3 = DomainBox(Base=debox.Plane, X=cluster, Y=cluster_2, Z=cluster_3)
adjust_box = Box(box_3)
adjust_box_2 = ClusterOutput(adjust_box)

# ==== cluster SortSurfacesByOrientation
B = ClusterInput()
debrep = DeconstructBrep(Brep=B)  # -> flatten(Faces), Edges, Vertices
facen = FaceNormals(Mesh=debrep.Faces)  # -> simplify(Centers), simplify(Normals)
item = ListItem(List=facen.Normals, Index=0, Wrap=True)  # -> flatten(Item)
devec = DeconstructVector(Vector=item)  # -> XComponent, YComponent, ZComponent
smaller = SmallerThan(FirstNumber=devec.ZComponent, SecondNumber="0.01")  # -> SmallerThan, OrEqualTo
smaller_2 = SmallerThan(FirstNumber=devec.ZComponent, SecondNumber="-0.01")  # -> SmallerThan, OrEqualTo
larger = LargerThan(FirstNumber=devec.ZComponent, SecondNumber="0.01")  # -> LargerThan, OrEqualTo
larger_2 = LargerThan(FirstNumber=devec.ZComponent, SecondNumber="-0.01")  # -> LargerThan, OrEqualTo
and = GateAnd(A=smaller.SmallerThan, B=smaller_2.SmallerThan)
and_2 = GateAnd(A=smaller.SmallerThan, B=larger_2.LargerThan)
cull = CullPattern(List=debrep.Faces, CullPattern=and)
cull_2 = CullPattern(List=debrep.Faces, CullPattern=larger.LargerThan)
cull_3 = CullPattern(List=debrep.Faces, CullPattern=and_2)
base = Surface(cull)
roof = Surface(cull_2)
walls = Surface(cull_3)
base_2 = ClusterOutput(base)
roof_2 = ClusterOutput(roof)
walls_2 = ClusterOutput(walls)

# ==== cluster ExportBlock_2: Export geometry with layer names to a file.
gr = ClusterInput()
ty = ClusterInput()
export = ClusterInput()
rp = ClusterInput()
path = ClusterInput()
path_2 = FilePath(path)
ty_2 = Type(ty)
rp_2 = Representation(rp)
export_2 = Boolean(export)
cluster = Cluster(gr=gr)  # -> geo_2, txt_2
layer = ModelLayer(Name=cluster.txt_2)  # -> Layer, Name, Hidden, Locked, DisplayColour, Material, Linetype
object = ModelObject(Geometry=cluster.geo_2, Layer=layer.Layer)  # -> Object, Geometry, Name, Layer, Visibility, Display, Drafting, Render
typ = ModelType(Type=ty_2)  # -> Type, Valid, Name, Description, Icon, Image, Variant, Stock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
rep = ModelRepresentation(Representation=rp_2)  # -> Representation, Valid, Url, Description, Tags, Qualities
trim = TrimTree(Tree=object.Object, Depth="5")
concat = Concatenate(FragmentA=typ.Type, FragmentC=":", FragmentB=rep.Representation)
block_definition = ModelBlockDefinition(Objects=trim, Name=concat, Notes=typ.Description)  # -> BlockDefinition, Objects, Units, Name, Notes, URL, URLDescription
export_definition = ExportModelBlockDefinition(BlockDefinition=block_definition.BlockDefinition, FilePath=path_2, Overwrite="T", Export=export_2)  # -> BlockDefinition, FilePath, Exported
block_definition_2 = ModelBlockDefinition(export_definition.BlockDefinition)
path_3 = FilePath(export_definition.FilePath)
exported = Boolean(export_definition.Exported)

# ---- group: Export single files. WIP
sep = Separator()  # -> S
# ---------- sep: C# ----------
#region Usings
using System;
using System.Linq;
using System.Collections;
using System.Collections.Generic;
using System.Drawing;
using System.IO;

using Rhino;
using Rhino.Geometry;

using Grasshopper;
using Grasshopper.Kernel;
using Grasshopper.Kernel.Data;
using Grasshopper.Kernel.Types;
#endregion

public class Script_Instance : GH_ScriptInstance
{
    private void RunScript(ref object S)
    {
        S = Path.DirectorySeparatorChar;
    }
}
# ---------- end sep ----------
rep_2 = ReplaceText(Text=rep.Url, Find="/", Replace=sep, RecursiveReplace=False)
item = ListItem(List=rep.Tags, Index=0, Wrap=True)
concat_2 = Concatenate(FragmentA=path_2, FragmentB=sep, FragmentC=rep_2)
mime = Mime({".glb": "model/gltf-binary", ".gltf": "model/gltf+json", ".stl": "model/stl", ".obj": "model/obj", ".blend": "model/x-blender", ".3dm": "model/vnd.3dm", ".ifc": "model/x-ifc", ".dwg": "model/acad", ".dxf": "model/dxf", ".rvt": "model/vnd.revit"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}, selected=".3dm")
trim_2 = TrimTree(Tree=item, Depth=1)
expression = Expression(x=trim_2, y=mime, Expression="x=y")
# WIP
dispatch = Dispatch(List=concat_2, DispatchPattern=expression)  # -> ListA, ListB
dispatch_2 = Dispatch(List=concat_2, DispatchPattern=expression)  # -> ListA, ListB

# ----
exported_2 = ClusterOutput(exported)
path_4 = ClusterOutput(path_3)
block_definition_3 = ClusterOutput(block_definition_2)

# ==== cluster ExportBlock_3: Export geometry with layer names to a file.
ob = ClusterInput()
G = ClusterInput()
dc = ClusterInput()
path = ClusterInput()
name = ClusterInput()
url = ClusterInput()
layer_n = ClusterInput()
export = ClusterInput()
ob_2 = ModelObject(ob)
group = Group(Geometry=G)
path_2 = FilePath(path)
name_2 = Text(name)
url_2 = Text(url)
export_2 = Boolean(export)
layer_n_2 = Name(layer_n)
dc_2 = DisplayColour(dc)
object = ModelObject(Object=group)  # -> Object, Geometry, Name, Layer, Visibility, Display, Drafting, Render
layer = ModelLayer(Name=layer_n_2, DisplayColour=dc_2)  # -> Layer, Name, Hidden, Locked, DisplayColour, Material, Linetype, PrintColour, PrintWidth
object_2 = ModelObject(group)
group_2 = NamedGroup(Geometry=group)  # -> Group, Geometry, Name
object_3 = ModelObject(Geometry=object_2, Layer=layer.Layer)  # -> Object, Geometry, Name, Layer, Visibility, Display, Drafting, Render
object_4 = ModelObject(Object=object_2)  # -> Object, Geometry, Name, Layer, Visibility, Display, Drafting, Render
block_definition = ModelBlockDefinition(Objects=object_3.Object, Name=name_2, URL=url_2)  # -> BlockDefinition, Objects, Units, Name, Notes, URL, URLDescription
panel = Panel(object_4.Layer)
export_definition = ExportModelBlockDefinition(BlockDefinition=block_definition.BlockDefinition, FilePath=path_2, Overwrite="T", Export=export_2)  # -> BlockDefinition, FilePath, Exported
block_definition_2 = ModelBlockDefinition(export_definition.BlockDefinition)
path_3 = FilePath(export_definition.FilePath)
exported = Boolean(export_definition.Exported)
path_4 = ClusterOutput(path_3)
exported_2 = ClusterOutput(exported)
block_definition_3 = ClusterOutput(block_definition_2)

# ==== cluster D
length = ClusterInput()
I = ClusterInput()
length_2 = Number(length)
domprop = DomainProperties(I=I, In=True)  # -> L, M, T0, T1; inputs I: tree, In: tree of Boolean
# ---------- domprop: Python ----------
#Component Information
#--------------------------------------------------------------------------------------------
if ghenv.Component.RunCount<2:
    #General
    #--------------------------------------------------------------------------------------------
    __author__ = "Ueli Saluz"
    __version__ = "2021.11.22"
    
    ghenv.Component.Name = "DomainProperties"
    ghenv.Component.NickName = "DomProp"
    ghenv.Component.Description = "Returns some properties of a domain"
    ghenv.Component.Message = "VER 1.0"
    ghenv.Component.Category = "Maths"
    ghenv.Component.SubCategory = "Domain"
    
     #Inputs
    #--------------------------------------------------------------------------------------------
    inputIndex=0
    
    ghenv.Component.Params.Input[inputIndex].Name = "Domain"
    ghenv.Component.Params.Input[inputIndex].NickName = "I"
    ghenv.Component.Params.Input[inputIndex].Description = "Domain to evaluate"
    ghenv.Component.Params.Input[inputIndex].Optional = False
    inputIndex+=1
    
    ghenv.Component.Params.Input[inputIndex].Name = "MakeIncreasing"
    ghenv.Component.Params.Input[inputIndex].NickName = "In"
    ghenv.Component.Params.Input[inputIndex].Description = "Makes sure that the domain is increasing. If not it gets swapped."
    ghenv.Component.Params.Input[inputIndex].Optional = False
    inputIndex+=1
    
    #Outputs
    #--------------------------------------------------------------------------------------------
    outputIndex=0
    
    ghenv.Component.Params.Output[outputIndex].Name = "Length"
    ghenv.Component.Params.Output[outputIndex].NickName = "L"
    ghenv.Component.Params.Output[outputIndex].Description = "Length of the domain"
    outputIndex+=1
    
    ghenv.Component.Params.Output[outputIndex].Name = "Mid"
    ghenv.Component.Params.Output[outputIndex].NickName = "M"
    ghenv.Component.Params.Output[outputIndex].Description = "Middle of the of the domain"
    outputIndex+=1
    
    ghenv.Component.Params.Output[outputIndex].Name = "DomainStartParameter"
    ghenv.Component.Params.Output[outputIndex].NickName = "T0"
    ghenv.Component.Params.Output[outputIndex].Description = "Start parameter. Doens't have to be smaller than the end parameter."
    outputIndex+=1
    
    ghenv.Component.Params.Output[outputIndex].Name = "DomainEndParameter"
    ghenv.Component.Params.Output[outputIndex].NickName = "T1"
    ghenv.Component.Params.Output[outputIndex].Description = "End parameter. Doens't have to be bigger than the start parameter."
    outputIndex+=1
    


#Imports
#--------------------------------------------------------------------------------------------
from System import Object
from Grasshopper import DataTree

#Solver - Run with trees to enhance performance drastically
#--------------------------------------------------------------------------------------------
if __name__ == "__main__":
    
    #Initialize trees
    #--------------------------------------------------------------------------------------------
    LengthTree = DataTree[Object]()
    MidTree = DataTree[Object]()
    DomainStartParameterTree = DataTree[Object]()
    DomainEndParameterTree = DataTree[Object]()
    LengthTree = DataTree[Object]()
    
    #Data matching
    #--------------------------------------------------------------------------------------------
    for path in I.Paths:
        domainBranch = I.Branch(path)
        for i,domain in enumerate(domainBranch):
            if In==True:
                domain.MakeIncreasing()
            LengthTree.Add(domain.Length, path)
            MidTree.Add(domain.Mid, path)
            DomainStartParameterTree.Add(domain.T0, path)
            DomainEndParameterTree.Add(domain.T1, path)
    
     #Assign trees to output
    #--------------------------------------------------------------------------------------------
    L = LengthTree
    M = MidTree
    T0 = DomainStartParameterTree
    T1 = DomainEndParameterTree
# ---------- end domprop ----------
addition = Addition(A=domprop.T1, B=length_2)
subtraction = Subtraction(A=domprop.T0, B=length_2)
dom = ConstructDomain(DomainStart=subtraction, DomainEnd=addition)
I_2 = ClusterOutput(dom)

# ==== cluster Cluster
gr = ClusterInput()
gr_2 = Group(gr)
group = NamedGroup(Group=gr_2)  # -> Group, Geometry, Name
group_2 = NamedGroup(Group=group.Geometry)  # -> Group, Geometry, Name
expression = Expression(x=graft(group.Name), y=group_2.Name, Expression="x")
group_3 = NamedGroup(Group=group_2.Geometry)  # -> Group, Geometry, Name
expression_2 = Expression(x=graft(expression), y=group_3.Name, Expression="x")
expression_3 = Expression(x=graft(group_2.Name), y=group_3.Name, Expression="x")
group_4 = NamedGroup(Group=group_3.Geometry)  # -> Group, Geometry, Name
expression_4 = Expression(x=graft(expression_2), y=group_4.Name, Expression="x")
expression_5 = Expression(x=graft(expression_3), y=group_4.Name, Expression="x")
expression_6 = Expression(x=graft(group_3.Name), y=group_4.Name, Expression="x")
group_5 = NamedGroup(Group=group_4.Geometry)  # -> Group, Geometry, Name
expression_7 = Expression(x=graft(expression_4), y=group_5.Name, Expression="x")
expression_8 = Expression(x=graft(expression_5), y=group_5.Name, Expression="x")
expression_9 = Expression(x=graft(expression_6), y=group_5.Name, Expression="x")
expression_10 = Expression(x=graft(group_4.Name), y=group_5.Name, Expression="x")
group_6 = NamedGroup(Group=group_5.Geometry)  # -> Group, Geometry, Name
expression_11 = Expression(x=graft(expression_7), y=group_6.Name, Expression="x")
expression_12 = Expression(x=graft(expression_9), y=group_6.Name, Expression="x")
expression_13 = Expression(x=graft(expression_8), y=group_6.Name, Expression="x")
expression_14 = Expression(x=graft(expression_10), y=group_6.Name, Expression="x")
expression_15 = Expression(x=graft(group_5.Name), y=group_6.Name, Expression="x")
merge = Merge(
    Data1=expression_11,
    Data2=expression_13,
    Data3=expression_12,
    Data4=expression_14,
    Data5=expression_15,
    Data6=group_6.Name)
join = TextJoin(Text=merge, Join="::")
geo = Geometry(group_6.Geometry)
txt = Text(join)
geo_2 = ClusterOutput(geo)
txt_2 = ClusterOutput(txt)
