# Grasshopper definition external-stair.gh (Grasshopper 1.0.8)
# Copyright: GNU Lesser General Public License Version 3
# Copyright: GNU Lesser General Public License v3.0 or later
# plug-ins: RhinoCodePluginGH, semio

txt = NormalizeText(Text="external stair")  # -> Strict, Title, Underscore, Kebab, Pascal
panel = Panel("""Platform Top
Platform Top Double
Platform Top Double Open""")
number_slider = Slider(0, range=0..15)
number_slider_2 = Slider(3, range=0..3)
save_representation = BooleanToggle(False)
icon_export = BooleanToggle(False)
validate = BooleanToggle(False)
save = BooleanToggle(False)
dir = Directory()  # -> D, F
# ---------- dir: C# ----------
#region Usings
using System;
using System.Linq;
using System.Collections;
using System.Collections.Generic;
using System.Drawing;
using System.IO;

using Rhino;
using Rhino.Geometry;

using Grasshopper;
using Grasshopper.Kernel;
using Grasshopper.Kernel.Data;
using Grasshopper.Kernel.Types;
#endregion

public class Script_Instance : GH_ScriptInstance
{
    private void RunScript(ref object D, ref object F)
    {
        F = this.GrasshopperDocument.FilePath;
        D = Path.GetDirectoryName((string)F);
    }
}
# ---------- end dir ----------
sep = Separator()  # -> S; same code as sep
concat = Concatenate(FragmentC=dir.D, FragmentA=sep, FragmentD=txt.Kebab, FragmentB=".3dm")
import = ImportContent(FilePath=concat, Import=Toggle(True))  # -> ModelTransform, Objects, Layers, Linetypes, HatchPatterns, AnnotationStyles, Materials, BlockDefinitions
object = ModelObject(Object=import.Objects)  # -> Object, Geometry, Name, Layer, Visibility, Display, Drafting, Render
layer = ModelLayer(Layer=import.Layers)  # -> Layer, Name, Hidden, Locked, DisplayColour, Material, Linetype
loop_slider = PythonScript(
    SliderToModify=number_slider_2,
    Min="0",
    Max="3",
    stepSize="1",
    Delay=Slider(0, range=0..1),
    Run=Toggle(False),
    Reset=Button())  # inputs Run: Boolean, Reset: Boolean
# ---------- loop_slider: Python ----------
import time

def updateSliderInput(inputName,min,max,value,decimalPlace=2):
    for input in ghenv.Component.Params.Input:
        for source in input.Sources:
            if input.Name == str(inputName):
                source.Slider.DecimalPlaces = decimalPlace
                source.Slider.Minimum = min
                source.Slider.Maximum = max
                source.Slider.Value = value
                source.ExpireSolution(True)

def countDecimal(number):
    string= str(number)
    return string[::-1].find('.')

if Run == True:
    if SliderToModify < Max:
        time.sleep(Delay)
        updateSliderInput("SliderToModify",Min,Max,SliderToModify+stepSize,countDecimal(stepSize))
if Reset == True:
    updateSliderInput("SliderToModify",Min,Max,Min)
# ---------- end loop_slider ----------
item = ListItem(List=panel, Index=number_slider_2, Wrap=True)
panel_2 = Panel(item)
and = GateAnd(A=save, B=save_representation)
and_2 = GateAnd(A=save, B=icon_export)
# ^                                    ^
#    |                                     |
# <-- Constants    Preview -->
# Parameters    External    Local -->
# <-- Meta               |
#      |                       v
#      v
par = ParentDirectory(D=dir.D)  # -> P; inputs D: String
# ---------- par: C# ----------
#region Usings
using System;
using System.Linq;
using System.Collections;
using System.Collections.Generic;
using System.Drawing;
using System.IO;

using Rhino;
using Rhino.Geometry;

using Grasshopper;
using Grasshopper.Kernel;
using Grasshopper.Kernel.Data;
using Grasshopper.Kernel.Types;
#endregion

public class Script_Instance : GH_ScriptInstance
{
    private void RunScript(string D, ref object P)
    {
        P = new DirectoryInfo(D).Parent;
    }
}
# ---------- end par ----------

# ----
# For sloped terrain
list = ValueList({"Default": "", "Last Storey"}, selected="Default")
list_2 = ValueList({"Default": "", "Last Storey"}, selected="Last Storey")
list_3 = ValueList({"Default": "", "First Storey", "Last Storey"}, selected="First Storey")
# 2023-2025 Ueli Saluz
# 2025 Elduane Lumpine
# 2025 Christian Hödtke
# Permission is hereby granted, free of charge, to any person obtaining a copy
# of this Grasshopper file and associated documentation files (the "Document"),
# to deal in the Document without restriction, including without limitation the
# rights to use, copy, modify, merge, publish, distribute, sublicense, and/or sell
# copies of the Document, and to permit persons to whom the Document is
# furnished to do so.
# 
# Individual clusters used inside this document might be licensed under
# different terms. This is indicated through a similar copyright notice group
# inside the cluster and otherwise in the license field of the cluster. If you
# have any question please reach out to us: license@semio-tech.com
# 
# THE DOCUMENT IS PROVIDED "AS IS", WITHOUT WARRANTY OF ANY
# KIND, EXPRESS OR IMPLIED, INCLUDING BUT NOT LIMITED TO THE
# WARRANTIES OF MERCHANTABILITY, FITNESS FOR A PARTICULAR
# PURPOSE AND NONINFRINGEMENT. IN NO EVENT SHALL THE
# AUTHORS OR COPYRIGHT HOLDERS BE LIABLE FOR ANY CLAIM,
# DAMAGES OR OTHER LIABILITY, WHETHER IN AN ACTION OF
# CONTRACT, TORT OR OTHERWISE, ARISING FROM, OUT OF OR IN
# CONNECTION WITH THE DOCUMENT OR THE USE OR OTHER
# DEALINGS IN THE DOCUMENT.
stair = Stair(variant=list)  # -> ty_2, geo_2
stair_2 = Stair(variant=list_3)  # -> ty_2, geo_2
stair_3 = Stair(variant=list_2)  # -> ty_2, geo_2

panel_3 = Panel("""f9222724e5
b27c179b7d
89d6e55762
c5850e2821
53dc156694
345fa2173d
73566dc911
8965b08c83""")  # disabled
panel_4 = Panel("https://app.speckle.systems/projects/e7de1a2f8f/models/")  # disabled
panel_5 = Panel("2")  # disabled
panel_6 = Panel("4")  # disabled
dup = DuplicateData(Data=panel_5, Number=panel_6, Order=True)  # disabled
concat_2 = Concatenate(FragmentA=panel_4, FragmentB=panel_3)  # disabled
trim = TrimTree(Tree=dup, Depth=1)  # disabled
partition = PartitionList(List=concat_2, Size=trim)  # disabled
tstat = TreeStatistics(Tree=partition)  # -> Paths, Length, Count; disabled
item_2 = ListItem(List=flatten(tstat.Paths), Index=0, Wrap=True)  # disabled
branch = TreeBranch(Tree=partition, Path=item_2, MaintainPaths=True)  # disabled
item_3 = ListItem(List=flatten(branch), Index=0, Wrap=True)  # -> Item, Item1; disabled

panel_7 = Panel("""s
p-w
p-e
p-s""")
panel_8 = Panel("""s
p-w
p-e""")
panel_9 = Panel("""s
e""")
panel_10 = Panel("""s
p-w""")
band = Brep([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])
variant = GetString(item, AtLeast=0, AtMost=1, TreeAccess=False)
panel_11 = Panel("An external stair with no platform on the beginning and a double-sized platform with an opening for another stair on the end.")
panel_12 = Panel("An external stair with no platform on the beginning and a platform on the end.")
panel_13 = Panel("An external stair with no platform on the beginning and a double-sized platform on the end.")
group = NamedGroup(Geometry=band, Name="Band")  # -> Group, Geometry, Name
itemindex = ItemIndex(L=panel, I=variant)  # -> i; inputs L: list; same code as itemindex
typ = SerializeType()
save_representation_2 = BooleanToggle(False)
icon_export_2 = BooleanToggle(False)
validate_2 = BooleanToggle(False)
save_2 = BooleanToggle(False)

subtraction = Subtraction()
filter = StreamFilter(Gate=0, Stream0=subtraction)
filter_2 = StreamFilter(Gate=0, Stream1="0")
Z = UnitZ(Factor=1)
rev = Reverse(Vector=Z)
pt = ConstructPoint(XCoordinate=0, YCoordinate=0, ZCoordinate=filter)
pt_2 = ConstructPoint(XCoordinate=0, YCoordinate=0, ZCoordinate=filter_2)

pt_3 = Point([Point(0, 0, 0), Point(3.90222032, 0, 1.681818)])
vec = Vector([Vector(-1, 0, 0), Vector(1, 0, 0)])
panel_14 = Panel("""stair start
stair end""")
# stair start
# platform west
# platform east
# stair start
# platform west
# platform east
# platform stair
panel_15 = Panel("""stair start
platform west""")
txt_2 = EncodeText(Text=typ, Mode=0)
pt_4 = Point([Point(0, 0, 0), Point(5.40222032, 0, 1.681818)])
vec_2 = Vector([Vector(-1, 0, 0), Vector(1, 0, 0)])
# stair start
# platform west
# platform east
# stair start
# platform west
# platform east
# platform stair
panel_17 = Panel("""stair start
platform west""")
vec_3 = Vector([Vector(-1, 0, 0), Vector(1, 0, 0), Vector(1, 0, 0)])
type = Text(txt_2)
pt_5 = Point([Point(0, 0, 0), Point(5.40222032, 0, 1.681818), Point(5.40222032, -1.668820631, 1.681818)])
context_bake = ContextBake(Geometry=type)
and_3 = GateAnd(A=save_2, B=icon_export_2)

# ----
# Outputs   ->
#                 |
#                 v
panel_18 = Panel("icons")
concat_3 = Concatenate(FragmentC="icon")
concat_4 = Concatenate(FragmentC=panel_18, FragmentD=sep)
expression = Expression(x="bridge", Expression="x")
concat_5 = Concatenate(FragmentA=concat_4)
concat_6 = Concatenate(FragmentA=par, FragmentB=sep, FragmentC=concat_5)
blc = ExportBlock(path=concat_6, name=concat_3, url=concat_5, layer_name=expression, export=and_3)  # -> block_definition_3, path_4, exported_2

and_4 = GateAnd(A=save_2, B=save_representation_2)
vec_4 = Vector([Vector(-1, 0, 0), Vector(1, 0, 0), Vector(1, 0, 0), Vector(-1, 0, 0)])
pt_6 = Point([Point(0, 0, 0), Point(5.40222032, 0, 1.681818), Point(5.40222032, -1.668820631, 1.681818), Point(3.90222032, -1.668820631, 1.681818)])
brep = Brep(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)
maintenance_expenses_month_eff_m² = Number(Slider(5, range=0..10))
construction_cost_eff_m² = Number(Slider(4500, range=0..10000))
aut = ModelAuthor(Name="Ueli Saluz", Email="ueli@semio-tech.org")  # -> Author, Valid, Name, Email, Attributes
concat_7 = Concatenate(FragmentA="icons/", FragmentC=".svg")
concat_8 = Concatenate(FragmentA="images/", FragmentC=".svg")
filter_3 = StreamFilter(Gate=itemindex, Stream0=pt_3, Stream1=pt_4, Stream2=pt_5, Stream3=pt_6)
filter_4 = StreamFilter(Gate=itemindex, Stream0=vec, Stream1=vec_2, Stream2=vec_3, Stream3=vec_4)
filter_5 = StreamFilter(Gate=itemindex, Stream0=panel_9, Stream1=panel_10, Stream2=panel_8, Stream3=panel_7)
filter_6 = StreamFilter(Gate=itemindex, Stream0="An external stair with no platforms", Stream1=panel_12, Stream2=panel_13, Stream3=panel_11)
typ_2 = ModelType(Name="Tambour", Icon=concat_7, Image=concat_8, Unit="m", Authors=aut.Author)  # -> Type, Valid, Name, Description, Icon, Image, Variant, Stock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
id = Id(filter_5)
description = Description(filter_6)
vec_5 = Vector(filter_4)
pt_7 = Point(filter_3)
panel_19 = Panel(description)
typ_3 = PutType(Type=typ_2.Type, Run=False)
construction_global_warming_potential_kg = Number(Slider(400, range=0..2000))  # "Construction Global Warming Potential [kgCO2e/eff. m²]"
por = ModelPort(Id=id, Description=description, Point=pt_7, Direction=vec_5)  # -> Port, Valid, Id, Description, Mandatory, Family, CompatibleFamilies, Point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
prv = PreviewPort(po=por.Port)
aut_2 = ModelAuthor(Name="Ueli Saluz", Email="ueli@semio-tech.com")  # -> Author, Valid, Name, Email, Attributes
typ_4 = PutType(Type=<missing>, Uri=<missing>, Run=save_2)

steps_surface = Brep(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)
steps_volume = Brep([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])
stairs_volume = Brep(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)
lower_band = Brep([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])
upper_band = Brep([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])
railing_posts = Brep([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])
handrailing = Brep([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])
collider = Mesh(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)
collider_2 = Mesh(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)
walking_volume = Brep(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)
platform_modules = Brep([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])
handrailing_2 = Brep([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])
railing_posts_2 = Brep([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])
band_2 = Brep([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])
platform = Brep(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)
collider_3 = Mesh(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)
walking_volume_2 = Brep(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)
railing_posts_3 = Brep([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])
handrailing_3 = Brep([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])
band_3 = Brep([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])
band_4 = Brep([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])
handrailing_4 = Brep([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])
railing_posts_4 = Brep([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])

filter_7 = StreamFilter(Gate=itemindex, Stream0=railing_posts, Stream1=railing_posts_2, Stream2=railing_posts_3, Stream3=railing_posts_4)
debrep = DeconstructBrep(Brep=filter_7)  # -> Faces, Edges, Vertices
item_4 = ListItem(List=debrep.Vertices, Index="0", Wrap=True)  # -> Item, Item1, Item2, Item3, Item4, Item5, Item6, Item7
group_2 = NamedGroup(Geometry=railing_posts, Name="RailingPosts")  # -> Group, Geometry, Name
group_3 = NamedGroup(Geometry=handrailing, Name="Handrailing")  # -> Group, Geometry, Name
group_4 = NamedGroup(Geometry=stairs_volume, Name="StairsVolume")  # -> Group, Geometry, Name
srf4pt = _4PointSurface(CornerA=item_4.Item, CornerB=item_4.Item5, CornerC=item_4.Item6, CornerD=item_4.Item7)
srf4pt_2 = _4PointSurface(CornerA=item_4.Item1, CornerB=item_4.Item2, CornerC=item_4.Item3, CornerD=item_4.Item4)
group_5 = NamedGroup(Geometry=band_2, Name="Band")  # -> Group, Geometry, Name
group_6 = NamedGroup(Geometry=railing_posts_2, Name="RailingPosts")  # -> Group, Geometry, Name
group_7 = NamedGroup(Geometry=handrailing_2, Name="Handrailing")  # -> Group, Geometry, Name
area = Area(Geometry=srf4pt_2)  # -> Area, Centroid
group_8 = NamedGroup(Geometry=walking_volume, Name="WalkingVolume")  # -> Group, Geometry, Name
area_2 = Area(Geometry=srf4pt)  # -> Area, Centroid
ln = Line(StartPoint=area.Centroid, EndPoint=area_2.Centroid)  # -> flatten(Line)
group_9 = NamedGroup(Geometry=walking_volume_2, Name="WalkingVolume")  # -> Group, Geometry, Name
group_10 = NamedGroup(Geometry=band_3, Name="Band")  # -> Group, Geometry, Name
group_11 = NamedGroup(Geometry=railing_posts_3, Name="RailingPosts")  # -> Group, Geometry, Name
group_12 = NamedGroup(Geometry=handrailing_3, Name="Handrailing")  # -> Group, Geometry, Name
merge = Merge(Data1=group_9.Group, Data2=band_2)
merge_2 = Merge(Data1=walking_volume, Data2=band_3)
group_13 = NamedGroup(Geometry=band_4, Name="Band")  # -> Group, Geometry, Name
group_14 = NamedGroup(Geometry=railing_posts_4, Name="RailingPosts")  # -> Group, Geometry, Name
group_15 = NamedGroup(Geometry=handrailing_4, Name="Handrailing")  # -> Group, Geometry, Name

merge_3 = Merge(Data1=group_4.Group, Data2=group.Group)
merge_4 = Merge(Data1=group_9.Group, Data2=group_5.Group)
merge_5 = Merge(Data1=group_4.Group, Data2=group.Group, Data3=group_2.Group, Data4=group_3.Group)
merge_6 = Merge(Data1=group_8.Group, Data2=group_10.Group)
merge_7 = Merge(Data1=group_9.Group, Data2=group_5.Group, Data3=group_6.Group, Data4=group_7.Group)
merge_8 = Merge(Data1=group_8.Group, Data2=group_13.Group)
merge_9 = Merge(Data1=group_8.Group, Data2=group_10.Group, Data3=group_11.Group, Data4=group_12.Group)
default = Geometry(merge_3)
platform_top = Geometry(merge_4)
platform_top_double = Geometry(merge_6)
platform_top_double_open = Geometry(merge_8)
merge_10 = Merge(Data1=group_8.Group, Data2=group_13.Group, Data3=group_14.Group, Data4=group_15.Group)
platform_top_double_2 = Geometry(merge_9)
platform_top_double_open_2 = Geometry(merge_10)
platform_top_2 = Geometry(merge_7)
default_2 = Geometry(merge_5)

merge_11 = Merge(Data1=walking_volume, Data2=band_4)
item_5 = ListItem(List=platform, Index=0, Wrap=True)
item_6 = ListItem(List=platform_modules, Index=0, Wrap=True)
debrep_2 = DeconstructBrep(Brep=item_6)  # -> Faces, Edges, Vertices
debrep_3 = DeconstructBrep(Brep=item_5)  # -> Faces, Edges, Vertices
filter_8 = StreamFilter(Gate=itemindex, Stream0=default, Stream1=platform_top, Stream2=platform_top_double, Stream3=platform_top_double_open)
filter_9 = StreamFilter(
    Gate=itemindex,
    Stream0=default_2,
    Stream1=platform_top_2,
    Stream2=platform_top_double_2,
    Stream3=platform_top_double_open_2)
filter_10 = StreamFilter(Gate=itemindex, Stream0=collider, Stream1=collider_2, Stream2=collider_3, Stream3=collider_3)
filter_11 = StreamFilter(Gate=itemindex, Stream0=brep, Stream1=merge, Stream2=merge_2, Stream3=merge_11)
item_7 = ListItem(List=debrep_2.Faces, Index="4", Wrap=True)
item_8 = ListItem(List=debrep_3.Faces, Index="3", Wrap=True)
_1to500 = Geometry(filter_8)
_1to200 = Geometry(filter_9)
collider_4 = Mesh(filter_10)
paper = Geometry(filter_11)
filter_12 = StreamFilter(Gate=itemindex, Stream1=item_7, Stream2=item_8, Stream3=item_8)

group_16 = NamedGroup(Geometry=steps_surface, Name="Steps")  # -> Group, Geometry, Name
group_17 = NamedGroup(Geometry=filter_12, Name="platform")  # -> Group, Geometry, Name
group_18 = NamedGroup(Geometry=lower_band, Name="LowerBand")  # -> Group, Geometry, Name
group_19 = NamedGroup(Geometry=upper_band, Name="UpperBand")  # -> Group, Geometry, Name
group_20 = NamedGroup(Geometry=_1to500)  # -> Group, Geometry, Name
group_21 = NamedGroup(Geometry=_1to200)  # -> Group, Geometry, Name
wires = BrepWireframe(Brep=paper, Density=-1)  # -> flatten(Wireframe)
merge_12 = Merge(Data1=group_16.Group, Data2=group_17.Group, Data3=group_18.Group, Data4=group_19.Group)  # -> flatten(Result)
merge_13 = Merge(Data1=paper, Data2=wires, Data3=ln)
group_22 = NamedGroup(Geometry=merge_12, Name="shades")  # -> Group, Geometry, Name
data = Data(description)
collider_5 = Mesh(collider_4)
rep = ModelRepresentation(Tags="1 to 200")  # -> Representation, Valid, Url, Description, Tags, Attributes
data_2 = Data(variant)
po = Port(por.Port)
au = Author(aut_2.Author)
ql = Quality()
group_23 = NamedGroup(Geometry=merge_13)  # -> Group, Geometry, Name
energy_representation = Data(group_22.Group)
typ_5 = OppinionatedType(
    path=dir.D,
    na="external stair",
    description=data,
    variant=data_2,
    de=group_20.Group,
    paper=group_23.Group,
    collider=collider_5,
    volume=group_20.Group,
    group=group_21.Group,
    rp=rep.Representation,
    po=po,
    authors=au,
    qualities=ql,
    ex=and)  # -> ty_2, ba_2

geo = PreviewGeometry(geo=group_21.Group, sc=1)

# ==== cluster ExportBlock: Export geometry with layer names to a file.
path = ClusterInput()
name = ClusterInput()
url = ClusterInput()
geo = ClusterInput()
layer_name = ClusterInput()
export = ClusterInput()
path_2 = FilePath(path)
name_2 = Text(name)
url_2 = Text(url)
geo_2 = Geometry(geo)
layer_name_2 = Text(layer_name)
export_2 = Boolean(export)
layer = ModelLayer(Name=layer_name_2)  # -> Layer, Name, Hidden, Locked, DisplayColour, Material, Linetype
object = ModelObject(Geometry=geo_2, Layer=layer.Layer)  # -> Object, Geometry, Name, Layer, Visibility, Display, Drafting, Render
block_definition = ModelBlockDefinition(Objects=object.Object, Name=name_2, URL=url_2)  # -> BlockDefinition, Objects, Units, Name, Notes, URL, URLDescription
export_definition = ExportModelBlockDefinition(BlockDefinition=block_definition.BlockDefinition, FilePath=path_2, Overwrite="T", Export=export_2)  # -> BlockDefinition, FilePath, Exported
block_definition_2 = ModelBlockDefinition(export_definition.BlockDefinition)
path_3 = FilePath(export_definition.FilePath)
exported = Boolean(export_definition.Exported)
path_4 = ClusterOutput(path_3)
exported_2 = ClusterOutput(exported)
block_definition_3 = ClusterOutput(block_definition_2)

# ==== cluster Stair
variant = ClusterInput()
panel = Panel("""_first-storey
_last-storey""")
panel_2 = Panel("""First Storey
Last Storey""")
panel_3 = Panel("""s
p-d-0
p-d-1""")
panel_4 = Panel("""s
p-s
p-d-0
p-d-1""")
variant_2 = Text(variant)
panel_5 = Panel("An external stair with no platform on the beginning and a double-sized platform with an opening for another stair on the end.")
panel_6 = Panel("An external stair with no platform on the beginning and a double-sized platform on the end.")
itemindex = ItemIndex(L=panel_2, I=variant_2)  # -> i; inputs L: list
# ---------- itemindex: Python ----------
#Component Information
#--------------------------------------------------------------------------------------------
if ghenv.Component.RunCount<2:
    #General
    #--------------------------------------------------------------------------------------------
    __author__ = "Ueli Saluz"
    __version__ = "2022.11.18"
    
    ghenv.Component.Name = "ItemIndex"
    ghenv.Component.NickName = "ItemIndex"
    ghenv.Component.Description = "A better IdemIndex"
    ghenv.Component.Message = "VER 1.0"
    ghenv.Component.Category = "Set"
    ghenv.Component.SubCategory = "List"
    
     #Inputs
    #--------------------------------------------------------------------------------------------
    inputIndex=0
    
    ghenv.Component.Params.Input[inputIndex].Name = "List"
    ghenv.Component.Params.Input[inputIndex].NickName = "L"
    ghenv.Component.Params.Input[inputIndex].Description = "Input1 is..."
    ghenv.Component.Params.Input[inputIndex].Optional = False
    inputIndex+=1
    
    ghenv.Component.Params.Input[inputIndex].Name = "Item"
    ghenv.Component.Params.Input[inputIndex].NickName = "I"
    ghenv.Component.Params.Input[inputIndex].Description = "Input2 is..."
    ghenv.Component.Params.Input[inputIndex].Optional = False
    inputIndex+=1
    
    #Outputs
    #--------------------------------------------------------------------------------------------
    outputIndex=0
    
    ghenv.Component.Params.Output[outputIndex].Name = "Index"
    ghenv.Component.Params.Output[outputIndex].NickName = "i"
    ghenv.Component.Params.Output[outputIndex].Description = "Output1 is..."
    outputIndex+=1

i = L.index(I)
# ---------- end itemindex ----------
item = ListItem(List=panel, Index=itemindex, Wrap=True)
concat = Concatenate(FragmentA="representations/external-stair", FragmentB=item, FragmentC=".3dm")
division = Division(A=Slider(1.38, range=0..10), B=Slider(1.09, range=0..10))
brep = Brep(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)
brep_2 = Brep(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)
brep_3 = Brep(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)
pt = Point([Point(0, 0, 0), Point(2.16748275, -1.668820631, 1.085001312), Point(3.732226217, 0, 1.085001312), Point(3.732226217, -1.668820631, 1.085000523)])
vec = Vector([Vector(-1, 0, 0), Vector(-1, 0, 0), Vector(1, 0, 0), Vector(1, 0, 0)])
pt_2 = Point([Point(0, 0, 0), Point(1.238561571, -1.668820631, 0.62000075), Point(2.803305038, 0, 0.62000075), Point(2.803305038, -1.668820631, 0.61999996)])
pt_3 = Point([Point(0, 0, 0), Point(3.732226217, 0, 1.085001312), Point(3.732226217, -1.668820631, 1.085000523)])
vec_2 = Vector([Vector(-1, 0, 0), Vector(1, 0, 0), Vector(1, 0, 0)])
filter = StreamFilter(Gate=itemindex, Stream0=panel_5, Stream1=panel_5, Stream2=panel_6)
filter_2 = StreamFilter(Gate=itemindex, Stream0=brep_2, Stream1=brep_3, Stream2=brep)
filter_3 = StreamFilter(Gate=itemindex, Stream0=vec, Stream1=vec, Stream2=vec_2)
filter_4 = StreamFilter(Gate=itemindex, Stream0=panel_4, Stream1=panel_4, Stream2=panel_3)
filter_5 = StreamFilter(Gate=itemindex, Stream0=pt, Stream1=pt_2, Stream2=pt_3)
scale_nu = ScaleNU(Geometry=filter_2, Plane=PlaneXY(0, 0, 0), ScaleX=1, ScaleY=1, ScaleZ=division)  # -> Geometry, Transform
scale_nu_2 = ScaleNU(Geometry=filter_3, Plane=PlaneXY(0, 0, 0), ScaleX=1, ScaleY=1, ScaleZ=division)  # -> Geometry, Transform
scale_nu_3 = ScaleNU(Geometry=filter_5, Plane=PlaneXY(0, 0, 0), ScaleX=1, ScaleY=1, ScaleZ=division)  # -> Geometry, Transform
pt_4 = Point(scale_nu_3.Geometry)
dr = Direction(scale_nu_2.Geometry)
id = Id(filter_4)
description = Description(filter)
rep = ModelRepresentation(Url=concat, Tags="1to200")  # -> Representation, Valid, Url, Description, Tags, Qualities
por = ModelPort(Id=id, Point=pt_4, Direction=dr)  # -> Port, Valid, Id, Description, Mandatory, Family, CompatibleFamilies, Point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
qal = ModelQuality()  # -> Quality, Valid, Name, Value, Unit
typ = ModelType(Name="External Stair", Description=description, Variant=variant_2, Representations=rep.Representation, Ports=por.Port)  # -> Type, Valid, Name, Description, Icon, Image, Variant, Stock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
prv = PreviewPort(po=por.Port)
ty = Type(typ.Type)
geo = Geometry(scale_nu.Geometry)
ty_2 = ClusterOutput(ty)
geo_2 = ClusterOutput(geo)

# ==== cluster PreviewGeometry: Preview geometry by ungrouping everything, showing light surfaces and dark edges.
sc = ClusterInput()
geo = ClusterInput()
geo_2 = Geometry(flatten(geo))
sc_2 = Number(sc)
expression = Expression(x=sc_2, Expression="x+1")
swatch = ColourSwatch(SwatchColor=RGB(0, 0, 0))
swatch_2 = ColourSwatch(SwatchColor=RGB(255, 255, 255))
ungroup = Ungroup(Group=geo_2)
ungroup_2 = Ungroup(Group=ungroup)
ungroup_3 = Ungroup(Group=ungroup_2)
ungroup_4 = Ungroup(Group=ungroup_3)
log = Logarithm(Value=expression)
clean = CleanTree(RemoveNulls=True, RemoveInvalid=True, RemoveEmpty=invert(False), Tree=ungroup_4)  # -> flatten(Tree)
multiplication = Multiplication(A=log, B=Slider(0.05, range=0..1))
linetype = ModelLinetype(Name="semio", Width=multiplication)  # -> ModelLinetype, Name, Segments, CapStyle, JoinStyle, Width, WidthUnits, TaperWidths, TaperPositions
dispatch = CSharpScript(D=clean)  # -> P, C, B, M, R
# ---------- dispatch: C# ----------
// Grasshopper Script Instance
#region Usings
using System;
using System.Linq;
using System.Collections;
using System.Collections.Generic;
using System.Drawing;

using Rhino;
using Rhino.Geometry;

using Grasshopper;
using Grasshopper.Kernel;
using Grasshopper.Kernel.Data;
using Grasshopper.Kernel.Types;
#endregion

public class Script_Instance : GH_ScriptInstance
{
    #region Notes
    /* 
      Members:
        RhinoDoc RhinoDocument
        GH_Document GrasshopperDocument
        IGH_Component Component
        int Iteration

      Methods (Virtual & overridable):
        Print(string text)
        Print(string format, params object[] args)
        Reflect(object obj)
        Reflect(object obj, string method_name)
    */
    #endregion

    private void RunScript(
	object D,
	ref object P,
	ref object C,
	ref object B,
	ref object M,
	ref object R)
    {
        if (D is Curve) C = D; // Curve
        else if (
            D is Rhino.Geometry.Point ||
            D is PointCloud
            )
            P = D; // Point
        else if ( D is Mesh) M = D; // Mesh
        else if (
            D is Surface ||
            D is Extrusion ||
            D is SubD ||
            D is Brep
            )
            B = D; // Brep
        else R = D; // Rest
            
    }
}
# ---------- end dispatch ----------
clean_2 = CleanTree(RemoveNulls=True, RemoveInvalid=True, RemoveEmpty=False, Tree=dispatch.M)
clean_3 = CleanTree(RemoveNulls=True, RemoveInvalid=True, RemoveEmpty=False, Tree=dispatch.R)
clean_4 = CleanTree(RemoveNulls=True, RemoveInvalid=True, RemoveEmpty=False, Tree=dispatch.B)
clean_5 = CleanTree(RemoveNulls=True, RemoveInvalid=True, RemoveEmpty=False, Tree=dispatch.P)
clean_6 = CleanTree(RemoveNulls=True, RemoveInvalid=True, RemoveEmpty=False, Tree=dispatch.C)
debrep = DeconstructBrep(Brep=clean_4)  # -> Faces, Edges, Vertices
preview = CustomPreview(Geometry=flatten(clean_5), Material=swatch)
preview_2 = CustomPreview(Geometry=flatten(debrep.Faces), Material=swatch_2)
preview_3 = CustomPreview(Geometry=flatten(clean_2), Material=swatch_2)
preview_4 = CustomPreview(Geometry=flatten(clean_3), Material=swatch)
curve_preview = CustomCurvePreview(Curve=clean_6, Linetype=linetype.ModelLinetype, Colour=swatch)
curve_preview_2 = CustomCurvePreview(Curve=debrep.Edges, Linetype=linetype.ModelLinetype, Colour=swatch)

# ==== cluster OppinionatedType: Construct a type following the oppinionated conventions of semio. All representations are saved under representations folder where each representation is saved once natively (.3dm) and once exported (.glb). Further a collider representation is required. All names and file names are standardized.
emoji = Panel("")
name = Panel("Default")
abbreviation = Panel("Dft?")
nn = Panel("De")
prm = ModelParam(Na=name, NN=nn, Dc="The optional default representation geometry group.", Op=Toggle(True), Ru=Toggle(True))  # -> Param, Name, NickName, Description, Optional, Success; inputs Pr: tree, Op: Boolean, Ru: Boolean
# ---------- prm: Python ----------
#Component Information
#--------------------------------------------------------------------------------------------
if ghenv.Component.RunCount<2:
    #General
    #--------------------------------------------------------------------------------------------
    __author__ = "Ueli Saluz"
    __version__ = "2025.06.18"
    
    ghenv.Component.Name = "Model Param"
    ghenv.Component.NickName = "~Prm"
    ghenv.Component.Description = "Deconstruct or modify a param."
    ghenv.Component.Message = "VER 1.0"
    ghenv.Component.Category = "semio"
    ghenv.Component.SubCategory = "Scripting"
    
     #Inputs
    #--------------------------------------------------------------------------------------------
    inputIndex=0
    
    ghenv.Component.Params.Input[inputIndex].Name = "Param"
    ghenv.Component.Params.Input[inputIndex].NickName = "Pr"
    ghenv.Component.Params.Input[inputIndex].Description = "Connect the param to desconstruct or modify here with one wire."
    ghenv.Component.Params.Input[inputIndex].Optional = False
    inputIndex+=1

    ghenv.Component.Params.Input[inputIndex].Name = "Name"
    ghenv.Component.Params.Input[inputIndex].NickName = "Na"
    ghenv.Component.Params.Input[inputIndex].Description = "Name of the param."
    ghenv.Component.Params.Input[inputIndex].Optional = False
    inputIndex+=1
    
    ghenv.Component.Params.Input[inputIndex].Name = "NickName"
    ghenv.Component.Params.Input[inputIndex].NickName = "NN"
    ghenv.Component.Params.Input[inputIndex].Description = "Nickname of the param."
    ghenv.Component.Params.Input[inputIndex].Optional = False
    inputIndex+=1
    
    ghenv.Component.Params.Input[inputIndex].Name = "Description"
    ghenv.Component.Params.Input[inputIndex].NickName = "Dc"
    ghenv.Component.Params.Input[inputIndex].Description = "Description of the param."
    ghenv.Component.Params.Input[inputIndex].Optional = True
    inputIndex+=1
    
    ghenv.Component.Params.Input[inputIndex].Name = "Optional"
    ghenv.Component.Params.Input[inputIndex].NickName = "Op"
    ghenv.Component.Params.Input[inputIndex].Description = "Wheather the param is optional."
    ghenv.Component.Params.Input[inputIndex].Optional = True
    inputIndex+=1
    
    ghenv.Component.Params.Input[inputIndex].Name = "Run"
    ghenv.Component.Params.Input[inputIndex].NickName = "Ru"
    ghenv.Component.Params.Input[inputIndex].Description = "Modify the param."
    ghenv.Component.Params.Input[inputIndex].Optional = True
    inputIndex+=1
    
    #Outputs
    #--------------------------------------------------------------------------------------------
    outputIndex=0
    
    ghenv.Component.Params.Output[outputIndex].Name = "Param"
    ghenv.Component.Params.Output[outputIndex].NickName = "Param"
    ghenv.Component.Params.Output[outputIndex].Description = "The desconstruct or modified param"
    ghenv.Component.Params.Output[outputIndex].Optional = False
    outputIndex+=1
    
    ghenv.Component.Params.Output[outputIndex].Name = "Name"
    ghenv.Component.Params.Output[outputIndex].NickName = "Name"
    ghenv.Component.Params.Output[outputIndex].Description = "Name of the param."
    ghenv.Component.Params.Output[outputIndex].Optional = False
    outputIndex+=1
    
    ghenv.Component.Params.Output[outputIndex].Name = "NickName"
    ghenv.Component.Params.Output[outputIndex].NickName = "NickName"
    ghenv.Component.Params.Output[outputIndex].Description = "Nickname of the param."
    ghenv.Component.Params.Output[outputIndex].Optional = False
    outputIndex+=1
    
    ghenv.Component.Params.Output[outputIndex].Name = "Description"
    ghenv.Component.Params.Output[outputIndex].NickName = "Description"
    ghenv.Component.Params.Output[outputIndex].Description = "Description of the param."
    ghenv.Component.Params.Output[outputIndex].Optional = True
    outputIndex+=1
    
    ghenv.Component.Params.Output[outputIndex].Name = "Optional"
    ghenv.Component.Params.Output[outputIndex].NickName = "Optional"
    ghenv.Component.Params.Output[outputIndex].Description = "Wheather the param is optional."
    ghenv.Component.Params.Output[outputIndex].Optional = True
    outputIndex+=1
    
    ghenv.Component.Params.Output[outputIndex].Name = "Success"
    ghenv.Component.Params.Output[outputIndex].NickName = "Success"
    ghenv.Component.Params.Output[outputIndex].Description = "Wheather the operation was successful."
    ghenv.Component.Params.Output[outputIndex].Optional = False
    outputIndex+=1

input = ghenv.Component.Params.Input[0]
param = input.Sources[0]
if Ru:
    if Na:
        param.Name = Na
    if NN:
        param.NickName = NN
    if Dc:
        param.Description = Dc
    if Op:
        param.Optional = Op
    Success = True
else:
    Success = False
Param = param
Name = param.Name
NickName = param.NickName
Description = param.Description
Optional = param.Optional
# ---------- end prm ----------
concat = Concatenate(FragmentA="\"", FragmentB=prm.Description, FragmentC="\"")
merge = Merge(Data1=emoji, Data2=prm.NickName, Data3=abbreviation, Data4=prm.Name, Data5=concat)
join = TextJoin(Text=merge, Join=",")
de = ClusterInput()
paper = ClusterInput()
panel = Panel(join)
path = ClusterInput()
na = ClusterInput()
description = ClusterInput()
variant = ClusterInput()
rp = ClusterInput()
collider = ClusterInput()
volume = ClusterInput()
ex = ClusterInput()
group = ClusterInput()
po = ClusterInput()
authors = ClusterInput()
qualities = ClusterInput()
sep = Separator()  # -> S; same code as sep
path_2 = FilePath(path)
na_2 = Name(na)
description_2 = Description(description)
variant_2 = Variant(variant)
de_2 = Default(de)
rp_2 = Representation(rp)
volume_2 = Volume(volume)
group_2 = Group(group)
paper_2 = Paper(paper)
collider_2 = Collider(collider)
authors_2 = Authors(authors)
qualities_2 = Qualities(qualities)
po_2 = Port(po)
ex_2 = Export(ex)
merge_2 = Merge(Data1=de_2, Data2=paper_2, Data3=collider_2, Data4=volume_2)
rep = ModelRepresentation(Representation=rp_2)  # -> Representation, Valid, Url, Description, Tags, Qualities
rep_2 = ReplaceText(Text=variant_2, Find="/", Replace="slash", RecursiveReplace=False)
txt = NormalizeText(Text=na_2)  # -> Strict, Title, Underscore, Kebab, Pascal
split = SplitList(List=rep.Tags, Index="1")  # -> ListA, ListB
rep_3 = ReplaceText(Text=rep_2, Find="\", Replace="backslash", RecursiveReplace=False)
panel_2 = Panel(rp_2)
txt_2 = NormalizeText(Text=rep_3)  # -> Strict, Title, Underscore, Kebab, Pascal
join_2 = TextJoin(Text=split.ListB, Join="_")
panel_3 = Panel("""default
paper
collider
volume""")
concat_2 = Concatenate(FragmentA=txt.Kebab, FragmentD="_", FragmentB=txt_2.Kebab)
concat_3 = Concatenate(FragmentA="images", FragmentB=sep, FragmentC=concat_2, FragmentD=".png")
concat_4 = Concatenate(FragmentA="icons", FragmentB=sep, FragmentC=concat_2, FragmentD=".svg")
concat_5 = Concatenate(FragmentA=concat_2, FragmentB=".glb")
concat_6 = Concatenate(FragmentA=concat_2, FragmentD="_", FragmentB=join_2)
concat_7 = Concatenate(FragmentA="representations", FragmentB=sep, FragmentC=concat_2, FragmentD=".glb")
concat_8 = Concatenate(FragmentA="representations", FragmentB=sep, FragmentC=concat_2, FragmentD=".3dm")
concat_9 = Concatenate(FragmentA=concat_6, FragmentB=".glb")
concat_10 = Concatenate(FragmentA=concat_6, FragmentB=".3dm")
concat_11 = Concatenate(FragmentD=concat_2, FragmentC="_", FragmentA=panel_3, FragmentB=".3dm")
concat_12 = Concatenate(FragmentA=concat_2, FragmentC="_", FragmentB=panel_3, FragmentD=".glb")
concat_13 = Concatenate(FragmentA="representations", FragmentB=sep, FragmentC=concat_10)
concat_14 = Concatenate(FragmentA="representations", FragmentB=sep, FragmentC=concat_9)
concat_15 = Concatenate(FragmentA="representations", FragmentB=sep, FragmentC=concat_11)
concat_16 = Concatenate(FragmentA="representations", FragmentB=sep, FragmentC=concat_12)
panel_4 = Panel(concat_13)
rep_4 = ModelRepresentation(Url=concat_13, Tags=split.ListB)  # -> Representation, Valid, Url, Description, Tags, Qualities
rep_5 = ModelRepresentation(Url=graft(concat_16), Tags=graft(panel_3))  # -> Representation, Valid, Url, Description, Tags, Qualities
rep_6 = ModelRepresentation(Url=concat_14, Tags=split.ListB)  # -> Representation, Valid, Url, Description, Tags, Qualities
rep_7 = ModelRepresentation(Url=graft(concat_15), Tags=graft(panel_3))  # -> Representation, Valid, Url, Description, Tags, Qualities
rep_8 = ModelRepresentation(Url=concat_7)  # -> Representation, Valid, Url, Description, Tags, Qualities
rep_9 = ModelRepresentation(Url=concat_8)  # -> Representation, Valid, Url, Description, Tags, Qualities
trim = TrimTree(Tree=rep_4.Representation, Depth=1)
trim_2 = TrimTree(Tree=rep_6.Representation, Depth=1)
trim_3 = TrimTree(Tree=rep_7.Representation, Depth=1)
trim_4 = TrimTree(Tree=rep_5.Representation, Depth=1)
merge_3 = Merge(Data1=rep_8.Representation, Data2=rep_9.Representation, Data3=trim, Data4=trim_2, Data5=trim_4, Data6=trim_3)
concat_17 = Concatenate(FragmentA=path_2, FragmentB=sep, FragmentC=concat_16)
concat_18 = Concatenate(FragmentA=path_2, FragmentB=sep, FragmentC=concat_14)
concat_collider_glb = Concatenate(FragmentA=path_2, FragmentB=sep, FragmentC=concat_16)
cluster = Cluster(gr=merge_2)  # -> geo_2, txt_2
typ = ModelType(
    Name=txt.Title,
    Description=description_2,
    Icon=concat_4,
    Image=concat_3,
    Variant=variant_2,
    Representations=merge_3,
    Ports=po_2,
    Authors=authors_2,
    Qualities=qualities_2)  # -> Type, Valid, Name, Description, Icon, Image, Variant, Stock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
geo = ExportGeometry(F=concat_collider_glb, G=collider_2, R=ex_2)  # -> S; inputs G: tree of GeometryBase, R: Boolean
# ---------- geo: C# ----------
// Grasshopper Script Instance
#region Usings
using System;
using System.Linq;
using System.Collections;
using System.Collections.Generic;
using System.Drawing;
using System.IO;

using Rhino;
using Rhino.Geometry;

using Grasshopper;
using Grasshopper.Kernel;
using Grasshopper.Kernel.Data;
using Grasshopper.Kernel.Types;
#endregion

public class Script_Instance : GH_ScriptInstance
{
    #region Notes
    /* 
      Members:
        RhinoDoc RhinoDocument
        GH_Document GrasshopperDocument
        IGH_Component Component
        int Iteration

      Methods (Virtual & overridable):
        Print(string text)
        Print(string format, params object[] args)
        Reflect(object obj)
        Reflect(object obj, string method_name)
    */
    #endregion

    private void RunScript(object F, DataTree<GeometryBase> G, bool R, ref object S)
    {
        // inspired from https://github.com/jhorikawa/GrasshopperProgrammingTutorials/blob/master/0015%20Export%20Geometry%20with%20Grasshopper%20C%23/Export%20Geometry%20with%20Grasshopper%20C%23.gh
        if(R){
            var guids = new List<Guid>();

            for(int i = 0; i < G.BranchCount; i++){
                for(int n = 0; n < G.Branches[i].Count; n++){
                var geom = G.Branches[i][n];
                var guid = Rhino.RhinoDoc.ActiveDoc.Objects.Add(geom);
                guids.Add(guid);
                }
            }

            Rhino.RhinoDoc.ActiveDoc.Objects.Select(guids);

            string cmd = "_-Export " + "\"" + F + "\"" + " _Enter _Enter";

            Rhino.RhinoApp.RunScript(cmd, false);

            Rhino.RhinoDoc.ActiveDoc.Objects.Delete(guids, true);
            S = true;
        }
    }
}
# ---------- end geo ----------
concat_3dm = Concatenate(FragmentA=path_2, FragmentB=sep, FragmentC=concat_13)
geo_2 = ExportGeometry(F=concat_18, G=collider_2, R=ex_2)  # -> S; inputs G: tree of GeometryBase, R: Boolean; same code as geo
geo_3 = ExportGeometry(F=concat_17, G=cluster.geo_2, R=ex_2)  # -> S; inputs G: tree of GeometryBase, R: Boolean; same code as geo
geo_4 = ExportGeometry()  # -> S; inputs G: tree of GeometryBase, R: Boolean; same code as geo
ty = Type(typ.Type)
ba = Text(concat_2)
ty_2 = ClusterOutput(ty)
ba_2 = ClusterOutput(ba)
blc = ExportBlock_3(export=ex_2, ob=group_2)  # -> block_definition_3, path_4, exported_2
blc_2 = ExportBlock_2(path=path_2, gr=group_2, ty=typ.Type, rp=rp_2, export=ex_2)  # -> block_definition_3, path_4, exported_2
blc_3 = ExportBlock_2(path=path_2, export=ex_2)  # -> block_definition_3, path_4, exported_2
geo_5 = ExportGeometry(F=concat_3dm, G=group_2, R=ex_2)  # -> S; inputs G: tree of GeometryBase, R: Boolean; same code as geo

# ==== cluster PreviewPort: Preview a port by showing the point and direction and if exists: id, family and compatible families.
po = ClusterInput()
sc = ClusterInput()
sc_2 = Number(sc)
po_2 = Port(po)
por = ModelPort(Port=po_2)  # -> Port, Valid, Id, Description, Mandatory, Family, CompatibleFamilies, Point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
swatch = ColourSwatch(SwatchColor=RGB(235, 52, 79))
swatch_2 = ColourSwatch(SwatchColor=RGB(250, 149, 0))
amp = Amplitude(Vector=por.Direction, Amplitude=sc_2)
lng = ListLength(List=por.CompatibleFamilies)
expression = Expression(x=por.Family, Expression="x=\"\"")
cull = CullPattern(List=por.Point, CullPattern=expression)
expression_2 = Expression(x=lng, Expression="x=0")
join = TextJoin(Text=por.CompatibleFamilies, Join=",")
merge = Merge(Data1=":")
trim = TrimTree(Tree=join, Depth=1)
trim_2 = TrimTree(Tree=expression_2, Depth=1)
item = ListItem(List=merge, Index=expression, Wrap=invert(True))
log = Logarithm(Value=sc_2)
concat = Concatenate(FragmentA="[", FragmentB=trim, FragmentC="]")
expression_3 = Expression(y=trim_2, Expression="x")
merge_2 = Merge(Data1=graft(concat), Data2=graft(expression_3))
item_2 = ListItem(List=merge_2, Index=graft(expression), Wrap=invert(True))
multiplication = Multiplication(A=log, B=Slider(2, range=0..10))
trim_3 = TrimTree(Tree=item_2, Depth=1)
concat_2 = Concatenate(FragmentA=por.Id, FragmentB=item, FragmentC=por.Family, FragmentD=trim_3)
preview = CustomPreview(Geometry=cull, Material=swatch)
tag = TextTag(Location=por.Point, Text=concat_2, Colour=swatch)
vdisex = VectorDisplayEx(Point=por.Point, Vector=amp, Colour=ColourSwatch(SwatchColor=RGB(0, 166, 157)), Width=multiplication)

# ==== cluster ExportBlock_2: Export geometry with layer names to a file.
gr = ClusterInput()
ty = ClusterInput()
export = ClusterInput()
rp = ClusterInput()
path = ClusterInput()
path_2 = FilePath(path)
ty_2 = Type(ty)
rp_2 = Representation(rp)
export_2 = Boolean(export)
cluster = Cluster(gr=gr)  # -> geo_2, txt_2
layer = ModelLayer(Name=cluster.txt_2)  # -> Layer, Name, Hidden, Locked, DisplayColour, Material, Linetype
object = ModelObject(Geometry=cluster.geo_2, Layer=layer.Layer)  # -> Object, Geometry, Name, Layer, Visibility, Display, Drafting, Render
typ = ModelType(Type=ty_2)  # -> Type, Valid, Name, Description, Icon, Image, Variant, Stock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
rep = ModelRepresentation(Representation=rp_2)  # -> Representation, Valid, Url, Description, Tags, Qualities
trim = TrimTree(Tree=object.Object, Depth="5")
concat = Concatenate(FragmentA=typ.Type, FragmentC=":", FragmentB=rep.Representation)
block_definition = ModelBlockDefinition(Objects=trim, Name=concat, Notes=typ.Description)  # -> BlockDefinition, Objects, Units, Name, Notes, URL, URLDescription
export_definition = ExportModelBlockDefinition(BlockDefinition=block_definition.BlockDefinition, FilePath=path_2, Overwrite="T", Export=export_2)  # -> BlockDefinition, FilePath, Exported
block_definition_2 = ModelBlockDefinition(export_definition.BlockDefinition)
path_3 = FilePath(export_definition.FilePath)
exported = Boolean(export_definition.Exported)

# ---- group: Export single files. WIP
sep = Separator()  # -> S
# ---------- sep: C# ----------
#region Usings
using System;
using System.Linq;
using System.Collections;
using System.Collections.Generic;
using System.Drawing;
using System.IO;

using Rhino;
using Rhino.Geometry;

using Grasshopper;
using Grasshopper.Kernel;
using Grasshopper.Kernel.Data;
using Grasshopper.Kernel.Types;
#endregion

public class Script_Instance : GH_ScriptInstance
{
    private void RunScript(ref object S)
    {
        S = Path.DirectorySeparatorChar;
    }
}
# ---------- end sep ----------
rep_2 = ReplaceText(Text=rep.Url, Find="/", Replace=sep, RecursiveReplace=False)
item = ListItem(List=rep.Tags, Index=0, Wrap=True)
concat_2 = Concatenate(FragmentA=path_2, FragmentB=sep, FragmentC=rep_2)
mime = Mime({".glb": "model/gltf-binary", ".gltf": "model/gltf+json", ".stl": "model/stl", ".obj": "model/obj", ".blend": "model/x-blender", ".3dm": "model/vnd.3dm", ".ifc": "model/x-ifc", ".dwg": "model/acad", ".dxf": "model/dxf", ".rvt": "model/vnd.revit"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}, selected=".3dm")
trim_2 = TrimTree(Tree=item, Depth=1)
expression = Expression(x=trim_2, y=mime, Expression="x=y")
# WIP
dispatch = Dispatch(List=concat_2, DispatchPattern=expression)  # -> ListA, ListB
dispatch_2 = Dispatch(List=concat_2, DispatchPattern=expression)  # -> ListA, ListB

# ----
exported_2 = ClusterOutput(exported)
path_4 = ClusterOutput(path_3)
block_definition_3 = ClusterOutput(block_definition_2)

# ==== cluster ExportBlock_3: Export geometry with layer names to a file.
ob = ClusterInput()
G = ClusterInput()
dc = ClusterInput()
path = ClusterInput()
name = ClusterInput()
url = ClusterInput()
layer_n = ClusterInput()
export = ClusterInput()
ob_2 = ModelObject(ob)
group = Group(Geometry=G)
path_2 = FilePath(path)
name_2 = Text(name)
url_2 = Text(url)
export_2 = Boolean(export)
layer_n_2 = Name(layer_n)
dc_2 = DisplayColour(dc)
object = ModelObject(Object=group)  # -> Object, Geometry, Name, Layer, Visibility, Display, Drafting, Render
layer = ModelLayer(Name=layer_n_2, DisplayColour=dc_2)  # -> Layer, Name, Hidden, Locked, DisplayColour, Material, Linetype, PrintColour, PrintWidth
object_2 = ModelObject(group)
group_2 = NamedGroup(Geometry=group)  # -> Group, Geometry, Name
object_3 = ModelObject(Geometry=object_2, Layer=layer.Layer)  # -> Object, Geometry, Name, Layer, Visibility, Display, Drafting, Render
object_4 = ModelObject(Object=object_2)  # -> Object, Geometry, Name, Layer, Visibility, Display, Drafting, Render
block_definition = ModelBlockDefinition(Objects=object_3.Object, Name=name_2, URL=url_2)  # -> BlockDefinition, Objects, Units, Name, Notes, URL, URLDescription
panel = Panel(object_4.Layer)
export_definition = ExportModelBlockDefinition(BlockDefinition=block_definition.BlockDefinition, FilePath=path_2, Overwrite="T", Export=export_2)  # -> BlockDefinition, FilePath, Exported
block_definition_2 = ModelBlockDefinition(export_definition.BlockDefinition)
path_3 = FilePath(export_definition.FilePath)
exported = Boolean(export_definition.Exported)
path_4 = ClusterOutput(path_3)
exported_2 = ClusterOutput(exported)
block_definition_3 = ClusterOutput(block_definition_2)

# ==== cluster Cluster
gr = ClusterInput()
gr_2 = Group(gr)
group = NamedGroup(Group=gr_2)  # -> Group, Geometry, Name
group_2 = NamedGroup(Group=group.Geometry)  # -> Group, Geometry, Name
expression = Expression(x=graft(group.Name), y=group_2.Name, Expression="x")
group_3 = NamedGroup(Group=group_2.Geometry)  # -> Group, Geometry, Name
expression_2 = Expression(x=graft(expression), y=group_3.Name, Expression="x")
expression_3 = Expression(x=graft(group_2.Name), y=group_3.Name, Expression="x")
group_4 = NamedGroup(Group=group_3.Geometry)  # -> Group, Geometry, Name
expression_4 = Expression(x=graft(expression_2), y=group_4.Name, Expression="x")
expression_5 = Expression(x=graft(expression_3), y=group_4.Name, Expression="x")
expression_6 = Expression(x=graft(group_3.Name), y=group_4.Name, Expression="x")
group_5 = NamedGroup(Group=group_4.Geometry)  # -> Group, Geometry, Name
expression_7 = Expression(x=graft(expression_4), y=group_5.Name, Expression="x")
expression_8 = Expression(x=graft(expression_5), y=group_5.Name, Expression="x")
expression_9 = Expression(x=graft(expression_6), y=group_5.Name, Expression="x")
expression_10 = Expression(x=graft(group_4.Name), y=group_5.Name, Expression="x")
group_6 = NamedGroup(Group=group_5.Geometry)  # -> Group, Geometry, Name
expression_11 = Expression(x=graft(expression_7), y=group_6.Name, Expression="x")
expression_12 = Expression(x=graft(expression_9), y=group_6.Name, Expression="x")
expression_13 = Expression(x=graft(expression_8), y=group_6.Name, Expression="x")
expression_14 = Expression(x=graft(expression_10), y=group_6.Name, Expression="x")
expression_15 = Expression(x=graft(group_5.Name), y=group_6.Name, Expression="x")
merge = Merge(
    Data1=expression_11,
    Data2=expression_13,
    Data3=expression_12,
    Data4=expression_14,
    Data5=expression_15,
    Data6=group_6.Name)
join = TextJoin(Text=merge, Join="::")
geo = Geometry(group_6.Geometry)
txt = Text(join)
geo_2 = ClusterOutput(geo)
txt_2 = ClusterOutput(txt)
