# Grasshopper definition tiles.gh (Grasshopper 1.0.8)

_2d = _2D(
    raster=Slider(5.2, range=0..10),
    corridor=Slider(2.4, range=0..10),
    offset=Slider(0.7, range=0..1),
    shift=Slider(0.25, range=0..1))  # -> columns_3, slab_2, beams_2
_3d = _3D(
    columns=_2d.columns_3,
    slabs=_2d.slab_2,
    beams=_2d.beams_2,
    floor=Slider(3, range=0..10),
    slab=Slider(0.265, range=0..1),
    beam=Slider(0.45, range=0..1),
    width=Slider(0.56, range=0..1))  # -> slabs_6, columns_6, beams_6, slabs_5, columns_5, beams_4, points_2, vec_2, ids_2, port_2
merge = Merge(Data1=_3d.slabs_5, Data2=_3d.beams_4, Data3=_3d.columns_5)
merge_2 = Merge(Data1=_3d.slabs_6, Data2=_3d.columns_6, Data3=_3d.beams_6)
txt = Text()
merge_3 = Merge()

# ==== cluster _2D
raster = ClusterInput()
corridor = ClusterInput()
offset = ClusterInput()
shift = ClusterInput()
raster_2 = Number(raster)
corridor_2 = Number(corridor)
offset_2 = Number(offset)
shift_2 = Number(shift)
expression = Expression(x=raster_2, Expression="x*Sqrt(3)/2")
expression_2 = Expression(x=offset_2, Expression="x*2/Sqrt(3)")
expression_3 = Expression(x=raster_2, Expression="x*Sqrt(3)/6")
expression_4 = Expression(x=raster_2, Expression="x/Sqrt(3)")
expression_5 = Expression(x=raster_2, Expression="x/2")
expression_6 = Expression(x=corridor_2, Expression="x/2")
expression_7 = Expression(x=raster_2, Expression="x/4")
addition = Addition(A=raster_2, B=corridor_2)
X = UnitX(Factor=expression_6)
X_2 = UnitX(Factor=raster_2)
triangle_height = Number(expression)
X_3 = UnitX(Factor=expression_5)
rev = Reverse(Vector=X_3)
Y = UnitY(Factor=triangle_height)
rev_2 = Reverse(Vector=Y)
X_4 = UnitX(Factor=raster_2)
Y_2 = UnitY(Factor=triangle_height)
X_5 = UnitX(Factor=expression_5)
pt = ConstructPoint(XCoordinate=0, YCoordinate=0, ZCoordinate=0)
addition_2 = Addition(A=rev, B=rev_2)
rev_3 = Reverse(Vector=Y_2)
rev_4 = Reverse(Vector=X_5)
addition_3 = Addition(A=X_3, B=Y)
X_6 = UnitX(Factor=expression_2)
rev_5 = Reverse(Vector=X_6)
multiplication = Multiplication(A=shift_2, B=rev_3)
move = Move(Geometry=pt, Motion=addition_3)  # -> Geometry, Transform
multiplication_2 = Multiplication(A=shift_2, B=rev_4)
move_2 = Move(Geometry=pt, Motion=X_4)  # -> Geometry, Transform
column_1 = Point(pt)
column_2 = Point(move_2.Geometry)
column_3 = Point(move.Geometry)
addition_4 = Addition(A=multiplication, B=multiplication_2)
merge = Merge(Data1=pt, Data2=move_2.Geometry, Data3=move.Geometry)
merge_2 = Merge(Data1=pt, Data2=move_2.Geometry)
columns_1 = Point(merge_2)
X_7 = UnitX(Factor=addition)
pline = PolyLine(Vertices=merge, Closed=invert(False))
move_3 = Move(Geometry=columns_1, Motion=X_7)  # -> Geometry, Transform
triangle_1 = Curve(pline)
move_4 = Move(Geometry=triangle_1, Motion=X_2)  # -> Geometry, Transform
rotate = Rotate(Geometry=move_4.Geometry, Angle=degrees("60"), Plane=move_2.Geometry)  # -> Geometry, Transform
triangle_2 = Curve(rotate.Geometry)
merge_3 = Merge(Data1=triangle_1, Data2=triangle_2)
triangles_1 = Curve(merge_3)
move_5 = Move(Geometry=triangles_1, Motion=X_7)  # -> Geometry, Transform
triangles_2 = Curve(move_5.Geometry)
columns_2 = Point(move_3.Geometry)
merge_4 = Merge(Data1=columns_1, Data2=columns_2)
item = ListItem(List=columns_2, Index=0, Wrap=True)  # -> Item, Item1
columns = Point(merge_4)
columns_3 = ClusterOutput(columns)
Z = UnitZ(Factor=1)
merge_5 = Merge(Data1=triangle_1, Data2=triangle_2)
merge_6 = Merge(Data1=triangles_1, Data2=triangles_2)
move_6 = Move(Geometry=merge_6, Motion=addition_2)  # -> Geometry, Transform
runion = RegionUnion(Curves=merge_5)
triangles_b = Curve(move_6.Geometry)
triangles_a = Curve(merge_6)
trim = TrimTree(Tree=runion, Depth=1)
merge_7 = Merge(Data1=triangles_a, Data2=triangles_b)
parallelogram_1 = Curve(trim)
merge_8 = Merge(Data1=parallelogram_1)
move_7 = Move(Geometry=merge_8, Motion=rev_5)  # -> Geometry, Transform
move_8 = Move(Geometry=parallelogram_1, Motion=X_7)  # -> Geometry, Transform
parallelogram_2 = Curve(move_8.Geometry)
merge_9 = Merge(Data1=parallelogram_2)
move_9 = Move(Geometry=merge_9, Motion=X_6)  # -> Geometry, Transform
merge_10 = Merge(Data1=move_7.Geometry, Data2=move_9.Geometry)
cp = ControlPoints(Curve=merge_10)  # -> Points, Weights, Knots
trim_2 = TrimTree(Tree=cp.Points, Depth=1)
hull2d = ConvexHull(Points=trim_2, Plane=PlaneXY(0, 0, 0))  # -> Hull, HullZ, Indices
outline_1 = Curve(hull2d.Hull)
bbox = BoundingBox(Content=outline_1, Plane=PlaneXY(0, 0, 0))  # -> Box, Box_2
debox = DeconstructBox(Box=bbox.Box_2)  # -> Plane, X, Y, Z
trim_3 = TrimTree(Tree=debox.Plane, Depth=1)
trim_4 = TrimTree(Tree=debox.Y, Depth=1)
trim_5 = TrimTree(Tree=debox.X, Depth=1)
rectangle = Rectangle(Plane=trim_3, XSize=trim_5, YSize=trim_4, Radius=0)  # -> Rectangle, Length
move_10 = Move(Geometry=outline_1, Motion=addition_2)  # -> Geometry, Transform
move_11 = Move(Geometry=rectangle.Rectangle, Motion=addition_4)  # -> Geometry, Transform
outline_2 = Curve(move_10.Geometry)
cutter = Curve(move_11.Geometry)
merge_11 = Merge(Data1=outline_1, Data2=outline_2)
srf = Surface(cutter)
runion_2 = RegionUnion(Curves=merge_11)
extr = Extrude(Base=srf, Direction=Z)
trim_6 = TrimTree(Tree=runion_2, Depth=1)
rint = RegionIntersection(CurvesA=trim_6, CurvesB=cutter)
merge_12 = Merge(Data1=parallelogram_1, Data2=parallelogram_2)
parallelograms_1 = Curve(merge_12)
move_12 = Move(Geometry=parallelograms_1, Motion=addition_2)  # -> Geometry, Transform
parallelograms_2 = Curve(move_12.Geometry)
item_2 = ListItem(List=parallelograms_2, Index=0, Wrap=True)  # -> Item, Item1
parallelogram_a = Curve(item_2.Item)
parallelogram_b = Curve(item_2.Item1)
triangles = Curve(merge_7)
trim_7 = TrimWithBrep(Curve=triangles, Brep=extr)  # -> Inside, Outside
trim_8 = TrimTree(Tree=trim_7.Inside, Depth=1)
item_3 = ListItem(List=trim_8, Index=0, Wrap=True)  # -> Item, Item1, Item2, Item3, Item4, Item5, Item6, Item7
crv_cp = CurveClosestPoint(Point=columns_1, Curve=item_3.Item)  # -> Point, Parameter, Distance
crv_cp_2 = CurveClosestPoint(Point=column_2, Curve=item_3.Item1)  # -> Point, Parameter, Distance
crv_cp_3 = CurveClosestPoint(Point=columns_2, Curve=item_3.Item2)  # -> Point, Parameter, Distance
crv_cp_4 = CurveClosestPoint(Point=item.Item1, Curve=item_3.Item3)  # -> Point, Parameter, Distance
crv_cp_5 = CurveClosestPoint(Point=column_1, Curve=item_3.Item4)  # -> Point, Parameter, Distance
crv_cp_6 = CurveClosestPoint(Point=columns_1, Curve=item_3.Item5)  # -> Point, Parameter, Distance
crv_cp_7 = CurveClosestPoint(Point=item.Item, Curve=item_3.Item6)  # -> Point, Parameter, Distance
crv_cp_8 = CurveClosestPoint(Point=columns_2, Curve=item_3.Item7)  # -> Point, Parameter, Distance
shatter = Shatter(Curve=item_3.Item, Parameters=crv_cp.Parameter)
shatter_2 = Shatter(Curve=item_3.Item1, Parameters=crv_cp_2.Parameter)
shatter_3 = Shatter(Curve=item_3.Item2, Parameters=crv_cp_3.Parameter)
shatter_4 = Shatter(Curve=item_3.Item3, Parameters=crv_cp_4.Parameter)
shatter_5 = Shatter(Curve=item_3.Item4, Parameters=crv_cp_5.Parameter)
shatter_6 = Shatter(Curve=item_3.Item5, Parameters=crv_cp_6.Parameter)
shatter_7 = Shatter(Curve=item_3.Item6, Parameters=crv_cp_7.Parameter)
shatter_8 = Shatter(Curve=item_3.Item7, Parameters=crv_cp_8.Parameter)
trim_9 = TrimTree(Tree=shatter, Depth=1)
trim_10 = TrimTree(Tree=shatter_2, Depth=1)
trim_11 = TrimTree(Tree=shatter_3, Depth=1)
trim_12 = TrimTree(Tree=shatter_4, Depth=1)
trim_13 = TrimTree(Tree=shatter_5, Depth=1)
trim_14 = TrimTree(Tree=shatter_6, Depth=1)
trim_15 = TrimTree(Tree=shatter_7, Depth=1)
trim_16 = TrimTree(Tree=shatter_8, Depth=1)
item_4 = ListItem(List=trim_9, Index=0, Wrap=invert(True))  # -> Item, Item1, Item2
item_5 = ListItem(List=trim_10, Index=0, Wrap=invert(True))  # -> Item, Item1
move_13 = Move(Geometry=item_5.Item1, Motion=X)  # -> Geometry, Transform
ext = ExtendCurve(Curve=move_13.Geometry, Type=0, Start=raster_2, End="0")
item_6 = ListItem(List=trim_11, Index=0, Wrap=invert(True))  # -> Item, Item1, Item2
item_7 = ListItem(List=trim_12, Index=0, Wrap=invert(True))  # -> Item, Item1
item_8 = ListItem(List=trim_13, Index=0, Wrap=invert(True))  # -> Item, Item1
item_9 = ListItem(List=trim_14, Index=0, Wrap=invert(True))  # -> Item, Item1, Item2
item_10 = ListItem(List=trim_15, Index=0, Wrap=invert(True))  # -> Item, Item1
item_11 = ListItem(List=trim_16, Index=0, Wrap=invert(True))  # -> Item, Item1, Item2
srfsplit = SurfaceSplit(Surface=rint, Curves=ext)
flip = FlipCurve(Curve=item_4.Item)  # -> Curve, Flag
flip_2 = FlipCurve(Curve=item_9.Item)  # -> Curve, Flag
flip_3 = FlipCurve(Curve=item_11.Item)  # -> Curve, Flag
flip_4 = FlipCurve(Curve=item_5.Item)  # -> Curve, Flag
flip_5 = FlipCurve(Curve=item_6.Item)  # -> Curve, Flag
flip_6 = FlipCurve(Curve=item_7.Item)  # -> Curve, Flag
trim_17 = TrimTree(Tree=srfsplit, Depth=1)
merge_13 = Merge(
    Data1=flip.Curve,
    Data2=flip_4.Curve,
    Data3=item_5.Item1,
    Data4=flip_5.Curve,
    Data5=flip_6.Curve,
    Data6=item_7.Item1,
    Data7=flip_2.Curve,
    Data8=item_9.Item2,
    Data9=item_10.Item1,
    Data10=flip_3.Curve,
    Data11=item_11.Item2)
merge_14 = Merge(Data1=item_9.Item1, Data2=item_11.Item1)
crv = Curve(item_4.Item)
slab = Surface(trim_17)
entwine = Entwine(Branch00=merge_14, Branch01=merge_13, FlattenInputs=True)
slab_2 = ClusterOutput(slab)
beams = Curve(entwine)
beams_2 = ClusterOutput(beams)

# ==== cluster _3D
columns = ClusterInput()
slabs = ClusterInput()
beams = ClusterInput()
floor = ClusterInput()
slab = ClusterInput()
beam = ClusterInput()
width = ClusterInput()
columns_2 = Point(columns)
slabs_2 = Surface(slabs)
beams_2 = Curve(beams)
floor_2 = Number(floor)
slab_2 = Number(slab)
beam_2 = Number(beam)
width_2 = Number(width)
expression = Expression(x=width_2, Expression="x/2")
expression_2 = Expression(x=expression, Expression="x/2")
expression_3 = Expression(x=beam_2, Expression="x/2")
beam_width = Number(expression)
beam_parallelogram_top_bottom_triangle_c = Panel("""b-p1-t-t1-c3-l
b-p1-t-t1-c3-r
b-p1-t-t2-c3-l
b-p2-t-t1-c3-l
b-p2-t-t1-c3-r
b-p2-t-t2-c3-l
b-p1-b-t1-c2-l
b-p1-b-t1-c1-r
b-p2-b-t1-c1-l
b-p2-b-t1-c2-l
b-p2-b-t1-c1-r""")  # "beam parallelogram top|bottom triangle column left|right"
polygon = Polygon(Plane=columns_2, Radius=expression, Segments=6, FilletRadius=0)  # -> Polygon, Length
neg = Negative(Value=expression_2)
neg_2 = Negative(Value=expression_3)
Z = UnitZ(Factor=1)
xz = XZPlane(Origin=Point(0, 0, 0))
dom = ConstructDomain(DomainStart=expression_3, DomainEnd=neg_2)
bang = ExplodeTree(Data=beams_2)  # -> Branch0, Branch1
dom_2 = ConstructDomain(DomainStart=expression_2, DomainEnd=neg)
rotate = Rotate(Geometry=polygon.Polygon, Angle=degrees("30"), Plane=columns_2)  # -> Geometry, Transform
subtraction = Subtraction(A=floor_2, B=slab_2)
line = LineSDL(Start=columns_2, Direction=Z, Length=subtraction)
rectangle = Rectangle(Plane=xz, XSize=dom_2, YSize=dom, Radius=0)  # -> Rectangle, Length
runion = RegionUnion(Curves=slabs_2)
Z_2 = UnitZ(Factor=subtraction)
srf = Surface(rotate.Geometry)
columns_3 = Line(line)
ext = ExtendCurve(Curve=bang.Branch1, Type=0, Start="0", End=expression)
Z_3 = UnitZ(Factor=slab_2)
trim = TrimTree(Tree=runion, Depth=1)
extr = Extrude(Base=srf, Direction=Z_2)
merge = Merge(Data1=bang.Branch0, Data2=ext)
pframe = PerpFrame(Curve=reparameterize(merge), Parameter="0")
Z_4 = UnitZ(Factor=subtraction)
move = Move(Geometry=slabs_2, Motion=Z_2)  # -> Geometry, Transform
Z_5 = UnitZ(Factor=floor_2)
crv = Curve(trim)
prot = RotatePlane(Plane=pframe, Angle=degrees("90"))
columns_4 = Brep(extr)
beam_parallelogram_top_bottom_triangle_c_2 = Panel("""b-l
b-l-m
b-l
b-l
b-l-m
b-l
b-s-m
b-s
b-s-m
b-s-m
b-s""")  # "beam parallelogram top|bottom triangle column left|right"
Z_6 = UnitZ(Factor=beam_2)
move_2 = Move(Geometry=beams_2, Motion=Z_4)  # -> Geometry, Transform
extr_2 = Extrude(Base=move.Geometry, Direction=Z_3)
extr_3 = Extrude(Base=crv, Direction=Z_5)
orient = Orient(Geometry=rectangle.Rectangle, Source=xz, Target=prot)  # -> Geometry, Transform
subtraction_2 = Subtraction(A=Z_2, B=Z_6)
slabs_3 = Brep(extr_2)
slabs_4 = Surface(move.Geometry)
beams_3 = Line(move_2.Geometry)
bang_2 = ExplodeTree(Data=beams_3)  # -> Branch0, Branch1
end = EndPoints(Curve=bang_2.Branch1)  # -> Start, End
split = SplitList(List=end.End, Index="5")  # -> ListA, ListB
xz_2 = XZPlane(Origin=split.ListA)
pflip = FlipPlane(Plane=xz_2, ReverseX=False, ReverseY=False, SwapAxes=True)
deplane = DeconstructPlane(Plane=pflip)  # -> Origin, XAxis, YAxis, ZAxis
pt = Point(split.ListB)
xz_3 = XZPlane(Origin=pt)
deplane_2 = DeconstructPlane(Plane=xz_3)  # -> Origin, XAxis, YAxis, ZAxis
merge_2 = Merge(Data1=deplane.ZAxis, Data2=deplane_2.ZAxis)
points = Point(end.End)
vec = Vector(merge_2)
ids = Text(beam_parallelogram_top_bottom_triangle_c)
port = Text(beam_parallelogram_top_bottom_triangle_c_2)
swp1 = Sweep1(Rail=graft(merge), Sections=graft(orient.Geometry), Miter=1)
slabs_5 = ClusterOutput(slabs_4)
columns_5 = ClusterOutput(columns_3)
beams_4 = ClusterOutput(beams_3)
points_2 = ClusterOutput(points)
vec_2 = ClusterOutput(vec)
ids_2 = ClusterOutput(ids)
port_2 = ClusterOutput(port)
slabs_6 = ClusterOutput(slabs_3)
columns_6 = ClusterOutput(columns_4)
Z_7 = UnitZ(Factor=expression_3)
trim_2 = TrimTree(Tree=swp1, Depth="3")
move_3 = Move(Geometry=trim_2, Motion=Z_7)  # -> Geometry, Transform
trim_3 = TrimSolid(Shape=move_3.Geometry, Cutters=columns_4)
trim_4 = TrimTree(Tree=trim_3, Depth=1)
cap = CapHoles(Brep=trim_4)
split_2 = SplitBrep(Brep=cap, Cutter=extr_3)
item = ListItem(List=split_2, Index=0, Wrap=True)
cap_2 = CapHoles(Brep=item)
move_4 = Move(Geometry=cap_2, Motion=subtraction_2)  # -> Geometry, Transform
beams_5 = Brep(move_4.Geometry)
beams_6 = ClusterOutput(beams_5)
vdis = VectorDisplay(Anchor=points, Vector=vec)
points_3 = PointList(Points=points, Size=Slider(1, range=0..10))
tag = TextTag(Location=points, Text=beam_parallelogram_top_bottom_triangle_c)
tag_2 = TextTag(Location=points, Text=beam_parallelogram_top_bottom_triangle_c_2)
