# Grasshopper definition sum-qualities-by-hierarchy.gh (Grasshopper 1.0.8)
# Copyright: GNU Lesser General Public License Version 3
# plug-ins: RhinoCodePluginGH

panel = Panel("{0;0}")
# ventilation heating energy demand
panel_2 = Panel("primary energy demand")
graft = GraftTree(Tree=graft("primary heating energy factor"), IncludeEmptyLists=True, IncludeNullItems=True)
merge = Merge()
graft_2 = GraftTree(Tree=graft("125"), IncludeEmptyLists=True, IncludeNullItems=True)
merge_2 = Merge(Data1="80", Data2="45")
merge_3 = Merge()
merge_4 = Merge(Data1="150", Data2="50")
graft_3 = GraftTree(Tree=graft("final heating energy demand"), IncludeEmptyLists=True, IncludeNullItems=True)
merge_5 = Merge(Data1="trasmission heating energy loss", Data2="final ventilation heating energy demand")
merge_6 = Merge(Data1="primary heating energy demand", Data2="pimary cooling energy demand")
flatten = FlattenTree(Tree="90", Path="{0;0;0;1}")  # -> graft(Tree)
flatten_2 = FlattenTree(Tree=merge_3, Path="{0}")  # -> graft(Tree)
flatten_3 = FlattenTree(Path="{0;1}")  # -> graft(Tree)
flatten_4 = FlattenTree(Tree=merge_4, Path="{0}")  # -> graft(Tree)
flatten_5 = FlattenTree(Tree=merge, Path="{0;0;0}")  # -> graft(Tree)
flatten_6 = FlattenTree(Tree="1 - ventilation heating recovery", Path="{0;0;0;1}")  # -> graft(Tree)
flatten_7 = FlattenTree(Tree="40", Path="{0;1}")  # -> graft(Tree)
flatten_8 = FlattenTree(Tree=merge_6, Path="{0}")  # -> graft(Tree)
flatten_9 = FlattenTree(Tree="ventilation heating energy demand", Path="{0;0;0;1}")  # -> graft(Tree)
flatten_10 = FlattenTree(Tree=merge_2, Path="{0;0;0}")  # -> graft(Tree)
flatten_11 = FlattenTree(Tree="final cooling energy demand", Path="{0;1}")  # -> graft(Tree)
flatten_12 = FlattenTree(Tree=merge_5, Path="{0;0;0}")  # -> graft(Tree)
merge_7 = Merge(Data1="200", Data2=flatten_4, Data3=graft_2, Data4=flatten_7, Data5=flatten_10, Data6=flatten)
merge_8 = Merge(Data1=panel_2, Data2=flatten_8, Data3=graft_3, Data4=flatten_11, Data5=flatten_12, Data6=flatten_9)
merge_9 = Merge(Data2=flatten_2, Data3=graft, Data4=flatten_3, Data5=flatten_5, Data6=flatten_6)
panel_3 = Panel(merge_8)
c_script = CSharpScript(Na=merge_8)  # -> out, a; inputs Na: tree, Vl: tree, Fa: tree
# ---------- c_script: C# ----------
// Grasshopper Script Instance
#region Usings
using System;
using System.Linq;
using System.Collections;
using System.Collections.Generic;
using System.Drawing;

using Rhino;
using Rhino.Geometry;

using Grasshopper;
using Grasshopper.Kernel;
using Grasshopper.Kernel.Data;
using Grasshopper.Kernel.Types;
#endregion

public class Script_Instance : GH_ScriptInstance
{
    #region Notes
    /* 
      Members:
        RhinoDoc RhinoDocument
        GH_Document GrasshopperDocument
        IGH_Component Component
        int Iteration

      Methods (Virtual & overridable):
        Print(string text)
        Print(string format, params object[] args)
        Reflect(object obj)
        Reflect(object obj, string method_name)
    */
    #endregion

    private void RunScript(
	DataTree<object> Na,
	DataTree<object> Vl,
	object De,
	DataTree<object> Fa,
	ref object a)
    {
        // Write your logic here
        a = null;
    }
}
# ---------- end c_script ----------
na = Name(merge_8)
tstat = TreeStatistics(Tree=na)  # -> Paths, Length, Count
dpath = DeconstructPath(Branch=tstat.Paths)
lng = ListLength(List=dpath)
join = TextJoin(Text=dpath)  # -> flatten(Result)
panel_4 = Panel(merge_9)
path = ConstructPath(Indices=lng)
merge_10 = Merge(Data1=lng, Data2=dpath)
cset = CreateSet(List=lng)  # -> Set, Map
lng_2 = ListLength(List=cset.Set)
series = Series(Start=0, Step=1, Count=lng_2)
tsort = SortText(Keys=join, Values=tstat.Paths, Culture=127)  # -> Keys, Values
match = MatchTree(Tree=graft(tstat.Paths), Guide=path)
path_2 = ConstructPath(Indices=merge_10)  # -> flatten(Branch)
trim = TrimTree(Tree=series, Depth=1)
sort = SortList(Keys=join)  # -> Keys, ValuesA
d = Integer(cset.Map)
panel_5 = Panel(merge_7)
replace = ReplaceItems(List=cset.Map, Item=cset.Set, Wrap=False)
relblbrch = RelabelBranches(TreeToMatch=na, ListOfPaths=path_2)  # -> RelabeledTree; inputs TreeToMatch: tree, ListOfPaths: list
# ---------- relblbrch: Python ----------
if ghenv.Component.RunCount<2:
    __author__ = "Your name"
    __version__ = "2000.00.00"
    
    ghenv.Component.Name = "RelabelBranches"
    ghenv.Component.NickName = "ReLblBrch"
    ghenv.Component.Description = "Relabel all the paths of the branches with a list of new paths. The amount of branches must match with the size of the list of pahts"
    ghenv.Component.Message = "VER 1.0"
    
    ghenv.Component.Params.Input[0].NickName = "TreeToMatch"
    ghenv.Component.Params.Input[1].NickName = "ListOfPaths"
    
    ghenv.Component.Params.Input[0].Description = "Tree that should be relabeled."
    ghenv.Component.Params.Input[1].Description = "List of paths to use for new branch paths."
    
    ghenv.Component.Params.Output[0].NickName = "RelabeledTree"
    ghenv.Component.Params.Output[0].Description = "Relabeled tree where all the paths of the branches have been replaced with new paths."

from System import Object
from Grasshopper import DataTree

def relabelBranchesWithLstOfPths (tree, paths):
    newTree = DataTree[Object]()
    for i,path in enumerate(tree.Paths):
        items = tree.Branch(path)
        for data in items:
            newTree.Add(data,paths[i])
    return newTree

if __name__ == "__main__":
    RelabeledTree = relabelBranchesWithLstOfPths(TreeToMatch,ListOfPaths)
# ---------- end relblbrch ----------
panel_6 = Panel(match)
sort_2 = SortList(Keys=cset.Set)  # -> Keys, ValuesA
branch = TreeBranch(MaintainPaths=True)
rev = ReverseList(List=sort_2.Keys)
