# Grasshopper definition tests.gh (Grasshopper 1.0.8)
# Copyright: GNU Lesser General Public License Version 3
# plug-ins: semio

panel = Panel("C:\git\semio\semio\examples\metabolism\representations\base.3dm")
file = ReadFile(File="C:\git\semio\semio\assets\semio\kit_metabolism.json", PerLineParse=False)
import = ImportContent(FilePath=panel, Import=Toggle(True))  # -> ModelTransform, Objects, Layers, Linetypes, HatchPatterns, AnnotationStyles, Materials, BlockDefinitions
dkx = DeserializeKit(Text=file)
mog = ModelObjectToGroup(RhinoModelObject=import.Objects)
pkx = PassthroughKit(Kit=dkx)  # -> Kit, Valid, Guid, Name, Version, Description, Icon, Image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
mog_2 = ModelObjectToGroup(RhinoModelObject=import.Objects)
item = ListItem(List=pkx.Design, Index=0, Wrap=True)
item_2 = ListItem(List=pkx.Type, Index=0, Wrap=True)  # -> Item, Item1, Item2, Item3, Item4
pfx = PassthroughFile(File=pkx.File)  # -> File, Valid, Guid, Name, Mime, FolderId, FolderId_2, Size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
ptx = PassthroughType(Type=item_2.Item4)  # -> Type, Valid, Guid, Name, TypeId, IsAbstract, Folder, Description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
pdx = PassthroughDesign(Design=item)  # -> Design, Valid, Guid, Name, DesignId, IsAbstract, Folder, Description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
item_3 = ListItem(List=pkx.File, Index=0, Wrap=True)  # -> Item, Item1, Item2
pmx = PassthroughModel()  # -> Model, Valid, Guid, Name, FileId, Description, TagId, Attribute
item_4 = ListItem(List=ptx.Model, Index=0, Wrap=True)  # -> Item, Item1, Item2, Item3, Item4
imx = ImportModel(Model=item_3.Item1)
imx_2 = ImportModel(Model=pmx.Model, File=item_3.Item)
mog_3 = ModelObjectToGroup()
imx_3 = ImportModel()
object = ModelObject(Object=imx_2)  # -> Object, Geometry, Name, Layer, Visibility, Display, Drafting, Render
fdx = FlattenDesign(Kit=dkx, DesignId=pdx.Guid)
group = NamedGroup(Group=mog_3)  # -> Group, Geometry, Name
pdd = PassthroughDesignDiff(DesignDiff=fdx)  # -> DesignDiff, Valid, Guid, Name, DesignId, IsAbstract, Folder, Description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
add = ApplyDesignDiff(Design=pdx.Design, DesignDiff=fdx)
group_2 = NamedGroup(Group=group.Geometry)  # -> Group, Geometry, Name
ppd = PassthroughPiecesDiff(PiecesDiff=pdd.PiecesDiff)  # -> PiecesDiff, Valid, PieceId, PieceDiff, Piece
pdx_2 = PassthroughDesign(Design=add)  # -> Design, Valid, Guid, Name, DesignId, IsAbstract, Folder, Description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
ppx = PassthroughPiece(Piece=pdx_2.Piece)  # -> Piece, Valid, Guid, Name, Description, TypeId, DesignId, Plane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
ppd_2 = PassthroughPieceDiff(PieceDiff=ppd.PieceDiff)  # -> PieceDiff, Valid, Guid, Name, Description, TypeId, DesignId, Plane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
pln = Plane(ppx.Plane)
