# Grasshopper definition ProfiledWoodWithMitter.gh (Grasshopper 1.0.7)
# plug-ins: Semio

pt = Point(Point(380.5513898, 192.4258079, 0))
breadth = Slider(110, range=0..300)
length = GetNumber(Slider(310, range=0..2000), AtLeast=1, AtMost=1, Maximum=1.797693135e+308, Minimum=-1.797693135e+308, TreeAccess=False)
connection_connecting = GetPoint(pt, AtLeast=1, AtMost=1, Realtime=True, TreeAccess=False)
connection_t = GetNumber(Slider(0, range=0..1), AtLeast=1, AtMost=1, Maximum=1.797693135e+308, Minimum=-1.797693135e+308, TreeAccess=False)
tiefe_der_fase_radius = Slider(3, range=0..5)
versatz_blockprofil = Slider(2, range=0..5)
anzahl_der_innennuten = Slider(2, range=0..5)
breite_der_innennut = Slider(3, range=0..5)
höhe_der_innennut = Slider(3, range=0..5)
profilhöhe = Slider(16, range=0..30)
nuttiefe = Slider(8, range=0..10)
nutbreite = Slider(5, range=0..10)
federtiefe = Slider(7, range=0..10)
federbreite = Slider(4, range=0..10)
versatz = Slider(5, range=0..30)
winkel_der_fase = Slider(30, range=0..100)
anzahl_der_elemente = Slider(1, range=1..20)
neg = Negative(Value=breadth)
konstruktionsbreite = Slider(110, range=0..300)
list = ValueList({"Ohne Innennut": 0, "Mit Innennut": 1}, selected="Mit Innennut")
xy = XYPlane(Origin=Point(0, 0, 0))
list_2 = ValueList({"Einfach": 0, "Fase": 1, "Softline": 2, "Trapez": 3, "Blockhaus": 4, "Diagonal": 5}, selected="Softline")
X = UnitX(Factor=length)
X_2 = UnitX(Factor=neg)
Y = UnitY(Factor=breadth)
move = Move(Geometry=xy, Motion=Y)  # -> Geometry, Transform
addition = Addition(A=Y, B=X_2)
move_2 = Move(Geometry=xy, Motion=X)  # -> Geometry, Transform
move_3 = Move(Geometry=move_2.Geometry, Motion=addition)  # -> Geometry, Transform
profiledwoodelements = ProfiledWoodElements(
    baseplane=xy,
    elementbreadth=konstruktionsbreite,
    elementcount=anzahl_der_elemente,
    lengthelement=length,
    profiletype=list_2,
    innergrooves=list,
    profileheight=profilhöhe,
    groovedepth=nuttiefe,
    groovebreadth=nutbreite,
    tonguedepth=federtiefe,
    tonguebreadth=federbreite,
    innergroovecount=anzahl_der_innennuten,
    innergroovebreadth=breite_der_innennut,
    innergrooveheight=höhe_der_innennut,
    chamferdepth_radius=tiefe_der_fase_radius,
    chamferangle=winkel_der_fase,
    offset=versatz,
    offsetblockprofile=versatz_blockprofil)  # -> profilewood_2, grooveport_2, tongueport_2
merge = Merge(Data1=xy, Data2=move_2.Geometry, Data3=move_3.Geometry, Data4=move.Geometry, Data5=xy)
pline = PolyLine(Vertices=merge, Closed="True")
neg_2 = Negative(Value=profilhöhe)
cutmitter = CutMitter(baseplane=xy, length=length, profilewood=profiledwoodelements.profilewood_2)
expression = Expression(x=neg_2, Expression="x/2")
area = Area(Geometry=pline)  # -> Area, Centroid
move_4 = Move(Geometry=connection_connecting, Motion=area.Centroid)  # -> Geometry, Transform
Z = UnitZ(Factor=expression)
polylineport = PolyLinePort(polylineport=pline, attracted_pointofview=move_4.Geometry, bias_t=connection_t)  # -> attractionpoint_2, attraction_lineport_2
move_5 = Move(Geometry=cutmitter, Motion=Z)  # -> Geometry, Transform
serialize = Serialize(Input=pline)
serialize_2 = Serialize(Input=move_5.Geometry)
representation = ConstructRepresentation(Body=serialize, Concepts="Wireframe")
representation_2 = ConstructRepresentation(Body=serialize_2, Concepts="Detailed")
merge_2 = Merge(Data1=representation, Data2=representation_2)
connection_point = Point(polylineport.attractionpoint_2)
compress = Compress(Input=merge_2)
representations = Text(compress)
context_bake = ContextBake(CONNECTIONPOINT=connection_point)
context_print = ContextPrint(REPRESENTATIONS=representations)

# ==== cluster PolyLinePort
polylineport = ClusterInput()
attracted_pointofview = ClusterInput()
bias_t = ClusterInput()
attracted_pointofview_2 = Point(attracted_pointofview)
polylineport_2 = Curve(polylineport)
bias_t_2 = Number(bias_t)
crv_cp = CurveClosestPoint(Point=attracted_pointofview_2, Curve=polylineport_2)  # -> Point, Parameter, Distance
explode = Explode(Curve=polylineport_2, Recursive=True)  # -> Segments, Vertices
trim = TrimTree(Tree=explode.Segments, Depth=1)
crv_cp_2 = CurveClosestPoint(Point=crv_cp.Point, Curve=trim)  # -> Point, Parameter, Distance
equalst = EqualityWithinTolerance(FirstNumber=crv_cp_2.Distance, SecondNumber="0", Tolerance=0.001)  # -> Equality, Inequality
dispatch = Dispatch(List=trim, DispatchPattern=equalst.Equality)  # -> ListA, ListB
eval = EvaluateCurve(Curve=reparameterize(dispatch.ListA), Parameter="0.5")  # -> Point, Tangent, Angle
dist = Distance(PointA=attracted_pointofview_2, PointB=eval.Point)
sort = SortList(Keys=dist, ValuesA=eval.Point, ValuesB=dispatch.ListA)  # -> Keys, ValuesA, ValuesB
item = ListItem(List=sort.ValuesA, Index=0, Wrap=True)
item_2 = ListItem(List=sort.ValuesB, Index=0, Wrap=True)
ln = Line(StartPoint=crv_cp.Point, EndPoint=item)
flip = FlipCurve(Curve=item_2, Guide=ln)  # -> Curve, Flag
eval_2 = EvaluateCurve(Curve=reparameterize(flip.Curve), Parameter=bias_t_2)  # -> Point, Tangent, Angle
attractionpoint = Point(eval_2.Point)
attraction_lineport = Line(item_2)
attractionpoint_2 = ClusterOutput(attractionpoint)
attraction_lineport_2 = ClusterOutput(attraction_lineport)

# ==== cluster ProfiledWoodElements: Create an array of profiled wood elements.
baseplane = ClusterInput()
elementbreadth = ClusterInput()
elementcount = ClusterInput()
lengthelement = ClusterInput()
profiletype = ClusterInput()
innergrooves = ClusterInput()
profileheight = ClusterInput()
groovedepth = ClusterInput()
groovebreadth = ClusterInput()
tonguedepth = ClusterInput()
tonguebreadth = ClusterInput()
innergroovecount = ClusterInput()
innergroovebreadth = ClusterInput()
innergrooveheight = ClusterInput()
chamferdepth_radius = ClusterInput()
chamferangle = ClusterInput()
offset = ClusterInput()
offsetblockprofile = ClusterInput()
profileheight_2 = Number(profileheight)
groovedepth_2 = Number(groovedepth)
tonguedepth_2 = Number(tonguedepth)
tonguebreadth_2 = Number(tonguebreadth)
innergroovecount_2 = Number(innergroovecount)
innergroovebreadth_2 = Number(innergroovebreadth)
innergrooveheight_2 = Number(innergrooveheight)
chamferangle_2 = Number(chamferangle)
offset_2 = Number(offset)
offsetblockprofile_2 = Number(offsetblockprofile)
groovebreadth_2 = Number(groovebreadth)
chamferdepth_radius_2 = Number(chamferdepth_radius)
elementbreadth_2 = Number(elementbreadth)
lengthelement_2 = Number(lengthelement)
elementcount_2 = Integer(elementcount)
profiletype_2 = Integer(profiletype)
baseplane_2 = Plane(baseplane)
innergrooves_2 = Boolean(innergrooves)

# ----
# Originally script was built with another reference plane.
# Therefore the plane is moved and the seam later adjusted.
deplane = DeconstructPlane(Plane=baseplane_2)  # -> Origin, XAxis, YAxis, ZAxis
amp = Amplitude(Vector=deplane.YAxis, Amplitude=elementbreadth_2)
move = Move(Geometry=baseplane_2, Motion=amp)  # -> Geometry, Transform
deplane_2 = DeconstructPlane(Plane=move.Geometry)  # -> Origin, XAxis, YAxis, ZAxis
rev = Reverse(Vector=deplane_2.YAxis)

line = LineSDL(Start=deplane_2.Origin, Direction=rev, Length=elementbreadth_2)
expression = Expression(x=profileheight_2, y=groovebreadth_2, Expression="(x-y)/2")
expression_2 = Expression(x=profileheight_2, y=tonguebreadth_2, Expression="(x-y)/2")
end = EndPoints(Curve=line)  # -> Start, End
line_2 = LineSDL(Start=end.End, Direction=deplane_2.ZAxis, Length=expression)
line_3 = LineSDL(Start=end.Start, Direction=deplane_2.ZAxis, Length=expression_2)
end_2 = EndPoints(Curve=line_2)  # -> Start, End
end_3 = EndPoints(Curve=line_3)  # -> Start, End
line_4 = LineSDL(Start=end_2.End, Direction=rev, Length=expr("-x", groovedepth_2))
line_5 = LineSDL(Start=end_3.End, Direction=rev, Length=expr("-x", tonguedepth_2))
merge = Merge(Data1=line_3, Data2=line_5)
end_4 = EndPoints(Curve=line_4)  # -> Start, End
end_5 = EndPoints(Curve=line_5)  # -> Start, End
line_6 = LineSDL(Start=end_4.End, Direction=deplane_2.ZAxis, Length=groovebreadth_2)
federbasis = Curve(merge)
line_7 = LineSDL(Start=end_5.End, Direction=deplane_2.ZAxis, Length=tonguebreadth_2)
end_6 = EndPoints(Curve=line_7)  # -> Start, End
end_7 = EndPoints(Curve=line_6)  # -> Start, End
line_8 = LineSDL(Start=end_6.End, Direction=rev, Length=tonguedepth_2)
line_9 = LineSDL(Start=end_7.End, Direction=rev, Length=groovedepth_2)
end_8 = EndPoints(Curve=line_8)  # -> Start, End
end_9 = EndPoints(Curve=line_9)  # -> Start, End
line_10 = LineSDL(Start=end_8.End, Direction=deplane_2.ZAxis, Length=expression_2)
line_11 = LineSDL(Start=end_9.End, Direction=deplane_2.ZAxis, Length=expression)
end_10 = EndPoints(Curve=line_10)  # -> Start, End
end_11 = EndPoints(Curve=line_11)  # -> Start, End
merge_2 = Merge(Data1=line_7, Data2=line_8)
merge_3 = Merge(Data1=line_7, Data2=line_8, Data3=line_10)
ln = Line(StartPoint=end_10.End, EndPoint=end_11.End)
blockhausfederoberseite = Curve(merge_2)
simplefederoberseite = Curve(merge_3)
merge_4 = Merge(Data1=line_9, Data2=line_6, Data3=line_4, Data4=line_2)
flip = FlipCurve(Curve=merge_4)  # -> Curve, Flag
flip_2 = FlipCurve(Curve=line_11)  # -> Curve, Flag
nutbasis = Curve(flip.Curve)
merge_5 = Merge(Data1=flip_2.Curve, Data2=nutbasis)
einfachenut = Curve(merge_5)

expression_3 = Expression(x=chamferangle_2, Expression="x+210")
rad = Radians(Degrees=expr("90-x", chamferangle_2))
expression_4 = Expression(x=profileheight_2, y=groovebreadth_2, z=offset_2, Expression="(x-y)/2+z")
expression_5 = Expression(x=chamferangle_2, Expression="x+270")
rad_2 = Radians(Degrees=expr("90-x", chamferangle_2))
rad_3 = Radians(Degrees=expression_3)
sin = Sine(Value=rad)
line_12 = LineSDL(Start=end_7.End, Direction=rev, Length=groovedepth_2)
line_13 = LineSDL(Start=end_6.End, Direction=rev, Length=expression_4)
rad_4 = Radians(Degrees=expression_5)
sin_2 = Sine(Value=rad_2)
end_12 = EndPoints(Curve=line_12)  # -> Start, End
division = Division(A=expression, B=sin)
vrot = Rotate(Vector=rev, Axis=deplane_2.XAxis, Angle=rad_3)
end_13 = EndPoints(Curve=line_13)  # -> Start, End
division_2 = Division(A=expression_2, B=sin_2)
vrot_2 = Rotate(Vector=rev, Axis=deplane_2.XAxis, Angle=rad_4)
line_14 = LineSDL(Start=end_12.End, Direction=vrot, Length=division)
line_15 = LineSDL(Start=end_13.End, Direction=vrot_2, Length=division_2)
flip_3 = FlipCurve(Curve=line_14)  # -> Curve, Flag
end_14 = EndPoints(Curve=line_15)  # -> Start, End
end_15 = EndPoints(Curve=flip_3.Curve)  # -> Start, End
ln_2 = Line(StartPoint=end_14.End, EndPoint=end_15.Start)
merge_6 = Merge(Data1=line_7, Data2=line_13)
merge_7 = Merge(Data2=line_15, Data3=ln_2, Data4=flip_3.Curve)
oberseitetrapez = Curve(merge_7)
fasenfederoberseite = Curve(merge_6)

expression_6 = Expression(x=elementbreadth_2, y=innergroovecount_2, z=innergroovebreadth_2, Expression="(x-z*y)/(y+1)")
line_16 = LineSDL(Start=deplane_2.Origin, Direction=rev, Length=expression_6)
end_16 = EndPoints(Curve=line_16)  # -> Start, End
line_17 = LineSDL(Start=end_16.End, Direction=deplane_2.ZAxis, Length=innergrooveheight_2)
end_17 = EndPoints(Curve=line_17)  # -> Start, End
line_18 = LineSDL(Start=end_17.End, Direction=rev, Length=innergroovebreadth_2)
end_18 = EndPoints(Curve=line_18)  # -> Start, End
line_19 = LineSDL(Start=end_18.End, Direction=deplane_2.ZAxis, Length=expr("-x", innergrooveheight_2))
merge_8 = Merge(Data1=line_16, Data2=line_17, Data3=line_18, Data4=line_19)
expression_7 = Expression(x=elementbreadth_2, y=innergroovecount_2, z=innergroovebreadth_2, Expression="(x-z*y)/(y+1)+z")
join = JoinCurves(Curves=merge_8, Preserve=False)
trim = TrimTree(Tree=join, Depth=1)
amp_2 = Amplitude(Vector=rev, Amplitude=expression_7)
flip_4 = FlipCurve(Curve=trim)  # -> Curve, Flag
arrlinear = LinearArray(Geometry=flip_4.Curve, Direction=amp_2, Count=innergroovecount_2)  # -> Geometry, Transform
trim_2 = TrimTree(Tree=arrlinear.Geometry, Depth=1)
join_2 = JoinCurves(Curves=trim_2, Preserve=False)
trim_3 = TrimTree(Tree=join_2, Depth=1)
end_19 = EndPoints(Curve=trim_3)  # -> Start, End
line_20 = LineSDL(Start=end_19.Start, Direction=rev, Length=expression_6)
merge_9 = Merge(Data1=line_20, Data2=trim_3)
join_3 = JoinCurves(Curves=merge_9, Preserve=False)
trim_4 = TrimTree(Tree=join_3, Depth=1)
innennut = StreamFilter(Gate=innergrooves_2, Stream0=line, Stream1=trim_4)
unterseite = Curve(innennut)

expression_8 = Expression(x=profileheight_2, y=groovebreadth_2, z=chamferdepth_radius_2, Expression="(x-y)/2-z")
rad_5 = Radians(Degrees=expr("90-x", chamferangle_2))
rad_6 = Radians(Degrees=expr("x+90", chamferangle_2))
sin_3 = Sine(Value=rad_5)
expression_9 = Expression(x=profileheight_2, y=tonguebreadth_2, z=chamferdepth_radius_2, Expression="(x-y)/2-z")
line_21 = LineSDL(Start=end_12.End, Direction=deplane_2.ZAxis, Length=expression_8)
rad_7 = Radians(Degrees=expr("90-x", chamferangle_2))
end_20 = EndPoints(Curve=line_13)  # -> Start, End
division_3 = Division(A=chamferdepth_radius_2, B=sin_3)
flip_5 = FlipCurve(Curve=line_21)  # -> Curve, Flag
vrot_3 = Rotate(Vector=rev, Axis=deplane_2.XAxis, Angle=rad_6)
rad_8 = Radians(Degrees=expr("90-x", chamferangle_2))
sin_4 = Sine(Value=rad_7)
line_22 = LineSDL(Start=end_20.End, Direction=deplane_2.ZAxis, Length=expression_9)
end_21 = EndPoints(Curve=flip_5.Curve)  # -> Start, End
line_23 = LineSDL(Start=end_21.Start, Direction=vrot_3, Length=division_3)
division_4 = Division(A=chamferdepth_radius_2, B=sin_4)
vrot_4 = Rotate(Vector=rev, Axis=deplane_2.XAxis, Angle=rad_8)
end_22 = EndPoints(Curve=line_22)  # -> Start, End
flip_6 = FlipCurve(Curve=line_23)  # -> Curve, Flag
end_23 = EndPoints(Curve=flip_6.Curve)  # -> Start, End
line_24 = LineSDL(Start=end_22.End, Direction=vrot_4, Length=division_4)
end_24 = EndPoints(Curve=line_24)  # -> Start, End
ln_3 = Line(StartPoint=end_24.End, EndPoint=end_23.Start)
merge_10 = Merge(Data1=line_22, Data2=line_24, Data3=ln_3, Data4=flip_6.Curve, Data5=flip_5.Curve)
oberseitefase = Curve(merge_10)

amp_3 = Amplitude(Vector=deplane_2.ZAxis, Amplitude=chamferdepth_radius_2)
amp_4 = Amplitude(Vector=rev, Amplitude=chamferdepth_radius_2)
amp_5 = Amplitude(Vector=rev, Amplitude=expr("-x", chamferdepth_radius_2))
amp_6 = Amplitude(Vector=deplane_2.ZAxis, Amplitude=chamferdepth_radius_2)
addition = Addition(A=amp_4, B=amp_3)
addition_2 = Addition(A=amp_5, B=amp_6)
move_2 = Move(Geometry=end_22.End, Motion=addition)  # -> Geometry, Transform
move_3 = Move(Geometry=end_21.Start, Motion=addition_2)  # -> Geometry, Transform
arc = ArcSED(Start=end_22.End, End=move_2.Geometry, Direction=deplane_2.ZAxis)  # -> Arc, Plane, Radius
arc_2 = ArcSED(Start=end_21.Start, End=move_3.Geometry, Direction=deplane_2.ZAxis)  # -> Arc, Plane, Radius
flip_7 = FlipCurve(Curve=arc_2.Arc)  # -> Curve, Flag
end_25 = EndPoints(Curve=arc.Arc)  # -> Start, End
end_26 = EndPoints(Curve=flip_7.Curve)  # -> Start, End
ln_4 = Line(StartPoint=end_25.End, EndPoint=end_26.Start)
merge_11 = Merge(Data1=line_22, Data2=arc.Arc, Data3=ln_4, Data4=flip_7.Curve, Data5=flip_5.Curve)
oberseitesoftline = Curve(merge_11)

vec2pt = Vector2Pt(PointA=end_8.End, PointB=end_11.End, Unitize=False)  # -> Vector, Length
angle = Angle(VectorA=vec2pt.Vector, VectorB=rev)  # -> Angle, Reflex
cos = Cosine(Value=angle.Angle)
division_5 = Division(A=tonguedepth_2, B=cos)
addition_3 = Addition(A=vec2pt.Length, B=division_5)
line_25 = LineSDL(Start=end_11.End, Direction=vec2pt.Vector, Length=expr("-x", addition_3))
flip_8 = FlipCurve(Curve=line_25)  # -> Curve, Flag
end_27 = EndPoints(Curve=flip_8.Curve)  # -> Start, End
ln_5 = Line(StartPoint=end_5.End, EndPoint=end_27.Start)
merge_12 = Merge(Data1=ln_5, Data2=flip_8.Curve)
oberseiteundfederdiagonal = Curve(merge_12)

expression_10 = Expression(x=profileheight_2, y=tonguebreadth_2, z=offsetblockprofile_2, Expression="(x-y)/2-z")
amp_7 = Amplitude(Vector=rev, Amplitude=expr("x/2", elementbreadth_2))
amp_8 = Amplitude(Vector=deplane_2.ZAxis, Amplitude=profileheight_2)
line_26 = LineSDL(Start=end_8.End, Direction=deplane_2.ZAxis, Length=expression_10)
addition_4 = Addition(A=amp_7, B=amp_8)
line_27 = LineSDL(Start=end_9.End, Direction=deplane_2.ZAxis, Length=expression_10)
flip_9 = FlipCurve(Curve=line_27)  # -> Curve, Flag
end_28 = EndPoints(Curve=line_26)  # -> Start, End
move_4 = Move(Geometry=deplane_2.Origin, Motion=addition_4)  # -> Geometry, Transform
end_29 = EndPoints(Curve=flip_9.Curve)  # -> Start, End
arc_3 = Arc3Pt(PointA=end_28.End, PointB=move_4.Geometry, PointC=end_29.Start)  # -> Arc, Plane, Radius
merge_13 = Merge(Data1=line_26, Data2=arc_3.Arc, Data3=flip_9.Curve)
oberseiteblockprofil = Curve(merge_13)

# ----
# Sadly the tangnet doesn't always point in the same direction.
# The join algorithm is not consistent
# and the forcing of the seam apparently has different rounding errors
# and sometimes y and sometimes the z tangent is the start tangent.
merge_14 = Merge(Data1=federbasis, Data2=fasenfederoberseite, Data3=oberseitefase, Data4=nutbasis)
merge_15 = Merge(Data1=federbasis, Data2=simplefederoberseite, Data3=ln, Data4=einfachenut)
merge_16 = Merge(Data1=federbasis, Data2=fasenfederoberseite, Data3=oberseitesoftline, Data4=nutbasis)
merge_17 = Merge(Data1=federbasis, Data2=fasenfederoberseite, Data3=oberseitetrapez, Data4=nutbasis)
merge_18 = Merge(Data1=federbasis, Data2=blockhausfederoberseite, Data3=oberseiteblockprofil, Data4=nutbasis)
merge_19 = Merge(Data1=federbasis, Data2=oberseiteundfederdiagonal, Data3=einfachenut)
fase = Curve(merge_14)
softline = Curve(merge_16)
blockhaus = Curve(merge_18)
trapez = Curve(merge_17)
diagonalprofile = Curve(merge_19)
simpleprofile = Curve(merge_15)
profil = StreamFilter(
    Gate=profiletype_2,
    Stream0=simpleprofile,
    Stream1=fase,
    Stream2=softline,
    Stream3=trapez,
    Stream4=blockhaus,
    Stream5=diagonalprofile)
join_4 = JoinCurves(Curves=profil, Preserve=True)
trim_5 = TrimTree(Tree=join_4, Depth=1)
merge_20 = Merge(Data1=trim_5, Data2=unterseite)
join_5 = JoinCurves(Curves=merge_20, Preserve=True)
trim_6 = TrimTree(Tree=join_5, Depth=1)
crv_cp = CurveClosestPoint(Point=deplane_2.Origin, Curve=trim_6)  # -> Point, Parameter, Distance
seam = Seam(Curve=trim_6, Seam=crv_cp.Parameter)
profiles = Curve(seam)

pt = Point()

crv = Curve(seam)
end_30 = EndPoints(Curve=crv)  # -> Start, End
number_slider = Slider(3, range=0..10)
crv_cp_2 = CurveClosestPoint(Point=end_30.Start, Curve=crv)  # -> Point, Parameter, Distance
eval = EvaluateCurve(Curve=crv, Parameter=crv_cp_2.Parameter)  # -> Point, Tangent, Angle
points = PointList(Points=flatten(end_30.Start), Size=number_slider)
vdisex = VectorDisplayEx(Point=end_30.Start, Vector=eval.Tangent, Colour=RGB(179, 255, 38), Width=number_slider)

amp_9 = Amplitude(Vector=deplane_2.XAxis, Amplitude=lengthelement_2)
extr = Extrude(Base=profiles, Direction=amp_9)
cap = CapHoles(Brep=extr)
amp_10 = Amplitude(Vector=deplane_2.YAxis, Amplitude=elementbreadth_2)
arrlinear_2 = LinearArray(Geometry=cap, Direction=amp_10, Count=elementcount_2)  # -> Geometry, Transform
trim_7 = TrimTree(Tree=arrlinear_2.Geometry, Depth=1)
profilewood = Brep(trim_7)

grooveport = Line(line_12)
tongueport = Line(line_5)
profilewood_2 = ClusterOutput(profilewood)
grooveport_2 = ClusterOutput(grooveport)
tongueport_2 = ClusterOutput(tongueport)

# ==== cluster CutMitter
baseplane = ClusterInput()
length = ClusterInput()
profilewood = ClusterInput()
length_2 = Number(length)
profilewood_2 = Brep(profilewood)
baseplane_2 = Plane(baseplane)
X = UnitX(Factor=length_2)
move = Move(Geometry=baseplane_2, Motion=X)  # -> Geometry, Transform
Y = UnitY(Factor=1)
line = LineSDL(Start=move.Geometry, Direction=Y, Length=1)
Z = UnitZ(Factor=1)
rotax = RotateAxis(Geometry=move.Geometry, Angle=degrees(Slider(90, range=0..100)), Axis=line)  # -> Geometry, Transform
line_2 = LineSDL(Start=move.Geometry, Direction=Z, Length=1)
rotax_2 = RotateAxis(Geometry=rotax.Geometry, Angle=degrees(Slider(45, range=0..100)), Axis=line_2)  # -> Geometry, Transform
sec = BrepPlane(Brep=profilewood_2, Plane=rotax_2.Geometry)  # -> Curves, Points
trim = TrimTree(Tree=sec.Curves, Depth=1)
split = SplitBrep(Brep=profilewood_2, Cutter=trim)
trim_2 = TrimTree(Tree=split, Depth=1)
item = ListItem(List=trim_2, Index=0, Wrap=True)  # -> Item, Item1
cap = CapHoles(Brep=item.Item1)
profilewoodwithmitter = Brep(cap)
profilewoodwithmitter_2 = ClusterOutput(profilewoodwithmitter)
