# Grasshopper definition Hybrid.gh (Grasshopper 1.0.7)
# plug-ins: Semio, Swiftlet, Human

list = ValueList({"Back", "Side"}, selected="Side")
list_2 = ValueList({"Back", "Side"}, selected="Side")
parameter = ConstructParameter(Name="Entrance", Value=list)
parameter_2 = ConstructParameter(Name="Entrance", Value=list_2)
parameter_3 = ConstructParameter(Name="Height", Value=Slider(350, range=0..1000))
panel = Panel("Height")
panel_2 = Panel("C:\Git\Studium\PhD\semio\examples\nakagincapsuletower\capsule.gh")
parameter_4 = ConstructParameter(Name="Length", Value=Slider(330, range=0..1000))
parameter_5 = ConstructParameter(Name="Length", Value=Slider(440, range=0..1000))
parameter_6 = ConstructParameter(Name="Length", Value=Slider(220, range=0..1000))
cluster = Cluster(
    X=Slider(-400, range=-1000..1000),
    Y=Slider(10, range=-1000..1000),
    Z=Slider(-5, range=-1000..1000),
    yaw=Slider(0, range=-360..360),
    pitch=Slider(0, range=-360..360),
    roll=Slider(0, range=-360..360))
panel_3 = Panel("C:\Git\Studium\PhD\semio\tests\assets\elements\ProfiledWoodWithMitter.gh")
cluster_2 = Cluster(
    X=Slider(-70, range=-1000..1000),
    Y=Slider(670, range=-1000..1000),
    Z=Slider(-5, range=-1000..1000),
    yaw=Slider(30, range=-360..360),
    pitch=Slider(35, range=-360..360),
    roll=Slider(0, range=-360..360))
cluster_3 = Cluster(
    X=Slider(-500, range=-1000..1000),
    Y=Slider(1000, range=-1000..1000),
    Z=Slider(400, range=-1000..1000),
    yaw=Slider(0, range=-360..360),
    pitch=Slider(0, range=-360..360),
    roll=Slider(180, range=-360..360))
cluster_4 = Cluster(
    X=Slider(-180, range=-1000..1000),
    Y=Slider(340, range=-1000..1000),
    Z=Slider(-5, range=-1000..1000),
    yaw=Slider(90, range=-360..360),
    pitch=Slider(0, range=-360..360),
    roll=Slider(0, range=-360..360))
cluster_5 = Cluster(
    X=Slider(-70, range=-1000..1000),
    Y=Slider(340, range=-1000..1000),
    Z=Slider(-5, range=-1000..1000),
    yaw=Slider(-90, range=-360..360),
    pitch=Slider(0, range=-360..360),
    roll=Slider(180, range=-360..360))
cluster_6 = Cluster(
    X=Slider(-400, range=-1000..1000),
    Y=Slider(10, range=-1000..1000),
    Z=Slider(-5, range=-1000..1000),
    yaw=Slider(0, range=-360..360),
    pitch=Slider(0, range=-360..360),
    roll=Slider(0, range=-360..360))
cluster_7 = Cluster(
    X=Slider(30, range=-1000..1000),
    Y=Slider(750, range=-1000..1000),
    Z=Slider(100, range=-1000..1000),
    yaw=Slider(90, range=-360..360),
    pitch=Slider(0, range=-360..360),
    roll=Slider(0, range=-360..360))
cluster_8 = Cluster(
    X=Slider(30, range=-1000..1000),
    Y=Slider(500, range=-1000..1000),
    Z=Slider(20, range=-1000..1000),
    yaw=Slider(-90, range=-360..360),
    pitch=Slider(0, range=-360..360),
    roll=Slider(180, range=-360..360))
plan = ConstructPlan(Url=panel_2, Parameters=parameter_4)  # -> Plan, Hash
plan_2 = ConstructPlan(Url=panel_2, Parameters=parameter_5)  # -> Plan, Hash
plan_3 = ConstructPlan(Url=panel_2, Parameters=parameter_6)  # -> Plan, Hash
sobject = ConstructSobject(Pose=cluster, Plan=plan.Plan)
sobject_2 = ConstructSobject(Pose=cluster_2, Plan=plan.Plan)
sobject_3 = ConstructSobject(Pose=cluster_3, Plan=plan_2.Plan)
sobject_4 = ConstructSobject(Pose=cluster_4, Plan=plan.Plan)
sobject_5 = ConstructSobject(Pose=cluster_5, Plan=plan.Plan)
sobject_6 = ConstructSobject(Pose=cluster_6, Plan=plan_2.Plan)
sobject_7 = ConstructSobject(Pose=cluster_7, Plan=plan_3.Plan)
sobject_8 = ConstructSobject(Pose=cluster_8, Plan=plan_2.Plan)
merge = Merge(Data1=cluster, Data2=cluster_5, Data3=cluster_4, Data4=cluster_2)
layout = ConstructLayout(Sobjects=sobject_6, Assembly=sobject_6)
panel_4 = Panel("Door")
link = ConstructLink(Protocol="Simple")
link_2 = ConstructLink(Protocol="Simple")
parameter_7 = ConstructParameter(Name="Gap", Value=Slider(440, range=0..1000))
layout_design = LayoutDesign(Url="http://localhost:2999", Layout=layout, Run=Toggle(True))
panel_6 = Panel("Wireframe")
connectable = ConstructConnectable(Sobject=sobject_6, Link=link)
connectable_2 = ConstructConnectable(Sobject=sobject_7, Link=link)
connectable_3 = ConstructConnectable(Sobject=sobject, Link=link_2)
connectable_4 = ConstructConnectable(Sobject=sobject_8, Link=link)
connectable_5 = ConstructConnectable(Sobject=sobject_5, Link=link_2)
connectable_6 = ConstructConnectable(Sobject=sobject_4, Link=link_2)
connectable_7 = ConstructConnectable(Sobject=sobject_2, Link=link_2)
connectable_8 = ConstructConnectable(Sobject=sobject_3, Link=link)
merge_2 = Merge(Data1=sobject, Data2=sobject_5, Data3=sobject_4, Data4=sobject_2)
design = ShowDesign(Design=layout_design, Concepts="Detailed")
merge_3 = Merge(Data1=sobject_6, Data2=sobject_8, Data3=sobject_7, Data4=sobject_3)
connection = ConstructConnection(Connecting=connectable_2, Connected=connectable_8)
connection_2 = ConstructConnection(Connecting=connectable_3, Connected=connectable_5)
connection_3 = ConstructConnection(Connecting=connectable_4, Connected=connectable_2)
connection_4 = ConstructConnection(Connecting=connectable_5, Connected=connectable_6)
connection_5 = ConstructConnection(Connecting=connectable, Connected=connectable_4)
connection_6 = ConstructConnection(Connecting=connectable_6, Connected=connectable_7)
fjs = FormatJsonString(JSONString=merge_2)
layout_2 = ConstructLayout(
    Sobjects=[sobject, sobject_5, sobject_4, sobject_2],
    Connections=[connection_2, connection_4, connection_6],
    Assembly=sobject)
layout_3 = ConstructLayout(
    Sobjects=[sobject_6, sobject_8, sobject_7, sobject_3],
    Connections=[connection_5, connection_3, connection],
    Assembly=sobject_6)
fjs_2 = FormatJsonString(JSONString=layout_3)
panel_7 = Panel(fjs)
panel_8 = Panel(fjs_2)
layout_design_2 = LayoutDesign(Url="http://localhost:2999", Layout=layout_2, Run=Toggle(False))
layout_design_3 = LayoutDesign(Url="http://localhost:2999", Layout=layout_3, Run=Toggle(True))
number_slider = Slider(100, range=0..1000)
previewplane = PreviewPlane(plane=merge, axis_length=number_slider)
number_slider_2 = Slider(100, range=0..1000)
dedesign = DeconstructDesign(Design=layout_design_2)  # -> Prototypes, Elements
panel_10 = Panel("Detailed")
dedesign_2 = DeconstructDesign(Design=layout_design_3)  # -> Prototypes, Elements
design_2 = ShowDesign(Design=layout_design_3, Concepts="Detailed")
ln = Line(StartPoint=cluster_6, EndPoint=cluster_8)
ln_2 = Line(StartPoint=cluster_8, EndPoint=cluster_7)
ln_3 = Line(StartPoint=cluster_7, EndPoint=cluster_3)
deelement = DeconstructElement(Element=dedesign.Elements)  # -> SobjectId, PlanHash, Pose
merge_4 = Merge(Data1=cluster_6, Data2=cluster_8, Data3=cluster_7, Data4=cluster_3)
design_3 = ShowDesign(Design=layout_design_2, Concepts="Wireframe")
deelement_2 = DeconstructElement(Element=dedesign_2.Elements)  # -> SobjectId, PlanHash, Pose
merge_5 = Merge(Data1=ln, Data2=ln_2, Data3=ln_3)
previewplane_2 = PreviewPlane(plane=deelement.Pose, axis_length=number_slider_2)
fjs_3 = FormatJsonString(JSONString=dedesign.Elements)
fjs_4 = FormatJsonString(JSONString=dedesign_2.Elements)
previewplane_3 = PreviewPlane(plane=deelement_2.Pose, axis_length=number_slider_2)
previewplane_4 = PreviewPlane(plane=merge_4, axis_length=number_slider)
sph = Sphere(Base=merge_4, Radius=number_slider)
preview = CustomPreview(Geometry=sph, Material=ColourSwatch(SwatchColor=RGBA(255, 199, 255, 68)))
previewlw = CustomPreviewLineweights(Geometry=merge_5, Shader=ColourSwatch(SwatchColor=RGB(255, 0, 255)), Thickness=Slider(4, range=0..10), Absolute=False)
panel_11 = Panel(fjs_3)
panel_12 = Panel(fjs_4)

# ==== cluster Cluster
X = ClusterInput()
Y = ClusterInput()
Z = ClusterInput()
yaw = ClusterInput()
pitch = ClusterInput()
roll = ClusterInput()
yawpitchroll = NAME(yaw=yaw, pitch=pitch, roll=roll)  # -> t
# ---------- yawpitchroll: Python ----------
from Rhino.Geometry import Transform
from math import radians

t = Transform.RotationZYX(radians(yaw),radians(pitch),radians(roll))
# ---------- end yawpitchroll ----------
pt = ConstructPoint(XCoordinate=X, YCoordinate=Y, ZCoordinate=Z)
xy = XYPlane(Origin=Point(0, 0, 0))
transform = Transform(Geometry=xy, Transform=yawpitchroll)
pl_origin = PlaneOrigin(Base=transform, Origin=pt)
pln = Plane(pl_origin)
pln_2 = ClusterOutput(pln)

# ==== cluster PreviewPlane: Preview a plane with axis colors and naming.
axis_length = ClusterInput()
plane = ClusterInput()
axis_length_2 = Number(axis_length)
plane_2 = Plane(plane)
deplane = DeconstructPlane(Plane=plane_2)  # -> Origin, XAxis, YAxis, ZAxis
line = LineSDL(Start=deplane.Origin, Direction=deplane.YAxis, Length=axis_length_2)
line_2 = LineSDL(Start=deplane.Origin, Direction=deplane.XAxis, Length=axis_length_2)
line_3 = LineSDL(Start=deplane.Origin, Direction=deplane.ZAxis, Length=axis_length_2)
swatch = ColourSwatch(SwatchColor=RGB(235, 52, 79))
swatch_2 = ColourSwatch(SwatchColor=RGB(0, 166, 157))
swatch_3 = ColourSwatch(SwatchColor=RGB(240, 117, 24))
end = EndPoints(Curve=line_2)  # -> Start, End
end_2 = EndPoints(Curve=line)  # -> Start, End
end_3 = EndPoints(Curve=line_3)  # -> Start, End
tag = TextTag(Location=end.End, Text="X", Colour=swatch)
tag_2 = TextTag(Location=end_2.End, Text="Y", Colour=swatch_2)
tag_3 = TextTag(Location=end_3.End, Text="Z", Colour=swatch_3)
preview = CustomPreview(Geometry=line_2, Material=swatch)
preview_2 = CustomPreview(Geometry=line, Material=swatch_2)
preview_3 = CustomPreview(Geometry=line_3, Material=swatch_3)
