# Grasshopper definition semio-ui-grasshopper-test.gh (Grasshopper 1.0.7)
# plug-ins: Swiftlet, Semio

panel = Panel("C:\Git\Studium\PhD\semio\tests\elements\RectangleWithMiter.gh")
cluster = Cluster(
    X=Slider(-91, range=-1000..1000),
    Y=Slider(-319, range=-1000..1000),
    Z=Slider(50, range=-1000..1000),
    yaw=Slider(16, range=-360..360),
    pitch=Slider(-102, range=-360..360),
    roll=Slider(-43, range=-360..360))
panel_2 = Panel(cluster)
po = Pose(cluster)
fjs = FormatJsonString(JSONString=po)
panel_3 = Panel(fjs)
cluster_2 = Cluster(
    X=Slider(226, range=-1000..1000),
    Y=Slider(39, range=-1000..1000),
    Z=Slider(279, range=-1000..1000),
    yaw=Slider(165, range=-360..360),
    pitch=Slider(-17, range=-360..360),
    roll=Slider(150, range=-360..360))
pln = Plane(po)
panel_4 = Panel(pln)
parameter = ConstructParameter(Name="Length", Value=Slider(344, range=0..1000))
parameter_2 = ConstructParameter(Name="Length", Value=Slider(220, range=0..1000))
plan = ConstructPlan(Url=panel, Parameters=parameter)  # -> Plan, Hash
plan_2 = ConstructPlan(Url=panel, Parameters=parameter_2)  # -> Plan, Hash
sobject = ConstructSobject(Pose=cluster, Plan=plan.Plan)
fjs_2 = FormatJsonString(JSONString=sobject)
panel_5 = Panel(fjs_2)
sobject_2 = ConstructSobject(Pose=cluster_2, Plan=plan_2.Plan)
fjs_3 = FormatJsonString(JSONString=sobject_2)
panel_6 = Panel(fjs_3)
parameter_3 = ConstructParameter(Name="T", Value=Slider(0, range=0..1))
link = ConstructLink(Protocol="Simple", Ports="Tongue", Bias=parameter_3)
link_2 = ConstructLink(Ports="Groove", Bias=parameter_3)
connectable = ConstructConnectable(Sobject=sobject, Link=link_2)
connectable_2 = ConstructConnectable(Sobject=sobject, Link=link)
fjs_4 = FormatJsonString(JSONString=connectable_2)
panel_7 = Panel(fjs_4)
fjs_5 = FormatJsonString(JSONString=connectable)
panel_8 = Panel(fjs_5)
connection = ConstructConnection(Connecting=connectable_2, Connected=connectable)
fjs_6 = FormatJsonString(JSONString=connection)
assembly = ConstructAssembly(Sobject=sobject)
panel_9 = Panel(fjs_6)
merge = Merge(Data1=sobject, Data2=sobject_2)
assembly_2 = ConstructAssembly(Sobject=sobject_2, Parts=assembly)
layout = ConstructLayout(Sobjects=merge, Connections=connection, Assembly=assembly_2)
fjs_7 = FormatJsonString(JSONString=assembly_2)
panel_10 = Panel(fjs_7)
fjs_8 = FormatJsonString(JSONString=layout)
panel_11 = Panel(fjs_8)
layout_design = LayoutDesign(Url="http://localhost:2999", Layout=layout, Platform="Rhino", Run=Toggle(False))
fjs_9 = FormatJsonString(JSONString=layout_design)
dedesign = DeconstructDesign(Design=layout_design)  # -> Prototypes, Elements
panel_12 = Panel(fjs_9)
deprototype = DeconstructPrototype(Prototype=dedesign.Prototypes)  # -> PlanHash, Representations, Description
derepresentation = DeconstructRepresentation(Representation=deprototype.Representations)  # -> Body, FileType, Platform, Description, Concepts, LevelOfDetail
imrepresentation = ImportRepresentation()
panel_13 = Panel(derepresentation.Body)
panel_14 = Panel(derepresentation.Platform)
panel_15 = Panel(imrepresentation)

# ==== cluster Cluster
X = ClusterInput()
Y = ClusterInput()
Z = ClusterInput()
yaw = ClusterInput()
pitch = ClusterInput()
roll = ClusterInput()
yawpitchroll = NAME(yaw=yaw, pitch=pitch, roll=roll)  # -> t
# ---------- yawpitchroll: Python ----------
from Rhino.Geometry import Transform
from math import radians

t = Transform.RotationZYX(radians(yaw),radians(pitch),radians(roll))
# ---------- end yawpitchroll ----------
pt = ConstructPoint(XCoordinate=X, YCoordinate=Y, ZCoordinate=Z)
xy = XYPlane(Origin=Point(0, 0, 0))
transform = Transform(Geometry=xy, Transform=yawpitchroll)
pl_origin = PlaneOrigin(Base=transform, Origin=pt)
pln = Plane(pl_origin)
pln_2 = ClusterOutput(pln)
