# Grasshopper definition semio-ui-grasshopper-test.gh (Grasshopper 1.0.7)
# plug-ins: Swiftlet, Semio

panel = Panel("C:\Git\Studium\PhD\semio\tests\elements\RectangleWithMiter.gh")
cluster = Cluster(
    X=Slider(-91, range=-1000..1000),
    Y=Slider(-319, range=-1000..1000),
    Z=Slider(50, range=-1000..1000),
    yaw=Slider(16, range=-360..360),
    pitch=Slider(-102, range=-360..360),
    roll=Slider(-43, range=-360..360))
panel_2 = Panel(cluster)
po = Pose(cluster)
fjs = FormatJsonString(JSONString=po)
panel_3 = Panel(fjs)
cluster_2 = Cluster(
    X=Slider(226, range=-1000..1000),
    Y=Slider(39, range=-1000..1000),
    Z=Slider(279, range=-1000..1000),
    yaw=Slider(165, range=-360..360),
    pitch=Slider(-17, range=-360..360),
    roll=Slider(150, range=-360..360))
pln = Plane(po)
panel_4 = Panel(pln)
parameter = ConstructParameter()
plan = ConstructPlan(Url=panel)
sobject = ConstructSobject()
parameter_2 = ConstructParameter(Name="Length", Value=Slider(344, range=0..1000))
parameter_3 = ConstructParameter(Name="Length", Value=Slider(220, range=0..1000))
po_2 = Pose(cluster)
po_3 = Pose(cluster_2)
sobject_2 = ConstructSobject(Pose=po_2)
fjs_2 = FormatJsonString(JSONString=sobject)
panel_5 = Panel(fjs_2)
parameter_4 = ConstructParameter(Name="T", Value=Slider(0, range=0..1))
sobject_3 = ConstructSobject(Url=panel, Pose=po_3)
fjs_3 = FormatJsonString(JSONString=sobject_3)
panel_6 = Panel(fjs_3)
panel_7 = Panel("Tongue")
panel_8 = Panel("Groove")
attraction_participant = ConstructAttractionParticipant(Participant=sobject, Protocol="Simple")
fjs_4 = FormatJsonString(JSONString=attraction_participant)
panel_9 = Panel(fjs_4)
attraction_participant_2 = ConstructAttractionParticipant(Participant=sobject_3)
fjs_5 = FormatJsonString(JSONString=attraction_participant_2)
panel_10 = Panel(fjs_5)
attraction = ConstructAttraction(Attractor=attraction_participant, Attracted=attraction_participant_2)
fjs_6 = FormatJsonString(JSONString=attraction)
attraction_tree = ConstructAttractionTree(Attraction=attraction)
panel_11 = Panel(fjs_6)
fjs_7 = FormatJsonString(JSONString=attraction_tree)
panel_12 = Panel(fjs_7)
merge = Merge(Data1=sobject, Data2=sobject_3)
layout = ConstructLayout(Sobjects=merge, Attractions=attraction, RootSobject=sobject)
fjs_8 = FormatJsonString(JSONString=layout)
panel_13 = Panel(fjs_8)
layout_2 = ConstructLayout(Sobjects=merge)
layout_design = LayoutDesign(Url="http://localhost:8081", Layout=layout, Run=False)
layout_design_2 = LayoutDesign(Url="http://localhost:8081", Layout=layout, Run=False)
dedesign = DeconstructDesign(Design=layout_design)
deprototype = DeconstructPrototype()
derepresentation = DeconstructRepresentation(Representation=deprototype)  # -> Body, FileType, Platform, Description, Concepts, LevelOfDetail
imrepresentation = ImportRepresentation()
panel_14 = Panel(imrepresentation)

# ==== cluster Cluster
X = ClusterInput()
Y = ClusterInput()
Z = ClusterInput()
yaw = ClusterInput()
pitch = ClusterInput()
roll = ClusterInput()
yawpitchroll = NAME(yaw=yaw, pitch=pitch, roll=roll)  # -> t
# ---------- yawpitchroll: Python ----------
from Rhino.Geometry import Transform
from math import radians

t = Transform.RotationZYX(radians(yaw),radians(pitch),radians(roll))
# ---------- end yawpitchroll ----------
pt = ConstructPoint(XCoordinate=X, YCoordinate=Y, ZCoordinate=Z)
xy = XYPlane(Origin=Point(0, 0, 0))
transform = Transform(Geometry=xy, Transform=yawpitchroll)
pl_origin = PlaneOrigin(Base=transform, Origin=pt)
pln = Plane(pl_origin)
pln_2 = ClusterOutput(pln)
