# Grasshopper definition speckle-hops.gh (Grasshopper 1.0.7)
# plug-ins: Hops, Semio, Speckle 2, Human

hops = Hops(
    _Path="C:\Git\Studium\PhD\semio\tests\speckle.gh",
    PointNumber=Slider(8, range=0..10),
    CacheResultsInMemory=True,
    CacheSolveResults=True,
    RemoteDefinitionLocation="C:\Git\Studium\PhD\semio\tests\speckle.gh",
    RemoteSolveVersion=(0, 1, 0),
    ShowInput_Enabled=False,
    ShowInput_Path=True,
    SynchronousSolve=True)
deserialize = Deserialize(Platform="Speckle")
dso = DeconstructSpeckleObject(SpeckleObject=deserialize, selectedKitName="Objects")
imrepresentation = ImportRepresentation()
_3dm = Read3dmFile(LayerFilter="*")  # -> Objects, LayerNames, Attributes, Units
dso_2 = DeconstructSpeckleObject(SpeckleObject=dso, selectedKitName="Objects")
geo = Geometry(dso_2)
panel = Panel(geo)
