# Grasshopper definition speckle.gh (Grasshopper 1.0.7)
# plug-ins: Speckle 2, Semio

point_number = GetInteger(Slider(10, range=0..10), AtLeast=1, AtMost=1, Maximum=2147483647, Minimum=-2147483648, TreeAccess=False)
pop2d = Populate2D(Region={Plane=PlaneXY(0, 0, 0), Size=Domain2(u=0..20, v=0..10)}, Count=point_number, Seed=1)
pt = Point(pop2d)
pt_2 = Point(Point(10, 54, 63))
box = Box2Pt(PointA=pt, PointB=pt_2, Plane=PlaneXY(0, 0, 0))
cso = CreateSpeckleObject(Test=box, selectedKitName="Objects")
cso_2 = CreateSpeckleObject(Test=box, selectedKitName="Objects")
wires = BrepWireframe(Brep=box, Density=-1)
mesh = MeshBrep(
    Brep=box,
    Settings={GridMaxCount=0, GridMinCount=16, JaggedSeams=False, MaxEdgeLength=0, MinEdgeLength=0.0001, MinTolerance=0, Refine=True, RefineAngle=0, RelativeTolerance=0.65, SimplePlanes=True, Tolerance=0})
brep = Brep(box)
serialize = Serialize(Input=mesh)
cso_3 = CreateSpeckleObject(A=cso, B=cso_2, selectedKitName="Objects")
number_slider = Slider(0, range=0..100)
serialize_2 = Serialize(Input=cso_3)
panel = Panel("""Different
Just different""")
panel_2 = Panel("""Fancy
And more""")
representation = ConstructRepresentation(
    Body=serialize_2,
    FileType="Json",
    Platform="Speckle",
    Description="Test...",
    Concepts=panel_2,
    LevelOfDetail=Slider(100, range=0..100))
representation_2 = ConstructRepresentation(Body=serialize, Description="I am different.", Concepts=panel)
merge = Merge(Data1=representation, Data2=representation_2)
derepresentation = DeconstructRepresentation(Representation=representation_2)  # -> Body, FileType, Platform, Description, Concepts, LevelOfDetail
imrepresentation = ImportRepresentation(Representation=representation_2)
txt = Text(representation_2)
txt_2 = Text(merge)
deserialize = Deserialize(Serialized=derepresentation.Body, Platform=derepresentation.Platform)
R = ContextPrint(REPRESENTATIONS=txt_2)
