# Grasshopper definition CapsuleTest.gh (Grasshopper 1.0.7)
# plug-ins: Semio, Swiftlet, Hops

cluster = Cluster(
    X=Slider(600, range=-1000..1000),
    Y=Slider(188, range=-1000..1000),
    Z=Slider(300, range=-1000..1000),
    yaw=Slider(125, range=-360..360),
    pitch=Slider(-164, range=-360..360),
    roll=Slider(87, range=-360..360))
po = Pose(cluster)
plcoord = PlaneCoordinates(System=cluster)  # -> XCoordinate, YCoordinate, ZCoordinate
pl2pl = MoveObjectPlaneToPlane(S=PlaneXY(0, 0, 0))  # -> TG; inputs S: Plane, T: Plane
# ---------- pl2pl: Python ----------
#Component Information
#--------------------------------------------------------------------------------------------
if ghenv.Component.RunCount<2:
    #General
    #--------------------------------------------------------------------------------------------
    __author__ = "Ueli Saluz"
    __version__ = "2022.12.10"
    
    ghenv.Component.Name = "MoveObjectPlaneToPlane"
    ghenv.Component.NickName = "Pl2Pl"
    ghenv.Component.Description = "Moves abitrary geometry from a source plane to a target plane."
    ghenv.Component.Message = "VER 1.1"
    ghenv.Component.Category = "Transform"
    ghenv.Component.SubCategory = "Euclidean"
    
     #Inputs
    #--------------------------------------------------------------------------------------------
    inputIndex=0
    
    ghenv.Component.Params.Input[inputIndex].Name = "Geometry"
    ghenv.Component.Params.Input[inputIndex].NickName = "G"
    ghenv.Component.Params.Input[inputIndex].Description = "Geometry to move."
    ghenv.Component.Params.Input[inputIndex].Optional = False
    inputIndex+=1
    
    ghenv.Component.Params.Input[inputIndex].Name = "SourcePlane"
    ghenv.Component.Params.Input[inputIndex].NickName = "S"
    ghenv.Component.Params.Input[inputIndex].Description = "Source plane of object."
    ghenv.Component.Params.Input[inputIndex].Optional = False
    inputIndex+=1
    
    ghenv.Component.Params.Input[inputIndex].Name = "TargetPlane"
    ghenv.Component.Params.Input[inputIndex].NickName = "T"
    ghenv.Component.Params.Input[inputIndex].Description = "Target plane of object."
    ghenv.Component.Params.Input[inputIndex].Optional = False
    inputIndex+=1
    
    #Outputs
    #--------------------------------------------------------------------------------------------
    outputIndex=0
    
    ghenv.Component.Params.Output[outputIndex].Name = "TranslatedGeometry"
    ghenv.Component.Params.Output[outputIndex].NickName = "TG"
    ghenv.Component.Params.Output[outputIndex].Description = "Translated geometry in target plane."
    outputIndex+=1


#Imports
#--------------------------------------------------------------------------------------------
import Rhino.Geometry.Transform as trsf

def MvObjPlnToPln (geo,plnObj,plnDest):
    geo.Transform(trsf.PlaneToPlane(plnObj,plnDest))
    return geo

TG = MvObjPlnToPln(G,S,T)
# ---------- end pl2pl ----------
fjs = FormatJsonString(JSONString=po)
panel = Panel(fjs)
pt = ConstructPoint(
    XCoordinate=Slider(84, range=-1000..1000),
    YCoordinate=Slider(51, range=-1000..1000),
    ZCoordinate=Slider(125, range=-1000..1000))
panel_2 = Panel("C:\Git\Studium\PhD\semio\tests\elements\Capsule_Simple.gh")
serialize = Serialize(Input=pt)
list = ValueList({"Back", "Side"}, selected="Back")
list_2 = ValueList({"Front", "Side"}, selected="Front")
list_3 = ValueList({"Back", "Side"}, selected="Back")
representation = ConstructRepresentation(Body=serialize)
panel_3 = Panel("Door")
parameter = ConstructParameter(Name="Entrance", Value=list)
parameter_2 = ConstructParameter(Name="Height", Value=Slider(280, range=0..1000))
compress = Compress(Input=representation)
cluster_2 = Cluster(
    X=Slider(600, range=-1000..1000),
    Y=Slider(0, range=-1000..1000),
    Z=Slider(300, range=-1000..1000),
    yaw=Slider(0, range=-360..360),
    pitch=Slider(0, range=-360..360),
    roll=Slider(0, range=-360..360))
cluster_3 = Cluster(
    X=Slider(300, range=-1000..1000),
    Y=Slider(0, range=-1000..1000),
    Z=Slider(0, range=-1000..1000),
    yaw=Slider(0, range=-360..360),
    pitch=Slider(0, range=-360..360),
    roll=Slider(0, range=-360..360))
cluster_4 = Cluster(
    X=Slider(600, range=-1000..1000),
    Y=Slider(0, range=-1000..1000),
    Z=Slider(0, range=-1000..1000),
    yaw=Slider(0, range=-360..360),
    pitch=Slider(0, range=-360..360),
    roll=Slider(0, range=-360..360))
sobject = ConstructSobject(Plan=panel_2)
parameter_3 = ConstructParameter(Name="Width", Value=Slider(300, range=0..1000))
parameter_4 = ConstructParameter(Name="Length", Value=Slider(550, range=0..1000))
parameter_5 = ConstructParameter(Name="Gap", Value=Slider(0, range=0..50))
plan = ConstructPlan(Url=panel_2, Parameters=parameter)  # -> Plan, Hash
hops = Hops(
    _Path=panel_2,
    Length=Slider(420, range=0..1000),
    Width=Slider(270, range=0..1000),
    Height=Slider(275, range=0..1000),
    Entrance=list_3,
    Window=list_2,
    Mirror=Toggle(False),
    ShellThickness=Slider(20, range=0..100),
    SightProtection=Toggle(False),
    CONNECTIONPORTS=" ",
    CONNECTIONPOINT=pt,
    CONNECTIONBIASGap=Slider(20, range=0..100),
    CONNECTIONBIASCorner=Toggle(False),
    CacheResultsInMemory=True,
    CacheSolveResults=True,
    RemoteDefinitionLocation="C:\Git\Studium\PhD\semio\tests\elements\Capsule_Simple.gh",
    RemoteSolveVersion=(0, 1, 0),
    ShowInput_Enabled=False,
    ShowInput_Path=True,
    SynchronousSolve=True)  # -> REPRESENTATIONS, CONNECTIONPOINT
layout = ConstructLayout(Sobjects=sobject)
sobject_2 = ConstructSobject(Pose=cluster_2, Plan=panel_2)
link = ConstructLink(Bias=[parameter_4, parameter_3])
sobject_3 = ConstructSobject(Pose=cluster_4, Plan=panel_2)
link_2 = ConstructLink(Bias=parameter_5)
sobject_4 = ConstructSobject(Pose=cluster_3, Plan=panel_2)
sobject_5 = ConstructSobject(Plan=plan.Plan)
link_3 = ConstructLink()
connectable = ConstructConnectable(Sobject=sobject_2, Link=link)
connectable_2 = ConstructConnectable(Sobject=sobject_3, Link=link_2)
connection = ConstructConnection(Connecting=sobject, Connected=sobject_5)
connectable_3 = ConstructConnectable(Sobject=sobject_4, Link=link_3)
layout_2 = ConstructLayout(Sobjects=[sobject, sobject_5], Connections=connection, Assembly=sobject)
connection_2 = ConstructConnection(Connecting=sobject, Connected=connectable_3)
connection_3 = ConstructConnection(Connecting=sobject_5, Connected=connectable_3)
connection_4 = ConstructConnection(Connecting=connectable_3, Connected=connectable_2)
connection_5 = ConstructConnection(Connecting=connectable_2, Connected=connectable)
layout_design = LayoutDesign(Url="http://localhost:2999", Layout=layout, Run=Toggle(False))
layout_design_2 = LayoutDesign(Url="http://localhost:2999", Layout=layout_2, Run=Toggle(True))
layout_3 = ConstructLayout(Sobjects=[sobject, sobject_5], Connections=[connection, connection_2, connection_3], Assembly=sobject)
layout_4 = ConstructLayout(Sobjects=[sobject, sobject_5, sobject_3], Connections=[connection, connection_2, connection_4], Assembly=sobject)
R = Representation()
layout_5 = ConstructLayout(Sobjects=[sobject, sobject_5, sobject_2], Connections=[connection, connection_2, connection_5], Assembly=sobject)
derepresentation = DeconstructRepresentation(Representation=R)  # -> Body, FileType, Platform, Description, Concepts, LevelOfDetail
layout_design_3 = LayoutDesign(Url="http://localhost:2999", Layout=layout_3, Run=Toggle(False))
layout_design_4 = LayoutDesign(Url="http://localhost:2999", Layout=layout_4, Run=Toggle(False))
layout_design_5 = LayoutDesign(Url="http://localhost:2999", Layout=layout_5, Run=Toggle(False))
design = ShowDesign(Design=layout_design_2, Concepts="Wireframe")
dedesign = DeconstructDesign(Design=layout_design_2)  # -> Prototypes, Elements
deserialize = Deserialize(Serialized=derepresentation.Body)
deprototype = DeconstructPrototype(Prototype=dedesign.Prototypes)  # -> PlanHash, Representations, Description
derepresentation_2 = DeconstructRepresentation(Representation=deprototype.Representations)  # -> Body, FileType, Platform, Description, Concepts, LevelOfDetail
item = ListItem(List=derepresentation_2.Body, Index=0, Wrap=True)  # -> Item, Item1, Item2
deserialize_2 = Deserialize(Serialized=item.Item)
fjs_2 = FormatJsonString(JSONString=layout_design_2)

# ==== cluster Cluster
X = ClusterInput()
Y = ClusterInput()
Z = ClusterInput()
yaw = ClusterInput()
pitch = ClusterInput()
roll = ClusterInput()
yawpitchroll = NAME(yaw=yaw, pitch=pitch, roll=roll)  # -> t
# ---------- yawpitchroll: Python ----------
from Rhino.Geometry import Transform
from math import radians

t = Transform.RotationZYX(radians(yaw),radians(pitch),radians(roll))
# ---------- end yawpitchroll ----------
pt = ConstructPoint(XCoordinate=X, YCoordinate=Y, ZCoordinate=Z)
xy = XYPlane(Origin=Point(0, 0, 0))
transform = Transform(Geometry=xy, Transform=yawpitchroll)
pl_origin = PlaneOrigin(Base=transform, Origin=pt)
pln = Plane(pl_origin)
pln_2 = ClusterOutput(pln)
