# Grasshopper definition Hybrid.gh (Grasshopper 1.0.7)
# plug-ins: Semio, Swiftlet

list = ValueList({"Back", "Side"}, selected="Back")
panel = Panel("Height")
parameter = ConstructParameter(Name="Entrance", Value=list)
list_2 = ValueList({"Back", "Side"}, selected="Side")
parameter_2 = ConstructParameter(Name="Length", Value=Slider(440, range=0..1000))
parameter_3 = ConstructParameter(Name="Length", Value=Slider(330, range=0..1000))
parameter_4 = ConstructParameter(Name="Entrance", Value=list_2)
parameter_5 = ConstructParameter(Name="Height", Value=Slider(350, range=0..1000))
cluster = Cluster(
    X=Slider(0, range=-1000..1000),
    Y=Slider(0, range=-1000..1000),
    Z=Slider(0, range=-1000..1000),
    yaw=Slider(45, range=-360..360),
    pitch=Slider(-45, range=-360..360),
    roll=Slider(90, range=-360..360))
cluster_2 = Cluster(
    X=Slider(366, range=-1000..1000),
    Y=Slider(155, range=-1000..1000),
    Z=Slider(425, range=-1000..1000),
    yaw=Slider(-180, range=-360..360),
    pitch=Slider(0, range=-360..360),
    roll=Slider(-180, range=-360..360))
panel_2 = Panel("C:\Git\Studium\PhD\semio\tests\elements\RectangleWithMiter.gh")
plan = ConstructPlan(Url=panel_2, Parameters=parameter_2)  # -> Plan, Hash
panel_3 = Panel("C:\Git\Studium\PhD\semio\tests\elements\Capsule_Simple.gh")
plan_2 = ConstructPlan(Uri=panel_2, Parameters=parameter_3)  # -> Plan, Hash
panel_4 = Panel("Door")
sobject = ConstructSobject(Pose=cluster, Plan=plan.Plan)
sobject_2 = ConstructSobject(Plan=plan_2.Plan)
po = Pose(cluster)
link = ConstructLink(Protocol="Simple")
fjs = FormatJsonString(JSONString=po)
connectable = ConstructConnectable(Sobject=sobject_2, Link=link)
connectable_2 = ConstructConnectable(Sobject=sobject, Link=link)
panel_5 = Panel(fjs)
connection = ConstructConnection(Connecting=connectable_2, Connected=connectable)
layout = ConstructLayout(Sobjects=[sobject, sobject_2], Assembly=sobject)
layout_2 = ConstructLayout(Sobjects=sobject)
layout_design = LayoutDesign(Url="http://localhost:2999", Layout=layout, Run=Toggle(True))
dedesign = DeconstructDesign(Design=layout_design)  # -> Prototypes, Elements
panel_6 = Panel("Wireframe")
deprototype = DeconstructPrototype(Prototype=dedesign.Prototypes)  # -> PlanHash, Representations, Description
deelement = DeconstructElement(Element=dedesign.Elements)  # -> SobjectId, PlanHash, Pose
design = ShowDesign(Design=layout_design, Concepts="Detailed")
fjs_2 = FormatJsonString(JSONString=dedesign.Elements)
po_2 = Pose(cluster)
derepresentation = DeconstructRepresentation(Representation=deprototype.Representations)  # -> Body, FileType, Platform, Description, Concepts, LevelOfDetail
panel_7 = Panel(fjs_2)
deserialize = Deserialize(Serialized=derepresentation.Body)
po_3 = Pose(cluster)
pln = Plane(cluster)
pln_2 = Plane(po_3)
po_4 = Pose(pln)
fjs_3 = FormatJsonString(JSONString=po_3)
fjs_4 = FormatJsonString(JSONString=po_4)
panel_8 = Panel(pln_2)
panel_9 = Panel(pln)
panel_10 = Panel(fjs_3)
panel_11 = Panel(fjs_4)
number_slider = Slider(200, range=0..1000)
po_5 = Pose(pln_2)
fjs_5 = FormatJsonString(JSONString=po_5)
pln_3 = Plane(po_5)
panel_12 = Panel(fjs_5)
panel_13 = Panel(pln_3)
previewplane = PreviewPlane(axis_length=number_slider)
previewplane_2 = PreviewPlane(plane=cluster, axis_length=number_slider)

# ==== cluster Cluster
X = ClusterInput()
Y = ClusterInput()
Z = ClusterInput()
yaw = ClusterInput()
pitch = ClusterInput()
roll = ClusterInput()
yawpitchroll = NAME(yaw=yaw, pitch=pitch, roll=roll)  # -> t
# ---------- yawpitchroll: Python ----------
from Rhino.Geometry import Transform
from math import radians

t = Transform.RotationZYX(radians(yaw),radians(pitch),radians(roll))
# ---------- end yawpitchroll ----------
pt = ConstructPoint(XCoordinate=X, YCoordinate=Y, ZCoordinate=Z)
xy = XYPlane(Origin=Point(0, 0, 0))
transform = Transform(Geometry=xy, Transform=yawpitchroll)
pl_origin = PlaneOrigin(Base=transform, Origin=pt)
pln = Plane(pl_origin)
pln_2 = ClusterOutput(pln)

# ==== cluster PreviewPlane: Preview a plane with axis colors and naming.
axis_length = ClusterInput()
plane = ClusterInput()
axis_length_2 = Number(axis_length)
plane_2 = Plane(plane)
deplane = DeconstructPlane(Plane=plane_2)  # -> Origin, XAxis, YAxis, ZAxis
line = LineSDL(Start=deplane.Origin, Direction=deplane.YAxis, Length=axis_length_2)
line_2 = LineSDL(Start=deplane.Origin, Direction=deplane.XAxis, Length=axis_length_2)
line_3 = LineSDL(Start=deplane.Origin, Direction=deplane.ZAxis, Length=axis_length_2)
swatch = ColourSwatch(SwatchColor=RGB(235, 52, 79))
swatch_2 = ColourSwatch(SwatchColor=RGB(0, 166, 157))
swatch_3 = ColourSwatch(SwatchColor=RGB(240, 117, 24))
end = EndPoints(Curve=line_2)  # -> Start, End
end_2 = EndPoints(Curve=line)  # -> Start, End
end_3 = EndPoints(Curve=line_3)  # -> Start, End
tag = TextTag(Location=end.End, Text="X", Colour=swatch)
tag_2 = TextTag(Location=end_2.End, Text="Y", Colour=swatch_2)
tag_3 = TextTag(Location=end_3.End, Text="Z", Colour=swatch_3)
preview = CustomPreview(Geometry=line_2, Material=swatch)
preview_2 = CustomPreview(Geometry=line, Material=swatch_2)
preview_3 = CustomPreview(Geometry=line_3, Material=swatch_3)
