# Grasshopper definition RecursiveCapsule.gh (Grasshopper 1.0.7)
# plug-ins: Semio

scale = GetNumber(Slider(2, range=0..10), AtLeast=1, AtMost=1, Maximum=1.797693135e+308, Minimum=-1.797693135e+308, TreeAccess=False)
sobject = ConstructSobject(Plan="C:\Git\Studium\PhD\semio\tests\elements\Capsule_Simple.gh")
layout = ConstructLayout(Sobjects=sobject)
layout_design = LayoutDesign(Url="http://localhost:2999", Layout=layout, Run=Toggle(True))
dedesign = DeconstructDesign(Design=layout_design)  # -> Prototypes, Elements
deprototype = DeconstructPrototype(Prototype=dedesign.Prototypes)  # -> PlanHash, Representations, Description
derepresentation = DeconstructRepresentation(Representation=deprototype.Representations)  # -> Body, FileType, Platform, Description, Concepts, LevelOfDetail
item = ListItem(List=derepresentation.Body, Index=0, Wrap=True)  # -> Item, Item1, Item2
deserialize = Deserialize(Serialized=item.Item)
scale_2 = Scale(Geometry=deserialize, Center=Point(0, 0, 0), Factor=scale)  # -> Geometry, Transform
serialize = Serialize(Input=scale_2.Geometry)
representation = ConstructRepresentation(Body=serialize)
prepare = Prepare(Input=representation)
context_bake = ContextBake(REPRESENTATIONS=prepare)
