# Grasshopper definition semio-pytest-helper.gh (Grasshopper 1.0.7)
# plug-ins: Pufferfish, Hops, LunchBox

pt = Point([Point(3, 5, 6), Point(20, 7, -5), Point(10, -4, -6), Point(-8, 10, -4)])
concat = Concatenate(FragmentA="http://127.0.0.1:5000", FragmentB="/", FragmentC="constructParameters")
concat_2 = Concatenate(FragmentA="http://127.0.0.1:5000", FragmentB="/", FragmentC="constructGrasshopperModuleProxy")
concat_3 = Concatenate(FragmentA="http://127.0.0.1:5000", FragmentB="/", FragmentC="constructSobject")
concat_4 = Concatenate(FragmentA="http://127.0.0.1:5000", FragmentB="/", FragmentC="constructAttraction")
concat_5 = Concatenate(FragmentA="http://127.0.0.1:5000", FragmentB="/", FragmentC="relativePointOfView")
concat_6 = Concatenate(FragmentA="http://127.0.0.1:5000", FragmentB="/", FragmentC="relativePointOfView")
concat_7 = Concatenate(FragmentA="http://127.0.0.1:5000", FragmentB="/", FragmentC="plane2Pose")
concat_8 = Concatenate(FragmentA="http://127.0.0.1:5000", FragmentB="/", FragmentC="pose2Plane")
cluster = Cluster_4(
    X=Slider(0, range=-1000..1000),
    Y=Slider(0, range=-1000..1000),
    Z=Slider(0, range=-1000..1000),
    yaw=Slider(0, range=-360..360),
    pitch=Slider(0, range=-360..360),
    roll=Slider(0, range=-360..360))
cluster_2 = Cluster_4(
    X=Slider(-83, range=-1000..1000),
    Y=Slider(400, range=-1000..1000),
    Z=Slider(-292, range=-1000..1000),
    yaw=Slider(0, range=-360..360),
    pitch=Slider(0, range=-360..360),
    roll=Slider(0, range=-360..360))
cluster_3 = Cluster_4(
    X=Slider(0, range=-1000..1000),
    Y=Slider(-464, range=-1000..1000),
    Z=Slider(-322, range=-1000..1000),
    yaw=Slider(45, range=-360..360),
    pitch=Slider(0, range=-360..360),
    roll=Slider(0, range=-360..360))
pt_2 = ConstructPoint(
    XCoordinate=Slider(-520, range=-1000..1000),
    YCoordinate=Slider(207, range=-1000..1000),
    ZCoordinate=Slider(-218, range=-1000..1000))
pt_3 = ConstructPoint(
    XCoordinate=Slider(0, range=-1000..1000),
    YCoordinate=Slider(0, range=-1000..1000),
    ZCoordinate=Slider(0, range=-1000..1000))
cluster_4 = Cluster_3(P=pt)
pt_4 = Point(Point(0, 0, 0))
pt_5 = Point(Point(1, 2, 0))
pt_6 = Point(Point(1, 1, 0))
cluster_5 = Cluster_4(
    X=Slider(-150, range=-1000..1000),
    Y=Slider(0, range=-1000..1000),
    Z=Slider(0, range=-1000..1000),
    yaw=Slider(0, range=-360..360),
    pitch=Slider(-45, range=-360..360),
    roll=Slider(0, range=-360..360))
pt_7 = ConstructPoint(
    XCoordinate=Slider(220, range=-1000..1000),
    YCoordinate=Slider(110, range=-1000..1000),
    ZCoordinate=Slider(0, range=-1000..1000))
pt_8 = ConstructPoint(
    XCoordinate=Slider(6, range=-1000..1000),
    YCoordinate=Slider(110, range=-1000..1000),
    ZCoordinate=Slider(156, range=-1000..1000))
merge = Merge(Data1=pt_4, Data2=pt_6, Data3=pt_5)
po = Pose("{Pose: {pointOfView: [0, 0, 0], view: [1.0, 0.0, 0.0, 0.0]}}")
hops = Hops(
    _Path=concat_7,
    Plane=cluster_2,
    CacheResultsInMemory=False,
    CacheSolveResults=False,
    RemoteDefinitionLocation="http://127.0.0.1:5000/plane2Pose",
    RemoteSolveVersion=(0, 1, 0),
    ShowInput_Enabled=False,
    ShowInput_Path=True,
    SynchronousSolve=True)  # -> Pose, PointOfView, View
crv = Curve(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)
hops_2 = Hops(
    _Path=concat_6,
    Pose=hops.Pose,
    PointOfView=pt_3,
    CacheResultsInMemory=False,
    CacheSolveResults=False,
    RemoteDefinitionLocation="http://127.0.0.1:5000/relativePointOfView",
    RemoteSolveVersion=(0, 1, 0),
    ShowInput_Enabled=False,
    ShowInput_Path=True,
    SynchronousSolve=True)  # -> LocalPointOfView, WorldPointOfView
hops_3 = Hops(
    CacheResultsInMemory=False,
    CacheSolveResults=False,
    RemoteSolveVersion=(0, 1, 0),
    ShowInput_Enabled=False,
    ShowInput_Path=True,
    SynchronousSolve=True)
cluster_6 = Cluster(pt=cluster_4)  # -> txt_3, list_2, withoutlist_2
explode = Explode(Curve=crv, Recursive=True)  # -> Segments, Vertices
hops_4 = Hops(
    _Path=concat_7,
    Plane=cluster_5,
    CacheResultsInMemory=False,
    CacheSolveResults=False,
    RemoteDefinitionLocation="http://127.0.0.1:5000/plane2Pose",
    RemoteSolveVersion=(0, 1, 0),
    ShowInput_Enabled=False,
    ShowInput_Path=True,
    SynchronousSolve=True)  # -> Pose, PointOfView, View
nurbs = NurbsCurve(Vertices=merge, Degree=Slider(1, range=0..10), Periodic=False)  # -> Curve, Length, Domain
relative = RelativeCoordinates(Plane=cluster_5, Point=pt_8)  # -> RelativePoint, RelativeX, RelativeY, RelativeZ
hops_5 = Hops(
    _Path=concat_8,
    Pose=hops.Pose,
    CacheResultsInMemory=False,
    CacheSolveResults=False,
    RemoteDefinitionLocation="http://127.0.0.1:5000/pose2Plane",
    RemoteSolveVersion=(0, 1, 0),
    ShowInput_Enabled=False,
    ShowInput_Path=True,
    SynchronousSolve=True)
crv_2 = Curve(<curve referenced from the Rhino model>)
relative_2 = RelativeCoordinates(Plane=cluster_2, Point=pt_3)  # -> RelativePoint, RelativeX, RelativeY, RelativeZ
hops_6 = Hops(
    _Path=concat_2,
    Url="C:\Git\Studium\PhD\semio\semio\tests\RectangleWithMiter.gh",
    ComputeUrl="http://localhost:6500/",
    ComputeAuthToken=" ",
    CacheResultsInMemory=True,
    CacheSolveResults=True,
    RemoteDefinitionLocation="http://127.0.0.1:5000/constructGrasshopperModuleProxy",
    RemoteSolveVersion=(0, 1, 0),
    ShowInput_Enabled=False,
    ShowInput_Path=True,
    SynchronousSolve=True)
cluster_7 = Cluster_7(
    pointofview=cluster_2,
    view=hops.View,
    point=pt_3,
    localpoint=hops_2.LocalPointOfView,
    worldpoint=hops_2.WorldPointOfView)
pln = Plane(Plane(origin=(14, -5, -9), x=(0, 0.8944197201, 0.4472285369), y=(-0.9497356045, 0.1400063072, -0.2800009207)))
cluster_8 = Cluster_8(pose2planepath=concat_8, plane2posepath=concat_7, pln=cluster_3)
move = Move(Motion=Vector(0, 0, 10))  # -> Geometry, Transform
explode_2 = Explode(Curve=crv_2, Recursive=True)  # -> Segments, Vertices
hops_7 = Hops(
    _Path=concat_6,
    Pose=hops_4.Pose,
    PointOfView=pt_7,
    CacheResultsInMemory=False,
    CacheSolveResults=False,
    RemoteDefinitionLocation="http://127.0.0.1:5000/relativePointOfView",
    RemoteSolveVersion=(0, 1, 0),
    ShowInput_Enabled=False,
    ShowInput_Path=True,
    SynchronousSolve=True)  # -> LocalPointOfView, WorldPointOfView
hops_8 = Hops(
    _Path=concat_8,
    Pose="{\"Pose\": {\"pointOfView\": [0, 0, 0], \"view\": [1.0, 0.0, 0.0, 0.0]}}",
    CacheResultsInMemory=False,
    CacheSolveResults=False,
    RemoteDefinitionLocation="http://127.0.0.1:5000/pose2Plane",
    RemoteSolveVersion=(0, 1, 0),
    ShowInput_Enabled=False,
    ShowInput_Path=True,
    SynchronousSolve=True)
rotate = Rotate(Geometry=nurbs.Curve, Angle=degrees(Slider(51, range=0..100)), Plane=PlaneXY(0, 0, 0))  # -> Geometry, Transform
panel = Panel(cluster_2)
panel_2 = Panel(hops_5)
panel_3 = Panel(hops_2.WorldPointOfView)
panel_4 = Panel(hops_2.LocalPointOfView)
panel_5 = Panel(relative_2.RelativePoint)
cluster_9 = Cluster_3(P=explode_2.Vertices)
trim = TrimTree(Tree=explode_2.Vertices, Depth=1)
hops_9 = Hops(
    _Path="C:\Git\Studium\PhD\semio\semio\tests\RectangleWithMiter.gh",
    SobjectLength=360,
    AttractedPointOfView=Point(430, 490, 25),
    BiasT=0,
    CacheResultsInMemory=True,
    CacheSolveResults=True,
    RemoteDefinitionLocation="C:\Git\Studium\PhD\semio\semio\tests\RectangleWithMiter.gh",
    RemoteSolveVersion=(0, 1, 0),
    ShowInput_Enabled=False,
    ShowInput_Path=True,
    SynchronousSolve=True)  # -> SobjectShape, AttractionPoint, AttractionPort
split = Split(Transform=rotate.Transform)
panel_6 = Panel(relative.RelativePoint)
matrix = TransformMatrix(rotate.Transform, Digits=3)
panel_7 = Panel(hops_7.LocalPointOfView)
panel_8 = Panel(hops_7.WorldPointOfView)
nickname = NAME(x=rotate.Transform)  # -> a
# ---------- nickname: Python ----------
a= x.GetQuaternion()[1]
# ---------- end nickname ----------
nickname_2 = NAME(x=rotate.Transform)  # -> a
# ---------- nickname_2: Python ----------
a = x.ToFloatArray(True)
# ---------- end nickname_2 ----------
cluster_10 = Cluster(pt=cluster_9)  # -> txt_3, list_2, withoutlist_2
cluster_11 = Cluster_4(
    X=Slider(-200, range=-1000..1000),
    Y=Slider(0, range=-1000..1000),
    Z=Slider(75, range=-1000..1000),
    yaw=Slider(0, range=-360..360),
    pitch=Slider(-45, range=-360..360),
    roll=Slider(0, range=-360..360))
trim_2 = TrimTree(Tree=nickname_2, Depth=1)
panel_9 = Panel(cluster_8)
hops_10 = Hops(
    _Path=concat,
    Names="Length",
    Values=Slider(330, range=0..1000),
    CacheResultsInMemory=True,
    CacheSolveResults=True,
    RemoteDefinitionLocation="http://127.0.0.1:5000/constructParameters",
    RemoteSolveVersion=(0, 1, 0),
    ShowInput_Enabled=False,
    ShowInput_Path=True,
    SynchronousSolve=True)
cluster_12 = Cluster_4(
    X=Slider(10, range=-1000..1000),
    Y=Slider(20, range=-1000..1000),
    Z=Slider(30, range=-1000..1000),
    yaw=Slider(0, range=-360..360),
    pitch=Slider(0, range=-360..360),
    roll=Slider(0, range=-360..360))
panel_10 = Panel(cluster_7)
hops_11 = Hops(
    _Path=concat,
    Names="Length",
    Values=Slider(330, range=0..1000),
    CacheResultsInMemory=True,
    CacheSolveResults=True,
    RemoteDefinitionLocation="http://127.0.0.1:5000/constructParameters",
    RemoteSolveVersion=(0, 1, 0),
    ShowInput_Enabled=False,
    ShowInput_Path=True,
    SynchronousSolve=True)
roundd = RoundToDecimalPlace(NumberX=trim_2, DecimalPlace=Slider(2, range=0..10), RoundType=0)  # -> Rounded, Difference
panel_11 = Panel(cluster_10.txt_3)
pt_9 = Point(Point(1, 20, -5))
hops_12 = Hops(
    _Path=concat_3,
    ModuleProxy=hops_6,
    Pose=cluster_12,
    Parameters=hops_11,
    Request=True,
    CacheResultsInMemory=False,
    CacheSolveResults=False,
    RemoteDefinitionLocation="http://127.0.0.1:5000/constructSobject",
    RemoteSolveVersion=(0, 1, 0),
    ShowInput_Enabled=False,
    ShowInput_Path=True,
    SynchronousSolve=True)  # -> SobjectJson, Geometry
hops_13 = Hops(
    _Path=concat_3,
    ModuleProxy=hops_6,
    Pose=cluster_11,
    Parameters=hops_10,
    Request=True,
    CacheResultsInMemory=False,
    CacheSolveResults=False,
    RemoteDefinitionLocation="http://127.0.0.1:5000/constructSobject",
    RemoteSolveVersion=(0, 1, 0),
    ShowInput_Enabled=False,
    ShowInput_Path=True,
    SynchronousSolve=True)  # -> SobjectJson, Geometry
nickname_3 = NAME(x=roundd.Rounded)  # -> a; inputs x: list; same code as nickname
transform = Transform(Geometry=crv, Transform=nickname_3)
pt_10 = Point(Point(-1, 49, 89))
pt_11 = ConstructPoint(XCoordinate=Slider(400, range=0..1000), YCoordinate=Slider(400, range=0..1000), ZCoordinate=0)
transform_2 = Transform(Geometry=pt_10, Transform=nickname_3)
pl2pl = MoveObjectPlaneToPlane(G=hops_12.Geometry, S=PlaneXY(0, 0, 0), T=cluster_12)  # -> TG; inputs S: Plane, T: Plane
# ---------- pl2pl: Python ----------
#Component Information
#--------------------------------------------------------------------------------------------
if ghenv.Component.RunCount<2:
    #General
    #--------------------------------------------------------------------------------------------
    __author__ = "Ueli Saluz"
    __version__ = "2022.12.10"
    
    ghenv.Component.Name = "MoveObjectPlaneToPlane"
    ghenv.Component.NickName = "Pl2Pl"
    ghenv.Component.Description = "Moves abitrary geometry from a source plane to a target plane."
    ghenv.Component.Message = "VER 1.1"
    ghenv.Component.Category = "Transform"
    ghenv.Component.SubCategory = "Euclidean"
    
     #Inputs
    #--------------------------------------------------------------------------------------------
    inputIndex=0
    
    ghenv.Component.Params.Input[inputIndex].Name = "Geometry"
    ghenv.Component.Params.Input[inputIndex].NickName = "G"
    ghenv.Component.Params.Input[inputIndex].Description = "Geometry to move."
    ghenv.Component.Params.Input[inputIndex].Optional = False
    inputIndex+=1
    
    ghenv.Component.Params.Input[inputIndex].Name = "SourcePlane"
    ghenv.Component.Params.Input[inputIndex].NickName = "S"
    ghenv.Component.Params.Input[inputIndex].Description = "Source plane of object."
    ghenv.Component.Params.Input[inputIndex].Optional = False
    inputIndex+=1
    
    ghenv.Component.Params.Input[inputIndex].Name = "TargetPlane"
    ghenv.Component.Params.Input[inputIndex].NickName = "T"
    ghenv.Component.Params.Input[inputIndex].Description = "Target plane of object."
    ghenv.Component.Params.Input[inputIndex].Optional = False
    inputIndex+=1
    
    #Outputs
    #--------------------------------------------------------------------------------------------
    outputIndex=0
    
    ghenv.Component.Params.Output[outputIndex].Name = "TranslatedGeometry"
    ghenv.Component.Params.Output[outputIndex].NickName = "TG"
    ghenv.Component.Params.Output[outputIndex].Description = "Translated geometry in target plane."
    outputIndex+=1


#Imports
#--------------------------------------------------------------------------------------------
import Rhino.Geometry.Transform as trsf

def MvObjPlnToPln (geo,plnObj,plnDest):
    geo.Transform(trsf.PlaneToPlane(plnObj,plnDest))
    return geo

TG = MvObjPlnToPln(G,S,T)
# ---------- end pl2pl ----------
yz = YZPlane(Origin=Point(0, 0, 0))
cluster_13 = Cluster_2(transform=nickname_3)  # -> array_2, quaternionarray_2, eulerarray_2
explode_3 = Explode(Curve=transform, Recursive=True)  # -> Segments, Vertices
cluster_14 = Cluster(pt=pt_10)  # -> txt_3, list_2, withoutlist_2
pdecon = Deconstruct()  # -> XComponent, YComponent, ZComponent
rotate_2 = Rotate(Geometry=hops_9.SobjectShape, Angle=degrees(Slider(90, range=0..100)), Plane=PlaneXY(0, 0, 0))  # -> Geometry, Transform
cluster_15 = Cluster(pt=transform_2)  # -> txt_3, list_2, withoutlist_2
mirror = Mirror(Geometry=hops_9.SobjectShape, Plane=yz)  # -> Geometry, Transform
cluster_16 = Cluster(pt=explode_3.Vertices)  # -> txt_3, list_2, withoutlist_2
merge_2 = Merge(Data1=mirror.Transform, Data2=rotate_2.Transform)
panel_12 = Panel(cluster_13.array_2)
matrix_2 = TransformMatrix(nickname_3, Digits=3)
panel_13 = Panel(cluster_14.list_2)
previewplane = PreviewPlane(plane=cluster_2, axis_length=Slider(200, range=0..1000))  # -> X_2, Y_2, Z_2
panel_14 = Panel(cluster_15.list_2)
panel_15 = Panel(cluster_16.list_2)
comp = Compound(Transforms=merge_2)
cluster_17 = Cluster_2(transform=mirror.Transform)  # -> array_2, quaternionarray_2, eulerarray_2
nickname_4 = NAME(x=rotate_2.Transform)  # -> a; same code as nickname
transform_3 = Transform(Geometry=hops_9.SobjectShape, Transform=comp)
panel_16 = Panel(nickname_4)
panel_17 = Panel(cluster_17.array_2)
matrix_3 = TransformMatrix(mirror.Transform, Digits=3)
panel_18 = Panel(cluster_17.eulerarray_2)
panel_19 = Panel(cluster_17.quaternionarray_2)
panel_20 = Panel("(((-0.7075520753860474, 0.0,0.7077839970588684, -380),0.0, 1.0, 0.0, 260),-0.7077839970588684, 0.0, -0.7075520753860474, -48),0.0, 0.0, 0.0, 1.0)))")
panel_21 = Panel("(((-0.7075520753860474, 0.0,0.7077839970588684, 0.0),0.0, 1.0, 0.0, 0.0),-0.7077839970588684, 0.0, -0.7075520753860474, 0.0),0.0, 0.0, 0.0, 1.0)))")
panel_22 = Panel("(((-0.7075520753860474, 0.0,0.7077839970588684, 10),0.0, 1.0, 0.0, 10),-0.7077839970588684, 0.0, -0.7075520753860474, 10),0.0, 0.0, 0.0, 1.0)))")
panel_23 = Panel("""Matrix(((-1.3435885648505064e-07, -1.0000001192092896, 0.0),
        (-1.0000001192092896, -1.3435885648505064e-07, 0.0),
        (-0.0, 0.0, -1.000000238418579)))""")
panel_24 = Panel("""Matrix(((-1.3435884227419592e-07, -1.0, 0.0, 0.0),
        (-1.0, -1.3435884227419592e-07, 0.0, 0.0),
        (0.0, 0.0, -1.0, 0.0),
        (0.0, 0.0, 0.0, 1.0)))""")
cluster_18 = Cluster_4(
    X=Slider(10, range=-1000..1000),
    Y=Slider(20, range=-1000..1000),
    Z=Slider(30, range=-1000..1000),
    yaw=Slider(0, range=-360..360),
    pitch=Slider(-135, range=-360..360),
    roll=Slider(0, range=-360..360))
pt_12 = ConstructPoint(
    XCoordinate=Slider(-380, range=-1000..1000),
    YCoordinate=Slider(260, range=-1000..1000),
    ZCoordinate=Slider(-48, range=-1000..1000))
cluster_19 = Cluster_4(
    X=Slider(-24, range=-1000..1000),
    Y=Slider(65, range=-1000..1000),
    Z=Slider(37, range=-1000..1000),
    yaw=Slider(0, range=-360..360),
    pitch=Slider(-135, range=-360..360),
    roll=Slider(0, range=-360..360))
cluster_20 = Cluster_4(
    X=Slider(-380, range=-1000..1000),
    Y=Slider(260, range=-1000..1000),
    Z=Slider(-48, range=-1000..1000),
    yaw=Slider(0, range=-360..360),
    pitch=Slider(-135, range=-360..360),
    roll=Slider(0, range=-360..360))
vec = VectorXYZ(XComponent="0", YComponent="-1", ZComponent="0")  # -> Vector, Length
vec_2 = VectorXYZ(XComponent="-1", YComponent="0", ZComponent="-1")  # -> Vector, Length
pt_13 = ConstructPoint(
    XCoordinate=Slider(-24, range=-1000..1000),
    YCoordinate=Slider(65, range=-1000..1000),
    ZCoordinate=Slider(37, range=-1000..1000))
pt_14 = Point(cluster_19)
pt_15 = ConstructPoint(XCoordinate=0, YCoordinate=0, ZCoordinate=0)
pl = ConstructPlane(Origin=cluster_20, XAxis=vec_2.Vector, YAxis=vec.Vector)
vec_3 = VectorXYZ(XComponent="-1", YComponent="0", ZComponent="-1")  # -> Vector, Length
vec_4 = VectorXYZ(XComponent="0", YComponent="1", ZComponent="0")  # -> Vector, Length
X = UnitX(Factor=1)
Y = UnitY(Factor=1)
Z = UnitZ(Factor=1)
cluster_21 = Cluster_5(matrixstring=panel_23)
rotquat = RotateQuaternion(Geometry=pt_15, Plane1=cluster_20, Plane2=PlaneYZ(0, 0, 0), Factor=Slider(0, range=0..1))  # -> Rotated, Plane, Axis, Degree, Transform
relative_3 = RelativeCoordinates(Plane=pl, Point=pt_14)  # -> RelativePoint, RelativeX, RelativeY, RelativeZ
panel_25 = Panel(pt_14)
merge_3 = Merge(Data1=X, Data2=Y, Data3=Z)
pl_2 = ConstructPlane(Origin=pt_12, XAxis=vec_3.Vector, YAxis=vec_4.Vector)
pt_16 = ConstructPoint(XCoordinate="1", YCoordinate="1", ZCoordinate="1")
matrix_4 = TransformMatrix(rotquat.Transform, Digits=3)
relative_4 = RelativeCoordinates(Plane=cluster_18, Point=pt_13)  # -> RelativePoint, RelativeX, RelativeY, RelativeZ
nickname_5 = NAME(x=cluster_21)  # -> i
# ---------- nickname_5: Python ----------
i = x.TryGetInverse()[1]
# ---------- end nickname_5 ----------
nickname_6 = NAME(x=pl)  # -> O1
# ---------- nickname_6: Python ----------
x.
# ---------- end nickname_6 ----------
panel_26 = Panel(relative_3.RelativePoint)
transform_4 = Transform(Geometry=merge_3, Transform=cluster_21)
transform_5 = Transform(Geometry=merge_3, Transform=nickname_5)
matrix_5 = TransformMatrix(cluster_21, Digits=3)
matrix_6 = TransformMatrix(nickname_5, Digits=3)
panel_27 = Panel(transform_5)
panel_28 = Panel(relative_4.RelativePoint)
panel_29 = Panel(transform_4)
hops_14 = Hops(
    CacheResultsInMemory=False,
    CacheSolveResults=False,
    RemoteSolveVersion=(0, 1, 0),
    ShowInput_Enabled=False,
    ShowInput_Path=True,
    SynchronousSolve=True)
previewplane_2 = PreviewPlane(plane=cluster_18, axis_length=Slider(200, range=0..1000))  # -> X_2, Y_2, Z_2

# ==== cluster Cluster
pt = ClusterInput()
pt_2 = Point(pt)
txt = Text(pt_2)
rep = ReplaceText(Text=txt, Find=" ", RecursiveReplace=False)
rep_2 = ReplaceText(Text=rep, Find="{", RecursiveReplace=False)
rep_3 = ReplaceText(Text=rep_2, Find="}", RecursiveReplace=False)
concat = Concatenate(FragmentA="Point3d(", FragmentB=rep_3, FragmentC=")")
concat_2 = Concatenate(FragmentA="[", FragmentB=rep_3, FragmentC="]")
join = TextJoin(Text=concat, Join=",")
join_2 = TextJoin(Text=concat_2, Join=",")
txt_2 = Text(join)
concat_3 = Concatenate(FragmentA="[", FragmentB=join_2, FragmentC="]")
txt_3 = ClusterOutput(txt_2)
list = Text(concat_3)
withoutlist = Text(join_2)
list_2 = ClusterOutput(list)
withoutlist_2 = ClusterOutput(withoutlist)

# ==== cluster Cluster_2
transform = ClusterInput()
transform_2 = Transform(transform)
nickname = NAME(x=transform_2)  # -> a, b, c
# ---------- nickname: Python ----------
a = x.ToFloatArray(True)
b = x.GetQuaternion()[1]
c = x.GetEulerZYZ()
# ---------- end nickname ----------
panel = Panel("""4
4
4
4""")
deg = Degrees(Radians=nickname.c)
partition = PartitionList(List=nickname.a, Size=panel)
item = ListItem(List=deg, Index=0, Wrap=True)  # -> Item, Item1, Item2, Item3
nickname_2 = NAME(x=nickname.b)  # -> a, b, c, d
# ---------- nickname_2: Python ----------
a = x.A
b= x.B
c = x.C
d = x.D
# ---------- end nickname_2 ----------
merge = Merge(Data1=nickname_2.a, Data2=nickname_2.b, Data3=nickname_2.c, Data4=nickname_2.d)
join = TextJoin(Text=partition, Join=",")
merge_2 = Merge(Data1=item.Item1, Data2=item.Item2, Data3=item.Item3)
trim = TrimTree(Tree=join, Depth=1)
join_2 = TextJoin(Text=merge, Join=",")
join_3 = TextJoin(Text=merge_2, Join=",")
concat = Concatenate(FragmentA="[", FragmentB=trim, FragmentC="]")
concat_2 = Concatenate(FragmentA="[", FragmentB=join_2, FragmentC="]")
concat_3 = Concatenate(FragmentA="[", FragmentB=join_3, FragmentC="]")
join_4 = TextJoin(Text=concat, Join=",")
concat_4 = Concatenate(FragmentA="[", FragmentB=join_4, FragmentC="]")
quaternionarray = Text(concat_2)
array = Text(concat_4)
eulerarray = Text(concat_3)
array_2 = ClusterOutput(array)
quaternionarray_2 = ClusterOutput(quaternionarray)
eulerarray_2 = ClusterOutput(eulerarray)

# ==== cluster Cluster_3
P = ClusterInput()
pdecon = Deconstruct(Point=P)  # -> XComponent, YComponent, ZComponent
round = Round(Number=pdecon.YComponent)  # -> Nearest, Floor, Ceiling
round_2 = Round(Number=pdecon.XComponent)  # -> Nearest, Floor, Ceiling
round_3 = Round(Number=pdecon.ZComponent)  # -> Nearest, Floor, Ceiling
pt = ConstructPoint(XCoordinate=round_2.Nearest, YCoordinate=round.Nearest, ZCoordinate=round_3.Nearest)
pt_2 = ClusterOutput(pt)

# ==== cluster Cluster_4
X = ClusterInput()
Y = ClusterInput()
Z = ClusterInput()
yaw = ClusterInput()
pitch = ClusterInput()
roll = ClusterInput()
yawpitchroll = NAME(yaw=yaw, pitch=pitch, roll=roll)  # -> t
# ---------- yawpitchroll: Python ----------
from Rhino.Geometry import Transform
from math import radians

t = Transform.RotationZYX(radians(yaw),radians(pitch),radians(roll))
# ---------- end yawpitchroll ----------
pt = ConstructPoint(XCoordinate=X, YCoordinate=Y, ZCoordinate=Z)
xy = XYPlane(Origin=Point(0, 0, 0))
transform = Transform(Geometry=xy, Transform=yawpitchroll)
pl_origin = PlaneOrigin(Base=transform, Origin=pt)
pln = Plane(pl_origin)
pln_2 = ClusterOutput(pln)

# ==== cluster PreviewPlane
axis_length = ClusterInput()
plane = ClusterInput()
expression = Expression(Expression="Format(\"{0}, {1}\", x, y)")
axis_length_2 = Number(axis_length)
plane_2 = Plane(plane)
number_slider = Slider(0.05, range=0..1)
deplane = DeconstructPlane(Plane=plane_2)  # -> Origin, XAxis, YAxis, ZAxis
line = LineSDL(Start=deplane.Origin, Direction=deplane.YAxis, Length=axis_length_2)
line_2 = LineSDL(Start=deplane.Origin, Direction=deplane.XAxis, Length=axis_length_2)
line_3 = LineSDL(Start=deplane.Origin, Direction=deplane.ZAxis, Length=axis_length_2)
swatch = ColourSwatch(SwatchColor=RGB(235, 52, 79))
swatch_2 = ColourSwatch(SwatchColor=RGB(0, 166, 157))
swatch_3 = ColourSwatch(SwatchColor=RGB(240, 117, 24))
end = EndPoints(Curve=line_2)  # -> Start, End
end_2 = EndPoints(Curve=line)  # -> Start, End
end_3 = EndPoints(Curve=line_3)  # -> Start, End
multiplication = Multiplication(A=axis_length_2, B=number_slider)
multiplication_2 = Multiplication(A=axis_length_2, B=number_slider)
multiplication_3 = Multiplication(A=axis_length_2, B=number_slider)
X = Line(line_2)
Y = Line(line)
Z = Line(line_3)
amp = Amplitude(Vector=deplane.XAxis, Amplitude=multiplication)
amp_2 = Amplitude(Vector=deplane.YAxis, Amplitude=multiplication_2)
amp_3 = Amplitude(Vector=deplane.ZAxis, Amplitude=multiplication_3)
X_2 = ClusterOutput(X)
Y_2 = ClusterOutput(Y)
Z_2 = ClusterOutput(Z)
move = Move(Geometry=end.End, Motion=amp)  # -> Geometry, Transform
move_2 = Move(Geometry=end_2.End, Motion=amp_2)  # -> Geometry, Transform
move_3 = Move(Geometry=end_3.End, Motion=amp_3)  # -> Geometry, Transform
tag = TextTag(Location=move.Geometry, Text="X", Colour=swatch)
tag_2 = TextTag(Location=move_2.Geometry, Text="Y", Colour=swatch_2)
tag_3 = TextTag(Location=move_3.Geometry, Text="Z", Colour=swatch_3)
preview = CustomPreview(Geometry=line_2, Material=swatch)
preview_2 = CustomPreview(Geometry=line, Material=swatch_2)
preview_3 = CustomPreview(Geometry=line_3, Material=swatch_3)

# ==== cluster Cluster_5
matrixstring = ClusterInput()
matrixstring_2 = Text(matrixstring)
join = TextJoin(Text=matrixstring_2)
rep = ReplaceText(Text=join, Find="Matrix", RecursiveReplace=False)
rep_2 = ReplaceText(Text=rep, Find="(", RecursiveReplace=False)
rep_3 = ReplaceText(Text=rep_2, Find=")", RecursiveReplace=False)
rep_4 = ReplaceText(Text=rep_3, Find=" ", RecursiveReplace=False)
split = TextSplit(Text=rep_4, Separators=",")
num = Number(split)
nickname = NAME(x=num)  # -> a; inputs x: list
# ---------- nickname: Python ----------
from Rhino.Geometry import Transform
a = Transform()
a.M00 = x[0]
a.M01 = x[1]
a.M02 = x[2]
a.M03 = x[3]
a.M10 = x[4]
a.M11 = x[5]
a.M12 = x[6]
a.M13 = x[7]
a.M20 = x[8]
a.M21 = x[9]
a.M22 = x[10]
a.M23 = x[11]
a.Affineize()
# ---------- end nickname ----------
transform = Transform(nickname)
transform_2 = ClusterOutput(transform)

# ==== cluster Cluster_7
pointofview = ClusterInput()
view = ClusterInput()
worldpoint = ClusterInput()
localpoint = ClusterInput()
point = ClusterInput()
pointofview_2 = Point(pointofview)
view_2 = Text(view)
worldpoint_2 = Point(worldpoint)
localpoint_2 = Point(localpoint)
point_2 = Point(point)
cluster = Cluster_6(list=view_2)
cluster_2 = Cluster(pt=point_2)  # -> txt_3, list_2, withoutlist_2
cluster_3 = Cluster(pt=pointofview_2)  # -> txt_3, list_2, withoutlist_2
cluster_4 = Cluster(pt=localpoint_2)  # -> txt_3, list_2, withoutlist_2
cluster_5 = Cluster(pt=worldpoint_2)  # -> txt_3, list_2, withoutlist_2
view_3 = Text(cluster)
merge = Merge(
    Data1=cluster_3.withoutlist_2,
    Data2=view_3,
    Data3=cluster_2.withoutlist_2,
    Data4=cluster_4.withoutlist_2,
    Data5=cluster_5.withoutlist_2)
join = TextJoin(Text=merge, Join=",")
concat = Concatenate(FragmentA="(", FragmentC=join, FragmentB="),")
pytesttuple_test_pose_getviews = Text(concat)
pytesttuple_test_pose_getviews_2 = ClusterOutput(pytesttuple_test_pose_getviews)

# ==== cluster Cluster_8
plane2posepath = ClusterInput()
pose2planepath = ClusterInput()
pln = ClusterInput()
plane2posepath_2 = Text(plane2posepath)
pose2planepath_2 = Text(pose2planepath)
pln_2 = Plane(pln)
panel = Panel(pln_2)
hops = Hops(
    _Path=plane2posepath_2,
    Plane=pln_2,
    CacheResultsInMemory=False,
    CacheSolveResults=False,
    RemoteDefinitionLocation="http://127.0.0.1:5000/plane2Pose",
    RemoteSolveVersion=(0, 1, 0),
    ShowInput_Enabled=False,
    ShowInput_Path=True,
    SynchronousSolve=True)  # -> Pose, PointOfView, View
deplane = DeconstructPlane(Plane=pln_2)  # -> Origin, XAxis, YAxis, ZAxis
cluster = Cluster(pt=hops.PointOfView)  # -> txt_3, list_2, withoutlist_2
cluster_2 = Cluster_6(list=hops.View)
cluster_3 = Cluster(pt=deplane.XAxis)  # -> txt_3, list_2, withoutlist_2
cluster_4 = Cluster(pt=deplane.YAxis)  # -> txt_3, list_2, withoutlist_2
cluster_5 = Cluster(pt=deplane.ZAxis)  # -> txt_3, list_2, withoutlist_2
hops_2 = Hops(
    _Path=pose2planepath_2,
    Pose=hops.Pose,
    CacheResultsInMemory=False,
    CacheSolveResults=False,
    RemoteDefinitionLocation="http://127.0.0.1:5000/pose2Plane",
    RemoteSolveVersion=(0, 1, 0),
    ShowInput_Enabled=False,
    ShowInput_Path=True,
    SynchronousSolve=True)
panel_2 = Panel(hops_2)
number_slider = Slider(0.1, range=0..0.1)
deplane_2 = DeconstructPlane(Plane=hops_2)  # -> Origin, XAxis, YAxis, ZAxis
merge = Merge(
    Data1=cluster.withoutlist_2,
    Data2=cluster_2,
    Data3=cluster_3.withoutlist_2,
    Data4=cluster_4.withoutlist_2,
    Data5=cluster_5.withoutlist_2)
equalst = EqualityWithinTolerance(FirstNumber=deplane_2.Origin, SecondNumber=deplane.Origin, Tolerance=number_slider)  # -> Equality, Inequality
equalst_2 = EqualityWithinTolerance(FirstNumber=deplane_2.XAxis, SecondNumber=deplane.XAxis, Tolerance=number_slider)  # -> Equality, Inequality
equalst_3 = EqualityWithinTolerance(FirstNumber=deplane_2.YAxis, SecondNumber=deplane.YAxis, Tolerance=number_slider)  # -> Equality, Inequality
equalst_4 = EqualityWithinTolerance(FirstNumber=deplane.ZAxis, SecondNumber=deplane_2.ZAxis, Tolerance=number_slider)  # -> Equality, Inequality
join = TextJoin(Text=merge, Join=",")
and = GateAnd(A=equalst.Equality, B=equalst_2.Equality, C=equalst_3.Equality, D=equalst_4.Equality)
concat = Concatenate(FragmentA="(", FragmentC=join, FragmentB="),")
filter = StreamFilter(Gate=and, Stream1=concat)
test_translator_pose = Text(filter)
test_translator_pose_2 = ClusterOutput(test_translator_pose)

# ==== cluster Cluster_6
list = ClusterInput()
list_2 = Text(list)
join = TextJoin(Text=list_2, Join=",")
concat = Concatenate(FragmentA="[", FragmentC=join, FragmentB="]")
pythonlist = Text(concat)
pythonlist_2 = ClusterOutput(pythonlist)
