# Grasshopper definition plane.gh (Grasshopper 1.0.8)

crv = Curve([<curve referenced from the Rhino model> x14])
panel = Panel("""<DreiLine
	// name="z-axis"
	points = {[[0, 0, 0],[0, 1, 0]]}
	color={colors.tertiary}
	lineWidth={2}
/>""")
line = Line(graft(crv))
end = EndPoints(Curve=line)  # -> Start, End
cluster = Cluster(pt=end.Start)
cluster_2 = Cluster(pt=end.End)
panel_2 = Panel("""	color={colors.lightGrey}
	lineWidth={2}
/>""")
join = TextJoin(Text=cluster, Join=",")
panel_3 = Panel("""<DreiLine
	points = {[""")
concat = Concatenate(FragmentA=panel_3, FragmentB=join, FragmentC=",", FragmentD=cluster_2, FragmentG="]}", FragmentE=panel_2)
trim = TrimTree(Tree=concat, Depth=1)
panel_4 = Panel(trim)

# ==== cluster Cluster
pt = ClusterInput()
pt_2 = Point(pt)
pdecon = Deconstruct(Point=pt_2)  # -> XComponent, YComponent, ZComponent
neg = Negative(Value=pdecon.YComponent)
merge = Merge(Data1=graft(pdecon.XComponent), Data2=graft(pdecon.ZComponent), Data3=graft(neg))
join = TextJoin(Text=merge, Join=",")
concat = Concatenate(FragmentA="[", FragmentC=join, FragmentB="]")
trim = TrimTree(Tree=concat, Depth=1)
txt = Text(trim)
txt_2 = ClusterOutput(txt)
